# Grasshopper definition CemGrasshopperC#.gh (Grasshopper 1.0.7)
# plug-ins: Human

number_slider = Slider(59.6, range=0..200)  # disabled
number_slider_2 = Slider(81, range=0..200)  # disabled
number_slider_3 = Slider(54.5, range=0..200)  # disabled
xy_plane = XYPlane(Origin=Point(0, 650, 0))  # disabled

number_slider_4 = Slider(35, range=0..200)  # disabled
number_slider_5 = Slider(50, range=0..200)  # disabled
number_slider_6 = Slider(40, range=0..200)  # disabled
xy_plane_2 = XYPlane(Origin=Point(0, 900, 0))  # disabled

number_slider_7 = Slider(100, range=0..200)  # disabled
number_slider_8 = Slider(60, range=0..200)  # disabled
number_slider_9 = Slider(62, range=0..200)  # disabled
xy_plane_3 = XYPlane(Origin=Point(0, 1200, 0))  # disabled

# ----
# Furnitures!
xy_plane_4 = XYPlane(Origin=Point(0, 0, 0))

number_slider_10 = Slider(62.1, range=0..200)  # disabled
number_slider_11 = Slider(50, range=0..200)  # disabled
number_slider_12 = Slider(35, range=0..200)  # disabled
xy_plane_5 = XYPlane(Origin=Point(0, 400, 0))  # disabled

number_slider_13 = Slider(27.5, range=0..200)  # disabled
number_slider_14 = Slider(54.5, range=0..200)  # disabled
number_slider_15 = Slider(5, range=0..200)  # disabled
xy_plane_6 = XYPlane(Origin=Point(0, 200, 0))  # disabled

number_slider_16 = Slider(0, range=0..1000)  # disabled
number_slider_17 = Slider(107, range=100..120)  # disabled
number_slider_18 = Slider(76, range=50..200)  # disabled
number_slider_19 = Slider(75, range=50..200)  # disabled
number_slider_20 = Slider(243, range=0..1000)  # disabled
number_slider_21 = Slider(450, range=0..1000)  # disabled
number_slider_22 = Slider(623, range=0..1000)  # disabled
number_slider_23 = Slider(54, range=40..60)  # disabled
number_slider_24 = Slider(45, range=40..60)  # disabled
number_slider_25 = Slider(89, range=80..100)  # disabled
number_slider_26 = Slider(85, range=40..90)  # disabled
number_slider_27 = Slider(34, range=30..40)  # disabled
number_slider_28 = Slider(13, range=5..15)  # disabled
number_slider_29 = Slider(29, range=25..30)  # disabled
number_slider_30 = Slider(5, range=5..10)  # disabled
number_slider_31 = Slider(62, range=60..80)  # disabled
vector_xyz = VectorXYZ(XComponent=number_slider_16, YComponent=0, ZComponent=0)  # -> Vector, Length; disabled
vector_xyz_2 = VectorXYZ(XComponent=number_slider_20, YComponent=0, ZComponent=0)  # -> Vector, Length; disabled
vector_xyz_3 = VectorXYZ(XComponent=number_slider_22, YComponent=0, ZComponent=0)  # -> Vector, Length; disabled
vector_xyz_4 = VectorXYZ(XComponent=number_slider_21, YComponent=0, ZComponent=0)  # -> Vector, Length; disabled
multipurpose_table_for_2 = DomainBox(Base=vector_xyz.Vector, X=number_slider_18, Y=number_slider_17, Z=number_slider_19)  # disabled
sitting_unit = DomainBox(Base=vector_xyz_2.Vector, X=number_slider_24, Y=number_slider_23, Z=number_slider_25)  # disabled
monitor = DomainBox(Base=vector_xyz_4.Vector, X=number_slider_26, Y=number_slider_30, Z=number_slider_31)  # disabled
first_aid_closet = DomainBox(Base=vector_xyz_3.Vector, X=number_slider_27, Y=number_slider_28, Z=number_slider_29)  # disabled

number_slider_32 = Slider(1392, range=0..2000)  # disabled
number_slider_33 = Slider(1000, range=0..1000)  # disabled
number_slider_34 = Slider(40, range=35..45)  # disabled
number_slider_35 = Slider(60, range=50..65)  # disabled
number_slider_36 = Slider(2, range=2..220)  # disabled
number_slider_37 = Slider(60, range=55..65)  # disabled
number_slider_38 = Slider(230, range=110..230)  # disabled
number_slider_39 = Slider(210, range=2..220)  # disabled
vector_xyz_5 = VectorXYZ(XComponent=Slider(806, range=0..1000), YComponent=0, ZComponent=0)  # -> Vector, Length
vector_xyz_6 = VectorXYZ(XComponent=number_slider_33, YComponent=0, ZComponent=0)  # -> Vector, Length; disabled
vector_xyz_7 = VectorXYZ(XComponent=number_slider_32, YComponent=0, ZComponent=0)  # -> Vector, Length; disabled
closet = DomainBox(Base=vector_xyz_7.Vector, X=number_slider_38, Y=number_slider_37, Z=number_slider_39)  # disabled
connection_point = DomainBox(Base=vector_xyz_5.Vector, X=Slider(100, range=90..100), Y=Slider(10, range=5..15), Z=Slider(200, range=150..220))
changeover_zone = DomainBox(Base=vector_xyz_6.Vector, X=number_slider_35, Y=number_slider_34, Z=number_slider_36)  # disabled

# ----
# right
# right
# front
# front
# PERSONAL SPACE
number_slider_40 = Slider(0, range=0..100)  # disabled
number_slider_41 = Slider(293, range=0..2000)  # disabled
number_slider_42 = Slider(207, range=0..300)  # disabled
number_slider_43 = Slider(109, range=0..300)  # disabled
number_slider_44 = Slider(30, range=0..100)  # disabled
number_slider_45 = Slider(207, range=0..300)  # disabled
number_slider_46 = Slider(109, range=0..300)  # disabled
number_slider_47 = Slider(30, range=0..100)  # disabled
number_slider_48 = Slider(80, range=0..100)  # disabled
number_slider_49 = Slider(40, range=0..100)  # disabled
number_slider_50 = Slider(40, range=0..300)  # disabled
number_slider_51 = Slider(506, range=0..2000)  # disabled
number_slider_52 = Slider(80, range=0..100)  # disabled
number_slider_53 = Slider(40, range=0..100)  # disabled
number_slider_54 = Slider(40, range=0..300)  # disabled
number_slider_55 = Slider(711, range=0..2000)  # disabled
vector_xyz_8 = VectorXYZ(XComponent=number_slider_40, YComponent=0, ZComponent=0)  # -> Vector, Length; disabled
vector_xyz_9 = VectorXYZ(XComponent=0, YComponent=number_slider_41, ZComponent=0)  # -> Vector, Length; disabled
vector_xyz_10 = VectorXYZ(XComponent=0, YComponent=number_slider_51, ZComponent=0)  # -> Vector, Length; disabled
bed = DomainBox(Base=vector_xyz_8.Vector, X=number_slider_42, Y=number_slider_43, Z=number_slider_44)  # disabled
vector_xyz_11 = VectorXYZ(XComponent=0, YComponent=number_slider_55, ZComponent=0)  # -> Vector, Length; disabled
personal_closet = DomainBox(Base=vector_xyz_10.Vector, X=number_slider_48, Y=number_slider_49, Z=number_slider_50)  # disabled
personal_closet1 = DomainBox(Base=vector_xyz_11.Vector, X=number_slider_52, Y=number_slider_53, Z=number_slider_54)  # disabled
bed1 = DomainBox(Base=vector_xyz_9.Vector, X=number_slider_45, Y=number_slider_46, Z=number_slider_47)  # disabled
deconstruct_box = DeconstructBox(Box=bed)  # -> Plane, X, Y, Z; disabled
number_slider_56 = Slider(60, range=0..100)  # disabled
deconstruct_box_2 = DeconstructBox(Box=bed1)  # -> Plane, X, Y, Z; disabled
deconstruct_box_3 = DeconstructBox(Box=personal_closet)  # -> Plane, X, Y, Z; disabled
number_slider_57 = Slider(60, range=0..100)  # disabled
deconstruct_box_4 = DeconstructBox(Box=personal_closet1)  # -> Plane, X, Y, Z; disabled
number_slider_58 = Slider(40, range=0..100)  # disabled
number_slider_59 = Slider(40, range=0..100)  # disabled
deconstruct_domain = DeconstructDomain(Domain=deconstruct_box.Y)  # -> Start, End; disabled
deconstruct_domain_2 = DeconstructDomain(Domain=deconstruct_box_2.Y)  # -> Start, End; disabled
deconstruct_domain_3 = DeconstructDomain(Domain=deconstruct_box_3.Y)  # -> Start, End; disabled
deconstruct_domain_4 = DeconstructDomain(Domain=deconstruct_box_4.Y)  # -> Start, End; disabled
addition = Addition(A=deconstruct_domain.End, B=number_slider_56)  # disabled
addition_2 = Addition(A=deconstruct_domain_2.End, B=number_slider_57)  # disabled
addition_3 = Addition(A=deconstruct_domain_3.End, B=number_slider_58)  # disabled
addition_4 = Addition(A=deconstruct_domain_4.End, B=number_slider_59)  # disabled
construct_domain = ConstructDomain(DomainStart=deconstruct_domain.Start, DomainEnd=addition)  # disabled
construct_domain_2 = ConstructDomain(DomainStart=deconstruct_domain_2.Start, DomainEnd=addition_2)  # disabled
construct_domain_3 = ConstructDomain(DomainStart=deconstruct_domain_3.Start, DomainEnd=addition_3)  # disabled
construct_domain_4 = ConstructDomain(DomainStart=deconstruct_domain_4.Start, DomainEnd=addition_4)  # disabled
domain_box = DomainBox(Base=PlaneXY(0, 0, 0), X=deconstruct_box.X, Y=construct_domain, Z=deconstruct_box.Z)  # disabled
domain_box_2 = DomainBox(Base=bed1, X=deconstruct_box_2.X, Y=construct_domain_2, Z=deconstruct_box_2.Z)  # disabled
domain_box_3 = DomainBox(Base=personal_closet, X=deconstruct_box_3.X, Y=construct_domain_3, Z=deconstruct_box_3.Z)  # disabled
domain_box_4 = DomainBox(Base=personal_closet1, X=deconstruct_box_4.X, Y=construct_domain_4, Z=deconstruct_box_4.Z)  # disabled

# ----
# WET AREA
# left
# right
# front
# front
# front
# front
# front
number_slider_60 = Slider(0, range=0..100)  # disabled
number_slider_61 = Slider(60, range=0..100)  # disabled
number_slider_62 = Slider(15, range=0..100)  # disabled
number_slider_63 = Slider(80, range=0..100)  # disabled
number_slider_64 = Slider(0, range=-1000..100)  # disabled
number_slider_65 = Slider(50, range=0..100)  # disabled
number_slider_66 = Slider(60, range=0..300)  # disabled
number_slider_67 = Slider(80, range=0..100)  # disabled
number_slider_68 = Slider(200, range=0..300)  # disabled
number_slider_69 = Slider(54, range=0..100)  # disabled
number_slider_70 = Slider(-76, range=-100..101)  # disabled
number_slider_71 = Slider(80, range=0..100)  # disabled
number_slider_72 = Slider(0, range=0..100)  # disabled
number_slider_73 = Slider(36, range=0..100)  # disabled
number_slider_74 = Slider(210, range=0..300)  # disabled
number_slider_75 = Slider(80, range=0..100)  # disabled
vector_xyz_12 = VectorXYZ(XComponent=number_slider_70, YComponent=0, ZComponent=0)  # -> Vector, Length; disabled
vector_xyz_13 = VectorXYZ(XComponent=number_slider_60, YComponent=0, ZComponent=0)  # -> Vector, Length; disabled
vector_xyz_14 = VectorXYZ(XComponent=number_slider_72, YComponent=0, ZComponent=0)  # -> Vector, Length; disabled
vector_xyz_15 = VectorXYZ(XComponent=number_slider_64, YComponent=0, ZComponent=0)  # -> Vector, Length; disabled
vector_xyz_16 = VectorXYZ(XComponent=Slider(-199, range=-1000..100), YComponent=0, ZComponent=0)  # -> Vector, Length
toılet = DomainBox(Base=vector_xyz_12.Vector, X=number_slider_73, Y=number_slider_69, Z=number_slider_65)  # disabled
dressing_cabin = DomainBox(Base=vector_xyz_15.Vector, X=number_slider_67, Y=number_slider_63, Z=number_slider_68)  # disabled
mirror_cupboard = DomainBox(Base=vector_xyz_13.Vector, X=number_slider_61, Y=number_slider_62, Z=number_slider_66)  # disabled
shower_cabin = DomainBox(Base=vector_xyz_14.Vector, X=number_slider_71, Y=number_slider_75, Z=number_slider_74)  # disabled
sink_cupboard = DomainBox(Base=vector_xyz_16.Vector, X=Slider(55, range=0..100), Y=Slider(40, range=0..100), Z=Slider(85, range=0..300))
deconstruct_box_5 = DeconstructBox()  # -> Plane, X, Y, Z; disabled
deconstruct_box_6 = DeconstructBox(Box=toılet)  # -> Plane, X, Y, Z; disabled
deconstruct_box_7 = DeconstructBox()  # -> Plane, X, Y, Z; disabled
number_slider_76 = Slider(30, range=0..101)  # disabled
number_slider_77 = Slider(60, range=0..100)  # disabled
number_slider_78 = Slider(20, range=0..100)  # disabled
deconstruct_box_8 = DeconstructBox(Box=mirror_cupboard)  # -> Plane, X, Y, Z; disabled
deconstruct_box_9 = DeconstructBox(Box=shower_cabin)  # -> Plane, X, Y, Z; disabled
deconstruct_box_10 = DeconstructBox(Box=dressing_cabin)  # -> Plane, X, Y, Z; disabled
number_slider_79 = Slider(60, range=0..100)  # disabled
deconstruct_box_11 = DeconstructBox(Box=sink_cupboard)  # -> Plane, X, Y, Z
number_slider_80 = Slider(85, range=0..100)  # disabled
number_slider_81 = Slider(60, range=0..100)  # disabled
deconstruct_domain_5 = DeconstructDomain(Domain=deconstruct_box_6.X)  # -> Start, End; disabled
deconstruct_domain_6 = DeconstructDomain(Domain=deconstruct_box_7.Y)  # -> Start, End; disabled
deconstruct_domain_7 = DeconstructDomain(Domain=deconstruct_box_5.X)  # -> Start, End; disabled
deconstruct_domain_8 = DeconstructDomain(Domain=deconstruct_box_9.Y)  # -> Start, End; disabled
deconstruct_domain_9 = DeconstructDomain(Domain=deconstruct_box_8.Y)  # -> Start, End; disabled
deconstruct_domain_10 = DeconstructDomain(Domain=deconstruct_box_10.Y)  # -> Start, End; disabled
deconstruct_domain_11 = DeconstructDomain(Domain=deconstruct_box_11.Y)  # -> Start, End
addition_5 = Addition(A=deconstruct_domain_5.End, B=number_slider_78)  # disabled
addition_6 = Addition(A=deconstruct_domain_6.End, B=number_slider_77)  # disabled
subtraction = Subtraction(A=deconstruct_domain_7.Start, B=number_slider_76)  # disabled
addition_7 = Addition(A=deconstruct_domain_9.End, B=number_slider_80)  # disabled
addition_8 = Addition(A=deconstruct_domain_8.End, B=number_slider_79)  # disabled
addition_9 = Addition(A=deconstruct_domain_10.End, B=number_slider_81)  # disabled
addition_10 = Addition(A=deconstruct_domain_11.End, B=Slider(60, range=0..100))
construct_domain_5 = ConstructDomain(DomainStart=deconstruct_domain_5.Start, DomainEnd=addition_5)  # disabled
construct_domain_6 = ConstructDomain(DomainStart=deconstruct_domain_6.Start, DomainEnd=addition_6)  # disabled
construct_domain_7 = ConstructDomain(DomainStart=deconstruct_domain_7.Start, DomainEnd=subtraction)  # disabled
construct_domain_8 = ConstructDomain(DomainStart=deconstruct_domain_9.Start, DomainEnd=addition_7)  # disabled
construct_domain_9 = ConstructDomain(DomainStart=deconstruct_domain_8.Start, DomainEnd=addition_8)  # disabled
construct_domain_10 = ConstructDomain(DomainStart=deconstruct_domain_10.Start, DomainEnd=addition_9)  # disabled
construct_domain_11 = ConstructDomain(DomainStart=deconstruct_domain_11.Start, DomainEnd=addition_10)
domain_box_5 = DomainBox(Base=toılet, X=construct_domain_5, Y=deconstruct_box_6.Y, Z=deconstruct_box_6.Z)  # disabled
domain_box_6 = DomainBox(Base=PlaneXY(0, 0, 0), X=construct_domain_7, Y=deconstruct_box_5.Y, Z=deconstruct_box_5.Z)  # disabled
domain_box_7 = DomainBox(Base=PlaneXY(0, 0, 0), X=deconstruct_box_7.X, Y=construct_domain_6, Z=deconstruct_box_7.Z)  # disabled
domain_box_8 = DomainBox(Base=mirror_cupboard, X=deconstruct_box_8.X, Y=construct_domain_8, Z=deconstruct_box_8.Z)  # disabled
domain_box_9 = DomainBox(Base=shower_cabin, X=deconstruct_box_9.X, Y=construct_domain_9, Z=deconstruct_box_9.Z)  # disabled
domain_box_10 = DomainBox(Base=dressing_cabin, X=deconstruct_box_10.X, Y=construct_domain_10, Z=deconstruct_box_10.Z)  # disabled
domain_box_11 = DomainBox(Base=sink_cupboard, X=deconstruct_box_11.X, Y=construct_domain_11, Z=deconstruct_box_11.Z)

stove = DomainBox(Base=PlaneXY(0, 0, 0), X=number_slider_13, Y=number_slider_14, Z=number_slider_15)  # disabled
sink = DomainBox(Base=PlaneXY(0, 0, 0), X=Slider(54, range=0..200), Y=Slider(44, range=0..200), Z=Slider(19, range=0..200))
counter = DomainBox(Base=PlaneXY(0, 0, 0), X=number_slider_7, Y=number_slider_8, Z=number_slider_9)  # disabled
cupboard = DomainBox(Base=PlaneXY(0, 0, 0), X=number_slider_5, Y=number_slider_4, Z=number_slider_6)  # disabled
mıcrowave = DomainBox(Base=PlaneXY(0, 0, 0), X=number_slider_10, Y=number_slider_11, Z=number_slider_12)  # disabled
frıdge = DomainBox(Base=PlaneXY(0, 0, 0), X=number_slider, Y=number_slider_3, Z=number_slider_2)  # disabled
# Margins!
custom_preview_materials = CustomPreviewMaterials(Geometry=sink, DiffuseColor=RGB(174, 215, 230), Transparency=Slider(0, range=0..1))

deconstruct_box_12 = DeconstructBox(Box=mıcrowave)  # -> Plane, X, Y, Z; disabled
deconstruct_domain_12 = DeconstructDomain(Domain=deconstruct_box_12.Y)  # -> Start, End; disabled
number_slider_82 = Slider(80, range=0..1000)  # disabled
addition_11 = Addition(A=deconstruct_domain_12.End, B=number_slider_82)  # disabled
construct_domain_12 = ConstructDomain(DomainStart=deconstruct_domain_12.Start, DomainEnd=addition_11)  # disabled
microwave_margin = DomainBox(Base=deconstruct_box_12.Plane, X=deconstruct_box_12.X, Y=construct_domain_12, Z=deconstruct_box_12.Z)  # disabled

deconstruct_box_13 = DeconstructBox(Box=frıdge)  # -> Plane, X, Y, Z; disabled
deconstruct_domain_13 = DeconstructDomain(Domain=deconstruct_box_13.Y)  # -> Start, End; disabled
number_slider_83 = Slider(80, range=0..1000)  # disabled
addition_12 = Addition(A=deconstruct_domain_13.End, B=number_slider_83)  # disabled
construct_domain_13 = ConstructDomain(DomainStart=deconstruct_domain_13.Start, DomainEnd=addition_12)  # disabled
fridge_margin = DomainBox(Base=deconstruct_box_13.Plane, X=deconstruct_box_13.X, Y=construct_domain_13, Z=deconstruct_box_13.Z)  # disabled

deconstruct_box_14 = DeconstructBox(Box=sink)  # -> Plane, X, Y, Z
deconstruct_domain_14 = DeconstructDomain(Domain=deconstruct_box_14.Z)  # -> Start, End
deconstruct_domain_15 = DeconstructDomain(Domain=deconstruct_box_14.Y)  # -> Start, End
addition_13 = Addition(A=deconstruct_domain_14.End, B=Slider(123, range=0..1000))
addition_14 = Addition(A=deconstruct_domain_15.End, B=Slider(85, range=0..1000))
addition_15 = Addition(A=deconstruct_domain_15.Start, B=Slider(-10, range=-10..1000))
construct_domain_14 = ConstructDomain(DomainStart=deconstruct_domain_14.Start, DomainEnd=addition_13)
construct_domain_15 = ConstructDomain(DomainStart=addition_15, DomainEnd=addition_14)
sink_margin = DomainBox(Base=deconstruct_box_14.Plane, X=deconstruct_box_14.X, Y=construct_domain_15, Z=construct_domain_14)

deconstruct_box_15 = DeconstructBox(Box=stove)  # -> Plane, X, Y, Z; disabled
number_slider_84 = Slider(123, range=0..1000)  # disabled
deconstruct_domain_16 = DeconstructDomain(Domain=deconstruct_box_15.Z)  # -> Start, End; disabled
deconstruct_domain_17 = DeconstructDomain(Domain=deconstruct_box_15.Y)  # -> Start, End; disabled
number_slider_85 = Slider(80, range=0..1000)  # disabled
addition_16 = Addition(A=deconstruct_domain_16.End, B=number_slider_84)  # disabled
addition_17 = Addition(A=deconstruct_domain_17.End, B=number_slider_85)  # disabled
construct_domain_16 = ConstructDomain(DomainStart=deconstruct_domain_16.Start, DomainEnd=addition_16)  # disabled
construct_domain_17 = ConstructDomain(DomainStart=deconstruct_domain_17.Start, DomainEnd=addition_17)  # disabled
stove_margin = DomainBox(Base=deconstruct_box_15.Plane, X=deconstruct_box_15.X, Y=construct_domain_17, Z=construct_domain_16)  # disabled

deconstruct_box_16 = DeconstructBox(Box=counter)  # -> Plane, X, Y, Z; disabled
number_slider_86 = Slider(75, range=0..1000)  # disabled
deconstruct_domain_18 = DeconstructDomain(Domain=deconstruct_box_16.Z)  # -> Start, End; disabled
deconstruct_domain_19 = DeconstructDomain(Domain=deconstruct_box_16.Y)  # -> Start, End; disabled
number_slider_87 = Slider(80, range=0..1000)  # disabled
addition_18 = Addition(A=deconstruct_domain_18.End, B=number_slider_86)  # disabled
construct_domain_18 = ConstructDomain(DomainStart=deconstruct_domain_18.Start, DomainEnd=addition_18)  # disabled
addition_19 = Addition(A=deconstruct_domain_19.End, B=number_slider_87)  # disabled
construct_domain_19 = ConstructDomain(DomainStart=deconstruct_domain_19.Start, DomainEnd=addition_19)  # disabled
counter_margin = DomainBox(Base=deconstruct_box_16.Plane, X=deconstruct_box_16.X, Y=construct_domain_19, Z=construct_domain_18)  # disabled

deconstruct_box_17 = DeconstructBox(Box=cupboard)  # -> Plane, X, Y, Z; disabled
number_slider_88 = Slider(13, range=0..1000)  # disabled
deconstruct_domain_20 = DeconstructDomain(Domain=deconstruct_box_17.Z)  # -> Start, End; disabled
deconstruct_domain_21 = DeconstructDomain(Domain=deconstruct_box_17.Y)  # -> Start, End; disabled
number_slider_89 = Slider(-75, range=-100..1000)  # disabled
number_slider_90 = Slider(105, range=0..1000)  # disabled
addition_20 = Addition(A=deconstruct_domain_20.Start, B=number_slider_89)  # disabled
addition_21 = Addition(A=deconstruct_domain_20.End, B=number_slider_88)  # disabled
addition_22 = Addition(A=deconstruct_domain_21.End, B=number_slider_90)  # disabled
construct_domain_20 = ConstructDomain(DomainStart=addition_20, DomainEnd=addition_21)  # disabled
construct_domain_21 = ConstructDomain(DomainStart=deconstruct_domain_21.Start, DomainEnd=addition_22)  # disabled
cupboard_margin = DomainBox(Base=deconstruct_box_17.Plane, X=deconstruct_box_17.X, Y=construct_domain_21, Z=construct_domain_20)  # disabled

deconstruct_box_18 = DeconstructBox(Box=multipurpose_table_for_2)  # -> Plane, X, Y, Z; disabled
deconstruct_box_19 = DeconstructBox(Box=sitting_unit)  # -> Plane, X, Y, Z; disabled
deconstruct_box_20 = DeconstructBox(Box=monitor)  # -> Plane, X, Y, Z; disabled
deconstruct_box_21 = DeconstructBox(Box=connection_point)  # -> Plane, X, Y, Z
deconstruct_box_22 = DeconstructBox(Box=changeover_zone)  # -> Plane, X, Y, Z; disabled
deconstruct_box_23 = DeconstructBox(Box=closet)  # -> Plane, X, Y, Z; disabled
number_slider_91 = Slider(57, range=0..500)  # disabled
number_slider_92 = Slider(57, range=0..500)  # disabled
number_slider_93 = Slider(57, range=0..500)  # disabled
number_slider_94 = Slider(168, range=0..500)  # disabled
number_slider_95 = Slider(57, range=0..500)  # disabled
number_slider_96 = Slider(210, range=0..210)  # disabled
panel = Panel(deconstruct_box_18.X)  # disabled
number_slider_97 = Slider(60, range=0..60)  # disabled
deconstruct_domain_22 = DeconstructDomain(Domain=deconstruct_box_18.X)  # -> Start, End; disabled
deconstruct_domain_23 = DeconstructDomain(Domain=deconstruct_box_18.Y)  # -> Start, End; disabled
number_slider_98 = Slider(57, range=0..500)  # disabled
deconstruct_domain_24 = DeconstructDomain(Domain=deconstruct_box_18.Y)  # -> Start, End; disabled
deconstruct_domain_25 = DeconstructDomain(Domain=deconstruct_box_18.Y)  # -> Start, End; disabled
panel_2 = Panel(deconstruct_box_21.X)
deconstruct_domain_26 = DeconstructDomain(Domain=deconstruct_box_18.Y)  # -> Start, End; disabled
deconstruct_domain_27 = DeconstructDomain(Domain=deconstruct_box_21.X)  # -> Start, End
panel_3 = Panel(deconstruct_box_22.X)  # disabled
deconstruct_domain_28 = DeconstructDomain(Domain=deconstruct_box_22.Y)  # -> Start, End; disabled
deconstruct_domain_29 = DeconstructDomain(Domain=deconstruct_box_22.Z)  # -> Start, End; disabled
panel_4 = Panel(deconstruct_box_23.X)  # disabled
deconstruct_domain_30 = DeconstructDomain(Domain=deconstruct_box_23.X)  # -> Start, End; disabled
addition_23 = Addition(A=deconstruct_domain_22.End, B=number_slider_91)  # disabled
addition_24 = Addition(A=deconstruct_domain_23.End, B=number_slider_92)  # disabled
addition_25 = Addition(A=deconstruct_domain_24.End, B=number_slider_93)  # disabled
addition_26 = Addition(A=deconstruct_domain_25.End, B=number_slider_94)  # disabled
addition_27 = Addition(A=deconstruct_domain_26.End, B=number_slider_95)  # disabled
addition_28 = Addition(A=deconstruct_domain_27.End, B=Slider(57, range=0..500))
addition_29 = Addition(A=deconstruct_domain_28.End, B=number_slider_97)  # disabled
addition_30 = Addition(A=deconstruct_domain_29.End, B=number_slider_96)  # disabled
addition_31 = Addition(A=deconstruct_domain_30.End, B=number_slider_98)  # disabled
# Margin :  Front 80
#                 Left 55
#                 Top 135
#                 Bottom 72
construct_domain_22 = ConstructDomain(DomainStart=deconstruct_domain_22.Start, DomainEnd=addition_23)  # disabled
# Margin :  Back 30
#                  Top  121
construct_domain_23 = ConstructDomain(DomainStart=deconstruct_domain_23.Start, DomainEnd=addition_24)  # disabled
# Margin :  Back 50
#                  Top  121
construct_domain_24 = ConstructDomain(DomainStart=deconstruct_domain_24.Start, DomainEnd=addition_25)  # disabled
# Margin :  Front 100
construct_domain_25 = ConstructDomain(DomainStart=deconstruct_domain_25.Start, DomainEnd=addition_26)  # disabled
# Margin :  Front 29
construct_domain_26 = ConstructDomain(DomainStart=deconstruct_domain_26.Start, DomainEnd=addition_27)  # disabled
# Margin :  Front 100
construct_domain_27 = ConstructDomain(DomainStart=deconstruct_domain_27.Start, DomainEnd=addition_28)
construct_domain_28 = ConstructDomain(DomainStart=deconstruct_domain_28.Start, DomainEnd=addition_29)  # disabled
# Margin :  Front 60
# Margin :  Top 210
construct_domain_29 = ConstructDomain(DomainStart=deconstruct_domain_29.Start, DomainEnd=addition_30)  # disabled
# Margin : 65
construct_domain_30 = ConstructDomain(DomainStart=deconstruct_domain_30.Start, DomainEnd=addition_31)  # disabled
panel_5 = Panel(construct_domain_22)  # disabled
panel_6 = Panel(construct_domain_23)  # disabled
domain_box_12 = DomainBox(Base=multipurpose_table_for_2, X=construct_domain_22, Y=deconstruct_box_18.Y, Z=deconstruct_box_18.Z)  # disabled
domain_box_13 = DomainBox(Base=multipurpose_table_for_2, X=deconstruct_box_19.X, Y=deconstruct_box_19.Y, Z=deconstruct_box_19.Z)  # disabled
panel_7 = Panel(construct_domain_24)  # disabled
domain_box_14 = DomainBox(Base=multipurpose_table_for_2, X=construct_domain_24, Y=Domain(-0.5, 0.5), Z=Domain(0, 0.25))  # disabled
panel_8 = Panel(construct_domain_25)  # disabled
domain_box_15 = DomainBox(Base=multipurpose_table_for_2, X=construct_domain_25, Y=Domain(-0.5, 0.5), Z=Domain(0, 0.25))  # disabled
panel_9 = Panel(construct_domain_26)  # disabled
domain_box_16 = DomainBox(Base=multipurpose_table_for_2, X=construct_domain_26, Y=Domain(-0.5, 0.5), Z=Domain(0, 0.25))  # disabled
panel_10 = Panel(construct_domain_27)
domain_box_17 = DomainBox(Base=connection_point, X=construct_domain_27, Y=deconstruct_box_21.Y, Z=deconstruct_box_21.Z)
panel_11 = Panel(construct_domain_28)  # disabled
panel_12 = Panel(construct_domain_29)  # disabled
domain_box_18 = DomainBox(Base=changeover_zone, X=deconstruct_box_22.X, Y=construct_domain_28, Z=construct_domain_29)  # disabled
panel_13 = Panel(construct_domain_30)  # disabled
domain_box_19 = DomainBox(Base=closet, X=construct_domain_30, Y=deconstruct_box_23.Y, Z=deconstruct_box_23.Z)  # disabled
number_slider_99 = Slider(1, range=0..1)  # disabled
number_slider_100 = Slider(1, range=0..1)  # disabled
number_slider_101 = Slider(1, range=0..1)  # disabled
number_slider_102 = Slider(1, range=0..1)  # disabled
number_slider_103 = Slider(1, range=0..1)  # disabled
custom_preview_materials_2 = CustomPreviewMaterials(Geometry=stove_margin, DiffuseColor=RGB(174, 215, 230), Transparency=number_slider_99)  # disabled
custom_preview_materials_3 = CustomPreviewMaterials(Geometry=microwave_margin, DiffuseColor=RGB(174, 215, 230), Transparency=number_slider_100)  # disabled
custom_preview_materials_4 = CustomPreviewMaterials(Geometry=fridge_margin, DiffuseColor=RGB(174, 215, 230), Transparency=number_slider_101)  # disabled
custom_preview_materials_5 = CustomPreviewMaterials(Geometry=cupboard_margin, DiffuseColor=RGB(174, 215, 230), Transparency=number_slider_102)  # disabled
custom_preview_materials_6 = CustomPreviewMaterials(Geometry=counter_margin, DiffuseColor=RGB(174, 215, 230), Transparency=number_slider_103)  # disabled

# ---- group: Voxel Initilize
bounding_box = BoundingBox(Content=sink_margin, Plane=PlaneXY(0, 0, 0))  # -> Box, Box_2; disabled
number_slider_104 = Slider(0.7, range=0..1)  # disabled
box_corners = BoxCorners(Box=bounding_box.Box)  # -> CornerA, CornerB, CornerC, CornerD, CornerE, CornerF, CornerG, CornerH; disabled
dimensions = Dimensions()  # -> UDimension, VDimension; disabled
custom_preview_materials_7 = CustomPreviewMaterials(Geometry=sink_margin, DiffuseColor=RGB(174, 215, 230), Transparency=number_slider_104)  # disabled
distance = Distance(PointA=box_corners.CornerA, PointB=box_corners.CornerB)  # disabled
distance_2 = Distance(PointA=box_corners.CornerA, PointB=box_corners.CornerD)  # disabled
distance_3 = Distance(PointA=box_corners.CornerA, PointB=box_corners.CornerD)  # disabled
number_slider_105 = Slider(91, range=0..10000)  # disabled
mesh = Mesh(sink_margin)  # disabled
populate_geometry = PopulateGeometry(Geometry=mesh, Count=number_slider_105, Seed=1)  # disabled
octree = OcTree(Points=populate_geometry, Square=False, Group=5)  # -> Boxes, Points; disabled

# ----
construct_domain_31 = ConstructDomain(DomainStart=0, DomainEnd=1)  # disabled
number_slider_106 = Slider(10, range=0..10)  # disabled
number_slider_107 = Slider(30, range=0..100)  # disabled
number_slider_108 = Slider(10, range=0..10)  # disabled
number_slider_109 = Slider(10, range=0..10)  # disabled
number_slider_110 = Slider(1, range=0..10)  # disabled
number_slider_111 = Slider(42, range=0..100)  # disabled
number_slider_112 = Slider(2, range=0..10)  # disabled
multiplication = Multiplication(A=number_slider_107, B=number_slider_106)  # disabled
multiplication_2 = Multiplication(A=number_slider_108, B=number_slider_110)  # disabled
multiplication_3 = Multiplication(A=number_slider_111, B=number_slider_109)  # disabled
c_script = CSharpScript(width=number_slider_111, length=number_slider_107, cellSize=multiplication_2)  # -> out, A, R, G, B, Y, K, W; inputs width: Int32, length: Int32, height: Int32, cellSize: Int32; disabled
# ---------- c_script: C# ----------
    var WhiteCircles = new List<Circle>();
    /*public Zone(int spaceLimit,int spacesize,int counter, List<int> spaceList)*/

    var kitchen = new Zone
      {
        SpaceLimit = 20,
        SpaceSize = 300,
        Counter = 1,
        Id = 1
        };

    var wetArea = new Zone
      {
        SpaceLimit = 20,
        SpaceSize = 300,
        Counter = 1,
        Id = 2
        };

    var commonArea = new Zone
      {
        SpaceLimit = 20,
        SpaceSize = 300,
        Counter = 1,
        Id = 3
        };

    var entrance = new Zone
      {
        SpaceLimit = 20,
        SpaceSize = 300,
        Counter = 1,
        Id = 4
        };

    var personalSpace = new Zone
      {
        SpaceLimit = 20,
        SpaceSize = 300,
        Counter = 1 ,
        Id = 5
        };

    int[,,] areaArray = InitializeZeroMatrice(length, width);

    entrance.StartColors(areaArray);
    wetArea.StartColors(areaArray);
    personalSpace.StartColors(areaArray);
    kitchen.StartColors(areaArray);
    commonArea.StartColors(areaArray);

    for(int i = 0; i < 500; i++)
    {
      entrance.SpreadZone(areaArray, entrance.SpaceSize, entrance.SpaceList, ref entrance.Counter, entrance.SpaceLimit);
      wetArea.SpreadZone(areaArray, wetArea.SpaceSize, wetArea.SpaceList, ref  wetArea.Counter, wetArea.SpaceLimit);
      personalSpace.SpreadZone(areaArray, personalSpace.SpaceSize, personalSpace.SpaceList, ref personalSpace.Counter, personalSpace.SpaceLimit);
      kitchen.SpreadZone(areaArray, kitchen.SpaceSize, kitchen.SpaceList, ref kitchen.Counter, kitchen.SpaceLimit);
      commonArea.SpreadZone(areaArray, commonArea.SpaceSize, commonArea.SpaceList, ref commonArea.Counter, commonArea.SpaceLimit);
    }

    //Zone.ShowMatrix(areaArray);


    double radius = cellSize / 2;
    for (int i = 0;i < areaArray.GetLength(0) ;i++)
    {
      for (int j = 0;j < areaArray.GetLength(1);j++)
      {
        for (int k = 0;k < areaArray.GetLength(2);k++)
        {
          if (areaArray[i, j, k] == 1)
          {
            Point3d center = new Point3d(j * cellSize, i * cellSize, 0);
            Circle c = new Circle(center, radius);
            entrance.Circles.Add(c);
          }
          if (areaArray[i, j, k] == 2)
          {
            Point3d center = new Point3d(j * cellSize, i * cellSize, 0);
            Circle c = new Circle(center, radius);
            wetArea.Circles.Add(c);
          }
          if (areaArray[i, j, k] == 3)
          {
            Point3d center = new Point3d(j * cellSize, i * cellSize, 0);
            Circle c = new Circle(center, radius);
            personalSpace.Circles.Add(c);
          }
          if (areaArray[i, j, k] == 4)
          {
            Point3d center = new Point3d(j * cellSize, i * cellSize, 0);
            Circle c = new Circle(center, radius);
            kitchen.Circles.Add(c);
          }
          if (areaArray[i, j, k] == 5)
          {
            Point3d center = new Point3d(j * cellSize, i * cellSize, 0);
            Circle c = new Circle(center, radius);
            commonArea.Circles.Add(c);
          }

          if (areaArray[i, j, k] == 0)
          {
            Point3d center = new Point3d(j * cellSize, i * cellSize, 0);
            Circle c = new Circle(center, radius);
            WhiteCircles.Add(c);
          }
        }
      }
    }

    A = areaArray;
    R = entrance.Circles;
    G = wetArea.Circles;
    B = personalSpace.Circles;
    Y = kitchen.Circles;
    K = commonArea.Circles;
    W = WhiteCircles;
# ---------- c_script: C# additional code ----------
  /* The Color lists keep the colors in a seperate List in order to choose within them easily instead of searching where they are... */

  static int[,,] InitializeZeroMatrice(int width, int length)
  {
    var areaArray = new int[width, length, 3];

    for (int i = 0; i < width; i++)
    {
      for (int j = 0; j < length; j++)
      {
        for (int k = 0; k < 3; k++)
        {
          areaArray[i, j, k] = 0;
        }
      }
    }
    return areaArray;
  }

  /* Calculates the distance between initial point in the color and the possible new point!
   *  (if the possible new point is too far from inital point eleminate it.) */


  static void Evaluate()
  {
    // according to relations give score to the created zones
    // get the centers of the zones and acoording to the distances and created sizes give
    //positive or negative points and if score is not acceptable re-run and create variatians.
  }


    /* Instead of wrting methods seperately in main program, it is better to use class based
     informations to keep things organized, we are not yet transsferred methods here but we created the str.*/


  public class Zone
  {
    public int SpaceLimit;
    public int SpaceSize;
    public int Counter;
    public int Id;
    public List<int> SpaceList;
    public List<Circle> Circles = new List<Circle>();

    public Zone() // Constructor method
    {
      SpaceList = new List<int>();
      Circles = new List<Circle>();
    }

    public Zone(int spaceLimit, int spacesize, int counter, int id)
      :this()
    {
      this.SpaceLimit = spaceLimit;
      this.Counter = counter;
      this.SpaceSize = spacesize;
      this.Id = id;
    }

    static void ShowMatrix(int[,,] Arr)
    {
      ////Print("");
      for (int i = 0; i < Arr.GetLength(0); i++)
      {
        for (int j = 0; j < Arr.GetLength(1); j++)
        {
          ////Print(Arr[i, j].ToString() + " ");
        }
        ////Print("");
      }
      ////Print("   ");
      return;
    }

    static double distanceCalculate(List<int> spaceCoordList, int x2, int y2)
    {
      var distance = Math.Sqrt((y2 - spaceCoordList[1]) * (y2 - spaceCoordList[1]) + (x2 - spaceCoordList[0]) * (x2 - spaceCoordList[0]));
      return distance;
    }

    public void StartColors(int[,,] arr)
    {

      /**
       * Randomly Starts the color. Takes the Color lists as argumnts
       * (We can delete these argumnents and it can get them as local referance
       * in our case it gives us a chance to choose what to initilize)
       * **/

      Random rand = new Random();
      //----------------------
      /* GetLength(0) and GetLength(1) might be set as variable */
      var a = rand.Next(0, arr.GetLength(0)); //Array.GetLength(0) gives the column lenght in other words length of an array
      var b = rand.Next(0, arr.GetLength(1)); //Array.GetLength(1) gives the row lenght in other words width of an array

      this.SpaceList.AddRange(new int[2] { a, b }); //AddRange ==> Adds multiple elements to a List . We use mod%2 to call the index of the point back instead of stacking them as an another List(or Array) in our list.
      arr[a, b, 0] = this.Id;//  Starting Point
    }

    public void SpreadZone(int[,,] arr, int spaceSize, List<int> spaceCoordList, ref int counter, int spaceLimit)
    {
              /*ARGUMENTS
           * The main array which has rectangular form(will be 3d in short) ,
           * spaceSize = Maximum limit that can grow.  ,
           * spaceCoordList =  the cells of the zone which has been already defined. )
           */
      var rand = new Random();
      var directionList = new List<int>();
      int Xcoord;
      int Ycoord;
      bool draw = false;
      int trycount = 0;

      while (draw == false && counter <= spaceSize)
      {
        if (counter <= spaceSize) //Can be deleted. The condition is added to the While Loop Conditions.
        {
          ////Print("Counter Number is : {0}\n", counter);
          ////Print("Element number of the list {0}", spaceCoordList.Count / 2);
          var randomCellIndex = rand.Next(spaceCoordList.Count / 2);

          Xcoord = spaceCoordList[2 * randomCellIndex];
          Ycoord = spaceCoordList[2 * randomCellIndex + 1];

          //Print("Coordinates if the new Cell is = {0}, {1}\n", Xcoord, Ycoord);

          if (Xcoord < arr.GetLength(0) - 1 && Xcoord > 0 && Ycoord > 0 && Ycoord < arr.GetLength(1) - 1)
          {
            /* Check the conditions INSIDE borders */
            if (arr[Xcoord + 1, Ycoord, 0] == 0 && distanceCalculate(spaceCoordList, Xcoord + 1, Ycoord) < spaceLimit ) // Check if possible new cell is still white or not!
              directionList.AddRange(new int[2] { (Xcoord + 1), Ycoord }); //Store possible spread directions in a list.

            if (arr[Xcoord - 1, Ycoord, 0] == 0 && distanceCalculate(spaceCoordList, Xcoord - 1, Ycoord) < spaceLimit)
              directionList.AddRange(new int[2] { (Xcoord - 1), Ycoord }); //Store possible spread directions in a list.

            if (arr[Xcoord, Ycoord + 1, 0] == 0 && distanceCalculate(spaceCoordList, Xcoord, Ycoord + 1) < spaceLimit)
              directionList.AddRange(new int[2] { (Xcoord), Ycoord + 1 }); //Store possible spread directions in a list.

            if (arr[Xcoord, Ycoord - 1, 0] == 0 && distanceCalculate(spaceCoordList, Xcoord, Ycoord - 1) < spaceLimit)
              directionList.AddRange(new int[2] { (Xcoord), (Ycoord - 1) }); //Store possible spread directions in a list.

            if (directionList.Count > 0)
            {
              var randomIndex = rand.Next(directionList.Count / 2);

              int a = directionList[2 * randomIndex];
              int b = directionList[2 * randomIndex + 1];
              //print("Value of Xcoord and Ycoord: {0}, {1}", Xcoord, Ycoord);
              //Print("Value of new Coordinates: {0}, {1}", a, b);
              //Print("Value of initial value of Array[a, b]: {0}", arr[a, b]);

              arr[a, b, 0] = arr[Xcoord, Ycoord, 0];
              //Print("Value of new Array[a, b]: {0}", arr[a, b]);

              spaceCoordList.AddRange(new int[2] { a, b });

              directionList.Clear();
              directionList.TrimExcess();
              draw = true;
              counter++;
            }
            else
            {
              trycount++;
              if (trycount >= spaceCoordList.Count)
              {
                draw = true;
                //Print("trycountNumber is ={0}", trycount);
              }
            }
          }
            /* EDGE CONDITIONS */
            //BOTTOM
          else if (Xcoord == (arr.GetLength(0) - 1) && Ycoord != 0 && Ycoord != (arr.GetLength(1) - 1))
          {
            if (arr[Xcoord - 1, Ycoord, 0] == 0)
            {
              arr[Xcoord - 1, Ycoord, 0] = arr[Xcoord, Ycoord, 0];

              int a = Xcoord - 1;
              int b = Ycoord;

              spaceCoordList.AddRange(new int[2] { a, b });

              draw = true;
              counter++;
              //Print(" Counter Number is : {0}", counter);
            }
          }
            //TOP
          else if (Xcoord == 0 && Ycoord != 0 && Ycoord != (arr.GetLength(1) - 1))
          {
            if (arr[Xcoord + 1, Ycoord, 0] == 0)
            {
              arr[Xcoord + 1, Ycoord, 0] = arr[Xcoord, Ycoord, 0];

              int a = Xcoord + 1;
              int b = Ycoord;

              spaceCoordList.AddRange(new int[2] { a, b });

              draw = true;
              counter++;
              //Print(" Counter Number is : {0}", counter);
            }
          }
            //RIGHT
          else if ((Ycoord == arr.GetLength(1) - 1) && Xcoord != 0 && Xcoord != (arr.GetLength(0) - 1))
          {
            if (arr[Xcoord, Ycoord - 1, 0] == 0)
            {
              arr[Xcoord, Ycoord - 1, 0] = arr[Xcoord, Ycoord, 0];

              int a = Xcoord;
              int b = Ycoord - 1;

              spaceCoordList.AddRange(new int[2] { a, b });

              draw = true;
              counter++;
              //Print(" Counter Number is : {0}", counter);
            }
          }
            //LEFT
          else if (Ycoord == 0 && Xcoord != 0 && Xcoord != (arr.GetLength(0) - 1))
          {
            if (arr[Xcoord, Ycoord + 1, 0] == 0)
            {
              arr[Xcoord, Ycoord + 1, 0] = arr[Xcoord, Ycoord, 0];

              int a = Xcoord;
              int b = Ycoord + 1;

              arr[Xcoord, Ycoord + 1, 0] = arr[Xcoord, Ycoord, 0];

              spaceCoordList.AddRange(new int[2] { a, b });

              draw = true;
              counter++;
              //Print(" Counter Number is : {0}", counter);
            }
          }

            //LEFT TOP
          else if (Xcoord == 0 && Ycoord == 0)
          {
            if (arr[Xcoord, Ycoord + 1, 0] == 0)
              directionList.Add(Xcoord); directionList.Add(Ycoord + 1);

            if (arr[Xcoord + 1, Ycoord, 0] == 0)
              directionList.Add(Xcoord + 1); directionList.Add(Ycoord);

            if (directionList.Count > 0)
            {
              var randomIndex = rand.Next(directionList.Count / 2);

              int a = directionList[2 * randomIndex];
              int b = directionList[2 * randomIndex + 1];

              arr[a, b, 0] = arr[Xcoord, Ycoord, 0];

              spaceCoordList.AddRange(new int[2] { a, b });

              directionList.Clear();
              directionList.TrimExcess();
              draw = true;

              counter++;
              //Print(" Counter Number is : {0}", counter);
            }
          }
            //RIGHT TOP
          else if (Xcoord == 0 && Ycoord == (arr.GetLength(1) - 1))
          {
            if (arr[Xcoord + 1, Ycoord, 0] == 0)
              directionList.Add(Xcoord + 1); directionList.Add(Ycoord);

            if (arr[Xcoord, Ycoord - 1, 0] == 0)
              directionList.Add(Xcoord); directionList.Add(Ycoord - 1);

            if (directionList.Count > 0)
            {
              var randomIndex = rand.Next(directionList.Count / 2);

              int a = directionList[2 * randomIndex];
              int b = directionList[2 * randomIndex + 1];

              arr[a, b, 0] = arr[Xcoord, Ycoord, 0];

              spaceCoordList.AddRange(new int[2] { a, b });

              directionList.Clear();
              directionList.TrimExcess();

              draw = true;
              counter++;
              //Print(" Counter Number is : {0}", counter);
            }
          }
            //RIGHT BOTTOM
          else if (Xcoord == (arr.GetLength(0) - 1) && Ycoord == (arr.GetLength(1) - 1))
          {
            if (arr[Xcoord, Ycoord - 1, 0] == 0)
              directionList.Add(Xcoord); directionList.Add(Ycoord - 1);

            if (arr[Xcoord - 1, Ycoord, 0] == 0)
              directionList.Add(Xcoord - 1); directionList.Add(Ycoord);

            if (directionList.Count > 0)
            {
              var randomIndex = rand.Next(directionList.Count / 2);

              int a = directionList[2 * randomIndex];
              int b = directionList[2 * randomIndex + 1];

              arr[a, b, 0] = arr[Xcoord, Ycoord, 0];

              spaceCoordList.AddRange(new int[2] { a, b });

              directionList.Clear();
              directionList.TrimExcess();

              draw = true;
              counter++;
              //Print(" Counter Number is : {0}", counter);
            }
          }
            //LEFT BOTTOM
          else if (Xcoord == (arr.GetLength(1) - 1) && Ycoord == 0)
          {
            if (arr[Xcoord, Ycoord + 1, 0] == 0)
              directionList.Add(Xcoord); directionList.Add(Ycoord - 1);

            if (arr[Xcoord - 1, Ycoord, 0] == 0)
              directionList.Add(Xcoord - 1 - 1); directionList.Add(Ycoord);

            if (directionList.Count > 0)
            {
              var randomIndex = rand.Next(directionList.Count / 2);

              int a = directionList[2 * randomIndex];
              int b = directionList[2 * randomIndex + 1];

              arr[a, b, 0] = arr[Xcoord, Ycoord, 0];

              spaceCoordList.AddRange(new int[2] { a, b });

              directionList.Clear();
              directionList.TrimExcess();

              draw = true;
              counter++;
              //Print(" Counter Number is : {0}", counter);
            }
          }
          /* EDGE CONDITIONS */
        }
      }
    }
  }
# ---------- end c_script ----------
division = Division(A=multiplication_2, B=number_slider_112)  # disabled
panel_14 = Panel(c_script.out)  # disabled

# ---- group: Visualize as 3D Boxes
center_box = CenterBox(Base=c_script.W, X=division, Y=division, Z=division)  # disabled
center_box_2 = CenterBox(Base=c_script.G, X=division, Y=division, Z=division)  # disabled
center_box_3 = CenterBox(Base=c_script.K, X=division, Y=division, Z=division)  # disabled
center_box_4 = CenterBox(Base=c_script.B, X=division, Y=division, Z=division)  # disabled
center_box_5 = CenterBox(Base=c_script.Y, X=division, Y=division, Z=division)  # disabled
center_box_6 = CenterBox(Base=c_script.R, X=division, Y=division, Z=division)  # disabled
number_slider_113 = Slider(0.2, range=0..1)  # disabled
colour_picker = ColourPicker(PickedColour=RGB(255, 0, 0))  # disabled
colour_picker_2 = ColourPicker(PickedColour=RGB(255, 255, 255))  # disabled
colour_picker_3 = ColourPicker(PickedColour=RGB(0, 255, 255))  # disabled
colour_picker_4 = ColourPicker(PickedColour=RGB(0, 255, 0))  # disabled
colour_picker_5 = ColourPicker(PickedColour=RGB(255, 255, 0))  # disabled
colour_picker_6 = ColourPicker(PickedColour=RGB(0, 0, 0))  # disabled
create_material = CreateMaterial(Diffuse=colour_picker, Specular=RGB(255, 255, 255), Emission=RGB(0, 0, 0), Transparency=number_slider_113, Shine=0)  # disabled
create_material_2 = CreateMaterial(Diffuse=colour_picker_4, Specular=RGB(255, 255, 255), Emission=RGB(0, 0, 0), Transparency=number_slider_113, Shine=0)  # disabled
create_material_3 = CreateMaterial(Diffuse=colour_picker_2, Specular=RGB(255, 255, 255), Emission=RGB(0, 0, 0), Transparency=number_slider_113, Shine=0)  # disabled
create_material_4 = CreateMaterial(Diffuse=colour_picker_3, Specular=RGB(255, 255, 255), Emission=RGB(0, 0, 0), Transparency=number_slider_113, Shine=0)  # disabled
create_material_5 = CreateMaterial(Diffuse=colour_picker_5, Specular=RGB(255, 255, 255), Emission=RGB(0, 0, 0), Transparency=number_slider_113, Shine=0)  # disabled
create_material_6 = CreateMaterial(Diffuse=colour_picker_6, Specular=RGB(255, 255, 255), Emission=RGB(0, 0, 0), Transparency=number_slider_113, Shine=0)  # disabled
custom_preview = CustomPreview(Geometry=center_box_6, Material=create_material)  # disabled
custom_preview_2 = CustomPreview(Geometry=center_box, Material=create_material_3)  # disabled
custom_preview_3 = CustomPreview(Geometry=center_box_4, Material=create_material_4)  # disabled
custom_preview_4 = CustomPreview(Geometry=center_box_2, Material=create_material_2)  # disabled
custom_preview_5 = CustomPreview(Geometry=center_box_5, Material=create_material_5)  # disabled
custom_preview_6 = CustomPreview(Geometry=center_box_3, Material=create_material_6)  # disabled

# ----
number_slider_114 = Slider(10, range=0..10)
multiplication_4 = Multiplication(A=Slider(60, range=20..60), B=number_slider_114)
multiplication_5 = Multiplication(A=Slider(30, range=20..60), B=number_slider_114)
multiplication_6 = Multiplication(A=Slider(5, range=2..10), B=number_slider_114)
panel_15 = Panel(multiplication_4)
panel_16 = Panel(multiplication_5)
multiplication_7 = Multiplication(A=multiplication_6, B=multiplication_6)
division_2 = Division(A=multiplication_4, B=multiplication_6)
division_3 = Division(A=multiplication_5, B=multiplication_6)
number_slider_115 = Slider(10, range=0..50)  # disabled
number_slider_116 = Slider(12, range=0..100)  # disabled
panel_17 = Panel(multiplication_6)
number_slider_117 = Slider(27, range=0..100)  # disabled
number_slider_118 = Slider(2, range=0..10)  # disabled
division_4 = Division(A=multiplication_7, B=Slider(10000, range=0..10000))
c_script_2 = CSharpScript(Width=number_slider_117, Length=number_slider_116, cellSize=number_slider_115)  # -> out, A, R, G, B, Y, K, W; inputs Width: Int32, Length: Int32, height: Int32, cellSize: Int32; disabled
# ---------- c_script_2: C# ----------
    List<Circle> entranceCircles = new List<Circle>();
    List<Circle> wetAreaCircles = new List<Circle>();
    List<Circle> personalSpaceCircles = new List<Circle>();
    List<Circle> kitchenCircles = new List<Circle>();
    List<Circle> commonAreaCircles = new List<Circle>();
    List<Circle> WhiteCircles = new List<Circle>();

    int width = Width;        
    int length = Length;

    int[,] areaArray = InitializeZeroMatrice(length, width);
    StartColors(areaArray);

    for (int i = 0; i < 500; i++)
    {
      Spread(areaArray, ref entranceSize, entranceList, ref entranceCounter, entranceLimit);
      Spread(areaArray, ref personalSpaceSize, personalSpaceList, ref personalSpaceCounter, personalSpaceLimit);
      Spread(areaArray, ref wetAreaSize, wetAreaList, ref wetAreaCounter, wetAreaLimit);
      Spread(areaArray, ref kitchenSize, kitchenList, ref kitchenCounter, kitchenLimit);
      Spread(areaArray, ref commonAreaSize, commonAreaList, ref commonAreaCounter, commonAreaLimit);
    }
    double radius = cellSize / 2;


    for (int i = 0;i < length;i++)
    {
      for (int j = 0;j < width;j++)
      {
        if (areaArray[i, j] == 1)
        {
          Point3d center = new Point3d(j * cellSize, i * cellSize, 0);
          Circle c = new Circle(center, radius);
          entranceCircles.Add(c);
        }
        if (areaArray[i, j] == 2)
        {
          Point3d center = new Point3d(j * cellSize, i * cellSize, 0);
          Circle c = new Circle(center, radius);
          personalSpaceCircles.Add(c);
        }
        if (areaArray[i, j] == 3)
        {
          Point3d center = new Point3d(j * cellSize, i * cellSize, 0);
          Circle c = new Circle(center, radius);
          wetAreaCircles.Add(c);
        }
        if (areaArray[i, j] == 4)
        {
          Point3d center = new Point3d(j * cellSize, i * cellSize, 0);
          Circle c = new Circle(center, radius);
          kitchenCircles.Add(c);
        }
        if (areaArray[i, j] == 5)
        {
          Point3d center = new Point3d(j * cellSize, i * cellSize, 0);
          Circle c = new Circle(center, radius);
          commonAreaCircles.Add(c);
        }

        if (areaArray[i, j] == 0)
        {
          Point3d center = new Point3d(j * cellSize, i * cellSize, 0);
          Circle c = new Circle(center, radius);
          WhiteCircles.Add(c);
        }
      }
    }

    ShowMatrix(areaArray);
    A = areaArray;
    R = entranceCircles;
    G = personalSpaceCircles;
    B = wetAreaCircles;
    Y = kitchenCircles;
    K = commonAreaCircles;
    W = WhiteCircles;
# ---------- c_script_2: C# additional code ----------
  static void ShowMatrix(int[,] Arr)
  {
    ////Print("");
    for (int i = 0; i < Arr.GetLength(0); i++)
    {
      for (int j = 0; j < Arr.GetLength(1); j++)
      {
        ////Print(Arr[i, j].ToString() + " ");
      }
      ////Print("");
    }
    ////Print("   ");
    return;
  }
  static int[,] InitializeZeroMatrice(int width, int length)
  {
    var areaArray = new int[width, length];

    for (int i = 0; i < width; i++)
    {
      for (int j = 0; j < length; j++)
      {
        areaArray[i, j] = 0;
      }
    }
    return areaArray;
  }

  /* The Color lists keep the colors in a seperate List in order to choose within them easily instead of searching where they are... */
  static List<int> entranceList = new List<int>();
  static List<int> personalSpaceList = new List<int>();
  static List<int> wetAreaList = new List<int>();
  static List<int> kitchenList = new List<int>();
  static List<int> commonAreaList = new List<int>();
  /**           These sizes are Spreading Limits for the spaces   //total cells           **/

  static int entranceSize = 230;
  static int personalSpaceSize = 300;
  static int wetAreaSize = 250;
  static int kitchenSize = 500;
  static int commonAreaSize = 1000;
  /**           these counters are used for starting the límitations counts.         **/

  static int entranceCounter = 1;
  static int personalSpaceCounter = 1;
  static int wetAreaCounter = 1;
  static int kitchenCounter = 1;
  static int commonAreaCounter = 1;
  /**           these limits are used for defining max distance that zone can spread.  **/

  static int entranceLimit = 10;
  static int personalSpaceLimit = 15;
  static int wetAreaLimit = 15;
  static int kitchenLimit = 20;
  static int commonAreaLimit = 30;

  static void StartColors(int[,] arr)
  {

            /**
             * Randomly Starts the color. Takes the Color lists as argumnts
             * (We can delete these argumnents and it can get them as local referance
             * in our case it gives us a chance to choose what to initilize)
             * **/

    Random rand = new Random();
    //----------------------
    /* GetLength(0) and GetLength(1) might be set as variable */
    //Array.GetLength(0) gives the column lenght in other words length of an array
    //Array.GetLength(1) gives the row lenght in other words width of an array
    var a = rand.Next(arr.GetLength(0) / 2, arr.GetLength(0) / 2);
    var b = rand.Next(0, 2);

    entranceList.AddRange(new int[2] { a, b }); //AddRange ==> Adds multiple elements to a List . We use mod%2 to call the index of the point back instead of stacking them as an another List(or Array) in our list.
    arr[a, b] = 1;// entrance Starting Point
    //----------------------

    b = rand.Next(0, arr.GetLength(1));
    a = rand.Next(0, arr.GetLength(0));

    personalSpaceList.AddRange(new int[2] { a, b });
    arr[a, b] = 2; // personalSpace Starting Point
    //----------------------
    a = rand.Next(0, arr.GetLength(0));
    b = rand.Next(0, arr.GetLength(1));

    wetAreaList.AddRange(new int[2] { a, b });
    arr[a, b] = 3; // wetArea Starting Point
    //----------------------
    a = rand.Next(0, arr.GetLength(0));
    b = rand.Next(0, arr.GetLength(1));

    kitchenList.AddRange(new int[2] { a, b });
    arr[a, b] = 4; // kitchen Starting Point
    //----------------------
    a = rand.Next(0, arr.GetLength(0));
    b = rand.Next(0, arr.GetLength(1));

    commonAreaList.AddRange(new int[2] { a, b });
    arr[a, b] = 5; // commonArea Starting Point
    //----------------------
  }
        /* Calculates the distance between initial point in the color and the possible new point!
         *  (if the possible new point is too far from inital point eleminate it.) */
  static double distanceCalculate(List<int> spaceCoordList, int x2, int y2)
  {
    var distance = Math.Sqrt((y2 - spaceCoordList[1]) * (y2 - spaceCoordList[1]) + (x2 - spaceCoordList[0]) * (x2 - spaceCoordList[0]));
    return distance;
  }

  static void Evaluate()
  {
    // according to relations give score to the created zones
    // get the centers of the zones and acoording to the distances and created sizes give
    //positive or negative points and if score is not acceptable re-run and create variatians.
  }

  static void Spread(int[,] arr, ref int spaceSize, List<int> spaceCoordList, ref int counter, int spaceLimit)
  {
                /*ARGUMENTS
             * The main array which has rectangular form(will be 3d in short) ,
             * spaceSize = Maximum limit that can grow.  ,
             * spaceCoordList =  the cells of the zone which has been already defined. )
             */
    var rand = new Random();
    var directionList = new List<int>();
    int Xcoord;
    int Ycoord;
    bool draw = false;
    int trycount = 0;

    while (draw == false && counter <= spaceSize)
    {
      if (counter <= spaceSize) //Can be deleted. The condition is added to the While Loop Conditions.
      {
        ////Print("Counter Number is : {0}\n", counter);
        ////Print("Element number of the list {0}", spaceCoordList.Count / 2);
        var randomCellIndex = rand.Next(spaceCoordList.Count / 2);

        Xcoord = spaceCoordList[2 * randomCellIndex];
        Ycoord = spaceCoordList[2 * randomCellIndex + 1];

        //Print("Coordinates if the new Cell is = {0}, {1}\n", Xcoord, Ycoord);

        if (Xcoord < arr.GetLength(0) - 1 && Xcoord > 0 && Ycoord > 0 && Ycoord < arr.GetLength(1) - 1)
        {
          /* Check the conditions INSIDE borders */
          if (arr[Xcoord + 1, Ycoord] == 0 && distanceCalculate(spaceCoordList, Xcoord + 1, Ycoord) < spaceLimit ) // Check if possible new cell is still white or not!
            directionList.AddRange(new int[2] { (Xcoord + 1), Ycoord }); //Store possible spread directions in a list.

          if (arr[Xcoord - 1, Ycoord] == 0 && distanceCalculate(spaceCoordList, Xcoord - 1, Ycoord) < spaceLimit)
            directionList.AddRange(new int[2] { (Xcoord - 1), Ycoord }); //Store possible spread directions in a list.

          if (arr[Xcoord, Ycoord + 1] == 0 && distanceCalculate(spaceCoordList, Xcoord, Ycoord + 1) < spaceLimit)
            directionList.AddRange(new int[2] { (Xcoord), Ycoord + 1 }); //Store possible spread directions in a list.

          if (arr[Xcoord, Ycoord - 1] == 0 && distanceCalculate(spaceCoordList, Xcoord, Ycoord - 1) < spaceLimit)
            directionList.AddRange(new int[2] { (Xcoord), (Ycoord - 1) }); //Store possible spread directions in a list.

          if (directionList.Count > 0)
          {
            var randomIndex = rand.Next(directionList.Count / 2);

            int a = directionList[2 * randomIndex];
            int b = directionList[2 * randomIndex + 1];
            //Print("Value of Xcoord and Ycoord: {0}, {1}", Xcoord, Ycoord);
            //Print("Value of new Coordinates: {0}, {1}", a, b);
            //Print("Value of initial value of Array[a, b]: {0}", arr[a, b]);


            arr[a, b] = arr[Xcoord, Ycoord];
            //Print("Value of new Array[a, b]: {0}", arr[a, b]);

            spaceCoordList.AddRange(new int[2] { a, b });

            directionList.Clear();
            directionList.TrimExcess();
            draw = true;
            counter++;
          }
          else
          {
            trycount++;
            if (trycount >= spaceCoordList.Count)
            {
              draw = true;
              //Print("trycountNumber is ={0}", trycount);
            }

          }
        }

          /* EDGE CONDITIONS */

          //BOTTOM
        else if (Xcoord == (arr.GetLength(0) - 1) && Ycoord != 0 && Ycoord != (arr.GetLength(1) - 1))
        {
          if (arr[Xcoord - 1, Ycoord] == 0)
          {
            arr[Xcoord - 1, Ycoord] = arr[Xcoord, Ycoord];

            int a = Xcoord - 1;
            int b = Ycoord;

            spaceCoordList.AddRange(new int[2] { a, b });

            draw = true;
            counter++;
            //Print(" Counter Number is : {0}", counter);
          }
        }
          //TOP
        else if (Xcoord == 0 && Ycoord != 0 && Ycoord != (arr.GetLength(1) - 1))
        {
          if (arr[Xcoord + 1, Ycoord] == 0)
          {
            arr[Xcoord + 1, Ycoord] = arr[Xcoord, Ycoord];

            int a = Xcoord + 1;
            int b = Ycoord;

            spaceCoordList.AddRange(new int[2] { a, b });

            draw = true;
            counter++;
            //Print(" Counter Number is : {0}", counter);
          }
        }
          //RIGHT
        else if ((Ycoord == arr.GetLength(1) - 1) && Xcoord != 0 && Xcoord != (arr.GetLength(0) - 1))
        {
          if (arr[Xcoord, Ycoord - 1] == 0)
          {
            arr[Xcoord, Ycoord - 1] = arr[Xcoord, Ycoord];

            int a = Xcoord;
            int b = Ycoord - 1;

            spaceCoordList.AddRange(new int[2] { a, b });

            draw = true;
            counter++;
            //Print(" Counter Number is : {0}", counter);
          }
        }
          //LEFT
        else if (Ycoord == 0 && Xcoord != 0 && Xcoord != (arr.GetLength(0) - 1))
        {
          if (arr[Xcoord, Ycoord + 1] == 0)
          {
            arr[Xcoord, Ycoord + 1] = arr[Xcoord, Ycoord];

            int a = Xcoord;
            int b = Ycoord + 1;

            arr[Xcoord, Ycoord + 1] = arr[Xcoord, Ycoord];

            spaceCoordList.AddRange(new int[2] { a, b });

            draw = true;
            counter++;
            //Print(" Counter Number is : {0}", counter);
          }
        }

          //LEFT TOP
        else if (Xcoord == 0 && Ycoord == 0)
        {
          if (arr[Xcoord, Ycoord + 1] == 0)
            directionList.Add(Xcoord); directionList.Add(Ycoord + 1);

          if (arr[Xcoord + 1, Ycoord] == 0)
            directionList.Add(Xcoord + 1); directionList.Add(Ycoord);

          if (directionList.Count > 0)
          {
            var randomIndex = rand.Next(directionList.Count / 2);

            int a = directionList[2 * randomIndex];
            int b = directionList[2 * randomIndex + 1];

            arr[a, b] = arr[Xcoord, Ycoord];

            spaceCoordList.AddRange(new int[2] { a, b });

            directionList.Clear();
            directionList.TrimExcess();
            draw = true;

            counter++;
            //Print(" Counter Number is : {0}", counter);
          }
        }
          //RIGHT TOP
        else if (Xcoord == 0 && Ycoord == (arr.GetLength(1) - 1))
        {
          if (arr[Xcoord + 1, Ycoord] == 0)
            directionList.Add(Xcoord + 1); directionList.Add(Ycoord);

          if (arr[Xcoord, Ycoord - 1] == 0)
            directionList.Add(Xcoord); directionList.Add(Ycoord - 1);

          if (directionList.Count > 0)
          {
            var randomIndex = rand.Next(directionList.Count / 2);

            int a = directionList[2 * randomIndex];
            int b = directionList[2 * randomIndex + 1];

            arr[a, b] = arr[Xcoord, Ycoord];

            spaceCoordList.AddRange(new int[2] { a, b });

            directionList.Clear();
            directionList.TrimExcess();

            draw = true;
            counter++;
            //Print(" Counter Number is : {0}", counter);
          }
        }
          //RIGHT BOTTOM
        else if (Xcoord == (arr.GetLength(0) - 1) && Ycoord == (arr.GetLength(1) - 1))
        {
          if (arr[Xcoord, Ycoord - 1] == 0)
            directionList.Add(Xcoord); directionList.Add(Ycoord - 1);

          if (arr[Xcoord - 1, Ycoord] == 0)
            directionList.Add(Xcoord - 1); directionList.Add(Ycoord);

          if (directionList.Count > 0)
          {
            var randomIndex = rand.Next(directionList.Count / 2);

            int a = directionList[2 * randomIndex];
            int b = directionList[2 * randomIndex + 1];

            arr[a, b] = arr[Xcoord, Ycoord];

            spaceCoordList.AddRange(new int[2] { a, b });

            directionList.Clear();
            directionList.TrimExcess();

            draw = true;
            counter++;
            //Print(" Counter Number is : {0}", counter);
          }
        }
          //LEFT BOTTOM
        else if (Xcoord == (arr.GetLength(1) - 1) && Ycoord == 0)
        {
          if (arr[Xcoord, Ycoord + 1] == 0)
            directionList.Add(Xcoord); directionList.Add(Ycoord - 1);

          if (arr[Xcoord - 1, Ycoord] == 0)
            directionList.Add(Xcoord - 1 - 1); directionList.Add(Ycoord);

          if (directionList.Count > 0)
          {
            var randomIndex = rand.Next(directionList.Count / 2);

            int a = directionList[2 * randomIndex];
            int b = directionList[2 * randomIndex + 1];

            arr[a, b] = arr[Xcoord, Ycoord];

            spaceCoordList.AddRange(new int[2] { a, b });

            directionList.Clear();
            directionList.TrimExcess();

            draw = true;
            counter++;
            //Print(" Counter Number is : {0}", counter);
          }
        }
        /* EDGE CONDITIONS */
      }
    }

  }


    /* Instead of wrting methods seperately in main program, it is better to use class based
     informations to keep things organized, we are not yet transsferentrance methods here but we created the str.*/

    /*
    public class Zone
    {
        public string Name;
        public int SpaceLimit;
        public Int16 SpaceSize;
        public int Counter;
        public List<Int16> SpaceList;

        public void Describe()
        {
            Console.WriteLine("Hey this zone is{ 0} ", Name);
        }

        public Zone()
        {
           // SpaceList = new List<int>();
        }

        public Zone(string name, int spaceLimit,int spacesize,int counter, List<int> SpaceList)
        :this()
        {

        }

        static void InitializeZeroMatrice() { }
        static void startZones() { }
        public void SpreadZones() { }

    }
    */
# ---------- end c_script_2 ----------
division_5 = Division(A=number_slider_115, B=number_slider_118)  # disabled
integer = Integer(division_2)
integer_2 = Integer(division_3)
c_script_3 = CSharpScript(Width=integer, Length=integer_2, cellSize=multiplication_6)  # -> out, A, R, G, B, Y, K, W; inputs Width: Int32, Length: Int32, height: Int32, cellSize: Int32
# ---------- c_script_3: C# ----------
    List<Box> entranceBoxes = new List<Box>();
    List<Box> wetAreaBoxes = new List<Box>();
    List<Box> personalSpaceBoxes = new List<Box>();
    List<Box> kitchenBoxes = new List<Box>();
    List<Box> commonAreaBoxes = new List<Box>();
    List<Box> WhiteBoxes = new List<Box>();

    Point3d pA = new Point3d(0, 0, 0);
    Point3d pB = new Point3d(10, 0, 0);
    Point3d pC = new Point3d(0, 10, 0);

    Plane p = new Plane(pA, pB, pC);

    int width = Width;
    int length = Length;

    int[,] areaArray = InitializeZeroMatrice(length, width);
    StartColors(areaArray);


    for (int i = 0; i < width * height * 2; i++)
    {
      Spread(areaArray, ref entranceSize, entranceList, ref entranceCounter, entranceLimit, cellSize);
      Spread(areaArray, ref personalSpaceSize, personalSpaceList, ref personalSpaceCounter, personalSpaceLimit, cellSize);
      Spread(areaArray, ref wetAreaSize, wetAreaList, ref wetAreaCounter, wetAreaLimit, cellSize);
      Spread(areaArray, ref kitchenSize, kitchenList, ref kitchenCounter, kitchenLimit, cellSize);
      Spread(areaArray, ref commonAreaSize, commonAreaList, ref commonAreaCounter, commonAreaLimit, cellSize);
    }
    double radius = cellSize / 2;

    for (int i = 0;i < length;i++)
    {
      for (int j = 0;j < width;j++)
      {
        if (areaArray[i, j] == 1)
        {
          Interval xInterval = new Interval(j * cellSize, (j + 1) * (cellSize ));
          Interval yInterval = new Interval(i * cellSize, (i + 1) * (cellSize ));
          Interval zInterval = new Interval(0, 100);

          Box boxgh = new Box(p, xInterval, yInterval, zInterval);
          entranceBoxes.Add(boxgh);
        }
        if (areaArray[i, j] == 2)
        {
          Interval xInterval = new Interval(j * cellSize, (j + 1) * (cellSize ));
          Interval yInterval = new Interval(i * cellSize, (i + 1) * (cellSize ));
          Interval zInterval = new Interval(0, 100);

          Box boxgh = new Box(p, xInterval, yInterval, zInterval);
          wetAreaBoxes.Add(boxgh);
        }
        if (areaArray[i, j] == 3)
        {
          Interval xInterval = new Interval(j * cellSize, (j + 1) * (cellSize ));
          Interval yInterval = new Interval(i * cellSize, (i + 1) * (cellSize ));
          Interval zInterval = new Interval(0, 100);

          Box boxgh = new Box(p, xInterval, yInterval, zInterval);
          personalSpaceBoxes.Add(boxgh);
        }
        if (areaArray[i, j] == 4)
        {
          Interval xInterval = new Interval(j * cellSize, (j + 1) * (cellSize ));
          Interval yInterval = new Interval(i * cellSize, (i + 1) * (cellSize ));
          Interval zInterval = new Interval(0, 100);

          Box boxgh = new Box(p, xInterval, yInterval, zInterval);
          kitchenBoxes.Add(boxgh);
        }
        if (areaArray[i, j] == 5)
        {
          Interval xInterval = new Interval(j * cellSize, (j + 1) * (cellSize ));
          Interval yInterval = new Interval(i * cellSize, (i + 1) * (cellSize ));
          Interval zInterval = new Interval(0, 100);

          Box boxgh = new Box(p, xInterval, yInterval, zInterval);
          commonAreaBoxes.Add(boxgh);
        }
        if (areaArray[i, j] == 0)
        {

          Interval xInterval = new Interval(j * cellSize, (j + 1) * (cellSize ));
          Interval yInterval = new Interval(i * cellSize, (i + 1) * (cellSize ));
          Interval zInterval = new Interval(0, 100);

          Box boxgh = new Box(p, xInterval, yInterval, zInterval);
          WhiteBoxes.Add(boxgh);
        }
      }
    }

    ShowMatrix(areaArray);
    A = areaArray;
    R = entranceBoxes;
    G = personalSpaceBoxes;
    B = wetAreaBoxes;
    Y = kitchenBoxes;
    K = commonAreaBoxes;
    W = WhiteBoxes;
# ---------- c_script_3: C# additional code ----------
  static void ShowMatrix(int[,] Arr)
  {
    ////Print("");
    for (int i = 0; i < Arr.GetLength(0); i++)
    {
      for (int j = 0; j < Arr.GetLength(1); j++)
      {
        ////Print(Arr[i, j].ToString() + " ");
      }
      ////Print("");
    }
    ////Print("   ");
    return;
  }
  static int[,] InitializeZeroMatrice(int width, int length)
  {
    var areaArray = new int[width, length];

    for (int i = 0; i < width; i++)
    {
      for (int j = 0; j < length; j++)
      {
        areaArray[i, j] = 0;
      }
    }
    return areaArray;
  }

  /* The Color lists keep the colors in a seperate List in order to choose within them easily instead of searching where they are... */
  static List<int> entranceList = new List<int>();
  static List<int> personalSpaceList = new List<int>();
  static List<int> wetAreaList = new List<int>();
  static List<int> kitchenList = new List<int>();
  static List<int> commonAreaList = new List<int>();
  /**           These sizes are Spreading Limits for the spaces   //total cells           **/

  static int entranceSize = 300;
  static int personalSpaceSize = 300;
  static int wetAreaSize = 250;
  static int kitchenSize = 500;
  static int commonAreaSize = 1000;
  /**           these counters are used for starting the límitations counts.         **/

  static int entranceCounter = 1;
  static int personalSpaceCounter = 1;
  static int wetAreaCounter = 1;
  static int kitchenCounter = 1;
  static int commonAreaCounter = 1;
  /**           these limits are used for defining max distance that zone can spread.  **/

  static int entranceLimit = 100;
  static int personalSpaceLimit = 100;
  static int wetAreaLimit = 100;
  static int kitchenLimit = 100;
  static int commonAreaLimit = 100;

  static void StartColors(int[,] arr)
  {

            /**
             * Randomly Starts the color. Takes the Color lists as argumnts
             * (We can delete these argumnents and it can get them as local referance
             * in our case it gives us a chance to choose what to initilize)
             * **/

    Random rand = new Random();
    //----------------------
    /* GetLength(0) and GetLength(1) might be set as variable */
    //Array.GetLength(0) gives the column lenght in other words length of an array
    //Array.GetLength(1) gives the row lenght in other words width of an array
    var a = rand.Next(arr.GetLength(0) / 2, arr.GetLength(0) / 2);
    var b = rand.Next(0, 2);

    entranceList.AddRange(new int[2] { a, b }); //AddRange ==> Adds multiple elements to a List . We use mod%2 to call the index of the point back instead of stacking them as an another List(or Array) in our list.
    arr[a, b] = 1;// entrance Starting Point
    //----------------------

    b = rand.Next(0, arr.GetLength(1));
    a = rand.Next(0, arr.GetLength(0));

    personalSpaceList.AddRange(new int[2] { a, b });
    arr[a, b] = 2; // personalSpace Starting Point
    //----------------------
    a = rand.Next(0, arr.GetLength(0));
    b = rand.Next(0, arr.GetLength(1));

    wetAreaList.AddRange(new int[2] { a, b });
    arr[a, b] = 3; // wetArea Starting Point
    //----------------------
    a = rand.Next(0, arr.GetLength(0));
    b = rand.Next(0, arr.GetLength(1));

    kitchenList.AddRange(new int[2] { a, b });
    arr[a, b] = 4; // kitchen Starting Point
    //----------------------
    a = rand.Next(0, arr.GetLength(0));
    b = rand.Next(0, arr.GetLength(1));

    commonAreaList.AddRange(new int[2] { a, b });
    arr[a, b] = 5; // commonArea Starting Point
    //----------------------
  }
        /* Calculates the distance between initial point in the color and the possible new point!
         *  (if the possible new point is too far from inital point eleminate it.) */
  static double distanceCalculate(List<int> spaceCoordList, int x2, int y2, int cellSize)
  {
    var distance = cellSize * Math.Sqrt((y2 - spaceCoordList[1]) * (y2 - spaceCoordList[1]) + (x2 - spaceCoordList[0]) * (x2 - spaceCoordList[0]));
    return distance;
  }

  static void Evaluate()
  {
    // according to relations give score to the created zones
    // get the centers of the zones and acoording to the distances and created sizes give
    //positive or negative points and if score is not acceptable re-run and create variatians.
  }

  static void Spread(int[,] arr, ref int spaceSize, List<int> spaceCoordList, ref int counter, int spaceLimit, int cellSize)
  {
        /*ARGUMENTS
     * The main array which has rectangular form(will be 3d in short) ,
     * spaceSize = Maximum limit that can grow.  ,
     * spaceCoordList =  the cells of the zone which has been already defined. )
     */
    var rand = new Random();
    var directionList = new List<int>();
    int Xcoord;
    int Ycoord;
    bool draw = false;
    int trycount = 0;

    while (draw == false && counter <= spaceSize)
    {
      if (counter <= spaceSize) //Can be deleted. The condition is added to the While Loop Conditions.
      {
        ////Print("Counter Number is : {0}\n", counter);
        ////Print("Element number of the list {0}", spaceCoordList.Count / 2);
        var randomCellIndex = rand.Next(spaceCoordList.Count / 2);

        Xcoord = spaceCoordList[2 * randomCellIndex];
        Ycoord = spaceCoordList[2 * randomCellIndex + 1];

        //Print("Coordinates if the new Cell is = {0}, {1}\n", Xcoord, Ycoord);

        if (Xcoord < arr.GetLength(0) - 1 && Xcoord > 0 && Ycoord > 0 && Ycoord < arr.GetLength(1) - 1)
        {
          /* Check the conditions INSIDE borders */
          if (arr[Xcoord + 1, Ycoord] == 0 && distanceCalculate(spaceCoordList, Xcoord + 1, Ycoord, cellSize) < spaceLimit ) // Check if possible new cell is still white or not!
            directionList.AddRange(new int[2] { (Xcoord + 1), Ycoord }); //Store possible spread directions in a list.

          if (arr[Xcoord - 1, Ycoord] == 0 && distanceCalculate(spaceCoordList, Xcoord - 1, Ycoord, cellSize) < spaceLimit)
            directionList.AddRange(new int[2] { (Xcoord - 1), Ycoord }); //Store possible spread directions in a list.

          if (arr[Xcoord, Ycoord + 1] == 0 && distanceCalculate(spaceCoordList, Xcoord, Ycoord + 1, cellSize) < spaceLimit)
            directionList.AddRange(new int[2] { (Xcoord), Ycoord + 1 }); //Store possible spread directions in a list.

          if (arr[Xcoord, Ycoord - 1] == 0 && distanceCalculate(spaceCoordList, Xcoord, Ycoord - 1, cellSize) < spaceLimit)
            directionList.AddRange(new int[2] { (Xcoord), (Ycoord - 1) }); //Store possible spread directions in a list.

          if (directionList.Count > 0)
          {
            var randomIndex = rand.Next(directionList.Count / 2);
            int a = directionList[2 * randomIndex];
            int b = directionList[2 * randomIndex + 1];

            arr[a, b] = arr[Xcoord, Ycoord];


            spaceCoordList.AddRange(new int[2] { a, b });

            directionList.Clear();
            directionList.TrimExcess();
            draw = true;
            counter++;
          }
          else
          {
            trycount++;
            if (trycount >= spaceCoordList.Count)
            {
              draw = true;
              //Print("trycountNumber is ={0}", trycount);
            }
          }
        }

          /* EDGE CONDITIONS */
          //BOTTOM
        else if (Xcoord == (arr.GetLength(0) - 1) && Ycoord != 0 && Ycoord != (arr.GetLength(1) - 1))
        {
          if (arr[Xcoord - 1, Ycoord] == 0)
          {
            arr[Xcoord - 1, Ycoord] = arr[Xcoord, Ycoord];

            int a = Xcoord - 1;
            int b = Ycoord;

            spaceCoordList.AddRange(new int[2] { a, b });

            draw = true;
            counter++;
            //Print(" Counter Number is : {0}", counter);
          }
        }
          //TOP
        else if (Xcoord == 0 && Ycoord != 0 && Ycoord != (arr.GetLength(1) - 1))
        {
          if (arr[Xcoord + 1, Ycoord] == 0)
          {
            arr[Xcoord + 1, Ycoord] = arr[Xcoord, Ycoord];

            int a = Xcoord + 1;
            int b = Ycoord;

            spaceCoordList.AddRange(new int[2] { a, b });

            draw = true;
            counter++;
            //Print(" Counter Number is : {0}", counter);
          }
        }
          //RIGHT
        else if ((Ycoord == arr.GetLength(1) - 1) && Xcoord != 0 && Xcoord != (arr.GetLength(0) - 1))
        {
          if (arr[Xcoord, Ycoord - 1] == 0)
          {
            arr[Xcoord, Ycoord - 1] = arr[Xcoord, Ycoord];

            int a = Xcoord;
            int b = Ycoord - 1;

            spaceCoordList.AddRange(new int[2] { a, b });

            draw = true;
            counter++;
            //Print(" Counter Number is : {0}", counter);
          }
        }
          //LEFT
        else if (Ycoord == 0 && Xcoord != 0 && Xcoord != (arr.GetLength(0) - 1))
        {
          if (arr[Xcoord, Ycoord + 1] == 0)
          {
            arr[Xcoord, Ycoord + 1] = arr[Xcoord, Ycoord];

            int a = Xcoord;
            int b = Ycoord + 1;

            arr[Xcoord, Ycoord + 1] = arr[Xcoord, Ycoord];

            spaceCoordList.AddRange(new int[2] { a, b });

            draw = true;
            counter++;
            //Print(" Counter Number is : {0}", counter);
          }
        }

          //LEFT TOP
        else if (Xcoord == 0 && Ycoord == 0)
        {
          if (arr[Xcoord, Ycoord + 1] == 0)
            directionList.Add(Xcoord); directionList.Add(Ycoord + 1);

          if (arr[Xcoord + 1, Ycoord] == 0)
            directionList.Add(Xcoord + 1); directionList.Add(Ycoord);

          if (directionList.Count > 0)
          {
            var randomIndex = rand.Next(directionList.Count / 2);

            int a = directionList[2 * randomIndex];
            int b = directionList[2 * randomIndex + 1];

            arr[a, b] = arr[Xcoord, Ycoord];

            spaceCoordList.AddRange(new int[2] { a, b });

            directionList.Clear();
            directionList.TrimExcess();
            draw = true;

            counter++;
            //Print(" Counter Number is : {0}", counter);
          }
        }
          //RIGHT TOP
        else if (Xcoord == 0 && Ycoord == (arr.GetLength(1) - 1))
        {
          if (arr[Xcoord + 1, Ycoord] == 0)
            directionList.Add(Xcoord + 1); directionList.Add(Ycoord);

          if (arr[Xcoord, Ycoord - 1] == 0)
            directionList.Add(Xcoord); directionList.Add(Ycoord - 1);

          if (directionList.Count > 0)
          {
            var randomIndex = rand.Next(directionList.Count / 2);

            int a = directionList[2 * randomIndex];
            int b = directionList[2 * randomIndex + 1];

            arr[a, b] = arr[Xcoord, Ycoord];

            spaceCoordList.AddRange(new int[2] { a, b });

            directionList.Clear();
            directionList.TrimExcess();

            draw = true;
            counter++;
            //Print(" Counter Number is : {0}", counter);
          }
        }
          //RIGHT BOTTOM
        else if (Xcoord == (arr.GetLength(0) - 1) && Ycoord == (arr.GetLength(1) - 1))
        {
          if (arr[Xcoord, Ycoord - 1] == 0)
            directionList.Add(Xcoord); directionList.Add(Ycoord - 1);

          if (arr[Xcoord - 1, Ycoord] == 0)
            directionList.Add(Xcoord - 1); directionList.Add(Ycoord);

          if (directionList.Count > 0)
          {
            var randomIndex = rand.Next(directionList.Count / 2);

            int a = directionList[2 * randomIndex];
            int b = directionList[2 * randomIndex + 1];

            arr[a, b] = arr[Xcoord, Ycoord];

            spaceCoordList.AddRange(new int[2] { a, b });

            directionList.Clear();
            directionList.TrimExcess();

            draw = true;
            counter++;
            //Print(" Counter Number is : {0}", counter);
          }
        }
          //LEFT BOTTOM
        else if (Xcoord == (arr.GetLength(1) - 1) && Ycoord == 0)
        {
          if (arr[Xcoord, Ycoord + 1] == 0)
            directionList.Add(Xcoord); directionList.Add(Ycoord - 1);

          if (arr[Xcoord - 1, Ycoord] == 0)
            directionList.Add(Xcoord - 1 - 1); directionList.Add(Ycoord);

          if (directionList.Count > 0)
          {
            var randomIndex = rand.Next(directionList.Count / 2);

            int a = directionList[2 * randomIndex];
            int b = directionList[2 * randomIndex + 1];

            arr[a, b] = arr[Xcoord, Ycoord];

            spaceCoordList.AddRange(new int[2] { a, b });

            directionList.Clear();
            directionList.TrimExcess();

            draw = true;
            counter++;
            //Print(" Counter Number is : {0}", counter);
          }
        }
        /* EDGE CONDITIONS */
      }
    }

  }


    /* Instead of wrting methods seperately in main program, it is better to use class based
     informations to keep things organized, we are not yet transsferentrance methods here but we created the str.*/

    /*
    public class Zone
    {
        public string Name;
        public int SpaceLimit;
        public Int16 SpaceSize;
        public int Counter;
        public List<Int16> SpaceList;

        public void Describe()
        {
            Console.WriteLine("Hey this zone is{ 0} ", Name);
        }

        public Zone()
        {
           // SpaceList = new List<int>();
        }

        public Zone(string name, int spaceLimit,int spacesize,int counter, List<int> SpaceList)
        :this()
        {
        }
        static void InitializeZeroMatrice() { }
        static void startZones() { }
        public void SpreadZones() { }

    }
    */
# ---------- end c_script_3 ----------
panel_18 = Panel(c_script_3.out)
multiplication_8 = Multiplication(A=number_slider_117, B=number_slider_116)  # disabled
number_slider_119 = Slider(18, range=0..100)  # disabled

# ---- group: Visualize as 3D Boxes
number_slider_120 = Slider(0, range=0..1)
colour_picker_7 = ColourPicker(PickedColour=RGB(255, 255, 255))
colour_picker_8 = ColourPicker(PickedColour=RGB(255, 0, 0))
colour_picker_9 = ColourPicker(PickedColour=RGB(0, 0, 255))
colour_picker_10 = ColourPicker(PickedColour=RGB(0, 255, 0))
colour_picker_11 = ColourPicker(PickedColour=RGB(255, 255, 0))
colour_picker_12 = ColourPicker(PickedColour=RGB(0, 0, 0))
create_material_7 = CreateMaterial(Diffuse=colour_picker_8, Specular=RGB(255, 255, 255), Emission=RGB(0, 0, 0), Transparency=number_slider_120, Shine=0)
create_material_8 = CreateMaterial(Diffuse=colour_picker_10, Specular=RGB(255, 255, 255), Emission=RGB(0, 0, 0), Transparency=number_slider_120, Shine=0)
create_material_9 = CreateMaterial(Diffuse=colour_picker_9, Specular=RGB(255, 255, 255), Emission=RGB(0, 0, 0), Transparency=number_slider_120, Shine=0)
create_material_10 = CreateMaterial(Diffuse=colour_picker_11, Specular=RGB(255, 255, 255), Emission=RGB(0, 0, 0), Transparency=number_slider_120, Shine=0)
create_material_11 = CreateMaterial(Diffuse=colour_picker_12, Specular=RGB(255, 255, 255), Emission=RGB(0, 0, 0), Transparency=number_slider_120, Shine=0)
create_material_12 = CreateMaterial(Diffuse=colour_picker_7, Specular=RGB(255, 255, 255), Emission=RGB(0, 0, 0), Transparency=Slider(1, range=0..1), Shine=0)
custom_preview_7 = CustomPreview(Geometry=c_script_3.R, Material=create_material_7)
custom_preview_8 = CustomPreview(Geometry=c_script_3.W, Material=create_material_12)
custom_preview_9 = CustomPreview(Geometry=c_script_3.B, Material=create_material_9)
custom_preview_10 = CustomPreview(Geometry=c_script_3.G, Material=create_material_8)
custom_preview_11 = CustomPreview(Geometry=c_script_3.Y, Material=create_material_10)
custom_preview_12 = CustomPreview(Geometry=c_script_3.K, Material=create_material_11)

# ----
division_6 = Division(A=number_slider_119, B=multiplication_8)  # disabled

# ---- group: Visualize as 3D Boxes
center_box_7 = CenterBox(Base=c_script_2.W, X=division_5, Y=division_5, Z=division_5)  # disabled
center_box_8 = CenterBox(Base=c_script_2.G, X=division_5, Y=division_5, Z=division_5)  # disabled
center_box_9 = CenterBox(Base=c_script_2.Y, X=division_5, Y=division_5, Z=division_5)  # disabled
center_box_10 = CenterBox(Base=c_script_2.K, X=division_5, Y=division_5, Z=division_5)  # disabled
center_box_11 = CenterBox(Base=c_script_2.B, X=division_5, Y=division_5, Z=division_5)  # disabled
center_box_12 = CenterBox(Base=c_script_2.R, X=division_5, Y=division_5, Z=division_5)  # disabled
number_slider_121 = Slider(0.2, range=0..1)  # disabled
colour_picker_13 = ColourPicker(PickedColour=RGB(255, 0, 0))  # disabled
colour_picker_14 = ColourPicker(PickedColour=RGB(255, 255, 255))  # disabled
colour_picker_15 = ColourPicker(PickedColour=RGB(0, 0, 255))  # disabled
colour_picker_16 = ColourPicker(PickedColour=RGB(0, 255, 0))  # disabled
colour_picker_17 = ColourPicker(PickedColour=RGB(255, 255, 0))  # disabled
colour_picker_18 = ColourPicker(PickedColour=RGB(0, 0, 0))  # disabled
create_material_13 = CreateMaterial(Diffuse=colour_picker_13, Specular=RGB(255, 255, 255), Emission=RGB(0, 0, 0), Transparency=number_slider_121, Shine=0)  # disabled
create_material_14 = CreateMaterial(Diffuse=colour_picker_16, Specular=RGB(255, 255, 255), Emission=RGB(0, 0, 0), Transparency=number_slider_121, Shine=0)  # disabled
create_material_15 = CreateMaterial(Diffuse=colour_picker_14, Specular=RGB(255, 255, 255), Emission=RGB(0, 0, 0), Transparency=number_slider_121, Shine=0)  # disabled
create_material_16 = CreateMaterial(Diffuse=colour_picker_15, Specular=RGB(255, 255, 255), Emission=RGB(0, 0, 0), Transparency=number_slider_121, Shine=0)  # disabled
create_material_17 = CreateMaterial(Diffuse=colour_picker_17, Specular=RGB(255, 255, 255), Emission=RGB(0, 0, 0), Transparency=number_slider_121, Shine=0)  # disabled
create_material_18 = CreateMaterial(Diffuse=colour_picker_18, Specular=RGB(255, 255, 255), Emission=RGB(0, 0, 0), Transparency=number_slider_121, Shine=0)  # disabled
custom_preview_13 = CustomPreview(Geometry=center_box_12, Material=create_material_13)  # disabled
custom_preview_14 = CustomPreview(Geometry=center_box_7, Material=create_material_15)  # disabled
custom_preview_15 = CustomPreview(Geometry=center_box_11, Material=create_material_16)  # disabled
custom_preview_16 = CustomPreview(Geometry=center_box_8, Material=create_material_14)  # disabled
custom_preview_17 = CustomPreview(Geometry=center_box_9, Material=create_material_17)  # disabled
custom_preview_18 = CustomPreview(Geometry=center_box_10, Material=create_material_18)  # disabled

# ----
list_length = ListLength(List=c_script_3.R)
list_length_2 = ListLength(List=c_script_3.B)
list_length_3 = ListLength(List=c_script_3.Y)
list_length_4 = ListLength(List=c_script_3.K)
list_length_5 = ListLength(List=c_script_3.G)
list_length_6 = ListLength(List=c_script_3.W)
multiplication_9 = Multiplication(A=list_length, B=division_4)
multiplication_10 = Multiplication(A=list_length_2, B=division_4)
multiplication_11 = Multiplication(A=list_length_3, B=division_4)
multiplication_12 = Multiplication(A=list_length_4, B=division_4)
multiplication_13 = Multiplication(A=list_length_5, B=division_4)
multiplication_14 = Multiplication(A=list_length_6, B=division_4)
panel_19 = Panel(multiplication_9)
panel_20 = Panel(multiplication_10)
panel_21 = Panel(multiplication_11)
panel_22 = Panel(multiplication_12)
panel_23 = Panel(multiplication_13)
panel_24 = Panel(multiplication_14)
concatenate = Concatenate(Fragment_A=" PersonalSpace = ", Fragment_B=panel_20, Fragment_C="m2 ")
concatenate_2 = Concatenate(Fragment_A=" Kitchen = ", Fragment_B=panel_21, Fragment_C="m2 ")
concatenate_3 = Concatenate(Fragment_A=" Common Area = ", Fragment_B=panel_22, Fragment_C=" m2 ")
concatenate_4 = Concatenate(Fragment_A=" WetArea = ", Fragment_B=panel_23, Fragment_C="m2 ")
concatenate_5 = Concatenate(Fragment_A=" Entrance = ", Fragment_B=panel_19, Fragment_C="m2 ")
concatenate_6 = Concatenate(Fragment_A=" Empty Space= ", Fragment_B=panel_24, Fragment_C="m2 ")
number_slider_122 = Slider(15, range=0..100)
panel_25 = Panel(concatenate)
panel_26 = Panel(concatenate_2)
panel_27 = Panel(concatenate_3)
panel_28 = Panel(concatenate_4)
panel_29 = Panel(concatenate_5)
panel_30 = Panel(concatenate_6)
text_tag_3d = TextTag3D(Location="240,-50", Text=concatenate_5, Size=number_slider_122, Justification=7)
text_tag_3d_2 = TextTag3D(Location="240,-110", Text=concatenate, Size=number_slider_122, Justification=7)
text_tag_3d_3 = TextTag3D(Location="240,-80", Text=concatenate_4, Size=number_slider_122, Justification=7)
text_tag_3d_4 = TextTag3D(Location="240,-200", Text=concatenate_6, Size=number_slider_122, Justification=7)
text_tag_3d_5 = TextTag3D(Location="240,-170", Text=concatenate_3, Size=number_slider_122, Justification=7)
text_tag_3d_6 = TextTag3D(Location="240,-140", Text=concatenate_2, Size=number_slider_122, Justification=7)
mass_addition = MassAddition(Input=[multiplication_13, multiplication_9, multiplication_10, multiplication_11, multiplication_12])  # -> Result, PartialResults
panel_31 = Panel(mass_addition.Result)
list_length_7 = ListLength(List=center_box_12)  # disabled
list_length_8 = ListLength(List=center_box_11)  # disabled
list_length_9 = ListLength(List=center_box_9)  # disabled
list_length_10 = ListLength(List=center_box_10)  # disabled
list_length_11 = ListLength(List=center_box_8)  # disabled
list_length_12 = ListLength(List=center_box_7)  # disabled
concatenate_7 = Concatenate(Fragment_A=" Total Area =", Fragment_B=panel_31, Fragment_C="m2 ")
multiplication_15 = Multiplication(A=list_length_7, B=division_6)  # disabled
multiplication_16 = Multiplication(A=list_length_8, B=division_6)  # disabled
multiplication_17 = Multiplication(A=list_length_9, B=division_6)  # disabled
multiplication_18 = Multiplication(A=list_length_10, B=division_6)  # disabled
multiplication_19 = Multiplication(A=list_length_11, B=division_6)  # disabled
multiplication_20 = Multiplication(A=list_length_12, B=division_6)  # disabled
panel_32 = Panel(concatenate_7)
text_tag_3d_7 = TextTag3D(Location="500,-100", Text=concatenate_7, Size=number_slider_122, Justification=7)
panel_33 = Panel("m2 ")  # disabled
panel_34 = Panel(multiplication_15)  # disabled
panel_35 = Panel(" Entrance = ")  # disabled
panel_36 = Panel("m2 ")  # disabled
panel_37 = Panel(multiplication_16)  # disabled
panel_38 = Panel("m2 ")  # disabled
panel_39 = Panel(multiplication_17)  # disabled
panel_40 = Panel(" m2 ")  # disabled
panel_41 = Panel("m2 ")  # disabled
panel_42 = Panel(" PersonalSpace = ")  # disabled
panel_43 = Panel(" Kitchen = ")  # disabled
panel_44 = Panel(multiplication_18)  # disabled
panel_45 = Panel(multiplication_19)  # disabled
panel_46 = Panel(" Common Area = ")  # disabled
panel_47 = Panel(" WetArea = ")  # disabled
panel_48 = Panel("m2 ")  # disabled
panel_49 = Panel(multiplication_20)  # disabled
panel_50 = Panel(" Empty Space= ")  # disabled
panel_51 = Panel("60,-70")  # disabled
panel_52 = Panel("180,-70")  # disabled
concatenate_8 = Concatenate(Fragment_A=panel_35, Fragment_B=panel_34, Fragment_C=panel_33)  # disabled
panel_53 = Panel("240,-60")  # disabled
panel_54 = Panel("300,-70")  # disabled
panel_55 = Panel("120,-70")  # disabled
concatenate_9 = Concatenate(Fragment_A=panel_42, Fragment_B=panel_37, Fragment_C=panel_36)  # disabled
concatenate_10 = Concatenate(Fragment_A=panel_43, Fragment_B=panel_39, Fragment_C=panel_38)  # disabled
concatenate_11 = Concatenate(Fragment_A=panel_46, Fragment_B=panel_44, Fragment_C=panel_40)  # disabled
concatenate_12 = Concatenate(Fragment_A=panel_47, Fragment_B=panel_45, Fragment_C=panel_41)  # disabled
panel_56 = Panel("360,-70")  # disabled
concatenate_13 = Concatenate(Fragment_A=panel_50, Fragment_B=panel_49, Fragment_C=panel_48)  # disabled
panel_57 = Panel(concatenate_8)  # disabled
panel_58 = Panel(concatenate_9)  # disabled
panel_59 = Panel(concatenate_10)  # disabled
panel_60 = Panel(concatenate_11)  # disabled
panel_61 = Panel(concatenate_12)  # disabled
text_tag = TextTag(Location=panel_51, Text=concatenate_8)  # disabled
panel_62 = Panel(concatenate_13)  # disabled
text_tag_2 = TextTag(Location=panel_52, Text=concatenate_9)  # disabled
text_tag_3 = TextTag(Location=panel_53, Text=concatenate_10)  # disabled
text_tag_4 = TextTag(Location=panel_54, Text=concatenate_11)  # disabled
text_tag_5 = TextTag(Location=panel_55, Text=concatenate_12)  # disabled
text_tag_6 = TextTag(Location=panel_56, Text=concatenate_13)  # disabled
mass_addition_2 = MassAddition(Input=[multiplication_19, multiplication_15, multiplication_16, multiplication_17, multiplication_18])  # -> Result, PartialResults; disabled
panel_63 = Panel("m2 ")  # disabled
panel_64 = Panel(mass_addition_2.Result)  # disabled
panel_65 = Panel(" Total Area =")  # disabled
panel_66 = Panel("420,-70")  # disabled
concatenate_14 = Concatenate(Fragment_A=panel_65, Fragment_B=panel_64, Fragment_C=panel_63)  # disabled
panel_67 = Panel(concatenate_14)  # disabled
text_tag_7 = TextTag(Location=panel_66, Text=concatenate_14)  # disabled
