# Grasshopper definition CemGrasshopperC#131.gh (Grasshopper 1.0.7)

X = Slider(60, range=45..60)
Y = Slider(60, range=45..60)
Z = Slider(40, range=40..50)

# ----
# Sink
X_2 = Slider(30, range=26..40)  # disabled
# Stove
Y_2 = Slider(58, range=48..58)  # disabled
rectangle = Rectangle(Plane=PlaneXY(1500, 0, 0), XSize=X_2, YSize=Y_2, Radius=0)  # -> Rectangle, Length; disabled
Z_2 = Slider(15, range=15..22)  # disabled
stove = BoxRectangle(Rectangle=rectangle.Rectangle, Height=Z_2)  # disabled

# ----
# Lower Bed
number_slider = Slider(20, range=20..100)
# Counter 2
number_slider_2 = Slider(75, range=75..100)  # disabled

# ----
# Drawer
X_3 = Slider(60, range=60..100)  # disabled
Y_3 = Slider(60, range=50..65)  # disabled
Z_3 = Slider(18, range=18..25)  # disabled
rectangle_2 = Rectangle(Plane=PlaneXY(400, 0, 0), XSize=X_3, YSize=Y_3, Radius=0)  # -> Rectangle, Length; disabled
drawer = BoxRectangle(Rectangle=rectangle_2.Rectangle, Height=Z_3)  # disabled

# ----
# Counter 1
number_slider_3 = Slider(75, range=75..100)
# Table 1
number_slider_4 = Slider(100, range=75..100)
# Sitting Unit
number_slider_5 = Slider(75, range=75..100)

X_4 = Slider(60, range=55..70)  # disabled
# Fridge
Y_4 = Slider(60, range=50..65)  # disabled
rectangle_3 = Rectangle(Plane=PlaneXY(600, 0, 0), XSize=X_4, YSize=Y_4, Radius=0)  # -> Rectangle, Length; disabled
Z_4 = Slider(79, range=72..79)  # disabled
fridge = BoxRectangle(Rectangle=rectangle_3.Rectangle, Height=Z_4)  # disabled

X_5 = Slider(120, range=100..140)  # disabled
Y_5 = Slider(60, range=50..65)  # disabled
Z_5 = Slider(3, range=3..6)  # disabled

X_6 = Slider(60, range=38..60)  # disabled
Y_6 = Slider(44, range=38..50)  # disabled
rectangle_4 = Rectangle(Plane=PlaneXY(1300, 0, 0), XSize=X_6, YSize=Y_6, Radius=0)  # -> Rectangle, Length; disabled
Z_6 = Slider(22, range=13..22)  # disabled
table_2 = BoxRectangle(Rectangle=rectangle_4.Rectangle, Height=Z_6)  # disabled

Z_7 = Slider(3, range=3..6)
Y_7 = Slider(60, range=50..65)
X_7 = Slider(120, range=100..140)

X_8 = Slider(60, range=60..100)  # disabled
# Table 2
Y_8 = Slider(120, range=110..140)  # disabled
rectangle_5 = Rectangle(Plane=PlaneXY(1100, 0, 0), XSize=X_8, YSize=Y_8, Radius=0)  # -> Rectangle, Length; disabled
Z_8 = Slider(6, range=2..6)  # disabled
table_2_2 = BoxRectangle(Rectangle=rectangle_5.Rectangle, Height=Z_8)  # disabled

Z_9 = Slider(20, range=20..40)
X_9 = Slider(210, range=200..220)
Y_9 = Slider(120, range=90..120)

X_10 = Slider(120, range=110..140)
Z_10 = Slider(6, range=2..6)
Y_10 = Slider(60, range=60..100)

construct_point = ConstructPoint(XCoordinate=X_10, YCoordinate=Y_10, ZCoordinate=Z_10)
# Interior Door
vector_xyz = VectorXYZ(XComponent=Slider(0, range=0..1000), YComponent=0, ZComponent=0)  # -> Vector, Length
vector_xyz_2 = VectorXYZ(XComponent=0, YComponent=0, ZComponent=number_slider)  # -> Vector, Length
construct_point_2 = ConstructPoint(XCoordinate=X_7, YCoordinate=Y_7, ZCoordinate=Z_7)  # disabled
vector_xyz_3 = VectorXYZ(XComponent=Slider(0, range=0..1000), YComponent=0, ZComponent=0)  # -> Vector, Length
vector_xyz_4 = VectorXYZ(XComponent=0, YComponent=0, ZComponent=number_slider_2)  # -> Vector, Length; disabled
vector_xyz_5 = VectorXYZ(XComponent=Slider(0, range=0..1000), YComponent=0, ZComponent=0)  # -> Vector, Length
vector_xyz_6 = VectorXYZ(XComponent=Slider(0, range=0..2000), YComponent=0, ZComponent=0)  # -> Vector, Length
vector_xyz_7 = VectorXYZ(XComponent=0, YComponent=0, ZComponent=number_slider_3)  # -> Vector, Length
vector_xyz_8 = VectorXYZ(XComponent=0, YComponent=0, ZComponent=number_slider_5)  # -> Vector, Length
vector_xyz_9 = VectorXYZ(XComponent=0, YComponent=0, ZComponent=number_slider_4)  # -> Vector, Length
counter_1 = DomainBox(Base=vector_xyz_4.Vector, X=X_5, Y=Y_5, Z=Z_5)  # disabled
# Objects in Level 1
counter_1_2 = DomainBox(Base=vector_xyz_7.Vector, X=X_7, Y=Y_7, Z=Z_7)
table_1 = DomainBox(Base=vector_xyz_8.Vector, X=X, Y=Y, Z=Z)
table_1_2 = DomainBox(Base=vector_xyz_9.Vector, X=X_10, Y=Y_10, Z=Z_10)
lower_bed = DomainBox(Base=vector_xyz_2.Vector, X=X_9, Y=Y_9, Z=Z_9)
move = Move(Geometry=construct_point, Motion=vector_xyz_9.Vector)  # -> Geometry, Transform
move_2 = Move(Geometry=construct_point_2, Motion=vector_xyz_7.Vector)  # -> Geometry, Transform; disabled

deconstruct_box = DeconstructBox(Box=counter_1_2)  # -> Plane, X, Y, Z
deconstruct_domain = DeconstructDomain(Domain=deconstruct_box.Y)  # -> Start, End
deconstruct_domain_2 = DeconstructDomain(Domain=deconstruct_box.Z)  # -> Start, End
margin_front = Slider(60, range=60..80)
margin_top = Slider(90, range=70..90)
margin_bottom = Slider(-72, range=-72..-69)
addition = Addition(A=deconstruct_domain.End, B=margin_front)
addition_2 = Addition(A=margin_bottom, B=deconstruct_domain_2.Start)
addition_3 = Addition(A=deconstruct_domain_2.End, B=margin_top)
back_front_margin = ConstructDomain(DomainStart=deconstruct_domain.Start, DomainEnd=addition)
top_bottom_margin = ConstructDomain(DomainStart=addition_2, DomainEnd=addition_3)
counter_1_margin = DomainBox(Base=deconstruct_box.Plane, LEFTRIGHT=deconstruct_box.X, BACKFRONT=back_front_margin, TOPBOTTOM=top_bottom_margin)

interior_door = DomainBox(Base=vector_xyz.Vector, X=Slider(100, range=90..100), Y=Slider(5, range=5..15), Z=Slider(200, range=150..220))

deconstruct_box_2 = DeconstructBox(Box=drawer)  # -> Plane, X, Y, Z; disabled
margin_front_2 = Slider(60, range=60..80)  # disabled
margin_right = Slider(60, range=0..80)  # disabled
margin_left = Slider(-60, range=-80..0)  # disabled
deconstruct_domain_3 = DeconstructDomain(Domain=deconstruct_box_2.X)  # -> Start, End; disabled
deconstruct_domain_4 = DeconstructDomain(Domain=deconstruct_box_2.Y)  # -> Start, End; disabled
addition_4 = Addition(A=margin_left, B=deconstruct_domain_3.Start)  # disabled
addition_5 = Addition(A=deconstruct_domain_3.End, B=margin_right)  # disabled
addition_6 = Addition(A=deconstruct_domain_4.End, B=margin_front_2)  # disabled
left_right_margin = ConstructDomain(DomainStart=addition_4, DomainEnd=addition_5)  # disabled
back_front_margin_2 = ConstructDomain(DomainStart=deconstruct_domain_4.Start, DomainEnd=addition_6)  # disabled
drawer_margin = DomainBox(Base=deconstruct_box_2.Plane, LEFTRIGHT=left_right_margin, BACKFRONT=back_front_margin_2, TOPBOTTOM=deconstruct_box_2.Z)  # disabled

deconstruct_box_3 = DeconstructBox(Box=counter_1)  # -> Plane, X, Y, Z; disabled
deconstruct_domain_5 = DeconstructDomain(Domain=deconstruct_box_3.Z)  # -> Start, End; disabled
deconstruct_domain_6 = DeconstructDomain(Domain=deconstruct_box_3.Y)  # -> Start, End; disabled
margin_back = Slider(-60, range=-80..-60)  # disabled
margin_front_3 = Slider(60, range=60..80)  # disabled
margin_bottom_2 = Slider(-72, range=-72..-69)  # disabled
margin_top_2 = Slider(90, range=70..90)  # disabled
addition_7 = Addition(A=margin_back, B=deconstruct_domain_6.Start)  # disabled
addition_8 = Addition(A=margin_bottom_2, B=deconstruct_domain_5.Start)  # disabled
addition_9 = Addition(A=deconstruct_domain_5.End, B=margin_top_2)  # disabled
addition_10 = Addition(A=deconstruct_domain_6.End, B=margin_front_3)  # disabled
top_bottom_margin_2 = ConstructDomain(DomainStart=addition_8, DomainEnd=addition_9)  # disabled
back_front_margin_3 = ConstructDomain(DomainStart=addition_7, DomainEnd=addition_10)  # disabled
counter_2_margin = DomainBox(
    Base=deconstruct_box_3.Plane,
    LEFTRIGHT=deconstruct_box_3.X,
    BACKFRONT=back_front_margin_3,
    TOPBOTTOM=top_bottom_margin_2)  # disabled

deconstruct_box_4 = DeconstructBox(Box=fridge)  # -> Plane, X, Y, Z; disabled
deconstruct_domain_7 = DeconstructDomain(Domain=deconstruct_box_4.Y)  # -> Start, End; disabled
addition_11 = Addition(A=deconstruct_domain_7.End, B=X_4)  # disabled
back_front_margin_4 = ConstructDomain(DomainStart=deconstruct_domain_7.Start, DomainEnd=addition_11)  # disabled
fridge_margin = DomainBox(
    Base=deconstruct_box_4.Plane,
    LEFTRIGHT=deconstruct_box_4.X,
    BACKFRONT=back_front_margin_4,
    TOPBOTTOM=deconstruct_box_4.Z)  # disabled

deconstruct_box_5 = DeconstructBox(Box=lower_bed)  # -> Plane, X, Y, Z
margin_top_3 = Slider(90, range=70..90)
margin_bottom_3 = Slider(-40, range=-50..-40)
margin_front_4 = Slider(60, range=60..80)
deconstruct_domain_8 = DeconstructDomain(Domain=deconstruct_box_5.Z)  # -> Start, End
deconstruct_domain_9 = DeconstructDomain(Domain=deconstruct_box_5.Y)  # -> Start, End
addition_12 = Addition(A=margin_bottom_3, B=deconstruct_domain_8.Start)
addition_13 = Addition(A=deconstruct_domain_8.End, B=margin_top_3)
addition_14 = Addition(A=deconstruct_domain_9.End, B=margin_front_4)
back_front_margin_5 = ConstructDomain(DomainStart=deconstruct_domain_9.Start, DomainEnd=addition_14)
top_bottom_margin_3 = ConstructDomain(DomainStart=addition_12, DomainEnd=addition_13)
lower_bed_margin = DomainBox(
    Base=deconstruct_box_5.Plane,
    LEFTRIGHT=deconstruct_box_5.X,
    BACKFRONT=back_front_margin_5,
    TOPBOTTOM=top_bottom_margin_3)

deconstruct_box_6 = DeconstructBox(Box=table_1_2)  # -> Plane, X, Y, Z
margin_top_4 = Slider(135, range=130..135)
margin_right_2 = Slider(-60, range=-80..-50)
margin_top_5 = Slider(-78, range=-78..-66)
margin_left_2 = Slider(60, range=50..80)
deconstruct_domain_10 = DeconstructDomain(Domain=deconstruct_box_6.Z)  # -> Start, End
deconstruct_domain_11 = DeconstructDomain(Domain=deconstruct_box_6.X)  # -> Start, End
deconstruct_domain_12 = DeconstructDomain(Domain=deconstruct_box_6.Y)  # -> Start, End
margin_front_5 = Slider(60, range=50..80)
addition_15 = Addition(A=margin_right_2, B=deconstruct_domain_11.Start)
addition_16 = Addition(A=deconstruct_domain_10.End, B=margin_top_4)
addition_17 = Addition(A=deconstruct_domain_12.End, B=margin_front_5)
addition_18 = Addition(A=deconstruct_domain_11.End, B=margin_left_2)
addition_19 = Addition(A=margin_top_5, B=deconstruct_domain_10.Start)
back_front_margin_6 = ConstructDomain(DomainStart=deconstruct_domain_12.Start, DomainEnd=addition_17)
top_bottom_margin_4 = ConstructDomain(DomainStart=addition_19, DomainEnd=addition_16)
left_right_margin_2 = ConstructDomain(DomainStart=addition_15, DomainEnd=addition_18)
table_1_margin = DomainBox(
    Base=deconstruct_box_6.Plane,
    LEFTRIGHT=left_right_margin_2,
    BACKFRONT=back_front_margin_6,
    TOPBOTTOM=top_bottom_margin_4)

exterior_door = DomainBox(Base=vector_xyz_3.Vector, X=Slider(100, range=90..100), Y=Slider(10, range=5..15), Z=Slider(200, range=150..220))
closet = DomainBox(Base=vector_xyz_6.Vector, X=Slider(230, range=110..230), Y=Slider(60, range=55..65), Z=Slider(210, range=2..220))
changeover_zone = DomainBox(Base=vector_xyz_5.Vector, X=Slider(60, range=50..65), Y=Slider(40, range=35..45), Z=Slider(2, range=2..220))

deconstruct_box_7 = DeconstructBox(Box=table_2_2)  # -> Plane, X, Y, Z; disabled
margin_top_6 = Slider(135, range=130..135)  # disabled
margin_top_7 = Slider(-78, range=-78..-66)  # disabled
margin_right_3 = Slider(-60, range=-80..-50)  # disabled
margin_front_6 = Slider(60, range=50..80)  # disabled
margin_left_3 = Slider(60, range=50..80)  # disabled
deconstruct_domain_13 = DeconstructDomain(Domain=deconstruct_box_7.Z)  # -> Start, End; disabled
deconstruct_domain_14 = DeconstructDomain(Domain=deconstruct_box_7.X)  # -> Start, End; disabled
deconstruct_domain_15 = DeconstructDomain(Domain=deconstruct_box_7.Y)  # -> Start, End; disabled
addition_20 = Addition(A=margin_right_3, B=deconstruct_domain_14.Start)  # disabled
addition_21 = Addition(A=deconstruct_domain_13.End, B=margin_top_6)  # disabled
addition_22 = Addition(A=deconstruct_domain_15.End, B=margin_front_6)  # disabled
addition_23 = Addition(A=deconstruct_domain_14.End, B=margin_left_3)  # disabled
addition_24 = Addition(A=margin_top_7, B=deconstruct_domain_13.Start)  # disabled
back_front_margin_7 = ConstructDomain(DomainStart=deconstruct_domain_15.Start, DomainEnd=addition_22)  # disabled
top_bottom_margin_5 = ConstructDomain(DomainStart=addition_24, DomainEnd=addition_21)  # disabled
left_right_margin_3 = ConstructDomain(DomainStart=addition_20, DomainEnd=addition_23)  # disabled
table_2_margin = DomainBox(
    Base=deconstruct_box_7.Plane,
    LEFTRIGHT=left_right_margin_3,
    BACKFRONT=back_front_margin_7,
    TOPBOTTOM=top_bottom_margin_5)  # disabled

deconstruct_box_8 = DeconstructBox(Box=stove)  # -> Plane, X, Y, Z; disabled
margin_top_8 = Slider(90, range=70..90)  # disabled
deconstruct_domain_16 = DeconstructDomain(Domain=deconstruct_box_8.Z)  # -> Start, End; disabled
deconstruct_domain_17 = DeconstructDomain(Domain=deconstruct_box_8.Y)  # -> Start, End; disabled
margin_front_7 = Slider(60, range=60..80)  # disabled
addition_25 = Addition(A=deconstruct_domain_16.End, B=margin_top_8)  # disabled
addition_26 = Addition(A=deconstruct_domain_17.End, B=margin_front_7)  # disabled
back_front_margin_8 = ConstructDomain(DomainStart=deconstruct_domain_17.Start, DomainEnd=addition_26)  # disabled
top_bottom_margin_6 = ConstructDomain(DomainStart=deconstruct_domain_16.Start, DomainEnd=addition_25)  # disabled
stove_margin = DomainBox(
    Base=deconstruct_box_8.Plane,
    LEFTRIGHT=deconstruct_box_8.X,
    BACKFRONT=back_front_margin_8,
    TOPBOTTOM=top_bottom_margin_6)  # disabled

deconstruct_box_9 = DeconstructBox(Box=table_1)  # -> Plane, X, Y, Z
margin_right_4 = Slider(-60, range=-60..-45)
margin_left_4 = Slider(60, range=45..60)
margin_top_9 = Slider(160, range=150..160)
deconstruct_domain_18 = DeconstructDomain(Domain=deconstruct_box_9.X)  # -> Start, End
deconstruct_domain_19 = DeconstructDomain(Domain=deconstruct_box_9.Z)  # -> Start, End
deconstruct_domain_20 = DeconstructDomain(Domain=deconstruct_box_9.Y)  # -> Start, End
addition_27 = Addition(A=deconstruct_domain_19.End, B=margin_top_9)
addition_28 = Addition(A=deconstruct_domain_20.End, B="5")
addition_29 = Addition(A=margin_right_4, B=deconstruct_domain_18.Start)
addition_30 = Addition(A=deconstruct_domain_18.End, B=margin_left_4)
left_right_margin_4 = ConstructDomain(DomainStart=addition_29, DomainEnd=addition_30)
back_front_margin_9 = ConstructDomain(DomainStart=deconstruct_domain_20.Start, DomainEnd=addition_28)
top_bottom_margin_7 = ConstructDomain(DomainStart=deconstruct_domain_19.Start, DomainEnd=addition_27)
sitting_unit_margin = DomainBox(
    Base=deconstruct_box_9.Plane,
    LEFTRIGHT=left_right_margin_4,
    BACKFRONT=back_front_margin_9,
    TOPBOTTOM=top_bottom_margin_7)

deconstruct_box_10 = DeconstructBox(Box=table_2)  # -> Plane, X, Y, Z; disabled
margin_top_10 = Slider(90, range=70..90)  # disabled
margin_front_8 = Slider(60, range=60..80)  # disabled
deconstruct_domain_21 = DeconstructDomain(Domain=deconstruct_box_10.Z)  # -> Start, End; disabled
deconstruct_domain_22 = DeconstructDomain(Domain=deconstruct_box_10.Y)  # -> Start, End; disabled
addition_31 = Addition(A=deconstruct_domain_22.End, B=margin_front_8)  # disabled
addition_32 = Addition(A=deconstruct_domain_21.End, B=margin_top_10)  # disabled
back_front_margin_10 = ConstructDomain(DomainStart=deconstruct_domain_22.Start, DomainEnd=addition_31)  # disabled
top_bottom_margin_8 = ConstructDomain(DomainStart=deconstruct_domain_21.Start, DomainEnd=addition_32)  # disabled
table_2_margin_2 = DomainBox(
    Base=deconstruct_box_10.Plane,
    LEFTRIGHT=deconstruct_box_10.X,
    BACKFRONT=back_front_margin_10,
    TOPBOTTOM=top_bottom_margin_8)  # disabled

deconstruct_box_11 = DeconstructBox(Box=interior_door)  # -> Plane, X, Y, Z
deconstruct_box_12 = DeconstructBox(Box=exterior_door)  # -> Plane, X, Y, Z
deconstruct_box_13 = DeconstructBox(Box=changeover_zone)  # -> Plane, X, Y, Z
deconstruct_box_14 = DeconstructBox(Box=closet)  # -> Plane, X, Y, Z
panel = Panel(deconstruct_box_11.X)
deconstruct_domain_23 = DeconstructDomain(Domain=deconstruct_box_11.Y)  # -> Start, End
panel_2 = Panel(deconstruct_box_12.X)
deconstruct_domain_24 = DeconstructDomain(Domain=deconstruct_box_12.Y)  # -> Start, End
panel_3 = Panel(deconstruct_box_13.X)
deconstruct_domain_25 = DeconstructDomain(Domain=deconstruct_box_13.Y)  # -> Start, End
deconstruct_domain_26 = DeconstructDomain(Domain=deconstruct_box_13.Z)  # -> Start, End
panel_4 = Panel(deconstruct_box_14.X)
deconstruct_domain_27 = DeconstructDomain(Domain=deconstruct_box_14.Y)  # -> Start, End
addition_33 = Addition(A=deconstruct_domain_23.End, B=Slider(80, range=0..500))
addition_34 = Addition(A=deconstruct_domain_24.End, B=Slider(100, range=0..500))
addition_35 = Addition(A=deconstruct_domain_25.End, B=Slider(60, range=0..60))
addition_36 = Addition(A=deconstruct_domain_26.End, B=Slider(210, range=0..210))
addition_37 = Addition(A=deconstruct_domain_23.Start, B=Slider(-80, range=-80..500))
# Margin :  Front 80
construct_domain = ConstructDomain(DomainStart=addition_37, DomainEnd=addition_33)
addition_38 = Addition(A=deconstruct_domain_27.End, B=Slider(65, range=0..500))
# Margin :  Front 100
construct_domain_2 = ConstructDomain(DomainStart=deconstruct_domain_24.Start, DomainEnd=addition_34)
construct_domain_3 = ConstructDomain(DomainStart=deconstruct_domain_25.Start, DomainEnd=addition_35)
# Margin :  Front 60
# Margin :  Top 210
construct_domain_4 = ConstructDomain(DomainStart=deconstruct_domain_26.Start, DomainEnd=addition_36)
# Margin : 65
construct_domain_5 = ConstructDomain(DomainStart=deconstruct_domain_27.Start, DomainEnd=addition_38)
panel_5 = Panel(construct_domain)
interor_door_margin = DomainBox(Base=interior_door, X=deconstruct_box_11.X, Y=construct_domain, Z=deconstruct_box_11.Z)
panel_6 = Panel(construct_domain_2)
change_over_zone_margin = DomainBox(Base=changeover_zone, X=deconstruct_box_13.X, Y=construct_domain_3, Z=construct_domain_4)
exterior_door_margin = DomainBox(Base=exterior_door, X=deconstruct_box_12.X, Y=construct_domain_2, Z=deconstruct_box_12.Z)
panel_7 = Panel(construct_domain_5)
panel_8 = Panel(construct_domain_4)
closet_margin = DomainBox(Base=closet, X=deconstruct_box_14.X, Y=construct_domain_5, Z=deconstruct_box_14.Z)
panel_9 = Panel(construct_domain_3)

# ----
# Upper Bed
X_11 = Slider(60, range=33..60)  # disabled
# Microwave Oven
Y_11 = Slider(58, range=30..58)  # disabled
rectangle_6 = Rectangle(Plane=PlaneXY(1700, 0, 0), XSize=X_11, YSize=Y_11, Radius=0)  # -> Rectangle, Length; disabled
Z_11 = Slider(25, range=25..41)  # disabled
microwave_oven = BoxRectangle(Rectangle=rectangle_6.Rectangle, Height=Z_11)  # disabled

X_12 = Slider(60, range=30..60)  # disabled
# Cupboard
Y_12 = Slider(45, range=30..45)  # disabled
rectangle_7 = Rectangle(Plane=PlaneXY(1900, 0, 0), XSize=X_12, YSize=Y_12, Radius=0)  # -> Rectangle, Length; disabled
Z_12 = Slider(30, range=30..50)  # disabled
# Objects in Level  2
cupboard = BoxRectangle(Rectangle=rectangle_7.Rectangle, Height=Z_12)  # disabled

X_13 = Slider(210, range=200..220)  # disabled
Y_13 = Slider(120, range=90..120)  # disabled
rectangle_8 = Rectangle(Plane=PlaneXY(2700, 0, 0), XSize=X_13, YSize=Y_13, Radius=0)  # -> Rectangle, Length; disabled
Z_13 = Slider(20, range=20..40)  # disabled
upper_bed = BoxRectangle(Rectangle=rectangle_8.Rectangle, Height=Z_13)  # disabled

# ----
# First Aid
number_slider_6 = Slider(200, range=75..200)

Y_14 = Slider(3, range=3..8)  # disabled
X_14 = Slider(60, range=43..82)  # disabled
# Monitor
division = Division(A=9, B=16)  # disabled
rectangle_9 = Rectangle(Plane=PlaneXY(2300, 0, 0), XSize=X_14, YSize=Y_14, Radius=0)  # -> Rectangle, Length; disabled
multiplication = Multiplication(A=X_14, B=division)  # disabled
monitor = BoxRectangle(Rectangle=rectangle_9.Rectangle, Height=multiplication)  # disabled

X_15 = Slider(60, range=30..60)
Y_15 = Slider(20, range=13..20)
Z_14 = Slider(60, range=30..60)

create_material = CreateMaterial(
    Diffuse=ColourSwatch(SwatchColor=RGB(120, 116, 107)),
    Specular=RGB(255, 255, 255),
    Emission=RGB(0, 0, 0),
    Transparency=Slider(0.8, range=0..1),
    Shine=0)
# Entrance
create_material_2 = CreateMaterial(
    Diffuse=ColourSwatch(SwatchColor=RGB(120, 116, 107)),
    Specular=RGB(255, 255, 255),
    Emission=RGB(0, 0, 0),
    Transparency=Slider(0.33, range=0..1),
    Shine=0)
vector_xyz_10 = VectorXYZ(XComponent=0, YComponent=0, ZComponent=number_slider_6)  # -> Vector, Length
firstaid = DomainBox(Base=vector_xyz_10.Vector, X=X_15, Y=Y_15, Z=Z_14)
create_material_3 = CreateMaterial(
    Diffuse=ColourSwatch(SwatchColor=RGB(120, 116, 107)),
    Specular=RGB(255, 255, 255),
    Emission=RGB(0, 0, 0),
    Transparency=Slider(0.8, range=0..1),
    Shine=0)
# Wet Area
create_material_4 = CreateMaterial(
    Diffuse=ColourSwatch(SwatchColor=RGB(120, 116, 107)),
    Specular=RGB(255, 255, 255),
    Emission=RGB(0, 0, 0),
    Transparency=Slider(0.33, range=0..1),
    Shine=0)
box = Box([interior_door, exterior_door, changeover_zone, closet])
box_2 = Box([interor_door_margin, exterior_door_margin, change_over_zone_margin, closet_margin])
custom_preview = CustomPreview(Geometry=box, Material=create_material_2)  # disabled
custom_preview_2 = CustomPreview(Geometry=box_2, Material=create_material)  # disabled

deconstruct_box_15 = DeconstructBox(Box=upper_bed)  # -> Plane, X, Y, Z; disabled
deconstruct_domain_28 = DeconstructDomain(Domain=deconstruct_box_15.Y)  # -> Start, End; disabled
margin_front_9 = Slider(60, range=60..80)  # disabled
deconstruct_domain_29 = DeconstructDomain(Domain=deconstruct_box_15.Z)  # -> Start, End; disabled
margin_top_11 = Slider(90, range=70..90)  # disabled
addition_39 = Addition(A=deconstruct_domain_28.End, B=margin_front_9)  # disabled
addition_40 = Addition(A=deconstruct_domain_29.End, B=margin_top_11)  # disabled
back_front_margin_11 = ConstructDomain(DomainStart=deconstruct_domain_28.Start, DomainEnd=addition_39)  # disabled
top_bottom_margin_9 = ConstructDomain(DomainStart=deconstruct_domain_29.Start, DomainEnd=addition_40)  # disabled
upper_bed_margin = DomainBox(
    Base=deconstruct_box_15.Plane,
    LEFTRIGHT=deconstruct_box_15.X,
    BACKFRONT=back_front_margin_11,
    TOPBOTTOM=top_bottom_margin_9)  # disabled

deconstruct_box_16 = DeconstructBox(Box=microwave_oven)  # -> Plane, X, Y, Z; disabled
margin_front_10 = Slider(60, range=60..80)  # disabled
deconstruct_domain_30 = DeconstructDomain(Domain=deconstruct_box_16.Y)  # -> Start, End; disabled
addition_41 = Addition(A=deconstruct_domain_30.End, B=margin_front_10)  # disabled
back_front_margin_12 = ConstructDomain(DomainStart=deconstruct_domain_30.Start, DomainEnd=addition_41)  # disabled
microwave_oven_margin = DomainBox(Base=deconstruct_box_16.Plane, LEFTRIGHT=deconstruct_box_16.X, BACKFRONT=back_front_margin_12, TOPBOTTOM=Domain(0, 0.25))  # disabled

deconstruct_box_17 = DeconstructBox(Box=firstaid)  # -> Plane, X, Y, Z
deconstruct_domain_31 = DeconstructDomain(Domain=deconstruct_box_17.Y)  # -> Start, End
addition_42 = Addition(A=deconstruct_domain_31.End, B="30")
back_front_margin_13 = ConstructDomain(DomainStart=deconstruct_domain_31.Start, DomainEnd=addition_42)
first_aid_margin = DomainBox(
    Base=deconstruct_box_17.Plane,
    LEFTRIGHT=deconstruct_box_17.X,
    BACKFRONT=back_front_margin_13,
    TOPBOTTOM=deconstruct_box_17.Z)

deconstruct_box_18 = DeconstructBox(Box=monitor)  # -> Plane, X, Y, Z; disabled
margin_front_11 = Slider(150, range=50..150)  # disabled
deconstruct_domain_32 = DeconstructDomain(Domain=deconstruct_box_18.Y)  # -> Start, End; disabled
addition_43 = Addition(A=deconstruct_domain_32.End, B=margin_front_11)  # disabled
back_front_margin_14 = ConstructDomain(DomainStart=deconstruct_domain_32.Start, DomainEnd=addition_43)  # disabled
monitor_margin = DomainBox(
    Base=deconstruct_box_18.Plane,
    LEFTRIGHT=deconstruct_box_18.X,
    BACKFRONT=back_front_margin_14,
    TOPBOTTOM=deconstruct_box_18.Z)  # disabled

deconstruct_box_19 = DeconstructBox(Box=cupboard)  # -> Plane, X, Y, Z; disabled
margin_front_12 = Slider(60, range=60..80)  # disabled
deconstruct_domain_33 = DeconstructDomain(Domain=deconstruct_box_19.Y)  # -> Start, End; disabled
addition_44 = Addition(A=deconstruct_domain_33.End, B=margin_front_12)  # disabled
back_front_margin_15 = ConstructDomain(DomainStart=deconstruct_domain_33.Start, DomainEnd=addition_44)  # disabled
cupboard_margin = DomainBox(
    Base=deconstruct_box_19.Plane,
    LEFTRIGHT=deconstruct_box_19.X,
    BACKFRONT=back_front_margin_15,
    TOPBOTTOM=deconstruct_box_19.Z)  # disabled

create_material_5 = CreateMaterial(
    Diffuse=ColourSwatch(SwatchColor=RGB(120, 116, 107)),
    Specular=RGB(255, 255, 255),
    Emission=RGB(0, 0, 0),
    Transparency=Slider(0.8, range=0..1),
    Shine=0)
# Common Area
create_material_6 = CreateMaterial(
    Diffuse=ColourSwatch(SwatchColor=RGB(120, 116, 107)),
    Specular=RGB(255, 255, 255),
    Emission=RGB(0, 0, 0),
    Transparency=Slider(0.33, range=0..1),
    Shine=0)
box_3 = Box([counter_1_2, table_1_2, table_1, lower_bed])
box_4 = Box([counter_1_margin, table_1_margin, sitting_unit_margin, lower_bed_margin])
custom_preview_3 = CustomPreview(Geometry=box_3, Material=create_material_6)  # disabled
custom_preview_4 = CustomPreview(Geometry=box_4, Material=create_material_5)  # disabled
number_slider_7 = Slider(10, range=0..10)
number_slider_8 = Slider(10, range=0..10)
multiplication_2 = Multiplication(A=Slider(30, range=0..100), B=number_slider_7)
multiplication_3 = Multiplication(A=Slider(60, range=20..60), B=number_slider_7)
multiplication_4 = Multiplication(A=Slider(6, range=2..10), B=number_slider_7)
multiplication_5 = Multiplication(A=Slider(36, range=20..60), B=number_slider_7)
panel_10 = Panel(multiplication_2)
panel_11 = Panel(multiplication_5)
panel_12 = Panel(multiplication_3)
multiplication_6 = Multiplication(A=multiplication_4, B=multiplication_4)
multiplication_7 = Multiplication(A=Slider(30, range=0..100), B=number_slider_8)
division_2 = Division(A=multiplication_3, B=multiplication_4)
panel_13 = Panel(multiplication_4)
division_3 = Division(A=multiplication_5, B=multiplication_4)
number_slider_9 = Slider(150, range=0..1000)
multiplication_8 = Multiplication(A=Slider(60, range=20..60), B=number_slider_8)
multiplication_9 = Multiplication(A=Slider(6, range=2..10), B=number_slider_8)
multiplication_10 = Multiplication(A=Slider(36, range=20..60), B=number_slider_8)
multiplication_11 = Multiplication(A=Slider(10000, range=0..10000), B=Slider(2, range=0..10))
division_4 = Division(A=multiplication_6, B=multiplication_11)
panel_14 = Panel(division_3)
panel_15 = Panel(multiplication_7)
panel_16 = Panel(multiplication_10)
panel_17 = Panel(multiplication_8)
multiplication_12 = Multiplication(A=multiplication_9, B=multiplication_9)
integer = Integer(division_3)
integer_2 = Integer(division_2)
integer_3 = Integer(panel_10)
box_5 = Box(closet_margin)
box_6 = Box(changeover_zone)
box_7 = Box(closet)
box_8 = Box(interior_door)
box_9 = Box(interor_door_margin)
box_10 = Box(exterior_door)
box_11 = Box(exterior_door_margin)
box_12 = Box(counter_1_2)
box_13 = Box(counter_1_margin)
box_14 = Box(change_over_zone_margin)
box_15 = Box(table_1_2)
box_16 = Box(table_1_margin)
box_17 = Box(lower_bed_margin)
box_18 = Box(table_1)
box_19 = Box(firstaid)
box_20 = Box(first_aid_margin)
box_21 = Box(sitting_unit_margin)
box_22 = Box(lower_bed)
division_5 = Division(A=multiplication_8, B=multiplication_9)
panel_18 = Panel(multiplication_9)
division_6 = Division(A=multiplication_10, B=multiplication_9)
multiplication_13 = Multiplication(A=Slider(10000, range=0..10000), B=Slider(2, range=0..10))
division_7 = Division(A=multiplication_12, B=multiplication_13)
panel_19 = Panel(division_6)
integer_4 = Integer(division_6)
integer_5 = Integer(division_5)
integer_6 = Integer(panel_15)
box_23 = Box(closet_margin)
box_24 = Box(changeover_zone)
box_25 = Box(closet)
box_26 = Box(interior_door)
box_27 = Box(interor_door_margin)
box_28 = Box(exterior_door)
c_script = CSharpScript(boxx=box_28)  # -> out, lenght; inputs boxx: Box; disabled
# ---------- c_script: C# ----------
    List < int> growDirection = new List<int>{9};

  
    int a = growDirection[0];

    Rhino.RhinoApp.WriteLine(growDirection.Count.ToString());
 
    switch (a) 
    ​{ 
      case 9:
        if (  false )
        {
        }
        else
          growDirection.Remove(a);
        Rhino.RhinoApp.WriteLine(growDirection.Count.ToString());
        break;
    }
# ---------- end c_script ----------
panel_20 = Panel(c_script.out)
box_29 = Box(exterior_door_margin)
box_30 = Box(counter_1_2)
box_31 = Box(counter_1_margin)
box_32 = Box(change_over_zone_margin)
box_33 = Box(table_1_2)
box_34 = Box(table_1_margin)
box_35 = Box(lower_bed_margin)
box_36 = Box(table_1)
box_37 = Box(firstaid)
box_38 = Box(first_aid_margin)
box_39 = Box(sitting_unit_margin)
box_40 = Box(lower_bed)
number_slider_10 = Slider(0.746, range=0..100)  # disabled
colour_swatch = ColourSwatch(SwatchColor=RGB(255, 255, 0))
colour_swatch_2 = ColourSwatch(SwatchColor=RGB(0, 0, 0))
colour_swatch_3 = ColourSwatch(SwatchColor=RGB(255, 255, 255))
colour_swatch_4 = ColourSwatch(SwatchColor=RGB(240, 240, 200))
colour_swatch_5 = ColourSwatch(SwatchColor=RGB(240, 200, 200))
colour_swatch_6 = ColourSwatch(SwatchColor=RGB(150, 200, 255))
colour_swatch_7 = ColourSwatch(SwatchColor=RGB(0, 91, 255))  # disabled
create_material_7 = CreateMaterial(
    Diffuse=ColourSwatch(SwatchColor=RGB(0, 0, 0)),
    Specular=RGB(255, 255, 255),
    Emission=RGB(0, 0, 0),
    Transparency=Slider(0, range=0..1),
    Shine=0)
create_material_8 = CreateMaterial(
    Diffuse=ColourSwatch(SwatchColor=RGB(120, 116, 107)),
    Specular=RGB(255, 255, 255),
    Emission=RGB(0, 0, 0),
    Transparency=Slider(0.8, range=0..1),
    Shine=0)
colour_swatch_8 = ColourSwatch(SwatchColor=RGB(255, 255, 0))
colour_swatch_9 = ColourSwatch(SwatchColor=RGB(0, 0, 0))
colour_swatch_10 = ColourSwatch(SwatchColor=RGB(255, 255, 255))
colour_swatch_11 = ColourSwatch(SwatchColor=RGB(240, 240, 200))
colour_swatch_12 = ColourSwatch(SwatchColor=RGB(240, 200, 200))
colour_swatch_13 = ColourSwatch(SwatchColor=RGB(150, 200, 255))
c_script_2 = CSharpScript()  # -> out, A
# ---------- c_script_2: C# ----------
    List < int> IntegerNumbers = new List<int>(){1,2,3,4,5,6};
    Fisher_Yates_CardDeck_Shuffle(IntegerNumbers);
    Rhino.RhinoApp.WriteLine(IntegerNumbers[0].ToString());
# ---------- c_script_2: C# additional code ----------
  public static void Fisher_Yates_CardDeck_Shuffle (List < int > aList) {
 
    System.Random _random = new System.Random ();
 
    int myGO;                    
 
    int n = aList.Count;
    for (int i = 0; i < n; i++)
    {
      // NextDouble returns a random number between 0 and 1.
      // ... It is equivalent to Math.random() in Java.
      int r = i + (int) (_random.NextDouble() * (n - i));
      myGO = aList[r];
      aList[r] = aList[i];
      aList[i] = myGO;
    }
       
    // return aList;
  }
# ---------- end c_script_2 ----------
create_material_9 = CreateMaterial(
    Diffuse=ColourSwatch(SwatchColor=RGB(0, 0, 0)),
    Specular=RGB(255, 255, 255),
    Emission=RGB(0, 0, 0),
    Transparency=Slider(0, range=0..1),
    Shine=0)
create_material_10 = CreateMaterial(
    Diffuse=ColourSwatch(SwatchColor=RGB(120, 116, 107)),
    Specular=RGB(255, 255, 255),
    Emission=RGB(0, 0, 0),
    Transparency=Slider(0.8, range=0..1),
    Shine=0)
panel_21 = Panel(c_script_2.out)
number_slider_11 = Slider(15, range=0..100)
panel_22 = Panel("m2 ")  # disabled
panel_23 = Panel(" Entrance = ")  # disabled
panel_24 = Panel(" Empty Space= ")  # disabled
panel_25 = Panel("m2 ")  # disabled
panel_26 = Panel("m2 ")  # disabled
panel_27 = Panel(" CommonArea = ")  # disabled
panel_28 = Panel("m2 ")  # disabled
panel_29 = Panel("Wet Area = ")  # disabled
panel_30 = Panel(" Common Area = ")  # disabled
panel_31 = Panel("m2 ")  # disabled
panel_32 = Panel(" Kitchen = ")  # disabled
panel_33 = Panel(" m2 ")  # disabled
number_slider_12 = Slider(15, range=0..100)  # disabled
panel_34 = Panel("0,-50")  # disabled
panel_35 = Panel("0,-80")  # disabled
panel_36 = Panel("0,-140")  # disabled
panel_37 = Panel("120,-200")
panel_38 = Panel("240,-170")  # disabled
panel_39 = Panel("0,-110")  # disabled
panel_40 = Panel("120,-200")  # disabled
number_slider_13 = Slider(1, range=0..1)  # disabled
panel_41 = Panel(" Total Area =")  # disabled
panel_42 = Panel("m2 ")  # disabled
panel_43 = Panel("240,-100")  # disabled

# ----
# left
# WET AREA
# right
# front
# front
# front
# front
# front
number_slider_14 = Slider(100, range=0..100)
vector_xyz_11 = VectorXYZ(XComponent=Slider(0, range=-100..101), YComponent=0, ZComponent=0)  # -> Vector, Length
vector_xyz_12 = VectorXYZ(XComponent=0, YComponent=0, ZComponent=number_slider_14)  # -> Vector, Length
vector_xyz_13 = VectorXYZ(XComponent=Slider(0, range=0..100), YComponent=0, ZComponent=0)  # -> Vector, Length
vector_xyz_14 = VectorXYZ(XComponent=Slider(0, range=-1000..100), YComponent=0, ZComponent=0)  # -> Vector, Length
vector_xyz_15 = VectorXYZ(XComponent=0, YComponent=0, ZComponent=Slider(85, range=0..200))  # -> Vector, Length
toılet = DomainBox(Base=vector_xyz_11.Vector, X=Slider(36, range=0..100), Y=Slider(54, range=0..100), Z=Slider(50, range=0..100))
dressing_cabin = DomainBox(Base=vector_xyz_14.Vector, X=Slider(80, range=0..100), Y=Slider(80, range=0..100), Z=Slider(200, range=0..300))
mirror_cupboard = DomainBox(Base=vector_xyz_12.Vector, X=Slider(60, range=0..100), Y=Slider(15, range=0..100), Z=Slider(60, range=0..300))
shower_cabin = DomainBox(Base=vector_xyz_13.Vector, X=Slider(80, range=0..100), Y=Slider(80, range=0..100), Z=Slider(210, range=0..300))
sink_cupboard = DomainBox(Base=vector_xyz_15.Vector, X=Slider(55, range=0..100), Y=Slider(40, range=0..100), Z=Slider(37, range=0..300))
deconstruct_box_20 = DeconstructBox(Box=toılet)  # -> Plane, X, Y, Z
deconstruct_box_21 = DeconstructBox(Box=mirror_cupboard)  # -> Plane, X, Y, Z
deconstruct_box_22 = DeconstructBox(Box=shower_cabin)  # -> Plane, X, Y, Z
deconstruct_box_23 = DeconstructBox(Box=sink_cupboard)  # -> Plane, X, Y, Z
deconstruct_box_24 = DeconstructBox(Box=dressing_cabin)  # -> Plane, X, Y, Z
deconstruct_domain_34 = DeconstructDomain(Domain=deconstruct_box_20.Y)  # -> Start, End
deconstruct_domain_35 = DeconstructDomain(Domain=deconstruct_box_20.Z)  # -> Start, End
deconstruct_domain_36 = DeconstructDomain(Domain=deconstruct_box_20.X)  # -> Start, End
deconstruct_domain_37 = DeconstructDomain(Domain=deconstruct_box_22.Y)  # -> Start, End
deconstruct_domain_38 = DeconstructDomain(Domain=deconstruct_box_21.Y)  # -> Start, End
deconstruct_domain_39 = DeconstructDomain(Domain=deconstruct_box_24.Y)  # -> Start, End
deconstruct_domain_40 = DeconstructDomain(Domain=deconstruct_box_23.Y)  # -> Start, End
addition_45 = Addition(A=deconstruct_domain_35.End, B=Slider(160, range=0..160))
addition_46 = Addition(A=deconstruct_domain_36.End, B=Slider(30, range=0..100))
addition_47 = Addition(A=deconstruct_domain_38.End, B=Slider(85, range=0..100))
addition_48 = Addition(A=deconstruct_domain_37.End, B=Slider(60, range=0..100))
addition_49 = Addition(A=deconstruct_domain_39.End, B=Slider(60, range=0..100))
addition_50 = Addition(A=deconstruct_domain_40.End, B=Slider(60, range=0..100))
construct_domain_6 = ConstructDomain(DomainStart=deconstruct_domain_35.Start, DomainEnd=addition_45)
construct_domain_7 = ConstructDomain(DomainStart=deconstruct_domain_38.Start, DomainEnd=addition_47)
construct_domain_8 = ConstructDomain(DomainStart=deconstruct_domain_37.Start, DomainEnd=addition_48)
construct_domain_9 = ConstructDomain(DomainStart=deconstruct_domain_39.Start, DomainEnd=addition_49)
construct_domain_10 = ConstructDomain(DomainStart=deconstruct_domain_40.Start, DomainEnd=addition_50)
domain_box = DomainBox(Base=mirror_cupboard, X=deconstruct_box_21.X, Y=construct_domain_7, Z=deconstruct_box_21.Z)
shower_cabin_2 = DomainBox(Base=shower_cabin, X=deconstruct_box_22.X, Y=construct_domain_8, Z=deconstruct_box_22.Z)
shower_cabin_margin = DomainBox(Base=dressing_cabin, X=deconstruct_box_24.X, Y=construct_domain_9, Z=deconstruct_box_24.Z)

deconstruct_domain_41 = DeconstructDomain(Domain=deconstruct_box_23.Z)  # -> Start, End
addition_51 = Addition(A=deconstruct_domain_34.End, B=Slider(60, range=0..101))
addition_52 = Addition(A=deconstruct_domain_36.Start, B=Slider(-20, range=-20..100))
addition_53 = Addition(A=deconstruct_domain_41.End, B=Slider(100, range=0..160))
construct_domain_11 = ConstructDomain(DomainStart=deconstruct_domain_41.Start, DomainEnd=addition_53)

construct_domain_12 = ConstructDomain(DomainStart=addition_52, DomainEnd=addition_46)
construct_domain_13 = ConstructDomain(DomainStart=deconstruct_domain_34.Start, DomainEnd=addition_51)
toilet_margin = DomainBox(Base=toılet, X=construct_domain_12, Y=construct_domain_13, Z=construct_domain_6)
sink_margin = DomainBox(Base=sink_cupboard, X=deconstruct_box_23.X, Y=construct_domain_10, Z=construct_domain_11)

custom_preview_5 = CustomPreview(Geometry=[toilet_margin, sink_margin, shower_cabin_2, shower_cabin_margin], Material=create_material_3)  # disabled
custom_preview_6 = CustomPreview(Geometry=[toılet, sink_cupboard, shower_cabin, dressing_cabin], Material=create_material_4)  # disabled
box_41 = Box(toılet)
box_42 = Box(toilet_margin)
box_43 = Box(sink_cupboard)
box_44 = Box(sink_margin)
box_45 = Box(shower_cabin)
box_46 = Box(shower_cabin_2)
c_script_3 = CSharpScript(
    Width=integer_2,
    Length=integer,
    Height=integer_3,
    LevelHeight=number_slider_9,
    cellSize=multiplication_4,
    ExteriorDoor=box_10,
    ExteriorDoorMargin=box_11,
    ChangeOverZone=box_6,
    ChangeOverZoneMargin=box_14,
    Closet=box_7,
    ClosetMargin=box_5,
    InteriorDoor=box_8,
    InteriorDoorMargin=box_9,
    Counter=box_12,
    CounterMargin=box_13,
    Table=box_15,
    TableMargin=box_16,
    SittingUnit=box_18,
    SittingUnitMargin=box_21,
    Bed=box_22,
    HealtCare=box_19,
    HealthCareMargin=box_20,
    Toilet=box_41,
    ToiletMargin=box_42,
    Sink=box_43,
    SinkMargin=box_44,
    SowerCabin=box_45,
    ShowerCabinMargin=box_46)  # -> out, A, EntranceBoxes, CommonBoxes, WetAreaBoxes, Y, K, W, Furnitures, FurnituresMargins; inputs Width: Int32, Length: Int32, Height: Int32, LevelHeight: Int32, cellSize: Int32, ExteriorDoor: Box, ExteriorDoorMargin: Box, ChangeOverZone: Box, ChangeOverZoneMargin: Box, Closet: Box, ClosetMargin: Box, InteriorDoor: Box, InteriorDoorMargin: Box, Counter: Box, CounterMargin: Box, Table: Box, TableMargin: Box, SittingUnit: Box, SittingUnitMargin: Box, Bed: Box, BedMargin: Box, HealtCare: Box, HealthCareMargin: Box, Toilet: Box, ToiletMargin: Box, Sink: Box, SinkMargin: Box, SowerCabin: Box; disabled
# ---------- c_script_3: C# usings ----------
using System.Linq;
# ---------- c_script_3: C# ----------
    List<Box> entranceBoxes = new List<Box>();
    List<Box> commonBoxes = new List<Box>();
    List<Box> wetAreaBoxes = new List<Box>();

    List<Box> ObjectsList = new List<Box>();
    List<Box> MarginsList = new List<Box>();

    List<Box> WhiteBoxes = new List<Box>();

    double entranceSize = (12 * 100 * 100) / (cellSize * cellSize);
    double commonSize = (7 * 100 * 100) / (cellSize * cellSize);
    double wetAreaSize = (7 * 100 * 100 ) / (cellSize * cellSize);

    Point3d pA = new Point3d(0, 0, 0);
    Point3d pB = new Point3d(10, 0, 0);
    Point3d pC = new Point3d(0, 10, 0);

    Plane p = new Plane(pA, pB, pC);

    int width = Width;
    int length = Length;
    int levelHeight = LevelHeight;
    int height = Height;
    int levelNumber = Height / LevelHeight;

    bool objectPlacementEnded = false;
    bool placementFailed = false;
    bool validZoning = false;

    int[,,] areaArray = InitializeZeroMatrice(length, width, levelNumber);
    int[,,] emptyFullArray = InitializeZeroMatrice(length, width, levelNumber);

    int objectReplacementCounter = 1;

    while( (objectPlacementEnded == false || placementFailed == true) && objectReplacementCounter < 50  )
    {
      Rhino.RhinoApp.WriteLine(" ");
      Rhino.RhinoApp.WriteLine("Object Replacement Counter is:   " + objectReplacementCounter);
      Rhino.RhinoApp.WriteLine(" ");

      placementFailed = false;
      validZoning = false;
      int zoneCounter = 0;

      while( validZoning == false && zoneCounter < 100 )
      {
        entranceList.Clear();
        commonList.Clear();
        wetAreaList.Clear();

        commonBoxes.Clear();
        wetAreaBoxes.Clear();
        entranceBoxes.Clear();
        WhiteBoxes.Clear();

        wetAreaCounter = 1;
        commonCounter = 1;
        entranceCounter = 1;

        areaArray = InitializeZeroMatrice(length, width, levelNumber);
        StartZones(areaArray);

        for (int i = 0; i < width * length * 3; i++)
        {
          Spread(areaArray, ref entranceSize, entranceList, ref entranceCounter, entranceLimit, cellSize);
          Spread(areaArray, ref commonSize, commonList, ref commonCounter, commonLimit, cellSize);
          Spread(areaArray, ref wetAreaSize, wetAreaList, ref wetAreaCounter, wetAreaLimit, cellSize);
        }
        NoiseFilter(areaArray, 0, 3, 5);
        NoiseFilter(areaArray, 1, 2, 2);

        entranceList.Clear();
        commonList.Clear();
        wetAreaList.Clear();

        for (int k = 0;k < levelNumber;k++)
        {
          for (int i = 0;i < length;i++)
          {
            for (int j = 0;j < width;j++)
            {
              areaArray[i, j, k] = areaArray[i, j, 0];
            }
          }
        }

        for (int k = 0;k < levelNumber;k++)
        {
          for (int i = 0;i < length;i++)
          {
            for (int j = 0;j < width;j++)
            {
              emptyFullArray[i, j, k] = 0;
            }
          }
        }

        for (int k = 0;k < levelNumber;k++)
        {
          for (int i = 0;i < length;i++)
          {
            for (int j = 0;j < width;j++)
            {
              if (areaArray[i, j, k] == 1)
              {
                Interval xInterval = new Interval(i * cellSize, (i + 1) * (cellSize ));
                Interval yInterval = new Interval(j * cellSize, (j + 1) * (cellSize ));
                Interval zInterval = new Interval(k * LevelHeight, k * LevelHeight + levelHeight);

                Box boxgh = new Box(p, xInterval, yInterval, zInterval);
                entranceBoxes.Add(boxgh);
                entranceList.AddRange(new int[2] { i, j });
              }
              if (areaArray[i, j, k] == 2)
              {
                Interval xInterval = new Interval(i * cellSize, (i + 1) * (cellSize ));
                Interval yInterval = new Interval(j * cellSize, (j + 1) * (cellSize ));
                Interval zInterval = new Interval(k * LevelHeight, k * LevelHeight + levelHeight);

                Box boxgh = new Box(p, xInterval, yInterval, zInterval);
                commonBoxes.Add(boxgh);
                commonList.AddRange(new int[2] { i, j });
              }
              if (areaArray[i, j, k] == 3)
              {
                Interval xInterval = new Interval(i * cellSize, (i + 1) * (cellSize ));
                Interval yInterval = new Interval(j * cellSize, (j + 1) * (cellSize ));
                Interval zInterval = new Interval(k * LevelHeight, k * LevelHeight + levelHeight);

                Box boxgh = new Box(p, xInterval, yInterval, zInterval);
                wetAreaBoxes.Add(boxgh);
                wetAreaList.AddRange(new int[2] { i, j });
              }
              if (areaArray[i, j, k] == 0)
              {
                Interval xInterval = new Interval(i * cellSize, (i + 1) * (cellSize ));
                Interval yInterval = new Interval(j * cellSize, (j + 1) * (cellSize ));
                Interval zInterval = new Interval(k * LevelHeight, k * LevelHeight + levelHeight);

                Box boxgh = new Box(p, xInterval, yInterval, zInterval);
                WhiteBoxes.Add(boxgh);
              }
            }
          }
        }
        if( 60 * 60 * entranceList.Count / 4 >= 100 * 100 * 8 && 60 * 60 * commonList.Count / 4 >= 100 * 100 * 5 && 60 * 60 * wetAreaList.Count / 4 >= 100 * 100 * 5  )
        {
          Rhino.RhinoApp.WriteLine(" ");

          Rhino.RhinoApp.WriteLine(" VALID ZONING is TRUE");
          Rhino.RhinoApp.WriteLine("  ");
          Rhino.RhinoApp.WriteLine(" Enrance Space is :" + 60 * 60 * entranceList.Count / 4 + " > " + 100 * 100 * 6);
          Rhino.RhinoApp.WriteLine(" entrance Count is :" + entranceList.Count / 4);
          Rhino.RhinoApp.WriteLine(" commonList Count is :" + commonList.Count / 4);
          Rhino.RhinoApp.WriteLine(" wetAreaList Count is :" + wetAreaList.Count / 4);
          Rhino.RhinoApp.WriteLine("  ");
          validZoning = true;

        }
        else
        {
          Rhino.RhinoApp.WriteLine(" ");

          Rhino.RhinoApp.WriteLine(" VALID ZONING is FALSE ");
          Rhino.RhinoApp.WriteLine(" Enrance Space is :" + 60 * 60 * entranceList.Count / 4 + " > " + 100 * 100 * 6);
          Rhino.RhinoApp.WriteLine(" entrance Count is :" + entranceList.Count / 4);
          Rhino.RhinoApp.WriteLine(" commonList Count is :" + commonList.Count / 4);
          Rhino.RhinoApp.WriteLine(" wetAreaList Count is :" + wetAreaList.Count / 4);
          validZoning = false;
          zoneCounter++;
          Rhino.RhinoApp.WriteLine("Zone Counter is :" + zoneCounter);
        }
      }
      emptyFullArray = InitializeZeroMatrice(length, width, levelNumber);


      ObjectsList.Clear();
      MarginsList.Clear();
      /* FURNITURE LAYOUT ==> ENTRANCE STARTED */

      Point3d pointa = new Point3d(0, 0, 0);
      Vector3d vectorb = new Vector3d(0, 0, 1);

      Plane planebase = new Plane(pointa, vectorb);

      Interval xInter = new Interval(0, 10);
      Interval yInter = new Interval(0, 10);
      Interval zInter = new Interval(0, 10);

      Box ObjBox = new Box(planebase, xInter, yInter, zInter);
      Box marginBox = new Box(planebase, xInter, yInter, zInter);

      /* ENTRANCE REFERENCE */
      var exteriorDoorO = new Objects
        {
          Name = "Exterior Door",
          ZoneName = 1,

          Obj = ExteriorDoor,
          ObjMargin = ExteriorDoorMargin,

          Front = true,
          Right = true,
          Back = false,
          Left = true,
          Top = false,
          Bottom = false,

          RotationBool = false,
          RotationOpt = 2,

          MirrorBool = false,
          MirrorOpt = 2,

          Source = "NULL",
          FixedToWall = 1,

          CellSize = 60,
          SpaceList = entranceList,

          };
      exteriorDoorO.AssignDimensions();
      exteriorDoorO.PlaceRefObjectEntrance(emptyFullArray, areaArray, out ObjBox, out marginBox, out placementFailed);

      ObjectsList.Add(ObjBox);
      MarginsList.Add(marginBox);

      /* ENTRANCE 2ND OBJECT */

      var changeOverZoneO = new Objects
        {
          Name = "changeOverZone",
          ZoneName = 1,

          Obj = ChangeOverZone,
          ObjMargin = ChangeOverZoneMargin,

          Front = true,
          Right = true,
          Back = true,
          Left = true,
          Top = false,
          Bottom = false,

          RotationBool = false,
          RotationOpt = 2,

          MirrorBool = false,
          MirrorOpt = 2,

          Source = "NULL",
          FixedToWall = 1,
          CellSize = 60,

          PreviousObject = exteriorDoorO,
          SpaceList = entranceList,

          };



      changeOverZoneO.AssignDimensions();
      changeOverZoneO.PlaceObject(emptyFullArray, areaArray, out ObjBox, out marginBox, out placementFailed);
      ObjectsList.Add(ObjBox);
      MarginsList.Add(marginBox);


      var closetO = new Objects
        {
          Name = "closet",
          ZoneName = 1,

          Obj = Closet,
          ObjMargin = ClosetMargin,

          Front = true,
          Right = true,
          Back = false,
          Left = false,
          Top = false,
          Bottom = false,

          RotationBool = false,
          RotationOpt = 2,

          MirrorBool = false,
          MirrorOpt = 2,

          Source = "NULL",
          FixedToWall = 1,
          CellSize = 60,

          PreviousObject = changeOverZoneO,
          SpaceList = entranceList, 

          };

      closetO.AssignDimensions();

      closetO.PlaceObject(emptyFullArray, areaArray, out ObjBox, out marginBox, out placementFailed);

      ObjectsList.Add(ObjBox);
      MarginsList.Add(marginBox);

      objectReplacementCounter++;
      objectPlacementEnded = true;
    }

    ShowMatrix(areaArray);

    A = areaArray;
    EntranceBoxes = entranceBoxes;
    CommonBoxes = commonBoxes;
    WetAreaBoxes = wetAreaBoxes;
    /*Y = kitchenBoxes;
    K = commonAreaBoxes;*/
    W = WhiteBoxes;
    Furnitures = ObjectsList;
    FurnituresMargins = MarginsList;
# ---------- c_script_3: C# additional code ----------
  class Objects
  {
    public string Name;
    public int ZoneName;

    public Box Obj;
    public Box ObjMargin;

    public bool Front = false;
    public bool Right = false;
    public bool Back = false;
    public bool Left = false;
    public bool Top = false;
    public bool Bottom = false;

    public bool RotationBool = true;
    public int RotationOpt; // rotation options

    public bool MirrorBool = true;
    public int MirrorOpt; // mirror options

    public string Source; // Water, Electiricity
    public int FixedToWall; // Bed, Television //1,2,3 conditions
    public int CellSize;

    public Objects PreviousObject;

    public double ObjLength ;
    public double ObjWidth ;
    public double ObjHeight ;

    public double MrjLength;
    public double MrjWidth;
    public double MrjHeight;
    
    public Vector3d FrontVectorMargin;
    public Vector3d FrontVectorObject;

    public double baseX, baseY, baseZ;
    public List<int> SpaceList = new List<int>();

    public double  XCellMargin;
    public double  YCellMargin;
    public double  ZCellMargin;

    public Objects()
    {
    }

    public Objects(string name, int zoneName, bool front, bool right, bool back, bool left, bool top, bool bottom, bool rotationalBool, int rotationOpt, bool mirrorBool, int mirrorOpt, string source, int fixedTowall, int cellSize, Box obj, Box objMargin, List<int> spaceList)
      : this()
    {
      this.Obj = obj;
      this.ObjMargin = objMargin;

      this.Name = name;
      this.ZoneName = zoneName;

      this.Front = front;
      this.Right = right;
      this.Back = back;
      this.Left = left;
      this.Bottom = bottom;
      this.Top = top;

      this.RotationBool = rotationalBool;
      this.RotationOpt = rotationOpt;

      this.MirrorBool = mirrorBool;
      this.MirrorOpt = mirrorOpt;

      this.Source = source;
      this.FixedToWall = fixedTowall;
      this.CellSize = cellSize;

      this.baseX = Obj.Plane.OriginX;
      this.baseY = Obj.Plane.OriginY;
      this.baseZ = Obj.Plane.OriginZ; 

      this.SpaceList = spaceList;
    }

    public Objects(string name, int zoneName, bool front, bool right, bool back, bool left, bool top, bool bottom, bool rotationalBool, int rotationOpt, bool mirrorBool, int mirrorOpt, string source, int fixedTowall, int cellSize, Box obj, Box objMargin, Objects previousObject, List<int> spaceList)
      : this(name, zoneName, front, right, back, left, top, bottom, rotationalBool, rotationOpt, mirrorBool, mirrorOpt, source, fixedTowall, cellSize, obj, objMargin, spaceList)
    {
      this.PreviousObject = previousObject;
    }

        
        public void AssignDimensions()
        {
            this.ObjWidth = this.Obj.X.T1;
            this.ObjLength = this.Obj.Y.T1;
            this.ObjHeight = this.Obj.Z.T1;

            this.MrjWidth = this.ObjMargin.X.T1;
            this.MrjLength = this.ObjMargin.Y.T1;
            this.MrjHeight = this.ObjMargin.Z.T1;
                   
            this.VectorMargin = new Vector3d(this.ObjLength, this.ObjWidth, this.ObjHeight);
            this.VectorObject = new Vector3d(this.MrjWidth, this.MrjWidth, this.MrjHeight);

        }
        

    public void PrintDimensions()
    {
      Rhino.RhinoApp.WriteLine("Obj Width " + this.ObjWidth.ToString());
      Rhino.RhinoApp.WriteLine("Obj Length " + this.ObjLength.ToString());
      Rhino.RhinoApp.WriteLine("Obj Height " + this.ObjHeight.ToString());

      Rhino.RhinoApp.WriteLine("Obj Width " + this.MrjWidth.ToString());
      Rhino.RhinoApp.WriteLine("Obj Length " + this.MrjLength.ToString());
      Rhino.RhinoApp.WriteLine("Obj Height " + this.MrjHeight.ToString());
    }

    public void PlaceRefObject(int [,,]emptyFullArray, int[,,]areaArray, out Box ObjBox, out Box marginBox)
    {
      this.XCellMargin = Math.Ceiling((double) (this.MrjWidth / CellSize));
      this.YCellMargin = Math.Ceiling((double) (this.MrjLength / CellSize));
      this.ZCellMargin = Math.Ceiling((double) (this.MrjHeight / 150));

      bool emptyBool = true;
      bool sameZone = true;

      bool placeSuccessful = false;
      int trycount = 0;

      while (placeSuccessful == false)
      {
        var rand = new Random();
        var randomCellIndex = rand.Next(this.SpaceList.Count / 2);

        baseX = (this.SpaceList[2 * randomCellIndex]) * CellSize;
        baseY = (this.SpaceList[2 * randomCellIndex + 1]) * CellSize;
        baseZ = 0;

        if( (baseX + this.MrjWidth < 360) && (baseY + this.MrjLength < 600) && (baseZ + this.MrjHeight < 300) &&
          (baseX + this.MrjWidth > 0) && (baseY + this.MrjLength > 0) && (baseZ + this.MrjHeight > 0) )
        {
          for(int i = (int) (baseX / CellSize) ; i < (baseX / CellSize + (int) XCellMargin); i++)
          {
            for(int j = (int) (baseY / CellSize); j < baseY / CellSize + (int) YCellMargin; j++)
            {
              for(int k = (int) (baseZ / 150); k < baseZ / 150 + (int) ZCellMargin; k++)
              {
                //Rhino.RhinoApp.WriteLine("Entrance Reference Object :  " + "  i:  " + i + "  j:  " + j + "  k:  " + k);
                if (emptyFullArray[i, j, k] == 2 || emptyFullArray[i, j, k] == 1)
                {
                  emptyBool = false;
                }
                if (areaArray[i, j, k] != this.ZoneName)
                {
                  sameZone = false;
                }
              }
            }
          }

          if (emptyBool && sameZone)
          {
            placeSuccessful = true;

            Rhino.RhinoApp.WriteLine("Reference Object conditions are successful ");
            for(int i = (int) (baseX / CellSize) ; i < (baseX / CellSize + (int) XCellMargin); i++)
            {
              for(int j = (int) (baseY / CellSize); j < baseY / CellSize + (int) YCellMargin; j++)
              {
                for(int k = (int) (baseZ / 150); k < baseZ / 150 + (int) ZCellMargin; k++)
                {
                  emptyFullArray[i, j, k] = 2;
                }
              }
            }
          }
          else
          {
            Rhino.RhinoApp.WriteLine("Conditions are not satisfied ");
          }
        }

        trycount++;
        Rhino.RhinoApp.WriteLine("Try count is : " + trycount);
        if (trycount > 60 )
          Rhino.RhinoApp.WriteLine("Try count is over 60 placement is unsuccessful: ");
        placeSuccessful = true;
      }

      if( trycount < 60 && placeSuccessful )
      {
        Rhino.RhinoApp.WriteLine("baseX " + this.baseX);
        Rhino.RhinoApp.WriteLine("baseY " + this.baseY);
        Rhino.RhinoApp.WriteLine("baseZ " + this.baseZ);

        Point3d pointa = new Point3d(baseX, baseY, 0);
        Vector3d pointb = new Vector3d(0, 0, 1);

        Plane planebase = new Plane(pointa, pointb);

        Interval xInterval = new Interval(0, this.ObjWidth);
        Interval yInterval = new Interval(0, this.ObjLength);
        Interval zInterval = new Interval(0, this.ObjHeight);

        ObjBox = new Box(planebase, xInterval, yInterval, zInterval);

        xInterval = new Interval(0, this.MrjWidth);
        yInterval = new Interval(0, this.MrjLength);
        zInterval = new Interval(0, this.MrjHeight);

        marginBox = new Box(planebase, xInterval, yInterval, zInterval);

      }

      else
      {
        ObjBox = new Box();
        marginBox = new Box();
      }
    }

    public void PlaceRefObjectEntrance(int [,,]emptyFullArray, int[,,]areaArray, out Box ObjBox, out Box marginBox, out bool placementFailed)
    {
      this.XCellMargin = Math.Ceiling((double) (this.MrjWidth / CellSize));
      this.YCellMargin = Math.Ceiling((double) (this.MrjLength / CellSize));
      this.ZCellMargin = Math.Ceiling((double) (this.MrjHeight / 150));

      bool emptyBool = true;
      bool sameZone = true;

      bool placeSuccessful = false;
      int trycount = 0;
      bool enoughTries = false;

      while (placeSuccessful == false && enoughTries == false )
      {
        var rand = new Random();
        var randomCellIndex = rand.Next(this.SpaceList.Count / 2);

        baseX = (this.SpaceList[2 * randomCellIndex]) * CellSize;
        baseY = 0;
        baseZ = 0;

        //baseX = baseX * CellSize;
        //baseY = baseY * CellSize;

        bool inLimit = false;


        if((baseX + this.MrjWidth < 360) && (baseY + this.MrjLength < 600) && (baseZ + this.MrjHeight < 300) &&
          (baseX + this.MrjWidth > 0) && (baseY + this.MrjLength > 0) && (baseZ + this.MrjHeight > 0))
        {
          inLimit = true;
        }

        if( inLimit )
        {
          for(int i = (int) (baseX / CellSize) ; i < (baseX / CellSize + (int) XCellMargin); i++)
          {
            for(int j = (int) (baseY / CellSize); j < baseY / CellSize + (int) YCellMargin; j++)
            {
              for(int k = (int) (baseZ / 150); k < baseZ / 150 + (int) ZCellMargin; k++)
              {
                //Rhino.RhinoApp.WriteLine("Entrance Reference Object :  " + "  i:  " + i + "  j:  " + j + "  k:  " + k);
                if (emptyFullArray[i, j, k] == 1)
                {
                  emptyBool = false;
                }

                if ( areaArray[i, j, k] != this.ZoneName || areaArray[i, j, k] != 0 )
                {
                  sameZone = false;
                }
              }
            }
          }

          if (emptyBool && sameZone)
          {
            placeSuccessful = true;

            Rhino.RhinoApp.WriteLine("Reference Object conditions are successful ");
            for(int i = (int) (baseX / CellSize) ; i < (baseX / CellSize + (int) XCellMargin); i++)
            {
              for(int j = (int) (baseY / CellSize); j < baseY / CellSize + (int) YCellMargin; j++)
              {
                for(int k = (int) (baseZ / 150); k < baseZ / 150 + (int) ZCellMargin; k++)
                {
                  emptyFullArray[i, j, k] = 1;
                }
              }
            }
          }
          else
          {
            Rhino.RhinoApp.WriteLine("Conditions are not satisfied ");
          }
        }

        trycount++;
        Rhino.RhinoApp.WriteLine("Try count is : " + trycount);
        if (trycount > 60 )
          Rhino.RhinoApp.WriteLine("Try count is over 60 placement is unsuccessful: ");
        enoughTries = true;
      }

      if( trycount < 60 && placeSuccessful )
      {
        placementFailed = false;

        Rhino.RhinoApp.WriteLine("baseX " + this.baseX);
        Rhino.RhinoApp.WriteLine("baseY " + this.baseY);
        Rhino.RhinoApp.WriteLine("baseZ " + this.baseZ);

        Point3d pointa = new Point3d(baseX, 0, 0);
        Vector3d pointb = new Vector3d(0, 0, 1);

        Plane planebase = new Plane(pointa, pointb);

        Interval xInterval = new Interval(0, this.ObjWidth);
        Interval yInterval = new Interval(0, this.ObjLength);
        Interval zInterval = new Interval(0, this.ObjHeight);

        ObjBox = new Box(planebase, xInterval, yInterval, zInterval);

        xInterval = new Interval(0, this.MrjWidth);
        yInterval = new Interval(0, this.MrjLength);
        zInterval = new Interval(0, this.MrjHeight);

        marginBox = new Box(planebase, xInterval, yInterval, zInterval);
      }
      else
      {
        ObjBox = new Box();
        marginBox = new Box();
        placementFailed = true;
      }
    }

    public void PlaceObject(int[,,] emptyFullArray, int[,,] areaArray, out Box ObjBox, out Box marginBox, out bool placementFailed)
    {
      Point3d pointa = new Point3d(baseX, baseY, baseZ);
      Vector3d pointb = new Vector3d(0, 0, 1);

      Plane planebase = new Plane(pointa, pointb);

      Interval xInterval = new Interval(0, ObjWidth);
      Interval yInterval = new Interval(0, this.ObjLength);
      Interval zInterval = new Interval(0, this.ObjHeight);

      ObjBox = new Box(planebase, xInterval, yInterval, zInterval);

      xInterval = new Interval(0, this.MrjWidth);
      yInterval = new Interval(0, this.MrjLength);
      zInterval = new Interval(0, this.MrjHeight);

      marginBox = new Box(planebase, xInterval, yInterval, zInterval);

      List<int> growDirection = new List<int>();

      if (PreviousObject.Front == true)
        growDirection.Add(1); // Front Direction
      if (PreviousObject.Right == true)
        growDirection.Add(2); // Right Direction
      if (PreviousObject.Back == true)
        growDirection.Add(3); // Back Direction
      if (PreviousObject.Left == true)
        growDirection.Add(4); // Left Direction
      if (PreviousObject.Bottom == true)
        growDirection.Add(5); // Bottom Direction
      if (PreviousObject.Top == true)
        growDirection.Add(6); // Right Direction


      if(growDirection.Count != 0)
      {
        for(int i = 0;i < growDirection.Count ;i++)
        {
          Rhino.RhinoApp.WriteLine("In grow  " + growDirection[i]);
        }
      }


      bool placeSuccess = false;
      int counter = 0;

      Random randm = new Random();
      Rhino.RhinoApp.WriteLine("Element Number of the grow Direction before while loop " + growDirection.Count.ToString());

      while (growDirection.Count > 0 && placeSuccess == false && counter < 6)
      {
        Rhino.RhinoApp.WriteLine("Counter number in the checkFront Loop " + counter.ToString());

        int a = randm.Next(0, growDirection.Count); // BAK
        Rhino.RhinoApp.WriteLine("A VALUE ---------------------------------------------------" + a);

        int randomMethod = growDirection[a];

        Rhino.RhinoApp.WriteLine("Element Number of the grow Direction in while loop " + growDirection.Count.ToString());

        switch (randomMethod)
        {
          case 1:
            if (CheckFront(emptyFullArray, areaArray))
            {
              this.PlaceFront(emptyFullArray, out ObjBox, out marginBox);
              placeSuccess = true;

            }
            else
            {
              growDirection.Remove(a);
              Rhino.RhinoApp.WriteLine("Could not Placed to Front " + growDirection.Count.ToString());
              Rhino.RhinoApp.WriteLine("Element Number of the grow Direction after removal " + growDirection.Count.ToString());
            }
            counter++;
            break;

          case 2:
            if (CheckRight(emptyFullArray, areaArray))
            {
              this.PlaceRight(emptyFullArray, out ObjBox, out marginBox);
              placeSuccess = true;
            }
            else
            {
              growDirection.Remove(a);
              Rhino.RhinoApp.WriteLine("Could not Placed to right " + growDirection.Count.ToString());
              Rhino.RhinoApp.WriteLine("Element Number of the grow Direction after removal " + growDirection.Count.ToString());
            }
            counter++;
            break;

          case 3:
            if (CheckBack(emptyFullArray, areaArray))
            {
              this.PlaceBack(emptyFullArray, out ObjBox, out marginBox);
              placeSuccess = true;

            }
            else
            {
              growDirection.Remove(a);
              Rhino.RhinoApp.WriteLine("Could not Placed to left " + growDirection.Count.ToString());
              Rhino.RhinoApp.WriteLine("Element Number of the grow Direction after removal " + growDirection.Count.ToString());

            }
            counter++;
            break;

          case 4:
            if (CheckLeft(emptyFullArray, areaArray))
            {
              this.PlaceLeft(emptyFullArray, out ObjBox, out marginBox);
              placeSuccess = true;
            }
            else
            {
              growDirection.Remove(a);
              Rhino.RhinoApp.WriteLine("Could not Placed to LEFT " + growDirection.Count.ToString());
              Rhino.RhinoApp.WriteLine("Element Number of the grow Direction after removal " + growDirection.Count.ToString());
            }
            counter++;
            break;

          case 5:
            if (CheckTop(emptyFullArray, areaArray))
            {
              this.PlaceTop(emptyFullArray, out ObjBox, out marginBox);
              placeSuccess = true;
            }
            else
            {
              growDirection.Remove(a);
              Rhino.RhinoApp.WriteLine("Could not Placed to Top " + growDirection.Count.ToString());
              Rhino.RhinoApp.WriteLine("Element Number of the grow Direction after removal " + growDirection.Count.ToString());
            }
            counter++;
            break;

          case 6:
            if (CheckBottom(emptyFullArray, areaArray))
            {
              this.PlaceBottom(emptyFullArray, out ObjBox, out marginBox);
              placeSuccess = true;

            }
            else
            {
              growDirection.Remove(a);
              Rhino.RhinoApp.WriteLine("Could not Placed to Bottom " + growDirection.Count.ToString());
              Rhino.RhinoApp.WriteLine("Element Number of the grow Direction after removal " + growDirection.Count.ToString());
            }
            counter++;
            break;

          default:
            counter++;
            break;
        }
      }

      if (placeSuccess == false)
      {
        Rhino.RhinoApp.WriteLine("Placement unsuccessfull ");
        placementFailed = !placeSuccess;
      }
      else
        placementFailed = !placeSuccess;
    }

    public bool CheckFront(int[,,] emptyFullArray, int[,,] areaArray)

    {
      bool inLimits = true;
      bool emptyBool = true;
      bool sameZone = true;

      bool suitableDirection = true;

      this.XCellMargin = Math.Ceiling((double) (this.MrjWidth / CellSize));
      this.YCellMargin = Math.Ceiling((double) (this.MrjLength / CellSize));
      this.ZCellMargin = Math.Ceiling((double) (this.MrjHeight / 150));

      this.baseX = PreviousObject.baseX;
      this.baseY = PreviousObject.baseY + CellSize * PreviousObject.YCellMargin;
      this.baseZ = PreviousObject.baseZ;

      if (!((baseX + this.MrjWidth < 360) && (baseY + this.MrjLength < 600) && (baseZ + this.MrjHeight < 300) &&
        (baseX > 0) && (baseY + this.MrjLength > 0) && (baseZ + this.MrjHeight > 0)))
      {
        inLimits = false;
      }

      if (inLimits)
      {
        for (int i = (int) (baseX / CellSize); i < (baseX / CellSize + (int) XCellMargin); i++)
        {
          for (int j = (int) (baseY / CellSize); j < baseY / CellSize + (int) YCellMargin; j++)
          {
            for (int k = (int) (baseZ / 150); k < baseZ / 150 + (int) ZCellMargin; k++)
            {
              Rhino.RhinoApp.WriteLine("i:  " + i + "  j:  " + j + "  k:  " + k);

              if (emptyFullArray[i, j, k] == 1 )
              {
                emptyBool = false;
              }

              if (areaArray[i, j, k] != this.ZoneName || areaArray[i, j, k] != this.ZoneName )
              {
                sameZone = false;
              }
            }
          }
        }

        if (emptyBool && sameZone)
        {
          suitableDirection = true;
          Rhino.RhinoApp.WriteLine("Place Front:  Conditions are  satisfied ");
        }
        else
        {
          Rhino.RhinoApp.WriteLine("Place Front:  Conditions are not satisfied ");
          suitableDirection = false;
        }
      }
      else
      {
        Rhino.RhinoApp.WriteLine("Place Front:  Conditions are not satisfied ");
        suitableDirection = false;
      }
      return suitableDirection;
    }

    public void PlaceFront(int[,,] emptyFullArray, out Box ObjBox, out Box marginBox)
    {

      for (int i = (int) (baseX / CellSize); i < (baseX / CellSize + (int) XCellMargin); i++)
      {
        for (int j = (int) (baseY / CellSize); j < baseY / CellSize + (int) YCellMargin; j++)
        {
          for (int k = (int) (baseZ / 150); k < baseZ / 150 + (int) ZCellMargin; k++)
          {
            emptyFullArray[i, j, k] = 1;
          }
        }
      }

      Point3d pointa = new Point3d(baseX, baseY, baseZ);
      Vector3d pointb = new Vector3d(0, 0, 1);

      Plane planebase = new Plane(pointa, pointb);

      Interval xInterval = new Interval(0, this.ObjWidth);
      Interval yInterval = new Interval(0, this.ObjLength);
      Interval zInterval = new Interval(0, this.ObjHeight);

      ObjBox = new Box(planebase, xInterval, yInterval, zInterval);

      xInterval = new Interval(0, this.MrjWidth);
      yInterval = new Interval(0, this.MrjLength);
      zInterval = new Interval(0, this.MrjHeight);

      marginBox = new Box(planebase, xInterval, yInterval, zInterval);
    }

    public bool CheckRight(int[,,] emptyFullArray, int[,,] areaArray)
    {
      bool inLimits = true;
      bool emptyBool = true;
      bool sameZone = true;
      bool suitableDirection = true;

      this.XCellMargin = Math.Ceiling((double) (this.MrjWidth / CellSize));
      this.YCellMargin = Math.Ceiling((double) (this.MrjLength / CellSize));
      this.ZCellMargin = Math.Ceiling((double) (this.MrjHeight / 150));

      this.baseX = PreviousObject.baseX + CellSize * PreviousObject.XCellMargin;
      this.baseY = PreviousObject.baseY;
      this.baseZ = PreviousObject.baseZ;

      if (!((baseX + this.ObjWidth < 360) && (baseY + this.ObjLength < 600) && (baseZ + this.ObjHeight < 300) &&
        (baseX + this.ObjWidth > 0) && (baseY + this.ObjLength > 0) && (baseZ + this.ObjHeight > 0)))
      {
        inLimits = false;
      }

      if (inLimits)
      {
        for (int i = (int) (baseX / CellSize); i < (baseX / CellSize + (int) XCellMargin); i++)
        {
          for (int j = (int) (baseY / CellSize); j < baseY / CellSize + (int) YCellMargin; j++)
          {
            for (int k = (int) (baseZ / 150); k < baseZ / 150 + (int) ZCellMargin; k++)
            {
              if (emptyFullArray[i, j, k] == 1)
              {
                emptyBool = false;
              }

              if (areaArray[i, j, k] != this.ZoneName)
              {
                sameZone = false;
              }

            }
          }
        }

        if (emptyBool && sameZone)
        {
          suitableDirection = true;
          Rhino.RhinoApp.WriteLine("Place Right:  Conditions are  satisfied ");
        }
        else
        {
          Rhino.RhinoApp.WriteLine("Place Right:  Conditions are not satisfied ");
          suitableDirection = false;
        }
      }
      else
      {
        Rhino.RhinoApp.WriteLine("Place Right:  Conditions are not satisfied ");
        suitableDirection = false;
      }
      return suitableDirection;
    }

    public void PlaceRight(int[,,] emptyFullArray, out Box ObjBox, out Box marginBox)
    {
      for (int i = (int) (baseX / CellSize); i < (baseX / CellSize + (int) XCellMargin); i++)
      {
        for (int j = (int) (baseY / CellSize); j < baseY / CellSize + (int) YCellMargin; j++)
        {
          for (int k = (int) (baseZ / 150); k < baseZ / 150 + (int) ZCellMargin; k++)
          {
            emptyFullArray[i, j, k] = 1;
          }
        }
      }

      Point3d pointa = new Point3d(baseX, baseY, baseZ);
      Vector3d pointb = new Vector3d(0, 0, 1);

      Plane planebase = new Plane(pointa, pointb);

      Interval xInterval = new Interval(0, this.ObjWidth);
      Interval yInterval = new Interval(0, this.ObjLength);
      Interval zInterval = new Interval(0, this.ObjHeight);

      ObjBox = new Box(planebase, xInterval, yInterval, zInterval);

      xInterval = new Interval(0, this.MrjWidth);
      yInterval = new Interval(0, this.MrjLength);
      zInterval = new Interval(0, this.MrjHeight);

      marginBox = new Box(planebase, xInterval, yInterval, zInterval);
    }


    public bool CheckBack(int[,,] emptyFullArray, int[,,] areaArray)

    {
      bool inLimits = true;
      bool emptyBool = true;
      bool sameZone = true;

      bool suitableDirection = true;

      this.XCellMargin = Math.Ceiling((double) (this.MrjWidth / CellSize));
      this.YCellMargin = Math.Ceiling((double) (this.MrjLength / CellSize));
      this.ZCellMargin = Math.Ceiling((double) (this.MrjHeight / 150));

      this.baseX = PreviousObject.baseX;
      this.baseY = PreviousObject.baseY - CellSize * this.YCellMargin;
      this.baseZ = PreviousObject.baseZ;

      if (!((baseX + this.ObjWidth < 300) && (baseY + this.ObjLength < 600) && (baseZ + this.ObjHeight < 300) &&
        (baseX + this.ObjWidth > 0) && (baseY + this.ObjLength > 0) && (baseZ + this.ObjHeight > 0)))
      {
        inLimits = false;
      }
      if (inLimits)
      {
        for (int i = (int) (baseX / CellSize); i < (baseX / CellSize + (int) XCellMargin); i++)
        {
          for (int j = (int) (baseY / CellSize); j < baseY / CellSize + (int) YCellMargin; j++)
          {
            for (int k = (int) (baseZ / 150); k < baseZ / 150 + (int) ZCellMargin; k++)
            {
              if (emptyFullArray[i, j, k] == 1)
              {
                emptyBool = false;
              }
              if (areaArray[i, j, k] != this.ZoneName)
              {
                sameZone = false;
              }
            }
          }
        }

        if (emptyBool && sameZone)
        {
          suitableDirection = true;
          Rhino.RhinoApp.WriteLine("Place Back:  Conditions are  satisfied ");
        }
        else
        {
          Rhino.RhinoApp.WriteLine("Place Back:  Conditions are not satisfied ");
          suitableDirection = false;
        }
      }
      else
      {
        Rhino.RhinoApp.WriteLine("Place Back:  Conditions are not satisfied ");
        suitableDirection = false;
      }
      return suitableDirection;
    }

    public void PlaceBack(int[,,] emptyFullArray, out Box ObjBox, out Box marginBox)
    {
      Rhino.RhinoApp.WriteLine("Place Back: Conditions are successful ");
      for (int i = (int) (baseX / CellSize); i < (baseX / CellSize + (int) XCellMargin); i++)
      {
        for (int j = (int) (baseY / CellSize); j < baseY / CellSize + (int) YCellMargin; j++)
        {
          for (int k = (int) (baseZ / 150); k < baseZ / 150 + (int) ZCellMargin; k++)
          {
            emptyFullArray[i, j, k] = 1;
          }
        }
      }

      Point3d pointa = new Point3d(baseX, baseY, baseZ);
      Vector3d pointb = new Vector3d(0, 0, 1);

      Plane planebase = new Plane(pointa, pointb);

      Interval xInterval = new Interval(0, this.ObjWidth);
      Interval yInterval = new Interval(0, this.ObjLength);
      Interval zInterval = new Interval(0, this.ObjHeight);

      ObjBox = new Box(planebase, xInterval, yInterval, zInterval);

      xInterval = new Interval(0, this.MrjWidth);
      yInterval = new Interval(0, this.MrjLength);
      zInterval = new Interval(0, this.MrjHeight);

      marginBox = new Box(planebase, xInterval, yInterval, zInterval);
    }

    public bool CheckLeft(int[,,] emptyFullArray, int[,,] areaArray)
    {

      Rhino.RhinoApp.WriteLine("Left is Checked !******************************* ");
      bool inLimits = true;
      bool emptyBool = true;
      bool sameZone = true;
      bool suitableDirection = true;

      this.XCellMargin = Math.Ceiling((double) (this.MrjWidth / CellSize));
      this.YCellMargin = Math.Ceiling((double) (this.MrjLength / CellSize));
      this.ZCellMargin = Math.Ceiling((double) (this.MrjHeight / 150));

      this.baseX = PreviousObject.baseX - CellSize * this.XCellMargin;
      this.baseY = PreviousObject.baseY;
      this.baseZ = PreviousObject.baseZ;

      if (!((baseX + this.ObjWidth < 360) && (baseY + this.ObjLength < 600) && (baseZ + this.ObjHeight < 300) &&
        (baseX > 0) && (baseY + this.ObjLength > 0) && (baseZ + this.ObjHeight > 0)))
      {
        Rhino.RhinoApp.WriteLine("CAN NOT PLACE TO LEFT NOT IN LIMITS!******************************* ");
        inLimits = false;
      }

      if (inLimits)
      {
        for (int i = (int) (baseX / CellSize); i < (baseX / CellSize + (int) XCellMargin); i++)
        {
          for (int j = (int) (baseY / CellSize); j < baseY / CellSize + (int) YCellMargin; j++)
          {
            for (int k = (int) (baseZ / 150); k < baseZ / 150 + (int) ZCellMargin; k++)
            {
              Rhino.RhinoApp.WriteLine("i:  " + i + "  j:  " + j + "  k:  " + k);

              if (emptyFullArray[i, j, k] == 1)
              {
                emptyBool = false;
              }
              if (areaArray[i, j, k] != this.ZoneName)
              {
                sameZone = false;
              }
            }
          }
        }

        if (emptyBool && sameZone)
        {
          suitableDirection = true;
          Rhino.RhinoApp.WriteLine("Place Left:  Conditions are  satisfied ");
        }
        else
        {
          Rhino.RhinoApp.WriteLine("Place Left:  Conditions are not satisfied ");
          suitableDirection = false;
        }
      }
      else
      {
        Rhino.RhinoApp.WriteLine("Place Left:  Conditions are not satisfied ");
        suitableDirection = false;
      }
      return suitableDirection;
    }

    public void PlaceLeft(int[,,] emptyFullArray, out Box ObjBox, out Box marginBox)
    {
      for (int i = (int) (baseX / CellSize); i < (baseX / CellSize + (int) XCellMargin); i++)
      {
        for (int j = (int) (baseY / CellSize); j < baseY / CellSize + (int) YCellMargin; j++)
        {
          for (int k = (int) (baseZ / 150); k < baseZ / 150 + (int) ZCellMargin; k++)
          {
            emptyFullArray[i, j, k] = 1;
          }
        }
      }

      Point3d pointa = new Point3d(baseX, baseY, baseZ);
      Vector3d pointb = new Vector3d(0, 0, 1);

      Plane planebase = new Plane(pointa, pointb);

      Interval xInterval = new Interval(0, this.ObjWidth);
      Interval yInterval = new Interval(0, this.ObjLength);
      Interval zInterval = new Interval(0, this.ObjHeight);

      ObjBox = new Box(planebase, xInterval, yInterval, zInterval);

      xInterval = new Interval(0, this.MrjWidth);
      yInterval = new Interval(0, this.MrjLength);
      zInterval = new Interval(0, this.MrjHeight);

      marginBox = new Box(planebase, xInterval, yInterval, zInterval);
    }

    public bool CheckTop(int[,,] emptyFullArray, int[,,] areaArray)
    {
      bool inLimits = true;
      bool emptyBool = true;
      bool sameZone = true;

      bool suitableDirection = true;

      this.XCellMargin = Math.Ceiling((double) (MrjWidth / CellSize));
      this.YCellMargin = Math.Ceiling((double) (this.MrjLength / CellSize));
      this.ZCellMargin = Math.Ceiling((double) (this.MrjHeight / 150));

      this.baseX = PreviousObject.baseX;
      this.baseY = PreviousObject.baseY;
      this.baseZ = PreviousObject.baseZ + CellSize * PreviousObject.ZCellMargin;

      if (!((baseX + this.ObjWidth < 360) && (baseY + this.ObjLength < 600) && (baseZ + this.ObjHeight < 300) &&
        (baseX + this.ObjWidth > 0) && (baseY + this.ObjLength > 0) && (baseZ + this.ObjHeight > 0)))
      {
        inLimits = false;
      }

      if (inLimits)
      {
        for (int i = (int) (baseX / CellSize); i < (baseX / CellSize + (int) XCellMargin); i++)
        {
          for (int j = (int) (baseY / CellSize); j < baseY / CellSize + (int) YCellMargin; j++)
          {
            for (int k = (int) (baseZ / 150); k < baseZ / 150 + (int) ZCellMargin; k++)
            {
              Rhino.RhinoApp.WriteLine("i:  " + i + "  j:  " + j + "  k:  " + k);

              if (emptyFullArray[i, j, k] == 1)
              {
                emptyBool = false;
              }

              if (areaArray[i, j, k] != this.ZoneName)
              {
                sameZone = false;
              }
            }
          }
        }

        if (emptyBool && sameZone)
        {
          suitableDirection = true;
          Rhino.RhinoApp.WriteLine("Place Top:  Conditions are  satisfied ");
        }
        else
        {
          Rhino.RhinoApp.WriteLine("Place Top:  Conditions are not satisfied ");
          suitableDirection = false;
        }
      }
      else
      {
        Rhino.RhinoApp.WriteLine("Place Top:  Conditions are not satisfied ");
        suitableDirection = false;
      }
      return suitableDirection;
    }

    public void PlaceTop(int[,,] emptyFullArray, out Box ObjBox, out Box marginBox)
    {

      for (int i = (int) (baseX / CellSize); i < (baseX / CellSize + (int) XCellMargin); i++)
      {
        for (int j = (int) (baseY / CellSize); j < baseY / CellSize + (int) YCellMargin; j++)
        {
          for (int k = (int) (baseZ / 150); k < baseZ / 150 + (int) ZCellMargin; k++)
          {
            emptyFullArray[i, j, k] = 1;
          }
        }
      }

      Point3d pointa = new Point3d(baseX, baseY, baseZ);
      Vector3d pointb = new Vector3d(0, 0, 1);

      Plane planebase = new Plane(pointa, pointb);

      Interval xInterval = new Interval(0, this.ObjWidth);
      Interval yInterval = new Interval(0, this.ObjLength);
      Interval zInterval = new Interval(0, this.ObjHeight);

      ObjBox = new Box(planebase, xInterval, yInterval, zInterval);

      xInterval = new Interval(0, this.MrjWidth);
      yInterval = new Interval(0, this.MrjLength);
      zInterval = new Interval(0, this.MrjHeight);

      marginBox = new Box(planebase, xInterval, yInterval, zInterval);
    }

    public bool CheckBottom(int[,,] emptyFullArray, int[,,] areaArray)
    {
      bool inLimits = true;
      bool emptyBool = true;
      bool sameZone = true;

      bool suitableDirection = true;

      this.XCellMargin = Math.Ceiling((double) (this.MrjWidth / CellSize));
      this.YCellMargin = Math.Ceiling((double) (this.MrjLength / CellSize));
      this.ZCellMargin = Math.Ceiling((double) (this.MrjHeight / 150));

      this.baseX = PreviousObject.baseX;
      this.baseY = PreviousObject.baseY;
      this.baseZ = PreviousObject.baseZ - CellSize * this.ZCellMargin;

      if (!((baseX + this.ObjWidth < 360) && (baseY + this.ObjLength < 600) && (baseZ + this.ObjHeight < 300) &&
        (baseX + this.ObjWidth > 0) && (baseY + this.ObjLength > 0) && (baseZ + this.ObjHeight > 0)))
      {
        inLimits = false;
      }

      if (inLimits)
      {
        for (int i = (int) (baseX / CellSize); i < (baseX / CellSize + (int) XCellMargin); i++)
        {
          for (int j = (int) (baseY / CellSize); j < baseY / CellSize + (int) YCellMargin; j++)
          {
            for (int k = (int) (baseZ / 150); k < baseZ / 150 + (int) ZCellMargin; k++)
            {
              Rhino.RhinoApp.WriteLine("i:  " + i + "  j:  " + j + "  k:  " + k);

              if (emptyFullArray[i, j, k] == 1)
              {
                emptyBool = false;
              }
              if (areaArray[i, j, k] != this.ZoneName)
              {
                sameZone = false;
              }
            }
          }
        }

        if (emptyBool && sameZone)
        {
          suitableDirection = true;
          Rhino.RhinoApp.WriteLine("Place Bottom:  Conditions are  satisfied ");
        }
        else
        {
          Rhino.RhinoApp.WriteLine("Place Bottom:  Conditions are not satisfied ");
          suitableDirection = false;
        }
      }
      else
      {
        Rhino.RhinoApp.WriteLine("Place Bottom:  Conditions are not satisfied ");
        suitableDirection = false;
      }
      return suitableDirection;
    }

    public void PlaceBottom(int[,,] emptyFullArray, out Box ObjBox, out Box marginBox)
    {
      for (int i = (int) (baseX / CellSize); i < (baseX / CellSize + (int) XCellMargin); i++)
      {
        for (int j = (int) (baseY / CellSize); j < baseY / CellSize + (int) YCellMargin; j++)
        {
          for (int k = (int) (baseZ / 150); k < baseZ / 150 + (int) ZCellMargin; k++)
          {
            emptyFullArray[i, j, k] = 1;
          }
        }
      }

      Point3d pointa = new Point3d(baseX, baseY, baseZ);
      Vector3d pointb = new Vector3d(0, 0, 1);

      Plane planebase = new Plane(pointa, pointb);

      Interval xInterval = new Interval(0, this.ObjWidth);
      Interval yInterval = new Interval(0, this.ObjLength);
      Interval zInterval = new Interval(0, this.ObjHeight);

      ObjBox = new Box(planebase, xInterval, yInterval, zInterval);

      xInterval = new Interval(0, this.MrjWidth);
      yInterval = new Interval(0, this.MrjLength);
      zInterval = new Interval(0, this.MrjHeight);

      marginBox = new Box(planebase, xInterval, yInterval, zInterval);
    }
  }

  static void ShowMatrix(int[,,] Arr)
  {
    for (int i = 0; i < Arr.GetLength(0); i++)
    {
      for (int j = 0; j < Arr.GetLength(1); j++)
      {
        Rhino.RhinoApp.Write(Arr[i, j, 0] + " ");
      }
      Rhino.RhinoApp.WriteLine("   ");
    }
    return;
  }

  static int[,,] InitializeZeroMatrice(int width, int length, int levelNumber)
  {
    var areaArray = new int[width, length, levelNumber];

    for (int k = 0; k < levelNumber; k++)
    {
      for (int i = 0; i < width; i++)
      {
        for (int j = 0; j < length; j++)
        {
          areaArray[i, j, k] = 0;
        }
      }
    }
    return areaArray;
  }

  static  List<int> entranceList = new List<int>();
  static  List<int> commonList = new List<int>();
  static  List<int> wetAreaList = new List<int>();
  /**           these counters are used for starting the límitations counts.         **/
  static int entranceCounter = 1;
  static int commonCounter = 1;
  static int wetAreaCounter = 1;
  /**           these limits are used for defining max distance that zone can spread.  **/
  static readonly int entranceLimit = 400;
  static readonly int commonLimit = 300;
  static readonly int wetAreaLimit = 300;

  static void StartZones(int[,,] arr)
  {
    Random rand = new Random();
    var a = rand.Next(arr.GetLength(0) / 2, arr.GetLength(0) / 2);
    var b = rand.Next(0, 2);

    Rhino.RhinoApp.WriteLine("Zones started");
    entranceList.AddRange(new int[2] { a, b });
    arr[a, b, 0] = 1;
    b = rand.Next(0, arr.GetLength(1));
    a = rand.Next(0, arr.GetLength(0));

    commonList.AddRange(new int[2] { a, b });
    arr[a, b, 0] = 2;

    a = rand.Next(0, arr.GetLength(0));
    b = rand.Next(0, arr.GetLength(1));

    wetAreaList.AddRange(new int[2] { a, b });
    arr[a, b, 0] = 3; // wetArea Starting Point
    //----------------------
    a = rand.Next(0, arr.GetLength(0));
    b = rand.Next(0, arr.GetLength(1));

  }

  static double DistanceCalculate(List<int> spaceCoordList, int x2, int y2, int cellSize)
  {
    var distance = cellSize * Math.Sqrt((y2 - spaceCoordList[1]) * (y2 - spaceCoordList[1]) + (x2 - spaceCoordList[0]) * (x2 - spaceCoordList[0]));
    return distance;
  }

  static void NoiseFilter (int [,,] arr, int type, int iterationNumber, int controlNumber)
  {
    if(type == 0)
    {
      for( int loop = 0 ; loop < iterationNumber ; loop++ )
      {
        List < int> surrounding = new List<int>();
        for(int i = 1 ; i < arr.GetLength(0) - 1 ;i++)
        {
          for(int j = 1 ; j < arr.GetLength(1) - 1 ;j++)
          {
            for(int x = -1 ; x < 2;x++)
            {
              for(int y = -1 ; y < 2;y++)
              {
                if(!(x == y && x == 0))
                {

                  surrounding.Add(arr[i + x, j + y, 0]);
                }
              }
            }
            for (int v = 0 ; v < 6 ;v++) // 6 is the number of the zones including  empty cells
            {
              int count = (from z in surrounding where z == v select z).Count();
              if ( count >= controlNumber )
              {
                arr[i, j, 0] = v;
              }
            }
            surrounding.Clear();
            surrounding.TrimExcess();
          }
        }
      }
    }

    if(type == 1)
    {
      for( int loop = 0 ; loop < iterationNumber ; loop++ )
      {
        List < int> surrounding = new List<int>();
        for(int i = 1 ; i < arr.GetLength(0) - 1 ;i++)
        {
          for(int j = 1 ; j < arr.GetLength(1) - 1 ;j++)
          {
            for(int x = -1 ; x < 2;x++)
            {
              for(int y = -1 ; y < 2;y++)
              {
                if(!(x == y && x == 0) && ( (x + y == 1 ) || (x + y == -1 )) )
                {
                  surrounding.Add(arr[i + x, j + y, 0]);
                }
              }
            }

            for (int v = 0 ; v < 6 ;v++) // 6 is the number of the zones including  empty cells
            {
              int count = (from z in surrounding where z == v select z).Count();
              if ( count >= 2 )
              {
                arr[i, j, 0] = v;
              }
            }
            surrounding.Clear();
            surrounding.TrimExcess();
          }
        }
      }
    }
  }

  static void Spread(int[,,] arr, ref double spaceSize, List<int> spaceCoordList, ref int counter, int spaceLimit, int cellSize)
  {
    var rand = new Random();
    var directionList = new List<int>();
    int Xcoord;
    int Ycoord;
    bool draw = false;
    int trycount = 0;

    bool inTop ;
    bool inRight ;
    bool inBottom ;
    bool inLeft ;

    bool enoughTries = false;

    while (draw == false && counter < spaceSize && enoughTries == false )
    {
      var randomCellIndex = rand.Next(spaceCoordList.Count / 2);

      Xcoord = spaceCoordList[2 * randomCellIndex];
      Ycoord = spaceCoordList[2 * randomCellIndex + 1];

      inTop = (Ycoord + 1 < arr.GetLength(1));              // Check top border
      inRight = (Xcoord + 1 < arr.GetLength(0));              // Check Right border
      inBottom = (Ycoord - 1 >= 0 );              // Check bottom border
      inLeft = (Xcoord - 1 >= 0);             //  Check left border

      if(inRight)
      {
        if (arr[Xcoord + 1, Ycoord, 0] == 0 && DistanceCalculate(spaceCoordList, Xcoord + 1, Ycoord, cellSize) < spaceLimit ) // Check if possible new cell is still white or not!
          directionList.AddRange(new int[2] { (Xcoord + 1), Ycoord }); //Store possible spread directions in a list.
      }

      if(inLeft)
      {
        if (arr[Xcoord - 1, Ycoord, 0] == 0 && DistanceCalculate(spaceCoordList, Xcoord - 1, Ycoord, cellSize) < spaceLimit)
          directionList.AddRange(new int[2] { (Xcoord - 1), Ycoord }); //Store possible spread directions in a list.
      }

      if(inTop)
      {
        if (arr[Xcoord, Ycoord + 1, 0] == 0 && DistanceCalculate(spaceCoordList, Xcoord, Ycoord + 1, cellSize) < spaceLimit)
          directionList.AddRange(new int[2] { (Xcoord), Ycoord + 1 }); //Store possible spread directions in a list.
      }

      if(inBottom)
      {
        if (arr[Xcoord, Ycoord - 1, 0] == 0 && DistanceCalculate(spaceCoordList, Xcoord, Ycoord - 1, cellSize) < spaceLimit)
          directionList.AddRange(new int[2] { (Xcoord), (Ycoord - 1) }); //Store possible spread directions in a list.
      }


      if (directionList.Count > 0)
      {
        var randomIndex = rand.Next(directionList.Count / 2);
        int a = directionList[2 * randomIndex];
        int b = directionList[2 * randomIndex + 1];

        arr[a, b, 0] = arr[Xcoord, Ycoord, 0];

        spaceCoordList.AddRange(new int[2] { a, b });

        directionList.Clear();
        directionList.TrimExcess();
        draw = true;
        counter++;
      }

      else
      {
        trycount++;
        if (trycount >= spaceCoordList.Count)
        {
          enoughTries = true;
          //Print("trycountNumber is ={0}", trycount);
        }
      }
    }
  }
# ---------- end c_script_3 ----------
c_script_4 = CSharpScript(
    Width=integer_2,
    Length=integer,
    Height=integer_3,
    LevelHeight=number_slider_9,
    cellSize=multiplication_4,
    ExteriorDoor=box_10,
    ExteriorDoorMargin=box_11,
    ChangeOverZone=box_6,
    ChangeOverZoneMargin=box_14,
    Closet=box_7,
    ClosetMargin=box_5,
    InteriorDoor=box_8,
    InteriorDoorMargin=box_9,
    Counter=box_12,
    CounterMargin=box_13,
    Table=box_15,
    TableMargin=box_16,
    SittingUnit=box_18,
    SittingUnitMargin=box_21,
    Bed=box_22,
    HealtCare=box_19,
    HealthCareMargin=box_20,
    Toilet=box_41,
    ToiletMargin=box_42,
    Sink=box_43,
    SinkMargin=box_44,
    SowerCabin=box_45,
    ShowerCabinMargin=box_46)  # -> out, A, EntranceBoxes, CommonBoxes, WetAreaBoxes, Y, K, W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; inputs Width: Int32, Length: Int32, Height: Int32, LevelHeight: Int32, cellSize: Int32, ExteriorDoor: Box, ExteriorDoorMargin: Box, ChangeOverZone: Box, ChangeOverZoneMargin: Box, Closet: Box, ClosetMargin: Box, InteriorDoor: Box, InteriorDoorMargin: Box, Counter: Box, CounterMargin: Box, Table: Box, TableMargin: Box, SittingUnit: Box, SittingUnitMargin: Box, Bed: Box, BedMargin: Box, HealtCare: Box, HealthCareMargin: Box, Toilet: Box, ToiletMargin: Box, Sink: Box, SinkMargin: Box, SowerCabin: Box
# ---------- c_script_4: C# usings ----------
using System.Linq;
using System.Threading;
# ---------- c_script_4: C# ----------
    List<Box> entranceBoxes = new List<Box>();
    List<Box> commonBoxes = new List<Box>();
    List<Box> wetAreaBoxes = new List<Box>();

    List<Box> ObjectsList = new List<Box>();
    List<Box> MarginsList = new List<Box>();

    List<Box> WhiteBoxes = new List<Box>();

    double entranceSize = (12 * 100 * 100) / (cellSize * cellSize);
    double commonSize = (7 * 100 * 100) / (cellSize * cellSize);
    double wetAreaSize = (7 * 100 * 100 ) / (cellSize * cellSize);

    Point3d pA = new Point3d(0, 0, 0);
    Point3d pB = new Point3d(10, 0, 0);
    Point3d pC = new Point3d(0, 10, 0);

    Plane p = new Plane(pA, pB, pC);

    List<Vector3d> MarginVectors = new List<Vector3d>();
    List<Vector3d> ObjectVectors = new List<Vector3d>();
    List<Point3d> BasePoints = new List<Point3d>();

    int width = Width;
    int length = Length;
    int levelHeight = LevelHeight;
    int height = Height;
    int levelNumber = Height / LevelHeight;

    bool objectPlacementEnded = false;
    bool placementFailed = false;
    bool validZoning = false;

    int[,,] areaArray = InitializeZeroMatrice(length, width, levelNumber);
    int[,,] emptyFullArray = InitializeZeroMatrice(length, width, levelNumber);

    int objectReplacementCounter = 1;

    while( (objectPlacementEnded == false || placementFailed == true) && objectReplacementCounter < 50  )
    {
      MarginVectors.Clear();
      ObjectVectors.Clear();
      BasePoints.Clear();

      Rhino.RhinoApp.WriteLine(" ");
      Rhino.RhinoApp.WriteLine("Object Replacement Counter is:   " + objectReplacementCounter);
      Rhino.RhinoApp.WriteLine(" ");

      placementFailed = false;
      validZoning = false;
      int zoneCounter = 0;

      while( validZoning == false && zoneCounter < 100 )
      {
        entranceList.Clear();
        commonList.Clear();
        wetAreaList.Clear();

        commonBoxes.Clear();
        wetAreaBoxes.Clear();
        entranceBoxes.Clear();
        WhiteBoxes.Clear();

        wetAreaCounter = 1;
        commonCounter = 1;
        entranceCounter = 1;

        areaArray = InitializeZeroMatrice(length, width, levelNumber);
        StartZones(areaArray);

        for (int i = 0; i < width * length * 3; i++)
        {
          Spread(areaArray, ref entranceSize, entranceList, ref entranceCounter, entranceLimit, cellSize);
          Spread(areaArray, ref commonSize, commonList, ref commonCounter, commonLimit, cellSize);
          Spread(areaArray, ref wetAreaSize, wetAreaList, ref wetAreaCounter, wetAreaLimit, cellSize);
        }
        NoiseFilter(areaArray, 0, 3, 5);
        NoiseFilter(areaArray, 1, 2, 2);

        entranceList.Clear();
        commonList.Clear();
        wetAreaList.Clear();

        for (int k = 0;k < levelNumber;k++)
        {
          for (int i = 0;i < length;i++)
          {
            for (int j = 0;j < width;j++)
            {
              areaArray[i, j, k] = areaArray[i, j, 0];
            }
          }
        }

        for (int k = 0;k < levelNumber;k++)
        {
          for (int i = 0;i < length;i++)
          {
            for (int j = 0;j < width;j++)
            {
              emptyFullArray[i, j, k] = 0;
            }
          }
        }

        for (int k = 0;k < levelNumber;k++)
        {
          for (int i = 0;i < length;i++)
          {
            for (int j = 0;j < width;j++)
            {
              if (areaArray[i, j, k] == 1)
              {
                Interval xInterval = new Interval(i * cellSize, (i + 1) * (cellSize ));
                Interval yInterval = new Interval(j * cellSize, (j + 1) * (cellSize ));
                Interval zInterval = new Interval(k * LevelHeight, k * LevelHeight + levelHeight);

                Box boxgh = new Box(p, xInterval, yInterval, zInterval);
                entranceBoxes.Add(boxgh);
                entranceList.AddRange(new int[2] { i, j });
              }
              if (areaArray[i, j, k] == 2)
              {
                Interval xInterval = new Interval(i * cellSize, (i + 1) * (cellSize ));
                Interval yInterval = new Interval(j * cellSize, (j + 1) * (cellSize ));
                Interval zInterval = new Interval(k * LevelHeight, k * LevelHeight + levelHeight);

                Box boxgh = new Box(p, xInterval, yInterval, zInterval);
                commonBoxes.Add(boxgh);
                commonList.AddRange(new int[2] { i, j });
              }
              if (areaArray[i, j, k] == 3)
              {
                Interval xInterval = new Interval(i * cellSize, (i + 1) * (cellSize ));
                Interval yInterval = new Interval(j * cellSize, (j + 1) * (cellSize ));
                Interval zInterval = new Interval(k * LevelHeight, k * LevelHeight + levelHeight);

                Box boxgh = new Box(p, xInterval, yInterval, zInterval);
                wetAreaBoxes.Add(boxgh);
                wetAreaList.AddRange(new int[2] { i, j });
              }
              if (areaArray[i, j, k] == 0)
              {
                Interval xInterval = new Interval(i * cellSize, (i + 1) * (cellSize ));
                Interval yInterval = new Interval(j * cellSize, (j + 1) * (cellSize ));
                Interval zInterval = new Interval(k * LevelHeight, k * LevelHeight + levelHeight);

                Box boxgh = new Box(p, xInterval, yInterval, zInterval);
                WhiteBoxes.Add(boxgh);
              }
            }
          }
        }
        if( 60 * 60 * entranceList.Count / 4 >= 100 * 100 * 8 && 60 * 60 * commonList.Count / 4 >= 100 * 100 * 5 && 60 * 60 * wetAreaList.Count / 4 >= 100 * 100 * 5  )
        {
          Rhino.RhinoApp.WriteLine(" ");

          Rhino.RhinoApp.WriteLine(" VALID ZONING is TRUE");
          Rhino.RhinoApp.WriteLine("  ");
          Rhino.RhinoApp.WriteLine(" Enrance Space is :" + 60 * 60 * entranceList.Count / 4 + " > " + 100 * 100 * 6);
          Rhino.RhinoApp.WriteLine(" entrance Count is :" + entranceList.Count / 4);
          Rhino.RhinoApp.WriteLine(" commonList Count is :" + commonList.Count / 4);
          Rhino.RhinoApp.WriteLine(" wetAreaList Count is :" + wetAreaList.Count / 4);
          Rhino.RhinoApp.WriteLine("  ");
          validZoning = true;

        }
        else
        {
          Rhino.RhinoApp.WriteLine(" ");

          Rhino.RhinoApp.WriteLine(" VALID ZONING is FALSE ");
          Rhino.RhinoApp.WriteLine(" Enrance Space is :" + 60 * 60 * entranceList.Count / 4 + " > " + 100 * 100 * 6);
          Rhino.RhinoApp.WriteLine(" entrance Count is :" + entranceList.Count / 4);
          Rhino.RhinoApp.WriteLine(" commonList Count is :" + commonList.Count / 4);
          Rhino.RhinoApp.WriteLine(" wetAreaList Count is :" + wetAreaList.Count / 4);
          validZoning = false;
          zoneCounter++;
          Rhino.RhinoApp.WriteLine("Zone Counter is :" + zoneCounter);
        }
      }
      emptyFullArray = InitializeZeroMatrice(length, width, levelNumber);

      ObjectsList.Clear();
      MarginsList.Clear();
      /* FURNITURE LAYOUT ==> ENTRANCE STARTED */

      Point3d pointa = new Point3d(0, 0, 0);
      Vector3d vectorb = new Vector3d(0, 0, 1);

      Plane planebase = new Plane(pointa, vectorb);

      Interval xInter = new Interval(0, 10);
      Interval yInter = new Interval(0, 10);
      Interval zInter = new Interval(0, 10);

      Box ObjBox = new Box(planebase, xInter, yInter, zInter);
      Box marginBox = new Box(planebase, xInter, yInter, zInter);

      /* ENTRANCE REFERENCE */
      var exteriorDoorO = new Objects
        {
          Name = "Exterior Door",
          ZoneName = 1,

          Obj = ExteriorDoor,
          ObjMargin = ExteriorDoorMargin,

          Front = true,
          Right = true,
          Back = false,
          Left = true,
          Top = false,
          Bottom = false,

          RotationBool = true,
          RotationOpt = new List<double>(){0, 90, 180, 270},

          MirrorBool = false,
          MirrorOpt = new List<int>(){0, 2, 3},

          Source = "NULL",
          FixedToWall = 1,

          CellSize = 60,
          SpaceList = entranceList,

          };
      exteriorDoorO.AssignDimensions();
      exteriorDoorO.PlaceRefObjectEntrance(emptyFullArray, areaArray, out ObjBox, out marginBox, out placementFailed);

      ObjectVectors.Add(exteriorDoorO.VectorObject);
      MarginVectors.Add(exteriorDoorO.VectorMargin);

      BasePoints.Add(new Point3d(exteriorDoorO.BaseVector));

      ObjectsList.Add(ObjBox);
      MarginsList.Add(marginBox);

      /* ENTRANCE 2ND OBJECT */

      var changeOverZoneO = new Objects
        {
          Name = "changeOverZone",
          ZoneName = 1,

          Obj = ChangeOverZone,
          ObjMargin = ChangeOverZoneMargin,

          Front = true,
          Right = true,
          Back = true,
          Left = true,
          Top = false,
          Bottom = false,

          RotationBool = false,
          RotationOpt = new List<double>(){0, 90, 180, 270},

          MirrorBool = false,
          MirrorOpt = new List<int>(){0, 2, 3},

          Source = "NULL",
          FixedToWall = 1,
          CellSize = 60,

          PreviousObject = exteriorDoorO,
          SpaceList = entranceList,

          };


      changeOverZoneO.AssignDimensions();
      changeOverZoneO.PlaceObject(emptyFullArray, areaArray, out ObjBox, out marginBox, out placementFailed);

      if(placementFailed == true)
      { Rhino.RhinoApp.WriteLine("");
        Rhino.RhinoApp.WriteLine("");
        Rhino.RhinoApp.WriteLine("PLACEMENT FAILED RESTARTED");
        Rhino.RhinoApp.WriteLine("");
        Rhino.RhinoApp.WriteLine("");
        objectReplacementCounter++;
        continue;
      }
      else

      { Rhino.RhinoApp.WriteLine("");
        Rhino.RhinoApp.WriteLine("");
        Rhino.RhinoApp.WriteLine("PLACEMENT SATISFIED");
        Rhino.RhinoApp.WriteLine("");
        Rhino.RhinoApp.WriteLine("");
      }
      ObjectsList.Add(ObjBox);
      MarginsList.Add(marginBox);

      ObjectVectors.Add(changeOverZoneO.VectorObject);
      MarginVectors.Add(changeOverZoneO.VectorMargin);

      BasePoints.Add(new Point3d(changeOverZoneO.BaseVector));

      var closetO = new Objects
        {
          Name = "closet",
          ZoneName = 1,

          Obj = Closet,
          ObjMargin = ClosetMargin,

          Front = true,
          Right = true,
          Back = false,
          Left = false,
          Top = false,
          Bottom = false,

          RotationBool = false,
          RotationOpt = new List<double>(){0, 90, 180, 270},

          MirrorBool = false,
          MirrorOpt = new List<int>(){0, 2, 3},

          Source = "NULL",
          FixedToWall = 1,
          CellSize = 60,

          PreviousObject = changeOverZoneO,
          SpaceList = entranceList,
          };

      closetO.AssignDimensions();
      closetO.PlaceObject(emptyFullArray, areaArray, out ObjBox, out marginBox, out placementFailed);

      if(placementFailed == true)
      { Rhino.RhinoApp.WriteLine("");
        Rhino.RhinoApp.WriteLine("");
        Rhino.RhinoApp.WriteLine("PLACEMENT FAILED RESTARTED");
        Rhino.RhinoApp.WriteLine("");
        Rhino.RhinoApp.WriteLine("");
        objectReplacementCounter++;
        continue;
      }
      else

      { Rhino.RhinoApp.WriteLine("");
        Rhino.RhinoApp.WriteLine("");
        Rhino.RhinoApp.WriteLine("PLACEMENT OKAY ");
        Rhino.RhinoApp.WriteLine("");
        Rhino.RhinoApp.WriteLine("");

        ;
      }
      ObjectVectors.Add(closetO.VectorObject);
      MarginVectors.Add(closetO.VectorMargin);

      BasePoints.Add(new Point3d(closetO.BaseVector));

      ObjectsList.Add(ObjBox);
      MarginsList.Add(marginBox);

      objectReplacementCounter++;
      objectPlacementEnded = true;
    }

    ShowMatrix(areaArray);

    A = areaArray;
    EntranceBoxes = entranceBoxes;
    CommonBoxes = commonBoxes;
    WetAreaBoxes = wetAreaBoxes;
    /*Y = kitchenBoxes;
    K = commonAreaBoxes;*/
    W = WhiteBoxes;

    MV = MarginVectors;
    OV = ObjectVectors;
    Base_Points = BasePoints;

    Furnitures = ObjectsList;
    FurnituresMargins = MarginsList;
# ---------- c_script_4: C# additional code ----------
  public static void Fisher_Yates_CardDeck_Shuffle (List < int > aList) {

    System.Random _random = new System.Random ();

    int myGO;

    int n = aList.Count;
    for (int i = 0; i < n; i++)
    {
      // NextDouble returns a random number between 0 and 1.
      // ... It is equivalent to Math.random() in Java.
      int r = i + (int) (_random.NextDouble() * (n - i));
      myGO = aList[r];
      aList[r] = aList[i];
      aList[i] = myGO;
    }
    // return aList;
  }


  public static void Fisher_Yates_CardDeck_Shuffle (List < double > aList) {

    System.Random _random = new System.Random ();

    double myGO;

    int n = aList.Count;
    for (int i = 0; i < n; i++)
    {
      // NextDouble returns a random number between 0 and 1.
      // ... It is equivalent to Math.random() in Java.
      int r = i + (int) (_random.NextDouble() * (n - i));
      myGO = aList[r];
      aList[r] = aList[i];
      aList[i] = myGO;
    }

    // return aList;
  }

  class Objects
  {
    public string Name;
    public int ZoneName;

    public Box Obj;
    public Box ObjMargin;

    public bool Front = false;
    public bool Right = false;
    public bool Back = false;
    public bool Left = false;
    public bool Top = false;
    public bool Bottom = false;

    public bool RotationBool = true;
    public List<double> RotationOpt = new List<double>(); // rotation options Define angles as double list; 0 is default

    public bool MirrorBool = true;
    public List<int> MirrorOpt = new List<int>(); // mirror options 0=None! 1=z, 2= X, 3 = Y;
    public int AppliedMirror = 0;

    public string Source; // Water, Electiricity
    public int FixedToWall; // Bed, Television //1,2,3 conditions
    public int CellSize;

    public Objects PreviousObject;

    public double ObjLength;
    public double ObjWidth;
    public double ObjHeight;

    public double MrjLength;
    public double MrjWidth;
    public double MrjHeight;

    public double baseX, baseY, baseZ;
    public Vector3d BaseVector;

    public List<int> SpaceList = new List<int>();

    public double XCellMargin;
    public double YCellMargin;
    public double ZCellMargin;

    public double XCellObject;
    public double YCellObject;
    public double ZCellObject;

    public Vector3d VectorMargin;
    public Vector3d VectorObject;

    public Vector3d VectorMarginCache;
    public Vector3d VectorObjectCache;

    Plane PlaneBase;

    public Objects()
    {
    }

    public Objects(string name, int zoneName, bool front, bool right, bool back, bool left, bool top, bool bottom, bool rotationalBool, List<double> rotationOpt, bool mirrorBool, List<int> mirrorOpt, string source, int fixedTowall, int cellSize, Box obj, Box objMargin, List<int> spaceList)
      : this()
    {
      this.Obj = obj;
      this.ObjMargin = objMargin;

      this.Name = name;
      this.ZoneName = zoneName;

      this.Front = front;
      this.Right = right;
      this.Back = back;
      this.Left = left;
      this.Bottom = bottom;
      this.Top = top;

      this.RotationBool = rotationalBool;
      this.RotationOpt = rotationOpt;

      this.MirrorBool = mirrorBool;
      this.MirrorOpt = mirrorOpt;

      this.Source = source;
      this.FixedToWall = fixedTowall;
      this.CellSize = cellSize;

      this.baseX = Obj.Plane.OriginX;
      this.baseY = Obj.Plane.OriginY;
      this.baseZ = Obj.Plane.OriginZ;

      this.PlaneBase = new Plane(PreviousObject.PlaneBase.Origin, new Vector3d(0, 0, 1));

      this.SpaceList = spaceList;
    }

    public Objects(string name, int zoneName, bool front, bool right, bool back, bool left, bool top, bool bottom, bool rotationalBool, List<double> rotationOpt, bool mirrorBool, List<int> mirrorOpt, string source, int fixedTowall, int cellSize, Box obj, Box objMargin, Objects previousObject, List<int> spaceList)
      : this(name, zoneName, front, right, back, left, top, bottom, rotationalBool, rotationOpt, mirrorBool, mirrorOpt, source, fixedTowall, cellSize, obj, objMargin, spaceList)
    {
      this.PreviousObject = previousObject;
    }

    public void AssignDimensions()
    {
      this.ObjWidth = this.Obj.X.T1;
      this.ObjLength = this.Obj.Y.T1;
      this.ObjHeight = this.Obj.Z.T1;

      this.MrjWidth = this.ObjMargin.X.T1;
      this.MrjLength = this.ObjMargin.Y.T1;
      this.MrjHeight = this.ObjMargin.Z.T1;

      this.VectorObject = new Vector3d(this.ObjWidth, this.ObjLength, this.ObjHeight);
      this.VectorMargin = new Vector3d(this.MrjWidth, this.MrjLength, this.MrjHeight);

      this.VectorMarginCache = this.VectorMargin;
      this.VectorObjectCache = this.VectorObject;

    }

    public void PrintDimensions()
    {
      Rhino.RhinoApp.WriteLine("Obj Width " + this.ObjWidth.ToString());
      Rhino.RhinoApp.WriteLine("Obj Length " + this.ObjLength.ToString());
      Rhino.RhinoApp.WriteLine("Obj Height " + this.ObjHeight.ToString());

      Rhino.RhinoApp.WriteLine("Obj Width " + this.MrjWidth.ToString());
      Rhino.RhinoApp.WriteLine("Obj Length " + this.MrjLength.ToString());
      Rhino.RhinoApp.WriteLine("Obj Height " + this.MrjHeight.ToString());
    }

    public void Rotate(double Angle)
    {
      Angle = Angle * (Math.PI / 180);

      VectorMargin.Rotate(Angle, new Vector3d(0, 0, 1));
      VectorObject.Rotate(Angle, new Vector3d(0, 0, 1));
    }

    public void Mirroring(int axis)
    {
      if(axis != 0 )
      {
        Point3d pointa = new Point3d(this.baseX, this.baseY, this.baseZ);
        Vector3d pointb = new Vector3d();

        if (axis == 1)                //Z Symmetry
        { pointb = new Vector3d(0, 0, 1); }
        else if (axis == 2)                //X Symmtry
        { pointb = new Vector3d(0, 1, 0); }
        else if (axis == 3)                // Y Symmetry
        { pointb = new Vector3d(1, 0, 0); }

        Plane planee = new Plane(pointa, pointb);

        VectorMargin.Transform(Transform.Mirror(planee));
        VectorObject.Transform(Transform.Mirror(planee));
      }

    }

    public void PlaceRefObject(int[,,] emptyFullArray, int[,,] areaArray, out Box ObjBox, out Box marginBox)
    {

      Point3d pointa = new Point3d(0, 0, 0);
      Vector3d pointb = new Vector3d(0, 0, 1);
      Plane planee = new Plane(pointa, pointb);

      this.XCellMargin = (this.VectorMargin.X < 0 ? -1 : 1) * Math.Ceiling((double) Math.Abs(this.VectorMargin.X / CellSize));
      this.YCellMargin = (this.VectorMargin.Y < 0 ? -1 : 1) * Math.Ceiling((double) Math.Abs(this.VectorMargin.Y / CellSize));
      this.ZCellMargin = (this.VectorMargin.Z < 0 ? -1 : 1) * Math.Ceiling((double) Math.Abs(this.VectorMargin.Z / 150));

      this.XCellObject = (this.VectorObject.X < 0 ? -1 : 1) * Math.Ceiling((double) Math.Abs(this.VectorObject.X / CellSize));
      this.YCellObject = (this.VectorObject.Y < 0 ? -1 : 1) * Math.Ceiling((double) Math.Abs(this.VectorObject.Y / CellSize));
      this.ZCellObject = (this.VectorObject.Z < 0 ? -1 : 1) * Math.Ceiling((double) Math.Abs(this.VectorObject.Z / 150));

      bool emptyBool = true;
      bool sameZone = true;

      bool placeSuccessful = false;
      int trycount = 0;



      while (placeSuccessful == false)
      {
        var rand = new Random();
        var randomCellIndex = rand.Next(this.SpaceList.Count / 2);

        baseX = (this.SpaceList[2 * randomCellIndex]) * CellSize;
        baseY = (this.SpaceList[2 * randomCellIndex + 1]) * CellSize;
        baseZ = 0;

        if ((baseX + this.VectorMargin.X < 360) && (baseY + this.VectorMargin.Y < 600) && (baseZ + this.VectorMargin.Z < 300) &&
          (baseX + this.VectorMargin.X > 0) && (baseY + this.VectorMargin.Y > 0) && (baseZ + this.VectorMargin.Z > 0))
        {
          for (int i = (int) (baseX / CellSize); i < (baseX / CellSize + (int) XCellMargin); i++)
          {
            for (int j = (int) (baseY / CellSize); j < baseY / CellSize + (int) YCellMargin; j++)
            {
              for (int k = (int) (baseZ / 150); k < baseZ / 150 + (int) ZCellMargin; k++)
              {
                //Rhino.RhinoApp.WriteLine("Entrance Reference Object :  " + "  i:  " + i + "  j:  " + j + "  k:  " + k);
                if (emptyFullArray[i, j, k] == 2 || emptyFullArray[i, j, k] == 1)
                {
                  emptyBool = false;
                }
                if (areaArray[i, j, k] != this.ZoneName)
                {
                  sameZone = false;
                }
              }
            }
          }

          if (emptyBool && sameZone)
          {
            placeSuccessful = true;

            Rhino.RhinoApp.WriteLine("Reference Object conditions are successful ");
            for (int i = (int) (baseX / CellSize); i < (baseX / CellSize + (int) XCellMargin); i++)
            {
              for (int j = (int) (baseY / CellSize); j < baseY / CellSize + (int) YCellMargin; j++)
              {
                for (int k = (int) (baseZ / 150); k < baseZ / 150 + (int) ZCellMargin; k++)
                {
                  emptyFullArray[i, j, k] = 2;
                }
              }
            }
          }
          else
          {
            Rhino.RhinoApp.WriteLine("Conditions are not satisfied ");
          }
        }

        trycount++;
        Rhino.RhinoApp.WriteLine("Try count is : " + trycount);
        if (trycount > 60)
          Rhino.RhinoApp.WriteLine("Try count is over 60 placement is unsuccessful: ");
        placeSuccessful = true;
      }

      if (trycount < 60 && placeSuccessful)
      {
        Rhino.RhinoApp.WriteLine("baseX " + this.baseX);
        Rhino.RhinoApp.WriteLine("baseY " + this.baseY);
        Rhino.RhinoApp.WriteLine("baseZ " + this.baseZ);

        pointa = new Point3d(baseX, baseY, 0);
        pointb = new Vector3d(0, 0, 1);

        Plane planebase = new Plane(pointa, pointb);

        Interval xInterval = new Interval(0, this.ObjWidth);
        Interval yInterval = new Interval(0, this.ObjLength);
        Interval zInterval = new Interval(0, this.ObjHeight);

        ObjBox = new Box(planebase, xInterval, yInterval, zInterval);

        xInterval = new Interval(0, this.MrjWidth);
        yInterval = new Interval(0, this.MrjLength);
        zInterval = new Interval(0, this.MrjHeight);

        marginBox = new Box(planebase, xInterval, yInterval, zInterval);

      }

      else
      {
        ObjBox = new Box();
        marginBox = new Box();
      }
    }

    public void PlaceRefObjectEntrance(int[,,] emptyFullArray, int[,,] areaArray, out Box ObjBox, out Box marginBox, out bool placementFailed)
    {
      this.XCellMargin = (this.VectorMargin.X < 0 ? -1 : 1) * Math.Ceiling((double) Math.Abs(this.VectorMargin.X / CellSize));
      this.YCellMargin = (this.VectorMargin.Y < 0 ? -1 : 1) * Math.Ceiling((double) Math.Abs(this.VectorMargin.Y / CellSize));
      this.ZCellMargin = (this.VectorMargin.Z < 0 ? -1 : 1) * Math.Ceiling((double) Math.Abs(this.VectorMargin.Z / 150));

      //Rhino.RhinoApp.WriteLine(" MARGIN  numbers ----------------------------------" + XCellMargin.ToString() + ' ' + YCellMargin.ToString() + ' ' + ZCellMargin.ToString() + ' ');


      this.XCellObject = (this.VectorObject.X < 0 ? -1 : 1) * Math.Ceiling((double) Math.Abs(this.VectorObject.X / CellSize));
      this.YCellObject = (this.VectorObject.Y < 0 ? -1 : 1) * Math.Ceiling((double) Math.Abs(this.VectorObject.Y / CellSize));
      this.ZCellObject = (this.VectorObject.Z < 0 ? -1 : 1) * Math.Ceiling((double) Math.Abs(this.VectorObject.Z / 150));


      //Rhino.RhinoApp.WriteLine(" OBJECT  numbers ----------------------------------" + XCellObject.ToString() + ' ' + YCellObject.ToString() + ' ' + ZCellObject.ToString() + ' ');

      // We need to define the start end end points because we dont know if the inital poin is lower than end point


      bool emptyBool = true;
      bool sameZone = true;

      bool placeSuccessful = false;
      int trycount = 0;
      bool enoughTries = false;

      while (placeSuccessful == false && enoughTries == false)
      {
        var rand = new Random();
        var randomCellIndex = rand.Next(this.SpaceList.Count / 2);

        baseX = (this.SpaceList[2 * randomCellIndex]) * CellSize;
        baseY = 0;
        baseZ = 0;

        BaseVector = new Vector3d(baseX, baseY, baseZ);

        int XLoopStartMargin = (int) ((int) (baseX / CellSize) < (baseX / CellSize + (int) XCellMargin) ? (int) (baseX / CellSize) : (baseX / CellSize + (int) XCellMargin));
        int XLoopEndMargin = (int) ((int) (baseX / CellSize) > (baseX / CellSize + (int) XCellMargin) ? (int) (baseX / CellSize) : (baseX / CellSize + (int) XCellMargin));

        int YLoopStartMargin = (int) ((int) (baseY / CellSize) < baseY / CellSize + (int) YCellMargin ? (int) (baseY / CellSize) : baseY / CellSize + (int) YCellMargin);
        int YLoopEnMargin = (int) ((int) (baseY / CellSize) > baseY / CellSize + (int) YCellMargin ? (int) (baseY / CellSize) : baseY / CellSize + (int) YCellMargin);

        int ZLoopStartMargin = (int) ((int) (baseZ / 150) < baseZ / 150 + (int) ZCellMargin ? (int) (baseZ / 150) : baseZ / 150 + (int) ZCellMargin);
        int ZLoopEndMargin = (int) ((int) (baseZ / 150) > baseZ / 150 + (int) ZCellMargin ? (int) (baseZ / 150) : baseZ / 150 + (int) ZCellMargin);

        /***/
        int XLoopStartObject = (int) ((int) (baseX / CellSize) < (baseX / CellSize + (int) XCellObject) ? (int) (baseX / CellSize) : (baseX / CellSize + (int) XCellObject));
        int XLoopEndObject = (int) ((int) (baseX / CellSize) > (baseX / CellSize + (int) XCellObject) ? (int) (baseX / CellSize) : (baseX / CellSize + (int) XCellObject));

        int YLoopStartObject = (int) ((int) (baseY / CellSize) < baseY / CellSize + (int) YCellObject ? (int) (baseY / CellSize) : baseY / CellSize + (int) YCellObject);
        int YLoopEnObject = (int) ((int) (baseY / CellSize) > baseY / CellSize + (int) YCellObject ? (int) (baseY / CellSize) : baseY / CellSize + (int) YCellObject);

        int ZLoopStartObject = (int) ((int) (baseZ / 150) < baseZ / 150 + (int) ZCellObject ? (int) (baseZ / 150) : baseZ / 150 + (int) ZCellObject);
        int ZLoopEndObject = (int) ((int) (baseZ / 150) > baseZ / 150 + (int) ZCellObject ? (int) (baseZ / 150) : baseZ / 150 + (int) ZCellObject);

/*
        Rhino.RhinoApp.WriteLine("X    Loop numbers ----------------------------------" + XLoopStartMargin.ToString() + ' ' + XLoopEndMargin.ToString() + ' ');
        Rhino.RhinoApp.WriteLine("Y    Loop numbers ----------------------------------" + YLoopStartMargin.ToString() + ' ' + YLoopEnMargin.ToString() + ' ');
        Rhino.RhinoApp.WriteLine("Z    Loop numbers ----------------------------------" + ZLoopStartMargin.ToString() + ' ' + ZLoopEndMargin.ToString() + ' ');
*/
        bool inLimit = true;

        if (!((baseX + VectorMargin.X < 360) && (baseY + VectorMargin.Y < 600) && (baseZ + VectorMargin.Z < 300) &&
          (baseX + VectorMargin.X > 0) && (baseY + VectorMargin.Y > 0) && (baseZ + VectorMargin.Z > 0)))
        {
          inLimit = false;
        }

        if (inLimit)
        {
          for (int i = XLoopStartMargin; i < XLoopEndMargin; i++)
          {
            for (int j = YLoopStartMargin; j < YLoopEnMargin; j++)
            {
              for (int k = ZLoopStartMargin; k < ZLoopEndMargin; k++)
              {
                //checks if the cell is empty (We dont want to see an object in a cell! )
                if (((emptyFullArray[i, j, k] == 1) || (emptyFullArray[i, j, k] == 2)))
                {
                  //Rhino.RhinoApp.WriteLine(" Loop numbers ----------------------------------" + i.ToString() + ' ' + j.ToString() + ' ' + k.ToString() + ' ');
                  emptyBool = false;
                }

                // 2nd Loop checks if the zone is the same or empty zone // Actually margin can ovewflow to other zones
                /*
                if (!(areaArray[i, j, k] != this.ZoneName || areaArray[i, j, k] != 0))
                {
                sameZone = false;
                }
                */
              }
            }
          }

          // 2nd Loop checks if the zone is the same or empty zone
          for (int i = XLoopStartObject; i < XLoopEndObject; i++)
          {
            for (int j = YLoopStartObject; j < YLoopEnObject; j++)
            {
              for (int k = ZLoopStartObject; k < ZLoopEndObject; k++)
              {
                //checks if the cell is empty (We dont want to see margin or object in the cell )
                if (((emptyFullArray[i, j, k] == 1) || (emptyFullArray[i, j, k] == 2)))
                {
                  emptyBool = false;
                }

                // 2nd Loop checks if the zone is the same or empty zone
                if (!(areaArray[i, j, k] == this.ZoneName || areaArray[i, j, k] == 0))
                {
                  sameZone = false;
                }
              }
            }
          }

          if (emptyBool && sameZone)
          {
            placeSuccessful = true;
            Rhino.RhinoApp.WriteLine("Reference Object conditions are successful ");
            //Place Margin
            for (int i = XLoopStartMargin; i < XLoopEndMargin; i++)
            {
              for (int j = YLoopStartMargin; j < YLoopEnMargin; j++)
              {
                for (int k = ZLoopStartMargin; k < ZLoopEndMargin; k++)
                {
                  //Rhino.RhinoApp.WriteLine(" Loop numbers ----------------------------------" + i.ToString() + ' ' + j.ToString() + ' ' + k.ToString() + ' ');
                  emptyFullArray[i, j, k] = 2; // 2 represents margin
                }
              }
            }
            //Place Object, object is smaller than margin
            for (int i = XLoopStartObject; i < XLoopEndObject; i++)
            {
              for (int j = YLoopStartObject; j < YLoopEnObject; j++)
              {
                for (int k = ZLoopStartObject; k < ZLoopEndObject; k++)
                {
                  //Rhino.RhinoApp.WriteLine("Loop inetegers --------------- " + i.ToString() + ' ' + j.ToString() + ' ' + k.ToString() + ' ');
                  emptyFullArray[i, j, k] = 1; // 1 represents object
                }
              }
            }
          }
          else
          {
            Rhino.RhinoApp.WriteLine("EntranceZone Placement Conditions are not satisfied ");
          }
        }
      }
      trycount++;
      Rhino.RhinoApp.WriteLine("Try count is : " + trycount);
      if (trycount > 60)
      {
        Rhino.RhinoApp.WriteLine("Try count is over 60 placement is unsuccessful: ");
        enoughTries = true;
      }

      if (trycount < 60 && placeSuccessful)
      {
        placementFailed = false;
        Rhino.RhinoApp.WriteLine("baseX " + this.baseX);
        Rhino.RhinoApp.WriteLine("baseY " + this.baseY);
        Rhino.RhinoApp.WriteLine("baseZ " + this.baseZ);

        Point3d pointa = new Point3d(baseX, 0, 0);
        Vector3d pointb = new Vector3d(0, 0, 1);

        Plane planebase = new Plane(pointa, pointb);

        Interval xInterval = new Interval(0, this.ObjWidth);
        Interval yInterval = new Interval(0, this.ObjLength);
        Interval zInterval = new Interval(0, this.ObjHeight);

        ObjBox = new Box(planebase, xInterval, yInterval, zInterval);

        xInterval = new Interval(0, this.MrjWidth);
        yInterval = new Interval(0, this.MrjLength);
        zInterval = new Interval(0, this.MrjHeight);

        marginBox = new Box(planebase, xInterval, yInterval, zInterval);
      }
      else
      {
        ObjBox = new Box();
        marginBox = new Box();
        placementFailed = true;
      }
    }

    public void PlaceObject(int[,,] emptyFullArray, int[,,] areaArray, out Box ObjBox, out Box marginBox, out bool placementFailed)
    {
      Point3d pointa = new Point3d(baseX, baseY, baseZ);
      Vector3d pointb = new Vector3d(0, 0, 1);

      Plane planebase = new Plane(pointa, pointb);

      Interval xInterval = new Interval(0, this.VectorObject.X);
      Interval yInterval = new Interval(0, this.VectorObject.Y);
      Interval zInterval = new Interval(0, this.VectorObject.Z);

      ObjBox = new Box(planebase, xInterval, yInterval, zInterval);

      xInterval = new Interval(0, this.VectorMargin.X);
      yInterval = new Interval(0, this.VectorMargin.Y);
      zInterval = new Interval(0, this.VectorMargin.Z);

      marginBox = new Box(planebase, xInterval, yInterval, zInterval);

      List<int> growDirection = new List<int>();

      // Stack all the possible directions in a list!

      if (PreviousObject.Front == true)
        growDirection.Add(1); // Front Direction
      if (PreviousObject.Right == true)
        growDirection.Add(2); // Right Direction
      if (PreviousObject.Back == true)
        growDirection.Add(3); // Back Direction
      if (PreviousObject.Left == true)
        growDirection.Add(4); // Left Direction
      if (PreviousObject.Bottom == true)
        growDirection.Add(5); // Bottom Direction
      if (PreviousObject.Top == true)
        growDirection.Add(6); // Right Direction

      //Show the possible direction number !
      if (growDirection.Count != 0)
      {
        for (int i = 0; i < growDirection.Count; i++)
        {
          Rhino.RhinoApp.WriteLine("In grow  " + growDirection[i]);
        }
      }

      bool placeSuccess = false;
      int counter = 0;

      Random randm = new Random();
      Rhino.RhinoApp.WriteLine("Element Number of the grow Direction before while loop " + growDirection.Count.ToString());

      while (growDirection.Count > 0 && placeSuccess == false && counter < 6)
      {
        Rhino.RhinoApp.WriteLine("Counter number in the check direction loop " + counter.ToString());

        int a = randm.Next(0, growDirection.Count);

        int randomDirectionIndex = growDirection[a];

        Rhino.RhinoApp.WriteLine("Element Number of the grow Direction in while loop " + growDirection.Count.ToString());

        switch (randomDirectionIndex)
        {
          case 1:
            if (CheckFront(emptyFullArray, areaArray))
            {
              this.PlaceFront(emptyFullArray, out ObjBox, out marginBox);
              placeSuccess = true;
            }
            else
            {
              growDirection.Remove(randomDirectionIndex);
              Rhino.RhinoApp.WriteLine("Could not be Placed to FRONT ");
              Rhino.RhinoApp.WriteLine("Element Number of the grow Direction after removal " + growDirection.Count.ToString());
            }
            counter++;
            break;

          case 2:
            if (CheckRight(emptyFullArray, areaArray))
            {
              this.PlaceRight(emptyFullArray, out ObjBox, out marginBox);
              placeSuccess = true;
            }
            else
            {
              growDirection.Remove(randomDirectionIndex);
              Rhino.RhinoApp.WriteLine("Could not Placed to RIGHT ");
              Rhino.RhinoApp.WriteLine("Element Number of the grow Direction after removal " + growDirection.Count.ToString());
            }
            counter++;
            break;

          case 3:
            if (CheckBack(emptyFullArray, areaArray))
            {
              this.PlaceBack(emptyFullArray, out ObjBox, out marginBox);
              placeSuccess = true;
            }

            else
            {
              growDirection.Remove(randomDirectionIndex);
              Rhino.RhinoApp.WriteLine("Could not Placed to BACK ");
              Rhino.RhinoApp.WriteLine("Element Number of the grow Direction after removal " + growDirection.Count.ToString());
            }
            counter++;
            break;

          case 4:
            if (CheckLeft(emptyFullArray, areaArray))
            {
              this.PlaceLeft(emptyFullArray, out ObjBox, out marginBox);
              placeSuccess = true;
            }
            else
            {
              growDirection.Remove(randomDirectionIndex);
              Rhino.RhinoApp.WriteLine("Could not Placed to LEFT ");
              Rhino.RhinoApp.WriteLine("Element Number of the grow Direction after removal " + growDirection.Count.ToString());
            }
            counter++;
            break;

          case 5:
            if (CheckTop(emptyFullArray, areaArray))
            {
              this.PlaceTop(emptyFullArray, out ObjBox, out marginBox);
              placeSuccess = true;
            }
            else
            {
              growDirection.Remove(randomDirectionIndex);
              Rhino.RhinoApp.WriteLine("Could not Placed to Top ");
              Rhino.RhinoApp.WriteLine("Element Number of the grow Direction after removal " + growDirection.Count.ToString());
            }
            counter++;
            break;

          case 6:
            if (CheckBottom(emptyFullArray, areaArray))
            {
              this.PlaceBottom(emptyFullArray, out ObjBox, out marginBox);
              placeSuccess = true;
            }
            else
            {
              growDirection.Remove(randomDirectionIndex);
              Rhino.RhinoApp.WriteLine("Could not Placed to BOTTOM ");
              Rhino.RhinoApp.WriteLine("Element Number of the grow Direction after removal " + growDirection.Count.ToString());
            }
            counter++;
            break;

          default:
            counter++;
            break;
        }
      }

      if (placeSuccess == false)
      {
        Rhino.RhinoApp.WriteLine("Placement unsuccessfull ");
        placementFailed = true;
      }
      else
        placementFailed = false;
    }

    public bool CheckFront (int[,,] emptyFullArray, int[,,] areaArray)
    {
      bool suitableDirection = true;
      
      Fisher_Yates_CardDeck_Shuffle(MirrorOpt);
      Fisher_Yates_CardDeck_Shuffle(RotationOpt);

      for(int f = 0 ;f < this.MirrorOpt.Count ; f++ )
      {
        for( int g = 0 ;g < this.RotationOpt.Count ;g++ )
        {
          for(int h = (int ) (
              VectorMargin.X * VectorMargin.Y > 0 ? ( Math.Min(PreviousObject.baseX, PreviousObject.baseX + PreviousObject.VectorMargin.X))
              : ( Math.Min(PreviousObject.baseY, PreviousObject.baseY + PreviousObject.VectorMargin.Y)))
            ; VectorMargin.X * VectorMargin.Y > 0 ? ( h <= Math.Max(PreviousObject.baseX + PreviousObject.VectorMargin.X, PreviousObject.baseX))
            : ( h <= Math.Max(PreviousObject.baseY, PreviousObject.baseY))
            ; h = h + this.CellSize )
          {
            Rhino.RhinoApp.WriteLine(" ");
            Rhino.RhinoApp.WriteLine("Rotation Angle is:  " + RotationOpt[g].ToString());
            Rhino.RhinoApp.WriteLine("MirrorOption is:  " + MirrorOpt[f].ToString());
            Rhino.RhinoApp.WriteLine(" ");


            this.Rotate((int) RotationOpt[g]);
            this.Mirroring(MirrorOpt[f]);
            
            AppliedMirror = MirrorOpt[f];
            
            bool inLimits = true;
            bool emptyBool = true;
            bool sameZone = true;

            suitableDirection = true;
            bool initialDirectionCheck = true;

            this.XCellMargin = (this.VectorMargin.X < 0 ? -1 : 1) * Math.Ceiling((double) Math.Abs(this.VectorMargin.X / CellSize));
            this.YCellMargin = (this.VectorMargin.Y < 0 ? -1 : 1) * Math.Ceiling((double) Math.Abs(this.VectorMargin.Y / CellSize));
            this.ZCellMargin = (this.VectorMargin.Z < 0 ? -1 : 1) * Math.Ceiling((double) Math.Abs(this.VectorMargin.Z / 150));

            this.XCellObject = (this.VectorObject.X < 0 ? -1 : 1) * Math.Ceiling((double) Math.Abs(this.VectorObject.X / CellSize));
            this.YCellObject = (this.VectorObject.Y < 0 ? -1 : 1) * Math.Ceiling((double) Math.Abs(this.VectorObject.Y / CellSize));
            this.ZCellObject = (this.VectorObject.Z < 0 ? -1 : 1) * Math.Ceiling((double) Math.Abs(this.VectorObject.Z / 150));
/*
            Rhino.RhinoApp.WriteLine(" MARGIN  Front numbers -----------------------" + XCellMargin.ToString() + ' ' + YCellMargin.ToString() + ' ' + ZCellMargin.ToString() + ' ');
            Rhino.RhinoApp.WriteLine(" OBJECT  Front numbers -----------------------" + XCellObject.ToString() + ' ' + YCellObject.ToString() + ' ' + ZCellObject.ToString() + ' ');
*/
            if (VectorMargin.X * VectorMargin.Y > 0)
            {
              this.baseX = h; // slide over X axis , Y axis should be constant
              this.baseY = PreviousObject.baseY + PreviousObject.YCellMargin * this.CellSize;
              this.baseZ = PreviousObject.baseZ;
            }
            else if (VectorMargin.X * VectorMargin.Y < 0)
            {
              this.baseX = PreviousObject.baseX + PreviousObject.XCellMargin * this.CellSize;
              this.baseY = h; // slide over Y axis , X axis should be constant
              this.baseZ = PreviousObject.baseZ;
            }
 
            Point3d pointa = new Point3d(0, 0, 0);
            Vector3d pointb = new Vector3d(0, 0, 1);
            Plane planee = new Plane(pointa, pointb);

            Vector3d vecX1 = new Vector3d(1, 0, 0); 

            BaseVector = new Vector3d(baseX, baseY, baseZ);

            
            if(PreviousObject.AppliedMirror == 0)
            {
              
            
            }
            
            if(PreviousObject.AppliedMirror == 2)
            {
              
            
            }
            
            if(PreviousObject.AppliedMirror == 2)
            {
              
            
            }
            
            if(PreviousObject.AppliedMirror == 2)
            {
              
            
            }
            
            
            if (PreviousObject.VectorMargin.X > 0 && PreviousObject.VectorMargin.Y > 0 && VectorObject.Y > 0 || // if previous object looks front // Y value should be positive
              PreviousObject.VectorMargin.X < 0 && PreviousObject.VectorMargin.Y < 0 && VectorMargin.Y < 0 || // if previous object looks back  // Y value should be negative
              PreviousObject.VectorMargin.X < 0 && PreviousObject.VectorMargin.Y > 0 && VectorMargin.X < 0 || // if previous object looks left //  X value should be positive
              PreviousObject.VectorMargin.X > 0 && PreviousObject.VectorMargin.Y < 0 && VectorMargin.X > 0       // if previous object looks right // X value should be positive
              )
            {
              initialDirectionCheck = true;
            }

            if (!((baseX + VectorMargin.X < 360) && (baseY + VectorMargin.Y < 600) && (baseZ + VectorMargin.Z < 300) &&
              (baseX + VectorMargin.X > 0) && (baseY + VectorMargin.Y > 0) && (baseZ + VectorMargin.Z > 0)))
            {
              inLimits = false;
            }
            // Rhino.RhinoApp.WriteLine("Bools " + suitableDirection.ToString() + "    " + inLimits.ToString() + ' ');

            int XLoopStartMargin = (int) ((int) (baseX / CellSize) < (baseX / CellSize + (int) XCellMargin) ? (int) (baseX / CellSize) : (baseX / CellSize + (int) XCellMargin));
            int XLoopEndMargin = (int) ((int) (baseX / CellSize) > (baseX / CellSize + (int) XCellMargin) ? (int) (baseX / CellSize) : (baseX / CellSize + (int) XCellMargin));

            int YLoopStartMargin = (int) ((int) (baseY / CellSize) < baseY / CellSize + (int) YCellMargin ? (int) (baseY / CellSize) : baseY / CellSize + (int) YCellMargin);
            int YLoopEnMargin = (int) ((int) (baseY / CellSize) > baseY / CellSize + (int) YCellMargin ? (int) (baseY / CellSize) : baseY / CellSize + (int) YCellMargin);

            int ZLoopStartMargin = (int) ((int) (baseZ / 150) < baseZ / 150 + (int) ZCellMargin ? (int) (baseZ / 150) : baseZ / 150 + (int) ZCellMargin);
            int ZLoopEndMargin = (int) ((int) (baseZ / 150) > baseZ / 150 + (int) ZCellMargin ? (int) (baseZ / 150) : baseZ / 150 + (int) ZCellMargin);

            /***/
            int XLoopStartObject = (int) ((int) (baseX / CellSize) < (baseX / CellSize + (int) XCellObject) ? (int) (baseX / CellSize) : (baseX / CellSize + (int) XCellObject));
            int XLoopEndObject = (int) ((int) (baseX / CellSize) > (baseX / CellSize + (int) XCellObject) ? (int) (baseX / CellSize) : (baseX / CellSize + (int) XCellObject));

            int YLoopStartObject = (int) ((int) (baseY / CellSize) < baseY / CellSize + (int) YCellObject ? (int) (baseY / CellSize) : baseY / CellSize + (int) YCellObject);
            int YLoopEnObject = (int) ((int) (baseY / CellSize) > baseY / CellSize + (int) YCellObject ? (int) (baseY / CellSize) : baseY / CellSize + (int) YCellObject);

            int ZLoopStartObject = (int) ((int) (baseZ / 150) < baseZ / 150 + (int) ZCellObject ? (int) (baseZ / 150) : baseZ / 150 + (int) ZCellObject);
            int ZLoopEndObject = (int) ((int) (baseZ / 150) > baseZ / 150 + (int) ZCellObject ? (int) (baseZ / 150) : baseZ / 150 + (int) ZCellObject);
/*

            Rhino.RhinoApp.WriteLine("X  Front  Margin Loop numbers -------------" + XLoopStartMargin.ToString() + ' ' + XLoopEndMargin.ToString() + ' ');
            Rhino.RhinoApp.WriteLine("Y  Front Margin  Loop numbers -------------" + YLoopStartMargin.ToString() + ' ' + YLoopEnMargin.ToString() + ' ');
            Rhino.RhinoApp.WriteLine("Z  Front  Margin Loop numbers -------------" + ZLoopStartMargin.ToString() + ' ' + ZLoopEndMargin.ToString() + ' ');

            Rhino.RhinoApp.WriteLine("X  Front Object Loop numbers ----------" + XLoopStartObject.ToString() + ' ' + XLoopEndObject.ToString() + ' ');
            Rhino.RhinoApp.WriteLine("Y  Front Object  Loop numbers ---------" + YLoopStartObject.ToString() + ' ' + YLoopEnObject.ToString() + ' ');
            Rhino.RhinoApp.WriteLine("Z  Front Object  Loop numbers ---------" + ZLoopStartObject.ToString() + ' ' + ZLoopEndObject.ToString() + ' ');
*/
            if (inLimits && initialDirectionCheck)
            {
              for (int i = XLoopStartMargin; i < XLoopEndMargin; i++)
              {
                for (int j = YLoopStartMargin; j < YLoopEnMargin; j++)
                {
                  for (int k = ZLoopStartMargin; k < ZLoopEndMargin; k++)
                  {
                    //checks if the cell is empty (We dont want to see an object in a cell! )
                    if (((emptyFullArray[i, j, k] == 1) || (emptyFullArray[i, j, k] == 2)))
                    {
                      //Rhino.RhinoApp.WriteLine("Front Margin Array is full, Loop numbers ------" + i.ToString() + ' ' + j.ToString() + ' ' + k.ToString() + ' ');
                      emptyBool = false;
                    }

                    // 2nd Loop checks if the zone is the same or empty zone // Actually margin can ovewflow to other zones
                    /*
                    if (!(areaArray[i, j, k] != this.ZoneName || areaArray[i, j, k] != 0))
                    {
                    sameZone = false;
                    }
                    */
                  }
                }
              }
              // 2nd Loop checks if the zone is the same or empty zone
              for (int i = XLoopStartObject; i < XLoopEndObject; i++)
              {
                for (int j = YLoopStartObject; j < YLoopEnObject; j++)
                {
                  for (int k = ZLoopStartObject; k < ZLoopEndObject; k++)
                  {
                    //checks if the cell is empty (We dont want to see margin or object in the cell )
                    if (((emptyFullArray[i, j, k] == 1) || (emptyFullArray[i, j, k] == 2)))
                    {
                      //Rhino.RhinoApp.WriteLine("Front object Array is full: Loop numbers ---------------------------------- i:" + i.ToString() + 'j' + j.ToString() + 'k' + k.ToString() + ' ');
                      emptyBool = false;
                    }

                    // 2nd Loop checks if the zone is the same or empty zone
                    if (!(areaArray[i, j, k] == this.ZoneName || areaArray[i, j, k] == 0))
                    {
                      sameZone = false;
                    }
                  }
                }
              }

              if (emptyBool && sameZone)
              {
                suitableDirection = true;
                Rhino.RhinoApp.WriteLine("Place Front: Conditions are  satisfied********************************************************************************************************** ");
                goto SkipLoop;
                // BREAK THE LOOP IF A SOLUTION IS FOUND
              }
              else
              {
                Rhino.RhinoApp.WriteLine("Place Front: Conditions are not satisfied ");
                suitableDirection = false;

                // RESET DRIECTION AND MIRROR
                VectorMargin = this.VectorMarginCache;
                VectorObject = this.VectorObjectCache;
              }
            }
            else
            {
              Rhino.RhinoApp.WriteLine("Place Front:  Conditions are not satisfied ");
              suitableDirection = false;
              // RESET DRIECTION AND MIRROR
              VectorMargin = this.VectorMarginCache;
              VectorObject = this.VectorObjectCache;
            }
          }
        }
      }
      SkipLoop:
        return suitableDirection;
    }

    public void PlaceFront(int[,,] emptyFullArray, out Box ObjBox, out Box marginBox)
    {
      int XLoopStartMargin = (int) ((int) (baseX / CellSize) < (baseX / CellSize + (int) XCellMargin) ? (int) (baseX / CellSize) : (baseX / CellSize + (int) XCellMargin));
      int XLoopEndMargin = (int) ((int) (baseX / CellSize) > (baseX / CellSize + (int) XCellMargin) ? (int) (baseX / CellSize) : (baseX / CellSize + (int) XCellMargin));

      int YLoopStartMargin = (int) ((int) (baseY / CellSize) < baseY / CellSize + (int) YCellMargin ? (int) (baseY / CellSize) : baseY / CellSize + (int) YCellMargin);
      int YLoopEnMargin = (int) ((int) (baseY / CellSize) > baseY / CellSize + (int) YCellMargin ? (int) (baseY / CellSize) : baseY / CellSize + (int) YCellMargin);

      int ZLoopStartMargin = (int) ((int) (baseZ / 150) < baseZ / 150 + (int) ZCellMargin ? (int) (baseZ / 150) : baseZ / 150 + (int) ZCellMargin);
      int ZLoopEndMargin = (int) ((int) (baseZ / 150) > baseZ / 150 + (int) ZCellMargin ? (int) (baseZ / 150) : baseZ / 150 + (int) ZCellMargin);


      int XLoopStartObject = (int) ((int) (baseX / CellSize) < (baseX / CellSize + (int) XCellObject) ? (int) (baseX / CellSize) : (baseX / CellSize + (int) XCellObject));
      int XLoopEndObject = (int) ((int) (baseX / CellSize) > (baseX / CellSize + (int) XCellObject) ? (int) (baseX / CellSize) : (baseX / CellSize + (int) XCellObject));

      int YLoopStartObject = (int) ((int) (baseY / CellSize) < baseY / CellSize + (int) YCellObject ? (int) (baseY / CellSize) : baseY / CellSize + (int) YCellObject);
      int YLoopEnObject = (int) ((int) (baseY / CellSize) > baseY / CellSize + (int) YCellObject ? (int) (baseY / CellSize) : baseY / CellSize + (int) YCellObject);

      int ZLoopStartObject = (int) ((int) (baseZ / 150) < baseZ / 150 + (int) ZCellObject ? (int) (baseZ / 150) : baseZ / 150 + (int) ZCellObject);
      int ZLoopEndObject = (int) ((int) (baseZ / 150) > baseZ / 150 + (int) ZCellObject ? (int) (baseZ / 150) : baseZ / 150 + (int) ZCellObject);

      for (int i = XLoopStartMargin; i < XLoopEndMargin; i++)
      {
        for (int j = YLoopStartMargin; j < YLoopEnMargin; j++)
        {
          for (int k = ZLoopStartMargin; k < ZLoopEndMargin; k++)
          {
            emptyFullArray[i, j, k] = 2; // 2 represents margin
          }
        }
      }
      //Place Object, object is smaller than margin
      for (int i = XLoopStartObject; i < XLoopEndObject; i++)
      {
        for (int j = YLoopStartObject; j < YLoopEnObject; j++)
        {
          for (int k = ZLoopStartObject; k < ZLoopEndObject; k++)
          {
            emptyFullArray[i, j, k] = 1; // 1 represents object
          }
        }
      }

      Point3d pointa = new Point3d(baseX, baseY, baseZ);
      Vector3d pointb = new Vector3d(0, 0, 1);

      Plane planebase = new Plane(pointa, pointb);

      Interval xInterval = new Interval(0, this.VectorObject.X);
      Interval yInterval = new Interval(0, this.VectorObject.Y);
      Interval zInterval = new Interval(0, this.VectorObject.Z);

      ObjBox = new Box(planebase, xInterval, yInterval, zInterval);

      xInterval = new Interval(0, this.VectorMargin.X);
      yInterval = new Interval(0, this.VectorMargin.Y);
      zInterval = new Interval(0, this.VectorMargin.Z);

      marginBox = new Box(planebase, xInterval, yInterval, zInterval);

    }

    public bool CheckRight(int[,,] emptyFullArray, int[,,] areaArray)
    {
      bool emptyBool = true;
      bool sameZone = true;
      bool suitableDirection = true;
      bool inLimits = true;

      /**/
      this.XCellMargin = (this.VectorMargin.X < 0 ? -1 : 1) * Math.Ceiling((double) Math.Abs(this.VectorMargin.X / CellSize));
      this.YCellMargin = (this.VectorMargin.Y < 0 ? -1 : 1) * Math.Ceiling((double) Math.Abs(this.VectorMargin.Y / CellSize));
      this.ZCellMargin = (this.VectorMargin.Z < 0 ? -1 : 1) * Math.Ceiling((double) Math.Abs(this.VectorMargin.Z / 150));

      this.XCellObject = (this.VectorObject.X < 0 ? -1 : 1) * Math.Ceiling((double) Math.Abs(this.VectorObject.X / CellSize));
      this.YCellObject = (this.VectorObject.Y < 0 ? -1 : 1) * Math.Ceiling((double) Math.Abs(this.VectorObject.Y / CellSize));
      this.ZCellObject = (this.VectorObject.Z < 0 ? -1 : 1) * Math.Ceiling((double) Math.Abs(this.VectorObject.Z / 150));

      if (VectorMargin.X * VectorMargin.Y > 0)
      {
        this.baseX = PreviousObject.baseX + PreviousObject.XCellMargin * this.CellSize;
        this.baseY = PreviousObject.baseY;
        this.baseZ = PreviousObject.baseZ;
      }

      else if (VectorMargin.X * VectorMargin.Y < 0)
      {
        this.baseX = PreviousObject.baseX;
        this.baseY = PreviousObject.baseY + PreviousObject.YCellMargin * this.CellSize;
        this.baseZ = PreviousObject.baseZ;
      }

      Point3d pointa = new Point3d(0, 0, 0);
      Vector3d pointb = new Vector3d(0, 0, 1);
      Plane planee = new Plane(pointa, pointb);

      Vector3d vecX1 = new Vector3d(1, 0, 0);

      BaseVector = new Vector3d(baseX, baseY, baseZ);

      /**/

      if (PreviousObject.VectorMargin.X > 0 && PreviousObject.VectorMargin.Y > 0 && VectorObject.X > 0 ||
        PreviousObject.VectorMargin.X < 0 && PreviousObject.VectorMargin.Y < 0 && VectorMargin.X < 0 ||
        PreviousObject.VectorMargin.X < 0 && PreviousObject.VectorMargin.Y > 0 && VectorMargin.Y > 0 ||
        PreviousObject.VectorMargin.X > 0 && PreviousObject.VectorMargin.Y < 0 && VectorMargin.Y < 0
        )
      {
        suitableDirection = true;
      }

      int XLoopStartMargin = (int) ((int) (baseX / CellSize) < (baseX / CellSize + (int) XCellMargin) ? (int) (baseX / CellSize) : (baseX / CellSize + (int) XCellMargin));
      int XLoopEndMargin = (int) ((int) (baseX / CellSize) > (baseX / CellSize + (int) XCellMargin) ? (int) (baseX / CellSize) : (baseX / CellSize + (int) XCellMargin));

      int YLoopStartMargin = (int) ((int) (baseY / CellSize) < baseY / CellSize + (int) YCellMargin ? (int) (baseY / CellSize) : baseY / CellSize + (int) YCellMargin);
      int YLoopEnMargin = (int) ((int) (baseY / CellSize) > baseY / CellSize + (int) YCellMargin ? (int) (baseY / CellSize) : baseY / CellSize + (int) YCellMargin);

      int ZLoopStartMargin = (int) ((int) (baseZ / 150) < baseZ / 150 + (int) ZCellMargin ? (int) (baseZ / 150) : baseZ / 150 + (int) ZCellMargin);
      int ZLoopEndMargin = (int) ((int) (baseZ / 150) > baseZ / 150 + (int) ZCellMargin ? (int) (baseZ / 150) : baseZ / 150 + (int) ZCellMargin);

      /***/
      int XLoopStartObject = (int) ((int) (baseX / CellSize) < (baseX / CellSize + (int) XCellObject) ? (int) (baseX / CellSize) : (baseX / CellSize + (int) XCellObject));
      int XLoopEndObject = (int) ((int) (baseX / CellSize) > (baseX / CellSize + (int) XCellObject) ? (int) (baseX / CellSize) : (baseX / CellSize + (int) XCellObject));

      int YLoopStartObject = (int) ((int) (baseY / CellSize) < baseY / CellSize + (int) YCellObject ? (int) (baseY / CellSize) : baseY / CellSize + (int) YCellObject);
      int YLoopEnObject = (int) ((int) (baseY / CellSize) > baseY / CellSize + (int) YCellObject ? (int) (baseY / CellSize) : baseY / CellSize + (int) YCellObject);

      int ZLoopStartObject = (int) ((int) (baseZ / 150) < baseZ / 150 + (int) ZCellObject ? (int) (baseZ / 150) : baseZ / 150 + (int) ZCellObject);
      int ZLoopEndObject = (int) ((int) (baseZ / 150) > baseZ / 150 + (int) ZCellObject ? (int) (baseZ / 150) : baseZ / 150 + (int) ZCellObject);

      if (!((baseX + VectorMargin.X < 360) && (baseY + VectorMargin.Y < 600) && (baseZ + VectorMargin.Z < 300) &&
        (baseX + VectorMargin.X > 0) && (baseY + VectorMargin.Y > 0) && (baseZ + VectorMargin.Z > 0)))
      {
        inLimits = false;
      }

      if (inLimits && suitableDirection)
      {

        for (int i = XLoopStartMargin; i < XLoopEndMargin; i++)
        {
          for (int j = YLoopStartMargin; j < YLoopEnMargin; j++)
          {
            for (int k = ZLoopStartMargin; k < ZLoopEndMargin; k++)
            {
              //checks if the cell is empty (We dont want to see an object in a cell! )
              if (((emptyFullArray[i, j, k] == 1) || (emptyFullArray[i, j, k] == 2)))
              {
                emptyBool = false;
              }

              // 2nd Loop checks if the zone is the same or empty zone // Actually margin can ovewflow to other zones
              /*
              if (!(areaArray[i, j, k] != this.ZoneName || areaArray[i, j, k] != 0))
              {
              sameZone = false;
              }
              */
            }
          }
        }
        // 2nd Loop checks if the zone is the same or empty zone
        for (int i = XLoopStartObject; i < XLoopEndObject; i++)
        {
          for (int j = YLoopStartObject; j < YLoopEnObject; j++)
          {
            for (int k = ZLoopStartObject; k < ZLoopEndObject; k++)
            {
              //checks if the cell is empty (We dont want to see margin or object in the cell )
              if (((emptyFullArray[i, j, k] == 1) || (emptyFullArray[i, j, k] == 2)))
              {
                Rhino.RhinoApp.WriteLine(" Loop numbers ----------------------------------" + i.ToString() + ' ' + j.ToString() + ' ' + k.ToString() + ' ');
                emptyBool = false;
              }

              // 2nd Loop checks if the zone is the same or empty zone
              if (!(areaArray[i, j, k] == this.ZoneName || areaArray[i, j, k] == 0))
              {
                sameZone = false;
              }
            }
          }
        }


        if (emptyBool && sameZone)
        {
          suitableDirection = true;
          Rhino.RhinoApp.WriteLine("Place Right:  Conditions are  satisfied *********************************************************************************************************");
        }
        else
        {
          Rhino.RhinoApp.WriteLine("Place Right:  Conditions are not satisfied ");
          suitableDirection = false;
        }
      }
      else
      {
        Rhino.RhinoApp.WriteLine("Place Right:  Conditions are not satisfied ");
        suitableDirection = false;
      }
      return suitableDirection;
    }

    public void PlaceRight(int[,,] emptyFullArray, out Box ObjBox, out Box marginBox)
    {
      int XLoopStartMargin = (int) ((int) (baseX / CellSize) < (baseX / CellSize + (int) XCellMargin) ? (int) (baseX / CellSize) : (baseX / CellSize + (int) XCellMargin));
      int XLoopEndMargin = (int) ((int) (baseX / CellSize) > (baseX / CellSize + (int) XCellMargin) ? (int) (baseX / CellSize) : (baseX / CellSize + (int) XCellMargin));

      int YLoopStartMargin = (int) ((int) (baseY / CellSize) < baseY / CellSize + (int) YCellMargin ? (int) (baseY / CellSize) : baseY / CellSize + (int) YCellMargin);
      int YLoopEnMargin = (int) ((int) (baseY / CellSize) > baseY / CellSize + (int) YCellMargin ? (int) (baseY / CellSize) : baseY / CellSize + (int) YCellMargin);

      int ZLoopStartMargin = (int) ((int) (baseZ / 150) < baseZ / 150 + (int) ZCellMargin ? (int) (baseZ / 150) : baseZ / 150 + (int) ZCellMargin);
      int ZLoopEndMargin = (int) ((int) (baseZ / 150) > baseZ / 150 + (int) ZCellMargin ? (int) (baseZ / 150) : baseZ / 150 + (int) ZCellMargin);


      int XLoopStartObject = (int) ((int) (baseX / CellSize) < (baseX / CellSize + (int) XCellObject) ? (int) (baseX / CellSize) : (baseX / CellSize + (int) XCellObject));
      int XLoopEndObject = (int) ((int) (baseX / CellSize) > (baseX / CellSize + (int) XCellObject) ? (int) (baseX / CellSize) : (baseX / CellSize + (int) XCellObject));

      int YLoopStartObject = (int) ((int) (baseY / CellSize) < baseY / CellSize + (int) YCellObject ? (int) (baseY / CellSize) : baseY / CellSize + (int) YCellObject);
      int YLoopEnObject = (int) ((int) (baseY / CellSize) > baseY / CellSize + (int) YCellObject ? (int) (baseY / CellSize) : baseY / CellSize + (int) YCellObject);

      int ZLoopStartObject = (int) ((int) (baseZ / 150) < baseZ / 150 + (int) ZCellObject ? (int) (baseZ / 150) : baseZ / 150 + (int) ZCellObject);
      int ZLoopEndObject = (int) ((int) (baseZ / 150) > baseZ / 150 + (int) ZCellObject ? (int) (baseZ / 150) : baseZ / 150 + (int) ZCellObject);

      for (int i = XLoopStartMargin; i < XLoopEndMargin; i++)
      {
        for (int j = YLoopStartMargin; j < YLoopEnMargin; j++)
        {
          for (int k = ZLoopStartMargin; k < ZLoopEndMargin; k++)
          {
            emptyFullArray[i, j, k] = 2; // 2 represents margin
          }
        }
      }
      //Place Object, object is smaller than margin
      for (int i = XLoopStartObject; i < XLoopEndObject; i++)
      {
        for (int j = YLoopStartObject; j < YLoopEnObject; j++)
        {
          for (int k = ZLoopStartObject; k < ZLoopEndObject; k++)
          {
            emptyFullArray[i, j, k] = 1; // 1 represents object
          }
        }
      }

      Point3d pointa = new Point3d(baseX, baseY, baseZ);
      Vector3d pointb = new Vector3d(0, 0, 1);

      Plane planebase = new Plane(pointa, pointb);

      Interval xInterval = new Interval(0, this.VectorObject.X);
      Interval yInterval = new Interval(0, this.VectorObject.Y);
      Interval zInterval = new Interval(0, this.VectorObject.Z);

      ObjBox = new Box(planebase, xInterval, yInterval, zInterval);

      xInterval = new Interval(0, this.VectorMargin.X);
      yInterval = new Interval(0, this.VectorMargin.Y);
      zInterval = new Interval(0, this.VectorMargin.Z);

      marginBox = new Box(planebase, xInterval, yInterval, zInterval);

    }

    public bool CheckBack(int[,,] emptyFullArray, int[,,] areaArray)

    {
      bool inLimits = true;
      bool emptyBool = true;
      bool sameZone = true;

      bool suitableDirection = true;

      /**/
      this.XCellMargin = (this.VectorMargin.X < 0 ? -1 : 1) * Math.Ceiling((double) Math.Abs(this.VectorMargin.X / CellSize));
      this.YCellMargin = (this.VectorMargin.Y < 0 ? -1 : 1) * Math.Ceiling((double) Math.Abs(this.VectorMargin.Y / CellSize));
      this.ZCellMargin = (this.VectorMargin.Z < 0 ? -1 : 1) * Math.Ceiling((double) Math.Abs(this.VectorMargin.Z / 150));

      this.XCellObject = (this.VectorObject.X < 0 ? -1 : 1) * Math.Ceiling((double) Math.Abs(this.VectorObject.X / CellSize));
      this.YCellObject = (this.VectorObject.Y < 0 ? -1 : 1) * Math.Ceiling((double) Math.Abs(this.VectorObject.Y / CellSize));
      this.ZCellObject = (this.VectorObject.Z < 0 ? -1 : 1) * Math.Ceiling((double) Math.Abs(this.VectorObject.Z / 150));

      if (VectorMargin.X * VectorMargin.Y > 0)
      {
        this.baseX = PreviousObject.baseX;
        this.baseY = PreviousObject.baseY;
        this.baseZ = PreviousObject.baseZ;
      }

      else if (VectorMargin.X * VectorMargin.Y < 0)
      {
        this.baseX = PreviousObject.baseX;
        this.baseY = PreviousObject.baseY;
        this.baseZ = PreviousObject.baseZ;
      }

      Point3d pointa = new Point3d(0, 0, 0);
      Vector3d pointb = new Vector3d(0, 0, 1);
      Plane planee = new Plane(pointa, pointb);

      Vector3d vecX1 = new Vector3d(1, 0, 0);

      BaseVector = new Vector3d(baseX, baseY, baseZ);

      if (PreviousObject.VectorMargin.X > 0 && PreviousObject.VectorMargin.Y > 0 && VectorObject.Y < 0 || //++
        PreviousObject.VectorMargin.X < 0 && PreviousObject.VectorMargin.Y < 0 && VectorMargin.Y > 0 || //--
        PreviousObject.VectorMargin.X < 0 && PreviousObject.VectorMargin.Y > 0 && VectorMargin.X > 0 || //-+
        PreviousObject.VectorMargin.X > 0 && PreviousObject.VectorMargin.Y < 0 && VectorMargin.X < 0    //+-
        )
      {
        suitableDirection = true;
      }

      if (!((baseX + this.VectorMargin.X < 300) && (baseY + this.VectorMargin.Y < 600) && (baseZ + this.VectorObject.Z < 300) &&
        (baseX + this.VectorMargin.X > 0) && (baseY + this.VectorMargin.Y > 0) && (baseZ + this.VectorObject.Z > 0)))
      {
        inLimits = false;
      }


      int XLoopStartMargin = (int) ((int) (baseX / CellSize) < (baseX / CellSize + (int) XCellMargin) ? (int) (baseX / CellSize) : (baseX / CellSize + (int) XCellMargin));
      int XLoopEndMargin = (int) ((int) (baseX / CellSize) > (baseX / CellSize + (int) XCellMargin) ? (int) (baseX / CellSize) : (baseX / CellSize + (int) XCellMargin));

      int YLoopStartMargin = (int) ((int) (baseY / CellSize) < baseY / CellSize + (int) YCellMargin ? (int) (baseY / CellSize) : baseY / CellSize + (int) YCellMargin);
      int YLoopEnMargin = (int) ((int) (baseY / CellSize) > baseY / CellSize + (int) YCellMargin ? (int) (baseY / CellSize) : baseY / CellSize + (int) YCellMargin);

      int ZLoopStartMargin = (int) ((int) (baseZ / 150) < baseZ / 150 + (int) ZCellMargin ? (int) (baseZ / 150) : baseZ / 150 + (int) ZCellMargin);
      int ZLoopEndMargin = (int) ((int) (baseZ / 150) > baseZ / 150 + (int) ZCellMargin ? (int) (baseZ / 150) : baseZ / 150 + (int) ZCellMargin);

      /***/
      int XLoopStartObject = (int) ((int) (baseX / CellSize) < (baseX / CellSize + (int) XCellObject) ? (int) (baseX / CellSize) : (baseX / CellSize + (int) XCellObject));
      int XLoopEndObject = (int) ((int) (baseX / CellSize) > (baseX / CellSize + (int) XCellObject) ? (int) (baseX / CellSize) : (baseX / CellSize + (int) XCellObject));

      int YLoopStartObject = (int) ((int) (baseY / CellSize) < baseY / CellSize + (int) YCellObject ? (int) (baseY / CellSize) : baseY / CellSize + (int) YCellObject);
      int YLoopEnObject = (int) ((int) (baseY / CellSize) > baseY / CellSize + (int) YCellObject ? (int) (baseY / CellSize) : baseY / CellSize + (int) YCellObject);

      int ZLoopStartObject = (int) ((int) (baseZ / 150) < baseZ / 150 + (int) ZCellObject ? (int) (baseZ / 150) : baseZ / 150 + (int) ZCellObject);
      int ZLoopEndObject = (int) ((int) (baseZ / 150) > baseZ / 150 + (int) ZCellObject ? (int) (baseZ / 150) : baseZ / 150 + (int) ZCellObject);

      if (!((baseX + VectorMargin.X < 360) && (baseY + VectorMargin.Y < 600) && (baseZ + VectorMargin.Z < 300) &&
        (baseX + VectorMargin.X > 0) && (baseY + VectorMargin.Y > 0) && (baseZ + VectorMargin.Z > 0)))
      {
        inLimits = false;
      }

      if (inLimits && suitableDirection)
      {

        for (int i = XLoopStartMargin; i < XLoopEndMargin; i++)
        {
          for (int j = YLoopStartMargin; j < YLoopEnMargin; j++)
          {
            for (int k = ZLoopStartMargin; k < ZLoopEndMargin; k++)
            {
              //checks if the cell is empty (We dont want to see an object in a cell! )
              if (((emptyFullArray[i, j, k] == 1) || (emptyFullArray[i, j, k] == 2)))
              {
                emptyBool = false;
              }

              // 2nd Loop checks if the zone is the same or empty zone // Actually margin can ovewflow to other zones
              /*
              if (!(areaArray[i, j, k] != this.ZoneName || areaArray[i, j, k] != 0))
              {
              sameZone = false;
              }
              */
            }
          }
        }
        // 2nd Loop checks if the zone is the same or empty zone
        for (int i = XLoopStartObject; i < XLoopEndObject; i++)
        {
          for (int j = YLoopStartObject; j < YLoopEnObject; j++)
          {
            for (int k = ZLoopStartObject; k < ZLoopEndObject; k++)
            {
              //checks if the cell is empty (We dont want to see margin or object in the cell )
              if (((emptyFullArray[i, j, k] == 1) || (emptyFullArray[i, j, k] == 2)))
              {
                emptyBool = false;
              }

              // 2nd Loop checks if the zone is the same or empty zone
              if (!(areaArray[i, j, k] == this.ZoneName || areaArray[i, j, k] == 0))
              {
                sameZone = false;
              }
            }
          }
        }

        if (emptyBool && sameZone)
        {
          suitableDirection = true;
          Rhino.RhinoApp.WriteLine("Place Back:  Conditions are  satisfied ********************************************");
        }
        else
        {
          Rhino.RhinoApp.WriteLine("Place Back:  Conditions are not satisfied ");
          suitableDirection = false;
        }
      }
      else
      {
        Rhino.RhinoApp.WriteLine("Place Back:  Conditions are not satisfied ");
        suitableDirection = false;
      }
      return suitableDirection;
    }

    public void PlaceBack(int[,,] emptyFullArray, out Box ObjBox, out Box marginBox)
    {
      int XLoopStartMargin = (int) ((int) (baseX / CellSize) < (baseX / CellSize + (int) XCellMargin) ? (int) (baseX / CellSize) : (baseX / CellSize + (int) XCellMargin));
      int XLoopEndMargin = (int) ((int) (baseX / CellSize) > (baseX / CellSize + (int) XCellMargin) ? (int) (baseX / CellSize) : (baseX / CellSize + (int) XCellMargin));

      int YLoopStartMargin = (int) ((int) (baseY / CellSize) < baseY / CellSize + (int) YCellMargin ? (int) (baseY / CellSize) : baseY / CellSize + (int) YCellMargin);
      int YLoopEnMargin = (int) ((int) (baseY / CellSize) > baseY / CellSize + (int) YCellMargin ? (int) (baseY / CellSize) : baseY / CellSize + (int) YCellMargin);

      int ZLoopStartMargin = (int) ((int) (baseZ / 150) < baseZ / 150 + (int) ZCellMargin ? (int) (baseZ / 150) : baseZ / 150 + (int) ZCellMargin);
      int ZLoopEndMargin = (int) ((int) (baseZ / 150) > baseZ / 150 + (int) ZCellMargin ? (int) (baseZ / 150) : baseZ / 150 + (int) ZCellMargin);


      int XLoopStartObject = (int) ((int) (baseX / CellSize) < (baseX / CellSize + (int) XCellObject) ? (int) (baseX / CellSize) : (baseX / CellSize + (int) XCellObject));
      int XLoopEndObject = (int) ((int) (baseX / CellSize) > (baseX / CellSize + (int) XCellObject) ? (int) (baseX / CellSize) : (baseX / CellSize + (int) XCellObject));

      int YLoopStartObject = (int) ((int) (baseY / CellSize) < baseY / CellSize + (int) YCellObject ? (int) (baseY / CellSize) : baseY / CellSize + (int) YCellObject);
      int YLoopEnObject = (int) ((int) (baseY / CellSize) > baseY / CellSize + (int) YCellObject ? (int) (baseY / CellSize) : baseY / CellSize + (int) YCellObject);

      int ZLoopStartObject = (int) ((int) (baseZ / 150) < baseZ / 150 + (int) ZCellObject ? (int) (baseZ / 150) : baseZ / 150 + (int) ZCellObject);
      int ZLoopEndObject = (int) ((int) (baseZ / 150) > baseZ / 150 + (int) ZCellObject ? (int) (baseZ / 150) : baseZ / 150 + (int) ZCellObject);

      for (int i = XLoopStartMargin; i < XLoopEndMargin; i++)
      {
        for (int j = YLoopStartMargin; j < YLoopEnMargin; j++)
        {
          for (int k = ZLoopStartMargin; k < ZLoopEndMargin; k++)
          {
            emptyFullArray[i, j, k] = 2; // 2 represents margin
          }
        }
      }
      //Place Object, object is smaller than margin
      for (int i = XLoopStartObject; i < XLoopEndObject; i++)
      {
        for (int j = YLoopStartObject; j < YLoopEnObject; j++)
        {
          for (int k = ZLoopStartObject; k < ZLoopEndObject; k++)
          {
            emptyFullArray[i, j, k] = 1; // 1 represents object
          }
        }
      }

      Point3d pointa = new Point3d(baseX, baseY, baseZ);
      Vector3d pointb = new Vector3d(0, 0, 1);

      Plane planebase = new Plane(pointa, pointb);

      Interval xInterval = new Interval(0, this.VectorObject.X);
      Interval yInterval = new Interval(0, this.VectorObject.Y);
      Interval zInterval = new Interval(0, this.VectorObject.Z);

      ObjBox = new Box(planebase, xInterval, yInterval, zInterval);

      xInterval = new Interval(0, this.VectorMargin.X);
      yInterval = new Interval(0, this.VectorMargin.Y);
      zInterval = new Interval(0, this.VectorMargin.Z);

      marginBox = new Box(planebase, xInterval, yInterval, zInterval);
    }

    public bool CheckLeft(int[,,] emptyFullArray, int[,,] areaArray)
    {
      bool inLimits = true;
      bool emptyBool = true;
      bool sameZone = true;
      bool suitableDirection = true;

      /**/
      this.XCellMargin = (this.VectorMargin.X < 0 ? -1 : 1) * Math.Ceiling((double) Math.Abs(this.VectorMargin.X / CellSize));
      this.YCellMargin = (this.VectorMargin.Y < 0 ? -1 : 1) * Math.Ceiling((double) Math.Abs(this.VectorMargin.Y / CellSize));
      this.ZCellMargin = (this.VectorMargin.Z < 0 ? -1 : 1) * Math.Ceiling((double) Math.Abs(this.VectorMargin.Z / 150));

      this.XCellObject = (this.VectorObject.X < 0 ? -1 : 1) * Math.Ceiling((double) Math.Abs(this.VectorObject.X / CellSize));
      this.YCellObject = (this.VectorObject.Y < 0 ? -1 : 1) * Math.Ceiling((double) Math.Abs(this.VectorObject.Y / CellSize));
      this.ZCellObject = (this.VectorObject.Z < 0 ? -1 : 1) * Math.Ceiling((double) Math.Abs(this.VectorObject.Z / 150));

      if (VectorMargin.X * VectorMargin.Y > 0)
      {
        this.baseX = PreviousObject.baseX;
        this.baseY = PreviousObject.baseY;
        this.baseZ = PreviousObject.baseZ;
      }

      else if (VectorMargin.X * VectorMargin.Y < 0)
      {
        this.baseX = PreviousObject.baseX;
        this.baseY = PreviousObject.baseY;
        this.baseZ = PreviousObject.baseZ;
      }

      Point3d pointa = new Point3d(0, 0, 0);
      Vector3d pointb = new Vector3d(0, 0, 1);
      Plane planee = new Plane(pointa, pointb);

      Vector3d vecX1 = new Vector3d(1, 0, 0);

      BaseVector = new Vector3d(baseX, baseY, baseZ);

      if (PreviousObject.VectorMargin.X > 0 && PreviousObject.VectorMargin.Y > 0 && VectorObject.X < 0 ||
        PreviousObject.VectorMargin.X < 0 && PreviousObject.VectorMargin.Y < 0 && VectorMargin.X > 0 ||
        PreviousObject.VectorMargin.X < 0 && PreviousObject.VectorMargin.Y > 0 && VectorMargin.Y < 0 ||
        PreviousObject.VectorMargin.X > 0 && PreviousObject.VectorMargin.Y < 0 && VectorMargin.Y > 0
        )
      {
        suitableDirection = true;
      }


      if (!((baseX + this.VectorMargin.X < 360) && (baseY + this.VectorMargin.Y < 600) && (baseZ + this.VectorMargin.Z < 300) &&
        (baseX + this.VectorMargin.X > 0) && (baseY + this.VectorMargin.Y > 0) && (baseZ + this.VectorMargin.Z > 0)))
      {
        Rhino.RhinoApp.WriteLine("CAN NOT PLACE TO LEFT NOT IN LIMITS!******************************* ");
        inLimits = false;
      }


      int XLoopStartMargin = (int) ((int) (baseX / CellSize) < (baseX / CellSize + (int) XCellMargin) ? (int) (baseX / CellSize) : (baseX / CellSize + (int) XCellMargin));
      int XLoopEndMargin = (int) ((int) (baseX / CellSize) > (baseX / CellSize + (int) XCellMargin) ? (int) (baseX / CellSize) : (baseX / CellSize + (int) XCellMargin));

      int YLoopStartMargin = (int) ((int) (baseY / CellSize) < baseY / CellSize + (int) YCellMargin ? (int) (baseY / CellSize) : baseY / CellSize + (int) YCellMargin);
      int YLoopEnMargin = (int) ((int) (baseY / CellSize) > baseY / CellSize + (int) YCellMargin ? (int) (baseY / CellSize) : baseY / CellSize + (int) YCellMargin);

      int ZLoopStartMargin = (int) ((int) (baseZ / 150) < baseZ / 150 + (int) ZCellMargin ? (int) (baseZ / 150) : baseZ / 150 + (int) ZCellMargin);
      int ZLoopEndMargin = (int) ((int) (baseZ / 150) > baseZ / 150 + (int) ZCellMargin ? (int) (baseZ / 150) : baseZ / 150 + (int) ZCellMargin);

      /***/
      int XLoopStartObject = (int) ((int) (baseX / CellSize) < (baseX / CellSize + (int) XCellObject) ? (int) (baseX / CellSize) : (baseX / CellSize + (int) XCellObject));
      int XLoopEndObject = (int) ((int) (baseX / CellSize) > (baseX / CellSize + (int) XCellObject) ? (int) (baseX / CellSize) : (baseX / CellSize + (int) XCellObject));

      int YLoopStartObject = (int) ((int) (baseY / CellSize) < baseY / CellSize + (int) YCellObject ? (int) (baseY / CellSize) : baseY / CellSize + (int) YCellObject);
      int YLoopEnObject = (int) ((int) (baseY / CellSize) > baseY / CellSize + (int) YCellObject ? (int) (baseY / CellSize) : baseY / CellSize + (int) YCellObject);

      int ZLoopStartObject = (int) ((int) (baseZ / 150) < baseZ / 150 + (int) ZCellObject ? (int) (baseZ / 150) : baseZ / 150 + (int) ZCellObject);
      int ZLoopEndObject = (int) ((int) (baseZ / 150) > baseZ / 150 + (int) ZCellObject ? (int) (baseZ / 150) : baseZ / 150 + (int) ZCellObject);

      if (!((baseX + VectorMargin.X < 360) && (baseY + VectorMargin.Y < 600) && (baseZ + VectorMargin.Z < 300) &&
        (baseX + VectorMargin.X > 0) && (baseY + VectorMargin.Y > 0) && (baseZ + VectorMargin.Z > 0)))
      {
        inLimits = false;
      }

      if (inLimits && suitableDirection)
      {

        for (int i = XLoopStartMargin; i < XLoopEndMargin; i++)
        {
          for (int j = YLoopStartMargin; j < YLoopEnMargin; j++)
          {
            for (int k = ZLoopStartMargin; k < ZLoopEndMargin; k++)
            {
              //checks if the cell is empty (We dont want to see an object in a cell! )
              if (((emptyFullArray[i, j, k] == 1) || (emptyFullArray[i, j, k] == 2)))
              {
                emptyBool = false;
              }

              // 2nd Loop checks if the zone is the same or empty zone // Actually margin can ovewflow to other zones
              /*
              if (!(areaArray[i, j, k] != this.ZoneName || areaArray[i, j, k] != 0))
              {
              sameZone = false;
              }
              */
            }
          }
        }
        // 2nd Loop checks if the zone is the same or empty zone
        for (int i = XLoopStartObject; i < XLoopEndObject; i++)
        {
          for (int j = YLoopStartObject; j < YLoopEnObject; j++)
          {
            for (int k = ZLoopStartObject; k < ZLoopEndObject; k++)
            {
              //checks if the cell is empty (We dont want to see margin or object in the cell )
              if (((emptyFullArray[i, j, k] == 1) || (emptyFullArray[i, j, k] == 2)))
              {
                emptyBool = false;
              }

              // 2nd Loop checks if the zone is the same or empty zone
              if (!(areaArray[i, j, k] == this.ZoneName || areaArray[i, j, k] == 0))
              {
                sameZone = false;
              }
            }
          }
        }

        if (emptyBool && sameZone)
        {
          suitableDirection = true;
          Rhino.RhinoApp.WriteLine("Place Left:  Conditions are  satisfied ");
        }
        else
        {
          Rhino.RhinoApp.WriteLine("Place Left:  Conditions are not satisfied ");
          suitableDirection = false;
        }
      }
      else
      {
        Rhino.RhinoApp.WriteLine("Place Left:  Conditions are not satisfied ");
        suitableDirection = false;
      }
      return suitableDirection;
    }

    public void PlaceLeft(int[,,] emptyFullArray, out Box ObjBox, out Box marginBox)
    {
      int XLoopStartMargin = (int) ((int) (baseX / CellSize) < (baseX / CellSize + (int) XCellMargin) ? (int) (baseX / CellSize) : (baseX / CellSize + (int) XCellMargin));
      int XLoopEndMargin = (int) ((int) (baseX / CellSize) > (baseX / CellSize + (int) XCellMargin) ? (int) (baseX / CellSize) : (baseX / CellSize + (int) XCellMargin));

      int YLoopStartMargin = (int) ((int) (baseY / CellSize) < baseY / CellSize + (int) YCellMargin ? (int) (baseY / CellSize) : baseY / CellSize + (int) YCellMargin);
      int YLoopEnMargin = (int) ((int) (baseY / CellSize) > baseY / CellSize + (int) YCellMargin ? (int) (baseY / CellSize) : baseY / CellSize + (int) YCellMargin);

      int ZLoopStartMargin = (int) ((int) (baseZ / 150) < baseZ / 150 + (int) ZCellMargin ? (int) (baseZ / 150) : baseZ / 150 + (int) ZCellMargin);
      int ZLoopEndMargin = (int) ((int) (baseZ / 150) > baseZ / 150 + (int) ZCellMargin ? (int) (baseZ / 150) : baseZ / 150 + (int) ZCellMargin);


      int XLoopStartObject = (int) ((int) (baseX / CellSize) < (baseX / CellSize + (int) XCellObject) ? (int) (baseX / CellSize) : (baseX / CellSize + (int) XCellObject));
      int XLoopEndObject = (int) ((int) (baseX / CellSize) > (baseX / CellSize + (int) XCellObject) ? (int) (baseX / CellSize) : (baseX / CellSize + (int) XCellObject));

      int YLoopStartObject = (int) ((int) (baseY / CellSize) < baseY / CellSize + (int) YCellObject ? (int) (baseY / CellSize) : baseY / CellSize + (int) YCellObject);
      int YLoopEnObject = (int) ((int) (baseY / CellSize) > baseY / CellSize + (int) YCellObject ? (int) (baseY / CellSize) : baseY / CellSize + (int) YCellObject);

      int ZLoopStartObject = (int) ((int) (baseZ / 150) < baseZ / 150 + (int) ZCellObject ? (int) (baseZ / 150) : baseZ / 150 + (int) ZCellObject);
      int ZLoopEndObject = (int) ((int) (baseZ / 150) > baseZ / 150 + (int) ZCellObject ? (int) (baseZ / 150) : baseZ / 150 + (int) ZCellObject);

      for (int i = XLoopStartMargin; i < XLoopEndMargin; i++)
      {
        for (int j = YLoopStartMargin; j < YLoopEnMargin; j++)
        {
          for (int k = ZLoopStartMargin; k < ZLoopEndMargin; k++)
          {
            emptyFullArray[i, j, k] = 2; // 2 represents margin
          }
        }
      }
      //Place Object, object is smaller than margin
      for (int i = XLoopStartObject; i < XLoopEndObject; i++)
      {
        for (int j = YLoopStartObject; j < YLoopEnObject; j++)
        {
          for (int k = ZLoopStartObject; k < ZLoopEndObject; k++)
          {
            emptyFullArray[i, j, k] = 1; // 1 represents object
          }
        }
      }

      Point3d pointa = new Point3d(baseX, baseY, baseZ);
      Vector3d pointb = new Vector3d(0, 0, 1);

      Plane planebase = new Plane(pointa, pointb);

      Interval xInterval = new Interval(0, this.VectorObject.X);
      Interval yInterval = new Interval(0, this.VectorObject.Y);
      Interval zInterval = new Interval(0, this.VectorObject.Z);

      ObjBox = new Box(planebase, xInterval, yInterval, zInterval);

      xInterval = new Interval(0, this.VectorMargin.X);
      yInterval = new Interval(0, this.VectorMargin.Y);
      zInterval = new Interval(0, this.VectorMargin.Z);

      marginBox = new Box(planebase, xInterval, yInterval, zInterval);
    }

    public bool CheckTop(int[,,] emptyFullArray, int[,,] areaArray)
    {
      bool inLimits = true;
      bool emptyBool = true;
      bool sameZone = true;

      bool suitableDirection = true;

      /**/
      this.XCellMargin = (this.VectorMargin.X < 0 ? -1 : 1) * Math.Ceiling((double) Math.Abs(this.VectorMargin.X / CellSize));
      this.YCellMargin = (this.VectorMargin.Y < 0 ? -1 : 1) * Math.Ceiling((double) Math.Abs(this.VectorMargin.Y / CellSize));
      this.ZCellMargin = (this.VectorMargin.Z < 0 ? -1 : 1) * Math.Ceiling((double) Math.Abs(this.VectorMargin.Z / 150));

      this.XCellObject = (this.VectorObject.X < 0 ? -1 : 1) * Math.Ceiling((double) Math.Abs(this.VectorObject.X / CellSize));
      this.YCellObject = (this.VectorObject.Y < 0 ? -1 : 1) * Math.Ceiling((double) Math.Abs(this.VectorObject.Y / CellSize));
      this.ZCellObject = (this.VectorObject.Z < 0 ? -1 : 1) * Math.Ceiling((double) Math.Abs(this.VectorObject.Z / 150));

      if (VectorMargin.X * VectorMargin.Y > 0)
      {
        this.baseX = PreviousObject.baseX;
        this.baseY = PreviousObject.baseY;
        this.baseZ = PreviousObject.baseZ + PreviousObject.ZCellMargin; ;
      }

      else if (VectorMargin.X * VectorMargin.Y < 0)
      {
        this.baseX = PreviousObject.baseX;
        this.baseY = PreviousObject.baseY;
        this.baseZ = PreviousObject.baseZ + PreviousObject.ZCellMargin * this.CellSize;
      }

      Point3d pointa = new Point3d(0, 0, 0);
      Vector3d pointb = new Vector3d(0, 0, 1);
      Plane planee = new Plane(pointa, pointb);

      Vector3d vecX1 = new Vector3d(1, 0, 0);

      BaseVector = new Vector3d(baseX, baseY, baseZ);

      if (VectorObject.Z > 0) //++
      {
        suitableDirection = true;
      }

      if (!((baseX + this.VectorMargin.X < 360) && (baseY + this.VectorMargin.Y < 600) && (baseZ + this.VectorMargin.Z < 300) &&
        (baseX + this.VectorMargin.X > 0) && (baseY + this.VectorMargin.Y > 0) && (baseZ + this.VectorMargin.Z > 0)))
      {
        inLimits = false;
      }


      int XLoopStartMargin = (int) ((int) (baseX / CellSize) < (baseX / CellSize + (int) XCellMargin) ? (int) (baseX / CellSize) : (baseX / CellSize + (int) XCellMargin));
      int XLoopEndMargin = (int) ((int) (baseX / CellSize) > (baseX / CellSize + (int) XCellMargin) ? (int) (baseX / CellSize) : (baseX / CellSize + (int) XCellMargin));

      int YLoopStartMargin = (int) ((int) (baseY / CellSize) < baseY / CellSize + (int) YCellMargin ? (int) (baseY / CellSize) : baseY / CellSize + (int) YCellMargin);
      int YLoopEnMargin = (int) ((int) (baseY / CellSize) > baseY / CellSize + (int) YCellMargin ? (int) (baseY / CellSize) : baseY / CellSize + (int) YCellMargin);

      int ZLoopStartMargin = (int) ((int) (baseZ / 150) < baseZ / 150 + (int) ZCellMargin ? (int) (baseZ / 150) : baseZ / 150 + (int) ZCellMargin);
      int ZLoopEndMargin = (int) ((int) (baseZ / 150) > baseZ / 150 + (int) ZCellMargin ? (int) (baseZ / 150) : baseZ / 150 + (int) ZCellMargin);

      /***/
      int XLoopStartObject = (int) ((int) (baseX / CellSize) < (baseX / CellSize + (int) XCellObject) ? (int) (baseX / CellSize) : (baseX / CellSize + (int) XCellObject));
      int XLoopEndObject = (int) ((int) (baseX / CellSize) > (baseX / CellSize + (int) XCellObject) ? (int) (baseX / CellSize) : (baseX / CellSize + (int) XCellObject));

      int YLoopStartObject = (int) ((int) (baseY / CellSize) < baseY / CellSize + (int) YCellObject ? (int) (baseY / CellSize) : baseY / CellSize + (int) YCellObject);
      int YLoopEnObject = (int) ((int) (baseY / CellSize) > baseY / CellSize + (int) YCellObject ? (int) (baseY / CellSize) : baseY / CellSize + (int) YCellObject);

      int ZLoopStartObject = (int) ((int) (baseZ / 150) < baseZ / 150 + (int) ZCellObject ? (int) (baseZ / 150) : baseZ / 150 + (int) ZCellObject);
      int ZLoopEndObject = (int) ((int) (baseZ / 150) > baseZ / 150 + (int) ZCellObject ? (int) (baseZ / 150) : baseZ / 150 + (int) ZCellObject);

      if (!((baseX + VectorMargin.X < 360) && (baseY + VectorMargin.Y < 600) && (baseZ + VectorMargin.Z < 300) &&
        (baseX + VectorMargin.X > 0) && (baseY + VectorMargin.Y > 0) && (baseZ + VectorMargin.Z > 0)))
      {
        inLimits = false;
      }

      if (inLimits && suitableDirection)
      {

        for (int i = XLoopStartMargin; i < XLoopEndMargin; i++)
        {
          for (int j = YLoopStartMargin; j < YLoopEnMargin; j++)
          {
            for (int k = ZLoopStartMargin; k < ZLoopEndMargin; k++)
            {
              //checks if the cell is empty (We dont want to see an object in a cell! )
              if (((emptyFullArray[i, j, k] == 1) || (emptyFullArray[i, j, k] == 2)))
              {
                emptyBool = false;
              }

              // 2nd Loop checks if the zone is the same or empty zone // Actually margin can ovewflow to other zones
              /*
              if (!(areaArray[i, j, k] != this.ZoneName || areaArray[i, j, k] != 0))
              {
              sameZone = false;
              }
              */
            }
          }
        }
        // 2nd Loop checks if the zone is the same or empty zone
        for (int i = XLoopStartObject; i < XLoopEndObject; i++)
        {
          for (int j = YLoopStartObject; j < YLoopEnObject; j++)
          {
            for (int k = ZLoopStartObject; k < ZLoopEndObject; k++)
            {
              //checks if the cell is empty (We dont want to see margin or object in the cell )
              if (((emptyFullArray[i, j, k] == 1) || (emptyFullArray[i, j, k] == 2)))
              {
                emptyBool = false;
              }

              // 2nd Loop checks if the zone is the same or empty zone
              if (!(areaArray[i, j, k] == this.ZoneName || areaArray[i, j, k] == 0))
              {
                sameZone = false;
              }
            }
          }
        }

        if (emptyBool && sameZone)
        {
          suitableDirection = true;
          Rhino.RhinoApp.WriteLine("Place Top:  Conditions are  satisfied ");
        }
        else
        {
          Rhino.RhinoApp.WriteLine("Place Top:  Conditions are not satisfied ");
          suitableDirection = false;
        }
      }
      else
      {
        Rhino.RhinoApp.WriteLine("Place Top:  Conditions are not satisfied ");
        suitableDirection = false;
      }
      return suitableDirection;
    }

    public void PlaceTop(int[,,] emptyFullArray, out Box ObjBox, out Box marginBox)
    {

      int XLoopStartMargin = (int) ((int) (baseX / CellSize) < (baseX / CellSize + (int) XCellMargin) ? (int) (baseX / CellSize) : (baseX / CellSize + (int) XCellMargin));
      int XLoopEndMargin = (int) ((int) (baseX / CellSize) > (baseX / CellSize + (int) XCellMargin) ? (int) (baseX / CellSize) : (baseX / CellSize + (int) XCellMargin));

      int YLoopStartMargin = (int) ((int) (baseY / CellSize) < baseY / CellSize + (int) YCellMargin ? (int) (baseY / CellSize) : baseY / CellSize + (int) YCellMargin);
      int YLoopEnMargin = (int) ((int) (baseY / CellSize) > baseY / CellSize + (int) YCellMargin ? (int) (baseY / CellSize) : baseY / CellSize + (int) YCellMargin);

      int ZLoopStartMargin = (int) ((int) (baseZ / 150) < baseZ / 150 + (int) ZCellMargin ? (int) (baseZ / 150) : baseZ / 150 + (int) ZCellMargin);
      int ZLoopEndMargin = (int) ((int) (baseZ / 150) > baseZ / 150 + (int) ZCellMargin ? (int) (baseZ / 150) : baseZ / 150 + (int) ZCellMargin);


      int XLoopStartObject = (int) ((int) (baseX / CellSize) < (baseX / CellSize + (int) XCellObject) ? (int) (baseX / CellSize) : (baseX / CellSize + (int) XCellObject));
      int XLoopEndObject = (int) ((int) (baseX / CellSize) > (baseX / CellSize + (int) XCellObject) ? (int) (baseX / CellSize) : (baseX / CellSize + (int) XCellObject));

      int YLoopStartObject = (int) ((int) (baseY / CellSize) < baseY / CellSize + (int) YCellObject ? (int) (baseY / CellSize) : baseY / CellSize + (int) YCellObject);
      int YLoopEnObject = (int) ((int) (baseY / CellSize) > baseY / CellSize + (int) YCellObject ? (int) (baseY / CellSize) : baseY / CellSize + (int) YCellObject);

      int ZLoopStartObject = (int) ((int) (baseZ / 150) < baseZ / 150 + (int) ZCellObject ? (int) (baseZ / 150) : baseZ / 150 + (int) ZCellObject);
      int ZLoopEndObject = (int) ((int) (baseZ / 150) > baseZ / 150 + (int) ZCellObject ? (int) (baseZ / 150) : baseZ / 150 + (int) ZCellObject);

      for (int i = XLoopStartMargin; i < XLoopEndMargin; i++)
      {
        for (int j = YLoopStartMargin; j < YLoopEnMargin; j++)
        {
          for (int k = ZLoopStartMargin; k < ZLoopEndMargin; k++)
          {
            emptyFullArray[i, j, k] = 2; // 2 represents margin
          }
        }
      }
      //Place Object, object is smaller than margin
      for (int i = XLoopStartObject; i < XLoopEndObject; i++)
      {
        for (int j = YLoopStartObject; j < YLoopEnObject; j++)
        {
          for (int k = ZLoopStartObject; k < ZLoopEndObject; k++)
          {
            emptyFullArray[i, j, k] = 1; // 1 represents object
          }
        }
      }

      Point3d pointa = new Point3d(baseX, baseY, baseZ);
      Vector3d pointb = new Vector3d(0, 0, 1);

      Plane planebase = new Plane(pointa, pointb);

      Interval xInterval = new Interval(0, this.VectorObject.X);
      Interval yInterval = new Interval(0, this.VectorObject.Y);
      Interval zInterval = new Interval(0, this.VectorObject.Z);

      ObjBox = new Box(planebase, xInterval, yInterval, zInterval);

      xInterval = new Interval(0, this.VectorMargin.X);
      yInterval = new Interval(0, this.VectorMargin.Y);
      zInterval = new Interval(0, this.VectorMargin.Z);

      marginBox = new Box(planebase, xInterval, yInterval, zInterval);
    }

    public bool CheckBottom(int[,,] emptyFullArray, int[,,] areaArray)
    {
      bool inLimits = true;
      bool emptyBool = true;
      bool sameZone = true;

      bool suitableDirection = true;

      /**/
      this.XCellMargin = (this.VectorMargin.X < 0 ? -1 : 1) * Math.Ceiling((double) Math.Abs(this.VectorMargin.X / CellSize));
      this.YCellMargin = (this.VectorMargin.Y < 0 ? -1 : 1) * Math.Ceiling((double) Math.Abs(this.VectorMargin.Y / CellSize));
      this.ZCellMargin = (this.VectorMargin.Z < 0 ? -1 : 1) * Math.Ceiling((double) Math.Abs(this.VectorMargin.Z / 150));

      this.XCellObject = (this.VectorObject.X < 0 ? -1 : 1) * Math.Ceiling((double) Math.Abs(this.VectorObject.X / CellSize));
      this.YCellObject = (this.VectorObject.Y < 0 ? -1 : 1) * Math.Ceiling((double) Math.Abs(this.VectorObject.Y / CellSize));
      this.ZCellObject = (this.VectorObject.Z < 0 ? -1 : 1) * Math.Ceiling((double) Math.Abs(this.VectorObject.Z / 150));

      if (VectorMargin.X * VectorMargin.Y > 0)
      {
        this.baseX = PreviousObject.baseX;
        this.baseY = PreviousObject.baseY;
        this.baseZ = PreviousObject.baseZ;
      }

      else if (VectorMargin.X * VectorMargin.Y < 0)
      {
        this.baseX = PreviousObject.baseX;
        this.baseY = PreviousObject.baseY;
        this.baseZ = PreviousObject.baseZ;
      }

      Point3d pointa = new Point3d(0, 0, 0);
      Vector3d pointb = new Vector3d(0, 0, 1);
      Plane planee = new Plane(pointa, pointb);

      Vector3d vecX1 = new Vector3d(1, 0, 0);

      BaseVector = new Vector3d(baseX, baseY, baseZ);


      if (VectorObject.Z < 0) //++
      {
        suitableDirection = true;
      }

      if (!((baseX + this.ObjWidth < 360) && (baseY + this.ObjLength < 600) && (baseZ + this.ObjHeight < 300) &&
        (baseX + this.ObjWidth > 0) && (baseY + this.ObjLength > 0) && (baseZ + this.ObjHeight > 0)))
      {
        inLimits = false;
      }


      int XLoopStartMargin = (int) ((int) (baseX / CellSize) < (baseX / CellSize + (int) XCellMargin) ? (int) (baseX / CellSize) : (baseX / CellSize + (int) XCellMargin));
      int XLoopEndMargin = (int) ((int) (baseX / CellSize) > (baseX / CellSize + (int) XCellMargin) ? (int) (baseX / CellSize) : (baseX / CellSize + (int) XCellMargin));

      int YLoopStartMargin = (int) ((int) (baseY / CellSize) < baseY / CellSize + (int) YCellMargin ? (int) (baseY / CellSize) : baseY / CellSize + (int) YCellMargin);
      int YLoopEnMargin = (int) ((int) (baseY / CellSize) > baseY / CellSize + (int) YCellMargin ? (int) (baseY / CellSize) : baseY / CellSize + (int) YCellMargin);

      int ZLoopStartMargin = (int) ((int) (baseZ / 150) < baseZ / 150 + (int) ZCellMargin ? (int) (baseZ / 150) : baseZ / 150 + (int) ZCellMargin);
      int ZLoopEndMargin = (int) ((int) (baseZ / 150) > baseZ / 150 + (int) ZCellMargin ? (int) (baseZ / 150) : baseZ / 150 + (int) ZCellMargin);

      /***/
      int XLoopStartObject = (int) ((int) (baseX / CellSize) < (baseX / CellSize + (int) XCellObject) ? (int) (baseX / CellSize) : (baseX / CellSize + (int) XCellObject));
      int XLoopEndObject = (int) ((int) (baseX / CellSize) > (baseX / CellSize + (int) XCellObject) ? (int) (baseX / CellSize) : (baseX / CellSize + (int) XCellObject));

      int YLoopStartObject = (int) ((int) (baseY / CellSize) < baseY / CellSize + (int) YCellObject ? (int) (baseY / CellSize) : baseY / CellSize + (int) YCellObject);
      int YLoopEnObject = (int) ((int) (baseY / CellSize) > baseY / CellSize + (int) YCellObject ? (int) (baseY / CellSize) : baseY / CellSize + (int) YCellObject);

      int ZLoopStartObject = (int) ((int) (baseZ / 150) < baseZ / 150 + (int) ZCellObject ? (int) (baseZ / 150) : baseZ / 150 + (int) ZCellObject);
      int ZLoopEndObject = (int) ((int) (baseZ / 150) > baseZ / 150 + (int) ZCellObject ? (int) (baseZ / 150) : baseZ / 150 + (int) ZCellObject);

      if (!((baseX + VectorMargin.X < 360) && (baseY + VectorMargin.Y < 600) && (baseZ + VectorMargin.Z < 300) &&
        (baseX + VectorMargin.X > 0) && (baseY + VectorMargin.Y > 0) && (baseZ + VectorMargin.Z > 0)))
      {
        inLimits = false;
      }

      if (inLimits && suitableDirection)
      {

        for (int i = XLoopStartMargin; i < XLoopEndMargin; i++)
        {
          for (int j = YLoopStartMargin; j < YLoopEnMargin; j++)
          {
            for (int k = ZLoopStartMargin; k < ZLoopEndMargin; k++)
            {
              //checks if the cell is empty (We dont want to see an object in a cell! )
              if (((emptyFullArray[i, j, k] == 1) || (emptyFullArray[i, j, k] == 2)))
              {
                emptyBool = false;
              }

              // 2nd Loop checks if the zone is the same or empty zone // Actually margin can ovewflow to other zones
              /*
              if (!(areaArray[i, j, k] != this.ZoneName || areaArray[i, j, k] != 0))
              {
              sameZone = false;
              }
              */
            }
          }
        }
        // 2nd Loop checks if the zone is the same or empty zone
        for (int i = XLoopStartObject; i < XLoopEndObject; i++)
        {
          for (int j = YLoopStartObject; j < YLoopEnObject; j++)
          {
            for (int k = ZLoopStartObject; k < ZLoopEndObject; k++)
            {
              //checks if the cell is empty (We dont want to see margin or object in the cell )
              if (((emptyFullArray[i, j, k] == 1) || (emptyFullArray[i, j, k] == 2)))
              {
                emptyBool = false;
              }

              // 2nd Loop checks if the zone is the same or empty zone
              if (!(areaArray[i, j, k] == this.ZoneName || areaArray[i, j, k] == 0))
              {
                sameZone = false;
              }
            }
          }
        }

        if (emptyBool && sameZone)
        {
          suitableDirection = true;
          Rhino.RhinoApp.WriteLine("Place Bottom:  Conditions are  satisfied ");
        }
        else
        {
          Rhino.RhinoApp.WriteLine("Place Bottom:  Conditions are not satisfied ");
          suitableDirection = false;
        }
      }
      else
      {
        Rhino.RhinoApp.WriteLine("Place Bottom:  Conditions are not satisfied ");
        suitableDirection = false;
      }
      return suitableDirection;
    }

    public void PlaceBottom(int[,,] emptyFullArray, out Box ObjBox, out Box marginBox)
    {
      int XLoopStartMargin = (int) ((int) (baseX / CellSize) < (baseX / CellSize + (int) XCellMargin) ? (int) (baseX / CellSize) : (baseX / CellSize + (int) XCellMargin));
      int XLoopEndMargin = (int) ((int) (baseX / CellSize) > (baseX / CellSize + (int) XCellMargin) ? (int) (baseX / CellSize) : (baseX / CellSize + (int) XCellMargin));

      int YLoopStartMargin = (int) ((int) (baseY / CellSize) < baseY / CellSize + (int) YCellMargin ? (int) (baseY / CellSize) : baseY / CellSize + (int) YCellMargin);
      int YLoopEnMargin = (int) ((int) (baseY / CellSize) > baseY / CellSize + (int) YCellMargin ? (int) (baseY / CellSize) : baseY / CellSize + (int) YCellMargin);

      int ZLoopStartMargin = (int) ((int) (baseZ / 150) < baseZ / 150 + (int) ZCellMargin ? (int) (baseZ / 150) : baseZ / 150 + (int) ZCellMargin);
      int ZLoopEndMargin = (int) ((int) (baseZ / 150) > baseZ / 150 + (int) ZCellMargin ? (int) (baseZ / 150) : baseZ / 150 + (int) ZCellMargin);


      int XLoopStartObject = (int) ((int) (baseX / CellSize) < (baseX / CellSize + (int) XCellObject) ? (int) (baseX / CellSize) : (baseX / CellSize + (int) XCellObject));
      int XLoopEndObject = (int) ((int) (baseX / CellSize) > (baseX / CellSize + (int) XCellObject) ? (int) (baseX / CellSize) : (baseX / CellSize + (int) XCellObject));

      int YLoopStartObject = (int) ((int) (baseY / CellSize) < baseY / CellSize + (int) YCellObject ? (int) (baseY / CellSize) : baseY / CellSize + (int) YCellObject);
      int YLoopEnObject = (int) ((int) (baseY / CellSize) > baseY / CellSize + (int) YCellObject ? (int) (baseY / CellSize) : baseY / CellSize + (int) YCellObject);

      int ZLoopStartObject = (int) ((int) (baseZ / 150) < baseZ / 150 + (int) ZCellObject ? (int) (baseZ / 150) : baseZ / 150 + (int) ZCellObject);
      int ZLoopEndObject = (int) ((int) (baseZ / 150) > baseZ / 150 + (int) ZCellObject ? (int) (baseZ / 150) : baseZ / 150 + (int) ZCellObject);

      for (int i = XLoopStartMargin; i < XLoopEndMargin; i++)
      {
        for (int j = YLoopStartMargin; j < YLoopEnMargin; j++)
        {
          for (int k = ZLoopStartMargin; k < ZLoopEndMargin; k++)
          {
            emptyFullArray[i, j, k] = 2; // 2 represents margin
          }
        }
      }
      //Place Object, object is smaller than margin
      for (int i = XLoopStartObject; i < XLoopEndObject; i++)
      {
        for (int j = YLoopStartObject; j < YLoopEnObject; j++)
        {
          for (int k = ZLoopStartObject; k < ZLoopEndObject; k++)
          {
            emptyFullArray[i, j, k] = 1; // 1 represents object
          }
        }
      }

      Point3d pointa = new Point3d(baseX, baseY, baseZ);
      Vector3d pointb = new Vector3d(0, 0, 1);

      Plane planebase = new Plane(pointa, pointb);

      Interval xInterval = new Interval(0, this.VectorObject.X);
      Interval yInterval = new Interval(0, this.VectorObject.Y);
      Interval zInterval = new Interval(0, this.VectorObject.Z);

      ObjBox = new Box(planebase, xInterval, yInterval, zInterval);

      xInterval = new Interval(0, this.VectorMargin.X);
      yInterval = new Interval(0, this.VectorMargin.Y);
      zInterval = new Interval(0, this.VectorMargin.Z);

      marginBox = new Box(planebase, xInterval, yInterval, zInterval);
    }
  }

  static void ShowMatrix(int[,,] Arr)
  {
    for (int i = 0; i < Arr.GetLength(0); i++)
    {
      for (int j = 0; j < Arr.GetLength(1); j++)
      {
        Rhino.RhinoApp.Write(Arr[i, j, 0] + " ");
      }
      Rhino.RhinoApp.WriteLine("   ");
    }
    return;
  }

  static int[,,] InitializeZeroMatrice(int width, int length, int levelNumber)
  {
    var areaArray = new int[width, length, levelNumber];

    for (int k = 0; k < levelNumber; k++)
    {
      for (int i = 0; i < width; i++)
      {
        for (int j = 0; j < length; j++)
        {
          areaArray[i, j, k] = 0;
        }
      }
    }
    return areaArray;
  }

  static List<int> entranceList = new List<int>();
  static List<int> commonList = new List<int>();
  static List<int> wetAreaList = new List<int>();
  /**           these counters are used for starting the límitations counts.         **/
  static int entranceCounter = 1;
  static int commonCounter = 1;
  static int wetAreaCounter = 1;
  /**           these limits are used for defining max distance that zone can spread.  **/
  static readonly int entranceLimit = 400;
  static readonly int commonLimit = 300;
  static readonly int wetAreaLimit = 300;

  static void StartZones(int[,,] arr)
  {
    Random rand = new Random();
    var a = rand.Next(arr.GetLength(0) / 2, arr.GetLength(0) / 2);
    var b = rand.Next(0, 2);

    Rhino.RhinoApp.WriteLine("Zones started");
    entranceList.AddRange(new int[2] { a, b });
    arr[a, b, 0] = 1;
    b = rand.Next(0, arr.GetLength(1));
    a = rand.Next(0, arr.GetLength(0));

    commonList.AddRange(new int[2] { a, b });
    arr[a, b, 0] = 2;

    a = rand.Next(0, arr.GetLength(0));
    b = rand.Next(0, arr.GetLength(1));

    wetAreaList.AddRange(new int[2] { a, b });
    arr[a, b, 0] = 3; // wetArea Starting Point
    //----------------------
    a = rand.Next(0, arr.GetLength(0));
    b = rand.Next(0, arr.GetLength(1));

  }

  static double DistanceCalculate(List<int> spaceCoordList, int x2, int y2, int cellSize)
  {
    var distance = cellSize * Math.Sqrt((y2 - spaceCoordList[1]) * (y2 - spaceCoordList[1]) + (x2 - spaceCoordList[0]) * (x2 - spaceCoordList[0]));
    return distance;
  }

  static void NoiseFilter(int[,,] arr, int type, int iterationNumber, int controlNumber)
  {
    if (type == 0)
    {
      for (int loop = 0; loop < iterationNumber; loop++)
      {
        List<int> surrounding = new List<int>();
        for (int i = 1; i < arr.GetLength(0) - 1; i++)
        {
          for (int j = 1; j < arr.GetLength(1) - 1; j++)
          {
            for (int x = -1; x < 2; x++)
            {
              for (int y = -1; y < 2; y++)
              {
                if (!(x == y && x == 0))
                {

                  surrounding.Add(arr[i + x, j + y, 0]);
                }
              }
            }
            for (int v = 0; v < 6; v++) // 6 is the number of the zones including  empty cells
            {
              int count = (from z in surrounding where z == v select z).Count();
              if (count >= controlNumber)
              {
                arr[i, j, 0] = v;
              }
            }
            surrounding.Clear();
            surrounding.TrimExcess();
          }
        }
      }
    }

    if (type == 1)
    {
      for (int loop = 0; loop < iterationNumber; loop++)
      {
        List<int> surrounding = new List<int>();
        for (int i = 1; i < arr.GetLength(0) - 1; i++)
        {
          for (int j = 1; j < arr.GetLength(1) - 1; j++)
          {
            for (int x = -1; x < 2; x++)
            {
              for (int y = -1; y < 2; y++)
              {
                if (!(x == y && x == 0) && ((x + y == 1) || (x + y == -1)))
                {
                  surrounding.Add(arr[i + x, j + y, 0]);
                }
              }
            }

            for (int v = 0; v < 6; v++) // 6 is the number of the zones including  empty cells
            {
              int count = (from z in surrounding where z == v select z).Count();
              if (count >= 2)
              {
                arr[i, j, 0] = v;
              }
            }
            surrounding.Clear();
            surrounding.TrimExcess();
          }
        }
      }
    }
  }

  static void Spread(int[,,] arr, ref double spaceSize, List<int> spaceCoordList, ref int counter, int spaceLimit, int cellSize)
  {
    var rand = new Random();
    var directionList = new List<int>();
    int Xcoord;
    int Ycoord;
    bool draw = false;
    int trycount = 0;

    bool inTop;
    bool inRight;
    bool inBottom;
    bool inLeft;

    bool enoughTries = false;

    while (draw == false && counter < spaceSize && enoughTries == false)
    {
      var randomCellIndex = rand.Next(spaceCoordList.Count / 2);

      Xcoord = spaceCoordList[2 * randomCellIndex];
      Ycoord = spaceCoordList[2 * randomCellIndex + 1];

      inTop = (Ycoord + 1 < arr.GetLength(1));              // Check top border
      inRight = (Xcoord + 1 < arr.GetLength(0));              // Check Right border
      inBottom = (Ycoord - 1 >= 0);              // Check bottom border
      inLeft = (Xcoord - 1 >= 0);             //  Check left border

      if (inRight)
      {
        if (arr[Xcoord + 1, Ycoord, 0] == 0 && DistanceCalculate(spaceCoordList, Xcoord + 1, Ycoord, cellSize) < spaceLimit) // Check if possible new cell is still white or not!
          directionList.AddRange(new int[2] { (Xcoord + 1), Ycoord }); //Store possible spread directions in a list.
      }

      if (inLeft)
      {
        if (arr[Xcoord - 1, Ycoord, 0] == 0 && DistanceCalculate(spaceCoordList, Xcoord - 1, Ycoord, cellSize) < spaceLimit)
          directionList.AddRange(new int[2] { (Xcoord - 1), Ycoord }); //Store possible spread directions in a list.
      }

      if (inTop)
      {
        if (arr[Xcoord, Ycoord + 1, 0] == 0 && DistanceCalculate(spaceCoordList, Xcoord, Ycoord + 1, cellSize) < spaceLimit)
          directionList.AddRange(new int[2] { (Xcoord), Ycoord + 1 }); //Store possible spread directions in a list.
      }

      if (inBottom)
      {
        if (arr[Xcoord, Ycoord - 1, 0] == 0 && DistanceCalculate(spaceCoordList, Xcoord, Ycoord - 1, cellSize) < spaceLimit)
          directionList.AddRange(new int[2] { (Xcoord), (Ycoord - 1) }); //Store possible spread directions in a list.
      }


      if (directionList.Count > 0)
      {
        var randomIndex = rand.Next(directionList.Count / 2);
        int a = directionList[2 * randomIndex];
        int b = directionList[2 * randomIndex + 1];

        arr[a, b, 0] = arr[Xcoord, Ycoord, 0];

        spaceCoordList.AddRange(new int[2] { a, b });

        directionList.Clear();
        directionList.TrimExcess();
        draw = true;
        counter++;
      }

      else
      {
        trycount++;
        if (trycount >= spaceCoordList.Count)
        {
          enoughTries = true;
          //Print("trycountNumber is ={0}", trycount);
        }
      }
    }
  }
# ---------- end c_script_4 ----------
box_47 = Box(shower_cabin)
box_48 = Box(toilet_margin)
box_49 = Box(sink_cupboard)
box_50 = Box(sink_margin)
# ReferenceEntrance // Refenrence
# 1-checkfucntıon
# 2-place function
# 
# Fix directions
box_51 = Box(shower_cabin_2)
box_52 = Box(toılet)
panel_44 = Panel(c_script_4.FurnituresMargins)
c_script_5 = CSharpScript(
    Width=integer_5,
    Length=integer_4,
    Height=integer_6,
    LevelHeight=Slider(150, range=0..1000),
    cellSize=multiplication_9,
    ExteriorDoor=box_28,
    ExteriorDoorMargin=box_29,
    ChangeOverZone=box_24,
    ChangeOverZoneMargin=box_32,
    Closet=box_25,
    ClosetMargin=box_23,
    InteriorDoor=box_26,
    InteriorDoorMargin=box_27,
    Counter=box_30,
    CounterMargin=box_31,
    Table=box_33,
    TableMargin=box_34,
    SittingUnit=box_36,
    SittingUnitMargin=box_39,
    Bed=box_40,
    HealtCare=box_37,
    HealthCareMargin=box_38,
    Toilet=box_52,
    ToiletMargin=box_48,
    Sink=box_49,
    SinkMargin=box_50,
    SowerCabin=box_47,
    ShowerCabinMargin=box_51)  # -> out, A, EntranceBoxes, CommonBoxes, WetAreaBoxes, Y, K, W, Furnitures, FurnituresMargins; inputs Width: Int32, Length: Int32, Height: Int32, LevelHeight: Int32, cellSize: Int32, ExteriorDoor: Box, ExteriorDoorMargin: Box, ChangeOverZone: Box, ChangeOverZoneMargin: Box, Closet: Box, ClosetMargin: Box, InteriorDoor: Box, InteriorDoorMargin: Box, Counter: Box, CounterMargin: Box, Table: Box, TableMargin: Box, SittingUnit: Box, SittingUnitMargin: Box, Bed: Box, BedMargin: Box, HealtCare: Box, HealthCareMargin: Box, Toilet: Box, ToiletMargin: Box, Sink: Box, SinkMargin: Box, SowerCabin: Box; disabled
# ---------- c_script_5: C# ----------
    List<Box> entranceBoxes = new List<Box>();
    List<Box> commonBoxes = new List<Box>();
    List<Box> wetAreaBoxes = new List<Box>();

    List<Box> ObjectsList = new List<Box>();
    List<Box> MarginsList = new List<Box>();

    /*List<Box> kitchenBoxes = new List<Box>();
      List<Box> commonAreaBoxes = new List<Box>();*/

    List<Box> WhiteBoxes = new List<Box>();

    /**  These sizes are Spreading Limits for the spaces   //total cells     **/

    double entranceSize = (7 * 100 * 100) / (cellSize * cellSize);
    double commonSize = (9 * 100 * 100) / (cellSize * cellSize);
    double wetAreaSize = (7 * 100 * 100 ) / (cellSize * cellSize);

    /*
    double kitchenSize = 7 * 100 * 100 / cellSize * cell  Size;
    double commonAreaSize = 10 * 100 * 100 / cellSize * cellSize;
    */

    Point3d pA = new Point3d(0, 0, 0);
    Point3d pB = new Point3d(10, 0, 0);
    Point3d pC = new Point3d(0, 10, 0);

    Plane p = new Plane(pA, pB, pC);

    int width = Width;
    int length = Length;
    int levelHeight = LevelHeight;
    int height = Height;
    int levelNumber = Height / LevelHeight;

    bool objectPlacementEnded = false;
    bool placementFailed = false;
    bool validZoning = false;
    int[,,] areaArray = InitializeZeroMatrice(length, width, levelNumber);
    int[,,] emptyFullArray = InitializeZeroMatrice(length, width, levelNumber);

    while( objectPlacementEnded == false || placementFailed == true  )
    {
      entranceList.Clear();
      commonList.Clear();
      wetAreaList.Clear();
      
      placementFailed = false;
      validZoning = false;

      while( validZoning == false )
      {
        areaArray = InitializeZeroMatrice(length, width, levelNumber);
        StartZones(areaArray);

        emptyFullArray = InitializeZeroMatrice(length, width, levelNumber);

        for (int i = 0; i < width * length * 3; i++)
        {
          Spread(areaArray, ref entranceSize, entranceList, ref entranceCounter, entranceLimit, cellSize);
          Spread(areaArray, ref commonSize, commonList, ref commonCounter, commonLimit, cellSize);
          Spread(areaArray, ref wetAreaSize, wetAreaList, ref wetAreaCounter, wetAreaLimit, cellSize);
        }
        NoiseFilter(areaArray, 0, 3, 5);
        NoiseFilter(areaArray, 1, 2, 2);

        for (int k = 0;k < levelNumber;k++)
        {
          for (int i = 0;i < length;i++)
          {
            for (int j = 0;j < width;j++)
            {
              areaArray[i, j, k] = areaArray[i, j, 0];
            }
          }
        }

        for (int k = 0;k < levelNumber;k++)
        {
          for (int i = 0;i < length;i++)
          {
            for (int j = 0;j < width;j++)
            {
              emptyFullArray[i, j, k] = 0;
            }
          }
        }


        for (int k = 0;k < levelNumber;k++)
        {
          for (int i = 0;i < length;i++)
          {
            for (int j = 0;j < width;j++)
            {
              if (areaArray[i, j, k] == 1)
              {
                Interval xInterval = new Interval(i * cellSize, (i + 1) * (cellSize ));
                Interval yInterval = new Interval(j * cellSize, (j + 1) * (cellSize ));
                Interval zInterval = new Interval(k * LevelHeight, k * LevelHeight + levelHeight);

                Box boxgh = new Box(p, xInterval, yInterval, zInterval);
                entranceBoxes.Add(boxgh);
                entranceList.AddRange(new int[2] { i, j });
              }
              if (areaArray[i, j, k] == 2)
              {
                Interval xInterval = new Interval(i * cellSize, (i + 1) * (cellSize ));
                Interval yInterval = new Interval(j * cellSize, (j + 1) * (cellSize ));
                Interval zInterval = new Interval(k * LevelHeight, k * LevelHeight + levelHeight);

                Box boxgh = new Box(p, xInterval, yInterval, zInterval);
                commonBoxes.Add(boxgh);
                commonList.AddRange(new int[2] { i, j });
              }
              if (areaArray[i, j, k] == 3)
              {
                Interval xInterval = new Interval(i * cellSize, (i + 1) * (cellSize ));
                Interval yInterval = new Interval(j * cellSize, (j + 1) * (cellSize ));
                Interval zInterval = new Interval(k * LevelHeight, k * LevelHeight + levelHeight);

                Box boxgh = new Box(p, xInterval, yInterval, zInterval);
                wetAreaBoxes.Add(boxgh);
                wetAreaList.AddRange(new int[2] { i, j });
              }
              if (areaArray[i, j, k] == 0)
              {

                Interval xInterval = new Interval(i * cellSize, (i + 1) * (cellSize ));
                Interval yInterval = new Interval(j * cellSize, (j + 1) * (cellSize ));
                Interval zInterval = new Interval(k * LevelHeight, k * LevelHeight + levelHeight);

                Box boxgh = new Box(p, xInterval, yInterval, zInterval);
                WhiteBoxes.Add(boxgh);
                //WhiteList.AddRange(i, j);
              }
            }
          }
        }
        if(true)
        {
          validZoning = true;
        }

      }





      ObjectsList.Clear();
      MarginsList.Clear();
      /* FURNITURE LAYOUT ==> ENTRANCE STARTED */

      Point3d pointa = new Point3d(0, 0, 0);
      Vector3d vectorb = new Vector3d(0, 0, 1);

      Plane planebase = new Plane(pointa, vectorb);

      Interval xInter = new Interval(0, 10);
      Interval yInter = new Interval(0, 10);
      Interval zInter = new Interval(0, 10);


      Box ObjBox = new Box(planebase, xInter, yInter, zInter);
      Box marginBox = new Box(planebase, xInter, yInter, zInter);



      /* ENTRANCE REFERENCE */
      var exteriorDoorO = new Objects
        {
          Name = "Exterior Door",
          ZoneName = 1,

          Obj = ExteriorDoor,
          ObjMargin = ExteriorDoorMargin,

          Front = true,
          Right = true,
          Back = true,
          Left = false,
          Top = false,
          Bottom = false,

          RotationBool = false,
          RotationOpt = 2,

          MirrorBool = false,
          MirrorOpt = 2,

          Source = "NULL",
          FixedToWall = 1,

          CellSize = 60,
          SpaceList = entranceList,

          //PreviousObject = changeOverZoneO

          };

      exteriorDoorO.AssignDimensions();

      exteriorDoorO.PlaceRefObjectEntrance(emptyFullArray, areaArray, out ObjBox, out marginBox);

      ObjectsList.Add(ObjBox);
      MarginsList.Add(marginBox);



      /* ENTRANCE 2ND OBJECT */

      var changeOverZoneO = new Objects
        {
          Name = "changeOverZone",
          ZoneName = 1,

          Obj = ChangeOverZone,
          ObjMargin = ChangeOverZoneMargin,

          Front = true,
          Right = true,
          Back = false,
          Left = true,
          Top = false,
          Bottom = false,

          RotationBool = false,
          RotationOpt = 2,

          MirrorBool = false,
          MirrorOpt = 2,

          Source = "NULL",
          FixedToWall = 1,
          CellSize = 60,

          PreviousObject = exteriorDoorO,
          SpaceList = entranceList,

          };

      changeOverZoneO.AssignDimensions();
      changeOverZoneO.PlaceObject(emptyFullArray, areaArray, out ObjBox, out marginBox, out placementFailed);

      if (placementFailed == false)
      {
        Rhino.RhinoApp.WriteLine("The Placement is unsuccessfull start again!");
        continue;
      }
      //changeOverZoneO.printDimensions();
      ObjectsList.Add(ObjBox);
      MarginsList.Add(marginBox);


      /* ENTRANCE 3RD OBJECT */
      var closetO = new Objects
        {
          Name = "closet",
          ZoneName = 1,

          Obj = Closet,
          ObjMargin = ClosetMargin,

          Front = true,
          Right = true,
          Back = false,
          Left = false,
          Top = false,
          Bottom = false,

          RotationBool = false,
          RotationOpt = 2,

          MirrorBool = false,
          MirrorOpt = 2,

          Source = "NULL",
          FixedToWall = 1,
          CellSize = 60,

          PreviousObject = changeOverZoneO,
          SpaceList = entranceList,

          };

      closetO.AssignDimensions();

      closetO.PlaceObject(emptyFullArray, areaArray, out ObjBox, out marginBox, out placementFailed);

      if (placementFailed == false)
      {
        Rhino.RhinoApp.WriteLine("The Placement is unsuccessfull start again!");
        continue;
      }
      ObjectsList.Add(ObjBox);
      MarginsList.Add(marginBox);
      ObjectsList.Add(ObjBox);
      MarginsList.Add(marginBox);


      /* ENTRANCE 4TH OBJECT */
      var interiorDoorO = new Objects
        {
          Name = "Interior Door",
          ZoneName = 1,

          Obj = InteriorDoor,
          ObjMargin = InteriorDoorMargin,

          Front = false,
          Right = false,
          Back = false,
          Left = false,
          Top = false,
          Bottom = false,

          RotationBool = false,
          RotationOpt = 2,

          MirrorBool = false,
          MirrorOpt = 2,

          Source = "NULL",
          FixedToWall = 1,
          CellSize = 60,

          PreviousObject = closetO,
          SpaceList = entranceList,

          };

      interiorDoorO.AssignDimensions();
/*
      interiorDoorO.PlaceObject(emptyFullArray, areaArray, out ObjBox, out marginBox, out placementFailed);

      if (placementFailed == false)
      {
        Rhino.RhinoApp.WriteLine("The Placement is unsuccessfull start again!");
        continue;
      }
      ObjectsList.Add(ObjBox);
      MarginsList.Add(marginBox);
*/
      /* FURNITURE LAYOUT ==> ENTRANCE ENDED */


      /* FURNITURE LAYOUT ==> COMMON STARTED */

      var counterO = new Objects
        {
          Name = "Counter",
          ZoneName = 2,

          Obj = Counter,
          ObjMargin = CounterMargin,

          Front = true,
          Right = true,
          Back = false,
          Left = false,
          Top = false,
          Bottom = false,

          RotationBool = false,
          RotationOpt = 2,

          MirrorBool = false,
          MirrorOpt = 2,

          Source = "NULL",
          FixedToWall = 1,

          CellSize = 60,
          SpaceList = commonList,


          };
      counterO.AssignDimensions();

      //counterO.placeRefObject(emptyFullArray, areaArray, out ObjBox, out marginBox);
      //ObjectsList.Add(ObjBox);
      //MarginsList.Add(marginBox);


      /* COMMONAREA 2ND OBJECT */

      var tableO = new Objects
        {
          Name = "Table",
          ZoneName = 2,

          Obj = Table,
          ObjMargin = TableMargin,

          Front = true,
          Right = true,
          Back = false,
          Left = false,
          Top = false,
          Bottom = false,

          RotationBool = false,
          RotationOpt = 2,

          MirrorBool = false,
          MirrorOpt = 2,

          Source = "NULL",
          FixedToWall = 1,
          CellSize = 60,

          PreviousObject = counterO,
          SpaceList = commonList,

          };

      tableO.AssignDimensions();

/*
    Point3d pointa = new Point3d(0, 0, 0);
    Vector3d vectorb = new Vector3d(0, 0, 1);

    Plane planebase = new Plane(pointa, vectorb);

    Interval xInter = new Interval(0, 10);
    Interval yInter = new Interval(0, 10);
    Interval zInter = new Interval(0, 10);


    Box ObjBox = new Box(planebase, xInter, yInter, zInter);
    Box marginBox = new Box(planebase, xInter, yInter, zInter);
*/

    //tableO.placeFront(emptyFullArray, areaArray, out ObjBox, out marginBox);

    //changeOverZoneO.printDimensions();
    //ObjectsList.Add(ObjBox);
    //MarginsList.Add(marginBox);


    /* COMMON 3RD OBJECT */
      var sittingUnitO = new Objects
        {
          Name = "Sitting Unit",
          ZoneName = 2,

          Obj = SittingUnit,
          ObjMargin = SittingUnitMargin,

          Front = true,
          Right = true,
          Back = false,
          Left = false,
          Top = false,
          Bottom = false,

          RotationBool = false,
          RotationOpt = 2,

          MirrorBool = false,
          MirrorOpt = 2,

          Source = "NULL",
          FixedToWall = 1,
          CellSize = 60,

          PreviousObject = tableO,
          SpaceList = commonList,

          };

      sittingUnitO.AssignDimensions();

      //sittingUnitO.placeFront(emptyFullArray, areaArray, out ObjBox, out marginBox);
      //changeOverZoneO.printDimensions();
      //ObjectsList.Add(ObjBox);
      //MarginsList.Add(marginBox);


      /* COMMON 4TH OBJECT */


      var bedO = new Objects
        {
          Name = "Bed",
          ZoneName = 2,

          Obj = Bed,
          ObjMargin = BedMargin,

          Front = true,
          Right = true,
          Back = false,
          Left = false,
          Top = false,
          Bottom = false,

          RotationBool = false,
          RotationOpt = 2,

          MirrorBool = false,
          MirrorOpt = 2,

          Source = "NULL",
          FixedToWall = 1,
          CellSize = 60,

          PreviousObject = sittingUnitO,
          SpaceList = commonList,

          };

      bedO.AssignDimensions();

      //bedO.placeFront(emptyFullArray, areaArray, out ObjBox, out marginBox);

      // ObjectsList.Add(ObjBox);
      // MarginsList.Add(marginBox);  // there is bug here Check it

      /* FURNITURE LAYOUT ==> COMMON END */

      objectPlacementEnded = true;

    }



    ShowMatrix(areaArray);

    //Bxx = boxx;
    A = areaArray;
    EntranceBoxes = entranceBoxes;
    CommonBoxes = commonBoxes;
    WetAreaBoxes = wetAreaBoxes;
    /*Y = kitchenBoxes;
    K = commonAreaBoxes;*/
    W = WhiteBoxes;
    Furnitures = ObjectsList;
    FurnituresMargins = MarginsList;
# ---------- c_script_5: C# additional code ----------
  class Objects
  {
    public string Name;
    public int ZoneName;

    public Box Obj;
    public Box ObjMargin;

    public bool Front = false;
    public bool Right = false;
    public bool Back = false;
    public bool Left = false;
    public bool Top = false;
    public bool Bottom = false;

    public bool RotationBool = true;
    public int RotationOpt; // rotation options

    public bool MirrorBool = true;
    public int MirrorOpt; // mirror options

    public string Source; // Water, Electiricity
    public int FixedToWall; // Bed, Television //1,2,3 conditions
    public int CellSize;

    public Objects PreviousObject;

    public double ObjLength ;
    public double ObjWidth ;
    public double ObjHeight ;

    public double MrjLength;
    public double MrjWidth;
    public double MrjHeight;

    public double baseX, baseY, baseZ;
    public List<int> SpaceList = new List<int>();

    public double  XCell;
    public double  YCell;
    public double  ZCell;


    //deneme
    public Objects()
    {
            /*
            var Coordinates = new List<int>();
            Point3d pA = new Point3d(0, 0, 0);
            Point3d pB = new Point3d(10, 0, 0);
            Point3d pC = new Point3d(0, 10, 0);

            Plane p = new Plane(pA, pB, pC);*/
    }

    public Objects(string name, int zoneName, bool front, bool right, bool back, bool left, bool top, bool bottom, bool rotationalBool, int rotationOpt, bool mirrorBool, int mirrorOpt, string source, int fixedTowall, int cellSize, Box obj, Box objMargin, Objects previousObject, List<int> spaceList)
      : this()
    {
      this.Obj = obj;
      this.ObjMargin = objMargin;

      this.Name = name;
      this.ZoneName = zoneName;

      this.Front = front;
      this.Right = right;
      this.Back = back;
      this.Left = left;
      this.Bottom = bottom;
      this.Top = top;

      this.RotationBool = rotationalBool;
      this.RotationOpt = rotationOpt;

      this.MirrorBool = mirrorBool;
      this.MirrorOpt = mirrorOpt;

      this.Source = source;
      this.FixedToWall = fixedTowall;
      this.CellSize = cellSize;

      this.ObjWidth = obj.X.T1;
      this.ObjLength = obj.Y.T1;
      this.ObjHeight = obj.Z.T1;

      this.MrjWidth = objMargin.X.T1;
      this.MrjLength = objMargin.Y.T1;
      this.MrjHeight = objMargin.Z.T1;

      this.baseX = Obj.Plane.OriginX;
      this.baseY = Obj.Plane.OriginY;
      this.baseZ = Obj.Plane.OriginZ;

      this.PreviousObject = previousObject;
      this.SpaceList = spaceList;
    }

    public Objects(string name, int zoneName, bool front, bool right, bool back, bool left, bool top, bool bottom, bool rotationalBool, int rotationOpt, bool mirrorBool, int mirrorOpt, string source, int fixedTowall, int cellSize, Box obj, Box objMargin, List<int> spaceList)
      : this()
    {
      this.Obj = obj;
      this.ObjMargin = objMargin;

      this.Name = name;
      this.ZoneName = zoneName;

      this.Front = front;
      this.Right = right;
      this.Back = back;
      this.Left = left;
      this.Bottom = bottom;
      this.Top = top;

      this.RotationBool = rotationalBool;
      this.RotationOpt = rotationOpt;

      this.MirrorBool = mirrorBool;
      this.MirrorOpt = mirrorOpt;

      this.Source = source;
      this.FixedToWall = fixedTowall;
      this.CellSize = cellSize;

      this.ObjWidth = obj.X.T1;
      this.ObjLength = obj.Y.T1;
      this.ObjHeight = obj.Z.T1;

      this.MrjWidth = (this.ObjMargin.X.T1);
      this.MrjLength = (this.ObjMargin.Y.T1);
      this.MrjHeight = (this.ObjMargin.Z.T1);

      this.baseX = Obj.Plane.OriginX;
      this.baseY = Obj.Plane.OriginY;
      this.baseZ = Obj.Plane.OriginZ;

      this.SpaceList = spaceList;
    }

    public void AssignDimensions()
    {
      this.ObjWidth = this.Obj.X.T1;
      this.ObjLength = this.Obj.Y.T1;
      this.ObjHeight = this.Obj.Z.T1;

      this.MrjWidth = this.ObjMargin.X.T1;
      this.MrjLength = this.ObjMargin.Y.T1;
      this.MrjHeight = this.ObjMargin.Z.T1;

    }

    public void PrintDimensions()
    {
      Rhino.RhinoApp.WriteLine("Obj Width " + this.ObjWidth.ToString());
      Rhino.RhinoApp.WriteLine("Obj Length " + this.ObjLength.ToString());
      Rhino.RhinoApp.WriteLine("Obj Height " + this.ObjHeight.ToString());

      Rhino.RhinoApp.WriteLine("Obj Width " + this.MrjWidth.ToString());
      Rhino.RhinoApp.WriteLine("Obj Length " + this.MrjLength.ToString());
      Rhino.RhinoApp.WriteLine("Obj Height " + this.MrjHeight.ToString());
    }

    public void PlaceRefObject(int [,,]emptyFullArray, int[,,]areaArray, out Box ObjBox, out Box marginBox)
    {
      this.XCell = Math.Ceiling((double) (this.MrjWidth / CellSize));
      this.YCell = Math.Ceiling((double) (this.MrjLength / CellSize));
      this.ZCell = Math.Ceiling((double) (this.MrjHeight / 150));

      bool emptyBool = true;
      bool sameZone = true;

      bool placeSuccessful = false;
      int trycount = 0;

      while (placeSuccessful == false)
      {
        var rand = new Random();
        var randomCellIndex = rand.Next(this.SpaceList.Count / 2);

        baseX = (this.SpaceList[2 * randomCellIndex]) * CellSize;
        baseY = (this.SpaceList[2 * randomCellIndex + 1]) * CellSize;
        baseZ = 0;
        baseZ = 0;

        //baseX = baseX * CellSize;
        //baseY = baseY * CellSize;

        if( (baseX + this.MrjWidth < 300) && (baseY + this.MrjLength < 600) && (baseZ + this.MrjHeight < 300) &&
          (baseX + this.MrjWidth > 0) && (baseY + this.MrjLength > 0) && (baseZ + this.MrjHeight > 0) )
        {
          for(int i = (int) (baseX / CellSize) ; i < (baseX / CellSize + (int) XCell); i++)
          {
            for(int j = (int) (baseY / CellSize); j < baseY / CellSize + (int) YCell; j++)
            {
              for(int k = (int) (baseZ / 150); k < baseZ / 150 + (int) ZCell; k++)
              {
                Rhino.RhinoApp.WriteLine("Entrance Reference Object :  " + "  i:  " + i + "  j:  " + j + "  k:  " + k);
                if (emptyFullArray[i, j, k] == 1)
                {
                  emptyBool = false;
                }
                if (areaArray[i, j, k] != this.ZoneName)
                {
                  sameZone = false;
                }
              }
            }
          }

          if (emptyBool && sameZone)
          {
            placeSuccessful = true;

            Rhino.RhinoApp.WriteLine("Reference Object conditions are successful ");
            for(int i = (int) (baseX / CellSize) ; i < (baseX / CellSize + (int) XCell); i++)
            {
              for(int j = (int) (baseY / CellSize); j < baseY / CellSize + (int) YCell; j++)
              {
                for(int k = (int) (baseZ / 150); k < baseZ / 150 + (int) ZCell; k++)
                {
                  emptyFullArray[i, j, k] = 1;
                }
              }
            }
          }
          else
          {
            Rhino.RhinoApp.WriteLine("Conditions are not satisfied ");
          }
        }

        trycount++;
        Rhino.RhinoApp.WriteLine("Try count is : " + trycount);
        if (trycount > 60 )
          Rhino.RhinoApp.WriteLine("Try count is over 60 placement is unsuccessful: ");
        placeSuccessful = true;
      }

      if( trycount < 60 && placeSuccessful )
      {
        Rhino.RhinoApp.WriteLine("baseX " + this.baseX);
        Rhino.RhinoApp.WriteLine("baseY " + this.baseY);
        Rhino.RhinoApp.WriteLine("baseZ " + this.baseZ);

        Point3d pointa = new Point3d(baseX, baseY, 0);
        Vector3d pointb = new Vector3d(0, 0, 1);

        Plane planebase = new Plane(pointa, pointb);

        Interval xInterval = new Interval(0, this.ObjWidth);
        Interval yInterval = new Interval(0, this.ObjLength);
        Interval zInterval = new Interval(0, this.ObjHeight);

        ObjBox = new Box(planebase, xInterval, yInterval, zInterval);

        xInterval = new Interval(0, this.MrjWidth);
        yInterval = new Interval(0, this.MrjLength);
        zInterval = new Interval(0, this.MrjHeight);

        marginBox = new Box(planebase, xInterval, yInterval, zInterval);

      }

      else
      {
        ObjBox = new Box();
        marginBox = new Box();
      }
    }

    public void PlaceRefObjectEntrance(int [,,]emptyFullArray, int[,,]areaArray, out Box ObjBox, out Box marginBox)
    {
      this.XCell = Math.Ceiling((double) (this.MrjWidth / CellSize));
      this.YCell = Math.Ceiling((double) (this.MrjLength / CellSize));
      this.ZCell = Math.Ceiling((double) (this.MrjHeight / 150));

      bool emptyBool = true;
      bool sameZone = true;


      bool placeSuccessful = false;
      int trycount = 0;

      while (placeSuccessful == false)
      {
        var rand = new Random();
        var randomCellIndex = rand.Next(this.SpaceList.Count / 2);

        baseX = (this.SpaceList[2 * randomCellIndex]) * CellSize;
        baseY = 0;
        baseZ = 0;

        //baseX = baseX * CellSize;
        //baseY = baseY * CellSize;

        if( (baseX + this.MrjWidth < 300) && (baseY + this.MrjLength < 600) && (baseZ + this.MrjHeight < 300) &&
          (baseX + this.MrjWidth > 0) && (baseY + this.MrjLength > 0) && (baseZ + this.MrjHeight > 0) )
        {
          for(int i = (int) (baseX / CellSize) ; i < (baseX / CellSize + (int) XCell); i++)
          {
            for(int j = (int) (baseY / CellSize); j < baseY / CellSize + (int) YCell; j++)
            {
              for(int k = (int) (baseZ / 150); k < baseZ / 150 + (int) ZCell; k++)
              {
                Rhino.RhinoApp.WriteLine("Entrance Reference Object :  " + "  i:  " + i + "  j:  " + j + "  k:  " + k);
                if (emptyFullArray[i, j, k] == 1)
                {
                  emptyBool = false;
                }
                if (areaArray[i, j, k] != this.ZoneName)
                {
                  sameZone = false;
                }
              }
            }
          }

          if (emptyBool && sameZone)
          {
            placeSuccessful = true;

            Rhino.RhinoApp.WriteLine("Reference Object conditions are successful ");
            for(int i = (int) (baseX / CellSize) ; i < (baseX / CellSize + (int) XCell); i++)
            {
              for(int j = (int) (baseY / CellSize); j < baseY / CellSize + (int) YCell; j++)
              {
                for(int k = (int) (baseZ / 150); k < baseZ / 150 + (int) ZCell; k++)
                {
                  emptyFullArray[i, j, k] = 1;
                }
              }
            }
          }
          else
          {
            Rhino.RhinoApp.WriteLine("Conditions are not satisfied ");
          }
        }

        trycount++;
        Rhino.RhinoApp.WriteLine("Try count is : " + trycount);
        if (trycount > 60 )
          Rhino.RhinoApp.WriteLine("Try count is over 60 placement is unsuccessful: ");
        placeSuccessful = true;
      }

      if( trycount < 60 && placeSuccessful )
      {
        Rhino.RhinoApp.WriteLine("baseX " + this.baseX);
        Rhino.RhinoApp.WriteLine("baseY " + this.baseY);
        Rhino.RhinoApp.WriteLine("baseZ " + this.baseZ);

        Point3d pointa = new Point3d(baseX, 0, 0);
        Vector3d pointb = new Vector3d(0, 0, 1);

        Plane planebase = new Plane(pointa, pointb);

        Interval xInterval = new Interval(0, this.ObjWidth);
        Interval yInterval = new Interval(0, this.ObjLength);
        Interval zInterval = new Interval(0, this.ObjHeight);

        ObjBox = new Box(planebase, xInterval, yInterval, zInterval);

        xInterval = new Interval(0, this.MrjWidth);
        yInterval = new Interval(0, this.MrjLength);
        zInterval = new Interval(0, this.MrjHeight);

        marginBox = new Box(planebase, xInterval, yInterval, zInterval);

      }


      else
      {
        ObjBox = new Box();
        marginBox = new Box();
      }

    }

    public void PlaceObject(int[,,] emptyFullArray, int[,,] areaArray, out Box ObjBox, out Box marginBox, out bool placementFailed)
    {

      Point3d pointa = new Point3d(baseX, baseY, baseZ);
      Vector3d pointb = new Vector3d(0, 0, 1);

      Plane planebase = new Plane(pointa, pointb);

      Interval xInterval = new Interval(0, ObjWidth);
      Interval yInterval = new Interval(0, this.ObjLength);
      Interval zInterval = new Interval(0, this.ObjHeight);

      ObjBox = new Box(planebase, xInterval, yInterval, zInterval);

      xInterval = new Interval(0, this.MrjWidth);
      yInterval = new Interval(0, this.MrjLength);
      zInterval = new Interval(0, this.MrjHeight);

      marginBox = new Box(planebase, xInterval, yInterval, zInterval);

      List<int> growDirection = new List<int>();

      if (PreviousObject.Front == true)
        growDirection.Add(1); // Front Direction
      if (PreviousObject.Right == true)
        growDirection.Add(2); // Right Direction
      if (PreviousObject.Back == true)
        growDirection.Add(3); // Back Direction
      if (PreviousObject.Left == true)
        growDirection.Add(4); // Left Direction
      if (PreviousObject.Bottom == true)
        growDirection.Add(5); // Bottom Direction
      if (PreviousObject.Top == true)
        growDirection.Add(6); // Right Direction

      bool placeSuccess = false;
      int counter = 0;

      Random randm = new Random();
      Rhino.RhinoApp.WriteLine("Element Number of the grow Direction before while loop " + growDirection.Count.ToString());
      while (growDirection.Count > 0 && placeSuccess == false && counter < 6)
      {
        Rhino.RhinoApp.WriteLine("Counter number in the checkFront Loop " + counter.ToString());

        int a = randm.Next(0, growDirection.Count);
        int randomMethod = growDirection[a];

        Rhino.RhinoApp.WriteLine("Element Number of the grow Direction in while loop " + growDirection.Count.ToString());

        switch (a)
        {
          case 1:
            if (CheckFront(emptyFullArray, areaArray))
            {
              this.PlaceFront(emptyFullArray, out ObjBox, out marginBox);
              placeSuccess = true;

            }
            else
            {
              growDirection.Remove(a);
              Rhino.RhinoApp.WriteLine("Element Number of the grow Direction after removal " + growDirection.Count.ToString());

            }
            counter++;
            break;

          case 2:
            if (CheckRight(emptyFullArray, areaArray))
            {
              this.PlaceRight(emptyFullArray, out ObjBox, out marginBox);
              placeSuccess = true;
            }
            else
            {
              growDirection.Remove(a);
              Rhino.RhinoApp.WriteLine("Element Number of the grow Direction after removal " + growDirection.Count.ToString());
            }
            counter++;
            break;

          case 3:
            if (CheckBack(emptyFullArray, areaArray))
            {
              this.PlaceBack(emptyFullArray, out ObjBox, out marginBox);
              placeSuccess = true;

            }
            else
            {
              growDirection.Remove(a);
              Rhino.RhinoApp.WriteLine("Element Number of the grow Direction after removal " + growDirection.Count.ToString());

            }
            counter++;
            break;

          case 4:
            if (CheckLeft(emptyFullArray, areaArray))
            {
              this.PlaceLeft(emptyFullArray, out ObjBox, out marginBox);
              placeSuccess = true;
            }
            else
            {
              growDirection.Remove(a);
              Rhino.RhinoApp.WriteLine("Element Number of the grow Direction after removal " + growDirection.Count.ToString());
            }
            counter++;
            break;

          case 5:
            if (CheckTop(emptyFullArray, areaArray))
            {
              this.PlaceTop(emptyFullArray, out ObjBox, out marginBox);
              placeSuccess = true;
            }
            else
            {
              growDirection.Remove(a);
              Rhino.RhinoApp.WriteLine("Element Number of the grow Direction after removal " + growDirection.Count.ToString());
            }
            counter++;
            break;

          case 6:
            if (CheckBottom(emptyFullArray, areaArray))
            {
              this.PlaceBottom(emptyFullArray, out ObjBox, out marginBox);
              placeSuccess = true;

            }
            else
            {
              growDirection.Remove(a);
              Rhino.RhinoApp.WriteLine("Element Number of the grow Direction after removal " + growDirection.Count.ToString());
            }
            counter++;
            break;

          default:
            counter++;
            break;
        }
      }

      if (placeSuccess == false)
      {
        Rhino.RhinoApp.WriteLine("Placement Insuccessfull ");

      }

      placementFailed = placeSuccess;


    }



    public bool CheckFront(int[,,] emptyFullArray, int[,,] areaArray)

    {
      bool inLimits = true;
      bool emptyBool = true;
      bool sameZone = true;


      bool suitableDirection = true;

      this.XCell = Math.Ceiling((double) (this.MrjWidth / CellSize));
      this.YCell = Math.Ceiling((double) (this.MrjLength / CellSize));
      this.ZCell = Math.Ceiling((double) (this.MrjHeight / 150));

      this.baseX = PreviousObject.baseX;
      this.baseY = PreviousObject.baseY + CellSize * PreviousObject.YCell;
      this.baseZ = PreviousObject.baseZ;

      if (!((baseX + this.MrjWidth < 360) && (baseY + this.MrjLength < 600) && (baseZ + this.MrjHeight < 300) &&
        (baseX + this.MrjWidth > 0) && (baseY + this.MrjLength > 0) && (baseZ + this.MrjHeight > 0)))
      {
        inLimits = false;
      }

      if (inLimits)
      {
        for (int i = (int) (baseX / CellSize); i < (baseX / CellSize + (int) XCell); i++)
        {
          for (int j = (int) (baseY / CellSize); j < baseY / CellSize + (int) YCell; j++)
          {
            for (int k = (int) (baseZ / 150); k < baseZ / 150 + (int) ZCell; k++)
            {
              Rhino.RhinoApp.WriteLine("i:  " + i + "  j:  " + j + "  k:  " + k);

              if (emptyFullArray[i, j, k] == 1)
              {
                emptyBool = false;
              }

              if (areaArray[i, j, k] != this.ZoneName)
              {
                sameZone = false;
              }
            }
          }
        }

        if (emptyBool && sameZone)
        {
          suitableDirection = true;
          Rhino.RhinoApp.WriteLine("Place Front:  Conditions are  satisfied ");
        }
        else
        {
          Rhino.RhinoApp.WriteLine("Place Front:  Conditions are not satisfied ");
          suitableDirection = false;
        }
      }
      else
      {
        Rhino.RhinoApp.WriteLine("Place Front:  Conditions are not satisfied ");
        suitableDirection = false;
      }
      return suitableDirection;
    }

    public void PlaceFront(int[,,] emptyFullArray, out Box ObjBox, out Box marginBox)
    {

      for (int i = (int) (baseX / CellSize); i < (baseX / CellSize + (int) XCell); i++)
      {
        for (int j = (int) (baseY / CellSize); j < baseY / CellSize + (int) YCell; j++)
        {
          for (int k = (int) (baseZ / 150); k < baseZ / 150 + (int) ZCell; k++)
          {
            emptyFullArray[i, j, k] = 1;
          }
        }
      }

      Point3d pointa = new Point3d(baseX, baseY, baseZ);
      Vector3d pointb = new Vector3d(0, 0, 1);

      Plane planebase = new Plane(pointa, pointb);

      Interval xInterval = new Interval(0, this.ObjWidth);
      Interval yInterval = new Interval(0, this.ObjLength);
      Interval zInterval = new Interval(0, this.ObjHeight);

      ObjBox = new Box(planebase, xInterval, yInterval, zInterval);

      xInterval = new Interval(0, this.MrjWidth);
      yInterval = new Interval(0, this.MrjLength);
      zInterval = new Interval(0, this.MrjHeight);

      marginBox = new Box(planebase, xInterval, yInterval, zInterval);
    }



    public bool CheckRight(int[,,] emptyFullArray, int[,,] areaArray)

    {
      bool inLimits = true;
      bool emptyBool = true;
      bool sameZone = true;
      bool suitableDirection = true;

      this.XCell = Math.Ceiling((double) (this.MrjWidth / CellSize));
      this.YCell = Math.Ceiling((double) (this.MrjLength / CellSize));
      this.ZCell = Math.Ceiling((double) (this.MrjHeight / 150));

      this.baseX = PreviousObject.baseX;
      this.baseY = PreviousObject.baseY + CellSize * PreviousObject.YCell;
      this.baseZ = PreviousObject.baseZ;


      if (!((baseX + this.ObjWidth < 300) && (baseY + this.ObjLength < 600) && (baseZ + this.ObjHeight < 300) &&
        (baseX + this.ObjWidth > 0) && (baseY + this.ObjLength > 0) && (baseZ + this.ObjHeight > 0)))
      {
        inLimits = false;
      }

      if (inLimits)
      {
        for (int i = (int) (baseX / CellSize); i < (baseX / CellSize + (int) XCell); i++)
        {
          for (int j = (int) (baseY / CellSize); j < baseY / CellSize + (int) YCell; j++)
          {
            for (int k = (int) (baseZ / 150); k < baseZ / 150 + (int) ZCell; k++)
            {
              if (emptyFullArray[i, j, k] == 1)
              {
                emptyBool = false;
              }
              if (areaArray[i, j, k] != this.ZoneName)
              {
                sameZone = false;
              }
            }
          }
        }

        if (emptyBool && sameZone)
        {
          suitableDirection = true;
          Rhino.RhinoApp.WriteLine("Place Right:  Conditions are  satisfied ");
        }
        else
        {
          Rhino.RhinoApp.WriteLine("Place Right:  Conditions are not satisfied ");
          suitableDirection = false;
        }
      }
      else
      {
        Rhino.RhinoApp.WriteLine("Place Right:  Conditions are not satisfied ");
        suitableDirection = false;
      }
      return suitableDirection;
    }



    public void PlaceRight(int[,,] emptyFullArray, out Box ObjBox, out Box marginBox)
    {
      for (int i = (int) (baseX / CellSize); i < (baseX / CellSize + (int) XCell); i++)
      {
        for (int j = (int) (baseY / CellSize); j < baseY / CellSize + (int) YCell; j++)
        {
          for (int k = (int) (baseZ / 150); k < baseZ / 150 + (int) ZCell; k++)
          {
            emptyFullArray[i, j, k] = 1;
          }
        }
      }

      Point3d pointa = new Point3d(baseX, baseY, baseZ);
      Vector3d pointb = new Vector3d(0, 0, 1);

      Plane planebase = new Plane(pointa, pointb);

      Interval xInterval = new Interval(0, this.ObjWidth);
      Interval yInterval = new Interval(0, this.ObjLength);
      Interval zInterval = new Interval(0, this.ObjHeight);

      ObjBox = new Box(planebase, xInterval, yInterval, zInterval);

      xInterval = new Interval(0, this.MrjWidth);
      yInterval = new Interval(0, this.MrjLength);
      zInterval = new Interval(0, this.MrjHeight);

      marginBox = new Box(planebase, xInterval, yInterval, zInterval);
    }


    public bool CheckBack(int[,,] emptyFullArray, int[,,] areaArray)

    {
      bool inLimits = true;
      bool emptyBool = true;
      bool sameZone = true;


      bool suitableDirection = true;


      this.XCell = Math.Ceiling((double) (this.MrjWidth / CellSize));
      this.YCell = Math.Ceiling((double) (this.MrjLength / CellSize));
      this.ZCell = Math.Ceiling((double) (this.MrjHeight / 150));

      this.baseX = PreviousObject.baseX;
      this.baseY = PreviousObject.baseY - CellSize * this.YCell;
      this.baseZ = PreviousObject.baseZ;

      if (!((baseX + this.ObjWidth < 300) && (baseY + this.ObjLength < 600) && (baseZ + this.ObjHeight < 300) &&
        (baseX + this.ObjWidth > 0) && (baseY + this.ObjLength > 0) && (baseZ + this.ObjHeight > 0)))
      {
        inLimits = false;
      }

      if (inLimits)
      {
        for (int i = (int) (baseX / CellSize); i < (baseX / CellSize + (int) XCell); i++)
        {
          for (int j = (int) (baseY / CellSize); j < baseY / CellSize + (int) YCell; j++)
          {
            for (int k = (int) (baseZ / 150); k < baseZ / 150 + (int) ZCell; k++)
            {
              if (emptyFullArray[i, j, k] == 1)
              {
                emptyBool = false;
              }
              if (areaArray[i, j, k] != this.ZoneName)
              {
                sameZone = false;
              }
            }
          }
        }

        if (emptyBool && sameZone)
        {
          suitableDirection = true;
          Rhino.RhinoApp.WriteLine("Place Back:  Conditions are  satisfied ");
        }
        else
        {
          Rhino.RhinoApp.WriteLine("Place Back:  Conditions are not satisfied ");
          suitableDirection = false;
        }
      }
      else
      {
        Rhino.RhinoApp.WriteLine("Place Back:  Conditions are not satisfied ");
        suitableDirection = false;
      }
      return suitableDirection;
    }




    public void PlaceBack(int[,,] emptyFullArray, out Box ObjBox, out Box marginBox)
    {

      Rhino.RhinoApp.WriteLine("Place Back: Conditions are successful ");
      for (int i = (int) (baseX / CellSize); i < (baseX / CellSize + (int) XCell); i++)
      {
        for (int j = (int) (baseY / CellSize); j < baseY / CellSize + (int) YCell; j++)
        {
          for (int k = (int) (baseZ / 150); k < baseZ / 150 + (int) ZCell; k++)
          {
            emptyFullArray[i, j, k] = 1;
          }
        }
      }

      Point3d pointa = new Point3d(baseX, baseY, baseZ);
      Vector3d pointb = new Vector3d(0, 0, 1);

      Plane planebase = new Plane(pointa, pointb);

      Interval xInterval = new Interval(0, this.ObjWidth);
      Interval yInterval = new Interval(0, this.ObjLength);
      Interval zInterval = new Interval(0, this.ObjHeight);

      ObjBox = new Box(planebase, xInterval, yInterval, zInterval);

      xInterval = new Interval(0, this.MrjWidth);
      yInterval = new Interval(0, this.MrjLength);
      zInterval = new Interval(0, this.MrjHeight);

      marginBox = new Box(planebase, xInterval, yInterval, zInterval);
    }

    public bool CheckLeft(int[,,] emptyFullArray, int[,,] areaArray)

    {
      bool inLimits = true;
      bool emptyBool = true;
      bool sameZone = true;
      bool suitableDirection = true;

      this.XCell = Math.Ceiling((double) (this.MrjWidth / CellSize));
      this.YCell = Math.Ceiling((double) (this.MrjLength / CellSize));
      this.ZCell = Math.Ceiling((double) (this.MrjHeight / 150));

      this.baseX = PreviousObject.baseX - CellSize * this.XCell;
      this.baseY = PreviousObject.baseY;
      this.baseZ = PreviousObject.baseZ;

      if (!((baseX + this.ObjWidth < 300) && (baseY + this.ObjLength < 600) && (baseZ + this.ObjHeight < 300) &&
        (baseX + this.ObjWidth > 0) && (baseY + this.ObjLength > 0) && (baseZ + this.ObjHeight > 0)))
      {
        inLimits = false;
      }

      if (inLimits)
      {
        for (int i = (int) (baseX / CellSize); i < (baseX / CellSize + (int) XCell); i++)
        {
          for (int j = (int) (baseY / CellSize); j < baseY / CellSize + (int) YCell; j++)
          {
            for (int k = (int) (baseZ / 150); k < baseZ / 150 + (int) ZCell; k++)
            {
              Rhino.RhinoApp.WriteLine("i:  " + i + "  j:  " + j + "  k:  " + k);

              if (emptyFullArray[i, j, k] == 1)
              {
                emptyBool = false;
              }
              if (areaArray[i, j, k] != this.ZoneName)
              {
                sameZone = false;
              }
            }
          }
        }

        if (emptyBool && sameZone)
        {
          suitableDirection = true;
          Rhino.RhinoApp.WriteLine("Place Left:  Conditions are  satisfied ");
        }
        else
        {
          Rhino.RhinoApp.WriteLine("Place Left:  Conditions are not satisfied ");
          suitableDirection = false;
        }
      }
      else
      {
        Rhino.RhinoApp.WriteLine("Place Left:  Conditions are not satisfied ");
        suitableDirection = false;
      }
      return suitableDirection;
    }


    public void PlaceLeft(int[,,] emptyFullArray, out Box ObjBox, out Box marginBox)
    {
      for (int i = (int) (baseX / CellSize); i < (baseX / CellSize + (int) XCell); i++)
      {
        for (int j = (int) (baseY / CellSize); j < baseY / CellSize + (int) YCell; j++)
        {
          for (int k = (int) (baseZ / 150); k < baseZ / 150 + (int) ZCell; k++)
          {
            emptyFullArray[i, j, k] = 1;
          }
        }
      }

      Point3d pointa = new Point3d(baseX, baseY, baseZ);
      Vector3d pointb = new Vector3d(0, 0, 1);

      Plane planebase = new Plane(pointa, pointb);

      Interval xInterval = new Interval(0, this.ObjWidth);
      Interval yInterval = new Interval(0, this.ObjLength);
      Interval zInterval = new Interval(0, this.ObjHeight);

      ObjBox = new Box(planebase, xInterval, yInterval, zInterval);

      xInterval = new Interval(0, this.MrjWidth);
      yInterval = new Interval(0, this.MrjLength);
      zInterval = new Interval(0, this.MrjHeight);

      marginBox = new Box(planebase, xInterval, yInterval, zInterval);
    }

    public bool CheckTop(int[,,] emptyFullArray, int[,,] areaArray)
    {
      bool inLimits = true;
      bool emptyBool = true;
      bool sameZone = true;

      bool suitableDirection = true;

      this.XCell = Math.Ceiling((double) (MrjWidth / CellSize));
      this.YCell = Math.Ceiling((double) (this.MrjLength / CellSize));
      this.ZCell = Math.Ceiling((double) (this.MrjHeight / 150));

      this.baseX = PreviousObject.baseX;
      this.baseY = PreviousObject.baseY;
      this.baseZ = PreviousObject.baseZ + CellSize * PreviousObject.ZCell;

      if (!((baseX + this.ObjWidth < 360) && (baseY + this.ObjLength < 600) && (baseZ + this.ObjHeight < 300) &&
        (baseX + this.ObjWidth > 0) && (baseY + this.ObjLength > 0) && (baseZ + this.ObjHeight > 0)))
      {
        inLimits = false;
      }

      if (inLimits)
      {
        for (int i = (int) (baseX / CellSize); i < (baseX / CellSize + (int) XCell); i++)
        {
          for (int j = (int) (baseY / CellSize); j < baseY / CellSize + (int) YCell; j++)
          {
            for (int k = (int) (baseZ / 150); k < baseZ / 150 + (int) ZCell; k++)
            {
              Rhino.RhinoApp.WriteLine("i:  " + i + "  j:  " + j + "  k:  " + k);

              if (emptyFullArray[i, j, k] == 1)
              {
                emptyBool = false;
              }

              if (areaArray[i, j, k] != this.ZoneName)
              {
                sameZone = false;
              }
            }
          }
        }

        if (emptyBool && sameZone)
        {
          suitableDirection = true;
          Rhino.RhinoApp.WriteLine("Place Top:  Conditions are  satisfied ");
        }
        else
        {
          Rhino.RhinoApp.WriteLine("Place Top:  Conditions are not satisfied ");
          suitableDirection = false;
        }
      }
      else
      {
        Rhino.RhinoApp.WriteLine("Place Top:  Conditions are not satisfied ");
        suitableDirection = false;
      }
      return suitableDirection;
    }

    public void PlaceTop(int[,,] emptyFullArray, out Box ObjBox, out Box marginBox)
    {

      for (int i = (int) (baseX / CellSize); i < (baseX / CellSize + (int) XCell); i++)
      {
        for (int j = (int) (baseY / CellSize); j < baseY / CellSize + (int) YCell; j++)
        {
          for (int k = (int) (baseZ / 150); k < baseZ / 150 + (int) ZCell; k++)
          {
            emptyFullArray[i, j, k] = 1;
          }
        }
      }

      Point3d pointa = new Point3d(baseX, baseY, baseZ);
      Vector3d pointb = new Vector3d(0, 0, 1);

      Plane planebase = new Plane(pointa, pointb);

      Interval xInterval = new Interval(0, this.ObjWidth);
      Interval yInterval = new Interval(0, this.ObjLength);
      Interval zInterval = new Interval(0, this.ObjHeight);

      ObjBox = new Box(planebase, xInterval, yInterval, zInterval);

      xInterval = new Interval(0, this.MrjWidth);
      yInterval = new Interval(0, this.MrjLength);
      zInterval = new Interval(0, this.MrjHeight);

      marginBox = new Box(planebase, xInterval, yInterval, zInterval);
    }

    public bool CheckBottom(int[,,] emptyFullArray, int[,,] areaArray)
    {
      bool inLimits = true;
      bool emptyBool = true;
      bool sameZone = true;

      bool suitableDirection = true;

      this.XCell = Math.Ceiling((double) (this.MrjWidth / CellSize));
      this.YCell = Math.Ceiling((double) (this.MrjLength / CellSize));
      this.ZCell = Math.Ceiling((double) (this.MrjHeight / 150));

      this.baseX = PreviousObject.baseX;
      this.baseY = PreviousObject.baseY;
      this.baseZ = PreviousObject.baseZ - CellSize * this.ZCell;

      if (!((baseX + this.ObjWidth < 360) && (baseY + this.ObjLength < 600) && (baseZ + this.ObjHeight < 300) &&
        (baseX + this.ObjWidth > 0) && (baseY + this.ObjLength > 0) && (baseZ + this.ObjHeight > 0)))
      {
        inLimits = false;
      }

      if (inLimits)
      {
        for (int i = (int) (baseX / CellSize); i < (baseX / CellSize + (int) XCell); i++)
        {
          for (int j = (int) (baseY / CellSize); j < baseY / CellSize + (int) YCell; j++)
          {
            for (int k = (int) (baseZ / 150); k < baseZ / 150 + (int) ZCell; k++)
            {
              Rhino.RhinoApp.WriteLine("i:  " + i + "  j:  " + j + "  k:  " + k);

              if (emptyFullArray[i, j, k] == 1)
              {
                emptyBool = false;
              }
              if (areaArray[i, j, k] != this.ZoneName)
              {
                sameZone = false;
              }
            }
          }
        }

        if (emptyBool && sameZone)
        {
          suitableDirection = true;
          Rhino.RhinoApp.WriteLine("Place Bottom:  Conditions are  satisfied ");
        }
        else
        {
          Rhino.RhinoApp.WriteLine("Place Bottom:  Conditions are not satisfied ");
          suitableDirection = false;
        }
      }
      else
      {
        Rhino.RhinoApp.WriteLine("Place Bottom:  Conditions are not satisfied ");
        suitableDirection = false;
      }
      return suitableDirection;
    }

    public void PlaceBottom(int[,,] emptyFullArray, out Box ObjBox, out Box marginBox)
    {
      for (int i = (int) (baseX / CellSize); i < (baseX / CellSize + (int) XCell); i++)
      {
        for (int j = (int) (baseY / CellSize); j < baseY / CellSize + (int) YCell; j++)
        {
          for (int k = (int) (baseZ / 150); k < baseZ / 150 + (int) ZCell; k++)
          {
            emptyFullArray[i, j, k] = 1;
          }
        }
      }

      Point3d pointa = new Point3d(baseX, baseY, baseZ);
      Vector3d pointb = new Vector3d(0, 0, 1);

      Plane planebase = new Plane(pointa, pointb);

      Interval xInterval = new Interval(0, this.ObjWidth);
      Interval yInterval = new Interval(0, this.ObjLength);
      Interval zInterval = new Interval(0, this.ObjHeight);

      ObjBox = new Box(planebase, xInterval, yInterval, zInterval);

      xInterval = new Interval(0, this.MrjWidth);
      yInterval = new Interval(0, this.MrjLength);
      zInterval = new Interval(0, this.MrjHeight);

      marginBox = new Box(planebase, xInterval, yInterval, zInterval);
    }

    public void Rotate()
    {

    }

    static void Mirror()
    {
    }

    static void CreateWall()
    {

    }
  }

  static void ShowMatrix(int[,,] Arr)
  {
    for (int i = 0; i < Arr.GetLength(0); i++)
    {
      for (int j = 0; j < Arr.GetLength(1); j++)
      {
        Rhino.RhinoApp.Write(Arr[i, j, 0] + " ");
      }
      Rhino.RhinoApp.WriteLine("Loop Runs" + i.ToString());
    }
    return;
  }

  static int[,,] InitializeZeroMatrice(int width, int length, int levelNumber)
  {
    var areaArray = new int[width, length, levelNumber];

    for (int k = 0; k < levelNumber; k++)
    {
      for (int i = 0; i < width; i++)
      {
        for (int j = 0; j < length; j++)
        {
          areaArray[i, j, k] = 0;
        }
      }
    }
    return areaArray;
  }

  /* The Color lists keep the colors in a seperate List in order to choose within them easily instead of searching where they are... */
  static readonly List<int> entranceList = new List<int>();
  static readonly List<int> commonList = new List<int>();
  static readonly List<int> wetAreaList = new List<int>();
 /* static List<int> kitchenList = new List<int>();
  static List<int> commonAreaList = new List<int>();*/

  /**           these counters are used for starting the límitations counts.         **/

  static int entranceCounter = 1;
  static int commonCounter = 1;
  static int wetAreaCounter = 1;
  /*static int kitchenCounter = 1;
  static int commonAreaCounter = 1;*/
  /**           these limits are used for defining max distance that zone can spread.  **/

  static readonly int entranceLimit = 250;
  static readonly int commonLimit = 400;
  static readonly int wetAreaLimit = 300;
  /*static int kitchenLimit = 200;
  static int commonAreaLimit = 100;*/

  static void StartZones(int[,,] arr)
  {
    /**
     * Randomly Starts the color. Takes the Color lists as argumnts
     * (We can delete these argumnents and it can get them as local referance
     * in our case it gives us a chance to choose what to initilize)
     * **/

    Random rand = new Random();
    //----------------------
    /* GetLength(0) and GetLength(1) might be set as variable */
    //Array.GetLength(0) gives the column lenght in other words length of an array
    //Array.GetLength(1) gives the row lenght in other words width of an array
    var a = rand.Next(arr.GetLength(0) / 2, arr.GetLength(0) / 2);
    var b = rand.Next(0, 2);

    Rhino.RhinoApp.WriteLine("Zones started");
    entranceList.AddRange(new int[2] { a, b }); //AddRange ==> Adds multiple elements to a List . We use mod%2 to call the index of the point back instead of stacking them as an another List(or Array) in our list.
    arr[a, b, 0] = 1;// entrance Starting Point
    //----------------------

    b = rand.Next(0, arr.GetLength(1));
    a = rand.Next(0, arr.GetLength(0));

    commonList.AddRange(new int[2] { a, b });
    arr[a, b, 0] = 2; // common Starting Point
    //----------------------
    a = rand.Next(0, arr.GetLength(0));
    b = rand.Next(0, arr.GetLength(1));

    wetAreaList.AddRange(new int[2] { a, b });
    arr[a, b, 0] = 3; // wetArea Starting Point
    //----------------------
    a = rand.Next(0, arr.GetLength(0));
    b = rand.Next(0, arr.GetLength(1));
/*
    kitchenList.AddRange(new int[2] { a, b });
    arr[a, b, 0] = 4; // kitchen Starting Point
    //----------------------
    a = rand.Next(0, arr.GetLength(0));
    b = rand.Next(0, arr.GetLength(1));

    commonAreaList.AddRange(new int[2] { a, b });
    arr[a, b, 0] = 5; // commonArea Starting Point
    //----------------------
  */
  }
    /* Calculates the distance between initial point in the color and the possible new point!
     *  (if the possible new point is too far from inital point eleminate it.) */
  static double DistanceCalculate(List<int> spaceCoordList, int x2, int y2, int cellSize)
  {
    var distance = cellSize * Math.Sqrt((y2 - spaceCoordList[1]) * (y2 - spaceCoordList[1]) + (x2 - spaceCoordList[0]) * (x2 - spaceCoordList[0]));
    return distance;
  }

  static void Evaluate()
  {
    // according to relations give score to the created zones
    // get the centers of the zones and acoording to the distances and created sizes give
    //positive or negative points and if score is not acceptable re-run and create variatians.
  }


  static void NoiseFilter (int [,,] arr, int type, int iterationNumber, int controlNumber)
  {
    if(type == 0)
    {
      for( int loop = 0 ; loop < iterationNumber ; loop++ )
      {
        List < int> surrounding = new List<int>();
        for(int i = 1 ; i < arr.GetLength(0) - 1 ;i++)
        {
          for(int j = 1 ; j < arr.GetLength(1) - 1 ;j++)
          {
            for(int x = -1 ; x < 2;x++)
            {
              for(int y = -1 ; y < 2;y++)
              {
                if(!(x == y && x == 0))
                {

                  surrounding.Add(arr[i + x, j + y, 0]);
                }
              }
            }
            for (int v = 0 ; v < 6 ;v++) // 6 is the number of the zones including  empty cells
            {
              int count = (from z in surrounding where z == v select z).Count();
              if ( count >= controlNumber )
              {
                arr[i, j, 0] = v;
              }
            }
            surrounding.Clear();
            surrounding.TrimExcess();
          }
        }
      }
    }

    if(type == 1)
    {
      for( int loop = 0 ; loop < iterationNumber ; loop++ )
      {
        List < int> surrounding = new List<int>();
        for(int i = 1 ; i < arr.GetLength(0) - 1 ;i++)
        {
          for(int j = 1 ; j < arr.GetLength(1) - 1 ;j++)
          {
            for(int x = -1 ; x < 2;x++)
            {
              for(int y = -1 ; y < 2;y++)
              {
                if(!(x == y && x == 0) && ( (x + y == 1 ) || (x + y == -1 )) )
                {
                  surrounding.Add(arr[i + x, j + y, 0]);
                }
              }
            }

            for (int v = 0 ; v < 6 ;v++) // 6 is the number of the zones including  empty cells
            {
              int count = (from z in surrounding where z == v select z).Count();
              if ( count >= 2 )
              {
                arr[i, j, 0] = v;
              }
            }
            surrounding.Clear();
            surrounding.TrimExcess();
          }
        }
      }
    }
  }

  static void Spread(int[,,] arr, ref double spaceSize, List<int> spaceCoordList, ref int counter, int spaceLimit, int cellSize)
  {
        /*ARGUMENTS
     * The main array which has rectangular form(will be 3d in short) ,
     * spaceSize = Maximum limit that can grow.  ,
     * spaceCoordList =  the cells of the zone which has been already defined. )
     */
    var rand = new Random();
    var directionList = new List<int>();
    int Xcoord;
    int Ycoord;
    bool draw = false;
    int trycount = 0;

    while (draw == false && counter <= spaceSize)
    {
      if (counter <= spaceSize ) //Can be deleted. The condition is added to the While Loop Conditions.
      {
        var randomCellIndex = rand.Next(spaceCoordList.Count / 2);

        Xcoord = spaceCoordList[2 * randomCellIndex];
        Ycoord = spaceCoordList[2 * randomCellIndex + 1];

        if (Xcoord < arr.GetLength(0) - 1 && Xcoord > 0 && Ycoord > 0 && Ycoord < arr.GetLength(1) - 1)
        {
          /* Check the conditions INSIDE borders */
          if (arr[Xcoord + 1, Ycoord, 0] == 0 && DistanceCalculate(spaceCoordList, Xcoord + 1, Ycoord, cellSize) < spaceLimit ) // Check if possible new cell is still white or not!
            directionList.AddRange(new int[2] { (Xcoord + 1), Ycoord }); //Store possible spread directions in a list.

          if (arr[Xcoord - 1, Ycoord, 0] == 0 && DistanceCalculate(spaceCoordList, Xcoord - 1, Ycoord, cellSize) < spaceLimit)
            directionList.AddRange(new int[2] { (Xcoord - 1), Ycoord }); //Store possible spread directions in a list.

          if (arr[Xcoord, Ycoord + 1, 0] == 0 && DistanceCalculate(spaceCoordList, Xcoord, Ycoord + 1, cellSize) < spaceLimit)
            directionList.AddRange(new int[2] { (Xcoord), Ycoord + 1 }); //Store possible spread directions in a list.

          if (arr[Xcoord, Ycoord - 1, 0] == 0 && DistanceCalculate(spaceCoordList, Xcoord, Ycoord - 1, cellSize) < spaceLimit)
            directionList.AddRange(new int[2] { (Xcoord), (Ycoord - 1) }); //Store possible spread directions in a list.

          if (directionList.Count > 0)
          {
            var randomIndex = rand.Next(directionList.Count / 2);
            int a = directionList[2 * randomIndex];
            int b = directionList[2 * randomIndex + 1];

            arr[a, b, 0] = arr[Xcoord, Ycoord, 0];

            spaceCoordList.AddRange(new int[2] { a, b });

            directionList.Clear();
            directionList.TrimExcess();
            draw = true;
            counter++;
          }
          else
          {
            trycount++;
            if (trycount >= spaceCoordList.Count)
            {
              draw = true;
              //Print("trycountNumber is ={0}", trycount);
            }
          }
        }

          /* EDGE CONDITIONS */
          //RIGHT
        else if (Xcoord == (arr.GetLength(0) - 1) && Ycoord != 0 && Ycoord != (arr.GetLength(1) - 1))
        {
          if (arr[Xcoord - 1, Ycoord, 0] == 0 && DistanceCalculate(spaceCoordList, Xcoord - 1, Ycoord, cellSize) < spaceLimit )
            directionList.AddRange(new int[2] { (Xcoord - 1), (Ycoord) }); //Store possible spread directions in a list.
          if (arr[Xcoord, Ycoord + 1, 0] == 0 && DistanceCalculate(spaceCoordList, Xcoord, Ycoord + 1, cellSize) < spaceLimit )
            directionList.AddRange(new int[2] { (Xcoord ), (Ycoord + 1) }); //Store possible spread directions in a list.
          if (arr[Xcoord, Ycoord - 1, 0] == 0 && DistanceCalculate(spaceCoordList, Xcoord, Ycoord - 1, cellSize) < spaceLimit )
            directionList.AddRange(new int[2] { (Xcoord ), (Ycoord - 1) }); //Store possible spread directions in a list.

          if (directionList.Count > 0)
          {
            var randomIndex = rand.Next(directionList.Count / 2);
            int a = directionList[2 * randomIndex];
            int b = directionList[2 * randomIndex + 1];

            arr[a, b, 0] = arr[Xcoord, Ycoord, 0];

            spaceCoordList.AddRange(new int[2] { a, b });

            directionList.Clear();
            directionList.TrimExcess();
            draw = true;
            counter++;
          }
          else
          {
            trycount++;
            if (trycount >= spaceCoordList.Count)
            {
              draw = true;
              //Print("trycountNumber is ={0}", trycount);
            }
          }
        }

          //Left
        else if (Xcoord == 0 && Ycoord != 0 && Ycoord != (arr.GetLength(1) - 1))
        {

          if (arr[Xcoord + 1, Ycoord, 0] == 0 && DistanceCalculate(spaceCoordList, Xcoord + 1, Ycoord, cellSize) < spaceLimit )
            directionList.AddRange(new int[2] { (Xcoord + 1), (Ycoord) }); //Store possible spread directions in a list.
          if (arr[Xcoord, Ycoord + 1, 0] == 0 && DistanceCalculate(spaceCoordList, Xcoord, Ycoord + 1, cellSize) < spaceLimit )
            directionList.AddRange(new int[2] { (Xcoord ), (Ycoord + 1) }); //Store possible spread directions in a list.
          if (arr[Xcoord, Ycoord - 1, 0] == 0 && DistanceCalculate(spaceCoordList, Xcoord, Ycoord - 1, cellSize) < spaceLimit )
            directionList.AddRange(new int[2] { (Xcoord ), (Ycoord - 1) }); //Store possible spread directions in a list.
          if (directionList.Count > 0)
          {
            var randomIndex = rand.Next(directionList.Count / 2);
            int a = directionList[2 * randomIndex];
            int b = directionList[2 * randomIndex + 1];

            arr[a, b, 0] = arr[Xcoord, Ycoord, 0];

            spaceCoordList.AddRange(new int[2] { a, b });

            directionList.Clear();
            directionList.TrimExcess();
            draw = true;
            counter++;
          }
          else
          {
            trycount++;
            if (trycount >= spaceCoordList.Count)
            {
              draw = true;
              //Print("trycountNumber is ={0}", trycount);
            }
          }

        }
          //TOP
        else if ((Ycoord == arr.GetLength(1) - 1) && Xcoord != 0 && Xcoord != (arr.GetLength(0) - 1))
        {

          if (arr[Xcoord, Ycoord - 1, 0] == 0 && DistanceCalculate(spaceCoordList, Xcoord, Ycoord - 1, cellSize) < spaceLimit )
            directionList.AddRange(new int[2] { (Xcoord ), (Ycoord - 1) }); //Store possible spread directions in a list.
          if (arr[Xcoord + 1, Ycoord, 0] == 0 && DistanceCalculate(spaceCoordList, Xcoord + 1, Ycoord, cellSize) < spaceLimit )
            directionList.AddRange(new int[2] { (Xcoord + 1 ), (Ycoord ) }); //Store possible spread directions in a list.
          if (arr[Xcoord - 1, Ycoord, 0] == 0 && DistanceCalculate(spaceCoordList, Xcoord - 1, Ycoord, cellSize) < spaceLimit )
            directionList.AddRange(new int[2] { (Xcoord - 1), (Ycoord ) }); //Store possible spread directions in a list.
          if (directionList.Count > 0)
          {
            var randomIndex = rand.Next(directionList.Count / 2);
            int a = directionList[2 * randomIndex];
            int b = directionList[2 * randomIndex + 1];

            arr[a, b, 0] = arr[Xcoord, Ycoord, 0];

            spaceCoordList.AddRange(new int[2] { a, b });

            directionList.Clear();
            directionList.TrimExcess();
            draw = true;
            counter++;
          }
          else
          {
            trycount++;
            if (trycount >= spaceCoordList.Count)
            {
              draw = true;
              //Print("trycountNumber is ={0}", trycount);
            }
          }
        }
          //BOTTOM
        else if (Ycoord == 0 && Xcoord != 0 && Xcoord != (arr.GetLength(0) - 1))
        {
          if (arr[Xcoord, Ycoord + 1, 0] == 0 && DistanceCalculate(spaceCoordList, Xcoord, Ycoord + 1, cellSize) < spaceLimit )
            directionList.AddRange(new int[2] { (Xcoord ), (Ycoord + 1) }); //Store possible spread directions in a list.
          if (arr[Xcoord + 1, Ycoord, 0] == 0 && DistanceCalculate(spaceCoordList, Xcoord + 1, Ycoord, cellSize) < spaceLimit )
            directionList.AddRange(new int[2] { (Xcoord + 1 ), (Ycoord ) }); //Store possible spread directions in a list.
          if (arr[Xcoord - 1, Ycoord, 0] == 0 && DistanceCalculate(spaceCoordList, Xcoord - 1, Ycoord, cellSize) < spaceLimit )
            directionList.AddRange(new int[2] { (Xcoord - 1), (Ycoord ) }); //Store possible spread directions in a list.
          if (directionList.Count > 0)
          {
            var randomIndex = rand.Next(directionList.Count / 2);
            int a = directionList[2 * randomIndex];
            int b = directionList[2 * randomIndex + 1];

            arr[a, b, 0] = arr[Xcoord, Ycoord, 0];

            spaceCoordList.AddRange(new int[2] { a, b });

            directionList.Clear();
            directionList.TrimExcess();
            draw = true;
            counter++;
          }
          else
          {
            trycount++;
            if (trycount >= spaceCoordList.Count)
            {
              draw = true;
              //Print("trycountNumber is ={0}", trycount);
            }
          }
        }

          //LEFT BOTTOM
        else if (Xcoord == 0 && Ycoord == 0)
        {
          if (arr[Xcoord, Ycoord + 1, 0] == 0 && DistanceCalculate(spaceCoordList, Xcoord, Ycoord + 1, cellSize) < spaceLimit)
            directionList.Add(Xcoord); directionList.Add(Ycoord + 1);

          if (arr[Xcoord + 1, Ycoord, 0] == 0 && DistanceCalculate(spaceCoordList, Xcoord + 1, Ycoord, cellSize) < spaceLimit)
            directionList.Add(Xcoord + 1); directionList.Add(Ycoord);

          if (directionList.Count > 0)
          {

            var randomIndex = rand.Next(directionList.Count / 2);

            int a = directionList[2 * randomIndex];
            int b = directionList[2 * randomIndex + 1];

            arr[a, b, 0] = arr[Xcoord, Ycoord, 0];

            spaceCoordList.AddRange(new int[2] { a, b });

            directionList.Clear();
            directionList.TrimExcess();
            draw = true;

            counter++;
            //Print(" Counter Number is : {0}", counter);
          }
          else
          {
            trycount++;
            if (trycount >= spaceCoordList.Count)
            {
              draw = true;
              //Print("trycountNumber is ={0}", trycount);
            }
          }
        }
          //LEFT  TOP
          /*
          else if (Xcoord == 0 && Ycoord == (arr.GetLength(1) - 1))
          {
          if (arr[Xcoord + 1, Ycoord] == 0)
          directionList.Add(Xcoord + 1); directionList.Add(Ycoord);

          if (arr[Xcoord, Ycoord - 1] == 0)
          directionList.Add(Xcoord); directionList.Add(Ycoord - 1);

          if (directionList.Count > 0)
          {
          var randomIndex = rand.Next(directionList.Count / 2);

          int a = directionList[2 * randomIndex];
          int b = directionList[2 * randomIndex + 1];

          Rhino.RhinoApp.WriteLine("Left Top "  +  a +  " "  +  b);
          arr[a, b] = arr[Xcoord, Ycoord];

          spaceCoordList.AddRange(new int[2] { a, b });

          directionList.Clear();
          directionList.TrimExcess();
          draw = true;

          counter++;
          //Print(" Counter Number is : {0}", counter);
          }
          else
          {
          trycount++;
          if (trycount >= spaceCoordList.Count)
          {
          draw = true;
          //Print("trycountNumber is ={0}", trycount);
          }
          }
          }
          */
          /*
          //RIGHT TOP
          else if (Xcoord == (arr.GetLength(0) - 1) && Ycoord == (arr.GetLength(1) - 1))
          {
          if (arr[Xcoord, Ycoord - 1] == 0)
          directionList.Add(Xcoord); directionList.Add(Ycoord - 1);

          if (arr[Xcoord - 1, Ycoord] == 0)
          directionList.Add(Xcoord - 1); directionList.Add(Ycoord);

          if (directionList.Count > 0)
          {
          var randomIndex = rand.Next(directionList.Count / 2);

          int a = directionList[2 * randomIndex];
          int b = directionList[2 * randomIndex + 1];
          Rhino.RhinoApp.WriteLine(" Right top "+ a + " " + b);
          arr[a, b] = arr[Xcoord, Ycoord];

          //spaceCoordList.AddRange(new int[2] { a, b });

          directionList.Clear();
          directionList.TrimExcess();
          draw = true;

          counter++;
          //Print(" Counter Number is : {0}", counter);
          }
          else
          {
          trycount++;
          if (trycount >= spaceCoordList.Count)
          {
          draw = true;
          //Print("trycountNumber is ={0}", trycount);
          }
          }
          }
          */
          //RIGHT BOTTOM
        else if (Xcoord == (arr.GetLength(0) - 1) && Ycoord == 0)
        {
          if (arr[Xcoord, Ycoord + 1, 0] == 0)
            directionList.Add(Xcoord); directionList.Add(Ycoord + 1);

          if (arr[Xcoord - 1, Ycoord, 0] == 0)
            directionList.Add(Xcoord - 1); directionList.Add(Ycoord);

          if (directionList.Count > 0)
          {
            var randomIndex = rand.Next(directionList.Count / 2);

            int a = directionList[2 * randomIndex];
            int b = directionList[2 * randomIndex + 1];

            arr[a, b, 0] = arr[Xcoord, Ycoord, 0];

            spaceCoordList.AddRange(new int[2] { a, b });

            directionList.Clear();
            directionList.TrimExcess();

            draw = true;
            counter++;
            //Print(" Counter Number is : {0}", counter);
          }
          else
          {
            trycount++;
            if (trycount >= spaceCoordList.Count)
            {
              draw = true;
              //Print("trycountNumber is ={0}", trycount);
            }
          }
        }
        /* EDGE CONDITIONS */
      }
    }

  }
# ---------- end c_script_5 ----------
display_matrix = DisplayMatrix(c_script_4.A)  # disabled

# ---- group: Visualize as 3D Boxes
number_slider_15 = Slider(1, range=0..1)
create_material_11 = CreateMaterial(Diffuse=colour_swatch_4, Specular=RGB(255, 255, 255), Emission=RGB(0, 0, 0), Transparency=number_slider_15, Shine=0)
create_material_12 = CreateMaterial(Diffuse=colour_swatch, Specular=RGB(255, 255, 255), Emission=RGB(0, 0, 0), Transparency=number_slider_15, Shine=0)
create_material_13 = CreateMaterial(Diffuse=colour_swatch_5, Specular=RGB(255, 255, 255), Emission=RGB(0, 0, 0), Transparency=number_slider_15, Shine=0)
create_material_14 = CreateMaterial(Diffuse=colour_swatch_6, Specular=RGB(255, 255, 255), Emission=RGB(0, 0, 0), Transparency=number_slider_15, Shine=0)
create_material_15 = CreateMaterial(Diffuse=colour_swatch_2, Specular=RGB(255, 255, 255), Emission=RGB(0, 0, 0), Transparency=number_slider_15, Shine=0)
create_material_16 = CreateMaterial(
    Diffuse=colour_swatch_3,
    Specular=RGB(255, 255, 255),
    Emission=RGB(0, 0, 0),
    Transparency=Slider(0.624, range=0..1),
    Shine=0)
custom_preview_7 = CustomPreview(Geometry=c_script_4.EntranceBoxes, Material=create_material_11)
custom_preview_8 = CustomPreview(Geometry=c_script_4.CommonBoxes, Material=create_material_13)
custom_preview_9 = CustomPreview(Geometry=c_script_4.Y, Material=create_material_12)
custom_preview_10 = CustomPreview(Geometry=c_script_4.WetAreaBoxes, Material=create_material_14)
custom_preview_11 = CustomPreview(Geometry=c_script_4.K, Material=create_material_15)
custom_preview_12 = CustomPreview(Geometry=c_script_4.W, Material=create_material_16)

# ----
panel_45 = Panel(c_script_5.FurnituresMargins)
display_matrix_2 = DisplayMatrix(c_script_5.A)  # disabled
panel_46 = Panel(c_script_4.out)
panel_47 = Panel(c_script_5.out)

# ---- group: Visualize as 3D Boxes
number_slider_16 = Slider(1, range=0..1)
create_material_17 = CreateMaterial(Diffuse=colour_swatch_11, Specular=RGB(255, 255, 255), Emission=RGB(0, 0, 0), Transparency=number_slider_16, Shine=0)
create_material_18 = CreateMaterial(Diffuse=colour_swatch_8, Specular=RGB(255, 255, 255), Emission=RGB(0, 0, 0), Transparency=number_slider_16, Shine=0)
create_material_19 = CreateMaterial(Diffuse=colour_swatch_12, Specular=RGB(255, 255, 255), Emission=RGB(0, 0, 0), Transparency=number_slider_16, Shine=0)
create_material_20 = CreateMaterial(Diffuse=colour_swatch_13, Specular=RGB(255, 255, 255), Emission=RGB(0, 0, 0), Transparency=number_slider_16, Shine=0)
create_material_21 = CreateMaterial(Diffuse=colour_swatch_9, Specular=RGB(255, 255, 255), Emission=RGB(0, 0, 0), Transparency=number_slider_16, Shine=0)
create_material_22 = CreateMaterial(
    Diffuse=colour_swatch_10,
    Specular=RGB(255, 255, 255),
    Emission=RGB(0, 0, 0),
    Transparency=Slider(0.624, range=0..1),
    Shine=0)
custom_preview_13 = CustomPreview(Geometry=c_script_5.EntranceBoxes, Material=create_material_17)  # disabled
custom_preview_14 = CustomPreview(Geometry=c_script_5.CommonBoxes, Material=create_material_19)  # disabled
custom_preview_15 = CustomPreview(Geometry=c_script_5.Y, Material=create_material_18)  # disabled
custom_preview_16 = CustomPreview(Geometry=c_script_5.WetAreaBoxes, Material=create_material_20)  # disabled
custom_preview_17 = CustomPreview(Geometry=c_script_5.K, Material=create_material_21)  # disabled
custom_preview_18 = CustomPreview(Geometry=c_script_5.W, Material=create_material_22)  # disabled

# ----
panel_48 = Panel(c_script_4.MV)
vector_display = VectorDisplay(Anchor=c_script_4.Base_Points, Vector=c_script_4.MV)
vector_display_2 = VectorDisplay(Anchor=c_script_4.Base_Points, Vector=c_script_4.OV)
vector_display_ex = VectorDisplayEx(Point=c_script_4.Base_Points, Vector=c_script_4.OV, Colour=colour_swatch_7, Width=number_slider_10)  # disabled
custom_preview_19 = CustomPreview(Geometry=c_script_4.Furnitures, Material=create_material_7)
custom_preview_20 = CustomPreview(Geometry=c_script_4.FurnituresMargins, Material=create_material_8)
custom_preview_21 = CustomPreview(Geometry=c_script_5.Furnitures, Material=create_material_9)
list_length = ListLength(List=c_script_4.EntranceBoxes)
list_length_2 = ListLength(List=c_script_4.CommonBoxes)
list_length_3 = ListLength(List=c_script_4.W)
custom_preview_22 = CustomPreview(Geometry=c_script_5.FurnituresMargins, Material=create_material_10)
list_length_4 = ListLength(List=c_script_4.WetAreaBoxes)
list_length_5 = ListLength(List=c_script_4.Y)
list_length_6 = ListLength(List=c_script_4.K)
multiplication_14 = Multiplication(A=list_length_2, B=division_4)
multiplication_15 = Multiplication(A=list_length, B=division_4)
multiplication_16 = Multiplication(A=list_length_3, B=division_4)
multiplication_17 = Multiplication(A=list_length_4, B=division_4)
multiplication_18 = Multiplication(A=list_length_5, B=division_4)
multiplication_19 = Multiplication(A=list_length_6, B=division_4)
list_length_7 = ListLength(List=c_script_5.EntranceBoxes)  # disabled
list_length_8 = ListLength(List=c_script_5.CommonBoxes)  # disabled
list_length_9 = ListLength(List=c_script_5.W)  # disabled
list_length_10 = ListLength(List=c_script_5.WetAreaBoxes)  # disabled
list_length_11 = ListLength(List=c_script_5.Y)  # disabled
list_length_12 = ListLength(List=c_script_5.K)  # disabled
panel_49 = Panel(multiplication_15)
panel_50 = Panel(multiplication_16)
panel_51 = Panel(multiplication_14)
multiplication_20 = Multiplication(A=list_length_8, B=division_7)  # disabled
panel_52 = Panel(multiplication_17)
panel_53 = Panel(multiplication_18)
multiplication_21 = Multiplication(A=list_length_7, B=division_7)  # disabled
panel_54 = Panel(multiplication_19)
multiplication_22 = Multiplication(A=list_length_9, B=division_7)  # disabled
multiplication_23 = Multiplication(A=list_length_10, B=division_7)  # disabled
multiplication_24 = Multiplication(A=list_length_11, B=division_7)  # disabled
multiplication_25 = Multiplication(A=list_length_12, B=division_7)  # disabled
panel_55 = Panel(multiplication_21)  # disabled
panel_56 = Panel(multiplication_22)  # disabled
panel_57 = Panel(multiplication_20)  # disabled
panel_58 = Panel(multiplication_23)  # disabled
panel_59 = Panel(multiplication_24)  # disabled
concatenate = Concatenate(Fragment_A=" Empty Space= ", Fragment_B=panel_50, Fragment_C="m2 ")
concatenate_2 = Concatenate(Fragment_A=" Entrance = ", Fragment_B=panel_49, Fragment_C="m2 ")
panel_60 = Panel(multiplication_25)  # disabled
concatenate_3 = Concatenate(Fragment_A=" CommonArea = ", Fragment_B=panel_51, Fragment_C="m2 ")
concatenate_4 = Concatenate(Fragment_A="Wet Area = ", Fragment_B=panel_52, Fragment_C="m2 ")
concatenate_5 = Concatenate(Fragment_A=" Kitchen = ", Fragment_B=panel_53, Fragment_C="m2 ")
concatenate_6 = Concatenate(Fragment_A=" Common Area = ", Fragment_B=panel_54, Fragment_C=" m2 ")
panel_61 = Panel(concatenate)
panel_62 = Panel(concatenate_2)
panel_63 = Panel(concatenate_3)
panel_64 = Panel(concatenate_4)
panel_65 = Panel(concatenate_5)
panel_66 = Panel(concatenate_6)
concatenate_7 = Concatenate(Fragment_A=panel_24, Fragment_B=panel_56, Fragment_C=panel_26)  # disabled
concatenate_8 = Concatenate(Fragment_A=panel_23, Fragment_B=panel_55, Fragment_C=panel_22)  # disabled
concatenate_9 = Concatenate(Fragment_A=panel_27, Fragment_B=panel_57, Fragment_C=panel_25)  # disabled
concatenate_10 = Concatenate(Fragment_A=panel_29, Fragment_B=panel_58, Fragment_C=panel_28)  # disabled
concatenate_11 = Concatenate(Fragment_A=panel_32, Fragment_B=panel_59, Fragment_C=panel_31)  # disabled
concatenate_12 = Concatenate(Fragment_A=panel_30, Fragment_B=panel_60, Fragment_C=panel_33)  # disabled
panel_67 = Panel(concatenate_7)  # disabled
panel_68 = Panel(concatenate_8)  # disabled
panel_69 = Panel(concatenate_9)  # disabled
text_tag_3d = TextTag3D(Location="0,-50", Text=concatenate_2, Size=number_slider_11, Colour=colour_swatch_4, Justification=7)
text_tag_3d_2 = TextTag3D(Location="0,-80", Text=concatenate_3, Size=number_slider_11, Colour=colour_swatch_5, Justification=7)
panel_70 = Panel(concatenate_10)  # disabled
panel_71 = Panel(concatenate_11)  # disabled
text_tag_3d_3 = TextTag3D(Location="0,-140", Text=concatenate_5, Size=number_slider_11, Colour=colour_swatch, Justification=7)
text_tag_3d_4 = TextTag3D(Location="0,-110", Text=concatenate_4, Size=number_slider_11, Colour=colour_swatch_6, Justification=7)
text_tag_3d_5 = TextTag3D(Location="0,-140", Text=concatenate, Size=number_slider_11, Colour=colour_swatch_3, Justification=7)
panel_72 = Panel(concatenate_12)  # disabled
text_tag_3d_6 = TextTag3D(Location="240,-170", Text=concatenate_6, Size=number_slider_11, Colour=colour_swatch_2, Justification=7)
mass_addition = MassAddition(Input=[multiplication_14, multiplication_15, multiplication_17, multiplication_18, multiplication_19, multiplication_16])  # -> flatten(Result), PartialResults
text_tag_3d_7 = TextTag3D(Location=panel_34, Text=concatenate_8, Size=number_slider_12, Colour=colour_swatch_11, Justification=7)  # disabled
text_tag_3d_8 = TextTag3D(Location=panel_35, Text=concatenate_9, Size=number_slider_12, Colour=colour_swatch_12, Justification=7)  # disabled
text_tag_3d_9 = TextTag3D(Location=panel_36, Text=concatenate_11, Size=number_slider_12, Colour=colour_swatch_8, Justification=7)  # disabled
text_tag_3d_10 = TextTag3D(Location=panel_39, Text=concatenate_10, Size=number_slider_12, Colour=colour_swatch_13, Justification=7)  # disabled
text_tag_3d_11 = TextTag3D(Location=panel_36, Text=concatenate_7, Size=number_slider_12, Colour=colour_swatch_10, Justification=7)  # disabled
text_tag_3d_12 = TextTag3D(Location=panel_38, Text=concatenate_12, Size=number_slider_12, Colour=colour_swatch_9, Justification=7)  # disabled
list_item = ListItem(List=mass_addition.Result, Index=Slider(1, range=0..1), Wrap=True)
panel_73 = Panel(list_item)
mass_addition_2 = MassAddition(Input=[multiplication_20, multiplication_21, multiplication_23, multiplication_24, multiplication_25, multiplication_22])  # -> flatten(Result), PartialResults; disabled
concatenate_13 = Concatenate(Fragment_A=" Total Area =", Fragment_B=panel_73, Fragment_C="m2 ")
list_item_2 = ListItem(List=mass_addition_2.Result, Index=number_slider_13, Wrap=True)  # disabled
panel_74 = Panel(list_item_2)  # disabled
panel_75 = Panel(concatenate_13)
concatenate_14 = Concatenate(Fragment_A=panel_41, Fragment_B=panel_74, Fragment_C=panel_42)  # disabled
text_tag_3d_13 = TextTag3D(Location="240,-100", Text=concatenate_13, Size=number_slider_11, Justification=7)
panel_76 = Panel(concatenate_14)  # disabled
text_tag_3d_14 = TextTag3D(Location=panel_43, Text=concatenate_14, Size=number_slider_12, Justification=7)  # disabled
