# Grasshopper definition CemGrasshopperC#148.gh (Grasshopper 1.0.7)

X = Slider(60, range=45..60)
Y = Slider(60, range=45..60)
Z = Slider(40, range=40..50)

# ----
# Sink
X_2 = Slider(30, range=26..40)  # disabled
# Stove
Y_2 = Slider(58, range=48..58)  # disabled
rectangle = Rectangle(Plane=PlaneXY(1500, 0, 0), XSize=X_2, YSize=Y_2, Radius=0)  # -> Rectangle, Length; disabled
Z_2 = Slider(15, range=15..22)  # disabled
stove = BoxRectangle(Rectangle=rectangle.Rectangle, Height=Z_2)  # disabled

# ----
# Lower Bed
number_slider = Slider(20, range=20..100)
# Counter 2
number_slider_2 = Slider(75, range=75..100)  # disabled

# ----
# Drawer
X_3 = Slider(60, range=60..100)  # disabled
Y_3 = Slider(60, range=50..65)  # disabled
Z_3 = Slider(18, range=18..25)  # disabled
rectangle_2 = Rectangle(Plane=PlaneXY(400, 0, 0), XSize=X_3, YSize=Y_3, Radius=0)  # -> Rectangle, Length; disabled
drawer = BoxRectangle(Rectangle=rectangle_2.Rectangle, Height=Z_3)  # disabled

# ----
# Counter 1
number_slider_3 = Slider(75, range=75..100)
# Table 1
number_slider_4 = Slider(100, range=75..100)
# Sitting Unit
number_slider_5 = Slider(75, range=75..100)

X_4 = Slider(60, range=55..70)  # disabled
# Fridge
Y_4 = Slider(60, range=50..65)  # disabled
rectangle_3 = Rectangle(Plane=PlaneXY(600, 0, 0), XSize=X_4, YSize=Y_4, Radius=0)  # -> Rectangle, Length; disabled
Z_4 = Slider(79, range=72..79)  # disabled
fridge = BoxRectangle(Rectangle=rectangle_3.Rectangle, Height=Z_4)  # disabled

X_5 = Slider(120, range=100..140)  # disabled
Y_5 = Slider(60, range=50..65)  # disabled
Z_5 = Slider(3, range=3..6)  # disabled

X_6 = Slider(60, range=38..60)  # disabled
Y_6 = Slider(44, range=38..50)  # disabled
rectangle_4 = Rectangle(Plane=PlaneXY(1300, 0, 0), XSize=X_6, YSize=Y_6, Radius=0)  # -> Rectangle, Length; disabled
Z_6 = Slider(22, range=13..22)  # disabled
table_2 = BoxRectangle(Rectangle=rectangle_4.Rectangle, Height=Z_6)  # disabled

Z_7 = Slider(3, range=3..6)
Y_7 = Slider(60, range=50..65)
X_7 = Slider(120, range=100..140)

X_8 = Slider(60, range=60..100)  # disabled
# Table 2
Y_8 = Slider(120, range=110..140)  # disabled
rectangle_5 = Rectangle(Plane=PlaneXY(1100, 0, 0), XSize=X_8, YSize=Y_8, Radius=0)  # -> Rectangle, Length; disabled
Z_8 = Slider(6, range=2..6)  # disabled
table_2_2 = BoxRectangle(Rectangle=rectangle_5.Rectangle, Height=Z_8)  # disabled

Z_9 = Slider(20, range=20..40)
X_9 = Slider(210, range=200..220)
Y_9 = Slider(120, range=90..120)

X_10 = Slider(120, range=110..140)
Z_10 = Slider(6, range=2..6)
Y_10 = Slider(60, range=60..100)

construct_point = ConstructPoint(XCoordinate=X_10, YCoordinate=Y_10, ZCoordinate=Z_10)
# Interior Door
vector_xyz = VectorXYZ(XComponent=Slider(0, range=0..1000), YComponent=0, ZComponent=0)  # -> Vector, Length
vector_xyz_2 = VectorXYZ(XComponent=0, YComponent=0, ZComponent=number_slider)  # -> Vector, Length
construct_point_2 = ConstructPoint(XCoordinate=X_7, YCoordinate=Y_7, ZCoordinate=Z_7)  # disabled
vector_xyz_3 = VectorXYZ(XComponent=Slider(0, range=0..1000), YComponent=0, ZComponent=0)  # -> Vector, Length
vector_xyz_4 = VectorXYZ(XComponent=0, YComponent=0, ZComponent=number_slider_2)  # -> Vector, Length; disabled
vector_xyz_5 = VectorXYZ(XComponent=Slider(0, range=0..1000), YComponent=0, ZComponent=0)  # -> Vector, Length
vector_xyz_6 = VectorXYZ(XComponent=0, YComponent=0, ZComponent=number_slider_3)  # -> Vector, Length
vector_xyz_7 = VectorXYZ(XComponent=Slider(0, range=0..2000), YComponent=0, ZComponent=0)  # -> Vector, Length
vector_xyz_8 = VectorXYZ(XComponent=0, YComponent=0, ZComponent=number_slider_5)  # -> Vector, Length
vector_xyz_9 = VectorXYZ(XComponent=0, YComponent=0, ZComponent=number_slider_4)  # -> Vector, Length
counter_1 = DomainBox(Base=vector_xyz_4.Vector, X=X_5, Y=Y_5, Z=Z_5)  # disabled
vector_xyz_10 = VectorXYZ(XComponent=Slider(0, range=0..2000), YComponent=0, ZComponent=0)  # -> Vector, Length
# Objects in Level 1
counter_1_2 = DomainBox(Base=vector_xyz_6.Vector, X=X_7, Y=Y_7, Z=Z_7)
table_1 = DomainBox(Base=vector_xyz_8.Vector, X=X, Y=Y, Z=Z)
table_1_2 = DomainBox(Base=vector_xyz_9.Vector, X=X_10, Y=Y_10, Z=Z_10)
lower_bed = DomainBox(Base=vector_xyz_2.Vector, X=X_9, Y=Y_9, Z=Z_9)
move = Move(Geometry=construct_point, Motion=vector_xyz_9.Vector)  # -> Geometry, Transform
move_2 = Move(Geometry=construct_point_2, Motion=vector_xyz_6.Vector)  # -> Geometry, Transform; disabled

deconstruct_box = DeconstructBox(Box=counter_1_2)  # -> Plane, X, Y, Z
deconstruct_domain = DeconstructDomain(Domain=deconstruct_box.Y)  # -> Start, End
deconstruct_domain_2 = DeconstructDomain(Domain=deconstruct_box.Z)  # -> Start, End
margin_front = Slider(60, range=60..80)
margin_top = Slider(90, range=70..90)
margin_bottom = Slider(-72, range=-72..-69)
addition = Addition(A=deconstruct_domain.End, B=margin_front)
addition_2 = Addition(A=margin_bottom, B=deconstruct_domain_2.Start)
addition_3 = Addition(A=deconstruct_domain_2.End, B=margin_top)
back_front_margin = ConstructDomain(DomainStart=deconstruct_domain.Start, DomainEnd=addition)
top_bottom_margin = ConstructDomain(DomainStart=addition_2, DomainEnd=addition_3)
counter_1_margin = DomainBox(Base=deconstruct_box.Plane, LEFTRIGHT=deconstruct_box.X, BACKFRONT=back_front_margin, TOPBOTTOM=top_bottom_margin)

interior_door = DomainBox(Base=vector_xyz.Vector, X=Slider(100, range=90..100), Y=Slider(5, range=5..15), Z=Slider(200, range=150..220))

deconstruct_box_2 = DeconstructBox(Box=drawer)  # -> Plane, X, Y, Z; disabled
margin_front_2 = Slider(60, range=60..80)  # disabled
margin_right = Slider(60, range=0..80)  # disabled
margin_left = Slider(-60, range=-80..0)  # disabled
deconstruct_domain_3 = DeconstructDomain(Domain=deconstruct_box_2.X)  # -> Start, End; disabled
deconstruct_domain_4 = DeconstructDomain(Domain=deconstruct_box_2.Y)  # -> Start, End; disabled
addition_4 = Addition(A=margin_left, B=deconstruct_domain_3.Start)  # disabled
addition_5 = Addition(A=deconstruct_domain_3.End, B=margin_right)  # disabled
addition_6 = Addition(A=deconstruct_domain_4.End, B=margin_front_2)  # disabled
left_right_margin = ConstructDomain(DomainStart=addition_4, DomainEnd=addition_5)  # disabled
back_front_margin_2 = ConstructDomain(DomainStart=deconstruct_domain_4.Start, DomainEnd=addition_6)  # disabled
drawer_margin = DomainBox(Base=deconstruct_box_2.Plane, LEFTRIGHT=left_right_margin, BACKFRONT=back_front_margin_2, TOPBOTTOM=deconstruct_box_2.Z)  # disabled

deconstruct_box_3 = DeconstructBox(Box=counter_1)  # -> Plane, X, Y, Z; disabled
deconstruct_domain_5 = DeconstructDomain(Domain=deconstruct_box_3.Z)  # -> Start, End; disabled
deconstruct_domain_6 = DeconstructDomain(Domain=deconstruct_box_3.Y)  # -> Start, End; disabled
margin_back = Slider(-60, range=-80..-60)  # disabled
margin_front_3 = Slider(60, range=60..80)  # disabled
margin_bottom_2 = Slider(-72, range=-72..-69)  # disabled
margin_top_2 = Slider(90, range=70..90)  # disabled
addition_7 = Addition(A=margin_back, B=deconstruct_domain_6.Start)  # disabled
addition_8 = Addition(A=margin_bottom_2, B=deconstruct_domain_5.Start)  # disabled
addition_9 = Addition(A=deconstruct_domain_5.End, B=margin_top_2)  # disabled
addition_10 = Addition(A=deconstruct_domain_6.End, B=margin_front_3)  # disabled
top_bottom_margin_2 = ConstructDomain(DomainStart=addition_8, DomainEnd=addition_9)  # disabled
back_front_margin_3 = ConstructDomain(DomainStart=addition_7, DomainEnd=addition_10)  # disabled
counter_2_margin = DomainBox(
    Base=deconstruct_box_3.Plane,
    LEFTRIGHT=deconstruct_box_3.X,
    BACKFRONT=back_front_margin_3,
    TOPBOTTOM=top_bottom_margin_2)  # disabled

deconstruct_box_4 = DeconstructBox(Box=fridge)  # -> Plane, X, Y, Z; disabled
deconstruct_domain_7 = DeconstructDomain(Domain=deconstruct_box_4.Y)  # -> Start, End; disabled
addition_11 = Addition(A=deconstruct_domain_7.End, B=X_4)  # disabled
back_front_margin_4 = ConstructDomain(DomainStart=deconstruct_domain_7.Start, DomainEnd=addition_11)  # disabled
fridge_margin = DomainBox(
    Base=deconstruct_box_4.Plane,
    LEFTRIGHT=deconstruct_box_4.X,
    BACKFRONT=back_front_margin_4,
    TOPBOTTOM=deconstruct_box_4.Z)  # disabled

deconstruct_box_5 = DeconstructBox(Box=lower_bed)  # -> Plane, X, Y, Z
margin_top_3 = Slider(90, range=70..90)
margin_bottom_3 = Slider(-40, range=-50..-40)
margin_front_4 = Slider(60, range=60..80)
deconstruct_domain_8 = DeconstructDomain(Domain=deconstruct_box_5.Z)  # -> Start, End
deconstruct_domain_9 = DeconstructDomain(Domain=deconstruct_box_5.Y)  # -> Start, End
addition_12 = Addition(A=margin_bottom_3, B=deconstruct_domain_8.Start)
addition_13 = Addition(A=deconstruct_domain_8.End, B=margin_top_3)
addition_14 = Addition(A=deconstruct_domain_9.End, B=margin_front_4)
back_front_margin_5 = ConstructDomain(DomainStart=deconstruct_domain_9.Start, DomainEnd=addition_14)
top_bottom_margin_3 = ConstructDomain(DomainStart=addition_12, DomainEnd=addition_13)
lower_bed_margin = DomainBox(
    Base=deconstruct_box_5.Plane,
    LEFTRIGHT=deconstruct_box_5.X,
    BACKFRONT=back_front_margin_5,
    TOPBOTTOM=top_bottom_margin_3)

deconstruct_box_6 = DeconstructBox(Box=table_1_2)  # -> Plane, X, Y, Z
margin_top_4 = Slider(135, range=130..135)
margin_right_2 = Slider(-60, range=-80..-50)
margin_top_5 = Slider(-78, range=-78..-66)
margin_left_2 = Slider(60, range=50..80)
deconstruct_domain_10 = DeconstructDomain(Domain=deconstruct_box_6.Z)  # -> Start, End
deconstruct_domain_11 = DeconstructDomain(Domain=deconstruct_box_6.X)  # -> Start, End
deconstruct_domain_12 = DeconstructDomain(Domain=deconstruct_box_6.Y)  # -> Start, End
margin_front_5 = Slider(60, range=50..80)
addition_15 = Addition(A=margin_right_2, B=deconstruct_domain_11.Start)
addition_16 = Addition(A=deconstruct_domain_10.End, B=margin_top_4)
addition_17 = Addition(A=deconstruct_domain_12.End, B=margin_front_5)
addition_18 = Addition(A=deconstruct_domain_11.End, B=margin_left_2)
addition_19 = Addition(A=margin_top_5, B=deconstruct_domain_10.Start)
back_front_margin_6 = ConstructDomain(DomainStart=deconstruct_domain_12.Start, DomainEnd=addition_17)
top_bottom_margin_4 = ConstructDomain(DomainStart=addition_19, DomainEnd=addition_16)
left_right_margin_2 = ConstructDomain(DomainStart=addition_15, DomainEnd=addition_18)
table_1_margin = DomainBox(
    Base=deconstruct_box_6.Plane,
    LEFTRIGHT=left_right_margin_2,
    BACKFRONT=back_front_margin_6,
    TOPBOTTOM=top_bottom_margin_4)

exterior_door = DomainBox(Base=vector_xyz_3.Vector, X=Slider(100, range=90..100), Y=Slider(10, range=5..15), Z=Slider(200, range=150..220))
changeover_zone = DomainBox(Base=vector_xyz_5.Vector, X=Slider(60, range=50..65), Y=Slider(40, range=35..45), Z=Slider(2, range=2..220))

deconstruct_box_7 = DeconstructBox(Box=table_2_2)  # -> Plane, X, Y, Z; disabled
margin_top_6 = Slider(135, range=130..135)  # disabled
margin_top_7 = Slider(-78, range=-78..-66)  # disabled
margin_right_3 = Slider(-60, range=-80..-50)  # disabled
margin_front_6 = Slider(60, range=50..80)  # disabled
margin_left_3 = Slider(60, range=50..80)  # disabled
deconstruct_domain_13 = DeconstructDomain(Domain=deconstruct_box_7.Z)  # -> Start, End; disabled
deconstruct_domain_14 = DeconstructDomain(Domain=deconstruct_box_7.X)  # -> Start, End; disabled
deconstruct_domain_15 = DeconstructDomain(Domain=deconstruct_box_7.Y)  # -> Start, End; disabled
addition_20 = Addition(A=margin_right_3, B=deconstruct_domain_14.Start)  # disabled
addition_21 = Addition(A=deconstruct_domain_13.End, B=margin_top_6)  # disabled
addition_22 = Addition(A=deconstruct_domain_15.End, B=margin_front_6)  # disabled
addition_23 = Addition(A=deconstruct_domain_14.End, B=margin_left_3)  # disabled
addition_24 = Addition(A=margin_top_7, B=deconstruct_domain_13.Start)  # disabled
back_front_margin_7 = ConstructDomain(DomainStart=deconstruct_domain_15.Start, DomainEnd=addition_22)  # disabled
top_bottom_margin_5 = ConstructDomain(DomainStart=addition_24, DomainEnd=addition_21)  # disabled
left_right_margin_3 = ConstructDomain(DomainStart=addition_20, DomainEnd=addition_23)  # disabled
table_2_margin = DomainBox(
    Base=deconstruct_box_7.Plane,
    LEFTRIGHT=left_right_margin_3,
    BACKFRONT=back_front_margin_7,
    TOPBOTTOM=top_bottom_margin_5)  # disabled

deconstruct_box_8 = DeconstructBox(Box=stove)  # -> Plane, X, Y, Z; disabled
margin_top_8 = Slider(90, range=70..90)  # disabled
deconstruct_domain_16 = DeconstructDomain(Domain=deconstruct_box_8.Z)  # -> Start, End; disabled
deconstruct_domain_17 = DeconstructDomain(Domain=deconstruct_box_8.Y)  # -> Start, End; disabled
margin_front_7 = Slider(60, range=60..80)  # disabled
addition_25 = Addition(A=deconstruct_domain_16.End, B=margin_top_8)  # disabled
addition_26 = Addition(A=deconstruct_domain_17.End, B=margin_front_7)  # disabled
back_front_margin_8 = ConstructDomain(DomainStart=deconstruct_domain_17.Start, DomainEnd=addition_26)  # disabled
top_bottom_margin_6 = ConstructDomain(DomainStart=deconstruct_domain_16.Start, DomainEnd=addition_25)  # disabled
stove_margin = DomainBox(
    Base=deconstruct_box_8.Plane,
    LEFTRIGHT=deconstruct_box_8.X,
    BACKFRONT=back_front_margin_8,
    TOPBOTTOM=top_bottom_margin_6)  # disabled

closet = DomainBox(Base=vector_xyz_7.Vector, X=Slider(230, range=110..230), Y=Slider(60, range=55..65), Z=Slider(210, range=2..220))

deconstruct_box_9 = DeconstructBox(Box=table_1)  # -> Plane, X, Y, Z
margin_right_4 = Slider(-60, range=-60..-45)
margin_left_4 = Slider(60, range=45..60)
margin_top_9 = Slider(160, range=150..160)
deconstruct_domain_18 = DeconstructDomain(Domain=deconstruct_box_9.X)  # -> Start, End
deconstruct_domain_19 = DeconstructDomain(Domain=deconstruct_box_9.Z)  # -> Start, End
deconstruct_domain_20 = DeconstructDomain(Domain=deconstruct_box_9.Y)  # -> Start, End
addition_27 = Addition(A=deconstruct_domain_19.End, B=margin_top_9)
addition_28 = Addition(A=deconstruct_domain_20.End, B="5")
addition_29 = Addition(A=margin_right_4, B=deconstruct_domain_18.Start)
addition_30 = Addition(A=deconstruct_domain_18.End, B=margin_left_4)
left_right_margin_4 = ConstructDomain(DomainStart=addition_29, DomainEnd=addition_30)
back_front_margin_9 = ConstructDomain(DomainStart=deconstruct_domain_20.Start, DomainEnd=addition_28)
top_bottom_margin_7 = ConstructDomain(DomainStart=deconstruct_domain_19.Start, DomainEnd=addition_27)
sitting_unit_margin = DomainBox(
    Base=deconstruct_box_9.Plane,
    LEFTRIGHT=left_right_margin_4,
    BACKFRONT=back_front_margin_9,
    TOPBOTTOM=top_bottom_margin_7)

deconstruct_box_10 = DeconstructBox(Box=table_2)  # -> Plane, X, Y, Z; disabled
margin_top_10 = Slider(90, range=70..90)  # disabled
margin_front_8 = Slider(60, range=60..80)  # disabled
deconstruct_domain_21 = DeconstructDomain(Domain=deconstruct_box_10.Z)  # -> Start, End; disabled
deconstruct_domain_22 = DeconstructDomain(Domain=deconstruct_box_10.Y)  # -> Start, End; disabled
addition_31 = Addition(A=deconstruct_domain_22.End, B=margin_front_8)  # disabled
addition_32 = Addition(A=deconstruct_domain_21.End, B=margin_top_10)  # disabled
back_front_margin_10 = ConstructDomain(DomainStart=deconstruct_domain_22.Start, DomainEnd=addition_31)  # disabled
top_bottom_margin_8 = ConstructDomain(DomainStart=deconstruct_domain_21.Start, DomainEnd=addition_32)  # disabled
table_2_margin_2 = DomainBox(
    Base=deconstruct_box_10.Plane,
    LEFTRIGHT=deconstruct_box_10.X,
    BACKFRONT=back_front_margin_10,
    TOPBOTTOM=top_bottom_margin_8)  # disabled

closet_2 = DomainBox(Base=vector_xyz_10.Vector, X=Slider(60, range=60..230), Y=Slider(60, range=55..65), Z=Slider(210, range=2..220))
deconstruct_box_11 = DeconstructBox(Box=interior_door)  # -> Plane, X, Y, Z
deconstruct_box_12 = DeconstructBox(Box=exterior_door)  # -> Plane, X, Y, Z
deconstruct_box_13 = DeconstructBox(Box=changeover_zone)  # -> Plane, X, Y, Z
deconstruct_box_14 = DeconstructBox(Box=closet)  # -> Plane, X, Y, Z
deconstruct_box_15 = DeconstructBox(Box=closet_2)  # -> Plane, X, Y, Z
panel = Panel(deconstruct_box_11.X)
deconstruct_domain_23 = DeconstructDomain(Domain=deconstruct_box_11.Y)  # -> Start, End
panel_2 = Panel(deconstruct_box_12.X)
deconstruct_domain_24 = DeconstructDomain(Domain=deconstruct_box_12.Y)  # -> Start, End
panel_3 = Panel(deconstruct_box_13.X)
deconstruct_domain_25 = DeconstructDomain(Domain=deconstruct_box_13.Y)  # -> Start, End
deconstruct_domain_26 = DeconstructDomain(Domain=deconstruct_box_13.Z)  # -> Start, End
panel_4 = Panel(deconstruct_box_14.X)
deconstruct_domain_27 = DeconstructDomain(Domain=deconstruct_box_14.Y)  # -> Start, End
addition_33 = Addition(A=deconstruct_domain_23.End, B=Slider(80, range=0..500))
panel_5 = Panel(deconstruct_box_15.X)
deconstruct_domain_28 = DeconstructDomain(Domain=deconstruct_box_15.Y)  # -> Start, End
addition_34 = Addition(A=deconstruct_domain_24.End, B=Slider(100, range=0..500))
addition_35 = Addition(A=deconstruct_domain_25.End, B=Slider(60, range=0..60))
addition_36 = Addition(A=deconstruct_domain_26.End, B=Slider(210, range=0..210))
addition_37 = Addition(A=deconstruct_domain_23.Start, B=Slider(-80, range=-80..500))
# Margin :  Front 80
construct_domain = ConstructDomain(DomainStart=addition_37, DomainEnd=addition_33)
addition_38 = Addition(A=deconstruct_domain_27.End, B=Slider(65, range=0..500))
# Margin :  Front 100
construct_domain_2 = ConstructDomain(DomainStart=deconstruct_domain_24.Start, DomainEnd=addition_34)
addition_39 = Addition(A=deconstruct_domain_28.End, B=Slider(65, range=0..500))
construct_domain_3 = ConstructDomain(DomainStart=deconstruct_domain_25.Start, DomainEnd=addition_35)
# Margin :  Front 60
# Margin :  Top 210
construct_domain_4 = ConstructDomain(DomainStart=deconstruct_domain_26.Start, DomainEnd=addition_36)
# Margin : 65
construct_domain_5 = ConstructDomain(DomainStart=deconstruct_domain_27.Start, DomainEnd=addition_38)
# Margin : 65
construct_domain_6 = ConstructDomain(DomainStart=deconstruct_domain_28.Start, DomainEnd=addition_39)
panel_6 = Panel(construct_domain)
interor_door_margin = DomainBox(Base=interior_door, X=deconstruct_box_11.X, Y=construct_domain, Z=deconstruct_box_11.Z)
panel_7 = Panel(construct_domain_2)
change_over_zone_margin = DomainBox(Base=changeover_zone, X=deconstruct_box_13.X, Y=construct_domain_3, Z=construct_domain_4)
exterior_door_margin = DomainBox(Base=exterior_door, X=deconstruct_box_12.X, Y=construct_domain_2, Z=deconstruct_box_12.Z)
panel_8 = Panel(construct_domain_5)
panel_9 = Panel(construct_domain_4)
closet_margin = DomainBox(Base=closet, X=deconstruct_box_14.X, Y=construct_domain_5, Z=deconstruct_box_14.Z)
panel_10 = Panel(construct_domain_6)
closet_margin_2 = DomainBox(Base=closet_2, X=deconstruct_box_15.X, Y=construct_domain_6, Z=deconstruct_box_15.Z)
panel_11 = Panel(construct_domain_3)

# ----
# Upper Bed
X_11 = Slider(60, range=33..60)  # disabled
# Microwave Oven
Y_11 = Slider(58, range=30..58)  # disabled
rectangle_6 = Rectangle(Plane=PlaneXY(1700, 0, 0), XSize=X_11, YSize=Y_11, Radius=0)  # -> Rectangle, Length; disabled
Z_11 = Slider(25, range=25..41)  # disabled
microwave_oven = BoxRectangle(Rectangle=rectangle_6.Rectangle, Height=Z_11)  # disabled

X_12 = Slider(60, range=30..60)  # disabled
# Cupboard
Y_12 = Slider(45, range=30..45)  # disabled
rectangle_7 = Rectangle(Plane=PlaneXY(1900, 0, 0), XSize=X_12, YSize=Y_12, Radius=0)  # -> Rectangle, Length; disabled
Z_12 = Slider(30, range=30..50)  # disabled
# Objects in Level  2
cupboard = BoxRectangle(Rectangle=rectangle_7.Rectangle, Height=Z_12)  # disabled

X_13 = Slider(210, range=200..220)  # disabled
Y_13 = Slider(120, range=90..120)  # disabled
rectangle_8 = Rectangle(Plane=PlaneXY(2700, 0, 0), XSize=X_13, YSize=Y_13, Radius=0)  # -> Rectangle, Length; disabled
Z_13 = Slider(20, range=20..40)  # disabled
upper_bed = BoxRectangle(Rectangle=rectangle_8.Rectangle, Height=Z_13)  # disabled

# ----
# First Aid
number_slider_6 = Slider(200, range=75..200)

Y_14 = Slider(3, range=3..8)  # disabled
X_14 = Slider(60, range=43..82)  # disabled
# Monitor
division = Division(A=9, B=16)  # disabled
rectangle_9 = Rectangle(Plane=PlaneXY(2300, 0, 0), XSize=X_14, YSize=Y_14, Radius=0)  # -> Rectangle, Length; disabled
multiplication = Multiplication(A=X_14, B=division)  # disabled
monitor = BoxRectangle(Rectangle=rectangle_9.Rectangle, Height=multiplication)  # disabled

X_15 = Slider(60, range=30..60)
Y_15 = Slider(20, range=13..20)
Z_14 = Slider(60, range=30..60)

create_material = CreateMaterial(
    Diffuse=ColourSwatch(SwatchColor=RGB(120, 116, 107)),
    Specular=RGB(255, 255, 255),
    Emission=RGB(0, 0, 0),
    Transparency=Slider(0.8, range=0..1),
    Shine=0)
# Entrance
create_material_2 = CreateMaterial(
    Diffuse=ColourSwatch(SwatchColor=RGB(120, 116, 107)),
    Specular=RGB(255, 255, 255),
    Emission=RGB(0, 0, 0),
    Transparency=Slider(0.33, range=0..1),
    Shine=0)
vector_xyz_11 = VectorXYZ(XComponent=0, YComponent=0, ZComponent=number_slider_6)  # -> Vector, Length
firstaid = DomainBox(Base=vector_xyz_11.Vector, X=X_15, Y=Y_15, Z=Z_14)
create_material_3 = CreateMaterial(
    Diffuse=ColourSwatch(SwatchColor=RGB(120, 116, 107)),
    Specular=RGB(255, 255, 255),
    Emission=RGB(0, 0, 0),
    Transparency=Slider(0.8, range=0..1),
    Shine=0)
# Wet Area
create_material_4 = CreateMaterial(
    Diffuse=ColourSwatch(SwatchColor=RGB(120, 116, 107)),
    Specular=RGB(255, 255, 255),
    Emission=RGB(0, 0, 0),
    Transparency=Slider(0.33, range=0..1),
    Shine=0)
box = Box([interior_door, exterior_door, changeover_zone, closet])
box_2 = Box([interor_door_margin, exterior_door_margin, change_over_zone_margin, closet_margin])
custom_preview = CustomPreview(Geometry=box, Material=create_material_2)  # disabled
custom_preview_2 = CustomPreview(Geometry=box_2, Material=create_material)  # disabled

deconstruct_box_16 = DeconstructBox(Box=upper_bed)  # -> Plane, X, Y, Z; disabled
deconstruct_domain_29 = DeconstructDomain(Domain=deconstruct_box_16.Y)  # -> Start, End; disabled
margin_front_9 = Slider(60, range=60..80)  # disabled
deconstruct_domain_30 = DeconstructDomain(Domain=deconstruct_box_16.Z)  # -> Start, End; disabled
margin_top_11 = Slider(90, range=70..90)  # disabled
addition_40 = Addition(A=deconstruct_domain_29.End, B=margin_front_9)  # disabled
addition_41 = Addition(A=deconstruct_domain_30.End, B=margin_top_11)  # disabled
back_front_margin_11 = ConstructDomain(DomainStart=deconstruct_domain_29.Start, DomainEnd=addition_40)  # disabled
top_bottom_margin_9 = ConstructDomain(DomainStart=deconstruct_domain_30.Start, DomainEnd=addition_41)  # disabled
upper_bed_margin = DomainBox(
    Base=deconstruct_box_16.Plane,
    LEFTRIGHT=deconstruct_box_16.X,
    BACKFRONT=back_front_margin_11,
    TOPBOTTOM=top_bottom_margin_9)  # disabled

deconstruct_box_17 = DeconstructBox(Box=microwave_oven)  # -> Plane, X, Y, Z; disabled
margin_front_10 = Slider(60, range=60..80)  # disabled
deconstruct_domain_31 = DeconstructDomain(Domain=deconstruct_box_17.Y)  # -> Start, End; disabled
addition_42 = Addition(A=deconstruct_domain_31.End, B=margin_front_10)  # disabled
back_front_margin_12 = ConstructDomain(DomainStart=deconstruct_domain_31.Start, DomainEnd=addition_42)  # disabled
microwave_oven_margin = DomainBox(Base=deconstruct_box_17.Plane, LEFTRIGHT=deconstruct_box_17.X, BACKFRONT=back_front_margin_12, TOPBOTTOM=Domain(0, 0.25))  # disabled

deconstruct_box_18 = DeconstructBox(Box=firstaid)  # -> Plane, X, Y, Z
deconstruct_domain_32 = DeconstructDomain(Domain=deconstruct_box_18.Y)  # -> Start, End
addition_43 = Addition(A=deconstruct_domain_32.End, B="30")
back_front_margin_13 = ConstructDomain(DomainStart=deconstruct_domain_32.Start, DomainEnd=addition_43)
first_aid_margin = DomainBox(
    Base=deconstruct_box_18.Plane,
    LEFTRIGHT=deconstruct_box_18.X,
    BACKFRONT=back_front_margin_13,
    TOPBOTTOM=deconstruct_box_18.Z)

deconstruct_box_19 = DeconstructBox(Box=monitor)  # -> Plane, X, Y, Z; disabled
margin_front_11 = Slider(150, range=50..150)  # disabled
deconstruct_domain_33 = DeconstructDomain(Domain=deconstruct_box_19.Y)  # -> Start, End; disabled
addition_44 = Addition(A=deconstruct_domain_33.End, B=margin_front_11)  # disabled
back_front_margin_14 = ConstructDomain(DomainStart=deconstruct_domain_33.Start, DomainEnd=addition_44)  # disabled
monitor_margin = DomainBox(
    Base=deconstruct_box_19.Plane,
    LEFTRIGHT=deconstruct_box_19.X,
    BACKFRONT=back_front_margin_14,
    TOPBOTTOM=deconstruct_box_19.Z)  # disabled

deconstruct_box_20 = DeconstructBox(Box=cupboard)  # -> Plane, X, Y, Z; disabled
margin_front_12 = Slider(60, range=60..80)  # disabled
deconstruct_domain_34 = DeconstructDomain(Domain=deconstruct_box_20.Y)  # -> Start, End; disabled
addition_45 = Addition(A=deconstruct_domain_34.End, B=margin_front_12)  # disabled
back_front_margin_15 = ConstructDomain(DomainStart=deconstruct_domain_34.Start, DomainEnd=addition_45)  # disabled
cupboard_margin = DomainBox(
    Base=deconstruct_box_20.Plane,
    LEFTRIGHT=deconstruct_box_20.X,
    BACKFRONT=back_front_margin_15,
    TOPBOTTOM=deconstruct_box_20.Z)  # disabled

number_slider_7 = Slider(0.8, range=0..1)  # disabled
number_slider_8 = Slider(0.33, range=0..1)  # disabled
colour_swatch = ColourSwatch(SwatchColor=RGB(120, 116, 107))  # disabled
colour_swatch_2 = ColourSwatch(SwatchColor=RGB(120, 116, 107))  # disabled
create_material_5 = CreateMaterial(Diffuse=colour_swatch, Specular=RGB(255, 255, 255), Emission=RGB(0, 0, 0), Transparency=number_slider_7, Shine=0)  # disabled
# Common Area
create_material_6 = CreateMaterial(Diffuse=colour_swatch_2, Specular=RGB(255, 255, 255), Emission=RGB(0, 0, 0), Transparency=number_slider_8, Shine=0)  # disabled
box_3 = Box([counter_1_2, table_1_2, table_1, lower_bed])  # disabled
box_4 = Box([counter_1_margin, table_1_margin, sitting_unit_margin, lower_bed_margin])  # disabled
custom_preview_3 = CustomPreview(Geometry=box_3, Material=create_material_6)  # disabled
custom_preview_4 = CustomPreview(Geometry=box_4, Material=create_material_5)  # disabled

# ---- group: KITCHEN UNIT TYPE 1 / COUNTER 2
X_16 = Slider(0, range=0..140)
Y_16 = Slider(0, range=0..500)

thickness_of_counter = Slider(6, range=3..6)
Z_15 = Slider(72, range=69..72)
margin_top_12 = Slider(60, range=60..80)
addition_46 = Addition(A=thickness_of_counter, B=margin_top_12)
addition_47 = Addition(A=Z_15, B=thickness_of_counter)
vector_xyz_12 = VectorXYZ(XComponent=X_16, YComponent=Y_16, ZComponent=addition_47)  # -> Vector, Length
X_17 = Slider(180, range=160..280)
Y_17 = Slider(65, range=50..65)
rectangle_10 = Rectangle(Plane=vector_xyz_12.Vector, XSize=X_17, YSize=Y_17, Radius=0)  # -> Rectangle, Length
multiplication_2 = Multiplication(A=addition_47, B="-1")
counter_2 = BoxRectangle(Rectangle=rectangle_10.Rectangle, Height=thickness_of_counter)
deconstruct_box_21 = DeconstructBox(Box=counter_2)  # -> Plane, X, Y, Z
margin_back_2 = Slider(-80, range=-80..-60)  # disabled
margin_front_13 = Slider(80, range=60..80)  # disabled
deconstruct_domain_35 = DeconstructDomain(Domain=deconstruct_box_21.Y)  # -> Start, End; disabled
deconstruct_domain_36 = DeconstructDomain(Domain=deconstruct_box_21.Z)  # -> Start, End; disabled
addition_48 = Addition(A=margin_back_2, B=deconstruct_domain_35.Start)  # disabled
addition_49 = Addition(A=deconstruct_domain_35.End, B=margin_front_13)  # disabled
addition_50 = Addition(A=multiplication_2, B=deconstruct_domain_36.Start)  # disabled
addition_51 = Addition(A=deconstruct_domain_36.End, B=margin_top_12)  # disabled
back_front_margin_16 = ConstructDomain(DomainStart=addition_48, DomainEnd=addition_49)  # disabled
top_bottom_margin_10 = ConstructDomain(DomainStart=addition_50, DomainEnd=addition_51)  # disabled
counter_2_margin_2 = DomainBox(
    Base=deconstruct_box_21.Plane,
    LEFTRIGHT=deconstruct_box_21.X,
    BACKFRONT=back_front_margin_16,
    TOPBOTTOM=top_bottom_margin_10)  # disabled

# ---- group: KITCHEN UNIT TYPE 1 / cupboard
X_18 = Slider(60, range=0..140)
addition_52 = Addition(A=Y_16, B=X_18)
vector_xyz_13 = VectorXYZ(XComponent=X_16, YComponent=addition_52, ZComponent=Slider(145, range=145..170))  # -> Vector, Length
radians = Radians(Degrees=Slider(270, range=0..360))
X_19 = Slider(60, range=30..60)
Y_18 = Slider(45, range=30..45)
rotate_plane = RotatePlane(Plane=vector_xyz_13.Vector, Angle=radians)
Z_16 = Slider(30, range=30..50)
rectangle_11 = Rectangle(Plane=rotate_plane, XSize=X_19, YSize=Y_18, Radius=0)  # -> Rectangle, Length
cupboard_2 = BoxRectangle(Rectangle=rectangle_11.Rectangle, Height=Z_16)
deconstruct_box_22 = DeconstructBox(Box=cupboard_2)  # -> Plane, X, Y, Z
margin_front_14 = Slider(60, range=60..80)  # disabled
deconstruct_domain_37 = DeconstructDomain(Domain=deconstruct_box_22.Y)  # -> Start, End
addition_53 = Addition(A=deconstruct_domain_37.End, B=margin_front_14)  # disabled
back_front_margin_17 = ConstructDomain(DomainStart=deconstruct_domain_37.Start, DomainEnd=addition_53)  # disabled
cupboard_margin_2 = DomainBox(
    Base=deconstruct_box_22.Plane,
    LEFTRIGHT=deconstruct_box_22.X,
    BACKFRONT=back_front_margin_17,
    TOPBOTTOM=deconstruct_box_22.Z)  # disabled

# ---- group: KITCHEN UNIT TYPE 1 / microwave
X_20 = Slider(0, range=0..140)
addition_54 = Addition(A=Y_16, B=X_20)
vector_xyz_14 = VectorXYZ(XComponent=X_16, YComponent=addition_54, ZComponent=Slider(145, range=145..170))  # -> Vector, Length
radians_2 = Radians(Degrees=Slider(270, range=0..360))
rotate_plane_2 = RotatePlane(Plane=vector_xyz_14.Vector, Angle=radians_2)
Z_17 = Slider(30, range=30..50)
rectangle_12 = Rectangle(Plane=rotate_plane_2, XSize=X_19, YSize=Y_18, Radius=0)  # -> Rectangle, Length
microwave = BoxRectangle(Rectangle=rectangle_12.Rectangle, Height=Z_17)
deconstruct_box_23 = DeconstructBox(Box=microwave)  # -> Plane, X, Y, Z
deconstruct_domain_38 = DeconstructDomain(Domain=deconstruct_box_23.Y)  # -> Start, End
addition_55 = Addition(A=deconstruct_domain_38.End, B=margin_front_14)  # disabled
back_front_margin_18 = ConstructDomain(DomainStart=deconstruct_domain_38.Start, DomainEnd=addition_55)  # disabled
microwave_margin = DomainBox(
    Base=deconstruct_box_23.Plane,
    LEFTRIGHT=deconstruct_box_23.X,
    BACKFRONT=back_front_margin_18,
    TOPBOTTOM=deconstruct_box_23.Z)  # disabled

# ---- group: KITCHEN UNIT TYPE 1 / fridge
X_21 = Slider(110, range=0..210)
addition_56 = Addition(A=X_16, B=X_21)
vector_xyz_15 = VectorXYZ(XComponent=addition_56, YComponent=Y_16, ZComponent=0)  # -> Vector, Length
X_22 = Slider(70, range=55..70)
Y_19 = Slider(65, range=50..65)
rectangle_13 = Rectangle(Plane=vector_xyz_15.Vector, XSize=X_22, YSize=Y_19, Radius=0)  # -> Rectangle, Length
Z_18 = Slider(78, range=72..78)
fridge_2 = BoxRectangle(Rectangle=rectangle_13.Rectangle, Height=Z_18)
deconstruct_box_24 = DeconstructBox(Box=fridge_2)  # -> Plane, X, Y, Z
deconstruct_domain_39 = DeconstructDomain(Domain=deconstruct_box_24.Y)  # -> Start, End
addition_57 = Addition(A=deconstruct_domain_39.End, B=X_22)  # disabled
back_front_margin_19 = ConstructDomain(DomainStart=deconstruct_domain_39.Start, DomainEnd=addition_57)  # disabled
fridge_margin_2 = DomainBox(
    Base=deconstruct_box_24.Plane,
    LEFTRIGHT=deconstruct_box_24.X,
    BACKFRONT=back_front_margin_19,
    TOPBOTTOM=deconstruct_box_24.Z)  # disabled

# ---- group: KITCHEN UNIT TYPE 1 / sink
Y_20 = Slider(0, range=0..220)
addition_58 = Addition(A=X_16, B=Y_20)
addition_59 = Addition(A=addition_47, B=thickness_of_counter)
vector_xyz_16 = VectorXYZ(XComponent=addition_58, YComponent=Y_16, ZComponent=addition_59)  # -> Vector, Length
Y_21 = Slider(38, range=38..50)
X_23 = Slider(60, range=38..60)
Z_19 = Slider(13, range=13..22)
rectangle_14 = Rectangle(Plane=vector_xyz_16.Vector, XSize=X_23, YSize=Y_21, Radius=0)  # -> Rectangle, Length
table_2_3 = BoxRectangle(Rectangle=rectangle_14.Rectangle, Height=Z_19)
deconstruct_box_25 = DeconstructBox(Box=table_2_3)  # -> Plane, X, Y, Z
margin_top_13 = Slider(70, range=70..90)
margin_front_15 = Slider(60, range=60..80)  # disabled
deconstruct_domain_40 = DeconstructDomain(Domain=deconstruct_box_25.Y)  # -> Start, End
deconstruct_domain_41 = DeconstructDomain(Domain=deconstruct_box_25.Z)  # -> Start, End
addition_60 = Addition(A=deconstruct_domain_40.End, B=margin_front_15)  # disabled
addition_61 = Addition(A=deconstruct_domain_41.End, B=margin_top_13)  # disabled
back_front_margin_20 = ConstructDomain(DomainStart=deconstruct_domain_40.Start, DomainEnd=addition_60)  # disabled
top_bottom_margin_11 = ConstructDomain(DomainStart=deconstruct_domain_41.Start, DomainEnd=addition_61)  # disabled
table_2_margin_3 = DomainBox(
    Base=deconstruct_box_25.Plane,
    LEFTRIGHT=deconstruct_box_25.X,
    BACKFRONT=back_front_margin_20,
    TOPBOTTOM=top_bottom_margin_11)  # disabled

# ---- group: KITCHEN UNIT TYPE 1 / stove
X_24 = Slider(140, range=0..240)
addition_62 = Addition(A=X_16, B=X_24)
vector_xyz_17 = VectorXYZ(XComponent=addition_62, YComponent=Y_16, ZComponent=addition_59)  # -> Vector, Length
X_25 = Slider(40, range=26..40)
Y_22 = Slider(58, range=48..58)
Z_20 = Slider(15, range=15..22)
rectangle_15 = Rectangle(Plane=vector_xyz_17.Vector, XSize=X_25, YSize=Y_22, Radius=0)  # -> Rectangle, Length
stove_2 = BoxRectangle(Rectangle=rectangle_15.Rectangle, Height=Z_20)
deconstruct_box_26 = DeconstructBox(Box=stove_2)  # -> Plane, X, Y, Z
deconstruct_domain_42 = DeconstructDomain(Domain=deconstruct_box_26.Z)  # -> Start, End
margin_top_14 = Slider(70, range=70..90)
deconstruct_domain_43 = DeconstructDomain(Domain=deconstruct_box_26.Y)  # -> Start, End
margin_front_16 = Slider(80, range=60..80)
addition_63 = Addition(A=deconstruct_domain_42.End, B=margin_top_14)  # disabled
addition_64 = Addition(A=deconstruct_domain_43.End, B=margin_front_16)  # disabled
back_front_margin_21 = ConstructDomain(DomainStart=deconstruct_domain_43.Start, DomainEnd=addition_64)  # disabled
top_bottom_margin_12 = ConstructDomain(DomainStart=deconstruct_domain_42.Start, DomainEnd=addition_63)  # disabled
stove_margin_2 = DomainBox(
    Base=deconstruct_box_26.Plane,
    LEFTRIGHT=deconstruct_box_26.X,
    BACKFRONT=back_front_margin_21,
    TOPBOTTOM=top_bottom_margin_12)  # disabled

# ---- group: KITCHEN UNIT TYPE 1 / sitting unit 1
Z_21 = Slider(6, range=2..6)
addition_65 = Addition(A=Slider(35, range=35..45), B=Z_21)
addition_66 = Addition(A=Y_16, B=Y_17)
vector_xyz_18 = VectorXYZ(XComponent=X_16, YComponent=addition_66, ZComponent=addition_65)  # -> Vector, Length
Y_23 = Slider(60, range=45..60)
rectangle_16 = Rectangle(Plane=vector_xyz_18.Vector, XSize=X_17, YSize=Y_23, Radius=0)  # -> Rectangle, Length
sitting_unit = BoxRectangle(Rectangle=rectangle_16.Rectangle, Height=Z_21)
deconstruct_box_27 = DeconstructBox(Box=sitting_unit)  # -> Plane, X, Y, Z
margin_bottom_4 = Slider(-40, range=-55..-40)  # disabled
margin_top_15 = Slider(135, range=130..135)  # disabled
margin_front_17 = Slider(10, range=5..10)  # disabled
margin_left_5 = Slider(80, range=50..80)  # disabled
deconstruct_domain_44 = DeconstructDomain(Domain=deconstruct_box_27.Z)  # -> Start, End
deconstruct_domain_45 = DeconstructDomain(Domain=deconstruct_box_27.X)  # -> Start, End
deconstruct_domain_46 = DeconstructDomain(Domain=deconstruct_box_27.Y)  # -> Start, End
addition_67 = Addition(A=deconstruct_domain_44.End, B=margin_top_15)  # disabled
addition_68 = Addition(A=deconstruct_domain_46.End, B=margin_front_17)  # disabled
addition_69 = Addition(A=deconstruct_domain_45.End, B=margin_left_5)  # disabled
addition_70 = Addition(A=margin_bottom_4, B=deconstruct_domain_44.Start)  # disabled
back_front_margin_22 = ConstructDomain(DomainStart=deconstruct_domain_46.Start, DomainEnd=addition_68)  # disabled
top_bottom_margin_13 = ConstructDomain(DomainStart=addition_70, DomainEnd=addition_67)  # disabled
left_right_margin_5 = ConstructDomain(DomainStart=deconstruct_domain_45.Start, DomainEnd=addition_69)  # disabled
sitting_unit_1_margin = DomainBox(
    Base=deconstruct_box_27.Plane,
    LEFTRIGHT=left_right_margin_5,
    BACKFRONT=back_front_margin_22,
    TOPBOTTOM=top_bottom_margin_13)  # disabled

# ----
# We multiply all values by 10 so we want to be sure they have a common number to be divided
number_slider_9 = Slider(10, range=0..10)

# ----
# Height
number_slider_10 = Slider(30, range=0..100)
multiplication_3 = Multiplication(A=number_slider_10, B=number_slider_9)
panel_12 = Panel(multiplication_3)

# ----
# Pre-Calculations for Area Calculations
# Divide to Layer number
number_slider_11 = Slider(6, range=2..10)
multiplication_4 = Multiplication(A=number_slider_11, B=number_slider_9)
panel_13 = Panel(multiplication_4)
multiplication_5 = Multiplication(A=Slider(10000, range=0..10000), B=Slider(2, range=0..10))
multiplication_6 = Multiplication(A=multiplication_4, B=multiplication_4)
division_2 = Division(A=multiplication_6, B=multiplication_5)

# ----
# Length
number_slider_12 = Slider(66, range=20..66)
multiplication_7 = Multiplication(A=number_slider_12, B=number_slider_9)
panel_14 = Panel(multiplication_7)
division_3 = Division(A=multiplication_7, B=multiplication_4)

# ----
# Width
number_slider_13 = Slider(36, range=20..60)
multiplication_8 = Multiplication(A=number_slider_13, B=number_slider_9)
panel_15 = Panel(multiplication_8)
division_4 = Division(A=multiplication_8, B=multiplication_4)

number_slider_14 = Slider(10, range=0..10)
panel_16 = Panel(division_4)
multiplication_9 = Multiplication(A=Slider(30, range=0..100), B=number_slider_14)
multiplication_10 = Multiplication(A=Slider(60, range=20..60), B=number_slider_14)
multiplication_11 = Multiplication(A=Slider(6, range=2..10), B=number_slider_14)
multiplication_12 = Multiplication(A=Slider(36, range=20..60), B=number_slider_14)
panel_17 = Panel(multiplication_9)
panel_18 = Panel(multiplication_12)
panel_19 = Panel(multiplication_10)
multiplication_13 = Multiplication(A=multiplication_11, B=multiplication_11)
integer = Integer(division_4)
integer_2 = Integer(division_3)
box_5 = Box(closet_margin)
integer_3 = Integer(panel_12)
box_6 = Box(changeover_zone)
box_7 = Box(closet)
box_8 = Box(interior_door)
box_9 = Box(interor_door_margin)
box_10 = Box(exterior_door)
box_11 = Box(exterior_door_margin)
box_12 = Box(counter_1_2)
box_13 = Box(counter_1_margin)
box_14 = Box(change_over_zone_margin)
box_15 = Box(table_1_2)
box_16 = Box(table_1_margin)
box_17 = Box(lower_bed_margin)
box_18 = Box(table_1)
box_19 = Box(lower_bed)
box_20 = Box(firstaid)
box_21 = Box(first_aid_margin)
box_22 = Box(sitting_unit_margin)
division_5 = Division(A=multiplication_10, B=multiplication_11)
panel_20 = Panel(multiplication_11)
division_6 = Division(A=multiplication_12, B=multiplication_11)
multiplication_14 = Multiplication(A=Slider(10000, range=0..10000), B=Slider(2, range=0..10))
division_7 = Division(A=multiplication_13, B=multiplication_14)
panel_21 = Panel(division_6)
integer_4 = Integer(division_6)
integer_5 = Integer(division_5)
integer_6 = Integer(panel_17)
box_23 = Box(closet_margin)
box_24 = Box(changeover_zone)
box_25 = Box(closet)
box_26 = Box(interior_door)
box_27 = Box(interor_door_margin)
box_28 = Box(exterior_door)
c_script = CSharpScript(boxx=box_28)  # -> out, lenght; inputs boxx: Box; disabled
# ---------- c_script: C# ----------
    List < int> growDirection = new List<int>{9};

  
    int a = growDirection[0];

    Rhino.RhinoApp.WriteLine(growDirection.Count.ToString());
 
    switch (a) 
    ​{ 
      case 9:
        if (  false )
        {
        }
        else
          growDirection.Remove(a);
        Rhino.RhinoApp.WriteLine(growDirection.Count.ToString());
        break;
    }
# ---------- end c_script ----------
panel_22 = Panel(c_script.out)
box_29 = Box(exterior_door_margin)
box_30 = Box(counter_1_2)
box_31 = Box(counter_1_margin)
box_32 = Box(change_over_zone_margin)
box_33 = Box(table_1_2)
box_34 = Box(table_1_margin)
box_35 = Box(lower_bed_margin)
box_36 = Box(table_1)
box_37 = Box(sitting_unit_margin)
box_38 = Box(firstaid)
box_39 = Box(first_aid_margin)
box_40 = Box(lower_bed)
colour_swatch_3 = ColourSwatch(SwatchColor=RGB(255, 255, 0))
colour_swatch_4 = ColourSwatch(SwatchColor=RGB(0, 0, 0))
colour_swatch_5 = ColourSwatch(SwatchColor=RGB(255, 255, 255))
colour_swatch_6 = ColourSwatch(SwatchColor=RGB(240, 240, 200))
colour_swatch_7 = ColourSwatch(SwatchColor=RGB(240, 200, 200))
colour_swatch_8 = ColourSwatch(SwatchColor=RGB(150, 200, 255))

# ---- group: KITCHEN UNIT TYPE 1
kitchen_unit_type_i = Merge(Data1=counter_2, Data2=table_2_3, Data3=fridge_2, Data4=stove_2, Data5=cupboard_2, Data6=microwave, Data7=sitting_unit)  # disabled
kitchen_unit_type_i_margin = Merge(
    Data1=counter_2_margin_2,
    Data2=table_2_margin_3,
    Data3=fridge_margin_2,
    Data4=stove_margin_2,
    Data5=cupboard_margin_2,
    Data6=microwave_margin,
    Data7=sitting_unit_1_margin)  # disabled

# ----
create_material_7 = CreateMaterial(
    Diffuse=ColourSwatch(SwatchColor=RGB(0, 0, 0)),
    Specular=RGB(255, 255, 255),
    Emission=RGB(0, 0, 0),
    Transparency=Slider(0.7, range=0..1),
    Shine=0)
create_material_8 = CreateMaterial(
    Diffuse=ColourSwatch(SwatchColor=RGB(120, 116, 107)),
    Specular=RGB(255, 255, 255),
    Emission=RGB(0, 0, 0),
    Transparency=Slider(0.8, range=0..1),
    Shine=0)
colour_swatch_9 = ColourSwatch(SwatchColor=RGB(255, 255, 0))
colour_swatch_10 = ColourSwatch(SwatchColor=RGB(0, 0, 0))
colour_swatch_11 = ColourSwatch(SwatchColor=RGB(255, 255, 255))
colour_swatch_12 = ColourSwatch(SwatchColor=RGB(240, 240, 200))
colour_swatch_13 = ColourSwatch(SwatchColor=RGB(240, 200, 200))
colour_swatch_14 = ColourSwatch(SwatchColor=RGB(150, 200, 255))
panel_23 = Panel(kitchen_unit_type_i)  # disabled
create_material_9 = CreateMaterial(
    Diffuse=ColourSwatch(SwatchColor=RGB(0, 0, 0)),
    Specular=RGB(255, 255, 255),
    Emission=RGB(0, 0, 0),
    Transparency=Slider(0, range=0..1),
    Shine=0)
create_material_10 = CreateMaterial(
    Diffuse=ColourSwatch(SwatchColor=RGB(120, 116, 107)),
    Specular=RGB(255, 255, 255),
    Emission=RGB(0, 0, 0),
    Transparency=Slider(0.8, range=0..1),
    Shine=0)

# ---- group: KITCHEN UNIT TYPE II / COUNTER 2
X_26 = Slider(0, range=0..140)  # disabled
Y_24 = Slider(500, range=0..500)  # disabled

thickness_of_counter_2 = Slider(6, range=3..6)  # disabled
Z_22 = Slider(72, range=69..72)  # disabled
margin_top_16 = Slider(60, range=60..80)  # disabled
addition_71 = Addition(A=Z_22, B=thickness_of_counter_2)  # disabled
addition_72 = Addition(A=thickness_of_counter_2, B=margin_top_16)  # disabled
vector_xyz_19 = VectorXYZ(XComponent=X_26, YComponent=Y_24, ZComponent=addition_71)  # -> Vector, Length; disabled
X_27 = Slider(180, range=160..280)  # disabled
Y_25 = Slider(65, range=50..65)  # disabled
panel_24 = Panel("-1")  # disabled
rectangle_17 = Rectangle(Plane=vector_xyz_19.Vector, XSize=X_27, YSize=Y_25, Radius=0)  # -> Rectangle, Length; disabled
multiplication_15 = Multiplication(A=addition_71, B=panel_24)  # disabled
counter_2_2 = BoxRectangle(Rectangle=rectangle_17.Rectangle, Height=thickness_of_counter_2)  # disabled
deconstruct_box_28 = DeconstructBox(Box=counter_2_2)  # -> Plane, X, Y, Z; disabled
margin_back_3 = Slider(-80, range=-80..-60)  # disabled
margin_front_18 = Slider(80, range=60..80)  # disabled
deconstruct_domain_47 = DeconstructDomain(Domain=deconstruct_box_28.Y)  # -> Start, End; disabled
deconstruct_domain_48 = DeconstructDomain(Domain=deconstruct_box_28.Z)  # -> Start, End; disabled
addition_73 = Addition(A=margin_back_3, B=deconstruct_domain_47.Start)  # disabled
addition_74 = Addition(A=deconstruct_domain_47.End, B=margin_front_18)  # disabled
addition_75 = Addition(A=multiplication_15, B=deconstruct_domain_48.Start)  # disabled
addition_76 = Addition(A=deconstruct_domain_48.End, B=margin_top_16)  # disabled
back_front_margin_23 = ConstructDomain(DomainStart=addition_73, DomainEnd=addition_74)  # disabled
top_bottom_margin_14 = ConstructDomain(DomainStart=addition_75, DomainEnd=addition_76)  # disabled
counter_2_margin_3 = DomainBox(
    Base=deconstruct_box_28.Plane,
    LEFTRIGHT=deconstruct_box_28.X,
    BACKFRONT=back_front_margin_23,
    TOPBOTTOM=top_bottom_margin_14)  # disabled

# ---- group: KITCHEN UNIT TYPE II / cupboard
X_28 = Slider(60, range=0..140)  # disabled
number_slider_15 = Slider(145, range=145..170)  # disabled
addition_77 = Addition(A=Y_24, B=X_28)  # disabled
number_slider_16 = Slider(270, range=0..360)  # disabled
vector_xyz_20 = VectorXYZ(XComponent=X_26, YComponent=addition_77, ZComponent=number_slider_15)  # -> Vector, Length; disabled
radians_3 = Radians(Degrees=number_slider_16)  # disabled
X_29 = Slider(60, range=30..60)  # disabled
Y_26 = Slider(45, range=30..45)  # disabled
rotate_plane_3 = RotatePlane(Plane=vector_xyz_20.Vector, Angle=radians_3)  # disabled
Z_23 = Slider(30, range=30..50)  # disabled
rectangle_18 = Rectangle(Plane=rotate_plane_3, XSize=X_29, YSize=Y_26, Radius=0)  # -> Rectangle, Length; disabled
cupboard_3 = BoxRectangle(Rectangle=rectangle_18.Rectangle, Height=Z_23)  # disabled
deconstruct_box_29 = DeconstructBox(Box=cupboard_3)  # -> Plane, X, Y, Z; disabled
margin_front_19 = Slider(60, range=60..80)  # disabled
deconstruct_domain_49 = DeconstructDomain(Domain=deconstruct_box_29.Y)  # -> Start, End; disabled
addition_78 = Addition(A=deconstruct_domain_49.End, B=margin_front_19)  # disabled
back_front_margin_24 = ConstructDomain(DomainStart=deconstruct_domain_49.Start, DomainEnd=addition_78)  # disabled
cupboard_margin_3 = DomainBox(
    Base=deconstruct_box_29.Plane,
    LEFTRIGHT=deconstruct_box_29.X,
    BACKFRONT=back_front_margin_24,
    TOPBOTTOM=deconstruct_box_29.Z)  # disabled

# ---- group: KITCHEN UNIT TYPE II / microwave
X_30 = Slider(0, range=0..140)  # disabled
number_slider_17 = Slider(145, range=145..170)  # disabled
addition_79 = Addition(A=Y_24, B=X_30)  # disabled
number_slider_18 = Slider(270, range=0..360)  # disabled
vector_xyz_21 = VectorXYZ(XComponent=X_26, YComponent=addition_79, ZComponent=number_slider_17)  # -> Vector, Length; disabled
radians_4 = Radians(Degrees=number_slider_18)  # disabled
rotate_plane_4 = RotatePlane(Plane=vector_xyz_21.Vector, Angle=radians_4)  # disabled
Z_24 = Slider(30, range=30..50)  # disabled
rectangle_19 = Rectangle(Plane=rotate_plane_4, XSize=X_29, YSize=Y_26, Radius=0)  # -> Rectangle, Length; disabled
microwave_2 = BoxRectangle(Rectangle=rectangle_19.Rectangle, Height=Z_24)  # disabled
deconstruct_box_30 = DeconstructBox(Box=microwave_2)  # -> Plane, X, Y, Z; disabled
deconstruct_domain_50 = DeconstructDomain(Domain=deconstruct_box_30.Y)  # -> Start, End; disabled
addition_80 = Addition(A=deconstruct_domain_50.End, B=margin_front_19)  # disabled
back_front_margin_25 = ConstructDomain(DomainStart=deconstruct_domain_50.Start, DomainEnd=addition_80)  # disabled
microwave_margin_2 = DomainBox(
    Base=deconstruct_box_30.Plane,
    LEFTRIGHT=deconstruct_box_30.X,
    BACKFRONT=back_front_margin_25,
    TOPBOTTOM=deconstruct_box_30.Z)  # disabled

# ---- group: KITCHEN UNIT TYPE II / fridge
X_31 = Slider(110, range=0..210)  # disabled
addition_81 = Addition(A=X_26, B=X_31)  # disabled
vector_xyz_22 = VectorXYZ(XComponent=addition_81, YComponent=Y_24, ZComponent=0)  # -> Vector, Length; disabled
X_32 = Slider(70, range=55..70)  # disabled
Y_27 = Slider(65, range=50..65)  # disabled
rectangle_20 = Rectangle(Plane=vector_xyz_22.Vector, XSize=X_32, YSize=Y_27, Radius=0)  # -> Rectangle, Length; disabled
Z_25 = Slider(78, range=72..78)  # disabled
fridge_3 = BoxRectangle(Rectangle=rectangle_20.Rectangle, Height=Z_25)  # disabled
deconstruct_box_31 = DeconstructBox(Box=fridge_3)  # -> Plane, X, Y, Z; disabled
deconstruct_domain_51 = DeconstructDomain(Domain=deconstruct_box_31.Y)  # -> Start, End; disabled
addition_82 = Addition(A=deconstruct_domain_51.End, B=X_32)  # disabled
back_front_margin_26 = ConstructDomain(DomainStart=deconstruct_domain_51.Start, DomainEnd=addition_82)  # disabled
fridge_margin_3 = DomainBox(
    Base=deconstruct_box_31.Plane,
    LEFTRIGHT=deconstruct_box_31.X,
    BACKFRONT=back_front_margin_26,
    TOPBOTTOM=deconstruct_box_31.Z)  # disabled

# ----
number_slider_19 = Slider(15, range=0..100)

# ---- group: KITCHEN UNIT TYPE II / sink
Y_28 = Slider(0, range=0..220)  # disabled
addition_83 = Addition(A=X_26, B=Y_28)  # disabled
addition_84 = Addition(A=addition_71, B=thickness_of_counter_2)  # disabled
vector_xyz_23 = VectorXYZ(XComponent=addition_83, YComponent=Y_24, ZComponent=addition_84)  # -> Vector, Length; disabled
Y_29 = Slider(38, range=38..50)  # disabled
X_33 = Slider(60, range=38..60)  # disabled
Z_26 = Slider(13, range=13..22)  # disabled
rectangle_21 = Rectangle(Plane=vector_xyz_23.Vector, XSize=X_33, YSize=Y_29, Radius=0)  # -> Rectangle, Length; disabled
table_2_4 = BoxRectangle(Rectangle=rectangle_21.Rectangle, Height=Z_26)  # disabled
deconstruct_box_32 = DeconstructBox(Box=table_2_4)  # -> Plane, X, Y, Z; disabled
margin_top_17 = Slider(70, range=70..90)  # disabled
margin_front_20 = Slider(60, range=60..80)  # disabled
deconstruct_domain_52 = DeconstructDomain(Domain=deconstruct_box_32.Y)  # -> Start, End; disabled
deconstruct_domain_53 = DeconstructDomain(Domain=deconstruct_box_32.Z)  # -> Start, End; disabled
addition_85 = Addition(A=deconstruct_domain_52.End, B=margin_front_20)  # disabled
addition_86 = Addition(A=deconstruct_domain_53.End, B=margin_top_17)  # disabled
back_front_margin_27 = ConstructDomain(DomainStart=deconstruct_domain_52.Start, DomainEnd=addition_85)  # disabled
top_bottom_margin_15 = ConstructDomain(DomainStart=deconstruct_domain_53.Start, DomainEnd=addition_86)  # disabled
table_2_margin_4 = DomainBox(
    Base=deconstruct_box_32.Plane,
    LEFTRIGHT=deconstruct_box_32.X,
    BACKFRONT=back_front_margin_27,
    TOPBOTTOM=top_bottom_margin_15)  # disabled

# ---- group: KITCHEN UNIT TYPE II / stove
X_34 = Slider(140, range=0..240)  # disabled
addition_87 = Addition(A=X_26, B=X_34)  # disabled
vector_xyz_24 = VectorXYZ(XComponent=addition_87, YComponent=Y_24, ZComponent=addition_84)  # -> Vector, Length; disabled
X_35 = Slider(40, range=26..40)  # disabled
Y_30 = Slider(58, range=48..58)  # disabled
Z_27 = Slider(15, range=15..22)  # disabled
rectangle_22 = Rectangle(Plane=vector_xyz_24.Vector, XSize=X_35, YSize=Y_30, Radius=0)  # -> Rectangle, Length; disabled
stove_3 = BoxRectangle(Rectangle=rectangle_22.Rectangle, Height=Z_27)  # disabled
deconstruct_box_33 = DeconstructBox(Box=stove_3)  # -> Plane, X, Y, Z; disabled
margin_top_18 = Slider(70, range=70..90)  # disabled
deconstruct_domain_54 = DeconstructDomain(Domain=deconstruct_box_33.Z)  # -> Start, End; disabled
deconstruct_domain_55 = DeconstructDomain(Domain=deconstruct_box_33.Y)  # -> Start, End; disabled
margin_front_21 = Slider(80, range=60..80)  # disabled
addition_88 = Addition(A=deconstruct_domain_54.End, B=margin_top_18)  # disabled
addition_89 = Addition(A=deconstruct_domain_55.End, B=margin_front_21)  # disabled
back_front_margin_28 = ConstructDomain(DomainStart=deconstruct_domain_55.Start, DomainEnd=addition_89)  # disabled
top_bottom_margin_16 = ConstructDomain(DomainStart=deconstruct_domain_54.Start, DomainEnd=addition_88)  # disabled
stove_margin_3 = DomainBox(
    Base=deconstruct_box_33.Plane,
    LEFTRIGHT=deconstruct_box_33.X,
    BACKFRONT=back_front_margin_28,
    TOPBOTTOM=top_bottom_margin_16)  # disabled

# ----
panel_25 = Panel("m2 ")  # disabled
panel_26 = Panel(" Entrance = ")  # disabled
panel_27 = Panel(" Empty Space= ")  # disabled
panel_28 = Panel("m2 ")  # disabled
panel_29 = Panel("m2 ")  # disabled
panel_30 = Panel(" CommonArea = ")  # disabled
panel_31 = Panel("m2 ")  # disabled
panel_32 = Panel("Wet Area = ")  # disabled
panel_33 = Panel(" Common Area = ")  # disabled
panel_34 = Panel("m2 ")  # disabled
panel_35 = Panel(" Kitchen = ")  # disabled
panel_36 = Panel(" m2 ")  # disabled
number_slider_20 = Slider(15, range=0..100)  # disabled
panel_37 = Panel("0,-50")  # disabled
panel_38 = Panel("0,-80")  # disabled
panel_39 = Panel("0,-140")  # disabled
panel_40 = Panel("-1")  # disabled
panel_41 = Panel("120,-200")
panel_42 = Panel("240,-170")  # disabled
panel_43 = Panel("0,-110")  # disabled
panel_44 = Panel("120,-200")  # disabled
number_slider_21 = Slider(1, range=0..1)  # disabled
panel_45 = Panel(" Total Area =")  # disabled
panel_46 = Panel("m2 ")  # disabled
panel_47 = Panel("240,-100")  # disabled

# ---- group: KITCHEN UNIT TYPE III / COUNTER 2
# Kitchen Unit Blocks
X_36 = Slider(0, range=0..140)  # disabled
Y_31 = Slider(1000, range=0..1000)  # disabled

thickness_of_counter_3 = Slider(6, range=3..6)  # disabled
Z_28 = Slider(72, range=69..72)  # disabled
margin_top_19 = Slider(60, range=60..80)  # disabled
addition_90 = Addition(A=Z_28, B=thickness_of_counter_3)  # disabled
addition_91 = Addition(A=thickness_of_counter_3, B=margin_top_19)  # disabled
vector_xyz_25 = VectorXYZ(XComponent=X_36, YComponent=Y_31, ZComponent=addition_90)  # -> Vector, Length; disabled
Y_32 = Slider(65, range=50..65)  # disabled
X_37 = Slider(180, range=160..280)  # disabled
panel_48 = Panel("-1")  # disabled
rectangle_23 = Rectangle(Plane=vector_xyz_25.Vector, XSize=X_37, YSize=Y_32, Radius=0)  # -> Rectangle, Length; disabled
multiplication_16 = Multiplication(A=addition_90, B=panel_48)  # disabled
counter_2_3 = BoxRectangle(Rectangle=rectangle_23.Rectangle, Height=thickness_of_counter_3)  # disabled
deconstruct_box_34 = DeconstructBox(Box=counter_2_3)  # -> Plane, X, Y, Z; disabled
margin_front_22 = Slider(80, range=60..80)  # disabled
deconstruct_domain_56 = DeconstructDomain(Domain=deconstruct_box_34.Y)  # -> Start, End; disabled
deconstruct_domain_57 = DeconstructDomain(Domain=deconstruct_box_34.Z)  # -> Start, End; disabled
addition_92 = Addition(A=deconstruct_domain_56.End, B=margin_front_22)  # disabled
addition_93 = Addition(A=multiplication_16, B=deconstruct_domain_57.Start)  # disabled
addition_94 = Addition(A=deconstruct_domain_57.End, B=margin_top_19)  # disabled
back_front_margin_29 = ConstructDomain(DomainStart=deconstruct_domain_56.Start, DomainEnd=addition_92)  # disabled
top_bottom_margin_17 = ConstructDomain(DomainStart=addition_93, DomainEnd=addition_94)  # disabled
counter_2_margin_4 = DomainBox(
    Base=deconstruct_box_34.Plane,
    LEFTRIGHT=deconstruct_box_34.X,
    BACKFRONT=back_front_margin_29,
    TOPBOTTOM=top_bottom_margin_17)  # disabled

# ----
X_38 = Slider(0, range=0..240)  # disabled
X_39 = Slider(64, range=0..240)  # disabled

# ---- group: KITCHEN UNIT TYPE III / fridge
X_40 = Slider(110, range=0..210)  # disabled
addition_95 = Addition(A=X_36, B=X_40)  # disabled
vector_xyz_26 = VectorXYZ(XComponent=addition_95, YComponent=Y_31, ZComponent=0)  # -> Vector, Length; disabled
X_41 = Slider(70, range=55..70)  # disabled
Y_33 = Slider(65, range=50..65)  # disabled
rectangle_24 = Rectangle(Plane=vector_xyz_26.Vector, XSize=X_41, YSize=Y_33, Radius=0)  # -> Rectangle, Length; disabled
Z_29 = Slider(78, range=72..78)  # disabled
fridge_4 = BoxRectangle(Rectangle=rectangle_24.Rectangle, Height=Z_29)  # disabled
deconstruct_box_35 = DeconstructBox(Box=fridge_4)  # -> Plane, X, Y, Z; disabled
deconstruct_domain_58 = DeconstructDomain(Domain=deconstruct_box_35.Y)  # -> Start, End; disabled
addition_96 = Addition(A=deconstruct_domain_58.End, B=X_41)  # disabled
back_front_margin_30 = ConstructDomain(DomainStart=deconstruct_domain_58.Start, DomainEnd=addition_96)  # disabled
fridge_margin_4 = DomainBox(
    Base=deconstruct_box_35.Plane,
    LEFTRIGHT=deconstruct_box_35.X,
    BACKFRONT=back_front_margin_30,
    TOPBOTTOM=deconstruct_box_35.Z)  # disabled

# ---- group: KITCHEN UNIT TYPE III / sink
Y_34 = Slider(0, range=0..220)  # disabled
addition_97 = Addition(A=X_36, B=Y_34)  # disabled
addition_98 = Addition(A=addition_90, B=thickness_of_counter_3)  # disabled
vector_xyz_27 = VectorXYZ(XComponent=addition_97, YComponent=Y_31, ZComponent=addition_98)  # -> Vector, Length; disabled
Y_35 = Slider(38, range=38..50)  # disabled
X_42 = Slider(60, range=38..60)  # disabled
Z_30 = Slider(13, range=13..22)  # disabled
rectangle_25 = Rectangle(Plane=vector_xyz_27.Vector, XSize=X_42, YSize=Y_35, Radius=0)  # -> Rectangle, Length; disabled
table_2_5 = BoxRectangle(Rectangle=rectangle_25.Rectangle, Height=Z_30)  # disabled
deconstruct_box_36 = DeconstructBox(Box=table_2_5)  # -> Plane, X, Y, Z; disabled
margin_top_20 = Slider(70, range=70..90)  # disabled
margin_front_23 = Slider(60, range=60..80)  # disabled
deconstruct_domain_59 = DeconstructDomain(Domain=deconstruct_box_36.Y)  # -> Start, End; disabled
deconstruct_domain_60 = DeconstructDomain(Domain=deconstruct_box_36.Z)  # -> Start, End; disabled
addition_99 = Addition(A=deconstruct_domain_59.End, B=margin_front_23)  # disabled
addition_100 = Addition(A=deconstruct_domain_60.End, B=margin_top_20)  # disabled
back_front_margin_31 = ConstructDomain(DomainStart=deconstruct_domain_59.Start, DomainEnd=addition_99)  # disabled
top_bottom_margin_18 = ConstructDomain(DomainStart=deconstruct_domain_60.Start, DomainEnd=addition_100)  # disabled
table_2_margin_5 = DomainBox(
    Base=deconstruct_box_36.Plane,
    LEFTRIGHT=deconstruct_box_36.X,
    BACKFRONT=back_front_margin_31,
    TOPBOTTOM=top_bottom_margin_18)  # disabled

# ---- group: KITCHEN UNIT TYPE III / stove
X_43 = Slider(140, range=0..240)  # disabled
addition_101 = Addition(A=X_36, B=X_43)  # disabled
vector_xyz_28 = VectorXYZ(XComponent=addition_101, YComponent=Y_31, ZComponent=addition_98)  # -> Vector, Length; disabled
X_44 = Slider(40, range=26..40)  # disabled
Y_36 = Slider(58, range=48..58)  # disabled
Z_31 = Slider(15, range=15..22)  # disabled
rectangle_26 = Rectangle(Plane=vector_xyz_28.Vector, XSize=X_44, YSize=Y_36, Radius=0)  # -> Rectangle, Length; disabled
stove_4 = BoxRectangle(Rectangle=rectangle_26.Rectangle, Height=Z_31)  # disabled
deconstruct_box_37 = DeconstructBox(Box=stove_4)  # -> Plane, X, Y, Z; disabled
margin_top_21 = Slider(70, range=70..90)  # disabled
deconstruct_domain_61 = DeconstructDomain(Domain=deconstruct_box_37.Z)  # -> Start, End; disabled
deconstruct_domain_62 = DeconstructDomain(Domain=deconstruct_box_37.Y)  # -> Start, End; disabled
margin_front_24 = Slider(80, range=60..80)  # disabled
addition_102 = Addition(A=deconstruct_domain_61.End, B=margin_top_21)  # disabled
addition_103 = Addition(A=deconstruct_domain_62.End, B=margin_front_24)  # disabled
back_front_margin_32 = ConstructDomain(DomainStart=deconstruct_domain_62.Start, DomainEnd=addition_103)  # disabled
top_bottom_margin_19 = ConstructDomain(DomainStart=deconstruct_domain_61.Start, DomainEnd=addition_102)  # disabled
stove_margin_4 = DomainBox(
    Base=deconstruct_box_37.Plane,
    LEFTRIGHT=deconstruct_box_37.X,
    BACKFRONT=back_front_margin_32,
    TOPBOTTOM=top_bottom_margin_19)  # disabled

# ----
addition_104 = Addition(A=X_36, B=X_38)  # disabled
addition_105 = Addition(A=X_36, B=X_39)  # disabled

# ---- group: KITCHEN UNIT TYPE III / cupboard
number_slider_22 = Slider(145, range=145..170)  # disabled
vector_xyz_29 = VectorXYZ(XComponent=addition_105, YComponent=Y_31, ZComponent=number_slider_22)  # -> Vector, Length; disabled
X_45 = Slider(60, range=30..60)  # disabled
Y_37 = Slider(45, range=30..45)  # disabled
Z_32 = Slider(30, range=30..50)  # disabled
rectangle_27 = Rectangle(Plane=vector_xyz_29.Vector, XSize=X_45, YSize=Y_37, Radius=0)  # -> Rectangle, Length; disabled
cupboard_4 = BoxRectangle(Rectangle=rectangle_27.Rectangle, Height=Z_32)  # disabled
deconstruct_box_38 = DeconstructBox(Box=cupboard_4)  # -> Plane, X, Y, Z; disabled
margin_front_25 = Slider(60, range=60..80)  # disabled
deconstruct_domain_63 = DeconstructDomain(Domain=deconstruct_box_38.Y)  # -> Start, End; disabled
addition_106 = Addition(A=deconstruct_domain_63.End, B=margin_front_25)  # disabled
back_front_margin_33 = ConstructDomain(DomainStart=deconstruct_domain_63.Start, DomainEnd=addition_106)  # disabled
cupboard_margin_4 = DomainBox(
    Base=deconstruct_box_38.Plane,
    LEFTRIGHT=deconstruct_box_38.X,
    BACKFRONT=back_front_margin_33,
    TOPBOTTOM=deconstruct_box_38.Z)  # disabled

# ---- group: KITCHEN UNIT TYPE III / microwave
number_slider_23 = Slider(145, range=145..170)  # disabled
vector_xyz_30 = VectorXYZ(XComponent=addition_104, YComponent=Y_31, ZComponent=number_slider_23)  # -> Vector, Length; disabled
Z_33 = Slider(30, range=30..50)  # disabled
rectangle_28 = Rectangle(Plane=vector_xyz_30.Vector, XSize=X_45, YSize=Y_37, Radius=0)  # -> Rectangle, Length; disabled
microwave_3 = BoxRectangle(Rectangle=rectangle_28.Rectangle, Height=Z_33)  # disabled
deconstruct_box_39 = DeconstructBox(Box=microwave_3)  # -> Plane, X, Y, Z; disabled
deconstruct_domain_64 = DeconstructDomain(Domain=deconstruct_box_39.Y)  # -> Start, End; disabled
addition_107 = Addition(A=deconstruct_domain_64.End, B=margin_front_25)  # disabled
back_front_margin_34 = ConstructDomain(DomainStart=deconstruct_domain_64.Start, DomainEnd=addition_107)  # disabled
microwave_margin_3 = DomainBox(
    Base=deconstruct_box_39.Plane,
    LEFTRIGHT=deconstruct_box_39.X,
    BACKFRONT=back_front_margin_34,
    TOPBOTTOM=deconstruct_box_39.Z)  # disabled

# ----
Y_38 = Slider(140, range=110..140)  # disabled
panel_49 = Panel("-1")  # disabled

# ---- group: KITCHEN UNIT TYPE IV / COUNTER 2
X_46 = Slider(0, range=0..140)  # disabled
Y_39 = Slider(1500, range=0..1500)  # disabled

Z_34 = Slider(72, range=69..72)  # disabled
thickness_of_counter_4 = Slider(6, range=3..6)  # disabled
margin_top_22 = Slider(60, range=60..80)  # disabled
addition_108 = Addition(A=Z_34, B=thickness_of_counter_4)  # disabled
addition_109 = Addition(A=thickness_of_counter_4, B=margin_top_22)  # disabled
vector_xyz_31 = VectorXYZ(XComponent=X_46, YComponent=Y_39, ZComponent=addition_108)  # -> Vector, Length; disabled
Y_40 = Slider(65, range=50..65)  # disabled
X_47 = Slider(180, range=160..280)  # disabled
panel_50 = Panel("-1")  # disabled
rectangle_29 = Rectangle(Plane=vector_xyz_31.Vector, XSize=X_47, YSize=Y_40, Radius=0)  # -> Rectangle, Length; disabled
multiplication_17 = Multiplication(A=addition_108, B=panel_50)  # disabled
counter_2_4 = BoxRectangle(Rectangle=rectangle_29.Rectangle, Height=thickness_of_counter_4)  # disabled
deconstruct_box_40 = DeconstructBox(Box=counter_2_4)  # -> Plane, X, Y, Z; disabled
margin_front_26 = Slider(80, range=60..80)  # disabled
deconstruct_domain_65 = DeconstructDomain(Domain=deconstruct_box_40.Y)  # -> Start, End; disabled
deconstruct_domain_66 = DeconstructDomain(Domain=deconstruct_box_40.Z)  # -> Start, End; disabled
addition_110 = Addition(A=deconstruct_domain_65.End, B=margin_front_26)  # disabled
addition_111 = Addition(A=multiplication_17, B=deconstruct_domain_66.Start)  # disabled
addition_112 = Addition(A=deconstruct_domain_66.End, B=margin_top_22)  # disabled
back_front_margin_35 = ConstructDomain(DomainStart=deconstruct_domain_65.Start, DomainEnd=addition_110)  # disabled
top_bottom_margin_20 = ConstructDomain(DomainStart=addition_111, DomainEnd=addition_112)  # disabled
counter_2_margin_5 = DomainBox(
    Base=deconstruct_box_40.Plane,
    LEFTRIGHT=deconstruct_box_40.X,
    BACKFRONT=back_front_margin_35,
    TOPBOTTOM=top_bottom_margin_20)  # disabled

# ----
X_48 = Slider(0, range=0..240)  # disabled
X_49 = Slider(64, range=0..240)  # disabled

# ---- group: KITCHEN UNIT TYPE IV / fridge
X_50 = Slider(110, range=0..210)  # disabled
addition_113 = Addition(A=X_46, B=X_50)  # disabled
vector_xyz_32 = VectorXYZ(XComponent=addition_113, YComponent=Y_39, ZComponent=0)  # -> Vector, Length; disabled
X_51 = Slider(70, range=55..70)  # disabled
Y_41 = Slider(65, range=50..65)  # disabled
rectangle_30 = Rectangle(Plane=vector_xyz_32.Vector, XSize=X_51, YSize=Y_41, Radius=0)  # -> Rectangle, Length; disabled
Z_35 = Slider(78, range=72..78)  # disabled
fridge_5 = BoxRectangle(Rectangle=rectangle_30.Rectangle, Height=Z_35)  # disabled
deconstruct_box_41 = DeconstructBox(Box=fridge_5)  # -> Plane, X, Y, Z; disabled
deconstruct_domain_67 = DeconstructDomain(Domain=deconstruct_box_41.Y)  # -> Start, End; disabled
addition_114 = Addition(A=deconstruct_domain_67.End, B=X_51)  # disabled
back_front_margin_36 = ConstructDomain(DomainStart=deconstruct_domain_67.Start, DomainEnd=addition_114)  # disabled
fridge_margin_5 = DomainBox(
    Base=deconstruct_box_41.Plane,
    LEFTRIGHT=deconstruct_box_41.X,
    BACKFRONT=back_front_margin_36,
    TOPBOTTOM=deconstruct_box_41.Z)  # disabled

# ---- group: KITCHEN UNIT TYPE IV / sink
Y_42 = Slider(0, range=0..220)  # disabled
addition_115 = Addition(A=X_46, B=Y_42)  # disabled
addition_116 = Addition(A=addition_108, B=thickness_of_counter_4)  # disabled
vector_xyz_33 = VectorXYZ(XComponent=addition_115, YComponent=Y_39, ZComponent=addition_116)  # -> Vector, Length; disabled
Y_43 = Slider(38, range=38..50)  # disabled
X_52 = Slider(60, range=38..60)  # disabled
Z_36 = Slider(13, range=13..22)  # disabled
rectangle_31 = Rectangle(Plane=vector_xyz_33.Vector, XSize=X_52, YSize=Y_43, Radius=0)  # -> Rectangle, Length; disabled
table_2_6 = BoxRectangle(Rectangle=rectangle_31.Rectangle, Height=Z_36)  # disabled
deconstruct_box_42 = DeconstructBox(Box=table_2_6)  # -> Plane, X, Y, Z; disabled
margin_top_23 = Slider(70, range=70..90)  # disabled
margin_front_27 = Slider(60, range=60..80)  # disabled
deconstruct_domain_68 = DeconstructDomain(Domain=deconstruct_box_42.Y)  # -> Start, End; disabled
deconstruct_domain_69 = DeconstructDomain(Domain=deconstruct_box_42.Z)  # -> Start, End; disabled
addition_117 = Addition(A=deconstruct_domain_68.End, B=margin_front_27)  # disabled
addition_118 = Addition(A=deconstruct_domain_69.End, B=margin_top_23)  # disabled
back_front_margin_37 = ConstructDomain(DomainStart=deconstruct_domain_68.Start, DomainEnd=addition_117)  # disabled
top_bottom_margin_21 = ConstructDomain(DomainStart=deconstruct_domain_69.Start, DomainEnd=addition_118)  # disabled
table_2_margin_6 = DomainBox(
    Base=deconstruct_box_42.Plane,
    LEFTRIGHT=deconstruct_box_42.X,
    BACKFRONT=back_front_margin_37,
    TOPBOTTOM=top_bottom_margin_21)  # disabled

# ---- group: KITCHEN UNIT TYPE IV / stove
X_53 = Slider(140, range=0..240)  # disabled
addition_119 = Addition(A=X_46, B=X_53)  # disabled
vector_xyz_34 = VectorXYZ(XComponent=addition_119, YComponent=Y_39, ZComponent=addition_116)  # -> Vector, Length; disabled
X_54 = Slider(40, range=26..40)  # disabled
Y_44 = Slider(58, range=48..58)  # disabled
Z_37 = Slider(15, range=15..22)  # disabled
rectangle_32 = Rectangle(Plane=vector_xyz_34.Vector, XSize=X_54, YSize=Y_44, Radius=0)  # -> Rectangle, Length; disabled
stove_5 = BoxRectangle(Rectangle=rectangle_32.Rectangle, Height=Z_37)  # disabled
deconstruct_box_43 = DeconstructBox(Box=stove_5)  # -> Plane, X, Y, Z; disabled
margin_top_24 = Slider(70, range=70..90)  # disabled
deconstruct_domain_70 = DeconstructDomain(Domain=deconstruct_box_43.Z)  # -> Start, End; disabled
deconstruct_domain_71 = DeconstructDomain(Domain=deconstruct_box_43.Y)  # -> Start, End; disabled
margin_front_28 = Slider(80, range=60..80)  # disabled
addition_120 = Addition(A=deconstruct_domain_70.End, B=margin_top_24)  # disabled
addition_121 = Addition(A=deconstruct_domain_71.End, B=margin_front_28)  # disabled
back_front_margin_38 = ConstructDomain(DomainStart=deconstruct_domain_71.Start, DomainEnd=addition_121)  # disabled
top_bottom_margin_22 = ConstructDomain(DomainStart=deconstruct_domain_70.Start, DomainEnd=addition_120)  # disabled
stove_margin_5 = DomainBox(
    Base=deconstruct_box_43.Plane,
    LEFTRIGHT=deconstruct_box_43.X,
    BACKFRONT=back_front_margin_38,
    TOPBOTTOM=top_bottom_margin_22)  # disabled

# ----
addition_122 = Addition(A=X_46, B=X_48)  # disabled
addition_123 = Addition(A=X_46, B=X_49)  # disabled

# ---- group: KITCHEN UNIT TYPE IV / cupboard
number_slider_24 = Slider(145, range=145..170)  # disabled
vector_xyz_35 = VectorXYZ(XComponent=addition_123, YComponent=Y_39, ZComponent=number_slider_24)  # -> Vector, Length; disabled
X_55 = Slider(60, range=30..60)  # disabled
Y_45 = Slider(45, range=30..45)  # disabled
Z_38 = Slider(30, range=30..50)  # disabled
rectangle_33 = Rectangle(Plane=vector_xyz_35.Vector, XSize=X_55, YSize=Y_45, Radius=0)  # -> Rectangle, Length; disabled
cupboard_5 = BoxRectangle(Rectangle=rectangle_33.Rectangle, Height=Z_38)  # disabled
deconstruct_box_44 = DeconstructBox(Box=cupboard_5)  # -> Plane, X, Y, Z; disabled
margin_front_29 = Slider(60, range=60..80)  # disabled
deconstruct_domain_72 = DeconstructDomain(Domain=deconstruct_box_44.Y)  # -> Start, End; disabled
addition_124 = Addition(A=deconstruct_domain_72.End, B=margin_front_29)  # disabled
back_front_margin_39 = ConstructDomain(DomainStart=deconstruct_domain_72.Start, DomainEnd=addition_124)  # disabled
cupboard_margin_5 = DomainBox(
    Base=deconstruct_box_44.Plane,
    LEFTRIGHT=deconstruct_box_44.X,
    BACKFRONT=back_front_margin_39,
    TOPBOTTOM=deconstruct_box_44.Z)  # disabled

# ---- group: KITCHEN UNIT TYPE IV / microwave
number_slider_25 = Slider(145, range=145..170)  # disabled
vector_xyz_36 = VectorXYZ(XComponent=addition_122, YComponent=Y_39, ZComponent=number_slider_25)  # -> Vector, Length; disabled
Z_39 = Slider(30, range=30..50)  # disabled
rectangle_34 = Rectangle(Plane=vector_xyz_36.Vector, XSize=X_55, YSize=Y_45, Radius=0)  # -> Rectangle, Length; disabled
microwave_4 = BoxRectangle(Rectangle=rectangle_34.Rectangle, Height=Z_39)  # disabled
deconstruct_box_45 = DeconstructBox(Box=microwave_4)  # -> Plane, X, Y, Z; disabled
deconstruct_domain_73 = DeconstructDomain(Domain=deconstruct_box_45.Y)  # -> Start, End; disabled
addition_125 = Addition(A=deconstruct_domain_73.End, B=margin_front_29)  # disabled
back_front_margin_40 = ConstructDomain(DomainStart=deconstruct_domain_73.Start, DomainEnd=addition_125)  # disabled
microwave_margin_4 = DomainBox(
    Base=deconstruct_box_45.Plane,
    LEFTRIGHT=deconstruct_box_45.X,
    BACKFRONT=back_front_margin_40,
    TOPBOTTOM=deconstruct_box_45.Z)  # disabled

# ----
Y_46 = Slider(140, range=110..140)  # disabled
panel_51 = Panel("-1")  # disabled

# ----
# left
# WET AREA
# right
# front
# front
# front
# front
# front
number_slider_26 = Slider(100, range=0..100)
vector_xyz_37 = VectorXYZ(XComponent=Slider(0, range=-100..101), YComponent=0, ZComponent=0)  # -> Vector, Length
vector_xyz_38 = VectorXYZ(XComponent=0, YComponent=0, ZComponent=number_slider_26)  # -> Vector, Length
vector_xyz_39 = VectorXYZ(XComponent=Slider(0, range=0..100), YComponent=0, ZComponent=0)  # -> Vector, Length
vector_xyz_40 = VectorXYZ(XComponent=Slider(0, range=-1000..100), YComponent=0, ZComponent=0)  # -> Vector, Length
vector_xyz_41 = VectorXYZ(XComponent=0, YComponent=0, ZComponent=Slider(85, range=0..200))  # -> Vector, Length
toılet = DomainBox(Base=vector_xyz_37.Vector, X=Slider(36, range=0..100), Y=Slider(54, range=0..100), Z=Slider(50, range=0..100))
dressing_cabin = DomainBox(Base=vector_xyz_40.Vector, X=Slider(80, range=0..100), Y=Slider(80, range=0..100), Z=Slider(200, range=0..300))
mirror_cupboard = DomainBox(Base=vector_xyz_38.Vector, X=Slider(60, range=0..100), Y=Slider(15, range=0..100), Z=Slider(60, range=0..300))
shower_cabin = DomainBox(Base=vector_xyz_39.Vector, X=Slider(80, range=0..100), Y=Slider(80, range=0..100), Z=Slider(210, range=0..300))
sink_cupboard = DomainBox(Base=vector_xyz_41.Vector, X=Slider(55, range=0..100), Y=Slider(40, range=0..100), Z=Slider(37, range=0..300))
deconstruct_box_46 = DeconstructBox(Box=toılet)  # -> Plane, X, Y, Z
deconstruct_box_47 = DeconstructBox(Box=mirror_cupboard)  # -> Plane, X, Y, Z
deconstruct_box_48 = DeconstructBox(Box=shower_cabin)  # -> Plane, X, Y, Z
deconstruct_box_49 = DeconstructBox(Box=sink_cupboard)  # -> Plane, X, Y, Z
deconstruct_box_50 = DeconstructBox(Box=dressing_cabin)  # -> Plane, X, Y, Z
deconstruct_domain_74 = DeconstructDomain(Domain=deconstruct_box_46.Y)  # -> Start, End
deconstruct_domain_75 = DeconstructDomain(Domain=deconstruct_box_46.Z)  # -> Start, End
deconstruct_domain_76 = DeconstructDomain(Domain=deconstruct_box_46.X)  # -> Start, End
deconstruct_domain_77 = DeconstructDomain(Domain=deconstruct_box_48.Y)  # -> Start, End
deconstruct_domain_78 = DeconstructDomain(Domain=deconstruct_box_47.Y)  # -> Start, End
deconstruct_domain_79 = DeconstructDomain(Domain=deconstruct_box_50.Y)  # -> Start, End
deconstruct_domain_80 = DeconstructDomain(Domain=deconstruct_box_49.Y)  # -> Start, End
addition_126 = Addition(A=deconstruct_domain_75.End, B=Slider(160, range=0..160))
addition_127 = Addition(A=deconstruct_domain_76.End, B=Slider(30, range=0..100))
addition_128 = Addition(A=deconstruct_domain_78.End, B=Slider(85, range=0..100))
addition_129 = Addition(A=deconstruct_domain_77.End, B=Slider(60, range=0..100))
addition_130 = Addition(A=deconstruct_domain_79.End, B=Slider(60, range=0..100))
addition_131 = Addition(A=deconstruct_domain_80.End, B=Slider(60, range=0..100))
construct_domain_7 = ConstructDomain(DomainStart=deconstruct_domain_75.Start, DomainEnd=addition_126)
construct_domain_8 = ConstructDomain(DomainStart=deconstruct_domain_78.Start, DomainEnd=addition_128)
construct_domain_9 = ConstructDomain(DomainStart=deconstruct_domain_77.Start, DomainEnd=addition_129)
construct_domain_10 = ConstructDomain(DomainStart=deconstruct_domain_79.Start, DomainEnd=addition_130)
construct_domain_11 = ConstructDomain(DomainStart=deconstruct_domain_80.Start, DomainEnd=addition_131)
domain_box = DomainBox(Base=mirror_cupboard, X=deconstruct_box_47.X, Y=construct_domain_8, Z=deconstruct_box_47.Z)
shower_cabin_2 = DomainBox(Base=shower_cabin, X=deconstruct_box_48.X, Y=construct_domain_9, Z=deconstruct_box_48.Z)
shower_cabin_margin = DomainBox(Base=dressing_cabin, X=deconstruct_box_50.X, Y=construct_domain_10, Z=deconstruct_box_50.Z)

deconstruct_domain_81 = DeconstructDomain(Domain=deconstruct_box_49.Z)  # -> Start, End
addition_132 = Addition(A=deconstruct_domain_74.End, B=Slider(60, range=0..101))
addition_133 = Addition(A=deconstruct_domain_76.Start, B=Slider(-20, range=-20..100))
addition_134 = Addition(A=deconstruct_domain_81.End, B=Slider(100, range=0..160))
construct_domain_12 = ConstructDomain(DomainStart=deconstruct_domain_81.Start, DomainEnd=addition_134)

construct_domain_13 = ConstructDomain(DomainStart=addition_133, DomainEnd=addition_127)
construct_domain_14 = ConstructDomain(DomainStart=deconstruct_domain_74.Start, DomainEnd=addition_132)
toilet_margin = DomainBox(Base=toılet, X=construct_domain_13, Y=construct_domain_14, Z=construct_domain_7)
sink_margin = DomainBox(Base=sink_cupboard, X=deconstruct_box_49.X, Y=construct_domain_11, Z=construct_domain_12)

custom_preview_5 = CustomPreview(Geometry=[toilet_margin, sink_margin, shower_cabin_2, shower_cabin_margin], Material=create_material_3)  # disabled
custom_preview_6 = CustomPreview(Geometry=[toılet, sink_cupboard, shower_cabin, dressing_cabin], Material=create_material_4)  # disabled
box_41 = Box(toılet)
box_42 = Box(toilet_margin)
box_43 = Box(sink_cupboard)
box_44 = Box(sink_margin)
box_45 = Box(shower_cabin)
box_46 = Box(shower_cabin_2)
c_script_2 = CSharpScript(
    Width=integer_2,
    Length=integer,
    Height=integer_3,
    LevelHeight=Slider(150, range=0..1000),
    cellSize=multiplication_4,
    ExteriorDoor=box_10,
    ExteriorDoorMargin=box_11,
    ChangeOverZone=box_6,
    ChangeOverZoneMargin=box_14,
    Closet=box_7,
    ClosetMargin=box_5,
    InteriorDoor=box_8,
    InteriorDoorMargin=box_9,
    Counter=box_12,
    CounterMargin=box_13,
    Table=box_15,
    TableMargin=box_16,
    SittingUnit=box_18,
    SittingUnitMargin=box_22,
    Bed=box_19,
    HealtCare=box_20,
    HealthCareMargin=box_21,
    Toilet=box_41,
    ToiletMargin=box_42,
    Sink=box_43,
    SinkMargin=box_44,
    ShowerCabin=box_45,
    ShowerCabinMargin=box_46,
    DressingCabin=dressing_cabin,
    DressingCabinMargin=shower_cabin_margin,
    PersonalCloset=closet_2,
    PersonalClosetMargin=closet_margin_2)  # -> out, A, EntranceBoxes, CommonBoxes, WetAreaBoxes, Y, K, W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; inputs Width: Int32, Length: Int32, Height: Int32, LevelHeight: Int32, cellSize: Int32, ExteriorDoor: Box, ExteriorDoorMargin: Box, ChangeOverZone: Box, ChangeOverZoneMargin: Box, Closet: Box, ClosetMargin: Box, InteriorDoor: Box, InteriorDoorMargin: Box, Counter: Box, CounterMargin: Box, Table: Box, TableMargin: Box, SittingUnit: Box, SittingUnitMargin: Box, Bed: Box, BedMargin: Box, HealtCare: Box, HealthCareMargin: Box, Toilet: Box, ToiletMargin: Box, Sink: Box, SinkMargin: Box, ShowerCabin: Box, ShowerCabinMargin: Box, DressingCabin: Box, DressingCabinMargin: Box, PersonalCloset: Box, PersonalClosetMargin: Box
# ---------- c_script_2: C# usings ----------
using System.Linq;
using System.Threading;
# ---------- c_script_2: C# ----------
            /*
         *
         *
         *
         * ...............................................................................

            ..................................+@WWWWWWW@=-.................................

            ................................#WWWWWWWWWWWWWW+...............................

            ..............................-WWWWWWWWWWWWWWWWW=..............................

            .............................-@W@WWWWWWWWWWWWW@@W*.............................

            .............................*W:...*WWWWWWWW*...:@-............................

            .............................#@..-..:WWWWWW+..-..@+............................

            .............................*#.....=W@--WW=.....=*............................

            ............................-+:+....=WW++WW#....:-*............................

            ............................::.-*:.....--.....+*..*............................

            ............................*:....-:*=====*+:.....*:...........................

            ...........................:@.....................:@...........................

            ..........................+W:......................*@-.........................

            ........................-@W-........................+W=........................

            .......................=W*............................#W*......................

            .....................:W=...............................-@@.....................

            ....................:W:..................................*@-...................

            ...................-@:....................................+#...................

            ...................#+......................................=+..................

            ..................:=........................................#-.................

            ..................=-........................................++.................

            .................-=.........................................-=.................

            .................++..........................................*-................

            .................=-..........................................++................

            .................=...........................................-*................

            .................*............................................*................

            ................-+..+.....................................-+..=................

            ................-:.-@.....................................+#..*................

            ................-+.##-....................................*=*.*................

            .................@W=:+....................................=-@@#................

            .................-:.-=...................................:=..+-................

            .....................#:..................................#-....................

            .....................-@-................................*=.....................

            ......................+@-..............................*#......................

            .......................+W*............................#@-......................

            ........................-@W=-.......................*W=........................

            ..........................-#WW#+=#:+@+....=#:+@+-#@W@-.........................

            ............................@WWWWWWWWW#==@WWWWWWWWW=...........................

            ............................#WW@WW@WWW==##WW@WWW@WW*...........................

            .............................::.-+..+.....-+..+..+-............................
         * This Project is created by a KingPenuin Team. Cem Gunes, Efay Tan, Nurcan Sutcu  Pelin Arman, Ozan Balci
         *
         * This Space Organization Algorithm is developped as part of Digital Architectural Design Studio (DADS) 2019-2020 at ITU
         * Tutored by: Prof. Dr. Mine Ozkar, Prof. Dr. Yuksel Avci
         * Assistant Tutors: Koray, Inanc Sencan, Burak Delikanli, Muge Halici
         *
         * In case of you have any question please contact us
         *
         * This generator has 2 main parts. 1-) Zone Generator 2-) Furniture Layout Algorithm
         * Width, Height, Level Count, Cell Size are given by the user. (In this spesific solution some methods uses cell size and dimensions as static values, If you change the dimensions
         * please be sure that you updated them or use dynamic cellsize variable instead of constants.)
         *
         * First part keeps working until it produces expected solutions. Checks min required sizes. Filter(Cellular Automata Filters) the borders in order to reduce jagged/rigged cells.
         * We started to define Zones as Objects which can contain large amount of data in it however we faced software problem within grasshopper.
         * So we continued in conventional methods. In case of swithing to class you may easily transfer the given methods here.
         *
         * FurnitureLayout Alg. start whenever Zone creation is complated.  Strating from Reference Objects(which are only one in each zone and has no previous object),
         * all the objects are tried to be fitted in given zones. All off the methods and properties related Layout Solution placed in Objects Class.
         * So we can keep layers of ínformations for each object.
         *
         *
         *
         * - Each furniture has main boundry representations. Object and Margin.
         * - Objects and Margins should be connected to our package in order to get size and direction informations of objects.
         * -
         * - Margins can be intersecting. It is accaptable so we can still save some space and create enough circulation area.
         * - Margins can overflow to other zones.
         * - Objects can not intersect with objects or Margins
         * - Objects should be in the zone which is defined.
         * - Furnitures has multiple properties such as: RotationAngles, MirrorOptions, Zone, Name etc.
         * - While placement continues all off the options are tried for aech possible base point in give direction
         * - !!All the objects are placed without any extra gap except Cell Snapping. Our Processing Code studied this case. In case of you want to keep building our method in that way
         * - Please also check KingPenguin Teams Processing folder.
         * - Some spesific cases like Television Direction, Window placements, Wall creation couldn't be codified because of the time limitations.
         *
         * - There are prepared evaluation Flowcharts you may check them for write a method which finds the better solutions.
         *
         * - To solve the problem in faster way square area is choosen. New works may be focused on make our methods work in triangular cells or within another types of borders.
         *
         * - To run program faster please comment the console string outputs. It takes time more than calculations!
         *
         * */





        // To represent our zones as Boxes we need to be stacking them in a list
        // At the end of the main part we will be giving them to outputs

    List<Box> entranceBoxes = new List<Box>();
    List<Box> commonBoxes = new List<Box>();
    List<Box> wetAreaBoxes = new List<Box>();


    List<Box> WhiteBoxes = new List<Box>(); // empty.

    // Stack Object and Margin Boundries in Lists

    List<Box> ObjectsList = new List<Box>();
    List<Box> MarginsList = new List<Box>();

    // Expected Areas of the zones
    double entranceSize = (12 * 100 * 100) / (cellSize * cellSize);
    double commonSize = (10 * 100 * 100) / (cellSize * cellSize);
    double wetAreaSize = (10 * 100 * 100) / (cellSize * cellSize);


    // Points to create p Plane , XY plane.
    Point3d pA = new Point3d(0, 0, 0);
    Point3d pB = new Point3d(10, 0, 0);
    Point3d pC = new Point3d(0, 10, 0);

    // XY plane , used  for placing boxes
    Plane p = new Plane(pA, pB, pC);

    // Stack vectors and Points in a list.
    List<Vector3d> MarginVectors = new List<Vector3d>();
    List<Vector3d> ObjectVectors = new List<Vector3d>();
    List<Point3d> BasePoints = new List<Point3d>();

    // get the input values and assing them to new varibles. This is not necessary. variables can be used directly.
    int width = Width;
    int length = Length;
    int levelHeight = LevelHeight;
    int height = Height;
    // calc level number
    int levelNumber = Height / LevelHeight;


    // Bools to finish loop
    bool objectPlacementEnded = false;
    bool placementFailed = false;
    bool validZoning = false;

    // Initialize matrices for checking empty/full conditons or zone values.// in case of we have a class it would be more practical.
    // Should be considered in future works.
    int[,,] areaArray = InitializeZeroMatrice(length, width, levelNumber);
    int[,,] emptyFullArray = InitializeZeroMatrice(length, width, levelNumber);

    int objectReplacementCounter = 1;

    //The loop: whole algorithm works here. runs until it gives acceptable solutionor it reached enough tries.

    while( (objectPlacementEnded == false || placementFailed == true) && objectReplacementCounter < 50  )
    {
      // Each Lists should be cleared in order to get rid of the elements from previous runs.
      MarginVectors.Clear();
      ObjectVectors.Clear();
      BasePoints.Clear();

      //Check Placement Counter for debug or avoiding infinite loops. // If you are sure everything works fine Comment these line program will work faster.
      Rhino.RhinoApp.WriteLine(" ");
      Rhino.RhinoApp.WriteLine("Object Replacement Counter is:   " + objectReplacementCounter);
      Rhino.RhinoApp.WriteLine(" ");

      placementFailed = false;
      validZoning = false;
      int zoneCounter = 0;
      // ZONING STARTS
      while (validZoning == false && zoneCounter < 100)
      {
        // CLEAR EACH LIST TO START EACH LOOP WITH EMPTY LIST.
        entranceList.Clear();
        commonList.Clear();
        wetAreaList.Clear();

        commonBoxes.Clear();
        wetAreaBoxes.Clear();
        entranceBoxes.Clear();
        WhiteBoxes.Clear();

        // SET EACH ONE CELL COUNTER TO 1 IN EACH LOOP
        wetAreaCounter = 1;
        commonCounter = 1;
        entranceCounter = 1;

        //INIITIALIZE A ZERO MATRICE WITH TTHE GIVEN DIMENSIONS

        areaArray = InitializeZeroMatrice(length, width, levelNumber);
        StartZones(areaArray);// RANDOMLY ASSING ZONE VALUES

        //SPREAD EACH ZONE WITHIN DEFINED LIMITS.
        // KEEP THE VALUES ELEMENTS IN LIST TO HAVE THEM AS OUTPUTS
        // REF keyword represent the argument which taken from already existing ones and retured as output. So ref values are already defined out of the func
        // Please check `scope` topic for further informations .
        for (int i = 0; i < width * length * 3; i++)
        {
          Spread(areaArray, ref entranceSize, entranceList, ref entranceCounter, entranceLimit, cellSize);
          Spread(areaArray, ref commonSize, commonList, ref commonCounter, commonLimit, cellSize);
          Spread(areaArray, ref wetAreaSize, wetAreaList, ref wetAreaCounter, wetAreaLimit, cellSize);
        }

        // FILTER THE JAGGED BORDERS
        NoiseFilter(areaArray, 0, 3, 5); // CHEKS 8 SIDES (FILTER TYPE, REPEAT COUNT, THE NUMBER OF THE CELLS IN SAME SIZE)
        NoiseFilter(areaArray, 1, 2, 2); // CHEKS 4 SIDES

        entranceList.Clear();
        commonList.Clear();
        wetAreaList.Clear();

        //ASSIGN THE ZONE INFORMATIONS IN FIRST LEVEL TO OTHER LEVELS.
        for (int k = 0; k < levelNumber; k++)
        {
          for (int i = 0; i < length; i++)
          {
            for (int j = 0; j < width; j++)
            {
              areaArray[i, j, k] = areaArray[i, j, 0];
            }
          }
        }

        // START 0 MATRICE. LATER  WITH PLACEMENTS CHECK IF THE CELL IS EMPTY , MARGINED OR FULL

        for (int k = 0; k < levelNumber; k++)
        {
          for (int i = 0; i < length; i++)
          {
            for (int j = 0; j < width; j++)
            {
              emptyFullArray[i, j, k] = 0;
            }
          }
        }

        // PLACE BOXES ACCORDING TO ITS ZONE VALUES AND REARRANGE THE ZONELISTS

        for (int k = 0; k < levelNumber; k++)
        {
          for (int i = 0; i < length; i++)
          {
            for (int j = 0; j < width; j++)
            {
              if (areaArray[i, j, k] == 1)  // if the zone is 1 =Entrance Zone
              {
                Interval xInterval = new Interval(i * cellSize, (i + 1) * (cellSize));
                Interval yInterval = new Interval(j * cellSize, (j + 1) * (cellSize));
                Interval zInterval = new Interval(k * LevelHeight, k * LevelHeight + levelHeight);

                Box boxgh = new Box(p, xInterval, yInterval, zInterval);
                entranceBoxes.Add(boxgh);
                entranceList.AddRange(new int[2] { i, j });
              }
              if (areaArray[i, j, k] == 2)  // if the zone is 2 = ... Zone
              {
                Interval xInterval = new Interval(i * cellSize, (i + 1) * (cellSize));
                Interval yInterval = new Interval(j * cellSize, (j + 1) * (cellSize));
                Interval zInterval = new Interval(k * LevelHeight, k * LevelHeight + levelHeight);

                Box boxgh = new Box(p, xInterval, yInterval, zInterval);
                commonBoxes.Add(boxgh);
                commonList.AddRange(new int[2] { i, j });
              }
              if (areaArray[i, j, k] == 3)  // if the zone is 3 = ... Zone
              {
                Interval xInterval = new Interval(i * cellSize, (i + 1) * (cellSize));
                Interval yInterval = new Interval(j * cellSize, (j + 1) * (cellSize));
                Interval zInterval = new Interval(k * LevelHeight, k * LevelHeight + levelHeight);

                Box boxgh = new Box(p, xInterval, yInterval, zInterval);
                wetAreaBoxes.Add(boxgh);
                wetAreaList.AddRange(new int[2] { i, j });
              }
              if (areaArray[i, j, k] == 0)  // if the zone is empty
              {
                Interval xInterval = new Interval(i * cellSize, (i + 1) * (cellSize));
                Interval yInterval = new Interval(j * cellSize, (j + 1) * (cellSize));
                Interval zInterval = new Interval(k * LevelHeight, k * LevelHeight + levelHeight);

                Box boxgh = new Box(p, xInterval, yInterval, zInterval);
                WhiteBoxes.Add(boxgh);
              }
            }
          }
        }
        // Divide ZoneLists count to 4 , because we are stacking both coordinates in one list[x1,y1,x2,y,x3,y3...] and we have 2 levels in our case!
        // IF LEVEL NUMBER IS CHANGED PLASE UPDATE THIS EQUATION IN THIS WAY. enra  entranceList.Count / 4  == entranceList.Count/ LevelNumber * 2
        if (60 * 60 * entranceList.Count / 4 >= 100 * 100 * 8 && 60 * 60 * commonList.Count / 4 >= 100 * 100 * 6 && 60 * 60 * wetAreaList.Count / 4 >= 100 * 100 * 6)
        {
          Rhino.RhinoApp.WriteLine(" ");

          Rhino.RhinoApp.WriteLine(" VALID ZONING is TRUE");
          Rhino.RhinoApp.WriteLine("  ");
                    /*
                    Rhino.RhinoApp.WriteLine(" Enrance Space is :" + 60 * 60 * entranceList.Count / 4 + " > " + 100 * 100 * 6);
                    Rhino.RhinoApp.WriteLine(" entrance Count is :" + entranceList.Count / 4);
                    Rhino.RhinoApp.WriteLine(" commonList Count is :" + commonList.Count / 4);
                    Rhino.RhinoApp.WriteLine(" wetAreaList Count is :" + wetAreaList.Count / 4);
               */
          Rhino.RhinoApp.WriteLine("  ");
          validZoning = true;

        }
        else
        {
          Rhino.RhinoApp.WriteLine(" ");
                    /*
                              Rhino.RhinoApp.WriteLine(" VALID ZONING is FALSE ");
                              Rhino.RhinoApp.WriteLine(" Enrance Space is :" + 60 * 60 * entranceList.Count / 4 + " > " + 100 * 100 * 6);
                              Rhino.RhinoApp.WriteLine(" entrance Count is :" + entranceList.Count / 4);
                              Rhino.RhinoApp.WriteLine(" commonList Count is :" + commonList.Count / 4);
                              Rhino.RhinoApp.WriteLine(" wetAreaList Count is :" + wetAreaList.Count / 4);*/
          validZoning = false;
          zoneCounter++;
          Rhino.RhinoApp.WriteLine("Zone Counter is :" + zoneCounter);
        }
      }
      // ZONING ENDS


      emptyFullArray = InitializeZeroMatrice(length, width, levelNumber);

      ObjectsList.Clear();
      MarginsList.Clear();
      /* FURNITURE LAYOUT ==> ENTRANCE STARTED */

      Point3d pointa = new Point3d(0, 0, 0);
      Vector3d vectorb = new Vector3d(0, 0, 1);

      Plane planebase = new Plane(pointa, vectorb);

      Interval xInter = new Interval(0, 10);
      Interval yInter = new Interval(0, 10);
      Interval zInter = new Interval(0, 10);

      Box ObjBox = new Box(planebase, xInter, yInter, zInter);
      Box marginBox = new Box(planebase, xInter, yInter, zInter);



      /* ENTRANCE REFERENCE */
      var exteriorDoorO = new Objects
        {
          /*enter the name of the object in case of it is needed in user interface.*/
          // get the zone value. It will be compared with placement cell.
          Name = "Exterior Door",
          ZoneName = 1,


          // get the margin and objects boxes plugged in as input.
          // we will get direction and dimenion infrmations from them
          Obj = ExteriorDoor,
          ObjMargin = ExteriorDoorMargin,

          // rotation options to be tried
          Front = true,
          Right = true,
          Back = false,
          Left = true,
          Top = false,
          Bottom = false,

          //rotation options to be tried, elements in the lists are looping until it one of them works or stop if none...
          RotationBool = true,
          RotationOpt = new List<double>() { 0, 90, 180, 270 },

          // mirrors to be tried. 0 = default. 1 = Z, 2= X, 3=y.
          MirrorBool = false,
          MirrorOpt = new List<int>() { 0, 2, 3 },

          // FUTURE WORK: some sources can be identifed such as waste water, clean water,electricity. So their placement and connections can be codified.
          Source = "NULL",
          FixedToWall = 1,

          //Cellsize is defined to place objects snapping on grids. This is static here but it can be equalified to cellsize variable.
          CellSize = 60,
          // checks the random placement points if it is needed so we need this list.
          SpaceList = entranceList,

          };

      // Constructor method had a problem with assigning the  dimensions son we have seperate funtion to do that.
      // Place function tries to fit the given in given zone. If it is referenceOBject. No prevOBject. if not  place the object around prev object.

      // 1- Check Each possible sides.
      // 2- Check Each possible Mirror.
      // 3- Check Each possible base point node

      // FUTURE WORK: NOW THE PLACEMENT WORKS ONLY OVER THE POINTS OVER THE OBJECTS SIDE ON GIVEN DIRECTION CELL.
      // BASE POINT SLIDES OVER THE REFERENCE SIDE
      // IT CAN ALSO SLIDE AS LONG AS SOME PART IS TOUCHING TO REFERENCE OBJECT SO BASE POINT DOES NOT HAVE TO DIRECTLY CONNECTED TO REF OBJECT.

      // FUTURE WORK 2: WE PLACE OBJECTS TO NEAREST CELLS . THERE MIGHT BE EXTRA GAP TOLERANCE. CHECK KINGPENGUIN PROCESSING CODE.

      // FUTURE WORK 3: WE CHECK COLLUSION WITH HAND WRITTEN FUNCTIONS. ACTUALLY  THERE ARE SOME METHODS IN RHINO/GRASSHOPPER. FOR SIMPLIFICATION THEY CAN BE USED


      //OUT IDENTIFIER IS USED FOR RETURNING MULTIPLE VALUES
      // IF YOU HAVE NO PRIOR INFORMATION ABOUT KEYWORDS SUCH AS --REF-- OR --OUT-- PLEASE CHECK DOCUMENTS.

      // https://docs.microsoft.com/en-us/dotnet/csharp/language-reference/keywords/out-parameter-modifier
      // https://docs.microsoft.com/en-us/dotnet/csharp/language-reference/keywords/ref

      exteriorDoorO.AssignDimensions();
      exteriorDoorO.PlaceRefObjectEntrance(emptyFullArray, areaArray, out ObjBox, out marginBox, out placementFailed);


      //STACK THE VECTOR AND BASE POINTS OUTPUTS IN SEPERATE LISTS. IT IS NOTHING TO BE REPRESENTED BUT USEFULL FOR DEBUGGING AND UNDERSTANDING THE CODE.
      ObjectVectors.Add(exteriorDoorO.VectorObject);
      MarginVectors.Add(exteriorDoorO.VectorMargin);

      BasePoints.Add(new Point3d(exteriorDoorO.BaseVector));

      // STACK OBJECT AND MARHIN BOXES.
      ObjectsList.Add(ObjBox);
      MarginsList.Add(marginBox);

      /* ENTRANCE 2ND OBJECT */

      var changeOverZoneO = new Objects
        {
          Name = "changeOverZone",
          ZoneName = 1,

          Obj = ChangeOverZone,
          ObjMargin = ChangeOverZoneMargin,

          Front = true,
          Right = true,
          Back = true,
          Left = true,
          Top = false,
          Bottom = false,

          RotationBool = false,
          RotationOpt = new List<double>() { 0, 90, 180, 270 },

          MirrorBool = false,
          MirrorOpt = new List<int>() { 0, 2, 3 },

          Source = "NULL",
          FixedToWall = 1,
          CellSize = 60,

          PreviousObject = exteriorDoorO,
          SpaceList = entranceList,

          };


      changeOverZoneO.AssignDimensions();
      changeOverZoneO.PlaceObject(emptyFullArray, areaArray, out ObjBox, out marginBox, out placementFailed);
      // OUT PARAM HAS TO RETURN SOME VALUES SO WORKING OF .PLACEOBJECT DOES NOT MEAN WE GOT ACCEPTABLE SOLUTION
      // WE NEED TO CHECK IF WE GOT WE EXPECTED SO FUCTION ALSO RETURNS A BOOL SHOWS IF THE PLACEMENTS IS VALID
      // IN IF CONDITION WE ARE DECIDING TO CONTINUE OR BREAK THE UNSUCCESSFULL LOOP!

      // continue;  BREAKS THE LOOP ARE SKIP TO NEXT ITERATION. SO WE DON'T LOOSE TIME OR COMPUTATION POWER.
      // WE DO THIS CONTROL AFTER EACH OBJECT IS PLACED.

      if (placementFailed == true)
      {
        Rhino.RhinoApp.WriteLine("");
        Rhino.RhinoApp.WriteLine("");
        Rhino.RhinoApp.WriteLine("PLACEMENT FAILED RESTARTED");
        Rhino.RhinoApp.WriteLine("");
        Rhino.RhinoApp.WriteLine("");
        objectReplacementCounter++;
        continue;
      }
      else

      {
        Rhino.RhinoApp.WriteLine("");
        Rhino.RhinoApp.WriteLine("");
        Rhino.RhinoApp.WriteLine("PLACEMENT SATISFIED");
        Rhino.RhinoApp.WriteLine("");
        Rhino.RhinoApp.WriteLine("");
      }
      ObjectsList.Add(ObjBox);
      MarginsList.Add(marginBox);

      ObjectVectors.Add(changeOverZoneO.VectorObject);
      MarginVectors.Add(changeOverZoneO.VectorMargin);

      BasePoints.Add(new Point3d(changeOverZoneO.BaseVector));

      var closetO = new Objects
        {
          Name = "closet",
          ZoneName = 1,

          Obj = Closet,
          ObjMargin = ClosetMargin,

          Front = true,
          Right = true,
          Back = false,
          Left = false,
          Top = false,
          Bottom = false,

          RotationBool = false,
          RotationOpt = new List<double>() { 0, 90, 180, 270 },

          MirrorBool = false,
          MirrorOpt = new List<int>() { 0, 2, 3 },

          Source = "NULL",
          FixedToWall = 1,
          CellSize = 60,

          PreviousObject = changeOverZoneO,
          SpaceList = entranceList,
          };

      closetO.AssignDimensions();
      closetO.PlaceObject(emptyFullArray, areaArray, out ObjBox, out marginBox, out placementFailed);

      if (placementFailed == true)
      {
        Rhino.RhinoApp.WriteLine("");
        Rhino.RhinoApp.WriteLine("");
        Rhino.RhinoApp.WriteLine("PLACEMENT FAILED RESTARTED");
        Rhino.RhinoApp.WriteLine("");
        Rhino.RhinoApp.WriteLine("");
        objectReplacementCounter++;
        continue;
      }
      else

      {
        Rhino.RhinoApp.WriteLine("");
        Rhino.RhinoApp.WriteLine("");
        Rhino.RhinoApp.WriteLine("PLACEMENT OKAY ");
        Rhino.RhinoApp.WriteLine("");
        Rhino.RhinoApp.WriteLine("");

        ;
      }
      ObjectVectors.Add(closetO.VectorObject);
      MarginVectors.Add(closetO.VectorMargin);

      BasePoints.Add(new Point3d(closetO.BaseVector));

      ObjectsList.Add(ObjBox);
      MarginsList.Add(marginBox);

      /***********************************WET AREA START ***************************/


      var toiletO = new Objects
        {
          Name = "Toilet",
          ZoneName = 3,

          Obj = Toilet,
          ObjMargin = ToiletMargin,

          Front = true,
          Right = true,
          Back = false,
          Left = true,
          Top = false,
          Bottom = false,

          RotationBool = false,
          RotationOpt = new List<double>() { 0, 90, 180, 270 },

          MirrorBool = false,
          MirrorOpt = new List<int>() { 0, 2, 3 },

          Source = "NULL",
          FixedToWall = 1,

          CellSize = 60,
          SpaceList = wetAreaList ,
          };


      toiletO.AssignDimensions();
      toiletO.PlaceRefObject(emptyFullArray, areaArray, out ObjBox, out marginBox, out placementFailed);

      if (placementFailed == true)
      {
        Rhino.RhinoApp.WriteLine("");
        Rhino.RhinoApp.WriteLine("");
        Rhino.RhinoApp.WriteLine("PLACEMENT FAILED RESTARTED");
        Rhino.RhinoApp.WriteLine("");
        Rhino.RhinoApp.WriteLine("");
        objectReplacementCounter++;
        continue;
      }
      else

      {
        Rhino.RhinoApp.WriteLine("");
        Rhino.RhinoApp.WriteLine("");
        Rhino.RhinoApp.WriteLine("PLACEMENT OKAY ");
        Rhino.RhinoApp.WriteLine("");
        Rhino.RhinoApp.WriteLine("");

      }

      ObjectVectors.Add(toiletO.VectorObject);
      MarginVectors.Add(toiletO.VectorMargin);

      BasePoints.Add(new Point3d(toiletO.BaseVector));

      ObjectsList.Add(ObjBox);
      MarginsList.Add(marginBox);

      /*
      var sinkO = new Objects
        {
          Name = "Sink",
          ZoneName = 3,

          Obj = Sink,
          ObjMargin = SinkMargin,

          Front = true,
          Right = true,
          Back = false,
          Left = true,
          Top = false,
          Bottom = false,

          RotationBool = false,
          RotationOpt = new List<double>() { 0, 90, 180, 270 },

          MirrorBool = false,
          MirrorOpt = new List<int>() { 0, 2, 3 },

          Source = "NULL",
          FixedToWall = 1,
          CellSize = 60,

          PreviousObject = toiletO,
          SpaceList = wetAreaList,

          };


      sinkO.AssignDimensions();
      sinkO.PlaceObject(emptyFullArray, areaArray, out ObjBox, out marginBox, out placementFailed);

      if (placementFailed == true)
      {
        Rhino.RhinoApp.WriteLine("");
        Rhino.RhinoApp.WriteLine("");
        Rhino.RhinoApp.WriteLine("PLACEMENT FAILED RESTARTED");
        Rhino.RhinoApp.WriteLine("");
        Rhino.RhinoApp.WriteLine("");
        objectReplacementCounter++;
        continue;
      }
      else

      {
        Rhino.RhinoApp.WriteLine("");
        Rhino.RhinoApp.WriteLine("");
        Rhino.RhinoApp.WriteLine("PLACEMENT OKAY ");
        Rhino.RhinoApp.WriteLine("");
        Rhino.RhinoApp.WriteLine("");

        ;
      }

      ObjectVectors.Add(sinkO.VectorObject);
      MarginVectors.Add(sinkO.VectorMargin);

      BasePoints.Add(new Point3d(sinkO.BaseVector));

      ObjectsList.Add(ObjBox);
      MarginsList.Add(marginBox);


      var showerCabinO = new Objects
        {
          Name = "ShowerCabin",
          ZoneName = 3,

          Obj = ShowerCabin,
          ObjMargin = ShowerCabinMargin,

          Front = true,
          Right = true,
          Back = false,
          Left = true,
          Top = false,
          Bottom = false,

          RotationBool = false,
          RotationOpt = new List<double>() { 0, 90, 180, 270 },

          MirrorBool = false,
          MirrorOpt = new List<int>() { 0, 2, 3 },

          Source = "NULL",
          FixedToWall = 1,
          CellSize = 60,

          PreviousObject = sinkO,
          SpaceList = wetAreaList,
          };


      showerCabinO.AssignDimensions();
      showerCabinO.PlaceObject(emptyFullArray, areaArray, out ObjBox, out marginBox, out placementFailed);

      if (placementFailed == true)
      {
        Rhino.RhinoApp.WriteLine("");
        Rhino.RhinoApp.WriteLine("");
        Rhino.RhinoApp.WriteLine("PLACEMENT FAILED RESTARTED");
        Rhino.RhinoApp.WriteLine("");
        Rhino.RhinoApp.WriteLine("");
        objectReplacementCounter++;
        continue;
      }
      else

      {
        Rhino.RhinoApp.WriteLine("");
        Rhino.RhinoApp.WriteLine("");
        Rhino.RhinoApp.WriteLine("PLACEMENT OKAY ");
        Rhino.RhinoApp.WriteLine("");
        Rhino.RhinoApp.WriteLine("");
      }

      ObjectVectors.Add(showerCabinO.VectorObject);
      MarginVectors.Add(showerCabinO.VectorMargin);

      BasePoints.Add(new Point3d(showerCabinO.BaseVector));

      ObjectsList.Add(ObjBox);
      MarginsList.Add(marginBox);

      var DressingCabinO = new Objects
        {
          Name = "DressingCabin",
          ZoneName = 3,

          Obj = DressingCabin,
          ObjMargin = DressingCabinMargin,

          Front = true,
          Right = true,
          Back = false,
          Left = true,
          Top = false,
          Bottom = false,

          RotationBool = false,
          RotationOpt = new List<double>() { 0, 90, 180, 270 },

          MirrorBool = false,
          MirrorOpt = new List<int>() { 0, 2, 3 },

          Source = "NULL",
          FixedToWall = 1,

          CellSize = 60,
          SpaceList = wetAreaList ,


          };


      DressingCabinO.AssignDimensions();
      DressingCabinO.PlaceRefObject(emptyFullArray, areaArray, out ObjBox, out marginBox, out placementFailed);

      if (placementFailed == true)
      {
        Rhino.RhinoApp.WriteLine("");
        Rhino.RhinoApp.WriteLine("");
        Rhino.RhinoApp.WriteLine("PLACEMENT FAILED RESTARTED");
        Rhino.RhinoApp.WriteLine("");
        Rhino.RhinoApp.WriteLine("");
        objectReplacementCounter++;
        continue;
      }
      else

      {
        Rhino.RhinoApp.WriteLine("");
        Rhino.RhinoApp.WriteLine("");
        Rhino.RhinoApp.WriteLine("PLACEMENT OKAY ");
        Rhino.RhinoApp.WriteLine("");
        Rhino.RhinoApp.WriteLine("");
        ;
      }

      ObjectVectors.Add(DressingCabinO.VectorObject);
      MarginVectors.Add(DressingCabinO.VectorMargin);

      BasePoints.Add(new Point3d(DressingCabinO.BaseVector));

      ObjectsList.Add(ObjBox);
      MarginsList.Add(marginBox);



      var PersonalClosetO = new Objects
        {
          Name = "PersonalCloset",
          ZoneName = 3,

          Obj = PersonalCloset,
          ObjMargin = PersonalClosetMargin,

          Front = true,
          Right = true,
          Back = false,
          Left = true,
          Top = false,
          Bottom = false,

          RotationBool = false,
          RotationOpt = new List<double>() { 0, 90, 180, 270 },

          MirrorBool = false,
          MirrorOpt = new List<int>() { 0, 2, 3 },

          Source = "NULL",
          FixedToWall = 1,

          CellSize = 60,
          PreviousObject = sinkO,
          SpaceList = wetAreaList ,
          };

      PersonalClosetO.AssignDimensions();
      PersonalClosetO.PlaceObject(emptyFullArray, areaArray, out ObjBox, out marginBox, out placementFailed);

      if (placementFailed == true)
      {
        Rhino.RhinoApp.WriteLine("");
        Rhino.RhinoApp.WriteLine("");
        Rhino.RhinoApp.WriteLine("PLACEMENT FAILED RESTARTED");
        Rhino.RhinoApp.WriteLine("");
        Rhino.RhinoApp.WriteLine("");
        objectReplacementCounter++;
        continue;
      }
      else
      {
        Rhino.RhinoApp.WriteLine("");
        Rhino.RhinoApp.WriteLine("");
        Rhino.RhinoApp.WriteLine("PLACEMENT OKAY ");
        Rhino.RhinoApp.WriteLine("");
        Rhino.RhinoApp.WriteLine("");
      }

      ObjectVectors.Add(PersonalClosetO.VectorObject);
      MarginVectors.Add(PersonalClosetO.VectorMargin);

      BasePoints.Add(new Point3d(PersonalClosetO.BaseVector));

      ObjectsList.Add(ObjBox);
      MarginsList.Add(marginBox);

*/
      /***********************************WET AREA END ***************************/



      // THIS IS THE END POINTS IF PLACEMENT IS ENDED END THE LOOP WITH BOOL!
      objectReplacementCounter++;
      objectPlacementEnded = true;
    }



    // SINCE EVERTHING WORKED FINE UNTILL HERE WE ARE READY TO SHOW THE OUTPUTS.
    // SHOW MATRIX PRINT AN ARRAY AS INTEGERS TO RHINO CONSOLE

    ShowMatrix(areaArray);

    // WE ARE ASSIGNING EACH LIST AND VARIABLE TO SEE THEM AS OUTPUT IN GRASSHOPPER
    A = areaArray;
    EntranceBoxes = entranceBoxes;
    CommonBoxes = commonBoxes;
    WetAreaBoxes = wetAreaBoxes;
        /*Y = kitchenBoxes;
        K = commonAreaBoxes;*/
    W = WhiteBoxes;

    MV = MarginVectors;
    OV = ObjectVectors;
    Base_Points = BasePoints;

    Furnitures = ObjectsList;
    FurnituresMargins = MarginsList;
# ---------- c_script_2: C# additional code ----------
  /*
  public static void Fisher_Yates_CardDeck_Shuffle (List < int > aList) {

  System.Random _random = new System.Random ();

  int myGO;

  int n = aList.Count;
  for (int i = 0; i < n; i++)
  {
  // NextDouble returns a random number between 0 and 1.
  // ... It is equivalent to Math.random() in Java.
  int r = i + (int) (_random.NextDouble() * (n - i));
  myGO = aList[r];
  aList[r] = aList[i];
  aList[i] = myGO;
  }
  // return aList;
  }


  public static void Fisher_Yates_CardDeck_Shuffle (List < double > aList) {

  System.Random _random = new System.Random ();

  double myGO;

  int n = aList.Count;
  for (int i = 0; i < n; i++)
  {
  // NextDouble returns a random number between 0 and 1.
  // ... It is equivalent to Math.random() in Java.
  int r = i + (int) (_random.NextDouble() * (n - i));
  myGO = aList[r];
  aList[r] = aList[i];
  aList[i] = myGO;
  }

  // return aList;
  }
  */
  class Objects
  {
    // we are declaring the public variables of our child objects.
    // IF YOU ARE COMFORTABLE WITH OOP PLEASE ADD PRIVIACY OF THE PROPERTIES AND FUNCTIONS. Private, readonly, get, set etc.
    //

    // ZONE AS STRING AND INTEGER TO CHECK THE ARRAY VALUES IT MIGHT BE ENUM, OR TUPLE AS WELL.
    public string Name;
    public int ZoneName;

    // ASSGING THE CONNECTED BOX AND MARGIN BOXES.
    public Box Obj;
    public Box ObjMargin;

    // POSSIBLE ROTATIONS BOOLS
    public bool Front = false;
    public bool Right = false;
    public bool Back = false;
    public bool Left = false;
    public bool Top = false;
    public bool Bottom = false;

    // ROTATION  OPTIONS INITIALIZED AS EMPTY LIST.
    // BOOL CREATED BUT IS NOT ACTIVE RIGHT NOW.
    // WE KEEP THE ROTATION INFORMATION TO FOLLOW DIRECTIONS AND DEBUG THEM.
    public bool RotationBool = true;
    public List<double> RotationOpt = new List<double>(); // rotation options Define angles as double list; 0 is default
    public double AppliedRotation = 0;

    // MIRROR BOOL IS DEFINED AND MIRROR OPTION IS CREATED AS LIST OF INTEGERS
    // WE KEEP APPLIED MIRROR VALUE FOLLOW DIRECTIONS AND DEBUG THEM..
    public bool MirrorBool = true;
    public List<int> MirrorOpt = new List<int>(); // mirror options 0=None! 1=z, 2= X, 3 = Y;
    public int AppliedMirror = 0;

    public string Source; // Water, Electiricity
    public int FixedToWall; // Bed, Television //1,2,3 conditions
    public int CellSize;

    // WE NEED INFORMATIONS FROM THE PREVIOUS OBJECTS DIRECTION ROTATION DIMENSIONS ETC TO PLACE NEW OBJECT
    // SO WE NEED TO BE ABLE REACH THE PREV OBJ.
    public Objects PreviousObject;

    // DECLARE DIMENSION, AND BASE VARIABLES OF BOUNDRY BOXES.
    public double ObjLength;
    public double ObjWidth;
    public double ObjHeight;

    public double MrjLength;
    public double MrjWidth;
    public double MrjHeight;

    public double baseX, baseY, baseZ;
    public Vector3d BaseVector;

    public List<int> SpaceList = new List<int>();


    // CELL VALUES OF THE GIVEN OBJECTS AND MARGINS
    public double XCellMargin;
    public double YCellMargin;
    public double ZCellMargin;

    public double XCellObject;
    public double YCellObject;
    public double ZCellObject;

    // TO KEEP DIRECTION,ROTATE,MIRROR OPTIONS AND ALL THE DIMENSIONS PROPERLY WE NEED TO USE VECTORS
    // IT STARTS FROM BASE POINT GOES TO FAREST CORNER.

    public Vector3d VectorMargin;
    public Vector3d VectorObject;

    // KEEP THE INITIAL VECTORS, USEFUL FOR ROTATE AND MIRROR FUNCTIONS AND PLACEMENT TRIES.
    public Vector3d VectorMarginCache;
    public Vector3d VectorObjectCache;

    Plane PlaneBase;

    public Objects()
    {
      // EMPTY CONSTRUCTOR METHOD.
      // PLEASE CHECK CONSTRUCTOR METHOD DOCUMENTS TO MODIFY THEM.
      // https://docs.microsoft.com/en-us/dotnet/csharp/programming-guide/classes-and-structs/constructors
      // THESE METHODS ARE USED FOR INITIALIZING THE OBJECTS OF THE CLASS IN MAIN FUNCTIONS.
      // WE CAN DEFINE MULTIPLE CONSTRUCTOR METHODS.
      // https://www.w3schools.com/cs/cs_method_overloading.asp
    }

    public Objects(string name, int zoneName, bool front, bool right, bool back, bool left, bool top, bool bottom, bool rotationalBool, List<double> rotationOpt, bool mirrorBool, List<int> mirrorOpt, string source, int fixedTowall, int cellSize, Box obj, Box objMargin, List<int> spaceList)
      : this()// THANK TO --- :this()  WE CAN COLLECT ASSIGNMENTS IN THE CONSTRUCTOR METHOD WITH MENTIONED ARGUMENTS
    {
      // be carefull about naming convention, arguments are  starts with lowercase.
      // Objects properties starts UPPERCASE and they have .this to mention that the properties of thisobject will be getting the assigned values.

      // to understand these values functions please check the objects class beginning where these variables are declared.
      this.Obj = obj;
      this.ObjMargin = objMargin;

      this.Name = name;
      this.ZoneName = zoneName;

      this.Front = front;
      this.Right = right;
      this.Back = back;
      this.Left = left;
      this.Bottom = bottom;
      this.Top = top;

      this.RotationBool = rotationalBool;
      this.RotationOpt = rotationOpt;

      this.MirrorBool = mirrorBool;
      this.MirrorOpt = mirrorOpt;

      this.Source = source;
      this.FixedToWall = fixedTowall;
      this.CellSize = cellSize;

      this.baseX = Obj.Plane.OriginX;
      this.baseY = Obj.Plane.OriginY;
      this.baseZ = Obj.Plane.OriginZ;

      this.PlaneBase = new Plane(PreviousObject.PlaneBase.Origin, new Vector3d(0, 0, 1));

      this.SpaceList = spaceList;
      // this constructor DOES NOT has previousObjects so it can be used for  reference objects
    }

    public Objects(string name, int zoneName, bool front, bool right, bool back, bool left, bool top, bool bottom, bool rotationalBool, List<double> rotationOpt, bool mirrorBool, List<int> mirrorOpt, string source, int fixedTowall, int cellSize, Box obj, Box objMargin, Objects previousObject, List<int> spaceList)
      : this(name, zoneName, front, right, back, left, top, bottom, rotationalBool, rotationOpt, mirrorBool, mirrorOpt, source, fixedTowall, cellSize, obj, objMargin, spaceList)
    {
      // this constructor method has previousObject so it can be used next objects afteer reference objects.
      this.PreviousObject = previousObject;
    }

    public void AssignDimensions()
    {
      // we need to run this method after constructor to assign dimensions and vectors.
      // Get Margin and objects side lenghts - T1 represents end of the interval. T0 = 0.
      this.ObjWidth = this.Obj.X.T1;
      this.ObjLength = this.Obj.Y.T1;
      this.ObjHeight = this.Obj.Z.T1;

      this.MrjWidth = this.ObjMargin.X.T1;
      this.MrjLength = this.ObjMargin.Y.T1;
      this.MrjHeight = this.ObjMargin.Z.T1;

      // use dimensions to create a vector3d
      this.VectorObject = new Vector3d(this.ObjWidth, this.ObjLength, this.ObjHeight);
      this.VectorMargin = new Vector3d(this.MrjWidth, this.MrjLength, this.MrjHeight);

      // keep the initial vectors seperately.
      // MAKE THEM READ-ONLY. THEY SHOULD NOT BE MODIFIED.
      this.VectorMarginCache = this.VectorMargin;
      this.VectorObjectCache = this.VectorObject;

    }

    public void PrintDimensions()
    {
      // TO SEE THE DIMS WITHOUT ANY TRANSLATIONS  OVER THE RHINO CONSOLE USE IT.
      Rhino.RhinoApp.WriteLine("Obj Width " + this.ObjWidth.ToString());
      Rhino.RhinoApp.WriteLine("Obj Length " + this.ObjLength.ToString());
      Rhino.RhinoApp.WriteLine("Obj Height " + this.ObjHeight.ToString());

      Rhino.RhinoApp.WriteLine("Obj Width " + this.MrjWidth.ToString());
      Rhino.RhinoApp.WriteLine("Obj Length " + this.MrjLength.ToString());
      Rhino.RhinoApp.WriteLine("Obj Height " + this.MrjHeight.ToString());
    }

    public void Rotate(double Angle)
    {
      // rotate the objects around Z+direction
      // input is double change it to radians.
      Angle = Angle * (Math.PI / 180);

      VectorMargin.Rotate(Angle, new Vector3d(0, 0, 1));
      VectorObject.Rotate(Angle, new Vector3d(0, 0, 1));
    }

    public void Mirroring(int axis)
    {
      // get the symmetric of th objects according the symmetry lines.
      if (axis != 0)
      {
        Point3d pointa = new Point3d(this.baseX, this.baseY, this.baseZ);
        Vector3d pointb = new Vector3d();

        if (axis == 1)                //Z Symmetry
        { pointb = new Vector3d(0, 0, 1); }
        else if (axis == 2)                //X Symmtry
        { pointb = new Vector3d(0, 1, 0); }
        else if (axis == 3)                // Y Symmetry
        { pointb = new Vector3d(1, 0, 0); }

        Plane planee = new Plane(pointa, pointb);

        VectorMargin.Transform(Transform.Mirror(planee));
        VectorObject.Transform(Transform.Mirror(planee));
      }
    }

    public void PlaceRefObject(int[,,] emptyFullArray, int[,,] areaArray, out Box ObjBox, out Box marginBox, out bool placementFailed)
    {

      this.XCellMargin = (this.VectorMargin.X < 0 ? -1 : 1) * Math.Ceiling((double) Math.Abs(this.VectorMargin.X / CellSize));
      this.YCellMargin = (this.VectorMargin.Y < 0 ? -1 : 1) * Math.Ceiling((double) Math.Abs(this.VectorMargin.Y / CellSize));
      this.ZCellMargin = (this.VectorMargin.Z < 0 ? -1 : 1) * Math.Ceiling((double) Math.Abs(this.VectorMargin.Z / 150));

      Rhino.RhinoApp.WriteLine(" MARGIN  numbers ----------------------------------" + XCellMargin.ToString() + ' ' + YCellMargin.ToString() + ' ' + ZCellMargin.ToString() + ' ');


      this.XCellObject = (this.VectorObject.X < 0 ? -1 : 1) * Math.Ceiling((double) Math.Abs(this.VectorObject.X / CellSize));
      this.YCellObject = (this.VectorObject.Y < 0 ? -1 : 1) * Math.Ceiling((double) Math.Abs(this.VectorObject.Y / CellSize));
      this.ZCellObject = (this.VectorObject.Z < 0 ? -1 : 1) * Math.Ceiling((double) Math.Abs(this.VectorObject.Z / 150));


      Rhino.RhinoApp.WriteLine(" OBJECT  numbers ----------------------------------" + XCellObject.ToString() + ' ' + YCellObject.ToString() + ' ' + ZCellObject.ToString() + ' ');

      // We need to define the start end end points because we dont know if the inital poin is lower than end point


      bool emptyBool = true;
      bool sameZone = true;

      bool placeSuccessful = false;
      int trycount = 0;
      bool enoughTries = false;

      while (placeSuccessful == false && enoughTries == false)
      {
        var rand = new Random();
        var randomCellIndex = rand.Next(this.SpaceList.Count / 2);

        baseX = (this.SpaceList[2 * randomCellIndex]) * CellSize;
        baseY = (this.SpaceList[2 * randomCellIndex + 1]) * CellSize;
        baseZ = 0;

        BaseVector = new Vector3d(baseX, baseY, baseZ);

        int XLoopStartMargin = (int) ((int) (baseX / CellSize) < (baseX / CellSize + (int) XCellMargin) ? (int) (baseX / CellSize) : (baseX / CellSize + (int) XCellMargin));
        int XLoopEndMargin = (int) ((int) (baseX / CellSize) > (baseX / CellSize + (int) XCellMargin) ? (int) (baseX / CellSize) : (baseX / CellSize + (int) XCellMargin));

        int YLoopStartMargin = (int) ((int) (baseY / CellSize) < baseY / CellSize + (int) YCellMargin ? (int) (baseY / CellSize) : baseY / CellSize + (int) YCellMargin);
        int YLoopEnMargin = (int) ((int) (baseY / CellSize) > baseY / CellSize + (int) YCellMargin ? (int) (baseY / CellSize) : baseY / CellSize + (int) YCellMargin);

        int ZLoopStartMargin = (int) ((int) (baseZ / 150) < baseZ / 150 + (int) ZCellMargin ? (int) (baseZ / 150) : baseZ / 150 + (int) ZCellMargin);
        int ZLoopEndMargin = (int) ((int) (baseZ / 150) > baseZ / 150 + (int) ZCellMargin ? (int) (baseZ / 150) : baseZ / 150 + (int) ZCellMargin);

        /***/
        int XLoopStartObject = (int) ((int) (baseX / CellSize) < (baseX / CellSize + (int) XCellObject) ? (int) (baseX / CellSize) : (baseX / CellSize + (int) XCellObject));
        int XLoopEndObject = (int) ((int) (baseX / CellSize) > (baseX / CellSize + (int) XCellObject) ? (int) (baseX / CellSize) : (baseX / CellSize + (int) XCellObject));

        int YLoopStartObject = (int) ((int) (baseY / CellSize) < baseY / CellSize + (int) YCellObject ? (int) (baseY / CellSize) : baseY / CellSize + (int) YCellObject);
        int YLoopEnObject = (int) ((int) (baseY / CellSize) > baseY / CellSize + (int) YCellObject ? (int) (baseY / CellSize) : baseY / CellSize + (int) YCellObject);

        int ZLoopStartObject = (int) ((int) (baseZ / 150) < baseZ / 150 + (int) ZCellObject ? (int) (baseZ / 150) : baseZ / 150 + (int) ZCellObject);
        int ZLoopEndObject = (int) ((int) (baseZ / 150) > baseZ / 150 + (int) ZCellObject ? (int) (baseZ / 150) : baseZ / 150 + (int) ZCellObject);

/*
        Rhino.RhinoApp.WriteLine("X    Loop numbers ----------------------------------" + XLoopStartMargin.ToString() + ' ' + XLoopEndMargin.ToString() + ' ');
        Rhino.RhinoApp.WriteLine("Y    Loop numbers ----------------------------------" + YLoopStartMargin.ToString() + ' ' + YLoopEnMargin.ToString() + ' ');
        Rhino.RhinoApp.WriteLine("Z    Loop numbers ----------------------------------" + ZLoopStartMargin.ToString() + ' ' + ZLoopEndMargin.ToString() + ' ');
*/
        bool inLimit = true;

        if (!((baseX + VectorMargin.X < 360) && (baseY + VectorMargin.Y < 660) && (baseZ + VectorMargin.Z < 300) &&
          (baseX + VectorMargin.X > 0) && (baseY + VectorMargin.Y > 0) && (baseZ + VectorMargin.Z > 0)))
        {
          inLimit = false;
        }

        if (inLimit)
        {
          for (int i = XLoopStartMargin; i < XLoopEndMargin; i++)
          {
            for (int j = YLoopStartMargin; j < YLoopEnMargin; j++)
            {
              for (int k = ZLoopStartMargin; k < ZLoopEndMargin; k++)
              {
                //checks if the cell is empty (We dont want to see an object in a cell! )
                if (((emptyFullArray[i, j, k] == 1) || (emptyFullArray[i, j, k] == 2)))
                {
                  //Rhino.RhinoApp.WriteLine(" Loop numbers ----------------------------------" + i.ToString() + ' ' + j.ToString() + ' ' + k.ToString() + ' ');
                  emptyBool = false;
                }

                // 2nd Loop checks if the zone is the same or empty zone // Actually margin can ovewflow to other zones
                /*
                if (!(areaArray[i, j, k] != this.ZoneName || areaArray[i, j, k] != 0))
                {
                sameZone = false;
                }
                */
              }
            }
          }

          // 2nd Loop checks if the zone is the same or empty zone
          for (int i = XLoopStartObject; i < XLoopEndObject; i++)
          {
            for (int j = YLoopStartObject; j < YLoopEnObject; j++)
            {
              for (int k = ZLoopStartObject; k < ZLoopEndObject; k++)
              {
                //checks if the cell is empty (We dont want to see margin or object in the cell )
                if (((emptyFullArray[i, j, k] == 1) || (emptyFullArray[i, j, k] == 2)))
                {
                  emptyBool = false;
                }

                // 2nd Loop checks if the zone is the same or empty zone
                if (!(areaArray[i, j, k] == this.ZoneName || areaArray[i, j, k] == 0))
                {
                  sameZone = false;
                }
              }
            }
          }

          if (emptyBool && sameZone)
          {
            placeSuccessful = true;
            Rhino.RhinoApp.WriteLine("Reference Object conditions are successful ");
            //Place Margin
            for (int i = XLoopStartMargin; i < XLoopEndMargin; i++)
            {
              for (int j = YLoopStartMargin; j < YLoopEnMargin; j++)
              {
                for (int k = ZLoopStartMargin; k < ZLoopEndMargin; k++)
                {
                  //Rhino.RhinoApp.WriteLine(" Loop numbers ----------------------------------" + i.ToString() + ' ' + j.ToString() + ' ' + k.ToString() + ' ');
                  emptyFullArray[i, j, k] = 2; // 2 represents margin
                }
              }
            }
            //Place Object, object is smaller than margin
            for (int i = XLoopStartObject; i < XLoopEndObject; i++)
            {
              for (int j = YLoopStartObject; j < YLoopEnObject; j++)
              {
                for (int k = ZLoopStartObject; k < ZLoopEndObject; k++)
                {
                  //Rhino.RhinoApp.WriteLine("Loop inetegers --------------- " + i.ToString() + ' ' + j.ToString() + ' ' + k.ToString() + ' ');
                  emptyFullArray[i, j, k] = 1; // 1 represents object
                }
              }
            }
          }
          else
          {
            Rhino.RhinoApp.WriteLine("Reference Placement Conditions are not satisfied ");
            trycount++;
            goto skipEntrance;

          }
        }
      }
      skipEntrance:
        trycount++;
      Rhino.RhinoApp.WriteLine("Try count is : " + trycount);
      if (trycount > 300)
      {
        Rhino.RhinoApp.WriteLine("Try count is over 60 placement is unsuccessful: ");
        enoughTries = true;
      }

      if (trycount < 300 && placeSuccessful)
      {
        placementFailed = false;
        Rhino.RhinoApp.WriteLine("baseX " + this.baseX);
        Rhino.RhinoApp.WriteLine("baseY " + this.baseY);
        Rhino.RhinoApp.WriteLine("baseZ " + this.baseZ);

        Point3d pointa = new Point3d(baseX, 0, 0);
        Vector3d pointb = new Vector3d(0, 0, 1);

        Plane planebase = new Plane(pointa, pointb);

        Interval xInterval = new Interval(0, this.ObjWidth);
        Interval yInterval = new Interval(0, this.ObjLength);
        Interval zInterval = new Interval(0, this.ObjHeight);

        ObjBox = new Box(planebase, xInterval, yInterval, zInterval);

        xInterval = new Interval(0, this.MrjWidth);
        yInterval = new Interval(0, this.MrjLength);
        zInterval = new Interval(0, this.MrjHeight);

        marginBox = new Box(planebase, xInterval, yInterval, zInterval);
      }
      else
      {
        ObjBox = new Box();
        marginBox = new Box();
        placementFailed = true;
      }
    }

    public void PlaceRefObjectEntrance(int[,,] emptyFullArray, int[,,] areaArray, out Box ObjBox, out Box marginBox, out bool placementFailed)
    {
      // find the cell numbers that objects fills in the Area.
      // Math.Ceiling ==> 1.1 ==> 2.0
      // because of preveting from errors like -0.9 ==> 0.0 (we want -1.0) we are using absolute values and multiply it with -1 if vector value is actually negative
      this.XCellMargin = (this.VectorMargin.X < 0 ? -1 : 1) * Math.Ceiling((double) Math.Abs(this.VectorMargin.X / CellSize));
      this.YCellMargin = (this.VectorMargin.Y < 0 ? -1 : 1) * Math.Ceiling((double) Math.Abs(this.VectorMargin.Y / CellSize));
      this.ZCellMargin = (this.VectorMargin.Z < 0 ? -1 : 1) * Math.Ceiling((double) Math.Abs(this.VectorMargin.Z / 150));

      //Rhino.RhinoApp.WriteLine(" MARGIN  numbers ----------------------------------" + XCellMargin.ToString() + ' ' + YCellMargin.ToString() + ' ' + ZCellMargin.ToString() + ' ');

      this.XCellObject = (this.VectorObject.X < 0 ? -1 : 1) * Math.Ceiling((double) Math.Abs(this.VectorObject.X / CellSize));
      this.YCellObject = (this.VectorObject.Y < 0 ? -1 : 1) * Math.Ceiling((double) Math.Abs(this.VectorObject.Y / CellSize));
      this.ZCellObject = (this.VectorObject.Z < 0 ? -1 : 1) * Math.Ceiling((double) Math.Abs(this.VectorObject.Z / 150));

      //Rhino.RhinoApp.WriteLine(" OBJECT  numbers ----------------------------------" + XCellObject.ToString() + ' ' + YCellObject.ToString() + ' ' + ZCellObject.ToString() + ' ');

      // We need to define the start end end points because we dont know if the inital poin is lower than end point

      bool emptyBool = true;
      bool sameZone = true;

      // while loop control variables.
      bool placeSuccessful = false; // stop if placement is successfull
      int trycount = 0;
      bool enoughTries = false; // stop after enough tries.

      while (placeSuccessful == false && enoughTries == false)
      {
        var rand = new Random();
        var randomCellIndex = rand.Next(this.SpaceList.Count / 2);

        // to place exteriorDoor we a random point over X. y=z=0
        baseX = (this.SpaceList[2 * randomCellIndex]) * CellSize;
        baseY = 0;
        baseZ = 0;

        BaseVector = new Vector3d(baseX, baseY, baseZ);

                /**
                  we are gonna use these start and end values in for loops but the problem here is we don't know if the new point after a vector is added is
                  lower than the base point or not. So we need o compare each axis'start end end conditions and find the min and max values.
                  like that for loops can work without any problem.
                 */
                 //FUTURE WORK : UPATE 150 constant with a level height!  it works but if we divide to differnt levels it will crash!
        int XLoopStartMargin = (int) ((int) (baseX / CellSize) < (baseX / CellSize + (int) XCellMargin) ? (int) (baseX / CellSize) : (baseX / CellSize + (int) XCellMargin));
        int XLoopEndMargin = (int) ((int) (baseX / CellSize) > (baseX / CellSize + (int) XCellMargin) ? (int) (baseX / CellSize) : (baseX / CellSize + (int) XCellMargin));

        int YLoopStartMargin = (int) ((int) (baseY / CellSize) < baseY / CellSize + (int) YCellMargin ? (int) (baseY / CellSize) : baseY / CellSize + (int) YCellMargin);
        int YLoopEnMargin = (int) ((int) (baseY / CellSize) > baseY / CellSize + (int) YCellMargin ? (int) (baseY / CellSize) : baseY / CellSize + (int) YCellMargin);

        int ZLoopStartMargin = (int) ((int) (baseZ / 150) < baseZ / 150 + (int) ZCellMargin ? (int) (baseZ / 150) : baseZ / 150 + (int) ZCellMargin);
        int ZLoopEndMargin = (int) ((int) (baseZ / 150) > baseZ / 150 + (int) ZCellMargin ? (int) (baseZ / 150) : baseZ / 150 + (int) ZCellMargin);

        /***/
        int XLoopStartObject = (int) ((int) (baseX / CellSize) < (baseX / CellSize + (int) XCellObject) ? (int) (baseX / CellSize) : (baseX / CellSize + (int) XCellObject));
        int XLoopEndObject = (int) ((int) (baseX / CellSize) > (baseX / CellSize + (int) XCellObject) ? (int) (baseX / CellSize) : (baseX / CellSize + (int) XCellObject));

        int YLoopStartObject = (int) ((int) (baseY / CellSize) < baseY / CellSize + (int) YCellObject ? (int) (baseY / CellSize) : baseY / CellSize + (int) YCellObject);
        int YLoopEnObject = (int) ((int) (baseY / CellSize) > baseY / CellSize + (int) YCellObject ? (int) (baseY / CellSize) : baseY / CellSize + (int) YCellObject);

        int ZLoopStartObject = (int) ((int) (baseZ / 150) < baseZ / 150 + (int) ZCellObject ? (int) (baseZ / 150) : baseZ / 150 + (int) ZCellObject);
        int ZLoopEndObject = (int) ((int) (baseZ / 150) > baseZ / 150 + (int) ZCellObject ? (int) (baseZ / 150) : baseZ / 150 + (int) ZCellObject);

        // can open the comments for debugging.
        /*
        Rhino.RhinoApp.WriteLine("X    Loop numbers ----------------------------------" + XLoopStartMargin.ToString() + ' ' + XLoopEndMargin.ToString() + ' ');
        Rhino.RhinoApp.WriteLine("Y    Loop numbers ----------------------------------" + YLoopStartMargin.ToString() + ' ' + YLoopEnMargin.ToString() + ' ');
        Rhino.RhinoApp.WriteLine("Z    Loop numbers ----------------------------------" + ZLoopStartMargin.ToString() + ' ' + ZLoopEndMargin.ToString() + ' ');
        */
        bool inLimit = true;

        // Before entering the for loops check if the objects boundries are in given area zone!
        // we are doing it to avoid for crashing AKA -- Out of Bound Exception --

        if (!((baseX + VectorMargin.X < 360) && (baseY + VectorMargin.Y < 660) && (baseZ + VectorMargin.Z < 300) &&
          (baseX + VectorMargin.X > 0) && (baseY + VectorMargin.Y > 0) && (baseZ + VectorMargin.Z > 0)))
        {
          inLimit = false;
        }

        if (inLimit) // if the conditions are okay! Dive into loops
        {
          for (int i = XLoopStartMargin; i < XLoopEndMargin; i++)
          {
            for (int j = YLoopStartMargin; j < YLoopEnMargin; j++)
            {
              for (int k = ZLoopStartMargin; k < ZLoopEndMargin; k++)
              {
                //checks if the cell is empty (We dont want to see any object in a cell! )
                if (((emptyFullArray[i, j, k] == 1) || (emptyFullArray[i, j, k] == 2)))
                {
                  //Rhino.RhinoApp.WriteLine(" Loop numbers ----------------------------------" + i.ToString() + ' ' + j.ToString() + ' ' + k.ToString() + ' ');
                  emptyBool = false;
                }

                // 2nd Loop checks if the zone is the same or empty zone // Actually margin can ovewflow to other zones
                /*
                if (!(areaArray[i, j, k] != this.ZoneName || areaArray[i, j, k] != 0))
                {
                sameZone = false;
                }
                */
              }
            }
          }

          // 2nd Loop checks if the zone is the same or empty zone
          for (int i = XLoopStartObject; i < XLoopEndObject; i++)
          {
            for (int j = YLoopStartObject; j < YLoopEnObject; j++)
            {
              for (int k = ZLoopStartObject; k < ZLoopEndObject; k++)
              {
                //checks if the cell is empty (We dont want to see margin or object in the cell )
                if (((emptyFullArray[i, j, k] == 1) || (emptyFullArray[i, j, k] == 2)))
                {
                  emptyBool = false;
                }

                // 2nd Loop checks if the zone is the same or empty zone
                if (!(areaArray[i, j, k] == this.ZoneName || areaArray[i, j, k] == 0)) // if the zone is not empty or same zone ==> False
                {
                  sameZone = false;
                }
              }
            }
          }

          if (emptyBool && sameZone) // if the conditions above are true // Place object and margin!
          {
            placeSuccessful = true;
            Rhino.RhinoApp.WriteLine("Reference Object conditions are successful ");
            //Place Margin
            for (int i = XLoopStartMargin; i < XLoopEndMargin; i++)
            {
              for (int j = YLoopStartMargin; j < YLoopEnMargin; j++)
              {
                for (int k = ZLoopStartMargin; k < ZLoopEndMargin; k++)
                {
                  //Rhino.RhinoApp.WriteLine(" Loop numbers ----------------------------------" + i.ToString() + ' ' + j.ToString() + ' ' + k.ToString() + ' ');
                  emptyFullArray[i, j, k] = 2; // 2 represents margin
                }
              }
            }
            //Place Object, object is smaller than margin
            for (int i = XLoopStartObject; i < XLoopEndObject; i++)
            {
              for (int j = YLoopStartObject; j < YLoopEnObject; j++)
              {
                for (int k = ZLoopStartObject; k < ZLoopEndObject; k++)
                {
                  //Rhino.RhinoApp.WriteLine("Loop inetegers --------------- " + i.ToString() + ' ' + j.ToString() + ' ' + k.ToString() + ' ');
                  emptyFullArray[i, j, k] = 1; // 1 represents object
                }
              }
            }
          }
          else
          {
            Rhino.RhinoApp.WriteLine("EntranceZone Placement Conditions are not satisfied ");
            trycount++;
            goto skipEntrance; //sometimes program were stuck here so instead of expecting it to continue it calculations force program to go out of the loop!
            // it automatically goes where the goto element is.

            //PLEASE CHECK JUMP STATEMENTS FOR  goto, break, continues etc.
            //https://www.geeksforgeeks.org/c-sharp-jump-statements-break-continue-goto-return-and-throw/

          }
        }
      }   
      skipEntrance:
        trycount++;

      Rhino.RhinoApp.WriteLine("Try count is : " + trycount);

      if (trycount > 60) // check the try number if it is over given number go out od the loop! to do that return a bool value.
      {
        Rhino.RhinoApp.WriteLine("Try count is over 60 placement is unsuccessful: ");
        enoughTries = true;
      }

      if (trycount < 60 && placeSuccessful)
      {
        // if all the conditions  are right place object and margin.
        placementFailed = false;
        Rhino.RhinoApp.WriteLine("REF OBJ baseX " + this.baseX);
        Rhino.RhinoApp.WriteLine("REF OBJ baseY " + this.baseY);
        Rhino.RhinoApp.WriteLine("REF OBJ baseZ " + this.baseZ);


        // create point and verctor for creaating plane
        Point3d pointa = new Point3d(baseX, 0, 0);
        Vector3d pointb = new Vector3d(0, 0, 1);

        // create plane to define base point of BOX
        Plane planebase = new Plane(pointa, pointb);

        // define box sides as intervals.
        Interval xInterval = new Interval(0, this.ObjWidth);
        Interval yInterval = new Interval(0, this.ObjLength);
        Interval zInterval = new Interval(0, this.ObjHeight);

        ObjBox = new Box(planebase, xInterval, yInterval, zInterval);

        xInterval = new Interval(0, this.MrjWidth);
        yInterval = new Interval(0, this.MrjLength);
        zInterval = new Interval(0, this.MrjHeight);

        marginBox = new Box(planebase, xInterval, yInterval, zInterval);
      }
      else
      {
        // even if conditions are false we need to return out parameter!
        // so we  are creating empty box but we are also returning PlacementFailed bool
        // so main function will not continue over this iteration anymore!
        ObjBox = new Box();
        marginBox = new Box();
        placementFailed = true;
      }
    }

    public void PlaceObject(int[,,] emptyFullArray, int[,,] areaArray, out Box ObjBox, out Box marginBox, out bool placementFailed)
    {
      // Create point and vector to create plane

      Point3d pointa = new Point3d(baseX, baseY, baseZ);
      Vector3d pointb = new Vector3d(0, 0, 1);

      // Crate a palne to create a Box
      Plane planebase = new Plane(pointa, pointb);

      // Define intervals by using Vector dimensions
      Interval xInterval = new Interval(0, this.VectorObject.X);
      Interval yInterval = new Interval(0, this.VectorObject.Y);
      Interval zInterval = new Interval(0, this.VectorObject.Z);

      ObjBox = new Box(planebase, xInterval, yInterval, zInterval);


      xInterval = new Interval(0, this.VectorMargin.X);
      yInterval = new Interval(0, this.VectorMargin.Y);
      zInterval = new Interval(0, this.VectorMargin.Z);

      marginBox = new Box(planebase, xInterval, yInterval, zInterval);

      List<int> growDirection = new List<int>();

      // Stack all the possible directions in a list!

      if (PreviousObject.Front == true)
        growDirection.Add(1); // Front Direction
      if (PreviousObject.Right == true)
        growDirection.Add(2); // Right Direction
      if (PreviousObject.Back == true)
        growDirection.Add(3); // Back Direction
      if (PreviousObject.Left == true)
        growDirection.Add(4); // Left Direction
      if (PreviousObject.Bottom == true)
        growDirection.Add(5); // Bottom Direction
      if (PreviousObject.Top == true)
        growDirection.Add(6); // Right Direction

      //Show the possible direction number !
      if (growDirection.Count != 0)
      {
        for (int i = 0; i < growDirection.Count; i++)
        {
          //Rhino.RhinoApp.WriteLine("In grow  " + growDirection[i]);
        }
      }

      // declare varibles to  check loop conditions.
      bool placeSuccess = false;
      int counter = 0;

      Random randm = new Random();
      // Rhino.RhinoApp.WriteLine("Element Number of the grow Direction before while loop " + growDirection.Count.ToString());

      while (growDirection.Count > 0 && placeSuccess == false && counter < 6) // if max 6 directions are tried go out of the loop. go out if one of them successsfull.
      {
        //Rhino.RhinoApp.WriteLine("Counter number in the check direction loop " + counter.ToString());

        int a = randm.Next(0, growDirection.Count); // get the index of one of the directions

        int randomDirectionValue = growDirection[a]; // get the value of direction in that index

        // Rhino.RhinoApp.WriteLine("Element Number of the grow Direction in while loop " + growDirection.Count.ToString());

        switch (randomDirectionValue)
        {
          case 1: // Try to place this.object to front of previousobject!
            if (CheckFront(emptyFullArray, areaArray)) // Check front controls each possible options to place the object and returns a bool true if the condition is successful
            {
              // if conditions are valid place object and margin.
              this.PlaceFront(emptyFullArray, out ObjBox, out marginBox);
              placeSuccess = true; // assign it true so loo will be broken
            }
            else
            {
              growDirection.Remove(randomDirectionValue);
              Rhino.RhinoApp.WriteLine("Could not be Placed to FRONT ");
              //Rhino.RhinoApp.WriteLine("Element Number of the grow Direction after removal " + growDirection.Count.ToString());
            }
            counter++;
            break;

          case 2:
            if (CheckRight(emptyFullArray, areaArray))
            {
              this.PlaceRight(emptyFullArray, out ObjBox, out marginBox);
              placeSuccess = true;
            }
            else
            {
              growDirection.Remove(randomDirectionValue);
              Rhino.RhinoApp.WriteLine("Could not Placed to RIGHT ");
              //Rhino.RhinoApp.WriteLine("Element Number of the grow Direction after removal " + growDirection.Count.ToString());
            }
            counter++;
            break;

          case 3:
            if (CheckBack(emptyFullArray, areaArray))
            {
              this.PlaceBack(emptyFullArray, out ObjBox, out marginBox);
              placeSuccess = true;
            }

            else
            {
              growDirection.Remove(randomDirectionValue);
              Rhino.RhinoApp.WriteLine("Could not Placed to BACK ");
              //Rhino.RhinoApp.WriteLine("Element Number of the grow Direction after removal " + growDirection.Count.ToString());
            }
            counter++;
            break;

          case 4:
            if (CheckLeft(emptyFullArray, areaArray))
            {
              this.PlaceLeft(emptyFullArray, out ObjBox, out marginBox);
              placeSuccess = true;
            }
            else
            {
              growDirection.Remove(randomDirectionValue);
              Rhino.RhinoApp.WriteLine("Could not Placed to LEFT ");
              //Rhino.RhinoApp.WriteLine("Element Number of the grow Direction after removal " + growDirection.Count.ToString());
            }
            counter++;
            break;

          case 5:
            if (CheckTop(emptyFullArray, areaArray))
            {
              this.PlaceTop(emptyFullArray, out ObjBox, out marginBox);
              placeSuccess = true;
            }
            else
            {
              growDirection.Remove(randomDirectionValue);
              Rhino.RhinoApp.WriteLine("Could not Placed to Top ");
              //Rhino.RhinoApp.WriteLine("Element Number of the grow Direction after removal " + growDirection.Count.ToString());
            }
            counter++;
            break;

          case 6:
            if (CheckBottom(emptyFullArray, areaArray))
            {
              this.PlaceBottom(emptyFullArray, out ObjBox, out marginBox);
              placeSuccess = true;
            }
            else
            {
              growDirection.Remove(randomDirectionValue);
              Rhino.RhinoApp.WriteLine("Could not Placed to BOTTOM ");
              //Rhino.RhinoApp.WriteLine("Element Number of the grow Direction after removal " + growDirection.Count.ToString());
            }
            counter++;
            break;

          default:
            counter++;
            break;
        }
      }

      if (placeSuccess == false)
      {
        Rhino.RhinoApp.WriteLine("Placement unsuccessfull ");
        placementFailed = true;// after all of the tries placement failed. It will result in breaking the main loop.!
      }
      else
        placementFailed = false;
    }

    public bool CheckFront(int[,,] emptyFullArray, int[,,] areaArray)
    {

            /*
             Check Functions have same process in itselfs.
             It checkes each possible mirror, rotation and closest base points in given directions projecting the previousMargin border.

             */
      bool suitableDirection = true;

      // start baseSlider variables. These are the variables sliding over previous objects side and creating multiple base points fot this.Object
      int baseSliderMin = 0;
      int baseSliderMax = 0;

      // Shuffle the rotation and mirror functions in order to randomize process.

      Fisher_Yates_CardDeck_Shuffle(MirrorOpt);
      Fisher_Yates_CardDeck_Shuffle(RotationOpt);

      for (int f = 0; f < this.MirrorOpt.Count; f++)
      {
        for (int g = 0; g < this.RotationOpt.Count; g++)
        {
          if (PreviousObject.AppliedMirror == 0)// Mirror default
          {
            // Min value is the min integeer value when we are checking growing direction side. Normally we can set one point but we want to
            // slide over from min valuee to max value over edge in the direction.
            // we can write if statements separetly but ? operator gives us a chance to check condition and return expected values in one line.
            // https://docs.microsoft.com/en-us/dotnet/csharp/language-reference/operators/conditional-operator

            baseSliderMin = (int) (PreviousObject.VectorMargin.X * PreviousObject.VectorMargin.Y > 0 ? (Math.Min(PreviousObject.baseX, PreviousObject.baseX + PreviousObject.VectorMargin.X))
              : (Math.Min(PreviousObject.baseY, PreviousObject.baseY + PreviousObject.VectorMargin.Y)));
            baseSliderMax = (int) (PreviousObject.VectorMargin.X * PreviousObject.VectorMargin.Y > 0 ? (Math.Max(PreviousObject.baseX + PreviousObject.VectorMargin.X, PreviousObject.baseX))
              : (Math.Max(PreviousObject.baseY, PreviousObject.baseY)));
          }

          if (PreviousObject.AppliedMirror == 1) // Mirror Z
          {
            baseSliderMin = (int) (PreviousObject.VectorMargin.X * PreviousObject.VectorMargin.Y > 0 ? (Math.Min(PreviousObject.baseX, PreviousObject.baseX + PreviousObject.VectorMargin.X))
              : (Math.Min(PreviousObject.baseY, PreviousObject.baseY + PreviousObject.VectorMargin.Y)));
            baseSliderMax = (int) (PreviousObject.VectorMargin.X * PreviousObject.VectorMargin.Y > 0 ? (Math.Max(PreviousObject.baseX + PreviousObject.VectorMargin.X, PreviousObject.baseX))
              : (Math.Max(PreviousObject.baseY, PreviousObject.baseY)));
          }

          if (PreviousObject.AppliedMirror == 2) // Mirror X
          {
            baseSliderMin = (int) (PreviousObject.VectorMargin.X * PreviousObject.VectorMargin.Y < 0 ? (Math.Min(PreviousObject.baseX, PreviousObject.baseX + PreviousObject.VectorMargin.X))
              : (Math.Min(PreviousObject.baseY, PreviousObject.baseY + PreviousObject.VectorMargin.Y)));

            baseSliderMax = (int) (PreviousObject.VectorMargin.X * PreviousObject.VectorMargin.Y < 0 ? (Math.Max(PreviousObject.baseX + PreviousObject.VectorMargin.X, PreviousObject.baseX))
              : (Math.Max(PreviousObject.baseY, PreviousObject.baseY)));
          }

          if (PreviousObject.AppliedMirror == 3) // Mirror Y
          {
            baseSliderMin = (int) (PreviousObject.VectorMargin.X * PreviousObject.VectorMargin.Y < 0 ? (Math.Min(PreviousObject.baseX, PreviousObject.baseX + PreviousObject.VectorMargin.X))
              : (Math.Min(PreviousObject.baseY, PreviousObject.baseY + PreviousObject.VectorMargin.Y)));

            baseSliderMax = (int) (PreviousObject.VectorMargin.X * PreviousObject.VectorMargin.Y < 0 ? (Math.Max(PreviousObject.baseX + PreviousObject.VectorMargin.X, PreviousObject.baseX))
              : (Math.Max(PreviousObject.baseY, PreviousObject.baseY)));
          }

          for (int h = baseSliderMin; h <= baseSliderMax; h = h + this.CellSize)
            // slide over the base points given above.
          {
            this.Mirroring(MirrorOpt[f]);      // apply  mirror function
            this.Rotate((int) RotationOpt[g]); // apply rotate function

            AppliedRotation = RotationOpt[g]; // save applied rotation
            AppliedMirror = MirrorOpt[f];    // save applied mirror

            bool inLimits = true;
            bool emptyBool = true;
            bool sameZone = true;

            suitableDirection = true;
            bool initialDirectionCheck = false;

            // find the cell numbers that objects fills in the Area.
            // Math.Ceiling ==> 1.1 ==> 2.0
            // because of preveting from errors like -0.9 ==> 0.0 (we want -1.0) we are using absolute values and multiply it with -1 if vector value is actually negative

            // Get the cell values * check entranceReference method for more.
            this.XCellMargin = (this.VectorMargin.X < 0 ? -1 : 1) * Math.Ceiling((double) Math.Abs(this.VectorMargin.X / CellSize));
            this.YCellMargin = (this.VectorMargin.Y < 0 ? -1 : 1) * Math.Ceiling((double) Math.Abs(this.VectorMargin.Y / CellSize));
            this.ZCellMargin = (this.VectorMargin.Z < 0 ? -1 : 1) * Math.Ceiling((double) Math.Abs(this.VectorMargin.Z / 150));

            this.XCellObject = (this.VectorObject.X < 0 ? -1 : 1) * Math.Ceiling((double) Math.Abs(this.VectorObject.X / CellSize));
            this.YCellObject = (this.VectorObject.Y < 0 ? -1 : 1) * Math.Ceiling((double) Math.Abs(this.VectorObject.Y / CellSize));
            this.ZCellObject = (this.VectorObject.Z < 0 ? -1 : 1) * Math.Ceiling((double) Math.Abs(this.VectorObject.Z / 150));

                        /*
                        Rhino.RhinoApp.WriteLine(" MARGIN  Front numbers -----------------------" + XCellMargin.ToString() + ' ' + YCellMargin.ToString() + ' ' + ZCellMargin.ToString() + ' ');
                        Rhino.RhinoApp.WriteLine(" OBJECT  Front numbers -----------------------" + XCellObject.ToString() + ' ' + YCellObject.ToString() + ' ' + ZCellObject.ToString() + ' ');
                        */

                        // Cactch the base point conditions according to its rotation and mirror conditions!
                        // h is the sliding values.

            if (PreviousObject.AppliedMirror == 0) // assign base points, Use sliding variables
            {
              if (PreviousObject.VectorMargin.X * PreviousObject.VectorMargin.Y > 0)
              {
                this.baseX = h; // slide over X axis , Y axis should be constant
                this.baseY = PreviousObject.baseY + PreviousObject.YCellMargin * this.CellSize;
                this.baseZ = PreviousObject.baseZ;
              }
              else if (PreviousObject.VectorMargin.X * PreviousObject.VectorMargin.Y < 0)
              {
                this.baseX = PreviousObject.baseX + PreviousObject.XCellMargin * this.CellSize;
                this.baseY = h; // slide over Y axis , X axis should be constant
                this.baseZ = PreviousObject.baseZ;
              }
            }

            if (PreviousObject.AppliedMirror == 2)
            {

              if (PreviousObject.VectorMargin.X * PreviousObject.VectorMargin.Y < 0)
              {
                this.baseX = h; // slide over X axis , Y axis should be constant
                this.baseY = PreviousObject.baseY + PreviousObject.YCellMargin * this.CellSize;
                this.baseZ = PreviousObject.baseZ;
              }
              else if (PreviousObject.PreviousObject.VectorMargin.X * PreviousObject.PreviousObject.VectorMargin.Y > 0)
              {
                this.baseX = PreviousObject.baseX + PreviousObject.XCellMargin * this.CellSize;
                this.baseY = h; // slide over X axis , Y axis should be constant
                this.baseZ = PreviousObject.baseZ;
              }

              if (AppliedRotation == 90)
              {
                this.baseX = PreviousObject.baseX + PreviousObject.XCellMargin * this.CellSize; // slide over X axis , Y axis should be constant
                this.baseY = PreviousObject.baseY + PreviousObject.YCellMargin * this.CellSize;
                this.baseZ = PreviousObject.baseZ;
              }
            }

            if (PreviousObject.AppliedMirror == 3)
            {
              if (PreviousObject.VectorMargin.X * PreviousObject.VectorMargin.Y < 0)
              {
                this.baseX = h; // slide over X axis , Y axis should be constant
                this.baseY = PreviousObject.baseY + PreviousObject.YCellMargin * this.CellSize;
                this.baseZ = PreviousObject.baseZ;
              }
              else if (VectorMargin.X * VectorMargin.Y > 0)
              {
                this.baseX = PreviousObject.baseX + PreviousObject.XCellMargin * this.CellSize;
                this.baseY = h; // slide over Y axis , X axis should be constant
                this.baseZ = PreviousObject.baseZ;
              }
            }

            Point3d pointa = new Point3d(0, 0, 0);
            Vector3d pointb = new Vector3d(0, 0, 1);
            Plane planee = new Plane(pointa, pointb);

            Vector3d vecX1 = new Vector3d(1, 0, 0);
            BaseVector = new Vector3d(baseX, baseY, baseZ); // by using the given base points create base vector.

            /**
            * We don't want to new object is overflows to other directions so we need to limit the directions.
            * these methods checks if everything works fine after placing new object vector to base point..
            *
            */
            if (PreviousObject.AppliedMirror == 0) // mirror default
            {
              if (
                (PreviousObject.VectorMargin.X > 0 && PreviousObject.VectorMargin.Y > 0 && VectorObject.Y > 0) || // if previous object looks front // Y value should be positive
                (PreviousObject.VectorMargin.X < 0 && PreviousObject.VectorMargin.Y < 0 && VectorMargin.Y < 0) || // if previous object looks back  // Y value should be negative
                (PreviousObject.VectorMargin.X < 0 && PreviousObject.VectorMargin.Y > 0 && VectorMargin.X < 0) || // if previous object looks left //  X value should be positive
                (PreviousObject.VectorMargin.X > 0 && PreviousObject.VectorMargin.Y < 0 && VectorMargin.X > 0)       // if previous object looks right // X value should be positive
                )
              {
                initialDirectionCheck = true;
              }
            }

            else if (PreviousObject.AppliedMirror == 1) //mirror  Z
            {
              if (
                (PreviousObject.VectorMargin.X > 0 && PreviousObject.VectorMargin.Y > 0 && VectorObject.Y > 0) || // if previous object looks front // Y value should be positive
                (PreviousObject.VectorMargin.X < 0 && PreviousObject.VectorMargin.Y < 0 && VectorMargin.Y < 0) || // if previous object looks back  // Y value should be negative
                (PreviousObject.VectorMargin.X < 0 && PreviousObject.VectorMargin.Y > 0 && VectorMargin.X < 0) || // if previous object looks left //  X value should be positive
                (PreviousObject.VectorMargin.X > 0 && PreviousObject.VectorMargin.Y < 0 && VectorMargin.X > 0)       // if previous object looks right // X value should be positive
                )
              {
                initialDirectionCheck = true;
              }
            }

            else if (PreviousObject.AppliedMirror == 2) // mirror x
            {
              if ((PreviousObject.VectorMargin.X > 0 && PreviousObject.VectorMargin.Y > 0 && VectorObject.X > 0) ||
                (PreviousObject.VectorMargin.X < 0 && PreviousObject.VectorMargin.Y < 0 && VectorMargin.X < 0) ||
                (PreviousObject.VectorMargin.X < 0 && PreviousObject.VectorMargin.Y > 0 && VectorMargin.Y > 0) ||
                (PreviousObject.VectorMargin.X > 0 && PreviousObject.VectorMargin.Y < 0 && VectorMargin.Y < 0)
                )
              {
                initialDirectionCheck = true;
              }
            }

            else if (PreviousObject.AppliedMirror == 3) //mirror  Y
            {
              if ((PreviousObject.VectorMargin.X > 0 && PreviousObject.VectorMargin.Y > 0 && VectorObject.X > 0) || // if previous object looks front // Y value should be positive
                (PreviousObject.VectorMargin.X < 0 && PreviousObject.VectorMargin.Y < 0 && VectorMargin.X < 0) || // if previous object looks back  // Y value should be negative
                (PreviousObject.VectorMargin.X < 0 && PreviousObject.VectorMargin.Y > 0 && VectorMargin.Y > 0) || // if previous object looks left  // X value should be positive
                (PreviousObject.VectorMargin.X > 0 && PreviousObject.VectorMargin.Y < 0 && VectorMargin.Y < 0)      // if previous object looks right // X value should be positive
                )
              {
                initialDirectionCheck = true;
              }

            }
            else
            {
                            /*
                            if (PreviousObject.VectorMargin.X > 0 && PreviousObject.VectorMargin.Y > 0 && VectorObject.Y > 0 || // if previous object looks front // Y value should be positive
                              PreviousObject.VectorMargin.X < 0 && PreviousObject.VectorMargin.Y < 0 && VectorMargin.Y < 0 || // if previous object looks back  // Y value should be negative
                              PreviousObject.VectorMargin.X < 0 && PreviousObject.VectorMargin.Y > 0 && VectorMargin.X < 0 || // if previous object looks left //  X value should be positive
                              PreviousObject.VectorMargin.X > 0 && PreviousObject.VectorMargin.Y < 0 && VectorMargin.X > 0       // if previous object looks right // X value should be positive
                              )
                            {
                              initialDirectionCheck = true;
                            }
                              */
            }

            if (!((baseX + VectorMargin.X < 360) && (baseY + VectorMargin.Y < 660) && (baseZ + VectorMargin.Z < 300) &&
              (baseX + VectorMargin.X > 0) && (baseY + VectorMargin.Y > 0) && (baseZ + VectorMargin.Z > 0)))
            {
              inLimits = false;
            }
            // Rhino.RhinoApp.WriteLine("Bools " + suitableDirection.ToString() + "    " + inLimits.ToString() + ' ');

            /**
            we are gonna use these start and end values in for loops but the problem here is we don't know if the new point after a vector is added is
            lower than the base point or not. So we need o compare each axis'start end end conditions and find the min and max values.
            like that for loops can work without any problem.
            */
            //FUTURE WORK : UPATE 150 constant with a level height!  it works but if we divide to differnt levels it will crash!

            int XLoopStartMargin = (int) ((int) (baseX / CellSize) < (baseX / CellSize + (int) XCellMargin) ? (int) (baseX / CellSize) : (baseX / CellSize + (int) XCellMargin));
            int XLoopEndMargin = (int) ((int) (baseX / CellSize) > (baseX / CellSize + (int) XCellMargin) ? (int) (baseX / CellSize) : (baseX / CellSize + (int) XCellMargin));

            int YLoopStartMargin = (int) ((int) (baseY / CellSize) < baseY / CellSize + (int) YCellMargin ? (int) (baseY / CellSize) : baseY / CellSize + (int) YCellMargin);
            int YLoopEnMargin = (int) ((int) (baseY / CellSize) > baseY / CellSize + (int) YCellMargin ? (int) (baseY / CellSize) : baseY / CellSize + (int) YCellMargin);

            int ZLoopStartMargin = (int) ((int) (baseZ / 150) < baseZ / 150 + (int) ZCellMargin ? (int) (baseZ / 150) : baseZ / 150 + (int) ZCellMargin);
            int ZLoopEndMargin = (int) ((int) (baseZ / 150) > baseZ / 150 + (int) ZCellMargin ? (int) (baseZ / 150) : baseZ / 150 + (int) ZCellMargin);

            /***/
            int XLoopStartObject = (int) ((int) (baseX / CellSize) < (baseX / CellSize + (int) XCellObject) ? (int) (baseX / CellSize) : (baseX / CellSize + (int) XCellObject));
            int XLoopEndObject = (int) ((int) (baseX / CellSize) > (baseX / CellSize + (int) XCellObject) ? (int) (baseX / CellSize) : (baseX / CellSize + (int) XCellObject));

            int YLoopStartObject = (int) ((int) (baseY / CellSize) < baseY / CellSize + (int) YCellObject ? (int) (baseY / CellSize) : baseY / CellSize + (int) YCellObject);
            int YLoopEnObject = (int) ((int) (baseY / CellSize) > baseY / CellSize + (int) YCellObject ? (int) (baseY / CellSize) : baseY / CellSize + (int) YCellObject);

            int ZLoopStartObject = (int) ((int) (baseZ / 150) < baseZ / 150 + (int) ZCellObject ? (int) (baseZ / 150) : baseZ / 150 + (int) ZCellObject);
            int ZLoopEndObject = (int) ((int) (baseZ / 150) > baseZ / 150 + (int) ZCellObject ? (int) (baseZ / 150) : baseZ / 150 + (int) ZCellObject);

                        /*
                                    Rhino.RhinoApp.WriteLine("X  Front  Margin Loop numbers -------------" + XLoopStartMargin.ToString() + ' ' + XLoopEndMargin.ToString() + ' ');
                                    Rhino.RhinoApp.WriteLine("Y  Front Margin  Loop numbers -------------" + YLoopStartMargin.ToString() + ' ' + YLoopEnMargin.ToString() + ' ');
                                    Rhino.RhinoApp.WriteLine("Z  Front  Margin Loop numbers -------------" + ZLoopStartMargin.ToString() + ' ' + ZLoopEndMargin.ToString() + ' ');

                                    Rhino.RhinoApp.WriteLine("X  Front Object Loop numbers ----------" + XLoopStartObject.ToString() + ' ' + XLoopEndObject.ToString() + ' ');
                                    Rhino.RhinoApp.WriteLine("Y  Front Object  Loop numbers ---------" + YLoopStartObject.ToString() + ' ' + YLoopEnObject.ToString() + ' ');
                                    Rhino.RhinoApp.WriteLine("Z  Front Object  Loop numbers ---------" + ZLoopStartObject.ToString() + ' ' + ZLoopEndObject.ToString() + ' ');
                        */
            if (inLimits && initialDirectionCheck)
            {
              for (int i = XLoopStartMargin; i < XLoopEndMargin; i++)
              {
                for (int j = YLoopStartMargin; j < YLoopEnMargin; j++)
                {
                  for (int k = ZLoopStartMargin; k < ZLoopEndMargin; k++)
                  {
                    //checks if the cell is empty (We dont want to see an object in a cell! )
                    if (((emptyFullArray[i, j, k] == 1) || (emptyFullArray[i, j, k] == 2)))
                    {
                      //Rhino.RhinoApp.WriteLine("Front Margin Array is full, Loop numbers ------" + i.ToString() + ' ' + j.ToString() + ' ' + k.ToString() + ' ');
                      emptyBool = false;
                    }

                    // 2nd Loop checks if the zone is the same or empty zone // Actually margin can ovewflow to other zones
                    /*
                    if (!(areaArray[i, j, k] != this.ZoneName || areaArray[i, j, k] != 0))
                    {
                    sameZone = false;
                    }
                    */
                  }
                }
              }
              // 2nd Loop checks if the zone is the same or empty zone
              for (int i = XLoopStartObject; i < XLoopEndObject; i++)
              {
                for (int j = YLoopStartObject; j < YLoopEnObject; j++)
                {
                  for (int k = ZLoopStartObject; k < ZLoopEndObject; k++)
                  {
                    //checks if the cell is empty (We dont want to see margin or object in the cell )
                    if (((emptyFullArray[i, j, k] == 1) || (emptyFullArray[i, j, k] == 2)))
                    {
                      //Rhino.RhinoApp.WriteLine("Front object Array is full: Loop numbers ---------------------------------- i:" + i.ToString() + 'j' + j.ToString() + 'k' + k.ToString() + ' ');
                      emptyBool = false;
                    }

                    // 2nd Loop checks if the zone is the same or empty zone
                    if (!(areaArray[i, j, k] == this.ZoneName || areaArray[i, j, k] == 0))
                    {
                      sameZone = false;
                    }
                  }
                }
              }

              if (emptyBool && sameZone)
              {
                //if everything is fine change bool to  true and skip the loop...
                Rhino.RhinoApp.WriteLine(" ");
                Rhino.RhinoApp.WriteLine("Rotation Angle is:  " + RotationOpt[g].ToString());
                Rhino.RhinoApp.WriteLine("MirrorOption is:  " + MirrorOpt[f].ToString());
                Rhino.RhinoApp.WriteLine("Sliding base position is:  " + h.ToString());
                Rhino.RhinoApp.WriteLine("Base VEctor is :  " + this.BaseVector.ToString());
                Rhino.RhinoApp.WriteLine(" ");

                suitableDirection = true;
                Rhino.RhinoApp.WriteLine("Place Front: Conditions are  satisfied********************************************************************************************************** ");
                goto SkipLoop;
                // BREAK THE LOOP IF A SOLUTION IS FOUND
              }
              else
              {

                // even if conditions are false we need to return out parameter!
                // so we  are creating empty box but we are also returning PlacementFailed bool
                // so main function will not continue over this iteration anymore!

                Rhino.RhinoApp.WriteLine("Place Front: Conditions are not satisfied ");
                suitableDirection = false;
                // RESET DRIECTION AND MIRROR
                VectorMargin = this.VectorMarginCache;
                VectorObject = this.VectorObjectCache;
              }
            }
            else
            {
              Rhino.RhinoApp.WriteLine("Place Front:  Conditions are not satisfied ");
              suitableDirection = false;
              // RESET DRIECTION AND MIRROR
              VectorMargin = this.VectorMarginCache;
              VectorObject = this.VectorObjectCache;
            }
          }
        }
      }
      SkipLoop:
        return suitableDirection;// return true!
    }

    public void PlaceFront(int[,,] emptyFullArray, out Box ObjBox, out Box marginBox)
    {

            /**
              we are gonna use these start and end values in for loops but the problem here is we don't know if the new point after a vector is added is
              lower than the base point or not. So we need o compare each axis'start end end conditions and find the min and max values.
              like that for loops can work without any problem.
             */

      int XLoopStartMargin = (int) ((int) (baseX / CellSize) < (baseX / CellSize + (int) XCellMargin) ? (int) (baseX / CellSize) : (baseX / CellSize + (int) XCellMargin));
      int XLoopEndMargin = (int) ((int) (baseX / CellSize) > (baseX / CellSize + (int) XCellMargin) ? (int) (baseX / CellSize) : (baseX / CellSize + (int) XCellMargin));

      int YLoopStartMargin = (int) ((int) (baseY / CellSize) < baseY / CellSize + (int) YCellMargin ? (int) (baseY / CellSize) : baseY / CellSize + (int) YCellMargin);
      int YLoopEnMargin = (int) ((int) (baseY / CellSize) > baseY / CellSize + (int) YCellMargin ? (int) (baseY / CellSize) : baseY / CellSize + (int) YCellMargin);

      int ZLoopStartMargin = (int) ((int) (baseZ / 150) < baseZ / 150 + (int) ZCellMargin ? (int) (baseZ / 150) : baseZ / 150 + (int) ZCellMargin);
      int ZLoopEndMargin = (int) ((int) (baseZ / 150) > baseZ / 150 + (int) ZCellMargin ? (int) (baseZ / 150) : baseZ / 150 + (int) ZCellMargin);


      int XLoopStartObject = (int) ((int) (baseX / CellSize) < (baseX / CellSize + (int) XCellObject) ? (int) (baseX / CellSize) : (baseX / CellSize + (int) XCellObject));
      int XLoopEndObject = (int) ((int) (baseX / CellSize) > (baseX / CellSize + (int) XCellObject) ? (int) (baseX / CellSize) : (baseX / CellSize + (int) XCellObject));

      int YLoopStartObject = (int) ((int) (baseY / CellSize) < baseY / CellSize + (int) YCellObject ? (int) (baseY / CellSize) : baseY / CellSize + (int) YCellObject);
      int YLoopEnObject = (int) ((int) (baseY / CellSize) > baseY / CellSize + (int) YCellObject ? (int) (baseY / CellSize) : baseY / CellSize + (int) YCellObject);

      int ZLoopStartObject = (int) ((int) (baseZ / 150) < baseZ / 150 + (int) ZCellObject ? (int) (baseZ / 150) : baseZ / 150 + (int) ZCellObject);
      int ZLoopEndObject = (int) ((int) (baseZ / 150) > baseZ / 150 + (int) ZCellObject ? (int) (baseZ / 150) : baseZ / 150 + (int) ZCellObject);

      //place margin
      for (int i = XLoopStartMargin; i < XLoopEndMargin; i++)
      {
        for (int j = YLoopStartMargin; j < YLoopEnMargin; j++)
        {
          for (int k = ZLoopStartMargin; k < ZLoopEndMargin; k++)
          {
            emptyFullArray[i, j, k] = 2; // 2 represents margin
          }
        }
      }
      //Place Object, object is smaller than margin
      for (int i = XLoopStartObject; i < XLoopEndObject; i++)
      {
        for (int j = YLoopStartObject; j < YLoopEnObject; j++)
        {
          for (int k = ZLoopStartObject; k < ZLoopEndObject; k++)
          {
            emptyFullArray[i, j, k] = 1; // 1 represents object
          }
        }
      }


      //Rhino.RhinoApp.WriteLine("Base Vector in placeFront is :  " + this.BaseVector.ToString());

      // Create output Boxes. !  For margin and Objects
      Point3d pointa = new Point3d(baseX, baseY, baseZ);
      Vector3d pointb = new Vector3d(0, 0, 1);

      Plane planebase = new Plane(pointa, pointb);

      Interval xInterval = new Interval(0, this.VectorObject.X);
      Interval yInterval = new Interval(0, this.VectorObject.Y);
      Interval zInterval = new Interval(0, this.VectorObject.Z);

      ObjBox = new Box(planebase, xInterval, yInterval, zInterval);

      xInterval = new Interval(0, this.VectorMargin.X);
      yInterval = new Interval(0, this.VectorMargin.Y);
      zInterval = new Interval(0, this.VectorMargin.Z);

      marginBox = new Box(planebase, xInterval, yInterval, zInterval);

    }

    public bool CheckRight(int[,,] emptyFullArray, int[,,] areaArray)
    {

      /*****************************/
      bool suitableDirection = true;

      int baseSliderMin = 0;
      int baseSliderMax = 0;

      Fisher_Yates_CardDeck_Shuffle(MirrorOpt);
      Fisher_Yates_CardDeck_Shuffle(RotationOpt);

      for (int f = 0; f < this.MirrorOpt.Count; f++)
      {
        for (int g = 0; g < this.RotationOpt.Count; g++)
        {
          if (PreviousObject.AppliedMirror == 0)
          {
            baseSliderMin = (int) (PreviousObject.VectorMargin.X * PreviousObject.VectorMargin.Y > 0 ? (Math.Min(PreviousObject.baseY, PreviousObject.baseY + PreviousObject.VectorMargin.Y))
              : (Math.Min(PreviousObject.baseX, PreviousObject.baseX + PreviousObject.VectorMargin.X)));
            baseSliderMax = (int) (PreviousObject.VectorMargin.X * PreviousObject.VectorMargin.Y > 0 ? (Math.Max(PreviousObject.baseY, PreviousObject.baseY + PreviousObject.VectorMargin.Y))
              : (Math.Max(PreviousObject.baseX + PreviousObject.VectorMargin.X, PreviousObject.baseX)));
          }

          if (PreviousObject.AppliedMirror == 1)
          {
            baseSliderMin = (int) (PreviousObject.VectorMargin.X * PreviousObject.VectorMargin.Y > 0 ? (Math.Min(PreviousObject.baseX, PreviousObject.baseX + PreviousObject.VectorMargin.X))
              : (Math.Min(PreviousObject.baseY, PreviousObject.baseY + PreviousObject.VectorMargin.Y)));
            baseSliderMax = (int) (PreviousObject.VectorMargin.X * PreviousObject.VectorMargin.Y > 0 ? (Math.Max(PreviousObject.baseX, PreviousObject.baseX + PreviousObject.VectorMargin.X))
              : (Math.Max(PreviousObject.baseY, PreviousObject.baseY + PreviousObject.VectorMargin.Y)));
          }

          if (PreviousObject.AppliedMirror == 2)
          {
            baseSliderMin = (int) (PreviousObject.VectorMargin.X * PreviousObject.VectorMargin.Y > 0 ? (Math.Min(PreviousObject.baseX, PreviousObject.baseX + PreviousObject.VectorMargin.X))
              : (Math.Min(PreviousObject.baseY, PreviousObject.baseY + PreviousObject.VectorMargin.Y)));

            baseSliderMax = (int) (PreviousObject.VectorMargin.X * PreviousObject.VectorMargin.Y > 0 ? (Math.Max(PreviousObject.baseX, PreviousObject.baseX + PreviousObject.VectorMargin.X))
              : (Math.Max(PreviousObject.baseY, PreviousObject.baseY + PreviousObject.VectorMargin.Y)));
          }

          if (PreviousObject.AppliedMirror == 3)
          {
            baseSliderMin = (int) (PreviousObject.VectorMargin.X * PreviousObject.VectorMargin.Y < 0 ? (Math.Min(PreviousObject.baseX, PreviousObject.baseX + PreviousObject.VectorMargin.X))
              : (Math.Min(PreviousObject.baseY, PreviousObject.baseY + PreviousObject.VectorMargin.Y)));

            baseSliderMax = (int) (PreviousObject.VectorMargin.X * PreviousObject.VectorMargin.Y < 0 ? (Math.Max(PreviousObject.baseX, PreviousObject.baseX + PreviousObject.VectorMargin.X))
              : (Math.Max(PreviousObject.baseY, PreviousObject.baseY + PreviousObject.VectorMargin.Y)));
          }

          for (int h = baseSliderMin; h <= baseSliderMax; h = h + this.CellSize)

          {
            this.Mirroring(MirrorOpt[f]);
            this.Rotate((int) RotationOpt[g]);

            AppliedRotation = RotationOpt[g];
            AppliedMirror = MirrorOpt[f];

            bool inLimits = true;
            bool emptyBool = true;
            bool sameZone = true;

            suitableDirection = true;
            bool initialDirectionCheck = false;

            this.XCellMargin = (this.VectorMargin.X < 0 ? -1 : 1) * Math.Ceiling((double) Math.Abs(this.VectorMargin.X / CellSize));
            this.YCellMargin = (this.VectorMargin.Y < 0 ? -1 : 1) * Math.Ceiling((double) Math.Abs(this.VectorMargin.Y / CellSize));
            this.ZCellMargin = (this.VectorMargin.Z < 0 ? -1 : 1) * Math.Ceiling((double) Math.Abs(this.VectorMargin.Z / 150));

            this.XCellObject = (this.VectorObject.X < 0 ? -1 : 1) * Math.Ceiling((double) Math.Abs(this.VectorObject.X / CellSize));
            this.YCellObject = (this.VectorObject.Y < 0 ? -1 : 1) * Math.Ceiling((double) Math.Abs(this.VectorObject.Y / CellSize));
            this.ZCellObject = (this.VectorObject.Z < 0 ? -1 : 1) * Math.Ceiling((double) Math.Abs(this.VectorObject.Z / 150));

                        /*
                        Rhino.RhinoApp.WriteLine(" MARGIN  Front numbers -----------------------" + XCellMargin.ToString() + ' ' + YCellMargin.ToString() + ' ' + ZCellMargin.ToString() + ' ');
                        Rhino.RhinoApp.WriteLine(" OBJECT  Front numbers -----------------------" + XCellObject.ToString() + ' ' + YCellObject.ToString() + ' ' + ZCellObject.ToString() + ' ');
                        */

            if (PreviousObject.AppliedMirror == 0)
            {
              if (PreviousObject.VectorMargin.X * PreviousObject.VectorMargin.Y > 0)
              {
                this.baseX = PreviousObject.baseX + PreviousObject.XCellMargin * this.CellSize;
                this.baseY = h;
                this.baseZ = PreviousObject.baseZ;
              }
              else if (PreviousObject.VectorMargin.X * PreviousObject.VectorMargin.Y < 0)
              {
                this.baseX = h;
                this.baseY = PreviousObject.baseY + PreviousObject.YCellMargin * this.CellSize;
                this.baseZ = PreviousObject.baseZ;
              }
            }

            if (PreviousObject.AppliedMirror == 2)
            {

              if (PreviousObject.VectorMargin.X * PreviousObject.VectorMargin.Y > 0)
              {
                this.baseX = h;
                this.baseY = PreviousObject.baseY + PreviousObject.YCellMargin * this.CellSize;
                this.baseZ = PreviousObject.baseZ;

              }
              else if (PreviousObject.VectorMargin.X * PreviousObject.VectorMargin.Y < 0)
              {
                this.baseX = PreviousObject.baseX + PreviousObject.XCellMargin * this.CellSize;
                this.baseY = h;
                this.baseZ = PreviousObject.baseZ;
              }
            }

            if (PreviousObject.AppliedMirror == 3)
            {

              if (VectorMargin.X * VectorMargin.Y > 0)
              {
                this.baseX = h;
                this.baseY = PreviousObject.baseY + PreviousObject.YCellMargin * this.CellSize;
                this.baseZ = PreviousObject.baseZ;
              }
              else if (PreviousObject.VectorMargin.X * PreviousObject.VectorMargin.Y < 0)
              {

                this.baseX = PreviousObject.baseX + PreviousObject.XCellMargin * this.CellSize;
                this.baseY = h; // slide over Y axis , X axis should be constant
                this.baseZ = PreviousObject.baseZ;
              }
            }
            Point3d pointa = new Point3d(0, 0, 0);
            Vector3d pointb = new Vector3d(0, 0, 1);
            Plane planee = new Plane(pointa, pointb);

            BaseVector = new Vector3d(baseX, baseY, baseZ);

            if (PreviousObject.AppliedMirror == 0)
            {
              if (
                (PreviousObject.VectorMargin.X > 0 && PreviousObject.VectorMargin.Y > 0 && VectorObject.X > 0) || // if previous object looks front // Y value should be positive
                (PreviousObject.VectorMargin.X < 0 && PreviousObject.VectorMargin.Y < 0 && VectorMargin.X < 0) || // if previous object looks back  // Y value should be negative
                (PreviousObject.VectorMargin.X < 0 && PreviousObject.VectorMargin.Y > 0 && VectorMargin.Y > 0) || // if previous object looks left //  X value should be positive
                (PreviousObject.VectorMargin.X > 0 && PreviousObject.VectorMargin.Y < 0 && VectorMargin.Y < 0)       // if previous object looks right // X value should be positive
                )

              {
                initialDirectionCheck = true;
              }
            }

            else if (PreviousObject.AppliedMirror == 1) // Z
            {
              if (
                (PreviousObject.VectorMargin.X > 0 && PreviousObject.VectorMargin.Y > 0 && VectorObject.X > 0) ||
                (PreviousObject.VectorMargin.X < 0 && PreviousObject.VectorMargin.Y < 0 && VectorMargin.X < 0) ||
                (PreviousObject.VectorMargin.X < 0 && PreviousObject.VectorMargin.Y > 0 && VectorMargin.Y > 0) ||
                (PreviousObject.VectorMargin.X > 0 && PreviousObject.VectorMargin.Y < 0 && VectorMargin.Y < 0)
                )
              {
                initialDirectionCheck = true;
              }
            }

            else if (PreviousObject.AppliedMirror == 2) // x
            {
              if (
                (PreviousObject.VectorMargin.X > 0 && PreviousObject.VectorMargin.Y > 0 && VectorObject.Y > 0) ||
                (PreviousObject.VectorMargin.X < 0 && PreviousObject.VectorMargin.Y < 0 && VectorMargin.Y < 0) ||
                (PreviousObject.VectorMargin.X < 0 && PreviousObject.VectorMargin.Y > 0 && VectorMargin.X < 0) ||
                (PreviousObject.VectorMargin.X > 0 && PreviousObject.VectorMargin.Y < 0 && VectorMargin.X > 0)
                )
              {
                initialDirectionCheck = true;
              }
            }

            else if (PreviousObject.AppliedMirror == 3) // Y
            {
              if (
                (PreviousObject.VectorMargin.X > 0 && PreviousObject.VectorMargin.Y > 0 && VectorObject.Y > 0) || // if previous object looks front // Y value should be positive
                (PreviousObject.VectorMargin.X < 0 && PreviousObject.VectorMargin.Y < 0 && VectorMargin.Y < 0) || // if previous object looks back  // Y value should be negative
                (PreviousObject.VectorMargin.X < 0 && PreviousObject.VectorMargin.Y > 0 && VectorMargin.X < 0) || // if previous object looks left  // X value should be positive
                (PreviousObject.VectorMargin.X > 0 && PreviousObject.VectorMargin.Y < 0 && VectorMargin.X > 0)      // if previous object looks right // X value should be positive
                )
              {
                initialDirectionCheck = true;
              }

            }
            else
            {
            }

            if (!((baseX + VectorMargin.X < 360) && (baseY + VectorMargin.Y < 660) && (baseZ + VectorMargin.Z < 300) &&
              (baseX + VectorMargin.X > 0) && (baseY + VectorMargin.Y > 0) && (baseZ + VectorMargin.Z > 0)))
            {
              inLimits = false;
            }
            // Rhino.RhinoApp.WriteLine("Bools " + suitableDirection.ToString() + "    " + inLimits.ToString() + ' ');

            int XLoopStartMargin = (int) ((int) (baseX / CellSize) < (baseX / CellSize + (int) XCellMargin) ? (int) (baseX / CellSize) : (baseX / CellSize + (int) XCellMargin));
            int XLoopEndMargin = (int) ((int) (baseX / CellSize) > (baseX / CellSize + (int) XCellMargin) ? (int) (baseX / CellSize) : (baseX / CellSize + (int) XCellMargin));

            int YLoopStartMargin = (int) ((int) (baseY / CellSize) < baseY / CellSize + (int) YCellMargin ? (int) (baseY / CellSize) : baseY / CellSize + (int) YCellMargin);
            int YLoopEnMargin = (int) ((int) (baseY / CellSize) > baseY / CellSize + (int) YCellMargin ? (int) (baseY / CellSize) : baseY / CellSize + (int) YCellMargin);

            int ZLoopStartMargin = (int) ((int) (baseZ / 150) < baseZ / 150 + (int) ZCellMargin ? (int) (baseZ / 150) : baseZ / 150 + (int) ZCellMargin);
            int ZLoopEndMargin = (int) ((int) (baseZ / 150) > baseZ / 150 + (int) ZCellMargin ? (int) (baseZ / 150) : baseZ / 150 + (int) ZCellMargin);

            /***/
            int XLoopStartObject = (int) ((int) (baseX / CellSize) < (baseX / CellSize + (int) XCellObject) ? (int) (baseX / CellSize) : (baseX / CellSize + (int) XCellObject));
            int XLoopEndObject = (int) ((int) (baseX / CellSize) > (baseX / CellSize + (int) XCellObject) ? (int) (baseX / CellSize) : (baseX / CellSize + (int) XCellObject));

            int YLoopStartObject = (int) ((int) (baseY / CellSize) < baseY / CellSize + (int) YCellObject ? (int) (baseY / CellSize) : baseY / CellSize + (int) YCellObject);
            int YLoopEnObject = (int) ((int) (baseY / CellSize) > baseY / CellSize + (int) YCellObject ? (int) (baseY / CellSize) : baseY / CellSize + (int) YCellObject);

            int ZLoopStartObject = (int) ((int) (baseZ / 150) < baseZ / 150 + (int) ZCellObject ? (int) (baseZ / 150) : baseZ / 150 + (int) ZCellObject);
            int ZLoopEndObject = (int) ((int) (baseZ / 150) > baseZ / 150 + (int) ZCellObject ? (int) (baseZ / 150) : baseZ / 150 + (int) ZCellObject);

            if (inLimits && initialDirectionCheck)
            {
              for (int i = XLoopStartMargin; i < XLoopEndMargin; i++)
              {
                for (int j = YLoopStartMargin; j < YLoopEnMargin; j++)
                {
                  for (int k = ZLoopStartMargin; k < ZLoopEndMargin; k++)
                  {
                    //checks if the cell is empty (We dont want to see an object in a cell! )
                    if (((emptyFullArray[i, j, k] == 1) || (emptyFullArray[i, j, k] == 2)))
                    {
                      Rhino.RhinoApp.WriteLine("Front Margin Array is full, Loop numbers ------" + i.ToString() + ' ' + j.ToString() + ' ' + k.ToString() + ' ');
                      emptyBool = false;
                    }

                    // 2nd Loop checks if the zone is the same or empty zone // Actually margin can ovewflow to other zones
                    /*
                    if (!(areaArray[i, j, k] != this.ZoneName || areaArray[i, j, k] != 0))
                    {
                    sameZone = false;
                    }
                    */
                  }
                }
              }
              // 2nd Loop checks if the zone is the same or empty zone
              for (int i = XLoopStartObject; i < XLoopEndObject; i++)
              {
                for (int j = YLoopStartObject; j < YLoopEnObject; j++)
                {
                  for (int k = ZLoopStartObject; k < ZLoopEndObject; k++)
                  {
                    //checks if the cell is empty (We dont want to see margin or object in the cell )
                    if (((emptyFullArray[i, j, k] == 1) || (emptyFullArray[i, j, k] == 2)))
                    {
                      Rhino.RhinoApp.WriteLine("Front object Array is full: Loop numbers ---------------------------------- i:" + i.ToString() + 'j' + j.ToString() + 'k' + k.ToString() + ' ');
                      emptyBool = false;
                    }

                    // 2nd Loop checks if the zone is the same or empty zone
                    if (!(areaArray[i, j, k] == this.ZoneName || areaArray[i, j, k] == 0))
                    {
                      sameZone = false;
                    }
                  }
                }
              }

              if (emptyBool && sameZone)
              {
                Rhino.RhinoApp.WriteLine(" ");
                Rhino.RhinoApp.WriteLine("Rotation Angle is:  " + RotationOpt[g].ToString());
                Rhino.RhinoApp.WriteLine("MirrorOption is:  " + MirrorOpt[f].ToString());
                Rhino.RhinoApp.WriteLine("Sliding base position is:  " + h.ToString());
                Rhino.RhinoApp.WriteLine("Base VEctor is :  " + this.BaseVector.ToString());
                Rhino.RhinoApp.WriteLine(" ");

                suitableDirection = true;
                Rhino.RhinoApp.WriteLine("Place Right: Conditions are  satisfied********************************************************************************************************** ");
                goto SkipLoop;
                // BREAK THE LOOP IF A SOLUTION IS FOUND
              }
              else
              {
                Rhino.RhinoApp.WriteLine("Place Right: Conditions are not satisfied ");
                suitableDirection = false;
                // RESET DRIECTION AND MIRROR
                VectorMargin = this.VectorMarginCache;
                VectorObject = this.VectorObjectCache;
              }
            }
            else
            {
              Rhino.RhinoApp.WriteLine("Place Right:  Conditions are not satisfied ");
              suitableDirection = false;
              // RESET DRIECTION AND MIRROR
              VectorMargin = this.VectorMarginCache;
              VectorObject = this.VectorObjectCache;
            }
          }
        }
      }
      SkipLoop:
        return suitableDirection;
    }

    public void PlaceRight(int[,,] emptyFullArray, out Box ObjBox, out Box marginBox)
    {
      int XLoopStartMargin = (int) ((int) (baseX / CellSize) < (baseX / CellSize + (int) XCellMargin) ? (int) (baseX / CellSize) : (baseX / CellSize + (int) XCellMargin));
      int XLoopEndMargin = (int) ((int) (baseX / CellSize) > (baseX / CellSize + (int) XCellMargin) ? (int) (baseX / CellSize) : (baseX / CellSize + (int) XCellMargin));

      int YLoopStartMargin = (int) ((int) (baseY / CellSize) < baseY / CellSize + (int) YCellMargin ? (int) (baseY / CellSize) : baseY / CellSize + (int) YCellMargin);
      int YLoopEnMargin = (int) ((int) (baseY / CellSize) > baseY / CellSize + (int) YCellMargin ? (int) (baseY / CellSize) : baseY / CellSize + (int) YCellMargin);

      int ZLoopStartMargin = (int) ((int) (baseZ / 150) < baseZ / 150 + (int) ZCellMargin ? (int) (baseZ / 150) : baseZ / 150 + (int) ZCellMargin);
      int ZLoopEndMargin = (int) ((int) (baseZ / 150) > baseZ / 150 + (int) ZCellMargin ? (int) (baseZ / 150) : baseZ / 150 + (int) ZCellMargin);


      int XLoopStartObject = (int) ((int) (baseX / CellSize) < (baseX / CellSize + (int) XCellObject) ? (int) (baseX / CellSize) : (baseX / CellSize + (int) XCellObject));
      int XLoopEndObject = (int) ((int) (baseX / CellSize) > (baseX / CellSize + (int) XCellObject) ? (int) (baseX / CellSize) : (baseX / CellSize + (int) XCellObject));

      int YLoopStartObject = (int) ((int) (baseY / CellSize) < baseY / CellSize + (int) YCellObject ? (int) (baseY / CellSize) : baseY / CellSize + (int) YCellObject);
      int YLoopEnObject = (int) ((int) (baseY / CellSize) > baseY / CellSize + (int) YCellObject ? (int) (baseY / CellSize) : baseY / CellSize + (int) YCellObject);

      int ZLoopStartObject = (int) ((int) (baseZ / 150) < baseZ / 150 + (int) ZCellObject ? (int) (baseZ / 150) : baseZ / 150 + (int) ZCellObject);
      int ZLoopEndObject = (int) ((int) (baseZ / 150) > baseZ / 150 + (int) ZCellObject ? (int) (baseZ / 150) : baseZ / 150 + (int) ZCellObject);

      for (int i = XLoopStartMargin; i < XLoopEndMargin; i++)
      {
        for (int j = YLoopStartMargin; j < YLoopEnMargin; j++)
        {
          for (int k = ZLoopStartMargin; k < ZLoopEndMargin; k++)
          {
            Rhino.RhinoApp.WriteLine("Front object Array is full: Loop numbers ---------------------------------- i:" + i.ToString() + 'j' + j.ToString() + 'k' + k.ToString() + ' ');
            emptyFullArray[i, j, k] = 2; // 2 represents margin
          }
        }
      }
      //Place Object, object is smaller than margin
      for (int i = XLoopStartObject; i < XLoopEndObject; i++)
      {
        for (int j = YLoopStartObject; j < YLoopEnObject; j++)
        {
          for (int k = ZLoopStartObject; k < ZLoopEndObject; k++)
          {
            emptyFullArray[i, j, k] = 1; // 1 represents object
          }
        }
      }

      Point3d pointa = new Point3d(baseX, baseY, baseZ);
      Vector3d pointb = new Vector3d(0, 0, 1);

      Plane planebase = new Plane(pointa, pointb);

      Interval xInterval = new Interval(0, this.VectorObject.X);
      Interval yInterval = new Interval(0, this.VectorObject.Y);
      Interval zInterval = new Interval(0, this.VectorObject.Z);

      ObjBox = new Box(planebase, xInterval, yInterval, zInterval);

      xInterval = new Interval(0, this.VectorMargin.X);
      yInterval = new Interval(0, this.VectorMargin.Y);
      zInterval = new Interval(0, this.VectorMargin.Z);

      marginBox = new Box(planebase, xInterval, yInterval, zInterval);

    }

    public bool CheckBack(int[,,] emptyFullArray, int[,,] areaArray)
    {
      /**/
      bool suitableDirection = true;

      int baseSliderMin = 0;
      int baseSliderMax = 0;

      Fisher_Yates_CardDeck_Shuffle(MirrorOpt);
      Fisher_Yates_CardDeck_Shuffle(RotationOpt);

      for (int f = 0; f < this.MirrorOpt.Count; f++)
      {
        for (int g = 0; g < this.RotationOpt.Count; g++)
        {
          if (PreviousObject.AppliedMirror == 0)
          {
            baseSliderMin = (int) (PreviousObject.VectorMargin.X * PreviousObject.VectorMargin.Y > 0 ? (Math.Min(PreviousObject.baseX, PreviousObject.baseX + PreviousObject.VectorMargin.X))
              : (Math.Min(PreviousObject.baseY, PreviousObject.baseY + PreviousObject.VectorMargin.Y)));
            baseSliderMax = (int) (PreviousObject.VectorMargin.X * PreviousObject.VectorMargin.Y > 0 ? (Math.Max(PreviousObject.baseX + PreviousObject.VectorMargin.X, PreviousObject.baseX))
              : (Math.Max(PreviousObject.baseY, PreviousObject.baseY + PreviousObject.VectorMargin.Y)));
          }

          if (PreviousObject.AppliedMirror == 1)
          {
            baseSliderMin = (int) (PreviousObject.VectorMargin.X * PreviousObject.VectorMargin.Y > 0 ? (Math.Min(PreviousObject.baseX, PreviousObject.baseX + PreviousObject.VectorMargin.X))
              : (Math.Min(PreviousObject.baseY, PreviousObject.baseY + PreviousObject.VectorMargin.Y)));
            baseSliderMax = (int) (PreviousObject.VectorMargin.X * PreviousObject.VectorMargin.Y > 0 ? (Math.Max(PreviousObject.baseX + PreviousObject.VectorMargin.X, PreviousObject.baseX))
              : (Math.Max(PreviousObject.baseY, PreviousObject.baseY + PreviousObject.VectorMargin.Y)));
          }

          if (PreviousObject.AppliedMirror == 2)
          {
            baseSliderMin = (int) (PreviousObject.VectorMargin.X * PreviousObject.VectorMargin.Y < 0 ? (Math.Min(PreviousObject.baseX, PreviousObject.baseX + PreviousObject.VectorMargin.X))
              : (Math.Min(PreviousObject.baseY, PreviousObject.baseY + PreviousObject.VectorMargin.Y)));

            baseSliderMax = (int) (PreviousObject.VectorMargin.X * PreviousObject.VectorMargin.Y < 0 ? (Math.Max(PreviousObject.baseX + PreviousObject.VectorMargin.X, PreviousObject.baseX))
              : (Math.Max(PreviousObject.baseY, PreviousObject.baseY + PreviousObject.VectorMargin.Y)));
          }

          if (PreviousObject.AppliedMirror == 3)
          {
            baseSliderMin = (int) (PreviousObject.VectorMargin.X * PreviousObject.VectorMargin.Y < 0 ? (Math.Min(PreviousObject.baseX, PreviousObject.baseX + PreviousObject.VectorMargin.X))
              : (Math.Min(PreviousObject.baseY, PreviousObject.baseY + PreviousObject.VectorMargin.Y)));

            baseSliderMax = (int) (PreviousObject.VectorMargin.X * PreviousObject.VectorMargin.Y < 0 ? (Math.Max(PreviousObject.baseX + PreviousObject.VectorMargin.X, PreviousObject.baseX))
              : (Math.Max(PreviousObject.baseY, PreviousObject.baseY + PreviousObject.VectorMargin.Y)));
          }

          for (int h = baseSliderMin; h <= baseSliderMax; h = h + this.CellSize)

          {
            this.Mirroring(MirrorOpt[f]);
            this.Rotate((int) RotationOpt[g]);

            AppliedRotation = RotationOpt[g];
            AppliedMirror = MirrorOpt[f];

            bool inLimits = true;
            bool emptyBool = true;
            bool sameZone = true;

            suitableDirection = true;
            bool initialDirectionCheck = false;

            this.XCellMargin = (this.VectorMargin.X < 0 ? -1 : 1) * Math.Ceiling((double) Math.Abs(this.VectorMargin.X / CellSize));
            this.YCellMargin = (this.VectorMargin.Y < 0 ? -1 : 1) * Math.Ceiling((double) Math.Abs(this.VectorMargin.Y / CellSize));
            this.ZCellMargin = (this.VectorMargin.Z < 0 ? -1 : 1) * Math.Ceiling((double) Math.Abs(this.VectorMargin.Z / 150));

            this.XCellObject = (this.VectorObject.X < 0 ? -1 : 1) * Math.Ceiling((double) Math.Abs(this.VectorObject.X / CellSize));
            this.YCellObject = (this.VectorObject.Y < 0 ? -1 : 1) * Math.Ceiling((double) Math.Abs(this.VectorObject.Y / CellSize));
            this.ZCellObject = (this.VectorObject.Z < 0 ? -1 : 1) * Math.Ceiling((double) Math.Abs(this.VectorObject.Z / 150));

                        /*
                        Rhino.RhinoApp.WriteLine(" MARGIN  Front numbers -----------------------" + XCellMargin.ToString() + ' ' + YCellMargin.ToString() + ' ' + ZCellMargin.ToString() + ' ');
                        Rhino.RhinoApp.WriteLine(" OBJECT  Front numbers -----------------------" + XCellObject.ToString() + ' ' + YCellObject.ToString() + ' ' + ZCellObject.ToString() + ' ');
                        */

            if (PreviousObject.AppliedMirror == 0)
            {
              if (PreviousObject.VectorMargin.X * PreviousObject.VectorMargin.Y > 0) // back checked true
              {
                this.baseX = h; // slide over X axis , Y axis should be constant
                this.baseY = PreviousObject.baseY;
                this.baseZ = PreviousObject.baseZ;
              }
              else if (PreviousObject.VectorMargin.X * PreviousObject.VectorMargin.Y < 0)// back checked true
              {
                this.baseX = PreviousObject.baseX;
                this.baseY = h; // slide over Y axis , X axis should be constant
                this.baseZ = PreviousObject.baseZ;
              }
            }

            if (PreviousObject.AppliedMirror == 2) // back checked true
            {
              if (PreviousObject.VectorMargin.X * PreviousObject.VectorMargin.Y < 0)
              {
                this.baseX = h; // slide over X axis , Y axis should be constant
                this.baseY = PreviousObject.baseY;
                this.baseZ = PreviousObject.baseZ;
              }
              else if (PreviousObject.VectorMargin.X * PreviousObject.VectorMargin.Y > 0)
              {
                this.baseX = PreviousObject.baseX;
                this.baseY = h; // slide over Y axis , X axis should be constant
                this.baseZ = PreviousObject.baseZ;
              }
            }

            if (PreviousObject.AppliedMirror == 3) // back checked true
            {
              if (PreviousObject.VectorMargin.X * PreviousObject.VectorMargin.Y < 0)
              {
                this.baseX = h; // slide over X axis , Y axis should be constant
                this.baseY = PreviousObject.baseY;
                this.baseZ = PreviousObject.baseZ;
              }
              else if (VectorMargin.X * VectorMargin.Y > 0)
              {
                this.baseX = PreviousObject.baseX;
                this.baseY = h; // slide over Y axis , X axis should be constant
                this.baseZ = PreviousObject.baseZ;
              }
            }

            Point3d pointa = new Point3d(0, 0, 0);
            Vector3d pointb = new Vector3d(0, 0, 1);
            Plane planee = new Plane(pointa, pointb);

            Vector3d vecX1 = new Vector3d(1, 0, 0);
            BaseVector = new Vector3d(baseX, baseY, baseZ);

            if (PreviousObject.AppliedMirror == 0) //back true
            {
              if (
                PreviousObject.VectorMargin.X > 0 && PreviousObject.VectorMargin.Y > 0 && VectorObject.Y < 0 || //++
                PreviousObject.VectorMargin.X < 0 && PreviousObject.VectorMargin.Y < 0 && VectorMargin.Y > 0 || //--
                PreviousObject.VectorMargin.X < 0 && PreviousObject.VectorMargin.Y > 0 && VectorMargin.X > 0 || //-+
                PreviousObject.VectorMargin.X > 0 && PreviousObject.VectorMargin.Y < 0 && VectorMargin.X < 0)   //+-

              {
                initialDirectionCheck = true;
              }
            }

            else if (PreviousObject.AppliedMirror == 1) // Z
            {

              if (PreviousObject.VectorMargin.X > 0 && PreviousObject.VectorMargin.Y > 0 && VectorObject.Y < 0 || //++
                PreviousObject.VectorMargin.X < 0 && PreviousObject.VectorMargin.Y < 0 && VectorMargin.Y > 0 || //--
                PreviousObject.VectorMargin.X < 0 && PreviousObject.VectorMargin.Y > 0 && VectorMargin.X > 0 || //-+
                PreviousObject.VectorMargin.X > 0 && PreviousObject.VectorMargin.Y < 0 && VectorMargin.X < 0       // if previous object looks right // X value should be positive
                )
              {
                initialDirectionCheck = true;
              }
            }

            else if (PreviousObject.AppliedMirror == 2) // x back true
            {
              if (
                (PreviousObject.VectorMargin.X > 0 && PreviousObject.VectorMargin.Y > 0 && VectorObject.X < 0) || // if previous object looks front // Y value should be positive
                (PreviousObject.VectorMargin.X < 0 && PreviousObject.VectorMargin.Y < 0 && VectorMargin.X > 0) || // if previous object looks back  // Y value should be negative
                (PreviousObject.VectorMargin.X < 0 && PreviousObject.VectorMargin.Y > 0 && VectorMargin.Y < 0) || // if previous object looks left //  X value should be positive
                (PreviousObject.VectorMargin.X > 0 && PreviousObject.VectorMargin.Y < 0 && VectorMargin.Y > 0)     // if previous object looks right // X value should be positive
                )
              {
                initialDirectionCheck = true;
              }
            }

            else if (PreviousObject.AppliedMirror == 3) // Y
            {
              if (
                (PreviousObject.VectorMargin.X > 0 && PreviousObject.VectorMargin.Y > 0 && VectorObject.X < 0) || // if previous object looks front // Y value should be positive
                (PreviousObject.VectorMargin.X < 0 && PreviousObject.VectorMargin.Y < 0 && VectorMargin.X > 0) || // if previous object looks back  // Y value should be negative
                (PreviousObject.VectorMargin.X < 0 && PreviousObject.VectorMargin.Y > 0 && VectorMargin.Y < 0) || // if previous object looks left  // X value should be positive
                (PreviousObject.VectorMargin.X > 0 && PreviousObject.VectorMargin.Y < 0 && VectorMargin.Y > 0)      // if previous object looks right // X value should be positive
                )
              {
                initialDirectionCheck = true;
              }

            }
            else
            {
                            /*
                            if (PreviousObject.VectorMargin.X > 0 && PreviousObject.VectorMargin.Y > 0 && VectorObject.Y > 0 || // if previous object looks front // Y value should be positive
                              PreviousObject.VectorMargin.X < 0 && PreviousObject.VectorMargin.Y < 0 && VectorMargin.Y < 0 || // if previous object looks back  // Y value should be negative
                              PreviousObject.VectorMargin.X < 0 && PreviousObject.VectorMargin.Y > 0 && VectorMargin.X < 0 || // if previous object looks left //  X value should be positive
                              PreviousObject.VectorMargin.X > 0 && PreviousObject.VectorMargin.Y < 0 && VectorMargin.X > 0       // if previous object looks right // X value should be positive
                              )
                            {
                              initialDirectionCheck = true;
                            }
                              */
            }

            if (!((baseX + VectorMargin.X < 360) && (baseY + VectorMargin.Y < 660) && (baseZ + VectorMargin.Z < 300) &&
              (baseX + VectorMargin.X > 0) && (baseY + VectorMargin.Y > 0) && (baseZ + VectorMargin.Z > 0)))
            {
              inLimits = false;
            }
            // Rhino.RhinoApp.WriteLine("Bools " + suitableDirection.ToString() + "    " + inLimits.ToString() + ' ');

            int XLoopStartMargin = (int) ((int) (baseX / CellSize) < (baseX / CellSize + (int) XCellMargin) ? (int) (baseX / CellSize) : (baseX / CellSize + (int) XCellMargin));
            int XLoopEndMargin = (int) ((int) (baseX / CellSize) > (baseX / CellSize + (int) XCellMargin) ? (int) (baseX / CellSize) : (baseX / CellSize + (int) XCellMargin));

            int YLoopStartMargin = (int) ((int) (baseY / CellSize) < baseY / CellSize + (int) YCellMargin ? (int) (baseY / CellSize) : baseY / CellSize + (int) YCellMargin);
            int YLoopEnMargin = (int) ((int) (baseY / CellSize) > baseY / CellSize + (int) YCellMargin ? (int) (baseY / CellSize) : baseY / CellSize + (int) YCellMargin);

            int ZLoopStartMargin = (int) ((int) (baseZ / 150) < baseZ / 150 + (int) ZCellMargin ? (int) (baseZ / 150) : baseZ / 150 + (int) ZCellMargin);
            int ZLoopEndMargin = (int) ((int) (baseZ / 150) > baseZ / 150 + (int) ZCellMargin ? (int) (baseZ / 150) : baseZ / 150 + (int) ZCellMargin);

            /***/
            int XLoopStartObject = (int) ((int) (baseX / CellSize) < (baseX / CellSize + (int) XCellObject) ? (int) (baseX / CellSize) : (baseX / CellSize + (int) XCellObject));
            int XLoopEndObject = (int) ((int) (baseX / CellSize) > (baseX / CellSize + (int) XCellObject) ? (int) (baseX / CellSize) : (baseX / CellSize + (int) XCellObject));

            int YLoopStartObject = (int) ((int) (baseY / CellSize) < baseY / CellSize + (int) YCellObject ? (int) (baseY / CellSize) : baseY / CellSize + (int) YCellObject);
            int YLoopEnObject = (int) ((int) (baseY / CellSize) > baseY / CellSize + (int) YCellObject ? (int) (baseY / CellSize) : baseY / CellSize + (int) YCellObject);

            int ZLoopStartObject = (int) ((int) (baseZ / 150) < baseZ / 150 + (int) ZCellObject ? (int) (baseZ / 150) : baseZ / 150 + (int) ZCellObject);
            int ZLoopEndObject = (int) ((int) (baseZ / 150) > baseZ / 150 + (int) ZCellObject ? (int) (baseZ / 150) : baseZ / 150 + (int) ZCellObject);

                        /*
                                    Rhino.RhinoApp.WriteLine("X  Front  Margin Loop numbers -------------" + XLoopStartMargin.ToString() + ' ' + XLoopEndMargin.ToString() + ' ');
                                    Rhino.RhinoApp.WriteLine("Y  Front Margin  Loop numbers -------------" + YLoopStartMargin.ToString() + ' ' + YLoopEnMargin.ToString() + ' ');
                                    Rhino.RhinoApp.WriteLine("Z  Front  Margin Loop numbers -------------" + ZLoopStartMargin.ToString() + ' ' + ZLoopEndMargin.ToString() + ' ');

                                    Rhino.RhinoApp.WriteLine("X  Front Object Loop numbers ----------" + XLoopStartObject.ToString() + ' ' + XLoopEndObject.ToString() + ' ');
                                    Rhino.RhinoApp.WriteLine("Y  Front Object  Loop numbers ---------" + YLoopStartObject.ToString() + ' ' + YLoopEnObject.ToString() + ' ');
                                    Rhino.RhinoApp.WriteLine("Z  Front Object  Loop numbers ---------" + ZLoopStartObject.ToString() + ' ' + ZLoopEndObject.ToString() + ' ');
                        */
            if (inLimits && initialDirectionCheck)
            {
              for (int i = XLoopStartMargin; i < XLoopEndMargin; i++)
              {
                for (int j = YLoopStartMargin; j < YLoopEnMargin; j++)
                {
                  for (int k = ZLoopStartMargin; k < ZLoopEndMargin; k++)
                  {
                    //checks if the cell is empty (We dont want to see an object in a cell! )
                    if (((emptyFullArray[i, j, k] == 1) || (emptyFullArray[i, j, k] == 2)))
                    {
                      //Rhino.RhinoApp.WriteLine("Front Margin Array is full, Loop numbers ------" + i.ToString() + ' ' + j.ToString() + ' ' + k.ToString() + ' ');
                      emptyBool = false;
                    }

                    // 2nd Loop checks if the zone is the same or empty zone // Actually margin can ovewflow to other zones
                    /*
                    if (!(areaArray[i, j, k] != this.ZoneName || areaArray[i, j, k] != 0))
                    {
                    sameZone = false;
                    }
                    */
                  }
                }
              }
              // 2nd Loop checks if the zone is the same or empty zone
              for (int i = XLoopStartObject; i < XLoopEndObject; i++)
              {
                for (int j = YLoopStartObject; j < YLoopEnObject; j++)
                {
                  for (int k = ZLoopStartObject; k < ZLoopEndObject; k++)
                  {
                    //checks if the cell is empty (We dont want to see margin or object in the cell )
                    if (((emptyFullArray[i, j, k] == 1) || (emptyFullArray[i, j, k] == 2)))
                    {
                      //Rhino.RhinoApp.WriteLine("Front object Array is full: Loop numbers ---------------------------------- i:" + i.ToString() + 'j' + j.ToString() + 'k' + k.ToString() + ' ');
                      emptyBool = false;
                    }
                    // 2nd Loop checks if the zone is the same or empty zone
                    if (!(areaArray[i, j, k] == this.ZoneName || areaArray[i, j, k] == 0))
                    {
                      sameZone = false;
                    }
                  }
                }
              }

              if (emptyBool && sameZone)
              {
                                /*
                                Rhino.RhinoApp.WriteLine(" ");
                                Rhino.RhinoApp.WriteLine("Rotation Angle is:  " + RotationOpt[g].ToString());
                                Rhino.RhinoApp.WriteLine("MirrorOption is:  " + MirrorOpt[f].ToString());
                                Rhino.RhinoApp.WriteLine("Sliding base position is:  " + h.ToString());
                                Rhino.RhinoApp.WriteLine("Base VEctor is :  " + this.BaseVector.ToString());
                                Rhino.RhinoApp.WriteLine(" ");
                                */

                                // In order the follow placement Informations uncomment the lines upwards.
                                // Usefull for debugging

                suitableDirection = true;
                Rhino.RhinoApp.WriteLine("Place Front: Conditions are  satisfied");
                goto SkipLoop;
                // BREAK THE LOOP IF A SOLUTION IS FOUND
              }
              else
              {
                Rhino.RhinoApp.WriteLine("Place Front: Conditions are not satisfied ");
                suitableDirection = false;
                // RESET DRIECTION AND MIRROR
                VectorMargin = this.VectorMarginCache;
                VectorObject = this.VectorObjectCache;
              }
            }
            else
            {
              Rhino.RhinoApp.WriteLine("Place Front:  Conditions are not satisfied ");
              suitableDirection = false;
              // RESET DRIECTION AND MIRROR
              VectorMargin = this.VectorMarginCache;
              VectorObject = this.VectorObjectCache;
            }
          }
        }
      }
      SkipLoop:
        return suitableDirection;

    }

    public void PlaceBack(int[,,] emptyFullArray, out Box ObjBox, out Box marginBox)
    {
      int XLoopStartMargin = (int) ((int) (baseX / CellSize) < (baseX / CellSize + (int) XCellMargin) ? (int) (baseX / CellSize) : (baseX / CellSize + (int) XCellMargin));
      int XLoopEndMargin = (int) ((int) (baseX / CellSize) > (baseX / CellSize + (int) XCellMargin) ? (int) (baseX / CellSize) : (baseX / CellSize + (int) XCellMargin));

      int YLoopStartMargin = (int) ((int) (baseY / CellSize) < baseY / CellSize + (int) YCellMargin ? (int) (baseY / CellSize) : baseY / CellSize + (int) YCellMargin);
      int YLoopEnMargin = (int) ((int) (baseY / CellSize) > baseY / CellSize + (int) YCellMargin ? (int) (baseY / CellSize) : baseY / CellSize + (int) YCellMargin);

      int ZLoopStartMargin = (int) ((int) (baseZ / 150) < baseZ / 150 + (int) ZCellMargin ? (int) (baseZ / 150) : baseZ / 150 + (int) ZCellMargin);
      int ZLoopEndMargin = (int) ((int) (baseZ / 150) > baseZ / 150 + (int) ZCellMargin ? (int) (baseZ / 150) : baseZ / 150 + (int) ZCellMargin);


      int XLoopStartObject = (int) ((int) (baseX / CellSize) < (baseX / CellSize + (int) XCellObject) ? (int) (baseX / CellSize) : (baseX / CellSize + (int) XCellObject));
      int XLoopEndObject = (int) ((int) (baseX / CellSize) > (baseX / CellSize + (int) XCellObject) ? (int) (baseX / CellSize) : (baseX / CellSize + (int) XCellObject));

      int YLoopStartObject = (int) ((int) (baseY / CellSize) < baseY / CellSize + (int) YCellObject ? (int) (baseY / CellSize) : baseY / CellSize + (int) YCellObject);
      int YLoopEnObject = (int) ((int) (baseY / CellSize) > baseY / CellSize + (int) YCellObject ? (int) (baseY / CellSize) : baseY / CellSize + (int) YCellObject);

      int ZLoopStartObject = (int) ((int) (baseZ / 150) < baseZ / 150 + (int) ZCellObject ? (int) (baseZ / 150) : baseZ / 150 + (int) ZCellObject);
      int ZLoopEndObject = (int) ((int) (baseZ / 150) > baseZ / 150 + (int) ZCellObject ? (int) (baseZ / 150) : baseZ / 150 + (int) ZCellObject);

      for (int i = XLoopStartMargin; i < XLoopEndMargin; i++)
      {
        for (int j = YLoopStartMargin; j < YLoopEnMargin; j++)
        {
          for (int k = ZLoopStartMargin; k < ZLoopEndMargin; k++)
          {
            emptyFullArray[i, j, k] = 2; // 2 represents margin
          }
        }
      }
      //Place Object, object is smaller than margin
      for (int i = XLoopStartObject; i < XLoopEndObject; i++)
      {
        for (int j = YLoopStartObject; j < YLoopEnObject; j++)
        {
          for (int k = ZLoopStartObject; k < ZLoopEndObject; k++)
          {
            emptyFullArray[i, j, k] = 1; // 1 represents object
          }
        }
      }

      Point3d pointa = new Point3d(baseX, baseY, baseZ);
      Vector3d pointb = new Vector3d(0, 0, 1);

      Plane planebase = new Plane(pointa, pointb);

      Interval xInterval = new Interval(0, this.VectorObject.X);
      Interval yInterval = new Interval(0, this.VectorObject.Y);
      Interval zInterval = new Interval(0, this.VectorObject.Z);

      ObjBox = new Box(planebase, xInterval, yInterval, zInterval);

      xInterval = new Interval(0, this.VectorMargin.X);
      yInterval = new Interval(0, this.VectorMargin.Y);
      zInterval = new Interval(0, this.VectorMargin.Z);

      marginBox = new Box(planebase, xInterval, yInterval, zInterval);
    }

    public bool CheckLeft(int[,,] emptyFullArray, int[,,] areaArray)
    {

      /*****************************/
      bool suitableDirection = true;

      int baseSliderMin = 0;
      int baseSliderMax = 0;

      Fisher_Yates_CardDeck_Shuffle(MirrorOpt);
      Fisher_Yates_CardDeck_Shuffle(RotationOpt);

      for (int f = 0; f < this.MirrorOpt.Count; f++)
      {
        for (int g = 0; g < this.RotationOpt.Count; g++)
        {
          if (PreviousObject.AppliedMirror == 0) // left okay
          {
            baseSliderMin = (int) (PreviousObject.VectorMargin.X * PreviousObject.VectorMargin.Y > 0 ? (Math.Min(PreviousObject.baseY, PreviousObject.baseY + PreviousObject.VectorMargin.Y))
              : (Math.Min(PreviousObject.baseX, PreviousObject.baseX + PreviousObject.VectorMargin.X)));
            baseSliderMax = (int) (PreviousObject.VectorMargin.X * PreviousObject.VectorMargin.Y > 0 ? (Math.Max(PreviousObject.baseY, PreviousObject.baseY + PreviousObject.VectorMargin.Y))
              : (Math.Max(PreviousObject.baseX + PreviousObject.VectorMargin.X, PreviousObject.baseX)));
          }

          if (PreviousObject.AppliedMirror == 1) // oaky
          {
            baseSliderMin = (int) (PreviousObject.VectorMargin.X * PreviousObject.VectorMargin.Y > 0 ? (Math.Min(PreviousObject.baseY, PreviousObject.baseY + PreviousObject.VectorMargin.Y))
              : (Math.Min(PreviousObject.baseX, PreviousObject.baseX + PreviousObject.VectorMargin.X)));
            baseSliderMax = (int) (PreviousObject.VectorMargin.X * PreviousObject.VectorMargin.Y > 0 ? (Math.Max(PreviousObject.baseY, PreviousObject.baseY + PreviousObject.VectorMargin.Y))
              : (Math.Max(PreviousObject.baseX + PreviousObject.VectorMargin.X, PreviousObject.baseX)));
          }

          if (PreviousObject.AppliedMirror == 2) //okay
          {
            baseSliderMin = (int) (PreviousObject.VectorMargin.X * PreviousObject.VectorMargin.Y < 0 ? (Math.Min(PreviousObject.baseX, PreviousObject.baseX + PreviousObject.VectorMargin.X))
              : (Math.Min(PreviousObject.baseY, PreviousObject.baseY + PreviousObject.VectorMargin.Y)));

            baseSliderMax = (int) (PreviousObject.VectorMargin.X * PreviousObject.VectorMargin.Y < 0 ? (Math.Max(PreviousObject.baseX + PreviousObject.VectorMargin.X, PreviousObject.baseX))
              : (Math.Max(PreviousObject.baseY, PreviousObject.baseY + PreviousObject.VectorMargin.Y)));
          }

          if (PreviousObject.AppliedMirror == 3)//okay
          {
            baseSliderMin = (int) (PreviousObject.VectorMargin.X * PreviousObject.VectorMargin.Y < 0 ? (Math.Min(PreviousObject.baseX, PreviousObject.baseX + PreviousObject.VectorMargin.X))
              : (Math.Min(PreviousObject.baseY, PreviousObject.baseY + PreviousObject.VectorMargin.Y)));

            baseSliderMax = (int) (PreviousObject.VectorMargin.X * PreviousObject.VectorMargin.Y < 0 ? (Math.Max(PreviousObject.baseX + PreviousObject.VectorMargin.X, PreviousObject.baseX))
              : (Math.Max(PreviousObject.baseY, PreviousObject.baseY + PreviousObject.VectorMargin.Y)));
          }

          for (int h = baseSliderMin; h <= baseSliderMax; h = h + this.CellSize)

          {
            this.Mirroring(MirrorOpt[f]);
            this.Rotate((int) RotationOpt[g]);

            AppliedRotation = RotationOpt[g];
            AppliedMirror = MirrorOpt[f];

            bool inLimits = true;
            bool emptyBool = true;
            bool sameZone = true;

            suitableDirection = true;
            bool initialDirectionCheck = false;

            this.XCellMargin = (this.VectorMargin.X < 0 ? -1 : 1) * Math.Ceiling((double) Math.Abs(this.VectorMargin.X / CellSize));
            this.YCellMargin = (this.VectorMargin.Y < 0 ? -1 : 1) * Math.Ceiling((double) Math.Abs(this.VectorMargin.Y / CellSize));
            this.ZCellMargin = (this.VectorMargin.Z < 0 ? -1 : 1) * Math.Ceiling((double) Math.Abs(this.VectorMargin.Z / 150));

            this.XCellObject = (this.VectorObject.X < 0 ? -1 : 1) * Math.Ceiling((double) Math.Abs(this.VectorObject.X / CellSize));
            this.YCellObject = (this.VectorObject.Y < 0 ? -1 : 1) * Math.Ceiling((double) Math.Abs(this.VectorObject.Y / CellSize));
            this.ZCellObject = (this.VectorObject.Z < 0 ? -1 : 1) * Math.Ceiling((double) Math.Abs(this.VectorObject.Z / 150));

                        /*
                        Rhino.RhinoApp.WriteLine(" MARGIN  Front numbers -----------------------" + XCellMargin.ToString() + ' ' + YCellMargin.ToString() + ' ' + ZCellMargin.ToString() + ' ');
                        Rhino.RhinoApp.WriteLine(" OBJECT  Front numbers -----------------------" + XCellObject.ToString() + ' ' + YCellObject.ToString() + ' ' + ZCellObject.ToString() + ' ');
                        */

            if (PreviousObject.AppliedMirror == 0) // left kontrol edildi dogru
            {
              if (PreviousObject.VectorMargin.X * PreviousObject.VectorMargin.Y > 0)
              {
                this.baseX = PreviousObject.baseX;
                this.baseY = h;
                this.baseZ = PreviousObject.baseZ;
              }
              else if (PreviousObject.VectorMargin.X * PreviousObject.VectorMargin.Y < 0)
              {
                this.baseX = h;
                this.baseY = PreviousObject.baseY;
                this.baseZ = PreviousObject.baseZ;
              }
            }

            if (PreviousObject.AppliedMirror == 2) // left checked true
            {

              if (PreviousObject.VectorMargin.X * PreviousObject.VectorMargin.Y > 0)
              {
                this.baseX = h;
                this.baseY = PreviousObject.baseY;
                this.baseZ = PreviousObject.baseZ;

              }
              else if (PreviousObject.VectorMargin.X * PreviousObject.VectorMargin.Y < 0)
              {
                this.baseX = PreviousObject.baseX;
                this.baseY = h;
                this.baseZ = PreviousObject.baseZ;
              }
            }

            if (PreviousObject.AppliedMirror == 3)// left checked true
            {

              if (VectorMargin.X * VectorMargin.Y > 0)
              {
                this.baseX = h;
                this.baseY = PreviousObject.baseY;
                this.baseZ = PreviousObject.baseZ;
              }
              else if (PreviousObject.VectorMargin.X * PreviousObject.VectorMargin.Y < 0)
              {
                this.baseX = PreviousObject.baseX;
                this.baseY = h;
                this.baseZ = PreviousObject.baseZ;
              }
            }

            Point3d pointa = new Point3d(0, 0, 0);
            Vector3d pointb = new Vector3d(0, 0, 1);
            Plane planee = new Plane(pointa, pointb);

            BaseVector = new Vector3d(baseX, baseY, baseZ);

            if (PreviousObject.AppliedMirror == 0) // Left is checked
            {
              if (

                (PreviousObject.VectorMargin.X > 0 && PreviousObject.VectorMargin.Y > 0 && VectorObject.X < 0) || // if previous object looks front // Y value should be positive
                (PreviousObject.VectorMargin.X < 0 && PreviousObject.VectorMargin.Y < 0 && VectorMargin.X > 0) || // if previous object looks back  // Y value should be negative
                (PreviousObject.VectorMargin.X < 0 && PreviousObject.VectorMargin.Y > 0 && VectorMargin.Y > 0) || // if previous object looks left //  X value should be positive
                (PreviousObject.VectorMargin.X > 0 && PreviousObject.VectorMargin.Y < 0 && VectorMargin.Y < 0)       // if previous object looks right // X value should be positive

                )

              {
                initialDirectionCheck = true;
              }
            }

            else if (PreviousObject.AppliedMirror == 1) // Z Left is checked
            {
              if (

                (PreviousObject.VectorMargin.X > 0 && PreviousObject.VectorMargin.Y > 0 && VectorObject.X < 0) || // if previous object looks front // Y value should be positive
                (PreviousObject.VectorMargin.X < 0 && PreviousObject.VectorMargin.Y < 0 && VectorMargin.X > 0) || // if previous object looks back  // Y value should be negative
                (PreviousObject.VectorMargin.X < 0 && PreviousObject.VectorMargin.Y > 0 && VectorMargin.Y > 0) || // if previous object looks left //  X value should be positive
                (PreviousObject.VectorMargin.X > 0 && PreviousObject.VectorMargin.Y < 0 && VectorMargin.Y < 0)       // if previous object looks right // X value should be positive
                )
              {
                initialDirectionCheck = true;
              }
            }

            else if (PreviousObject.AppliedMirror == 2) // x  Left is checked
            {
              if (
                (PreviousObject.VectorMargin.X > 0 && PreviousObject.VectorMargin.Y > 0 && VectorObject.Y < 0) ||
                (PreviousObject.VectorMargin.X < 0 && PreviousObject.VectorMargin.Y < 0 && VectorMargin.Y > 0) ||
                (PreviousObject.VectorMargin.X < 0 && PreviousObject.VectorMargin.Y > 0 && VectorMargin.X > 0) ||
                (PreviousObject.VectorMargin.X > 0 && PreviousObject.VectorMargin.Y < 0 && VectorMargin.X < 0)
                )
              {
                initialDirectionCheck = true;
              }
            }

            else if (PreviousObject.AppliedMirror == 3) // Y Left is checked
            {
              if (
                (PreviousObject.VectorMargin.X > 0 && PreviousObject.VectorMargin.Y > 0 && VectorObject.Y < 0) || // if previous object looks front // Y value should be positive
                (PreviousObject.VectorMargin.X < 0 && PreviousObject.VectorMargin.Y < 0 && VectorMargin.Y > 0) || // if previous object looks back  // Y value should be negative
                (PreviousObject.VectorMargin.X < 0 && PreviousObject.VectorMargin.Y > 0 && VectorMargin.X > 0) || // if previous object looks left  // X value should be positive
                (PreviousObject.VectorMargin.X > 0 && PreviousObject.VectorMargin.Y < 0 && VectorMargin.X < 0)      // if previous object looks right // X value should be positive
                )
              {
                initialDirectionCheck = true;
              }

            }
            else
            {
            }

            if (!((baseX + VectorMargin.X < 360) && (baseY + VectorMargin.Y < 660) && (baseZ + VectorMargin.Z < 300) &&
              (baseX + VectorMargin.X > 0) && (baseY + VectorMargin.Y > 0) && (baseZ + VectorMargin.Z > 0)))
            {
              inLimits = false;
            }
            // Rhino.RhinoApp.WriteLine("Bools " + suitableDirection.ToString() + "    " + inLimits.ToString() + ' ');

            int XLoopStartMargin = (int) ((int) (baseX / CellSize) < (baseX / CellSize + (int) XCellMargin) ? (int) (baseX / CellSize) : (baseX / CellSize + (int) XCellMargin));
            int XLoopEndMargin = (int) ((int) (baseX / CellSize) > (baseX / CellSize + (int) XCellMargin) ? (int) (baseX / CellSize) : (baseX / CellSize + (int) XCellMargin));

            int YLoopStartMargin = (int) ((int) (baseY / CellSize) < baseY / CellSize + (int) YCellMargin ? (int) (baseY / CellSize) : baseY / CellSize + (int) YCellMargin);
            int YLoopEnMargin = (int) ((int) (baseY / CellSize) > baseY / CellSize + (int) YCellMargin ? (int) (baseY / CellSize) : baseY / CellSize + (int) YCellMargin);

            int ZLoopStartMargin = (int) ((int) (baseZ / 150) < baseZ / 150 + (int) ZCellMargin ? (int) (baseZ / 150) : baseZ / 150 + (int) ZCellMargin);
            int ZLoopEndMargin = (int) ((int) (baseZ / 150) > baseZ / 150 + (int) ZCellMargin ? (int) (baseZ / 150) : baseZ / 150 + (int) ZCellMargin);

            /***/
            int XLoopStartObject = (int) ((int) (baseX / CellSize) < (baseX / CellSize + (int) XCellObject) ? (int) (baseX / CellSize) : (baseX / CellSize + (int) XCellObject));
            int XLoopEndObject = (int) ((int) (baseX / CellSize) > (baseX / CellSize + (int) XCellObject) ? (int) (baseX / CellSize) : (baseX / CellSize + (int) XCellObject));

            int YLoopStartObject = (int) ((int) (baseY / CellSize) < baseY / CellSize + (int) YCellObject ? (int) (baseY / CellSize) : baseY / CellSize + (int) YCellObject);
            int YLoopEnObject = (int) ((int) (baseY / CellSize) > baseY / CellSize + (int) YCellObject ? (int) (baseY / CellSize) : baseY / CellSize + (int) YCellObject);

            int ZLoopStartObject = (int) ((int) (baseZ / 150) < baseZ / 150 + (int) ZCellObject ? (int) (baseZ / 150) : baseZ / 150 + (int) ZCellObject);
            int ZLoopEndObject = (int) ((int) (baseZ / 150) > baseZ / 150 + (int) ZCellObject ? (int) (baseZ / 150) : baseZ / 150 + (int) ZCellObject);

            if (inLimits && initialDirectionCheck)
            {
              for (int i = XLoopStartMargin; i < XLoopEndMargin; i++)
              {
                for (int j = YLoopStartMargin; j < YLoopEnMargin; j++)
                {
                  for (int k = ZLoopStartMargin; k < ZLoopEndMargin; k++)
                  {
                    //checks if the cell is empty (We dont want to see an object in a cell! )
                    if (((emptyFullArray[i, j, k] == 1) || (emptyFullArray[i, j, k] == 2)))
                    {
                      //Rhino.RhinoApp.WriteLine("Front Margin Array is full, Loop numbers ------" + i.ToString() + ' ' + j.ToString() + ' ' + k.ToString() + ' ');
                      emptyBool = false;
                    }

                    // 2nd Loop checks if the zone is the same or empty zone // Actually margin can ovewflow to other zones
                    /*
                    if (!(areaArray[i, j, k] != this.ZoneName || areaArray[i, j, k] != 0))
                    {
                    sameZone = false;
                    }
                    */
                  }
                }
              }
              // 2nd Loop checks if the zone is the same or empty zone
              for (int i = XLoopStartObject; i < XLoopEndObject; i++)
              {
                for (int j = YLoopStartObject; j < YLoopEnObject; j++)
                {
                  for (int k = ZLoopStartObject; k < ZLoopEndObject; k++)
                  {
                    //checks if the cell is empty (We dont want to see margin or object in the cell )
                    if (((emptyFullArray[i, j, k] == 1) || (emptyFullArray[i, j, k] == 2)))
                    {
                      //Rhino.RhinoApp.WriteLine("Front object Array is full: Loop numbers ---------------------------------- i:" + i.ToString() + 'j' + j.ToString() + 'k' + k.ToString() + ' ');
                      emptyBool = false;
                    }

                    // 2nd Loop checks if the zone is the same or empty zone
                    if (!(areaArray[i, j, k] == this.ZoneName || areaArray[i, j, k] == 0))
                    {
                      sameZone = false;
                    }
                  }
                }
              }

              if (emptyBool && sameZone)
              {
                Rhino.RhinoApp.WriteLine(" ");
                Rhino.RhinoApp.WriteLine("Rotation Angle is:  " + RotationOpt[g].ToString());
                Rhino.RhinoApp.WriteLine("MirrorOption is:  " + MirrorOpt[f].ToString());
                Rhino.RhinoApp.WriteLine("Sliding base position is:  " + h.ToString());
                Rhino.RhinoApp.WriteLine("Base VEctor is :  " + this.BaseVector.ToString());
                Rhino.RhinoApp.WriteLine(" ");

                suitableDirection = true;
                Rhino.RhinoApp.WriteLine("Place Right: Conditions are  satisfied********************************************************************************************************** ");
                goto SkipLoop;
                // BREAK THE LOOP IF A SOLUTION IS FOUND
              }
              else
              {
                Rhino.RhinoApp.WriteLine("Place Right: Conditions are not satisfied ");
                suitableDirection = false;
                // RESET DRIECTION AND MIRROR
                VectorMargin = this.VectorMarginCache;
                VectorObject = this.VectorObjectCache;
              }
            }
            else
            {
              Rhino.RhinoApp.WriteLine("Place Right:  Conditions are not satisfied ");
              suitableDirection = false;
              // RESET DRIECTION AND MIRROR
              VectorMargin = this.VectorMarginCache;
              VectorObject = this.VectorObjectCache;
            }
          }
        }
      }
      SkipLoop:
        return suitableDirection;
    }

    public void PlaceLeft(int[,,] emptyFullArray, out Box ObjBox, out Box marginBox)
    {
      int XLoopStartMargin = (int) ((int) (baseX / CellSize) < (baseX / CellSize + (int) XCellMargin) ? (int) (baseX / CellSize) : (baseX / CellSize + (int) XCellMargin));
      int XLoopEndMargin = (int) ((int) (baseX / CellSize) > (baseX / CellSize + (int) XCellMargin) ? (int) (baseX / CellSize) : (baseX / CellSize + (int) XCellMargin));

      int YLoopStartMargin = (int) ((int) (baseY / CellSize) < baseY / CellSize + (int) YCellMargin ? (int) (baseY / CellSize) : baseY / CellSize + (int) YCellMargin);
      int YLoopEnMargin = (int) ((int) (baseY / CellSize) > baseY / CellSize + (int) YCellMargin ? (int) (baseY / CellSize) : baseY / CellSize + (int) YCellMargin);

      int ZLoopStartMargin = (int) ((int) (baseZ / 150) < baseZ / 150 + (int) ZCellMargin ? (int) (baseZ / 150) : baseZ / 150 + (int) ZCellMargin);
      int ZLoopEndMargin = (int) ((int) (baseZ / 150) > baseZ / 150 + (int) ZCellMargin ? (int) (baseZ / 150) : baseZ / 150 + (int) ZCellMargin);


      int XLoopStartObject = (int) ((int) (baseX / CellSize) < (baseX / CellSize + (int) XCellObject) ? (int) (baseX / CellSize) : (baseX / CellSize + (int) XCellObject));
      int XLoopEndObject = (int) ((int) (baseX / CellSize) > (baseX / CellSize + (int) XCellObject) ? (int) (baseX / CellSize) : (baseX / CellSize + (int) XCellObject));

      int YLoopStartObject = (int) ((int) (baseY / CellSize) < baseY / CellSize + (int) YCellObject ? (int) (baseY / CellSize) : baseY / CellSize + (int) YCellObject);
      int YLoopEnObject = (int) ((int) (baseY / CellSize) > baseY / CellSize + (int) YCellObject ? (int) (baseY / CellSize) : baseY / CellSize + (int) YCellObject);

      int ZLoopStartObject = (int) ((int) (baseZ / 150) < baseZ / 150 + (int) ZCellObject ? (int) (baseZ / 150) : baseZ / 150 + (int) ZCellObject);
      int ZLoopEndObject = (int) ((int) (baseZ / 150) > baseZ / 150 + (int) ZCellObject ? (int) (baseZ / 150) : baseZ / 150 + (int) ZCellObject);

      for (int i = XLoopStartMargin; i < XLoopEndMargin; i++)
      {
        for (int j = YLoopStartMargin; j < YLoopEnMargin; j++)
        {
          for (int k = ZLoopStartMargin; k < ZLoopEndMargin; k++)
          {
            emptyFullArray[i, j, k] = 2; // 2 represents margin
          }
        }
      }
      //Place Object, object is smaller than margin
      for (int i = XLoopStartObject; i < XLoopEndObject; i++)
      {
        for (int j = YLoopStartObject; j < YLoopEnObject; j++)
        {
          for (int k = ZLoopStartObject; k < ZLoopEndObject; k++)
          {
            emptyFullArray[i, j, k] = 1; // 1 represents object
          }
        }
      }

      Point3d pointa = new Point3d(baseX, baseY, baseZ);
      Vector3d pointb = new Vector3d(0, 0, 1);

      Plane planebase = new Plane(pointa, pointb);

      Interval xInterval = new Interval(0, this.VectorObject.X);
      Interval yInterval = new Interval(0, this.VectorObject.Y);
      Interval zInterval = new Interval(0, this.VectorObject.Z);

      ObjBox = new Box(planebase, xInterval, yInterval, zInterval);

      xInterval = new Interval(0, this.VectorMargin.X);
      yInterval = new Interval(0, this.VectorMargin.Y);
      zInterval = new Interval(0, this.VectorMargin.Z);

      marginBox = new Box(planebase, xInterval, yInterval, zInterval);
    }

    public bool CheckTop(int[,,] emptyFullArray, int[,,] areaArray)
    {
      bool inLimits = true;
      bool emptyBool = true;
      bool sameZone = true;

      bool suitableDirection = true;

      /**/
      this.XCellMargin = (this.VectorMargin.X < 0 ? -1 : 1) * Math.Ceiling((double) Math.Abs(this.VectorMargin.X / CellSize));
      this.YCellMargin = (this.VectorMargin.Y < 0 ? -1 : 1) * Math.Ceiling((double) Math.Abs(this.VectorMargin.Y / CellSize));
      this.ZCellMargin = (this.VectorMargin.Z < 0 ? -1 : 1) * Math.Ceiling((double) Math.Abs(this.VectorMargin.Z / 150));

      this.XCellObject = (this.VectorObject.X < 0 ? -1 : 1) * Math.Ceiling((double) Math.Abs(this.VectorObject.X / CellSize));
      this.YCellObject = (this.VectorObject.Y < 0 ? -1 : 1) * Math.Ceiling((double) Math.Abs(this.VectorObject.Y / CellSize));
      this.ZCellObject = (this.VectorObject.Z < 0 ? -1 : 1) * Math.Ceiling((double) Math.Abs(this.VectorObject.Z / 150));

      if (VectorMargin.X * VectorMargin.Y > 0)
      {
        this.baseX = PreviousObject.baseX;
        this.baseY = PreviousObject.baseY;
        this.baseZ = PreviousObject.baseZ + PreviousObject.ZCellMargin; ;
      }

      else if (VectorMargin.X * VectorMargin.Y < 0)
      {
        this.baseX = PreviousObject.baseX;
        this.baseY = PreviousObject.baseY;
        this.baseZ = PreviousObject.baseZ + PreviousObject.ZCellMargin * this.CellSize;
      }

      Point3d pointa = new Point3d(0, 0, 0);
      Vector3d pointb = new Vector3d(0, 0, 1);
      Plane planee = new Plane(pointa, pointb);

      Vector3d vecX1 = new Vector3d(1, 0, 0);

      BaseVector = new Vector3d(baseX, baseY, baseZ);

      if (VectorObject.Z > 0) //++
      {
        suitableDirection = true;
      }

      if (!((baseX + this.VectorMargin.X < 360) && (baseY + this.VectorMargin.Y < 660) && (baseZ + this.VectorMargin.Z < 300) &&
        (baseX + this.VectorMargin.X > 0) && (baseY + this.VectorMargin.Y > 0) && (baseZ + this.VectorMargin.Z > 0)))
      {
        inLimits = false;
      }


      int XLoopStartMargin = (int) ((int) (baseX / CellSize) < (baseX / CellSize + (int) XCellMargin) ? (int) (baseX / CellSize) : (baseX / CellSize + (int) XCellMargin));
      int XLoopEndMargin = (int) ((int) (baseX / CellSize) > (baseX / CellSize + (int) XCellMargin) ? (int) (baseX / CellSize) : (baseX / CellSize + (int) XCellMargin));

      int YLoopStartMargin = (int) ((int) (baseY / CellSize) < baseY / CellSize + (int) YCellMargin ? (int) (baseY / CellSize) : baseY / CellSize + (int) YCellMargin);
      int YLoopEnMargin = (int) ((int) (baseY / CellSize) > baseY / CellSize + (int) YCellMargin ? (int) (baseY / CellSize) : baseY / CellSize + (int) YCellMargin);

      int ZLoopStartMargin = (int) ((int) (baseZ / 150) < baseZ / 150 + (int) ZCellMargin ? (int) (baseZ / 150) : baseZ / 150 + (int) ZCellMargin);
      int ZLoopEndMargin = (int) ((int) (baseZ / 150) > baseZ / 150 + (int) ZCellMargin ? (int) (baseZ / 150) : baseZ / 150 + (int) ZCellMargin);

      /***/
      int XLoopStartObject = (int) ((int) (baseX / CellSize) < (baseX / CellSize + (int) XCellObject) ? (int) (baseX / CellSize) : (baseX / CellSize + (int) XCellObject));
      int XLoopEndObject = (int) ((int) (baseX / CellSize) > (baseX / CellSize + (int) XCellObject) ? (int) (baseX / CellSize) : (baseX / CellSize + (int) XCellObject));

      int YLoopStartObject = (int) ((int) (baseY / CellSize) < baseY / CellSize + (int) YCellObject ? (int) (baseY / CellSize) : baseY / CellSize + (int) YCellObject);
      int YLoopEnObject = (int) ((int) (baseY / CellSize) > baseY / CellSize + (int) YCellObject ? (int) (baseY / CellSize) : baseY / CellSize + (int) YCellObject);

      int ZLoopStartObject = (int) ((int) (baseZ / 150) < baseZ / 150 + (int) ZCellObject ? (int) (baseZ / 150) : baseZ / 150 + (int) ZCellObject);
      int ZLoopEndObject = (int) ((int) (baseZ / 150) > baseZ / 150 + (int) ZCellObject ? (int) (baseZ / 150) : baseZ / 150 + (int) ZCellObject);

      if (!((baseX + VectorMargin.X < 360) && (baseY + VectorMargin.Y < 660) && (baseZ + VectorMargin.Z < 300) &&
        (baseX + VectorMargin.X > 0) && (baseY + VectorMargin.Y > 0) && (baseZ + VectorMargin.Z > 0)))
      {
        inLimits = false;
      }

      if (inLimits && suitableDirection)
      {

        for (int i = XLoopStartMargin; i < XLoopEndMargin; i++)
        {
          for (int j = YLoopStartMargin; j < YLoopEnMargin; j++)
          {
            for (int k = ZLoopStartMargin; k < ZLoopEndMargin; k++)
            {
              //checks if the cell is empty (We dont want to see an object in a cell! )
              if (((emptyFullArray[i, j, k] == 1) || (emptyFullArray[i, j, k] == 2)))
              {
                emptyBool = false;
              }

              // 2nd Loop checks if the zone is the same or empty zone // Actually margin can ovewflow to other zones
              /*
              if (!(areaArray[i, j, k] != this.ZoneName || areaArray[i, j, k] != 0))
              {
              sameZone = false;
              }
              */
            }
          }
        }
        // 2nd Loop checks if the zone is the same or empty zone
        for (int i = XLoopStartObject; i < XLoopEndObject; i++)
        {
          for (int j = YLoopStartObject; j < YLoopEnObject; j++)
          {
            for (int k = ZLoopStartObject; k < ZLoopEndObject; k++)
            {
              //checks if the cell is empty (We dont want to see margin or object in the cell )
              if (((emptyFullArray[i, j, k] == 1) || (emptyFullArray[i, j, k] == 2)))
              {
                emptyBool = false;
              }

              // 2nd Loop checks if the zone is the same or empty zone
              if (!(areaArray[i, j, k] == this.ZoneName || areaArray[i, j, k] == 0))
              {
                sameZone = false;
              }
            }
          }
        }

        if (emptyBool && sameZone)
        {
          suitableDirection = true;
          Rhino.RhinoApp.WriteLine("Place Top:  Conditions are  satisfied ");
        }
        else
        {
          Rhino.RhinoApp.WriteLine("Place Top:  Conditions are not satisfied ");
          suitableDirection = false;
        }
      }
      else
      {
        Rhino.RhinoApp.WriteLine("Place Top:  Conditions are not satisfied ");
        suitableDirection = false;
      }
      return suitableDirection;
    }

    public void PlaceTop(int[,,] emptyFullArray, out Box ObjBox, out Box marginBox)
    {

      int XLoopStartMargin = (int) ((int) (baseX / CellSize) < (baseX / CellSize + (int) XCellMargin) ? (int) (baseX / CellSize) : (baseX / CellSize + (int) XCellMargin));
      int XLoopEndMargin = (int) ((int) (baseX / CellSize) > (baseX / CellSize + (int) XCellMargin) ? (int) (baseX / CellSize) : (baseX / CellSize + (int) XCellMargin));

      int YLoopStartMargin = (int) ((int) (baseY / CellSize) < baseY / CellSize + (int) YCellMargin ? (int) (baseY / CellSize) : baseY / CellSize + (int) YCellMargin);
      int YLoopEnMargin = (int) ((int) (baseY / CellSize) > baseY / CellSize + (int) YCellMargin ? (int) (baseY / CellSize) : baseY / CellSize + (int) YCellMargin);

      int ZLoopStartMargin = (int) ((int) (baseZ / 150) < baseZ / 150 + (int) ZCellMargin ? (int) (baseZ / 150) : baseZ / 150 + (int) ZCellMargin);
      int ZLoopEndMargin = (int) ((int) (baseZ / 150) > baseZ / 150 + (int) ZCellMargin ? (int) (baseZ / 150) : baseZ / 150 + (int) ZCellMargin);


      int XLoopStartObject = (int) ((int) (baseX / CellSize) < (baseX / CellSize + (int) XCellObject) ? (int) (baseX / CellSize) : (baseX / CellSize + (int) XCellObject));
      int XLoopEndObject = (int) ((int) (baseX / CellSize) > (baseX / CellSize + (int) XCellObject) ? (int) (baseX / CellSize) : (baseX / CellSize + (int) XCellObject));

      int YLoopStartObject = (int) ((int) (baseY / CellSize) < baseY / CellSize + (int) YCellObject ? (int) (baseY / CellSize) : baseY / CellSize + (int) YCellObject);
      int YLoopEnObject = (int) ((int) (baseY / CellSize) > baseY / CellSize + (int) YCellObject ? (int) (baseY / CellSize) : baseY / CellSize + (int) YCellObject);

      int ZLoopStartObject = (int) ((int) (baseZ / 150) < baseZ / 150 + (int) ZCellObject ? (int) (baseZ / 150) : baseZ / 150 + (int) ZCellObject);
      int ZLoopEndObject = (int) ((int) (baseZ / 150) > baseZ / 150 + (int) ZCellObject ? (int) (baseZ / 150) : baseZ / 150 + (int) ZCellObject);

      for (int i = XLoopStartMargin; i < XLoopEndMargin; i++)
      {
        for (int j = YLoopStartMargin; j < YLoopEnMargin; j++)
        {
          for (int k = ZLoopStartMargin; k < ZLoopEndMargin; k++)
          {
            emptyFullArray[i, j, k] = 2; // 2 represents margin
          }
        }
      }
      //Place Object, object is smaller than margin
      for (int i = XLoopStartObject; i < XLoopEndObject; i++)
      {
        for (int j = YLoopStartObject; j < YLoopEnObject; j++)
        {
          for (int k = ZLoopStartObject; k < ZLoopEndObject; k++)
          {
            emptyFullArray[i, j, k] = 1; // 1 represents object
          }
        }
      }

      Point3d pointa = new Point3d(baseX, baseY, baseZ);
      Vector3d pointb = new Vector3d(0, 0, 1);

      Plane planebase = new Plane(pointa, pointb);

      Interval xInterval = new Interval(0, this.VectorObject.X);
      Interval yInterval = new Interval(0, this.VectorObject.Y);
      Interval zInterval = new Interval(0, this.VectorObject.Z);

      ObjBox = new Box(planebase, xInterval, yInterval, zInterval);

      xInterval = new Interval(0, this.VectorMargin.X);
      yInterval = new Interval(0, this.VectorMargin.Y);
      zInterval = new Interval(0, this.VectorMargin.Z);

      marginBox = new Box(planebase, xInterval, yInterval, zInterval);
    }

    public bool CheckBottom(int[,,] emptyFullArray, int[,,] areaArray)
    {
      bool inLimits = true;
      bool emptyBool = true;
      bool sameZone = true;

      bool suitableDirection = true;

      /**/
      this.XCellMargin = (this.VectorMargin.X < 0 ? -1 : 1) * Math.Ceiling((double) Math.Abs(this.VectorMargin.X / CellSize));
      this.YCellMargin = (this.VectorMargin.Y < 0 ? -1 : 1) * Math.Ceiling((double) Math.Abs(this.VectorMargin.Y / CellSize));
      this.ZCellMargin = (this.VectorMargin.Z < 0 ? -1 : 1) * Math.Ceiling((double) Math.Abs(this.VectorMargin.Z / 150));

      this.XCellObject = (this.VectorObject.X < 0 ? -1 : 1) * Math.Ceiling((double) Math.Abs(this.VectorObject.X / CellSize));
      this.YCellObject = (this.VectorObject.Y < 0 ? -1 : 1) * Math.Ceiling((double) Math.Abs(this.VectorObject.Y / CellSize));
      this.ZCellObject = (this.VectorObject.Z < 0 ? -1 : 1) * Math.Ceiling((double) Math.Abs(this.VectorObject.Z / 150));

      if (VectorMargin.X * VectorMargin.Y > 0)
      {
        this.baseX = PreviousObject.baseX;
        this.baseY = PreviousObject.baseY;
        this.baseZ = PreviousObject.baseZ;
      }

      else if (VectorMargin.X * VectorMargin.Y < 0)
      {
        this.baseX = PreviousObject.baseX;
        this.baseY = PreviousObject.baseY;
        this.baseZ = PreviousObject.baseZ;
      }

      Point3d pointa = new Point3d(0, 0, 0);
      Vector3d pointb = new Vector3d(0, 0, 1);
      Plane planee = new Plane(pointa, pointb);

      Vector3d vecX1 = new Vector3d(1, 0, 0);

      BaseVector = new Vector3d(baseX, baseY, baseZ);


      if (VectorObject.Z < 0) //++
      {
        suitableDirection = true;
      }

      if (!((baseX + this.ObjWidth < 360) && (baseY + this.ObjLength < 660) && (baseZ + this.ObjHeight < 300) &&
        (baseX + this.ObjWidth > 0) && (baseY + this.ObjLength > 0) && (baseZ + this.ObjHeight > 0)))
      {
        inLimits = false;
      }


      int XLoopStartMargin = (int) ((int) (baseX / CellSize) < (baseX / CellSize + (int) XCellMargin) ? (int) (baseX / CellSize) : (baseX / CellSize + (int) XCellMargin));
      int XLoopEndMargin = (int) ((int) (baseX / CellSize) > (baseX / CellSize + (int) XCellMargin) ? (int) (baseX / CellSize) : (baseX / CellSize + (int) XCellMargin));

      int YLoopStartMargin = (int) ((int) (baseY / CellSize) < baseY / CellSize + (int) YCellMargin ? (int) (baseY / CellSize) : baseY / CellSize + (int) YCellMargin);
      int YLoopEnMargin = (int) ((int) (baseY / CellSize) > baseY / CellSize + (int) YCellMargin ? (int) (baseY / CellSize) : baseY / CellSize + (int) YCellMargin);

      int ZLoopStartMargin = (int) ((int) (baseZ / 150) < baseZ / 150 + (int) ZCellMargin ? (int) (baseZ / 150) : baseZ / 150 + (int) ZCellMargin);
      int ZLoopEndMargin = (int) ((int) (baseZ / 150) > baseZ / 150 + (int) ZCellMargin ? (int) (baseZ / 150) : baseZ / 150 + (int) ZCellMargin);

      /***/
      int XLoopStartObject = (int) ((int) (baseX / CellSize) < (baseX / CellSize + (int) XCellObject) ? (int) (baseX / CellSize) : (baseX / CellSize + (int) XCellObject));
      int XLoopEndObject = (int) ((int) (baseX / CellSize) > (baseX / CellSize + (int) XCellObject) ? (int) (baseX / CellSize) : (baseX / CellSize + (int) XCellObject));

      int YLoopStartObject = (int) ((int) (baseY / CellSize) < baseY / CellSize + (int) YCellObject ? (int) (baseY / CellSize) : baseY / CellSize + (int) YCellObject);
      int YLoopEnObject = (int) ((int) (baseY / CellSize) > baseY / CellSize + (int) YCellObject ? (int) (baseY / CellSize) : baseY / CellSize + (int) YCellObject);

      int ZLoopStartObject = (int) ((int) (baseZ / 150) < baseZ / 150 + (int) ZCellObject ? (int) (baseZ / 150) : baseZ / 150 + (int) ZCellObject);
      int ZLoopEndObject = (int) ((int) (baseZ / 150) > baseZ / 150 + (int) ZCellObject ? (int) (baseZ / 150) : baseZ / 150 + (int) ZCellObject);

      if (!((baseX + VectorMargin.X < 360) && (baseY + VectorMargin.Y < 660) && (baseZ + VectorMargin.Z < 300) &&
        (baseX + VectorMargin.X > 0) && (baseY + VectorMargin.Y > 0) && (baseZ + VectorMargin.Z > 0)))
      {
        inLimits = false;
      }

      if (inLimits && suitableDirection)
      {

        for (int i = XLoopStartMargin; i < XLoopEndMargin; i++)
        {
          for (int j = YLoopStartMargin; j < YLoopEnMargin; j++)
          {
            for (int k = ZLoopStartMargin; k < ZLoopEndMargin; k++)
            {
              //checks if the cell is empty (We dont want to see an object in a cell! )
              if (((emptyFullArray[i, j, k] == 1) || (emptyFullArray[i, j, k] == 2)))
              {
                emptyBool = false;
              }

              // 2nd Loop checks if the zone is the same or empty zone // Actually margin can ovewflow to other zones
              /*
              if (!(areaArray[i, j, k] != this.ZoneName || areaArray[i, j, k] != 0))
              {
              sameZone = false;
              }
              */
            }
          }
        }
        // 2nd Loop checks if the zone is the same or empty zone
        for (int i = XLoopStartObject; i < XLoopEndObject; i++)
        {
          for (int j = YLoopStartObject; j < YLoopEnObject; j++)
          {
            for (int k = ZLoopStartObject; k < ZLoopEndObject; k++)
            {
              //checks if the cell is empty (We dont want to see margin or object in the cell )
              if (((emptyFullArray[i, j, k] == 1) || (emptyFullArray[i, j, k] == 2)))
              {
                emptyBool = false;
              }

              // 2nd Loop checks if the zone is the same or empty zone
              if (!(areaArray[i, j, k] == this.ZoneName || areaArray[i, j, k] == 0))
              {
                sameZone = false;
              }
            }
          }
        }

        if (emptyBool && sameZone)
        {
          suitableDirection = true;
          Rhino.RhinoApp.WriteLine("Place Bottom:  Conditions are  satisfied ");
        }
        else
        {
          Rhino.RhinoApp.WriteLine("Place Bottom:  Conditions are not satisfied ");
          suitableDirection = false;
        }
      }
      else
      {
        Rhino.RhinoApp.WriteLine("Place Bottom:  Conditions are not satisfied ");
        suitableDirection = false;
      }
      return suitableDirection;
    }

    public void PlaceBottom(int[,,] emptyFullArray, out Box ObjBox, out Box marginBox)
    {
      int XLoopStartMargin = (int) ((int) (baseX / CellSize) < (baseX / CellSize + (int) XCellMargin) ? (int) (baseX / CellSize) : (baseX / CellSize + (int) XCellMargin));
      int XLoopEndMargin = (int) ((int) (baseX / CellSize) > (baseX / CellSize + (int) XCellMargin) ? (int) (baseX / CellSize) : (baseX / CellSize + (int) XCellMargin));

      int YLoopStartMargin = (int) ((int) (baseY / CellSize) < baseY / CellSize + (int) YCellMargin ? (int) (baseY / CellSize) : baseY / CellSize + (int) YCellMargin);
      int YLoopEnMargin = (int) ((int) (baseY / CellSize) > baseY / CellSize + (int) YCellMargin ? (int) (baseY / CellSize) : baseY / CellSize + (int) YCellMargin);

      int ZLoopStartMargin = (int) ((int) (baseZ / 150) < baseZ / 150 + (int) ZCellMargin ? (int) (baseZ / 150) : baseZ / 150 + (int) ZCellMargin);
      int ZLoopEndMargin = (int) ((int) (baseZ / 150) > baseZ / 150 + (int) ZCellMargin ? (int) (baseZ / 150) : baseZ / 150 + (int) ZCellMargin);


      int XLoopStartObject = (int) ((int) (baseX / CellSize) < (baseX / CellSize + (int) XCellObject) ? (int) (baseX / CellSize) : (baseX / CellSize + (int) XCellObject));
      int XLoopEndObject = (int) ((int) (baseX / CellSize) > (baseX / CellSize + (int) XCellObject) ? (int) (baseX / CellSize) : (baseX / CellSize + (int) XCellObject));

      int YLoopStartObject = (int) ((int) (baseY / CellSize) < baseY / CellSize + (int) YCellObject ? (int) (baseY / CellSize) : baseY / CellSize + (int) YCellObject);
      int YLoopEnObject = (int) ((int) (baseY / CellSize) > baseY / CellSize + (int) YCellObject ? (int) (baseY / CellSize) : baseY / CellSize + (int) YCellObject);

      int ZLoopStartObject = (int) ((int) (baseZ / 150) < baseZ / 150 + (int) ZCellObject ? (int) (baseZ / 150) : baseZ / 150 + (int) ZCellObject);
      int ZLoopEndObject = (int) ((int) (baseZ / 150) > baseZ / 150 + (int) ZCellObject ? (int) (baseZ / 150) : baseZ / 150 + (int) ZCellObject);

      for (int i = XLoopStartMargin; i < XLoopEndMargin; i++)
      {
        for (int j = YLoopStartMargin; j < YLoopEnMargin; j++)
        {
          for (int k = ZLoopStartMargin; k < ZLoopEndMargin; k++)
          {
            emptyFullArray[i, j, k] = 2; // 2 represents margin
          }
        }
      }
      //Place Object, object is smaller than margin
      for (int i = XLoopStartObject; i < XLoopEndObject; i++)
      {
        for (int j = YLoopStartObject; j < YLoopEnObject; j++)
        {
          for (int k = ZLoopStartObject; k < ZLoopEndObject; k++)
          {
            emptyFullArray[i, j, k] = 1; // 1 represents object
          }
        }
      }

      Point3d pointa = new Point3d(baseX, baseY, baseZ);
      Vector3d pointb = new Vector3d(0, 0, 1);

      Plane planebase = new Plane(pointa, pointb);

      Interval xInterval = new Interval(0, this.VectorObject.X);
      Interval yInterval = new Interval(0, this.VectorObject.Y);
      Interval zInterval = new Interval(0, this.VectorObject.Z);

      ObjBox = new Box(planebase, xInterval, yInterval, zInterval);

      xInterval = new Interval(0, this.VectorMargin.X);
      yInterval = new Interval(0, this.VectorMargin.Y);
      zInterval = new Interval(0, this.VectorMargin.Z);

      marginBox = new Box(planebase, xInterval, yInterval, zInterval);
    }
  }
  static void ShowMatrix(int[,,] Arr)
  {
        /* SHOW 2D ARRAY
         IT CAN BE USED FOR EMPTY/FULL/MARGIN
         OR ZONE LAYOUT */
    for (int i = 0; i < Arr.GetLength(0); i++)
    {
      for (int j = 0; j < Arr.GetLength(1); j++)
      {
        Rhino.RhinoApp.Write(Arr[i, j, 0] + " ");
      }
      Rhino.RhinoApp.WriteLine("   ");
    }
    return;
  }

  static int[,,] InitializeZeroMatrice(int width, int length, int levelNumber)
  {
    // CREATE AN ARRAY IN GIVEN DIMENSIONS
    var areaArray = new int[width, length, levelNumber];
    /* PASS THROUGH EAC ELEMENT OF THE ARRAY AND  ASSING THEM 0*/
    for (int k = 0; k < levelNumber; k++)
    {
      for (int i = 0; i < width; i++)
      {
        for (int j = 0; j < length; j++)
        {
          areaArray[i, j, k] = 0;
        }
      }
    }
    return areaArray;
  }

  /*         Initialize zone list to stack cell informations    */
  static List<int> entranceList = new List<int>();
  static List<int> commonList = new List<int>();
  static List<int> wetAreaList = new List<int>();

  /**           these counters are used for starting the límitations counts.         **/
  static int entranceCounter = 1;
  static int commonCounter = 1;
  static int wetAreaCounter = 1;

  /**           these limits are used for defining max distance that zone can spread. Unit is cm.  **/
  static readonly int entranceLimit = 400;
  static readonly int commonLimit = 300;
  static readonly int wetAreaLimit = 300;

  static void StartZones(int[,,] arr)
  {
    /*GetLenght0  == width of an array, getLength == lenght of an array. It is dynamic because we can change area anytime we want. */
    Rhino.RhinoApp.WriteLine("Zone creation started");
    Random rand = new Random();
    // get a zone in the middle of X=0 or X=1 or X=2 line.
    // it is resticred because we want to place entrance Zone and entrance door close to X=0.
    var a = rand.Next(arr.GetLength(0) / 2, arr.GetLength(0) / 2);
    var b = rand.Next(0, 2);
    entranceList.AddRange(new int[2] { a, b });
    arr[a, b, 0] = 1;

    //Add.Range adds multiple elements to a list. Instead of creating multiple sublists we are using flatted data structure. We are stacking them in one long list. Faster!
    // x1,y1,x2,y2,x3,y3.... all in one list

    // Randomly assign tho any cell.
    b = rand.Next(0, arr.GetLength(1));
    a = rand.Next(0, arr.GetLength(0));
    commonList.AddRange(new int[2] { a, b });
    arr[a, b, 0] = 2;

    // Randomly assign tho any cell.
    a = rand.Next(0, arr.GetLength(0));
    b = rand.Next(0, arr.GetLength(1));
    wetAreaList.AddRange(new int[2] { a, b });
    arr[a, b, 0] = 3;


  }

  static double DistanceCalculate(List<int> spaceCoordList, int x2, int y2, int cellSize)
  {
    // Euclidian distance calculator.
    var distance = cellSize * Math.Sqrt((y2 - spaceCoordList[1]) * (y2 - spaceCoordList[1]) + (x2 - spaceCoordList[0]) * (x2 - spaceCoordList[0]));
    return distance;
  }

  static void NoiseFilter(int[,,] arr, int type, int iterationNumber, int controlNumber)
  {
        /*
         *https://www.researchgate.net/figure/Neighboring-type-in-cellular-automata-A-von-Neumann-configuration-B-Moor_fig3_326665499
         * We are using Von neumann and Moore controls to filter the borders. (cellular automata.)
         * Check the link for further informations.
         *
         */
    if (type == 0)    //check 8 neighbour cells.
    {
      for (int loop = 0; loop < iterationNumber; loop++)
      {
        List<int> surrounding = new List<int>();

        for (int i = 1; i < arr.GetLength(0) - 1; i++)
        {
          for (int j = 1; j < arr.GetLength(1) - 1; j++)
          {
            for (int x = -1; x < 2; x++)
            {
              for (int y = -1; y < 2; y++)
              {
                if (!(x == y && x == 0))
                {

                  surrounding.Add(arr[i + x, j + y, 0]);
                }
              }
            }
            for (int v = 0; v < 6; v++) // 6 is the number of the zones including  empty cells
            {
              int count = (from z in surrounding where z == v select z).Count(); //USED LINQ methods for getting the number of the each surrounding cell number.
              //https://docs.microsoft.com/en-us/dotnet/csharp/programming-guide/concepts/linq/introduction-to-linq-queries
              if (count >= controlNumber)
              {
                arr[i, j, 0] = v; // if one of the Zone has elements => number elements than control number argument transform current cell to it.
              }
            }
            surrounding.Clear();
            surrounding.TrimExcess();
          }
        }
      }
    }

    if (type == 1)  //check 4 neighbour cells.
    {
      for (int loop = 0; loop < iterationNumber; loop++)
      {
        List<int> surrounding = new List<int>();
        for (int i = 1; i < arr.GetLength(0) - 1; i++)
        {
          for (int j = 1; j < arr.GetLength(1) - 1; j++)
          {
            for (int x = -1; x < 2; x++)
            {
              for (int y = -1; y < 2; y++)
              {
                if (!(x == y && x == 0) && ((x + y == 1) || (x + y == -1)))
                {
                  surrounding.Add(arr[i + x, j + y, 0]);
                }
              }
            }

            for (int v = 0; v < 6; v++) // 6 is the number of the zones including  empty cells
            {
              int count = (from z in surrounding where z == v select z).Count();
              if (count >= 2)
              {
                // if 2 neigbours has same zone value transform itself to this!
                // controlNumber CAN BE ASSIGNED INSTEAD OF 2 here . we can give it as arguments as well.
                arr[i, j, 0] = v;
              }
            }
            surrounding.Clear();
            surrounding.TrimExcess();
          }
        }
      }
    }
  }

  public static void Fisher_Yates_CardDeck_Shuffle(List<int> aList)
  {
    // Method to shuffle List elements.
    System.Random _random = new System.Random();

    int myGO;

    int n = aList.Count;
    for (int i = 0; i < n; i++)
    {
      // NextDouble returns a random number between 0 and 1.
      // ... It is equivalent to Math.random() in Java.
      int r = i + (int) (_random.NextDouble() * (n - i));
      myGO = aList[r];
      aList[r] = aList[i];
      aList[i] = myGO;
    }
    // return aList;
  }


  public static void Fisher_Yates_CardDeck_Shuffle(List<double> aList)
  {
    // Method to shuffle List elements.
    System.Random _random = new System.Random();

    double myGO;

    int n = aList.Count;
    for (int i = 0; i < n; i++)
    {
      // NextDouble returns a random number between 0 and 1.
      // ... It is equivalent to Math.random() in Java.
      int r = i + (int) (_random.NextDouble() * (n - i));
      myGO = aList[r];
      aList[r] = aList[i];
      aList[i] = myGO;
    }

    // return aList;
  }
  static void Spread(int[,,] arr, ref double spaceSize, List<int> spaceCoordList, ref int counter, int spaceLimit, int cellSize)
  {
    // SPREAD ZONE CELLS BY USING THE INITIAL CELLS IN THE ZONE LISTS.
    var rand = new Random();
    var directionList = new List<int>();
    int Xcoord;
    int Ycoord;
    bool draw = false;
    int trycount = 0;

        /*THIS inDirection BOOLS ARE VITAL!! DON'T DELETE THEM.
         *THEY CHECKS IF THE GIVEN CONTROLS ARE IN THE ARRAY LIMITS OTHERWISE PROGRAM CRASHES!
         *  FOR NOT GETTING OUTOFBOUND EXCEPTION BE CAREFUL ABOUT CHECKING ARRAY BOUNDRIES BEFORE USING THERE ARRAYS!
         *
         *
         */
    bool inTop;
    bool inRight;
    bool inBottom;
    bool inLeft;

    bool enoughTries = false;


    while (draw == false && counter < spaceSize && enoughTries == false)
    {
            /*
               TO RUN THE WHILE LOOP WE NEED

               1- DRAW CONTITIONS IS FALSE. iF IT IS SUCCESSFULL END THE LOOP
               2- SPACESIZE CONTITIONS IS FALSE. IN THIS CASE IT IS CELL NUMBER
               3- IF THERE IS NO POSSIBLE SOLUTION AFTE ENOUGH TRIES WE STOP THE LOOP. SO WE SHOULD BE IN VALID NUMBER OF TRIES.
             */


            // THIS RANDOM VALUE LEADS US  A X VALUES IN COORDINATE LIST. IF WE DIDNT DIVIDE IT BY 2 IT MIGHT RETURN US Y VALUES TOO BUT IT WILL HARDER TO CONTROL THEM.
            // NOW WE ARE SURE THAT IF WE MULTIPLE THE VALUE BY TWO BY 2 WE AREA GONAN GET X COORDINATE AT GIVEN INDEX.

            // SO CHOOSE ANY RANDOM CELL IN THE GIVEN ZONE.
      var randomCellIndex = rand.Next(spaceCoordList.Count / 2);

      // AS WE ARE USING FLATTENED DATA WE NEED TO MULTIPLY INDEX BY 2    TO GET X VALUES IN GIVEN INDEX
      // AS WE ARE USING FLATTENED DATA WE NEED TO MULTIPLY INDEX BY 2 +1 TO GET Y VALUES IN GIVEN INDEX
      Xcoord = spaceCoordList[2 * randomCellIndex];
      Ycoord = spaceCoordList[2 * randomCellIndex + 1];

      // THIS BOOLS ARE TO BE SURE THAT WE ARE IN THE ARERA LIMITS.

      inTop = (Ycoord + 1 < arr.GetLength(1));              // Check top border
      inRight = (Xcoord + 1 < arr.GetLength(0));              // Check Right border
      inBottom = (Ycoord - 1 >= 0);              // Check bottom border
      inLeft = (Xcoord - 1 >= 0);             //  Check left border

      if (inRight)
      {
                /*
                 * 1- CHECK IF THE POSSIBLE DIRECTION IS EMPTY.
                 * 2- CHECK IF THE POSSIBLE DIRECTION IS IN CIRCULAR DISTANCE LIMIT FROM THE STARTING POINT.
                 */
        if (arr[Xcoord + 1, Ycoord, 0] == 0 && DistanceCalculate(spaceCoordList, Xcoord + 1, Ycoord, cellSize) < spaceLimit) // Check if possible new cell is still white or not!
          directionList.AddRange(new int[2] { (Xcoord + 1), Ycoord }); //Store possible spread directions in a list.
      }

      if (inLeft)
      {
                /*
                 * 1- CHECK IF THE POSSIBLE DIRECTION IS EMPTY.
                 * 2- CHECK IF THE POSSIBLE DIRECTION IS IN CIRCULAR DISTANCE LIMIT FROM THE STARTING POINT.
                 */
        if (arr[Xcoord - 1, Ycoord, 0] == 0 && DistanceCalculate(spaceCoordList, Xcoord - 1, Ycoord, cellSize) < spaceLimit)
          directionList.AddRange(new int[2] { (Xcoord - 1), Ycoord }); //Store possible spread directions in a list.
      }

      if (inTop)
      {
                /*
                 * 1- CHECK IF THE POSSIBLE DIRECTION IS EMPTY.
                 * 2- CHECK IF THE POSSIBLE DIRECTION IS IN CIRCULAR DISTANCE LIMIT FROM THE STARTING POINT.
                 */
        if (arr[Xcoord, Ycoord + 1, 0] == 0 && DistanceCalculate(spaceCoordList, Xcoord, Ycoord + 1, cellSize) < spaceLimit)
          directionList.AddRange(new int[2] { (Xcoord), Ycoord + 1 }); //Store possible spread directions in a list.
      }

      if (inBottom)
      {
                /*
                 * 1- CHECK IF THE POSSIBLE DIRECTION IS EMPTY.
                 * 2- CHECK IF THE POSSIBLE DIRECTION IS IN CIRCULAR DISTANCE LIMIT FROM THE STARTING POINT.
                 */
        if (arr[Xcoord, Ycoord - 1, 0] == 0 && DistanceCalculate(spaceCoordList, Xcoord, Ycoord - 1, cellSize) < spaceLimit)
          directionList.AddRange(new int[2] { (Xcoord), (Ycoord - 1) }); //Store possible spread directions in a list.
      }

      // NOW WE HAVE A DIRECTION LIST WITH POSSIBLE DIRECTION COORDINATES.
      // IN NEXT STEP IF WE HAVE MORE THAN 0 DIRECTIONS WE ARE GONNA CHOOSE THEM RANDOMLY.

      if (directionList.Count > 0)
      {
        var randomIndex = rand.Next(directionList.Count / 2);
        int a = directionList[2 * randomIndex];
        int b = directionList[2 * randomIndex + 1];

        // ASSSIGN THE VALUES TO AREA ARRAY
        arr[a, b, 0] = arr[Xcoord, Ycoord, 0];

        // ADD THE COORDINATES TO ZONE LIST.
        spaceCoordList.AddRange(new int[2] { a, b });

        directionList.Clear();
        directionList.TrimExcess();
        draw = true;
        counter++;
      }

      else
      {
        trycount++;
        if (trycount >= spaceCoordList.Count)
        {
          enoughTries = true;
          //Print("trycountNumber is ={0}", trycount);
        }
      }
    }
  }
# ---------- end c_script_2 ----------
box_47 = Box(shower_cabin)
box_48 = Box(toilet_margin)
box_49 = Box(sink_cupboard)
# ReferenceEntrance // Refenrence
# 1-checkfucntıon
# 2-place function
# 
# Fix directions
box_50 = Box(shower_cabin_2)
box_51 = Box(sink_margin)
box_52 = Box(toılet)
panel_52 = Panel(c_script_2.out)
c_script_3 = CSharpScript(
    Width=integer_5,
    Length=integer_4,
    Height=integer_6,
    LevelHeight=Slider(150, range=0..1000),
    cellSize=multiplication_11,
    ExteriorDoor=box_28,
    ExteriorDoorMargin=box_29,
    ChangeOverZone=box_24,
    ChangeOverZoneMargin=box_32,
    Closet=box_25,
    ClosetMargin=box_23,
    InteriorDoor=box_26,
    InteriorDoorMargin=box_27,
    Counter=box_30,
    CounterMargin=box_31,
    Table=box_33,
    TableMargin=box_34,
    SittingUnit=box_36,
    SittingUnitMargin=box_37,
    Bed=box_40,
    HealtCare=box_38,
    HealthCareMargin=box_39,
    Toilet=box_52,
    ToiletMargin=box_48,
    Sink=box_49,
    SinkMargin=box_51,
    SowerCabin=box_47,
    ShowerCabinMargin=box_50,
    DressingCabin=dressing_cabin,
    DressingCabinMargin=shower_cabin_margin,
    PersonalCloset=closet_2,
    PersonalClosetMargin=closet_margin_2)  # -> out, A, EntranceBoxes, CommonBoxes, WetAreaBoxes, Y, K, W, Furnitures, FurnituresMargins; inputs Width: Int32, Length: Int32, Height: Int32, LevelHeight: Int32, cellSize: Int32, ExteriorDoor: Box, ExteriorDoorMargin: Box, ChangeOverZone: Box, ChangeOverZoneMargin: Box, Closet: Box, ClosetMargin: Box, InteriorDoor: Box, InteriorDoorMargin: Box, Counter: Box, CounterMargin: Box, Table: Box, TableMargin: Box, SittingUnit: Box, SittingUnitMargin: Box, Bed: Box, BedMargin: Box, HealtCare: Box, HealthCareMargin: Box, Toilet: Box, ToiletMargin: Box, Sink: Box, SinkMargin: Box, SowerCabin: Box, DressingCabin: Box, DressingCabinMargin: Box, PersonalCloset: Box, PersonalClosetMargin: Box; disabled
# ---------- c_script_3: C# usings ----------
using System.Linq;
# ---------- c_script_3: C# ----------
    List<Box> entranceBoxes = new List<Box>();
    List<Box> commonBoxes = new List<Box>();
    List<Box> wetAreaBoxes = new List<Box>();

    List<Box> ObjectsList = new List<Box>();
    List<Box> MarginsList = new List<Box>();

    /*List<Box> kitchenBoxes = new List<Box>();
      List<Box> commonAreaBoxes = new List<Box>();*/

    List<Box> WhiteBoxes = new List<Box>();

    /**  These sizes are Spreading Limits for the spaces   //total cells     **/

    double entranceSize = (7 * 100 * 100) / (cellSize * cellSize);
    double commonSize = (9 * 100 * 100) / (cellSize * cellSize);
    double wetAreaSize = (7 * 100 * 100 ) / (cellSize * cellSize);

    /*
    double kitchenSize = 7 * 100 * 100 / cellSize * cell  Size;
    double commonAreaSize = 10 * 100 * 100 / cellSize * cellSize;
    */

    Point3d pA = new Point3d(0, 0, 0);
    Point3d pB = new Point3d(10, 0, 0);
    Point3d pC = new Point3d(0, 10, 0);

    Plane p = new Plane(pA, pB, pC);

    int width = Width;
    int length = Length;
    int levelHeight = LevelHeight;
    int height = Height;
    int levelNumber = Height / LevelHeight;

    bool objectPlacementEnded = false;
    bool placementFailed = false;
    bool validZoning = false;
    int[,,] areaArray = InitializeZeroMatrice(length, width, levelNumber);
    int[,,] emptyFullArray = InitializeZeroMatrice(length, width, levelNumber);

    while( objectPlacementEnded == false || placementFailed == true  )
    {
      entranceList.Clear();
      commonList.Clear();
      wetAreaList.Clear();
      
      placementFailed = false;
      validZoning = false;

      while( validZoning == false )
      {
        areaArray = InitializeZeroMatrice(length, width, levelNumber);
        StartZones(areaArray);

        emptyFullArray = InitializeZeroMatrice(length, width, levelNumber);

        for (int i = 0; i < width * length * 3; i++)
        {
          Spread(areaArray, ref entranceSize, entranceList, ref entranceCounter, entranceLimit, cellSize);
          Spread(areaArray, ref commonSize, commonList, ref commonCounter, commonLimit, cellSize);
          Spread(areaArray, ref wetAreaSize, wetAreaList, ref wetAreaCounter, wetAreaLimit, cellSize);
        }
        NoiseFilter(areaArray, 0, 3, 5);
        NoiseFilter(areaArray, 1, 2, 2);

        for (int k = 0;k < levelNumber;k++)
        {
          for (int i = 0;i < length;i++)
          {
            for (int j = 0;j < width;j++)
            {
              areaArray[i, j, k] = areaArray[i, j, 0];
            }
          }
        }

        for (int k = 0;k < levelNumber;k++)
        {
          for (int i = 0;i < length;i++)
          {
            for (int j = 0;j < width;j++)
            {
              emptyFullArray[i, j, k] = 0;
            }
          }
        }


        for (int k = 0;k < levelNumber;k++)
        {
          for (int i = 0;i < length;i++)
          {
            for (int j = 0;j < width;j++)
            {
              if (areaArray[i, j, k] == 1)
              {
                Interval xInterval = new Interval(i * cellSize, (i + 1) * (cellSize ));
                Interval yInterval = new Interval(j * cellSize, (j + 1) * (cellSize ));
                Interval zInterval = new Interval(k * LevelHeight, k * LevelHeight + levelHeight);

                Box boxgh = new Box(p, xInterval, yInterval, zInterval);
                entranceBoxes.Add(boxgh);
                entranceList.AddRange(new int[2] { i, j });
              }
              if (areaArray[i, j, k] == 2)
              {
                Interval xInterval = new Interval(i * cellSize, (i + 1) * (cellSize ));
                Interval yInterval = new Interval(j * cellSize, (j + 1) * (cellSize ));
                Interval zInterval = new Interval(k * LevelHeight, k * LevelHeight + levelHeight);

                Box boxgh = new Box(p, xInterval, yInterval, zInterval);
                commonBoxes.Add(boxgh);
                commonList.AddRange(new int[2] { i, j });
              }
              if (areaArray[i, j, k] == 3)
              {
                Interval xInterval = new Interval(i * cellSize, (i + 1) * (cellSize ));
                Interval yInterval = new Interval(j * cellSize, (j + 1) * (cellSize ));
                Interval zInterval = new Interval(k * LevelHeight, k * LevelHeight + levelHeight);

                Box boxgh = new Box(p, xInterval, yInterval, zInterval);
                wetAreaBoxes.Add(boxgh);
                wetAreaList.AddRange(new int[2] { i, j });
              }
              if (areaArray[i, j, k] == 0)
              {

                Interval xInterval = new Interval(i * cellSize, (i + 1) * (cellSize ));
                Interval yInterval = new Interval(j * cellSize, (j + 1) * (cellSize ));
                Interval zInterval = new Interval(k * LevelHeight, k * LevelHeight + levelHeight);

                Box boxgh = new Box(p, xInterval, yInterval, zInterval);
                WhiteBoxes.Add(boxgh);
                //WhiteList.AddRange(i, j);
              }
            }
          }
        }
        if(true)
        {
          validZoning = true;
        }

      }





      ObjectsList.Clear();
      MarginsList.Clear();
      /* FURNITURE LAYOUT ==> ENTRANCE STARTED */

      Point3d pointa = new Point3d(0, 0, 0);
      Vector3d vectorb = new Vector3d(0, 0, 1);

      Plane planebase = new Plane(pointa, vectorb);

      Interval xInter = new Interval(0, 10);
      Interval yInter = new Interval(0, 10);
      Interval zInter = new Interval(0, 10);


      Box ObjBox = new Box(planebase, xInter, yInter, zInter);
      Box marginBox = new Box(planebase, xInter, yInter, zInter);



      /* ENTRANCE REFERENCE */
      var exteriorDoorO = new Objects
        {
          Name = "Exterior Door",
          ZoneName = 1,

          Obj = ExteriorDoor,
          ObjMargin = ExteriorDoorMargin,

          Front = true,
          Right = true,
          Back = true,
          Left = false,
          Top = false,
          Bottom = false,

          RotationBool = false,
          RotationOpt = 2,

          MirrorBool = false,
          MirrorOpt = 2,

          Source = "NULL",
          FixedToWall = 1,

          CellSize = 60,
          SpaceList = entranceList,

          //PreviousObject = changeOverZoneO

          };

      exteriorDoorO.AssignDimensions();

      exteriorDoorO.PlaceRefObjectEntrance(emptyFullArray, areaArray, out ObjBox, out marginBox);

      ObjectsList.Add(ObjBox);
      MarginsList.Add(marginBox);



      /* ENTRANCE 2ND OBJECT */

      var changeOverZoneO = new Objects
        {
          Name = "changeOverZone",
          ZoneName = 1,

          Obj = ChangeOverZone,
          ObjMargin = ChangeOverZoneMargin,

          Front = true,
          Right = true,
          Back = false,
          Left = true,
          Top = false,
          Bottom = false,

          RotationBool = false,
          RotationOpt = 2,

          MirrorBool = false,
          MirrorOpt = 2,

          Source = "NULL",
          FixedToWall = 1,
          CellSize = 60,

          PreviousObject = exteriorDoorO,
          SpaceList = entranceList,

          };

      changeOverZoneO.AssignDimensions();
      changeOverZoneO.PlaceObject(emptyFullArray, areaArray, out ObjBox, out marginBox, out placementFailed);

      if (placementFailed == false)
      {
        Rhino.RhinoApp.WriteLine("The Placement is unsuccessfull start again!");
        continue;
      }
      //changeOverZoneO.printDimensions();
      ObjectsList.Add(ObjBox);
      MarginsList.Add(marginBox);


      /* ENTRANCE 3RD OBJECT */
      var closetO = new Objects
        {
          Name = "closet",
          ZoneName = 1,

          Obj = Closet,
          ObjMargin = ClosetMargin,

          Front = true,
          Right = true,
          Back = false,
          Left = false,
          Top = false,
          Bottom = false,

          RotationBool = false,
          RotationOpt = 2,

          MirrorBool = false,
          MirrorOpt = 2,

          Source = "NULL",
          FixedToWall = 1,
          CellSize = 60,

          PreviousObject = changeOverZoneO,
          SpaceList = entranceList,

          };

      closetO.AssignDimensions();

      closetO.PlaceObject(emptyFullArray, areaArray, out ObjBox, out marginBox, out placementFailed);

      if (placementFailed == false)
      {
        Rhino.RhinoApp.WriteLine("The Placement is unsuccessfull start again!");
        continue;
      }
      ObjectsList.Add(ObjBox);
      MarginsList.Add(marginBox);
      ObjectsList.Add(ObjBox);
      MarginsList.Add(marginBox);


      /* ENTRANCE 4TH OBJECT */
      var interiorDoorO = new Objects
        {
          Name = "Interior Door",
          ZoneName = 1,

          Obj = InteriorDoor,
          ObjMargin = InteriorDoorMargin,

          Front = false,
          Right = false,
          Back = false,
          Left = false,
          Top = false,
          Bottom = false,

          RotationBool = false,
          RotationOpt = 2,

          MirrorBool = false,
          MirrorOpt = 2,

          Source = "NULL",
          FixedToWall = 1,
          CellSize = 60,

          PreviousObject = closetO,
          SpaceList = entranceList,

          };

      interiorDoorO.AssignDimensions();
/*
      interiorDoorO.PlaceObject(emptyFullArray, areaArray, out ObjBox, out marginBox, out placementFailed);

      if (placementFailed == false)
      {
        Rhino.RhinoApp.WriteLine("The Placement is unsuccessfull start again!");
        continue;
      }
      ObjectsList.Add(ObjBox);
      MarginsList.Add(marginBox);
*/
      /* FURNITURE LAYOUT ==> ENTRANCE ENDED */


      /* FURNITURE LAYOUT ==> COMMON STARTED */

      var counterO = new Objects
        {
          Name = "Counter",
          ZoneName = 2,

          Obj = Counter,
          ObjMargin = CounterMargin,

          Front = true,
          Right = true,
          Back = false,
          Left = false,
          Top = false,
          Bottom = false,

          RotationBool = false,
          RotationOpt = 2,

          MirrorBool = false,
          MirrorOpt = 2,

          Source = "NULL",
          FixedToWall = 1,

          CellSize = 60,
          SpaceList = commonList,


          };
      counterO.AssignDimensions();

      //counterO.placeRefObject(emptyFullArray, areaArray, out ObjBox, out marginBox);
      //ObjectsList.Add(ObjBox);
      //MarginsList.Add(marginBox);


      /* COMMONAREA 2ND OBJECT */

      var tableO = new Objects
        {
          Name = "Table",
          ZoneName = 2,

          Obj = Table,
          ObjMargin = TableMargin,

          Front = true,
          Right = true,
          Back = false,
          Left = false,
          Top = false,
          Bottom = false,

          RotationBool = false,
          RotationOpt = 2,

          MirrorBool = false,
          MirrorOpt = 2,

          Source = "NULL",
          FixedToWall = 1,
          CellSize = 60,

          PreviousObject = counterO,
          SpaceList = commonList,

          };

      tableO.AssignDimensions();

/*
    Point3d pointa = new Point3d(0, 0, 0);
    Vector3d vectorb = new Vector3d(0, 0, 1);

    Plane planebase = new Plane(pointa, vectorb);

    Interval xInter = new Interval(0, 10);
    Interval yInter = new Interval(0, 10);
    Interval zInter = new Interval(0, 10);


    Box ObjBox = new Box(planebase, xInter, yInter, zInter);
    Box marginBox = new Box(planebase, xInter, yInter, zInter);
*/

    //tableO.placeFront(emptyFullArray, areaArray, out ObjBox, out marginBox);

    //changeOverZoneO.printDimensions();
    //ObjectsList.Add(ObjBox);
    //MarginsList.Add(marginBox);


    /* COMMON 3RD OBJECT */
      var sittingUnitO = new Objects
        {
          Name = "Sitting Unit",
          ZoneName = 2,

          Obj = SittingUnit,
          ObjMargin = SittingUnitMargin,

          Front = true,
          Right = true,
          Back = false,
          Left = false,
          Top = false,
          Bottom = false,

          RotationBool = false,
          RotationOpt = 2,

          MirrorBool = false,
          MirrorOpt = 2,

          Source = "NULL",
          FixedToWall = 1,
          CellSize = 60,

          PreviousObject = tableO,
          SpaceList = commonList,

          };

      sittingUnitO.AssignDimensions();

      //sittingUnitO.placeFront(emptyFullArray, areaArray, out ObjBox, out marginBox);
      //changeOverZoneO.printDimensions();
      //ObjectsList.Add(ObjBox);
      //MarginsList.Add(marginBox);


      /* COMMON 4TH OBJECT */


      var bedO = new Objects
        {
          Name = "Bed",
          ZoneName = 2,

          Obj = Bed,
          ObjMargin = BedMargin,

          Front = true,
          Right = true,
          Back = false,
          Left = false,
          Top = false,
          Bottom = false,

          RotationBool = false,
          RotationOpt = 2,

          MirrorBool = false,
          MirrorOpt = 2,

          Source = "NULL",
          FixedToWall = 1,
          CellSize = 60,

          PreviousObject = sittingUnitO,
          SpaceList = commonList,

          };

      bedO.AssignDimensions();

      //bedO.placeFront(emptyFullArray, areaArray, out ObjBox, out marginBox);

      // ObjectsList.Add(ObjBox);
      // MarginsList.Add(marginBox);  // there is bug here Check it

      /* FURNITURE LAYOUT ==> COMMON END */

      objectPlacementEnded = true;

    }



    ShowMatrix(areaArray);

    //Bxx = boxx;
    A = areaArray;
    EntranceBoxes = entranceBoxes;
    CommonBoxes = commonBoxes;
    WetAreaBoxes = wetAreaBoxes;
    /*Y = kitchenBoxes;
    K = commonAreaBoxes;*/
    W = WhiteBoxes;
    Furnitures = ObjectsList;
    FurnituresMargins = MarginsList;
# ---------- c_script_3: C# additional code ----------
  class Objects
  {
    public string Name;
    public int ZoneName;

    public Box Obj;
    public Box ObjMargin;

    public bool Front = false;
    public bool Right = false;
    public bool Back = false;
    public bool Left = false;
    public bool Top = false;
    public bool Bottom = false;

    public bool RotationBool = true;
    public int RotationOpt; // rotation options

    public bool MirrorBool = true;
    public int MirrorOpt; // mirror options

    public string Source; // Water, Electiricity
    public int FixedToWall; // Bed, Television //1,2,3 conditions
    public int CellSize;

    public Objects PreviousObject;

    public double ObjLength ;
    public double ObjWidth ;
    public double ObjHeight ;

    public double MrjLength;
    public double MrjWidth;
    public double MrjHeight;

    public double baseX, baseY, baseZ;
    public List<int> SpaceList = new List<int>();

    public double  XCell;
    public double  YCell;
    public double  ZCell;


    //deneme
    public Objects()
    {
            /*
            var Coordinates = new List<int>();
            Point3d pA = new Point3d(0, 0, 0);
            Point3d pB = new Point3d(10, 0, 0);
            Point3d pC = new Point3d(0, 10, 0);

            Plane p = new Plane(pA, pB, pC);*/
    }

    public Objects(string name, int zoneName, bool front, bool right, bool back, bool left, bool top, bool bottom, bool rotationalBool, int rotationOpt, bool mirrorBool, int mirrorOpt, string source, int fixedTowall, int cellSize, Box obj, Box objMargin, Objects previousObject, List<int> spaceList)
      : this()
    {
      this.Obj = obj;
      this.ObjMargin = objMargin;

      this.Name = name;
      this.ZoneName = zoneName;

      this.Front = front;
      this.Right = right;
      this.Back = back;
      this.Left = left;
      this.Bottom = bottom;
      this.Top = top;

      this.RotationBool = rotationalBool;
      this.RotationOpt = rotationOpt;

      this.MirrorBool = mirrorBool;
      this.MirrorOpt = mirrorOpt;

      this.Source = source;
      this.FixedToWall = fixedTowall;
      this.CellSize = cellSize;

      this.ObjWidth = obj.X.T1;
      this.ObjLength = obj.Y.T1;
      this.ObjHeight = obj.Z.T1;

      this.MrjWidth = objMargin.X.T1;
      this.MrjLength = objMargin.Y.T1;
      this.MrjHeight = objMargin.Z.T1;

      this.baseX = Obj.Plane.OriginX;
      this.baseY = Obj.Plane.OriginY;
      this.baseZ = Obj.Plane.OriginZ;

      this.PreviousObject = previousObject;
      this.SpaceList = spaceList;
    }

    public Objects(string name, int zoneName, bool front, bool right, bool back, bool left, bool top, bool bottom, bool rotationalBool, int rotationOpt, bool mirrorBool, int mirrorOpt, string source, int fixedTowall, int cellSize, Box obj, Box objMargin, List<int> spaceList)
      : this()
    {
      this.Obj = obj;
      this.ObjMargin = objMargin;

      this.Name = name;
      this.ZoneName = zoneName;

      this.Front = front;
      this.Right = right;
      this.Back = back;
      this.Left = left;
      this.Bottom = bottom;
      this.Top = top;

      this.RotationBool = rotationalBool;
      this.RotationOpt = rotationOpt;

      this.MirrorBool = mirrorBool;
      this.MirrorOpt = mirrorOpt;

      this.Source = source;
      this.FixedToWall = fixedTowall;
      this.CellSize = cellSize;

      this.ObjWidth = obj.X.T1;
      this.ObjLength = obj.Y.T1;
      this.ObjHeight = obj.Z.T1;

      this.MrjWidth = (this.ObjMargin.X.T1);
      this.MrjLength = (this.ObjMargin.Y.T1);
      this.MrjHeight = (this.ObjMargin.Z.T1);

      this.baseX = Obj.Plane.OriginX;
      this.baseY = Obj.Plane.OriginY;
      this.baseZ = Obj.Plane.OriginZ;

      this.SpaceList = spaceList;
    }

    public void AssignDimensions()
    {
      this.ObjWidth = this.Obj.X.T1;
      this.ObjLength = this.Obj.Y.T1;
      this.ObjHeight = this.Obj.Z.T1;

      this.MrjWidth = this.ObjMargin.X.T1;
      this.MrjLength = this.ObjMargin.Y.T1;
      this.MrjHeight = this.ObjMargin.Z.T1;

    }

    public void PrintDimensions()
    {
      Rhino.RhinoApp.WriteLine("Obj Width " + this.ObjWidth.ToString());
      Rhino.RhinoApp.WriteLine("Obj Length " + this.ObjLength.ToString());
      Rhino.RhinoApp.WriteLine("Obj Height " + this.ObjHeight.ToString());

      Rhino.RhinoApp.WriteLine("Obj Width " + this.MrjWidth.ToString());
      Rhino.RhinoApp.WriteLine("Obj Length " + this.MrjLength.ToString());
      Rhino.RhinoApp.WriteLine("Obj Height " + this.MrjHeight.ToString());
    }

    public void PlaceRefObject(int [,,]emptyFullArray, int[,,]areaArray, out Box ObjBox, out Box marginBox)
    {
      this.XCell = Math.Ceiling((double) (this.MrjWidth / CellSize));
      this.YCell = Math.Ceiling((double) (this.MrjLength / CellSize));
      this.ZCell = Math.Ceiling((double) (this.MrjHeight / 150));

      bool emptyBool = true;
      bool sameZone = true;

      bool placeSuccessful = false;
      int trycount = 0;

      while (placeSuccessful == false)
      {
        var rand = new Random();
        var randomCellIndex = rand.Next(this.SpaceList.Count / 2);

        baseX = (this.SpaceList[2 * randomCellIndex]) * CellSize;
        baseY = (this.SpaceList[2 * randomCellIndex + 1]) * CellSize;
        baseZ = 0;
        baseZ = 0;

        //baseX = baseX * CellSize;
        //baseY = baseY * CellSize;

        if( (baseX + this.MrjWidth < 300) && (baseY + this.MrjLength < 600) && (baseZ + this.MrjHeight < 300) &&
          (baseX + this.MrjWidth > 0) && (baseY + this.MrjLength > 0) && (baseZ + this.MrjHeight > 0) )
        {
          for(int i = (int) (baseX / CellSize) ; i < (baseX / CellSize + (int) XCell); i++)
          {
            for(int j = (int) (baseY / CellSize); j < baseY / CellSize + (int) YCell; j++)
            {
              for(int k = (int) (baseZ / 150); k < baseZ / 150 + (int) ZCell; k++)
              {
                Rhino.RhinoApp.WriteLine("Entrance Reference Object :  " + "  i:  " + i + "  j:  " + j + "  k:  " + k);
                if (emptyFullArray[i, j, k] == 1)
                {
                  emptyBool = false;
                }
                if (areaArray[i, j, k] != this.ZoneName)
                {
                  sameZone = false;
                }
              }
            }
          }

          if (emptyBool && sameZone)
          {
            placeSuccessful = true;

            Rhino.RhinoApp.WriteLine("Reference Object conditions are successful ");
            for(int i = (int) (baseX / CellSize) ; i < (baseX / CellSize + (int) XCell); i++)
            {
              for(int j = (int) (baseY / CellSize); j < baseY / CellSize + (int) YCell; j++)
              {
                for(int k = (int) (baseZ / 150); k < baseZ / 150 + (int) ZCell; k++)
                {
                  emptyFullArray[i, j, k] = 1;
                }
              }
            }
          }
          else
          {
            Rhino.RhinoApp.WriteLine("Conditions are not satisfied ");
          }
        }

        trycount++;
        Rhino.RhinoApp.WriteLine("Try count is : " + trycount);
        if (trycount > 60 )
          Rhino.RhinoApp.WriteLine("Try count is over 60 placement is unsuccessful: ");
        placeSuccessful = true;
      }

      if( trycount < 60 && placeSuccessful )
      {
        Rhino.RhinoApp.WriteLine("baseX " + this.baseX);
        Rhino.RhinoApp.WriteLine("baseY " + this.baseY);
        Rhino.RhinoApp.WriteLine("baseZ " + this.baseZ);

        Point3d pointa = new Point3d(baseX, baseY, 0);
        Vector3d pointb = new Vector3d(0, 0, 1);

        Plane planebase = new Plane(pointa, pointb);

        Interval xInterval = new Interval(0, this.ObjWidth);
        Interval yInterval = new Interval(0, this.ObjLength);
        Interval zInterval = new Interval(0, this.ObjHeight);

        ObjBox = new Box(planebase, xInterval, yInterval, zInterval);

        xInterval = new Interval(0, this.MrjWidth);
        yInterval = new Interval(0, this.MrjLength);
        zInterval = new Interval(0, this.MrjHeight);

        marginBox = new Box(planebase, xInterval, yInterval, zInterval);

      }

      else
      {
        ObjBox = new Box();
        marginBox = new Box();
      }
    }

    public void PlaceRefObjectEntrance(int [,,]emptyFullArray, int[,,]areaArray, out Box ObjBox, out Box marginBox)
    {
      this.XCell = Math.Ceiling((double) (this.MrjWidth / CellSize));
      this.YCell = Math.Ceiling((double) (this.MrjLength / CellSize));
      this.ZCell = Math.Ceiling((double) (this.MrjHeight / 150));

      bool emptyBool = true;
      bool sameZone = true;


      bool placeSuccessful = false;
      int trycount = 0;

      while (placeSuccessful == false)
      {
        var rand = new Random();
        var randomCellIndex = rand.Next(this.SpaceList.Count / 2);

        baseX = (this.SpaceList[2 * randomCellIndex]) * CellSize;
        baseY = 0;
        baseZ = 0;

        //baseX = baseX * CellSize;
        //baseY = baseY * CellSize;

        if( (baseX + this.MrjWidth < 300) && (baseY + this.MrjLength < 600) && (baseZ + this.MrjHeight < 300) &&
          (baseX + this.MrjWidth > 0) && (baseY + this.MrjLength > 0) && (baseZ + this.MrjHeight > 0) )
        {
          for(int i = (int) (baseX / CellSize) ; i < (baseX / CellSize + (int) XCell); i++)
          {
            for(int j = (int) (baseY / CellSize); j < baseY / CellSize + (int) YCell; j++)
            {
              for(int k = (int) (baseZ / 150); k < baseZ / 150 + (int) ZCell; k++)
              {
                Rhino.RhinoApp.WriteLine("Entrance Reference Object :  " + "  i:  " + i + "  j:  " + j + "  k:  " + k);
                if (emptyFullArray[i, j, k] == 1)
                {
                  emptyBool = false;
                }
                if (areaArray[i, j, k] != this.ZoneName)
                {
                  sameZone = false;
                }
              }
            }
          }

          if (emptyBool && sameZone)
          {
            placeSuccessful = true;

            Rhino.RhinoApp.WriteLine("Reference Object conditions are successful ");
            for(int i = (int) (baseX / CellSize) ; i < (baseX / CellSize + (int) XCell); i++)
            {
              for(int j = (int) (baseY / CellSize); j < baseY / CellSize + (int) YCell; j++)
              {
                for(int k = (int) (baseZ / 150); k < baseZ / 150 + (int) ZCell; k++)
                {
                  emptyFullArray[i, j, k] = 1;
                }
              }
            }
          }
          else
          {
            Rhino.RhinoApp.WriteLine("Conditions are not satisfied ");
          }
        }

        trycount++;
        Rhino.RhinoApp.WriteLine("Try count is : " + trycount);
        if (trycount > 60 )
          Rhino.RhinoApp.WriteLine("Try count is over 60 placement is unsuccessful: ");
        placeSuccessful = true;
      }

      if( trycount < 60 && placeSuccessful )
      {
        Rhino.RhinoApp.WriteLine("baseX " + this.baseX);
        Rhino.RhinoApp.WriteLine("baseY " + this.baseY);
        Rhino.RhinoApp.WriteLine("baseZ " + this.baseZ);

        Point3d pointa = new Point3d(baseX, 0, 0);
        Vector3d pointb = new Vector3d(0, 0, 1);

        Plane planebase = new Plane(pointa, pointb);

        Interval xInterval = new Interval(0, this.ObjWidth);
        Interval yInterval = new Interval(0, this.ObjLength);
        Interval zInterval = new Interval(0, this.ObjHeight);

        ObjBox = new Box(planebase, xInterval, yInterval, zInterval);

        xInterval = new Interval(0, this.MrjWidth);
        yInterval = new Interval(0, this.MrjLength);
        zInterval = new Interval(0, this.MrjHeight);

        marginBox = new Box(planebase, xInterval, yInterval, zInterval);

      }


      else
      {
        ObjBox = new Box();
        marginBox = new Box();
      }

    }

    public void PlaceObject(int[,,] emptyFullArray, int[,,] areaArray, out Box ObjBox, out Box marginBox, out bool placementFailed)
    {

      Point3d pointa = new Point3d(baseX, baseY, baseZ);
      Vector3d pointb = new Vector3d(0, 0, 1);

      Plane planebase = new Plane(pointa, pointb);

      Interval xInterval = new Interval(0, ObjWidth);
      Interval yInterval = new Interval(0, this.ObjLength);
      Interval zInterval = new Interval(0, this.ObjHeight);

      ObjBox = new Box(planebase, xInterval, yInterval, zInterval);

      xInterval = new Interval(0, this.MrjWidth);
      yInterval = new Interval(0, this.MrjLength);
      zInterval = new Interval(0, this.MrjHeight);

      marginBox = new Box(planebase, xInterval, yInterval, zInterval);

      List<int> growDirection = new List<int>();

      if (PreviousObject.Front == true)
        growDirection.Add(1); // Front Direction
      if (PreviousObject.Right == true)
        growDirection.Add(2); // Right Direction
      if (PreviousObject.Back == true)
        growDirection.Add(3); // Back Direction
      if (PreviousObject.Left == true)
        growDirection.Add(4); // Left Direction
      if (PreviousObject.Bottom == true)
        growDirection.Add(5); // Bottom Direction
      if (PreviousObject.Top == true)
        growDirection.Add(6); // Right Direction

      bool placeSuccess = false;
      int counter = 0;

      Random randm = new Random();
      Rhino.RhinoApp.WriteLine("Element Number of the grow Direction before while loop " + growDirection.Count.ToString());
      while (growDirection.Count > 0 && placeSuccess == false && counter < 6)
      {
        Rhino.RhinoApp.WriteLine("Counter number in the checkFront Loop " + counter.ToString());

        int a = randm.Next(0, growDirection.Count);
        int randomMethod = growDirection[a];

        Rhino.RhinoApp.WriteLine("Element Number of the grow Direction in while loop " + growDirection.Count.ToString());

        switch (a)
        {
          case 1:
            if (CheckFront(emptyFullArray, areaArray))
            {
              this.PlaceFront(emptyFullArray, out ObjBox, out marginBox);
              placeSuccess = true;

            }
            else
            {
              growDirection.Remove(a);
              Rhino.RhinoApp.WriteLine("Element Number of the grow Direction after removal " + growDirection.Count.ToString());

            }
            counter++;
            break;

          case 2:
            if (CheckRight(emptyFullArray, areaArray))
            {
              this.PlaceRight(emptyFullArray, out ObjBox, out marginBox);
              placeSuccess = true;
            }
            else
            {
              growDirection.Remove(a);
              Rhino.RhinoApp.WriteLine("Element Number of the grow Direction after removal " + growDirection.Count.ToString());
            }
            counter++;
            break;

          case 3:
            if (CheckBack(emptyFullArray, areaArray))
            {
              this.PlaceBack(emptyFullArray, out ObjBox, out marginBox);
              placeSuccess = true;

            }
            else
            {
              growDirection.Remove(a);
              Rhino.RhinoApp.WriteLine("Element Number of the grow Direction after removal " + growDirection.Count.ToString());

            }
            counter++;
            break;

          case 4:
            if (CheckLeft(emptyFullArray, areaArray))
            {
              this.PlaceLeft(emptyFullArray, out ObjBox, out marginBox);
              placeSuccess = true;
            }
            else
            {
              growDirection.Remove(a);
              Rhino.RhinoApp.WriteLine("Element Number of the grow Direction after removal " + growDirection.Count.ToString());
            }
            counter++;
            break;

          case 5:
            if (CheckTop(emptyFullArray, areaArray))
            {
              this.PlaceTop(emptyFullArray, out ObjBox, out marginBox);
              placeSuccess = true;
            }
            else
            {
              growDirection.Remove(a);
              Rhino.RhinoApp.WriteLine("Element Number of the grow Direction after removal " + growDirection.Count.ToString());
            }
            counter++;
            break;

          case 6:
            if (CheckBottom(emptyFullArray, areaArray))
            {
              this.PlaceBottom(emptyFullArray, out ObjBox, out marginBox);
              placeSuccess = true;

            }
            else
            {
              growDirection.Remove(a);
              Rhino.RhinoApp.WriteLine("Element Number of the grow Direction after removal " + growDirection.Count.ToString());
            }
            counter++;
            break;

          default:
            counter++;
            break;
        }
      }

      if (placeSuccess == false)
      {
        Rhino.RhinoApp.WriteLine("Placement Insuccessfull ");

      }

      placementFailed = placeSuccess;


    }



    public bool CheckFront(int[,,] emptyFullArray, int[,,] areaArray)

    {
      bool inLimits = true;
      bool emptyBool = true;
      bool sameZone = true;


      bool suitableDirection = true;

      this.XCell = Math.Ceiling((double) (this.MrjWidth / CellSize));
      this.YCell = Math.Ceiling((double) (this.MrjLength / CellSize));
      this.ZCell = Math.Ceiling((double) (this.MrjHeight / 150));

      this.baseX = PreviousObject.baseX;
      this.baseY = PreviousObject.baseY + CellSize * PreviousObject.YCell;
      this.baseZ = PreviousObject.baseZ;

      if (!((baseX + this.MrjWidth < 360) && (baseY + this.MrjLength < 600) && (baseZ + this.MrjHeight < 300) &&
        (baseX + this.MrjWidth > 0) && (baseY + this.MrjLength > 0) && (baseZ + this.MrjHeight > 0)))
      {
        inLimits = false;
      }

      if (inLimits)
      {
        for (int i = (int) (baseX / CellSize); i < (baseX / CellSize + (int) XCell); i++)
        {
          for (int j = (int) (baseY / CellSize); j < baseY / CellSize + (int) YCell; j++)
          {
            for (int k = (int) (baseZ / 150); k < baseZ / 150 + (int) ZCell; k++)
            {
              Rhino.RhinoApp.WriteLine("i:  " + i + "  j:  " + j + "  k:  " + k);

              if (emptyFullArray[i, j, k] == 1)
              {
                emptyBool = false;
              }

              if (areaArray[i, j, k] != this.ZoneName)
              {
                sameZone = false;
              }
            }
          }
        }

        if (emptyBool && sameZone)
        {
          suitableDirection = true;
          Rhino.RhinoApp.WriteLine("Place Front:  Conditions are  satisfied ");
        }
        else
        {
          Rhino.RhinoApp.WriteLine("Place Front:  Conditions are not satisfied ");
          suitableDirection = false;
        }
      }
      else
      {
        Rhino.RhinoApp.WriteLine("Place Front:  Conditions are not satisfied ");
        suitableDirection = false;
      }
      return suitableDirection;
    }

    public void PlaceFront(int[,,] emptyFullArray, out Box ObjBox, out Box marginBox)
    {

      for (int i = (int) (baseX / CellSize); i < (baseX / CellSize + (int) XCell); i++)
      {
        for (int j = (int) (baseY / CellSize); j < baseY / CellSize + (int) YCell; j++)
        {
          for (int k = (int) (baseZ / 150); k < baseZ / 150 + (int) ZCell; k++)
          {
            emptyFullArray[i, j, k] = 1;
          }
        }
      }

      Point3d pointa = new Point3d(baseX, baseY, baseZ);
      Vector3d pointb = new Vector3d(0, 0, 1);

      Plane planebase = new Plane(pointa, pointb);

      Interval xInterval = new Interval(0, this.ObjWidth);
      Interval yInterval = new Interval(0, this.ObjLength);
      Interval zInterval = new Interval(0, this.ObjHeight);

      ObjBox = new Box(planebase, xInterval, yInterval, zInterval);

      xInterval = new Interval(0, this.MrjWidth);
      yInterval = new Interval(0, this.MrjLength);
      zInterval = new Interval(0, this.MrjHeight);

      marginBox = new Box(planebase, xInterval, yInterval, zInterval);
    }



    public bool CheckRight(int[,,] emptyFullArray, int[,,] areaArray)

    {
      bool inLimits = true;
      bool emptyBool = true;
      bool sameZone = true;
      bool suitableDirection = true;

      this.XCell = Math.Ceiling((double) (this.MrjWidth / CellSize));
      this.YCell = Math.Ceiling((double) (this.MrjLength / CellSize));
      this.ZCell = Math.Ceiling((double) (this.MrjHeight / 150));

      this.baseX = PreviousObject.baseX;
      this.baseY = PreviousObject.baseY + CellSize * PreviousObject.YCell;
      this.baseZ = PreviousObject.baseZ;


      if (!((baseX + this.ObjWidth < 300) && (baseY + this.ObjLength < 600) && (baseZ + this.ObjHeight < 300) &&
        (baseX + this.ObjWidth > 0) && (baseY + this.ObjLength > 0) && (baseZ + this.ObjHeight > 0)))
      {
        inLimits = false;
      }

      if (inLimits)
      {
        for (int i = (int) (baseX / CellSize); i < (baseX / CellSize + (int) XCell); i++)
        {
          for (int j = (int) (baseY / CellSize); j < baseY / CellSize + (int) YCell; j++)
          {
            for (int k = (int) (baseZ / 150); k < baseZ / 150 + (int) ZCell; k++)
            {
              if (emptyFullArray[i, j, k] == 1)
              {
                emptyBool = false;
              }
              if (areaArray[i, j, k] != this.ZoneName)
              {
                sameZone = false;
              }
            }
          }
        }

        if (emptyBool && sameZone)
        {
          suitableDirection = true;
          Rhino.RhinoApp.WriteLine("Place Right:  Conditions are  satisfied ");
        }
        else
        {
          Rhino.RhinoApp.WriteLine("Place Right:  Conditions are not satisfied ");
          suitableDirection = false;
        }
      }
      else
      {
        Rhino.RhinoApp.WriteLine("Place Right:  Conditions are not satisfied ");
        suitableDirection = false;
      }
      return suitableDirection;
    }



    public void PlaceRight(int[,,] emptyFullArray, out Box ObjBox, out Box marginBox)
    {
      for (int i = (int) (baseX / CellSize); i < (baseX / CellSize + (int) XCell); i++)
      {
        for (int j = (int) (baseY / CellSize); j < baseY / CellSize + (int) YCell; j++)
        {
          for (int k = (int) (baseZ / 150); k < baseZ / 150 + (int) ZCell; k++)
          {
            emptyFullArray[i, j, k] = 1;
          }
        }
      }

      Point3d pointa = new Point3d(baseX, baseY, baseZ);
      Vector3d pointb = new Vector3d(0, 0, 1);

      Plane planebase = new Plane(pointa, pointb);

      Interval xInterval = new Interval(0, this.ObjWidth);
      Interval yInterval = new Interval(0, this.ObjLength);
      Interval zInterval = new Interval(0, this.ObjHeight);

      ObjBox = new Box(planebase, xInterval, yInterval, zInterval);

      xInterval = new Interval(0, this.MrjWidth);
      yInterval = new Interval(0, this.MrjLength);
      zInterval = new Interval(0, this.MrjHeight);

      marginBox = new Box(planebase, xInterval, yInterval, zInterval);
    }


    public bool CheckBack(int[,,] emptyFullArray, int[,,] areaArray)

    {
      bool inLimits = true;
      bool emptyBool = true;
      bool sameZone = true;


      bool suitableDirection = true;


      this.XCell = Math.Ceiling((double) (this.MrjWidth / CellSize));
      this.YCell = Math.Ceiling((double) (this.MrjLength / CellSize));
      this.ZCell = Math.Ceiling((double) (this.MrjHeight / 150));

      this.baseX = PreviousObject.baseX;
      this.baseY = PreviousObject.baseY - CellSize * this.YCell;
      this.baseZ = PreviousObject.baseZ;

      if (!((baseX + this.ObjWidth < 300) && (baseY + this.ObjLength < 600) && (baseZ + this.ObjHeight < 300) &&
        (baseX + this.ObjWidth > 0) && (baseY + this.ObjLength > 0) && (baseZ + this.ObjHeight > 0)))
      {
        inLimits = false;
      }

      if (inLimits)
      {
        for (int i = (int) (baseX / CellSize); i < (baseX / CellSize + (int) XCell); i++)
        {
          for (int j = (int) (baseY / CellSize); j < baseY / CellSize + (int) YCell; j++)
          {
            for (int k = (int) (baseZ / 150); k < baseZ / 150 + (int) ZCell; k++)
            {
              if (emptyFullArray[i, j, k] == 1)
              {
                emptyBool = false;
              }
              if (areaArray[i, j, k] != this.ZoneName)
              {
                sameZone = false;
              }
            }
          }
        }

        if (emptyBool && sameZone)
        {
          suitableDirection = true;
          Rhino.RhinoApp.WriteLine("Place Back:  Conditions are  satisfied ");
        }
        else
        {
          Rhino.RhinoApp.WriteLine("Place Back:  Conditions are not satisfied ");
          suitableDirection = false;
        }
      }
      else
      {
        Rhino.RhinoApp.WriteLine("Place Back:  Conditions are not satisfied ");
        suitableDirection = false;
      }
      return suitableDirection;
    }




    public void PlaceBack(int[,,] emptyFullArray, out Box ObjBox, out Box marginBox)
    {

      Rhino.RhinoApp.WriteLine("Place Back: Conditions are successful ");
      for (int i = (int) (baseX / CellSize); i < (baseX / CellSize + (int) XCell); i++)
      {
        for (int j = (int) (baseY / CellSize); j < baseY / CellSize + (int) YCell; j++)
        {
          for (int k = (int) (baseZ / 150); k < baseZ / 150 + (int) ZCell; k++)
          {
            emptyFullArray[i, j, k] = 1;
          }
        }
      }

      Point3d pointa = new Point3d(baseX, baseY, baseZ);
      Vector3d pointb = new Vector3d(0, 0, 1);

      Plane planebase = new Plane(pointa, pointb);

      Interval xInterval = new Interval(0, this.ObjWidth);
      Interval yInterval = new Interval(0, this.ObjLength);
      Interval zInterval = new Interval(0, this.ObjHeight);

      ObjBox = new Box(planebase, xInterval, yInterval, zInterval);

      xInterval = new Interval(0, this.MrjWidth);
      yInterval = new Interval(0, this.MrjLength);
      zInterval = new Interval(0, this.MrjHeight);

      marginBox = new Box(planebase, xInterval, yInterval, zInterval);
    }

    public bool CheckLeft(int[,,] emptyFullArray, int[,,] areaArray)

    {
      bool inLimits = true;
      bool emptyBool = true;
      bool sameZone = true;
      bool suitableDirection = true;

      this.XCell = Math.Ceiling((double) (this.MrjWidth / CellSize));
      this.YCell = Math.Ceiling((double) (this.MrjLength / CellSize));
      this.ZCell = Math.Ceiling((double) (this.MrjHeight / 150));

      this.baseX = PreviousObject.baseX - CellSize * this.XCell;
      this.baseY = PreviousObject.baseY;
      this.baseZ = PreviousObject.baseZ;

      if (!((baseX + this.ObjWidth < 300) && (baseY + this.ObjLength < 600) && (baseZ + this.ObjHeight < 300) &&
        (baseX + this.ObjWidth > 0) && (baseY + this.ObjLength > 0) && (baseZ + this.ObjHeight > 0)))
      {
        inLimits = false;
      }

      if (inLimits)
      {
        for (int i = (int) (baseX / CellSize); i < (baseX / CellSize + (int) XCell); i++)
        {
          for (int j = (int) (baseY / CellSize); j < baseY / CellSize + (int) YCell; j++)
          {
            for (int k = (int) (baseZ / 150); k < baseZ / 150 + (int) ZCell; k++)
            {
              Rhino.RhinoApp.WriteLine("i:  " + i + "  j:  " + j + "  k:  " + k);

              if (emptyFullArray[i, j, k] == 1)
              {
                emptyBool = false;
              }
              if (areaArray[i, j, k] != this.ZoneName)
              {
                sameZone = false;
              }
            }
          }
        }

        if (emptyBool && sameZone)
        {
          suitableDirection = true;
          Rhino.RhinoApp.WriteLine("Place Left:  Conditions are  satisfied ");
        }
        else
        {
          Rhino.RhinoApp.WriteLine("Place Left:  Conditions are not satisfied ");
          suitableDirection = false;
        }
      }
      else
      {
        Rhino.RhinoApp.WriteLine("Place Left:  Conditions are not satisfied ");
        suitableDirection = false;
      }
      return suitableDirection;
    }


    public void PlaceLeft(int[,,] emptyFullArray, out Box ObjBox, out Box marginBox)
    {
      for (int i = (int) (baseX / CellSize); i < (baseX / CellSize + (int) XCell); i++)
      {
        for (int j = (int) (baseY / CellSize); j < baseY / CellSize + (int) YCell; j++)
        {
          for (int k = (int) (baseZ / 150); k < baseZ / 150 + (int) ZCell; k++)
          {
            emptyFullArray[i, j, k] = 1;
          }
        }
      }

      Point3d pointa = new Point3d(baseX, baseY, baseZ);
      Vector3d pointb = new Vector3d(0, 0, 1);

      Plane planebase = new Plane(pointa, pointb);

      Interval xInterval = new Interval(0, this.ObjWidth);
      Interval yInterval = new Interval(0, this.ObjLength);
      Interval zInterval = new Interval(0, this.ObjHeight);

      ObjBox = new Box(planebase, xInterval, yInterval, zInterval);

      xInterval = new Interval(0, this.MrjWidth);
      yInterval = new Interval(0, this.MrjLength);
      zInterval = new Interval(0, this.MrjHeight);

      marginBox = new Box(planebase, xInterval, yInterval, zInterval);
    }

    public bool CheckTop(int[,,] emptyFullArray, int[,,] areaArray)
    {
      bool inLimits = true;
      bool emptyBool = true;
      bool sameZone = true;

      bool suitableDirection = true;

      this.XCell = Math.Ceiling((double) (MrjWidth / CellSize));
      this.YCell = Math.Ceiling((double) (this.MrjLength / CellSize));
      this.ZCell = Math.Ceiling((double) (this.MrjHeight / 150));

      this.baseX = PreviousObject.baseX;
      this.baseY = PreviousObject.baseY;
      this.baseZ = PreviousObject.baseZ + CellSize * PreviousObject.ZCell;

      if (!((baseX + this.ObjWidth < 360) && (baseY + this.ObjLength < 600) && (baseZ + this.ObjHeight < 300) &&
        (baseX + this.ObjWidth > 0) && (baseY + this.ObjLength > 0) && (baseZ + this.ObjHeight > 0)))
      {
        inLimits = false;
      }

      if (inLimits)
      {
        for (int i = (int) (baseX / CellSize); i < (baseX / CellSize + (int) XCell); i++)
        {
          for (int j = (int) (baseY / CellSize); j < baseY / CellSize + (int) YCell; j++)
          {
            for (int k = (int) (baseZ / 150); k < baseZ / 150 + (int) ZCell; k++)
            {
              Rhino.RhinoApp.WriteLine("i:  " + i + "  j:  " + j + "  k:  " + k);

              if (emptyFullArray[i, j, k] == 1)
              {
                emptyBool = false;
              }

              if (areaArray[i, j, k] != this.ZoneName)
              {
                sameZone = false;
              }
            }
          }
        }

        if (emptyBool && sameZone)
        {
          suitableDirection = true;
          Rhino.RhinoApp.WriteLine("Place Top:  Conditions are  satisfied ");
        }
        else
        {
          Rhino.RhinoApp.WriteLine("Place Top:  Conditions are not satisfied ");
          suitableDirection = false;
        }
      }
      else
      {
        Rhino.RhinoApp.WriteLine("Place Top:  Conditions are not satisfied ");
        suitableDirection = false;
      }
      return suitableDirection;
    }

    public void PlaceTop(int[,,] emptyFullArray, out Box ObjBox, out Box marginBox)
    {

      for (int i = (int) (baseX / CellSize); i < (baseX / CellSize + (int) XCell); i++)
      {
        for (int j = (int) (baseY / CellSize); j < baseY / CellSize + (int) YCell; j++)
        {
          for (int k = (int) (baseZ / 150); k < baseZ / 150 + (int) ZCell; k++)
          {
            emptyFullArray[i, j, k] = 1;
          }
        }
      }

      Point3d pointa = new Point3d(baseX, baseY, baseZ);
      Vector3d pointb = new Vector3d(0, 0, 1);

      Plane planebase = new Plane(pointa, pointb);

      Interval xInterval = new Interval(0, this.ObjWidth);
      Interval yInterval = new Interval(0, this.ObjLength);
      Interval zInterval = new Interval(0, this.ObjHeight);

      ObjBox = new Box(planebase, xInterval, yInterval, zInterval);

      xInterval = new Interval(0, this.MrjWidth);
      yInterval = new Interval(0, this.MrjLength);
      zInterval = new Interval(0, this.MrjHeight);

      marginBox = new Box(planebase, xInterval, yInterval, zInterval);
    }

    public bool CheckBottom(int[,,] emptyFullArray, int[,,] areaArray)
    {
      bool inLimits = true;
      bool emptyBool = true;
      bool sameZone = true;

      bool suitableDirection = true;

      this.XCell = Math.Ceiling((double) (this.MrjWidth / CellSize));
      this.YCell = Math.Ceiling((double) (this.MrjLength / CellSize));
      this.ZCell = Math.Ceiling((double) (this.MrjHeight / 150));

      this.baseX = PreviousObject.baseX;
      this.baseY = PreviousObject.baseY;
      this.baseZ = PreviousObject.baseZ - CellSize * this.ZCell;

      if (!((baseX + this.ObjWidth < 360) && (baseY + this.ObjLength < 600) && (baseZ + this.ObjHeight < 300) &&
        (baseX + this.ObjWidth > 0) && (baseY + this.ObjLength > 0) && (baseZ + this.ObjHeight > 0)))
      {
        inLimits = false;
      }

      if (inLimits)
      {
        for (int i = (int) (baseX / CellSize); i < (baseX / CellSize + (int) XCell); i++)
        {
          for (int j = (int) (baseY / CellSize); j < baseY / CellSize + (int) YCell; j++)
          {
            for (int k = (int) (baseZ / 150); k < baseZ / 150 + (int) ZCell; k++)
            {
              Rhino.RhinoApp.WriteLine("i:  " + i + "  j:  " + j + "  k:  " + k);

              if (emptyFullArray[i, j, k] == 1)
              {
                emptyBool = false;
              }
              if (areaArray[i, j, k] != this.ZoneName)
              {
                sameZone = false;
              }
            }
          }
        }

        if (emptyBool && sameZone)
        {
          suitableDirection = true;
          Rhino.RhinoApp.WriteLine("Place Bottom:  Conditions are  satisfied ");
        }
        else
        {
          Rhino.RhinoApp.WriteLine("Place Bottom:  Conditions are not satisfied ");
          suitableDirection = false;
        }
      }
      else
      {
        Rhino.RhinoApp.WriteLine("Place Bottom:  Conditions are not satisfied ");
        suitableDirection = false;
      }
      return suitableDirection;
    }

    public void PlaceBottom(int[,,] emptyFullArray, out Box ObjBox, out Box marginBox)
    {
      for (int i = (int) (baseX / CellSize); i < (baseX / CellSize + (int) XCell); i++)
      {
        for (int j = (int) (baseY / CellSize); j < baseY / CellSize + (int) YCell; j++)
        {
          for (int k = (int) (baseZ / 150); k < baseZ / 150 + (int) ZCell; k++)
          {
            emptyFullArray[i, j, k] = 1;
          }
        }
      }

      Point3d pointa = new Point3d(baseX, baseY, baseZ);
      Vector3d pointb = new Vector3d(0, 0, 1);

      Plane planebase = new Plane(pointa, pointb);

      Interval xInterval = new Interval(0, this.ObjWidth);
      Interval yInterval = new Interval(0, this.ObjLength);
      Interval zInterval = new Interval(0, this.ObjHeight);

      ObjBox = new Box(planebase, xInterval, yInterval, zInterval);

      xInterval = new Interval(0, this.MrjWidth);
      yInterval = new Interval(0, this.MrjLength);
      zInterval = new Interval(0, this.MrjHeight);

      marginBox = new Box(planebase, xInterval, yInterval, zInterval);
    }

    public void Rotate()
    {

    }

    static void Mirror()
    {
    }

    static void CreateWall()
    {

    }
  }

  static void ShowMatrix(int[,,] Arr)
  {
    for (int i = 0; i < Arr.GetLength(0); i++)
    {
      for (int j = 0; j < Arr.GetLength(1); j++)
      {
        Rhino.RhinoApp.Write(Arr[i, j, 0] + " ");
      }
      Rhino.RhinoApp.WriteLine("Loop Runs" + i.ToString());
    }
    return;
  }

  static int[,,] InitializeZeroMatrice(int width, int length, int levelNumber)
  {
    var areaArray = new int[width, length, levelNumber];

    for (int k = 0; k < levelNumber; k++)
    {
      for (int i = 0; i < width; i++)
      {
        for (int j = 0; j < length; j++)
        {
          areaArray[i, j, k] = 0;
        }
      }
    }
    return areaArray;
  }

  /* The Color lists keep the colors in a seperate List in order to choose within them easily instead of searching where they are... */
  static readonly List<int> entranceList = new List<int>();
  static readonly List<int> commonList = new List<int>();
  static readonly List<int> wetAreaList = new List<int>();
 /* static List<int> kitchenList = new List<int>();
  static List<int> commonAreaList = new List<int>();*/

  /**           these counters are used for starting the límitations counts.         **/

  static int entranceCounter = 1;
  static int commonCounter = 1;
  static int wetAreaCounter = 1;
  /*static int kitchenCounter = 1;
  static int commonAreaCounter = 1;*/
  /**           these limits are used for defining max distance that zone can spread.  **/

  static readonly int entranceLimit = 250;
  static readonly int commonLimit = 400;
  static readonly int wetAreaLimit = 300;
  /*static int kitchenLimit = 200;
  static int commonAreaLimit = 100;*/

  static void StartZones(int[,,] arr)
  {
    /**
     * Randomly Starts the color. Takes the Color lists as argumnts
     * (We can delete these argumnents and it can get them as local referance
     * in our case it gives us a chance to choose what to initilize)
     * **/

    Random rand = new Random();
    //----------------------
    /* GetLength(0) and GetLength(1) might be set as variable */
    //Array.GetLength(0) gives the column lenght in other words length of an array
    //Array.GetLength(1) gives the row lenght in other words width of an array
    var a = rand.Next(arr.GetLength(0) / 2, arr.GetLength(0) / 2);
    var b = rand.Next(0, 2);

    Rhino.RhinoApp.WriteLine("Zones started");
    entranceList.AddRange(new int[2] { a, b }); //AddRange ==> Adds multiple elements to a List . We use mod%2 to call the index of the point back instead of stacking them as an another List(or Array) in our list.
    arr[a, b, 0] = 1;// entrance Starting Point
    //----------------------

    b = rand.Next(0, arr.GetLength(1));
    a = rand.Next(0, arr.GetLength(0));

    commonList.AddRange(new int[2] { a, b });
    arr[a, b, 0] = 2; // common Starting Point
    //----------------------
    a = rand.Next(0, arr.GetLength(0));
    b = rand.Next(0, arr.GetLength(1));

    wetAreaList.AddRange(new int[2] { a, b });
    arr[a, b, 0] = 3; // wetArea Starting Point
    //----------------------
    a = rand.Next(0, arr.GetLength(0));
    b = rand.Next(0, arr.GetLength(1));
/*
    kitchenList.AddRange(new int[2] { a, b });
    arr[a, b, 0] = 4; // kitchen Starting Point
    //----------------------
    a = rand.Next(0, arr.GetLength(0));
    b = rand.Next(0, arr.GetLength(1));

    commonAreaList.AddRange(new int[2] { a, b });
    arr[a, b, 0] = 5; // commonArea Starting Point
    //----------------------
  */
  }
    /* Calculates the distance between initial point in the color and the possible new point!
     *  (if the possible new point is too far from inital point eleminate it.) */
  static double DistanceCalculate(List<int> spaceCoordList, int x2, int y2, int cellSize)
  {
    var distance = cellSize * Math.Sqrt((y2 - spaceCoordList[1]) * (y2 - spaceCoordList[1]) + (x2 - spaceCoordList[0]) * (x2 - spaceCoordList[0]));
    return distance;
  }

  static void Evaluate()
  {
    // according to relations give score to the created zones
    // get the centers of the zones and acoording to the distances and created sizes give
    //positive or negative points and if score is not acceptable re-run and create variatians.
  }


  static void NoiseFilter (int [,,] arr, int type, int iterationNumber, int controlNumber)
  {
    if(type == 0)
    {
      for( int loop = 0 ; loop < iterationNumber ; loop++ )
      {
        List < int> surrounding = new List<int>();
        for(int i = 1 ; i < arr.GetLength(0) - 1 ;i++)
        {
          for(int j = 1 ; j < arr.GetLength(1) - 1 ;j++)
          {
            for(int x = -1 ; x < 2;x++)
            {
              for(int y = -1 ; y < 2;y++)
              {
                if(!(x == y && x == 0))
                {

                  surrounding.Add(arr[i + x, j + y, 0]);
                }
              }
            }
            for (int v = 0 ; v < 6 ;v++) // 6 is the number of the zones including  empty cells
            {
              int count = (from z in surrounding where z == v select z).Count();
              if ( count >= controlNumber )
              {
                arr[i, j, 0] = v;
              }
            }
            surrounding.Clear();
            surrounding.TrimExcess();
          }
        }
      }
    }

    if(type == 1)
    {
      for( int loop = 0 ; loop < iterationNumber ; loop++ )
      {
        List < int> surrounding = new List<int>();
        for(int i = 1 ; i < arr.GetLength(0) - 1 ;i++)
        {
          for(int j = 1 ; j < arr.GetLength(1) - 1 ;j++)
          {
            for(int x = -1 ; x < 2;x++)
            {
              for(int y = -1 ; y < 2;y++)
              {
                if(!(x == y && x == 0) && ( (x + y == 1 ) || (x + y == -1 )) )
                {
                  surrounding.Add(arr[i + x, j + y, 0]);
                }
              }
            }

            for (int v = 0 ; v < 6 ;v++) // 6 is the number of the zones including  empty cells
            {
              int count = (from z in surrounding where z == v select z).Count();
              if ( count >= 2 )
              {
                arr[i, j, 0] = v;
              }
            }
            surrounding.Clear();
            surrounding.TrimExcess();
          }
        }
      }
    }
  }

  static void Spread(int[,,] arr, ref double spaceSize, List<int> spaceCoordList, ref int counter, int spaceLimit, int cellSize)
  {
        /*ARGUMENTS
     * The main array which has rectangular form(will be 3d in short) ,
     * spaceSize = Maximum limit that can grow.  ,
     * spaceCoordList =  the cells of the zone which has been already defined. )
     */
    var rand = new Random();
    var directionList = new List<int>();
    int Xcoord;
    int Ycoord;
    bool draw = false;
    int trycount = 0;

    while (draw == false && counter <= spaceSize)
    {
      if (counter <= spaceSize ) //Can be deleted. The condition is added to the While Loop Conditions.
      {
        var randomCellIndex = rand.Next(spaceCoordList.Count / 2);

        Xcoord = spaceCoordList[2 * randomCellIndex];
        Ycoord = spaceCoordList[2 * randomCellIndex + 1];

        if (Xcoord < arr.GetLength(0) - 1 && Xcoord > 0 && Ycoord > 0 && Ycoord < arr.GetLength(1) - 1)
        {
          /* Check the conditions INSIDE borders */
          if (arr[Xcoord + 1, Ycoord, 0] == 0 && DistanceCalculate(spaceCoordList, Xcoord + 1, Ycoord, cellSize) < spaceLimit ) // Check if possible new cell is still white or not!
            directionList.AddRange(new int[2] { (Xcoord + 1), Ycoord }); //Store possible spread directions in a list.

          if (arr[Xcoord - 1, Ycoord, 0] == 0 && DistanceCalculate(spaceCoordList, Xcoord - 1, Ycoord, cellSize) < spaceLimit)
            directionList.AddRange(new int[2] { (Xcoord - 1), Ycoord }); //Store possible spread directions in a list.

          if (arr[Xcoord, Ycoord + 1, 0] == 0 && DistanceCalculate(spaceCoordList, Xcoord, Ycoord + 1, cellSize) < spaceLimit)
            directionList.AddRange(new int[2] { (Xcoord), Ycoord + 1 }); //Store possible spread directions in a list.

          if (arr[Xcoord, Ycoord - 1, 0] == 0 && DistanceCalculate(spaceCoordList, Xcoord, Ycoord - 1, cellSize) < spaceLimit)
            directionList.AddRange(new int[2] { (Xcoord), (Ycoord - 1) }); //Store possible spread directions in a list.

          if (directionList.Count > 0)
          {
            var randomIndex = rand.Next(directionList.Count / 2);
            int a = directionList[2 * randomIndex];
            int b = directionList[2 * randomIndex + 1];

            arr[a, b, 0] = arr[Xcoord, Ycoord, 0];

            spaceCoordList.AddRange(new int[2] { a, b });

            directionList.Clear();
            directionList.TrimExcess();
            draw = true;
            counter++;
          }
          else
          {
            trycount++;
            if (trycount >= spaceCoordList.Count)
            {
              draw = true;
              //Print("trycountNumber is ={0}", trycount);
            }
          }
        }

          /* EDGE CONDITIONS */
          //RIGHT
        else if (Xcoord == (arr.GetLength(0) - 1) && Ycoord != 0 && Ycoord != (arr.GetLength(1) - 1))
        {
          if (arr[Xcoord - 1, Ycoord, 0] == 0 && DistanceCalculate(spaceCoordList, Xcoord - 1, Ycoord, cellSize) < spaceLimit )
            directionList.AddRange(new int[2] { (Xcoord - 1), (Ycoord) }); //Store possible spread directions in a list.
          if (arr[Xcoord, Ycoord + 1, 0] == 0 && DistanceCalculate(spaceCoordList, Xcoord, Ycoord + 1, cellSize) < spaceLimit )
            directionList.AddRange(new int[2] { (Xcoord ), (Ycoord + 1) }); //Store possible spread directions in a list.
          if (arr[Xcoord, Ycoord - 1, 0] == 0 && DistanceCalculate(spaceCoordList, Xcoord, Ycoord - 1, cellSize) < spaceLimit )
            directionList.AddRange(new int[2] { (Xcoord ), (Ycoord - 1) }); //Store possible spread directions in a list.

          if (directionList.Count > 0)
          {
            var randomIndex = rand.Next(directionList.Count / 2);
            int a = directionList[2 * randomIndex];
            int b = directionList[2 * randomIndex + 1];

            arr[a, b, 0] = arr[Xcoord, Ycoord, 0];

            spaceCoordList.AddRange(new int[2] { a, b });

            directionList.Clear();
            directionList.TrimExcess();
            draw = true;
            counter++;
          }
          else
          {
            trycount++;
            if (trycount >= spaceCoordList.Count)
            {
              draw = true;
              //Print("trycountNumber is ={0}", trycount);
            }
          }
        }

          //Left
        else if (Xcoord == 0 && Ycoord != 0 && Ycoord != (arr.GetLength(1) - 1))
        {

          if (arr[Xcoord + 1, Ycoord, 0] == 0 && DistanceCalculate(spaceCoordList, Xcoord + 1, Ycoord, cellSize) < spaceLimit )
            directionList.AddRange(new int[2] { (Xcoord + 1), (Ycoord) }); //Store possible spread directions in a list.
          if (arr[Xcoord, Ycoord + 1, 0] == 0 && DistanceCalculate(spaceCoordList, Xcoord, Ycoord + 1, cellSize) < spaceLimit )
            directionList.AddRange(new int[2] { (Xcoord ), (Ycoord + 1) }); //Store possible spread directions in a list.
          if (arr[Xcoord, Ycoord - 1, 0] == 0 && DistanceCalculate(spaceCoordList, Xcoord, Ycoord - 1, cellSize) < spaceLimit )
            directionList.AddRange(new int[2] { (Xcoord ), (Ycoord - 1) }); //Store possible spread directions in a list.
          if (directionList.Count > 0)
          {
            var randomIndex = rand.Next(directionList.Count / 2);
            int a = directionList[2 * randomIndex];
            int b = directionList[2 * randomIndex + 1];

            arr[a, b, 0] = arr[Xcoord, Ycoord, 0];

            spaceCoordList.AddRange(new int[2] { a, b });

            directionList.Clear();
            directionList.TrimExcess();
            draw = true;
            counter++;
          }
          else
          {
            trycount++;
            if (trycount >= spaceCoordList.Count)
            {
              draw = true;
              //Print("trycountNumber is ={0}", trycount);
            }
          }

        }
          //TOP
        else if ((Ycoord == arr.GetLength(1) - 1) && Xcoord != 0 && Xcoord != (arr.GetLength(0) - 1))
        {

          if (arr[Xcoord, Ycoord - 1, 0] == 0 && DistanceCalculate(spaceCoordList, Xcoord, Ycoord - 1, cellSize) < spaceLimit )
            directionList.AddRange(new int[2] { (Xcoord ), (Ycoord - 1) }); //Store possible spread directions in a list.
          if (arr[Xcoord + 1, Ycoord, 0] == 0 && DistanceCalculate(spaceCoordList, Xcoord + 1, Ycoord, cellSize) < spaceLimit )
            directionList.AddRange(new int[2] { (Xcoord + 1 ), (Ycoord ) }); //Store possible spread directions in a list.
          if (arr[Xcoord - 1, Ycoord, 0] == 0 && DistanceCalculate(spaceCoordList, Xcoord - 1, Ycoord, cellSize) < spaceLimit )
            directionList.AddRange(new int[2] { (Xcoord - 1), (Ycoord ) }); //Store possible spread directions in a list.
          if (directionList.Count > 0)
          {
            var randomIndex = rand.Next(directionList.Count / 2);
            int a = directionList[2 * randomIndex];
            int b = directionList[2 * randomIndex + 1];

            arr[a, b, 0] = arr[Xcoord, Ycoord, 0];

            spaceCoordList.AddRange(new int[2] { a, b });

            directionList.Clear();
            directionList.TrimExcess();
            draw = true;
            counter++;
          }
          else
          {
            trycount++;
            if (trycount >= spaceCoordList.Count)
            {
              draw = true;
              //Print("trycountNumber is ={0}", trycount);
            }
          }
        }
          //BOTTOM
        else if (Ycoord == 0 && Xcoord != 0 && Xcoord != (arr.GetLength(0) - 1))
        {
          if (arr[Xcoord, Ycoord + 1, 0] == 0 && DistanceCalculate(spaceCoordList, Xcoord, Ycoord + 1, cellSize) < spaceLimit )
            directionList.AddRange(new int[2] { (Xcoord ), (Ycoord + 1) }); //Store possible spread directions in a list.
          if (arr[Xcoord + 1, Ycoord, 0] == 0 && DistanceCalculate(spaceCoordList, Xcoord + 1, Ycoord, cellSize) < spaceLimit )
            directionList.AddRange(new int[2] { (Xcoord + 1 ), (Ycoord ) }); //Store possible spread directions in a list.
          if (arr[Xcoord - 1, Ycoord, 0] == 0 && DistanceCalculate(spaceCoordList, Xcoord - 1, Ycoord, cellSize) < spaceLimit )
            directionList.AddRange(new int[2] { (Xcoord - 1), (Ycoord ) }); //Store possible spread directions in a list.
          if (directionList.Count > 0)
          {
            var randomIndex = rand.Next(directionList.Count / 2);
            int a = directionList[2 * randomIndex];
            int b = directionList[2 * randomIndex + 1];

            arr[a, b, 0] = arr[Xcoord, Ycoord, 0];

            spaceCoordList.AddRange(new int[2] { a, b });

            directionList.Clear();
            directionList.TrimExcess();
            draw = true;
            counter++;
          }
          else
          {
            trycount++;
            if (trycount >= spaceCoordList.Count)
            {
              draw = true;
              //Print("trycountNumber is ={0}", trycount);
            }
          }
        }

          //LEFT BOTTOM
        else if (Xcoord == 0 && Ycoord == 0)
        {
          if (arr[Xcoord, Ycoord + 1, 0] == 0 && DistanceCalculate(spaceCoordList, Xcoord, Ycoord + 1, cellSize) < spaceLimit)
            directionList.Add(Xcoord); directionList.Add(Ycoord + 1);

          if (arr[Xcoord + 1, Ycoord, 0] == 0 && DistanceCalculate(spaceCoordList, Xcoord + 1, Ycoord, cellSize) < spaceLimit)
            directionList.Add(Xcoord + 1); directionList.Add(Ycoord);

          if (directionList.Count > 0)
          {

            var randomIndex = rand.Next(directionList.Count / 2);

            int a = directionList[2 * randomIndex];
            int b = directionList[2 * randomIndex + 1];

            arr[a, b, 0] = arr[Xcoord, Ycoord, 0];

            spaceCoordList.AddRange(new int[2] { a, b });

            directionList.Clear();
            directionList.TrimExcess();
            draw = true;

            counter++;
            //Print(" Counter Number is : {0}", counter);
          }
          else
          {
            trycount++;
            if (trycount >= spaceCoordList.Count)
            {
              draw = true;
              //Print("trycountNumber is ={0}", trycount);
            }
          }
        }
          //LEFT  TOP
          /*
          else if (Xcoord == 0 && Ycoord == (arr.GetLength(1) - 1))
          {
          if (arr[Xcoord + 1, Ycoord] == 0)
          directionList.Add(Xcoord + 1); directionList.Add(Ycoord);

          if (arr[Xcoord, Ycoord - 1] == 0)
          directionList.Add(Xcoord); directionList.Add(Ycoord - 1);

          if (directionList.Count > 0)
          {
          var randomIndex = rand.Next(directionList.Count / 2);

          int a = directionList[2 * randomIndex];
          int b = directionList[2 * randomIndex + 1];

          Rhino.RhinoApp.WriteLine("Left Top "  +  a +  " "  +  b);
          arr[a, b] = arr[Xcoord, Ycoord];

          spaceCoordList.AddRange(new int[2] { a, b });

          directionList.Clear();
          directionList.TrimExcess();
          draw = true;

          counter++;
          //Print(" Counter Number is : {0}", counter);
          }
          else
          {
          trycount++;
          if (trycount >= spaceCoordList.Count)
          {
          draw = true;
          //Print("trycountNumber is ={0}", trycount);
          }
          }
          }
          */
          /*
          //RIGHT TOP
          else if (Xcoord == (arr.GetLength(0) - 1) && Ycoord == (arr.GetLength(1) - 1))
          {
          if (arr[Xcoord, Ycoord - 1] == 0)
          directionList.Add(Xcoord); directionList.Add(Ycoord - 1);

          if (arr[Xcoord - 1, Ycoord] == 0)
          directionList.Add(Xcoord - 1); directionList.Add(Ycoord);

          if (directionList.Count > 0)
          {
          var randomIndex = rand.Next(directionList.Count / 2);

          int a = directionList[2 * randomIndex];
          int b = directionList[2 * randomIndex + 1];
          Rhino.RhinoApp.WriteLine(" Right top "+ a + " " + b);
          arr[a, b] = arr[Xcoord, Ycoord];

          //spaceCoordList.AddRange(new int[2] { a, b });

          directionList.Clear();
          directionList.TrimExcess();
          draw = true;

          counter++;
          //Print(" Counter Number is : {0}", counter);
          }
          else
          {
          trycount++;
          if (trycount >= spaceCoordList.Count)
          {
          draw = true;
          //Print("trycountNumber is ={0}", trycount);
          }
          }
          }
          */
          //RIGHT BOTTOM
        else if (Xcoord == (arr.GetLength(0) - 1) && Ycoord == 0)
        {
          if (arr[Xcoord, Ycoord + 1, 0] == 0)
            directionList.Add(Xcoord); directionList.Add(Ycoord + 1);

          if (arr[Xcoord - 1, Ycoord, 0] == 0)
            directionList.Add(Xcoord - 1); directionList.Add(Ycoord);

          if (directionList.Count > 0)
          {
            var randomIndex = rand.Next(directionList.Count / 2);

            int a = directionList[2 * randomIndex];
            int b = directionList[2 * randomIndex + 1];

            arr[a, b, 0] = arr[Xcoord, Ycoord, 0];

            spaceCoordList.AddRange(new int[2] { a, b });

            directionList.Clear();
            directionList.TrimExcess();

            draw = true;
            counter++;
            //Print(" Counter Number is : {0}", counter);
          }
          else
          {
            trycount++;
            if (trycount >= spaceCoordList.Count)
            {
              draw = true;
              //Print("trycountNumber is ={0}", trycount);
            }
          }
        }
        /* EDGE CONDITIONS */
      }
    }

  }
# ---------- end c_script_3 ----------
panel_53 = Panel(c_script_2.FurnituresMargins)

# ---- group: Visualize as 3D Boxes
number_slider_27 = Slider(1, range=0..1)
create_material_11 = CreateMaterial(Diffuse=colour_swatch_6, Specular=RGB(255, 255, 255), Emission=RGB(0, 0, 0), Transparency=number_slider_27, Shine=0)
create_material_12 = CreateMaterial(Diffuse=colour_swatch_3, Specular=RGB(255, 255, 255), Emission=RGB(0, 0, 0), Transparency=number_slider_27, Shine=0)
create_material_13 = CreateMaterial(Diffuse=colour_swatch_7, Specular=RGB(255, 255, 255), Emission=RGB(0, 0, 0), Transparency=number_slider_27, Shine=0)
create_material_14 = CreateMaterial(Diffuse=colour_swatch_8, Specular=RGB(255, 255, 255), Emission=RGB(0, 0, 0), Transparency=number_slider_27, Shine=0)
create_material_15 = CreateMaterial(Diffuse=colour_swatch_4, Specular=RGB(255, 255, 255), Emission=RGB(0, 0, 0), Transparency=number_slider_27, Shine=0)
create_material_16 = CreateMaterial(
    Diffuse=colour_swatch_5,
    Specular=RGB(255, 255, 255),
    Emission=RGB(0, 0, 0),
    Transparency=Slider(0.624, range=0..1),
    Shine=0)
custom_preview_7 = CustomPreview(Geometry=c_script_2.EntranceBoxes, Material=create_material_11)
custom_preview_8 = CustomPreview(Geometry=c_script_2.CommonBoxes, Material=create_material_13)
custom_preview_9 = CustomPreview(Geometry=c_script_2.Y, Material=create_material_12)
custom_preview_10 = CustomPreview(Geometry=c_script_2.WetAreaBoxes, Material=create_material_14)
custom_preview_11 = CustomPreview(Geometry=c_script_2.K, Material=create_material_15)
custom_preview_12 = CustomPreview(Geometry=c_script_2.W, Material=create_material_16)

# ----
display_matrix = DisplayMatrix(c_script_3.A)  # disabled
panel_54 = Panel(c_script_3.FurnituresMargins)
panel_55 = Panel(c_script_3.out)

# ---- group: Visualize as 3D Boxes
number_slider_28 = Slider(1, range=0..1)
create_material_17 = CreateMaterial(Diffuse=colour_swatch_12, Specular=RGB(255, 255, 255), Emission=RGB(0, 0, 0), Transparency=number_slider_28, Shine=0)
create_material_18 = CreateMaterial(Diffuse=colour_swatch_9, Specular=RGB(255, 255, 255), Emission=RGB(0, 0, 0), Transparency=number_slider_28, Shine=0)
create_material_19 = CreateMaterial(Diffuse=colour_swatch_13, Specular=RGB(255, 255, 255), Emission=RGB(0, 0, 0), Transparency=number_slider_28, Shine=0)
create_material_20 = CreateMaterial(Diffuse=colour_swatch_14, Specular=RGB(255, 255, 255), Emission=RGB(0, 0, 0), Transparency=number_slider_28, Shine=0)
create_material_21 = CreateMaterial(Diffuse=colour_swatch_10, Specular=RGB(255, 255, 255), Emission=RGB(0, 0, 0), Transparency=number_slider_28, Shine=0)
create_material_22 = CreateMaterial(
    Diffuse=colour_swatch_11,
    Specular=RGB(255, 255, 255),
    Emission=RGB(0, 0, 0),
    Transparency=Slider(0.624, range=0..1),
    Shine=0)
custom_preview_13 = CustomPreview(Geometry=c_script_3.EntranceBoxes, Material=create_material_17)  # disabled
custom_preview_14 = CustomPreview(Geometry=c_script_3.CommonBoxes, Material=create_material_19)  # disabled
custom_preview_15 = CustomPreview(Geometry=c_script_3.Y, Material=create_material_18)  # disabled
custom_preview_16 = CustomPreview(Geometry=c_script_3.WetAreaBoxes, Material=create_material_20)  # disabled
custom_preview_17 = CustomPreview(Geometry=c_script_3.K, Material=create_material_21)  # disabled
custom_preview_18 = CustomPreview(Geometry=c_script_3.W, Material=create_material_22)  # disabled

# ----
panel_56 = Panel(c_script_2.MV)
vector_display = VectorDisplay(Anchor=c_script_2.Base_Points, Vector=c_script_2.MV)
vector_display_2 = VectorDisplay(Anchor=c_script_2.Base_Points, Vector=c_script_2.OV)
custom_preview_19 = CustomPreview(Geometry=c_script_2.Furnitures, Material=create_material_7)
custom_preview_20 = CustomPreview(Geometry=c_script_2.FurnituresMargins, Material=create_material_8)
custom_preview_21 = CustomPreview(Geometry=c_script_3.Furnitures, Material=create_material_9)
list_length = ListLength(List=c_script_2.EntranceBoxes)
list_length_2 = ListLength(List=c_script_2.CommonBoxes)
list_length_3 = ListLength(List=c_script_2.W)
custom_preview_22 = CustomPreview(Geometry=c_script_3.FurnituresMargins, Material=create_material_10)
list_length_4 = ListLength(List=c_script_2.WetAreaBoxes)
list_length_5 = ListLength(List=c_script_2.Y)
list_length_6 = ListLength(List=c_script_2.K)
multiplication_18 = Multiplication(A=list_length_2, B=division_2)
multiplication_19 = Multiplication(A=list_length, B=division_2)
multiplication_20 = Multiplication(A=list_length_3, B=division_2)
multiplication_21 = Multiplication(A=list_length_4, B=division_2)
multiplication_22 = Multiplication(A=list_length_5, B=division_2)
multiplication_23 = Multiplication(A=list_length_6, B=division_2)
list_length_7 = ListLength(List=c_script_3.EntranceBoxes)  # disabled
list_length_8 = ListLength(List=c_script_3.CommonBoxes)  # disabled
list_length_9 = ListLength(List=c_script_3.W)  # disabled
list_length_10 = ListLength(List=c_script_3.WetAreaBoxes)  # disabled
list_length_11 = ListLength(List=c_script_3.Y)  # disabled
list_length_12 = ListLength(List=c_script_3.K)  # disabled
panel_57 = Panel(multiplication_19)
panel_58 = Panel(multiplication_18)
panel_59 = Panel(multiplication_20)
multiplication_24 = Multiplication(A=list_length_8, B=division_7)  # disabled
panel_60 = Panel(multiplication_21)
panel_61 = Panel(multiplication_22)
multiplication_25 = Multiplication(A=list_length_7, B=division_7)  # disabled
panel_62 = Panel(multiplication_23)
multiplication_26 = Multiplication(A=list_length_9, B=division_7)  # disabled
multiplication_27 = Multiplication(A=list_length_10, B=division_7)  # disabled
multiplication_28 = Multiplication(A=list_length_11, B=division_7)  # disabled
multiplication_29 = Multiplication(A=list_length_12, B=division_7)  # disabled
panel_63 = Panel(multiplication_25)  # disabled
panel_64 = Panel(multiplication_26)  # disabled
panel_65 = Panel(multiplication_24)  # disabled
panel_66 = Panel(multiplication_27)  # disabled
panel_67 = Panel(multiplication_28)  # disabled
concatenate = Concatenate(Fragment_A=" Empty Space= ", Fragment_B=panel_59, Fragment_C="m2 ")
concatenate_2 = Concatenate(Fragment_A=" Entrance = ", Fragment_B=panel_57, Fragment_C="m2 ")
panel_68 = Panel(multiplication_29)  # disabled
concatenate_3 = Concatenate(Fragment_A=" CommonArea = ", Fragment_B=panel_58, Fragment_C="m2 ")
concatenate_4 = Concatenate(Fragment_A="Wet Area = ", Fragment_B=panel_60, Fragment_C="m2 ")
concatenate_5 = Concatenate(Fragment_A=" Kitchen = ", Fragment_B=panel_61, Fragment_C="m2 ")
concatenate_6 = Concatenate(Fragment_A=" Common Area = ", Fragment_B=panel_62, Fragment_C=" m2 ")
panel_69 = Panel(concatenate)
panel_70 = Panel(concatenate_2)
panel_71 = Panel(concatenate_3)
panel_72 = Panel(concatenate_5)
panel_73 = Panel(concatenate_4)
panel_74 = Panel(concatenate_6)
concatenate_7 = Concatenate(Fragment_A=panel_27, Fragment_B=panel_64, Fragment_C=panel_29)  # disabled
concatenate_8 = Concatenate(Fragment_A=panel_26, Fragment_B=panel_63, Fragment_C=panel_25)  # disabled
concatenate_9 = Concatenate(Fragment_A=panel_30, Fragment_B=panel_65, Fragment_C=panel_28)  # disabled
concatenate_10 = Concatenate(Fragment_A=panel_32, Fragment_B=panel_66, Fragment_C=panel_31)  # disabled
concatenate_11 = Concatenate(Fragment_A=panel_35, Fragment_B=panel_67, Fragment_C=panel_34)  # disabled
concatenate_12 = Concatenate(Fragment_A=panel_33, Fragment_B=panel_68, Fragment_C=panel_36)  # disabled
panel_75 = Panel(concatenate_7)  # disabled
panel_76 = Panel(concatenate_8)  # disabled
panel_77 = Panel(concatenate_9)  # disabled
text_tag_3d = TextTag3D(Location="0,-50", Text=concatenate_2, Size=number_slider_19, Colour=colour_swatch_6, Justification=7)
text_tag_3d_2 = TextTag3D(Location="0,-80", Text=concatenate_3, Size=number_slider_19, Colour=colour_swatch_7, Justification=7)
panel_78 = Panel(concatenate_10)  # disabled
panel_79 = Panel(concatenate_11)  # disabled
text_tag_3d_3 = TextTag3D(Location="0,-140", Text=concatenate_5, Size=number_slider_19, Colour=colour_swatch_3, Justification=7)
text_tag_3d_4 = TextTag3D(Location="0,-110", Text=concatenate_4, Size=number_slider_19, Colour=colour_swatch_8, Justification=7)
text_tag_3d_5 = TextTag3D(Location="0,-140", Text=concatenate, Size=number_slider_19, Colour=colour_swatch_5, Justification=7)
panel_80 = Panel(concatenate_12)  # disabled
text_tag_3d_6 = TextTag3D(Location="240,-170", Text=concatenate_6, Size=number_slider_19, Colour=colour_swatch_4, Justification=7)
mass_addition = MassAddition(Input=[multiplication_18, multiplication_19, multiplication_21, multiplication_22, multiplication_23, multiplication_20])  # -> flatten(Result), PartialResults
text_tag_3d_7 = TextTag3D(Location=panel_37, Text=concatenate_8, Size=number_slider_20, Colour=colour_swatch_12, Justification=7)  # disabled
text_tag_3d_8 = TextTag3D(Location=panel_38, Text=concatenate_9, Size=number_slider_20, Colour=colour_swatch_13, Justification=7)  # disabled
text_tag_3d_9 = TextTag3D(Location=panel_39, Text=concatenate_11, Size=number_slider_20, Colour=colour_swatch_9, Justification=7)  # disabled
text_tag_3d_10 = TextTag3D(Location=panel_43, Text=concatenate_10, Size=number_slider_20, Colour=colour_swatch_14, Justification=7)  # disabled
text_tag_3d_11 = TextTag3D(Location=panel_39, Text=concatenate_7, Size=number_slider_20, Colour=colour_swatch_11, Justification=7)  # disabled
text_tag_3d_12 = TextTag3D(Location=panel_42, Text=concatenate_12, Size=number_slider_20, Colour=colour_swatch_10, Justification=7)  # disabled
list_item = ListItem(List=mass_addition.Result, Index=Slider(1, range=0..1), Wrap=True)
panel_81 = Panel(list_item)
mass_addition_2 = MassAddition(Input=[multiplication_24, multiplication_25, multiplication_27, multiplication_28, multiplication_29, multiplication_26])  # -> flatten(Result), PartialResults; disabled
concatenate_13 = Concatenate(Fragment_A=" Total Area =", Fragment_B=panel_81, Fragment_C="m2 ")
list_item_2 = ListItem(List=mass_addition_2.Result, Index=number_slider_21, Wrap=True)  # disabled
panel_82 = Panel(list_item_2)  # disabled
panel_83 = Panel(concatenate_13)
concatenate_14 = Concatenate(Fragment_A=panel_45, Fragment_B=panel_82, Fragment_C=panel_46)  # disabled
text_tag_3d_13 = TextTag3D(Location="240,-100", Text=concatenate_13, Size=number_slider_19, Justification=7)
panel_84 = Panel(concatenate_14)  # disabled
text_tag_3d_14 = TextTag3D(Location=panel_47, Text=concatenate_14, Size=number_slider_20, Justification=7)  # disabled

# ---- group: KITCHEN UNIT TYPE II / sitting unit 1
number_slider_29 = Slider(65, range=60..65)  # disabled
Z_40 = Slider(6, range=2..6)  # disabled
addition_135 = Addition(A=number_slider_29, B=Z_40)  # disabled
addition_136 = Addition(A=Y_24, B=Y_25)  # disabled
vector_xyz_42 = VectorXYZ(XComponent=X_26, YComponent=addition_136, ZComponent=addition_135)  # -> Vector, Length; disabled
Y_47 = Slider(60, range=60..100)  # disabled
rectangle_35 = Rectangle(Plane=vector_xyz_42.Vector, XSize=X_27, YSize=Y_47, Radius=0)  # -> Rectangle, Length; disabled
table_1_3 = BoxRectangle(Rectangle=rectangle_35.Rectangle, Height=Z_40)  # disabled
deconstruct_box_51 = DeconstructBox(Box=table_1_3)  # -> Plane, X, Y, Z; disabled
margin_top_25 = Slider(135, range=130..135)  # disabled
margin_front_30 = Slider(60, range=60..80)  # disabled
margin_left_6 = Slider(80, range=50..80)  # disabled
deconstruct_domain_82 = DeconstructDomain(Domain=deconstruct_box_51.Z)  # -> Start, End; disabled
deconstruct_domain_83 = DeconstructDomain(Domain=deconstruct_box_51.X)  # -> Start, End; disabled
deconstruct_domain_84 = DeconstructDomain(Domain=deconstruct_box_51.Y)  # -> Start, End; disabled
addition_137 = Addition(A=deconstruct_domain_82.End, B=margin_top_25)  # disabled
addition_138 = Addition(A=deconstruct_domain_84.End, B=margin_front_30)  # disabled
addition_139 = Addition(A=deconstruct_domain_83.End, B=margin_left_6)  # disabled
back_front_margin_41 = ConstructDomain(DomainStart=deconstruct_domain_84.Start, DomainEnd=addition_138)  # disabled
left_right_margin_6 = ConstructDomain(DomainStart=deconstruct_domain_83.Start, DomainEnd=addition_139)  # disabled

# ----
multiplication_30 = Multiplication(A=addition_135, B=panel_40)  # disabled

# ---- group: KITCHEN UNIT TYPE II / sitting unit 1 (continued)
addition_140 = Addition(A=multiplication_30, B=deconstruct_domain_82.Start)  # disabled
top_bottom_margin_23 = ConstructDomain(DomainStart=addition_140, DomainEnd=addition_137)  # disabled
table_1_margin_2 = DomainBox(
    Base=deconstruct_box_51.Plane,
    LEFTRIGHT=left_right_margin_6,
    BACKFRONT=back_front_margin_41,
    TOPBOTTOM=top_bottom_margin_23)  # disabled

# ---- group: KITCHEN UNIT TYPE II
kitchen_unit_type_ii = Merge(Data1=counter_2_2, Data2=table_2_4, Data3=fridge_3, Data4=stove_3, Data5=cupboard_3, Data6=microwave_2, Data7=table_1_3)  # disabled
kitchen_unit_type_ii_margin = Merge(
    Data1=counter_2_margin_3,
    Data2=table_2_margin_4,
    Data3=fridge_margin_3,
    Data4=stove_margin_3,
    Data5=cupboard_margin_3,
    Data6=microwave_margin_2,
    Data7=table_1_margin_2)  # disabled

# ---- group: KITCHEN UNIT TYPE III / sitting unit 1
number_slider_30 = Slider(60, range=60..65)  # disabled
Z_41 = Slider(6, range=2..6)  # disabled
addition_141 = Addition(A=Y_31, B=Y_32)  # disabled
addition_142 = Addition(A=number_slider_30, B=Z_41)  # disabled
vector_xyz_43 = VectorXYZ(XComponent=X_36, YComponent=addition_141, ZComponent=addition_142)  # -> Vector, Length; disabled
Y_48 = Slider(60, range=60..100)  # disabled
rectangle_36 = Rectangle(Plane=vector_xyz_43.Vector, XSize=Y_48, YSize=Y_38, Radius=0)  # -> Rectangle, Length; disabled
table_1_4 = BoxRectangle(Rectangle=rectangle_36.Rectangle, Height=Z_41)  # disabled
deconstruct_box_52 = DeconstructBox(Box=table_1_4)  # -> Plane, X, Y, Z; disabled
margin_left_7 = Slider(-60, range=-80..-60)  # disabled
margin_top_26 = Slider(135, range=130..135)  # disabled
margin_front_31 = Slider(60, range=60..80)  # disabled
margin_left_8 = Slider(80, range=50..80)  # disabled
deconstruct_domain_85 = DeconstructDomain(Domain=deconstruct_box_52.Z)  # -> Start, End; disabled
deconstruct_domain_86 = DeconstructDomain(Domain=deconstruct_box_52.Y)  # -> Start, End; disabled
deconstruct_domain_87 = DeconstructDomain(Domain=deconstruct_box_52.X)  # -> Start, End; disabled
addition_143 = Addition(A=deconstruct_domain_85.End, B=margin_top_26)  # disabled
addition_144 = Addition(A=deconstruct_domain_86.End, B=margin_front_31)  # disabled
addition_145 = Addition(A=deconstruct_domain_87.End, B=margin_left_8)  # disabled
addition_146 = Addition(A=margin_left_7, B=deconstruct_domain_87.Start)  # disabled
back_front_margin_42 = ConstructDomain(DomainStart=deconstruct_domain_86.Start, DomainEnd=addition_144)  # disabled
left_right_margin_7 = ConstructDomain(DomainStart=addition_146, DomainEnd=addition_145)  # disabled

# ----
multiplication_31 = Multiplication(A=addition_142, B=panel_49)  # disabled

# ---- group: KITCHEN UNIT TYPE III / sitting unit 1 (continued)
addition_147 = Addition(A=multiplication_31, B=deconstruct_domain_85.Start)  # disabled
top_bottom_margin_24 = ConstructDomain(DomainStart=addition_147, DomainEnd=addition_143)  # disabled
table_margin = DomainBox(
    Base=deconstruct_box_52.Plane,
    LEFTRIGHT=left_right_margin_7,
    BACKFRONT=back_front_margin_42,
    TOPBOTTOM=top_bottom_margin_24)  # disabled

# ---- group: KITCHEN UNIT TYPE III
kitchen_unit_type_iii = Merge(Data1=counter_2_3, Data2=table_2_5, Data3=fridge_4, Data4=stove_4, Data5=cupboard_4, Data6=microwave_3, Data7=table_1_4)  # disabled
kitchen_unit_type_iii_margin = Merge(
    Data1=counter_2_margin_4,
    Data2=table_2_margin_5,
    Data3=fridge_margin_4,
    Data4=stove_margin_4,
    Data5=cupboard_margin_4,
    Data6=microwave_margin_3,
    Data7=table_margin)  # disabled

# ---- group: KITCHEN UNIT TYPE IV / sitting unit 1
number_slider_31 = Slider(45, range=35..45)  # disabled
Z_42 = Slider(6, range=2..6)  # disabled
addition_148 = Addition(A=Y_39, B=Y_40)  # disabled
addition_149 = Addition(A=number_slider_31, B=Z_42)  # disabled
vector_xyz_44 = VectorXYZ(XComponent=X_46, YComponent=addition_148, ZComponent=addition_149)  # -> Vector, Length; disabled
Y_49 = Slider(60, range=60..100)  # disabled
rectangle_37 = Rectangle(Plane=vector_xyz_44.Vector, XSize=Y_49, YSize=Y_46, Radius=0)  # -> Rectangle, Length; disabled
sitting_unit_1 = BoxRectangle(Rectangle=rectangle_37.Rectangle, Height=Z_42)  # disabled
deconstruct_box_53 = DeconstructBox(Box=sitting_unit_1)  # -> Plane, X, Y, Z; disabled
margin_left_9 = Slider(-60, range=-80..-60)  # disabled
margin_top_27 = Slider(135, range=130..135)  # disabled
margin_front_32 = Slider(10, range=5..10)  # disabled
margin_left_10 = Slider(80, range=50..80)  # disabled
deconstruct_domain_88 = DeconstructDomain(Domain=deconstruct_box_53.Z)  # -> Start, End; disabled
deconstruct_domain_89 = DeconstructDomain(Domain=deconstruct_box_53.Y)  # -> Start, End; disabled
deconstruct_domain_90 = DeconstructDomain(Domain=deconstruct_box_53.X)  # -> Start, End; disabled
addition_150 = Addition(A=deconstruct_domain_88.End, B=margin_top_27)  # disabled
addition_151 = Addition(A=deconstruct_domain_89.End, B=margin_front_32)  # disabled
addition_152 = Addition(A=deconstruct_domain_90.End, B=margin_left_10)  # disabled
addition_153 = Addition(A=margin_left_9, B=deconstruct_domain_90.Start)  # disabled
back_front_margin_43 = ConstructDomain(DomainStart=deconstruct_domain_89.Start, DomainEnd=addition_151)  # disabled
left_right_margin_8 = ConstructDomain(DomainStart=addition_153, DomainEnd=addition_152)  # disabled

# ----
multiplication_32 = Multiplication(A=addition_149, B=panel_51)  # disabled

# ---- group: KITCHEN UNIT TYPE IV / sitting unit 1 (continued)
addition_154 = Addition(A=multiplication_32, B=deconstruct_domain_88.Start)  # disabled
top_bottom_margin_25 = ConstructDomain(DomainStart=addition_154, DomainEnd=addition_150)  # disabled
sitting_unit_1_margin_2 = DomainBox(
    Base=deconstruct_box_53.Plane,
    LEFTRIGHT=left_right_margin_8,
    BACKFRONT=back_front_margin_43,
    TOPBOTTOM=top_bottom_margin_25)  # disabled

# ---- group: KITCHEN UNIT TYPE IV
kitchen_unit_type_iv = Merge(
    Data1=counter_2_4,
    Data2=table_2_6,
    Data3=fridge_5,
    Data4=stove_5,
    Data5=cupboard_5,
    Data6=microwave_4,
    Data7=sitting_unit_1)  # disabled
kitchen_unit_type_iv_margin = Merge(
    Data1=counter_2_margin_5,
    Data2=table_2_margin_6,
    Data3=fridge_margin_5,
    Data4=stove_margin_5,
    Data5=cupboard_margin_5,
    Data6=microwave_margin_4,
    Data7=sitting_unit_1_margin_2)  # disabled
