# Grasshopper definition CemGrasshopperC#58.gh (Grasshopper 1.0.7)
# plug-ins: Human

number_slider = Slider(59.6, range=0..200)  # disabled
number_slider_2 = Slider(81, range=0..200)  # disabled
number_slider_3 = Slider(54.5, range=0..200)  # disabled
xy_plane = XYPlane(Origin=Point(0, 650, 0))  # disabled

number_slider_4 = Slider(35, range=0..200)  # disabled
number_slider_5 = Slider(50, range=0..200)  # disabled
number_slider_6 = Slider(40, range=0..200)  # disabled
xy_plane_2 = XYPlane(Origin=Point(0, 900, 0))  # disabled

number_slider_7 = Slider(100, range=0..200)  # disabled
number_slider_8 = Slider(60, range=0..200)  # disabled
number_slider_9 = Slider(62, range=0..200)  # disabled
xy_plane_3 = XYPlane(Origin=Point(0, 1200, 0))  # disabled

# ----
# Furnitures!
xy_plane_4 = XYPlane(Origin=Point(0, 0, 0))

number_slider_10 = Slider(62.1, range=0..200)  # disabled
number_slider_11 = Slider(50, range=0..200)  # disabled
number_slider_12 = Slider(35, range=0..200)  # disabled
xy_plane_5 = XYPlane(Origin=Point(0, 400, 0))  # disabled

number_slider_13 = Slider(27.5, range=0..200)  # disabled
number_slider_14 = Slider(54.5, range=0..200)  # disabled
number_slider_15 = Slider(5, range=0..200)  # disabled
xy_plane_6 = XYPlane(Origin=Point(0, 200, 0))  # disabled

# ----
# Entrance
vector_xyz = VectorXYZ(XComponent=Slider(806, range=0..1000), YComponent=0, ZComponent=0)  # -> Vector, Length
vector_xyz_2 = VectorXYZ(XComponent=Slider(1000, range=0..1000), YComponent=0, ZComponent=0)  # -> Vector, Length
vector_xyz_3 = VectorXYZ(XComponent=Slider(1392, range=0..2000), YComponent=0, ZComponent=0)  # -> Vector, Length
closet = DomainBox(Base=vector_xyz_3.Vector, X=Slider(230, range=110..230), Y=Slider(60, range=55..65), Z=Slider(210, range=2..220))
exterior_door = DomainBox(Base=vector_xyz.Vector, X=Slider(100, range=90..100), Y=Slider(10, range=5..15), Z=Slider(200, range=150..220))
changeover_zone = DomainBox(Base=vector_xyz_2.Vector, X=Slider(60, range=50..65), Y=Slider(40, range=35..45), Z=Slider(2, range=2..220))

number_slider_16 = Slider(243, range=0..1000)  # disabled
number_slider_17 = Slider(450, range=0..1000)  # disabled
number_slider_18 = Slider(623, range=0..1000)  # disabled
number_slider_19 = Slider(54, range=40..60)  # disabled
number_slider_20 = Slider(45, range=40..60)  # disabled
number_slider_21 = Slider(89, range=80..100)  # disabled
number_slider_22 = Slider(85, range=40..90)  # disabled
number_slider_23 = Slider(34, range=30..40)  # disabled
number_slider_24 = Slider(13, range=5..15)  # disabled
number_slider_25 = Slider(29, range=25..30)  # disabled
number_slider_26 = Slider(5, range=5..10)  # disabled
number_slider_27 = Slider(62, range=60..80)  # disabled
# Kitchen
vector_xyz_4 = VectorXYZ(XComponent=Slider(0, range=0..1000), YComponent=0, ZComponent=0)  # -> Vector, Length
vector_xyz_5 = VectorXYZ(XComponent=number_slider_16, YComponent=0, ZComponent=0)  # -> Vector, Length; disabled
vector_xyz_6 = VectorXYZ(XComponent=number_slider_18, YComponent=0, ZComponent=0)  # -> Vector, Length; disabled
vector_xyz_7 = VectorXYZ(XComponent=number_slider_17, YComponent=0, ZComponent=0)  # -> Vector, Length; disabled
multipurpose_table_for_2 = DomainBox(Base=vector_xyz_4.Vector, X=Slider(76, range=50..200), Y=Slider(107, range=100..120), Z=Slider(75, range=50..200))
sitting_unit = DomainBox(Base=vector_xyz_5.Vector, X=number_slider_20, Y=number_slider_19, Z=number_slider_21)  # disabled
monitor = DomainBox(Base=vector_xyz_7.Vector, X=number_slider_22, Y=number_slider_26, Z=number_slider_27)  # disabled
first_aid_closet = DomainBox(Base=vector_xyz_6.Vector, X=number_slider_23, Y=number_slider_24, Z=number_slider_25)  # disabled

# ----
# right
# right
# front
# front
# PERSONAL SPACE
number_slider_28 = Slider(0, range=0..100)  # disabled
number_slider_29 = Slider(293, range=0..2000)  # disabled
number_slider_30 = Slider(207, range=0..300)  # disabled
number_slider_31 = Slider(109, range=0..300)  # disabled
number_slider_32 = Slider(30, range=0..100)  # disabled
number_slider_33 = Slider(207, range=0..300)  # disabled
number_slider_34 = Slider(109, range=0..300)  # disabled
number_slider_35 = Slider(30, range=0..100)  # disabled
number_slider_36 = Slider(80, range=0..100)  # disabled
number_slider_37 = Slider(40, range=0..100)  # disabled
number_slider_38 = Slider(40, range=0..300)  # disabled
number_slider_39 = Slider(506, range=0..2000)  # disabled
number_slider_40 = Slider(80, range=0..100)  # disabled
number_slider_41 = Slider(40, range=0..100)  # disabled
number_slider_42 = Slider(40, range=0..300)  # disabled
number_slider_43 = Slider(711, range=0..2000)  # disabled
vector_xyz_8 = VectorXYZ(XComponent=number_slider_28, YComponent=0, ZComponent=0)  # -> Vector, Length; disabled
vector_xyz_9 = VectorXYZ(XComponent=0, YComponent=number_slider_29, ZComponent=0)  # -> Vector, Length; disabled
vector_xyz_10 = VectorXYZ(XComponent=0, YComponent=number_slider_39, ZComponent=0)  # -> Vector, Length; disabled
bed = DomainBox(Base=vector_xyz_8.Vector, X=number_slider_30, Y=number_slider_31, Z=number_slider_32)  # disabled
vector_xyz_11 = VectorXYZ(XComponent=0, YComponent=number_slider_43, ZComponent=0)  # -> Vector, Length; disabled
personal_closet = DomainBox(Base=vector_xyz_10.Vector, X=number_slider_36, Y=number_slider_37, Z=number_slider_38)  # disabled
personal_closet1 = DomainBox(Base=vector_xyz_11.Vector, X=number_slider_40, Y=number_slider_41, Z=number_slider_42)  # disabled
bed1 = DomainBox(Base=vector_xyz_9.Vector, X=number_slider_33, Y=number_slider_34, Z=number_slider_35)  # disabled
deconstruct_box = DeconstructBox(Box=bed)  # -> Plane, X, Y, Z; disabled
number_slider_44 = Slider(60, range=0..100)  # disabled
deconstruct_box_2 = DeconstructBox(Box=bed1)  # -> Plane, X, Y, Z; disabled
deconstruct_box_3 = DeconstructBox(Box=personal_closet)  # -> Plane, X, Y, Z; disabled
number_slider_45 = Slider(60, range=0..100)  # disabled
deconstruct_box_4 = DeconstructBox(Box=personal_closet1)  # -> Plane, X, Y, Z; disabled
number_slider_46 = Slider(40, range=0..100)  # disabled
number_slider_47 = Slider(40, range=0..100)  # disabled
deconstruct_domain = DeconstructDomain(Domain=deconstruct_box.Y)  # -> Start, End; disabled
deconstruct_domain_2 = DeconstructDomain(Domain=deconstruct_box_2.Y)  # -> Start, End; disabled
deconstruct_domain_3 = DeconstructDomain(Domain=deconstruct_box_3.Y)  # -> Start, End; disabled
deconstruct_domain_4 = DeconstructDomain(Domain=deconstruct_box_4.Y)  # -> Start, End; disabled
addition = Addition(A=deconstruct_domain.End, B=number_slider_44)  # disabled
addition_2 = Addition(A=deconstruct_domain_2.End, B=number_slider_45)  # disabled
addition_3 = Addition(A=deconstruct_domain_3.End, B=number_slider_46)  # disabled
addition_4 = Addition(A=deconstruct_domain_4.End, B=number_slider_47)  # disabled
construct_domain = ConstructDomain(DomainStart=deconstruct_domain.Start, DomainEnd=addition)  # disabled
construct_domain_2 = ConstructDomain(DomainStart=deconstruct_domain_2.Start, DomainEnd=addition_2)  # disabled
construct_domain_3 = ConstructDomain(DomainStart=deconstruct_domain_3.Start, DomainEnd=addition_3)  # disabled
construct_domain_4 = ConstructDomain(DomainStart=deconstruct_domain_4.Start, DomainEnd=addition_4)  # disabled
domain_box = DomainBox(Base=PlaneXY(0, 0, 0), X=deconstruct_box.X, Y=construct_domain, Z=deconstruct_box.Z)  # disabled
domain_box_2 = DomainBox(Base=bed1, X=deconstruct_box_2.X, Y=construct_domain_2, Z=deconstruct_box_2.Z)  # disabled
domain_box_3 = DomainBox(Base=personal_closet, X=deconstruct_box_3.X, Y=construct_domain_3, Z=deconstruct_box_3.Z)  # disabled
domain_box_4 = DomainBox(Base=personal_closet1, X=deconstruct_box_4.X, Y=construct_domain_4, Z=deconstruct_box_4.Z)  # disabled

# ----
# WET AREA
# left
# right
# front
# front
# front
# front
# front
number_slider_48 = Slider(0, range=0..100)
vector_xyz_12 = VectorXYZ(XComponent=Slider(-76, range=-100..101), YComponent=0, ZComponent=0)  # -> Vector, Length
vector_xyz_13 = VectorXYZ(XComponent=number_slider_48, YComponent=0, ZComponent=0)  # -> Vector, Length
vector_xyz_14 = VectorXYZ(XComponent=Slider(0, range=0..100), YComponent=0, ZComponent=0)  # -> Vector, Length
vector_xyz_15 = VectorXYZ(XComponent=Slider(0, range=-1000..100), YComponent=0, ZComponent=0)  # -> Vector, Length
vector_xyz_16 = VectorXYZ(XComponent=Slider(-199, range=-1000..100), YComponent=0, ZComponent=0)  # -> Vector, Length
toılet = DomainBox(Base=vector_xyz_12.Vector, X=Slider(36, range=0..100), Y=Slider(54, range=0..100), Z=Slider(50, range=0..100))
dressing_cabin = DomainBox(Base=vector_xyz_15.Vector, X=Slider(80, range=0..100), Y=Slider(80, range=0..100), Z=Slider(200, range=0..300))
mirror_cupboard = DomainBox(Base=vector_xyz_13.Vector, X=Slider(60, range=0..100), Y=Slider(15, range=0..100), Z=Slider(60, range=0..300))
shower_cabin = DomainBox(Base=vector_xyz_14.Vector, X=Slider(80, range=0..100), Y=Slider(80, range=0..100), Z=Slider(210, range=0..300))
sink_cupboard = DomainBox(Base=vector_xyz_16.Vector, X=Slider(55, range=0..100), Y=Slider(40, range=0..100), Z=Slider(85, range=0..300))
deconstruct_box_5 = DeconstructBox()  # -> Plane, X, Y, Z
deconstruct_box_6 = DeconstructBox(Box=toılet)  # -> Plane, X, Y, Z
deconstruct_box_7 = DeconstructBox()  # -> Plane, X, Y, Z
deconstruct_box_8 = DeconstructBox(Box=mirror_cupboard)  # -> Plane, X, Y, Z
deconstruct_box_9 = DeconstructBox(Box=shower_cabin)  # -> Plane, X, Y, Z
deconstruct_box_10 = DeconstructBox(Box=sink_cupboard)  # -> Plane, X, Y, Z
deconstruct_box_11 = DeconstructBox(Box=dressing_cabin)  # -> Plane, X, Y, Z
deconstruct_domain_5 = DeconstructDomain(Domain=deconstruct_box_6.X)  # -> Start, End
deconstruct_domain_6 = DeconstructDomain(Domain=deconstruct_box_7.Y)  # -> Start, End
deconstruct_domain_7 = DeconstructDomain(Domain=deconstruct_box_5.X)  # -> Start, End
deconstruct_domain_8 = DeconstructDomain(Domain=deconstruct_box_9.Y)  # -> Start, End
deconstruct_domain_9 = DeconstructDomain(Domain=deconstruct_box_8.Y)  # -> Start, End
deconstruct_domain_10 = DeconstructDomain(Domain=deconstruct_box_11.Y)  # -> Start, End
deconstruct_domain_11 = DeconstructDomain(Domain=deconstruct_box_10.Y)  # -> Start, End
addition_5 = Addition(A=deconstruct_domain_5.End, B=Slider(20, range=0..100))
addition_6 = Addition(A=deconstruct_domain_6.End, B=Slider(60, range=0..100))
subtraction = Subtraction(A=deconstruct_domain_7.Start, B=Slider(30, range=0..101))
addition_7 = Addition(A=deconstruct_domain_9.End, B=Slider(85, range=0..100))
addition_8 = Addition(A=deconstruct_domain_8.End, B=Slider(60, range=0..100))
addition_9 = Addition(A=deconstruct_domain_10.End, B=Slider(60, range=0..100))
addition_10 = Addition(A=deconstruct_domain_11.End, B=Slider(60, range=0..100))
construct_domain_5 = ConstructDomain(DomainStart=deconstruct_domain_5.Start, DomainEnd=addition_5)
construct_domain_6 = ConstructDomain(DomainStart=deconstruct_domain_6.Start, DomainEnd=addition_6)
construct_domain_7 = ConstructDomain(DomainStart=deconstruct_domain_7.Start, DomainEnd=subtraction)
construct_domain_8 = ConstructDomain(DomainStart=deconstruct_domain_9.Start, DomainEnd=addition_7)
construct_domain_9 = ConstructDomain(DomainStart=deconstruct_domain_8.Start, DomainEnd=addition_8)
construct_domain_10 = ConstructDomain(DomainStart=deconstruct_domain_10.Start, DomainEnd=addition_9)
construct_domain_11 = ConstructDomain(DomainStart=deconstruct_domain_11.Start, DomainEnd=addition_10)
domain_box_5 = DomainBox(Base=toılet, X=construct_domain_5, Y=deconstruct_box_6.Y, Z=deconstruct_box_6.Z)
domain_box_6 = DomainBox(Base=PlaneXY(0, 0, 0), X=construct_domain_7, Y=deconstruct_box_5.Y, Z=deconstruct_box_5.Z)
domain_box_7 = DomainBox(Base=PlaneXY(0, 0, 0), X=deconstruct_box_7.X, Y=construct_domain_6, Z=deconstruct_box_7.Z)
domain_box_8 = DomainBox(Base=mirror_cupboard, X=deconstruct_box_8.X, Y=construct_domain_8, Z=deconstruct_box_8.Z)
domain_box_9 = DomainBox(Base=shower_cabin, X=deconstruct_box_9.X, Y=construct_domain_9, Z=deconstruct_box_9.Z)
domain_box_10 = DomainBox(Base=dressing_cabin, X=deconstruct_box_11.X, Y=construct_domain_10, Z=deconstruct_box_11.Z)
domain_box_11 = DomainBox(Base=sink_cupboard, X=deconstruct_box_10.X, Y=construct_domain_11, Z=deconstruct_box_10.Z)

stove = DomainBox(Base=PlaneXY(0, 0, 0), X=number_slider_13, Y=number_slider_14, Z=number_slider_15)  # disabled
sink = DomainBox(Base=PlaneXY(0, 0, 0), X=Slider(54, range=0..200), Y=Slider(44, range=0..200), Z=Slider(19, range=0..200))
counter = DomainBox(Base=PlaneXY(0, 0, 0), X=number_slider_7, Y=number_slider_8, Z=number_slider_9)  # disabled
cupboard = DomainBox(Base=PlaneXY(0, 0, 0), X=number_slider_5, Y=number_slider_4, Z=number_slider_6)  # disabled
mıcrowave = DomainBox(Base=PlaneXY(0, 0, 0), X=number_slider_10, Y=number_slider_11, Z=number_slider_12)  # disabled
frıdge = DomainBox(Base=PlaneXY(0, 0, 0), X=number_slider, Y=number_slider_3, Z=number_slider_2)  # disabled
# Margins!
custom_preview_materials = CustomPreviewMaterials(Geometry=sink, DiffuseColor=RGB(174, 215, 230), Transparency=Slider(0, range=0..1))

deconstruct_box_12 = DeconstructBox(Box=mıcrowave)  # -> Plane, X, Y, Z; disabled
deconstruct_domain_12 = DeconstructDomain(Domain=deconstruct_box_12.Y)  # -> Start, End; disabled
number_slider_49 = Slider(80, range=0..1000)  # disabled
addition_11 = Addition(A=deconstruct_domain_12.End, B=number_slider_49)  # disabled
construct_domain_12 = ConstructDomain(DomainStart=deconstruct_domain_12.Start, DomainEnd=addition_11)  # disabled
microwave_margin = DomainBox(Base=deconstruct_box_12.Plane, X=deconstruct_box_12.X, Y=construct_domain_12, Z=deconstruct_box_12.Z)  # disabled

deconstruct_box_13 = DeconstructBox(Box=frıdge)  # -> Plane, X, Y, Z; disabled
deconstruct_domain_13 = DeconstructDomain(Domain=deconstruct_box_13.Y)  # -> Start, End; disabled
number_slider_50 = Slider(80, range=0..1000)  # disabled
addition_12 = Addition(A=deconstruct_domain_13.End, B=number_slider_50)  # disabled
construct_domain_13 = ConstructDomain(DomainStart=deconstruct_domain_13.Start, DomainEnd=addition_12)  # disabled
fridge_margin = DomainBox(Base=deconstruct_box_13.Plane, X=deconstruct_box_13.X, Y=construct_domain_13, Z=deconstruct_box_13.Z)  # disabled

deconstruct_box_14 = DeconstructBox(Box=sink)  # -> Plane, X, Y, Z
deconstruct_domain_14 = DeconstructDomain(Domain=deconstruct_box_14.Z)  # -> Start, End
deconstruct_domain_15 = DeconstructDomain(Domain=deconstruct_box_14.Y)  # -> Start, End
addition_13 = Addition(A=deconstruct_domain_14.End, B=Slider(123, range=0..1000))
addition_14 = Addition(A=deconstruct_domain_15.End, B=Slider(85, range=0..1000))
addition_15 = Addition(A=deconstruct_domain_15.Start, B=Slider(-10, range=-10..1000))
construct_domain_14 = ConstructDomain(DomainStart=deconstruct_domain_14.Start, DomainEnd=addition_13)
construct_domain_15 = ConstructDomain(DomainStart=addition_15, DomainEnd=addition_14)
sink_margin = DomainBox(Base=deconstruct_box_14.Plane, X=deconstruct_box_14.X, Y=construct_domain_15, Z=construct_domain_14)

deconstruct_box_15 = DeconstructBox(Box=stove)  # -> Plane, X, Y, Z; disabled
number_slider_51 = Slider(123, range=0..1000)  # disabled
deconstruct_domain_16 = DeconstructDomain(Domain=deconstruct_box_15.Z)  # -> Start, End; disabled
deconstruct_domain_17 = DeconstructDomain(Domain=deconstruct_box_15.Y)  # -> Start, End; disabled
number_slider_52 = Slider(80, range=0..1000)  # disabled
addition_16 = Addition(A=deconstruct_domain_16.End, B=number_slider_51)  # disabled
addition_17 = Addition(A=deconstruct_domain_17.End, B=number_slider_52)  # disabled
construct_domain_16 = ConstructDomain(DomainStart=deconstruct_domain_16.Start, DomainEnd=addition_16)  # disabled
construct_domain_17 = ConstructDomain(DomainStart=deconstruct_domain_17.Start, DomainEnd=addition_17)  # disabled
stove_margin = DomainBox(Base=deconstruct_box_15.Plane, X=deconstruct_box_15.X, Y=construct_domain_17, Z=construct_domain_16)  # disabled

deconstruct_box_16 = DeconstructBox(Box=counter)  # -> Plane, X, Y, Z; disabled
number_slider_53 = Slider(75, range=0..1000)  # disabled
deconstruct_domain_18 = DeconstructDomain(Domain=deconstruct_box_16.Z)  # -> Start, End; disabled
deconstruct_domain_19 = DeconstructDomain(Domain=deconstruct_box_16.Y)  # -> Start, End; disabled
number_slider_54 = Slider(80, range=0..1000)  # disabled
addition_18 = Addition(A=deconstruct_domain_18.End, B=number_slider_53)  # disabled
construct_domain_18 = ConstructDomain(DomainStart=deconstruct_domain_18.Start, DomainEnd=addition_18)  # disabled
addition_19 = Addition(A=deconstruct_domain_19.End, B=number_slider_54)  # disabled
construct_domain_19 = ConstructDomain(DomainStart=deconstruct_domain_19.Start, DomainEnd=addition_19)  # disabled
counter_margin = DomainBox(Base=deconstruct_box_16.Plane, X=deconstruct_box_16.X, Y=construct_domain_19, Z=construct_domain_18)  # disabled

deconstruct_box_17 = DeconstructBox(Box=cupboard)  # -> Plane, X, Y, Z; disabled
number_slider_55 = Slider(13, range=0..1000)  # disabled
deconstruct_domain_20 = DeconstructDomain(Domain=deconstruct_box_17.Z)  # -> Start, End; disabled
deconstruct_domain_21 = DeconstructDomain(Domain=deconstruct_box_17.Y)  # -> Start, End; disabled
number_slider_56 = Slider(-75, range=-100..1000)  # disabled
number_slider_57 = Slider(105, range=0..1000)  # disabled
addition_20 = Addition(A=deconstruct_domain_20.Start, B=number_slider_56)  # disabled
addition_21 = Addition(A=deconstruct_domain_20.End, B=number_slider_55)  # disabled
addition_22 = Addition(A=deconstruct_domain_21.End, B=number_slider_57)  # disabled
construct_domain_20 = ConstructDomain(DomainStart=addition_20, DomainEnd=addition_21)  # disabled
construct_domain_21 = ConstructDomain(DomainStart=deconstruct_domain_21.Start, DomainEnd=addition_22)  # disabled
cupboard_margin = DomainBox(Base=deconstruct_box_17.Plane, X=deconstruct_box_17.X, Y=construct_domain_21, Z=construct_domain_20)  # disabled

deconstruct_box_18 = DeconstructBox(Box=multipurpose_table_for_2)  # -> Plane, X, Y, Z
deconstruct_box_19 = DeconstructBox(Box=sitting_unit)  # -> Plane, X, Y, Z; disabled
deconstruct_box_20 = DeconstructBox(Box=monitor)  # -> Plane, X, Y, Z; disabled
deconstruct_box_21 = DeconstructBox(Box=exterior_door)  # -> Plane, X, Y, Z
deconstruct_box_22 = DeconstructBox(Box=changeover_zone)  # -> Plane, X, Y, Z
deconstruct_box_23 = DeconstructBox(Box=closet)  # -> Plane, X, Y, Z
number_slider_58 = Slider(57, range=0..500)  # disabled
number_slider_59 = Slider(57, range=0..500)  # disabled
number_slider_60 = Slider(168, range=0..500)  # disabled
number_slider_61 = Slider(57, range=0..500)  # disabled
panel = Panel(deconstruct_box_18.X)
deconstruct_domain_22 = DeconstructDomain(Domain=deconstruct_box_18.Y)  # -> Start, End; disabled
deconstruct_domain_23 = DeconstructDomain(Domain=deconstruct_box_18.X)  # -> Start, End
deconstruct_domain_24 = DeconstructDomain(Domain=deconstruct_box_18.Y)  # -> Start, End; disabled
deconstruct_domain_25 = DeconstructDomain(Domain=deconstruct_box_18.Y)  # -> Start, End; disabled
deconstruct_domain_26 = DeconstructDomain(Domain=deconstruct_box_18.Y)  # -> Start, End; disabled
panel_2 = Panel(deconstruct_box_21.X)
deconstruct_domain_27 = DeconstructDomain(Domain=deconstruct_box_21.X)  # -> Start, End
panel_3 = Panel(deconstruct_box_22.X)
deconstruct_domain_28 = DeconstructDomain(Domain=deconstruct_box_22.Y)  # -> Start, End
deconstruct_domain_29 = DeconstructDomain(Domain=deconstruct_box_22.Z)  # -> Start, End
panel_4 = Panel(deconstruct_box_23.X)
deconstruct_domain_30 = DeconstructDomain(Domain=deconstruct_box_23.X)  # -> Start, End
addition_23 = Addition(A=deconstruct_domain_22.End, B=number_slider_58)  # disabled
addition_24 = Addition(A=deconstruct_domain_23.End, B=Slider(57, range=0..500))
addition_25 = Addition(A=deconstruct_domain_24.End, B=number_slider_59)  # disabled
addition_26 = Addition(A=deconstruct_domain_25.End, B=number_slider_60)  # disabled
addition_27 = Addition(A=deconstruct_domain_26.End, B=number_slider_61)  # disabled
addition_28 = Addition(A=deconstruct_domain_27.End, B=Slider(57, range=0..500))
addition_29 = Addition(A=deconstruct_domain_28.End, B=Slider(60, range=0..60))
addition_30 = Addition(A=deconstruct_domain_29.End, B=Slider(210, range=0..210))
addition_31 = Addition(A=deconstruct_domain_30.End, B=Slider(57, range=0..500))
# Margin :  Back 30
#                  Top  121
construct_domain_22 = ConstructDomain(DomainStart=deconstruct_domain_22.Start, DomainEnd=addition_23)  # disabled
construct_domain_23 = ConstructDomain(DomainStart=deconstruct_domain_23.Start, DomainEnd=addition_24)
# Margin :  Back 50
#                  Top  121
construct_domain_24 = ConstructDomain(DomainStart=deconstruct_domain_24.Start, DomainEnd=addition_25)  # disabled
# Margin :  Front 100
construct_domain_25 = ConstructDomain(DomainStart=deconstruct_domain_25.Start, DomainEnd=addition_26)  # disabled
# Margin :  Front 29
construct_domain_26 = ConstructDomain(DomainStart=deconstruct_domain_26.Start, DomainEnd=addition_27)  # disabled
# Margin :  Front 100
construct_domain_27 = ConstructDomain(DomainStart=deconstruct_domain_27.Start, DomainEnd=addition_28)
construct_domain_28 = ConstructDomain(DomainStart=deconstruct_domain_28.Start, DomainEnd=addition_29)
# Margin :  Front 60
# Margin :  Top 210
construct_domain_29 = ConstructDomain(DomainStart=deconstruct_domain_29.Start, DomainEnd=addition_30)
# Margin : 65
construct_domain_30 = ConstructDomain(DomainStart=deconstruct_domain_30.Start, DomainEnd=addition_31)
# Margin :  Front 80
#                 Left 55
#                 Top 135
#                 Bottom 72
panel_5 = Panel(construct_domain_22)  # disabled
panel_6 = Panel(construct_domain_23)
domain_box_12 = DomainBox(Base=multipurpose_table_for_2, X=deconstruct_box_19.X, Y=deconstruct_box_19.Y, Z=deconstruct_box_19.Z)  # disabled
domain_box_13 = DomainBox(Base=multipurpose_table_for_2, X=construct_domain_23, Y=deconstruct_box_18.Y, Z=deconstruct_box_18.Z)
panel_7 = Panel(construct_domain_24)  # disabled
domain_box_14 = DomainBox(Base=multipurpose_table_for_2, X=construct_domain_24, Y=Domain(-0.5, 0.5), Z=Domain(0, 0.25))  # disabled
panel_8 = Panel(construct_domain_25)  # disabled
domain_box_15 = DomainBox(Base=multipurpose_table_for_2, X=construct_domain_25, Y=Domain(-0.5, 0.5), Z=Domain(0, 0.25))  # disabled
panel_9 = Panel(construct_domain_26)  # disabled
domain_box_16 = DomainBox(Base=multipurpose_table_for_2, X=construct_domain_26, Y=Domain(-0.5, 0.5), Z=Domain(0, 0.25))  # disabled
panel_10 = Panel(construct_domain_27)
exterior_door_margin = DomainBox(Base=exterior_door, X=construct_domain_27, Y=deconstruct_box_21.Y, Z=deconstruct_box_21.Z)
change_over_zone_margin = DomainBox(Base=changeover_zone, X=deconstruct_box_22.X, Y=construct_domain_28, Z=construct_domain_29)
panel_11 = Panel(construct_domain_30)
panel_12 = Panel(construct_domain_29)
closet_margin = DomainBox(Base=closet, X=construct_domain_30, Y=deconstruct_box_23.Y, Z=deconstruct_box_23.Z)
panel_13 = Panel(construct_domain_28)
box = Box([sink_cupboard, domain_box_11])
box_2 = Box([sink_cupboard, domain_box_11])
number_slider_62 = Slider(1, range=0..1)  # disabled
number_slider_63 = Slider(1, range=0..1)  # disabled
number_slider_64 = Slider(1, range=0..1)  # disabled
number_slider_65 = Slider(1, range=0..1)  # disabled
number_slider_66 = Slider(1, range=0..1)  # disabled
box_3 = Box([box, box_2])
panel_14 = Panel(box_3)
custom_preview_materials_2 = CustomPreviewMaterials(Geometry=stove_margin, DiffuseColor=RGB(174, 215, 230), Transparency=number_slider_62)  # disabled
custom_preview_materials_3 = CustomPreviewMaterials(Geometry=microwave_margin, DiffuseColor=RGB(174, 215, 230), Transparency=number_slider_63)  # disabled
custom_preview_materials_4 = CustomPreviewMaterials(Geometry=fridge_margin, DiffuseColor=RGB(174, 215, 230), Transparency=number_slider_64)  # disabled
custom_preview_materials_5 = CustomPreviewMaterials(Geometry=cupboard_margin, DiffuseColor=RGB(174, 215, 230), Transparency=number_slider_65)  # disabled
custom_preview_materials_6 = CustomPreviewMaterials(Geometry=counter_margin, DiffuseColor=RGB(174, 215, 230), Transparency=number_slider_66)  # disabled

# ---- group: Voxel Initilize
bounding_box = BoundingBox(Content=sink_margin, Plane=PlaneXY(0, 0, 0))  # -> Box, Box_2; disabled
number_slider_67 = Slider(0.7, range=0..1)  # disabled
box_corners = BoxCorners(Box=bounding_box.Box)  # -> CornerA, CornerB, CornerC, CornerD, CornerE, CornerF, CornerG, CornerH; disabled
dimensions = Dimensions()  # -> UDimension, VDimension; disabled
custom_preview_materials_7 = CustomPreviewMaterials(Geometry=sink_margin, DiffuseColor=RGB(174, 215, 230), Transparency=number_slider_67)  # disabled
distance = Distance(PointA=box_corners.CornerA, PointB=box_corners.CornerB)  # disabled
distance_2 = Distance(PointA=box_corners.CornerA, PointB=box_corners.CornerD)  # disabled
distance_3 = Distance(PointA=box_corners.CornerA, PointB=box_corners.CornerD)  # disabled
number_slider_68 = Slider(91, range=0..10000)  # disabled
mesh = Mesh(sink_margin)  # disabled
populate_geometry = PopulateGeometry(Geometry=mesh, Count=number_slider_68, Seed=1)  # disabled
octree = OcTree(Points=populate_geometry, Square=False, Group=5)  # -> Boxes, Points; disabled

# ----
construct_domain_31 = ConstructDomain(DomainStart=0, DomainEnd=1)  # disabled
number_slider_69 = Slider(10, range=0..10)  # disabled
number_slider_70 = Slider(30, range=0..100)  # disabled
number_slider_71 = Slider(10, range=0..10)  # disabled
number_slider_72 = Slider(10, range=0..10)  # disabled
number_slider_73 = Slider(1, range=0..10)  # disabled
number_slider_74 = Slider(42, range=0..100)  # disabled
number_slider_75 = Slider(2, range=0..10)  # disabled
multiplication = Multiplication(A=number_slider_70, B=number_slider_69)  # disabled
multiplication_2 = Multiplication(A=number_slider_71, B=number_slider_73)  # disabled
multiplication_3 = Multiplication(A=number_slider_74, B=number_slider_72)  # disabled
c_script = CSharpScript(width=number_slider_74, length=number_slider_70, cellSize=multiplication_2)  # -> out, A, R, G, B, Y, K, W; inputs width: Int32, length: Int32, height: Int32, cellSize: Int32; disabled
# ---------- c_script: C# ----------
    var WhiteCircles = new List<Circle>();
    /*public Zone(int spaceLimit,int spacesize,int counter, List<int> spaceList)*/

    var kitchen = new Zone
      {
        SpaceLimit = 20,
        SpaceSize = 300,
        Counter = 1,
        Id = 1
        };

    var wetArea = new Zone
      {
        SpaceLimit = 20,
        SpaceSize = 300,
        Counter = 1,
        Id = 2
        };

    var commonArea = new Zone
      {
        SpaceLimit = 20,
        SpaceSize = 300,
        Counter = 1,
        Id = 3
        };

    var entrance = new Zone
      {
        SpaceLimit = 20,
        SpaceSize = 300,
        Counter = 1,
        Id = 4
        };

    var personalSpace = new Zone
      {
        SpaceLimit = 20,
        SpaceSize = 300,
        Counter = 1 ,
        Id = 5
        };

    int[,,] areaArray = InitializeZeroMatrice(length, width);

    entrance.StartColors(areaArray);
    wetArea.StartColors(areaArray);
    personalSpace.StartColors(areaArray);
    kitchen.StartColors(areaArray);
    commonArea.StartColors(areaArray);

    for(int i = 0; i < 500; i++)
    {
      entrance.SpreadZone(areaArray, entrance.SpaceSize, entrance.SpaceList, ref entrance.Counter, entrance.SpaceLimit);
      wetArea.SpreadZone(areaArray, wetArea.SpaceSize, wetArea.SpaceList, ref  wetArea.Counter, wetArea.SpaceLimit);
      personalSpace.SpreadZone(areaArray, personalSpace.SpaceSize, personalSpace.SpaceList, ref personalSpace.Counter, personalSpace.SpaceLimit);
      kitchen.SpreadZone(areaArray, kitchen.SpaceSize, kitchen.SpaceList, ref kitchen.Counter, kitchen.SpaceLimit);
      commonArea.SpreadZone(areaArray, commonArea.SpaceSize, commonArea.SpaceList, ref commonArea.Counter, commonArea.SpaceLimit);
    }

    //Zone.ShowMatrix(areaArray);


    double radius = cellSize / 2;
    for (int i = 0;i < areaArray.GetLength(0) ;i++)
    {
      for (int j = 0;j < areaArray.GetLength(1);j++)
      {
        for (int k = 0;k < areaArray.GetLength(2);k++)
        {
          if (areaArray[i, j, k] == 1)
          {
            Point3d center = new Point3d(j * cellSize, i * cellSize, 0);
            Circle c = new Circle(center, radius);
            entrance.Circles.Add(c);
          }
          if (areaArray[i, j, k] == 2)
          {
            Point3d center = new Point3d(j * cellSize, i * cellSize, 0);
            Circle c = new Circle(center, radius);
            wetArea.Circles.Add(c);
          }
          if (areaArray[i, j, k] == 3)
          {
            Point3d center = new Point3d(j * cellSize, i * cellSize, 0);
            Circle c = new Circle(center, radius);
            personalSpace.Circles.Add(c);
          }
          if (areaArray[i, j, k] == 4)
          {
            Point3d center = new Point3d(j * cellSize, i * cellSize, 0);
            Circle c = new Circle(center, radius);
            kitchen.Circles.Add(c);
          }
          if (areaArray[i, j, k] == 5)
          {
            Point3d center = new Point3d(j * cellSize, i * cellSize, 0);
            Circle c = new Circle(center, radius);
            commonArea.Circles.Add(c);
          }

          if (areaArray[i, j, k] == 0)
          {
            Point3d center = new Point3d(j * cellSize, i * cellSize, 0);
            Circle c = new Circle(center, radius);
            WhiteCircles.Add(c);
          }
        }
      }
    }

    A = areaArray;
    R = entrance.Circles;
    G = wetArea.Circles;
    B = personalSpace.Circles;
    Y = kitchen.Circles;
    K = commonArea.Circles;
    W = WhiteCircles;
# ---------- c_script: C# additional code ----------
  /* The Color lists keep the colors in a seperate List in order to choose within them easily instead of searching where they are... */

  static int[,,] InitializeZeroMatrice(int width, int length)
  {
    var areaArray = new int[width, length, 3];

    for (int i = 0; i < width; i++)
    {
      for (int j = 0; j < length; j++)
      {
        for (int k = 0; k < 3; k++)
        {
          areaArray[i, j, k] = 0;
        }
      }
    }
    return areaArray;
  }

  /* Calculates the distance between initial point in the color and the possible new point!
   *  (if the possible new point is too far from inital point eleminate it.) */


  static void Evaluate()
  {
    // according to relations give score to the created zones
    // get the centers of the zones and acoording to the distances and created sizes give
    //positive or negative points and if score is not acceptable re-run and create variatians.
  }


    /* Instead of wrting methods seperately in main program, it is better to use class based
     informations to keep things organized, we are not yet transsferred methods here but we created the str.*/


  public class Zone
  {
    public int SpaceLimit;
    public int SpaceSize;
    public int Counter;
    public int Id;
    public List<int> SpaceList;
    public List<Circle> Circles = new List<Circle>();

    public Zone() // Constructor method
    {
      SpaceList = new List<int>();
      Circles = new List<Circle>();
    }

    public Zone(int spaceLimit, int spacesize, int counter, int id)
      :this()
    {
      this.SpaceLimit = spaceLimit;
      this.Counter = counter;
      this.SpaceSize = spacesize;
      this.Id = id;
    }

    static void ShowMatrix(int[,,] Arr)
    {
      ////Print("");
      for (int i = 0; i < Arr.GetLength(0); i++)
      {
        for (int j = 0; j < Arr.GetLength(1); j++)
        {
          ////Print(Arr[i, j].ToString() + " ");
        }
        ////Print("");
      }
      ////Print("   ");
      return;
    }

    static double distanceCalculate(List<int> spaceCoordList, int x2, int y2)
    {
      var distance = Math.Sqrt((y2 - spaceCoordList[1]) * (y2 - spaceCoordList[1]) + (x2 - spaceCoordList[0]) * (x2 - spaceCoordList[0]));
      return distance;
    }

    public void StartColors(int[,,] arr)
    {

      /**
       * Randomly Starts the color. Takes the Color lists as argumnts
       * (We can delete these argumnents and it can get them as local referance
       * in our case it gives us a chance to choose what to initilize)
       * **/

      Random rand = new Random();
      //----------------------
      /* GetLength(0) and GetLength(1) might be set as variable */
      var a = rand.Next(0, arr.GetLength(0)); //Array.GetLength(0) gives the column lenght in other words length of an array
      var b = rand.Next(0, arr.GetLength(1)); //Array.GetLength(1) gives the row lenght in other words width of an array

      this.SpaceList.AddRange(new int[2] { a, b }); //AddRange ==> Adds multiple elements to a List . We use mod%2 to call the index of the point back instead of stacking them as an another List(or Array) in our list.
      arr[a, b, 0] = this.Id;//  Starting Point
    }

    public void SpreadZone(int[,,] arr, int spaceSize, List<int> spaceCoordList, ref int counter, int spaceLimit)
    {
              /*ARGUMENTS
           * The main array which has rectangular form(will be 3d in short) ,
           * spaceSize = Maximum limit that can grow.  ,
           * spaceCoordList =  the cells of the zone which has been already defined. )
           */
      var rand = new Random();
      var directionList = new List<int>();
      int Xcoord;
      int Ycoord;
      bool draw = false;
      int trycount = 0;

      while (draw == false && counter <= spaceSize)
      {
        if (counter <= spaceSize) //Can be deleted. The condition is added to the While Loop Conditions.
        {
          ////Print("Counter Number is : {0}\n", counter);
          ////Print("Element number of the list {0}", spaceCoordList.Count / 2);
          var randomCellIndex = rand.Next(spaceCoordList.Count / 2);

          Xcoord = spaceCoordList[2 * randomCellIndex];
          Ycoord = spaceCoordList[2 * randomCellIndex + 1];

          //Print("Coordinates if the new Cell is = {0}, {1}\n", Xcoord, Ycoord);

          if (Xcoord < arr.GetLength(0) - 1 && Xcoord > 0 && Ycoord > 0 && Ycoord < arr.GetLength(1) - 1)
          {
            /* Check the conditions INSIDE borders */
            if (arr[Xcoord + 1, Ycoord, 0] == 0 && distanceCalculate(spaceCoordList, Xcoord + 1, Ycoord) < spaceLimit ) // Check if possible new cell is still white or not!
              directionList.AddRange(new int[2] { (Xcoord + 1), Ycoord }); //Store possible spread directions in a list.

            if (arr[Xcoord - 1, Ycoord, 0] == 0 && distanceCalculate(spaceCoordList, Xcoord - 1, Ycoord) < spaceLimit)
              directionList.AddRange(new int[2] { (Xcoord - 1), Ycoord }); //Store possible spread directions in a list.

            if (arr[Xcoord, Ycoord + 1, 0] == 0 && distanceCalculate(spaceCoordList, Xcoord, Ycoord + 1) < spaceLimit)
              directionList.AddRange(new int[2] { (Xcoord), Ycoord + 1 }); //Store possible spread directions in a list.

            if (arr[Xcoord, Ycoord - 1, 0] == 0 && distanceCalculate(spaceCoordList, Xcoord, Ycoord - 1) < spaceLimit)
              directionList.AddRange(new int[2] { (Xcoord), (Ycoord - 1) }); //Store possible spread directions in a list.

            if (directionList.Count > 0)
            {
              var randomIndex = rand.Next(directionList.Count / 2);

              int a = directionList[2 * randomIndex];
              int b = directionList[2 * randomIndex + 1];
              //print("Value of Xcoord and Ycoord: {0}, {1}", Xcoord, Ycoord);
              //Print("Value of new Coordinates: {0}, {1}", a, b);
              //Print("Value of initial value of Array[a, b]: {0}", arr[a, b]);

              arr[a, b, 0] = arr[Xcoord, Ycoord, 0];
              //Print("Value of new Array[a, b]: {0}", arr[a, b]);

              spaceCoordList.AddRange(new int[2] { a, b });

              directionList.Clear();
              directionList.TrimExcess();
              draw = true;
              counter++;
            }
            else
            {
              trycount++;
              if (trycount >= spaceCoordList.Count)
              {
                draw = true;
                //Print("trycountNumber is ={0}", trycount);
              }
            }
          }
            /* EDGE CONDITIONS */
            //BOTTOM
          else if (Xcoord == (arr.GetLength(0) - 1) && Ycoord != 0 && Ycoord != (arr.GetLength(1) - 1))
          {
            if (arr[Xcoord - 1, Ycoord, 0] == 0)
            {
              arr[Xcoord - 1, Ycoord, 0] = arr[Xcoord, Ycoord, 0];

              int a = Xcoord - 1;
              int b = Ycoord;

              spaceCoordList.AddRange(new int[2] { a, b });

              draw = true;
              counter++;
              //Print(" Counter Number is : {0}", counter);
            }
          }
            //TOP
          else if (Xcoord == 0 && Ycoord != 0 && Ycoord != (arr.GetLength(1) - 1))
          {
            if (arr[Xcoord + 1, Ycoord, 0] == 0)
            {
              arr[Xcoord + 1, Ycoord, 0] = arr[Xcoord, Ycoord, 0];

              int a = Xcoord + 1;
              int b = Ycoord;

              spaceCoordList.AddRange(new int[2] { a, b });

              draw = true;
              counter++;
              //Print(" Counter Number is : {0}", counter);
            }
          }
            //RIGHT
          else if ((Ycoord == arr.GetLength(1) - 1) && Xcoord != 0 && Xcoord != (arr.GetLength(0) - 1))
          {
            if (arr[Xcoord, Ycoord - 1, 0] == 0)
            {
              arr[Xcoord, Ycoord - 1, 0] = arr[Xcoord, Ycoord, 0];

              int a = Xcoord;
              int b = Ycoord - 1;

              spaceCoordList.AddRange(new int[2] { a, b });

              draw = true;
              counter++;
              //Print(" Counter Number is : {0}", counter);
            }
          }
            //LEFT
          else if (Ycoord == 0 && Xcoord != 0 && Xcoord != (arr.GetLength(0) - 1))
          {
            if (arr[Xcoord, Ycoord + 1, 0] == 0)
            {
              arr[Xcoord, Ycoord + 1, 0] = arr[Xcoord, Ycoord, 0];

              int a = Xcoord;
              int b = Ycoord + 1;

              arr[Xcoord, Ycoord + 1, 0] = arr[Xcoord, Ycoord, 0];

              spaceCoordList.AddRange(new int[2] { a, b });

              draw = true;
              counter++;
              //Print(" Counter Number is : {0}", counter);
            }
          }

            //LEFT TOP
          else if (Xcoord == 0 && Ycoord == 0)
          {
            if (arr[Xcoord, Ycoord + 1, 0] == 0)
              directionList.Add(Xcoord); directionList.Add(Ycoord + 1);

            if (arr[Xcoord + 1, Ycoord, 0] == 0)
              directionList.Add(Xcoord + 1); directionList.Add(Ycoord);

            if (directionList.Count > 0)
            {
              var randomIndex = rand.Next(directionList.Count / 2);

              int a = directionList[2 * randomIndex];
              int b = directionList[2 * randomIndex + 1];

              arr[a, b, 0] = arr[Xcoord, Ycoord, 0];

              spaceCoordList.AddRange(new int[2] { a, b });

              directionList.Clear();
              directionList.TrimExcess();
              draw = true;

              counter++;
              //Print(" Counter Number is : {0}", counter);
            }
          }
            //RIGHT TOP
          else if (Xcoord == 0 && Ycoord == (arr.GetLength(1) - 1))
          {
            if (arr[Xcoord + 1, Ycoord, 0] == 0)
              directionList.Add(Xcoord + 1); directionList.Add(Ycoord);

            if (arr[Xcoord, Ycoord - 1, 0] == 0)
              directionList.Add(Xcoord); directionList.Add(Ycoord - 1);

            if (directionList.Count > 0)
            {
              var randomIndex = rand.Next(directionList.Count / 2);

              int a = directionList[2 * randomIndex];
              int b = directionList[2 * randomIndex + 1];

              arr[a, b, 0] = arr[Xcoord, Ycoord, 0];

              spaceCoordList.AddRange(new int[2] { a, b });

              directionList.Clear();
              directionList.TrimExcess();

              draw = true;
              counter++;
              //Print(" Counter Number is : {0}", counter);
            }
          }
            //RIGHT BOTTOM
          else if (Xcoord == (arr.GetLength(0) - 1) && Ycoord == (arr.GetLength(1) - 1))
          {
            if (arr[Xcoord, Ycoord - 1, 0] == 0)
              directionList.Add(Xcoord); directionList.Add(Ycoord - 1);

            if (arr[Xcoord - 1, Ycoord, 0] == 0)
              directionList.Add(Xcoord - 1); directionList.Add(Ycoord);

            if (directionList.Count > 0)
            {
              var randomIndex = rand.Next(directionList.Count / 2);

              int a = directionList[2 * randomIndex];
              int b = directionList[2 * randomIndex + 1];

              arr[a, b, 0] = arr[Xcoord, Ycoord, 0];

              spaceCoordList.AddRange(new int[2] { a, b });

              directionList.Clear();
              directionList.TrimExcess();

              draw = true;
              counter++;
              //Print(" Counter Number is : {0}", counter);
            }
          }
            //LEFT BOTTOM
          else if (Xcoord == (arr.GetLength(1) - 1) && Ycoord == 0)
          {
            if (arr[Xcoord, Ycoord + 1, 0] == 0)
              directionList.Add(Xcoord); directionList.Add(Ycoord - 1);

            if (arr[Xcoord - 1, Ycoord, 0] == 0)
              directionList.Add(Xcoord - 1 - 1); directionList.Add(Ycoord);

            if (directionList.Count > 0)
            {
              var randomIndex = rand.Next(directionList.Count / 2);

              int a = directionList[2 * randomIndex];
              int b = directionList[2 * randomIndex + 1];

              arr[a, b, 0] = arr[Xcoord, Ycoord, 0];

              spaceCoordList.AddRange(new int[2] { a, b });

              directionList.Clear();
              directionList.TrimExcess();

              draw = true;
              counter++;
              //Print(" Counter Number is : {0}", counter);
            }
          }
          /* EDGE CONDITIONS */
        }
      }
    }
  }
# ---------- end c_script ----------
division = Division(A=multiplication_2, B=number_slider_75)  # disabled
panel_15 = Panel(c_script.out)  # disabled

# ---- group: Visualize as 3D Boxes
center_box = CenterBox(Base=c_script.W, X=division, Y=division, Z=division)  # disabled
center_box_2 = CenterBox(Base=c_script.G, X=division, Y=division, Z=division)  # disabled
center_box_3 = CenterBox(Base=c_script.K, X=division, Y=division, Z=division)  # disabled
center_box_4 = CenterBox(Base=c_script.B, X=division, Y=division, Z=division)  # disabled
center_box_5 = CenterBox(Base=c_script.Y, X=division, Y=division, Z=division)  # disabled
center_box_6 = CenterBox(Base=c_script.R, X=division, Y=division, Z=division)  # disabled
number_slider_76 = Slider(0.2, range=0..1)  # disabled
colour_picker = ColourPicker(PickedColour=RGB(255, 0, 0))  # disabled
colour_picker_2 = ColourPicker(PickedColour=RGB(255, 255, 255))  # disabled
colour_picker_3 = ColourPicker(PickedColour=RGB(0, 255, 255))  # disabled
colour_picker_4 = ColourPicker(PickedColour=RGB(0, 255, 0))  # disabled
colour_picker_5 = ColourPicker(PickedColour=RGB(255, 255, 0))  # disabled
colour_picker_6 = ColourPicker(PickedColour=RGB(0, 0, 0))  # disabled
create_material = CreateMaterial(Diffuse=colour_picker, Specular=RGB(255, 255, 255), Emission=RGB(0, 0, 0), Transparency=number_slider_76, Shine=0)  # disabled
create_material_2 = CreateMaterial(Diffuse=colour_picker_4, Specular=RGB(255, 255, 255), Emission=RGB(0, 0, 0), Transparency=number_slider_76, Shine=0)  # disabled
create_material_3 = CreateMaterial(Diffuse=colour_picker_2, Specular=RGB(255, 255, 255), Emission=RGB(0, 0, 0), Transparency=number_slider_76, Shine=0)  # disabled
create_material_4 = CreateMaterial(Diffuse=colour_picker_3, Specular=RGB(255, 255, 255), Emission=RGB(0, 0, 0), Transparency=number_slider_76, Shine=0)  # disabled
create_material_5 = CreateMaterial(Diffuse=colour_picker_5, Specular=RGB(255, 255, 255), Emission=RGB(0, 0, 0), Transparency=number_slider_76, Shine=0)  # disabled
create_material_6 = CreateMaterial(Diffuse=colour_picker_6, Specular=RGB(255, 255, 255), Emission=RGB(0, 0, 0), Transparency=number_slider_76, Shine=0)  # disabled
custom_preview = CustomPreview(Geometry=center_box_6, Material=create_material)  # disabled
custom_preview_2 = CustomPreview(Geometry=center_box, Material=create_material_3)  # disabled
custom_preview_3 = CustomPreview(Geometry=center_box_4, Material=create_material_4)  # disabled
custom_preview_4 = CustomPreview(Geometry=center_box_2, Material=create_material_2)  # disabled
custom_preview_5 = CustomPreview(Geometry=center_box_5, Material=create_material_5)  # disabled
custom_preview_6 = CustomPreview(Geometry=center_box_3, Material=create_material_6)  # disabled

# ----
deconstruct_box_24 = DeconstructBox(Box=domain_box_11)  # -> Plane, X, Y, Z
panel_16 = Panel(deconstruct_box_24.Y)
panel_17 = Panel(deconstruct_box_24.Z)
panel_18 = Panel(deconstruct_box_24.X)
number_slider_77 = Slider(10, range=0..10)
number_slider_78 = Slider(10, range=0..50)  # disabled
number_slider_79 = Slider(12, range=0..100)  # disabled
number_slider_80 = Slider(27, range=0..100)  # disabled
number_slider_81 = Slider(2, range=0..10)  # disabled
deconstruct_domain_31 = DeconstructDomain(Domain=panel_16)  # -> Start, End
deconstruct_domain_32 = DeconstructDomain(Domain=panel_18)  # -> Start, End
deconstruct_domain_33 = DeconstructDomain(Domain=panel_17)  # -> Start, End
c_script_2 = CSharpScript(Width=number_slider_80, Length=number_slider_79, cellSize=number_slider_78)  # -> out, A, R, G, B, Y, K, W; inputs Width: Int32, Length: Int32, height: Int32, cellSize: Int32; disabled
# ---------- c_script_2: C# ----------
    List<Circle> entranceCircles = new List<Circle>();
    List<Circle> wetAreaCircles = new List<Circle>();
    List<Circle> personalSpaceCircles = new List<Circle>();
    List<Circle> kitchenCircles = new List<Circle>();
    List<Circle> commonAreaCircles = new List<Circle>();
    List<Circle> WhiteCircles = new List<Circle>();

    int width = Width;        
    int length = Length;

    int[,] areaArray = InitializeZeroMatrice(length, width);
    StartColors(areaArray);

    for (int i = 0; i < 500; i++)
    {
      Spread(areaArray, ref entranceSize, entranceList, ref entranceCounter, entranceLimit);
      Spread(areaArray, ref personalSpaceSize, personalSpaceList, ref personalSpaceCounter, personalSpaceLimit);
      Spread(areaArray, ref wetAreaSize, wetAreaList, ref wetAreaCounter, wetAreaLimit);
      Spread(areaArray, ref kitchenSize, kitchenList, ref kitchenCounter, kitchenLimit);
      Spread(areaArray, ref commonAreaSize, commonAreaList, ref commonAreaCounter, commonAreaLimit);
    }
    double radius = cellSize / 2;


    for (int i = 0;i < length;i++)
    {
      for (int j = 0;j < width;j++)
      {
        if (areaArray[i, j] == 1)
        {
          Point3d center = new Point3d(j * cellSize, i * cellSize, 0);
          Circle c = new Circle(center, radius);
          entranceCircles.Add(c);
        }
        if (areaArray[i, j] == 2)
        {
          Point3d center = new Point3d(j * cellSize, i * cellSize, 0);
          Circle c = new Circle(center, radius);
          personalSpaceCircles.Add(c);
        }
        if (areaArray[i, j] == 3)
        {
          Point3d center = new Point3d(j * cellSize, i * cellSize, 0);
          Circle c = new Circle(center, radius);
          wetAreaCircles.Add(c);
        }
        if (areaArray[i, j] == 4)
        {
          Point3d center = new Point3d(j * cellSize, i * cellSize, 0);
          Circle c = new Circle(center, radius);
          kitchenCircles.Add(c);
        }
        if (areaArray[i, j] == 5)
        {
          Point3d center = new Point3d(j * cellSize, i * cellSize, 0);
          Circle c = new Circle(center, radius);
          commonAreaCircles.Add(c);
        }

        if (areaArray[i, j] == 0)
        {
          Point3d center = new Point3d(j * cellSize, i * cellSize, 0);
          Circle c = new Circle(center, radius);
          WhiteCircles.Add(c);
        }
      }
    }

    ShowMatrix(areaArray);
    A = areaArray;
    R = entranceCircles;
    G = personalSpaceCircles;
    B = wetAreaCircles;
    Y = kitchenCircles;
    K = commonAreaCircles;
    W = WhiteCircles;
# ---------- c_script_2: C# additional code ----------
  static void ShowMatrix(int[,] Arr)
  {
    ////Print("");
    for (int i = 0; i < Arr.GetLength(0); i++)
    {
      for (int j = 0; j < Arr.GetLength(1); j++)
      {
        ////Print(Arr[i, j].ToString() + " ");
      }
      ////Print("");
    }
    ////Print("   ");
    return;
  }
  static int[,] InitializeZeroMatrice(int width, int length)
  {
    var areaArray = new int[width, length];

    for (int i = 0; i < width; i++)
    {
      for (int j = 0; j < length; j++)
      {
        areaArray[i, j] = 0;
      }
    }
    return areaArray;
  }

  /* The Color lists keep the colors in a seperate List in order to choose within them easily instead of searching where they are... */
  static List<int> entranceList = new List<int>();
  static List<int> personalSpaceList = new List<int>();
  static List<int> wetAreaList = new List<int>();
  static List<int> kitchenList = new List<int>();
  static List<int> commonAreaList = new List<int>();
  /**           These sizes are Spreading Limits for the spaces   //total cells           **/

  static int entranceSize = 230;
  static int personalSpaceSize = 300;
  static int wetAreaSize = 250;
  static int kitchenSize = 500;
  static int commonAreaSize = 1000;
  /**           these counters are used for starting the límitations counts.         **/

  static int entranceCounter = 1;
  static int personalSpaceCounter = 1;
  static int wetAreaCounter = 1;
  static int kitchenCounter = 1;
  static int commonAreaCounter = 1;
  /**           these limits are used for defining max distance that zone can spread.  **/

  static int entranceLimit = 10;
  static int personalSpaceLimit = 15;
  static int wetAreaLimit = 15;
  static int kitchenLimit = 20;
  static int commonAreaLimit = 30;

  static void StartColors(int[,] arr)
  {

            /**
             * Randomly Starts the color. Takes the Color lists as argumnts
             * (We can delete these argumnents and it can get them as local referance
             * in our case it gives us a chance to choose what to initilize)
             * **/

    Random rand = new Random();
    //----------------------
    /* GetLength(0) and GetLength(1) might be set as variable */
    //Array.GetLength(0) gives the column lenght in other words length of an array
    //Array.GetLength(1) gives the row lenght in other words width of an array
    var a = rand.Next(arr.GetLength(0) / 2, arr.GetLength(0) / 2);
    var b = rand.Next(0, 2);

    entranceList.AddRange(new int[2] { a, b }); //AddRange ==> Adds multiple elements to a List . We use mod%2 to call the index of the point back instead of stacking them as an another List(or Array) in our list.
    arr[a, b] = 1;// entrance Starting Point
    //----------------------

    b = rand.Next(0, arr.GetLength(1));
    a = rand.Next(0, arr.GetLength(0));

    personalSpaceList.AddRange(new int[2] { a, b });
    arr[a, b] = 2; // personalSpace Starting Point
    //----------------------
    a = rand.Next(0, arr.GetLength(0));
    b = rand.Next(0, arr.GetLength(1));

    wetAreaList.AddRange(new int[2] { a, b });
    arr[a, b] = 3; // wetArea Starting Point
    //----------------------
    a = rand.Next(0, arr.GetLength(0));
    b = rand.Next(0, arr.GetLength(1));

    kitchenList.AddRange(new int[2] { a, b });
    arr[a, b] = 4; // kitchen Starting Point
    //----------------------
    a = rand.Next(0, arr.GetLength(0));
    b = rand.Next(0, arr.GetLength(1));

    commonAreaList.AddRange(new int[2] { a, b });
    arr[a, b] = 5; // commonArea Starting Point
    //----------------------
  }
        /* Calculates the distance between initial point in the color and the possible new point!
         *  (if the possible new point is too far from inital point eleminate it.) */
  static double distanceCalculate(List<int> spaceCoordList, int x2, int y2)
  {
    var distance = Math.Sqrt((y2 - spaceCoordList[1]) * (y2 - spaceCoordList[1]) + (x2 - spaceCoordList[0]) * (x2 - spaceCoordList[0]));
    return distance;
  }

  static void Evaluate()
  {
    // according to relations give score to the created zones
    // get the centers of the zones and acoording to the distances and created sizes give
    //positive or negative points and if score is not acceptable re-run and create variatians.
  }

  static void Spread(int[,] arr, ref int spaceSize, List<int> spaceCoordList, ref int counter, int spaceLimit)
  {
                /*ARGUMENTS
             * The main array which has rectangular form(will be 3d in short) ,
             * spaceSize = Maximum limit that can grow.  ,
             * spaceCoordList =  the cells of the zone which has been already defined. )
             */
    var rand = new Random();
    var directionList = new List<int>();
    int Xcoord;
    int Ycoord;
    bool draw = false;
    int trycount = 0;

    while (draw == false && counter <= spaceSize)
    {
      if (counter <= spaceSize) //Can be deleted. The condition is added to the While Loop Conditions.
      {
        ////Print("Counter Number is : {0}\n", counter);
        ////Print("Element number of the list {0}", spaceCoordList.Count / 2);
        var randomCellIndex = rand.Next(spaceCoordList.Count / 2);

        Xcoord = spaceCoordList[2 * randomCellIndex];
        Ycoord = spaceCoordList[2 * randomCellIndex + 1];

        //Print("Coordinates if the new Cell is = {0}, {1}\n", Xcoord, Ycoord);

        if (Xcoord < arr.GetLength(0) - 1 && Xcoord > 0 && Ycoord > 0 && Ycoord < arr.GetLength(1) - 1)
        {
          /* Check the conditions INSIDE borders */
          if (arr[Xcoord + 1, Ycoord] == 0 && distanceCalculate(spaceCoordList, Xcoord + 1, Ycoord) < spaceLimit ) // Check if possible new cell is still white or not!
            directionList.AddRange(new int[2] { (Xcoord + 1), Ycoord }); //Store possible spread directions in a list.

          if (arr[Xcoord - 1, Ycoord] == 0 && distanceCalculate(spaceCoordList, Xcoord - 1, Ycoord) < spaceLimit)
            directionList.AddRange(new int[2] { (Xcoord - 1), Ycoord }); //Store possible spread directions in a list.

          if (arr[Xcoord, Ycoord + 1] == 0 && distanceCalculate(spaceCoordList, Xcoord, Ycoord + 1) < spaceLimit)
            directionList.AddRange(new int[2] { (Xcoord), Ycoord + 1 }); //Store possible spread directions in a list.

          if (arr[Xcoord, Ycoord - 1] == 0 && distanceCalculate(spaceCoordList, Xcoord, Ycoord - 1) < spaceLimit)
            directionList.AddRange(new int[2] { (Xcoord), (Ycoord - 1) }); //Store possible spread directions in a list.

          if (directionList.Count > 0)
          {
            var randomIndex = rand.Next(directionList.Count / 2);

            int a = directionList[2 * randomIndex];
            int b = directionList[2 * randomIndex + 1];
            //Print("Value of Xcoord and Ycoord: {0}, {1}", Xcoord, Ycoord);
            //Print("Value of new Coordinates: {0}, {1}", a, b);
            //Print("Value of initial value of Array[a, b]: {0}", arr[a, b]);


            arr[a, b] = arr[Xcoord, Ycoord];
            //Print("Value of new Array[a, b]: {0}", arr[a, b]);

            spaceCoordList.AddRange(new int[2] { a, b });

            directionList.Clear();
            directionList.TrimExcess();
            draw = true;
            counter++;
          }
          else
          {
            trycount++;
            if (trycount >= spaceCoordList.Count)
            {
              draw = true;
              //Print("trycountNumber is ={0}", trycount);
            }

          }
        }

          /* EDGE CONDITIONS */

          //BOTTOM
        else if (Xcoord == (arr.GetLength(0) - 1) && Ycoord != 0 && Ycoord != (arr.GetLength(1) - 1))
        {
          if (arr[Xcoord - 1, Ycoord] == 0)
          {
            arr[Xcoord - 1, Ycoord] = arr[Xcoord, Ycoord];

            int a = Xcoord - 1;
            int b = Ycoord;

            spaceCoordList.AddRange(new int[2] { a, b });

            draw = true;
            counter++;
            //Print(" Counter Number is : {0}", counter);
          }
        }
          //TOP
        else if (Xcoord == 0 && Ycoord != 0 && Ycoord != (arr.GetLength(1) - 1))
        {
          if (arr[Xcoord + 1, Ycoord] == 0)
          {
            arr[Xcoord + 1, Ycoord] = arr[Xcoord, Ycoord];

            int a = Xcoord + 1;
            int b = Ycoord;

            spaceCoordList.AddRange(new int[2] { a, b });

            draw = true;
            counter++;
            //Print(" Counter Number is : {0}", counter);
          }
        }
          //RIGHT
        else if ((Ycoord == arr.GetLength(1) - 1) && Xcoord != 0 && Xcoord != (arr.GetLength(0) - 1))
        {
          if (arr[Xcoord, Ycoord - 1] == 0)
          {
            arr[Xcoord, Ycoord - 1] = arr[Xcoord, Ycoord];

            int a = Xcoord;
            int b = Ycoord - 1;

            spaceCoordList.AddRange(new int[2] { a, b });

            draw = true;
            counter++;
            //Print(" Counter Number is : {0}", counter);
          }
        }
          //LEFT
        else if (Ycoord == 0 && Xcoord != 0 && Xcoord != (arr.GetLength(0) - 1))
        {
          if (arr[Xcoord, Ycoord + 1] == 0)
          {
            arr[Xcoord, Ycoord + 1] = arr[Xcoord, Ycoord];

            int a = Xcoord;
            int b = Ycoord + 1;

            arr[Xcoord, Ycoord + 1] = arr[Xcoord, Ycoord];

            spaceCoordList.AddRange(new int[2] { a, b });

            draw = true;
            counter++;
            //Print(" Counter Number is : {0}", counter);
          }
        }

          //LEFT TOP
        else if (Xcoord == 0 && Ycoord == 0)
        {
          if (arr[Xcoord, Ycoord + 1] == 0)
            directionList.Add(Xcoord); directionList.Add(Ycoord + 1);

          if (arr[Xcoord + 1, Ycoord] == 0)
            directionList.Add(Xcoord + 1); directionList.Add(Ycoord);

          if (directionList.Count > 0)
          {
            var randomIndex = rand.Next(directionList.Count / 2);

            int a = directionList[2 * randomIndex];
            int b = directionList[2 * randomIndex + 1];

            arr[a, b] = arr[Xcoord, Ycoord];

            spaceCoordList.AddRange(new int[2] { a, b });

            directionList.Clear();
            directionList.TrimExcess();
            draw = true;

            counter++;
            //Print(" Counter Number is : {0}", counter);
          }
        }
          //RIGHT TOP
        else if (Xcoord == 0 && Ycoord == (arr.GetLength(1) - 1))
        {
          if (arr[Xcoord + 1, Ycoord] == 0)
            directionList.Add(Xcoord + 1); directionList.Add(Ycoord);

          if (arr[Xcoord, Ycoord - 1] == 0)
            directionList.Add(Xcoord); directionList.Add(Ycoord - 1);

          if (directionList.Count > 0)
          {
            var randomIndex = rand.Next(directionList.Count / 2);

            int a = directionList[2 * randomIndex];
            int b = directionList[2 * randomIndex + 1];

            arr[a, b] = arr[Xcoord, Ycoord];

            spaceCoordList.AddRange(new int[2] { a, b });

            directionList.Clear();
            directionList.TrimExcess();

            draw = true;
            counter++;
            //Print(" Counter Number is : {0}", counter);
          }
        }
          //RIGHT BOTTOM
        else if (Xcoord == (arr.GetLength(0) - 1) && Ycoord == (arr.GetLength(1) - 1))
        {
          if (arr[Xcoord, Ycoord - 1] == 0)
            directionList.Add(Xcoord); directionList.Add(Ycoord - 1);

          if (arr[Xcoord - 1, Ycoord] == 0)
            directionList.Add(Xcoord - 1); directionList.Add(Ycoord);

          if (directionList.Count > 0)
          {
            var randomIndex = rand.Next(directionList.Count / 2);

            int a = directionList[2 * randomIndex];
            int b = directionList[2 * randomIndex + 1];

            arr[a, b] = arr[Xcoord, Ycoord];

            spaceCoordList.AddRange(new int[2] { a, b });

            directionList.Clear();
            directionList.TrimExcess();

            draw = true;
            counter++;
            //Print(" Counter Number is : {0}", counter);
          }
        }
          //LEFT BOTTOM
        else if (Xcoord == (arr.GetLength(1) - 1) && Ycoord == 0)
        {
          if (arr[Xcoord, Ycoord + 1] == 0)
            directionList.Add(Xcoord); directionList.Add(Ycoord - 1);

          if (arr[Xcoord - 1, Ycoord] == 0)
            directionList.Add(Xcoord - 1 - 1); directionList.Add(Ycoord);

          if (directionList.Count > 0)
          {
            var randomIndex = rand.Next(directionList.Count / 2);

            int a = directionList[2 * randomIndex];
            int b = directionList[2 * randomIndex + 1];

            arr[a, b] = arr[Xcoord, Ycoord];

            spaceCoordList.AddRange(new int[2] { a, b });

            directionList.Clear();
            directionList.TrimExcess();

            draw = true;
            counter++;
            //Print(" Counter Number is : {0}", counter);
          }
        }
        /* EDGE CONDITIONS */
      }
    }

  }


    /* Instead of wrting methods seperately in main program, it is better to use class based
     informations to keep things organized, we are not yet transsferentrance methods here but we created the str.*/

    /*
    public class Zone
    {
        public string Name;
        public int SpaceLimit;
        public Int16 SpaceSize;
        public int Counter;
        public List<Int16> SpaceList;

        public void Describe()
        {
            Console.WriteLine("Hey this zone is{ 0} ", Name);
        }

        public Zone()
        {
           // SpaceList = new List<int>();
        }

        public Zone(string name, int spaceLimit,int spacesize,int counter, List<int> SpaceList)
        :this()
        {

        }

        static void InitializeZeroMatrice() { }
        static void startZones() { }
        public void SpreadZones() { }

    }
    */
# ---------- end c_script_2 ----------
division_2 = Division(A=number_slider_78, B=number_slider_81)  # disabled
panel_19 = Panel(deconstruct_domain_31.End)
panel_20 = Panel(deconstruct_domain_32.End)
panel_21 = Panel(deconstruct_domain_33.End)
multiplication_4 = Multiplication(A=Slider(30, range=0..100), B=number_slider_77)
multiplication_5 = Multiplication(A=Slider(60, range=20..60), B=number_slider_77)
multiplication_6 = Multiplication(A=Slider(6, range=2..10), B=number_slider_77)
multiplication_7 = Multiplication(A=Slider(30, range=20..60), B=number_slider_77)
multiplication_8 = Multiplication(A=number_slider_80, B=number_slider_79)  # disabled
round = Round()  # -> Nearest, Floor, Ceiling
number_slider_82 = Slider(18, range=0..100)  # disabled
panel_22 = Panel(multiplication_5)
panel_23 = Panel(multiplication_7)
panel_24 = Panel(multiplication_4)
multiplication_9 = Multiplication(A=multiplication_6, B=multiplication_6)
division_3 = Division(A=multiplication_5, B=multiplication_6)
panel_25 = Panel(multiplication_6)
division_4 = Division(A=multiplication_7, B=multiplication_6)
number_slider_83 = Slider(150, range=0..1000)
multiplication_10 = Multiplication(A=Slider(10000, range=0..10000), B=Slider(2, range=0..10))
division_5 = Division(A=multiplication_9, B=multiplication_10)
division_6 = Division(A=number_slider_82, B=multiplication_8)  # disabled
panel_26 = Panel(division_4)
integer = Integer(division_4)
integer_2 = Integer(division_3)
integer_3 = Integer(panel_24)
box_4 = Box(closet_margin)
box_5 = Box(changeover_zone)
box_6 = Box(closet)
box_7 = Box(exterior_door)
c_script_3 = CSharpScript(boxx=box_7)  # -> out, lenght; inputs boxx: Box
# ---------- c_script_3: C# ----------
    lenght = boxx.X.T1;
        //lenght = 5;
# ---------- end c_script_3 ----------
panel_27 = Panel(c_script_3.lenght)
deconstruct_box_25 = DeconstructBox(Box=box_7)  # -> Plane, X, Y, Z
panel_28 = Panel(deconstruct_box_25.Plane)
panel_29 = Panel(deconstruct_box_25.Y)
panel_30 = Panel(deconstruct_box_25.Z)
panel_31 = Panel(deconstruct_box_25.X)
box_8 = Box(exterior_door_margin)
box_9 = Box(change_over_zone_margin)
box_10 = Box()
box_11 = Box()
box_12 = Box()
box_13 = Box()
box_14 = Box()
box_15 = Box()
box_16 = Box()
box_17 = Box()
box_18 = Box()
box_19 = Box()
box_20 = Box()
c_script_4 = CSharpScript(
    Width=integer_2,
    Length=integer,
    Height=integer_3,
    LevelHeight=number_slider_83,
    cellSize=multiplication_6,
    ExteriorDoor=box_7,
    ExteriorDoorMargin=box_8,
    ChangeOverZone=box_5,
    ChangeOverZoneMargin=box_9,
    Closet=box_6,
    ClosetMargin=box_4,
    InteriorDoor=box_10,
    InteriorDoorMargin=box_11,
    Counter=box_12,
    CounterMargin=box_13,
    Table=box_14,
    TableMargin=box_15,
    SittingUnit=box_16,
    SittingUnitMargin=box_17,
    Bed=box_18,
    HealtCare=box_19,
    HealthCareMargin=box_20)  # -> out, A, R, G, B, Y, K, W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; inputs Width: Int32, Length: Int32, Height: Int32, LevelHeight: Int32, cellSize: Int32, ExteriorDoor: Box, ExteriorDoorMargin: Box, ChangeOverZone: Box, ChangeOverZoneMargin: Box, Closet: Box, ClosetMargin: Box, InteriorDoor: Box, InteriorDoorMargin: Box, Counter: Box, CounterMargin: Box, Table: Box, TableMargin: Box, SittingUnit: Box, SittingUnitMargin: Box, Bed: Box, BedMargin: Box, HealtCare: Box, HealthCareMargin: Box
# ---------- c_script_4: C# usings ----------
using System.Linq;
# ---------- c_script_4: C# ----------
    List<Box> entranceBoxes = new List<Box>();
    List<Box> commonBoxes = new List<Box>();
    List<Box> wetAreaBoxes = new List<Box>();

    /*List<Box> kitchenBoxes = new List<Box>();
      List<Box> commonAreaBoxes = new List<Box>();*/

    List<Box> WhiteBoxes = new List<Box>();

    /**  These sizes are Spreading Limits for the spaces   //total cells     **/

    double entranceSize = (5 * 100 * 100) / (cellSize * cellSize);
    double commonSize = (8 * 100 * 100) / (cellSize * cellSize);
    double wetAreaSize = (3 * 100 * 100 ) / (cellSize * cellSize);

    /*
    double kitchenSize = 7 * 100 * 100 / cellSize * cellSize;
    double commonAreaSize = 10 * 100 * 100 / cellSize * cellSize;
    */

    Point3d pA = new Point3d(0, 0, 0);
    Point3d pB = new Point3d(10, 0, 0);
    Point3d pC = new Point3d(0, 10, 0);

    Plane p = new Plane(pA, pB, pC);

    int width = Width;
    int length = Length;
    int levelHeight = LevelHeight;
    int height = Height;
    int levelNumber = Height / LevelHeight;

    int[,,] areaArray = InitializeZeroMatrice(length, width, levelNumber);
    StartZones(areaArray);

    int[,,] emptyFullArray = InitializeZeroMatrice(length, width, levelNumber);

    for (int i = 0; i < width * length * 3; i++)
    {
      //Rhino.RhinoApp.WriteLine("\n Loop Runs" + i.ToString());

      Spread(areaArray, ref entranceSize, entranceList, ref entranceCounter, entranceLimit, cellSize);
      /*Rhino.RhinoApp.WriteLine("Entrance size" + entranceSize.ToString());
      Rhino.RhinoApp.WriteLine("Entrance counter" + entranceCounter.ToString());
      Rhino.RhinoApp.WriteLine("\n ");*/


      Spread(areaArray, ref commonSize, commonList, ref commonCounter, commonLimit, cellSize);
      /*Rhino.RhinoApp.WriteLine("Common size" + commonSize.ToString());
      Rhino.RhinoApp.WriteLine("Common counter" + commonCounter.ToString());*/

      Spread(areaArray, ref wetAreaSize, wetAreaList, ref wetAreaCounter, wetAreaLimit, cellSize);

      /*Spread(areaArray, ref kitchenSize, kitchenList, ref kitchenCounter, kitchenLimit, cellSize);
      Spread(areaArray, ref commonAreaSize, commonAreaList, ref commonAreaCounter, commonAreaLimit, cellSize);*/
    }

    noiseFilter(areaArray, 0, 6, 5);
    noiseFilter(areaArray, 1, 2, 2);

    for (int k = 0;k < levelNumber;k++)
    {
      for (int i = 0;i < length;i++)
      {
        for (int j = 0;j < width;j++)
        {
          areaArray[i, j, k] = areaArray[i, j, 0];
        }
      }
    }

    for (int k = 0;k < levelNumber;k++)
    {
      for (int i = 0;i < length;i++)
      {
        for (int j = 0;j < width;j++)
        {
          emptyFullArray[i, j, k] = 0;
        }
      }
    }

    entranceList.Clear();
    commonList.Clear();
    wetAreaList.Clear();
    /*kitchenList.Clear();
    commonAreaList.Clear();*/

    for (int k = 0;k < levelNumber;k++)
    {
      for (int i = 0;i < length;i++)
      {
        for (int j = 0;j < width;j++)
        {
          if (areaArray[i, j, k] == 1)
          {
            Interval xInterval = new Interval(i * cellSize, (i + 1) * (cellSize ));
            Interval yInterval = new Interval(j * cellSize, (j + 1) * (cellSize ));
            Interval zInterval = new Interval(k * LevelHeight, k * LevelHeight + levelHeight);

            Box boxgh = new Box(p, xInterval, yInterval, zInterval);
            entranceBoxes.Add(boxgh);
            entranceList.AddRange(new int[2] { i, j });
          }
          if (areaArray[i, j, k] == 2)
          {
            Interval xInterval = new Interval(i * cellSize, (i + 1) * (cellSize ));
            Interval yInterval = new Interval(j * cellSize, (j + 1) * (cellSize ));
            Interval zInterval = new Interval(k * LevelHeight, k * LevelHeight + levelHeight);

            Box boxgh = new Box(p, xInterval, yInterval, zInterval);
            commonBoxes.Add(boxgh);
            commonList.AddRange(new int[2] { i, j });
          }
          if (areaArray[i, j, k] == 3)
          {
            Interval xInterval = new Interval(i * cellSize, (i + 1) * (cellSize ));
            Interval yInterval = new Interval(j * cellSize, (j + 1) * (cellSize ));
            Interval zInterval = new Interval(k * LevelHeight, k * LevelHeight + levelHeight);

            Box boxgh = new Box(p, xInterval, yInterval, zInterval);
            wetAreaBoxes.Add(boxgh);
            wetAreaList.AddRange(new int[2] { i, j });
          }

          /*if (areaArray[i, j, k] == 4)
          {
            Interval xInterval = new Interval(j * cellSize, (j + 1) * (cellSize ));
            Interval yInterval = new Interval(i * cellSize, (i + 1) * (cellSize ));
            Interval zInterval = new Interval(k * LevelHeight, k * LevelHeight + levelHeight);

            Box boxgh = new Box(p, xInterval, yInterval, zInterval);
            kitchenBoxes.Add(boxgh);
            kitchenList.AddRange(new int[2] { i, j });
          }
          if (areaArray[i, j, k] == 5)
          {
            Interval xInterval = new Interval(j * cellSize, (j + 1) * (cellSize ));
            Interval yInterval = new Interval(i * cellSize, (i + 1) * (cellSize ));
            Interval zInterval = new Interval(k * LevelHeight, k * LevelHeight + levelHeight);

            Box boxgh = new Box(p, xInterval, yInterval, zInterval);
            commonAreaBoxes.Add(boxgh);
            commonAreaList.AddRange(new int[2] { i, j });
          }*/
          if (areaArray[i, j, k] == 0)
          {

            Interval xInterval = new Interval(i * cellSize, (i + 1) * (cellSize ));
            Interval yInterval = new Interval(j * cellSize, (j + 1) * (cellSize ));
            Interval zInterval = new Interval(k * LevelHeight, k * LevelHeight + levelHeight);

            Box boxgh = new Box(p, xInterval, yInterval, zInterval);
            WhiteBoxes.Add(boxgh);
            //WhiteList.AddRange(i, j);
          }
        }
      }
    }
    List<Box> ObjectsList = new List<Box>();
    List<Box> MarginsList = new List<Box>();


    /* FURNITURE LAYOUT ==> ENTRANCE STARTED */


    Point3d pointa = new Point3d(0, 0, 0);
    Vector3d vectorb = new Vector3d(0, 0, 1);

    Plane planebase = new Plane(pointa, vectorb);

    Interval xInter = new Interval(0, 10);
    Interval yInter = new Interval(0, 10);
    Interval zInter = new Interval(0, 10);


    Box ObjBox = new Box(planebase, xInter, yInter, zInter);
    Box marginBox = new Box(planebase, xInter, yInter, zInter);


    /* ENTRANCE REFERENCE */
    var exteriorDoorO = new Objects
      {
        Name = "Exterior Door",
        ZoneName = 1,

        Obj = ExteriorDoor,
        ObjMargin = ExteriorDoorMargin,

        Front = true,
        Right = true,
        Back = false,
        Left = false,
        Top = false,
        Bottom = false,

        RotationBool = false,
        RotationOpt = 2,

        MirrorBool = false,
        MirrorOpt = 2,

        Source = "NULL",
        FixedToWall = 1,

        CellSize = 60,
        SpaceList = entranceList,

        //PreviousObject = changeOverZoneO

        };
    exteriorDoorO.assignDimensions();
    exteriorDoorO.placeRefObjectEntrance(emptyFullArray, areaArray, out ObjBox, out marginBox);
    
    ObjectsList.Add(ObjBox);
    MarginsList.Add(marginBox);



    /* ENTRANCE 2ND OBJECT */

    var changeOverZoneO = new Objects
      {
        Name = "changeOverZone",
        ZoneName = 1,

        Obj = ChangeOverZone,
        ObjMargin = ChangeOverZoneMargin,

        Front = true,
        Right = true,
        Back = false,
        Left = false,
        Top = false,
        Bottom = false,

        RotationBool = false,
        RotationOpt = 2,

        MirrorBool = false,
        MirrorOpt = 2,

        Source = "NULL",
        FixedToWall = 1,
        CellSize = 60,

        PreviousObject = exteriorDoorO,
        SpaceList = entranceList,

        };

    changeOverZoneO.assignDimensions();




    changeOverZoneO.placeFront(emptyFullArray, areaArray, out ObjBox, out marginBox);
    //changeOverZoneO.printDimensions();
    ObjectsList.Add(ObjBox);
    MarginsList.Add(marginBox);


    /* ENTRANCE 3RD OBJECT */
    var closetO = new Objects
      {
        Name = "closet",
        ZoneName = 1,

        Obj = Closet,
        ObjMargin = ClosetMargin,

        Front = true,
        Right = true,
        Back = false,
        Left = false,
        Top = false,
        Bottom = false,

        RotationBool = false,
        RotationOpt = 2,

        MirrorBool = false,
        MirrorOpt = 2,

        Source = "NULL",
        FixedToWall = 1,
        CellSize = 60,

        PreviousObject = changeOverZoneO,
        SpaceList = entranceList,

        };

    closetO.assignDimensions();

    closetO.placeFront(emptyFullArray, areaArray, out ObjBox, out marginBox);
    //changeOverZoneO.printDimensions();
    ObjectsList.Add(ObjBox);
    MarginsList.Add(marginBox);


    /* ENTRANCE 4TH OBJECT */
    var interiorDoorO = new Objects
      {
        Name = "Interior Door",
        ZoneName = 1,

        Obj = InteriorDoor,
        ObjMargin = InteriorDoorMargin,

        Front = true,
        Right = true,
        Back = false,
        Left = false,
        Top = false,
        Bottom = false,

        RotationBool = false,
        RotationOpt = 2,

        MirrorBool = false,
        MirrorOpt = 2,

        Source = "NULL",
        FixedToWall = 1,
        CellSize = 60,

        PreviousObject = closetO,
        SpaceList = entranceList,

        };

    interiorDoorO.assignDimensions();

    interiorDoorO.placeFront(emptyFullArray, areaArray, out ObjBox, out marginBox);

    ObjectsList.Add(ObjBox);
    MarginsList.Add(marginBox);

    /* FURNITURE LAYOUT ==> ENTRANCE ENDED */


    /* FURNITURE LAYOUT ==> COMMON STARTED */

    var counterO = new Objects
      {
        Name = "Counter",
        ZoneName = 2,

        Obj = Counter,
        ObjMargin = CounterMargin,

        Front = true,
        Right = true,
        Back = false,
        Left = false,
        Top = false,
        Bottom = false,

        RotationBool = false,
        RotationOpt = 2,

        MirrorBool = false,
        MirrorOpt = 2,

        Source = "NULL",
        FixedToWall = 1,

        CellSize = 60,
        SpaceList = commonList,


        };
    counterO.assignDimensions();
    ObjectsList.Add(counterO.placeRefObject());



    /* COMMONAREA 2ND OBJECT */

    var tableO = new Objects
      {
        Name = "Table",
        ZoneName = 2,

        Obj = Table,
        ObjMargin = TableMargin,

        Front = true,
        Right = true,
        Back = false,
        Left = false,
        Top = false,
        Bottom = false,

        RotationBool = false,
        RotationOpt = 2,

        MirrorBool = false,
        MirrorOpt = 2,

        Source = "NULL",
        FixedToWall = 1,
        CellSize = 60,

        PreviousObject = counterO,
        SpaceList = commonList,

        };

    tableO.assignDimensions();

/*
    Point3d pointa = new Point3d(0, 0, 0);
    Vector3d vectorb = new Vector3d(0, 0, 1);

    Plane planebase = new Plane(pointa, vectorb);

    Interval xInter = new Interval(0, 10);
    Interval yInter = new Interval(0, 10);
    Interval zInter = new Interval(0, 10);


    Box ObjBox = new Box(planebase, xInter, yInter, zInter);
    Box marginBox = new Box(planebase, xInter, yInter, zInter);
*/

    tableO.placeFront(emptyFullArray, areaArray, out ObjBox, out marginBox);
    //changeOverZoneO.printDimensions();
    ObjectsList.Add(ObjBox);
    MarginsList.Add(marginBox);


    /* COMMON 3RD OBJECT */
    var sittingUnitO = new Objects
      {
        Name = "Sitting Unit",
        ZoneName = 2,

        Obj = SittingUnit,
        ObjMargin = SittingUnitMargin,

        Front = true,
        Right = true,
        Back = false,
        Left = false,
        Top = false,
        Bottom = false,

        RotationBool = false,
        RotationOpt = 2,

        MirrorBool = false,
        MirrorOpt = 2,

        Source = "NULL",
        FixedToWall = 1,
        CellSize = 60,

        PreviousObject = tableO,
        SpaceList = commonList,

        };

    sittingUnitO.assignDimensions();

    sittingUnitO.placeFront(emptyFullArray, areaArray, out ObjBox, out marginBox);
    //changeOverZoneO.printDimensions();
    ObjectsList.Add(ObjBox);
    MarginsList.Add(marginBox);


    /* COMMON 4TH OBJECT */


    var bedO = new Objects
      {
        Name = "Bed",
        ZoneName = 2,

        Obj = Bed,
        ObjMargin = BedMargin,

        Front = true,
        Right = true,
        Back = false,
        Left = false,
        Top = false,
        Bottom = false,

        RotationBool = false,
        RotationOpt = 2,

        MirrorBool = false,
        MirrorOpt = 2,

        Source = "NULL",
        FixedToWall = 1,
        CellSize = 60,

        PreviousObject = sittingUnitO,
        SpaceList = commonList,

        };

    bedO.assignDimensions();

    bedO.placeFront(emptyFullArray, areaArray, out ObjBox, out marginBox);

    ObjectsList.Add(ObjBox);
    MarginsList.Add(marginBox);

    /* FURNITURE LAYOUT ==> COMMON END */







    ShowMatrix(areaArray);

    //Bxx = boxx;
    A = areaArray;
    R = entranceBoxes;
    G = commonBoxes;
    B = wetAreaBoxes;
    /*Y = kitchenBoxes;
    K = commonAreaBoxes;*/
    W = WhiteBoxes;
    Furnitures = ObjectsList;
    FurnituresMargins = MarginsList;
# ---------- c_script_4: C# additional code ----------
  class Objects
  {
    public string Name;
    public int ZoneName;

    public Box Obj;
    public Box ObjMargin;

    public bool Front = false;
    public bool Right = false;
    public bool Back = false;
    public bool Left = false;
    public bool Top = false;
    public bool Bottom = false;

    public bool RotationBool = true;
    public int RotationOpt; // rotation options

    public bool MirrorBool = true;
    public int MirrorOpt; // mirror options

    public string Source; // Water, Electiricity
    public int FixedToWall; // Bed, Television //1,2,3 conditions
    public int CellSize;

    public Objects PreviousObject;

    public double ObjLength ;
    public double ObjWidth ;
    public double ObjHeight ;

    public double MrjLength;
    public double MrjWidth;
    public double MrjHeight;

    public double baseX, baseY, baseZ;
    public List<int> SpaceList = new List<int>();

    public double  XCell;
    public double  YCell;
    public double  ZCell;


    //deneme
    public Objects()
    {
            /*
            var Coordinates = new List<int>();
            Point3d pA = new Point3d(0, 0, 0);
            Point3d pB = new Point3d(10, 0, 0);
            Point3d pC = new Point3d(0, 10, 0);

            Plane p = new Plane(pA, pB, pC);*/
    }

    public Objects(string name, int zoneName, bool front, bool right, bool back, bool left, bool top, bool bottom, bool rotationalBool, int rotationOpt, bool mirrorBool, int mirrorOpt, string source, int fixedTowall, int cellSize, Box obj, Box objMargin, Objects previousObject, List<int> spaceList)
      : this()
    {
      this.Obj = obj;
      this.ObjMargin = objMargin;

      this.Name = name;
      this.ZoneName = zoneName;

      this.Front = front;
      this.Right = right;
      this.Back = back;
      this.Left = left;
      this.Bottom = bottom;
      this.Top = top;

      this.RotationBool = rotationalBool;
      this.RotationOpt = rotationOpt;

      this.MirrorBool = mirrorBool;
      this.MirrorOpt = mirrorOpt;

      this.Source = source;
      this.FixedToWall = fixedTowall;
      this.CellSize = cellSize;

      this.ObjWidth = obj.X.T1;
      this.ObjLength = obj.Y.T1;
      this.ObjHeight = obj.Z.T1;

      this.MrjWidth = objMargin.X.T1;
      this.MrjLength = objMargin.Y.T1;
      this.MrjHeight = objMargin.Z.T1;

      this.baseX = Obj.Plane.OriginX;
      this.baseY = Obj.Plane.OriginY;
      this.baseZ = Obj.Plane.OriginZ;

      this.PreviousObject = previousObject;
      this.SpaceList = spaceList;

    }

    public Objects(string name, int zoneName, bool front, bool right, bool back, bool left, bool top, bool bottom, bool rotationalBool, int rotationOpt, bool mirrorBool, int mirrorOpt, string source, int fixedTowall, int cellSize, Box obj, Box objMargin, List<int> spaceList)
      : this()
    {
      this.Obj = obj;
      this.ObjMargin = objMargin;

      this.Name = name;
      this.ZoneName = zoneName;

      this.Front = front;
      this.Right = right;
      this.Back = back;
      this.Left = left;
      this.Bottom = bottom;
      this.Top = top;

      this.RotationBool = rotationalBool;
      this.RotationOpt = rotationOpt;

      this.MirrorBool = mirrorBool;
      this.MirrorOpt = mirrorOpt;

      this.Source = source;
      this.FixedToWall = fixedTowall;
      this.CellSize = cellSize;

      this.ObjWidth = obj.X.T1;
      this.ObjLength = obj.Y.T1;
      this.ObjHeight = obj.Z.T1;

      this.MrjWidth = (this.ObjMargin.X.T1);
      this.MrjLength = (this.ObjMargin.Y.T1);
      this.MrjHeight = (this.ObjMargin.Z.T1);

      this.baseX = Obj.Plane.OriginX;
      this.baseY = Obj.Plane.OriginY;
      this.baseZ = Obj.Plane.OriginZ;

      this.SpaceList = spaceList;

    }

    public void assignDimensions()
    {
      this.ObjWidth = this.Obj.X.T1;
      this.ObjLength = this.Obj.Y.T1;
      this.ObjHeight = this.Obj.Z.T1;

      this.MrjWidth = this.ObjMargin.X.T1;
      this.MrjLength = this.ObjMargin.Y.T1;
      this.MrjHeight = this.ObjMargin.Z.T1;

    }

    public void printDimensions()
    {
      Rhino.RhinoApp.WriteLine("Obj Width " + this.ObjWidth.ToString());
      Rhino.RhinoApp.WriteLine("Obj Length " + this.ObjLength.ToString());
      Rhino.RhinoApp.WriteLine("Obj Height " + this.ObjHeight.ToString());

      Rhino.RhinoApp.WriteLine("Obj Width " + this.MrjWidth.ToString());
      Rhino.RhinoApp.WriteLine("Obj Length " + this.MrjLength.ToString());
      Rhino.RhinoApp.WriteLine("Obj Height " + this.MrjHeight.ToString());
    }



    public Box placeRefObject()
    {
      this.XCell = Math.Ceiling((double) (this.MrjWidth / CellSize));
      this.YCell = Math.Ceiling((double) (this.MrjLength / CellSize));
      this.ZCell = Math.Ceiling((double) (this.MrjHeight / 150));

      var rand = new Random();
      var randomCellIndex = rand.Next(this.SpaceList.Count / 2);

      baseX = (this.SpaceList[2 * randomCellIndex]);
      baseY = 0;
      baseZ = 0;

      baseX = baseX * CellSize;
      baseY = baseY * CellSize;

      Rhino.RhinoApp.WriteLine("baseX " + this.baseX);
      Rhino.RhinoApp.WriteLine("baseY " + this.baseY);
      Rhino.RhinoApp.WriteLine("baseZ " + this.baseZ);

      Point3d pointa = new Point3d(baseX, 0, 0);
      Vector3d pointb = new Vector3d(0, 0, 1);

      Plane planebase = new Plane(pointa, pointb);

      Interval xInterval = new Interval(0, this.ObjWidth);
      Interval yInterval = new Interval(0, this.ObjLength);
      Interval zInterval = new Interval(0, this.ObjHeight);

      Rhino.RhinoApp.WriteLine("ref object hehight " + this.ObjHeight);

      Box boxx = new Box(planebase, xInterval, yInterval, zInterval);
      return boxx;
    }

    public void placeRefObjectEntrance(int [,,]emptyFullArray, int[,,]areaArray, out Box ObjBox, out Box marginBox)
    {
      this.XCell = Math.Ceiling((double) (this.MrjWidth / CellSize));
      this.YCell = Math.Ceiling((double) (this.MrjLength / CellSize));
      this.ZCell = Math.Ceiling((double) (this.MrjHeight / 150));

      bool emptyBool = true;
      bool sameZone = true;


      bool placeSuccessful = false;
      int trycount = 0;

      while (placeSuccessful == false)
      {
        var rand = new Random();
        var randomCellIndex = rand.Next(this.SpaceList.Count / 2);

        baseX = (this.SpaceList[2 * randomCellIndex]) * CellSize;
        baseY = 0;
        baseZ = 0;

        //baseX = baseX * CellSize;
        //baseY = baseY * CellSize;

        if( (baseX + this.MrjWidth < 300) && (baseY + this.MrjLength < 600) && (baseZ + this.MrjHeight < 300) &&
          (baseX + this.MrjWidth > 0) && (baseY + this.MrjLength > 0) && (baseZ + this.MrjHeight > 0) )
        {
          for(int i = (int) (baseX / CellSize) ; i < (baseX / CellSize + (int) XCell); i++)
          {
            for(int j = (int) (baseY / CellSize); j < baseY / CellSize + (int) YCell; j++)
            {
              for(int k = (int) (baseZ / 150); k < baseZ / 150 + (int) ZCell; k++)
              {
                Rhino.RhinoApp.WriteLine("i:  " + i + "  j:  " + j + "  k:  " + k);
                if (emptyFullArray[i, j, k] == 1)
                {
                  emptyBool = false;
                }
                if (areaArray[i, j, k] != this.ZoneName)
                {
                  sameZone = false;
                }
              }
            }
          }

          if (emptyBool && sameZone)
          {
            Rhino.RhinoApp.WriteLine("Conditions are successful ");
            for(int i = (int) (baseX / CellSize) ; i < (baseX / CellSize + (int) XCell); i++)
            {
              for(int j = (int) (baseY / CellSize); j < baseY / CellSize + (int) YCell; j++)
              {
                for(int k = (int) (baseZ / 150); k < baseZ / 150 + (int) ZCell; k++)
                {
                  emptyFullArray[i, j, k] = 1;
                }
              }
            }
          }
          else
          {
            Rhino.RhinoApp.WriteLine("Conditions are not satisfied ");
          }
        }

        trycount++;
        if (trycount > 60 )
          placeSuccessful = true;
      }

      if( trycount < 60 && placeSuccessful )
      {
        Rhino.RhinoApp.WriteLine("baseX " + this.baseX);
        Rhino.RhinoApp.WriteLine("baseY " + this.baseY);
        Rhino.RhinoApp.WriteLine("baseZ " + this.baseZ);

        Point3d pointa = new Point3d(baseX, 0, 0);
        Vector3d pointb = new Vector3d(0, 0, 1);

        Plane planebase = new Plane(pointa, pointb);

        Interval xInterval = new Interval(0, this.ObjWidth);
        Interval yInterval = new Interval(0, this.ObjLength);
        Interval zInterval = new Interval(0, this.ObjHeight);

        Box ObjBox = new Box(planebase, xInterval, yInterval, zInterval);
        
         xInterval = new Interval(0, this.MrjWidth);
         yInterval = new Interval(0, this.MrjLength);
         zInterval = new Interval(0, this.MrjHeight);

        Box marginBox = new Box(planebase, xInterval, yInterval, zInterval);
        
      }

    }


    public void placeFront(int [,,]emptyFullArray, int[,,]areaArray, out Box ObjBox, out Box marginBox)
    {
      bool emptyBool = true;
      bool sameZone = true;

      this.XCell = Math.Ceiling((double) (this.MrjWidth / CellSize));
      this.YCell = Math.Ceiling((double) (this.MrjLength / CellSize));
      this.ZCell = Math.Ceiling((double) (this.MrjHeight / 150));

      this.baseX = PreviousObject.baseX;
      this.baseY = PreviousObject.baseY + CellSize * PreviousObject.YCell;
      this.baseZ = PreviousObject.baseZ;

      if( (baseX + this.MrjWidth < 300) && (baseY + this.MrjLength < 600) && (baseZ + this.MrjHeight < 300) &&
        (baseX + this.MrjWidth > 0) && (baseY + this.MrjLength > 0) && (baseZ + this.MrjHeight > 0) )
      {
        for(int i = (int) (baseX / CellSize) ; i < (baseX / CellSize + (int) XCell); i++)
        {
          for(int j = (int) (baseY / CellSize); j < baseY / CellSize + (int) YCell; j++)
          {
            for(int k = (int) (baseZ / 150); k < baseZ / 150 + (int) ZCell; k++)
            {
              Rhino.RhinoApp.WriteLine("i:  " + i + "  j:  " + j + "  k:  " + k);
              if (emptyFullArray[i, j, k] == 1)
              {
                emptyBool = false;
              }
              if (areaArray[i, j, k] != this.ZoneName)
              {
                sameZone = false;
              }
            }
          }
        }

        if (emptyBool && sameZone)
        {
          Rhino.RhinoApp.WriteLine("Conditions are successful ");
          for(int i = (int) (baseX / CellSize) ; i < (baseX / CellSize + (int) XCell); i++)
          {
            for(int j = (int) (baseY / CellSize); j < baseY / CellSize + (int) YCell; j++)
            {
              for(int k = (int) (baseZ / 150); k < baseZ / 150 + (int) ZCell; k++)
              {
                emptyFullArray[i, j, k] = 1;
              }
            }
          }
        }
        else
        {
          Rhino.RhinoApp.WriteLine("Conditions are not satisfied ");
        }
      }
      else
      {
        Rhino.RhinoApp.WriteLine("Conditions are not satisfied ");
      }


      Point3d pointa = new Point3d(baseX, baseY, baseZ);
      Vector3d pointb = new Vector3d(0, 0, 1);

      Plane planebase = new Plane(pointa, pointb);

      Interval xInterval = new Interval(0, this.ObjWidth);
      Interval yInterval = new Interval(0, this.ObjLength);
      Interval zInterval = new Interval(0, this.ObjHeight);

      ObjBox = new Box(planebase, xInterval, yInterval, zInterval);

      xInterval = new Interval(0, this.MrjWidth);
      yInterval = new Interval(0, this.MrjLength);
      zInterval = new Interval(0, this.MrjHeight);

      marginBox = new Box(planebase, xInterval, yInterval, zInterval);
    }






    public void placeRight(int [,,]emptyFullArray, int[,,]areaArray, out Box ObjBox, out Box marginBox)
    {
      bool emptyBool = true;
      bool sameZone = true;

      this.XCell = Math.Ceiling((double) (this.MrjWidth / CellSize));
      this.YCell = Math.Ceiling((double) (this.MrjLength / CellSize));
      this.ZCell = Math.Ceiling((double) (this.MrjHeight / 150));

      this.baseX = PreviousObject.baseX + CellSize * PreviousObject.XCell;
      this.baseY = PreviousObject.baseY;
      this.baseZ = PreviousObject.baseZ;

      if( (baseX + this.ObjWidth < 300) && (baseY + this.ObjLength < 600) && (baseZ + this.ObjHeight < 300) &&
        (baseX + this.ObjWidth > 0) && (baseY + this.ObjLength > 0) && (baseZ + this.ObjHeight > 0) )
      {
        for(int i = (int) (baseX / CellSize) ; i < (baseX / CellSize + (int) XCell); i++)
        {
          for(int j = (int) (baseY / CellSize); j < baseY / CellSize + (int) YCell; j++)
          {
            for(int k = (int) (baseZ / 150); k < baseZ / 150 + (int) ZCell; k++)
            {
              if (emptyFullArray[i, j, k] == 1)
              {
                emptyBool = false;
              }
              if (areaArray[i, j, k] != this.ZoneName)
              {
                sameZone = false;
              }
            }
          }
        }

        if (emptyBool && sameZone)
        {
          Rhino.RhinoApp.WriteLine("Conditions are successful ");
          for(int i = (int) (baseX / CellSize) ; i < (baseX / CellSize + (int) XCell); i++)
          {
            for(int j = (int) (baseY / CellSize); j < baseY / CellSize + (int) YCell; j++)
            {
              for(int k = (int) (baseZ / 150); k < baseZ / 150 + (int) ZCell; k++)
              {
                emptyFullArray[i, j, k] = 1;
              }
            }
          }
        }
        else
        {
          Rhino.RhinoApp.WriteLine("Conditions are not satisfied ");
        }
      }
      else
      {
        Rhino.RhinoApp.WriteLine("Conditions are not satisfied ");
      }

      Point3d pointa = new Point3d(baseX, baseY, baseZ);
      Vector3d pointb = new Vector3d(0, 0, 1);

      Plane planebase = new Plane(pointa, pointb);

      Interval xInterval = new Interval(0, this.ObjWidth);
      Interval yInterval = new Interval(0, this.ObjLength);
      Interval zInterval = new Interval(0, this.ObjHeight);

      ObjBox = new Box(planebase, xInterval, yInterval, zInterval);

      xInterval = new Interval(0, this.MrjWidth);
      yInterval = new Interval(0, this.MrjLength);
      zInterval = new Interval(0, this.MrjHeight);

      marginBox = new Box(planebase, xInterval, yInterval, zInterval);
    }

    public void placeBack(int [,,]emptyFullArray, int[,,]areaArray, out Box ObjBox, out Box marginBox)
    {
      bool emptyBool = true;
      bool sameZone = true;

      this.XCell = Math.Ceiling((double) (this.MrjWidth / CellSize));
      this.YCell = Math.Ceiling((double) (this.MrjLength / CellSize));
      this.ZCell = Math.Ceiling((double) (this.MrjHeight / 150));

      this.baseX = PreviousObject.baseX;
      this.baseY = PreviousObject.baseY - CellSize * this.YCell;
      this.baseZ = PreviousObject.baseZ;

      if( (baseX + this.ObjWidth < 300) && (baseY + this.ObjLength < 600) && (baseZ + this.ObjHeight < 300) &&
        (baseX + this.ObjWidth > 0) && (baseY + this.ObjLength > 0) && (baseZ + this.ObjHeight > 0) )
      {
        for(int i = (int) (baseX / CellSize) ; i < (baseX / CellSize + (int) XCell); i++)
        {
          for(int j = (int) (baseY / CellSize); j < baseY / CellSize + (int) YCell; j++)
          {
            for(int k = (int) (baseZ / 150); k < baseZ / 150 + (int) ZCell; k++)
            {
              if (emptyFullArray[i, j, k] == 1)
              {
                emptyBool = false;
              }
              if (areaArray[i, j, k] != this.ZoneName)
              {
                sameZone = false;
              }
            }
          }
        }

        if (emptyBool && sameZone)
        {
          Rhino.RhinoApp.WriteLine("Conditions are successful ");
          for(int i = (int) (baseX / CellSize) ; i < (baseX / CellSize + (int) XCell); i++)
          {
            for(int j = (int) (baseY / CellSize); j < baseY / CellSize + (int) YCell; j++)
            {
              for(int k = (int) (baseZ / 150); k < baseZ / 150 + (int) ZCell; k++)
              {
                emptyFullArray[i, j, k] = 1;
              }
            }
          }
        }
        else
        {
          Rhino.RhinoApp.WriteLine("Conditions are not satisfied ");
        }
      }
      else
      {
        Rhino.RhinoApp.WriteLine("Conditions are not satisfied ");
      }

      Point3d pointa = new Point3d(baseX, baseY, baseZ);
      Vector3d pointb = new Vector3d(0, 0, 1);

      Plane planebase = new Plane(pointa, pointb);

      Interval xInterval = new Interval(0, this.ObjWidth);
      Interval yInterval = new Interval(0, this.ObjLength);
      Interval zInterval = new Interval(0, this.ObjHeight);

      ObjBox = new Box(planebase, xInterval, yInterval, zInterval);

      xInterval = new Interval(0, this.MrjWidth);
      yInterval = new Interval(0, this.MrjLength);
      zInterval = new Interval(0, this.MrjHeight);

      marginBox = new Box(planebase, xInterval, yInterval, zInterval);
    }

    public void placeLeft(int [,,]emptyFullArray, int[,,]areaArray, out Box ObjBox, out Box marginBox)
    {
      bool emptyBool = true;
      bool sameZone = true;

      this.XCell = Math.Ceiling((double) (this.MrjWidth / CellSize));
      this.YCell = Math.Ceiling((double) (this.MrjLength / CellSize));
      this.ZCell = Math.Ceiling((double) (this.MrjHeight / 150));

      this.baseX = PreviousObject.baseX - CellSize * this.XCell;
      this.baseY = PreviousObject.baseY;
      this.baseZ = PreviousObject.baseZ;

      if( (baseX + this.ObjWidth < 300) && (baseY + this.ObjLength < 600) && (baseZ + this.ObjHeight < 300) &&
        (baseX + this.ObjWidth > 0) && (baseY + this.ObjLength > 0) && (baseZ + this.ObjHeight > 0) )
      {
        for(int i = (int) (baseX / CellSize) ; i < (baseX / CellSize + (int) XCell); i++)
        {
          for(int j = (int) (baseY / CellSize); j < baseY / CellSize + (int) YCell; j++)
          {
            for(int k = (int) (baseZ / 150); k < baseZ / 150 + (int) ZCell; k++)
            {
              if (emptyFullArray[i, j, k] == 1)
              {
                emptyBool = false;
              }
              if (areaArray[i, j, k] != this.ZoneName)
              {
                sameZone = false;
              }
            }
          }
        }

        if (emptyBool && sameZone)
        {
          Rhino.RhinoApp.WriteLine("Conditions are successful ");
          for(int i = (int) (baseX / CellSize) ; i < (baseX / CellSize + (int) XCell); i++)
          {
            for(int j = (int) (baseY / CellSize); j < baseY / CellSize + (int) YCell; j++)
            {
              for(int k = (int) (baseZ / 150); k < baseZ / 150 + (int) ZCell; k++)
              {
                emptyFullArray[i, j, k] = 1;
              }
            }
          }
        }
        else
        {
          Rhino.RhinoApp.WriteLine("Conditions are not satisfied ");
        }
      }
      else
      {
        Rhino.RhinoApp.WriteLine("Conditions are not satisfied ");
      }

      Point3d pointa = new Point3d(baseX, baseY, baseZ);
      Vector3d pointb = new Vector3d(0, 0, 1);

      Plane planebase = new Plane(pointa, pointb);

      Interval xInterval = new Interval(0, this.ObjWidth);
      Interval yInterval = new Interval(0, this.ObjLength);
      Interval zInterval = new Interval(0, this.ObjHeight);

      ObjBox = new Box(planebase, xInterval, yInterval, zInterval);

      xInterval = new Interval(0, this.MrjWidth);
      yInterval = new Interval(0, this.MrjLength);
      zInterval = new Interval(0, this.MrjHeight);

      marginBox = new Box(planebase, xInterval, yInterval, zInterval);
    }
    public void placeTop(int [,,]emptyFullArray, int[,,]areaArray, out Box ObjBox, out Box marginBox)
    {
      bool emptyBool = true;
      bool sameZone = true;

      this.XCell = Math.Ceiling((double) (this.MrjWidth / CellSize));
      this.YCell = Math.Ceiling((double) (this.MrjLength / CellSize));
      this.ZCell = Math.Ceiling((double) (this.MrjHeight / 150));

      this.baseX = PreviousObject.baseX - CellSize * this.XCell;
      this.baseY = PreviousObject.baseY;
      this.baseZ = PreviousObject.baseZ;

      if( (baseX + this.ObjWidth < 300) && (baseY + this.ObjLength < 600) && (baseZ + this.ObjHeight < 300) &&
        (baseX + this.ObjWidth > 0) && (baseY + this.ObjLength > 0) && (baseZ + this.ObjHeight > 0) )
      {
        for(int i = (int) (baseX / CellSize) ; i < (baseX / CellSize + (int) XCell); i++)
        {
          for(int j = (int) (baseY / CellSize); j < baseY / CellSize + (int) YCell; j++)
          {
            for(int k = (int) (baseZ / 150); k < baseZ / 150 + (int) ZCell; k++)
            {
              if (emptyFullArray[i, j, k] == 1)
              {
                emptyBool = false;
              }
              if (areaArray[i, j, k] != this.ZoneName)
              {
                sameZone = false;
              }
            }
          }
        }

        if (emptyBool && sameZone)
        {
          Rhino.RhinoApp.WriteLine("Conditions are successful ");
          for(int i = (int) (baseX / CellSize) ; i < (baseX / CellSize + (int) XCell); i++)
          {
            for(int j = (int) (baseY / CellSize); j < baseY / CellSize + (int) YCell; j++)
            {
              for(int k = (int) (baseZ / 150); k < baseZ / 150 + (int) ZCell; k++)
              {
                emptyFullArray[i, j, k] = 1;
              }
            }
          }
        }
        else
        {
          Rhino.RhinoApp.WriteLine("Conditions are not satisfied ");
        }
      }
      else
      {
        Rhino.RhinoApp.WriteLine("Conditions are not satisfied ");
      }

      Point3d pointa = new Point3d(baseX, baseY, baseZ);
      Vector3d pointb = new Vector3d(0, 0, 1);

      Plane planebase = new Plane(pointa, pointb);

      Interval xInterval = new Interval(0, this.ObjWidth);
      Interval yInterval = new Interval(0, this.ObjLength);
      Interval zInterval = new Interval(0, this.ObjHeight);

      ObjBox = new Box(planebase, xInterval, yInterval, zInterval);

      xInterval = new Interval(0, this.MrjWidth);
      yInterval = new Interval(0, this.MrjLength);
      zInterval = new Interval(0, this.MrjHeight);

      marginBox = new Box(planebase, xInterval, yInterval, zInterval);
    }

    public void placeBottom(int [,,]emptyFullArray, int[,,]areaArray, out Box ObjBox, out Box marginBox)
    {
      bool emptyBool = true;
      bool sameZone = true;

      this.XCell = Math.Ceiling((double) (this.MrjWidth / CellSize));
      this.YCell = Math.Ceiling((double) (this.MrjLength / CellSize));
      this.ZCell = Math.Ceiling((double) (this.MrjHeight / 150));

      this.baseX = PreviousObject.baseX - CellSize * this.XCell;
      this.baseY = PreviousObject.baseY;
      this.baseZ = PreviousObject.baseZ;

      if( (baseX + this.ObjWidth < 300) && (baseY + this.ObjLength < 600) && (baseZ + this.ObjHeight < 300) &&
        (baseX + this.ObjWidth > 0) && (baseY + this.ObjLength > 0) && (baseZ + this.ObjHeight > 0) )
      {
        for(int i = (int) (baseX / CellSize) ; i < (baseX / CellSize + (int) XCell); i++)
        {
          for(int j = (int) (baseY / CellSize); j < baseY / CellSize + (int) YCell; j++)
          {
            for(int k = (int) (baseZ / 150); k < baseZ / 150 + (int) ZCell; k++)
            {
              if (emptyFullArray[i, j, k] == 1)
              {
                emptyBool = false;
              }
              if (areaArray[i, j, k] != this.ZoneName)
              {
                sameZone = false;
              }
            }
          }
        }

        if (emptyBool && sameZone)
        {
          Rhino.RhinoApp.WriteLine("Conditions are successful ");
          for(int i = (int) (baseX / CellSize) ; i < (baseX / CellSize + (int) XCell); i++)
          {
            for(int j = (int) (baseY / CellSize); j < baseY / CellSize + (int) YCell; j++)
            {
              for(int k = (int) (baseZ / 150); k < baseZ / 150 + (int) ZCell; k++)
              {
                emptyFullArray[i, j, k] = 1;
              }
            }
          }
        }
        else
        {
          Rhino.RhinoApp.WriteLine("Conditions are not satisfied ");
        }
      }
      else
      {
        Rhino.RhinoApp.WriteLine("Conditions are not satisfied ");
      }

      Point3d pointa = new Point3d(baseX, baseY, baseZ);
      Vector3d pointb = new Vector3d(0, 0, 1);

      Plane planebase = new Plane(pointa, pointb);

      Interval xInterval = new Interval(0, this.ObjWidth);
      Interval yInterval = new Interval(0, this.ObjLength);
      Interval zInterval = new Interval(0, this.ObjHeight);

      ObjBox = new Box(planebase, xInterval, yInterval, zInterval);

      xInterval = new Interval(0, this.MrjWidth);
      yInterval = new Interval(0, this.MrjLength);
      zInterval = new Interval(0, this.MrjHeight);

      marginBox = new Box(planebase, xInterval, yInterval, zInterval);
    }

    public void placeObject()
    {
      List<int> growDirection = new List<int>();

      if(PreviousObject.Front == true)
        growDirection.Add(1); // Front Direction
      if(PreviousObject.Right == true)
        growDirection.Add(2); // Right Direction
      if(PreviousObject.Back == true)
        growDirection.Add(3); // Back Direction
      if(PreviousObject.Left == true)
        growDirection.Add(4); // Left Direction
      if(PreviousObject.Bottom == true)
        growDirection.Add(5); // Bottom Direction
      if(PreviousObject.Top == true)
        growDirection.Add(6); // Right Direction

      if(growDirection.Count >= 1)
      {
        Random randm = new Random();

        int a = randm.Next(0, growDirection.Count);
        int randomMethod = growDirection[a];
        {

        }



      }


    }


    public void rotate()
    {

    }



    static void mirror()
    {

    }

    static void getClosestCell()
    {

    }

    static void createWall()
    {

    }

  }

  static void ShowMatrix(int[,,] Arr)
  {
    for (int i = 0; i < Arr.GetLength(0); i++)
    {
      for (int j = 0; j < Arr.GetLength(1); j++)
      {
        Rhino.RhinoApp.Write(Arr[i, j, 0] + " ");
      }
      Rhino.RhinoApp.WriteLine("Loop Runs" + i.ToString());
    }
    return;
  }

  static int[,,] InitializeZeroMatrice(int width, int length, int levelNumber)
  {
    var areaArray = new int[width, length, levelNumber];

    for (int k = 0; k < levelNumber; k++)
    {
      for (int i = 0; i < width; i++)
      {
        for (int j = 0; j < length; j++)
        {
          areaArray[i, j, k] = 0;
        }
      }
    }
    return areaArray;
  }

  /* The Color lists keep the colors in a seperate List in order to choose within them easily instead of searching where they are... */
  static List<int> entranceList = new List<int>();
  static List<int> commonList = new List<int>();
  static List<int> wetAreaList = new List<int>();
 /* static List<int> kitchenList = new List<int>();
  static List<int> commonAreaList = new List<int>();*/

  /**           these counters are used for starting the límitations counts.         **/

  static int entranceCounter = 1;
  static int commonCounter = 1;
  static int wetAreaCounter = 1;
  /*static int kitchenCounter = 1;
  static int commonAreaCounter = 1;*/
  /**           these limits are used for defining max distance that zone can spread.  **/

  static int entranceLimit = 200;
  static int commonLimit = 200;
  static int wetAreaLimit = 200;
  /*static int kitchenLimit = 200;
  static int commonAreaLimit = 100;*/

  static void StartZones(int[,,] arr)
  {
    /**
     * Randomly Starts the color. Takes the Color lists as argumnts
     * (We can delete these argumnents and it can get them as local referance
     * in our case it gives us a chance to choose what to initilize)
     * **/

    Random rand = new Random();
    //----------------------
    /* GetLength(0) and GetLength(1) might be set as variable */
    //Array.GetLength(0) gives the column lenght in other words length of an array
    //Array.GetLength(1) gives the row lenght in other words width of an array
    var a = rand.Next(arr.GetLength(0) / 2, arr.GetLength(0) / 2);
    var b = rand.Next(0, 2);

    Rhino.RhinoApp.WriteLine("started");
    entranceList.AddRange(new int[2] { a, b }); //AddRange ==> Adds multiple elements to a List . We use mod%2 to call the index of the point back instead of stacking them as an another List(or Array) in our list.
    arr[a, b, 0] = 1;// entrance Starting Point
    //----------------------

    b = rand.Next(0, arr.GetLength(1));
    a = rand.Next(0, arr.GetLength(0));

    commonList.AddRange(new int[2] { a, b });
    arr[a, b, 0] = 2; // common Starting Point
    //----------------------
    a = rand.Next(0, arr.GetLength(0));
    b = rand.Next(0, arr.GetLength(1));

    wetAreaList.AddRange(new int[2] { a, b });
    arr[a, b, 0] = 3; // wetArea Starting Point
    //----------------------
    a = rand.Next(0, arr.GetLength(0));
    b = rand.Next(0, arr.GetLength(1));
/*
    kitchenList.AddRange(new int[2] { a, b });
    arr[a, b, 0] = 4; // kitchen Starting Point
    //----------------------
    a = rand.Next(0, arr.GetLength(0));
    b = rand.Next(0, arr.GetLength(1));

    commonAreaList.AddRange(new int[2] { a, b });
    arr[a, b, 0] = 5; // commonArea Starting Point
    //----------------------
  */
  }
        /* Calculates the distance between initial point in the color and the possible new point!
         *  (if the possible new point is too far from inital point eleminate it.) */
  static double distanceCalculate(List<int> spaceCoordList, int x2, int y2, int cellSize)
  {
    var distance = cellSize * Math.Sqrt((y2 - spaceCoordList[1]) * (y2 - spaceCoordList[1]) + (x2 - spaceCoordList[0]) * (x2 - spaceCoordList[0]));
    return distance;
  }

  static void Evaluate()
  {
    // according to relations give score to the created zones
    // get the centers of the zones and acoording to the distances and created sizes give
    //positive or negative points and if score is not acceptable re-run and create variatians.
  }


  static void noiseFilter (int [,,] arr, int type, int iterationNumber, int controlNumber)
  {
    if(type == 0)
    {
      for( int loop = 0 ; loop < iterationNumber ; loop++ )
      {
        List < int> surrounding = new List<int>();
        for(int i = 1 ; i < arr.GetLength(0) - 1 ;i++)
        {
          for(int j = 1 ; j < arr.GetLength(1) - 1 ;j++)
          {
            for(int x = -1 ; x < 2;x++)
            {
              for(int y = -1 ; y < 2;y++)
              {
                if(!(x == y && x == 0))
                {

                  surrounding.Add(arr[i + x, j + y, 0]);
                }
              }
            }
            for (int v = 0 ; v < 6 ;v++) // 6 is the number of the zones including  empty cells
            {
              int count = (from z in surrounding where z == v select z).Count();
              if ( count >= controlNumber )
              {
                arr[i, j, 0] = v;
              }
            }
            surrounding.Clear();
            surrounding.TrimExcess();
          }
        }
      }
    }

    if(type == 1)
    {
      for( int loop = 0 ; loop < iterationNumber ; loop++ )
      {
        List < int> surrounding = new List<int>();
        for(int i = 1 ; i < arr.GetLength(0) - 1 ;i++)
        {
          for(int j = 1 ; j < arr.GetLength(1) - 1 ;j++)
          {
            for(int x = -1 ; x < 2;x++)
            {
              for(int y = -1 ; y < 2;y++)
              {
                if(!(x == y && x == 0) && ( (x + y == 1 ) || (x + y == -1 )) )
                {
                  surrounding.Add(arr[i + x, j + y, 0]);
                }
              }
            }

            for (int v = 0 ; v < 6 ;v++) // 6 is the number of the zones including  empty cells
            {
              int count = (from z in surrounding where z == v select z).Count();
              if ( count >= 2 )
              {
                arr[i, j, 0] = v;
              }
            }
            surrounding.Clear();
            surrounding.TrimExcess();
          }
        }
      }
    }
  }

  static void Spread(int[,,] arr, ref double spaceSize, List<int> spaceCoordList, ref int counter, int spaceLimit, int cellSize)
  {
        /*ARGUMENTS
     * The main array which has rectangular form(will be 3d in short) ,
     * spaceSize = Maximum limit that can grow.  ,
     * spaceCoordList =  the cells of the zone which has been already defined. )
     */
    var rand = new Random();
    var directionList = new List<int>();
    int Xcoord;
    int Ycoord;
    bool draw = false;
    int trycount = 0;

    while (draw == false && counter <= spaceSize)
    {
      if (counter <= spaceSize ) //Can be deleted. The condition is added to the While Loop Conditions.
      {
        var randomCellIndex = rand.Next(spaceCoordList.Count / 2);

        Xcoord = spaceCoordList[2 * randomCellIndex];
        Ycoord = spaceCoordList[2 * randomCellIndex + 1];

        if (Xcoord < arr.GetLength(0) - 1 && Xcoord > 0 && Ycoord > 0 && Ycoord < arr.GetLength(1) - 1)
        {
          /* Check the conditions INSIDE borders */
          if (arr[Xcoord + 1, Ycoord, 0] == 0 && distanceCalculate(spaceCoordList, Xcoord + 1, Ycoord, cellSize) < spaceLimit ) // Check if possible new cell is still white or not!
            directionList.AddRange(new int[2] { (Xcoord + 1), Ycoord }); //Store possible spread directions in a list.

          if (arr[Xcoord - 1, Ycoord, 0] == 0 && distanceCalculate(spaceCoordList, Xcoord - 1, Ycoord, cellSize) < spaceLimit)
            directionList.AddRange(new int[2] { (Xcoord - 1), Ycoord }); //Store possible spread directions in a list.

          if (arr[Xcoord, Ycoord + 1, 0] == 0 && distanceCalculate(spaceCoordList, Xcoord, Ycoord + 1, cellSize) < spaceLimit)
            directionList.AddRange(new int[2] { (Xcoord), Ycoord + 1 }); //Store possible spread directions in a list.

          if (arr[Xcoord, Ycoord - 1, 0] == 0 && distanceCalculate(spaceCoordList, Xcoord, Ycoord - 1, cellSize) < spaceLimit)
            directionList.AddRange(new int[2] { (Xcoord), (Ycoord - 1) }); //Store possible spread directions in a list.

          if (directionList.Count > 0)
          {
            var randomIndex = rand.Next(directionList.Count / 2);
            int a = directionList[2 * randomIndex];
            int b = directionList[2 * randomIndex + 1];

            arr[a, b, 0] = arr[Xcoord, Ycoord, 0];

            spaceCoordList.AddRange(new int[2] { a, b });

            directionList.Clear();
            directionList.TrimExcess();
            draw = true;
            counter++;
          }
          else
          {
            trycount++;
            if (trycount >= spaceCoordList.Count)
            {
              draw = true;
              //Print("trycountNumber is ={0}", trycount);
            }
          }
        }

          /* EDGE CONDITIONS */
          //RIGHT
        else if (Xcoord == (arr.GetLength(0) - 1) && Ycoord != 0 && Ycoord != (arr.GetLength(1) - 1))
        {
          if (arr[Xcoord - 1, Ycoord, 0] == 0 && distanceCalculate(spaceCoordList, Xcoord - 1, Ycoord, cellSize) < spaceLimit )
            directionList.AddRange(new int[2] { (Xcoord - 1), (Ycoord) }); //Store possible spread directions in a list.
          if (arr[Xcoord, Ycoord + 1, 0] == 0 && distanceCalculate(spaceCoordList, Xcoord, Ycoord + 1, cellSize) < spaceLimit )
            directionList.AddRange(new int[2] { (Xcoord ), (Ycoord + 1) }); //Store possible spread directions in a list.
          if (arr[Xcoord, Ycoord - 1, 0] == 0 && distanceCalculate(spaceCoordList, Xcoord, Ycoord - 1, cellSize) < spaceLimit )
            directionList.AddRange(new int[2] { (Xcoord ), (Ycoord - 1) }); //Store possible spread directions in a list.

          if (directionList.Count > 0)
          {
            var randomIndex = rand.Next(directionList.Count / 2);
            int a = directionList[2 * randomIndex];
            int b = directionList[2 * randomIndex + 1];

            arr[a, b, 0] = arr[Xcoord, Ycoord, 0];

            spaceCoordList.AddRange(new int[2] { a, b });

            directionList.Clear();
            directionList.TrimExcess();
            draw = true;
            counter++;
          }
          else
          {
            trycount++;
            if (trycount >= spaceCoordList.Count)
            {
              draw = true;
              //Print("trycountNumber is ={0}", trycount);
            }
          }
        }

          //Left
        else if (Xcoord == 0 && Ycoord != 0 && Ycoord != (arr.GetLength(1) - 1))
        {

          if (arr[Xcoord + 1, Ycoord, 0] == 0 && distanceCalculate(spaceCoordList, Xcoord + 1, Ycoord, cellSize) < spaceLimit )
            directionList.AddRange(new int[2] { (Xcoord + 1), (Ycoord) }); //Store possible spread directions in a list.
          if (arr[Xcoord, Ycoord + 1, 0] == 0 && distanceCalculate(spaceCoordList, Xcoord, Ycoord + 1, cellSize) < spaceLimit )
            directionList.AddRange(new int[2] { (Xcoord ), (Ycoord + 1) }); //Store possible spread directions in a list.
          if (arr[Xcoord, Ycoord - 1, 0] == 0 && distanceCalculate(spaceCoordList, Xcoord, Ycoord - 1, cellSize) < spaceLimit )
            directionList.AddRange(new int[2] { (Xcoord ), (Ycoord - 1) }); //Store possible spread directions in a list.
          if (directionList.Count > 0)
          {
            var randomIndex = rand.Next(directionList.Count / 2);
            int a = directionList[2 * randomIndex];
            int b = directionList[2 * randomIndex + 1];

            arr[a, b, 0] = arr[Xcoord, Ycoord, 0];

            spaceCoordList.AddRange(new int[2] { a, b });

            directionList.Clear();
            directionList.TrimExcess();
            draw = true;
            counter++;
          }
          else
          {
            trycount++;
            if (trycount >= spaceCoordList.Count)
            {
              draw = true;
              //Print("trycountNumber is ={0}", trycount);
            }
          }

        }
          //TOP
        else if ((Ycoord == arr.GetLength(1) - 1) && Xcoord != 0 && Xcoord != (arr.GetLength(0) - 1))
        {

          if (arr[Xcoord, Ycoord - 1, 0] == 0 && distanceCalculate(spaceCoordList, Xcoord, Ycoord - 1, cellSize) < spaceLimit )
            directionList.AddRange(new int[2] { (Xcoord ), (Ycoord - 1) }); //Store possible spread directions in a list.
          if (arr[Xcoord + 1, Ycoord, 0] == 0 && distanceCalculate(spaceCoordList, Xcoord + 1, Ycoord, cellSize) < spaceLimit )
            directionList.AddRange(new int[2] { (Xcoord + 1 ), (Ycoord ) }); //Store possible spread directions in a list.
          if (arr[Xcoord - 1, Ycoord, 0] == 0 && distanceCalculate(spaceCoordList, Xcoord - 1, Ycoord, cellSize) < spaceLimit )
            directionList.AddRange(new int[2] { (Xcoord - 1), (Ycoord ) }); //Store possible spread directions in a list.
          if (directionList.Count > 0)
          {
            var randomIndex = rand.Next(directionList.Count / 2);
            int a = directionList[2 * randomIndex];
            int b = directionList[2 * randomIndex + 1];

            arr[a, b, 0] = arr[Xcoord, Ycoord, 0];

            spaceCoordList.AddRange(new int[2] { a, b });

            directionList.Clear();
            directionList.TrimExcess();
            draw = true;
            counter++;
          }
          else
          {
            trycount++;
            if (trycount >= spaceCoordList.Count)
            {
              draw = true;
              //Print("trycountNumber is ={0}", trycount);
            }
          }
        }
          //BOTTOM
        else if (Ycoord == 0 && Xcoord != 0 && Xcoord != (arr.GetLength(0) - 1))
        {
          if (arr[Xcoord, Ycoord + 1, 0] == 0 && distanceCalculate(spaceCoordList, Xcoord, Ycoord + 1, cellSize) < spaceLimit )
            directionList.AddRange(new int[2] { (Xcoord ), (Ycoord + 1) }); //Store possible spread directions in a list.
          if (arr[Xcoord + 1, Ycoord, 0] == 0 && distanceCalculate(spaceCoordList, Xcoord + 1, Ycoord, cellSize) < spaceLimit )
            directionList.AddRange(new int[2] { (Xcoord + 1 ), (Ycoord ) }); //Store possible spread directions in a list.
          if (arr[Xcoord - 1, Ycoord, 0] == 0 && distanceCalculate(spaceCoordList, Xcoord - 1, Ycoord, cellSize) < spaceLimit )
            directionList.AddRange(new int[2] { (Xcoord - 1), (Ycoord ) }); //Store possible spread directions in a list.
          if (directionList.Count > 0)
          {
            var randomIndex = rand.Next(directionList.Count / 2);
            int a = directionList[2 * randomIndex];
            int b = directionList[2 * randomIndex + 1];

            arr[a, b, 0] = arr[Xcoord, Ycoord, 0];

            spaceCoordList.AddRange(new int[2] { a, b });

            directionList.Clear();
            directionList.TrimExcess();
            draw = true;
            counter++;
          }
          else
          {
            trycount++;
            if (trycount >= spaceCoordList.Count)
            {
              draw = true;
              //Print("trycountNumber is ={0}", trycount);
            }
          }
        }

          //LEFT BOTTOM
        else if (Xcoord == 0 && Ycoord == 0)
        {
          if (arr[Xcoord, Ycoord + 1, 0] == 0 && distanceCalculate(spaceCoordList, Xcoord, Ycoord + 1, cellSize) < spaceLimit)
            directionList.Add(Xcoord); directionList.Add(Ycoord + 1);

          if (arr[Xcoord + 1, Ycoord, 0] == 0 && distanceCalculate(spaceCoordList, Xcoord + 1, Ycoord, cellSize) < spaceLimit)
            directionList.Add(Xcoord + 1); directionList.Add(Ycoord);

          if (directionList.Count > 0)
          {

            var randomIndex = rand.Next(directionList.Count / 2);

            int a = directionList[2 * randomIndex];
            int b = directionList[2 * randomIndex + 1];

            arr[a, b, 0] = arr[Xcoord, Ycoord, 0];

            spaceCoordList.AddRange(new int[2] { a, b });

            directionList.Clear();
            directionList.TrimExcess();
            draw = true;

            counter++;
            //Print(" Counter Number is : {0}", counter);
          }
          else
          {
            trycount++;
            if (trycount >= spaceCoordList.Count)
            {
              draw = true;
              //Print("trycountNumber is ={0}", trycount);
            }
          }
        }
          //LEFT  TOP
          /*
          else if (Xcoord == 0 && Ycoord == (arr.GetLength(1) - 1))
          {
          if (arr[Xcoord + 1, Ycoord] == 0)
          directionList.Add(Xcoord + 1); directionList.Add(Ycoord);

          if (arr[Xcoord, Ycoord - 1] == 0)
          directionList.Add(Xcoord); directionList.Add(Ycoord - 1);

          if (directionList.Count > 0)
          {
          var randomIndex = rand.Next(directionList.Count / 2);

          int a = directionList[2 * randomIndex];
          int b = directionList[2 * randomIndex + 1];

          Rhino.RhinoApp.WriteLine("Left Top "  +  a +  " "  +  b);
          arr[a, b] = arr[Xcoord, Ycoord];

          spaceCoordList.AddRange(new int[2] { a, b });

          directionList.Clear();
          directionList.TrimExcess();
          draw = true;

          counter++;
          //Print(" Counter Number is : {0}", counter);
          }
          else
          {
          trycount++;
          if (trycount >= spaceCoordList.Count)
          {
          draw = true;
          //Print("trycountNumber is ={0}", trycount);
          }
          }
          }
          */
          /*
          //RIGHT TOP
          else if (Xcoord == (arr.GetLength(0) - 1) && Ycoord == (arr.GetLength(1) - 1))
          {
          if (arr[Xcoord, Ycoord - 1] == 0)
          directionList.Add(Xcoord); directionList.Add(Ycoord - 1);

          if (arr[Xcoord - 1, Ycoord] == 0)
          directionList.Add(Xcoord - 1); directionList.Add(Ycoord);

          if (directionList.Count > 0)
          {
          var randomIndex = rand.Next(directionList.Count / 2);

          int a = directionList[2 * randomIndex];
          int b = directionList[2 * randomIndex + 1];
          Rhino.RhinoApp.WriteLine(" Right top "+ a + " " + b);
          arr[a, b] = arr[Xcoord, Ycoord];

          //spaceCoordList.AddRange(new int[2] { a, b });

          directionList.Clear();
          directionList.TrimExcess();
          draw = true;

          counter++;
          //Print(" Counter Number is : {0}", counter);
          }
          else
          {
          trycount++;
          if (trycount >= spaceCoordList.Count)
          {
          draw = true;
          //Print("trycountNumber is ={0}", trycount);
          }
          }
          }
          */
          //RIGHT BOTTOM
        else if (Xcoord == (arr.GetLength(0) - 1) && Ycoord == 0)
        {
          if (arr[Xcoord, Ycoord + 1, 0] == 0)
            directionList.Add(Xcoord); directionList.Add(Ycoord + 1);

          if (arr[Xcoord - 1, Ycoord, 0] == 0)
            directionList.Add(Xcoord - 1); directionList.Add(Ycoord);

          if (directionList.Count > 0)
          {
            var randomIndex = rand.Next(directionList.Count / 2);

            int a = directionList[2 * randomIndex];
            int b = directionList[2 * randomIndex + 1];

            arr[a, b, 0] = arr[Xcoord, Ycoord, 0];

            spaceCoordList.AddRange(new int[2] { a, b });

            directionList.Clear();
            directionList.TrimExcess();

            draw = true;
            counter++;
            //Print(" Counter Number is : {0}", counter);
          }
          else
          {
            trycount++;
            if (trycount >= spaceCoordList.Count)
            {
              draw = true;
              //Print("trycountNumber is ={0}", trycount);
            }
          }
        }
        /* EDGE CONDITIONS */
      }
    }

  }




    /* Instead of wrting methods seperately in main program, it is better to use class based
     informations to keep things organized, we are not yet transsferentrance methods here but we created the str.*/

    /*
    public class Zone
    {
        public string Name;
        public int SpaceLimit;
        public Int16 SpaceSize;
        public int Counter;
        public List<Int16> SpaceList;

        public void Describe()
        {
            Console.WriteLine("Hey this zone is{ 0} ", Name);
        }

        public Zone()
        {
           // SpaceList = new List<int>();
        }

        public Zone(string name, int spaceLimit,int spacesize,int counter, List<int> SpaceList)
        :this()
        {
        }
        static void InitializeZeroMatrice() { }
        static void startZones() { }
        public void SpreadZones() { }

    }
    */
# ---------- end c_script_4 ----------
box_21 = Box(c_script_4.Furnitures)
deconstruct_box_26 = DeconstructBox(Box=box_21)  # -> Plane, X, Y, Z
panel_32 = Panel(deconstruct_box_26.Plane)
panel_33 = Panel(deconstruct_box_26.Y)
panel_34 = Panel(deconstruct_box_26.X)
panel_35 = Panel(deconstruct_box_26.Z)
c_script_5 = CSharpScript(
    Width=integer_2,
    Length=integer,
    Height=integer_3,
    LevelHeight=number_slider_83,
    cellSize=multiplication_6,
    ConnectionPoint=box_7,
    ConnectionPointMargin=box_8,
    ChangeOverZone=box_5,
    ChangeOverZoneMargin=box_9)  # -> out, A, R, G, B, Y, K, W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; inputs Width: Int32, Length: Int32, Height: Int32, LevelHeight: Int32, cellSize: Int32, ConnectionPoint: Box, ConnectionPointMargin: Box, ChangeOverZone: Box, ChangeOverZoneMargin: Box; disabled
# ---------- c_script_5: C# ----------
 
    List<Box> entranceBoxes = new List<Box>();
    List<Box> wetAreaBoxes = new List<Box>();
    List<Box> personalSpaceBoxes = new List<Box>();
    List<Box> kitchenBoxes = new List<Box>();
    List<Box> commonAreaBoxes = new List<Box>();
    List<Box> WhiteBoxes = new List<Box>();

    /**           These sizes are Spreading Limits for the spaces   //total cells           **/

    double entranceSize = 3 * 100 * 100 / cellSize * cellSize;
    double personalSpaceSize = 3 * 100 * 100 / cellSize * cellSize;
    double wetAreaSize = 2.5 * 100 * 100 / cellSize * cellSize;
    double kitchenSize = 5 * 100 * 100 / cellSize * cellSize;;
    double commonAreaSize = 10 * 100 * 100 / cellSize * cellSize;;

    Point3d pA = new Point3d(0, 0, 0);
    Point3d pB = new Point3d(10, 0, 0);
    Point3d pC = new Point3d(0, 10, 0);

    Plane p = new Plane(pA, pB, pC);

    int width = Width;
    int length = Length;
    int levelHeight = LevelHeight;
    int height = Height;
    int levelNumber = Height / LevelHeight;

    int[,,] areaArray = InitializeZeroMatrice(length, width, levelNumber);
    StartZones(areaArray);

    int[,,] emptyFullArray = InitializeZeroMatrice(length, width, levelNumber);

    for (int i = 0; i < width * length * 3; i++)
    {
      Rhino.RhinoApp.WriteLine("Loop Runs" + i.ToString());
      Spread(areaArray, ref entranceSize, entranceList, ref entranceCounter, entranceLimit, cellSize);
      Spread(areaArray, ref personalSpaceSize, personalSpaceList, ref personalSpaceCounter, personalSpaceLimit, cellSize);
      Spread(areaArray, ref wetAreaSize, wetAreaList, ref wetAreaCounter, wetAreaLimit, cellSize);
      Spread(areaArray, ref kitchenSize, kitchenList, ref kitchenCounter, kitchenLimit, cellSize);
      Spread(areaArray, ref commonAreaSize, commonAreaList, ref commonAreaCounter, commonAreaLimit, cellSize);
    }

    noiseFilter(areaArray, 0, 6, 5);
    noiseFilter(areaArray, 1, 2, 2);

    for (int k = 0;k < levelNumber;k++)
    {
      for (int i = 0;i < length;i++)
      {
        for (int j = 0;j < width;j++)
        {
          areaArray[i, j, k] = areaArray[i, j, 0];
        }
      }
    }

    for (int k = 0;k < levelNumber;k++)
    {
      for (int i = 0;i < length;i++)
      {
        for (int j = 0;j < width;j++)
        {
          emptyFullArray[i, j, k] = 0;
        }
      }
    }

    entranceList.Clear();
    personalSpaceList.Clear();
    wetAreaList.Clear();
    kitchenList.Clear();
    commonAreaList.Clear();

    for (int k = 0;k < levelNumber;k++)
    {
      for (int i = 0;i < length;i++)
      {
        for (int j = 0;j < width;j++)
        {
          if (areaArray[i, j, k] == 1)
          {
            Interval xInterval = new Interval(j * cellSize, (j + 1) * (cellSize ));
            Interval yInterval = new Interval(i * cellSize, (i + 1) * (cellSize ));
            Interval zInterval = new Interval(k * LevelHeight, k * LevelHeight + levelHeight);

            Box boxgh = new Box(p, xInterval, yInterval, zInterval);
            entranceBoxes.Add(boxgh);
            entranceList.AddRange(new int[2] { i, j });
          }
          if (areaArray[i, j, k] == 2)
          {
            Interval xInterval = new Interval(j * cellSize, (j + 1) * (cellSize ));
            Interval yInterval = new Interval(i * cellSize, (i + 1) * (cellSize ));
            Interval zInterval = new Interval(k * LevelHeight, k * LevelHeight + levelHeight);

            Box boxgh = new Box(p, xInterval, yInterval, zInterval);
            wetAreaBoxes.Add(boxgh);
            wetAreaList.AddRange(new int[2] { i, j });
          }
          if (areaArray[i, j, k] == 3)
          {
            Interval xInterval = new Interval(j * cellSize, (j + 1) * (cellSize ));
            Interval yInterval = new Interval(i * cellSize, (i + 1) * (cellSize ));
            Interval zInterval = new Interval(k * LevelHeight, k * LevelHeight + levelHeight);

            Box boxgh = new Box(p, xInterval, yInterval, zInterval);
            personalSpaceBoxes.Add(boxgh);
            personalSpaceList.AddRange(new int[2] { i, j });
          }
          if (areaArray[i, j, k] == 4)
          {
            Interval xInterval = new Interval(j * cellSize, (j + 1) * (cellSize ));
            Interval yInterval = new Interval(i * cellSize, (i + 1) * (cellSize ));
            Interval zInterval = new Interval(k * LevelHeight, k * LevelHeight + levelHeight);

            Box boxgh = new Box(p, xInterval, yInterval, zInterval);
            kitchenBoxes.Add(boxgh);
            kitchenList.AddRange(new int[2] { i, j });
          }
          if (areaArray[i, j, k] == 5)
          {
            Interval xInterval = new Interval(j * cellSize, (j + 1) * (cellSize ));
            Interval yInterval = new Interval(i * cellSize, (i + 1) * (cellSize ));
            Interval zInterval = new Interval(k * LevelHeight, k * LevelHeight + levelHeight);

            Box boxgh = new Box(p, xInterval, yInterval, zInterval);
            commonAreaBoxes.Add(boxgh);
            commonAreaList.AddRange(new int[2] { i, j });
          }
          if (areaArray[i, j, k] == 0)
          {

            Interval xInterval = new Interval(j * cellSize, (j + 1) * (cellSize ));
            Interval yInterval = new Interval(i * cellSize, (i + 1) * (cellSize ));
            Interval zInterval = new Interval(k * LevelHeight, k * LevelHeight + levelHeight);

            Box boxgh = new Box(p, xInterval, yInterval, zInterval);
            WhiteBoxes.Add(boxgh);
            //WhiteList.AddRange(i, j);
          }
        }
      }
    }

    var connectionPointO = new Objects
      {
        Name = "changeOverZone",
        ZoneName = 2,

        Obj = ConnectionPoint,
        ObjMargin = ConnectionPointMargin,

        Front = true,
        Right = true,
        Back = false,
        Left = false,
        Top = false,
        Bottom = false,

        RotationBool = false,
        RotationOpt = 2,

        MirrorBool = false,
        MirrorOpt = 2,

        Source = "NULL",
        FixedToWall = 1,

        CellSize = 60,
        SpaceList = entranceList,

        //PreviousObject = changeOverZoneO

        };

    var changeOverZoneO = new Objects
      {
        Name = "changeOverZone",
        ZoneName = 2,

        Obj = ChangeOverZone,
        ObjMargin = ChangeOverZoneMargin,

        Front = true,
        Right = true,
        Back = false,
        Left = false,
        Top = false,
        Bottom = false,

        RotationBool = false,
        RotationOpt = 2,

        MirrorBool = false,
        MirrorOpt = 2,

        Source = "NULL",
        FixedToWall = 1,
        CellSize = 60,

        PreviousObject = connectionPointO,
        SpaceList = entranceList,

        };

    connectionPointO.placeRefObject();


    var randd = new Random();
    //var entranceList = new List<int>();
    //entranceList.Add(3);entranceList.Add(4);
    Rhino.RhinoApp.WriteLine(entranceList.Count().ToString());
    var randomIndex = randd.Next(entranceList.Count / 2);
    int a = entranceList[2 * randomIndex];
    int b = entranceList[2 * randomIndex + 1];

    Point3d pointa = new Point3d(0 * cellSize, b * cellSize, 0);
    Vector3d pointb = new Vector3d(0, 0, 1);

    Plane planebase = new Plane(pointa, pointb);

    Box boxx = new Box(planebase, ConnectionPoint.Y, ConnectionPoint.X, ConnectionPoint.Z);

    List<Box> ObjectsList = new List<Box>();
    List<Box> MarginsList = new List<Box>();




/*
    //var entranceList = new List<int>();
    //entranceList.Add(3);entranceList.Add(4);
    Rhino.RhinoApp.WriteLine(wetAreaList.Count().ToString());
    var randomIndex = randd.Next(wetAreaList.Count / 2);
    int a = entranceList[2 * randomIndex];
    int b = entranceList[2 * randomIndex + 1];

    Point3d pointa = new Point3d(0 * cellSize, b * cellSize, 0);
    Vector3d pointb = new Vector3d(0, 0, 1);

    Plane planebase = new Plane(pointa, pointb);


    Box boxx = new Box(planebase, ChangeOverZone.Y, ChangeOverZone.X, ChangeOverZone.Z);
    */

    ShowMatrix(areaArray);

    Bxx = boxx;
    A = areaArray;
    R = entranceBoxes;
    G = personalSpaceBoxes;
    B = wetAreaBoxes;
    Y = kitchenBoxes;
    K = commonAreaBoxes;
    W = WhiteBoxes;
    Furnitures = ObjectsList;
    FurnituresMargins = MarginsList;
# ---------- c_script_5: C# additional code ----------
  class Objects
  {
    public string Name;
    public int ZoneName;

    public Box Obj;
    public Box ObjMargin;

    public bool Front = false;
    public bool Right = false;
    public bool Back = false;
    public bool Left = false;
    public bool Top = false;
    public bool Bottom = false;

    public bool RotationBool = true;
    public int RotationOpt; // rotation options

    public bool MirrorBool = true;
    public int MirrorOpt; // mirror options

    public string Source; // Water, Electiricity
    public int FixedToWall; // Bed, Television //1,2,3 conditions
    public int CellSize;

    public Objects PreviousObject;

    int ObjLength;
    int ObjWidth;
    int ObjHeight;

    int MrjLength;
    int MrjWidth;
    int MrjHeight;

    public double baseX, baseY, baseZ;
    public List<int> SpaceList = new List<int>();

    //deneme
    public Objects()
    {
            /*
            var Coordinates = new List<int>();
            Point3d pA = new Point3d(0, 0, 0);
            Point3d pB = new Point3d(10, 0, 0);
            Point3d pC = new Point3d(0, 10, 0);

            Plane p = new Plane(pA, pB, pC);*/
    }

    public Objects(string name, int zoneName, bool front, bool right, bool back, bool left, bool top, bool bottom, bool rotationalBool, int rotationOpt, bool mirrorBool, int mirrorOpt, string source, int fixedTowall, int cellSize, Box obj, Box objMargin, Objects previousObject, List<int> spaceList)
      : this()
    {
      this.Obj = obj;
      this.ObjMargin = objMargin;

      this.Name = name;
      this.ZoneName = zoneName;

      this.Front = front;
      this.Right = right;
      this.Back = back;
      this.Left = left;
      this.Bottom = bottom;
      this.Top = top;

      this.RotationBool = rotationalBool;
      this.RotationOpt = rotationOpt;

      this.MirrorBool = mirrorBool;
      this.MirrorOpt = mirrorOpt;

      this.Source = source;
      this.FixedToWall = fixedTowall;
      this.CellSize = cellSize;

      ObjWidth = (int) (Obj.X.Length);
      ObjLength = (int) (Obj.Y.Length);
      ObjHeight = (int) (Obj.Z.Length);

      MrjWidth = (int) (ObjMargin.X.Length);
      MrjLength = (int) (ObjMargin.Y.Length);
      MrjHeight = (int) (ObjMargin.Z.Length);

      baseX = Obj.Plane.OriginX;
      baseY = Obj.Plane.OriginY;
      baseZ = Obj.Plane.OriginZ;

      this.PreviousObject = previousObject;
      this.SpaceList = spaceList;

    }

    public Objects(string name, int zoneName, bool front, bool right, bool back, bool left, bool top, bool bottom, bool rotationalBool, int rotationOpt, bool mirrorBool, int mirrorOpt, string source, int fixedTowall, int cellSize, Box obj, Box objMargin, List<int> spaceList)
      : this()
    {
      this.Obj = obj;
      this.ObjMargin = objMargin;

      this.Name = name;
      this.ZoneName = zoneName;

      this.Front = front;
      this.Right = right;
      this.Back = back;
      this.Left = left;
      this.Bottom = bottom;
      this.Top = top;

      this.RotationBool = rotationalBool;
      this.RotationOpt = rotationOpt;

      this.MirrorBool = mirrorBool;
      this.MirrorOpt = mirrorOpt;

      this.Source = source;
      this.FixedToWall = fixedTowall;
      this.CellSize = cellSize;

      ObjWidth = (int) (Obj.X.Length);
      ObjLength = (int) (Obj.Y.Length);
      ObjHeight = (int) (Obj.Z.Length);

      MrjWidth = (int) (ObjMargin.X.Length);
      MrjLength = (int) (ObjMargin.Y.Length);
      MrjHeight = (int) (ObjMargin.Z.Length);

      baseX = Obj.Plane.OriginX;
      baseY = Obj.Plane.OriginY;
      baseZ = Obj.Plane.OriginZ;

      this.SpaceList = spaceList;

    }

    public void placeFront(int [,,]emptyFullArray, int[,,]areaArray)
    { /*
      this.baseX = PreviousObject.baseX + PreviousObject.MrjLength;
      this.baseY = PreviousObject.baseY;
      this.baseZ = PreviousObject.baseZ;
      */
      bool emptyBool = true;
      bool sameZone = true;

      double XCell = Math.Ceiling((double) (this.MrjWidth / CellSize));
      double YCell = Math.Ceiling((double) (this.MrjLength / CellSize));
      double ZCell = Math.Ceiling((double) (this.MrjHeight / CellSize));

      for(int i = (int) (PreviousObject.baseX / CellSize) ; i < PreviousObject.baseX / CellSize + (int) XCell; i++)
      {
        for(int j = (int) (PreviousObject.baseY / CellSize); j < PreviousObject.baseY / CellSize + (int) YCell; j++)
        {
          for(int k = (int) (PreviousObject.baseZ / CellSize); k < PreviousObject.baseZ / CellSize + (int) ZCell; k++)
          {
            if (emptyFullArray[i, j, k] == 1)
            {
              emptyBool = false;
            }
            if (areaArray[i, j, k] != this.ZoneName)
            {
              sameZone = false;
            }

          }
        }
      }

      if (emptyBool && sameZone)
      {
        this.baseX = PreviousObject.baseX + CellSize * XCell;
        this.baseY = PreviousObject.baseY;
        this.baseZ = PreviousObject.baseZ;
      }

      for(int i = 0; i < XCell; i++)
      {
        for(int j = 0; j < YCell; j++)
        {
          for(int k = 0; k < ZCell; k++)
          {
            emptyFullArray[i, j, k] = 1;
          }
        }
      }

    }

    public void placeRight()
    {
      this.baseX = PreviousObject.baseX;
      this.baseY = PreviousObject.baseY + this.MrjWidth;
      this.baseZ = PreviousObject.baseZ;
    }

    public void placeBack()
    {
      //this.ObjMargin.Transform(Transform.Rotation(1 * Math.PI, new Point3d(this.baseX, this.baseY, this.baseZ)));
      //this.Obj.Transform(Transform.Rotation(1 * Math.PI, new Point3d(this.baseX, this.baseY, this.baseZ)));

      this.baseX = PreviousObject.baseX - this.MrjLength;
      this.baseY = PreviousObject.baseY;
      this.baseZ = PreviousObject.baseZ;
    }

    public void placeLeft()
    {
      this.baseX = PreviousObject.baseX;
      this.baseY = PreviousObject.baseY - PreviousObject.MrjWidth;
      this.baseZ = PreviousObject.baseZ;
    }
    public void placeTop()
    {
      this.baseX = PreviousObject.baseX;
      this.baseY = PreviousObject.baseY;
      this.baseZ = PreviousObject.baseZ + PreviousObject.MrjHeight;
    }

    public void placeBottom()
    {
      this.baseX = PreviousObject.baseX;
      this.baseY = PreviousObject.baseY;
      this.baseZ = PreviousObject.baseZ - this.MrjHeight;
    }

    public void placeObject()
    {
      if (RotationBool == false)
      {

      }
    }


    public Box placeRefObject()
    {
      var rand = new Random();
      var randomCellIndex = rand.Next(this.SpaceList.Count / 2);

      baseX = SpaceList[2 * randomCellIndex];
      baseY = SpaceList[2 * randomCellIndex + 1];
      baseZ = 0;

      Point3d pointa = new Point3d(baseX * CellSize, baseY * CellSize, 0);
      Vector3d pointb = new Vector3d(0, 0, 1);

      Plane planebase = new Plane(pointa, pointb);

      Interval xInterval = new Interval(baseX * CellSize, ObjWidth);
      Interval yInterval = new Interval(baseY * CellSize, ObjLength);
      Interval zInterval = new Interval(baseZ, ObjHeight);

      Box boxx = new Box(planebase, yInterval, xInterval, zInterval);
      return boxx;
    }

    static void rotate()
    {

    }



    static void mirror()
    {

    }

    static void getClosestCell()
    {

    }

    static void createWall()
    {

    }

  }




  static void ShowMatrix(int[,,] Arr)
  {
    for (int i = 0; i < Arr.GetLength(0); i++)
    {
      for (int j = 0; j < Arr.GetLength(1); j++)
      {
        Rhino.RhinoApp.Write(Arr[i, j, 0] + " ");
      }
      Rhino.RhinoApp.WriteLine("Loop Runs" + i.ToString());
    }
    return;
  }

  static int[,,] InitializeZeroMatrice(int width, int length, int levelNumber)
  {
    var areaArray = new int[width, length, levelNumber];

    for (int k = 0; k < levelNumber; k++)
    {
      for (int i = 0; i < width; i++)
      {
        for (int j = 0; j < length; j++)
        {
          areaArray[i, j, k] = 0;
        }
      }
    }
    return areaArray;
  }

  /* The Color lists keep the colors in a seperate List in order to choose within them easily instead of searching where they are... */
  static List<int> entranceList = new List<int>();
  static List<int> personalSpaceList = new List<int>();
  static List<int> wetAreaList = new List<int>();
  static List<int> kitchenList = new List<int>();
  static List<int> commonAreaList = new List<int>();

  /**           these counters are used for starting the límitations counts.         **/

  static int entranceCounter = 1;
  static int personalSpaceCounter = 1;
  static int wetAreaCounter = 1;
  static int kitchenCounter = 1;
  static int commonAreaCounter = 1;
  /**           these limits are used for defining max distance that zone can spread.  **/

  static int entranceLimit = 200;
  static int personalSpaceLimit = 200;
  static int wetAreaLimit = 200;
  static int kitchenLimit = 200;
  static int commonAreaLimit = 100;

  static void StartZones(int[,,] arr)
  {
            /**
             * Randomly Starts the color. Takes the Color lists as argumnts
             * (We can delete these argumnents and it can get them as local referance
             * in our case it gives us a chance to choose what to initilize)
             * **/

    Random rand = new Random();
    //----------------------
    /* GetLength(0) and GetLength(1) might be set as variable */
    //Array.GetLength(0) gives the column lenght in other words length of an array
    //Array.GetLength(1) gives the row lenght in other words width of an array
    var a = rand.Next(arr.GetLength(0) / 2, arr.GetLength(0) / 2);
    var b = rand.Next(0, 2);

    Rhino.RhinoApp.WriteLine("started");
    entranceList.AddRange(new int[2] { a, b }); //AddRange ==> Adds multiple elements to a List . We use mod%2 to call the index of the point back instead of stacking them as an another List(or Array) in our list.
    arr[a, b, 0] = 1;// entrance Starting Point
    //----------------------

    b = rand.Next(0, arr.GetLength(1));
    a = rand.Next(0, arr.GetLength(0));

    personalSpaceList.AddRange(new int[2] { a, b });
    arr[a, b, 0] = 2; // personalSpace Starting Point
    //----------------------
    a = rand.Next(0, arr.GetLength(0));
    b = rand.Next(0, arr.GetLength(1));

    wetAreaList.AddRange(new int[2] { a, b });
    arr[a, b, 0] = 3; // wetArea Starting Point
    //----------------------
    a = rand.Next(0, arr.GetLength(0));
    b = rand.Next(0, arr.GetLength(1));

    kitchenList.AddRange(new int[2] { a, b });
    arr[a, b, 0] = 4; // kitchen Starting Point
    //----------------------
    a = rand.Next(0, arr.GetLength(0));
    b = rand.Next(0, arr.GetLength(1));

    commonAreaList.AddRange(new int[2] { a, b });
    arr[a, b, 0] = 5; // commonArea Starting Point
    //----------------------
  }
        /* Calculates the distance between initial point in the color and the possible new point!
         *  (if the possible new point is too far from inital point eleminate it.) */
  static double distanceCalculate(List<int> spaceCoordList, int x2, int y2, int cellSize)
  {
    var distance = cellSize * Math.Sqrt((y2 - spaceCoordList[1]) * (y2 - spaceCoordList[1]) + (x2 - spaceCoordList[0]) * (x2 - spaceCoordList[0]));
    return distance;
  }

  static void Evaluate()
  {
    // according to relations give score to the created zones
    // get the centers of the zones and acoording to the distances and created sizes give
    //positive or negative points and if score is not acceptable re-run and create variatians.
  }


  static void noiseFilter (int [,,] arr, int type, int iterationNumber, int controlNumber)
  {

    if(type == 0)
    {
      for( int loop = 0 ; loop < iterationNumber ; loop++ )
      {
        List < int> surrounding = new List<int>();
        for(int i = 1 ; i < arr.GetLength(0) - 1 ;i++)
        {
          for(int j = 1 ; j < arr.GetLength(1) - 1 ;j++)
          {
            for(int x = -1 ; x < 2;x++)
            {
              for(int y = -1 ; y < 2;y++)
              {
                if(!(x == y && x == 0))
                {

                  surrounding.Add(arr[i + x, j + y, 0]);
                }
              }
            }

            for (int v = 0 ; v < 6 ;v++) // 6 is the number of the zones including  empty cells
            {
              int count = (from z in surrounding where z == v select z).Count();
              if ( count >= controlNumber )
              {
                arr[i, j, 0] = v;
              }
            }
            surrounding.Clear();
            surrounding.TrimExcess();
          }
        }
      }
    }

    if(type == 1)
    {
      for( int loop = 0 ; loop < iterationNumber ; loop++ )
      {
        List < int> surrounding = new List<int>();
        for(int i = 1 ; i < arr.GetLength(0) - 1 ;i++)
        {
          for(int j = 1 ; j < arr.GetLength(1) - 1 ;j++)
          {
            for(int x = -1 ; x < 2;x++)
            {
              for(int y = -1 ; y < 2;y++)
              {
                if(!(x == y && x == 0) && ( (x + y == 1 ) || (x + y == -1 )) )
                {

                  surrounding.Add(arr[i + x, j + y, 0]);
                }
              }
            }

            for (int v = 0 ; v < 6 ;v++) // 6 is the number of the zones including  empty cells
            {
              int count = (from z in surrounding where z == v select z).Count();
              if ( count >= 2 )
              {
                arr[i, j, 0] = v;
              }
            }
            surrounding.Clear();
            surrounding.TrimExcess();
          }
        }
      }
    }
  }

  static void Spread(int[,,] arr, ref double spaceSize, List<int> spaceCoordList, ref int counter, int spaceLimit, int cellSize)
  {
        /*ARGUMENTS
     * The main array which has rectangular form(will be 3d in short) ,
     * spaceSize = Maximum limit that can grow.  ,
     * spaceCoordList =  the cells of the zone which has been already defined. )
     */
    var rand = new Random();
    var directionList = new List<int>();
    int Xcoord;
    int Ycoord;
    bool draw = false;
    int trycount = 0;

    while (draw == false && counter <= spaceSize)
    {
      if (counter <= spaceSize) //Can be deleted. The condition is added to the While Loop Conditions.
      {
        var randomCellIndex = rand.Next(spaceCoordList.Count / 2);

        Xcoord = spaceCoordList[2 * randomCellIndex];
        Ycoord = spaceCoordList[2 * randomCellIndex + 1];

        if (Xcoord < arr.GetLength(0) - 1 && Xcoord > 0 && Ycoord > 0 && Ycoord < arr.GetLength(1) - 1)
        {
          /* Check the conditions INSIDE borders */
          if (arr[Xcoord + 1, Ycoord, 0] == 0 && distanceCalculate(spaceCoordList, Xcoord + 1, Ycoord, cellSize) < spaceLimit ) // Check if possible new cell is still white or not!
            directionList.AddRange(new int[2] { (Xcoord + 1), Ycoord }); //Store possible spread directions in a list.

          if (arr[Xcoord - 1, Ycoord, 0] == 0 && distanceCalculate(spaceCoordList, Xcoord - 1, Ycoord, cellSize) < spaceLimit)
            directionList.AddRange(new int[2] { (Xcoord - 1), Ycoord }); //Store possible spread directions in a list.

          if (arr[Xcoord, Ycoord + 1, 0] == 0 && distanceCalculate(spaceCoordList, Xcoord, Ycoord + 1, cellSize) < spaceLimit)
            directionList.AddRange(new int[2] { (Xcoord), Ycoord + 1 }); //Store possible spread directions in a list.

          if (arr[Xcoord, Ycoord - 1, 0] == 0 && distanceCalculate(spaceCoordList, Xcoord, Ycoord - 1, cellSize) < spaceLimit)
            directionList.AddRange(new int[2] { (Xcoord), (Ycoord - 1) }); //Store possible spread directions in a list.

          if (directionList.Count > 0)
          {
            var randomIndex = rand.Next(directionList.Count / 2);
            int a = directionList[2 * randomIndex];
            int b = directionList[2 * randomIndex + 1];

            arr[a, b, 0] = arr[Xcoord, Ycoord, 0];

            spaceCoordList.AddRange(new int[2] { a, b });

            directionList.Clear();
            directionList.TrimExcess();
            draw = true;
            counter++;
          }
          else
          {
            trycount++;
            if (trycount >= spaceCoordList.Count)
            {
              draw = true;
              //Print("trycountNumber is ={0}", trycount);
            }
          }
        }

          /* EDGE CONDITIONS */
          //RIGHT
        else if (Xcoord == (arr.GetLength(0) - 1) && Ycoord != 0 && Ycoord != (arr.GetLength(1) - 1))
        {
          if (arr[Xcoord - 1, Ycoord, 0] == 0 && distanceCalculate(spaceCoordList, Xcoord - 1, Ycoord, cellSize) < spaceLimit )
            directionList.AddRange(new int[2] { (Xcoord - 1), (Ycoord) }); //Store possible spread directions in a list.
          if (arr[Xcoord, Ycoord + 1, 0] == 0 && distanceCalculate(spaceCoordList, Xcoord, Ycoord + 1, cellSize) < spaceLimit )
            directionList.AddRange(new int[2] { (Xcoord ), (Ycoord + 1) }); //Store possible spread directions in a list.
          if (arr[Xcoord, Ycoord - 1, 0] == 0 && distanceCalculate(spaceCoordList, Xcoord, Ycoord - 1, cellSize) < spaceLimit )
            directionList.AddRange(new int[2] { (Xcoord ), (Ycoord - 1) }); //Store possible spread directions in a list.

          if (directionList.Count > 0)
          {
            var randomIndex = rand.Next(directionList.Count / 2);
            int a = directionList[2 * randomIndex];
            int b = directionList[2 * randomIndex + 1];

            arr[a, b, 0] = arr[Xcoord, Ycoord, 0];

            spaceCoordList.AddRange(new int[2] { a, b });

            directionList.Clear();
            directionList.TrimExcess();
            draw = true;
            counter++;
          }
          else
          {
            trycount++;
            if (trycount >= spaceCoordList.Count)
            {
              draw = true;
              //Print("trycountNumber is ={0}", trycount);
            }
          }
        }

          //Left
        else if (Xcoord == 0 && Ycoord != 0 && Ycoord != (arr.GetLength(1) - 1))
        {

          if (arr[Xcoord + 1, Ycoord, 0] == 0 && distanceCalculate(spaceCoordList, Xcoord + 1, Ycoord, cellSize) < spaceLimit )
            directionList.AddRange(new int[2] { (Xcoord + 1), (Ycoord) }); //Store possible spread directions in a list.
          if (arr[Xcoord, Ycoord + 1, 0] == 0 && distanceCalculate(spaceCoordList, Xcoord, Ycoord + 1, cellSize) < spaceLimit )
            directionList.AddRange(new int[2] { (Xcoord ), (Ycoord + 1) }); //Store possible spread directions in a list.
          if (arr[Xcoord, Ycoord - 1, 0] == 0 && distanceCalculate(spaceCoordList, Xcoord, Ycoord - 1, cellSize) < spaceLimit )
            directionList.AddRange(new int[2] { (Xcoord ), (Ycoord - 1) }); //Store possible spread directions in a list.
          if (directionList.Count > 0)
          {
            var randomIndex = rand.Next(directionList.Count / 2);
            int a = directionList[2 * randomIndex];
            int b = directionList[2 * randomIndex + 1];

            arr[a, b, 0] = arr[Xcoord, Ycoord, 0];

            spaceCoordList.AddRange(new int[2] { a, b });

            directionList.Clear();
            directionList.TrimExcess();
            draw = true;
            counter++;
          }
          else
          {
            trycount++;
            if (trycount >= spaceCoordList.Count)
            {
              draw = true;
              //Print("trycountNumber is ={0}", trycount);
            }
          }

        }
          //TOP
        else if ((Ycoord == arr.GetLength(1) - 1) && Xcoord != 0 && Xcoord != (arr.GetLength(0) - 1))
        {

          if (arr[Xcoord, Ycoord - 1, 0] == 0 && distanceCalculate(spaceCoordList, Xcoord, Ycoord - 1, cellSize) < spaceLimit )
            directionList.AddRange(new int[2] { (Xcoord ), (Ycoord - 1) }); //Store possible spread directions in a list.
          if (arr[Xcoord + 1, Ycoord, 0] == 0 && distanceCalculate(spaceCoordList, Xcoord + 1, Ycoord, cellSize) < spaceLimit )
            directionList.AddRange(new int[2] { (Xcoord + 1 ), (Ycoord ) }); //Store possible spread directions in a list.
          if (arr[Xcoord - 1, Ycoord, 0] == 0 && distanceCalculate(spaceCoordList, Xcoord - 1, Ycoord, cellSize) < spaceLimit )
            directionList.AddRange(new int[2] { (Xcoord - 1), (Ycoord ) }); //Store possible spread directions in a list.
          if (directionList.Count > 0)
          {
            var randomIndex = rand.Next(directionList.Count / 2);
            int a = directionList[2 * randomIndex];
            int b = directionList[2 * randomIndex + 1];

            arr[a, b, 0] = arr[Xcoord, Ycoord, 0];

            spaceCoordList.AddRange(new int[2] { a, b });

            directionList.Clear();
            directionList.TrimExcess();
            draw = true;
            counter++;
          }
          else
          {
            trycount++;
            if (trycount >= spaceCoordList.Count)
            {
              draw = true;
              //Print("trycountNumber is ={0}", trycount);
            }
          }
        }
          //BOTTOM
        else if (Ycoord == 0 && Xcoord != 0 && Xcoord != (arr.GetLength(0) - 1))
        {
          if (arr[Xcoord, Ycoord + 1, 0] == 0 && distanceCalculate(spaceCoordList, Xcoord, Ycoord + 1, cellSize) < spaceLimit )
            directionList.AddRange(new int[2] { (Xcoord ), (Ycoord + 1) }); //Store possible spread directions in a list.
          if (arr[Xcoord + 1, Ycoord, 0] == 0 && distanceCalculate(spaceCoordList, Xcoord + 1, Ycoord, cellSize) < spaceLimit )
            directionList.AddRange(new int[2] { (Xcoord + 1 ), (Ycoord ) }); //Store possible spread directions in a list.
          if (arr[Xcoord - 1, Ycoord, 0] == 0 && distanceCalculate(spaceCoordList, Xcoord - 1, Ycoord, cellSize) < spaceLimit )
            directionList.AddRange(new int[2] { (Xcoord - 1), (Ycoord ) }); //Store possible spread directions in a list.
          if (directionList.Count > 0)
          {
            var randomIndex = rand.Next(directionList.Count / 2);
            int a = directionList[2 * randomIndex];
            int b = directionList[2 * randomIndex + 1];

            arr[a, b, 0] = arr[Xcoord, Ycoord, 0];

            spaceCoordList.AddRange(new int[2] { a, b });

            directionList.Clear();
            directionList.TrimExcess();
            draw = true;
            counter++;
          }
          else
          {
            trycount++;
            if (trycount >= spaceCoordList.Count)
            {
              draw = true;
              //Print("trycountNumber is ={0}", trycount);
            }
          }
        }

          //LEFT BOTTOM
        else if (Xcoord == 0 && Ycoord == 0)
        {
          if (arr[Xcoord, Ycoord + 1, 0] == 0 && distanceCalculate(spaceCoordList, Xcoord, Ycoord + 1, cellSize) < spaceLimit)
            directionList.Add(Xcoord); directionList.Add(Ycoord + 1);

          if (arr[Xcoord + 1, Ycoord, 0] == 0 && distanceCalculate(spaceCoordList, Xcoord + 1, Ycoord, cellSize) < spaceLimit)
            directionList.Add(Xcoord + 1); directionList.Add(Ycoord);

          if (directionList.Count > 0)
          {

            var randomIndex = rand.Next(directionList.Count / 2);

            int a = directionList[2 * randomIndex];
            int b = directionList[2 * randomIndex + 1];

            arr[a, b, 0] = arr[Xcoord, Ycoord, 0];

            spaceCoordList.AddRange(new int[2] { a, b });

            directionList.Clear();
            directionList.TrimExcess();
            draw = true;

            counter++;
            //Print(" Counter Number is : {0}", counter);
          }
          else
          {
            trycount++;
            if (trycount >= spaceCoordList.Count)
            {
              draw = true;
              //Print("trycountNumber is ={0}", trycount);
            }
          }
        }
          //LEFT  TOP
          /*
          else if (Xcoord == 0 && Ycoord == (arr.GetLength(1) - 1))
          {
          if (arr[Xcoord + 1, Ycoord] == 0)
          directionList.Add(Xcoord + 1); directionList.Add(Ycoord);

          if (arr[Xcoord, Ycoord - 1] == 0)
          directionList.Add(Xcoord); directionList.Add(Ycoord - 1);

          if (directionList.Count > 0)
          {
          var randomIndex = rand.Next(directionList.Count / 2);

          int a = directionList[2 * randomIndex];
          int b = directionList[2 * randomIndex + 1];

          Rhino.RhinoApp.WriteLine("Left Top "  +  a +  " "  +  b);
          arr[a, b] = arr[Xcoord, Ycoord];

          spaceCoordList.AddRange(new int[2] { a, b });

          directionList.Clear();
          directionList.TrimExcess();
          draw = true;

          counter++;
          //Print(" Counter Number is : {0}", counter);
          }
          else
          {
          trycount++;
          if (trycount >= spaceCoordList.Count)
          {
          draw = true;
          //Print("trycountNumber is ={0}", trycount);
          }
          }
          }
          */
          /*
          //RIGHT TOP
          else if (Xcoord == (arr.GetLength(0) - 1) && Ycoord == (arr.GetLength(1) - 1))
          {
          if (arr[Xcoord, Ycoord - 1] == 0)
          directionList.Add(Xcoord); directionList.Add(Ycoord - 1);

          if (arr[Xcoord - 1, Ycoord] == 0)
          directionList.Add(Xcoord - 1); directionList.Add(Ycoord);

          if (directionList.Count > 0)
          {
          var randomIndex = rand.Next(directionList.Count / 2);

          int a = directionList[2 * randomIndex];
          int b = directionList[2 * randomIndex + 1];
          Rhino.RhinoApp.WriteLine(" Right top "+ a + " " + b);
          arr[a, b] = arr[Xcoord, Ycoord];

          //spaceCoordList.AddRange(new int[2] { a, b });

          directionList.Clear();
          directionList.TrimExcess();
          draw = true;

          counter++;
          //Print(" Counter Number is : {0}", counter);
          }
          else
          {
          trycount++;
          if (trycount >= spaceCoordList.Count)
          {
          draw = true;
          //Print("trycountNumber is ={0}", trycount);
          }
          }
          }
          */
          //RIGHT BOTTOM
        else if (Xcoord == (arr.GetLength(0) - 1) && Ycoord == 0)
        {
          if (arr[Xcoord, Ycoord + 1, 0] == 0)
            directionList.Add(Xcoord); directionList.Add(Ycoord + 1);

          if (arr[Xcoord - 1, Ycoord, 0] == 0)
            directionList.Add(Xcoord - 1); directionList.Add(Ycoord);

          if (directionList.Count > 0)
          {
            var randomIndex = rand.Next(directionList.Count / 2);

            int a = directionList[2 * randomIndex];
            int b = directionList[2 * randomIndex + 1];

            arr[a, b, 0] = arr[Xcoord, Ycoord, 0];

            spaceCoordList.AddRange(new int[2] { a, b });

            directionList.Clear();
            directionList.TrimExcess();

            draw = true;
            counter++;
            //Print(" Counter Number is : {0}", counter);
          }
          else
          {
            trycount++;
            if (trycount >= spaceCoordList.Count)
            {
              draw = true;
              //Print("trycountNumber is ={0}", trycount);
            }
          }
        }
        /* EDGE CONDITIONS */
      }
    }

  }




    /* Instead of wrting methods seperately in main program, it is better to use class based
     informations to keep things organized, we are not yet transsferentrance methods here but we created the str.*/

    /*
    public class Zone
    {
        public string Name;
        public int SpaceLimit;
        public Int16 SpaceSize;
        public int Counter;
        public List<Int16> SpaceList;

        public void Describe()
        {
            Console.WriteLine("Hey this zone is{ 0} ", Name);
        }

        public Zone()
        {
           // SpaceList = new List<int>();
        }

        public Zone(string name, int spaceLimit,int spacesize,int counter, List<int> SpaceList)
        :this()
        {
        }
        static void InitializeZeroMatrice() { }
        static void startZones() { }
        public void SpreadZones() { }

    }
    */
# ---------- end c_script_5 ----------
deconstruct_domain_34 = DeconstructDomain(Domain=panel_29)  # -> Start, End
deconstruct_domain_35 = DeconstructDomain(Domain=panel_31)  # -> Start, End
deconstruct_domain_36 = DeconstructDomain(Domain=panel_30)  # -> Start, End
deconstruct_domain_37 = DeconstructDomain(Domain=panel_33)  # -> Start, End
deconstruct_domain_38 = DeconstructDomain(Domain=panel_34)  # -> Start, End
deconstruct_domain_39 = DeconstructDomain(Domain=panel_35)  # -> Start, End
c_script_6 = CSharpScript(
    Width=integer_2,
    Length=integer,
    Height=integer_3,
    LevelHeight=number_slider_83,
    cellSize=multiplication_6,
    ConnectionPoint=box_7,
    ConnectionPointMargin=box_8,
    ChangeOverZone=box_5,
    ChangeOverZoneMargin=box_9)  # -> out, A, R, G, B, Y, K, W, Bxx; inputs Width: Int32, Length: Int32, Height: Int32, LevelHeight: Int32, cellSize: Int32, iteration: Int32, ConnectionPoint: Box, ConnectionPointMargin: Box, ChangeOverZone: Box, ChangeOverZoneMargin: Box; disabled
# ---------- c_script_6: C# ----------
    List<Box> entranceBoxes = new List<Box>();
    List<Box> wetAreaBoxes = new List<Box>();
    List<Box> personalSpaceBoxes = new List<Box>();
    List<Box> kitchenBoxes = new List<Box>();
    List<Box> commonAreaBoxes = new List<Box>();
    List<Box> WhiteBoxes = new List<Box>();

    /**           These sizes are Spreading Limits for the spaces   //total cells           **/

    double entranceSize = 3 * 100 * 100 / cellSize * cellSize;
    double personalSpaceSize = 3 * 100 * 100 / cellSize * cellSize;
    double wetAreaSize = 2.5 * 100 * 100 / cellSize * cellSize;
    double kitchenSize = 5 * 100 * 100 / cellSize * cellSize;;
    double commonAreaSize = 10 * 100 * 100 / cellSize * cellSize;;

    Point3d pA = new Point3d(0, 0, 0);
    Point3d pB = new Point3d(10, 0, 0);
    Point3d pC = new Point3d(0, 10, 0);

    Plane p = new Plane(pA, pB, pC);

    int width = Width;
    int length = Length;
    int levelHeight = LevelHeight;
    int height = Height;
    int levelNumber = Height / LevelHeight;

    int[,,] areaArray = InitializeZeroMatrice(length, width, levelNumber);
    StartZones(areaArray);

    int[,,] emptyFullArray = InitializeZeroMatrice(length, width, levelNumber);

    for (int i = 0; i < width * length * 3; i++)
    {
      Rhino.RhinoApp.WriteLine("Loop Runs" + i.ToString());
      Spread(areaArray, ref entranceSize, entranceList, ref entranceCounter, entranceLimit, cellSize);
      Spread(areaArray, ref personalSpaceSize, personalSpaceList, ref personalSpaceCounter, personalSpaceLimit, cellSize);
      Spread(areaArray, ref wetAreaSize, wetAreaList, ref wetAreaCounter, wetAreaLimit, cellSize);
      Spread(areaArray, ref kitchenSize, kitchenList, ref kitchenCounter, kitchenLimit, cellSize);
      Spread(areaArray, ref commonAreaSize, commonAreaList, ref commonAreaCounter, commonAreaLimit, cellSize);
    }

    noiseFilter(areaArray, 0, 6, 5);
    noiseFilter(areaArray, 1, 2, 2);

    for (int k = 0;k < levelNumber;k++)
    {
      for (int i = 0;i < length;i++)
      {
        for (int j = 0;j < width;j++)
        {
          areaArray[i, j, k] = areaArray[i, j, 0];
        }
      }
    }

    for (int k = 0;k < levelNumber;k++)
    {
      for (int i = 0;i < length;i++)
      {
        for (int j = 0;j < width;j++)
        {
          emptyFullArray[i, j, k] = 0;
        }
      }
    }

    entranceList.Clear();
    personalSpaceList.Clear();
    wetAreaList.Clear();
    kitchenList.Clear();
    commonAreaList.Clear();

    for (int k = 0;k < levelNumber;k++)
    {
      for (int i = 0;i < length;i++)
      {
        for (int j = 0;j < width;j++)
        {
          if (areaArray[i, j, k] == 1)
          {
            Interval xInterval = new Interval(j * cellSize, (j + 1) * (cellSize ));
            Interval yInterval = new Interval(i * cellSize, (i + 1) * (cellSize ));
            Interval zInterval = new Interval(k * LevelHeight, k * LevelHeight + levelHeight);

            Box boxgh = new Box(p, xInterval, yInterval, zInterval);
            entranceBoxes.Add(boxgh);
            entranceList.AddRange(new int[2] { i, j });
          }
          if (areaArray[i, j, k] == 2)
          {
            Interval xInterval = new Interval(j * cellSize, (j + 1) * (cellSize ));
            Interval yInterval = new Interval(i * cellSize, (i + 1) * (cellSize ));
            Interval zInterval = new Interval(k * LevelHeight, k * LevelHeight + levelHeight);

            Box boxgh = new Box(p, xInterval, yInterval, zInterval);
            wetAreaBoxes.Add(boxgh);
            wetAreaList.AddRange(new int[2] { i, j });
          }
          if (areaArray[i, j, k] == 3)
          {
            Interval xInterval = new Interval(j * cellSize, (j + 1) * (cellSize ));
            Interval yInterval = new Interval(i * cellSize, (i + 1) * (cellSize ));
            Interval zInterval = new Interval(k * LevelHeight, k * LevelHeight + levelHeight);

            Box boxgh = new Box(p, xInterval, yInterval, zInterval);
            personalSpaceBoxes.Add(boxgh);
            personalSpaceList.AddRange(new int[2] { i, j });
          }
          if (areaArray[i, j, k] == 4)
          {
            Interval xInterval = new Interval(j * cellSize, (j + 1) * (cellSize ));
            Interval yInterval = new Interval(i * cellSize, (i + 1) * (cellSize ));
            Interval zInterval = new Interval(k * LevelHeight, k * LevelHeight + levelHeight);

            Box boxgh = new Box(p, xInterval, yInterval, zInterval);
            kitchenBoxes.Add(boxgh);
            kitchenList.AddRange(new int[2] { i, j });
          }
          if (areaArray[i, j, k] == 5)
          {
            Interval xInterval = new Interval(j * cellSize, (j + 1) * (cellSize ));
            Interval yInterval = new Interval(i * cellSize, (i + 1) * (cellSize ));
            Interval zInterval = new Interval(k * LevelHeight, k * LevelHeight + levelHeight);

            Box boxgh = new Box(p, xInterval, yInterval, zInterval);
            commonAreaBoxes.Add(boxgh);
            commonAreaList.AddRange(new int[2] { i, j });
          }
          if (areaArray[i, j, k] == 0)
          {

            Interval xInterval = new Interval(j * cellSize, (j + 1) * (cellSize ));
            Interval yInterval = new Interval(i * cellSize, (i + 1) * (cellSize ));
            Interval zInterval = new Interval(k * LevelHeight, k * LevelHeight + levelHeight);

            Box boxgh = new Box(p, xInterval, yInterval, zInterval);
            WhiteBoxes.Add(boxgh);
            //WhiteList.AddRange(i, j);
          }
        }
      }
    }

    var connectionPointO = new Objects
      {
        Name = "changeOverZone",
        ZoneName = 2,

        Obj = ConnectionPoint,
        ObjMargin = ConnectionPointMargin,

        Front = true,
        Right = true,
        Back = false,
        Left = false,
        Top = false,
        Bottom = false,

        RotationBool = false,
        RotationOpt = 2,

        MirrorBool = false,
        MirrorOpt = 2,

        Source = "NULL",
        FixedToWall = 1,
        CellSize = 60,

        //PreviousObject = changeOverZoneO

        };

    var changeOverZoneO = new Objects
      {
        Name = "changeOverZone",
        ZoneName = 2,

        Obj = ChangeOverZone,
        ObjMargin = ChangeOverZoneMargin,

        Front = true,
        Right = true,
        Back = false,
        Left = false,
        Top = false,
        Bottom = false,

        RotationBool = false,
        RotationOpt = 2,

        MirrorBool = false,
        MirrorOpt = 2,

        Source = "NULL",
        FixedToWall = 1,
        CellSize = 60,
        PreviousObject = connectionPointO,

        };

    connectionPointO.placeRefObject();


    var randd = new Random();
    //var entranceList = new List<int>();
    //entranceList.Add(3);entranceList.Add(4);
    Rhino.RhinoApp.WriteLine(entranceList.Count().ToString());
    var randomIndex = randd.Next(entranceList.Count / 2);
    int a = entranceList[2 * randomIndex];
    int b = entranceList[2 * randomIndex + 1];

    Point3d pointa = new Point3d(0 * cellSize, b * cellSize, 0);
    Vector3d pointb = new Vector3d(0, 0, 1);

    Plane planebase = new Plane(pointa, pointb);

    Box boxx = new Box(planebase, ConnectionPoint.Y, ConnectionPoint.X, ConnectionPoint.Z);
/*
    //var entranceList = new List<int>();
    //entranceList.Add(3);entranceList.Add(4);
    Rhino.RhinoApp.WriteLine(wetAreaList.Count().ToString());
    var randomIndex = randd.Next(wetAreaList.Count / 2);
    int a = entranceList[2 * randomIndex];
    int b = entranceList[2 * randomIndex + 1];

    Point3d pointa = new Point3d(0 * cellSize, b * cellSize, 0);
    Vector3d pointb = new Vector3d(0, 0, 1);

    Plane planebase = new Plane(pointa, pointb);


    Box boxx = new Box(planebase, ChangeOverZone.Y, ChangeOverZone.X, ChangeOverZone.Z);
    */

    ShowMatrix(areaArray);

    Bxx = boxx;
    A = areaArray;
    R = entranceBoxes;
    G = personalSpaceBoxes;
    B = wetAreaBoxes;
    Y = kitchenBoxes;
    K = commonAreaBoxes;
    W = WhiteBoxes;
# ---------- c_script_6: C# additional code ----------
  class Objects
  {
    public string Name;
    public int ZoneName;

    public Box Obj;
    public Box ObjMargin;

    public bool Front = false;
    public bool Right = false;
    public bool Back = false;
    public bool Left = false;
    public bool Top = false;
    public bool Bottom = false;

    public bool RotationBool = true;
    public int RotationOpt; // rotation options

    public bool MirrorBool = true;
    public int MirrorOpt; // mirror options

    public string Source; // Water, Electiricity
    public int FixedToWall; // Bed, Television //1,2,3 conditions
    public int CellSize;

    public Objects PreviousObject;

    int ObjLength;
    int ObjWidth;
    int ObjHeight;

    int MrjLength;
    int MrjWidth;
    int MrjHeight;

    public double baseX, baseY, baseZ;
    List<int> SpaceList = new List<int>();

    //deneme
    public Objects()
    {
            /*
            var Coordinates = new List<int>();
            Point3d pA = new Point3d(0, 0, 0);
            Point3d pB = new Point3d(10, 0, 0);
            Point3d pC = new Point3d(0, 10, 0);

            Plane p = new Plane(pA, pB, pC);*/
    }

    public Objects(string name, int zoneName, bool front, bool right, bool back, bool left, bool top, bool bottom, bool rotationalBool, int rotationOpt, bool mirrorBool, int mirrorOpt, string source, int fixedTowall, int cellSize, Box obj, Box objMargin, Objects previousObject, List<int> spaceList)
      : this()
    {
      this.Obj = obj;
      this.ObjMargin = objMargin;

      this.Name = name;
      this.ZoneName = zoneName;

      this.Front = front;
      this.Right = right;
      this.Back = back;
      this.Left = left;
      this.Bottom = bottom;
      this.Top = top;

      this.RotationBool = rotationalBool;
      this.RotationOpt = rotationOpt;

      this.MirrorBool = mirrorBool;
      this.MirrorOpt = mirrorOpt;

      this.Source = source;
      this.FixedToWall = fixedTowall;
      this.CellSize = cellSize;

      ObjWidth = (int) (Obj.X.Length);
      ObjLength = (int) (Obj.Y.Length);
      ObjHeight = (int) (Obj.Z.Length);

      MrjWidth = (int) (ObjMargin.X.Length);
      MrjLength = (int) (ObjMargin.Y.Length);
      MrjHeight = (int) (ObjMargin.Z.Length);

      baseX = Obj.Plane.OriginX;
      baseY = Obj.Plane.OriginY;
      baseZ = Obj.Plane.OriginZ;

      this.PreviousObject = previousObject;
      SpaceList = spaceList;

    }

    public Objects(string name, int zoneName, bool front, bool right, bool back, bool left, bool top, bool bottom, bool rotationalBool, int rotationOpt, bool mirrorBool, int mirrorOpt, string source, int fixedTowall, int cellSize, Box obj, Box objMargin, List<int> spaceList)
      : this()
    {
      this.Obj = obj;
      this.ObjMargin = objMargin;

      this.Name = name;
      this.ZoneName = zoneName;

      this.Front = front;
      this.Right = right;
      this.Back = back;
      this.Left = left;
      this.Bottom = bottom;
      this.Top = top;

      this.RotationBool = rotationalBool;
      this.RotationOpt = rotationOpt;

      this.MirrorBool = mirrorBool;
      this.MirrorOpt = mirrorOpt;

      this.Source = source;
      this.FixedToWall = fixedTowall;
      this.CellSize = cellSize;

      ObjWidth = (int) (Obj.X.Length);
      ObjLength = (int) (Obj.Y.Length);
      ObjHeight = (int) (Obj.Z.Length);

      MrjWidth = (int) (ObjMargin.X.Length);
      MrjLength = (int) (ObjMargin.Y.Length);
      MrjHeight = (int) (ObjMargin.Z.Length);

      baseX = Obj.Plane.OriginX;
      baseY = Obj.Plane.OriginY;
      baseZ = Obj.Plane.OriginZ;

      SpaceList = spaceList;

    }

    public void placeFront()
    { /*
      this.baseX = PreviousObject.baseX + PreviousObject.MrjLength;
      this.baseY = PreviousObject.baseY;
      this.baseZ = PreviousObject.baseZ;
      */
      Bool emptyBool = true;

      int Xcell = Math.Ceiling((double) (PreviousObject.MrjWidth / CellSize));
      int YCell = Math.Ceiling((double) (PreviousObject.MrjLength / CellSize));
      int ZCell = Math.Ceiling((double) (PreviousObject.MrjHeight / CellSize));

      for(int i = 0; i < Xcell; i++)
      {
        for(int j = 0; j < Ycell; j++)
        {
          for(int k = 0; k < Zcell; k++)
          {
            if (emptyFullArray[i, j, k] != 0)
            {
              emptyBool = false;
            }
          }
        }
        if (emptyBool = true)
        {
          this.baseX = PreviousObject.baseX + Cellsize*Xcell;
          this.baseY = PreviousObject.baseY;
          this.baseZ = PreviousObject.baseZ;
        }
       
      }




    }

    public void placeRight()
    {
      this.baseX = PreviousObject.baseX;
      this.baseY = PreviousObject.baseY + this.MrjWidth;
      this.baseZ = PreviousObject.baseZ;
    }

    public void placeBack()
    {
      //this.ObjMargin.Transform(Transform.Rotation(1 * Math.PI, new Point3d(this.baseX, this.baseY, this.baseZ)));
      //this.Obj.Transform(Transform.Rotation(1 * Math.PI, new Point3d(this.baseX, this.baseY, this.baseZ)));

      this.baseX = PreviousObject.baseX - this.MrjLength;
      this.baseY = PreviousObject.baseY;
      this.baseZ = PreviousObject.baseZ;
    }

    public void placeLeft()
    {
      this.baseX = PreviousObject.baseX;
      this.baseY = PreviousObject.baseY - PreviousObject.MrjWidth;
      this.baseZ = PreviousObject.baseZ;
    }
    public void placeTop()
    {
      this.baseX = PreviousObject.baseX;
      this.baseY = PreviousObject.baseY;
      this.baseZ = PreviousObject.baseZ + PreviousObject.MrjHeight;
    }

    public void placeBottom()
    {
      this.baseX = PreviousObject.baseX;
      this.baseY = PreviousObject.baseY;
      this.baseZ = PreviousObject.baseZ - this.MrjHeight;
    }

    public void placeObject()
    {
      if (RotationBool == false)
      {

      }
    }


    public Box placeRefObject()
    {
      var rand = new Random();
      var randomCellIndex = rand.Next(this.SpaceList.Count / 2);

      baseX = SpaceList[2 * randomCellIndex];
      baseY = SpaceList[2 * randomCellIndex + 1];
      baseZ = 0;

      Point3d pointa = new Point3d(baseX * CellSize, baseY * CellSize, 0);
      Vector3d pointb = new Vector3d(0, 0, 1);

      Plane planebase = new Plane(pointa, pointb);

      Interval xInterval = new Interval(baseX * CellSize, ObjWidth);
      Interval yInterval = new Interval(baseY * CellSize, ObjLength);
      Interval zInterval = new Interval(baseZ, ObjHeight);

      Box boxx = new Box(planebase, yInterval, xInterval, zInterval);
      return boxx;
    }

    static void rotate()
    {

    }



    static void mirror()
    {

    }

    static void getClosestCell()
    {

    }

    static void createWall()
    {

    }

  }




  static void ShowMatrix(int[,,] Arr)
  {
    for (int i = 0; i < Arr.GetLength(0); i++)
    {
      for (int j = 0; j < Arr.GetLength(1); j++)
      {
        Rhino.RhinoApp.Write(Arr[i, j, 0] + " ");
      }
      Rhino.RhinoApp.WriteLine("Loop Runs" + i.ToString());
    }
    return;
  }

  static int[,,] InitializeZeroMatrice(int width, int length, int levelNumber)
  {
    var areaArray = new int[width, length, levelNumber];

    for (int k = 0; k < levelNumber; k++)
    {
      for (int i = 0; i < width; i++)
      {
        for (int j = 0; j < length; j++)
        {
          areaArray[i, j, k] = 0;
        }
      }
    }
    return areaArray;
  }

  /* The Color lists keep the colors in a seperate List in order to choose within them easily instead of searching where they are... */
  static List<int> entranceList = new List<int>();
  static List<int> personalSpaceList = new List<int>();
  static List<int> wetAreaList = new List<int>();
  static List<int> kitchenList = new List<int>();
  static List<int> commonAreaList = new List<int>();

  /**           these counters are used for starting the límitations counts.         **/

  static int entranceCounter = 1;
  static int personalSpaceCounter = 1;
  static int wetAreaCounter = 1;
  static int kitchenCounter = 1;
  static int commonAreaCounter = 1;
  /**           these limits are used for defining max distance that zone can spread.  **/

  static int entranceLimit = 200;
  static int personalSpaceLimit = 200;
  static int wetAreaLimit = 200;
  static int kitchenLimit = 200;
  static int commonAreaLimit = 100;

  static void StartZones(int[,,] arr)
  {
            /**
             * Randomly Starts the color. Takes the Color lists as argumnts
             * (We can delete these argumnents and it can get them as local referance
             * in our case it gives us a chance to choose what to initilize)
             * **/

    Random rand = new Random();
    //----------------------
    /* GetLength(0) and GetLength(1) might be set as variable */
    //Array.GetLength(0) gives the column lenght in other words length of an array
    //Array.GetLength(1) gives the row lenght in other words width of an array
    var a = rand.Next(arr.GetLength(0) / 2, arr.GetLength(0) / 2);
    var b = rand.Next(0, 2);

    Rhino.RhinoApp.WriteLine("started");
    entranceList.AddRange(new int[2] { a, b }); //AddRange ==> Adds multiple elements to a List . We use mod%2 to call the index of the point back instead of stacking them as an another List(or Array) in our list.
    arr[a, b, 0] = 1;// entrance Starting Point
    //----------------------

    b = rand.Next(0, arr.GetLength(1));
    a = rand.Next(0, arr.GetLength(0));

    personalSpaceList.AddRange(new int[2] { a, b });
    arr[a, b, 0] = 2; // personalSpace Starting Point
    //----------------------
    a = rand.Next(0, arr.GetLength(0));
    b = rand.Next(0, arr.GetLength(1));

    wetAreaList.AddRange(new int[2] { a, b });
    arr[a, b, 0] = 3; // wetArea Starting Point
    //----------------------
    a = rand.Next(0, arr.GetLength(0));
    b = rand.Next(0, arr.GetLength(1));

    kitchenList.AddRange(new int[2] { a, b });
    arr[a, b, 0] = 4; // kitchen Starting Point
    //----------------------
    a = rand.Next(0, arr.GetLength(0));
    b = rand.Next(0, arr.GetLength(1));

    commonAreaList.AddRange(new int[2] { a, b });
    arr[a, b, 0] = 5; // commonArea Starting Point
    //----------------------
  }
        /* Calculates the distance between initial point in the color and the possible new point!
         *  (if the possible new point is too far from inital point eleminate it.) */
  static double distanceCalculate(List<int> spaceCoordList, int x2, int y2, int cellSize)
  {
    var distance = cellSize * Math.Sqrt((y2 - spaceCoordList[1]) * (y2 - spaceCoordList[1]) + (x2 - spaceCoordList[0]) * (x2 - spaceCoordList[0]));
    return distance;
  }

  static void Evaluate()
  {
    // according to relations give score to the created zones
    // get the centers of the zones and acoording to the distances and created sizes give
    //positive or negative points and if score is not acceptable re-run and create variatians.
  }


  static void noiseFilter (int [,,] arr, int type, int iterationNumber, int controlNumber)
  {

    if(type == 0)
    {
      for( int loop = 0 ; loop < iterationNumber ; loop++ )
      {
        List < int> surrounding = new List<int>();
        for(int i = 1 ; i < arr.GetLength(0) - 1 ;i++)
        {
          for(int j = 1 ; j < arr.GetLength(1) - 1 ;j++)
          {
            for(int x = -1 ; x < 2;x++)
            {
              for(int y = -1 ; y < 2;y++)
              {
                if(!(x == y && x == 0))
                {

                  surrounding.Add(arr[i + x, j + y, 0]);
                }
              }
            }

            for (int v = 0 ; v < 6 ;v++) // 6 is the number of the zones including  empty cells
            {
              int count = (from z in surrounding where z == v select z).Count();
              if ( count >= controlNumber )
              {
                arr[i, j, 0] = v;
              }
            }
            surrounding.Clear();
            surrounding.TrimExcess();
          }
        }
      }
    }

    if(type == 1)
    {
      for( int loop = 0 ; loop < iterationNumber ; loop++ )
      {
        List < int> surrounding = new List<int>();
        for(int i = 1 ; i < arr.GetLength(0) - 1 ;i++)
        {
          for(int j = 1 ; j < arr.GetLength(1) - 1 ;j++)
          {
            for(int x = -1 ; x < 2;x++)
            {
              for(int y = -1 ; y < 2;y++)
              {
                if(!(x == y && x == 0) && ( (x + y == 1 ) || (x + y == -1 )) )
                {

                  surrounding.Add(arr[i + x, j + y, 0]);
                }
              }
            }

            for (int v = 0 ; v < 6 ;v++) // 6 is the number of the zones including  empty cells
            {
              int count = (from z in surrounding where z == v select z).Count();
              if ( count >= 2 )
              {
                arr[i, j, 0] = v;
              }
            }
            surrounding.Clear();
            surrounding.TrimExcess();
          }
        }
      }
    }
  }

  static void Spread(int[,,] arr, ref double spaceSize, List<int> spaceCoordList, ref int counter, int spaceLimit, int cellSize)
  {
        /*ARGUMENTS
     * The main array which has rectangular form(will be 3d in short) ,
     * spaceSize = Maximum limit that can grow.  ,
     * spaceCoordList =  the cells of the zone which has been already defined. )
     */
    var rand = new Random();
    var directionList = new List<int>();
    int Xcoord;
    int Ycoord;
    bool draw = false;
    int trycount = 0;

    while (draw == false && counter <= spaceSize)
    {
      if (counter <= spaceSize) //Can be deleted. The condition is added to the While Loop Conditions.
      {
        var randomCellIndex = rand.Next(spaceCoordList.Count / 2);

        Xcoord = spaceCoordList[2 * randomCellIndex];
        Ycoord = spaceCoordList[2 * randomCellIndex + 1];

        if (Xcoord < arr.GetLength(0) - 1 && Xcoord > 0 && Ycoord > 0 && Ycoord < arr.GetLength(1) - 1)
        {
          /* Check the conditions INSIDE borders */
          if (arr[Xcoord + 1, Ycoord, 0] == 0 && distanceCalculate(spaceCoordList, Xcoord + 1, Ycoord, cellSize) < spaceLimit ) // Check if possible new cell is still white or not!
            directionList.AddRange(new int[2] { (Xcoord + 1), Ycoord }); //Store possible spread directions in a list.

          if (arr[Xcoord - 1, Ycoord, 0] == 0 && distanceCalculate(spaceCoordList, Xcoord - 1, Ycoord, cellSize) < spaceLimit)
            directionList.AddRange(new int[2] { (Xcoord - 1), Ycoord }); //Store possible spread directions in a list.

          if (arr[Xcoord, Ycoord + 1, 0] == 0 && distanceCalculate(spaceCoordList, Xcoord, Ycoord + 1, cellSize) < spaceLimit)
            directionList.AddRange(new int[2] { (Xcoord), Ycoord + 1 }); //Store possible spread directions in a list.

          if (arr[Xcoord, Ycoord - 1, 0] == 0 && distanceCalculate(spaceCoordList, Xcoord, Ycoord - 1, cellSize) < spaceLimit)
            directionList.AddRange(new int[2] { (Xcoord), (Ycoord - 1) }); //Store possible spread directions in a list.

          if (directionList.Count > 0)
          {
            var randomIndex = rand.Next(directionList.Count / 2);
            int a = directionList[2 * randomIndex];
            int b = directionList[2 * randomIndex + 1];

            arr[a, b, 0] = arr[Xcoord, Ycoord, 0];

            spaceCoordList.AddRange(new int[2] { a, b });

            directionList.Clear();
            directionList.TrimExcess();
            draw = true;
            counter++;
          }
          else
          {
            trycount++;
            if (trycount >= spaceCoordList.Count)
            {
              draw = true;
              //Print("trycountNumber is ={0}", trycount);
            }
          }
        }

          /* EDGE CONDITIONS */
          //RIGHT
        else if (Xcoord == (arr.GetLength(0) - 1) && Ycoord != 0 && Ycoord != (arr.GetLength(1) - 1))
        {
          if (arr[Xcoord - 1, Ycoord, 0] == 0 && distanceCalculate(spaceCoordList, Xcoord - 1, Ycoord, cellSize) < spaceLimit )
            directionList.AddRange(new int[2] { (Xcoord - 1), (Ycoord) }); //Store possible spread directions in a list.
          if (arr[Xcoord, Ycoord + 1, 0] == 0 && distanceCalculate(spaceCoordList, Xcoord, Ycoord + 1, cellSize) < spaceLimit )
            directionList.AddRange(new int[2] { (Xcoord ), (Ycoord + 1) }); //Store possible spread directions in a list.
          if (arr[Xcoord, Ycoord - 1, 0] == 0 && distanceCalculate(spaceCoordList, Xcoord, Ycoord - 1, cellSize) < spaceLimit )
            directionList.AddRange(new int[2] { (Xcoord ), (Ycoord - 1) }); //Store possible spread directions in a list.

          if (directionList.Count > 0)
          {
            var randomIndex = rand.Next(directionList.Count / 2);
            int a = directionList[2 * randomIndex];
            int b = directionList[2 * randomIndex + 1];

            arr[a, b, 0] = arr[Xcoord, Ycoord, 0];

            spaceCoordList.AddRange(new int[2] { a, b });

            directionList.Clear();
            directionList.TrimExcess();
            draw = true;
            counter++;
          }
          else
          {
            trycount++;
            if (trycount >= spaceCoordList.Count)
            {
              draw = true;
              //Print("trycountNumber is ={0}", trycount);
            }
          }
        }

          //Left
        else if (Xcoord == 0 && Ycoord != 0 && Ycoord != (arr.GetLength(1) - 1))
        {

          if (arr[Xcoord + 1, Ycoord, 0] == 0 && distanceCalculate(spaceCoordList, Xcoord + 1, Ycoord, cellSize) < spaceLimit )
            directionList.AddRange(new int[2] { (Xcoord + 1), (Ycoord) }); //Store possible spread directions in a list.
          if (arr[Xcoord, Ycoord + 1, 0] == 0 && distanceCalculate(spaceCoordList, Xcoord, Ycoord + 1, cellSize) < spaceLimit )
            directionList.AddRange(new int[2] { (Xcoord ), (Ycoord + 1) }); //Store possible spread directions in a list.
          if (arr[Xcoord, Ycoord - 1, 0] == 0 && distanceCalculate(spaceCoordList, Xcoord, Ycoord - 1, cellSize) < spaceLimit )
            directionList.AddRange(new int[2] { (Xcoord ), (Ycoord - 1) }); //Store possible spread directions in a list.
          if (directionList.Count > 0)
          {
            var randomIndex = rand.Next(directionList.Count / 2);
            int a = directionList[2 * randomIndex];
            int b = directionList[2 * randomIndex + 1];

            arr[a, b, 0] = arr[Xcoord, Ycoord, 0];

            spaceCoordList.AddRange(new int[2] { a, b });

            directionList.Clear();
            directionList.TrimExcess();
            draw = true;
            counter++;
          }
          else
          {
            trycount++;
            if (trycount >= spaceCoordList.Count)
            {
              draw = true;
              //Print("trycountNumber is ={0}", trycount);
            }
          }

        }
          //TOP
        else if ((Ycoord == arr.GetLength(1) - 1) && Xcoord != 0 && Xcoord != (arr.GetLength(0) - 1))
        {

          if (arr[Xcoord, Ycoord - 1, 0] == 0 && distanceCalculate(spaceCoordList, Xcoord, Ycoord - 1, cellSize) < spaceLimit )
            directionList.AddRange(new int[2] { (Xcoord ), (Ycoord - 1) }); //Store possible spread directions in a list.
          if (arr[Xcoord + 1, Ycoord, 0] == 0 && distanceCalculate(spaceCoordList, Xcoord + 1, Ycoord, cellSize) < spaceLimit )
            directionList.AddRange(new int[2] { (Xcoord + 1 ), (Ycoord ) }); //Store possible spread directions in a list.
          if (arr[Xcoord - 1, Ycoord, 0] == 0 && distanceCalculate(spaceCoordList, Xcoord - 1, Ycoord, cellSize) < spaceLimit )
            directionList.AddRange(new int[2] { (Xcoord - 1), (Ycoord ) }); //Store possible spread directions in a list.
          if (directionList.Count > 0)
          {
            var randomIndex = rand.Next(directionList.Count / 2);
            int a = directionList[2 * randomIndex];
            int b = directionList[2 * randomIndex + 1];

            arr[a, b, 0] = arr[Xcoord, Ycoord, 0];

            spaceCoordList.AddRange(new int[2] { a, b });

            directionList.Clear();
            directionList.TrimExcess();
            draw = true;
            counter++;
          }
          else
          {
            trycount++;
            if (trycount >= spaceCoordList.Count)
            {
              draw = true;
              //Print("trycountNumber is ={0}", trycount);
            }
          }
        }
          //BOTTOM
        else if (Ycoord == 0 && Xcoord != 0 && Xcoord != (arr.GetLength(0) - 1))
        {
          if (arr[Xcoord, Ycoord + 1, 0] == 0 && distanceCalculate(spaceCoordList, Xcoord, Ycoord + 1, cellSize) < spaceLimit )
            directionList.AddRange(new int[2] { (Xcoord ), (Ycoord + 1) }); //Store possible spread directions in a list.
          if (arr[Xcoord + 1, Ycoord, 0] == 0 && distanceCalculate(spaceCoordList, Xcoord + 1, Ycoord, cellSize) < spaceLimit )
            directionList.AddRange(new int[2] { (Xcoord + 1 ), (Ycoord ) }); //Store possible spread directions in a list.
          if (arr[Xcoord - 1, Ycoord, 0] == 0 && distanceCalculate(spaceCoordList, Xcoord - 1, Ycoord, cellSize) < spaceLimit )
            directionList.AddRange(new int[2] { (Xcoord - 1), (Ycoord ) }); //Store possible spread directions in a list.
          if (directionList.Count > 0)
          {
            var randomIndex = rand.Next(directionList.Count / 2);
            int a = directionList[2 * randomIndex];
            int b = directionList[2 * randomIndex + 1];

            arr[a, b, 0] = arr[Xcoord, Ycoord, 0];

            spaceCoordList.AddRange(new int[2] { a, b });

            directionList.Clear();
            directionList.TrimExcess();
            draw = true;
            counter++;
          }
          else
          {
            trycount++;
            if (trycount >= spaceCoordList.Count)
            {
              draw = true;
              //Print("trycountNumber is ={0}", trycount);
            }
          }
        }

          //LEFT BOTTOM
        else if (Xcoord == 0 && Ycoord == 0)
        {
          if (arr[Xcoord, Ycoord + 1, 0] == 0 && distanceCalculate(spaceCoordList, Xcoord, Ycoord + 1, cellSize) < spaceLimit)
            directionList.Add(Xcoord); directionList.Add(Ycoord + 1);

          if (arr[Xcoord + 1, Ycoord, 0] == 0 && distanceCalculate(spaceCoordList, Xcoord + 1, Ycoord, cellSize) < spaceLimit)
            directionList.Add(Xcoord + 1); directionList.Add(Ycoord);

          if (directionList.Count > 0)
          {
            var randomIndex = rand.Next(directionList.Count / 2);

            int a = directionList[2 * randomIndex];
            int b = directionList[2 * randomIndex + 1];

            arr[a, b, 0] = arr[Xcoord, Ycoord, 0];

            spaceCoordList.AddRange(new int[2] { a, b });

            directionList.Clear();
            directionList.TrimExcess();
            draw = true;

            counter++;
            //Print(" Counter Number is : {0}", counter);
          }
          else
          {
            trycount++;
            if (trycount >= spaceCoordList.Count)
            {
              draw = true;
              //Print("trycountNumber is ={0}", trycount);
            }
          }
        }
          //LEFT  TOP
          /*
          else if (Xcoord == 0 && Ycoord == (arr.GetLength(1) - 1))
          {
          if (arr[Xcoord + 1, Ycoord] == 0)
          directionList.Add(Xcoord + 1); directionList.Add(Ycoord);

          if (arr[Xcoord, Ycoord - 1] == 0)
          directionList.Add(Xcoord); directionList.Add(Ycoord - 1);

          if (directionList.Count > 0)
          {
          var randomIndex = rand.Next(directionList.Count / 2);

          int a = directionList[2 * randomIndex];
          int b = directionList[2 * randomIndex + 1];

          Rhino.RhinoApp.WriteLine("Left Top "  +  a +  " "  +  b);
          arr[a, b] = arr[Xcoord, Ycoord];

          spaceCoordList.AddRange(new int[2] { a, b });

          directionList.Clear();
          directionList.TrimExcess();
          draw = true;

          counter++;
          //Print(" Counter Number is : {0}", counter);
          }
          else
          {
          trycount++;
          if (trycount >= spaceCoordList.Count)
          {
          draw = true;
          //Print("trycountNumber is ={0}", trycount);
          }
          }
          }
          */
          /*
          //RIGHT TOP
          else if (Xcoord == (arr.GetLength(0) - 1) && Ycoord == (arr.GetLength(1) - 1))
          {
          if (arr[Xcoord, Ycoord - 1] == 0)
          directionList.Add(Xcoord); directionList.Add(Ycoord - 1);

          if (arr[Xcoord - 1, Ycoord] == 0)
          directionList.Add(Xcoord - 1); directionList.Add(Ycoord);

          if (directionList.Count > 0)
          {
          var randomIndex = rand.Next(directionList.Count / 2);

          int a = directionList[2 * randomIndex];
          int b = directionList[2 * randomIndex + 1];
          Rhino.RhinoApp.WriteLine(" Right top "+ a + " " + b);
          arr[a, b] = arr[Xcoord, Ycoord];

          //spaceCoordList.AddRange(new int[2] { a, b });

          directionList.Clear();
          directionList.TrimExcess();
          draw = true;

          counter++;
          //Print(" Counter Number is : {0}", counter);
          }
          else
          {
          trycount++;
          if (trycount >= spaceCoordList.Count)
          {
          draw = true;
          //Print("trycountNumber is ={0}", trycount);
          }
          }
          }
          */
          //RIGHT BOTTOM
        else if (Xcoord == (arr.GetLength(0) - 1) && Ycoord == 0)
        {
          if (arr[Xcoord, Ycoord + 1, 0] == 0)
            directionList.Add(Xcoord); directionList.Add(Ycoord + 1);

          if (arr[Xcoord - 1, Ycoord, 0] == 0)
            directionList.Add(Xcoord - 1); directionList.Add(Ycoord);

          if (directionList.Count > 0)
          {
            var randomIndex = rand.Next(directionList.Count / 2);

            int a = directionList[2 * randomIndex];
            int b = directionList[2 * randomIndex + 1];

            arr[a, b, 0] = arr[Xcoord, Ycoord, 0];

            spaceCoordList.AddRange(new int[2] { a, b });

            directionList.Clear();
            directionList.TrimExcess();

            draw = true;
            counter++;
            //Print(" Counter Number is : {0}", counter);
          }
          else
          {
            trycount++;
            if (trycount >= spaceCoordList.Count)
            {
              draw = true;
              //Print("trycountNumber is ={0}", trycount);
            }
          }
        }
        /* EDGE CONDITIONS */
      }
    }

  }




    /* Instead of wrting methods seperately in main program, it is better to use class based
     informations to keep things organized, we are not yet transsferentrance methods here but we created the str.*/

    /*
    public class Zone
    {
        public string Name;
        public int SpaceLimit;
        public Int16 SpaceSize;
        public int Counter;
        public List<Int16> SpaceList;

        public void Describe()
        {
            Console.WriteLine("Hey this zone is{ 0} ", Name);
        }

        public Zone()
        {
           // SpaceList = new List<int>();
        }

        public Zone(string name, int spaceLimit,int spacesize,int counter, List<int> SpaceList)
        :this()
        {
        }
        static void InitializeZeroMatrice() { }
        static void startZones() { }
        public void SpreadZones() { }

    }
    */
# ---------- end c_script_6 ----------
box_22 = Box(c_script_4.Bxx)  # disabled

# ---- group: Visualize as 3D Boxes
center_box_7 = CenterBox(Base=c_script_2.W, X=division_2, Y=division_2, Z=division_2)  # disabled
center_box_8 = CenterBox(Base=c_script_2.G, X=division_2, Y=division_2, Z=division_2)  # disabled
center_box_9 = CenterBox(Base=c_script_2.Y, X=division_2, Y=division_2, Z=division_2)  # disabled
center_box_10 = CenterBox(Base=c_script_2.K, X=division_2, Y=division_2, Z=division_2)  # disabled
center_box_11 = CenterBox(Base=c_script_2.B, X=division_2, Y=division_2, Z=division_2)  # disabled
center_box_12 = CenterBox(Base=c_script_2.R, X=division_2, Y=division_2, Z=division_2)  # disabled
number_slider_84 = Slider(0.2, range=0..1)  # disabled
colour_picker_7 = ColourPicker(PickedColour=RGB(255, 0, 0))  # disabled
colour_picker_8 = ColourPicker(PickedColour=RGB(255, 255, 255))  # disabled
colour_picker_9 = ColourPicker(PickedColour=RGB(0, 0, 255))  # disabled
colour_picker_10 = ColourPicker(PickedColour=RGB(0, 255, 0))  # disabled
colour_picker_11 = ColourPicker(PickedColour=RGB(255, 255, 0))  # disabled
colour_picker_12 = ColourPicker(PickedColour=RGB(0, 0, 0))  # disabled
create_material_7 = CreateMaterial(Diffuse=colour_picker_7, Specular=RGB(255, 255, 255), Emission=RGB(0, 0, 0), Transparency=number_slider_84, Shine=0)  # disabled
create_material_8 = CreateMaterial(Diffuse=colour_picker_10, Specular=RGB(255, 255, 255), Emission=RGB(0, 0, 0), Transparency=number_slider_84, Shine=0)  # disabled
create_material_9 = CreateMaterial(Diffuse=colour_picker_8, Specular=RGB(255, 255, 255), Emission=RGB(0, 0, 0), Transparency=number_slider_84, Shine=0)  # disabled
create_material_10 = CreateMaterial(Diffuse=colour_picker_9, Specular=RGB(255, 255, 255), Emission=RGB(0, 0, 0), Transparency=number_slider_84, Shine=0)  # disabled
create_material_11 = CreateMaterial(Diffuse=colour_picker_11, Specular=RGB(255, 255, 255), Emission=RGB(0, 0, 0), Transparency=number_slider_84, Shine=0)  # disabled
create_material_12 = CreateMaterial(Diffuse=colour_picker_12, Specular=RGB(255, 255, 255), Emission=RGB(0, 0, 0), Transparency=number_slider_84, Shine=0)  # disabled
custom_preview_7 = CustomPreview(Geometry=center_box_12, Material=create_material_7)  # disabled
custom_preview_8 = CustomPreview(Geometry=center_box_7, Material=create_material_9)  # disabled
custom_preview_9 = CustomPreview(Geometry=center_box_11, Material=create_material_10)  # disabled
custom_preview_10 = CustomPreview(Geometry=center_box_8, Material=create_material_8)  # disabled
custom_preview_11 = CustomPreview(Geometry=center_box_9, Material=create_material_11)  # disabled
custom_preview_12 = CustomPreview(Geometry=center_box_10, Material=create_material_12)  # disabled

# ----
panel_36 = Panel(deconstruct_domain_35.End)
panel_37 = Panel(deconstruct_domain_34.End)
panel_38 = Panel(deconstruct_domain_36.End)
panel_39 = Panel(box_22)  # disabled
panel_40 = Panel(deconstruct_domain_37.End)
panel_41 = Panel(deconstruct_domain_38.End)
panel_42 = Panel(deconstruct_domain_39.End)
panel_43 = Panel(c_script_4.out)
# .Net Version
c_script_7 = CSharpScript()  # -> out, A
# ---------- c_script_7: C# ----------
    A = Environment.Version;
# ---------- end c_script_7 ----------
colour_swatch = ColourSwatch(SwatchColor=RGB(255, 255, 0))
colour_swatch_2 = ColourSwatch(SwatchColor=RGB(0, 0, 0))
colour_swatch_3 = ColourSwatch(SwatchColor=RGB(255, 255, 255))
colour_swatch_4 = ColourSwatch(SwatchColor=RGB(255, 0, 0))
colour_swatch_5 = ColourSwatch(SwatchColor=RGB(0, 255, 0))
colour_swatch_6 = ColourSwatch(SwatchColor=RGB(0, 0, 255))

# ---- group: Visualize as 3D Boxes
number_slider_85 = Slider(0.941, range=0..1)
create_material_13 = CreateMaterial(Diffuse=colour_swatch_4, Specular=RGB(255, 255, 255), Emission=RGB(0, 0, 0), Transparency=number_slider_85, Shine=0)
create_material_14 = CreateMaterial(Diffuse=colour_swatch, Specular=RGB(255, 255, 255), Emission=RGB(0, 0, 0), Transparency=number_slider_85, Shine=0)
create_material_15 = CreateMaterial(Diffuse=colour_swatch_5, Specular=RGB(255, 255, 255), Emission=RGB(0, 0, 0), Transparency=number_slider_85, Shine=0)
create_material_16 = CreateMaterial(Diffuse=colour_swatch_6, Specular=RGB(255, 255, 255), Emission=RGB(0, 0, 0), Transparency=number_slider_85, Shine=0)
create_material_17 = CreateMaterial(Diffuse=colour_swatch_2, Specular=RGB(255, 255, 255), Emission=RGB(0, 0, 0), Transparency=number_slider_85, Shine=0)
create_material_18 = CreateMaterial(Diffuse=colour_swatch_3, Specular=RGB(255, 255, 255), Emission=RGB(0, 0, 0), Transparency=Slider(1, range=0..1), Shine=0)
custom_preview_13 = CustomPreview(Geometry=c_script_4.R, Material=create_material_13)
custom_preview_14 = CustomPreview(Geometry=c_script_4.G, Material=create_material_15)
custom_preview_15 = CustomPreview(Geometry=c_script_4.Y, Material=create_material_14)
custom_preview_16 = CustomPreview(Geometry=c_script_4.B, Material=create_material_16)
custom_preview_17 = CustomPreview(Geometry=c_script_4.K, Material=create_material_17)
custom_preview_18 = CustomPreview(Geometry=c_script_4.W, Material=create_material_18)

# ----
panel_44 = Panel(c_script_7.A)
create_material_19 = CreateMaterial(
    Diffuse=ColourSwatch(SwatchColor=RGB(0, 0, 0)),
    Specular=RGB(255, 255, 255),
    Emission=RGB(0, 0, 0),
    Transparency=Slider(0, range=0..1),
    Shine=0)
create_material_20 = CreateMaterial(
    Diffuse=ColourSwatch(SwatchColor=RGB(0, 0, 0)),
    Specular=RGB(255, 255, 255),
    Emission=RGB(0, 0, 0),
    Transparency=Slider(0.611, range=0..1),
    Shine=0)
custom_preview_19 = CustomPreview(Geometry=c_script_4.Furnitures, Material=create_material_19)
custom_preview_20 = CustomPreview(Geometry=c_script_4.FurnituresMargins, Material=create_material_20)
list_length = ListLength(List=c_script_4.R)
list_length_2 = ListLength(List=c_script_4.G)
list_length_3 = ListLength(List=c_script_4.W)
list_length_4 = ListLength(List=c_script_4.B)
list_length_5 = ListLength(List=c_script_4.Y)
list_length_6 = ListLength(List=c_script_4.K)
multiplication_11 = Multiplication(A=list_length_2, B=division_5)
multiplication_12 = Multiplication(A=list_length, B=division_5)
multiplication_13 = Multiplication(A=list_length_3, B=division_5)
multiplication_14 = Multiplication(A=list_length_4, B=division_5)
multiplication_15 = Multiplication(A=list_length_5, B=division_5)
multiplication_16 = Multiplication(A=list_length_6, B=division_5)
panel_45 = Panel(multiplication_12)
panel_46 = Panel(multiplication_13)
panel_47 = Panel(multiplication_11)
panel_48 = Panel(multiplication_14)
panel_49 = Panel(multiplication_15)
panel_50 = Panel(multiplication_16)
number_slider_86 = Slider(15, range=0..100)
concatenate = Concatenate(Fragment_A=" Empty Space= ", Fragment_B=panel_46, Fragment_C="m2 ")
concatenate_2 = Concatenate(Fragment_A=" Entrance = ", Fragment_B=panel_45, Fragment_C="m2 ")
concatenate_3 = Concatenate(Fragment_A=" WetArea = ", Fragment_B=panel_47, Fragment_C="m2 ")
concatenate_4 = Concatenate(Fragment_A=" PersonalSpace = ", Fragment_B=panel_48, Fragment_C="m2 ")
concatenate_5 = Concatenate(Fragment_A=" Kitchen = ", Fragment_B=panel_49, Fragment_C="m2 ")
concatenate_6 = Concatenate(Fragment_A=" Common Area = ", Fragment_B=panel_50, Fragment_C=" m2 ")
panel_51 = Panel(concatenate)
panel_52 = Panel(concatenate_2)
list_length_7 = ListLength(List=center_box_12)  # disabled
panel_53 = Panel(concatenate_3)
list_length_8 = ListLength(List=center_box_11)  # disabled
list_length_9 = ListLength(List=center_box_9)  # disabled
list_length_10 = ListLength(List=center_box_10)  # disabled
list_length_11 = ListLength(List=center_box_8)  # disabled
list_length_12 = ListLength(List=center_box_7)  # disabled
panel_54 = Panel(concatenate_4)
panel_55 = Panel(concatenate_5)
panel_56 = Panel(concatenate_6)
multiplication_17 = Multiplication(A=list_length_7, B=division_6)  # disabled
multiplication_18 = Multiplication(A=list_length_8, B=division_6)  # disabled
multiplication_19 = Multiplication(A=list_length_9, B=division_6)  # disabled
multiplication_20 = Multiplication(A=list_length_10, B=division_6)  # disabled
multiplication_21 = Multiplication(A=list_length_11, B=division_6)  # disabled
multiplication_22 = Multiplication(A=list_length_12, B=division_6)  # disabled
text_tag_3d = TextTag3D(Location="240,-50", Text=concatenate_2, Size=number_slider_86, Colour=colour_swatch_4, Justification=7)
text_tag_3d_2 = TextTag3D(Location="240,-80", Text=concatenate_3, Size=number_slider_86, Colour=colour_swatch_5, Justification=7)
text_tag_3d_3 = TextTag3D(Location="240,-140", Text=concatenate_5, Size=number_slider_86, Colour=colour_swatch, Justification=7)
text_tag_3d_4 = TextTag3D(Location="240,-110", Text=concatenate_4, Size=number_slider_86, Colour=colour_swatch_6, Justification=7)
text_tag_3d_5 = TextTag3D(Location="240,-200", Text=concatenate, Size=number_slider_86, Colour=colour_swatch_3, Justification=7)
text_tag_3d_6 = TextTag3D(Location="240,-170", Text=concatenate_6, Size=number_slider_86, Colour=colour_swatch_2, Justification=7)
panel_57 = Panel("m2 ")  # disabled
panel_58 = Panel(multiplication_17)  # disabled
panel_59 = Panel(" Entrance = ")  # disabled
panel_60 = Panel("m2 ")  # disabled
panel_61 = Panel(multiplication_18)  # disabled
panel_62 = Panel("m2 ")  # disabled
panel_63 = Panel(multiplication_19)  # disabled
panel_64 = Panel(" m2 ")  # disabled
panel_65 = Panel("m2 ")  # disabled
panel_66 = Panel(" PersonalSpace = ")  # disabled
panel_67 = Panel(" Kitchen = ")  # disabled
panel_68 = Panel(multiplication_20)  # disabled
panel_69 = Panel(multiplication_21)  # disabled
panel_70 = Panel(" Common Area = ")  # disabled
panel_71 = Panel(" WetArea = ")  # disabled
panel_72 = Panel("m2 ")  # disabled
panel_73 = Panel(multiplication_22)  # disabled
panel_74 = Panel(" Empty Space= ")  # disabled
mass_addition = MassAddition(Input=[multiplication_11, multiplication_12, multiplication_14, multiplication_15, multiplication_16, multiplication_13])  # -> flatten(Result), PartialResults
list_item = ListItem(List=mass_addition.Result, Index=Slider(1, range=0..1), Wrap=True)
panel_75 = Panel(list_item)
panel_76 = Panel("60,-70")  # disabled
panel_77 = Panel("180,-70")  # disabled
concatenate_7 = Concatenate(Fragment_A=panel_59, Fragment_B=panel_58, Fragment_C=panel_57)  # disabled
panel_78 = Panel("240,-60")  # disabled
panel_79 = Panel("300,-70")  # disabled
panel_80 = Panel("120,-70")  # disabled
concatenate_8 = Concatenate(Fragment_A=panel_66, Fragment_B=panel_61, Fragment_C=panel_60)  # disabled
concatenate_9 = Concatenate(Fragment_A=panel_67, Fragment_B=panel_63, Fragment_C=panel_62)  # disabled
concatenate_10 = Concatenate(Fragment_A=panel_70, Fragment_B=panel_68, Fragment_C=panel_64)  # disabled
concatenate_11 = Concatenate(Fragment_A=panel_71, Fragment_B=panel_69, Fragment_C=panel_65)  # disabled
panel_81 = Panel("360,-70")  # disabled
concatenate_12 = Concatenate(Fragment_A=panel_74, Fragment_B=panel_73, Fragment_C=panel_72)  # disabled
concatenate_13 = Concatenate(Fragment_A=" Total Area =", Fragment_B=panel_75, Fragment_C="m2 ")
panel_82 = Panel(concatenate_7)  # disabled
panel_83 = Panel(concatenate_8)  # disabled
panel_84 = Panel(concatenate_9)  # disabled
panel_85 = Panel(concatenate_10)  # disabled
panel_86 = Panel(concatenate_11)  # disabled
text_tag = TextTag(Location=panel_76, Text=concatenate_7)  # disabled
panel_87 = Panel(concatenate_12)  # disabled
text_tag_2 = TextTag(Location=panel_77, Text=concatenate_8)  # disabled
text_tag_3 = TextTag(Location=panel_78, Text=concatenate_9)  # disabled
text_tag_4 = TextTag(Location=panel_79, Text=concatenate_10)  # disabled
text_tag_5 = TextTag(Location=panel_80, Text=concatenate_11)  # disabled
text_tag_6 = TextTag(Location=panel_81, Text=concatenate_12)  # disabled
panel_88 = Panel(concatenate_13)
text_tag_3d_7 = TextTag3D(Location="500,-100", Text=concatenate_13, Size=number_slider_86, Justification=7)
mass_addition_2 = MassAddition(Input=[multiplication_21, multiplication_17, multiplication_18, multiplication_19, multiplication_20])  # -> Result, PartialResults; disabled
panel_89 = Panel("m2 ")  # disabled
panel_90 = Panel(mass_addition_2.Result)  # disabled
panel_91 = Panel(" Total Area =")  # disabled
panel_92 = Panel("420,-70")  # disabled
concatenate_14 = Concatenate(Fragment_A=panel_91, Fragment_B=panel_90, Fragment_C=panel_89)  # disabled
panel_93 = Panel(concatenate_14)  # disabled
text_tag_7 = TextTag(Location=panel_92, Text=concatenate_14)  # disabled
