# Grasshopper definition CemGrasshopperC#66.gh (Grasshopper 1.0.7)
# plug-ins: Human

number_slider = Slider(59.6, range=0..200)  # disabled
number_slider_2 = Slider(81, range=0..200)  # disabled
number_slider_3 = Slider(54.5, range=0..200)  # disabled
xy_plane = XYPlane(Origin=Point(0, 650, 0))  # disabled

number_slider_4 = Slider(35, range=0..200)  # disabled
number_slider_5 = Slider(50, range=0..200)  # disabled
number_slider_6 = Slider(40, range=0..200)  # disabled
xy_plane_2 = XYPlane(Origin=Point(0, 900, 0))  # disabled

number_slider_7 = Slider(100, range=0..200)  # disabled
number_slider_8 = Slider(60, range=0..200)  # disabled
number_slider_9 = Slider(62, range=0..200)  # disabled
xy_plane_3 = XYPlane(Origin=Point(0, 1200, 0))  # disabled

# ----
# Furnitures!
xy_plane_4 = XYPlane(Origin=Point(0, 0, 0))

number_slider_10 = Slider(62.1, range=0..200)  # disabled
number_slider_11 = Slider(50, range=0..200)  # disabled
number_slider_12 = Slider(35, range=0..200)  # disabled
xy_plane_5 = XYPlane(Origin=Point(0, 400, 0))  # disabled

number_slider_13 = Slider(27.5, range=0..200)  # disabled
number_slider_14 = Slider(54.5, range=0..200)  # disabled
number_slider_15 = Slider(5, range=0..200)  # disabled
xy_plane_6 = XYPlane(Origin=Point(0, 200, 0))  # disabled

# ----
# Entrance
vector_xyz = VectorXYZ(XComponent=Slider(806, range=0..1000), YComponent=0, ZComponent=0)  # -> Vector, Length
vector_xyz_2 = VectorXYZ(XComponent=Slider(1000, range=0..1000), YComponent=0, ZComponent=0)  # -> Vector, Length
vector_xyz_3 = VectorXYZ(XComponent=Slider(1392, range=0..2000), YComponent=0, ZComponent=0)  # -> Vector, Length
closet = DomainBox(Base=vector_xyz_3.Vector, X=Slider(230, range=110..230), Y=Slider(60, range=55..65), Z=Slider(210, range=2..220))
exterior_door = DomainBox(Base=vector_xyz.Vector, X=Slider(100, range=90..100), Y=Slider(10, range=5..15), Z=Slider(200, range=150..220))
changeover_zone = DomainBox(Base=vector_xyz_2.Vector, X=Slider(60, range=50..65), Y=Slider(40, range=35..45), Z=Slider(2, range=2..220))

number_slider_16 = Slider(243, range=0..1000)  # disabled
number_slider_17 = Slider(450, range=0..1000)  # disabled
number_slider_18 = Slider(623, range=0..1000)  # disabled
number_slider_19 = Slider(54, range=40..60)  # disabled
number_slider_20 = Slider(45, range=40..60)  # disabled
number_slider_21 = Slider(89, range=80..100)  # disabled
number_slider_22 = Slider(85, range=40..90)  # disabled
number_slider_23 = Slider(34, range=30..40)  # disabled
number_slider_24 = Slider(13, range=5..15)  # disabled
number_slider_25 = Slider(29, range=25..30)  # disabled
number_slider_26 = Slider(5, range=5..10)  # disabled
number_slider_27 = Slider(62, range=60..80)  # disabled
# Kitchen
vector_xyz_4 = VectorXYZ(XComponent=Slider(0, range=0..1000), YComponent=0, ZComponent=0)  # -> Vector, Length
vector_xyz_5 = VectorXYZ(XComponent=number_slider_16, YComponent=0, ZComponent=0)  # -> Vector, Length; disabled
vector_xyz_6 = VectorXYZ(XComponent=number_slider_18, YComponent=0, ZComponent=0)  # -> Vector, Length; disabled
vector_xyz_7 = VectorXYZ(XComponent=number_slider_17, YComponent=0, ZComponent=0)  # -> Vector, Length; disabled
multipurpose_table_for_2 = DomainBox(Base=vector_xyz_4.Vector, X=Slider(76, range=50..200), Y=Slider(107, range=100..120), Z=Slider(75, range=50..200))
sitting_unit = DomainBox(Base=vector_xyz_5.Vector, X=number_slider_20, Y=number_slider_19, Z=number_slider_21)  # disabled
monitor = DomainBox(Base=vector_xyz_7.Vector, X=number_slider_22, Y=number_slider_26, Z=number_slider_27)  # disabled
first_aid_closet = DomainBox(Base=vector_xyz_6.Vector, X=number_slider_23, Y=number_slider_24, Z=number_slider_25)  # disabled

# ----
# right
# right
# front
# front
# PERSONAL SPACE
number_slider_28 = Slider(0, range=0..100)  # disabled
number_slider_29 = Slider(293, range=0..2000)  # disabled
number_slider_30 = Slider(207, range=0..300)  # disabled
number_slider_31 = Slider(109, range=0..300)  # disabled
number_slider_32 = Slider(30, range=0..100)  # disabled
number_slider_33 = Slider(207, range=0..300)  # disabled
number_slider_34 = Slider(109, range=0..300)  # disabled
number_slider_35 = Slider(30, range=0..100)  # disabled
number_slider_36 = Slider(80, range=0..100)  # disabled
number_slider_37 = Slider(40, range=0..100)  # disabled
number_slider_38 = Slider(40, range=0..300)  # disabled
number_slider_39 = Slider(506, range=0..2000)  # disabled
number_slider_40 = Slider(80, range=0..100)  # disabled
number_slider_41 = Slider(40, range=0..100)  # disabled
number_slider_42 = Slider(40, range=0..300)  # disabled
number_slider_43 = Slider(711, range=0..2000)  # disabled
vector_xyz_8 = VectorXYZ(XComponent=number_slider_28, YComponent=0, ZComponent=0)  # -> Vector, Length; disabled
vector_xyz_9 = VectorXYZ(XComponent=0, YComponent=number_slider_29, ZComponent=0)  # -> Vector, Length; disabled
vector_xyz_10 = VectorXYZ(XComponent=0, YComponent=number_slider_39, ZComponent=0)  # -> Vector, Length; disabled
bed = DomainBox(Base=vector_xyz_8.Vector, X=number_slider_30, Y=number_slider_31, Z=number_slider_32)  # disabled
vector_xyz_11 = VectorXYZ(XComponent=0, YComponent=number_slider_43, ZComponent=0)  # -> Vector, Length; disabled
personal_closet = DomainBox(Base=vector_xyz_10.Vector, X=number_slider_36, Y=number_slider_37, Z=number_slider_38)  # disabled
personal_closet1 = DomainBox(Base=vector_xyz_11.Vector, X=number_slider_40, Y=number_slider_41, Z=number_slider_42)  # disabled
bed1 = DomainBox(Base=vector_xyz_9.Vector, X=number_slider_33, Y=number_slider_34, Z=number_slider_35)  # disabled
deconstruct_box = DeconstructBox(Box=bed)  # -> Plane, X, Y, Z; disabled
number_slider_44 = Slider(60, range=0..100)  # disabled
deconstruct_box_2 = DeconstructBox(Box=bed1)  # -> Plane, X, Y, Z; disabled
deconstruct_box_3 = DeconstructBox(Box=personal_closet)  # -> Plane, X, Y, Z; disabled
number_slider_45 = Slider(60, range=0..100)  # disabled
deconstruct_box_4 = DeconstructBox(Box=personal_closet1)  # -> Plane, X, Y, Z; disabled
number_slider_46 = Slider(40, range=0..100)  # disabled
number_slider_47 = Slider(40, range=0..100)  # disabled
deconstruct_domain = DeconstructDomain(Domain=deconstruct_box.Y)  # -> Start, End; disabled
deconstruct_domain_2 = DeconstructDomain(Domain=deconstruct_box_2.Y)  # -> Start, End; disabled
deconstruct_domain_3 = DeconstructDomain(Domain=deconstruct_box_3.Y)  # -> Start, End; disabled
deconstruct_domain_4 = DeconstructDomain(Domain=deconstruct_box_4.Y)  # -> Start, End; disabled
addition = Addition(A=deconstruct_domain.End, B=number_slider_44)  # disabled
addition_2 = Addition(A=deconstruct_domain_2.End, B=number_slider_45)  # disabled
addition_3 = Addition(A=deconstruct_domain_3.End, B=number_slider_46)  # disabled
addition_4 = Addition(A=deconstruct_domain_4.End, B=number_slider_47)  # disabled
construct_domain = ConstructDomain(DomainStart=deconstruct_domain.Start, DomainEnd=addition)  # disabled
construct_domain_2 = ConstructDomain(DomainStart=deconstruct_domain_2.Start, DomainEnd=addition_2)  # disabled
construct_domain_3 = ConstructDomain(DomainStart=deconstruct_domain_3.Start, DomainEnd=addition_3)  # disabled
construct_domain_4 = ConstructDomain(DomainStart=deconstruct_domain_4.Start, DomainEnd=addition_4)  # disabled
domain_box = DomainBox(Base=PlaneXY(0, 0, 0), X=deconstruct_box.X, Y=construct_domain, Z=deconstruct_box.Z)  # disabled
domain_box_2 = DomainBox(Base=bed1, X=deconstruct_box_2.X, Y=construct_domain_2, Z=deconstruct_box_2.Z)  # disabled
domain_box_3 = DomainBox(Base=personal_closet, X=deconstruct_box_3.X, Y=construct_domain_3, Z=deconstruct_box_3.Z)  # disabled
domain_box_4 = DomainBox(Base=personal_closet1, X=deconstruct_box_4.X, Y=construct_domain_4, Z=deconstruct_box_4.Z)  # disabled

# ----
# WET AREA
# left
# right
# front
# front
# front
# front
# front
number_slider_48 = Slider(0, range=0..100)
vector_xyz_12 = VectorXYZ(XComponent=Slider(-76, range=-100..101), YComponent=0, ZComponent=0)  # -> Vector, Length
vector_xyz_13 = VectorXYZ(XComponent=number_slider_48, YComponent=0, ZComponent=0)  # -> Vector, Length
vector_xyz_14 = VectorXYZ(XComponent=Slider(0, range=0..100), YComponent=0, ZComponent=0)  # -> Vector, Length
vector_xyz_15 = VectorXYZ(XComponent=Slider(0, range=-1000..100), YComponent=0, ZComponent=0)  # -> Vector, Length
vector_xyz_16 = VectorXYZ(XComponent=Slider(-199, range=-1000..100), YComponent=0, ZComponent=0)  # -> Vector, Length
toılet = DomainBox(Base=vector_xyz_12.Vector, X=Slider(36, range=0..100), Y=Slider(54, range=0..100), Z=Slider(50, range=0..100))
dressing_cabin = DomainBox(Base=vector_xyz_15.Vector, X=Slider(80, range=0..100), Y=Slider(80, range=0..100), Z=Slider(200, range=0..300))
mirror_cupboard = DomainBox(Base=vector_xyz_13.Vector, X=Slider(60, range=0..100), Y=Slider(15, range=0..100), Z=Slider(60, range=0..300))
shower_cabin = DomainBox(Base=vector_xyz_14.Vector, X=Slider(80, range=0..100), Y=Slider(80, range=0..100), Z=Slider(210, range=0..300))
sink_cupboard = DomainBox(Base=vector_xyz_16.Vector, X=Slider(55, range=0..100), Y=Slider(40, range=0..100), Z=Slider(85, range=0..300))
deconstruct_box_5 = DeconstructBox()  # -> Plane, X, Y, Z
deconstruct_box_6 = DeconstructBox(Box=toılet)  # -> Plane, X, Y, Z
deconstruct_box_7 = DeconstructBox()  # -> Plane, X, Y, Z
deconstruct_box_8 = DeconstructBox(Box=mirror_cupboard)  # -> Plane, X, Y, Z
deconstruct_box_9 = DeconstructBox(Box=shower_cabin)  # -> Plane, X, Y, Z
deconstruct_box_10 = DeconstructBox(Box=sink_cupboard)  # -> Plane, X, Y, Z
deconstruct_box_11 = DeconstructBox(Box=dressing_cabin)  # -> Plane, X, Y, Z
deconstruct_domain_5 = DeconstructDomain(Domain=deconstruct_box_6.X)  # -> Start, End
deconstruct_domain_6 = DeconstructDomain(Domain=deconstruct_box_7.Y)  # -> Start, End
deconstruct_domain_7 = DeconstructDomain(Domain=deconstruct_box_5.X)  # -> Start, End
deconstruct_domain_8 = DeconstructDomain(Domain=deconstruct_box_9.Y)  # -> Start, End
deconstruct_domain_9 = DeconstructDomain(Domain=deconstruct_box_8.Y)  # -> Start, End
deconstruct_domain_10 = DeconstructDomain(Domain=deconstruct_box_11.Y)  # -> Start, End
deconstruct_domain_11 = DeconstructDomain(Domain=deconstruct_box_10.Y)  # -> Start, End
addition_5 = Addition(A=deconstruct_domain_5.End, B=Slider(20, range=0..100))
addition_6 = Addition(A=deconstruct_domain_6.End, B=Slider(60, range=0..100))
subtraction = Subtraction(A=deconstruct_domain_7.Start, B=Slider(30, range=0..101))
addition_7 = Addition(A=deconstruct_domain_9.End, B=Slider(85, range=0..100))
addition_8 = Addition(A=deconstruct_domain_8.End, B=Slider(60, range=0..100))
addition_9 = Addition(A=deconstruct_domain_10.End, B=Slider(60, range=0..100))
addition_10 = Addition(A=deconstruct_domain_11.End, B=Slider(60, range=0..100))
construct_domain_5 = ConstructDomain(DomainStart=deconstruct_domain_5.Start, DomainEnd=addition_5)
construct_domain_6 = ConstructDomain(DomainStart=deconstruct_domain_6.Start, DomainEnd=addition_6)
construct_domain_7 = ConstructDomain(DomainStart=deconstruct_domain_7.Start, DomainEnd=subtraction)
construct_domain_8 = ConstructDomain(DomainStart=deconstruct_domain_9.Start, DomainEnd=addition_7)
construct_domain_9 = ConstructDomain(DomainStart=deconstruct_domain_8.Start, DomainEnd=addition_8)
construct_domain_10 = ConstructDomain(DomainStart=deconstruct_domain_10.Start, DomainEnd=addition_9)
construct_domain_11 = ConstructDomain(DomainStart=deconstruct_domain_11.Start, DomainEnd=addition_10)
domain_box_5 = DomainBox(Base=toılet, X=construct_domain_5, Y=deconstruct_box_6.Y, Z=deconstruct_box_6.Z)
domain_box_6 = DomainBox(Base=PlaneXY(0, 0, 0), X=construct_domain_7, Y=deconstruct_box_5.Y, Z=deconstruct_box_5.Z)
domain_box_7 = DomainBox(Base=PlaneXY(0, 0, 0), X=deconstruct_box_7.X, Y=construct_domain_6, Z=deconstruct_box_7.Z)
domain_box_8 = DomainBox(Base=mirror_cupboard, X=deconstruct_box_8.X, Y=construct_domain_8, Z=deconstruct_box_8.Z)
domain_box_9 = DomainBox(Base=shower_cabin, X=deconstruct_box_9.X, Y=construct_domain_9, Z=deconstruct_box_9.Z)
domain_box_10 = DomainBox(Base=dressing_cabin, X=deconstruct_box_11.X, Y=construct_domain_10, Z=deconstruct_box_11.Z)
domain_box_11 = DomainBox(Base=sink_cupboard, X=deconstruct_box_10.X, Y=construct_domain_11, Z=deconstruct_box_10.Z)

stove = DomainBox(Base=PlaneXY(0, 0, 0), X=number_slider_13, Y=number_slider_14, Z=number_slider_15)  # disabled
sink = DomainBox(Base=PlaneXY(0, 0, 0), X=Slider(54, range=0..200), Y=Slider(44, range=0..200), Z=Slider(19, range=0..200))
counter = DomainBox(Base=PlaneXY(0, 0, 0), X=number_slider_7, Y=number_slider_8, Z=number_slider_9)  # disabled
cupboard = DomainBox(Base=PlaneXY(0, 0, 0), X=number_slider_5, Y=number_slider_4, Z=number_slider_6)  # disabled
mıcrowave = DomainBox(Base=PlaneXY(0, 0, 0), X=number_slider_10, Y=number_slider_11, Z=number_slider_12)  # disabled
frıdge = DomainBox(Base=PlaneXY(0, 0, 0), X=number_slider, Y=number_slider_3, Z=number_slider_2)  # disabled
# Margins!
custom_preview_materials = CustomPreviewMaterials(Geometry=sink, DiffuseColor=RGB(174, 215, 230), Transparency=Slider(0, range=0..1))

deconstruct_box_12 = DeconstructBox(Box=mıcrowave)  # -> Plane, X, Y, Z; disabled
deconstruct_domain_12 = DeconstructDomain(Domain=deconstruct_box_12.Y)  # -> Start, End; disabled
number_slider_49 = Slider(80, range=0..1000)  # disabled
addition_11 = Addition(A=deconstruct_domain_12.End, B=number_slider_49)  # disabled
construct_domain_12 = ConstructDomain(DomainStart=deconstruct_domain_12.Start, DomainEnd=addition_11)  # disabled
microwave_margin = DomainBox(Base=deconstruct_box_12.Plane, X=deconstruct_box_12.X, Y=construct_domain_12, Z=deconstruct_box_12.Z)  # disabled

deconstruct_box_13 = DeconstructBox(Box=frıdge)  # -> Plane, X, Y, Z; disabled
deconstruct_domain_13 = DeconstructDomain(Domain=deconstruct_box_13.Y)  # -> Start, End; disabled
number_slider_50 = Slider(80, range=0..1000)  # disabled
addition_12 = Addition(A=deconstruct_domain_13.End, B=number_slider_50)  # disabled
construct_domain_13 = ConstructDomain(DomainStart=deconstruct_domain_13.Start, DomainEnd=addition_12)  # disabled
fridge_margin = DomainBox(Base=deconstruct_box_13.Plane, X=deconstruct_box_13.X, Y=construct_domain_13, Z=deconstruct_box_13.Z)  # disabled

deconstruct_box_14 = DeconstructBox(Box=sink)  # -> Plane, X, Y, Z
deconstruct_domain_14 = DeconstructDomain(Domain=deconstruct_box_14.Z)  # -> Start, End
deconstruct_domain_15 = DeconstructDomain(Domain=deconstruct_box_14.Y)  # -> Start, End
addition_13 = Addition(A=deconstruct_domain_14.End, B=Slider(123, range=0..1000))
addition_14 = Addition(A=deconstruct_domain_15.End, B=Slider(85, range=0..1000))
addition_15 = Addition(A=deconstruct_domain_15.Start, B=Slider(-10, range=-10..1000))
construct_domain_14 = ConstructDomain(DomainStart=deconstruct_domain_14.Start, DomainEnd=addition_13)
construct_domain_15 = ConstructDomain(DomainStart=addition_15, DomainEnd=addition_14)
sink_margin = DomainBox(Base=deconstruct_box_14.Plane, X=deconstruct_box_14.X, Y=construct_domain_15, Z=construct_domain_14)

deconstruct_box_15 = DeconstructBox(Box=stove)  # -> Plane, X, Y, Z; disabled
number_slider_51 = Slider(123, range=0..1000)  # disabled
deconstruct_domain_16 = DeconstructDomain(Domain=deconstruct_box_15.Z)  # -> Start, End; disabled
deconstruct_domain_17 = DeconstructDomain(Domain=deconstruct_box_15.Y)  # -> Start, End; disabled
number_slider_52 = Slider(80, range=0..1000)  # disabled
addition_16 = Addition(A=deconstruct_domain_16.End, B=number_slider_51)  # disabled
addition_17 = Addition(A=deconstruct_domain_17.End, B=number_slider_52)  # disabled
construct_domain_16 = ConstructDomain(DomainStart=deconstruct_domain_16.Start, DomainEnd=addition_16)  # disabled
construct_domain_17 = ConstructDomain(DomainStart=deconstruct_domain_17.Start, DomainEnd=addition_17)  # disabled
stove_margin = DomainBox(Base=deconstruct_box_15.Plane, X=deconstruct_box_15.X, Y=construct_domain_17, Z=construct_domain_16)  # disabled

deconstruct_box_16 = DeconstructBox(Box=counter)  # -> Plane, X, Y, Z; disabled
number_slider_53 = Slider(75, range=0..1000)  # disabled
deconstruct_domain_18 = DeconstructDomain(Domain=deconstruct_box_16.Z)  # -> Start, End; disabled
deconstruct_domain_19 = DeconstructDomain(Domain=deconstruct_box_16.Y)  # -> Start, End; disabled
number_slider_54 = Slider(80, range=0..1000)  # disabled
addition_18 = Addition(A=deconstruct_domain_18.End, B=number_slider_53)  # disabled
construct_domain_18 = ConstructDomain(DomainStart=deconstruct_domain_18.Start, DomainEnd=addition_18)  # disabled
addition_19 = Addition(A=deconstruct_domain_19.End, B=number_slider_54)  # disabled
construct_domain_19 = ConstructDomain(DomainStart=deconstruct_domain_19.Start, DomainEnd=addition_19)  # disabled
counter_margin = DomainBox(Base=deconstruct_box_16.Plane, X=deconstruct_box_16.X, Y=construct_domain_19, Z=construct_domain_18)  # disabled

deconstruct_box_17 = DeconstructBox(Box=cupboard)  # -> Plane, X, Y, Z; disabled
number_slider_55 = Slider(13, range=0..1000)  # disabled
deconstruct_domain_20 = DeconstructDomain(Domain=deconstruct_box_17.Z)  # -> Start, End; disabled
deconstruct_domain_21 = DeconstructDomain(Domain=deconstruct_box_17.Y)  # -> Start, End; disabled
number_slider_56 = Slider(-75, range=-100..1000)  # disabled
number_slider_57 = Slider(105, range=0..1000)  # disabled
addition_20 = Addition(A=deconstruct_domain_20.Start, B=number_slider_56)  # disabled
addition_21 = Addition(A=deconstruct_domain_20.End, B=number_slider_55)  # disabled
addition_22 = Addition(A=deconstruct_domain_21.End, B=number_slider_57)  # disabled
construct_domain_20 = ConstructDomain(DomainStart=addition_20, DomainEnd=addition_21)  # disabled
construct_domain_21 = ConstructDomain(DomainStart=deconstruct_domain_21.Start, DomainEnd=addition_22)  # disabled
cupboard_margin = DomainBox(Base=deconstruct_box_17.Plane, X=deconstruct_box_17.X, Y=construct_domain_21, Z=construct_domain_20)  # disabled

deconstruct_box_18 = DeconstructBox(Box=multipurpose_table_for_2)  # -> Plane, X, Y, Z
deconstruct_box_19 = DeconstructBox(Box=sitting_unit)  # -> Plane, X, Y, Z; disabled
deconstruct_box_20 = DeconstructBox(Box=exterior_door)  # -> Plane, X, Y, Z
deconstruct_box_21 = DeconstructBox(Box=monitor)  # -> Plane, X, Y, Z; disabled
deconstruct_box_22 = DeconstructBox(Box=changeover_zone)  # -> Plane, X, Y, Z
deconstruct_box_23 = DeconstructBox(Box=closet)  # -> Plane, X, Y, Z
number_slider_58 = Slider(57, range=0..500)  # disabled
number_slider_59 = Slider(57, range=0..500)  # disabled
number_slider_60 = Slider(168, range=0..500)  # disabled
number_slider_61 = Slider(57, range=0..500)  # disabled
panel = Panel(deconstruct_box_18.X)
deconstruct_domain_22 = DeconstructDomain(Domain=deconstruct_box_18.Y)  # -> Start, End; disabled
deconstruct_domain_23 = DeconstructDomain(Domain=deconstruct_box_18.X)  # -> Start, End
deconstruct_domain_24 = DeconstructDomain(Domain=deconstruct_box_18.Y)  # -> Start, End; disabled
deconstruct_domain_25 = DeconstructDomain(Domain=deconstruct_box_18.Y)  # -> Start, End; disabled
deconstruct_domain_26 = DeconstructDomain(Domain=deconstruct_box_18.Y)  # -> Start, End; disabled
panel_2 = Panel(deconstruct_box_20.X)
panel_3 = Panel(deconstruct_box_22.X)
deconstruct_domain_27 = DeconstructDomain(Domain=deconstruct_box_22.Y)  # -> Start, End
deconstruct_domain_28 = DeconstructDomain(Domain=deconstruct_box_22.Z)  # -> Start, End
panel_4 = Panel(deconstruct_box_23.X)
deconstruct_domain_29 = DeconstructDomain(Domain=deconstruct_box_20.Y)  # -> Start, End
deconstruct_domain_30 = DeconstructDomain(Domain=deconstruct_box_23.Y)  # -> Start, End
addition_23 = Addition(A=deconstruct_domain_22.End, B=number_slider_58)  # disabled
addition_24 = Addition(A=deconstruct_domain_23.End, B=Slider(57, range=0..500))
addition_25 = Addition(A=deconstruct_domain_24.End, B=number_slider_59)  # disabled
addition_26 = Addition(A=deconstruct_domain_25.End, B=number_slider_60)  # disabled
addition_27 = Addition(A=deconstruct_domain_26.End, B=number_slider_61)  # disabled
addition_28 = Addition(A=deconstruct_domain_29.End, B=Slider(50, range=0..500))
addition_29 = Addition(A=deconstruct_domain_27.End, B=Slider(60, range=0..60))
addition_30 = Addition(A=deconstruct_domain_28.End, B=Slider(210, range=0..210))
addition_31 = Addition(A=deconstruct_domain_30.End, B=Slider(65, range=0..500))
# Margin :  Back 30
#                  Top  121
construct_domain_22 = ConstructDomain(DomainStart=deconstruct_domain_22.Start, DomainEnd=addition_23)  # disabled
construct_domain_23 = ConstructDomain(DomainStart=deconstruct_domain_23.Start, DomainEnd=addition_24)
# Margin :  Back 50
#                  Top  121
construct_domain_24 = ConstructDomain(DomainStart=deconstruct_domain_24.Start, DomainEnd=addition_25)  # disabled
# Margin :  Front 100
construct_domain_25 = ConstructDomain(DomainStart=deconstruct_domain_25.Start, DomainEnd=addition_26)  # disabled
# Margin :  Front 29
construct_domain_26 = ConstructDomain(DomainStart=deconstruct_domain_26.Start, DomainEnd=addition_27)  # disabled
# Margin :  Front 100
construct_domain_27 = ConstructDomain(DomainStart=deconstruct_domain_29.Start, DomainEnd=addition_28)
construct_domain_28 = ConstructDomain(DomainStart=deconstruct_domain_27.Start, DomainEnd=addition_29)
# Margin :  Front 60
# Margin :  Top 210
construct_domain_29 = ConstructDomain(DomainStart=deconstruct_domain_28.Start, DomainEnd=addition_30)
# Margin : 65
construct_domain_30 = ConstructDomain(DomainStart=deconstruct_domain_30.Start, DomainEnd=addition_31)
# Margin :  Front 80
#                 Left 55
#                 Top 135
#                 Bottom 72
panel_5 = Panel(construct_domain_22)  # disabled
panel_6 = Panel(construct_domain_23)
domain_box_12 = DomainBox(Base=multipurpose_table_for_2, X=deconstruct_box_19.X, Y=deconstruct_box_19.Y, Z=deconstruct_box_19.Z)  # disabled
domain_box_13 = DomainBox(Base=multipurpose_table_for_2, X=construct_domain_23, Y=deconstruct_box_18.Y, Z=deconstruct_box_18.Z)
panel_7 = Panel(construct_domain_24)  # disabled
domain_box_14 = DomainBox(Base=multipurpose_table_for_2, X=construct_domain_24, Y=Domain(-0.5, 0.5), Z=Domain(0, 0.25))  # disabled
panel_8 = Panel(construct_domain_25)  # disabled
domain_box_15 = DomainBox(Base=multipurpose_table_for_2, X=construct_domain_25, Y=Domain(-0.5, 0.5), Z=Domain(0, 0.25))  # disabled
panel_9 = Panel(construct_domain_26)  # disabled
domain_box_16 = DomainBox(Base=multipurpose_table_for_2, X=construct_domain_26, Y=Domain(-0.5, 0.5), Z=Domain(0, 0.25))  # disabled
panel_10 = Panel(construct_domain_27)
change_over_zone_margin = DomainBox(Base=changeover_zone, X=deconstruct_box_22.X, Y=construct_domain_28, Z=construct_domain_29)
exterior_door_margin = DomainBox(Base=exterior_door, X=deconstruct_box_20.X, Y=construct_domain_27, Z=deconstruct_box_20.Z)
panel_11 = Panel(construct_domain_30)
panel_12 = Panel(construct_domain_29)
closet_margin = DomainBox(Base=closet, X=deconstruct_box_23.X, Y=construct_domain_30, Z=deconstruct_box_23.Z)
panel_13 = Panel(construct_domain_28)
box = Box([sink_cupboard, domain_box_11])
box_2 = Box([sink_cupboard, domain_box_11])
number_slider_62 = Slider(1, range=0..1)  # disabled
number_slider_63 = Slider(1, range=0..1)  # disabled
number_slider_64 = Slider(1, range=0..1)  # disabled
number_slider_65 = Slider(1, range=0..1)  # disabled
number_slider_66 = Slider(1, range=0..1)  # disabled
box_3 = Box([box, box_2])
panel_14 = Panel(box_3)
custom_preview_materials_2 = CustomPreviewMaterials(Geometry=stove_margin, DiffuseColor=RGB(174, 215, 230), Transparency=number_slider_62)  # disabled
custom_preview_materials_3 = CustomPreviewMaterials(Geometry=microwave_margin, DiffuseColor=RGB(174, 215, 230), Transparency=number_slider_63)  # disabled
custom_preview_materials_4 = CustomPreviewMaterials(Geometry=fridge_margin, DiffuseColor=RGB(174, 215, 230), Transparency=number_slider_64)  # disabled
custom_preview_materials_5 = CustomPreviewMaterials(Geometry=cupboard_margin, DiffuseColor=RGB(174, 215, 230), Transparency=number_slider_65)  # disabled
custom_preview_materials_6 = CustomPreviewMaterials(Geometry=counter_margin, DiffuseColor=RGB(174, 215, 230), Transparency=number_slider_66)  # disabled
deconstruct_box_24 = DeconstructBox(Box=domain_box_11)  # -> Plane, X, Y, Z; disabled
deconstruct_box_25 = DeconstructBox(Box=domain_box_11)  # -> Plane, X, Y, Z; disabled
panel_15 = Panel(deconstruct_box_24.Y)  # disabled
panel_16 = Panel(deconstruct_box_24.Z)  # disabled
panel_17 = Panel(deconstruct_box_24.X)  # disabled
number_slider_67 = Slider(10, range=0..10)  # disabled
panel_18 = Panel(deconstruct_box_25.Y)  # disabled
panel_19 = Panel(deconstruct_box_25.Z)  # disabled
panel_20 = Panel(deconstruct_box_25.X)  # disabled
number_slider_68 = Slider(10, range=0..10)  # disabled
deconstruct_domain_31 = DeconstructDomain(Domain=panel_15)  # -> Start, End; disabled
deconstruct_domain_32 = DeconstructDomain(Domain=panel_17)  # -> Start, End; disabled
deconstruct_domain_33 = DeconstructDomain(Domain=panel_16)  # -> Start, End; disabled
deconstruct_domain_34 = DeconstructDomain(Domain=panel_18)  # -> Start, End; disabled
deconstruct_domain_35 = DeconstructDomain(Domain=panel_20)  # -> Start, End; disabled
deconstruct_domain_36 = DeconstructDomain(Domain=panel_19)  # -> Start, End; disabled
number_slider_69 = Slider(30, range=0..100)  # disabled
number_slider_70 = Slider(60, range=20..60)  # disabled
panel_21 = Panel(deconstruct_domain_31.End)  # disabled
panel_22 = Panel(deconstruct_domain_32.End)  # disabled
panel_23 = Panel(deconstruct_domain_33.End)  # disabled
number_slider_71 = Slider(36, range=20..60)  # disabled
number_slider_72 = Slider(6, range=2..10)  # disabled
number_slider_73 = Slider(30, range=0..100)  # disabled
number_slider_74 = Slider(60, range=20..60)  # disabled
panel_24 = Panel(deconstruct_domain_34.End)  # disabled
panel_25 = Panel(deconstruct_domain_35.End)  # disabled
panel_26 = Panel(deconstruct_domain_36.End)  # disabled
number_slider_75 = Slider(6, range=2..10)  # disabled
number_slider_76 = Slider(36, range=20..60)  # disabled
multiplication = Multiplication(A=number_slider_69, B=number_slider_67)  # disabled
number_slider_77 = Slider(2, range=0..10)  # disabled
multiplication_2 = Multiplication(A=number_slider_70, B=number_slider_67)  # disabled
multiplication_3 = Multiplication(A=number_slider_72, B=number_slider_67)  # disabled
multiplication_4 = Multiplication(A=number_slider_71, B=number_slider_67)  # disabled
number_slider_78 = Slider(10000, range=0..10000)  # disabled
round = Round()  # -> Nearest, Floor, Ceiling; disabled
multiplication_5 = Multiplication(A=number_slider_73, B=number_slider_68)  # disabled
panel_27 = Panel(multiplication)  # disabled
panel_28 = Panel(multiplication_4)  # disabled
number_slider_79 = Slider(2, range=0..10)  # disabled
panel_29 = Panel(multiplication_2)  # disabled
multiplication_6 = Multiplication(A=multiplication_3, B=multiplication_3)  # disabled
multiplication_7 = Multiplication(A=number_slider_74, B=number_slider_68)  # disabled
multiplication_8 = Multiplication(A=number_slider_75, B=number_slider_68)  # disabled
multiplication_9 = Multiplication(A=number_slider_76, B=number_slider_68)  # disabled
number_slider_80 = Slider(10000, range=0..10000)  # disabled
round_2 = Round()  # -> Nearest, Floor, Ceiling; disabled
number_slider_81 = Slider(100, range=0..100)  # disabled
division = Division(A=multiplication_2, B=multiplication_3)  # disabled
panel_30 = Panel(multiplication_3)  # disabled
division_2 = Division(A=multiplication_4, B=multiplication_3)  # disabled
panel_31 = Panel(multiplication_5)  # disabled
panel_32 = Panel(multiplication_9)  # disabled
number_slider_82 = Slider(150, range=0..1000)  # disabled
panel_33 = Panel(multiplication_7)  # disabled
multiplication_10 = Multiplication(A=multiplication_8, B=multiplication_8)  # disabled
multiplication_11 = Multiplication(A=number_slider_78, B=number_slider_77)  # disabled
division_3 = Division(A=multiplication_6, B=multiplication_11)  # disabled
panel_34 = Panel(division_2)  # disabled
number_slider_83 = Slider(100, range=0..100)  # disabled
division_4 = Division(A=multiplication_7, B=multiplication_8)  # disabled
panel_35 = Panel(multiplication_8)  # disabled
division_5 = Division(A=multiplication_9, B=multiplication_8)  # disabled
number_slider_84 = Slider(150, range=0..1000)  # disabled
integer = Integer(division_2)  # disabled
integer_2 = Integer(division)  # disabled
integer_3 = Integer(panel_27)  # disabled
box_4 = Box(closet_margin)  # disabled
box_5 = Box(changeover_zone)  # disabled
box_6 = Box(closet)  # disabled
box_7 = Box(exterior_door)  # disabled
c_script = CSharpScript(boxx=box_7)  # -> out, lenght; inputs boxx: Box; disabled
# ---------- c_script: C# ----------
    lenght = boxx.X.T1;
        //lenght = 5;
# ---------- end c_script ----------
panel_36 = Panel(c_script.lenght)  # disabled
deconstruct_box_26 = DeconstructBox(Box=box_7)  # -> Plane, X, Y, Z; disabled
panel_37 = Panel(deconstruct_box_26.Plane)  # disabled
panel_38 = Panel(deconstruct_box_26.Y)  # disabled
panel_39 = Panel(deconstruct_box_26.Z)  # disabled
panel_40 = Panel(deconstruct_box_26.X)  # disabled
box_8 = Box(exterior_door_margin)  # disabled
box_9 = Box(change_over_zone_margin)  # disabled
multiplication_12 = Multiplication(A=number_slider_80, B=number_slider_79)  # disabled
division_6 = Division(A=multiplication_10, B=multiplication_12)  # disabled
box_10 = Box()  # disabled
box_11 = Box()  # disabled
box_12 = Box()  # disabled
box_13 = Box()  # disabled
box_14 = Box()  # disabled
box_15 = Box()  # disabled
box_16 = Box()  # disabled
box_17 = Box()  # disabled
box_18 = Box()  # disabled
box_19 = Box()  # disabled
box_20 = Box()  # disabled
panel_41 = Panel(division_5)  # disabled
number_slider_85 = Slider(8, range=0..10)  # disabled
c_script_2 = CSharpScript(
    Width=integer_2,
    Length=integer,
    Height=integer_3,
    LevelHeight=number_slider_82,
    cellSize=multiplication_3,
    ExteriorDoor=box_7,
    ExteriorDoorMargin=box_8,
    ChangeOverZone=box_5,
    ChangeOverZoneMargin=box_9,
    Closet=box_6,
    ClosetMargin=box_4,
    InteriorDoor=box_10,
    InteriorDoorMargin=box_11,
    Counter=box_12,
    CounterMargin=box_13,
    Table=box_14,
    TableMargin=box_15,
    SittingUnit=box_16,
    SittingUnitMargin=box_17,
    Bed=box_18,
    HealtCare=box_19,
    HealthCareMargin=box_20)  # -> out, A, EntranceBoxes, CommonBoxes, WetAreaBoxes, Y, K, W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; inputs Width: Int32, Length: Int32, Height: Int32, LevelHeight: Int32, cellSize: Int32, ExteriorDoor: Box, ExteriorDoorMargin: Box, ChangeOverZone: Box, ChangeOverZoneMargin: Box, Closet: Box, ClosetMargin: Box, InteriorDoor: Box, InteriorDoorMargin: Box, Counter: Box, CounterMargin: Box, Table: Box, TableMargin: Box, SittingUnit: Box, SittingUnitMargin: Box, Bed: Box, BedMargin: Box, HealtCare: Box, HealthCareMargin: Box; disabled
# ---------- c_script_2: C# usings ----------
using System.Linq;
# ---------- c_script_2: C# ----------
  

    List<Box> entranceBoxes = new List<Box>();
    List<Box> commonBoxes = new List<Box>();
    List<Box> wetAreaBoxes = new List<Box>();

    /*List<Box> kitchenBoxes = new List<Box>();
      List<Box> commonAreaBoxes = new List<Box>();*/

    List<Box> WhiteBoxes = new List<Box>();

    /**  These sizes are Spreading Limits for the spaces   //total cells     **/

    double entranceSize = (6 * 100 * 100) / (cellSize * cellSize);
    double commonSize = (8 * 100 * 100) / (cellSize * cellSize);
    double wetAreaSize = (6 * 100 * 100 ) / (cellSize * cellSize);

    /*
    double kitchenSize = 7 * 100 * 100 / cellSize * cell  Size;
    double commonAreaSize = 10 * 100 * 100 / cellSize * cellSize;
    */

    Point3d pA = new Point3d(0, 0, 0);
    Point3d pB = new Point3d(10, 0, 0);
    Point3d pC = new Point3d(0, 10, 0);

    Plane p = new Plane(pA, pB, pC);

    int width = Width;
    int length = Length;
    int levelHeight = LevelHeight;
    int height = Height;
    int levelNumber = Height / LevelHeight;

    int[,,] areaArray = InitializeZeroMatrice(length, width, levelNumber);
    StartZones(areaArray);

    int[,,] emptyFullArray = InitializeZeroMatrice(length, width, levelNumber);

    for (int i = 0; i < width * length * 3; i++)
    {
      //Rhino.RhinoApp.WriteLine("\n Loop Runs" + i.ToString());

      Spread(areaArray, ref entranceSize, entranceList, ref entranceCounter, entranceLimit, cellSize);
      /*Rhino.RhinoApp.WriteLine("Entrance size" + entranceSize.ToString());
      Rhino.RhinoApp.WriteLine("Entrance counter" + entranceCounter.ToString());
      Rhino.RhinoApp.WriteLine("\n ");*/


      Spread(areaArray, ref commonSize, commonList, ref commonCounter, commonLimit, cellSize);
      /*Rhino.RhinoApp.WriteLine("Common size" + commonSize.ToString());
      Rhino.RhinoApp.WriteLine("Common counter" + commonCounter.ToString());*/

      Spread(areaArray, ref wetAreaSize, wetAreaList, ref wetAreaCounter, wetAreaLimit, cellSize);

      /*Spread(areaArray, ref kitchenSize, kitchenList, ref kitchenCounter, kitchenLimit, cellSize);
      Spread(areaArray, ref commonAreaSize, commonAreaList, ref commonAreaCounter, commonAreaLimit, cellSize);*/
    }

    noiseFilter(areaArray, 0, 6, 5);
    noiseFilter(areaArray, 1, 2, 2);

    for (int k = 0;k < levelNumber;k++)
    {
      for (int i = 0;i < length;i++)
      {
        for (int j = 0;j < width;j++)
        {
          areaArray[i, j, k] = areaArray[i, j, 0];
        }
      }
    }

    for (int k = 0;k < levelNumber;k++)
    {
      for (int i = 0;i < length;i++)
      {
        for (int j = 0;j < width;j++)
        {
          emptyFullArray[i, j, k] = 0;
        }
      }
    }

    entranceList.Clear();
    commonList.Clear();
    wetAreaList.Clear();
    /*kitchenList.Clear();
    commonAreaList.Clear();*/

    for (int k = 0;k < levelNumber;k++)
    {
      for (int i = 0;i < length;i++)
      {
        for (int j = 0;j < width;j++)
        {
          if (areaArray[i, j, k] == 1)
          {
            Interval xInterval = new Interval(i * cellSize, (i + 1) * (cellSize ));
            Interval yInterval = new Interval(j * cellSize, (j + 1) * (cellSize ));
            Interval zInterval = new Interval(k * LevelHeight, k * LevelHeight + levelHeight);

            Box boxgh = new Box(p, xInterval, yInterval, zInterval);
            entranceBoxes.Add(boxgh);
            entranceList.AddRange(new int[2] { i, j });
          }
          if (areaArray[i, j, k] == 2)
          {
            Interval xInterval = new Interval(i * cellSize, (i + 1) * (cellSize ));
            Interval yInterval = new Interval(j * cellSize, (j + 1) * (cellSize ));
            Interval zInterval = new Interval(k * LevelHeight, k * LevelHeight + levelHeight);

            Box boxgh = new Box(p, xInterval, yInterval, zInterval);
            commonBoxes.Add(boxgh);
            commonList.AddRange(new int[2] { i, j });
          }
          if (areaArray[i, j, k] == 3)
          {
            Interval xInterval = new Interval(i * cellSize, (i + 1) * (cellSize ));
            Interval yInterval = new Interval(j * cellSize, (j + 1) * (cellSize ));
            Interval zInterval = new Interval(k * LevelHeight, k * LevelHeight + levelHeight);

            Box boxgh = new Box(p, xInterval, yInterval, zInterval);
            wetAreaBoxes.Add(boxgh);
            wetAreaList.AddRange(new int[2] { i, j });
          }

          /*if (areaArray[i, j, k] == 4)
          {
            Interval xInterval = new Interval(j * cellSize, (j + 1) * (cellSize ));
            Interval yInterval = new Interval(i * cellSize, (i + 1) * (cellSize ));
            Interval zInterval = new Interval(k * LevelHeight, k * LevelHeight + levelHeight);

            Box boxgh = new Box(p, xInterval, yInterval, zInterval);
            kitchenBoxes.Add(boxgh);
            kitchenList.AddRange(new int[2] { i, j });
          }
          if (areaArray[i, j, k] == 5)
          {
            Interval xInterval = new Interval(j * cellSize, (j + 1) * (cellSize ));
            Interval yInterval = new Interval(i * cellSize, (i + 1) * (cellSize ));
            Interval zInterval = new Interval(k * LevelHeight, k * LevelHeight + levelHeight);

            Box boxgh = new Box(p, xInterval, yInterval, zInterval);
            commonAreaBoxes.Add(boxgh);
            commonAreaList.AddRange(new int[2] { i, j });
          }*/
          if (areaArray[i, j, k] == 0)
          {

            Interval xInterval = new Interval(i * cellSize, (i + 1) * (cellSize ));
            Interval yInterval = new Interval(j * cellSize, (j + 1) * (cellSize ));
            Interval zInterval = new Interval(k * LevelHeight, k * LevelHeight + levelHeight);

            Box boxgh = new Box(p, xInterval, yInterval, zInterval);
            WhiteBoxes.Add(boxgh);
            //WhiteList.AddRange(i, j);
          }
        }
      }
    }
    List<Box> ObjectsList = new List<Box>();
    List<Box> MarginsList = new List<Box>();


    /* FURNITURE LAYOUT ==> ENTRANCE STARTED */


    Point3d pointa = new Point3d(0, 0, 0);
    Vector3d vectorb = new Vector3d(0, 0, 1);

    Plane planebase = new Plane(pointa, vectorb);

    Interval xInter = new Interval(0, 10);
    Interval yInter = new Interval(0, 10);
    Interval zInter = new Interval(0, 10);


    Box ObjBox = new Box(planebase, xInter, yInter, zInter);
    Box marginBox = new Box(planebase, xInter, yInter, zInter);


    /* ENTRANCE REFERENCE */
    var exteriorDoorO = new Objects
      {
        Name = "Exterior Door",
        ZoneName = 1,

        Obj = ExteriorDoor,
        ObjMargin = ExteriorDoorMargin,

        Front = true,
        Right = true,
        Back = false,
        Left = true,
        Top = false,
        Bottom = false,

        RotationBool = false,
        RotationOpt = 2,

        MirrorBool = false,
        MirrorOpt = 2,

        Source = "NULL",
        FixedToWall = 1,

        CellSize = 60,
        SpaceList = entranceList,

        //PreviousObject = changeOverZoneO

        };
    exteriorDoorO.assignDimensions();
    exteriorDoorO.placeRefObjectEntrance(emptyFullArray, areaArray, out ObjBox, out marginBox);

    ObjectsList.Add(ObjBox);
    MarginsList.Add(marginBox);



    /* ENTRANCE 2ND OBJECT */

    var changeOverZoneO = new Objects
      {
        Name = "changeOverZone",
        ZoneName = 1,

        Obj = ChangeOverZone,
        ObjMargin = ChangeOverZoneMargin,

        Front = true,
        Right = true,
        Back = false,
        Left = true,
        Top = false,
        Bottom = false,

        RotationBool = false,
        RotationOpt = 2,

        MirrorBool = false,
        MirrorOpt = 2,

        Source = "NULL",
        FixedToWall = 1,
        CellSize = 60,

        PreviousObject = exteriorDoorO,
        SpaceList = entranceList,

        };

    changeOverZoneO.assignDimensions();

    changeOverZoneO.placeFront(emptyFullArray, areaArray, out ObjBox, out marginBox);
    //changeOverZoneO.printDimensions();
    ObjectsList.Add(ObjBox);
    MarginsList.Add(marginBox);


    /* ENTRANCE 3RD OBJECT */
    var closetO = new Objects
      {
        Name = "closet",
        ZoneName = 1,

        Obj = Closet,
        ObjMargin = ClosetMargin,

        Front = true,
        Right = true,
        Back = false,
        Left = false,
        Top = false,
        Bottom = false,

        RotationBool = false,
        RotationOpt = 2,

        MirrorBool = false,
        MirrorOpt = 2,

        Source = "NULL",
        FixedToWall = 1,
        CellSize = 60,

        PreviousObject = changeOverZoneO,
        SpaceList = entranceList,

        };

    closetO.assignDimensions();

    closetO.placeFront(emptyFullArray, areaArray, out ObjBox, out marginBox);
    //changeOverZoneO.printDimensions();
    ObjectsList.Add(ObjBox);
    MarginsList.Add(marginBox);


    /* ENTRANCE 4TH OBJECT */
    var interiorDoorO = new Objects
      {
        Name = "Interior Door",
        ZoneName = 1,

        Obj = InteriorDoor,
        ObjMargin = InteriorDoorMargin,

        Front = false,
        Right = false,
        Back = false,
        Left = false,
        Top = false,
        Bottom = false,

        RotationBool = false,
        RotationOpt = 2,

        MirrorBool = false,
        MirrorOpt = 2,

        Source = "NULL",
        FixedToWall = 1,
        CellSize = 60,

        PreviousObject = closetO,
        SpaceList = entranceList,

        };

    interiorDoorO.assignDimensions();

    interiorDoorO.placeFront(emptyFullArray, areaArray, out ObjBox, out marginBox);

    ObjectsList.Add(ObjBox);
    MarginsList.Add(marginBox);

    /* FURNITURE LAYOUT ==> ENTRANCE ENDED */


    /* FURNITURE LAYOUT ==> COMMON STARTED */

    var counterO = new Objects
      {
        Name = "Counter",
        ZoneName = 2,

        Obj = Counter,
        ObjMargin = CounterMargin,

        Front = true,
        Right = true,
        Back = false,
        Left = false,
        Top = false,
        Bottom = false,

        RotationBool = false,
        RotationOpt = 2,

        MirrorBool = false,
        MirrorOpt = 2,

        Source = "NULL",
        FixedToWall = 1,

        CellSize = 60,
        SpaceList = commonList,


        };
    counterO.assignDimensions();
    counterO.placeRefObject(emptyFullArray, areaArray, out ObjBox, out marginBox);
    ObjectsList.Add(ObjBox);
    MarginsList.Add(marginBox);


    /* COMMONAREA 2ND OBJECT */

    var tableO = new Objects
      {
        Name = "Table",
        ZoneName = 2,

        Obj = Table,
        ObjMargin = TableMargin,

        Front = true,
        Right = true,
        Back = false,
        Left = false,
        Top = false,
        Bottom = false,

        RotationBool = false,
        RotationOpt = 2,

        MirrorBool = false,
        MirrorOpt = 2,

        Source = "NULL",
        FixedToWall = 1,
        CellSize = 60,

        PreviousObject = counterO,
        SpaceList = commonList,

        };

    tableO.assignDimensions();

/*
    Point3d pointa = new Point3d(0, 0, 0);
    Vector3d vectorb = new Vector3d(0, 0, 1);

    Plane planebase = new Plane(pointa, vectorb);

    Interval xInter = new Interval(0, 10);
    Interval yInter = new Interval(0, 10);
    Interval zInter = new Interval(0, 10);


    Box ObjBox = new Box(planebase, xInter, yInter, zInter);
    Box marginBox = new Box(planebase, xInter, yInter, zInter);
*/

    tableO.placeFront(emptyFullArray, areaArray, out ObjBox, out marginBox);
    //changeOverZoneO.printDimensions();
    ObjectsList.Add(ObjBox);
    MarginsList.Add(marginBox);


    /* COMMON 3RD OBJECT */
    var sittingUnitO = new Objects
      {
        Name = "Sitting Unit",
        ZoneName = 2,

        Obj = SittingUnit,
        ObjMargin = SittingUnitMargin,

        Front = true,
        Right = true,
        Back = false,
        Left = false,
        Top = false,
        Bottom = false,

        RotationBool = false,
        RotationOpt = 2,

        MirrorBool = false,
        MirrorOpt = 2,

        Source = "NULL",
        FixedToWall = 1,
        CellSize = 60,

        PreviousObject = tableO,
        SpaceList = commonList,

        };

    sittingUnitO.assignDimensions();

    sittingUnitO.placeFront(emptyFullArray, areaArray, out ObjBox, out marginBox);
    //changeOverZoneO.printDimensions();
    ObjectsList.Add(ObjBox);
    MarginsList.Add(marginBox);


    /* COMMON 4TH OBJECT */


    var bedO = new Objects
      {
        Name = "Bed",
        ZoneName = 2,

        Obj = Bed,
        ObjMargin = BedMargin,

        Front = true,
        Right = true,
        Back = false,
        Left = false,
        Top = false,
        Bottom = false,

        RotationBool = false,
        RotationOpt = 2,

        MirrorBool = false,
        MirrorOpt = 2,

        Source = "NULL",
        FixedToWall = 1,
        CellSize = 60,

        PreviousObject = sittingUnitO,
        SpaceList = commonList,

        };

    bedO.assignDimensions();

    bedO.placeFront(emptyFullArray, areaArray, out ObjBox, out marginBox);

    ObjectsList.Add(ObjBox);
    MarginsList.Add(marginBox);

    /* FURNITURE LAYOUT ==> COMMON END */

    ShowMatrix(areaArray);

    //Bxx = boxx;
    A = areaArray;
    EntranceBoxes = entranceBoxes;
    CommonBoxes = commonBoxes;
    WetAreaBoxes = wetAreaBoxes;
    /*Y = kitchenBoxes;
    K = commonAreaBoxes;*/
    W = WhiteBoxes;
    Furnitures = ObjectsList;
    FurnituresMargins = MarginsList;
# ---------- c_script_2: C# additional code ----------
  class Objects
  {
    public string Name;
    public int ZoneName;

    public Box Obj;
    public Box ObjMargin;

    public bool Front = false;
    public bool Right = false;
    public bool Back = false;
    public bool Left = false;
    public bool Top = false;
    public bool Bottom = false;

    public bool RotationBool = true;
    public int RotationOpt; // rotation options

    public bool MirrorBool = true;
    public int MirrorOpt; // mirror options

    public string Source; // Water, Electiricity
    public int FixedToWall; // Bed, Television //1,2,3 conditions
    public int CellSize;

    public Objects PreviousObject;

    public double ObjLength ;
    public double ObjWidth ;
    public double ObjHeight ;

    public double MrjLength;
    public double MrjWidth;
    public double MrjHeight;

    public double baseX, baseY, baseZ;
    public List<int> SpaceList = new List<int>();

    public double  XCell;
    public double  YCell;
    public double  ZCell;


    //deneme
    public Objects()
    {
            /*
            var Coordinates = new List<int>();
            Point3d pA = new Point3d(0, 0, 0);
            Point3d pB = new Point3d(10, 0, 0);
            Point3d pC = new Point3d(0, 10, 0);

            Plane p = new Plane(pA, pB, pC);*/
    }

    public Objects(string name, int zoneName, bool front, bool right, bool back, bool left, bool top, bool bottom, bool rotationalBool, int rotationOpt, bool mirrorBool, int mirrorOpt, string source, int fixedTowall, int cellSize, Box obj, Box objMargin, Objects previousObject, List<int> spaceList)
      : this()
    {
      this.Obj = obj;
      this.ObjMargin = objMargin;

      this.Name = name;
      this.ZoneName = zoneName;

      this.Front = front;
      this.Right = right;
      this.Back = back;
      this.Left = left;
      this.Bottom = bottom;
      this.Top = top;

      this.RotationBool = rotationalBool;
      this.RotationOpt = rotationOpt;

      this.MirrorBool = mirrorBool;
      this.MirrorOpt = mirrorOpt;

      this.Source = source;
      this.FixedToWall = fixedTowall;
      this.CellSize = cellSize;

      this.ObjWidth = obj.X.T1;
      this.ObjLength = obj.Y.T1;
      this.ObjHeight = obj.Z.T1;

      this.MrjWidth = objMargin.X.T1;
      this.MrjLength = objMargin.Y.T1;
      this.MrjHeight = objMargin.Z.T1;

      this.baseX = Obj.Plane.OriginX;
      this.baseY = Obj.Plane.OriginY;
      this.baseZ = Obj.Plane.OriginZ;

      this.PreviousObject = previousObject;
      this.SpaceList = spaceList;
    }

    public Objects(string name, int zoneName, bool front, bool right, bool back, bool left, bool top, bool bottom, bool rotationalBool, int rotationOpt, bool mirrorBool, int mirrorOpt, string source, int fixedTowall, int cellSize, Box obj, Box objMargin, List<int> spaceList)
      : this()
    {
      this.Obj = obj;
      this.ObjMargin = objMargin;

      this.Name = name;
      this.ZoneName = zoneName;

      this.Front = front;
      this.Right = right;
      this.Back = back;
      this.Left = left;
      this.Bottom = bottom;
      this.Top = top;

      this.RotationBool = rotationalBool;
      this.RotationOpt = rotationOpt;

      this.MirrorBool = mirrorBool;
      this.MirrorOpt = mirrorOpt;

      this.Source = source;
      this.FixedToWall = fixedTowall;
      this.CellSize = cellSize;

      this.ObjWidth = obj.X.T1;
      this.ObjLength = obj.Y.T1;
      this.ObjHeight = obj.Z.T1;

      this.MrjWidth = (this.ObjMargin.X.T1);
      this.MrjLength = (this.ObjMargin.Y.T1);
      this.MrjHeight = (this.ObjMargin.Z.T1);

      this.baseX = Obj.Plane.OriginX;
      this.baseY = Obj.Plane.OriginY;
      this.baseZ = Obj.Plane.OriginZ;

      this.SpaceList = spaceList;
    }

    public void assignDimensions()
    {
      this.ObjWidth = this.Obj.X.T1;
      this.ObjLength = this.Obj.Y.T1;
      this.ObjHeight = this.Obj.Z.T1;

      this.MrjWidth = this.ObjMargin.X.T1;
      this.MrjLength = this.ObjMargin.Y.T1;
      this.MrjHeight = this.ObjMargin.Z.T1;

    }

    public void printDimensions()
    {
      Rhino.RhinoApp.WriteLine("Obj Width " + this.ObjWidth.ToString());
      Rhino.RhinoApp.WriteLine("Obj Length " + this.ObjLength.ToString());
      Rhino.RhinoApp.WriteLine("Obj Height " + this.ObjHeight.ToString());

      Rhino.RhinoApp.WriteLine("Obj Width " + this.MrjWidth.ToString());
      Rhino.RhinoApp.WriteLine("Obj Length " + this.MrjLength.ToString());
      Rhino.RhinoApp.WriteLine("Obj Height " + this.MrjHeight.ToString());
    }



    public void placeRefObject(int [,,]emptyFullArray, int[,,]areaArray, out Box ObjBox, out Box marginBox)
    {
      this.XCell = Math.Ceiling((double) (this.MrjWidth / CellSize));
      this.YCell = Math.Ceiling((double) (this.MrjLength / CellSize));
      this.ZCell = Math.Ceiling((double) (this.MrjHeight / 150));

      bool emptyBool = true;
      bool sameZone = true;

      bool placeSuccessful = false;
      int trycount = 0;

      while (placeSuccessful == false)
      {
        var rand = new Random();
        var randomCellIndex = rand.Next(this.SpaceList.Count / 2);

        baseX = (this.SpaceList[2 * randomCellIndex]) * CellSize;
        baseY = (this.SpaceList[2 * randomCellIndex + 1]) * CellSize;
        baseZ = 0;
        baseZ = 0;

        //baseX = baseX * CellSize;
        //baseY = baseY * CellSize;

        if( (baseX + this.MrjWidth < 300) && (baseY + this.MrjLength < 600) && (baseZ + this.MrjHeight < 300) &&
          (baseX + this.MrjWidth > 0) && (baseY + this.MrjLength > 0) && (baseZ + this.MrjHeight > 0) )
        {
          for(int i = (int) (baseX / CellSize) ; i < (baseX / CellSize + (int) XCell); i++)
          {
            for(int j = (int) (baseY / CellSize); j < baseY / CellSize + (int) YCell; j++)
            {
              for(int k = (int) (baseZ / 150); k < baseZ / 150 + (int) ZCell; k++)
              {
                Rhino.RhinoApp.WriteLine("Entrance Reference Object :  " + "  i:  " + i + "  j:  " + j + "  k:  " + k);
                if (emptyFullArray[i, j, k] == 1)
                {
                  emptyBool = false;
                }
                if (areaArray[i, j, k] != this.ZoneName)
                {
                  sameZone = false;
                }
              }
            }
          }

          if (emptyBool && sameZone)
          {
            placeSuccessful = true;

            Rhino.RhinoApp.WriteLine("Reference Object conditions are successful ");
            for(int i = (int) (baseX / CellSize) ; i < (baseX / CellSize + (int) XCell); i++)
            {
              for(int j = (int) (baseY / CellSize); j < baseY / CellSize + (int) YCell; j++)
              {
                for(int k = (int) (baseZ / 150); k < baseZ / 150 + (int) ZCell; k++)
                {
                  emptyFullArray[i, j, k] = 1;
                }
              }
            }
          }
          else
          {
            Rhino.RhinoApp.WriteLine("Conditions are not satisfied ");
          }
        }

        trycount++;
        Rhino.RhinoApp.WriteLine("Try count is : " + trycount);
        if (trycount > 60 )
          Rhino.RhinoApp.WriteLine("Try count is over 60 placement is unsuccessful: ");
        placeSuccessful = true;
      }

      if( trycount < 60 && placeSuccessful )
      {
        Rhino.RhinoApp.WriteLine("baseX " + this.baseX);
        Rhino.RhinoApp.WriteLine("baseY " + this.baseY);
        Rhino.RhinoApp.WriteLine("baseZ " + this.baseZ);

        Point3d pointa = new Point3d(baseX, baseY, 0);
        Vector3d pointb = new Vector3d(0, 0, 1);

        Plane planebase = new Plane(pointa, pointb);

        Interval xInterval = new Interval(0, this.ObjWidth);
        Interval yInterval = new Interval(0, this.ObjLength);
        Interval zInterval = new Interval(0, this.ObjHeight);

        ObjBox = new Box(planebase, xInterval, yInterval, zInterval);

        xInterval = new Interval(0, this.MrjWidth);
        yInterval = new Interval(0, this.MrjLength);
        zInterval = new Interval(0, this.MrjHeight);

        marginBox = new Box(planebase, xInterval, yInterval, zInterval);

      }

      else
      {
        ObjBox = new Box();
        marginBox = new Box();
      }
    }

    public void placeRefObjectEntrance(int [,,]emptyFullArray, int[,,]areaArray, out Box ObjBox, out Box marginBox)
    {
      this.XCell = Math.Ceiling((double) (this.MrjWidth / CellSize));
      this.YCell = Math.Ceiling((double) (this.MrjLength / CellSize));
      this.ZCell = Math.Ceiling((double) (this.MrjHeight / 150));

      bool emptyBool = true;
      bool sameZone = true;


      bool placeSuccessful = false;
      int trycount = 0;

      while (placeSuccessful == false)
      {
        var rand = new Random();
        var randomCellIndex = rand.Next(this.SpaceList.Count / 2);

        baseX = (this.SpaceList[2 * randomCellIndex]) * CellSize;
        baseY = 0;
        baseZ = 0;

        //baseX = baseX * CellSize;
        //baseY = baseY * CellSize;

        if( (baseX + this.MrjWidth < 300) && (baseY + this.MrjLength < 600) && (baseZ + this.MrjHeight < 300) &&
          (baseX + this.MrjWidth > 0) && (baseY + this.MrjLength > 0) && (baseZ + this.MrjHeight > 0) )
        {
          for(int i = (int) (baseX / CellSize) ; i < (baseX / CellSize + (int) XCell); i++)
          {
            for(int j = (int) (baseY / CellSize); j < baseY / CellSize + (int) YCell; j++)
            {
              for(int k = (int) (baseZ / 150); k < baseZ / 150 + (int) ZCell; k++)
              {
                Rhino.RhinoApp.WriteLine("Entrance Reference Object :  " + "  i:  " + i + "  j:  " + j + "  k:  " + k);
                if (emptyFullArray[i, j, k] == 1)
                {
                  emptyBool = false;
                }
                if (areaArray[i, j, k] != this.ZoneName)
                {
                  sameZone = false;
                }
              }
            }
          }

          if (emptyBool && sameZone)
          {
            placeSuccessful = true;

            Rhino.RhinoApp.WriteLine("Reference Object conditions are successful ");
            for(int i = (int) (baseX / CellSize) ; i < (baseX / CellSize + (int) XCell); i++)
            {
              for(int j = (int) (baseY / CellSize); j < baseY / CellSize + (int) YCell; j++)
              {
                for(int k = (int) (baseZ / 150); k < baseZ / 150 + (int) ZCell; k++)
                {
                  emptyFullArray[i, j, k] = 1;
                }
              }
            }
          }
          else
          {
            Rhino.RhinoApp.WriteLine("Conditions are not satisfied ");
          }
        }

        trycount++;
        Rhino.RhinoApp.WriteLine("Try count is : " + trycount);
        if (trycount > 60 )
          Rhino.RhinoApp.WriteLine("Try count is over 60 placement is unsuccessful: ");
        placeSuccessful = true;
      }

      if( trycount < 60 && placeSuccessful )
      {
        Rhino.RhinoApp.WriteLine("baseX " + this.baseX);
        Rhino.RhinoApp.WriteLine("baseY " + this.baseY);
        Rhino.RhinoApp.WriteLine("baseZ " + this.baseZ);

        Point3d pointa = new Point3d(baseX, 0, 0);
        Vector3d pointb = new Vector3d(0, 0, 1);

        Plane planebase = new Plane(pointa, pointb);

        Interval xInterval = new Interval(0, this.ObjWidth);
        Interval yInterval = new Interval(0, this.ObjLength);
        Interval zInterval = new Interval(0, this.ObjHeight);

        ObjBox = new Box(planebase, xInterval, yInterval, zInterval);

        xInterval = new Interval(0, this.MrjWidth);
        yInterval = new Interval(0, this.MrjLength);
        zInterval = new Interval(0, this.MrjHeight);

        marginBox = new Box(planebase, xInterval, yInterval, zInterval);

      }


      else
      {
        ObjBox = new Box();
        marginBox = new Box();
      }

    }


    public void placeFront(int [,,]emptyFullArray, int[,,]areaArray, out Box ObjBox, out Box marginBox)
    {
      bool emptyBool = true;
      bool sameZone = true;

      this.XCell = Math.Ceiling((double) (this.MrjWidth / CellSize));
      this.YCell = Math.Ceiling((double) (this.MrjLength / CellSize));
      this.ZCell = Math.Ceiling((double) (this.MrjHeight / 150));

      this.baseX = PreviousObject.baseX;
      this.baseY = PreviousObject.baseY + CellSize * PreviousObject.YCell;
      this.baseZ = PreviousObject.baseZ;

      if( (baseX + this.MrjWidth < 300) && (baseY + this.MrjLength < 600) && (baseZ + this.MrjHeight < 300) &&
        (baseX + this.MrjWidth > 0) && (baseY + this.MrjLength > 0) && (baseZ + this.MrjHeight > 0) )
      {
        for(int i = (int) (baseX / CellSize) ; i < (baseX / CellSize + (int) XCell); i++)
        {
          for(int j = (int) (baseY / CellSize); j < baseY / CellSize + (int) YCell; j++)
          {
            for(int k = (int) (baseZ / 150); k < baseZ / 150 + (int) ZCell; k++)
            {
              Rhino.RhinoApp.WriteLine("i:  " + i + "  j:  " + j + "  k:  " + k);
              if (emptyFullArray[i, j, k] == 1)
              {
                emptyBool = false;
              }
              if (areaArray[i, j, k] != this.ZoneName)
              {
                sameZone = false;
              }
            }
          }
        }

        if (emptyBool && sameZone)
        {
          Rhino.RhinoApp.WriteLine("Conditions are successful ");
          for(int i = (int) (baseX / CellSize) ; i < (baseX / CellSize + (int) XCell); i++)
          {
            for(int j = (int) (baseY / CellSize); j < baseY / CellSize + (int) YCell; j++)
            {
              for(int k = (int) (baseZ / 150); k < baseZ / 150 + (int) ZCell; k++)
              {
                emptyFullArray[i, j, k] = 1;
              }
            }
          }
        }
        else
        {
          Rhino.RhinoApp.WriteLine("Place Front:  Conditions are not satisfied ");
        }
      }
      else
      {
        Rhino.RhinoApp.WriteLine("Place Front: Conditions are not satisfied ");
      }


      Point3d pointa = new Point3d(baseX, baseY, baseZ);
      Vector3d pointb = new Vector3d(0, 0, 1);

      Plane planebase = new Plane(pointa, pointb);

      Interval xInterval = new Interval(0, this.ObjWidth);
      Interval yInterval = new Interval(0, this.ObjLength);
      Interval zInterval = new Interval(0, this.ObjHeight);

      ObjBox = new Box(planebase, xInterval, yInterval, zInterval);

      xInterval = new Interval(0, this.MrjWidth);
      yInterval = new Interval(0, this.MrjLength);
      zInterval = new Interval(0, this.MrjHeight);

      marginBox = new Box(planebase, xInterval, yInterval, zInterval);
    }


    public void placeRight(int [,,]emptyFullArray, int[,,]areaArray, out Box ObjBox, out Box marginBox)
    {
      bool emptyBool = true;
      bool sameZone = true;

      this.XCell = Math.Ceiling((double) (this.MrjWidth / CellSize));
      this.YCell = Math.Ceiling((double) (this.MrjLength / CellSize));
      this.ZCell = Math.Ceiling((double) (this.MrjHeight / 150));

      this.baseX = PreviousObject.baseX + CellSize * PreviousObject.XCell;
      this.baseY = PreviousObject.baseY;
      this.baseZ = PreviousObject.baseZ;

      if( (baseX + this.ObjWidth < 300) && (baseY + this.ObjLength < 600) && (baseZ + this.ObjHeight < 300) &&
        (baseX + this.ObjWidth > 0) && (baseY + this.ObjLength > 0) && (baseZ + this.ObjHeight > 0) )
      {
        for(int i = (int) (baseX / CellSize) ; i < (baseX / CellSize + (int) XCell); i++)
        {
          for(int j = (int) (baseY / CellSize); j < baseY / CellSize + (int) YCell; j++)
          {
            for(int k = (int) (baseZ / 150); k < baseZ / 150 + (int) ZCell; k++)
            {
              if (emptyFullArray[i, j, k] == 1)
              {
                emptyBool = false;
              }
              if (areaArray[i, j, k] != this.ZoneName)
              {
                sameZone = false;
              }
            }
          }
        }

        if (emptyBool && sameZone)
        {
          Rhino.RhinoApp.WriteLine("Place Right: Conditions are successful ");
          for(int i = (int) (baseX / CellSize) ; i < (baseX / CellSize + (int) XCell); i++)
          {
            for(int j = (int) (baseY / CellSize); j < baseY / CellSize + (int) YCell; j++)
            {
              for(int k = (int) (baseZ / 150); k < baseZ / 150 + (int) ZCell; k++)
              {
                emptyFullArray[i, j, k] = 1;
              }
            }
          }
        }
        else
        {
          Rhino.RhinoApp.WriteLine("Place Right: Conditions are not satisfied ");
        }
      }
      else
      {
        Rhino.RhinoApp.WriteLine("Place Right: Conditions are not satisfied ");
      }

      Point3d pointa = new Point3d(baseX, baseY, baseZ);
      Vector3d pointb = new Vector3d(0, 0, 1);

      Plane planebase = new Plane(pointa, pointb);

      Interval xInterval = new Interval(0, this.ObjWidth);
      Interval yInterval = new Interval(0, this.ObjLength);
      Interval zInterval = new Interval(0, this.ObjHeight);

      ObjBox = new Box(planebase, xInterval, yInterval, zInterval);

      xInterval = new Interval(0, this.MrjWidth);
      yInterval = new Interval(0, this.MrjLength);
      zInterval = new Interval(0, this.MrjHeight);

      marginBox = new Box(planebase, xInterval, yInterval, zInterval);
    }

    public void placeBack(int [,,]emptyFullArray, int[,,]areaArray, out Box ObjBox, out Box marginBox)
    {
      bool emptyBool = true;
      bool sameZone = true;

      this.XCell = Math.Ceiling((double) (this.MrjWidth / CellSize));
      this.YCell = Math.Ceiling((double) (this.MrjLength / CellSize));
      this.ZCell = Math.Ceiling((double) (this.MrjHeight / 150));

      this.baseX = PreviousObject.baseX;
      this.baseY = PreviousObject.baseY - CellSize * this.YCell;
      this.baseZ = PreviousObject.baseZ;

      if( (baseX + this.ObjWidth < 300) && (baseY + this.ObjLength < 600) && (baseZ + this.ObjHeight < 300) &&
        (baseX + this.ObjWidth > 0) && (baseY + this.ObjLength > 0) && (baseZ + this.ObjHeight > 0) )
      {
        for(int i = (int) (baseX / CellSize) ; i < (baseX / CellSize + (int) XCell); i++)
        {
          for(int j = (int) (baseY / CellSize); j < baseY / CellSize + (int) YCell; j++)
          {
            for(int k = (int) (baseZ / 150); k < baseZ / 150 + (int) ZCell; k++)
            {
              if (emptyFullArray[i, j, k] == 1)
              {
                emptyBool = false;
              }
              if (areaArray[i, j, k] != this.ZoneName)
              {
                sameZone = false;
              }
            }
          }
        }

        if (emptyBool && sameZone)
        {
          Rhino.RhinoApp.WriteLine("Place Back: Conditions are successful ");
          for(int i = (int) (baseX / CellSize) ; i < (baseX / CellSize + (int) XCell); i++)
          {
            for(int j = (int) (baseY / CellSize); j < baseY / CellSize + (int) YCell; j++)
            {
              for(int k = (int) (baseZ / 150); k < baseZ / 150 + (int) ZCell; k++)
              {
                emptyFullArray[i, j, k] = 1;
              }
            }
          }
        }
        else
        {
          Rhino.RhinoApp.WriteLine("Place Back: Conditions are not satisfied ");
        }
      }
      else
      {
        Rhino.RhinoApp.WriteLine("Place Back:Conditions are not satisfied ");
      }

      Point3d pointa = new Point3d(baseX, baseY, baseZ);
      Vector3d pointb = new Vector3d(0, 0, 1);

      Plane planebase = new Plane(pointa, pointb);

      Interval xInterval = new Interval(0, this.ObjWidth);
      Interval yInterval = new Interval(0, this.ObjLength);
      Interval zInterval = new Interval(0, this.ObjHeight);

      ObjBox = new Box(planebase, xInterval, yInterval, zInterval);

      xInterval = new Interval(0, this.MrjWidth);
      yInterval = new Interval(0, this.MrjLength);
      zInterval = new Interval(0, this.MrjHeight);

      marginBox = new Box(planebase, xInterval, yInterval, zInterval);
    }

    public void placeLeft(int [,,]emptyFullArray, int[,,]areaArray, out Box ObjBox, out Box marginBox)
    {
      bool emptyBool = true;
      bool sameZone = true;

      this.XCell = Math.Ceiling((double) (this.MrjWidth / CellSize));
      this.YCell = Math.Ceiling((double) (this.MrjLength / CellSize));
      this.ZCell = Math.Ceiling((double) (this.MrjHeight / 150));

      this.baseX = PreviousObject.baseX - CellSize * this.XCell;
      this.baseY = PreviousObject.baseY;
      this.baseZ = PreviousObject.baseZ;

      if( (baseX + this.ObjWidth < 300) && (baseY + this.ObjLength < 600) && (baseZ + this.ObjHeight < 300) &&
        (baseX + this.ObjWidth > 0) && (baseY + this.ObjLength > 0) && (baseZ + this.ObjHeight > 0) )
      {
        for(int i = (int) (baseX / CellSize) ; i < (baseX / CellSize + (int) XCell); i++)
        {
          for(int j = (int) (baseY / CellSize); j < baseY / CellSize + (int) YCell; j++)
          {
            for(int k = (int) (baseZ / 150); k < baseZ / 150 + (int) ZCell; k++)
            {
              if (emptyFullArray[i, j, k] == 1)
              {
                emptyBool = false;
              }
              if (areaArray[i, j, k] != this.ZoneName)
              {
                sameZone = false;
              }
            }
          }
        }

        if (emptyBool && sameZone)
        {
          Rhino.RhinoApp.WriteLine("Place Left: Conditions are successful ");
          for(int i = (int) (baseX / CellSize) ; i < (baseX / CellSize + (int) XCell); i++)
          {
            for(int j = (int) (baseY / CellSize); j < baseY / CellSize + (int) YCell; j++)
            {
              for(int k = (int) (baseZ / 150); k < baseZ / 150 + (int) ZCell; k++)
              {
                emptyFullArray[i, j, k] = 1;
              }
            }
          }
        }
        else
        {
          Rhino.RhinoApp.WriteLine("Place Left: Conditions are not satisfied ");
        }
      }
      else
      {
        Rhino.RhinoApp.WriteLine("Place Left: Conditions are not satisfied ");
      }

      Point3d pointa = new Point3d(baseX, baseY, baseZ);
      Vector3d pointb = new Vector3d(0, 0, 1);

      Plane planebase = new Plane(pointa, pointb);

      Interval xInterval = new Interval(0, this.ObjWidth);
      Interval yInterval = new Interval(0, this.ObjLength);
      Interval zInterval = new Interval(0, this.ObjHeight);

      ObjBox = new Box(planebase, xInterval, yInterval, zInterval);

      xInterval = new Interval(0, this.MrjWidth);
      yInterval = new Interval(0, this.MrjLength);
      zInterval = new Interval(0, this.MrjHeight);

      marginBox = new Box(planebase, xInterval, yInterval, zInterval);
    }
    public void placeTop(int [,,]emptyFullArray, int[,,]areaArray, out Box ObjBox, out Box marginBox)
    {
      bool emptyBool = true;
      bool sameZone = true;

      this.XCell = Math.Ceiling((double) (this.MrjWidth / CellSize));
      this.YCell = Math.Ceiling((double) (this.MrjLength / CellSize));
      this.ZCell = Math.Ceiling((double) (this.MrjHeight / 150));

      this.baseX = PreviousObject.baseX;
      this.baseY = PreviousObject.baseY;
      this.baseZ = PreviousObject.baseZ + CellSize * PreviousObject.ZCell;

      if( (baseX + this.ObjWidth < 300) && (baseY + this.ObjLength < 600) && (baseZ + this.ObjHeight < 300) &&
        (baseX + this.ObjWidth > 0) && (baseY + this.ObjLength > 0) && (baseZ + this.ObjHeight > 0) )
      {
        for(int i = (int) (baseX / CellSize) ; i < (baseX / CellSize + (int) XCell); i++)
        {
          for(int j = (int) (baseY / CellSize); j < baseY / CellSize + (int) YCell; j++)
          {
            for(int k = (int) (baseZ / 150); k < baseZ / 150 + (int) ZCell; k++)
            {
              if (emptyFullArray[i, j, k] == 1)
              {
                emptyBool = false;
              }
              if (areaArray[i, j, k] != this.ZoneName)
              {
                sameZone = false;
              }
            }
          }
        }

        if (emptyBool && sameZone)
        {
          Rhino.RhinoApp.WriteLine("Conditions are successful ");
          for(int i = (int) (baseX / CellSize) ; i < (baseX / CellSize + (int) XCell); i++)
          {
            for(int j = (int) (baseY / CellSize); j < baseY / CellSize + (int) YCell; j++)
            {
              for(int k = (int) (baseZ / 150); k < baseZ / 150 + (int) ZCell; k++)
              {
                emptyFullArray[i, j, k] = 1;
              }
            }
          }
        }
        else
        {
          Rhino.RhinoApp.WriteLine("Conditions are not satisfied ");
        }
      }
      else
      {
        Rhino.RhinoApp.WriteLine("Conditions are not satisfied ");
      }

      Point3d pointa = new Point3d(baseX, baseY, baseZ);
      Vector3d pointb = new Vector3d(0, 0, 1);

      Plane planebase = new Plane(pointa, pointb);

      Interval xInterval = new Interval(0, this.ObjWidth);
      Interval yInterval = new Interval(0, this.ObjLength);
      Interval zInterval = new Interval(0, this.ObjHeight);

      ObjBox = new Box(planebase, xInterval, yInterval, zInterval);

      xInterval = new Interval(0, this.MrjWidth);
      yInterval = new Interval(0, this.MrjLength);
      zInterval = new Interval(0, this.MrjHeight);

      marginBox = new Box(planebase, xInterval, yInterval, zInterval);
    }

    public void placeBottom(int [,,]emptyFullArray, int[,,]areaArray, out Box ObjBox, out Box marginBox)
    {
      bool emptyBool = true;
      bool sameZone = true;

      this.XCell = Math.Ceiling((double) (this.MrjWidth / CellSize));
      this.YCell = Math.Ceiling((double) (this.MrjLength / CellSize));
      this.ZCell = Math.Ceiling((double) (this.MrjHeight / 150));

      this.baseX = PreviousObject.baseX;
      this.baseY = PreviousObject.baseY;
      this.baseZ = PreviousObject.baseZ - CellSize * this.ZCell;

      if( (baseX + this.ObjWidth < 300) && (baseY + this.ObjLength < 600) && (baseZ + this.ObjHeight < 300) &&
        (baseX + this.ObjWidth > 0) && (baseY + this.ObjLength > 0) && (baseZ + this.ObjHeight > 0) )
      {
        for(int i = (int) (baseX / CellSize) ; i < (baseX / CellSize + (int) XCell); i++)
        {
          for(int j = (int) (baseY / CellSize); j < baseY / CellSize + (int) YCell; j++)
          {
            for(int k = (int) (baseZ / 150); k < baseZ / 150 + (int) ZCell; k++)
            {
              if (emptyFullArray[i, j, k] == 1)
              {
                emptyBool = false;
              }
              if (areaArray[i, j, k] != this.ZoneName)
              {
                sameZone = false;
              }
            }
          }
        }

        if (emptyBool && sameZone)
        {
          Rhino.RhinoApp.WriteLine("Conditions are successful ");
          for(int i = (int) (baseX / CellSize) ; i < (baseX / CellSize + (int) XCell); i++)
          {
            for(int j = (int) (baseY / CellSize); j < baseY / CellSize + (int) YCell; j++)
            {
              for(int k = (int) (baseZ / 150); k < baseZ / 150 + (int) ZCell; k++)
              {
                emptyFullArray[i, j, k] = 1;
              }
            }
          }
        }
        else
        {
          Rhino.RhinoApp.WriteLine("Conditions are not satisfied ");
        }
      }
      else
      {
        Rhino.RhinoApp.WriteLine("Conditions are not satisfied ");
      }

      Point3d pointa = new Point3d(baseX, baseY, baseZ);
      Vector3d pointb = new Vector3d(0, 0, 1);

      Plane planebase = new Plane(pointa, pointb);

      Interval xInterval = new Interval(0, this.ObjWidth);
      Interval yInterval = new Interval(0, this.ObjLength);
      Interval zInterval = new Interval(0, this.ObjHeight);

      ObjBox = new Box(planebase, xInterval, yInterval, zInterval);

      xInterval = new Interval(0, this.MrjWidth);
      yInterval = new Interval(0, this.MrjLength);
      zInterval = new Interval(0, this.MrjHeight);

      marginBox = new Box(planebase, xInterval, yInterval, zInterval);
    }

    public void placeObject(int [,,]emptyFullArray, int[,,]areaArray, out Box ObjBox, out Box marginBox)
    {

      Point3d pointa = new Point3d(baseX, baseY, baseZ);
      Vector3d pointb = new Vector3d(0, 0, 1);

      Plane planebase = new Plane(pointa, pointb);

      Interval xInterval = new Interval(0, this.ObjWidth);
      Interval yInterval = new Interval(0, this.ObjLength);
      Interval zInterval = new Interval(0, this.ObjHeight);

      ObjBox = new Box(planebase, xInterval, yInterval, zInterval);

      xInterval = new Interval(0, this.MrjWidth);
      yInterval = new Interval(0, this.MrjLength);
      zInterval = new Interval(0, this.MrjHeight);

      marginBox = new Box(planebase, xInterval, yInterval, zInterval);

      List<int> growDirection = new List<int>();

      if(PreviousObject.Front == true)
        growDirection.Add(1); // Front Direction
      if(PreviousObject.Right == true)
        growDirection.Add(2); // Right Direction
      if(PreviousObject.Back == true)
        growDirection.Add(3); // Back Direction
      if(PreviousObject.Left == true)
        growDirection.Add(4); // Left Direction
      if(PreviousObject.Bottom == true)
        growDirection.Add(5); // Bottom Direction
      if(PreviousObject.Top == true)
        growDirection.Add(6); // Right Direction

      bool placeSuccess = false;
      int tryCounter = 0;

      if(growDirection.Count >= 1)
      {
        Random randm = new Random();

        while(placeSuccess == false )
        {
          int a = randm.Next(0, growDirection.Count);
          int randomMethod = growDirection[a];

          switch (a)
          ​{
            case 1:
              this.placeFront(emptyFullArray, areaArray, out  ObjBox, out marginBox);
              placeSuccess = true;
              break;
            case 2:
              this.placeRight(emptyFullArray, areaArray, out  ObjBox, out marginBox);
              placeSuccess = true;
              break;
            case 3:
              this.placeBack(emptyFullArray, areaArray, out  ObjBox, out marginBox);
              placeSuccess = true;
              break;
            case 4:
              this.placeLeft(emptyFullArray, areaArray, out  ObjBox, out marginBox);
              placeSuccess = true;
              break;
            case 5:
              this.placeBottom(emptyFullArray, areaArray, out  ObjBox, out marginBox);
              placeSuccess = true;
              break;
            case 6:
              this.placeTop(emptyFullArray, areaArray, out  ObjBox, out marginBox);
              placeSuccess = true;
              break;

            default:
              tryCounter++;
              break;
            // default statements
          }


        }
        growDirection.Clear();




      }


    }


    public void rotate()
    {

    }



    static void mirror()
    {

    }

    static void getClosestCell()
    {

    }

    static void createWall()
    {

    }

  }

  static void ShowMatrix(int[,,] Arr)
  {
    for (int i = 0; i < Arr.GetLength(0); i++)
    {
      for (int j = 0; j < Arr.GetLength(1); j++)
      {
        Rhino.RhinoApp.Write(Arr[i, j, 0] + " ");
      }
      Rhino.RhinoApp.WriteLine("Loop Runs" + i.ToString());
    }
    return;
  }

  static int[,,] InitializeZeroMatrice(int width, int length, int levelNumber)
  {
    var areaArray = new int[width, length, levelNumber];

    for (int k = 0; k < levelNumber; k++)
    {
      for (int i = 0; i < width; i++)
      {
        for (int j = 0; j < length; j++)
        {
          areaArray[i, j, k] = 0;
        }
      }
    }
    return areaArray;
  }

  /* The Color lists keep the colors in a seperate List in order to choose within them easily instead of searching where they are... */
  static List<int> entranceList = new List<int>();
  static List<int> commonList = new List<int>();
  static List<int> wetAreaList = new List<int>();
 /* static List<int> kitchenList = new List<int>();
  static List<int> commonAreaList = new List<int>();*/

  /**           these counters are used for starting the límitations counts.         **/

  static int entranceCounter = 1;
  static int commonCounter = 1;
  static int wetAreaCounter = 1;
  /*static int kitchenCounter = 1;
  static int commonAreaCounter = 1;*/
  /**           these limits are used for defining max distance that zone can spread.  **/

  static int entranceLimit = 200;
  static int commonLimit = 200;
  static int wetAreaLimit = 200;
  /*static int kitchenLimit = 200;
  static int commonAreaLimit = 100;*/

  static void StartZones(int[,,] arr)
  {
    /**
     * Randomly Starts the color. Takes the Color lists as argumnts
     * (We can delete these argumnents and it can get them as local referance
     * in our case it gives us a chance to choose what to initilize)
     * **/

    Random rand = new Random();
    //----------------------
    /* GetLength(0) and GetLength(1) might be set as variable */
    //Array.GetLength(0) gives the column lenght in other words length of an array
    //Array.GetLength(1) gives the row lenght in other words width of an array
    var a = rand.Next(arr.GetLength(0) / 2, arr.GetLength(0) / 2);
    var b = rand.Next(0, 2);

    Rhino.RhinoApp.WriteLine("started");
    entranceList.AddRange(new int[2] { a, b }); //AddRange ==> Adds multiple elements to a List . We use mod%2 to call the index of the point back instead of stacking them as an another List(or Array) in our list.
    arr[a, b, 0] = 1;// entrance Starting Point
    //----------------------

    b = rand.Next(0, arr.GetLength(1));
    a = rand.Next(0, arr.GetLength(0));

    commonList.AddRange(new int[2] { a, b });
    arr[a, b, 0] = 2; // common Starting Point
    //----------------------
    a = rand.Next(0, arr.GetLength(0));
    b = rand.Next(0, arr.GetLength(1));

    wetAreaList.AddRange(new int[2] { a, b });
    arr[a, b, 0] = 3; // wetArea Starting Point
    //----------------------
    a = rand.Next(0, arr.GetLength(0));
    b = rand.Next(0, arr.GetLength(1));
/*
    kitchenList.AddRange(new int[2] { a, b });
    arr[a, b, 0] = 4; // kitchen Starting Point
    //----------------------
    a = rand.Next(0, arr.GetLength(0));
    b = rand.Next(0, arr.GetLength(1));

    commonAreaList.AddRange(new int[2] { a, b });
    arr[a, b, 0] = 5; // commonArea Starting Point
    //----------------------
  */
  }
        /* Calculates the distance between initial point in the color and the possible new point!
         *  (if the possible new point is too far from inital point eleminate it.) */
  static double distanceCalculate(List<int> spaceCoordList, int x2, int y2, int cellSize)
  {
    var distance = cellSize * Math.Sqrt((y2 - spaceCoordList[1]) * (y2 - spaceCoordList[1]) + (x2 - spaceCoordList[0]) * (x2 - spaceCoordList[0]));
    return distance;
  }

  static void Evaluate()
  {
    // according to relations give score to the created zones
    // get the centers of the zones and acoording to the distances and created sizes give
    //positive or negative points and if score is not acceptable re-run and create variatians.
  }


  static void noiseFilter (int [,,] arr, int type, int iterationNumber, int controlNumber)
  {
    if(type == 0)
    {
      for( int loop = 0 ; loop < iterationNumber ; loop++ )
      {
        List < int> surrounding = new List<int>();
        for(int i = 1 ; i < arr.GetLength(0) - 1 ;i++)
        {
          for(int j = 1 ; j < arr.GetLength(1) - 1 ;j++)
          {
            for(int x = -1 ; x < 2;x++)
            {
              for(int y = -1 ; y < 2;y++)
              {
                if(!(x == y && x == 0))
                {

                  surrounding.Add(arr[i + x, j + y, 0]);
                }
              }
            }
            for (int v = 0 ; v < 6 ;v++) // 6 is the number of the zones including  empty cells
            {
              int count = (from z in surrounding where z == v select z).Count();
              if ( count >= controlNumber )
              {
                arr[i, j, 0] = v;
              }
            }
            surrounding.Clear();
            surrounding.TrimExcess();
          }
        }
      }
    }

    if(type == 1)
    {
      for( int loop = 0 ; loop < iterationNumber ; loop++ )
      {
        List < int> surrounding = new List<int>();
        for(int i = 1 ; i < arr.GetLength(0) - 1 ;i++)
        {
          for(int j = 1 ; j < arr.GetLength(1) - 1 ;j++)
          {
            for(int x = -1 ; x < 2;x++)
            {
              for(int y = -1 ; y < 2;y++)
              {
                if(!(x == y && x == 0) && ( (x + y == 1 ) || (x + y == -1 )) )
                {
                  surrounding.Add(arr[i + x, j + y, 0]);
                }
              }
            }

            for (int v = 0 ; v < 6 ;v++) // 6 is the number of the zones including  empty cells
            {
              int count = (from z in surrounding where z == v select z).Count();
              if ( count >= 2 )
              {
                arr[i, j, 0] = v;
              }
            }
            surrounding.Clear();
            surrounding.TrimExcess();
          }
        }
      }
    }
  }

  static void Spread(int[,,] arr, ref double spaceSize, List<int> spaceCoordList, ref int counter, int spaceLimit, int cellSize)
  {
        /*ARGUMENTS
     * The main array which has rectangular form(will be 3d in short) ,
     * spaceSize = Maximum limit that can grow.  ,
     * spaceCoordList =  the cells of the zone which has been already defined. )
     */
    var rand = new Random();
    var directionList = new List<int>();
    int Xcoord;
    int Ycoord;
    bool draw = false;
    int trycount = 0;

    while (draw == false && counter <= spaceSize)
    {
      if (counter <= spaceSize ) //Can be deleted. The condition is added to the While Loop Conditions.
      {
        var randomCellIndex = rand.Next(spaceCoordList.Count / 2);

        Xcoord = spaceCoordList[2 * randomCellIndex];
        Ycoord = spaceCoordList[2 * randomCellIndex + 1];

        if (Xcoord < arr.GetLength(0) - 1 && Xcoord > 0 && Ycoord > 0 && Ycoord < arr.GetLength(1) - 1)
        {
          /* Check the conditions INSIDE borders */
          if (arr[Xcoord + 1, Ycoord, 0] == 0 && distanceCalculate(spaceCoordList, Xcoord + 1, Ycoord, cellSize) < spaceLimit ) // Check if possible new cell is still white or not!
            directionList.AddRange(new int[2] { (Xcoord + 1), Ycoord }); //Store possible spread directions in a list.

          if (arr[Xcoord - 1, Ycoord, 0] == 0 && distanceCalculate(spaceCoordList, Xcoord - 1, Ycoord, cellSize) < spaceLimit)
            directionList.AddRange(new int[2] { (Xcoord - 1), Ycoord }); //Store possible spread directions in a list.

          if (arr[Xcoord, Ycoord + 1, 0] == 0 && distanceCalculate(spaceCoordList, Xcoord, Ycoord + 1, cellSize) < spaceLimit)
            directionList.AddRange(new int[2] { (Xcoord), Ycoord + 1 }); //Store possible spread directions in a list.

          if (arr[Xcoord, Ycoord - 1, 0] == 0 && distanceCalculate(spaceCoordList, Xcoord, Ycoord - 1, cellSize) < spaceLimit)
            directionList.AddRange(new int[2] { (Xcoord), (Ycoord - 1) }); //Store possible spread directions in a list.

          if (directionList.Count > 0)
          {
            var randomIndex = rand.Next(directionList.Count / 2);
            int a = directionList[2 * randomIndex];
            int b = directionList[2 * randomIndex + 1];

            arr[a, b, 0] = arr[Xcoord, Ycoord, 0];

            spaceCoordList.AddRange(new int[2] { a, b });

            directionList.Clear();
            directionList.TrimExcess();
            draw = true;
            counter++;
          }
          else
          {
            trycount++;
            if (trycount >= spaceCoordList.Count)
            {
              draw = true;
              //Print("trycountNumber is ={0}", trycount);
            }
          }
        }

          /* EDGE CONDITIONS */
          //RIGHT
        else if (Xcoord == (arr.GetLength(0) - 1) && Ycoord != 0 && Ycoord != (arr.GetLength(1) - 1))
        {
          if (arr[Xcoord - 1, Ycoord, 0] == 0 && distanceCalculate(spaceCoordList, Xcoord - 1, Ycoord, cellSize) < spaceLimit )
            directionList.AddRange(new int[2] { (Xcoord - 1), (Ycoord) }); //Store possible spread directions in a list.
          if (arr[Xcoord, Ycoord + 1, 0] == 0 && distanceCalculate(spaceCoordList, Xcoord, Ycoord + 1, cellSize) < spaceLimit )
            directionList.AddRange(new int[2] { (Xcoord ), (Ycoord + 1) }); //Store possible spread directions in a list.
          if (arr[Xcoord, Ycoord - 1, 0] == 0 && distanceCalculate(spaceCoordList, Xcoord, Ycoord - 1, cellSize) < spaceLimit )
            directionList.AddRange(new int[2] { (Xcoord ), (Ycoord - 1) }); //Store possible spread directions in a list.

          if (directionList.Count > 0)
          {
            var randomIndex = rand.Next(directionList.Count / 2);
            int a = directionList[2 * randomIndex];
            int b = directionList[2 * randomIndex + 1];

            arr[a, b, 0] = arr[Xcoord, Ycoord, 0];

            spaceCoordList.AddRange(new int[2] { a, b });

            directionList.Clear();
            directionList.TrimExcess();
            draw = true;
            counter++;
          }
          else
          {
            trycount++;
            if (trycount >= spaceCoordList.Count)
            {
              draw = true;
              //Print("trycountNumber is ={0}", trycount);
            }
          }
        }

          //Left
        else if (Xcoord == 0 && Ycoord != 0 && Ycoord != (arr.GetLength(1) - 1))
        {

          if (arr[Xcoord + 1, Ycoord, 0] == 0 && distanceCalculate(spaceCoordList, Xcoord + 1, Ycoord, cellSize) < spaceLimit )
            directionList.AddRange(new int[2] { (Xcoord + 1), (Ycoord) }); //Store possible spread directions in a list.
          if (arr[Xcoord, Ycoord + 1, 0] == 0 && distanceCalculate(spaceCoordList, Xcoord, Ycoord + 1, cellSize) < spaceLimit )
            directionList.AddRange(new int[2] { (Xcoord ), (Ycoord + 1) }); //Store possible spread directions in a list.
          if (arr[Xcoord, Ycoord - 1, 0] == 0 && distanceCalculate(spaceCoordList, Xcoord, Ycoord - 1, cellSize) < spaceLimit )
            directionList.AddRange(new int[2] { (Xcoord ), (Ycoord - 1) }); //Store possible spread directions in a list.
          if (directionList.Count > 0)
          {
            var randomIndex = rand.Next(directionList.Count / 2);
            int a = directionList[2 * randomIndex];
            int b = directionList[2 * randomIndex + 1];

            arr[a, b, 0] = arr[Xcoord, Ycoord, 0];

            spaceCoordList.AddRange(new int[2] { a, b });

            directionList.Clear();
            directionList.TrimExcess();
            draw = true;
            counter++;
          }
          else
          {
            trycount++;
            if (trycount >= spaceCoordList.Count)
            {
              draw = true;
              //Print("trycountNumber is ={0}", trycount);
            }
          }

        }
          //TOP
        else if ((Ycoord == arr.GetLength(1) - 1) && Xcoord != 0 && Xcoord != (arr.GetLength(0) - 1))
        {

          if (arr[Xcoord, Ycoord - 1, 0] == 0 && distanceCalculate(spaceCoordList, Xcoord, Ycoord - 1, cellSize) < spaceLimit )
            directionList.AddRange(new int[2] { (Xcoord ), (Ycoord - 1) }); //Store possible spread directions in a list.
          if (arr[Xcoord + 1, Ycoord, 0] == 0 && distanceCalculate(spaceCoordList, Xcoord + 1, Ycoord, cellSize) < spaceLimit )
            directionList.AddRange(new int[2] { (Xcoord + 1 ), (Ycoord ) }); //Store possible spread directions in a list.
          if (arr[Xcoord - 1, Ycoord, 0] == 0 && distanceCalculate(spaceCoordList, Xcoord - 1, Ycoord, cellSize) < spaceLimit )
            directionList.AddRange(new int[2] { (Xcoord - 1), (Ycoord ) }); //Store possible spread directions in a list.
          if (directionList.Count > 0)
          {
            var randomIndex = rand.Next(directionList.Count / 2);
            int a = directionList[2 * randomIndex];
            int b = directionList[2 * randomIndex + 1];

            arr[a, b, 0] = arr[Xcoord, Ycoord, 0];

            spaceCoordList.AddRange(new int[2] { a, b });

            directionList.Clear();
            directionList.TrimExcess();
            draw = true;
            counter++;
          }
          else
          {
            trycount++;
            if (trycount >= spaceCoordList.Count)
            {
              draw = true;
              //Print("trycountNumber is ={0}", trycount);
            }
          }
        }
          //BOTTOM
        else if (Ycoord == 0 && Xcoord != 0 && Xcoord != (arr.GetLength(0) - 1))
        {
          if (arr[Xcoord, Ycoord + 1, 0] == 0 && distanceCalculate(spaceCoordList, Xcoord, Ycoord + 1, cellSize) < spaceLimit )
            directionList.AddRange(new int[2] { (Xcoord ), (Ycoord + 1) }); //Store possible spread directions in a list.
          if (arr[Xcoord + 1, Ycoord, 0] == 0 && distanceCalculate(spaceCoordList, Xcoord + 1, Ycoord, cellSize) < spaceLimit )
            directionList.AddRange(new int[2] { (Xcoord + 1 ), (Ycoord ) }); //Store possible spread directions in a list.
          if (arr[Xcoord - 1, Ycoord, 0] == 0 && distanceCalculate(spaceCoordList, Xcoord - 1, Ycoord, cellSize) < spaceLimit )
            directionList.AddRange(new int[2] { (Xcoord - 1), (Ycoord ) }); //Store possible spread directions in a list.
          if (directionList.Count > 0)
          {
            var randomIndex = rand.Next(directionList.Count / 2);
            int a = directionList[2 * randomIndex];
            int b = directionList[2 * randomIndex + 1];

            arr[a, b, 0] = arr[Xcoord, Ycoord, 0];

            spaceCoordList.AddRange(new int[2] { a, b });

            directionList.Clear();
            directionList.TrimExcess();
            draw = true;
            counter++;
          }
          else
          {
            trycount++;
            if (trycount >= spaceCoordList.Count)
            {
              draw = true;
              //Print("trycountNumber is ={0}", trycount);
            }
          }
        }

          //LEFT BOTTOM
        else if (Xcoord == 0 && Ycoord == 0)
        {
          if (arr[Xcoord, Ycoord + 1, 0] == 0 && distanceCalculate(spaceCoordList, Xcoord, Ycoord + 1, cellSize) < spaceLimit)
            directionList.Add(Xcoord); directionList.Add(Ycoord + 1);

          if (arr[Xcoord + 1, Ycoord, 0] == 0 && distanceCalculate(spaceCoordList, Xcoord + 1, Ycoord, cellSize) < spaceLimit)
            directionList.Add(Xcoord + 1); directionList.Add(Ycoord);

          if (directionList.Count > 0)
          {

            var randomIndex = rand.Next(directionList.Count / 2);

            int a = directionList[2 * randomIndex];
            int b = directionList[2 * randomIndex + 1];

            arr[a, b, 0] = arr[Xcoord, Ycoord, 0];

            spaceCoordList.AddRange(new int[2] { a, b });

            directionList.Clear();
            directionList.TrimExcess();
            draw = true;

            counter++;
            //Print(" Counter Number is : {0}", counter);
          }
          else
          {
            trycount++;
            if (trycount >= spaceCoordList.Count)
            {
              draw = true;
              //Print("trycountNumber is ={0}", trycount);
            }
          }
        }
          //LEFT  TOP
          /*
          else if (Xcoord == 0 && Ycoord == (arr.GetLength(1) - 1))
          {
          if (arr[Xcoord + 1, Ycoord] == 0)
          directionList.Add(Xcoord + 1); directionList.Add(Ycoord);

          if (arr[Xcoord, Ycoord - 1] == 0)
          directionList.Add(Xcoord); directionList.Add(Ycoord - 1);

          if (directionList.Count > 0)
          {
          var randomIndex = rand.Next(directionList.Count / 2);

          int a = directionList[2 * randomIndex];
          int b = directionList[2 * randomIndex + 1];

          Rhino.RhinoApp.WriteLine("Left Top "  +  a +  " "  +  b);
          arr[a, b] = arr[Xcoord, Ycoord];

          spaceCoordList.AddRange(new int[2] { a, b });

          directionList.Clear();
          directionList.TrimExcess();
          draw = true;

          counter++;
          //Print(" Counter Number is : {0}", counter);
          }
          else
          {
          trycount++;
          if (trycount >= spaceCoordList.Count)
          {
          draw = true;
          //Print("trycountNumber is ={0}", trycount);
          }
          }
          }
          */
          /*
          //RIGHT TOP
          else if (Xcoord == (arr.GetLength(0) - 1) && Ycoord == (arr.GetLength(1) - 1))
          {
          if (arr[Xcoord, Ycoord - 1] == 0)
          directionList.Add(Xcoord); directionList.Add(Ycoord - 1);

          if (arr[Xcoord - 1, Ycoord] == 0)
          directionList.Add(Xcoord - 1); directionList.Add(Ycoord);

          if (directionList.Count > 0)
          {
          var randomIndex = rand.Next(directionList.Count / 2);

          int a = directionList[2 * randomIndex];
          int b = directionList[2 * randomIndex + 1];
          Rhino.RhinoApp.WriteLine(" Right top "+ a + " " + b);
          arr[a, b] = arr[Xcoord, Ycoord];

          //spaceCoordList.AddRange(new int[2] { a, b });

          directionList.Clear();
          directionList.TrimExcess();
          draw = true;

          counter++;
          //Print(" Counter Number is : {0}", counter);
          }
          else
          {
          trycount++;
          if (trycount >= spaceCoordList.Count)
          {
          draw = true;
          //Print("trycountNumber is ={0}", trycount);
          }
          }
          }
          */
          //RIGHT BOTTOM
        else if (Xcoord == (arr.GetLength(0) - 1) && Ycoord == 0)
        {
          if (arr[Xcoord, Ycoord + 1, 0] == 0)
            directionList.Add(Xcoord); directionList.Add(Ycoord + 1);

          if (arr[Xcoord - 1, Ycoord, 0] == 0)
            directionList.Add(Xcoord - 1); directionList.Add(Ycoord);

          if (directionList.Count > 0)
          {
            var randomIndex = rand.Next(directionList.Count / 2);

            int a = directionList[2 * randomIndex];
            int b = directionList[2 * randomIndex + 1];

            arr[a, b, 0] = arr[Xcoord, Ycoord, 0];

            spaceCoordList.AddRange(new int[2] { a, b });

            directionList.Clear();
            directionList.TrimExcess();

            draw = true;
            counter++;
            //Print(" Counter Number is : {0}", counter);
          }
          else
          {
            trycount++;
            if (trycount >= spaceCoordList.Count)
            {
              draw = true;
              //Print("trycountNumber is ={0}", trycount);
            }
          }
        }
        /* EDGE CONDITIONS */
      }
    }

  }




    /* Instead of wrting methods seperately in main program, it is better to use class based
     informations to keep things organized, we are not yet transsferentrance methods here but we created the str.*/

    /*
    public class Zone
    {
        public string Name;
        public int SpaceLimit;
        public Int16 SpaceSize;
        public int Counter;
        public List<Int16> SpaceList;

        public void Describe()
        {
            Console.WriteLine("Hey this zone is{ 0} ", Name);
        }

        public Zone()
        {
           // SpaceList = new List<int>();
        }

        public Zone(string name, int spaceLimit,int spacesize,int counter, List<int> SpaceList)
        :this()
        {
        }
        static void InitializeZeroMatrice() { }
        static void startZones() { }
        public void SpreadZones() { }

    }
    */
# ---------- end c_script_2 ----------
box_21 = Box(c_script_2.Furnitures)  # disabled
deconstruct_box_27 = DeconstructBox(Box=box_21)  # -> Plane, X, Y, Z; disabled
panel_42 = Panel(deconstruct_box_27.Plane)  # disabled
panel_43 = Panel(deconstruct_box_27.Y)  # disabled
panel_44 = Panel(deconstruct_box_27.X)  # disabled
panel_45 = Panel(deconstruct_box_27.Z)
boolean_toggle = BooleanToggle(False)  # disabled
integer_4 = Integer(division_5)  # disabled
integer_5 = Integer(division_4)  # disabled
integer_6 = Integer(panel_31)  # disabled
box_22 = Box(closet_margin)  # disabled
box_23 = Box(closet)  # disabled
box_24 = Box(exterior_door)  # disabled
c_script_3 = CSharpScript(boxx=box_24)  # -> out, lenght; inputs boxx: Box; disabled; same code as c_script
panel_46 = Panel(c_script_3.lenght)  # disabled
deconstruct_box_28 = DeconstructBox(Box=box_24)  # -> Plane, X, Y, Z; disabled
panel_47 = Panel(deconstruct_box_28.Plane)  # disabled
panel_48 = Panel(deconstruct_box_28.Y)  # disabled
panel_49 = Panel(deconstruct_box_28.Z)  # disabled
panel_50 = Panel(deconstruct_box_28.X)  # disabled
box_25 = Box(changeover_zone)  # disabled
box_26 = Box(exterior_door_margin)  # disabled
box_27 = Box(change_over_zone_margin)  # disabled
deconstruct_domain_37 = DeconstructDomain(Domain=panel_38)  # -> Start, End; disabled
deconstruct_domain_38 = DeconstructDomain(Domain=panel_40)  # -> Start, End; disabled
deconstruct_domain_39 = DeconstructDomain(Domain=panel_39)  # -> Start, End; disabled
box_28 = Box()  # disabled
box_29 = Box()  # disabled
box_30 = Box()  # disabled
box_31 = Box()  # disabled
box_32 = Box()  # disabled
box_33 = Box()  # disabled
deconstruct_domain_40 = DeconstructDomain(Domain=panel_43)  # -> Start, End; disabled
box_34 = Box()  # disabled
box_35 = Box()  # disabled
deconstruct_domain_41 = DeconstructDomain(Domain=panel_44)  # -> Start, End; disabled
box_36 = Box()  # disabled
box_37 = Box()  # disabled
deconstruct_domain_42 = DeconstructDomain(Domain=panel_45)  # -> Start, End
box_38 = Box()  # disabled
number_slider_86 = Slider(8, range=0..10)  # disabled
c_script_4 = CSharpScript(
    Width=integer_5,
    Length=integer_4,
    Height=integer_6,
    LevelHeight=number_slider_84,
    cellSize=multiplication_8,
    ExteriorDoor=box_24,
    ExteriorDoorMargin=box_26,
    ChangeOverZone=box_25,
    ChangeOverZoneMargin=box_27,
    Closet=box_23,
    ClosetMargin=box_22,
    InteriorDoor=box_28,
    InteriorDoorMargin=box_29,
    Counter=box_30,
    CounterMargin=box_31,
    Table=box_32,
    TableMargin=box_33,
    SittingUnit=box_34,
    SittingUnitMargin=box_35,
    Bed=box_36,
    HealtCare=box_37,
    HealthCareMargin=box_38)  # -> out, A, EntranceBoxes, CommonBoxes, WetAreaBoxes, Y, K, W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; inputs Width: Int32, Length: Int32, Height: Int32, LevelHeight: Int32, cellSize: Int32, ExteriorDoor: Box, ExteriorDoorMargin: Box, ChangeOverZone: Box, ChangeOverZoneMargin: Box, Closet: Box, ClosetMargin: Box, InteriorDoor: Box, InteriorDoorMargin: Box, Counter: Box, CounterMargin: Box, Table: Box, TableMargin: Box, SittingUnit: Box, SittingUnitMargin: Box, Bed: Box, BedMargin: Box, HealtCare: Box, HealthCareMargin: Box; disabled
# ---------- c_script_4: C# ----------
      
    List<Box> entranceBoxes = new List<Box>(); 
    List<Box> commonBoxes = new List<Box>();
    List<Box> wetAreaBoxes = new List<Box>();

    /*List<Box> kitchenBoxes = new List<Box>();
      List<Box> commonAreaBoxes = new List<Box>();*/

    List<Box> WhiteBoxes = new List<Box>();

    /**  These sizes are Spreading Limits for the spaces   //total cells     **/

    double entranceSize = (6 * 100 * 100) / (cellSize * cellSize);
    double commonSize = (8 * 100 * 100) / (cellSize * cellSize);
    double wetAreaSize = (6 * 100 * 100 ) / (cellSize * cellSize);

    /*
    double kitchenSize = 7 * 100 * 100 / cellSize * cell  Size;
    double commonAreaSize = 10 * 100 * 100 / cellSize * cellSize;
    */

    Point3d pA = new Point3d(0, 0, 0);
    Point3d pB = new Point3d(10, 0, 0);
    Point3d pC = new Point3d(0, 10, 0);

    Plane p = new Plane(pA, pB, pC);

    int width = Width;
    int length = Length;
    int levelHeight = LevelHeight;
    int height = Height;
    int levelNumber = Height / LevelHeight;

    int[,,] areaArray = InitializeZeroMatrice(length, width, levelNumber);
    //StartZones(areaArray);

    int[,,] emptyFullArray = InitializeZeroMatrice(length, width, levelNumber);

    for (int i = 0; i < width * length * 3; i++)
    {
/*
      Spread(areaArray, ref entranceSize, entranceList, ref entranceCounter, entranceLimit, cellSize);
      Spread(areaArray, ref commonSize, commonList, ref commonCounter, commonLimit, cellSize);
      Spread(areaArray, ref wetAreaSize, wetAreaList, ref wetAreaCounter, wetAreaLimit, cellSize);
*/
    }
/*
    noiseFilter(areaArray, 0, 6, 5);
    noiseFilter(areaArray, 1, 2, 2);
*/
    for (int k = 0;k < levelNumber;k++)
    {
      for (int i = 0;i < length;i++)
      {
        for (int j = 0;j < width;j++)
        {
          areaArray[i, j, k] = areaArray[i, j, 0];
        }
      }
    }

    for (int k = 0;k < levelNumber;k++)
    {
      for (int i = 0;i < length;i++)
      {
        for (int j = 0;j < width;j++)
        {
          emptyFullArray[i, j, k] = 0;
        }
      }
    }

    entranceList.Clear();
    commonList.Clear();
    wetAreaList.Clear();
    /*kitchenList.Clear();
    commonAreaList.Clear();*/

    for (int k = 0;k < levelNumber;k++)
    {
      for (int i = 0;i < length;i++)
      {
        for (int j = 0;j < width;j++)
        {
          if (areaArray[i, j, k] == 1)
          {
            Interval xInterval = new Interval(i * cellSize, (i + 1) * (cellSize ));
            Interval yInterval = new Interval(j * cellSize, (j + 1) * (cellSize ));
            Interval zInterval = new Interval(k * LevelHeight, k * LevelHeight + levelHeight);

            Box boxgh = new Box(p, xInterval, yInterval, zInterval);
            entranceBoxes.Add(boxgh);
            entranceList.AddRange(new int[2] { i, j });
          }
          if (areaArray[i, j, k] == 2)
          {
            Interval xInterval = new Interval(i * cellSize, (i + 1) * (cellSize ));
            Interval yInterval = new Interval(j * cellSize, (j + 1) * (cellSize ));
            Interval zInterval = new Interval(k * LevelHeight, k * LevelHeight + levelHeight);

            Box boxgh = new Box(p, xInterval, yInterval, zInterval);
            commonBoxes.Add(boxgh);
            commonList.AddRange(new int[2] { i, j });
          }
          if (areaArray[i, j, k] == 3)
          {
            Interval xInterval = new Interval(i * cellSize, (i + 1) * (cellSize ));
            Interval yInterval = new Interval(j * cellSize, (j + 1) * (cellSize ));
            Interval zInterval = new Interval(k * LevelHeight, k * LevelHeight + levelHeight);

            Box boxgh = new Box(p, xInterval, yInterval, zInterval);
            wetAreaBoxes.Add(boxgh);
            wetAreaList.AddRange(new int[2] { i, j });
          }

          /*if (areaArray[i, j, k] == 4)
          {
            Interval xInterval = new Interval(j * cellSize, (j + 1) * (cellSize ));
            Interval yInterval = new Interval(i * cellSize, (i + 1) * (cellSize ));
            Interval zInterval = new Interval(k * LevelHeight, k * LevelHeight + levelHeight);

            Box boxgh = new Box(p, xInterval, yInterval, zInterval);
            kitchenBoxes.Add(boxgh);
            kitchenList.AddRange(new int[2] { i, j });
          }
          if (areaArray[i, j, k] == 5)
          {
            Interval xInterval = new Interval(j * cellSize, (j + 1) * (cellSize ));
            Interval yInterval = new Interval(i * cellSize, (i + 1) * (cellSize ));
            Interval zInterval = new Interval(k * LevelHeight, k * LevelHeight + levelHeight);

            Box boxgh = new Box(p, xInterval, yInterval, zInterval);
            commonAreaBoxes.Add(boxgh);
            commonAreaList.AddRange(new int[2] { i, j });
          }*/
          if (areaArray[i, j, k] == 0)
          {

            Interval xInterval = new Interval(i * cellSize, (i + 1) * (cellSize ));
            Interval yInterval = new Interval(j * cellSize, (j + 1) * (cellSize ));
            Interval zInterval = new Interval(k * LevelHeight, k * LevelHeight + levelHeight);

            Box boxgh = new Box(p, xInterval, yInterval, zInterval);
            WhiteBoxes.Add(boxgh);
            //WhiteList.AddRange(i, j);
          }
        }
      }
    }
    
    ShowMatrix(areaArray);

    A = areaArray;
    EntranceBoxes = entranceBoxes;
    CommonBoxes = commonBoxes;
    WetAreaBoxes = wetAreaBoxes;
    W = WhiteBoxes;
# ---------- c_script_4: C# additional code ----------
  class Objects
  {
    public string Name;
    public int ZoneName;

    public Box Obj;
    public Box ObjMargin;

    public bool Front = false;
    public bool Right = false;
    public bool Back = false;
    public bool Left = false;
    public bool Top = false;
    public bool Bottom = false;

    public bool RotationBool = true;
    public int RotationOpt; // rotation options

    public bool MirrorBool = true;
    public int MirrorOpt; // mirror options

    public string Source; // Water, Electiricity
    public int FixedToWall; // Bed, Television //1,2,3 conditions
    public int CellSize;

    public Objects PreviousObject;

    public double ObjLength ;
    public double ObjWidth ;
    public double ObjHeight ;

    public double MrjLength;
    public double MrjWidth;
    public double MrjHeight;

    public double baseX, baseY, baseZ;
    public List<int> SpaceList = new List<int>();

    public double  XCell;
    public double  YCell;
    public double  ZCell;


    //deneme
    public Objects()
    {
            /*
            var Coordinates = new List<int>();
            Point3d pA = new Point3d(0, 0, 0);
            Point3d pB = new Point3d(10, 0, 0);
            Point3d pC = new Point3d(0, 10, 0);

            Plane p = new Plane(pA, pB, pC);*/
    }

    public Objects(string name, int zoneName, bool front, bool right, bool back, bool left, bool top, bool bottom, bool rotationalBool, int rotationOpt, bool mirrorBool, int mirrorOpt, string source, int fixedTowall, int cellSize, Box obj, Box objMargin, Objects previousObject, List<int> spaceList)
      : this()
    {
      this.Obj = obj;
      this.ObjMargin = objMargin;

      this.Name = name;
      this.ZoneName = zoneName;

      this.Front = front;
      this.Right = right;
      this.Back = back;
      this.Left = left;
      this.Bottom = bottom;
      this.Top = top;

      this.RotationBool = rotationalBool;
      this.RotationOpt = rotationOpt;

      this.MirrorBool = mirrorBool;
      this.MirrorOpt = mirrorOpt;

      this.Source = source;
      this.FixedToWall = fixedTowall;
      this.CellSize = cellSize;

      this.ObjWidth = obj.X.T1;
      this.ObjLength = obj.Y.T1;
      this.ObjHeight = obj.Z.T1;

      this.MrjWidth = objMargin.X.T1;
      this.MrjLength = objMargin.Y.T1;
      this.MrjHeight = objMargin.Z.T1;

      this.baseX = Obj.Plane.OriginX;
      this.baseY = Obj.Plane.OriginY;
      this.baseZ = Obj.Plane.OriginZ;

      this.PreviousObject = previousObject;
      this.SpaceList = spaceList;
    }

    public Objects(string name, int zoneName, bool front, bool right, bool back, bool left, bool top, bool bottom, bool rotationalBool, int rotationOpt, bool mirrorBool, int mirrorOpt, string source, int fixedTowall, int cellSize, Box obj, Box objMargin, List<int> spaceList)
      : this()
    {
      this.Obj = obj;
      this.ObjMargin = objMargin;

      this.Name = name;
      this.ZoneName = zoneName;

      this.Front = front;
      this.Right = right;
      this.Back = back;
      this.Left = left;
      this.Bottom = bottom;
      this.Top = top;

      this.RotationBool = rotationalBool;
      this.RotationOpt = rotationOpt;

      this.MirrorBool = mirrorBool;
      this.MirrorOpt = mirrorOpt;

      this.Source = source;
      this.FixedToWall = fixedTowall;
      this.CellSize = cellSize;

      this.ObjWidth = obj.X.T1;
      this.ObjLength = obj.Y.T1;
      this.ObjHeight = obj.Z.T1;

      this.MrjWidth = (this.ObjMargin.X.T1);
      this.MrjLength = (this.ObjMargin.Y.T1);
      this.MrjHeight = (this.ObjMargin.Z.T1);

      this.baseX = Obj.Plane.OriginX;
      this.baseY = Obj.Plane.OriginY;
      this.baseZ = Obj.Plane.OriginZ;

      this.SpaceList = spaceList;
    }

    public void assignDimensions()
    {
      this.ObjWidth = this.Obj.X.T1;
      this.ObjLength = this.Obj.Y.T1;
      this.ObjHeight = this.Obj.Z.T1;

      this.MrjWidth = this.ObjMargin.X.T1;
      this.MrjLength = this.ObjMargin.Y.T1;
      this.MrjHeight = this.ObjMargin.Z.T1;

    }

    public void printDimensions()
    {
      Rhino.RhinoApp.WriteLine("Obj Width " + this.ObjWidth.ToString());
      Rhino.RhinoApp.WriteLine("Obj Length " + this.ObjLength.ToString());
      Rhino.RhinoApp.WriteLine("Obj Height " + this.ObjHeight.ToString());

      Rhino.RhinoApp.WriteLine("Obj Width " + this.MrjWidth.ToString());
      Rhino.RhinoApp.WriteLine("Obj Length " + this.MrjLength.ToString());
      Rhino.RhinoApp.WriteLine("Obj Height " + this.MrjHeight.ToString());
    }



    public void placeRefObject(int [,,]emptyFullArray, int[,,]areaArray, out Box ObjBox, out Box marginBox)
    {
      this.XCell = Math.Ceiling((double) (this.MrjWidth / CellSize));
      this.YCell = Math.Ceiling((double) (this.MrjLength / CellSize));
      this.ZCell = Math.Ceiling((double) (this.MrjHeight / 150));

      bool emptyBool = true;
      bool sameZone = true;

      bool placeSuccessful = false;
      int trycount = 0;

      while (placeSuccessful == false)
      {
        var rand = new Random();
        var randomCellIndex = rand.Next(this.SpaceList.Count / 2);

        baseX = (this.SpaceList[2 * randomCellIndex]) * CellSize;
        baseY = (this.SpaceList[2 * randomCellIndex + 1]) * CellSize;
        baseZ = 0;
        baseZ = 0;

        //baseX = baseX * CellSize;
        //baseY = baseY * CellSize;

        if( (baseX + this.MrjWidth < 300) && (baseY + this.MrjLength < 600) && (baseZ + this.MrjHeight < 300) &&
          (baseX + this.MrjWidth > 0) && (baseY + this.MrjLength > 0) && (baseZ + this.MrjHeight > 0) )
        {
          for(int i = (int) (baseX / CellSize) ; i < (baseX / CellSize + (int) XCell); i++)
          {
            for(int j = (int) (baseY / CellSize); j < baseY / CellSize + (int) YCell; j++)
            {
              for(int k = (int) (baseZ / 150); k < baseZ / 150 + (int) ZCell; k++)
              {
                Rhino.RhinoApp.WriteLine("Entrance Reference Object :  " + "  i:  " + i + "  j:  " + j + "  k:  " + k);
                if (emptyFullArray[i, j, k] == 1)
                {
                  emptyBool = false;
                }
                if (areaArray[i, j, k] != this.ZoneName)
                {
                  sameZone = false;
                }
              }
            }
          }

          if (emptyBool && sameZone)
          {
            placeSuccessful = true;

            Rhino.RhinoApp.WriteLine("Reference Object conditions are successful ");
            for(int i = (int) (baseX / CellSize) ; i < (baseX / CellSize + (int) XCell); i++)
            {
              for(int j = (int) (baseY / CellSize); j < baseY / CellSize + (int) YCell; j++)
              {
                for(int k = (int) (baseZ / 150); k < baseZ / 150 + (int) ZCell; k++)
                {
                  emptyFullArray[i, j, k] = 1;
                }
              }
            }
          }
          else
          {
            Rhino.RhinoApp.WriteLine("Conditions are not satisfied ");
          }
        }

        trycount++;
        Rhino.RhinoApp.WriteLine("Try count is : " + trycount);
        if (trycount > 60 )
          Rhino.RhinoApp.WriteLine("Try count is over 60 placement is unsuccessful: ");
        placeSuccessful = true;
      }

      if( trycount < 60 && placeSuccessful )
      {
        Rhino.RhinoApp.WriteLine("baseX " + this.baseX);
        Rhino.RhinoApp.WriteLine("baseY " + this.baseY);
        Rhino.RhinoApp.WriteLine("baseZ " + this.baseZ);

        Point3d pointa = new Point3d(baseX, baseY, 0);
        Vector3d pointb = new Vector3d(0, 0, 1);

        Plane planebase = new Plane(pointa, pointb);

        Interval xInterval = new Interval(0, this.ObjWidth);
        Interval yInterval = new Interval(0, this.ObjLength);
        Interval zInterval = new Interval(0, this.ObjHeight);

        ObjBox = new Box(planebase, xInterval, yInterval, zInterval);

        xInterval = new Interval(0, this.MrjWidth);
        yInterval = new Interval(0, this.MrjLength);
        zInterval = new Interval(0, this.MrjHeight);

        marginBox = new Box(planebase, xInterval, yInterval, zInterval);

      }

      else
      {
        ObjBox = new Box();
        marginBox = new Box();
      }
    }

    public void placeRefObjectEntrance(int [,,]emptyFullArray, int[,,]areaArray, out Box ObjBox, out Box marginBox)
    {
      this.XCell = Math.Ceiling((double) (this.MrjWidth / CellSize));
      this.YCell = Math.Ceiling((double) (this.MrjLength / CellSize));
      this.ZCell = Math.Ceiling((double) (this.MrjHeight / 150));

      bool emptyBool = true;
      bool sameZone = true;


      bool placeSuccessful = false;
      int trycount = 0;

      while (placeSuccessful == false)
      {
        var rand = new Random();
        var randomCellIndex = rand.Next(this.SpaceList.Count / 2);

        baseX = (this.SpaceList[2 * randomCellIndex]) * CellSize;
        baseY = 0;
        baseZ = 0;

        //baseX = baseX * CellSize;
        //baseY = baseY * CellSize;

        if( (baseX + this.MrjWidth < 300) && (baseY + this.MrjLength < 600) && (baseZ + this.MrjHeight < 300) &&
          (baseX + this.MrjWidth > 0) && (baseY + this.MrjLength > 0) && (baseZ + this.MrjHeight > 0) )
        {
          for(int i = (int) (baseX / CellSize) ; i < (baseX / CellSize + (int) XCell); i++)
          {
            for(int j = (int) (baseY / CellSize); j < baseY / CellSize + (int) YCell; j++)
            {
              for(int k = (int) (baseZ / 150); k < baseZ / 150 + (int) ZCell; k++)
              {
                Rhino.RhinoApp.WriteLine("Entrance Reference Object :  " + "  i:  " + i + "  j:  " + j + "  k:  " + k);
                if (emptyFullArray[i, j, k] == 1)
                {
                  emptyBool = false;
                }
                if (areaArray[i, j, k] != this.ZoneName)
                {
                  sameZone = false;
                }
              }
            }
          }

          if (emptyBool && sameZone)
          {
            placeSuccessful = true;

            Rhino.RhinoApp.WriteLine("Reference Object conditions are successful ");
            for(int i = (int) (baseX / CellSize) ; i < (baseX / CellSize + (int) XCell); i++)
            {
              for(int j = (int) (baseY / CellSize); j < baseY / CellSize + (int) YCell; j++)
              {
                for(int k = (int) (baseZ / 150); k < baseZ / 150 + (int) ZCell; k++)
                {
                  emptyFullArray[i, j, k] = 1;
                }
              }
            }
          }
          else
          {
            Rhino.RhinoApp.WriteLine("Conditions are not satisfied ");
          }
        }

        trycount++;
        Rhino.RhinoApp.WriteLine("Try count is : " + trycount);
        if (trycount > 60 )
          Rhino.RhinoApp.WriteLine("Try count is over 60 placement is unsuccessful: ");
        placeSuccessful = true;
      }

      if( trycount < 60 && placeSuccessful )
      {
        Rhino.RhinoApp.WriteLine("baseX " + this.baseX);
        Rhino.RhinoApp.WriteLine("baseY " + this.baseY);
        Rhino.RhinoApp.WriteLine("baseZ " + this.baseZ);

        Point3d pointa = new Point3d(baseX, 0, 0);
        Vector3d pointb = new Vector3d(0, 0, 1);

        Plane planebase = new Plane(pointa, pointb);

        Interval xInterval = new Interval(0, this.ObjWidth);
        Interval yInterval = new Interval(0, this.ObjLength);
        Interval zInterval = new Interval(0, this.ObjHeight);

        ObjBox = new Box(planebase, xInterval, yInterval, zInterval);

        xInterval = new Interval(0, this.MrjWidth);
        yInterval = new Interval(0, this.MrjLength);
        zInterval = new Interval(0, this.MrjHeight);

        marginBox = new Box(planebase, xInterval, yInterval, zInterval);

      }


      else
      {
        ObjBox = new Box();
        marginBox = new Box();
      }

    }


    public void placeFront(int [,,]emptyFullArray, int[,,]areaArray, out Box ObjBox, out Box marginBox)
    {
      bool emptyBool = true;
      bool sameZone = true;

      this.XCell = Math.Ceiling((double) (this.MrjWidth / CellSize));
      this.YCell = Math.Ceiling((double) (this.MrjLength / CellSize));
      this.ZCell = Math.Ceiling((double) (this.MrjHeight / 150));

      this.baseX = PreviousObject.baseX;
      this.baseY = PreviousObject.baseY + CellSize * PreviousObject.YCell;
      this.baseZ = PreviousObject.baseZ;

      if( (baseX + this.MrjWidth < 300) && (baseY + this.MrjLength < 600) && (baseZ + this.MrjHeight < 300) &&
        (baseX + this.MrjWidth > 0) && (baseY + this.MrjLength > 0) && (baseZ + this.MrjHeight > 0) )
      {
        for(int i = (int) (baseX / CellSize) ; i < (baseX / CellSize + (int) XCell); i++)
        {
          for(int j = (int) (baseY / CellSize); j < baseY / CellSize + (int) YCell; j++)
          {
            for(int k = (int) (baseZ / 150); k < baseZ / 150 + (int) ZCell; k++)
            {
              Rhino.RhinoApp.WriteLine("i:  " + i + "  j:  " + j + "  k:  " + k);
              if (emptyFullArray[i, j, k] == 1)
              {
                emptyBool = false;
              }
              if (areaArray[i, j, k] != this.ZoneName)
              {
                sameZone = false;
              }
            }
          }
        }

        if (emptyBool && sameZone)
        {
          Rhino.RhinoApp.WriteLine("Conditions are successful ");
          for(int i = (int) (baseX / CellSize) ; i < (baseX / CellSize + (int) XCell); i++)
          {
            for(int j = (int) (baseY / CellSize); j < baseY / CellSize + (int) YCell; j++)
            {
              for(int k = (int) (baseZ / 150); k < baseZ / 150 + (int) ZCell; k++)
              {
                emptyFullArray[i, j, k] = 1;
              }
            }
          }
        }
        else
        {
          Rhino.RhinoApp.WriteLine("Place Front:  Conditions are not satisfied ");
        }
      }
      else
      {
        Rhino.RhinoApp.WriteLine("Place Front: Conditions are not satisfied ");
      }


      Point3d pointa = new Point3d(baseX, baseY, baseZ);
      Vector3d pointb = new Vector3d(0, 0, 1);

      Plane planebase = new Plane(pointa, pointb);

      Interval xInterval = new Interval(0, this.ObjWidth);
      Interval yInterval = new Interval(0, this.ObjLength);
      Interval zInterval = new Interval(0, this.ObjHeight);

      ObjBox = new Box(planebase, xInterval, yInterval, zInterval);

      xInterval = new Interval(0, this.MrjWidth);
      yInterval = new Interval(0, this.MrjLength);
      zInterval = new Interval(0, this.MrjHeight);

      marginBox = new Box(planebase, xInterval, yInterval, zInterval);
    }


    public void placeRight(int [,,]emptyFullArray, int[,,]areaArray, out Box ObjBox, out Box marginBox)
    {
      bool emptyBool = true;
      bool sameZone = true;

      this.XCell = Math.Ceiling((double) (this.MrjWidth / CellSize));
      this.YCell = Math.Ceiling((double) (this.MrjLength / CellSize));
      this.ZCell = Math.Ceiling((double) (this.MrjHeight / 150));

      this.baseX = PreviousObject.baseX + CellSize * PreviousObject.XCell;
      this.baseY = PreviousObject.baseY;
      this.baseZ = PreviousObject.baseZ;

      if( (baseX + this.ObjWidth < 300) && (baseY + this.ObjLength < 600) && (baseZ + this.ObjHeight < 300) &&
        (baseX + this.ObjWidth > 0) && (baseY + this.ObjLength > 0) && (baseZ + this.ObjHeight > 0) )
      {
        for(int i = (int) (baseX / CellSize) ; i < (baseX / CellSize + (int) XCell); i++)
        {
          for(int j = (int) (baseY / CellSize); j < baseY / CellSize + (int) YCell; j++)
          {
            for(int k = (int) (baseZ / 150); k < baseZ / 150 + (int) ZCell; k++)
            {
              if (emptyFullArray[i, j, k] == 1)
              {
                emptyBool = false;
              }
              if (areaArray[i, j, k] != this.ZoneName)
              {
                sameZone = false;
              }
            }
          }
        }

        if (emptyBool && sameZone)
        {
          Rhino.RhinoApp.WriteLine("Place Right: Conditions are successful ");
          for(int i = (int) (baseX / CellSize) ; i < (baseX / CellSize + (int) XCell); i++)
          {
            for(int j = (int) (baseY / CellSize); j < baseY / CellSize + (int) YCell; j++)
            {
              for(int k = (int) (baseZ / 150); k < baseZ / 150 + (int) ZCell; k++)
              {
                emptyFullArray[i, j, k] = 1;
              }
            }
          }
        }
        else
        {
          Rhino.RhinoApp.WriteLine("Place Right: Conditions are not satisfied ");
        }
      }
      else
      {
        Rhino.RhinoApp.WriteLine("Place Right: Conditions are not satisfied ");
      }

      Point3d pointa = new Point3d(baseX, baseY, baseZ);
      Vector3d pointb = new Vector3d(0, 0, 1);

      Plane planebase = new Plane(pointa, pointb);

      Interval xInterval = new Interval(0, this.ObjWidth);
      Interval yInterval = new Interval(0, this.ObjLength);
      Interval zInterval = new Interval(0, this.ObjHeight);

      ObjBox = new Box(planebase, xInterval, yInterval, zInterval);

      xInterval = new Interval(0, this.MrjWidth);
      yInterval = new Interval(0, this.MrjLength);
      zInterval = new Interval(0, this.MrjHeight);

      marginBox = new Box(planebase, xInterval, yInterval, zInterval);
    }

    public void placeBack(int [,,]emptyFullArray, int[,,]areaArray, out Box ObjBox, out Box marginBox)
    {
      bool emptyBool = true;
      bool sameZone = true;

      this.XCell = Math.Ceiling((double) (this.MrjWidth / CellSize));
      this.YCell = Math.Ceiling((double) (this.MrjLength / CellSize));
      this.ZCell = Math.Ceiling((double) (this.MrjHeight / 150));

      this.baseX = PreviousObject.baseX;
      this.baseY = PreviousObject.baseY - CellSize * this.YCell;
      this.baseZ = PreviousObject.baseZ;

      if( (baseX + this.ObjWidth < 300) && (baseY + this.ObjLength < 600) && (baseZ + this.ObjHeight < 300) &&
        (baseX + this.ObjWidth > 0) && (baseY + this.ObjLength > 0) && (baseZ + this.ObjHeight > 0) )
      {
        for(int i = (int) (baseX / CellSize) ; i < (baseX / CellSize + (int) XCell); i++)
        {
          for(int j = (int) (baseY / CellSize); j < baseY / CellSize + (int) YCell; j++)
          {
            for(int k = (int) (baseZ / 150); k < baseZ / 150 + (int) ZCell; k++)
            {
              if (emptyFullArray[i, j, k] == 1)
              {
                emptyBool = false;
              }
              if (areaArray[i, j, k] != this.ZoneName)
              {
                sameZone = false;
              }
            }
          }
        }

        if (emptyBool && sameZone)
        {
          Rhino.RhinoApp.WriteLine("Place Back: Conditions are successful ");
          for(int i = (int) (baseX / CellSize) ; i < (baseX / CellSize + (int) XCell); i++)
          {
            for(int j = (int) (baseY / CellSize); j < baseY / CellSize + (int) YCell; j++)
            {
              for(int k = (int) (baseZ / 150); k < baseZ / 150 + (int) ZCell; k++)
              {
                emptyFullArray[i, j, k] = 1;
              }
            }
          }
        }
        else
        {
          Rhino.RhinoApp.WriteLine("Place Back: Conditions are not satisfied ");
        }
      }
      else
      {
        Rhino.RhinoApp.WriteLine("Place Back:Conditions are not satisfied ");
      }

      Point3d pointa = new Point3d(baseX, baseY, baseZ);
      Vector3d pointb = new Vector3d(0, 0, 1);

      Plane planebase = new Plane(pointa, pointb);

      Interval xInterval = new Interval(0, this.ObjWidth);
      Interval yInterval = new Interval(0, this.ObjLength);
      Interval zInterval = new Interval(0, this.ObjHeight);

      ObjBox = new Box(planebase, xInterval, yInterval, zInterval);

      xInterval = new Interval(0, this.MrjWidth);
      yInterval = new Interval(0, this.MrjLength);
      zInterval = new Interval(0, this.MrjHeight);

      marginBox = new Box(planebase, xInterval, yInterval, zInterval);
    }

    public void placeLeft(int [,,]emptyFullArray, int[,,]areaArray, out Box ObjBox, out Box marginBox)
    {
      bool emptyBool = true;
      bool sameZone = true;

      this.XCell = Math.Ceiling((double) (this.MrjWidth / CellSize));
      this.YCell = Math.Ceiling((double) (this.MrjLength / CellSize));
      this.ZCell = Math.Ceiling((double) (this.MrjHeight / 150));

      this.baseX = PreviousObject.baseX - CellSize * this.XCell;
      this.baseY = PreviousObject.baseY;
      this.baseZ = PreviousObject.baseZ;

      if( (baseX + this.ObjWidth < 300) && (baseY + this.ObjLength < 600) && (baseZ + this.ObjHeight < 300) &&
        (baseX + this.ObjWidth > 0) && (baseY + this.ObjLength > 0) && (baseZ + this.ObjHeight > 0) )
      {
        for(int i = (int) (baseX / CellSize) ; i < (baseX / CellSize + (int) XCell); i++)
        {
          for(int j = (int) (baseY / CellSize); j < baseY / CellSize + (int) YCell; j++)
          {
            for(int k = (int) (baseZ / 150); k < baseZ / 150 + (int) ZCell; k++)
            {
              if (emptyFullArray[i, j, k] == 1)
              {
                emptyBool = false;
              }
              if (areaArray[i, j, k] != this.ZoneName)
              {
                sameZone = false;
              }
            }
          }
        }

        if (emptyBool && sameZone)
        {
          Rhino.RhinoApp.WriteLine("Place Left: Conditions are successful ");
          for(int i = (int) (baseX / CellSize) ; i < (baseX / CellSize + (int) XCell); i++)
          {
            for(int j = (int) (baseY / CellSize); j < baseY / CellSize + (int) YCell; j++)
            {
              for(int k = (int) (baseZ / 150); k < baseZ / 150 + (int) ZCell; k++)
              {
                emptyFullArray[i, j, k] = 1;
              }
            }
          }
        }
        else
        {
          Rhino.RhinoApp.WriteLine("Place Left: Conditions are not satisfied ");
        }
      }
      else
      {
        Rhino.RhinoApp.WriteLine("Place Left: Conditions are not satisfied ");
      }

      Point3d pointa = new Point3d(baseX, baseY, baseZ);
      Vector3d pointb = new Vector3d(0, 0, 1);

      Plane planebase = new Plane(pointa, pointb);

      Interval xInterval = new Interval(0, this.ObjWidth);
      Interval yInterval = new Interval(0, this.ObjLength);
      Interval zInterval = new Interval(0, this.ObjHeight);

      ObjBox = new Box(planebase, xInterval, yInterval, zInterval);

      xInterval = new Interval(0, this.MrjWidth);
      yInterval = new Interval(0, this.MrjLength);
      zInterval = new Interval(0, this.MrjHeight);

      marginBox = new Box(planebase, xInterval, yInterval, zInterval);
    }
    public void placeTop(int [,,]emptyFullArray, int[,,]areaArray, out Box ObjBox, out Box marginBox)
    {
      bool emptyBool = true;
      bool sameZone = true;

      this.XCell = Math.Ceiling((double) (this.MrjWidth / CellSize));
      this.YCell = Math.Ceiling((double) (this.MrjLength / CellSize));
      this.ZCell = Math.Ceiling((double) (this.MrjHeight / 150));

      this.baseX = PreviousObject.baseX;
      this.baseY = PreviousObject.baseY;
      this.baseZ = PreviousObject.baseZ + CellSize * PreviousObject.ZCell;

      if( (baseX + this.ObjWidth < 300) && (baseY + this.ObjLength < 600) && (baseZ + this.ObjHeight < 300) &&
        (baseX + this.ObjWidth > 0) && (baseY + this.ObjLength > 0) && (baseZ + this.ObjHeight > 0) )
      {
        for(int i = (int) (baseX / CellSize) ; i < (baseX / CellSize + (int) XCell); i++)
        {
          for(int j = (int) (baseY / CellSize); j < baseY / CellSize + (int) YCell; j++)
          {
            for(int k = (int) (baseZ / 150); k < baseZ / 150 + (int) ZCell; k++)
            {
              if (emptyFullArray[i, j, k] == 1)
              {
                emptyBool = false;
              }
              if (areaArray[i, j, k] != this.ZoneName)
              {
                sameZone = false;
              }
            }
          }
        }

        if (emptyBool && sameZone)
        {
          Rhino.RhinoApp.WriteLine("Conditions are successful ");
          for(int i = (int) (baseX / CellSize) ; i < (baseX / CellSize + (int) XCell); i++)
          {
            for(int j = (int) (baseY / CellSize); j < baseY / CellSize + (int) YCell; j++)
            {
              for(int k = (int) (baseZ / 150); k < baseZ / 150 + (int) ZCell; k++)
              {
                emptyFullArray[i, j, k] = 1;
              }
            }
          }
        }
        else
        {
          Rhino.RhinoApp.WriteLine("Conditions are not satisfied ");
        }
      }
      else
      {
        Rhino.RhinoApp.WriteLine("Conditions are not satisfied ");
      }

      Point3d pointa = new Point3d(baseX, baseY, baseZ);
      Vector3d pointb = new Vector3d(0, 0, 1);

      Plane planebase = new Plane(pointa, pointb);

      Interval xInterval = new Interval(0, this.ObjWidth);
      Interval yInterval = new Interval(0, this.ObjLength);
      Interval zInterval = new Interval(0, this.ObjHeight);

      ObjBox = new Box(planebase, xInterval, yInterval, zInterval);

      xInterval = new Interval(0, this.MrjWidth);
      yInterval = new Interval(0, this.MrjLength);
      zInterval = new Interval(0, this.MrjHeight);

      marginBox = new Box(planebase, xInterval, yInterval, zInterval);
    }

    public void placeBottom(int [,,]emptyFullArray, int[,,]areaArray, out Box ObjBox, out Box marginBox)
    {
      bool emptyBool = true;
      bool sameZone = true;

      this.XCell = Math.Ceiling((double) (this.MrjWidth / CellSize));
      this.YCell = Math.Ceiling((double) (this.MrjLength / CellSize));
      this.ZCell = Math.Ceiling((double) (this.MrjHeight / 150));

      this.baseX = PreviousObject.baseX;
      this.baseY = PreviousObject.baseY;
      this.baseZ = PreviousObject.baseZ - CellSize * this.ZCell;

      if( (baseX + this.ObjWidth < 300) && (baseY + this.ObjLength < 600) && (baseZ + this.ObjHeight < 300) &&
        (baseX + this.ObjWidth > 0) && (baseY + this.ObjLength > 0) && (baseZ + this.ObjHeight > 0) )
      {
        for(int i = (int) (baseX / CellSize) ; i < (baseX / CellSize + (int) XCell); i++)
        {
          for(int j = (int) (baseY / CellSize); j < baseY / CellSize + (int) YCell; j++)
          {
            for(int k = (int) (baseZ / 150); k < baseZ / 150 + (int) ZCell; k++)
            {
              if (emptyFullArray[i, j, k] == 1)
              {
                emptyBool = false;
              }
              if (areaArray[i, j, k] != this.ZoneName)
              {
                sameZone = false;
              }
            }
          }
        }

        if (emptyBool && sameZone)
        {
          Rhino.RhinoApp.WriteLine("Conditions are successful ");
          for(int i = (int) (baseX / CellSize) ; i < (baseX / CellSize + (int) XCell); i++)
          {
            for(int j = (int) (baseY / CellSize); j < baseY / CellSize + (int) YCell; j++)
            {
              for(int k = (int) (baseZ / 150); k < baseZ / 150 + (int) ZCell; k++)
              {
                emptyFullArray[i, j, k] = 1;
              }
            }
          }
        }
        else
        {
          Rhino.RhinoApp.WriteLine("Conditions are not satisfied ");
        }
      }
      else
      {
        Rhino.RhinoApp.WriteLine("Conditions are not satisfied ");
      }

      Point3d pointa = new Point3d(baseX, baseY, baseZ);
      Vector3d pointb = new Vector3d(0, 0, 1);

      Plane planebase = new Plane(pointa, pointb);

      Interval xInterval = new Interval(0, this.ObjWidth);
      Interval yInterval = new Interval(0, this.ObjLength);
      Interval zInterval = new Interval(0, this.ObjHeight);

      ObjBox = new Box(planebase, xInterval, yInterval, zInterval);

      xInterval = new Interval(0, this.MrjWidth);
      yInterval = new Interval(0, this.MrjLength);
      zInterval = new Interval(0, this.MrjHeight);

      marginBox = new Box(planebase, xInterval, yInterval, zInterval);
    }

    public void placeObject(int [,,]emptyFullArray, int[,,]areaArray, out Box ObjBox, out Box marginBox)
    {

      Point3d pointa = new Point3d(baseX, baseY, baseZ);
      Vector3d pointb = new Vector3d(0, 0, 1);

      Plane planebase = new Plane(pointa, pointb);

      Interval xInterval = new Interval(0, this.ObjWidth);
      Interval yInterval = new Interval(0, this.ObjLength);
      Interval zInterval = new Interval(0, this.ObjHeight);

      ObjBox = new Box(planebase, xInterval, yInterval, zInterval);

      xInterval = new Interval(0, this.MrjWidth);
      yInterval = new Interval(0, this.MrjLength);
      zInterval = new Interval(0, this.MrjHeight);

      marginBox = new Box(planebase, xInterval, yInterval, zInterval);

      List<int> growDirection = new List<int>();

      if(PreviousObject.Front == true)
        growDirection.Add(1); // Front Direction
      if(PreviousObject.Right == true)
        growDirection.Add(2); // Right Direction
      if(PreviousObject.Back == true)
        growDirection.Add(3); // Back Direction
      if(PreviousObject.Left == true)
        growDirection.Add(4); // Left Direction
      if(PreviousObject.Bottom == true)
        growDirection.Add(5); // Bottom Direction
      if(PreviousObject.Top == true)
        growDirection.Add(6); // Right Direction

      bool placeSuccess = false;
      int tryCounter = 0;

      if(growDirection.Count >= 1)
      {
        Random randm = new Random();

        while(placeSuccess == false )
        {
          int a = randm.Next(0, growDirection.Count);
          int randomMethod = growDirection[a];

          switch (a)
          ​{
            case 1:
              this.placeFront(emptyFullArray, areaArray, out  ObjBox, out marginBox);
              placeSuccess = true;
              break;
            case 2:
              this.placeRight(emptyFullArray, areaArray, out  ObjBox, out marginBox);
              placeSuccess = true;
              break;
            case 3:
              this.placeBack(emptyFullArray, areaArray, out  ObjBox, out marginBox);
              placeSuccess = true;
              break;
            case 4:
              this.placeLeft(emptyFullArray, areaArray, out  ObjBox, out marginBox);
              placeSuccess = true;
              break;
            case 5:
              this.placeBottom(emptyFullArray, areaArray, out  ObjBox, out marginBox);
              placeSuccess = true;
              break;
            case 6:
              this.placeTop(emptyFullArray, areaArray, out  ObjBox, out marginBox);
              placeSuccess = true;
              break;

            default:
              tryCounter++;
              break;
            // default statements
          }


        }
        growDirection.Clear();




      }


    }


    public void rotate()
    {

    }



    static void mirror()
    {

    }

    static void getClosestCell()
    {

    }

    static void createWall()
    {

    }

  }

  static void ShowMatrix(int[,,] Arr)
  {
    for (int i = 0; i < Arr.GetLength(0); i++)
    {
      for (int j = 0; j < Arr.GetLength(1); j++)
      {
        Rhino.RhinoApp.Write(Arr[i, j, 0] + " ");
      }
      Rhino.RhinoApp.WriteLine("Loop Runs" + i.ToString());
    }
    return;
  }

  static int[,,] InitializeZeroMatrice(int width, int length, int levelNumber)
  {
    var areaArray = new int[width, length, levelNumber];

    for (int k = 0; k < levelNumber; k++)
    {
      for (int i = 0; i < width; i++)
      {
        for (int j = 0; j < length; j++)
        {
          areaArray[i, j, k] = 0;
        }
      }
    }          
    return areaArray;
  }

  /* The Color lists keep the colors in a seperate List in order to choose within them easily instead of searching where they are... */
  static List<int> entranceList = new List<int>();
  static List<int> commonList = new List<int>();
  static List<int> wetAreaList = new List<int>();
 /* static List<int> kitchenList = new List<int>();
  static List<int> commonAreaList = new List<int>();*/

  /**           these counters are used for starting the límitations counts.         **/

  //static int entranceCounter = 1;
 // static int commonCounter = 1;
  //static int wetAreaCounter = 1;
  /*static int kitchenCounter = 1;
  static int commonAreaCounter = 1;*/
  /**           these limits are used for defining max distance that zone can spread.  **/

  //static int entranceLimit = 200;
 // static int commonLimit = 200;
  //static int wetAreaLimit = 200;
  /*static int kitchenLimit = 200;
  static int commonAreaLimit = 100;*/

  static void StartZones(int[,,] arr)
  {
    /**
     * Randomly Starts the color. Takes the Color lists as argumnts
     * (We can delete these argumnents and it can get them as local referance
     * in our case it gives us a chance to choose what to initilize)
     * **/

    Random rand = new Random();
    //----------------------
    /* GetLength(0) and GetLength(1) might be set as variable */
    //Array.GetLength(0) gives the column lenght in other words length of an array
    //Array.GetLength(1) gives the row lenght in other words width of an array
    var a = rand.Next(arr.GetLength(0) / 2, arr.GetLength(0) / 2);
    var b = rand.Next(0, 2);

    Rhino.RhinoApp.WriteLine("started");
    entranceList.AddRange(new int[2] { a, b }); //AddRange ==> Adds multiple elements to a List . We use mod%2 to call the index of the point back instead of stacking them as an another List(or Array) in our list.
    arr[a, b, 0] = 1;// entrance Starting Point
    //----------------------

    b = rand.Next(0, arr.GetLength(1));
    a = rand.Next(0, arr.GetLength(0));

    commonList.AddRange(new int[2] { a, b });
    arr[a, b, 0] = 2; // common Starting Point
    //----------------------
    a = rand.Next(0, arr.GetLength(0));
    b = rand.Next(0, arr.GetLength(1));

    wetAreaList.AddRange(new int[2] { a, b });
    arr[a, b, 0] = 3; // wetArea Starting Point
    //----------------------
    a = rand.Next(0, arr.GetLength(0));
    b = rand.Next(0, arr.GetLength(1));
/*
    kitchenList.AddRange(new int[2] { a, b });
    arr[a, b, 0] = 4; // kitchen Starting Point
    //----------------------
    a = rand.Next(0, arr.GetLength(0));
    b = rand.Next(0, arr.GetLength(1));

    commonAreaList.AddRange(new int[2] { a, b });
    arr[a, b, 0] = 5; // commonArea Starting Point
    //----------------------
  */
  }
        /* Calculates the distance between initial point in the color and the possible new point!
         *  (if the possible new point is too far from inital point eleminate it.) */
  static double distanceCalculate(List<int> spaceCoordList, int x2, int y2, int cellSize)
  {
    var distance = cellSize * Math.Sqrt((y2 - spaceCoordList[1]) * (y2 - spaceCoordList[1]) + (x2 - spaceCoordList[0]) * (x2 - spaceCoordList[0]));
    return distance;
  }

  static void Evaluate()
  {
    // according to relations give score to the created zones
    // get the centers of the zones and acoording to the distances and created sizes give
    //positive or negative points and if score is not acceptable re-run and create variatians.
  }


  static void noiseFilter (int [,,] arr, int type, int iterationNumber, int controlNumber)
  {
    if(type == 0)
    {
      for( int loop = 0 ; loop < iterationNumber ; loop++ )
      {
        List < int> surrounding = new List<int>();
        for(int i = 1 ; i < arr.GetLength(0) - 1 ;i++)
        {
          for(int j = 1 ; j < arr.GetLength(1) - 1 ;j++)
          {
            for(int x = -1 ; x < 2;x++)
            {
              for(int y = -1 ; y < 2;y++)
              {
                if(!(x == y && x == 0))
                {

                  surrounding.Add(arr[i + x, j + y, 0]);
                }
              }
            }
            for (int v = 0 ; v < 6 ;v++) // 6 is the number of the zones including  empty cells
            {
              int count = (from z in surrounding where z == v select z).Count();
              if ( count >= controlNumber )
              {
                arr[i, j, 0] = v;
              }
            }
            surrounding.Clear();
            surrounding.TrimExcess();
          }
        }
      }
    }

    if(type == 1)
    {
      for( int loop = 0 ; loop < iterationNumber ; loop++ )
      {
        List < int> surrounding = new List<int>();
        for(int i = 1 ; i < arr.GetLength(0) - 1 ;i++)
        {
          for(int j = 1 ; j < arr.GetLength(1) - 1 ;j++)
          {
            for(int x = -1 ; x < 2;x++)
            {
              for(int y = -1 ; y < 2;y++)
              {
                if(!(x == y && x == 0) && ( (x + y == 1 ) || (x + y == -1 )) )
                {
                  surrounding.Add(arr[i + x, j + y, 0]);
                }
              }
            }

            for (int v = 0 ; v < 6 ;v++) // 6 is the number of the zones including  empty cells
            {
              int count = (from z in surrounding where z == v select z).Count();
              if ( count >= 2 )
              {
                arr[i, j, 0] = v;
              }
            }
            surrounding.Clear();
            surrounding.TrimExcess();
          }
        }
      }
    }
  }

  static void Spread(int[,,] arr, ref double spaceSize, List<int> spaceCoordList, ref int counter, int spaceLimit, int cellSize)
  {
        /*ARGUMENTS
     * The main array which has rectangular form(will be 3d in short) ,
     * spaceSize = Maximum limit that can grow.  ,
     * spaceCoordList =  the cells of the zone which has been already defined. )
     */
    var rand = new Random();
    var directionList = new List<int>();
    int Xcoord;
    int Ycoord;
    bool draw = false;
    int trycount = 0;

    while (draw == false && counter <= spaceSize)
    {
      if (counter <= spaceSize ) //Can be deleted. The condition is added to the While Loop Conditions.
      {
        var randomCellIndex = rand.Next(spaceCoordList.Count / 2);

        Xcoord = spaceCoordList[2 * randomCellIndex];
        Ycoord = spaceCoordList[2 * randomCellIndex + 1];

        if (Xcoord < arr.GetLength(0) - 1 && Xcoord > 0 && Ycoord > 0 && Ycoord < arr.GetLength(1) - 1)
        {
          /* Check the conditions INSIDE borders */
          if (arr[Xcoord + 1, Ycoord, 0] == 0 && distanceCalculate(spaceCoordList, Xcoord + 1, Ycoord, cellSize) < spaceLimit ) // Check if possible new cell is still white or not!
            directionList.AddRange(new int[2] { (Xcoord + 1), Ycoord }); //Store possible spread directions in a list.

          if (arr[Xcoord - 1, Ycoord, 0] == 0 && distanceCalculate(spaceCoordList, Xcoord - 1, Ycoord, cellSize) < spaceLimit)
            directionList.AddRange(new int[2] { (Xcoord - 1), Ycoord }); //Store possible spread directions in a list.

          if (arr[Xcoord, Ycoord + 1, 0] == 0 && distanceCalculate(spaceCoordList, Xcoord, Ycoord + 1, cellSize) < spaceLimit)
            directionList.AddRange(new int[2] { (Xcoord), Ycoord + 1 }); //Store possible spread directions in a list.

          if (arr[Xcoord, Ycoord - 1, 0] == 0 && distanceCalculate(spaceCoordList, Xcoord, Ycoord - 1, cellSize) < spaceLimit)
            directionList.AddRange(new int[2] { (Xcoord), (Ycoord - 1) }); //Store possible spread directions in a list.

          if (directionList.Count > 0)
          {
            var randomIndex = rand.Next(directionList.Count / 2);
            int a = directionList[2 * randomIndex];
            int b = directionList[2 * randomIndex + 1];

            arr[a, b, 0] = arr[Xcoord, Ycoord, 0];

            spaceCoordList.AddRange(new int[2] { a, b });

            directionList.Clear();
            directionList.TrimExcess();
            draw = true;
            counter++;
          }
          else
          {
            trycount++;
            if (trycount >= spaceCoordList.Count)
            {
              draw = true;
              //Print("trycountNumber is ={0}", trycount);
            }
          }
        }

          /* EDGE CONDITIONS */
          //RIGHT
        else if (Xcoord == (arr.GetLength(0) - 1) && Ycoord != 0 && Ycoord != (arr.GetLength(1) - 1))
        {
          if (arr[Xcoord - 1, Ycoord, 0] == 0 && distanceCalculate(spaceCoordList, Xcoord - 1, Ycoord, cellSize) < spaceLimit )
            directionList.AddRange(new int[2] { (Xcoord - 1), (Ycoord) }); //Store possible spread directions in a list.
          if (arr[Xcoord, Ycoord + 1, 0] == 0 && distanceCalculate(spaceCoordList, Xcoord, Ycoord + 1, cellSize) < spaceLimit )
            directionList.AddRange(new int[2] { (Xcoord ), (Ycoord + 1) }); //Store possible spread directions in a list.
          if (arr[Xcoord, Ycoord - 1, 0] == 0 && distanceCalculate(spaceCoordList, Xcoord, Ycoord - 1, cellSize) < spaceLimit )
            directionList.AddRange(new int[2] { (Xcoord ), (Ycoord - 1) }); //Store possible spread directions in a list.

          if (directionList.Count > 0)
          {
            var randomIndex = rand.Next(directionList.Count / 2);
            int a = directionList[2 * randomIndex];
            int b = directionList[2 * randomIndex + 1];

            arr[a, b, 0] = arr[Xcoord, Ycoord, 0];

            spaceCoordList.AddRange(new int[2] { a, b });

            directionList.Clear();
            directionList.TrimExcess();
            draw = true;
            counter++;
          }
          else
          {
            trycount++;
            if (trycount >= spaceCoordList.Count)
            {
              draw = true;
              //Print("trycountNumber is ={0}", trycount);
            }
          }
        }

          //Left
        else if (Xcoord == 0 && Ycoord != 0 && Ycoord != (arr.GetLength(1) - 1))
        {

          if (arr[Xcoord + 1, Ycoord, 0] == 0 && distanceCalculate(spaceCoordList, Xcoord + 1, Ycoord, cellSize) < spaceLimit )
            directionList.AddRange(new int[2] { (Xcoord + 1), (Ycoord) }); //Store possible spread directions in a list.
          if (arr[Xcoord, Ycoord + 1, 0] == 0 && distanceCalculate(spaceCoordList, Xcoord, Ycoord + 1, cellSize) < spaceLimit )
            directionList.AddRange(new int[2] { (Xcoord ), (Ycoord + 1) }); //Store possible spread directions in a list.
          if (arr[Xcoord, Ycoord - 1, 0] == 0 && distanceCalculate(spaceCoordList, Xcoord, Ycoord - 1, cellSize) < spaceLimit )
            directionList.AddRange(new int[2] { (Xcoord ), (Ycoord - 1) }); //Store possible spread directions in a list.
          if (directionList.Count > 0)
          {
            var randomIndex = rand.Next(directionList.Count / 2);
            int a = directionList[2 * randomIndex];
            int b = directionList[2 * randomIndex + 1];

            arr[a, b, 0] = arr[Xcoord, Ycoord, 0];

            spaceCoordList.AddRange(new int[2] { a, b });

            directionList.Clear();
            directionList.TrimExcess();
            draw = true;
            counter++;
          }
          else
          {
            trycount++;
            if (trycount >= spaceCoordList.Count)
            {
              draw = true;
              //Print("trycountNumber is ={0}", trycount);
            }
          }

        }
          //TOP
        else if ((Ycoord == arr.GetLength(1) - 1) && Xcoord != 0 && Xcoord != (arr.GetLength(0) - 1))
        {

          if (arr[Xcoord, Ycoord - 1, 0] == 0 && distanceCalculate(spaceCoordList, Xcoord, Ycoord - 1, cellSize) < spaceLimit )
            directionList.AddRange(new int[2] { (Xcoord ), (Ycoord - 1) }); //Store possible spread directions in a list.
          if (arr[Xcoord + 1, Ycoord, 0] == 0 && distanceCalculate(spaceCoordList, Xcoord + 1, Ycoord, cellSize) < spaceLimit )
            directionList.AddRange(new int[2] { (Xcoord + 1 ), (Ycoord ) }); //Store possible spread directions in a list.
          if (arr[Xcoord - 1, Ycoord, 0] == 0 && distanceCalculate(spaceCoordList, Xcoord - 1, Ycoord, cellSize) < spaceLimit )
            directionList.AddRange(new int[2] { (Xcoord - 1), (Ycoord ) }); //Store possible spread directions in a list.
          if (directionList.Count > 0)
          {
            var randomIndex = rand.Next(directionList.Count / 2);
            int a = directionList[2 * randomIndex];
            int b = directionList[2 * randomIndex + 1];

            arr[a, b, 0] = arr[Xcoord, Ycoord, 0];

            spaceCoordList.AddRange(new int[2] { a, b });

            directionList.Clear();
            directionList.TrimExcess();
            draw = true;
            counter++;
          }
          else
          {
            trycount++;
            if (trycount >= spaceCoordList.Count)
            {
              draw = true;
              //Print("trycountNumber is ={0}", trycount);
            }
          }
        }
          //BOTTOM
        else if (Ycoord == 0 && Xcoord != 0 && Xcoord != (arr.GetLength(0) - 1))
        {
          if (arr[Xcoord, Ycoord + 1, 0] == 0 && distanceCalculate(spaceCoordList, Xcoord, Ycoord + 1, cellSize) < spaceLimit )
            directionList.AddRange(new int[2] { (Xcoord ), (Ycoord + 1) }); //Store possible spread directions in a list.
          if (arr[Xcoord + 1, Ycoord, 0] == 0 && distanceCalculate(spaceCoordList, Xcoord + 1, Ycoord, cellSize) < spaceLimit )
            directionList.AddRange(new int[2] { (Xcoord + 1 ), (Ycoord ) }); //Store possible spread directions in a list.
          if (arr[Xcoord - 1, Ycoord, 0] == 0 && distanceCalculate(spaceCoordList, Xcoord - 1, Ycoord, cellSize) < spaceLimit )
            directionList.AddRange(new int[2] { (Xcoord - 1), (Ycoord ) }); //Store possible spread directions in a list.
          if (directionList.Count > 0)
          {
            var randomIndex = rand.Next(directionList.Count / 2);
            int a = directionList[2 * randomIndex];
            int b = directionList[2 * randomIndex + 1];

            arr[a, b, 0] = arr[Xcoord, Ycoord, 0];

            spaceCoordList.AddRange(new int[2] { a, b });

            directionList.Clear();
            directionList.TrimExcess();
            draw = true;
            counter++;
          }
          else
          {
            trycount++;
            if (trycount >= spaceCoordList.Count)
            {
              draw = true;
              //Print("trycountNumber is ={0}", trycount);
            }
          }
        }

          //LEFT BOTTOM
        else if (Xcoord == 0 && Ycoord == 0)
        {
          if (arr[Xcoord, Ycoord + 1, 0] == 0 && distanceCalculate(spaceCoordList, Xcoord, Ycoord + 1, cellSize) < spaceLimit)
            directionList.Add(Xcoord); directionList.Add(Ycoord + 1);

          if (arr[Xcoord + 1, Ycoord, 0] == 0 && distanceCalculate(spaceCoordList, Xcoord + 1, Ycoord, cellSize) < spaceLimit)
            directionList.Add(Xcoord + 1); directionList.Add(Ycoord);

          if (directionList.Count > 0)
          {

            var randomIndex = rand.Next(directionList.Count / 2);

            int a = directionList[2 * randomIndex];
            int b = directionList[2 * randomIndex + 1];

            arr[a, b, 0] = arr[Xcoord, Ycoord, 0];

            spaceCoordList.AddRange(new int[2] { a, b });

            directionList.Clear();
            directionList.TrimExcess();
            draw = true;

            counter++;
            //Print(" Counter Number is : {0}", counter);
          }
          else
          {
            trycount++;
            if (trycount >= spaceCoordList.Count)
            {
              draw = true;
              //Print("trycountNumber is ={0}", trycount);
            }
          }
        }
          //LEFT  TOP
          /*
          else if (Xcoord == 0 && Ycoord == (arr.GetLength(1) - 1))
          {
          if (arr[Xcoord + 1, Ycoord] == 0)
          directionList.Add(Xcoord + 1); directionList.Add(Ycoord);

          if (arr[Xcoord, Ycoord - 1] == 0)
          directionList.Add(Xcoord); directionList.Add(Ycoord - 1);

          if (directionList.Count > 0)
          {
          var randomIndex = rand.Next(directionList.Count / 2);

          int a = directionList[2 * randomIndex];
          int b = directionList[2 * randomIndex + 1];

          Rhino.RhinoApp.WriteLine("Left Top "  +  a +  " "  +  b);
          arr[a, b] = arr[Xcoord, Ycoord];

          spaceCoordList.AddRange(new int[2] { a, b });

          directionList.Clear();
          directionList.TrimExcess();
          draw = true;

          counter++;
          //Print(" Counter Number is : {0}", counter);
          }
          else
          {
          trycount++;
          if (trycount >= spaceCoordList.Count)
          {
          draw = true;
          //Print("trycountNumber is ={0}", trycount);
          }
          }
          }
          */
          /*
          //RIGHT TOP
          else if (Xcoord == (arr.GetLength(0) - 1) && Ycoord == (arr.GetLength(1) - 1))
          {
          if (arr[Xcoord, Ycoord - 1] == 0)
          directionList.Add(Xcoord); directionList.Add(Ycoord - 1);

          if (arr[Xcoord - 1, Ycoord] == 0)
          directionList.Add(Xcoord - 1); directionList.Add(Ycoord);

          if (directionList.Count > 0)
          {
          var randomIndex = rand.Next(directionList.Count / 2);

          int a = directionList[2 * randomIndex];
          int b = directionList[2 * randomIndex + 1];
          Rhino.RhinoApp.WriteLine(" Right top "+ a + " " + b);
          arr[a, b] = arr[Xcoord, Ycoord];

          //spaceCoordList.AddRange(new int[2] { a, b });

          directionList.Clear();
          directionList.TrimExcess();
          draw = true;

          counter++;
          //Print(" Counter Number is : {0}", counter);
          }
          else
          {
          trycount++;
          if (trycount >= spaceCoordList.Count)
          {
          draw = true;
          //Print("trycountNumber is ={0}", trycount);
          }
          }
          }
          */
          //RIGHT BOTTOM
        else if (Xcoord == (arr.GetLength(0) - 1) && Ycoord == 0)
        {
          if (arr[Xcoord, Ycoord + 1, 0] == 0)
            directionList.Add(Xcoord); directionList.Add(Ycoord + 1);

          if (arr[Xcoord - 1, Ycoord, 0] == 0)
            directionList.Add(Xcoord - 1); directionList.Add(Ycoord);

          if (directionList.Count > 0)
          {
            var randomIndex = rand.Next(directionList.Count / 2);

            int a = directionList[2 * randomIndex];
            int b = directionList[2 * randomIndex + 1];

            arr[a, b, 0] = arr[Xcoord, Ycoord, 0];

            spaceCoordList.AddRange(new int[2] { a, b });

            directionList.Clear();
            directionList.TrimExcess();

            draw = true;
            counter++;
            //Print(" Counter Number is : {0}", counter);
          }
          else
          {
            trycount++;
            if (trycount >= spaceCoordList.Count)
            {
              draw = true;
              //Print("trycountNumber is ={0}", trycount);
            }
          }
        }
        /* EDGE CONDITIONS */
      }
    }

  }




    /* Instead of wrting methods seperately in main program, it is better to use class based
     informations to keep things organized, we are not yet transsferentrance methods here but we created the str.*/

    /*
    public class Zone
    {
        public string Name;
        public int SpaceLimit;
        public Int16 SpaceSize;
        public int Counter;
        public List<Int16> SpaceList;

        public void Describe()
        {
            Console.WriteLine("Hey this zone is{ 0} ", Name);
        }

        public Zone()
        {
           // SpaceList = new List<int>();
        }

        public Zone(string name, int spaceLimit,int spacesize,int counter, List<int> SpaceList)
        :this()
        {
        }
        static void InitializeZeroMatrice() { }
        static void startZones() { }
        public void SpreadZones() { }

    }
    */
# ---------- end c_script_4 ----------
box_39 = Box(c_script_4.Furnitures)  # disabled
deconstruct_box_29 = DeconstructBox(Box=box_39)  # -> Plane, X, Y, Z; disabled
panel_51 = Panel(deconstruct_box_29.Plane)  # disabled
panel_52 = Panel(deconstruct_box_29.Y)  # disabled
panel_53 = Panel(deconstruct_box_29.X)  # disabled
panel_54 = Panel(deconstruct_box_29.Z)  # disabled
boolean_toggle_2 = BooleanToggle(False)  # disabled
box_40 = Box(c_script_2.Bxx)  # disabled
deconstruct_domain_43 = DeconstructDomain(Domain=panel_48)  # -> Start, End; disabled
deconstruct_domain_44 = DeconstructDomain(Domain=panel_50)  # -> Start, End; disabled
deconstruct_domain_45 = DeconstructDomain(Domain=panel_49)  # -> Start, End; disabled
deconstruct_domain_46 = DeconstructDomain(Domain=panel_52)  # -> Start, End; disabled
deconstruct_domain_47 = DeconstructDomain(Domain=panel_53)  # -> Start, End; disabled
deconstruct_domain_48 = DeconstructDomain(Domain=panel_54)  # -> Start, End; disabled
panel_55 = Panel(deconstruct_domain_38.End)  # disabled
panel_56 = Panel(deconstruct_domain_37.End)  # disabled
panel_57 = Panel(deconstruct_domain_39.End)  # disabled
panel_58 = Panel(box_40)  # disabled
panel_59 = Panel(deconstruct_domain_40.End)  # disabled
panel_60 = Panel(deconstruct_domain_41.End)  # disabled
panel_61 = Panel(deconstruct_domain_42.End)
list_item = ListItem(List=c_script_2.Furnitures, Index=number_slider_85, Wrap=boolean_toggle)  # disabled
box_41 = Box(c_script_4.Bxx)  # disabled
panel_62 = Panel(c_script_2.out)  # disabled
panel_63 = Panel(deconstruct_domain_44.End)  # disabled
panel_64 = Panel(deconstruct_domain_43.End)  # disabled
panel_65 = Panel(deconstruct_domain_45.End)  # disabled
panel_66 = Panel(box_41)  # disabled
panel_67 = Panel(deconstruct_domain_46.End)  # disabled
panel_68 = Panel(deconstruct_domain_47.End)  # disabled
# White Cells
panel_69 = Panel(deconstruct_domain_48.End)  # disabled
list_item_2 = ListItem(List=c_script_4.Furnitures, Index=number_slider_86, Wrap=boolean_toggle_2)  # disabled
# White Cells
panel_70 = Panel(c_script_4.out)  # disabled
number_slider_87 = Slider(0, range=0..1)  # disabled
number_slider_88 = Slider(0.611, range=0..1)  # disabled
number_slider_89 = Slider(0.809, range=0..1)  # disabled
colour_swatch = ColourSwatch(SwatchColor=RGB(0, 0, 0))  # disabled
colour_swatch_2 = ColourSwatch(SwatchColor=RGB(0, 0, 0))  # disabled
colour_swatch_3 = ColourSwatch(SwatchColor=RGB(255, 255, 0))  # disabled
colour_swatch_4 = ColourSwatch(SwatchColor=RGB(0, 0, 0))  # disabled
colour_swatch_5 = ColourSwatch(SwatchColor=RGB(255, 255, 255))  # disabled
colour_swatch_6 = ColourSwatch(SwatchColor=RGB(240, 240, 200))  # disabled
colour_swatch_7 = ColourSwatch(SwatchColor=RGB(240, 200, 200))  # disabled
colour_swatch_8 = ColourSwatch(SwatchColor=RGB(150, 200, 255))  # disabled

# ---- group: Visualize as 3D Boxes
number_slider_90 = Slider(0.801, range=0..1)  # disabled
create_material = CreateMaterial(Diffuse=colour_swatch_6, Specular=RGB(255, 255, 255), Emission=RGB(0, 0, 0), Transparency=number_slider_90, Shine=0)  # disabled
create_material_2 = CreateMaterial(Diffuse=colour_swatch_3, Specular=RGB(255, 255, 255), Emission=RGB(0, 0, 0), Transparency=number_slider_90, Shine=0)  # disabled
create_material_3 = CreateMaterial(Diffuse=colour_swatch_7, Specular=RGB(255, 255, 255), Emission=RGB(0, 0, 0), Transparency=number_slider_90, Shine=0)  # disabled
create_material_4 = CreateMaterial(Diffuse=colour_swatch_8, Specular=RGB(255, 255, 255), Emission=RGB(0, 0, 0), Transparency=number_slider_90, Shine=0)  # disabled
create_material_5 = CreateMaterial(Diffuse=colour_swatch_4, Specular=RGB(255, 255, 255), Emission=RGB(0, 0, 0), Transparency=number_slider_90, Shine=0)  # disabled
create_material_6 = CreateMaterial(Diffuse=colour_swatch_5, Specular=RGB(255, 255, 255), Emission=RGB(0, 0, 0), Transparency=number_slider_89, Shine=0)  # disabled
custom_preview = CustomPreview(Geometry=c_script_2.EntranceBoxes, Material=create_material)  # disabled
custom_preview_2 = CustomPreview(Geometry=c_script_2.CommonBoxes, Material=create_material_3)  # disabled
custom_preview_3 = CustomPreview(Geometry=c_script_2.Y, Material=create_material_2)  # disabled
custom_preview_4 = CustomPreview(Geometry=c_script_2.WetAreaBoxes, Material=create_material_4)  # disabled
custom_preview_5 = CustomPreview(Geometry=c_script_2.K, Material=create_material_5)  # disabled
custom_preview_6 = CustomPreview(Geometry=c_script_2.W, Material=create_material_6)  # disabled

# ----
number_slider_91 = Slider(0, range=0..1)  # disabled
number_slider_92 = Slider(0.611, range=0..1)  # disabled
number_slider_93 = Slider(0.544, range=0..1)  # disabled
colour_swatch_9 = ColourSwatch(SwatchColor=RGB(0, 0, 0))  # disabled
colour_swatch_10 = ColourSwatch(SwatchColor=RGB(0, 0, 0))  # disabled
colour_swatch_11 = ColourSwatch(SwatchColor=RGB(255, 255, 0))  # disabled
colour_swatch_12 = ColourSwatch(SwatchColor=RGB(0, 0, 0))  # disabled
colour_swatch_13 = ColourSwatch(SwatchColor=RGB(255, 255, 255))  # disabled
colour_swatch_14 = ColourSwatch(SwatchColor=RGB(240, 240, 200))  # disabled
colour_swatch_15 = ColourSwatch(SwatchColor=RGB(240, 200, 200))  # disabled
colour_swatch_16 = ColourSwatch(SwatchColor=RGB(150, 200, 255))  # disabled

# ---- group: Visualize as 3D Boxes
number_slider_94 = Slider(0.801, range=0..1)  # disabled
create_material_7 = CreateMaterial(Diffuse=colour_swatch_14, Specular=RGB(255, 255, 255), Emission=RGB(0, 0, 0), Transparency=number_slider_94, Shine=0)  # disabled
create_material_8 = CreateMaterial(Diffuse=colour_swatch_11, Specular=RGB(255, 255, 255), Emission=RGB(0, 0, 0), Transparency=number_slider_94, Shine=0)  # disabled
create_material_9 = CreateMaterial(Diffuse=colour_swatch_15, Specular=RGB(255, 255, 255), Emission=RGB(0, 0, 0), Transparency=number_slider_94, Shine=0)  # disabled
create_material_10 = CreateMaterial(Diffuse=colour_swatch_16, Specular=RGB(255, 255, 255), Emission=RGB(0, 0, 0), Transparency=number_slider_94, Shine=0)  # disabled
create_material_11 = CreateMaterial(Diffuse=colour_swatch_12, Specular=RGB(255, 255, 255), Emission=RGB(0, 0, 0), Transparency=number_slider_94, Shine=0)  # disabled
create_material_12 = CreateMaterial(Diffuse=colour_swatch_13, Specular=RGB(255, 255, 255), Emission=RGB(0, 0, 0), Transparency=number_slider_93, Shine=0)  # disabled
custom_preview_7 = CustomPreview(Geometry=c_script_4.EntranceBoxes, Material=create_material_7)  # disabled
custom_preview_8 = CustomPreview(Geometry=c_script_4.CommonBoxes, Material=create_material_9)  # disabled
custom_preview_9 = CustomPreview(Geometry=c_script_4.Y, Material=create_material_8)  # disabled
custom_preview_10 = CustomPreview(Geometry=c_script_4.WetAreaBoxes, Material=create_material_10)  # disabled
custom_preview_11 = CustomPreview(Geometry=c_script_4.K, Material=create_material_11)  # disabled
custom_preview_12 = CustomPreview(Geometry=c_script_4.W, Material=create_material_12)  # disabled

# ----
create_material_13 = CreateMaterial(Diffuse=colour_swatch, Specular=RGB(255, 255, 255), Emission=RGB(0, 0, 0), Transparency=number_slider_87, Shine=0)  # disabled
create_material_14 = CreateMaterial(Diffuse=colour_swatch_2, Specular=RGB(255, 255, 255), Emission=RGB(0, 0, 0), Transparency=number_slider_88, Shine=0)  # disabled
create_material_15 = CreateMaterial(Diffuse=colour_swatch_9, Specular=RGB(255, 255, 255), Emission=RGB(0, 0, 0), Transparency=number_slider_91, Shine=0)  # disabled
create_material_16 = CreateMaterial(Diffuse=colour_swatch_10, Specular=RGB(255, 255, 255), Emission=RGB(0, 0, 0), Transparency=number_slider_92, Shine=0)  # disabled
custom_preview_13 = CustomPreview(Geometry=c_script_2.Furnitures, Material=create_material_13)  # disabled
custom_preview_14 = CustomPreview(Geometry=c_script_2.FurnituresMargins, Material=create_material_14)  # disabled
custom_preview_15 = CustomPreview(Geometry=c_script_4.Furnitures, Material=create_material_15)  # disabled
custom_preview_16 = CustomPreview(Geometry=c_script_4.FurnituresMargins, Material=create_material_16)  # disabled
list_length = ListLength(List=c_script_2.EntranceBoxes)  # disabled
list_length_2 = ListLength(List=c_script_2.CommonBoxes)  # disabled
list_length_3 = ListLength(List=c_script_2.W)  # disabled
list_length_4 = ListLength(List=c_script_2.WetAreaBoxes)  # disabled
list_length_5 = ListLength(List=c_script_2.Y)  # disabled
list_length_6 = ListLength(List=c_script_2.K)  # disabled
list_length_7 = ListLength(List=c_script_4.EntranceBoxes)  # disabled
list_length_8 = ListLength(List=c_script_4.CommonBoxes)  # disabled
list_length_9 = ListLength(List=c_script_4.W)  # disabled
list_length_10 = ListLength(List=c_script_4.WetAreaBoxes)  # disabled
list_length_11 = ListLength(List=c_script_4.Y)  # disabled
list_length_12 = ListLength(List=c_script_4.K)  # disabled
multiplication_13 = Multiplication(A=list_length_2, B=division_3)  # disabled
multiplication_14 = Multiplication(A=list_length, B=division_3)  # disabled
multiplication_15 = Multiplication(A=list_length_3, B=division_3)  # disabled
multiplication_16 = Multiplication(A=list_length_4, B=division_3)  # disabled
multiplication_17 = Multiplication(A=list_length_5, B=division_3)  # disabled
multiplication_18 = Multiplication(A=list_length_6, B=division_3)  # disabled
multiplication_19 = Multiplication(A=list_length_8, B=division_6)  # disabled
multiplication_20 = Multiplication(A=list_length_7, B=division_6)  # disabled
multiplication_21 = Multiplication(A=list_length_9, B=division_6)  # disabled
multiplication_22 = Multiplication(A=list_length_10, B=division_6)  # disabled
multiplication_23 = Multiplication(A=list_length_11, B=division_6)  # disabled
panel_71 = Panel("m2 ")  # disabled
panel_72 = Panel(multiplication_14)  # disabled
panel_73 = Panel(" Entrance = ")  # disabled
multiplication_24 = Multiplication(A=list_length_12, B=division_6)  # disabled
panel_74 = Panel(" Empty Space= ")  # disabled
panel_75 = Panel(multiplication_15)  # disabled
panel_76 = Panel("m2 ")  # disabled
panel_77 = Panel("m2 ")  # disabled
panel_78 = Panel(multiplication_13)  # disabled
panel_79 = Panel(" CommonArea = ")  # disabled
panel_80 = Panel("m2 ")  # disabled
panel_81 = Panel(multiplication_16)  # disabled
panel_82 = Panel("Wet Area = ")  # disabled
panel_83 = Panel(multiplication_17)  # disabled
panel_84 = Panel(" Common Area = ")  # disabled
panel_85 = Panel("m2 ")  # disabled
panel_86 = Panel(" Kitchen = ")  # disabled
panel_87 = Panel(" m2 ")  # disabled
panel_88 = Panel(multiplication_18)  # disabled
panel_89 = Panel("m2 ")  # disabled
panel_90 = Panel(multiplication_20)  # disabled
panel_91 = Panel(" Entrance = ")  # disabled
number_slider_95 = Slider(15, range=0..100)  # disabled
panel_92 = Panel(" Empty Space= ")  # disabled
panel_93 = Panel(multiplication_21)  # disabled
panel_94 = Panel("m2 ")  # disabled
panel_95 = Panel(multiplication_19)  # disabled
panel_96 = Panel("m2 ")  # disabled
panel_97 = Panel(" CommonArea = ")  # disabled
panel_98 = Panel("m2 ")  # disabled
panel_99 = Panel(multiplication_22)  # disabled
panel_100 = Panel(multiplication_23)  # disabled
panel_101 = Panel("Wet Area = ")  # disabled
panel_102 = Panel(" Common Area = ")  # disabled
panel_103 = Panel("m2 ")  # disabled
panel_104 = Panel(" Kitchen = ")  # disabled
panel_105 = Panel(" m2 ")  # disabled
panel_106 = Panel(multiplication_24)  # disabled
number_slider_96 = Slider(15, range=0..100)  # disabled
concatenate = Concatenate(Fragment_A=panel_74, Fragment_B=panel_75, Fragment_C=panel_77)  # disabled
concatenate_2 = Concatenate(Fragment_A=panel_73, Fragment_B=panel_72, Fragment_C=panel_71)  # disabled
panel_107 = Panel("0,-50")  # disabled
concatenate_3 = Concatenate(Fragment_A=panel_79, Fragment_B=panel_78, Fragment_C=panel_76)  # disabled
panel_108 = Panel("0,-80")  # disabled
panel_109 = Panel("0,-140")  # disabled
concatenate_4 = Concatenate(Fragment_A=panel_82, Fragment_B=panel_81, Fragment_C=panel_80)  # disabled
concatenate_5 = Concatenate(Fragment_A=panel_86, Fragment_B=panel_83, Fragment_C=panel_85)  # disabled
concatenate_6 = Concatenate(Fragment_A=panel_84, Fragment_B=panel_88, Fragment_C=panel_87)  # disabled
concatenate_7 = Concatenate(Fragment_A=panel_92, Fragment_B=panel_93, Fragment_C=panel_94)  # disabled
concatenate_8 = Concatenate(Fragment_A=panel_91, Fragment_B=panel_90, Fragment_C=panel_89)  # disabled
panel_110 = Panel("0,-50")  # disabled
concatenate_9 = Concatenate(Fragment_A=panel_97, Fragment_B=panel_95, Fragment_C=panel_96)  # disabled
panel_111 = Panel("0,-80")  # disabled
panel_112 = Panel(concatenate)  # disabled
panel_113 = Panel(concatenate_2)  # disabled
panel_114 = Panel("0,-140")  # disabled
concatenate_10 = Concatenate(Fragment_A=panel_101, Fragment_B=panel_99, Fragment_C=panel_98)  # disabled
concatenate_11 = Concatenate(Fragment_A=panel_104, Fragment_B=panel_100, Fragment_C=panel_103)  # disabled
panel_115 = Panel(concatenate_3)  # disabled
concatenate_12 = Concatenate(Fragment_A=panel_102, Fragment_B=panel_106, Fragment_C=panel_105)  # disabled
panel_116 = Panel(concatenate_4)  # disabled
panel_117 = Panel(concatenate_5)  # disabled
panel_118 = Panel(concatenate_6)  # disabled
panel_119 = Panel("240,-170")  # disabled
panel_120 = Panel("0,-110")  # disabled
panel_121 = Panel(concatenate_7)  # disabled
panel_122 = Panel(concatenate_8)  # disabled
panel_123 = Panel(concatenate_9)  # disabled
panel_124 = Panel(concatenate_10)  # disabled
panel_125 = Panel(concatenate_11)  # disabled
panel_126 = Panel("120,-200")  # disabled
panel_127 = Panel(concatenate_12)  # disabled
panel_128 = Panel("240,-170")  # disabled
panel_129 = Panel("0,-110")  # disabled
text_tag_3d = TextTag3D(Location=panel_107, Text=concatenate_2, Size=number_slider_95, Colour=colour_swatch_6, Justification=7)  # disabled
text_tag_3d_2 = TextTag3D(Location=panel_108, Text=concatenate_3, Size=number_slider_95, Colour=colour_swatch_7, Justification=7)  # disabled
text_tag_3d_3 = TextTag3D(Location=panel_109, Text=concatenate_5, Size=number_slider_95, Colour=colour_swatch_3, Justification=7)  # disabled
text_tag_3d_4 = TextTag3D(Location=panel_120, Text=concatenate_4, Size=number_slider_95, Colour=colour_swatch_8, Justification=7)  # disabled
text_tag_3d_5 = TextTag3D(Location=panel_109, Text=concatenate, Size=number_slider_95, Colour=colour_swatch_5, Justification=7)  # disabled
text_tag_3d_6 = TextTag3D(Location=panel_119, Text=concatenate_6, Size=number_slider_95, Colour=colour_swatch_4, Justification=7)  # disabled
text_tag_3d_7 = TextTag3D(Location=panel_110, Text=concatenate_8, Size=number_slider_96, Colour=colour_swatch_14, Justification=7)  # disabled
text_tag_3d_8 = TextTag3D(Location=panel_111, Text=concatenate_9, Size=number_slider_96, Colour=colour_swatch_15, Justification=7)  # disabled
text_tag_3d_9 = TextTag3D(Location=panel_114, Text=concatenate_11, Size=number_slider_96, Colour=colour_swatch_11, Justification=7)  # disabled
text_tag_3d_10 = TextTag3D(Location=panel_129, Text=concatenate_10, Size=number_slider_96, Colour=colour_swatch_16, Justification=7)  # disabled
text_tag_3d_11 = TextTag3D(Location=panel_114, Text=concatenate_7, Size=number_slider_96, Colour=colour_swatch_13, Justification=7)  # disabled
text_tag_3d_12 = TextTag3D(Location=panel_128, Text=concatenate_12, Size=number_slider_96, Colour=colour_swatch_12, Justification=7)  # disabled
mass_addition = MassAddition(Input=[multiplication_13, multiplication_14, multiplication_16, multiplication_17, multiplication_18, multiplication_15])  # -> flatten(Result), PartialResults; disabled
number_slider_97 = Slider(1, range=0..1)  # disabled
mass_addition_2 = MassAddition(Input=[multiplication_19, multiplication_20, multiplication_22, multiplication_23, multiplication_24, multiplication_21])  # -> flatten(Result), PartialResults; disabled
panel_131 = Panel(" Total Area =")  # disabled
number_slider_98 = Slider(1, range=0..1)  # disabled
panel_132 = Panel("m2 ")  # disabled
list_item_3 = ListItem(List=mass_addition.Result, Index=number_slider_97, Wrap=True)  # disabled
panel_133 = Panel(list_item_3)  # disabled
panel_134 = Panel(" Total Area =")  # disabled
panel_135 = Panel("m2 ")  # disabled
list_item_4 = ListItem(List=mass_addition_2.Result, Index=number_slider_98, Wrap=True)  # disabled
panel_136 = Panel(list_item_4)  # disabled
panel_137 = Panel("240,-100")  # disabled
concatenate_13 = Concatenate(Fragment_A=panel_131, Fragment_B=panel_133, Fragment_C=panel_132)  # disabled
panel_138 = Panel("240,-100")  # disabled
concatenate_14 = Concatenate(Fragment_A=panel_134, Fragment_B=panel_136, Fragment_C=panel_135)  # disabled
panel_139 = Panel(concatenate_13)  # disabled
text_tag_3d_13 = TextTag3D(Location=panel_137, Text=concatenate_13, Size=number_slider_95, Justification=7)  # disabled
panel_140 = Panel(concatenate_14)  # disabled
text_tag_3d_14 = TextTag3D(Location=panel_138, Text=concatenate_14, Size=number_slider_96, Justification=7)  # disabled
deconstruct_box_30 = DeconstructBox(Box=domain_box_11)  # -> Plane, X, Y, Z
panel_141 = Panel(deconstruct_box_30.Y)
panel_142 = Panel(deconstruct_box_30.Z)
panel_143 = Panel(deconstruct_box_30.X)
number_slider_99 = Slider(10, range=0..10)
deconstruct_domain_49 = DeconstructDomain(Domain=panel_141)  # -> Start, End
deconstruct_domain_50 = DeconstructDomain(Domain=panel_143)  # -> Start, End
deconstruct_domain_51 = DeconstructDomain(Domain=panel_142)  # -> Start, End
panel_144 = Panel(deconstruct_domain_49.End)
panel_145 = Panel(deconstruct_domain_50.End)
panel_146 = Panel(deconstruct_domain_51.End)
multiplication_25 = Multiplication(A=Slider(30, range=0..100), B=number_slider_99)
multiplication_26 = Multiplication(A=Slider(60, range=20..60), B=number_slider_99)
multiplication_27 = Multiplication(A=Slider(6, range=2..10), B=number_slider_99)
multiplication_28 = Multiplication(A=Slider(36, range=20..60), B=number_slider_99)
round_3 = Round()  # -> Nearest, Floor, Ceiling
panel_147 = Panel(multiplication_25)
panel_148 = Panel(multiplication_28)
panel_149 = Panel(multiplication_26)
multiplication_29 = Multiplication(A=multiplication_27, B=multiplication_27)
number_slider_100 = Slider(100, range=0..100)
division_7 = Division(A=multiplication_26, B=multiplication_27)
panel_150 = Panel(multiplication_27)
division_8 = Division(A=multiplication_28, B=multiplication_27)
multiplication_30 = Multiplication(A=Slider(10000, range=0..10000), B=Slider(2, range=0..10))
division_9 = Division(A=multiplication_29, B=multiplication_30)
panel_151 = Panel(division_8)
integer_7 = Integer(division_8)
integer_8 = Integer(division_7)
integer_9 = Integer(panel_147)
box_42 = Box(closet)
box_43 = Box(closet_margin)
box_44 = Box(exterior_door)
c_script_5 = CSharpScript(boxx=box_44)  # -> out, lenght; inputs boxx: Box; same code as c_script
panel_152 = Panel(c_script_5.lenght)
deconstruct_box_31 = DeconstructBox(Box=box_44)  # -> Plane, X, Y, Z
panel_153 = Panel(deconstruct_box_31.Plane)
panel_154 = Panel(deconstruct_box_31.Y)
panel_155 = Panel(deconstruct_box_31.Z)
panel_156 = Panel(deconstruct_box_31.X)
box_45 = Box(changeover_zone)
box_46 = Box(exterior_door_margin)
box_47 = Box(change_over_zone_margin)
box_48 = Box()
box_49 = Box()
box_50 = Box()
box_51 = Box()
box_52 = Box()
box_53 = Box()
box_54 = Box()
box_55 = Box()
box_56 = Box()
box_57 = Box()
box_58 = Box()
c_script_6 = CSharpScript(
    Width=integer_8,
    Length=integer_7,
    Height=integer_9,
    LevelHeight=Slider(150, range=0..1000),
    cellSize=multiplication_27,
    ExteriorDoor=box_44,
    ExteriorDoorMargin=box_46,
    ChangeOverZone=box_45,
    ChangeOverZoneMargin=box_47,
    Closet=box_42,
    ClosetMargin=box_43,
    InteriorDoor=box_48,
    InteriorDoorMargin=box_49,
    Counter=box_50,
    CounterMargin=box_51,
    Table=box_52,
    TableMargin=box_53,
    SittingUnit=box_54,
    SittingUnitMargin=box_55,
    Bed=box_56,
    HealtCare=box_57,
    HealthCareMargin=box_58)  # -> out, A, EntranceBoxes, CommonBoxes, WetAreaBoxes, Y, K, W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; inputs Width: Int32, Length: Int32, Height: Int32, LevelHeight: Int32, cellSize: Int32, ExteriorDoor: Box, ExteriorDoorMargin: Box, ChangeOverZone: Box, ChangeOverZoneMargin: Box, Closet: Box, ClosetMargin: Box, InteriorDoor: Box, InteriorDoorMargin: Box, Counter: Box, CounterMargin: Box, Table: Box, TableMargin: Box, SittingUnit: Box, SittingUnitMargin: Box, Bed: Box, BedMargin: Box, HealtCare: Box, HealthCareMargin: Box
# ---------- c_script_6: C# ----------
 
    List<Box> entranceBoxes = new List<Box>();
    List<Box> commonBoxes = new List<Box>();
    List<Box> wetAreaBoxes = new List<Box>();

    /*List<Box> kitchenBoxes = new List<Box>();
      List<Box> commonAreaBoxes = new List<Box>();*/

    List<Box> WhiteBoxes = new List<Box>();

    /**  These sizes are Spreading Limits for the spaces   //total cells     **/

    double entranceSize = (6 * 100 * 100) / (cellSize * cellSize);
    double commonSize = (8 * 100 * 100) / (cellSize * cellSize);
    double wetAreaSize = (6 * 100 * 100 ) / (cellSize * cellSize);

    /*
    double kitchenSize = 7 * 100 * 100 / cellSize * cell  Size;
    double commonAreaSize = 10 * 100 * 100 / cellSize * cellSize;
    */

    Point3d pA = new Point3d(0, 0, 0);
    Point3d pB = new Point3d(10, 0, 0);
    Point3d pC = new Point3d(0, 10, 0);

    Plane p = new Plane(pA, pB, pC);

    int width = Width;
    int length = Length;
    int levelHeight = LevelHeight;
    int height = Height;
    int levelNumber = Height / LevelHeight;

    int[,,] areaArray = InitializeZeroMatrice(length, width, levelNumber);
    StartZones(areaArray);

    int[,,] emptyFullArray = InitializeZeroMatrice(length, width, levelNumber);

    for (int i = 0; i < width * length * 3; i++)
    {
/*
      Spread(areaArray, ref entranceSize, entranceList, ref entranceCounter, entranceLimit, cellSize);
      Spread(areaArray, ref commonSize, commonList, ref commonCounter, commonLimit, cellSize);
      Spread(areaArray, ref wetAreaSize, wetAreaList, ref wetAreaCounter, wetAreaLimit, cellSize);
*/
    }
/*
    noiseFilter(areaArray, 0, 6, 5);
    noiseFilter(areaArray, 1, 2, 2);
*/
    for (int k = 0;k < levelNumber;k++)
    {
      for (int i = 0;i < length;i++)
      {
        for (int j = 0;j < width;j++)
        {
          areaArray[i, j, k] = areaArray[i, j, 0];
        }
      }
    }

    for (int k = 0;k < levelNumber;k++)
    {
      for (int i = 0;i < length;i++)
      {
        for (int j = 0;j < width;j++)
        {
          emptyFullArray[i, j, k] = 0;
        }
      }
    }

    entranceList.Clear();
    commonList.Clear();
    wetAreaList.Clear();
    /*kitchenList.Clear();
    commonAreaList.Clear();*/

    for (int k = 0;k < levelNumber;k++)
    {
      for (int i = 0;i < length;i++)
      {
        for (int j = 0;j < width;j++)
        {
          if (areaArray[i, j, k] == 1)
          {
            Interval xInterval = new Interval(i * cellSize, (i + 1) * (cellSize ));
            Interval yInterval = new Interval(j * cellSize, (j + 1) * (cellSize ));
            Interval zInterval = new Interval(k * LevelHeight, k * LevelHeight + levelHeight);

            Box boxgh = new Box(p, xInterval, yInterval, zInterval);
            entranceBoxes.Add(boxgh);
            entranceList.AddRange(new int[2] { i, j });
          }
          if (areaArray[i, j, k] == 2)
          {
            Interval xInterval = new Interval(i * cellSize, (i + 1) * (cellSize ));
            Interval yInterval = new Interval(j * cellSize, (j + 1) * (cellSize ));
            Interval zInterval = new Interval(k * LevelHeight, k * LevelHeight + levelHeight);

            Box boxgh = new Box(p, xInterval, yInterval, zInterval);
            commonBoxes.Add(boxgh);
            commonList.AddRange(new int[2] { i, j });
          }
          if (areaArray[i, j, k] == 3)
          {
            Interval xInterval = new Interval(i * cellSize, (i + 1) * (cellSize ));
            Interval yInterval = new Interval(j * cellSize, (j + 1) * (cellSize ));
            Interval zInterval = new Interval(k * LevelHeight, k * LevelHeight + levelHeight);

            Box boxgh = new Box(p, xInterval, yInterval, zInterval);
            wetAreaBoxes.Add(boxgh);
            wetAreaList.AddRange(new int[2] { i, j });
          }

          /*if (areaArray[i, j, k] == 4)
          {
            Interval xInterval = new Interval(j * cellSize, (j + 1) * (cellSize ));
            Interval yInterval = new Interval(i * cellSize, (i + 1) * (cellSize ));
            Interval zInterval = new Interval(k * LevelHeight, k * LevelHeight + levelHeight);

            Box boxgh = new Box(p, xInterval, yInterval, zInterval);
            kitchenBoxes.Add(boxgh);
            kitchenList.AddRange(new int[2] { i, j });
          }
          if (areaArray[i, j, k] == 5)
          {
            Interval xInterval = new Interval(j * cellSize, (j + 1) * (cellSize ));
            Interval yInterval = new Interval(i * cellSize, (i + 1) * (cellSize ));
            Interval zInterval = new Interval(k * LevelHeight, k * LevelHeight + levelHeight);

            Box boxgh = new Box(p, xInterval, yInterval, zInterval);
            commonAreaBoxes.Add(boxgh);
            commonAreaList.AddRange(new int[2] { i, j });
          }*/
          if (areaArray[i, j, k] == 0)
          {

            Interval xInterval = new Interval(i * cellSize, (i + 1) * (cellSize ));
            Interval yInterval = new Interval(j * cellSize, (j + 1) * (cellSize ));
            Interval zInterval = new Interval(k * LevelHeight, k * LevelHeight + levelHeight);

            Box boxgh = new Box(p, xInterval, yInterval, zInterval);
            WhiteBoxes.Add(boxgh);
            //WhiteList.AddRange(i, j);
          }
        }
      }
    }

    ShowMatrix(areaArray);

    A = areaArray;
    EntranceBoxes = entranceBoxes;
    CommonBoxes = commonBoxes;
    WetAreaBoxes = wetAreaBoxes;
    W = WhiteBoxes;
# ---------- c_script_6: C# additional code ----------
  class Objects
  {
    public string Name;
    public int ZoneName;

    public Box Obj;
    public Box ObjMargin;

    public bool Front = false;
    public bool Right = false;
    public bool Back = false;
    public bool Left = false;
    public bool Top = false;
    public bool Bottom = false;

    public bool RotationBool = true;
    public int RotationOpt; // rotation options

    public bool MirrorBool = true;
    public int MirrorOpt; // mirror options

    public string Source; // Water, Electiricity
    public int FixedToWall; // Bed, Television //1,2,3 conditions
    public int CellSize;

    public Objects PreviousObject;

    public double ObjLength ;
    public double ObjWidth ;
    public double ObjHeight ;

    public double MrjLength;
    public double MrjWidth;
    public double MrjHeight;

    public double baseX, baseY, baseZ;
    public List<int> SpaceList = new List<int>();

    public double  XCell;
    public double  YCell;
    public double  ZCell;


    //deneme
    public Objects()
    {
            /*
            var Coordinates = new List<int>();
            Point3d pA = new Point3d(0, 0, 0);
            Point3d pB = new Point3d(10, 0, 0);
            Point3d pC = new Point3d(0, 10, 0);

            Plane p = new Plane(pA, pB, pC);*/
    }

    public Objects(string name, int zoneName, bool front, bool right, bool back, bool left, bool top, bool bottom, bool rotationalBool, int rotationOpt, bool mirrorBool, int mirrorOpt, string source, int fixedTowall, int cellSize, Box obj, Box objMargin, Objects previousObject, List<int> spaceList)
      : this()
    {
      this.Obj = obj;
      this.ObjMargin = objMargin;

      this.Name = name;
      this.ZoneName = zoneName;

      this.Front = front;
      this.Right = right;
      this.Back = back;
      this.Left = left;
      this.Bottom = bottom;
      this.Top = top;

      this.RotationBool = rotationalBool;
      this.RotationOpt = rotationOpt;

      this.MirrorBool = mirrorBool;
      this.MirrorOpt = mirrorOpt;

      this.Source = source;
      this.FixedToWall = fixedTowall;
      this.CellSize = cellSize;

      this.ObjWidth = obj.X.T1;
      this.ObjLength = obj.Y.T1;
      this.ObjHeight = obj.Z.T1;

      this.MrjWidth = objMargin.X.T1;
      this.MrjLength = objMargin.Y.T1;
      this.MrjHeight = objMargin.Z.T1;

      this.baseX = Obj.Plane.OriginX;
      this.baseY = Obj.Plane.OriginY;
      this.baseZ = Obj.Plane.OriginZ;

      this.PreviousObject = previousObject;
      this.SpaceList = spaceList;
    }

    public Objects(string name, int zoneName, bool front, bool right, bool back, bool left, bool top, bool bottom, bool rotationalBool, int rotationOpt, bool mirrorBool, int mirrorOpt, string source, int fixedTowall, int cellSize, Box obj, Box objMargin, List<int> spaceList)
      : this()
    {
      this.Obj = obj;
      this.ObjMargin = objMargin;

      this.Name = name;
      this.ZoneName = zoneName;

      this.Front = front;
      this.Right = right;
      this.Back = back;
      this.Left = left;
      this.Bottom = bottom;
      this.Top = top;

      this.RotationBool = rotationalBool;
      this.RotationOpt = rotationOpt;

      this.MirrorBool = mirrorBool;
      this.MirrorOpt = mirrorOpt;

      this.Source = source;
      this.FixedToWall = fixedTowall;
      this.CellSize = cellSize;

      this.ObjWidth = obj.X.T1;
      this.ObjLength = obj.Y.T1;
      this.ObjHeight = obj.Z.T1;

      this.MrjWidth = (this.ObjMargin.X.T1);
      this.MrjLength = (this.ObjMargin.Y.T1);
      this.MrjHeight = (this.ObjMargin.Z.T1);

      this.baseX = Obj.Plane.OriginX;
      this.baseY = Obj.Plane.OriginY;
      this.baseZ = Obj.Plane.OriginZ;

      this.SpaceList = spaceList;
    }

    public void assignDimensions()
    {
      this.ObjWidth = this.Obj.X.T1;
      this.ObjLength = this.Obj.Y.T1;
      this.ObjHeight = this.Obj.Z.T1;

      this.MrjWidth = this.ObjMargin.X.T1;
      this.MrjLength = this.ObjMargin.Y.T1;
      this.MrjHeight = this.ObjMargin.Z.T1;

    }

    public void printDimensions()
    {
      Rhino.RhinoApp.WriteLine("Obj Width " + this.ObjWidth.ToString());
      Rhino.RhinoApp.WriteLine("Obj Length " + this.ObjLength.ToString());
      Rhino.RhinoApp.WriteLine("Obj Height " + this.ObjHeight.ToString());

      Rhino.RhinoApp.WriteLine("Obj Width " + this.MrjWidth.ToString());
      Rhino.RhinoApp.WriteLine("Obj Length " + this.MrjLength.ToString());
      Rhino.RhinoApp.WriteLine("Obj Height " + this.MrjHeight.ToString());
    }



    public void placeRefObject(int [,,]emptyFullArray, int[,,]areaArray, out Box ObjBox, out Box marginBox)
    {
      this.XCell = Math.Ceiling((double) (this.MrjWidth / CellSize));
      this.YCell = Math.Ceiling((double) (this.MrjLength / CellSize));
      this.ZCell = Math.Ceiling((double) (this.MrjHeight / 150));

      bool emptyBool = true;
      bool sameZone = true;

      bool placeSuccessful = false;
      int trycount = 0;

      while (placeSuccessful == false)
      {
        var rand = new Random();
        var randomCellIndex = rand.Next(this.SpaceList.Count / 2);

        baseX = (this.SpaceList[2 * randomCellIndex]) * CellSize;
        baseY = (this.SpaceList[2 * randomCellIndex + 1]) * CellSize;
        baseZ = 0;
        baseZ = 0;

        //baseX = baseX * CellSize;
        //baseY = baseY * CellSize;

        if( (baseX + this.MrjWidth < 300) && (baseY + this.MrjLength < 600) && (baseZ + this.MrjHeight < 300) &&
          (baseX + this.MrjWidth > 0) && (baseY + this.MrjLength > 0) && (baseZ + this.MrjHeight > 0) )
        {
          for(int i = (int) (baseX / CellSize) ; i < (baseX / CellSize + (int) XCell); i++)
          {
            for(int j = (int) (baseY / CellSize); j < baseY / CellSize + (int) YCell; j++)
            {
              for(int k = (int) (baseZ / 150); k < baseZ / 150 + (int) ZCell; k++)
              {
                Rhino.RhinoApp.WriteLine("Entrance Reference Object :  " + "  i:  " + i + "  j:  " + j + "  k:  " + k);
                if (emptyFullArray[i, j, k] == 1)
                {
                  emptyBool = false;
                }
                if (areaArray[i, j, k] != this.ZoneName)
                {
                  sameZone = false;
                }
              }
            }
          }

          if (emptyBool && sameZone)
          {
            placeSuccessful = true;

            Rhino.RhinoApp.WriteLine("Reference Object conditions are successful ");
            for(int i = (int) (baseX / CellSize) ; i < (baseX / CellSize + (int) XCell); i++)
            {
              for(int j = (int) (baseY / CellSize); j < baseY / CellSize + (int) YCell; j++)
              {
                for(int k = (int) (baseZ / 150); k < baseZ / 150 + (int) ZCell; k++)
                {
                  emptyFullArray[i, j, k] = 1;
                }
              }
            }
          }
          else
          {
            Rhino.RhinoApp.WriteLine("Conditions are not satisfied ");
          }
        }

        trycount++;
        Rhino.RhinoApp.WriteLine("Try count is : " + trycount);
        if (trycount > 60 )
          Rhino.RhinoApp.WriteLine("Try count is over 60 placement is unsuccessful: ");
        placeSuccessful = true;
      }

      if( trycount < 60 && placeSuccessful )
      {
        Rhino.RhinoApp.WriteLine("baseX " + this.baseX);
        Rhino.RhinoApp.WriteLine("baseY " + this.baseY);
        Rhino.RhinoApp.WriteLine("baseZ " + this.baseZ);

        Point3d pointa = new Point3d(baseX, baseY, 0);
        Vector3d pointb = new Vector3d(0, 0, 1);

        Plane planebase = new Plane(pointa, pointb);

        Interval xInterval = new Interval(0, this.ObjWidth);
        Interval yInterval = new Interval(0, this.ObjLength);
        Interval zInterval = new Interval(0, this.ObjHeight);

        ObjBox = new Box(planebase, xInterval, yInterval, zInterval);

        xInterval = new Interval(0, this.MrjWidth);
        yInterval = new Interval(0, this.MrjLength);
        zInterval = new Interval(0, this.MrjHeight);

        marginBox = new Box(planebase, xInterval, yInterval, zInterval);

      }

      else
      {
        ObjBox = new Box();
        marginBox = new Box();
      }
    }

    public void placeRefObjectEntrance(int [,,]emptyFullArray, int[,,]areaArray, out Box ObjBox, out Box marginBox)
    {
      this.XCell = Math.Ceiling((double) (this.MrjWidth / CellSize));
      this.YCell = Math.Ceiling((double) (this.MrjLength / CellSize));
      this.ZCell = Math.Ceiling((double) (this.MrjHeight / 150));

      bool emptyBool = true;
      bool sameZone = true;


      bool placeSuccessful = false;
      int trycount = 0;

      while (placeSuccessful == false)
      {
        var rand = new Random();
        var randomCellIndex = rand.Next(this.SpaceList.Count / 2);

        baseX = (this.SpaceList[2 * randomCellIndex]) * CellSize;
        baseY = 0;
        baseZ = 0;

        //baseX = baseX * CellSize;
        //baseY = baseY * CellSize;

        if( (baseX + this.MrjWidth < 300) && (baseY + this.MrjLength < 600) && (baseZ + this.MrjHeight < 300) &&
          (baseX + this.MrjWidth > 0) && (baseY + this.MrjLength > 0) && (baseZ + this.MrjHeight > 0) )
        {
          for(int i = (int) (baseX / CellSize) ; i < (baseX / CellSize + (int) XCell); i++)
          {
            for(int j = (int) (baseY / CellSize); j < baseY / CellSize + (int) YCell; j++)
            {
              for(int k = (int) (baseZ / 150); k < baseZ / 150 + (int) ZCell; k++)
              {
                Rhino.RhinoApp.WriteLine("Entrance Reference Object :  " + "  i:  " + i + "  j:  " + j + "  k:  " + k);
                if (emptyFullArray[i, j, k] == 1)
                {
                  emptyBool = false;
                }
                if (areaArray[i, j, k] != this.ZoneName)
                {
                  sameZone = false;
                }
              }
            }
          }

          if (emptyBool && sameZone)
          {
            placeSuccessful = true;

            Rhino.RhinoApp.WriteLine("Reference Object conditions are successful ");
            for(int i = (int) (baseX / CellSize) ; i < (baseX / CellSize + (int) XCell); i++)
            {
              for(int j = (int) (baseY / CellSize); j < baseY / CellSize + (int) YCell; j++)
              {
                for(int k = (int) (baseZ / 150); k < baseZ / 150 + (int) ZCell; k++)
                {
                  emptyFullArray[i, j, k] = 1;
                }
              }
            }
          }
          else
          {
            Rhino.RhinoApp.WriteLine("Conditions are not satisfied ");
          }
        }

        trycount++;
        Rhino.RhinoApp.WriteLine("Try count is : " + trycount);
        if (trycount > 60 )
          Rhino.RhinoApp.WriteLine("Try count is over 60 placement is unsuccessful: ");
        placeSuccessful = true;
      }

      if( trycount < 60 && placeSuccessful )
      {
        Rhino.RhinoApp.WriteLine("baseX " + this.baseX);
        Rhino.RhinoApp.WriteLine("baseY " + this.baseY);
        Rhino.RhinoApp.WriteLine("baseZ " + this.baseZ);

        Point3d pointa = new Point3d(baseX, 0, 0);
        Vector3d pointb = new Vector3d(0, 0, 1);

        Plane planebase = new Plane(pointa, pointb);

        Interval xInterval = new Interval(0, this.ObjWidth);
        Interval yInterval = new Interval(0, this.ObjLength);
        Interval zInterval = new Interval(0, this.ObjHeight);

        ObjBox = new Box(planebase, xInterval, yInterval, zInterval);

        xInterval = new Interval(0, this.MrjWidth);
        yInterval = new Interval(0, this.MrjLength);
        zInterval = new Interval(0, this.MrjHeight);

        marginBox = new Box(planebase, xInterval, yInterval, zInterval);

      }


      else
      {
        ObjBox = new Box();
        marginBox = new Box();
      }

    }


    public void placeFront(int [,,]emptyFullArray, int[,,]areaArray, out Box ObjBox, out Box marginBox)
    {
      bool emptyBool = true;
      bool sameZone = true;

      this.XCell = Math.Ceiling((double) (this.MrjWidth / CellSize));
      this.YCell = Math.Ceiling((double) (this.MrjLength / CellSize));
      this.ZCell = Math.Ceiling((double) (this.MrjHeight / 150));

      this.baseX = PreviousObject.baseX;
      this.baseY = PreviousObject.baseY + CellSize * PreviousObject.YCell;
      this.baseZ = PreviousObject.baseZ;

      if( (baseX + this.MrjWidth < 300) && (baseY + this.MrjLength < 600) && (baseZ + this.MrjHeight < 300) &&
        (baseX + this.MrjWidth > 0) && (baseY + this.MrjLength > 0) && (baseZ + this.MrjHeight > 0) )
      {
        for(int i = (int) (baseX / CellSize) ; i < (baseX / CellSize + (int) XCell); i++)
        {
          for(int j = (int) (baseY / CellSize); j < baseY / CellSize + (int) YCell; j++)
          {
            for(int k = (int) (baseZ / 150); k < baseZ / 150 + (int) ZCell; k++)
            {
              Rhino.RhinoApp.WriteLine("i:  " + i + "  j:  " + j + "  k:  " + k);
              if (emptyFullArray[i, j, k] == 1)
              {
                emptyBool = false;
              }
              if (areaArray[i, j, k] != this.ZoneName)
              {
                sameZone = false;
              }
            }
          }
        }

        if (emptyBool && sameZone)
        {
          Rhino.RhinoApp.WriteLine("Conditions are successful ");
          for(int i = (int) (baseX / CellSize) ; i < (baseX / CellSize + (int) XCell); i++)
          {
            for(int j = (int) (baseY / CellSize); j < baseY / CellSize + (int) YCell; j++)
            {
              for(int k = (int) (baseZ / 150); k < baseZ / 150 + (int) ZCell; k++)
              {
                emptyFullArray[i, j, k] = 1;
              }
            }
          }
        }
        else
        {
          Rhino.RhinoApp.WriteLine("Place Front:  Conditions are not satisfied ");
        }
      }
      else
      {
        Rhino.RhinoApp.WriteLine("Place Front: Conditions are not satisfied ");
      }


      Point3d pointa = new Point3d(baseX, baseY, baseZ);
      Vector3d pointb = new Vector3d(0, 0, 1);

      Plane planebase = new Plane(pointa, pointb);

      Interval xInterval = new Interval(0, this.ObjWidth);
      Interval yInterval = new Interval(0, this.ObjLength);
      Interval zInterval = new Interval(0, this.ObjHeight);

      ObjBox = new Box(planebase, xInterval, yInterval, zInterval);

      xInterval = new Interval(0, this.MrjWidth);
      yInterval = new Interval(0, this.MrjLength);
      zInterval = new Interval(0, this.MrjHeight);

      marginBox = new Box(planebase, xInterval, yInterval, zInterval);
    }


    public void placeRight(int [,,]emptyFullArray, int[,,]areaArray, out Box ObjBox, out Box marginBox)
    {
      bool emptyBool = true;
      bool sameZone = true;

      this.XCell = Math.Ceiling((double) (this.MrjWidth / CellSize));
      this.YCell = Math.Ceiling((double) (this.MrjLength / CellSize));
      this.ZCell = Math.Ceiling((double) (this.MrjHeight / 150));

      this.baseX = PreviousObject.baseX + CellSize * PreviousObject.XCell;
      this.baseY = PreviousObject.baseY;
      this.baseZ = PreviousObject.baseZ;

      if( (baseX + this.ObjWidth < 300) && (baseY + this.ObjLength < 600) && (baseZ + this.ObjHeight < 300) &&
        (baseX + this.ObjWidth > 0) && (baseY + this.ObjLength > 0) && (baseZ + this.ObjHeight > 0) )
      {
        for(int i = (int) (baseX / CellSize) ; i < (baseX / CellSize + (int) XCell); i++)
        {
          for(int j = (int) (baseY / CellSize); j < baseY / CellSize + (int) YCell; j++)
          {
            for(int k = (int) (baseZ / 150); k < baseZ / 150 + (int) ZCell; k++)
            {
              if (emptyFullArray[i, j, k] == 1)
              {
                emptyBool = false;
              }
              if (areaArray[i, j, k] != this.ZoneName)
              {
                sameZone = false;
              }
            }
          }
        }

        if (emptyBool && sameZone)
        {
          Rhino.RhinoApp.WriteLine("Place Right: Conditions are successful ");
          for(int i = (int) (baseX / CellSize) ; i < (baseX / CellSize + (int) XCell); i++)
          {
            for(int j = (int) (baseY / CellSize); j < baseY / CellSize + (int) YCell; j++)
            {
              for(int k = (int) (baseZ / 150); k < baseZ / 150 + (int) ZCell; k++)
              {
                emptyFullArray[i, j, k] = 1;
              }
            }
          }
        }
        else
        {
          Rhino.RhinoApp.WriteLine("Place Right: Conditions are not satisfied ");
        }
      }
      else
      {
        Rhino.RhinoApp.WriteLine("Place Right: Conditions are not satisfied ");
      }

      Point3d pointa = new Point3d(baseX, baseY, baseZ);
      Vector3d pointb = new Vector3d(0, 0, 1);

      Plane planebase = new Plane(pointa, pointb);

      Interval xInterval = new Interval(0, this.ObjWidth);
      Interval yInterval = new Interval(0, this.ObjLength);
      Interval zInterval = new Interval(0, this.ObjHeight);

      ObjBox = new Box(planebase, xInterval, yInterval, zInterval);

      xInterval = new Interval(0, this.MrjWidth);
      yInterval = new Interval(0, this.MrjLength);
      zInterval = new Interval(0, this.MrjHeight);

      marginBox = new Box(planebase, xInterval, yInterval, zInterval);
    }

    public void placeBack(int [,,]emptyFullArray, int[,,]areaArray, out Box ObjBox, out Box marginBox)
    {
      bool emptyBool = true;
      bool sameZone = true;

      this.XCell = Math.Ceiling((double) (this.MrjWidth / CellSize));
      this.YCell = Math.Ceiling((double) (this.MrjLength / CellSize));
      this.ZCell = Math.Ceiling((double) (this.MrjHeight / 150));

      this.baseX = PreviousObject.baseX;
      this.baseY = PreviousObject.baseY - CellSize * this.YCell;
      this.baseZ = PreviousObject.baseZ;

      if( (baseX + this.ObjWidth < 300) && (baseY + this.ObjLength < 600) && (baseZ + this.ObjHeight < 300) &&
        (baseX + this.ObjWidth > 0) && (baseY + this.ObjLength > 0) && (baseZ + this.ObjHeight > 0) )
      {
        for(int i = (int) (baseX / CellSize) ; i < (baseX / CellSize + (int) XCell); i++)
        {
          for(int j = (int) (baseY / CellSize); j < baseY / CellSize + (int) YCell; j++)
          {
            for(int k = (int) (baseZ / 150); k < baseZ / 150 + (int) ZCell; k++)
            {
              if (emptyFullArray[i, j, k] == 1)
              {
                emptyBool = false;
              }
              if (areaArray[i, j, k] != this.ZoneName)
              {
                sameZone = false;
              }
            }
          }
        }

        if (emptyBool && sameZone)
        {
          Rhino.RhinoApp.WriteLine("Place Back: Conditions are successful ");
          for(int i = (int) (baseX / CellSize) ; i < (baseX / CellSize + (int) XCell); i++)
          {
            for(int j = (int) (baseY / CellSize); j < baseY / CellSize + (int) YCell; j++)
            {
              for(int k = (int) (baseZ / 150); k < baseZ / 150 + (int) ZCell; k++)
              {
                emptyFullArray[i, j, k] = 1;
              }
            }
          }
        }
        else
        {
          Rhino.RhinoApp.WriteLine("Place Back: Conditions are not satisfied ");
        }
      }
      else
      {
        Rhino.RhinoApp.WriteLine("Place Back:Conditions are not satisfied ");
      }

      Point3d pointa = new Point3d(baseX, baseY, baseZ);
      Vector3d pointb = new Vector3d(0, 0, 1);

      Plane planebase = new Plane(pointa, pointb);

      Interval xInterval = new Interval(0, this.ObjWidth);
      Interval yInterval = new Interval(0, this.ObjLength);
      Interval zInterval = new Interval(0, this.ObjHeight);

      ObjBox = new Box(planebase, xInterval, yInterval, zInterval);

      xInterval = new Interval(0, this.MrjWidth);
      yInterval = new Interval(0, this.MrjLength);
      zInterval = new Interval(0, this.MrjHeight);

      marginBox = new Box(planebase, xInterval, yInterval, zInterval);
    }

    public void placeLeft(int [,,]emptyFullArray, int[,,]areaArray, out Box ObjBox, out Box marginBox)
    {
      bool emptyBool = true;
      bool sameZone = true;

      this.XCell = Math.Ceiling((double) (this.MrjWidth / CellSize));
      this.YCell = Math.Ceiling((double) (this.MrjLength / CellSize));
      this.ZCell = Math.Ceiling((double) (this.MrjHeight / 150));

      this.baseX = PreviousObject.baseX - CellSize * this.XCell;
      this.baseY = PreviousObject.baseY;
      this.baseZ = PreviousObject.baseZ;

      if( (baseX + this.ObjWidth < 300) && (baseY + this.ObjLength < 600) && (baseZ + this.ObjHeight < 300) &&
        (baseX + this.ObjWidth > 0) && (baseY + this.ObjLength > 0) && (baseZ + this.ObjHeight > 0) )
      {
        for(int i = (int) (baseX / CellSize) ; i < (baseX / CellSize + (int) XCell); i++)
        {
          for(int j = (int) (baseY / CellSize); j < baseY / CellSize + (int) YCell; j++)
          {
            for(int k = (int) (baseZ / 150); k < baseZ / 150 + (int) ZCell; k++)
            {
              if (emptyFullArray[i, j, k] == 1)
              {
                emptyBool = false;
              }
              if (areaArray[i, j, k] != this.ZoneName)
              {
                sameZone = false;
              }
            }
          }
        }

        if (emptyBool && sameZone)
        {
          Rhino.RhinoApp.WriteLine("Place Left: Conditions are successful ");
          for(int i = (int) (baseX / CellSize) ; i < (baseX / CellSize + (int) XCell); i++)
          {
            for(int j = (int) (baseY / CellSize); j < baseY / CellSize + (int) YCell; j++)
            {
              for(int k = (int) (baseZ / 150); k < baseZ / 150 + (int) ZCell; k++)
              {
                emptyFullArray[i, j, k] = 1;
              }
            }
          }
        }
        else
        {
          Rhino.RhinoApp.WriteLine("Place Left: Conditions are not satisfied ");
        }
      }
      else
      {
        Rhino.RhinoApp.WriteLine("Place Left: Conditions are not satisfied ");
      }

      Point3d pointa = new Point3d(baseX, baseY, baseZ);
      Vector3d pointb = new Vector3d(0, 0, 1);

      Plane planebase = new Plane(pointa, pointb);

      Interval xInterval = new Interval(0, this.ObjWidth);
      Interval yInterval = new Interval(0, this.ObjLength);
      Interval zInterval = new Interval(0, this.ObjHeight);

      ObjBox = new Box(planebase, xInterval, yInterval, zInterval);

      xInterval = new Interval(0, this.MrjWidth);
      yInterval = new Interval(0, this.MrjLength);
      zInterval = new Interval(0, this.MrjHeight);

      marginBox = new Box(planebase, xInterval, yInterval, zInterval);
    }
    public void placeTop(int [,,]emptyFullArray, int[,,]areaArray, out Box ObjBox, out Box marginBox)
    {
      bool emptyBool = true;
      bool sameZone = true;

      this.XCell = Math.Ceiling((double) (this.MrjWidth / CellSize));
      this.YCell = Math.Ceiling((double) (this.MrjLength / CellSize));
      this.ZCell = Math.Ceiling((double) (this.MrjHeight / 150));

      this.baseX = PreviousObject.baseX;
      this.baseY = PreviousObject.baseY;
      this.baseZ = PreviousObject.baseZ + CellSize * PreviousObject.ZCell;

      if( (baseX + this.ObjWidth < 300) && (baseY + this.ObjLength < 600) && (baseZ + this.ObjHeight < 300) &&
        (baseX + this.ObjWidth > 0) && (baseY + this.ObjLength > 0) && (baseZ + this.ObjHeight > 0) )
      {
        for(int i = (int) (baseX / CellSize) ; i < (baseX / CellSize + (int) XCell); i++)
        {
          for(int j = (int) (baseY / CellSize); j < baseY / CellSize + (int) YCell; j++)
          {
            for(int k = (int) (baseZ / 150); k < baseZ / 150 + (int) ZCell; k++)
            {
              if (emptyFullArray[i, j, k] == 1)
              {
                emptyBool = false;
              }
              if (areaArray[i, j, k] != this.ZoneName)
              {
                sameZone = false;
              }
            }
          }
        }

        if (emptyBool && sameZone)
        {
          Rhino.RhinoApp.WriteLine("Conditions are successful ");
          for(int i = (int) (baseX / CellSize) ; i < (baseX / CellSize + (int) XCell); i++)
          {
            for(int j = (int) (baseY / CellSize); j < baseY / CellSize + (int) YCell; j++)
            {
              for(int k = (int) (baseZ / 150); k < baseZ / 150 + (int) ZCell; k++)
              {
                emptyFullArray[i, j, k] = 1;
              }
            }
          }
        }
        else
        {
          Rhino.RhinoApp.WriteLine("Conditions are not satisfied ");
        }
      }
      else
      {
        Rhino.RhinoApp.WriteLine("Conditions are not satisfied ");
      }

      Point3d pointa = new Point3d(baseX, baseY, baseZ);
      Vector3d pointb = new Vector3d(0, 0, 1);

      Plane planebase = new Plane(pointa, pointb);

      Interval xInterval = new Interval(0, this.ObjWidth);
      Interval yInterval = new Interval(0, this.ObjLength);
      Interval zInterval = new Interval(0, this.ObjHeight);

      ObjBox = new Box(planebase, xInterval, yInterval, zInterval);

      xInterval = new Interval(0, this.MrjWidth);
      yInterval = new Interval(0, this.MrjLength);
      zInterval = new Interval(0, this.MrjHeight);

      marginBox = new Box(planebase, xInterval, yInterval, zInterval);
    }

    public void placeBottom(int [,,]emptyFullArray, int[,,]areaArray, out Box ObjBox, out Box marginBox)
    {
      bool emptyBool = true;
      bool sameZone = true;

      this.XCell = Math.Ceiling((double) (this.MrjWidth / CellSize));
      this.YCell = Math.Ceiling((double) (this.MrjLength / CellSize));
      this.ZCell = Math.Ceiling((double) (this.MrjHeight / 150));

      this.baseX = PreviousObject.baseX;
      this.baseY = PreviousObject.baseY;
      this.baseZ = PreviousObject.baseZ - CellSize * this.ZCell;

      if( (baseX + this.ObjWidth < 300) && (baseY + this.ObjLength < 600) && (baseZ + this.ObjHeight < 300) &&
        (baseX + this.ObjWidth > 0) && (baseY + this.ObjLength > 0) && (baseZ + this.ObjHeight > 0) )
      {
        for(int i = (int) (baseX / CellSize) ; i < (baseX / CellSize + (int) XCell); i++)
        {
          for(int j = (int) (baseY / CellSize); j < baseY / CellSize + (int) YCell; j++)
          {
            for(int k = (int) (baseZ / 150); k < baseZ / 150 + (int) ZCell; k++)
            {
              if (emptyFullArray[i, j, k] == 1)
              {
                emptyBool = false;
              }
              if (areaArray[i, j, k] != this.ZoneName)
              {
                sameZone = false;
              }
            }
          }
        }

        if (emptyBool && sameZone)
        {
          Rhino.RhinoApp.WriteLine("Conditions are successful ");
          for(int i = (int) (baseX / CellSize) ; i < (baseX / CellSize + (int) XCell); i++)
          {
            for(int j = (int) (baseY / CellSize); j < baseY / CellSize + (int) YCell; j++)
            {
              for(int k = (int) (baseZ / 150); k < baseZ / 150 + (int) ZCell; k++)
              {
                emptyFullArray[i, j, k] = 1;
              }
            }
          }
        }
        else
        {
          Rhino.RhinoApp.WriteLine("Conditions are not satisfied ");
        }
      }
      else
      {
        Rhino.RhinoApp.WriteLine("Conditions are not satisfied ");
      }

      Point3d pointa = new Point3d(baseX, baseY, baseZ);
      Vector3d pointb = new Vector3d(0, 0, 1);

      Plane planebase = new Plane(pointa, pointb);

      Interval xInterval = new Interval(0, this.ObjWidth);
      Interval yInterval = new Interval(0, this.ObjLength);
      Interval zInterval = new Interval(0, this.ObjHeight);

      ObjBox = new Box(planebase, xInterval, yInterval, zInterval);

      xInterval = new Interval(0, this.MrjWidth);
      yInterval = new Interval(0, this.MrjLength);
      zInterval = new Interval(0, this.MrjHeight);

      marginBox = new Box(planebase, xInterval, yInterval, zInterval);
    }

    public void placeObject(int [,,]emptyFullArray, int[,,]areaArray, out Box ObjBox, out Box marginBox)
    {

      Point3d pointa = new Point3d(baseX, baseY, baseZ);
      Vector3d pointb = new Vector3d(0, 0, 1);

      Plane planebase = new Plane(pointa, pointb);

      Interval xInterval = new Interval(0, this.ObjWidth);
      Interval yInterval = new Interval(0, this.ObjLength);
      Interval zInterval = new Interval(0, this.ObjHeight);

      ObjBox = new Box(planebase, xInterval, yInterval, zInterval);

      xInterval = new Interval(0, this.MrjWidth);
      yInterval = new Interval(0, this.MrjLength);
      zInterval = new Interval(0, this.MrjHeight);

      marginBox = new Box(planebase, xInterval, yInterval, zInterval);

      List<int> growDirection = new List<int>();

      if(PreviousObject.Front == true)
        growDirection.Add(1); // Front Direction
      if(PreviousObject.Right == true)
        growDirection.Add(2); // Right Direction
      if(PreviousObject.Back == true)
        growDirection.Add(3); // Back Direction
      if(PreviousObject.Left == true)
        growDirection.Add(4); // Left Direction
      if(PreviousObject.Bottom == true)
        growDirection.Add(5); // Bottom Direction
      if(PreviousObject.Top == true)
        growDirection.Add(6); // Right Direction

      bool placeSuccess = false;
      int tryCounter = 0;

      if(growDirection.Count >= 1)
      {
        Random randm = new Random();

        while(placeSuccess == false )
        {
          int a = randm.Next(0, growDirection.Count);
          int randomMethod = growDirection[a];

          switch (a)
          ​{
            case 1:
              this.placeFront(emptyFullArray, areaArray, out  ObjBox, out marginBox);
              placeSuccess = true;
              break;
            case 2:
              this.placeRight(emptyFullArray, areaArray, out  ObjBox, out marginBox);
              placeSuccess = true;
              break;
            case 3:
              this.placeBack(emptyFullArray, areaArray, out  ObjBox, out marginBox);
              placeSuccess = true;
              break;
            case 4:
              this.placeLeft(emptyFullArray, areaArray, out  ObjBox, out marginBox);
              placeSuccess = true;
              break;
            case 5:
              this.placeBottom(emptyFullArray, areaArray, out  ObjBox, out marginBox);
              placeSuccess = true;
              break;
            case 6:
              this.placeTop(emptyFullArray, areaArray, out  ObjBox, out marginBox);
              placeSuccess = true;
              break;

            default:
              tryCounter++;
              break;
            // default statements
          }


        }
        growDirection.Clear();




      }


    }


    public void rotate()
    {

    }



    static void mirror()
    {

    }

    static void getClosestCell()
    {

    }

    static void createWall()
    {

    }

  }

  static void ShowMatrix(int[,,] Arr)
  {
    for (int i = 0; i < Arr.GetLength(0); i++)
    {
      for (int j = 0; j < Arr.GetLength(1); j++)
      {
        Rhino.RhinoApp.Write(Arr[i, j, 0] + " ");
      }
      Rhino.RhinoApp.WriteLine("Loop Runs" + i.ToString());
    }
    return;
  }

  static int[,,] InitializeZeroMatrice(int width, int length, int levelNumber)
  {
    var areaArray = new int[width, length, levelNumber];

    for (int k = 0; k < levelNumber; k++)
    {
      for (int i = 0; i < width; i++)
      {
        for (int j = 0; j < length; j++)
        {
          areaArray[i, j, k] = 0;
        }
      }
    }
    return areaArray;
  }

  /* The Color lists keep the colors in a seperate List in order to choose within them easily instead of searching where they are... */
  static List<int> entranceList = new List<int>();
  static List<int> commonList = new List<int>();
  static List<int> wetAreaList = new List<int>();
 /* static List<int> kitchenList = new List<int>();
  static List<int> commonAreaList = new List<int>();*/

  /**           these counters are used for starting the límitations counts.         **/

  //static int entranceCounter = 1;
 // static int commonCounter = 1;
  //static int wetAreaCounter = 1;
  /*static int kitchenCounter = 1;
  static int commonAreaCounter = 1;*/
  /**           these limits are used for defining max distance that zone can spread.  **/

  //static int entranceLimit = 200;
 // static int commonLimit = 200;
  //static int wetAreaLimit = 200;
  /*static int kitchenLimit = 200;
  static int commonAreaLimit = 100;*/

  static void StartZones(int[,,] arr)
  {
    /**
     * Randomly Starts the color. Takes the Color lists as argumnts
     * (We can delete these argumnents and it can get them as local referance
     * in our case it gives us a chance to choose what to initilize)
     * **/

    Random rand = new Random();
    //----------------------
    /* GetLength(0) and GetLength(1) might be set as variable */
    //Array.GetLength(0) gives the column lenght in other words length of an array
    //Array.GetLength(1) gives the row lenght in other words width of an array
    var a = rand.Next(arr.GetLength(0) / 2, arr.GetLength(0) / 2);
    var b = rand.Next(0, 2);

    Rhino.RhinoApp.WriteLine("started");
    entranceList.AddRange(new int[2] { a, b }); //AddRange ==> Adds multiple elements to a List . We use mod%2 to call the index of the point back instead of stacking them as an another List(or Array) in our list.
    arr[a, b, 0] = 1;// entrance Starting Point
    //----------------------

    b = rand.Next(0, arr.GetLength(1));
    a = rand.Next(0, arr.GetLength(0));

    commonList.AddRange(new int[2] { a, b });
    arr[a, b, 0] = 2; // common Starting Point
    //----------------------
    a = rand.Next(0, arr.GetLength(0));
    b = rand.Next(0, arr.GetLength(1));

    wetAreaList.AddRange(new int[2] { a, b });
    arr[a, b, 0] = 3; // wetArea Starting Point
    //----------------------
    a = rand.Next(0, arr.GetLength(0));
    b = rand.Next(0, arr.GetLength(1));
/*
    kitchenList.AddRange(new int[2] { a, b });
    arr[a, b, 0] = 4; // kitchen Starting Point
    //----------------------
    a = rand.Next(0, arr.GetLength(0));
    b = rand.Next(0, arr.GetLength(1));

    commonAreaList.AddRange(new int[2] { a, b });
    arr[a, b, 0] = 5; // commonArea Starting Point
    //----------------------
  */
  }
        /* Calculates the distance between initial point in the color and the possible new point!
         *  (if the possible new point is too far from inital point eleminate it.) */
  static double distanceCalculate(List<int> spaceCoordList, int x2, int y2, int cellSize)
  {
    var distance = cellSize * Math.Sqrt((y2 - spaceCoordList[1]) * (y2 - spaceCoordList[1]) + (x2 - spaceCoordList[0]) * (x2 - spaceCoordList[0]));
    return distance;
  }

  static void Evaluate()
  {
    // according to relations give score to the created zones
    // get the centers of the zones and acoording to the distances and created sizes give
    //positive or negative points and if score is not acceptable re-run and create variatians.
  }


  static void noiseFilter (int [,,] arr, int type, int iterationNumber, int controlNumber)
  {
    if(type == 0)
    {
      for( int loop = 0 ; loop < iterationNumber ; loop++ )
      {
        List < int> surrounding = new List<int>();
        for(int i = 1 ; i < arr.GetLength(0) - 1 ;i++)
        {
          for(int j = 1 ; j < arr.GetLength(1) - 1 ;j++)
          {
            for(int x = -1 ; x < 2;x++)
            {
              for(int y = -1 ; y < 2;y++)
              {
                if(!(x == y && x == 0))
                {

                  surrounding.Add(arr[i + x, j + y, 0]);
                }
              }
            }
            for (int v = 0 ; v < 6 ;v++) // 6 is the number of the zones including  empty cells
            {
              int count = (from z in surrounding where z == v select z).Count();
              if ( count >= controlNumber )
              {
                arr[i, j, 0] = v;
              }
            }
            surrounding.Clear();
            surrounding.TrimExcess();
          }
        }
      }
    }

    if(type == 1)
    {
      for( int loop = 0 ; loop < iterationNumber ; loop++ )
      {
        List < int> surrounding = new List<int>();
        for(int i = 1 ; i < arr.GetLength(0) - 1 ;i++)
        {
          for(int j = 1 ; j < arr.GetLength(1) - 1 ;j++)
          {
            for(int x = -1 ; x < 2;x++)
            {
              for(int y = -1 ; y < 2;y++)
              {
                if(!(x == y && x == 0) && ( (x + y == 1 ) || (x + y == -1 )) )
                {
                  surrounding.Add(arr[i + x, j + y, 0]);
                }
              }
            }

            for (int v = 0 ; v < 6 ;v++) // 6 is the number of the zones including  empty cells
            {
              int count = (from z in surrounding where z == v select z).Count();
              if ( count >= 2 )
              {
                arr[i, j, 0] = v;
              }
            }
            surrounding.Clear();
            surrounding.TrimExcess();
          }
        }
      }
    }
  }

  static void Spread(int[,,] arr, ref double spaceSize, List<int> spaceCoordList, ref int counter, int spaceLimit, int cellSize)
  {
        /*ARGUMENTS
     * The main array which has rectangular form(will be 3d in short) ,
     * spaceSize = Maximum limit that can grow.  ,
     * spaceCoordList =  the cells of the zone which has been already defined. )
     */
    var rand = new Random();
    var directionList = new List<int>();
    int Xcoord;
    int Ycoord;
    bool draw = false;
    int trycount = 0;

    while (draw == false && counter <= spaceSize)
    {
      if (counter <= spaceSize ) //Can be deleted. The condition is added to the While Loop Conditions.
      {
        var randomCellIndex = rand.Next(spaceCoordList.Count / 2);

        Xcoord = spaceCoordList[2 * randomCellIndex];
        Ycoord = spaceCoordList[2 * randomCellIndex + 1];

        if (Xcoord < arr.GetLength(0) - 1 && Xcoord > 0 && Ycoord > 0 && Ycoord < arr.GetLength(1) - 1)
        {
          /* Check the conditions INSIDE borders */
          if (arr[Xcoord + 1, Ycoord, 0] == 0 && distanceCalculate(spaceCoordList, Xcoord + 1, Ycoord, cellSize) < spaceLimit ) // Check if possible new cell is still white or not!
            directionList.AddRange(new int[2] { (Xcoord + 1), Ycoord }); //Store possible spread directions in a list.

          if (arr[Xcoord - 1, Ycoord, 0] == 0 && distanceCalculate(spaceCoordList, Xcoord - 1, Ycoord, cellSize) < spaceLimit)
            directionList.AddRange(new int[2] { (Xcoord - 1), Ycoord }); //Store possible spread directions in a list.

          if (arr[Xcoord, Ycoord + 1, 0] == 0 && distanceCalculate(spaceCoordList, Xcoord, Ycoord + 1, cellSize) < spaceLimit)
            directionList.AddRange(new int[2] { (Xcoord), Ycoord + 1 }); //Store possible spread directions in a list.

          if (arr[Xcoord, Ycoord - 1, 0] == 0 && distanceCalculate(spaceCoordList, Xcoord, Ycoord - 1, cellSize) < spaceLimit)
            directionList.AddRange(new int[2] { (Xcoord), (Ycoord - 1) }); //Store possible spread directions in a list.

          if (directionList.Count > 0)
          {
            var randomIndex = rand.Next(directionList.Count / 2);
            int a = directionList[2 * randomIndex];
            int b = directionList[2 * randomIndex + 1];

            arr[a, b, 0] = arr[Xcoord, Ycoord, 0];

            spaceCoordList.AddRange(new int[2] { a, b });

            directionList.Clear();
            directionList.TrimExcess();
            draw = true;
            counter++;
          }
          else
          {
            trycount++;
            if (trycount >= spaceCoordList.Count)
            {
              draw = true;
              //Print("trycountNumber is ={0}", trycount);
            }
          }
        }

          /* EDGE CONDITIONS */
          //RIGHT
        else if (Xcoord == (arr.GetLength(0) - 1) && Ycoord != 0 && Ycoord != (arr.GetLength(1) - 1))
        {
          if (arr[Xcoord - 1, Ycoord, 0] == 0 && distanceCalculate(spaceCoordList, Xcoord - 1, Ycoord, cellSize) < spaceLimit )
            directionList.AddRange(new int[2] { (Xcoord - 1), (Ycoord) }); //Store possible spread directions in a list.
          if (arr[Xcoord, Ycoord + 1, 0] == 0 && distanceCalculate(spaceCoordList, Xcoord, Ycoord + 1, cellSize) < spaceLimit )
            directionList.AddRange(new int[2] { (Xcoord ), (Ycoord + 1) }); //Store possible spread directions in a list.
          if (arr[Xcoord, Ycoord - 1, 0] == 0 && distanceCalculate(spaceCoordList, Xcoord, Ycoord - 1, cellSize) < spaceLimit )
            directionList.AddRange(new int[2] { (Xcoord ), (Ycoord - 1) }); //Store possible spread directions in a list.

          if (directionList.Count > 0)
          {
            var randomIndex = rand.Next(directionList.Count / 2);
            int a = directionList[2 * randomIndex];
            int b = directionList[2 * randomIndex + 1];

            arr[a, b, 0] = arr[Xcoord, Ycoord, 0];

            spaceCoordList.AddRange(new int[2] { a, b });

            directionList.Clear();
            directionList.TrimExcess();
            draw = true;
            counter++;
          }
          else
          {
            trycount++;
            if (trycount >= spaceCoordList.Count)
            {
              draw = true;
              //Print("trycountNumber is ={0}", trycount);
            }
          }
        }

          //Left
        else if (Xcoord == 0 && Ycoord != 0 && Ycoord != (arr.GetLength(1) - 1))
        {

          if (arr[Xcoord + 1, Ycoord, 0] == 0 && distanceCalculate(spaceCoordList, Xcoord + 1, Ycoord, cellSize) < spaceLimit )
            directionList.AddRange(new int[2] { (Xcoord + 1), (Ycoord) }); //Store possible spread directions in a list.
          if (arr[Xcoord, Ycoord + 1, 0] == 0 && distanceCalculate(spaceCoordList, Xcoord, Ycoord + 1, cellSize) < spaceLimit )
            directionList.AddRange(new int[2] { (Xcoord ), (Ycoord + 1) }); //Store possible spread directions in a list.
          if (arr[Xcoord, Ycoord - 1, 0] == 0 && distanceCalculate(spaceCoordList, Xcoord, Ycoord - 1, cellSize) < spaceLimit )
            directionList.AddRange(new int[2] { (Xcoord ), (Ycoord - 1) }); //Store possible spread directions in a list.
          if (directionList.Count > 0)
          {
            var randomIndex = rand.Next(directionList.Count / 2);
            int a = directionList[2 * randomIndex];
            int b = directionList[2 * randomIndex + 1];

            arr[a, b, 0] = arr[Xcoord, Ycoord, 0];

            spaceCoordList.AddRange(new int[2] { a, b });

            directionList.Clear();
            directionList.TrimExcess();
            draw = true;
            counter++;
          }
          else
          {
            trycount++;
            if (trycount >= spaceCoordList.Count)
            {
              draw = true;
              //Print("trycountNumber is ={0}", trycount);
            }
          }

        }
          //TOP
        else if ((Ycoord == arr.GetLength(1) - 1) && Xcoord != 0 && Xcoord != (arr.GetLength(0) - 1))
        {

          if (arr[Xcoord, Ycoord - 1, 0] == 0 && distanceCalculate(spaceCoordList, Xcoord, Ycoord - 1, cellSize) < spaceLimit )
            directionList.AddRange(new int[2] { (Xcoord ), (Ycoord - 1) }); //Store possible spread directions in a list.
          if (arr[Xcoord + 1, Ycoord, 0] == 0 && distanceCalculate(spaceCoordList, Xcoord + 1, Ycoord, cellSize) < spaceLimit )
            directionList.AddRange(new int[2] { (Xcoord + 1 ), (Ycoord ) }); //Store possible spread directions in a list.
          if (arr[Xcoord - 1, Ycoord, 0] == 0 && distanceCalculate(spaceCoordList, Xcoord - 1, Ycoord, cellSize) < spaceLimit )
            directionList.AddRange(new int[2] { (Xcoord - 1), (Ycoord ) }); //Store possible spread directions in a list.
          if (directionList.Count > 0)
          {
            var randomIndex = rand.Next(directionList.Count / 2);
            int a = directionList[2 * randomIndex];
            int b = directionList[2 * randomIndex + 1];

            arr[a, b, 0] = arr[Xcoord, Ycoord, 0];

            spaceCoordList.AddRange(new int[2] { a, b });

            directionList.Clear();
            directionList.TrimExcess();
            draw = true;
            counter++;
          }
          else
          {
            trycount++;
            if (trycount >= spaceCoordList.Count)
            {
              draw = true;
              //Print("trycountNumber is ={0}", trycount);
            }
          }
        }
          //BOTTOM
        else if (Ycoord == 0 && Xcoord != 0 && Xcoord != (arr.GetLength(0) - 1))
        {
          if (arr[Xcoord, Ycoord + 1, 0] == 0 && distanceCalculate(spaceCoordList, Xcoord, Ycoord + 1, cellSize) < spaceLimit )
            directionList.AddRange(new int[2] { (Xcoord ), (Ycoord + 1) }); //Store possible spread directions in a list.
          if (arr[Xcoord + 1, Ycoord, 0] == 0 && distanceCalculate(spaceCoordList, Xcoord + 1, Ycoord, cellSize) < spaceLimit )
            directionList.AddRange(new int[2] { (Xcoord + 1 ), (Ycoord ) }); //Store possible spread directions in a list.
          if (arr[Xcoord - 1, Ycoord, 0] == 0 && distanceCalculate(spaceCoordList, Xcoord - 1, Ycoord, cellSize) < spaceLimit )
            directionList.AddRange(new int[2] { (Xcoord - 1), (Ycoord ) }); //Store possible spread directions in a list.
          if (directionList.Count > 0)
          {
            var randomIndex = rand.Next(directionList.Count / 2);
            int a = directionList[2 * randomIndex];
            int b = directionList[2 * randomIndex + 1];

            arr[a, b, 0] = arr[Xcoord, Ycoord, 0];

            spaceCoordList.AddRange(new int[2] { a, b });

            directionList.Clear();
            directionList.TrimExcess();
            draw = true;
            counter++;
          }
          else
          {
            trycount++;
            if (trycount >= spaceCoordList.Count)
            {
              draw = true;
              //Print("trycountNumber is ={0}", trycount);
            }
          }
        }

          //LEFT BOTTOM
        else if (Xcoord == 0 && Ycoord == 0)
        {
          if (arr[Xcoord, Ycoord + 1, 0] == 0 && distanceCalculate(spaceCoordList, Xcoord, Ycoord + 1, cellSize) < spaceLimit)
            directionList.Add(Xcoord); directionList.Add(Ycoord + 1);

          if (arr[Xcoord + 1, Ycoord, 0] == 0 && distanceCalculate(spaceCoordList, Xcoord + 1, Ycoord, cellSize) < spaceLimit)
            directionList.Add(Xcoord + 1); directionList.Add(Ycoord);

          if (directionList.Count > 0)
          {

            var randomIndex = rand.Next(directionList.Count / 2);

            int a = directionList[2 * randomIndex];
            int b = directionList[2 * randomIndex + 1];

            arr[a, b, 0] = arr[Xcoord, Ycoord, 0];

            spaceCoordList.AddRange(new int[2] { a, b });

            directionList.Clear();
            directionList.TrimExcess();
            draw = true;

            counter++;
            //Print(" Counter Number is : {0}", counter);
          }
          else
          {
            trycount++;
            if (trycount >= spaceCoordList.Count)
            {
              draw = true;
              //Print("trycountNumber is ={0}", trycount);
            }
          }
        }
          //LEFT  TOP
          /*
          else if (Xcoord == 0 && Ycoord == (arr.GetLength(1) - 1))
          {
          if (arr[Xcoord + 1, Ycoord] == 0)
          directionList.Add(Xcoord + 1); directionList.Add(Ycoord);

          if (arr[Xcoord, Ycoord - 1] == 0)
          directionList.Add(Xcoord); directionList.Add(Ycoord - 1);

          if (directionList.Count > 0)
          {
          var randomIndex = rand.Next(directionList.Count / 2);

          int a = directionList[2 * randomIndex];
          int b = directionList[2 * randomIndex + 1];

          Rhino.RhinoApp.WriteLine("Left Top "  +  a +  " "  +  b);
          arr[a, b] = arr[Xcoord, Ycoord];

          spaceCoordList.AddRange(new int[2] { a, b });

          directionList.Clear();
          directionList.TrimExcess();
          draw = true;

          counter++;
          //Print(" Counter Number is : {0}", counter);
          }
          else
          {
          trycount++;
          if (trycount >= spaceCoordList.Count)
          {
          draw = true;
          //Print("trycountNumber is ={0}", trycount);
          }
          }
          }
          */
          /*
          //RIGHT TOP
          else if (Xcoord == (arr.GetLength(0) - 1) && Ycoord == (arr.GetLength(1) - 1))
          {
          if (arr[Xcoord, Ycoord - 1] == 0)
          directionList.Add(Xcoord); directionList.Add(Ycoord - 1);

          if (arr[Xcoord - 1, Ycoord] == 0)
          directionList.Add(Xcoord - 1); directionList.Add(Ycoord);

          if (directionList.Count > 0)
          {
          var randomIndex = rand.Next(directionList.Count / 2);

          int a = directionList[2 * randomIndex];
          int b = directionList[2 * randomIndex + 1];
          Rhino.RhinoApp.WriteLine(" Right top "+ a + " " + b);
          arr[a, b] = arr[Xcoord, Ycoord];

          //spaceCoordList.AddRange(new int[2] { a, b });

          directionList.Clear();
          directionList.TrimExcess();
          draw = true;

          counter++;
          //Print(" Counter Number is : {0}", counter);
          }
          else
          {
          trycount++;
          if (trycount >= spaceCoordList.Count)
          {
          draw = true;
          //Print("trycountNumber is ={0}", trycount);
          }
          }
          }
          */
          //RIGHT BOTTOM
        else if (Xcoord == (arr.GetLength(0) - 1) && Ycoord == 0)
        {
          if (arr[Xcoord, Ycoord + 1, 0] == 0)
            directionList.Add(Xcoord); directionList.Add(Ycoord + 1);

          if (arr[Xcoord - 1, Ycoord, 0] == 0)
            directionList.Add(Xcoord - 1); directionList.Add(Ycoord);

          if (directionList.Count > 0)
          {
            var randomIndex = rand.Next(directionList.Count / 2);

            int a = directionList[2 * randomIndex];
            int b = directionList[2 * randomIndex + 1];

            arr[a, b, 0] = arr[Xcoord, Ycoord, 0];

            spaceCoordList.AddRange(new int[2] { a, b });

            directionList.Clear();
            directionList.TrimExcess();

            draw = true;
            counter++;
            //Print(" Counter Number is : {0}", counter);
          }
          else
          {
            trycount++;
            if (trycount >= spaceCoordList.Count)
            {
              draw = true;
              //Print("trycountNumber is ={0}", trycount);
            }
          }
        }
        /* EDGE CONDITIONS */
      }
    }

  }




    /* Instead of wrting methods seperately in main program, it is better to use class based
     informations to keep things organized, we are not yet transsferentrance methods here but we created the str.*/

    /*
    public class Zone
    {
        public string Name;
        public int SpaceLimit;
        public Int16 SpaceSize;
        public int Counter;
        public List<Int16> SpaceList;

        public void Describe()
        {
            Console.WriteLine("Hey this zone is{ 0} ", Name);
        }

        public Zone()
        {
           // SpaceList = new List<int>();
        }

        public Zone(string name, int spaceLimit,int spacesize,int counter, List<int> SpaceList)
        :this()
        {
        }
        static void InitializeZeroMatrice() { }
        static void startZones() { }
        public void SpreadZones() { }

    }
    */
# ---------- end c_script_6 ----------
box_59 = Box(c_script_6.Furnitures)
deconstruct_box_32 = DeconstructBox(Box=box_59)  # -> Plane, X, Y, Z
panel_157 = Panel(deconstruct_box_32.Plane)
panel_158 = Panel(deconstruct_box_32.Y)
panel_159 = Panel(deconstruct_box_32.X)
panel_160 = Panel(deconstruct_box_32.Z)
deconstruct_domain_52 = DeconstructDomain(Domain=panel_154)  # -> Start, End
deconstruct_domain_53 = DeconstructDomain(Domain=panel_156)  # -> Start, End
deconstruct_domain_54 = DeconstructDomain(Domain=panel_155)  # -> Start, End
deconstruct_domain_55 = DeconstructDomain(Domain=panel_158)  # -> Start, End
deconstruct_domain_56 = DeconstructDomain(Domain=panel_159)  # -> Start, End
box_60 = Box(c_script_6.Bxx)
panel_161 = Panel(deconstruct_domain_53.End)
panel_162 = Panel(deconstruct_domain_52.End)
panel_163 = Panel(deconstruct_domain_54.End)
panel_164 = Panel(box_60)
panel_165 = Panel(deconstruct_domain_55.End)
panel_166 = Panel(deconstruct_domain_56.End)
list_item_5 = ListItem(List=c_script_6.Furnitures, Index=Slider(8, range=0..10), Wrap=Toggle(False))
# White Cells
panel_167 = Panel(c_script_6.out)
colour_swatch_17 = ColourSwatch(SwatchColor=RGB(255, 255, 0))
colour_swatch_18 = ColourSwatch(SwatchColor=RGB(0, 0, 0))
colour_swatch_19 = ColourSwatch(SwatchColor=RGB(255, 255, 255))
colour_swatch_20 = ColourSwatch(SwatchColor=RGB(240, 240, 200))
colour_swatch_21 = ColourSwatch(SwatchColor=RGB(240, 200, 200))
colour_swatch_22 = ColourSwatch(SwatchColor=RGB(150, 200, 255))

# ---- group: Visualize as 3D Boxes
number_slider_101 = Slider(0.428, range=0..1)
create_material_17 = CreateMaterial(Diffuse=colour_swatch_20, Specular=RGB(255, 255, 255), Emission=RGB(0, 0, 0), Transparency=number_slider_101, Shine=0)
create_material_18 = CreateMaterial(Diffuse=colour_swatch_17, Specular=RGB(255, 255, 255), Emission=RGB(0, 0, 0), Transparency=number_slider_101, Shine=0)
create_material_19 = CreateMaterial(Diffuse=colour_swatch_21, Specular=RGB(255, 255, 255), Emission=RGB(0, 0, 0), Transparency=number_slider_101, Shine=0)
create_material_20 = CreateMaterial(Diffuse=colour_swatch_22, Specular=RGB(255, 255, 255), Emission=RGB(0, 0, 0), Transparency=number_slider_101, Shine=0)
create_material_21 = CreateMaterial(Diffuse=colour_swatch_18, Specular=RGB(255, 255, 255), Emission=RGB(0, 0, 0), Transparency=number_slider_101, Shine=0)
create_material_22 = CreateMaterial(
    Diffuse=colour_swatch_19,
    Specular=RGB(255, 255, 255),
    Emission=RGB(0, 0, 0),
    Transparency=Slider(0.544, range=0..1),
    Shine=0)
custom_preview_17 = CustomPreview(Geometry=c_script_6.EntranceBoxes, Material=create_material_17)
custom_preview_18 = CustomPreview(Geometry=c_script_6.CommonBoxes, Material=create_material_19)
custom_preview_19 = CustomPreview(Geometry=c_script_6.WetAreaBoxes, Material=create_material_20)
custom_preview_20 = CustomPreview(Geometry=c_script_6.K, Material=create_material_21)
custom_preview_21 = CustomPreview(Geometry=c_script_6.W, Material=create_material_22)
custom_preview_22 = CustomPreview(Geometry=c_script_6.Y, Material=create_material_18)

# ----
create_material_23 = CreateMaterial(
    Diffuse=ColourSwatch(SwatchColor=RGB(0, 0, 0)),
    Specular=RGB(255, 255, 255),
    Emission=RGB(0, 0, 0),
    Transparency=Slider(0, range=0..1),
    Shine=0)
create_material_24 = CreateMaterial(
    Diffuse=ColourSwatch(SwatchColor=RGB(0, 0, 0)),
    Specular=RGB(255, 255, 255),
    Emission=RGB(0, 0, 0),
    Transparency=Slider(0.611, range=0..1),
    Shine=0)
custom_preview_23 = CustomPreview(Geometry=c_script_6.Furnitures, Material=create_material_23)
custom_preview_24 = CustomPreview(Geometry=c_script_6.FurnituresMargins, Material=create_material_24)
list_length_13 = ListLength(List=c_script_6.EntranceBoxes)
list_length_14 = ListLength(List=c_script_6.CommonBoxes)
list_length_15 = ListLength(List=c_script_6.W)
list_length_16 = ListLength(List=c_script_6.WetAreaBoxes)
list_length_17 = ListLength(List=c_script_6.Y)
list_length_18 = ListLength(List=c_script_6.K)
multiplication_31 = Multiplication(A=list_length_14, B=division_9)
multiplication_32 = Multiplication(A=list_length_13, B=division_9)
multiplication_33 = Multiplication(A=list_length_15, B=division_9)
multiplication_34 = Multiplication(A=list_length_16, B=division_9)
multiplication_35 = Multiplication(A=list_length_17, B=division_9)
multiplication_36 = Multiplication(A=list_length_18, B=division_9)
panel_168 = Panel(multiplication_32)
panel_169 = Panel(multiplication_33)
panel_170 = Panel(multiplication_31)
panel_171 = Panel(multiplication_34)
panel_172 = Panel(multiplication_35)
panel_173 = Panel(multiplication_36)
number_slider_102 = Slider(15, range=0..100)
concatenate_15 = Concatenate(Fragment_A=" Empty Space= ", Fragment_B=panel_169, Fragment_C="m2 ")
concatenate_16 = Concatenate(Fragment_A=" Entrance = ", Fragment_B=panel_168, Fragment_C="m2 ")
concatenate_17 = Concatenate(Fragment_A=" CommonArea = ", Fragment_B=panel_170, Fragment_C="m2 ")
concatenate_18 = Concatenate(Fragment_A="Wet Area = ", Fragment_B=panel_171, Fragment_C="m2 ")
concatenate_19 = Concatenate(Fragment_A=" Kitchen = ", Fragment_B=panel_172, Fragment_C="m2 ")
concatenate_20 = Concatenate(Fragment_A=" Common Area = ", Fragment_B=panel_173, Fragment_C=" m2 ")
panel_174 = Panel(concatenate_15)
panel_175 = Panel(concatenate_16)
panel_176 = Panel(concatenate_17)
panel_177 = Panel(concatenate_18)
panel_178 = Panel(concatenate_19)
panel_179 = Panel(concatenate_20)
panel_180 = Panel("120,-200")
text_tag_3d_15 = TextTag3D(Location="0,-50", Text=concatenate_16, Size=number_slider_102, Colour=colour_swatch_20, Justification=7)
text_tag_3d_16 = TextTag3D(Location="0,-80", Text=concatenate_17, Size=number_slider_102, Colour=colour_swatch_21, Justification=7)
text_tag_3d_17 = TextTag3D(Location="0,-140", Text=concatenate_19, Size=number_slider_102, Colour=colour_swatch_17, Justification=7)
text_tag_3d_18 = TextTag3D(Location="0,-110", Text=concatenate_18, Size=number_slider_102, Colour=colour_swatch_22, Justification=7)
text_tag_3d_19 = TextTag3D(Location="0,-140", Text=concatenate_15, Size=number_slider_102, Colour=colour_swatch_19, Justification=7)
text_tag_3d_20 = TextTag3D(Location="240,-170", Text=concatenate_20, Size=number_slider_102, Colour=colour_swatch_18, Justification=7)
mass_addition_3 = MassAddition(Input=[multiplication_31, multiplication_32, multiplication_34, multiplication_35, multiplication_36, multiplication_33])  # -> flatten(Result), PartialResults
list_item_6 = ListItem(List=mass_addition_3.Result, Index=Slider(1, range=0..1), Wrap=True)
panel_181 = Panel(list_item_6)
concatenate_21 = Concatenate(Fragment_A=" Total Area =", Fragment_B=panel_181, Fragment_C="m2 ")
panel_182 = Panel(concatenate_21)
text_tag_3d_21 = TextTag3D(Location="240,-100", Text=concatenate_21, Size=number_slider_102, Justification=7)
