# Grasshopper definition CemGrasshopperC#68.gh (Grasshopper 1.0.7)
# plug-ins: Human

number_slider = Slider(59.6, range=0..200)  # disabled
number_slider_2 = Slider(81, range=0..200)  # disabled
number_slider_3 = Slider(54.5, range=0..200)  # disabled
xy_plane = XYPlane(Origin=Point(0, 650, 0))  # disabled

number_slider_4 = Slider(35, range=0..200)  # disabled
number_slider_5 = Slider(50, range=0..200)  # disabled
number_slider_6 = Slider(40, range=0..200)  # disabled
xy_plane_2 = XYPlane(Origin=Point(0, 900, 0))  # disabled

number_slider_7 = Slider(100, range=0..200)  # disabled
number_slider_8 = Slider(60, range=0..200)  # disabled
number_slider_9 = Slider(62, range=0..200)  # disabled
xy_plane_3 = XYPlane(Origin=Point(0, 1200, 0))  # disabled

# ----
# Furnitures!
xy_plane_4 = XYPlane(Origin=Point(0, 0, 0))

number_slider_10 = Slider(62.1, range=0..200)  # disabled
number_slider_11 = Slider(50, range=0..200)  # disabled
number_slider_12 = Slider(35, range=0..200)  # disabled
xy_plane_5 = XYPlane(Origin=Point(0, 400, 0))  # disabled

number_slider_13 = Slider(27.5, range=0..200)  # disabled
number_slider_14 = Slider(54.5, range=0..200)  # disabled
number_slider_15 = Slider(5, range=0..200)  # disabled
xy_plane_6 = XYPlane(Origin=Point(0, 200, 0))  # disabled

# ----
# Entrance
vector_xyz = VectorXYZ(XComponent=Slider(806, range=0..1000), YComponent=0, ZComponent=0)  # -> Vector, Length
vector_xyz_2 = VectorXYZ(XComponent=Slider(1000, range=0..1000), YComponent=0, ZComponent=0)  # -> Vector, Length
vector_xyz_3 = VectorXYZ(XComponent=Slider(1392, range=0..2000), YComponent=0, ZComponent=0)  # -> Vector, Length
closet = DomainBox(Base=vector_xyz_3.Vector, X=Slider(230, range=110..230), Y=Slider(60, range=55..65), Z=Slider(210, range=2..220))
exterior_door = DomainBox(Base=vector_xyz.Vector, X=Slider(100, range=90..100), Y=Slider(10, range=5..15), Z=Slider(200, range=150..220))
changeover_zone = DomainBox(Base=vector_xyz_2.Vector, X=Slider(60, range=50..65), Y=Slider(40, range=35..45), Z=Slider(2, range=2..220))

number_slider_16 = Slider(243, range=0..1000)  # disabled
number_slider_17 = Slider(450, range=0..1000)  # disabled
number_slider_18 = Slider(623, range=0..1000)  # disabled
number_slider_19 = Slider(54, range=40..60)  # disabled
number_slider_20 = Slider(45, range=40..60)  # disabled
number_slider_21 = Slider(89, range=80..100)  # disabled
number_slider_22 = Slider(85, range=40..90)  # disabled
number_slider_23 = Slider(34, range=30..40)  # disabled
number_slider_24 = Slider(13, range=5..15)  # disabled
number_slider_25 = Slider(29, range=25..30)  # disabled
number_slider_26 = Slider(5, range=5..10)  # disabled
number_slider_27 = Slider(62, range=60..80)  # disabled
# Kitchen
vector_xyz_4 = VectorXYZ(XComponent=Slider(0, range=0..1000), YComponent=0, ZComponent=0)  # -> Vector, Length
vector_xyz_5 = VectorXYZ(XComponent=number_slider_16, YComponent=0, ZComponent=0)  # -> Vector, Length; disabled
vector_xyz_6 = VectorXYZ(XComponent=number_slider_18, YComponent=0, ZComponent=0)  # -> Vector, Length; disabled
vector_xyz_7 = VectorXYZ(XComponent=number_slider_17, YComponent=0, ZComponent=0)  # -> Vector, Length; disabled
multipurpose_table_for_2 = DomainBox(Base=vector_xyz_4.Vector, X=Slider(76, range=50..200), Y=Slider(107, range=100..120), Z=Slider(75, range=50..200))
sitting_unit = DomainBox(Base=vector_xyz_5.Vector, X=number_slider_20, Y=number_slider_19, Z=number_slider_21)  # disabled
monitor = DomainBox(Base=vector_xyz_7.Vector, X=number_slider_22, Y=number_slider_26, Z=number_slider_27)  # disabled
first_aid_closet = DomainBox(Base=vector_xyz_6.Vector, X=number_slider_23, Y=number_slider_24, Z=number_slider_25)  # disabled

X = Slider(60, range=45..60)
# Sitting Unit
Y = Slider(60, range=45..60)
rectangle = Rectangle(Plane=PlaneXY(2100, 0, 0), XSize=X, YSize=Y, Radius=0)  # -> Rectangle, Length
Z = Slider(40, range=40..50)
sitting_unit_2 = BoxRectangle(Rectangle=rectangle.Rectangle, Height=Z)

# ----
# Sink
X_2 = Slider(30, range=26..40)
# Stove
Y_2 = Slider(58, range=48..58)
rectangle_2 = Rectangle(Plane=PlaneXY(1500, 0, 0), XSize=X_2, YSize=Y_2, Radius=0)  # -> Rectangle, Length
Z_2 = Slider(15, range=15..22)
stove = BoxRectangle(Rectangle=rectangle_2.Rectangle, Height=Z_2)

X_3 = Slider(120, range=110..140)
# Table 1
Y_3 = Slider(60, range=60..100)
Z_3 = Slider(6, range=2..6)
rectangle_3 = Rectangle(Plane=PlaneXY(800, 0, 0), XSize=X_3, YSize=Y_3, Radius=0)  # -> Rectangle, Length
table_1 = BoxRectangle(Rectangle=rectangle_3.Rectangle, Height=Z_3)

# ----
# Counter 2
number_slider_28 = Slider(75, range=75..100)

# ----
# Drawer
X_4 = Slider(60, range=60..100)
Y_4 = Slider(60, range=50..65)
Z_4 = Slider(18, range=18..25)
rectangle_4 = Rectangle(Plane=PlaneXY(400, 0, 0), XSize=X_4, YSize=Y_4, Radius=0)  # -> Rectangle, Length
drawer = BoxRectangle(Rectangle=rectangle_4.Rectangle, Height=Z_4)

X_5 = Slider(210, range=200..220)
# Lower Bed
Y_5 = Slider(120, range=90..120)
rectangle_5 = Rectangle(Plane=PlaneXY(3000, 0, 0), XSize=X_5, YSize=Y_5, Radius=0)  # -> Rectangle, Length
Z_5 = Slider(20, range=20..40)
lower_bed = BoxRectangle(Rectangle=rectangle_5.Rectangle, Height=Z_5)

stove_2 = DomainBox(Base=PlaneXY(0, 0, 0), X=number_slider_13, Y=number_slider_14, Z=number_slider_15)  # disabled
sink = DomainBox(Base=PlaneXY(0, 0, 0), X=Slider(54, range=0..200), Y=Slider(44, range=0..200), Z=Slider(19, range=0..200))
counter = DomainBox(Base=PlaneXY(0, 0, 0), X=number_slider_7, Y=number_slider_8, Z=number_slider_9)  # disabled

X_6 = Slider(60, range=55..70)
# Fridge
Y_6 = Slider(60, range=50..65)
Z_6 = Slider(79, range=72..79)
rectangle_6 = Rectangle(Plane=PlaneXY(600, 0, 0), XSize=X_6, YSize=Y_6, Radius=0)  # -> Rectangle, Length
fridge = BoxRectangle(Rectangle=rectangle_6.Rectangle, Height=Z_6)

# ----
# Counter 1
number_slider_29 = Slider(75, range=75..100)
cupboard = DomainBox(Base=PlaneXY(0, 0, 0), X=number_slider_5, Y=number_slider_4, Z=number_slider_6)  # disabled
mıcrowave = DomainBox(Base=PlaneXY(0, 0, 0), X=number_slider_10, Y=number_slider_11, Z=number_slider_12)  # disabled
frıdge = DomainBox(Base=PlaneXY(0, 0, 0), X=number_slider, Y=number_slider_3, Z=number_slider_2)  # disabled

X_7 = Slider(120, range=100..140)
Y_7 = Slider(60, range=50..65)
Z_7 = Slider(3, range=3..6)

X_8 = Slider(60, range=38..60)
Y_8 = Slider(44, range=38..50)
Z_8 = Slider(22, range=13..22)
rectangle_7 = Rectangle(Plane=PlaneXY(1300, 0, 0), XSize=X_8, YSize=Y_8, Radius=0)  # -> Rectangle, Length
table_2 = BoxRectangle(Rectangle=rectangle_7.Rectangle, Height=Z_8)

Z_9 = Slider(3, range=3..6)
Y_9 = Slider(60, range=50..65)
# Aşağıda olması gereken objeler
X_9 = Slider(120, range=100..140)

X_10 = Slider(60, range=60..100)
# Table 2
Y_10 = Slider(120, range=110..140)
Z_10 = Slider(6, range=2..6)
rectangle_8 = Rectangle(Plane=PlaneXY(1100, 0, 0), XSize=X_10, YSize=Y_10, Radius=0)  # -> Rectangle, Length
table_2_2 = BoxRectangle(Rectangle=rectangle_8.Rectangle, Height=Z_10)

vector_xyz_8 = VectorXYZ(XComponent=0, YComponent=0, ZComponent=number_slider_28)  # -> Vector, Length
vector_xyz_9 = VectorXYZ(XComponent=0, YComponent=0, ZComponent=number_slider_29)  # -> Vector, Length
counter_1 = DomainBox(Base=vector_xyz_8.Vector, X=X_7, Y=Y_7, Z=Z_7)
# Margins!
custom_preview_materials = CustomPreviewMaterials(Geometry=sink, DiffuseColor=RGB(174, 215, 230), Transparency=Slider(0, range=0..1))
counter_1_2 = DomainBox(Base=vector_xyz_9.Vector, X=X_9, Y=Y_9, Z=Z_9)

deconstruct_box = DeconstructBox(Box=mıcrowave)  # -> Plane, X, Y, Z; disabled
deconstruct_domain = DeconstructDomain(Domain=deconstruct_box.Y)  # -> Start, End; disabled
number_slider_30 = Slider(80, range=0..1000)  # disabled
addition = Addition(A=deconstruct_domain.End, B=number_slider_30)  # disabled
construct_domain = ConstructDomain(DomainStart=deconstruct_domain.Start, DomainEnd=addition)  # disabled
microwave_margin = DomainBox(Base=deconstruct_box.Plane, X=deconstruct_box.X, Y=construct_domain, Z=deconstruct_box.Z)  # disabled

deconstruct_box_2 = DeconstructBox(Box=frıdge)  # -> Plane, X, Y, Z; disabled
deconstruct_domain_2 = DeconstructDomain(Domain=deconstruct_box_2.Y)  # -> Start, End; disabled
number_slider_31 = Slider(80, range=0..1000)  # disabled
addition_2 = Addition(A=deconstruct_domain_2.End, B=number_slider_31)  # disabled
construct_domain_2 = ConstructDomain(DomainStart=deconstruct_domain_2.Start, DomainEnd=addition_2)  # disabled
fridge_margin = DomainBox(Base=deconstruct_box_2.Plane, X=deconstruct_box_2.X, Y=construct_domain_2, Z=deconstruct_box_2.Z)  # disabled

deconstruct_box_3 = DeconstructBox(Box=sink)  # -> Plane, X, Y, Z
deconstruct_domain_3 = DeconstructDomain(Domain=deconstruct_box_3.Z)  # -> Start, End
deconstruct_domain_4 = DeconstructDomain(Domain=deconstruct_box_3.Y)  # -> Start, End
addition_3 = Addition(A=deconstruct_domain_3.End, B=Slider(123, range=0..1000))
addition_4 = Addition(A=deconstruct_domain_4.End, B=Slider(85, range=0..1000))
addition_5 = Addition(A=deconstruct_domain_4.Start, B=Slider(-10, range=-10..1000))
construct_domain_3 = ConstructDomain(DomainStart=deconstruct_domain_3.Start, DomainEnd=addition_3)
construct_domain_4 = ConstructDomain(DomainStart=addition_5, DomainEnd=addition_4)
sink_margin = DomainBox(Base=deconstruct_box_3.Plane, X=deconstruct_box_3.X, Y=construct_domain_4, Z=construct_domain_3)

deconstruct_box_4 = DeconstructBox(Box=stove_2)  # -> Plane, X, Y, Z; disabled
number_slider_32 = Slider(123, range=0..1000)  # disabled
deconstruct_domain_5 = DeconstructDomain(Domain=deconstruct_box_4.Z)  # -> Start, End; disabled
deconstruct_domain_6 = DeconstructDomain(Domain=deconstruct_box_4.Y)  # -> Start, End; disabled
number_slider_33 = Slider(80, range=0..1000)  # disabled
addition_6 = Addition(A=deconstruct_domain_5.End, B=number_slider_32)  # disabled
addition_7 = Addition(A=deconstruct_domain_6.End, B=number_slider_33)  # disabled
construct_domain_5 = ConstructDomain(DomainStart=deconstruct_domain_5.Start, DomainEnd=addition_6)  # disabled
construct_domain_6 = ConstructDomain(DomainStart=deconstruct_domain_6.Start, DomainEnd=addition_7)  # disabled
stove_margin = DomainBox(Base=deconstruct_box_4.Plane, X=deconstruct_box_4.X, Y=construct_domain_6, Z=construct_domain_5)  # disabled

deconstruct_box_5 = DeconstructBox(Box=counter)  # -> Plane, X, Y, Z; disabled
number_slider_34 = Slider(75, range=0..1000)  # disabled
deconstruct_domain_7 = DeconstructDomain(Domain=deconstruct_box_5.Z)  # -> Start, End; disabled
deconstruct_domain_8 = DeconstructDomain(Domain=deconstruct_box_5.Y)  # -> Start, End; disabled
number_slider_35 = Slider(80, range=0..1000)  # disabled
addition_8 = Addition(A=deconstruct_domain_7.End, B=number_slider_34)  # disabled
construct_domain_7 = ConstructDomain(DomainStart=deconstruct_domain_7.Start, DomainEnd=addition_8)  # disabled
addition_9 = Addition(A=deconstruct_domain_8.End, B=number_slider_35)  # disabled
construct_domain_8 = ConstructDomain(DomainStart=deconstruct_domain_8.Start, DomainEnd=addition_9)  # disabled
counter_margin = DomainBox(Base=deconstruct_box_5.Plane, X=deconstruct_box_5.X, Y=construct_domain_8, Z=construct_domain_7)  # disabled

deconstruct_box_6 = DeconstructBox(Box=cupboard)  # -> Plane, X, Y, Z; disabled
number_slider_36 = Slider(13, range=0..1000)  # disabled
deconstruct_domain_9 = DeconstructDomain(Domain=deconstruct_box_6.Z)  # -> Start, End; disabled
deconstruct_domain_10 = DeconstructDomain(Domain=deconstruct_box_6.Y)  # -> Start, End; disabled
number_slider_37 = Slider(-75, range=-100..1000)  # disabled
number_slider_38 = Slider(105, range=0..1000)  # disabled
addition_10 = Addition(A=deconstruct_domain_9.Start, B=number_slider_37)  # disabled
addition_11 = Addition(A=deconstruct_domain_9.End, B=number_slider_36)  # disabled
addition_12 = Addition(A=deconstruct_domain_10.End, B=number_slider_38)  # disabled
construct_domain_9 = ConstructDomain(DomainStart=addition_10, DomainEnd=addition_11)  # disabled
construct_domain_10 = ConstructDomain(DomainStart=deconstruct_domain_10.Start, DomainEnd=addition_12)  # disabled
cupboard_margin = DomainBox(Base=deconstruct_box_6.Plane, X=deconstruct_box_6.X, Y=construct_domain_10, Z=construct_domain_9)  # disabled

deconstruct_box_7 = DeconstructBox(Box=drawer)  # -> Plane, X, Y, Z
margin_front = Slider(60, range=60..80)
margin_left = Slider(-60, range=-80..0)
margin_right = Slider(60, range=0..80)
deconstruct_domain_11 = DeconstructDomain(Domain=deconstruct_box_7.X)  # -> Start, End
deconstruct_domain_12 = DeconstructDomain(Domain=deconstruct_box_7.Y)  # -> Start, End
addition_13 = Addition(A=margin_left, B=deconstruct_domain_11.Start)
addition_14 = Addition(A=deconstruct_domain_11.End, B=margin_right)
addition_15 = Addition(A=deconstruct_domain_12.End, B=margin_front)
left_right_margin = ConstructDomain(DomainStart=addition_13, DomainEnd=addition_14)
back_front_margin = ConstructDomain(DomainStart=deconstruct_domain_12.Start, DomainEnd=addition_15)
drawer_margin = DomainBox(Base=deconstruct_box_7.Plane, LEFTRIGHT=left_right_margin, BACKFRONT=back_front_margin, TOPBOTTOM=deconstruct_box_7.Z)

deconstruct_box_8 = DeconstructBox(Box=counter_1_2)  # -> Plane, X, Y, Z
deconstruct_domain_13 = DeconstructDomain(Domain=deconstruct_box_8.Y)  # -> Start, End
deconstruct_domain_14 = DeconstructDomain(Domain=deconstruct_box_8.Z)  # -> Start, End
margin_front_2 = Slider(60, range=60..80)
margin_bottom = Slider(-72, range=-72..-69)
margin_top = Slider(90, range=70..90)
addition_16 = Addition(A=deconstruct_domain_13.End, B=margin_front_2)
addition_17 = Addition(A=margin_bottom, B=deconstruct_domain_14.Start)
addition_18 = Addition(A=deconstruct_domain_14.End, B=margin_top)
back_front_margin_2 = ConstructDomain(DomainStart=deconstruct_domain_13.Start, DomainEnd=addition_16)
top_bottom_margin = ConstructDomain(DomainStart=addition_17, DomainEnd=addition_18)
counter_1_margin = DomainBox(Base=deconstruct_box_8.Plane, LEFTRIGHT=deconstruct_box_8.X, BACKFRONT=back_front_margin_2, TOPBOTTOM=top_bottom_margin)

deconstruct_box_9 = DeconstructBox(Box=counter_1)  # -> Plane, X, Y, Z
deconstruct_domain_15 = DeconstructDomain(Domain=deconstruct_box_9.Z)  # -> Start, End
margin_back = Slider(-60, range=-80..-60)
deconstruct_domain_16 = DeconstructDomain(Domain=deconstruct_box_9.Y)  # -> Start, End
margin_front_3 = Slider(60, range=60..80)
margin_bottom_2 = Slider(-72, range=-72..-69)
margin_top_2 = Slider(90, range=70..90)
addition_19 = Addition(A=margin_back, B=deconstruct_domain_16.Start)
addition_20 = Addition(A=margin_bottom_2, B=deconstruct_domain_15.Start)
addition_21 = Addition(A=deconstruct_domain_15.End, B=margin_top_2)
addition_22 = Addition(A=deconstruct_domain_16.End, B=margin_front_3)
top_bottom_margin_2 = ConstructDomain(DomainStart=addition_20, DomainEnd=addition_21)
back_front_margin_3 = ConstructDomain(DomainStart=addition_19, DomainEnd=addition_22)
counter_2_margin = DomainBox(
    Base=deconstruct_box_9.Plane,
    LEFTRIGHT=deconstruct_box_9.X,
    BACKFRONT=back_front_margin_3,
    TOPBOTTOM=top_bottom_margin_2)

deconstruct_box_10 = DeconstructBox(Box=fridge)  # -> Plane, X, Y, Z
deconstruct_domain_17 = DeconstructDomain(Domain=deconstruct_box_10.Y)  # -> Start, End
addition_23 = Addition(A=deconstruct_domain_17.End, B=X_6)
back_front_margin_4 = ConstructDomain(DomainStart=deconstruct_domain_17.Start, DomainEnd=addition_23)
fridge_margin_2 = DomainBox(
    Base=deconstruct_box_10.Plane,
    LEFTRIGHT=deconstruct_box_10.X,
    BACKFRONT=back_front_margin_4,
    TOPBOTTOM=deconstruct_box_10.Z)

deconstruct_box_11 = DeconstructBox(Box=lower_bed)  # -> Plane, X, Y, Z
margin_top_3 = Slider(90, range=70..90)
margin_bottom_3 = Slider(-40, range=-50..-40)
margin_front_4 = Slider(60, range=60..80)
deconstruct_domain_18 = DeconstructDomain(Domain=deconstruct_box_11.Z)  # -> Start, End
deconstruct_domain_19 = DeconstructDomain(Domain=deconstruct_box_11.Y)  # -> Start, End
addition_24 = Addition(A=margin_bottom_3, B=deconstruct_domain_18.Start)
addition_25 = Addition(A=deconstruct_domain_18.End, B=margin_top_3)
addition_26 = Addition(A=deconstruct_domain_19.End, B=margin_front_4)
back_front_margin_5 = ConstructDomain(DomainStart=deconstruct_domain_19.Start, DomainEnd=addition_26)
top_bottom_margin_3 = ConstructDomain(DomainStart=addition_24, DomainEnd=addition_25)
lower_bed_margin = DomainBox(
    Base=deconstruct_box_11.Plane,
    LEFTRIGHT=deconstruct_box_11.X,
    BACKFRONT=back_front_margin_5,
    TOPBOTTOM=top_bottom_margin_3)

deconstruct_box_12 = DeconstructBox(Box=table_1)  # -> Plane, X, Y, Z
margin_top_4 = Slider(135, range=130..135)
margin_right_2 = Slider(-60, range=-80..-50)
margin_top_5 = Slider(-78, range=-78..-66)
margin_front_5 = Slider(60, range=50..80)
margin_left_2 = Slider(60, range=50..80)
deconstruct_domain_20 = DeconstructDomain(Domain=deconstruct_box_12.Z)  # -> Start, End
deconstruct_domain_21 = DeconstructDomain(Domain=deconstruct_box_12.X)  # -> Start, End
deconstruct_domain_22 = DeconstructDomain(Domain=deconstruct_box_12.Y)  # -> Start, End
addition_27 = Addition(A=margin_right_2, B=deconstruct_domain_21.Start)
addition_28 = Addition(A=deconstruct_domain_20.End, B=margin_top_4)
addition_29 = Addition(A=deconstruct_domain_22.End, B=margin_front_5)
addition_30 = Addition(A=deconstruct_domain_21.End, B=margin_left_2)
addition_31 = Addition(A=margin_top_5, B=deconstruct_domain_20.Start)
back_front_margin_6 = ConstructDomain(DomainStart=deconstruct_domain_22.Start, DomainEnd=addition_29)
top_bottom_margin_4 = ConstructDomain(DomainStart=addition_31, DomainEnd=addition_28)
left_right_margin_2 = ConstructDomain(DomainStart=addition_27, DomainEnd=addition_30)
table_1_margin = DomainBox(
    Base=deconstruct_box_12.Plane,
    LEFTRIGHT=left_right_margin_2,
    BACKFRONT=back_front_margin_6,
    TOPBOTTOM=top_bottom_margin_4)

deconstruct_box_13 = DeconstructBox(Box=multipurpose_table_for_2)  # -> Plane, X, Y, Z

deconstruct_box_14 = DeconstructBox(Box=table_2_2)  # -> Plane, X, Y, Z
margin_top_6 = Slider(135, range=130..135)
margin_top_7 = Slider(-78, range=-78..-66)
margin_right_3 = Slider(-60, range=-80..-50)
margin_front_6 = Slider(60, range=50..80)
margin_left_3 = Slider(60, range=50..80)
deconstruct_domain_23 = DeconstructDomain(Domain=deconstruct_box_14.Z)  # -> Start, End
deconstruct_domain_24 = DeconstructDomain(Domain=deconstruct_box_14.X)  # -> Start, End
deconstruct_domain_25 = DeconstructDomain(Domain=deconstruct_box_14.Y)  # -> Start, End
addition_32 = Addition(A=margin_right_3, B=deconstruct_domain_24.Start)
addition_33 = Addition(A=deconstruct_domain_23.End, B=margin_top_6)
addition_34 = Addition(A=deconstruct_domain_25.End, B=margin_front_6)
addition_35 = Addition(A=deconstruct_domain_24.End, B=margin_left_3)
addition_36 = Addition(A=margin_top_7, B=deconstruct_domain_23.Start)
back_front_margin_7 = ConstructDomain(DomainStart=deconstruct_domain_25.Start, DomainEnd=addition_34)
top_bottom_margin_5 = ConstructDomain(DomainStart=addition_36, DomainEnd=addition_33)
left_right_margin_3 = ConstructDomain(DomainStart=addition_32, DomainEnd=addition_35)
table_2_margin = DomainBox(
    Base=deconstruct_box_14.Plane,
    LEFTRIGHT=left_right_margin_3,
    BACKFRONT=back_front_margin_7,
    TOPBOTTOM=top_bottom_margin_5)

deconstruct_box_15 = DeconstructBox(Box=stove)  # -> Plane, X, Y, Z
margin_top_8 = Slider(90, range=70..90)
deconstruct_domain_26 = DeconstructDomain(Domain=deconstruct_box_15.Z)  # -> Start, End
margin_front_7 = Slider(60, range=60..80)
deconstruct_domain_27 = DeconstructDomain(Domain=deconstruct_box_15.Y)  # -> Start, End
addition_37 = Addition(A=deconstruct_domain_26.End, B=margin_top_8)
addition_38 = Addition(A=deconstruct_domain_27.End, B=margin_front_7)
back_front_margin_8 = ConstructDomain(DomainStart=deconstruct_domain_27.Start, DomainEnd=addition_38)
top_bottom_margin_6 = ConstructDomain(DomainStart=deconstruct_domain_26.Start, DomainEnd=addition_37)
stove_margin_2 = DomainBox(
    Base=deconstruct_box_15.Plane,
    LEFTRIGHT=deconstruct_box_15.X,
    BACKFRONT=back_front_margin_8,
    TOPBOTTOM=top_bottom_margin_6)

deconstruct_box_16 = DeconstructBox(Box=sitting_unit)  # -> Plane, X, Y, Z; disabled
deconstruct_box_17 = DeconstructBox(Box=exterior_door)  # -> Plane, X, Y, Z

deconstruct_box_18 = DeconstructBox(Box=sitting_unit_2)  # -> Plane, X, Y, Z
margin_right_4 = Slider(-60, range=-60..-45)
margin_left_4 = Slider(60, range=45..60)
margin_top_9 = Slider(160, range=150..160)
deconstruct_domain_28 = DeconstructDomain(Domain=deconstruct_box_18.X)  # -> Start, End
deconstruct_domain_29 = DeconstructDomain(Domain=deconstruct_box_18.Z)  # -> Start, End
deconstruct_domain_30 = DeconstructDomain(Domain=deconstruct_box_18.Y)  # -> Start, End
addition_39 = Addition(A=deconstruct_domain_29.End, B=margin_top_9)
addition_40 = Addition(A=deconstruct_domain_30.End, B="5")
addition_41 = Addition(A=margin_right_4, B=deconstruct_domain_28.Start)
addition_42 = Addition(A=deconstruct_domain_28.End, B=margin_left_4)
left_right_margin_4 = ConstructDomain(DomainStart=addition_41, DomainEnd=addition_42)
back_front_margin_9 = ConstructDomain(DomainStart=deconstruct_domain_30.Start, DomainEnd=addition_40)
top_bottom_margin_7 = ConstructDomain(DomainStart=deconstruct_domain_29.Start, DomainEnd=addition_39)
sitting_unit_margin = DomainBox(
    Base=deconstruct_box_18.Plane,
    LEFTRIGHT=left_right_margin_4,
    BACKFRONT=back_front_margin_9,
    TOPBOTTOM=top_bottom_margin_7)

deconstruct_box_19 = DeconstructBox(Box=table_2)  # -> Plane, X, Y, Z
margin_top_10 = Slider(90, range=70..90)
margin_front_8 = Slider(60, range=60..80)
deconstruct_domain_31 = DeconstructDomain(Domain=deconstruct_box_19.Z)  # -> Start, End
deconstruct_domain_32 = DeconstructDomain(Domain=deconstruct_box_19.Y)  # -> Start, End
addition_43 = Addition(A=deconstruct_domain_32.End, B=margin_front_8)
addition_44 = Addition(A=deconstruct_domain_31.End, B=margin_top_10)
back_front_margin_10 = ConstructDomain(DomainStart=deconstruct_domain_32.Start, DomainEnd=addition_43)
top_bottom_margin_8 = ConstructDomain(DomainStart=deconstruct_domain_31.Start, DomainEnd=addition_44)
table_2_margin_2 = DomainBox(
    Base=deconstruct_box_19.Plane,
    LEFTRIGHT=deconstruct_box_19.X,
    BACKFRONT=back_front_margin_10,
    TOPBOTTOM=top_bottom_margin_8)

deconstruct_box_20 = DeconstructBox(Box=monitor)  # -> Plane, X, Y, Z; disabled
deconstruct_box_21 = DeconstructBox(Box=changeover_zone)  # -> Plane, X, Y, Z
deconstruct_box_22 = DeconstructBox(Box=closet)  # -> Plane, X, Y, Z
number_slider_39 = Slider(57, range=0..500)  # disabled
number_slider_40 = Slider(57, range=0..500)  # disabled
number_slider_41 = Slider(168, range=0..500)  # disabled
number_slider_42 = Slider(57, range=0..500)  # disabled
panel = Panel(deconstruct_box_13.X)
deconstruct_domain_33 = DeconstructDomain(Domain=deconstruct_box_13.Y)  # -> Start, End; disabled
deconstruct_domain_34 = DeconstructDomain(Domain=deconstruct_box_13.X)  # -> Start, End
deconstruct_domain_35 = DeconstructDomain(Domain=deconstruct_box_13.Y)  # -> Start, End; disabled
deconstruct_domain_36 = DeconstructDomain(Domain=deconstruct_box_13.Y)  # -> Start, End; disabled
deconstruct_domain_37 = DeconstructDomain(Domain=deconstruct_box_13.Y)  # -> Start, End; disabled
panel_2 = Panel(deconstruct_box_17.X)
panel_3 = Panel(deconstruct_box_21.X)
deconstruct_domain_38 = DeconstructDomain(Domain=deconstruct_box_21.Y)  # -> Start, End
deconstruct_domain_39 = DeconstructDomain(Domain=deconstruct_box_21.Z)  # -> Start, End
panel_4 = Panel(deconstruct_box_22.X)
deconstruct_domain_40 = DeconstructDomain(Domain=deconstruct_box_17.Y)  # -> Start, End
deconstruct_domain_41 = DeconstructDomain(Domain=deconstruct_box_22.Y)  # -> Start, End
addition_45 = Addition(A=deconstruct_domain_33.End, B=number_slider_39)  # disabled
addition_46 = Addition(A=deconstruct_domain_34.End, B=Slider(57, range=0..500))
addition_47 = Addition(A=deconstruct_domain_35.End, B=number_slider_40)  # disabled
addition_48 = Addition(A=deconstruct_domain_36.End, B=number_slider_41)  # disabled
addition_49 = Addition(A=deconstruct_domain_37.End, B=number_slider_42)  # disabled
addition_50 = Addition(A=deconstruct_domain_40.End, B=Slider(50, range=0..500))
addition_51 = Addition(A=deconstruct_domain_38.End, B=Slider(60, range=0..60))
addition_52 = Addition(A=deconstruct_domain_39.End, B=Slider(210, range=0..210))
addition_53 = Addition(A=deconstruct_domain_41.End, B=Slider(65, range=0..500))
# Margin :  Back 30
#                  Top  121
construct_domain_11 = ConstructDomain(DomainStart=deconstruct_domain_33.Start, DomainEnd=addition_45)  # disabled
construct_domain_12 = ConstructDomain(DomainStart=deconstruct_domain_34.Start, DomainEnd=addition_46)
# Margin :  Back 50
#                  Top  121
construct_domain_13 = ConstructDomain(DomainStart=deconstruct_domain_35.Start, DomainEnd=addition_47)  # disabled
# Margin :  Front 100
construct_domain_14 = ConstructDomain(DomainStart=deconstruct_domain_36.Start, DomainEnd=addition_48)  # disabled
# Margin :  Front 29
construct_domain_15 = ConstructDomain(DomainStart=deconstruct_domain_37.Start, DomainEnd=addition_49)  # disabled
# Margin :  Front 100
construct_domain_16 = ConstructDomain(DomainStart=deconstruct_domain_40.Start, DomainEnd=addition_50)
construct_domain_17 = ConstructDomain(DomainStart=deconstruct_domain_38.Start, DomainEnd=addition_51)
# Margin :  Front 60
# Margin :  Top 210
construct_domain_18 = ConstructDomain(DomainStart=deconstruct_domain_39.Start, DomainEnd=addition_52)
# Margin : 65
construct_domain_19 = ConstructDomain(DomainStart=deconstruct_domain_41.Start, DomainEnd=addition_53)
# Margin :  Front 80
#                 Left 55
#                 Top 135
#                 Bottom 72
panel_5 = Panel(construct_domain_11)  # disabled
panel_6 = Panel(construct_domain_12)
domain_box = DomainBox(Base=multipurpose_table_for_2, X=deconstruct_box_16.X, Y=deconstruct_box_16.Y, Z=deconstruct_box_16.Z)  # disabled
domain_box_2 = DomainBox(Base=multipurpose_table_for_2, X=construct_domain_12, Y=deconstruct_box_13.Y, Z=deconstruct_box_13.Z)
panel_7 = Panel(construct_domain_13)  # disabled
domain_box_3 = DomainBox(Base=multipurpose_table_for_2, X=construct_domain_13, Y=Domain(-0.5, 0.5), Z=Domain(0, 0.25))  # disabled
panel_8 = Panel(construct_domain_14)  # disabled
domain_box_4 = DomainBox(Base=multipurpose_table_for_2, X=construct_domain_14, Y=Domain(-0.5, 0.5), Z=Domain(0, 0.25))  # disabled
panel_9 = Panel(construct_domain_15)  # disabled
domain_box_5 = DomainBox(Base=multipurpose_table_for_2, X=construct_domain_15, Y=Domain(-0.5, 0.5), Z=Domain(0, 0.25))  # disabled
panel_10 = Panel(construct_domain_16)
change_over_zone_margin = DomainBox(Base=changeover_zone, X=deconstruct_box_21.X, Y=construct_domain_17, Z=construct_domain_18)
exterior_door_margin = DomainBox(Base=exterior_door, X=deconstruct_box_17.X, Y=construct_domain_16, Z=deconstruct_box_17.Z)
panel_11 = Panel(construct_domain_19)
panel_12 = Panel(construct_domain_18)
closet_margin = DomainBox(Base=closet, X=deconstruct_box_22.X, Y=construct_domain_19, Z=deconstruct_box_22.Z)
panel_13 = Panel(construct_domain_17)
number_slider_43 = Slider(1, range=0..1)  # disabled
number_slider_44 = Slider(1, range=0..1)  # disabled
number_slider_45 = Slider(1, range=0..1)  # disabled
number_slider_46 = Slider(1, range=0..1)  # disabled
number_slider_47 = Slider(1, range=0..1)  # disabled
custom_preview_materials_2 = CustomPreviewMaterials(Geometry=stove_margin, DiffuseColor=RGB(174, 215, 230), Transparency=number_slider_43)  # disabled
custom_preview_materials_3 = CustomPreviewMaterials(Geometry=microwave_margin, DiffuseColor=RGB(174, 215, 230), Transparency=number_slider_44)  # disabled
custom_preview_materials_4 = CustomPreviewMaterials(Geometry=fridge_margin, DiffuseColor=RGB(174, 215, 230), Transparency=number_slider_45)  # disabled
custom_preview_materials_5 = CustomPreviewMaterials(Geometry=cupboard_margin, DiffuseColor=RGB(174, 215, 230), Transparency=number_slider_46)  # disabled
custom_preview_materials_6 = CustomPreviewMaterials(Geometry=counter_margin, DiffuseColor=RGB(174, 215, 230), Transparency=number_slider_47)  # disabled

# ----
# Upper Bed
X_11 = Slider(60, range=33..60)  # disabled
# Microwave Oven
Y_11 = Slider(58, range=30..58)  # disabled
rectangle_9 = Rectangle(Plane=PlaneXY(1700, 0, 0), XSize=X_11, YSize=Y_11, Radius=0)  # -> Rectangle, Length; disabled
Z_11 = Slider(25, range=25..41)  # disabled
microwave_oven = BoxRectangle(Rectangle=rectangle_9.Rectangle, Height=Z_11)  # disabled

# ----
# Yukarıda olması gereken Objeler
X_12 = Slider(60, range=30..60)  # disabled
# Cupboard
Y_12 = Slider(45, range=30..45)  # disabled
rectangle_10 = Rectangle(Plane=PlaneXY(1900, 0, 0), XSize=X_12, YSize=Y_12, Radius=0)  # -> Rectangle, Length; disabled
Z_12 = Slider(30, range=30..50)  # disabled
cupboard_2 = BoxRectangle(Rectangle=rectangle_10.Rectangle, Height=Z_12)  # disabled

Y_13 = Slider(120, range=90..120)  # disabled
X_13 = Slider(210, range=200..220)  # disabled
rectangle_11 = Rectangle(Plane=PlaneXY(2700, 0, 0), XSize=X_13, YSize=Y_13, Radius=0)  # -> Rectangle, Length; disabled
Z_13 = Slider(20, range=20..40)  # disabled
upper_bed = BoxRectangle(Rectangle=rectangle_11.Rectangle, Height=Z_13)  # disabled

Y_14 = Slider(3, range=3..8)  # disabled
X_14 = Slider(60, range=43..82)  # disabled
# Monitor
division = Division(A=9, B=16)  # disabled
rectangle_12 = Rectangle(Plane=PlaneXY(2300, 0, 0), XSize=X_14, YSize=Y_14, Radius=0)  # -> Rectangle, Length; disabled
multiplication = Multiplication(A=X_14, B=division)  # disabled
monitor_2 = BoxRectangle(Rectangle=rectangle_12.Rectangle, Height=multiplication)  # disabled

X_15 = Slider(60, range=30..60)  # disabled
# First Aid
Y_15 = Slider(20, range=13..20)  # disabled
rectangle_13 = Rectangle(Plane=PlaneXY(2500, 0, 0), XSize=X_15, YSize=Y_15, Radius=0)  # -> Rectangle, Length; disabled
Z_14 = Slider(60, range=30..60)  # disabled
first_aid = BoxRectangle(Rectangle=rectangle_13.Rectangle, Height=Z_14)  # disabled

deconstruct_box_23 = DeconstructBox(Box=upper_bed)  # -> Plane, X, Y, Z; disabled
deconstruct_domain_42 = DeconstructDomain(Domain=deconstruct_box_23.Y)  # -> Start, End; disabled
margin_front_9 = Slider(60, range=60..80)  # disabled
margin_top_11 = Slider(90, range=70..90)  # disabled
deconstruct_domain_43 = DeconstructDomain(Domain=deconstruct_box_23.Z)  # -> Start, End; disabled
addition_54 = Addition(A=deconstruct_domain_42.End, B=margin_front_9)  # disabled
addition_55 = Addition(A=deconstruct_domain_43.End, B=margin_top_11)  # disabled
back_front_margin_11 = ConstructDomain(DomainStart=deconstruct_domain_42.Start, DomainEnd=addition_54)  # disabled
top_bottom_margin_9 = ConstructDomain(DomainStart=deconstruct_domain_43.Start, DomainEnd=addition_55)  # disabled
upper_bed_margin = DomainBox(
    Base=deconstruct_box_23.Plane,
    LEFTRIGHT=deconstruct_box_23.X,
    BACKFRONT=back_front_margin_11,
    TOPBOTTOM=top_bottom_margin_9)  # disabled

deconstruct_box_24 = DeconstructBox(Box=microwave_oven)  # -> Plane, X, Y, Z; disabled
margin_front_10 = Slider(60, range=60..80)  # disabled
deconstruct_domain_44 = DeconstructDomain(Domain=deconstruct_box_24.Y)  # -> Start, End; disabled
addition_56 = Addition(A=deconstruct_domain_44.End, B=margin_front_10)  # disabled
back_front_margin_12 = ConstructDomain(DomainStart=deconstruct_domain_44.Start, DomainEnd=addition_56)  # disabled
microwave_oven_margin = DomainBox(Base=deconstruct_box_24.Plane, LEFTRIGHT=deconstruct_box_24.X, BACKFRONT=back_front_margin_12, TOPBOTTOM=Domain(0, 0.25))  # disabled

deconstruct_box_25 = DeconstructBox(Box=first_aid)  # -> Plane, X, Y, Z; disabled
deconstruct_domain_45 = DeconstructDomain(Domain=deconstruct_box_25.Y)  # -> Start, End; disabled
panel_14 = Panel("30")  # disabled
addition_57 = Addition(A=deconstruct_domain_45.End, B=panel_14)  # disabled
back_front_margin_13 = ConstructDomain(DomainStart=deconstruct_domain_45.Start, DomainEnd=addition_57)  # disabled
first_aid_margin = DomainBox(
    Base=deconstruct_box_25.Plane,
    LEFTRIGHT=deconstruct_box_25.X,
    BACKFRONT=back_front_margin_13,
    TOPBOTTOM=deconstruct_box_25.Z)  # disabled

deconstruct_box_26 = DeconstructBox(Box=monitor_2)  # -> Plane, X, Y, Z; disabled
margin_front_11 = Slider(150, range=50..150)  # disabled
deconstruct_domain_46 = DeconstructDomain(Domain=deconstruct_box_26.Y)  # -> Start, End; disabled
addition_58 = Addition(A=deconstruct_domain_46.End, B=margin_front_11)  # disabled
back_front_margin_14 = ConstructDomain(DomainStart=deconstruct_domain_46.Start, DomainEnd=addition_58)  # disabled
monitor_margin = DomainBox(
    Base=deconstruct_box_26.Plane,
    LEFTRIGHT=deconstruct_box_26.X,
    BACKFRONT=back_front_margin_14,
    TOPBOTTOM=deconstruct_box_26.Z)  # disabled

deconstruct_box_27 = DeconstructBox(Box=cupboard_2)  # -> Plane, X, Y, Z; disabled
margin_front_12 = Slider(60, range=60..80)  # disabled
deconstruct_domain_47 = DeconstructDomain(Domain=deconstruct_box_27.Y)  # -> Start, End; disabled
addition_59 = Addition(A=deconstruct_domain_47.End, B=margin_front_12)  # disabled
back_front_margin_15 = ConstructDomain(DomainStart=deconstruct_domain_47.Start, DomainEnd=addition_59)  # disabled
cupboard_margin_2 = DomainBox(
    Base=deconstruct_box_27.Plane,
    LEFTRIGHT=deconstruct_box_27.X,
    BACKFRONT=back_front_margin_15,
    TOPBOTTOM=deconstruct_box_27.Z)  # disabled

number_slider_48 = Slider(10, range=0..10)  # disabled
number_slider_49 = Slider(10, range=0..10)  # disabled
number_slider_50 = Slider(30, range=0..100)  # disabled
number_slider_51 = Slider(60, range=20..60)  # disabled
number_slider_52 = Slider(36, range=20..60)  # disabled
number_slider_53 = Slider(6, range=2..10)  # disabled
number_slider_54 = Slider(30, range=0..100)  # disabled
number_slider_55 = Slider(60, range=20..60)  # disabled
number_slider_56 = Slider(6, range=2..10)  # disabled
number_slider_57 = Slider(36, range=20..60)  # disabled
multiplication_2 = Multiplication(A=number_slider_50, B=number_slider_48)  # disabled
number_slider_58 = Slider(2, range=0..10)  # disabled
multiplication_3 = Multiplication(A=number_slider_51, B=number_slider_48)  # disabled
multiplication_4 = Multiplication(A=number_slider_53, B=number_slider_48)  # disabled
multiplication_5 = Multiplication(A=number_slider_52, B=number_slider_48)  # disabled
number_slider_59 = Slider(10000, range=0..10000)  # disabled
multiplication_6 = Multiplication(A=number_slider_54, B=number_slider_49)  # disabled
panel_15 = Panel(multiplication_2)  # disabled
panel_16 = Panel(multiplication_5)  # disabled
number_slider_60 = Slider(2, range=0..10)  # disabled
panel_17 = Panel(multiplication_3)  # disabled
multiplication_7 = Multiplication(A=multiplication_4, B=multiplication_4)  # disabled
multiplication_8 = Multiplication(A=number_slider_55, B=number_slider_49)  # disabled
multiplication_9 = Multiplication(A=number_slider_56, B=number_slider_49)  # disabled
multiplication_10 = Multiplication(A=number_slider_57, B=number_slider_49)  # disabled
number_slider_61 = Slider(10000, range=0..10000)  # disabled
round = Round()  # -> Nearest, Floor, Ceiling; disabled
number_slider_62 = Slider(100, range=0..100)  # disabled
division_2 = Division(A=multiplication_3, B=multiplication_4)  # disabled
panel_18 = Panel(multiplication_4)  # disabled
division_3 = Division(A=multiplication_5, B=multiplication_4)  # disabled
panel_19 = Panel(multiplication_6)  # disabled
panel_20 = Panel(multiplication_10)  # disabled
number_slider_63 = Slider(150, range=0..1000)  # disabled
panel_21 = Panel(multiplication_8)  # disabled
multiplication_11 = Multiplication(A=multiplication_9, B=multiplication_9)  # disabled
multiplication_12 = Multiplication(A=number_slider_59, B=number_slider_58)  # disabled
division_4 = Division(A=multiplication_7, B=multiplication_12)  # disabled
panel_22 = Panel(division_3)  # disabled
number_slider_64 = Slider(100, range=0..100)  # disabled
division_5 = Division(A=multiplication_8, B=multiplication_9)  # disabled
panel_23 = Panel(multiplication_9)  # disabled
division_6 = Division(A=multiplication_10, B=multiplication_9)  # disabled
number_slider_65 = Slider(150, range=0..1000)  # disabled
integer = Integer(division_3)  # disabled
integer_2 = Integer(division_2)  # disabled
integer_3 = Integer(panel_15)  # disabled
box = Box(closet_margin)  # disabled
box_2 = Box(changeover_zone)  # disabled
box_3 = Box(closet)  # disabled
box_4 = Box(exterior_door)  # disabled
c_script = CSharpScript(boxx=box_4)  # -> out, lenght; inputs boxx: Box; disabled
# ---------- c_script: C# ----------
    lenght = boxx.X.T1;
        //lenght = 5;
# ---------- end c_script ----------
panel_24 = Panel(c_script.lenght)  # disabled
box_5 = Box(exterior_door_margin)  # disabled
box_6 = Box(change_over_zone_margin)  # disabled
multiplication_13 = Multiplication(A=number_slider_61, B=number_slider_60)  # disabled
division_7 = Division(A=multiplication_11, B=multiplication_13)  # disabled
box_7 = Box()  # disabled
box_8 = Box()  # disabled
box_9 = Box()  # disabled
box_10 = Box()  # disabled
box_11 = Box()  # disabled
box_12 = Box()  # disabled
box_13 = Box()  # disabled
box_14 = Box()  # disabled
box_15 = Box()  # disabled
box_16 = Box()  # disabled
box_17 = Box()  # disabled
panel_25 = Panel(division_6)  # disabled
number_slider_66 = Slider(8, range=0..10)  # disabled
c_script_2 = CSharpScript(
    Width=integer_2,
    Length=integer,
    Height=integer_3,
    LevelHeight=number_slider_63,
    cellSize=multiplication_4,
    ExteriorDoor=box_4,
    ExteriorDoorMargin=box_5,
    ChangeOverZone=box_2,
    ChangeOverZoneMargin=box_6,
    Closet=box_3,
    ClosetMargin=box,
    InteriorDoor=box_7,
    InteriorDoorMargin=box_8,
    Counter=box_9,
    CounterMargin=box_10,
    Table=box_11,
    TableMargin=box_12,
    SittingUnit=box_13,
    SittingUnitMargin=box_14,
    Bed=box_15,
    HealtCare=box_16,
    HealthCareMargin=box_17)  # -> out, A, EntranceBoxes, CommonBoxes, WetAreaBoxes, Y, K, W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; inputs Width: Int32, Length: Int32, Height: Int32, LevelHeight: Int32, cellSize: Int32, ExteriorDoor: Box, ExteriorDoorMargin: Box, ChangeOverZone: Box, ChangeOverZoneMargin: Box, Closet: Box, ClosetMargin: Box, InteriorDoor: Box, InteriorDoorMargin: Box, Counter: Box, CounterMargin: Box, Table: Box, TableMargin: Box, SittingUnit: Box, SittingUnitMargin: Box, Bed: Box, BedMargin: Box, HealtCare: Box, HealthCareMargin: Box; disabled
# ---------- c_script_2: C# usings ----------
using System.Linq;
# ---------- c_script_2: C# ----------
    List<Box> entranceBoxes = new List<Box>();
    List<Box> commonBoxes = new List<Box>();
    List<Box> wetAreaBoxes = new List<Box>();

    /*List<Box> kitchenBoxes = new List<Box>();
      List<Box> commonAreaBoxes = new List<Box>();*/

    List<Box> WhiteBoxes = new List<Box>();

    /**  These sizes are Spreading Limits for the spaces   //total cells     **/

    double entranceSize = (7 * 100 * 100) / (cellSize * cellSize);
    double commonSize = (9 * 100 * 100) / (cellSize * cellSize);
    double wetAreaSize = (7 * 100 * 100 ) / (cellSize * cellSize);

    /*
    double kitchenSize = 7 * 100 * 100 / cellSize * cell  Size;
    double commonAreaSize = 10 * 100 * 100 / cellSize * cellSize;
    */

    Point3d pA = new Point3d(0, 0, 0);
    Point3d pB = new Point3d(10, 0, 0);
    Point3d pC = new Point3d(0, 10, 0);

    Plane p = new Plane(pA, pB, pC);

    int width = Width;
    int length = Length;
    int levelHeight = LevelHeight;
    int height = Height;
    int levelNumber = Height / LevelHeight;

    int[,,] areaArray = InitializeZeroMatrice(length, width, levelNumber);
    StartZones(areaArray);

    int[,,] emptyFullArray = InitializeZeroMatrice(length, width, levelNumber);

    for (int i = 0; i < width * length * 3; i++)
    {
      //Rhino.RhinoApp.WriteLine("\n Loop Runs" + i.ToString());

      Spread(areaArray, ref entranceSize, entranceList, ref entranceCounter, entranceLimit, cellSize);
      /*Rhino.RhinoApp.WriteLine("Entrance size" + entranceSize.ToString());
      Rhino.RhinoApp.WriteLine("Entrance counter" + entranceCounter.ToString());
      Rhino.RhinoApp.WriteLine("\n ");*/


      Spread(areaArray, ref commonSize, commonList, ref commonCounter, commonLimit, cellSize);
      /*Rhino.RhinoApp.WriteLine("Common size" + commonSize.ToString());
      Rhino.RhinoApp.WriteLine("Common counter" + commonCounter.ToString());*/

      Spread(areaArray, ref wetAreaSize, wetAreaList, ref wetAreaCounter, wetAreaLimit, cellSize);

      /*Spread(areaArray, ref kitchenSize, kitchenList, ref kitchenCounter, kitchenLimit, cellSize);
      Spread(areaArray, ref commonAreaSize, commonAreaList, ref commonAreaCounter, commonAreaLimit, cellSize);*/
    }

    noiseFilter(areaArray, 0, 3, 5);
    noiseFilter(areaArray, 1, 2, 2);

    for (int k = 0;k < levelNumber;k++)
    {
      for (int i = 0;i < length;i++)
      {
        for (int j = 0;j < width;j++)
        {
          areaArray[i, j, k] = areaArray[i, j, 0];
        }
      }
    }

    for (int k = 0;k < levelNumber;k++)
    {
      for (int i = 0;i < length;i++)
      {
        for (int j = 0;j < width;j++)
        {
          emptyFullArray[i, j, k] = 0;
        }
      }
    }

    entranceList.Clear();
    commonList.Clear();
    wetAreaList.Clear();
    /*kitchenList.Clear();
    commonAreaList.Clear();*/

    for (int k = 0;k < levelNumber;k++)
    {
      for (int i = 0;i < length;i++)
      {
        for (int j = 0;j < width;j++)
        {
          if (areaArray[i, j, k] == 1)
          {
            Interval xInterval = new Interval(i * cellSize, (i + 1) * (cellSize ));
            Interval yInterval = new Interval(j * cellSize, (j + 1) * (cellSize ));
            Interval zInterval = new Interval(k * LevelHeight, k * LevelHeight + levelHeight);

            Box boxgh = new Box(p, xInterval, yInterval, zInterval);
            entranceBoxes.Add(boxgh);
            entranceList.AddRange(new int[2] { i, j });
          }
          if (areaArray[i, j, k] == 2)
          {
            Interval xInterval = new Interval(i * cellSize, (i + 1) * (cellSize ));
            Interval yInterval = new Interval(j * cellSize, (j + 1) * (cellSize ));
            Interval zInterval = new Interval(k * LevelHeight, k * LevelHeight + levelHeight);

            Box boxgh = new Box(p, xInterval, yInterval, zInterval);
            commonBoxes.Add(boxgh);
            commonList.AddRange(new int[2] { i, j });
          }
          if (areaArray[i, j, k] == 3)
          {
            Interval xInterval = new Interval(i * cellSize, (i + 1) * (cellSize ));
            Interval yInterval = new Interval(j * cellSize, (j + 1) * (cellSize ));
            Interval zInterval = new Interval(k * LevelHeight, k * LevelHeight + levelHeight);

            Box boxgh = new Box(p, xInterval, yInterval, zInterval);
            wetAreaBoxes.Add(boxgh);
            wetAreaList.AddRange(new int[2] { i, j });
          }

          /*if (areaArray[i, j, k] == 4)
          {
            Interval xInterval = new Interval(j * cellSize, (j + 1) * (cellSize ));
            Interval yInterval = new Interval(i * cellSize, (i + 1) * (cellSize ));
            Interval zInterval = new Interval(k * LevelHeight, k * LevelHeight + levelHeight);

            Box boxgh = new Box(p, xInterval, yInterval, zInterval);
            kitchenBoxes.Add(boxgh);
            kitchenList.AddRange(new int[2] { i, j });
          }
          if (areaArray[i, j, k] == 5)
          {
            Interval xInterval = new Interval(j * cellSize, (j + 1) * (cellSize ));
            Interval yInterval = new Interval(i * cellSize, (i + 1) * (cellSize ));
            Interval zInterval = new Interval(k * LevelHeight, k * LevelHeight + levelHeight);

            Box boxgh = new Box(p, xInterval, yInterval, zInterval);
            commonAreaBoxes.Add(boxgh);
            commonAreaList.AddRange(new int[2] { i, j });
          }*/
          if (areaArray[i, j, k] == 0)
          {

            Interval xInterval = new Interval(i * cellSize, (i + 1) * (cellSize ));
            Interval yInterval = new Interval(j * cellSize, (j + 1) * (cellSize ));
            Interval zInterval = new Interval(k * LevelHeight, k * LevelHeight + levelHeight);

            Box boxgh = new Box(p, xInterval, yInterval, zInterval);
            WhiteBoxes.Add(boxgh);
            //WhiteList.AddRange(i, j);
          }
        }
      }
    }
    List<Box> ObjectsList = new List<Box>();
    List<Box> MarginsList = new List<Box>();


    /* FURNITURE LAYOUT ==> ENTRANCE STARTED */


    Point3d pointa = new Point3d(0, 0, 0);
    Vector3d vectorb = new Vector3d(0, 0, 1);

    Plane planebase = new Plane(pointa, vectorb);

    Interval xInter = new Interval(0, 10);
    Interval yInter = new Interval(0, 10);
    Interval zInter = new Interval(0, 10);


    Box ObjBox = new Box(planebase, xInter, yInter, zInter);
    Box marginBox = new Box(planebase, xInter, yInter, zInter);


    /* ENTRANCE REFERENCE */
    var exteriorDoorO = new Objects
      {
        Name = "Exterior Door",
        ZoneName = 1,

        Obj = ExteriorDoor,
        ObjMargin = ExteriorDoorMargin,

        Front = true,
        Right = true,
        Back = false,
        Left = true,
        Top = false,
        Bottom = false,

        RotationBool = false,
        RotationOpt = 2,

        MirrorBool = false,
        MirrorOpt = 2,

        Source = "NULL",
        FixedToWall = 1,

        CellSize = 60,
        SpaceList = entranceList,

        //PreviousObject = changeOverZoneO

        };
    exteriorDoorO.assignDimensions();
    exteriorDoorO.placeRefObjectEntrance(emptyFullArray, areaArray, out ObjBox, out marginBox);

    ObjectsList.Add(ObjBox);
    MarginsList.Add(marginBox);



    /* ENTRANCE 2ND OBJECT */

    var changeOverZoneO = new Objects
      {
        Name = "changeOverZone",
        ZoneName = 1,

        Obj = ChangeOverZone,
        ObjMargin = ChangeOverZoneMargin,

        Front = true,
        Right = true,
        Back = false,
        Left = true,
        Top = false,
        Bottom = false,

        RotationBool = false,
        RotationOpt = 2,

        MirrorBool = false,
        MirrorOpt = 2,

        Source = "NULL",
        FixedToWall = 1,
        CellSize = 60,

        PreviousObject = exteriorDoorO,
        SpaceList = entranceList,

        };

    changeOverZoneO.assignDimensions();

    changeOverZoneO.placeFront(emptyFullArray, areaArray, out ObjBox, out marginBox);
    //changeOverZoneO.printDimensions();
    ObjectsList.Add(ObjBox);
    MarginsList.Add(marginBox);


    /* ENTRANCE 3RD OBJECT */
    var closetO = new Objects
      {
        Name = "closet",
        ZoneName = 1,

        Obj = Closet,
        ObjMargin = ClosetMargin,

        Front = true,
        Right = true,
        Back = false,
        Left = false,
        Top = false,
        Bottom = false,

        RotationBool = false,
        RotationOpt = 2,

        MirrorBool = false,
        MirrorOpt = 2,

        Source = "NULL",
        FixedToWall = 1,
        CellSize = 60,

        PreviousObject = changeOverZoneO,
        SpaceList = entranceList,

        };

    closetO.assignDimensions();

    closetO.placeFront(emptyFullArray, areaArray, out ObjBox, out marginBox);
    //changeOverZoneO.printDimensions();
    ObjectsList.Add(ObjBox);
    MarginsList.Add(marginBox);


    /* ENTRANCE 4TH OBJECT */
    var interiorDoorO = new Objects
      {
        Name = "Interior Door",
        ZoneName = 1,

        Obj = InteriorDoor,
        ObjMargin = InteriorDoorMargin,

        Front = false,
        Right = false,
        Back = false,
        Left = false,
        Top = false,
        Bottom = false,

        RotationBool = false,
        RotationOpt = 2,

        MirrorBool = false,
        MirrorOpt = 2,

        Source = "NULL",
        FixedToWall = 1,
        CellSize = 60,

        PreviousObject = closetO,
        SpaceList = entranceList,

        };

    interiorDoorO.assignDimensions();

    interiorDoorO.placeFront(emptyFullArray, areaArray, out ObjBox, out marginBox);

    ObjectsList.Add(ObjBox);
    MarginsList.Add(marginBox);

    /* FURNITURE LAYOUT ==> ENTRANCE ENDED */


    /* FURNITURE LAYOUT ==> COMMON STARTED */

    var counterO = new Objects
      {
        Name = "Counter",
        ZoneName = 2,

        Obj = Counter,
        ObjMargin = CounterMargin,

        Front = true,
        Right = true,
        Back = false,
        Left = false,
        Top = false,
        Bottom = false,

        RotationBool = false,
        RotationOpt = 2,

        MirrorBool = false,
        MirrorOpt = 2,

        Source = "NULL",
        FixedToWall = 1,

        CellSize = 60,
        SpaceList = commonList,


        };
    counterO.assignDimensions();
    counterO.placeRefObject(emptyFullArray, areaArray, out ObjBox, out marginBox);
    ObjectsList.Add(ObjBox);
    MarginsList.Add(marginBox);


    /* COMMONAREA 2ND OBJECT */

    var tableO = new Objects
      {
        Name = "Table",
        ZoneName = 2,

        Obj = Table,
        ObjMargin = TableMargin,

        Front = true,
        Right = true,
        Back = false,
        Left = false,
        Top = false,
        Bottom = false,

        RotationBool = false,
        RotationOpt = 2,

        MirrorBool = false,
        MirrorOpt = 2,

        Source = "NULL",
        FixedToWall = 1,
        CellSize = 60,

        PreviousObject = counterO,
        SpaceList = commonList,

        };

    tableO.assignDimensions();

/*
    Point3d pointa = new Point3d(0, 0, 0);
    Vector3d vectorb = new Vector3d(0, 0, 1);

    Plane planebase = new Plane(pointa, vectorb);

    Interval xInter = new Interval(0, 10);
    Interval yInter = new Interval(0, 10);
    Interval zInter = new Interval(0, 10);


    Box ObjBox = new Box(planebase, xInter, yInter, zInter);
    Box marginBox = new Box(planebase, xInter, yInter, zInter);
*/

    tableO.placeFront(emptyFullArray, areaArray, out ObjBox, out marginBox);
    //changeOverZoneO.printDimensions();
    ObjectsList.Add(ObjBox);
    MarginsList.Add(marginBox);


    /* COMMON 3RD OBJECT */
    var sittingUnitO = new Objects
      {
        Name = "Sitting Unit",
        ZoneName = 2,

        Obj = SittingUnit,
        ObjMargin = SittingUnitMargin,

        Front = true,
        Right = true,
        Back = false,
        Left = false,
        Top = false,
        Bottom = false,

        RotationBool = false,
        RotationOpt = 2,

        MirrorBool = false,
        MirrorOpt = 2,

        Source = "NULL",
        FixedToWall = 1,
        CellSize = 60,

        PreviousObject = tableO,
        SpaceList = commonList,

        };

    sittingUnitO.assignDimensions();

    sittingUnitO.placeFront(emptyFullArray, areaArray, out ObjBox, out marginBox);
    //changeOverZoneO.printDimensions();
    ObjectsList.Add(ObjBox);
    MarginsList.Add(marginBox);


    /* COMMON 4TH OBJECT */


    var bedO = new Objects
      {
        Name = "Bed",
        ZoneName = 2,

        Obj = Bed,
        ObjMargin = BedMargin,

        Front = true,
        Right = true,
        Back = false,
        Left = false,
        Top = false,
        Bottom = false,

        RotationBool = false,
        RotationOpt = 2,

        MirrorBool = false,
        MirrorOpt = 2,

        Source = "NULL",
        FixedToWall = 1,
        CellSize = 60,

        PreviousObject = sittingUnitO,
        SpaceList = commonList,

        };

    bedO.assignDimensions();

    bedO.placeFront(emptyFullArray, areaArray, out ObjBox, out marginBox);

    ObjectsList.Add(ObjBox);
    MarginsList.Add(marginBox);

    /* FURNITURE LAYOUT ==> COMMON END */

    ShowMatrix(areaArray);

    //Bxx = boxx;
    A = areaArray;
    EntranceBoxes = entranceBoxes;
    CommonBoxes = commonBoxes;
    WetAreaBoxes = wetAreaBoxes;
    /*Y = kitchenBoxes;
    K = commonAreaBoxes;*/
    W = WhiteBoxes;
    Furnitures = ObjectsList;
    FurnituresMargins = MarginsList;
# ---------- c_script_2: C# additional code ----------
  class Objects
  {
    public string Name;
    public int ZoneName;

    public Box Obj;
    public Box ObjMargin;

    public bool Front = false;
    public bool Right = false;
    public bool Back = false;
    public bool Left = false;
    public bool Top = false;
    public bool Bottom = false;

    public bool RotationBool = true;
    public int RotationOpt; // rotation options

    public bool MirrorBool = true;
    public int MirrorOpt; // mirror options

    public string Source; // Water, Electiricity
    public int FixedToWall; // Bed, Television //1,2,3 conditions
    public int CellSize;

    public Objects PreviousObject;

    public double ObjLength ;
    public double ObjWidth ;
    public double ObjHeight ;

    public double MrjLength;
    public double MrjWidth;
    public double MrjHeight;

    public double baseX, baseY, baseZ;
    public List<int> SpaceList = new List<int>();

    public double  XCell;
    public double  YCell;
    public double  ZCell;


    //deneme
    public Objects()
    {
            /*
            var Coordinates = new List<int>();
            Point3d pA = new Point3d(0, 0, 0);
            Point3d pB = new Point3d(10, 0, 0);
            Point3d pC = new Point3d(0, 10, 0);

            Plane p = new Plane(pA, pB, pC);*/
    }

    public Objects(string name, int zoneName, bool front, bool right, bool back, bool left, bool top, bool bottom, bool rotationalBool, int rotationOpt, bool mirrorBool, int mirrorOpt, string source, int fixedTowall, int cellSize, Box obj, Box objMargin, Objects previousObject, List<int> spaceList)
      : this()
    {
      this.Obj = obj;
      this.ObjMargin = objMargin;

      this.Name = name;
      this.ZoneName = zoneName;

      this.Front = front;
      this.Right = right;
      this.Back = back;
      this.Left = left;
      this.Bottom = bottom;
      this.Top = top;

      this.RotationBool = rotationalBool;
      this.RotationOpt = rotationOpt;

      this.MirrorBool = mirrorBool;
      this.MirrorOpt = mirrorOpt;

      this.Source = source;
      this.FixedToWall = fixedTowall;
      this.CellSize = cellSize;

      this.ObjWidth = obj.X.T1;
      this.ObjLength = obj.Y.T1;
      this.ObjHeight = obj.Z.T1;

      this.MrjWidth = objMargin.X.T1;
      this.MrjLength = objMargin.Y.T1;
      this.MrjHeight = objMargin.Z.T1;

      this.baseX = Obj.Plane.OriginX;
      this.baseY = Obj.Plane.OriginY;
      this.baseZ = Obj.Plane.OriginZ;

      this.PreviousObject = previousObject;
      this.SpaceList = spaceList;
    }

    public Objects(string name, int zoneName, bool front, bool right, bool back, bool left, bool top, bool bottom, bool rotationalBool, int rotationOpt, bool mirrorBool, int mirrorOpt, string source, int fixedTowall, int cellSize, Box obj, Box objMargin, List<int> spaceList)
      : this()
    {
      this.Obj = obj;
      this.ObjMargin = objMargin;

      this.Name = name;
      this.ZoneName = zoneName;

      this.Front = front;
      this.Right = right;
      this.Back = back;
      this.Left = left;
      this.Bottom = bottom;
      this.Top = top;

      this.RotationBool = rotationalBool;
      this.RotationOpt = rotationOpt;

      this.MirrorBool = mirrorBool;
      this.MirrorOpt = mirrorOpt;

      this.Source = source;
      this.FixedToWall = fixedTowall;
      this.CellSize = cellSize;

      this.ObjWidth = obj.X.T1;
      this.ObjLength = obj.Y.T1;
      this.ObjHeight = obj.Z.T1;

      this.MrjWidth = (this.ObjMargin.X.T1);
      this.MrjLength = (this.ObjMargin.Y.T1);
      this.MrjHeight = (this.ObjMargin.Z.T1);

      this.baseX = Obj.Plane.OriginX;
      this.baseY = Obj.Plane.OriginY;
      this.baseZ = Obj.Plane.OriginZ;

      this.SpaceList = spaceList;
    }

    public void assignDimensions()
    {
      this.ObjWidth = this.Obj.X.T1;
      this.ObjLength = this.Obj.Y.T1;
      this.ObjHeight = this.Obj.Z.T1;

      this.MrjWidth = this.ObjMargin.X.T1;
      this.MrjLength = this.ObjMargin.Y.T1;
      this.MrjHeight = this.ObjMargin.Z.T1;

    }

    public void printDimensions()
    {
      Rhino.RhinoApp.WriteLine("Obj Width " + this.ObjWidth.ToString());
      Rhino.RhinoApp.WriteLine("Obj Length " + this.ObjLength.ToString());
      Rhino.RhinoApp.WriteLine("Obj Height " + this.ObjHeight.ToString());

      Rhino.RhinoApp.WriteLine("Obj Width " + this.MrjWidth.ToString());
      Rhino.RhinoApp.WriteLine("Obj Length " + this.MrjLength.ToString());
      Rhino.RhinoApp.WriteLine("Obj Height " + this.MrjHeight.ToString());
    }



    public void placeRefObject(int [,,]emptyFullArray, int[,,]areaArray, out Box ObjBox, out Box marginBox)
    {
      this.XCell = Math.Ceiling((double) (this.MrjWidth / CellSize));
      this.YCell = Math.Ceiling((double) (this.MrjLength / CellSize));
      this.ZCell = Math.Ceiling((double) (this.MrjHeight / 150));

      bool emptyBool = true;
      bool sameZone = true;

      bool placeSuccessful = false;
      int trycount = 0;

      while (placeSuccessful == false)
      {
        var rand = new Random();
        var randomCellIndex = rand.Next(this.SpaceList.Count / 2);

        baseX = (this.SpaceList[2 * randomCellIndex]) * CellSize;
        baseY = (this.SpaceList[2 * randomCellIndex + 1]) * CellSize;
        baseZ = 0;
        baseZ = 0;

        //baseX = baseX * CellSize;
        //baseY = baseY * CellSize;

        if( (baseX + this.MrjWidth < 300) && (baseY + this.MrjLength < 600) && (baseZ + this.MrjHeight < 300) &&
          (baseX + this.MrjWidth > 0) && (baseY + this.MrjLength > 0) && (baseZ + this.MrjHeight > 0) )
        {
          for(int i = (int) (baseX / CellSize) ; i < (baseX / CellSize + (int) XCell); i++)
          {
            for(int j = (int) (baseY / CellSize); j < baseY / CellSize + (int) YCell; j++)
            {
              for(int k = (int) (baseZ / 150); k < baseZ / 150 + (int) ZCell; k++)
              {
                Rhino.RhinoApp.WriteLine("Entrance Reference Object :  " + "  i:  " + i + "  j:  " + j + "  k:  " + k);
                if (emptyFullArray[i, j, k] == 1)
                {
                  emptyBool = false;
                }
                if (areaArray[i, j, k] != this.ZoneName)
                {
                  sameZone = false;
                }
              }
            }
          }

          if (emptyBool && sameZone)
          {
            placeSuccessful = true;

            Rhino.RhinoApp.WriteLine("Reference Object conditions are successful ");
            for(int i = (int) (baseX / CellSize) ; i < (baseX / CellSize + (int) XCell); i++)
            {
              for(int j = (int) (baseY / CellSize); j < baseY / CellSize + (int) YCell; j++)
              {
                for(int k = (int) (baseZ / 150); k < baseZ / 150 + (int) ZCell; k++)
                {
                  emptyFullArray[i, j, k] = 1;
                }
              }
            }
          }
          else
          {
            Rhino.RhinoApp.WriteLine("Conditions are not satisfied ");
          }
        }

        trycount++;
        Rhino.RhinoApp.WriteLine("Try count is : " + trycount);
        if (trycount > 60 )
          Rhino.RhinoApp.WriteLine("Try count is over 60 placement is unsuccessful: ");
        placeSuccessful = true;
      }

      if( trycount < 60 && placeSuccessful )
      {
        Rhino.RhinoApp.WriteLine("baseX " + this.baseX);
        Rhino.RhinoApp.WriteLine("baseY " + this.baseY);
        Rhino.RhinoApp.WriteLine("baseZ " + this.baseZ);

        Point3d pointa = new Point3d(baseX, baseY, 0);
        Vector3d pointb = new Vector3d(0, 0, 1);

        Plane planebase = new Plane(pointa, pointb);

        Interval xInterval = new Interval(0, this.ObjWidth);
        Interval yInterval = new Interval(0, this.ObjLength);
        Interval zInterval = new Interval(0, this.ObjHeight);

        ObjBox = new Box(planebase, xInterval, yInterval, zInterval);

        xInterval = new Interval(0, this.MrjWidth);
        yInterval = new Interval(0, this.MrjLength);
        zInterval = new Interval(0, this.MrjHeight);

        marginBox = new Box(planebase, xInterval, yInterval, zInterval);

      }

      else
      {
        ObjBox = new Box();
        marginBox = new Box();
      }
    }

    public void placeRefObjectEntrance(int [,,]emptyFullArray, int[,,]areaArray, out Box ObjBox, out Box marginBox)
    {
      this.XCell = Math.Ceiling((double) (this.MrjWidth / CellSize));
      this.YCell = Math.Ceiling((double) (this.MrjLength / CellSize));
      this.ZCell = Math.Ceiling((double) (this.MrjHeight / 150));

      bool emptyBool = true;
      bool sameZone = true;


      bool placeSuccessful = false;
      int trycount = 0;

      while (placeSuccessful == false)
      {
        var rand = new Random();
        var randomCellIndex = rand.Next(this.SpaceList.Count / 2);

        baseX = (this.SpaceList[2 * randomCellIndex]) * CellSize;
        baseY = 0;
        baseZ = 0;

        //baseX = baseX * CellSize;
        //baseY = baseY * CellSize;

        if( (baseX + this.MrjWidth < 300) && (baseY + this.MrjLength < 600) && (baseZ + this.MrjHeight < 300) &&
          (baseX + this.MrjWidth > 0) && (baseY + this.MrjLength > 0) && (baseZ + this.MrjHeight > 0) )
        {
          for(int i = (int) (baseX / CellSize) ; i < (baseX / CellSize + (int) XCell); i++)
          {
            for(int j = (int) (baseY / CellSize); j < baseY / CellSize + (int) YCell; j++)
            {
              for(int k = (int) (baseZ / 150); k < baseZ / 150 + (int) ZCell; k++)
              {
                Rhino.RhinoApp.WriteLine("Entrance Reference Object :  " + "  i:  " + i + "  j:  " + j + "  k:  " + k);
                if (emptyFullArray[i, j, k] == 1)
                {
                  emptyBool = false;
                }
                if (areaArray[i, j, k] != this.ZoneName)
                {
                  sameZone = false;
                }
              }
            }
          }

          if (emptyBool && sameZone)
          {
            placeSuccessful = true;

            Rhino.RhinoApp.WriteLine("Reference Object conditions are successful ");
            for(int i = (int) (baseX / CellSize) ; i < (baseX / CellSize + (int) XCell); i++)
            {
              for(int j = (int) (baseY / CellSize); j < baseY / CellSize + (int) YCell; j++)
              {
                for(int k = (int) (baseZ / 150); k < baseZ / 150 + (int) ZCell; k++)
                {
                  emptyFullArray[i, j, k] = 1;
                }
              }
            }
          }
          else
          {
            Rhino.RhinoApp.WriteLine("Conditions are not satisfied ");
          }
        }

        trycount++;
        Rhino.RhinoApp.WriteLine("Try count is : " + trycount);
        if (trycount > 60 )
          Rhino.RhinoApp.WriteLine("Try count is over 60 placement is unsuccessful: ");
        placeSuccessful = true;
      }

      if( trycount < 60 && placeSuccessful )
      {
        Rhino.RhinoApp.WriteLine("baseX " + this.baseX);
        Rhino.RhinoApp.WriteLine("baseY " + this.baseY);
        Rhino.RhinoApp.WriteLine("baseZ " + this.baseZ);

        Point3d pointa = new Point3d(baseX, 0, 0);
        Vector3d pointb = new Vector3d(0, 0, 1);

        Plane planebase = new Plane(pointa, pointb);

        Interval xInterval = new Interval(0, this.ObjWidth);
        Interval yInterval = new Interval(0, this.ObjLength);
        Interval zInterval = new Interval(0, this.ObjHeight);

        ObjBox = new Box(planebase, xInterval, yInterval, zInterval);

        xInterval = new Interval(0, this.MrjWidth);
        yInterval = new Interval(0, this.MrjLength);
        zInterval = new Interval(0, this.MrjHeight);

        marginBox = new Box(planebase, xInterval, yInterval, zInterval);

      }


      else
      {
        ObjBox = new Box();
        marginBox = new Box();
      }

    }


    public void placeFront(int [,,]emptyFullArray, int[,,]areaArray, out Box ObjBox, out Box marginBox)
    {
      bool emptyBool = true;
      bool sameZone = true;

      this.XCell = Math.Ceiling((double) (this.MrjWidth / CellSize));
      this.YCell = Math.Ceiling((double) (this.MrjLength / CellSize));
      this.ZCell = Math.Ceiling((double) (this.MrjHeight / 150));

      this.baseX = PreviousObject.baseX;
      this.baseY = PreviousObject.baseY + CellSize * PreviousObject.YCell;
      this.baseZ = PreviousObject.baseZ;

      if( (baseX + this.MrjWidth < 300) && (baseY + this.MrjLength < 600) && (baseZ + this.MrjHeight < 300) &&
        (baseX + this.MrjWidth > 0) && (baseY + this.MrjLength > 0) && (baseZ + this.MrjHeight > 0) )
      {
        for(int i = (int) (baseX / CellSize) ; i < (baseX / CellSize + (int) XCell); i++)
        {
          for(int j = (int) (baseY / CellSize); j < baseY / CellSize + (int) YCell; j++)
          {
            for(int k = (int) (baseZ / 150); k < baseZ / 150 + (int) ZCell; k++)
            {
              Rhino.RhinoApp.WriteLine("i:  " + i + "  j:  " + j + "  k:  " + k);
              if (emptyFullArray[i, j, k] == 1)
              {
                emptyBool = false;
              }
              if (areaArray[i, j, k] != this.ZoneName)
              {
                sameZone = false;
              }
            }
          }
        }

        if (emptyBool && sameZone)
        {
          Rhino.RhinoApp.WriteLine("Conditions are successful ");
          for(int i = (int) (baseX / CellSize) ; i < (baseX / CellSize + (int) XCell); i++)
          {
            for(int j = (int) (baseY / CellSize); j < baseY / CellSize + (int) YCell; j++)
            {
              for(int k = (int) (baseZ / 150); k < baseZ / 150 + (int) ZCell; k++)
              {
                emptyFullArray[i, j, k] = 1;
              }
            }
          }
        }
        else
        {
          Rhino.RhinoApp.WriteLine("Place Front:  Conditions are not satisfied ");
        }
      }
      else
      {
        Rhino.RhinoApp.WriteLine("Place Front: Conditions are not satisfied ");
      }


      Point3d pointa = new Point3d(baseX, baseY, baseZ);
      Vector3d pointb = new Vector3d(0, 0, 1);

      Plane planebase = new Plane(pointa, pointb);

      Interval xInterval = new Interval(0, this.ObjWidth);
      Interval yInterval = new Interval(0, this.ObjLength);
      Interval zInterval = new Interval(0, this.ObjHeight);

      ObjBox = new Box(planebase, xInterval, yInterval, zInterval);

      xInterval = new Interval(0, this.MrjWidth);
      yInterval = new Interval(0, this.MrjLength);
      zInterval = new Interval(0, this.MrjHeight);

      marginBox = new Box(planebase, xInterval, yInterval, zInterval);
    }


    public void placeRight(int [,,]emptyFullArray, int[,,]areaArray, out Box ObjBox, out Box marginBox)
    {
      bool emptyBool = true;
      bool sameZone = true;

      this.XCell = Math.Ceiling((double) (this.MrjWidth / CellSize));
      this.YCell = Math.Ceiling((double) (this.MrjLength / CellSize));
      this.ZCell = Math.Ceiling((double) (this.MrjHeight / 150));

      this.baseX = PreviousObject.baseX + CellSize * PreviousObject.XCell;
      this.baseY = PreviousObject.baseY;
      this.baseZ = PreviousObject.baseZ;

      if( (baseX + this.ObjWidth < 300) && (baseY + this.ObjLength < 600) && (baseZ + this.ObjHeight < 300) &&
        (baseX + this.ObjWidth > 0) && (baseY + this.ObjLength > 0) && (baseZ + this.ObjHeight > 0) )
      {
        for(int i = (int) (baseX / CellSize) ; i < (baseX / CellSize + (int) XCell); i++)
        {
          for(int j = (int) (baseY / CellSize); j < baseY / CellSize + (int) YCell; j++)
          {
            for(int k = (int) (baseZ / 150); k < baseZ / 150 + (int) ZCell; k++)
            {
              if (emptyFullArray[i, j, k] == 1)
              {
                emptyBool = false;
              }
              if (areaArray[i, j, k] != this.ZoneName)
              {
                sameZone = false;
              }
            }
          }
        }

        if (emptyBool && sameZone)
        {
          Rhino.RhinoApp.WriteLine("Place Right: Conditions are successful ");
          for(int i = (int) (baseX / CellSize) ; i < (baseX / CellSize + (int) XCell); i++)
          {
            for(int j = (int) (baseY / CellSize); j < baseY / CellSize + (int) YCell; j++)
            {
              for(int k = (int) (baseZ / 150); k < baseZ / 150 + (int) ZCell; k++)
              {
                emptyFullArray[i, j, k] = 1;
              }
            }
          }
        }
        else
        {
          Rhino.RhinoApp.WriteLine("Place Right: Conditions are not satisfied ");
        }
      }
      else
      {
        Rhino.RhinoApp.WriteLine("Place Right: Conditions are not satisfied ");
      }

      Point3d pointa = new Point3d(baseX, baseY, baseZ);
      Vector3d pointb = new Vector3d(0, 0, 1);

      Plane planebase = new Plane(pointa, pointb);

      Interval xInterval = new Interval(0, this.ObjWidth);
      Interval yInterval = new Interval(0, this.ObjLength);
      Interval zInterval = new Interval(0, this.ObjHeight);

      ObjBox = new Box(planebase, xInterval, yInterval, zInterval);

      xInterval = new Interval(0, this.MrjWidth);
      yInterval = new Interval(0, this.MrjLength);
      zInterval = new Interval(0, this.MrjHeight);

      marginBox = new Box(planebase, xInterval, yInterval, zInterval);
    }

    public void placeBack(int [,,]emptyFullArray, int[,,]areaArray, out Box ObjBox, out Box marginBox)
    {
      bool emptyBool = true;
      bool sameZone = true;

      this.XCell = Math.Ceiling((double) (this.MrjWidth / CellSize));
      this.YCell = Math.Ceiling((double) (this.MrjLength / CellSize));
      this.ZCell = Math.Ceiling((double) (this.MrjHeight / 150));

      this.baseX = PreviousObject.baseX;
      this.baseY = PreviousObject.baseY - CellSize * this.YCell;
      this.baseZ = PreviousObject.baseZ;

      if( (baseX + this.ObjWidth < 300) && (baseY + this.ObjLength < 600) && (baseZ + this.ObjHeight < 300) &&
        (baseX + this.ObjWidth > 0) && (baseY + this.ObjLength > 0) && (baseZ + this.ObjHeight > 0) )
      {
        for(int i = (int) (baseX / CellSize) ; i < (baseX / CellSize + (int) XCell); i++)
        {
          for(int j = (int) (baseY / CellSize); j < baseY / CellSize + (int) YCell; j++)
          {
            for(int k = (int) (baseZ / 150); k < baseZ / 150 + (int) ZCell; k++)
            {
              if (emptyFullArray[i, j, k] == 1)
              {
                emptyBool = false;
              }
              if (areaArray[i, j, k] != this.ZoneName)
              {
                sameZone = false;
              }
            }
          }
        }

        if (emptyBool && sameZone)
        {
          Rhino.RhinoApp.WriteLine("Place Back: Conditions are successful ");
          for(int i = (int) (baseX / CellSize) ; i < (baseX / CellSize + (int) XCell); i++)
          {
            for(int j = (int) (baseY / CellSize); j < baseY / CellSize + (int) YCell; j++)
            {
              for(int k = (int) (baseZ / 150); k < baseZ / 150 + (int) ZCell; k++)
              {
                emptyFullArray[i, j, k] = 1;
              }
            }
          }
        }
        else
        {
          Rhino.RhinoApp.WriteLine("Place Back: Conditions are not satisfied ");
        }
      }
      else
      {
        Rhino.RhinoApp.WriteLine("Place Back:Conditions are not satisfied ");
      }

      Point3d pointa = new Point3d(baseX, baseY, baseZ);
      Vector3d pointb = new Vector3d(0, 0, 1);

      Plane planebase = new Plane(pointa, pointb);

      Interval xInterval = new Interval(0, this.ObjWidth);
      Interval yInterval = new Interval(0, this.ObjLength);
      Interval zInterval = new Interval(0, this.ObjHeight);

      ObjBox = new Box(planebase, xInterval, yInterval, zInterval);

      xInterval = new Interval(0, this.MrjWidth);
      yInterval = new Interval(0, this.MrjLength);
      zInterval = new Interval(0, this.MrjHeight);

      marginBox = new Box(planebase, xInterval, yInterval, zInterval);
    }

    public void placeLeft(int [,,]emptyFullArray, int[,,]areaArray, out Box ObjBox, out Box marginBox)
    {
      bool emptyBool = true;
      bool sameZone = true;

      this.XCell = Math.Ceiling((double) (this.MrjWidth / CellSize));
      this.YCell = Math.Ceiling((double) (this.MrjLength / CellSize));
      this.ZCell = Math.Ceiling((double) (this.MrjHeight / 150));

      this.baseX = PreviousObject.baseX - CellSize * this.XCell;
      this.baseY = PreviousObject.baseY;
      this.baseZ = PreviousObject.baseZ;

      if( (baseX + this.ObjWidth < 300) && (baseY + this.ObjLength < 600) && (baseZ + this.ObjHeight < 300) &&
        (baseX + this.ObjWidth > 0) && (baseY + this.ObjLength > 0) && (baseZ + this.ObjHeight > 0) )
      {
        for(int i = (int) (baseX / CellSize) ; i < (baseX / CellSize + (int) XCell); i++)
        {
          for(int j = (int) (baseY / CellSize); j < baseY / CellSize + (int) YCell; j++)
          {
            for(int k = (int) (baseZ / 150); k < baseZ / 150 + (int) ZCell; k++)
            {
              if (emptyFullArray[i, j, k] == 1)
              {
                emptyBool = false;
              }
              if (areaArray[i, j, k] != this.ZoneName)
              {
                sameZone = false;
              }
            }
          }
        }

        if (emptyBool && sameZone)
        {
          Rhino.RhinoApp.WriteLine("Place Left: Conditions are successful ");
          for(int i = (int) (baseX / CellSize) ; i < (baseX / CellSize + (int) XCell); i++)
          {
            for(int j = (int) (baseY / CellSize); j < baseY / CellSize + (int) YCell; j++)
            {
              for(int k = (int) (baseZ / 150); k < baseZ / 150 + (int) ZCell; k++)
              {
                emptyFullArray[i, j, k] = 1;
              }
            }
          }
        }
        else
        {
          Rhino.RhinoApp.WriteLine("Place Left: Conditions are not satisfied ");
        }
      }
      else
      {
        Rhino.RhinoApp.WriteLine("Place Left: Conditions are not satisfied ");
      }

      Point3d pointa = new Point3d(baseX, baseY, baseZ);
      Vector3d pointb = new Vector3d(0, 0, 1);

      Plane planebase = new Plane(pointa, pointb);

      Interval xInterval = new Interval(0, this.ObjWidth);
      Interval yInterval = new Interval(0, this.ObjLength);
      Interval zInterval = new Interval(0, this.ObjHeight);

      ObjBox = new Box(planebase, xInterval, yInterval, zInterval);

      xInterval = new Interval(0, this.MrjWidth);
      yInterval = new Interval(0, this.MrjLength);
      zInterval = new Interval(0, this.MrjHeight);

      marginBox = new Box(planebase, xInterval, yInterval, zInterval);
    }
    public void placeTop(int [,,]emptyFullArray, int[,,]areaArray, out Box ObjBox, out Box marginBox)
    {
      bool emptyBool = true;
      bool sameZone = true;

      this.XCell = Math.Ceiling((double) (this.MrjWidth / CellSize));
      this.YCell = Math.Ceiling((double) (this.MrjLength / CellSize));
      this.ZCell = Math.Ceiling((double) (this.MrjHeight / 150));

      this.baseX = PreviousObject.baseX;
      this.baseY = PreviousObject.baseY;
      this.baseZ = PreviousObject.baseZ + CellSize * PreviousObject.ZCell;

      if( (baseX + this.ObjWidth < 300) && (baseY + this.ObjLength < 600) && (baseZ + this.ObjHeight < 300) &&
        (baseX + this.ObjWidth > 0) && (baseY + this.ObjLength > 0) && (baseZ + this.ObjHeight > 0) )
      {
        for(int i = (int) (baseX / CellSize) ; i < (baseX / CellSize + (int) XCell); i++)
        {
          for(int j = (int) (baseY / CellSize); j < baseY / CellSize + (int) YCell; j++)
          {
            for(int k = (int) (baseZ / 150); k < baseZ / 150 + (int) ZCell; k++)
            {
              if (emptyFullArray[i, j, k] == 1)
              {
                emptyBool = false;
              }
              if (areaArray[i, j, k] != this.ZoneName)
              {
                sameZone = false;
              }
            }
          }
        }

        if (emptyBool && sameZone)
        {
          Rhino.RhinoApp.WriteLine("Conditions are successful ");
          for(int i = (int) (baseX / CellSize) ; i < (baseX / CellSize + (int) XCell); i++)
          {
            for(int j = (int) (baseY / CellSize); j < baseY / CellSize + (int) YCell; j++)
            {
              for(int k = (int) (baseZ / 150); k < baseZ / 150 + (int) ZCell; k++)
              {
                emptyFullArray[i, j, k] = 1;
              }
            }
          }
        }
        else
        {
          Rhino.RhinoApp.WriteLine("Conditions are not satisfied ");
        }
      }
      else
      {
        Rhino.RhinoApp.WriteLine("Conditions are not satisfied ");
      }

      Point3d pointa = new Point3d(baseX, baseY, baseZ);
      Vector3d pointb = new Vector3d(0, 0, 1);

      Plane planebase = new Plane(pointa, pointb);

      Interval xInterval = new Interval(0, this.ObjWidth);
      Interval yInterval = new Interval(0, this.ObjLength);
      Interval zInterval = new Interval(0, this.ObjHeight);

      ObjBox = new Box(planebase, xInterval, yInterval, zInterval);

      xInterval = new Interval(0, this.MrjWidth);
      yInterval = new Interval(0, this.MrjLength);
      zInterval = new Interval(0, this.MrjHeight);

      marginBox = new Box(planebase, xInterval, yInterval, zInterval);
    }

    public void placeBottom(int [,,]emptyFullArray, int[,,]areaArray, out Box ObjBox, out Box marginBox)
    {
      bool emptyBool = true;
      bool sameZone = true;

      this.XCell = Math.Ceiling((double) (this.MrjWidth / CellSize));
      this.YCell = Math.Ceiling((double) (this.MrjLength / CellSize));
      this.ZCell = Math.Ceiling((double) (this.MrjHeight / 150));

      this.baseX = PreviousObject.baseX;
      this.baseY = PreviousObject.baseY;
      this.baseZ = PreviousObject.baseZ - CellSize * this.ZCell;

      if( (baseX + this.ObjWidth < 300) && (baseY + this.ObjLength < 600) && (baseZ + this.ObjHeight < 300) &&
        (baseX + this.ObjWidth > 0) && (baseY + this.ObjLength > 0) && (baseZ + this.ObjHeight > 0) )
      {
        for(int i = (int) (baseX / CellSize) ; i < (baseX / CellSize + (int) XCell); i++)
        {
          for(int j = (int) (baseY / CellSize); j < baseY / CellSize + (int) YCell; j++)
          {
            for(int k = (int) (baseZ / 150); k < baseZ / 150 + (int) ZCell; k++)
            {
              if (emptyFullArray[i, j, k] == 1)
              {
                emptyBool = false;
              }
              if (areaArray[i, j, k] != this.ZoneName)
              {
                sameZone = false;
              }
            }
          }
        }

        if (emptyBool && sameZone)
        {
          Rhino.RhinoApp.WriteLine("Conditions are successful ");
          for(int i = (int) (baseX / CellSize) ; i < (baseX / CellSize + (int) XCell); i++)
          {
            for(int j = (int) (baseY / CellSize); j < baseY / CellSize + (int) YCell; j++)
            {
              for(int k = (int) (baseZ / 150); k < baseZ / 150 + (int) ZCell; k++)
              {
                emptyFullArray[i, j, k] = 1;
              }
            }
          }
        }
        else
        {
          Rhino.RhinoApp.WriteLine("Conditions are not satisfied ");
        }
      }
      else
      {
        Rhino.RhinoApp.WriteLine("Conditions are not satisfied ");
      }

      Point3d pointa = new Point3d(baseX, baseY, baseZ);
      Vector3d pointb = new Vector3d(0, 0, 1);

      Plane planebase = new Plane(pointa, pointb);

      Interval xInterval = new Interval(0, this.ObjWidth);
      Interval yInterval = new Interval(0, this.ObjLength);
      Interval zInterval = new Interval(0, this.ObjHeight);

      ObjBox = new Box(planebase, xInterval, yInterval, zInterval);

      xInterval = new Interval(0, this.MrjWidth);
      yInterval = new Interval(0, this.MrjLength);
      zInterval = new Interval(0, this.MrjHeight);

      marginBox = new Box(planebase, xInterval, yInterval, zInterval);
    }

    public void placeObject(int [,,]emptyFullArray, int[,,]areaArray, out Box ObjBox, out Box marginBox)
    {

      Point3d pointa = new Point3d(baseX, baseY, baseZ);
      Vector3d pointb = new Vector3d(0, 0, 1);

      Plane planebase = new Plane(pointa, pointb);

      Interval xInterval = new Interval(0, this.ObjWidth);
      Interval yInterval = new Interval(0, this.ObjLength);
      Interval zInterval = new Interval(0, this.ObjHeight);

      ObjBox = new Box(planebase, xInterval, yInterval, zInterval);

      xInterval = new Interval(0, this.MrjWidth);
      yInterval = new Interval(0, this.MrjLength);
      zInterval = new Interval(0, this.MrjHeight);

      marginBox = new Box(planebase, xInterval, yInterval, zInterval);

      List<int> growDirection = new List<int>();

      if(PreviousObject.Front == true)
        growDirection.Add(1); // Front Direction
      if(PreviousObject.Right == true)
        growDirection.Add(2); // Right Direction
      if(PreviousObject.Back == true)
        growDirection.Add(3); // Back Direction
      if(PreviousObject.Left == true)
        growDirection.Add(4); // Left Direction
      if(PreviousObject.Bottom == true)
        growDirection.Add(5); // Bottom Direction
      if(PreviousObject.Top == true)
        growDirection.Add(6); // Right Direction

      bool placeSuccess = false;
      int tryCounter = 0;

      if(growDirection.Count >= 1)
      {
        Random randm = new Random();

        while(placeSuccess == false )
        {
          int a = randm.Next(0, growDirection.Count);
          int randomMethod = growDirection[a];

          switch (a)
          ​{
            case 1:
              this.placeFront(emptyFullArray, areaArray, out  ObjBox, out marginBox);
              placeSuccess = true;
              break;
            case 2:
              this.placeRight(emptyFullArray, areaArray, out  ObjBox, out marginBox);
              placeSuccess = true;
              break;
            case 3:
              this.placeBack(emptyFullArray, areaArray, out  ObjBox, out marginBox);
              placeSuccess = true;
              break;
            case 4:
              this.placeLeft(emptyFullArray, areaArray, out  ObjBox, out marginBox);
              placeSuccess = true;
              break;
            case 5:
              this.placeBottom(emptyFullArray, areaArray, out  ObjBox, out marginBox);
              placeSuccess = true;
              break;
            case 6:
              this.placeTop(emptyFullArray, areaArray, out  ObjBox, out marginBox);
              placeSuccess = true;
              break;

            default:
              tryCounter++;
              break;
            // default statements
          }


        }
        growDirection.Clear();




      }


    }


    public void rotate()
    {

    }



    static void mirror()
    {

    }

    static void getClosestCell()
    {

    }

    static void createWall()
    {

    }

  }

  static void ShowMatrix(int[,,] Arr)
  {
    for (int i = 0; i < Arr.GetLength(0); i++)
    {
      for (int j = 0; j < Arr.GetLength(1); j++)
      {
        Rhino.RhinoApp.Write(Arr[i, j, 0] + " ");
      }
      Rhino.RhinoApp.WriteLine("Loop Runs" + i.ToString());
    }
    return;
  }

  static int[,,] InitializeZeroMatrice(int width, int length, int levelNumber)
  {
    var areaArray = new int[width, length, levelNumber];

    for (int k = 0; k < levelNumber; k++)
    {
      for (int i = 0; i < width; i++)
      {
        for (int j = 0; j < length; j++)
        {
          areaArray[i, j, k] = 0;
        }
      }
    }
    return areaArray;
  }

  /* The Color lists keep the colors in a seperate List in order to choose within them easily instead of searching where they are... */
  static List<int> entranceList = new List<int>();
  static List<int> commonList = new List<int>();
  static List<int> wetAreaList = new List<int>();
 /* static List<int> kitchenList = new List<int>();
  static List<int> commonAreaList = new List<int>();*/

  /**           these counters are used for starting the límitations counts.         **/

  static int entranceCounter = 1;
  static int commonCounter = 1;
  static int wetAreaCounter = 1;
  /*static int kitchenCounter = 1;
  static int commonAreaCounter = 1;*/
  /**           these limits are used for defining max distance that zone can spread.  **/

  static int entranceLimit = 250;
  static int commonLimit = 400;
  static int wetAreaLimit = 300;
  /*static int kitchenLimit = 200;
  static int commonAreaLimit = 100;*/

  static void StartZones(int[,,] arr)
  {
    /**
     * Randomly Starts the color. Takes the Color lists as argumnts
     * (We can delete these argumnents and it can get them as local referance
     * in our case it gives us a chance to choose what to initilize)
     * **/

    Random rand = new Random();
    //----------------------
    /* GetLength(0) and GetLength(1) might be set as variable */
    //Array.GetLength(0) gives the column lenght in other words length of an array
    //Array.GetLength(1) gives the row lenght in other words width of an array
    var a = rand.Next(arr.GetLength(0) / 2, arr.GetLength(0) / 2);
    var b = rand.Next(0, 2);

    Rhino.RhinoApp.WriteLine("started");
    entranceList.AddRange(new int[2] { a, b }); //AddRange ==> Adds multiple elements to a List . We use mod%2 to call the index of the point back instead of stacking them as an another List(or Array) in our list.
    arr[a, b, 0] = 1;// entrance Starting Point
    //----------------------

    b = rand.Next(0, arr.GetLength(1));
    a = rand.Next(0, arr.GetLength(0));

    commonList.AddRange(new int[2] { a, b });
    arr[a, b, 0] = 2; // common Starting Point
    //----------------------
    a = rand.Next(0, arr.GetLength(0));
    b = rand.Next(0, arr.GetLength(1));

    wetAreaList.AddRange(new int[2] { a, b });
    arr[a, b, 0] = 3; // wetArea Starting Point
    //----------------------
    a = rand.Next(0, arr.GetLength(0));
    b = rand.Next(0, arr.GetLength(1));
/*
    kitchenList.AddRange(new int[2] { a, b });
    arr[a, b, 0] = 4; // kitchen Starting Point
    //----------------------
    a = rand.Next(0, arr.GetLength(0));
    b = rand.Next(0, arr.GetLength(1));

    commonAreaList.AddRange(new int[2] { a, b });
    arr[a, b, 0] = 5; // commonArea Starting Point
    //----------------------
  */
  }
        /* Calculates the distance between initial point in the color and the possible new point!
         *  (if the possible new point is too far from inital point eleminate it.) */
  static double distanceCalculate(List<int> spaceCoordList, int x2, int y2, int cellSize)
  {
    var distance = cellSize * Math.Sqrt((y2 - spaceCoordList[1]) * (y2 - spaceCoordList[1]) + (x2 - spaceCoordList[0]) * (x2 - spaceCoordList[0]));
    return distance;
  }

  static void Evaluate()
  {
    // according to relations give score to the created zones
    // get the centers of the zones and acoording to the distances and created sizes give
    //positive or negative points and if score is not acceptable re-run and create variatians.
  }


  static void noiseFilter (int [,,] arr, int type, int iterationNumber, int controlNumber)
  {
    if(type == 0)
    {
      for( int loop = 0 ; loop < iterationNumber ; loop++ )
      {
        List < int> surrounding = new List<int>();
        for(int i = 1 ; i < arr.GetLength(0) - 1 ;i++)
        {
          for(int j = 1 ; j < arr.GetLength(1) - 1 ;j++)
          {
            for(int x = -1 ; x < 2;x++)
            {
              for(int y = -1 ; y < 2;y++)
              {
                if(!(x == y && x == 0))
                {

                  surrounding.Add(arr[i + x, j + y, 0]);
                }
              }
            }
            for (int v = 0 ; v < 6 ;v++) // 6 is the number of the zones including  empty cells
            {
              int count = (from z in surrounding where z == v select z).Count();
              if ( count >= controlNumber )
              {
                arr[i, j, 0] = v;
              }
            }
            surrounding.Clear();
            surrounding.TrimExcess();
          }
        }
      }
    }

    if(type == 1)
    {
      for( int loop = 0 ; loop < iterationNumber ; loop++ )
      {
        List < int> surrounding = new List<int>();
        for(int i = 1 ; i < arr.GetLength(0) - 1 ;i++)
        {
          for(int j = 1 ; j < arr.GetLength(1) - 1 ;j++)
          {
            for(int x = -1 ; x < 2;x++)
            {
              for(int y = -1 ; y < 2;y++)
              {
                if(!(x == y && x == 0) && ( (x + y == 1 ) || (x + y == -1 )) )
                {
                  surrounding.Add(arr[i + x, j + y, 0]);
                }
              }
            }

            for (int v = 0 ; v < 6 ;v++) // 6 is the number of the zones including  empty cells
            {
              int count = (from z in surrounding where z == v select z).Count();
              if ( count >= 2 )
              {
                arr[i, j, 0] = v;
              }
            }
            surrounding.Clear();
            surrounding.TrimExcess();
          }
        }
      }
    }
  }

  static void Spread(int[,,] arr, ref double spaceSize, List<int> spaceCoordList, ref int counter, int spaceLimit, int cellSize)
  {
        /*ARGUMENTS
     * The main array which has rectangular form(will be 3d in short) ,
     * spaceSize = Maximum limit that can grow.  ,
     * spaceCoordList =  the cells of the zone which has been already defined. )
     */
    var rand = new Random();
    var directionList = new List<int>();
    int Xcoord;
    int Ycoord;
    bool draw = false;
    int trycount = 0;

    while (draw == false && counter <= spaceSize)
    {
      if (counter <= spaceSize ) //Can be deleted. The condition is added to the While Loop Conditions.
      {
        var randomCellIndex = rand.Next(spaceCoordList.Count / 2);

        Xcoord = spaceCoordList[2 * randomCellIndex];
        Ycoord = spaceCoordList[2 * randomCellIndex + 1];

        if (Xcoord < arr.GetLength(0) - 1 && Xcoord > 0 && Ycoord > 0 && Ycoord < arr.GetLength(1) - 1)
        {
          /* Check the conditions INSIDE borders */
          if (arr[Xcoord + 1, Ycoord, 0] == 0 && distanceCalculate(spaceCoordList, Xcoord + 1, Ycoord, cellSize) < spaceLimit ) // Check if possible new cell is still white or not!
            directionList.AddRange(new int[2] { (Xcoord + 1), Ycoord }); //Store possible spread directions in a list.

          if (arr[Xcoord - 1, Ycoord, 0] == 0 && distanceCalculate(spaceCoordList, Xcoord - 1, Ycoord, cellSize) < spaceLimit)
            directionList.AddRange(new int[2] { (Xcoord - 1), Ycoord }); //Store possible spread directions in a list.

          if (arr[Xcoord, Ycoord + 1, 0] == 0 && distanceCalculate(spaceCoordList, Xcoord, Ycoord + 1, cellSize) < spaceLimit)
            directionList.AddRange(new int[2] { (Xcoord), Ycoord + 1 }); //Store possible spread directions in a list.

          if (arr[Xcoord, Ycoord - 1, 0] == 0 && distanceCalculate(spaceCoordList, Xcoord, Ycoord - 1, cellSize) < spaceLimit)
            directionList.AddRange(new int[2] { (Xcoord), (Ycoord - 1) }); //Store possible spread directions in a list.

          if (directionList.Count > 0)
          {
            var randomIndex = rand.Next(directionList.Count / 2);
            int a = directionList[2 * randomIndex];
            int b = directionList[2 * randomIndex + 1];

            arr[a, b, 0] = arr[Xcoord, Ycoord, 0];

            spaceCoordList.AddRange(new int[2] { a, b });

            directionList.Clear();
            directionList.TrimExcess();
            draw = true;
            counter++;
          }
          else
          {
            trycount++;
            if (trycount >= spaceCoordList.Count)
            {
              draw = true;
              //Print("trycountNumber is ={0}", trycount);
            }
          }
        }

          /* EDGE CONDITIONS */
          //RIGHT
        else if (Xcoord == (arr.GetLength(0) - 1) && Ycoord != 0 && Ycoord != (arr.GetLength(1) - 1))
        {
          if (arr[Xcoord - 1, Ycoord, 0] == 0 && distanceCalculate(spaceCoordList, Xcoord - 1, Ycoord, cellSize) < spaceLimit )
            directionList.AddRange(new int[2] { (Xcoord - 1), (Ycoord) }); //Store possible spread directions in a list.
          if (arr[Xcoord, Ycoord + 1, 0] == 0 && distanceCalculate(spaceCoordList, Xcoord, Ycoord + 1, cellSize) < spaceLimit )
            directionList.AddRange(new int[2] { (Xcoord ), (Ycoord + 1) }); //Store possible spread directions in a list.
          if (arr[Xcoord, Ycoord - 1, 0] == 0 && distanceCalculate(spaceCoordList, Xcoord, Ycoord - 1, cellSize) < spaceLimit )
            directionList.AddRange(new int[2] { (Xcoord ), (Ycoord - 1) }); //Store possible spread directions in a list.

          if (directionList.Count > 0)
          {
            var randomIndex = rand.Next(directionList.Count / 2);
            int a = directionList[2 * randomIndex];
            int b = directionList[2 * randomIndex + 1];

            arr[a, b, 0] = arr[Xcoord, Ycoord, 0];

            spaceCoordList.AddRange(new int[2] { a, b });

            directionList.Clear();
            directionList.TrimExcess();
            draw = true;
            counter++;
          }
          else
          {
            trycount++;
            if (trycount >= spaceCoordList.Count)
            {
              draw = true;
              //Print("trycountNumber is ={0}", trycount);
            }
          }
        }

          //Left
        else if (Xcoord == 0 && Ycoord != 0 && Ycoord != (arr.GetLength(1) - 1))
        {

          if (arr[Xcoord + 1, Ycoord, 0] == 0 && distanceCalculate(spaceCoordList, Xcoord + 1, Ycoord, cellSize) < spaceLimit )
            directionList.AddRange(new int[2] { (Xcoord + 1), (Ycoord) }); //Store possible spread directions in a list.
          if (arr[Xcoord, Ycoord + 1, 0] == 0 && distanceCalculate(spaceCoordList, Xcoord, Ycoord + 1, cellSize) < spaceLimit )
            directionList.AddRange(new int[2] { (Xcoord ), (Ycoord + 1) }); //Store possible spread directions in a list.
          if (arr[Xcoord, Ycoord - 1, 0] == 0 && distanceCalculate(spaceCoordList, Xcoord, Ycoord - 1, cellSize) < spaceLimit )
            directionList.AddRange(new int[2] { (Xcoord ), (Ycoord - 1) }); //Store possible spread directions in a list.
          if (directionList.Count > 0)
          {
            var randomIndex = rand.Next(directionList.Count / 2);
            int a = directionList[2 * randomIndex];
            int b = directionList[2 * randomIndex + 1];

            arr[a, b, 0] = arr[Xcoord, Ycoord, 0];

            spaceCoordList.AddRange(new int[2] { a, b });

            directionList.Clear();
            directionList.TrimExcess();
            draw = true;
            counter++;
          }
          else
          {
            trycount++;
            if (trycount >= spaceCoordList.Count)
            {
              draw = true;
              //Print("trycountNumber is ={0}", trycount);
            }
          }

        }
          //TOP
        else if ((Ycoord == arr.GetLength(1) - 1) && Xcoord != 0 && Xcoord != (arr.GetLength(0) - 1))
        {

          if (arr[Xcoord, Ycoord - 1, 0] == 0 && distanceCalculate(spaceCoordList, Xcoord, Ycoord - 1, cellSize) < spaceLimit )
            directionList.AddRange(new int[2] { (Xcoord ), (Ycoord - 1) }); //Store possible spread directions in a list.
          if (arr[Xcoord + 1, Ycoord, 0] == 0 && distanceCalculate(spaceCoordList, Xcoord + 1, Ycoord, cellSize) < spaceLimit )
            directionList.AddRange(new int[2] { (Xcoord + 1 ), (Ycoord ) }); //Store possible spread directions in a list.
          if (arr[Xcoord - 1, Ycoord, 0] == 0 && distanceCalculate(spaceCoordList, Xcoord - 1, Ycoord, cellSize) < spaceLimit )
            directionList.AddRange(new int[2] { (Xcoord - 1), (Ycoord ) }); //Store possible spread directions in a list.
          if (directionList.Count > 0)
          {
            var randomIndex = rand.Next(directionList.Count / 2);
            int a = directionList[2 * randomIndex];
            int b = directionList[2 * randomIndex + 1];

            arr[a, b, 0] = arr[Xcoord, Ycoord, 0];

            spaceCoordList.AddRange(new int[2] { a, b });

            directionList.Clear();
            directionList.TrimExcess();
            draw = true;
            counter++;
          }
          else
          {
            trycount++;
            if (trycount >= spaceCoordList.Count)
            {
              draw = true;
              //Print("trycountNumber is ={0}", trycount);
            }
          }
        }
          //BOTTOM
        else if (Ycoord == 0 && Xcoord != 0 && Xcoord != (arr.GetLength(0) - 1))
        {
          if (arr[Xcoord, Ycoord + 1, 0] == 0 && distanceCalculate(spaceCoordList, Xcoord, Ycoord + 1, cellSize) < spaceLimit )
            directionList.AddRange(new int[2] { (Xcoord ), (Ycoord + 1) }); //Store possible spread directions in a list.
          if (arr[Xcoord + 1, Ycoord, 0] == 0 && distanceCalculate(spaceCoordList, Xcoord + 1, Ycoord, cellSize) < spaceLimit )
            directionList.AddRange(new int[2] { (Xcoord + 1 ), (Ycoord ) }); //Store possible spread directions in a list.
          if (arr[Xcoord - 1, Ycoord, 0] == 0 && distanceCalculate(spaceCoordList, Xcoord - 1, Ycoord, cellSize) < spaceLimit )
            directionList.AddRange(new int[2] { (Xcoord - 1), (Ycoord ) }); //Store possible spread directions in a list.
          if (directionList.Count > 0)
          {
            var randomIndex = rand.Next(directionList.Count / 2);
            int a = directionList[2 * randomIndex];
            int b = directionList[2 * randomIndex + 1];

            arr[a, b, 0] = arr[Xcoord, Ycoord, 0];

            spaceCoordList.AddRange(new int[2] { a, b });

            directionList.Clear();
            directionList.TrimExcess();
            draw = true;
            counter++;
          }
          else
          {
            trycount++;
            if (trycount >= spaceCoordList.Count)
            {
              draw = true;
              //Print("trycountNumber is ={0}", trycount);
            }
          }
        }

          //LEFT BOTTOM
        else if (Xcoord == 0 && Ycoord == 0)
        {
          if (arr[Xcoord, Ycoord + 1, 0] == 0 && distanceCalculate(spaceCoordList, Xcoord, Ycoord + 1, cellSize) < spaceLimit)
            directionList.Add(Xcoord); directionList.Add(Ycoord + 1);

          if (arr[Xcoord + 1, Ycoord, 0] == 0 && distanceCalculate(spaceCoordList, Xcoord + 1, Ycoord, cellSize) < spaceLimit)
            directionList.Add(Xcoord + 1); directionList.Add(Ycoord);

          if (directionList.Count > 0)
          {

            var randomIndex = rand.Next(directionList.Count / 2);

            int a = directionList[2 * randomIndex];
            int b = directionList[2 * randomIndex + 1];

            arr[a, b, 0] = arr[Xcoord, Ycoord, 0];

            spaceCoordList.AddRange(new int[2] { a, b });

            directionList.Clear();
            directionList.TrimExcess();
            draw = true;

            counter++;
            //Print(" Counter Number is : {0}", counter);
          }
          else
          {
            trycount++;
            if (trycount >= spaceCoordList.Count)
            {
              draw = true;
              //Print("trycountNumber is ={0}", trycount);
            }
          }
        }
          //LEFT  TOP
          /*
          else if (Xcoord == 0 && Ycoord == (arr.GetLength(1) - 1))
          {
          if (arr[Xcoord + 1, Ycoord] == 0)
          directionList.Add(Xcoord + 1); directionList.Add(Ycoord);

          if (arr[Xcoord, Ycoord - 1] == 0)
          directionList.Add(Xcoord); directionList.Add(Ycoord - 1);

          if (directionList.Count > 0)
          {
          var randomIndex = rand.Next(directionList.Count / 2);

          int a = directionList[2 * randomIndex];
          int b = directionList[2 * randomIndex + 1];

          Rhino.RhinoApp.WriteLine("Left Top "  +  a +  " "  +  b);
          arr[a, b] = arr[Xcoord, Ycoord];

          spaceCoordList.AddRange(new int[2] { a, b });

          directionList.Clear();
          directionList.TrimExcess();
          draw = true;

          counter++;
          //Print(" Counter Number is : {0}", counter);
          }
          else
          {
          trycount++;
          if (trycount >= spaceCoordList.Count)
          {
          draw = true;
          //Print("trycountNumber is ={0}", trycount);
          }
          }
          }
          */
          /*
          //RIGHT TOP
          else if (Xcoord == (arr.GetLength(0) - 1) && Ycoord == (arr.GetLength(1) - 1))
          {
          if (arr[Xcoord, Ycoord - 1] == 0)
          directionList.Add(Xcoord); directionList.Add(Ycoord - 1);

          if (arr[Xcoord - 1, Ycoord] == 0)
          directionList.Add(Xcoord - 1); directionList.Add(Ycoord);

          if (directionList.Count > 0)
          {
          var randomIndex = rand.Next(directionList.Count / 2);

          int a = directionList[2 * randomIndex];
          int b = directionList[2 * randomIndex + 1];
          Rhino.RhinoApp.WriteLine(" Right top "+ a + " " + b);
          arr[a, b] = arr[Xcoord, Ycoord];

          //spaceCoordList.AddRange(new int[2] { a, b });

          directionList.Clear();
          directionList.TrimExcess();
          draw = true;

          counter++;
          //Print(" Counter Number is : {0}", counter);
          }
          else
          {
          trycount++;
          if (trycount >= spaceCoordList.Count)
          {
          draw = true;
          //Print("trycountNumber is ={0}", trycount);
          }
          }
          }
          */
          //RIGHT BOTTOM
        else if (Xcoord == (arr.GetLength(0) - 1) && Ycoord == 0)
        {
          if (arr[Xcoord, Ycoord + 1, 0] == 0)
            directionList.Add(Xcoord); directionList.Add(Ycoord + 1);

          if (arr[Xcoord - 1, Ycoord, 0] == 0)
            directionList.Add(Xcoord - 1); directionList.Add(Ycoord);

          if (directionList.Count > 0)
          {
            var randomIndex = rand.Next(directionList.Count / 2);

            int a = directionList[2 * randomIndex];
            int b = directionList[2 * randomIndex + 1];

            arr[a, b, 0] = arr[Xcoord, Ycoord, 0];

            spaceCoordList.AddRange(new int[2] { a, b });

            directionList.Clear();
            directionList.TrimExcess();

            draw = true;
            counter++;
            //Print(" Counter Number is : {0}", counter);
          }
          else
          {
            trycount++;
            if (trycount >= spaceCoordList.Count)
            {
              draw = true;
              //Print("trycountNumber is ={0}", trycount);
            }
          }
        }
        /* EDGE CONDITIONS */
      }
    }

  }




    /* Instead of wrting methods seperately in main program, it is better to use class based
     informations to keep things organized, we are not yet transsferentrance methods here but we created the str.*/

    /*
    public class Zone
    {
        public string Name;
        public int SpaceLimit;
        public Int16 SpaceSize;
        public int Counter;
        public List<Int16> SpaceList;

        public void Describe()
        {
            Console.WriteLine("Hey this zone is{ 0} ", Name);
        }

        public Zone()
        {
           // SpaceList = new List<int>();
        }

        public Zone(string name, int spaceLimit,int spacesize,int counter, List<int> SpaceList)
        :this()
        {
        }
        static void InitializeZeroMatrice() { }
        static void startZones() { }
        public void SpreadZones() { }

    }
    */
# ---------- end c_script_2 ----------
boolean_toggle = BooleanToggle(False)  # disabled
integer_4 = Integer(division_6)  # disabled
integer_5 = Integer(division_5)  # disabled
integer_6 = Integer(panel_19)  # disabled
box_18 = Box(closet_margin)  # disabled
box_19 = Box(closet)  # disabled
box_20 = Box(exterior_door)  # disabled
c_script_3 = CSharpScript(boxx=box_20)  # -> out, lenght; inputs boxx: Box; disabled; same code as c_script
panel_26 = Panel(c_script_3.lenght)  # disabled
deconstruct_box_28 = DeconstructBox(Box=box_20)  # -> Plane, X, Y, Z; disabled
panel_27 = Panel(deconstruct_box_28.Plane)  # disabled
panel_28 = Panel(deconstruct_box_28.Y)  # disabled
panel_29 = Panel(deconstruct_box_28.Z)  # disabled
panel_30 = Panel(deconstruct_box_28.X)  # disabled
box_21 = Box(changeover_zone)  # disabled
box_22 = Box(exterior_door_margin)  # disabled
box_23 = Box(change_over_zone_margin)  # disabled
box_24 = Box()  # disabled
box_25 = Box()  # disabled
box_26 = Box()  # disabled
box_27 = Box()  # disabled
box_28 = Box()  # disabled
box_29 = Box()  # disabled
box_30 = Box()  # disabled
box_31 = Box()  # disabled
box_32 = Box()  # disabled
box_33 = Box()  # disabled
box_34 = Box()  # disabled
number_slider_67 = Slider(8, range=0..10)  # disabled
c_script_4 = CSharpScript(
    Width=integer_5,
    Length=integer_4,
    Height=integer_6,
    LevelHeight=number_slider_65,
    cellSize=multiplication_9,
    ExteriorDoor=box_20,
    ExteriorDoorMargin=box_22,
    ChangeOverZone=box_21,
    ChangeOverZoneMargin=box_23,
    Closet=box_19,
    ClosetMargin=box_18,
    InteriorDoor=box_24,
    InteriorDoorMargin=box_25,
    Counter=box_26,
    CounterMargin=box_27,
    Table=box_28,
    TableMargin=box_29,
    SittingUnit=box_30,
    SittingUnitMargin=box_31,
    Bed=box_32,
    HealtCare=box_33,
    HealthCareMargin=box_34)  # -> out, A, EntranceBoxes, CommonBoxes, WetAreaBoxes, Y, K, W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; inputs Width: Int32, Length: Int32, Height: Int32, LevelHeight: Int32, cellSize: Int32, ExteriorDoor: Box, ExteriorDoorMargin: Box, ChangeOverZone: Box, ChangeOverZoneMargin: Box, Closet: Box, ClosetMargin: Box, InteriorDoor: Box, InteriorDoorMargin: Box, Counter: Box, CounterMargin: Box, Table: Box, TableMargin: Box, SittingUnit: Box, SittingUnitMargin: Box, Bed: Box, BedMargin: Box, HealtCare: Box, HealthCareMargin: Box; disabled
# ---------- c_script_4: C# ----------
      
    List<Box> entranceBoxes = new List<Box>(); 
    List<Box> commonBoxes = new List<Box>();
    List<Box> wetAreaBoxes = new List<Box>();

    /*List<Box> kitchenBoxes = new List<Box>();
      List<Box> commonAreaBoxes = new List<Box>();*/

    List<Box> WhiteBoxes = new List<Box>();

    /**  These sizes are Spreading Limits for the spaces   //total cells     **/

    double entranceSize = (6 * 100 * 100) / (cellSize * cellSize);
    double commonSize = (8 * 100 * 100) / (cellSize * cellSize);
    double wetAreaSize = (6 * 100 * 100 ) / (cellSize * cellSize);

    /*
    double kitchenSize = 7 * 100 * 100 / cellSize * cell  Size;
    double commonAreaSize = 10 * 100 * 100 / cellSize * cellSize;
    */

    Point3d pA = new Point3d(0, 0, 0);
    Point3d pB = new Point3d(10, 0, 0);
    Point3d pC = new Point3d(0, 10, 0);

    Plane p = new Plane(pA, pB, pC);

    int width = Width;
    int length = Length;
    int levelHeight = LevelHeight;
    int height = Height;
    int levelNumber = Height / LevelHeight;

    int[,,] areaArray = InitializeZeroMatrice(length, width, levelNumber);
    //StartZones(areaArray);

    int[,,] emptyFullArray = InitializeZeroMatrice(length, width, levelNumber);

    for (int i = 0; i < width * length * 3; i++)
    {
/*
      Spread(areaArray, ref entranceSize, entranceList, ref entranceCounter, entranceLimit, cellSize);
      Spread(areaArray, ref commonSize, commonList, ref commonCounter, commonLimit, cellSize);
      Spread(areaArray, ref wetAreaSize, wetAreaList, ref wetAreaCounter, wetAreaLimit, cellSize);
*/
    }
/*
    noiseFilter(areaArray, 0, 6, 5);
    noiseFilter(areaArray, 1, 2, 2);
*/
    for (int k = 0;k < levelNumber;k++)
    {
      for (int i = 0;i < length;i++)
      {
        for (int j = 0;j < width;j++)
        {
          areaArray[i, j, k] = areaArray[i, j, 0];
        }
      }
    }

    for (int k = 0;k < levelNumber;k++)
    {
      for (int i = 0;i < length;i++)
      {
        for (int j = 0;j < width;j++)
        {
          emptyFullArray[i, j, k] = 0;
        }
      }
    }

    entranceList.Clear();
    commonList.Clear();
    wetAreaList.Clear();
    /*kitchenList.Clear();
    commonAreaList.Clear();*/

    for (int k = 0;k < levelNumber;k++)
    {
      for (int i = 0;i < length;i++)
      {
        for (int j = 0;j < width;j++)
        {
          if (areaArray[i, j, k] == 1)
          {
            Interval xInterval = new Interval(i * cellSize, (i + 1) * (cellSize ));
            Interval yInterval = new Interval(j * cellSize, (j + 1) * (cellSize ));
            Interval zInterval = new Interval(k * LevelHeight, k * LevelHeight + levelHeight);

            Box boxgh = new Box(p, xInterval, yInterval, zInterval);
            entranceBoxes.Add(boxgh);
            entranceList.AddRange(new int[2] { i, j });
          }
          if (areaArray[i, j, k] == 2)
          {
            Interval xInterval = new Interval(i * cellSize, (i + 1) * (cellSize ));
            Interval yInterval = new Interval(j * cellSize, (j + 1) * (cellSize ));
            Interval zInterval = new Interval(k * LevelHeight, k * LevelHeight + levelHeight);

            Box boxgh = new Box(p, xInterval, yInterval, zInterval);
            commonBoxes.Add(boxgh);
            commonList.AddRange(new int[2] { i, j });
          }
          if (areaArray[i, j, k] == 3)
          {
            Interval xInterval = new Interval(i * cellSize, (i + 1) * (cellSize ));
            Interval yInterval = new Interval(j * cellSize, (j + 1) * (cellSize ));
            Interval zInterval = new Interval(k * LevelHeight, k * LevelHeight + levelHeight);

            Box boxgh = new Box(p, xInterval, yInterval, zInterval);
            wetAreaBoxes.Add(boxgh);
            wetAreaList.AddRange(new int[2] { i, j });
          }

          /*if (areaArray[i, j, k] == 4)
          {
            Interval xInterval = new Interval(j * cellSize, (j + 1) * (cellSize ));
            Interval yInterval = new Interval(i * cellSize, (i + 1) * (cellSize ));
            Interval zInterval = new Interval(k * LevelHeight, k * LevelHeight + levelHeight);

            Box boxgh = new Box(p, xInterval, yInterval, zInterval);
            kitchenBoxes.Add(boxgh);
            kitchenList.AddRange(new int[2] { i, j });
          }
          if (areaArray[i, j, k] == 5)
          {
            Interval xInterval = new Interval(j * cellSize, (j + 1) * (cellSize ));
            Interval yInterval = new Interval(i * cellSize, (i + 1) * (cellSize ));
            Interval zInterval = new Interval(k * LevelHeight, k * LevelHeight + levelHeight);

            Box boxgh = new Box(p, xInterval, yInterval, zInterval);
            commonAreaBoxes.Add(boxgh);
            commonAreaList.AddRange(new int[2] { i, j });
          }*/
          if (areaArray[i, j, k] == 0)
          {

            Interval xInterval = new Interval(i * cellSize, (i + 1) * (cellSize ));
            Interval yInterval = new Interval(j * cellSize, (j + 1) * (cellSize ));
            Interval zInterval = new Interval(k * LevelHeight, k * LevelHeight + levelHeight);

            Box boxgh = new Box(p, xInterval, yInterval, zInterval);
            WhiteBoxes.Add(boxgh);
            //WhiteList.AddRange(i, j);
          }
        }
      }
    }
    
    ShowMatrix(areaArray);

    A = areaArray;
    EntranceBoxes = entranceBoxes;
    CommonBoxes = commonBoxes;
    WetAreaBoxes = wetAreaBoxes;
    W = WhiteBoxes;
# ---------- c_script_4: C# additional code ----------
  class Objects
  {
    public string Name;
    public int ZoneName;

    public Box Obj;
    public Box ObjMargin;

    public bool Front = false;
    public bool Right = false;
    public bool Back = false;
    public bool Left = false;
    public bool Top = false;
    public bool Bottom = false;

    public bool RotationBool = true;
    public int RotationOpt; // rotation options

    public bool MirrorBool = true;
    public int MirrorOpt; // mirror options

    public string Source; // Water, Electiricity
    public int FixedToWall; // Bed, Television //1,2,3 conditions
    public int CellSize;

    public Objects PreviousObject;

    public double ObjLength ;
    public double ObjWidth ;
    public double ObjHeight ;

    public double MrjLength;
    public double MrjWidth;
    public double MrjHeight;

    public double baseX, baseY, baseZ;
    public List<int> SpaceList = new List<int>();

    public double  XCell;
    public double  YCell;
    public double  ZCell;


    //deneme
    public Objects()
    {
            /*
            var Coordinates = new List<int>();
            Point3d pA = new Point3d(0, 0, 0);
            Point3d pB = new Point3d(10, 0, 0);
            Point3d pC = new Point3d(0, 10, 0);

            Plane p = new Plane(pA, pB, pC);*/
    }

    public Objects(string name, int zoneName, bool front, bool right, bool back, bool left, bool top, bool bottom, bool rotationalBool, int rotationOpt, bool mirrorBool, int mirrorOpt, string source, int fixedTowall, int cellSize, Box obj, Box objMargin, Objects previousObject, List<int> spaceList)
      : this()
    {
      this.Obj = obj;
      this.ObjMargin = objMargin;

      this.Name = name;
      this.ZoneName = zoneName;

      this.Front = front;
      this.Right = right;
      this.Back = back;
      this.Left = left;
      this.Bottom = bottom;
      this.Top = top;

      this.RotationBool = rotationalBool;
      this.RotationOpt = rotationOpt;

      this.MirrorBool = mirrorBool;
      this.MirrorOpt = mirrorOpt;

      this.Source = source;
      this.FixedToWall = fixedTowall;
      this.CellSize = cellSize;

      this.ObjWidth = obj.X.T1;
      this.ObjLength = obj.Y.T1;
      this.ObjHeight = obj.Z.T1;

      this.MrjWidth = objMargin.X.T1;
      this.MrjLength = objMargin.Y.T1;
      this.MrjHeight = objMargin.Z.T1;

      this.baseX = Obj.Plane.OriginX;
      this.baseY = Obj.Plane.OriginY;
      this.baseZ = Obj.Plane.OriginZ;

      this.PreviousObject = previousObject;
      this.SpaceList = spaceList;
    }

    public Objects(string name, int zoneName, bool front, bool right, bool back, bool left, bool top, bool bottom, bool rotationalBool, int rotationOpt, bool mirrorBool, int mirrorOpt, string source, int fixedTowall, int cellSize, Box obj, Box objMargin, List<int> spaceList)
      : this()
    {
      this.Obj = obj;
      this.ObjMargin = objMargin;

      this.Name = name;
      this.ZoneName = zoneName;

      this.Front = front;
      this.Right = right;
      this.Back = back;
      this.Left = left;
      this.Bottom = bottom;
      this.Top = top;

      this.RotationBool = rotationalBool;
      this.RotationOpt = rotationOpt;

      this.MirrorBool = mirrorBool;
      this.MirrorOpt = mirrorOpt;

      this.Source = source;
      this.FixedToWall = fixedTowall;
      this.CellSize = cellSize;

      this.ObjWidth = obj.X.T1;
      this.ObjLength = obj.Y.T1;
      this.ObjHeight = obj.Z.T1;

      this.MrjWidth = (this.ObjMargin.X.T1);
      this.MrjLength = (this.ObjMargin.Y.T1);
      this.MrjHeight = (this.ObjMargin.Z.T1);

      this.baseX = Obj.Plane.OriginX;
      this.baseY = Obj.Plane.OriginY;
      this.baseZ = Obj.Plane.OriginZ;

      this.SpaceList = spaceList;
    }

    public void assignDimensions()
    {
      this.ObjWidth = this.Obj.X.T1;
      this.ObjLength = this.Obj.Y.T1;
      this.ObjHeight = this.Obj.Z.T1;

      this.MrjWidth = this.ObjMargin.X.T1;
      this.MrjLength = this.ObjMargin.Y.T1;
      this.MrjHeight = this.ObjMargin.Z.T1;

    }

    public void printDimensions()
    {
      Rhino.RhinoApp.WriteLine("Obj Width " + this.ObjWidth.ToString());
      Rhino.RhinoApp.WriteLine("Obj Length " + this.ObjLength.ToString());
      Rhino.RhinoApp.WriteLine("Obj Height " + this.ObjHeight.ToString());

      Rhino.RhinoApp.WriteLine("Obj Width " + this.MrjWidth.ToString());
      Rhino.RhinoApp.WriteLine("Obj Length " + this.MrjLength.ToString());
      Rhino.RhinoApp.WriteLine("Obj Height " + this.MrjHeight.ToString());
    }



    public void placeRefObject(int [,,]emptyFullArray, int[,,]areaArray, out Box ObjBox, out Box marginBox)
    {
      this.XCell = Math.Ceiling((double) (this.MrjWidth / CellSize));
      this.YCell = Math.Ceiling((double) (this.MrjLength / CellSize));
      this.ZCell = Math.Ceiling((double) (this.MrjHeight / 150));

      bool emptyBool = true;
      bool sameZone = true;

      bool placeSuccessful = false;
      int trycount = 0;

      while (placeSuccessful == false)
      {
        var rand = new Random();
        var randomCellIndex = rand.Next(this.SpaceList.Count / 2);

        baseX = (this.SpaceList[2 * randomCellIndex]) * CellSize;
        baseY = (this.SpaceList[2 * randomCellIndex + 1]) * CellSize;
        baseZ = 0;
        baseZ = 0;

        //baseX = baseX * CellSize;
        //baseY = baseY * CellSize;

        if( (baseX + this.MrjWidth < 300) && (baseY + this.MrjLength < 600) && (baseZ + this.MrjHeight < 300) &&
          (baseX + this.MrjWidth > 0) && (baseY + this.MrjLength > 0) && (baseZ + this.MrjHeight > 0) )
        {
          for(int i = (int) (baseX / CellSize) ; i < (baseX / CellSize + (int) XCell); i++)
          {
            for(int j = (int) (baseY / CellSize); j < baseY / CellSize + (int) YCell; j++)
            {
              for(int k = (int) (baseZ / 150); k < baseZ / 150 + (int) ZCell; k++)
              {
                Rhino.RhinoApp.WriteLine("Entrance Reference Object :  " + "  i:  " + i + "  j:  " + j + "  k:  " + k);
                if (emptyFullArray[i, j, k] == 1)
                {
                  emptyBool = false;
                }
                if (areaArray[i, j, k] != this.ZoneName)
                {
                  sameZone = false;
                }
              }
            }
          }

          if (emptyBool && sameZone)
          {
            placeSuccessful = true;

            Rhino.RhinoApp.WriteLine("Reference Object conditions are successful ");
            for(int i = (int) (baseX / CellSize) ; i < (baseX / CellSize + (int) XCell); i++)
            {
              for(int j = (int) (baseY / CellSize); j < baseY / CellSize + (int) YCell; j++)
              {
                for(int k = (int) (baseZ / 150); k < baseZ / 150 + (int) ZCell; k++)
                {
                  emptyFullArray[i, j, k] = 1;
                }
              }
            }
          }
          else
          {
            Rhino.RhinoApp.WriteLine("Conditions are not satisfied ");
          }
        }

        trycount++;
        Rhino.RhinoApp.WriteLine("Try count is : " + trycount);
        if (trycount > 60 )
          Rhino.RhinoApp.WriteLine("Try count is over 60 placement is unsuccessful: ");
        placeSuccessful = true;
      }

      if( trycount < 60 && placeSuccessful )
      {
        Rhino.RhinoApp.WriteLine("baseX " + this.baseX);
        Rhino.RhinoApp.WriteLine("baseY " + this.baseY);
        Rhino.RhinoApp.WriteLine("baseZ " + this.baseZ);

        Point3d pointa = new Point3d(baseX, baseY, 0);
        Vector3d pointb = new Vector3d(0, 0, 1);

        Plane planebase = new Plane(pointa, pointb);

        Interval xInterval = new Interval(0, this.ObjWidth);
        Interval yInterval = new Interval(0, this.ObjLength);
        Interval zInterval = new Interval(0, this.ObjHeight);

        ObjBox = new Box(planebase, xInterval, yInterval, zInterval);

        xInterval = new Interval(0, this.MrjWidth);
        yInterval = new Interval(0, this.MrjLength);
        zInterval = new Interval(0, this.MrjHeight);

        marginBox = new Box(planebase, xInterval, yInterval, zInterval);

      }

      else
      {
        ObjBox = new Box();
        marginBox = new Box();
      }
    }

    public void placeRefObjectEntrance(int [,,]emptyFullArray, int[,,]areaArray, out Box ObjBox, out Box marginBox)
    {
      this.XCell = Math.Ceiling((double) (this.MrjWidth / CellSize));
      this.YCell = Math.Ceiling((double) (this.MrjLength / CellSize));
      this.ZCell = Math.Ceiling((double) (this.MrjHeight / 150));

      bool emptyBool = true;
      bool sameZone = true;


      bool placeSuccessful = false;
      int trycount = 0;

      while (placeSuccessful == false)
      {
        var rand = new Random();
        var randomCellIndex = rand.Next(this.SpaceList.Count / 2);

        baseX = (this.SpaceList[2 * randomCellIndex]) * CellSize;
        baseY = 0;
        baseZ = 0;

        //baseX = baseX * CellSize;
        //baseY = baseY * CellSize;

        if( (baseX + this.MrjWidth < 300) && (baseY + this.MrjLength < 600) && (baseZ + this.MrjHeight < 300) &&
          (baseX + this.MrjWidth > 0) && (baseY + this.MrjLength > 0) && (baseZ + this.MrjHeight > 0) )
        {
          for(int i = (int) (baseX / CellSize) ; i < (baseX / CellSize + (int) XCell); i++)
          {
            for(int j = (int) (baseY / CellSize); j < baseY / CellSize + (int) YCell; j++)
            {
              for(int k = (int) (baseZ / 150); k < baseZ / 150 + (int) ZCell; k++)
              {
                Rhino.RhinoApp.WriteLine("Entrance Reference Object :  " + "  i:  " + i + "  j:  " + j + "  k:  " + k);
                if (emptyFullArray[i, j, k] == 1)
                {
                  emptyBool = false;
                }
                if (areaArray[i, j, k] != this.ZoneName)
                {
                  sameZone = false;
                }
              }
            }
          }

          if (emptyBool && sameZone)
          {
            placeSuccessful = true;

            Rhino.RhinoApp.WriteLine("Reference Object conditions are successful ");
            for(int i = (int) (baseX / CellSize) ; i < (baseX / CellSize + (int) XCell); i++)
            {
              for(int j = (int) (baseY / CellSize); j < baseY / CellSize + (int) YCell; j++)
              {
                for(int k = (int) (baseZ / 150); k < baseZ / 150 + (int) ZCell; k++)
                {
                  emptyFullArray[i, j, k] = 1;
                }
              }
            }
          }
          else
          {
            Rhino.RhinoApp.WriteLine("Conditions are not satisfied ");
          }
        }

        trycount++;
        Rhino.RhinoApp.WriteLine("Try count is : " + trycount);
        if (trycount > 60 )
          Rhino.RhinoApp.WriteLine("Try count is over 60 placement is unsuccessful: ");
        placeSuccessful = true;
      }

      if( trycount < 60 && placeSuccessful )
      {
        Rhino.RhinoApp.WriteLine("baseX " + this.baseX);
        Rhino.RhinoApp.WriteLine("baseY " + this.baseY);
        Rhino.RhinoApp.WriteLine("baseZ " + this.baseZ);

        Point3d pointa = new Point3d(baseX, 0, 0);
        Vector3d pointb = new Vector3d(0, 0, 1);

        Plane planebase = new Plane(pointa, pointb);

        Interval xInterval = new Interval(0, this.ObjWidth);
        Interval yInterval = new Interval(0, this.ObjLength);
        Interval zInterval = new Interval(0, this.ObjHeight);

        ObjBox = new Box(planebase, xInterval, yInterval, zInterval);

        xInterval = new Interval(0, this.MrjWidth);
        yInterval = new Interval(0, this.MrjLength);
        zInterval = new Interval(0, this.MrjHeight);

        marginBox = new Box(planebase, xInterval, yInterval, zInterval);

      }


      else
      {
        ObjBox = new Box();
        marginBox = new Box();
      }

    }


    public void placeFront(int [,,]emptyFullArray, int[,,]areaArray, out Box ObjBox, out Box marginBox)
    {
      bool emptyBool = true;
      bool sameZone = true;

      this.XCell = Math.Ceiling((double) (this.MrjWidth / CellSize));
      this.YCell = Math.Ceiling((double) (this.MrjLength / CellSize));
      this.ZCell = Math.Ceiling((double) (this.MrjHeight / 150));

      this.baseX = PreviousObject.baseX;
      this.baseY = PreviousObject.baseY + CellSize * PreviousObject.YCell;
      this.baseZ = PreviousObject.baseZ;

      if( (baseX + this.MrjWidth < 300) && (baseY + this.MrjLength < 600) && (baseZ + this.MrjHeight < 300) &&
        (baseX + this.MrjWidth > 0) && (baseY + this.MrjLength > 0) && (baseZ + this.MrjHeight > 0) )
      {
        for(int i = (int) (baseX / CellSize) ; i < (baseX / CellSize + (int) XCell); i++)
        {
          for(int j = (int) (baseY / CellSize); j < baseY / CellSize + (int) YCell; j++)
          {
            for(int k = (int) (baseZ / 150); k < baseZ / 150 + (int) ZCell; k++)
            {
              Rhino.RhinoApp.WriteLine("i:  " + i + "  j:  " + j + "  k:  " + k);
              if (emptyFullArray[i, j, k] == 1)
              {
                emptyBool = false;
              }
              if (areaArray[i, j, k] != this.ZoneName)
              {
                sameZone = false;
              }
            }
          }
        }

        if (emptyBool && sameZone)
        {
          Rhino.RhinoApp.WriteLine("Conditions are successful ");
          for(int i = (int) (baseX / CellSize) ; i < (baseX / CellSize + (int) XCell); i++)
          {
            for(int j = (int) (baseY / CellSize); j < baseY / CellSize + (int) YCell; j++)
            {
              for(int k = (int) (baseZ / 150); k < baseZ / 150 + (int) ZCell; k++)
              {
                emptyFullArray[i, j, k] = 1;
              }
            }
          }
        }
        else
        {
          Rhino.RhinoApp.WriteLine("Place Front:  Conditions are not satisfied ");
        }
      }
      else
      {
        Rhino.RhinoApp.WriteLine("Place Front: Conditions are not satisfied ");
      }


      Point3d pointa = new Point3d(baseX, baseY, baseZ);
      Vector3d pointb = new Vector3d(0, 0, 1);

      Plane planebase = new Plane(pointa, pointb);

      Interval xInterval = new Interval(0, this.ObjWidth);
      Interval yInterval = new Interval(0, this.ObjLength);
      Interval zInterval = new Interval(0, this.ObjHeight);

      ObjBox = new Box(planebase, xInterval, yInterval, zInterval);

      xInterval = new Interval(0, this.MrjWidth);
      yInterval = new Interval(0, this.MrjLength);
      zInterval = new Interval(0, this.MrjHeight);

      marginBox = new Box(planebase, xInterval, yInterval, zInterval);
    }


    public void placeRight(int [,,]emptyFullArray, int[,,]areaArray, out Box ObjBox, out Box marginBox)
    {
      bool emptyBool = true;
      bool sameZone = true;

      this.XCell = Math.Ceiling((double) (this.MrjWidth / CellSize));
      this.YCell = Math.Ceiling((double) (this.MrjLength / CellSize));
      this.ZCell = Math.Ceiling((double) (this.MrjHeight / 150));

      this.baseX = PreviousObject.baseX + CellSize * PreviousObject.XCell;
      this.baseY = PreviousObject.baseY;
      this.baseZ = PreviousObject.baseZ;

      if( (baseX + this.ObjWidth < 300) && (baseY + this.ObjLength < 600) && (baseZ + this.ObjHeight < 300) &&
        (baseX + this.ObjWidth > 0) && (baseY + this.ObjLength > 0) && (baseZ + this.ObjHeight > 0) )
      {
        for(int i = (int) (baseX / CellSize) ; i < (baseX / CellSize + (int) XCell); i++)
        {
          for(int j = (int) (baseY / CellSize); j < baseY / CellSize + (int) YCell; j++)
          {
            for(int k = (int) (baseZ / 150); k < baseZ / 150 + (int) ZCell; k++)
            {
              if (emptyFullArray[i, j, k] == 1)
              {
                emptyBool = false;
              }
              if (areaArray[i, j, k] != this.ZoneName)
              {
                sameZone = false;
              }
            }
          }
        }

        if (emptyBool && sameZone)
        {
          Rhino.RhinoApp.WriteLine("Place Right: Conditions are successful ");
          for(int i = (int) (baseX / CellSize) ; i < (baseX / CellSize + (int) XCell); i++)
          {
            for(int j = (int) (baseY / CellSize); j < baseY / CellSize + (int) YCell; j++)
            {
              for(int k = (int) (baseZ / 150); k < baseZ / 150 + (int) ZCell; k++)
              {
                emptyFullArray[i, j, k] = 1;
              }
            }
          }
        }
        else
        {
          Rhino.RhinoApp.WriteLine("Place Right: Conditions are not satisfied ");
        }
      }
      else
      {
        Rhino.RhinoApp.WriteLine("Place Right: Conditions are not satisfied ");
      }

      Point3d pointa = new Point3d(baseX, baseY, baseZ);
      Vector3d pointb = new Vector3d(0, 0, 1);

      Plane planebase = new Plane(pointa, pointb);

      Interval xInterval = new Interval(0, this.ObjWidth);
      Interval yInterval = new Interval(0, this.ObjLength);
      Interval zInterval = new Interval(0, this.ObjHeight);

      ObjBox = new Box(planebase, xInterval, yInterval, zInterval);

      xInterval = new Interval(0, this.MrjWidth);
      yInterval = new Interval(0, this.MrjLength);
      zInterval = new Interval(0, this.MrjHeight);

      marginBox = new Box(planebase, xInterval, yInterval, zInterval);
    }

    public void placeBack(int [,,]emptyFullArray, int[,,]areaArray, out Box ObjBox, out Box marginBox)
    {
      bool emptyBool = true;
      bool sameZone = true;

      this.XCell = Math.Ceiling((double) (this.MrjWidth / CellSize));
      this.YCell = Math.Ceiling((double) (this.MrjLength / CellSize));
      this.ZCell = Math.Ceiling((double) (this.MrjHeight / 150));

      this.baseX = PreviousObject.baseX;
      this.baseY = PreviousObject.baseY - CellSize * this.YCell;
      this.baseZ = PreviousObject.baseZ;

      if( (baseX + this.ObjWidth < 300) && (baseY + this.ObjLength < 600) && (baseZ + this.ObjHeight < 300) &&
        (baseX + this.ObjWidth > 0) && (baseY + this.ObjLength > 0) && (baseZ + this.ObjHeight > 0) )
      {
        for(int i = (int) (baseX / CellSize) ; i < (baseX / CellSize + (int) XCell); i++)
        {
          for(int j = (int) (baseY / CellSize); j < baseY / CellSize + (int) YCell; j++)
          {
            for(int k = (int) (baseZ / 150); k < baseZ / 150 + (int) ZCell; k++)
            {
              if (emptyFullArray[i, j, k] == 1)
              {
                emptyBool = false;
              }
              if (areaArray[i, j, k] != this.ZoneName)
              {
                sameZone = false;
              }
            }
          }
        }

        if (emptyBool && sameZone)
        {
          Rhino.RhinoApp.WriteLine("Place Back: Conditions are successful ");
          for(int i = (int) (baseX / CellSize) ; i < (baseX / CellSize + (int) XCell); i++)
          {
            for(int j = (int) (baseY / CellSize); j < baseY / CellSize + (int) YCell; j++)
            {
              for(int k = (int) (baseZ / 150); k < baseZ / 150 + (int) ZCell; k++)
              {
                emptyFullArray[i, j, k] = 1;
              }
            }
          }
        }
        else
        {
          Rhino.RhinoApp.WriteLine("Place Back: Conditions are not satisfied ");
        }
      }
      else
      {
        Rhino.RhinoApp.WriteLine("Place Back:Conditions are not satisfied ");
      }

      Point3d pointa = new Point3d(baseX, baseY, baseZ);
      Vector3d pointb = new Vector3d(0, 0, 1);

      Plane planebase = new Plane(pointa, pointb);

      Interval xInterval = new Interval(0, this.ObjWidth);
      Interval yInterval = new Interval(0, this.ObjLength);
      Interval zInterval = new Interval(0, this.ObjHeight);

      ObjBox = new Box(planebase, xInterval, yInterval, zInterval);

      xInterval = new Interval(0, this.MrjWidth);
      yInterval = new Interval(0, this.MrjLength);
      zInterval = new Interval(0, this.MrjHeight);

      marginBox = new Box(planebase, xInterval, yInterval, zInterval);
    }

    public void placeLeft(int [,,]emptyFullArray, int[,,]areaArray, out Box ObjBox, out Box marginBox)
    {
      bool emptyBool = true;
      bool sameZone = true;

      this.XCell = Math.Ceiling((double) (this.MrjWidth / CellSize));
      this.YCell = Math.Ceiling((double) (this.MrjLength / CellSize));
      this.ZCell = Math.Ceiling((double) (this.MrjHeight / 150));

      this.baseX = PreviousObject.baseX - CellSize * this.XCell;
      this.baseY = PreviousObject.baseY;
      this.baseZ = PreviousObject.baseZ;

      if( (baseX + this.ObjWidth < 300) && (baseY + this.ObjLength < 600) && (baseZ + this.ObjHeight < 300) &&
        (baseX + this.ObjWidth > 0) && (baseY + this.ObjLength > 0) && (baseZ + this.ObjHeight > 0) )
      {
        for(int i = (int) (baseX / CellSize) ; i < (baseX / CellSize + (int) XCell); i++)
        {
          for(int j = (int) (baseY / CellSize); j < baseY / CellSize + (int) YCell; j++)
          {
            for(int k = (int) (baseZ / 150); k < baseZ / 150 + (int) ZCell; k++)
            {
              if (emptyFullArray[i, j, k] == 1)
              {
                emptyBool = false;
              }
              if (areaArray[i, j, k] != this.ZoneName)
              {
                sameZone = false;
              }
            }
          }
        }

        if (emptyBool && sameZone)
        {
          Rhino.RhinoApp.WriteLine("Place Left: Conditions are successful ");
          for(int i = (int) (baseX / CellSize) ; i < (baseX / CellSize + (int) XCell); i++)
          {
            for(int j = (int) (baseY / CellSize); j < baseY / CellSize + (int) YCell; j++)
            {
              for(int k = (int) (baseZ / 150); k < baseZ / 150 + (int) ZCell; k++)
              {
                emptyFullArray[i, j, k] = 1;
              }
            }
          }
        }
        else
        {
          Rhino.RhinoApp.WriteLine("Place Left: Conditions are not satisfied ");
        }
      }
      else
      {
        Rhino.RhinoApp.WriteLine("Place Left: Conditions are not satisfied ");
      }

      Point3d pointa = new Point3d(baseX, baseY, baseZ);
      Vector3d pointb = new Vector3d(0, 0, 1);

      Plane planebase = new Plane(pointa, pointb);

      Interval xInterval = new Interval(0, this.ObjWidth);
      Interval yInterval = new Interval(0, this.ObjLength);
      Interval zInterval = new Interval(0, this.ObjHeight);

      ObjBox = new Box(planebase, xInterval, yInterval, zInterval);

      xInterval = new Interval(0, this.MrjWidth);
      yInterval = new Interval(0, this.MrjLength);
      zInterval = new Interval(0, this.MrjHeight);

      marginBox = new Box(planebase, xInterval, yInterval, zInterval);
    }
    public void placeTop(int [,,]emptyFullArray, int[,,]areaArray, out Box ObjBox, out Box marginBox)
    {
      bool emptyBool = true;
      bool sameZone = true;

      this.XCell = Math.Ceiling((double) (this.MrjWidth / CellSize));
      this.YCell = Math.Ceiling((double) (this.MrjLength / CellSize));
      this.ZCell = Math.Ceiling((double) (this.MrjHeight / 150));

      this.baseX = PreviousObject.baseX;
      this.baseY = PreviousObject.baseY;
      this.baseZ = PreviousObject.baseZ + CellSize * PreviousObject.ZCell;

      if( (baseX + this.ObjWidth < 300) && (baseY + this.ObjLength < 600) && (baseZ + this.ObjHeight < 300) &&
        (baseX + this.ObjWidth > 0) && (baseY + this.ObjLength > 0) && (baseZ + this.ObjHeight > 0) )
      {
        for(int i = (int) (baseX / CellSize) ; i < (baseX / CellSize + (int) XCell); i++)
        {
          for(int j = (int) (baseY / CellSize); j < baseY / CellSize + (int) YCell; j++)
          {
            for(int k = (int) (baseZ / 150); k < baseZ / 150 + (int) ZCell; k++)
            {
              if (emptyFullArray[i, j, k] == 1)
              {
                emptyBool = false;
              }
              if (areaArray[i, j, k] != this.ZoneName)
              {
                sameZone = false;
              }
            }
          }
        }

        if (emptyBool && sameZone)
        {
          Rhino.RhinoApp.WriteLine("Conditions are successful ");
          for(int i = (int) (baseX / CellSize) ; i < (baseX / CellSize + (int) XCell); i++)
          {
            for(int j = (int) (baseY / CellSize); j < baseY / CellSize + (int) YCell; j++)
            {
              for(int k = (int) (baseZ / 150); k < baseZ / 150 + (int) ZCell; k++)
              {
                emptyFullArray[i, j, k] = 1;
              }
            }
          }
        }
        else
        {
          Rhino.RhinoApp.WriteLine("Conditions are not satisfied ");
        }
      }
      else
      {
        Rhino.RhinoApp.WriteLine("Conditions are not satisfied ");
      }

      Point3d pointa = new Point3d(baseX, baseY, baseZ);
      Vector3d pointb = new Vector3d(0, 0, 1);

      Plane planebase = new Plane(pointa, pointb);

      Interval xInterval = new Interval(0, this.ObjWidth);
      Interval yInterval = new Interval(0, this.ObjLength);
      Interval zInterval = new Interval(0, this.ObjHeight);

      ObjBox = new Box(planebase, xInterval, yInterval, zInterval);

      xInterval = new Interval(0, this.MrjWidth);
      yInterval = new Interval(0, this.MrjLength);
      zInterval = new Interval(0, this.MrjHeight);

      marginBox = new Box(planebase, xInterval, yInterval, zInterval);
    }

    public void placeBottom(int [,,]emptyFullArray, int[,,]areaArray, out Box ObjBox, out Box marginBox)
    {
      bool emptyBool = true;
      bool sameZone = true;

      this.XCell = Math.Ceiling((double) (this.MrjWidth / CellSize));
      this.YCell = Math.Ceiling((double) (this.MrjLength / CellSize));
      this.ZCell = Math.Ceiling((double) (this.MrjHeight / 150));

      this.baseX = PreviousObject.baseX;
      this.baseY = PreviousObject.baseY;
      this.baseZ = PreviousObject.baseZ - CellSize * this.ZCell;

      if( (baseX + this.ObjWidth < 300) && (baseY + this.ObjLength < 600) && (baseZ + this.ObjHeight < 300) &&
        (baseX + this.ObjWidth > 0) && (baseY + this.ObjLength > 0) && (baseZ + this.ObjHeight > 0) )
      {
        for(int i = (int) (baseX / CellSize) ; i < (baseX / CellSize + (int) XCell); i++)
        {
          for(int j = (int) (baseY / CellSize); j < baseY / CellSize + (int) YCell; j++)
          {
            for(int k = (int) (baseZ / 150); k < baseZ / 150 + (int) ZCell; k++)
            {
              if (emptyFullArray[i, j, k] == 1)
              {
                emptyBool = false;
              }
              if (areaArray[i, j, k] != this.ZoneName)
              {
                sameZone = false;
              }
            }
          }
        }

        if (emptyBool && sameZone)
        {
          Rhino.RhinoApp.WriteLine("Conditions are successful ");
          for(int i = (int) (baseX / CellSize) ; i < (baseX / CellSize + (int) XCell); i++)
          {
            for(int j = (int) (baseY / CellSize); j < baseY / CellSize + (int) YCell; j++)
            {
              for(int k = (int) (baseZ / 150); k < baseZ / 150 + (int) ZCell; k++)
              {
                emptyFullArray[i, j, k] = 1;
              }
            }
          }
        }
        else
        {
          Rhino.RhinoApp.WriteLine("Conditions are not satisfied ");
        }
      }
      else
      {
        Rhino.RhinoApp.WriteLine("Conditions are not satisfied ");
      }

      Point3d pointa = new Point3d(baseX, baseY, baseZ);
      Vector3d pointb = new Vector3d(0, 0, 1);

      Plane planebase = new Plane(pointa, pointb);

      Interval xInterval = new Interval(0, this.ObjWidth);
      Interval yInterval = new Interval(0, this.ObjLength);
      Interval zInterval = new Interval(0, this.ObjHeight);

      ObjBox = new Box(planebase, xInterval, yInterval, zInterval);

      xInterval = new Interval(0, this.MrjWidth);
      yInterval = new Interval(0, this.MrjLength);
      zInterval = new Interval(0, this.MrjHeight);

      marginBox = new Box(planebase, xInterval, yInterval, zInterval);
    }

    public void placeObject(int [,,]emptyFullArray, int[,,]areaArray, out Box ObjBox, out Box marginBox)
    {

      Point3d pointa = new Point3d(baseX, baseY, baseZ);
      Vector3d pointb = new Vector3d(0, 0, 1);

      Plane planebase = new Plane(pointa, pointb);

      Interval xInterval = new Interval(0, this.ObjWidth);
      Interval yInterval = new Interval(0, this.ObjLength);
      Interval zInterval = new Interval(0, this.ObjHeight);

      ObjBox = new Box(planebase, xInterval, yInterval, zInterval);

      xInterval = new Interval(0, this.MrjWidth);
      yInterval = new Interval(0, this.MrjLength);
      zInterval = new Interval(0, this.MrjHeight);

      marginBox = new Box(planebase, xInterval, yInterval, zInterval);

      List<int> growDirection = new List<int>();

      if(PreviousObject.Front == true)
        growDirection.Add(1); // Front Direction
      if(PreviousObject.Right == true)
        growDirection.Add(2); // Right Direction
      if(PreviousObject.Back == true)
        growDirection.Add(3); // Back Direction
      if(PreviousObject.Left == true)
        growDirection.Add(4); // Left Direction
      if(PreviousObject.Bottom == true)
        growDirection.Add(5); // Bottom Direction
      if(PreviousObject.Top == true)
        growDirection.Add(6); // Right Direction

      bool placeSuccess = false;
      int tryCounter = 0;

      if(growDirection.Count >= 1)
      {
        Random randm = new Random();

        while(placeSuccess == false )
        {
          int a = randm.Next(0, growDirection.Count);
          int randomMethod = growDirection[a];

          switch (a)
          ​{
            case 1:
              this.placeFront(emptyFullArray, areaArray, out  ObjBox, out marginBox);
              placeSuccess = true;
              break;
            case 2:
              this.placeRight(emptyFullArray, areaArray, out  ObjBox, out marginBox);
              placeSuccess = true;
              break;
            case 3:
              this.placeBack(emptyFullArray, areaArray, out  ObjBox, out marginBox);
              placeSuccess = true;
              break;
            case 4:
              this.placeLeft(emptyFullArray, areaArray, out  ObjBox, out marginBox);
              placeSuccess = true;
              break;
            case 5:
              this.placeBottom(emptyFullArray, areaArray, out  ObjBox, out marginBox);
              placeSuccess = true;
              break;
            case 6:
              this.placeTop(emptyFullArray, areaArray, out  ObjBox, out marginBox);
              placeSuccess = true;
              break;

            default:
              tryCounter++;
              break;
            // default statements
          }


        }
        growDirection.Clear();




      }


    }


    public void rotate()
    {

    }



    static void mirror()
    {

    }

    static void getClosestCell()
    {

    }

    static void createWall()
    {

    }

  }

  static void ShowMatrix(int[,,] Arr)
  {
    for (int i = 0; i < Arr.GetLength(0); i++)
    {
      for (int j = 0; j < Arr.GetLength(1); j++)
      {
        Rhino.RhinoApp.Write(Arr[i, j, 0] + " ");
      }
      Rhino.RhinoApp.WriteLine("Loop Runs" + i.ToString());
    }
    return;
  }

  static int[,,] InitializeZeroMatrice(int width, int length, int levelNumber)
  {
    var areaArray = new int[width, length, levelNumber];

    for (int k = 0; k < levelNumber; k++)
    {
      for (int i = 0; i < width; i++)
      {
        for (int j = 0; j < length; j++)
        {
          areaArray[i, j, k] = 0;
        }
      }
    }          
    return areaArray;
  }

  /* The Color lists keep the colors in a seperate List in order to choose within them easily instead of searching where they are... */
  static List<int> entranceList = new List<int>();
  static List<int> commonList = new List<int>();
  static List<int> wetAreaList = new List<int>();
 /* static List<int> kitchenList = new List<int>();
  static List<int> commonAreaList = new List<int>();*/

  /**           these counters are used for starting the límitations counts.         **/

  //static int entranceCounter = 1;
 // static int commonCounter = 1;
  //static int wetAreaCounter = 1;
  /*static int kitchenCounter = 1;
  static int commonAreaCounter = 1;*/
  /**           these limits are used for defining max distance that zone can spread.  **/

  //static int entranceLimit = 200;
 // static int commonLimit = 200;
  //static int wetAreaLimit = 200;
  /*static int kitchenLimit = 200;
  static int commonAreaLimit = 100;*/

  static void StartZones(int[,,] arr)
  {
    /**
     * Randomly Starts the color. Takes the Color lists as argumnts
     * (We can delete these argumnents and it can get them as local referance
     * in our case it gives us a chance to choose what to initilize)
     * **/

    Random rand = new Random();
    //----------------------
    /* GetLength(0) and GetLength(1) might be set as variable */
    //Array.GetLength(0) gives the column lenght in other words length of an array
    //Array.GetLength(1) gives the row lenght in other words width of an array
    var a = rand.Next(arr.GetLength(0) / 2, arr.GetLength(0) / 2);
    var b = rand.Next(0, 2);

    Rhino.RhinoApp.WriteLine("started");
    entranceList.AddRange(new int[2] { a, b }); //AddRange ==> Adds multiple elements to a List . We use mod%2 to call the index of the point back instead of stacking them as an another List(or Array) in our list.
    arr[a, b, 0] = 1;// entrance Starting Point
    //----------------------

    b = rand.Next(0, arr.GetLength(1));
    a = rand.Next(0, arr.GetLength(0));

    commonList.AddRange(new int[2] { a, b });
    arr[a, b, 0] = 2; // common Starting Point
    //----------------------
    a = rand.Next(0, arr.GetLength(0));
    b = rand.Next(0, arr.GetLength(1));

    wetAreaList.AddRange(new int[2] { a, b });
    arr[a, b, 0] = 3; // wetArea Starting Point
    //----------------------
    a = rand.Next(0, arr.GetLength(0));
    b = rand.Next(0, arr.GetLength(1));
/*
    kitchenList.AddRange(new int[2] { a, b });
    arr[a, b, 0] = 4; // kitchen Starting Point
    //----------------------
    a = rand.Next(0, arr.GetLength(0));
    b = rand.Next(0, arr.GetLength(1));

    commonAreaList.AddRange(new int[2] { a, b });
    arr[a, b, 0] = 5; // commonArea Starting Point
    //----------------------
  */
  }
        /* Calculates the distance between initial point in the color and the possible new point!
         *  (if the possible new point is too far from inital point eleminate it.) */
  static double distanceCalculate(List<int> spaceCoordList, int x2, int y2, int cellSize)
  {
    var distance = cellSize * Math.Sqrt((y2 - spaceCoordList[1]) * (y2 - spaceCoordList[1]) + (x2 - spaceCoordList[0]) * (x2 - spaceCoordList[0]));
    return distance;
  }

  static void Evaluate()
  {
    // according to relations give score to the created zones
    // get the centers of the zones and acoording to the distances and created sizes give
    //positive or negative points and if score is not acceptable re-run and create variatians.
  }


  static void noiseFilter (int [,,] arr, int type, int iterationNumber, int controlNumber)
  {
    if(type == 0)
    {
      for( int loop = 0 ; loop < iterationNumber ; loop++ )
      {
        List < int> surrounding = new List<int>();
        for(int i = 1 ; i < arr.GetLength(0) - 1 ;i++)
        {
          for(int j = 1 ; j < arr.GetLength(1) - 1 ;j++)
          {
            for(int x = -1 ; x < 2;x++)
            {
              for(int y = -1 ; y < 2;y++)
              {
                if(!(x == y && x == 0))
                {

                  surrounding.Add(arr[i + x, j + y, 0]);
                }
              }
            }
            for (int v = 0 ; v < 6 ;v++) // 6 is the number of the zones including  empty cells
            {
              int count = (from z in surrounding where z == v select z).Count();
              if ( count >= controlNumber )
              {
                arr[i, j, 0] = v;
              }
            }
            surrounding.Clear();
            surrounding.TrimExcess();
          }
        }
      }
    }

    if(type == 1)
    {
      for( int loop = 0 ; loop < iterationNumber ; loop++ )
      {
        List < int> surrounding = new List<int>();
        for(int i = 1 ; i < arr.GetLength(0) - 1 ;i++)
        {
          for(int j = 1 ; j < arr.GetLength(1) - 1 ;j++)
          {
            for(int x = -1 ; x < 2;x++)
            {
              for(int y = -1 ; y < 2;y++)
              {
                if(!(x == y && x == 0) && ( (x + y == 1 ) || (x + y == -1 )) )
                {
                  surrounding.Add(arr[i + x, j + y, 0]);
                }
              }
            }

            for (int v = 0 ; v < 6 ;v++) // 6 is the number of the zones including  empty cells
            {
              int count = (from z in surrounding where z == v select z).Count();
              if ( count >= 2 )
              {
                arr[i, j, 0] = v;
              }
            }
            surrounding.Clear();
            surrounding.TrimExcess();
          }
        }
      }
    }
  }

  static void Spread(int[,,] arr, ref double spaceSize, List<int> spaceCoordList, ref int counter, int spaceLimit, int cellSize)
  {
        /*ARGUMENTS
     * The main array which has rectangular form(will be 3d in short) ,
     * spaceSize = Maximum limit that can grow.  ,
     * spaceCoordList =  the cells of the zone which has been already defined. )
     */
    var rand = new Random();
    var directionList = new List<int>();
    int Xcoord;
    int Ycoord;
    bool draw = false;
    int trycount = 0;

    while (draw == false && counter <= spaceSize)
    {
      if (counter <= spaceSize ) //Can be deleted. The condition is added to the While Loop Conditions.
      {
        var randomCellIndex = rand.Next(spaceCoordList.Count / 2);

        Xcoord = spaceCoordList[2 * randomCellIndex];
        Ycoord = spaceCoordList[2 * randomCellIndex + 1];

        if (Xcoord < arr.GetLength(0) - 1 && Xcoord > 0 && Ycoord > 0 && Ycoord < arr.GetLength(1) - 1)
        {
          /* Check the conditions INSIDE borders */
          if (arr[Xcoord + 1, Ycoord, 0] == 0 && distanceCalculate(spaceCoordList, Xcoord + 1, Ycoord, cellSize) < spaceLimit ) // Check if possible new cell is still white or not!
            directionList.AddRange(new int[2] { (Xcoord + 1), Ycoord }); //Store possible spread directions in a list.

          if (arr[Xcoord - 1, Ycoord, 0] == 0 && distanceCalculate(spaceCoordList, Xcoord - 1, Ycoord, cellSize) < spaceLimit)
            directionList.AddRange(new int[2] { (Xcoord - 1), Ycoord }); //Store possible spread directions in a list.

          if (arr[Xcoord, Ycoord + 1, 0] == 0 && distanceCalculate(spaceCoordList, Xcoord, Ycoord + 1, cellSize) < spaceLimit)
            directionList.AddRange(new int[2] { (Xcoord), Ycoord + 1 }); //Store possible spread directions in a list.

          if (arr[Xcoord, Ycoord - 1, 0] == 0 && distanceCalculate(spaceCoordList, Xcoord, Ycoord - 1, cellSize) < spaceLimit)
            directionList.AddRange(new int[2] { (Xcoord), (Ycoord - 1) }); //Store possible spread directions in a list.

          if (directionList.Count > 0)
          {
            var randomIndex = rand.Next(directionList.Count / 2);
            int a = directionList[2 * randomIndex];
            int b = directionList[2 * randomIndex + 1];

            arr[a, b, 0] = arr[Xcoord, Ycoord, 0];

            spaceCoordList.AddRange(new int[2] { a, b });

            directionList.Clear();
            directionList.TrimExcess();
            draw = true;
            counter++;
          }
          else
          {
            trycount++;
            if (trycount >= spaceCoordList.Count)
            {
              draw = true;
              //Print("trycountNumber is ={0}", trycount);
            }
          }
        }

          /* EDGE CONDITIONS */
          //RIGHT
        else if (Xcoord == (arr.GetLength(0) - 1) && Ycoord != 0 && Ycoord != (arr.GetLength(1) - 1))
        {
          if (arr[Xcoord - 1, Ycoord, 0] == 0 && distanceCalculate(spaceCoordList, Xcoord - 1, Ycoord, cellSize) < spaceLimit )
            directionList.AddRange(new int[2] { (Xcoord - 1), (Ycoord) }); //Store possible spread directions in a list.
          if (arr[Xcoord, Ycoord + 1, 0] == 0 && distanceCalculate(spaceCoordList, Xcoord, Ycoord + 1, cellSize) < spaceLimit )
            directionList.AddRange(new int[2] { (Xcoord ), (Ycoord + 1) }); //Store possible spread directions in a list.
          if (arr[Xcoord, Ycoord - 1, 0] == 0 && distanceCalculate(spaceCoordList, Xcoord, Ycoord - 1, cellSize) < spaceLimit )
            directionList.AddRange(new int[2] { (Xcoord ), (Ycoord - 1) }); //Store possible spread directions in a list.

          if (directionList.Count > 0)
          {
            var randomIndex = rand.Next(directionList.Count / 2);
            int a = directionList[2 * randomIndex];
            int b = directionList[2 * randomIndex + 1];

            arr[a, b, 0] = arr[Xcoord, Ycoord, 0];

            spaceCoordList.AddRange(new int[2] { a, b });

            directionList.Clear();
            directionList.TrimExcess();
            draw = true;
            counter++;
          }
          else
          {
            trycount++;
            if (trycount >= spaceCoordList.Count)
            {
              draw = true;
              //Print("trycountNumber is ={0}", trycount);
            }
          }
        }

          //Left
        else if (Xcoord == 0 && Ycoord != 0 && Ycoord != (arr.GetLength(1) - 1))
        {

          if (arr[Xcoord + 1, Ycoord, 0] == 0 && distanceCalculate(spaceCoordList, Xcoord + 1, Ycoord, cellSize) < spaceLimit )
            directionList.AddRange(new int[2] { (Xcoord + 1), (Ycoord) }); //Store possible spread directions in a list.
          if (arr[Xcoord, Ycoord + 1, 0] == 0 && distanceCalculate(spaceCoordList, Xcoord, Ycoord + 1, cellSize) < spaceLimit )
            directionList.AddRange(new int[2] { (Xcoord ), (Ycoord + 1) }); //Store possible spread directions in a list.
          if (arr[Xcoord, Ycoord - 1, 0] == 0 && distanceCalculate(spaceCoordList, Xcoord, Ycoord - 1, cellSize) < spaceLimit )
            directionList.AddRange(new int[2] { (Xcoord ), (Ycoord - 1) }); //Store possible spread directions in a list.
          if (directionList.Count > 0)
          {
            var randomIndex = rand.Next(directionList.Count / 2);
            int a = directionList[2 * randomIndex];
            int b = directionList[2 * randomIndex + 1];

            arr[a, b, 0] = arr[Xcoord, Ycoord, 0];

            spaceCoordList.AddRange(new int[2] { a, b });

            directionList.Clear();
            directionList.TrimExcess();
            draw = true;
            counter++;
          }
          else
          {
            trycount++;
            if (trycount >= spaceCoordList.Count)
            {
              draw = true;
              //Print("trycountNumber is ={0}", trycount);
            }
          }

        }
          //TOP
        else if ((Ycoord == arr.GetLength(1) - 1) && Xcoord != 0 && Xcoord != (arr.GetLength(0) - 1))
        {

          if (arr[Xcoord, Ycoord - 1, 0] == 0 && distanceCalculate(spaceCoordList, Xcoord, Ycoord - 1, cellSize) < spaceLimit )
            directionList.AddRange(new int[2] { (Xcoord ), (Ycoord - 1) }); //Store possible spread directions in a list.
          if (arr[Xcoord + 1, Ycoord, 0] == 0 && distanceCalculate(spaceCoordList, Xcoord + 1, Ycoord, cellSize) < spaceLimit )
            directionList.AddRange(new int[2] { (Xcoord + 1 ), (Ycoord ) }); //Store possible spread directions in a list.
          if (arr[Xcoord - 1, Ycoord, 0] == 0 && distanceCalculate(spaceCoordList, Xcoord - 1, Ycoord, cellSize) < spaceLimit )
            directionList.AddRange(new int[2] { (Xcoord - 1), (Ycoord ) }); //Store possible spread directions in a list.
          if (directionList.Count > 0)
          {
            var randomIndex = rand.Next(directionList.Count / 2);
            int a = directionList[2 * randomIndex];
            int b = directionList[2 * randomIndex + 1];

            arr[a, b, 0] = arr[Xcoord, Ycoord, 0];

            spaceCoordList.AddRange(new int[2] { a, b });

            directionList.Clear();
            directionList.TrimExcess();
            draw = true;
            counter++;
          }
          else
          {
            trycount++;
            if (trycount >= spaceCoordList.Count)
            {
              draw = true;
              //Print("trycountNumber is ={0}", trycount);
            }
          }
        }
          //BOTTOM
        else if (Ycoord == 0 && Xcoord != 0 && Xcoord != (arr.GetLength(0) - 1))
        {
          if (arr[Xcoord, Ycoord + 1, 0] == 0 && distanceCalculate(spaceCoordList, Xcoord, Ycoord + 1, cellSize) < spaceLimit )
            directionList.AddRange(new int[2] { (Xcoord ), (Ycoord + 1) }); //Store possible spread directions in a list.
          if (arr[Xcoord + 1, Ycoord, 0] == 0 && distanceCalculate(spaceCoordList, Xcoord + 1, Ycoord, cellSize) < spaceLimit )
            directionList.AddRange(new int[2] { (Xcoord + 1 ), (Ycoord ) }); //Store possible spread directions in a list.
          if (arr[Xcoord - 1, Ycoord, 0] == 0 && distanceCalculate(spaceCoordList, Xcoord - 1, Ycoord, cellSize) < spaceLimit )
            directionList.AddRange(new int[2] { (Xcoord - 1), (Ycoord ) }); //Store possible spread directions in a list.
          if (directionList.Count > 0)
          {
            var randomIndex = rand.Next(directionList.Count / 2);
            int a = directionList[2 * randomIndex];
            int b = directionList[2 * randomIndex + 1];

            arr[a, b, 0] = arr[Xcoord, Ycoord, 0];

            spaceCoordList.AddRange(new int[2] { a, b });

            directionList.Clear();
            directionList.TrimExcess();
            draw = true;
            counter++;
          }
          else
          {
            trycount++;
            if (trycount >= spaceCoordList.Count)
            {
              draw = true;
              //Print("trycountNumber is ={0}", trycount);
            }
          }
        }

          //LEFT BOTTOM
        else if (Xcoord == 0 && Ycoord == 0)
        {
          if (arr[Xcoord, Ycoord + 1, 0] == 0 && distanceCalculate(spaceCoordList, Xcoord, Ycoord + 1, cellSize) < spaceLimit)
            directionList.Add(Xcoord); directionList.Add(Ycoord + 1);

          if (arr[Xcoord + 1, Ycoord, 0] == 0 && distanceCalculate(spaceCoordList, Xcoord + 1, Ycoord, cellSize) < spaceLimit)
            directionList.Add(Xcoord + 1); directionList.Add(Ycoord);

          if (directionList.Count > 0)
          {

            var randomIndex = rand.Next(directionList.Count / 2);

            int a = directionList[2 * randomIndex];
            int b = directionList[2 * randomIndex + 1];

            arr[a, b, 0] = arr[Xcoord, Ycoord, 0];

            spaceCoordList.AddRange(new int[2] { a, b });

            directionList.Clear();
            directionList.TrimExcess();
            draw = true;

            counter++;
            //Print(" Counter Number is : {0}", counter);
          }
          else
          {
            trycount++;
            if (trycount >= spaceCoordList.Count)
            {
              draw = true;
              //Print("trycountNumber is ={0}", trycount);
            }
          }
        }
          //LEFT  TOP
          /*
          else if (Xcoord == 0 && Ycoord == (arr.GetLength(1) - 1))
          {
          if (arr[Xcoord + 1, Ycoord] == 0)
          directionList.Add(Xcoord + 1); directionList.Add(Ycoord);

          if (arr[Xcoord, Ycoord - 1] == 0)
          directionList.Add(Xcoord); directionList.Add(Ycoord - 1);

          if (directionList.Count > 0)
          {
          var randomIndex = rand.Next(directionList.Count / 2);

          int a = directionList[2 * randomIndex];
          int b = directionList[2 * randomIndex + 1];

          Rhino.RhinoApp.WriteLine("Left Top "  +  a +  " "  +  b);
          arr[a, b] = arr[Xcoord, Ycoord];

          spaceCoordList.AddRange(new int[2] { a, b });

          directionList.Clear();
          directionList.TrimExcess();
          draw = true;

          counter++;
          //Print(" Counter Number is : {0}", counter);
          }
          else
          {
          trycount++;
          if (trycount >= spaceCoordList.Count)
          {
          draw = true;
          //Print("trycountNumber is ={0}", trycount);
          }
          }
          }
          */
          /*
          //RIGHT TOP
          else if (Xcoord == (arr.GetLength(0) - 1) && Ycoord == (arr.GetLength(1) - 1))
          {
          if (arr[Xcoord, Ycoord - 1] == 0)
          directionList.Add(Xcoord); directionList.Add(Ycoord - 1);

          if (arr[Xcoord - 1, Ycoord] == 0)
          directionList.Add(Xcoord - 1); directionList.Add(Ycoord);

          if (directionList.Count > 0)
          {
          var randomIndex = rand.Next(directionList.Count / 2);

          int a = directionList[2 * randomIndex];
          int b = directionList[2 * randomIndex + 1];
          Rhino.RhinoApp.WriteLine(" Right top "+ a + " " + b);
          arr[a, b] = arr[Xcoord, Ycoord];

          //spaceCoordList.AddRange(new int[2] { a, b });

          directionList.Clear();
          directionList.TrimExcess();
          draw = true;

          counter++;
          //Print(" Counter Number is : {0}", counter);
          }
          else
          {
          trycount++;
          if (trycount >= spaceCoordList.Count)
          {
          draw = true;
          //Print("trycountNumber is ={0}", trycount);
          }
          }
          }
          */
          //RIGHT BOTTOM
        else if (Xcoord == (arr.GetLength(0) - 1) && Ycoord == 0)
        {
          if (arr[Xcoord, Ycoord + 1, 0] == 0)
            directionList.Add(Xcoord); directionList.Add(Ycoord + 1);

          if (arr[Xcoord - 1, Ycoord, 0] == 0)
            directionList.Add(Xcoord - 1); directionList.Add(Ycoord);

          if (directionList.Count > 0)
          {
            var randomIndex = rand.Next(directionList.Count / 2);

            int a = directionList[2 * randomIndex];
            int b = directionList[2 * randomIndex + 1];

            arr[a, b, 0] = arr[Xcoord, Ycoord, 0];

            spaceCoordList.AddRange(new int[2] { a, b });

            directionList.Clear();
            directionList.TrimExcess();

            draw = true;
            counter++;
            //Print(" Counter Number is : {0}", counter);
          }
          else
          {
            trycount++;
            if (trycount >= spaceCoordList.Count)
            {
              draw = true;
              //Print("trycountNumber is ={0}", trycount);
            }
          }
        }
        /* EDGE CONDITIONS */
      }
    }

  }




    /* Instead of wrting methods seperately in main program, it is better to use class based
     informations to keep things organized, we are not yet transsferentrance methods here but we created the str.*/

    /*
    public class Zone
    {
        public string Name;
        public int SpaceLimit;
        public Int16 SpaceSize;
        public int Counter;
        public List<Int16> SpaceList;

        public void Describe()
        {
            Console.WriteLine("Hey this zone is{ 0} ", Name);
        }

        public Zone()
        {
           // SpaceList = new List<int>();
        }

        public Zone(string name, int spaceLimit,int spacesize,int counter, List<int> SpaceList)
        :this()
        {
        }
        static void InitializeZeroMatrice() { }
        static void startZones() { }
        public void SpreadZones() { }

    }
    */
# ---------- end c_script_4 ----------
box_35 = Box(c_script_4.Furnitures)  # disabled
deconstruct_box_29 = DeconstructBox(Box=box_35)  # -> Plane, X, Y, Z; disabled
panel_31 = Panel(deconstruct_box_29.Plane)  # disabled
panel_32 = Panel(deconstruct_box_29.Y)  # disabled
panel_33 = Panel(deconstruct_box_29.X)  # disabled
panel_34 = Panel(deconstruct_box_29.Z)  # disabled
boolean_toggle_2 = BooleanToggle(False)  # disabled
box_36 = Box(c_script_2.Bxx)  # disabled
deconstruct_domain_48 = DeconstructDomain(Domain=panel_28)  # -> Start, End; disabled
deconstruct_domain_49 = DeconstructDomain(Domain=panel_30)  # -> Start, End; disabled
deconstruct_domain_50 = DeconstructDomain(Domain=panel_29)  # -> Start, End; disabled
deconstruct_domain_51 = DeconstructDomain(Domain=panel_32)  # -> Start, End; disabled
deconstruct_domain_52 = DeconstructDomain(Domain=panel_33)  # -> Start, End; disabled
deconstruct_domain_53 = DeconstructDomain(Domain=panel_34)  # -> Start, End; disabled
panel_35 = Panel(box_36)  # disabled
list_item = ListItem(List=c_script_2.Furnitures, Index=number_slider_66, Wrap=boolean_toggle)  # disabled
box_37 = Box(c_script_4.Bxx)  # disabled
panel_36 = Panel(c_script_2.out)  # disabled
panel_37 = Panel(deconstruct_domain_49.End)  # disabled
panel_38 = Panel(deconstruct_domain_48.End)  # disabled
panel_39 = Panel(deconstruct_domain_50.End)  # disabled
panel_40 = Panel(box_37)  # disabled
panel_41 = Panel(deconstruct_domain_51.End)  # disabled
panel_42 = Panel(deconstruct_domain_52.End)  # disabled
# White Cells
panel_43 = Panel(deconstruct_domain_53.End)  # disabled
list_item_2 = ListItem(List=c_script_4.Furnitures, Index=number_slider_67, Wrap=boolean_toggle_2)  # disabled
# White Cells
panel_44 = Panel(c_script_4.out)  # disabled
number_slider_68 = Slider(0, range=0..1)  # disabled
number_slider_69 = Slider(0.611, range=0..1)  # disabled
number_slider_70 = Slider(0.809, range=0..1)  # disabled
colour_swatch = ColourSwatch(SwatchColor=RGB(0, 0, 0))  # disabled
colour_swatch_2 = ColourSwatch(SwatchColor=RGB(0, 0, 0))  # disabled
colour_swatch_3 = ColourSwatch(SwatchColor=RGB(255, 255, 0))  # disabled
colour_swatch_4 = ColourSwatch(SwatchColor=RGB(0, 0, 0))  # disabled
colour_swatch_5 = ColourSwatch(SwatchColor=RGB(255, 255, 255))  # disabled
colour_swatch_6 = ColourSwatch(SwatchColor=RGB(240, 240, 200))  # disabled
colour_swatch_7 = ColourSwatch(SwatchColor=RGB(240, 200, 200))  # disabled
colour_swatch_8 = ColourSwatch(SwatchColor=RGB(150, 200, 255))  # disabled

# ---- group: Visualize as 3D Boxes
number_slider_71 = Slider(0.801, range=0..1)  # disabled
create_material = CreateMaterial(Diffuse=colour_swatch_6, Specular=RGB(255, 255, 255), Emission=RGB(0, 0, 0), Transparency=number_slider_71, Shine=0)  # disabled
create_material_2 = CreateMaterial(Diffuse=colour_swatch_3, Specular=RGB(255, 255, 255), Emission=RGB(0, 0, 0), Transparency=number_slider_71, Shine=0)  # disabled
create_material_3 = CreateMaterial(Diffuse=colour_swatch_7, Specular=RGB(255, 255, 255), Emission=RGB(0, 0, 0), Transparency=number_slider_71, Shine=0)  # disabled
create_material_4 = CreateMaterial(Diffuse=colour_swatch_8, Specular=RGB(255, 255, 255), Emission=RGB(0, 0, 0), Transparency=number_slider_71, Shine=0)  # disabled
create_material_5 = CreateMaterial(Diffuse=colour_swatch_4, Specular=RGB(255, 255, 255), Emission=RGB(0, 0, 0), Transparency=number_slider_71, Shine=0)  # disabled
create_material_6 = CreateMaterial(Diffuse=colour_swatch_5, Specular=RGB(255, 255, 255), Emission=RGB(0, 0, 0), Transparency=number_slider_70, Shine=0)  # disabled
custom_preview = CustomPreview(Geometry=c_script_2.EntranceBoxes, Material=create_material)  # disabled
custom_preview_2 = CustomPreview(Geometry=c_script_2.CommonBoxes, Material=create_material_3)  # disabled
custom_preview_3 = CustomPreview(Geometry=c_script_2.Y, Material=create_material_2)  # disabled
custom_preview_4 = CustomPreview(Geometry=c_script_2.WetAreaBoxes, Material=create_material_4)  # disabled
custom_preview_5 = CustomPreview(Geometry=c_script_2.K, Material=create_material_5)  # disabled
custom_preview_6 = CustomPreview(Geometry=c_script_2.W, Material=create_material_6)  # disabled

# ----
number_slider_72 = Slider(0, range=0..1)  # disabled
number_slider_73 = Slider(0.611, range=0..1)  # disabled
number_slider_74 = Slider(0.544, range=0..1)  # disabled
colour_swatch_9 = ColourSwatch(SwatchColor=RGB(0, 0, 0))  # disabled
colour_swatch_10 = ColourSwatch(SwatchColor=RGB(0, 0, 0))  # disabled
colour_swatch_11 = ColourSwatch(SwatchColor=RGB(255, 255, 0))  # disabled
colour_swatch_12 = ColourSwatch(SwatchColor=RGB(0, 0, 0))  # disabled
colour_swatch_13 = ColourSwatch(SwatchColor=RGB(255, 255, 255))  # disabled
colour_swatch_14 = ColourSwatch(SwatchColor=RGB(240, 240, 200))  # disabled
colour_swatch_15 = ColourSwatch(SwatchColor=RGB(240, 200, 200))  # disabled
colour_swatch_16 = ColourSwatch(SwatchColor=RGB(150, 200, 255))  # disabled

# ---- group: Visualize as 3D Boxes
number_slider_75 = Slider(0.801, range=0..1)  # disabled
create_material_7 = CreateMaterial(Diffuse=colour_swatch_14, Specular=RGB(255, 255, 255), Emission=RGB(0, 0, 0), Transparency=number_slider_75, Shine=0)  # disabled
create_material_8 = CreateMaterial(Diffuse=colour_swatch_11, Specular=RGB(255, 255, 255), Emission=RGB(0, 0, 0), Transparency=number_slider_75, Shine=0)  # disabled
create_material_9 = CreateMaterial(Diffuse=colour_swatch_15, Specular=RGB(255, 255, 255), Emission=RGB(0, 0, 0), Transparency=number_slider_75, Shine=0)  # disabled
create_material_10 = CreateMaterial(Diffuse=colour_swatch_16, Specular=RGB(255, 255, 255), Emission=RGB(0, 0, 0), Transparency=number_slider_75, Shine=0)  # disabled
create_material_11 = CreateMaterial(Diffuse=colour_swatch_12, Specular=RGB(255, 255, 255), Emission=RGB(0, 0, 0), Transparency=number_slider_75, Shine=0)  # disabled
create_material_12 = CreateMaterial(Diffuse=colour_swatch_13, Specular=RGB(255, 255, 255), Emission=RGB(0, 0, 0), Transparency=number_slider_74, Shine=0)  # disabled
custom_preview_7 = CustomPreview(Geometry=c_script_4.EntranceBoxes, Material=create_material_7)  # disabled
custom_preview_8 = CustomPreview(Geometry=c_script_4.CommonBoxes, Material=create_material_9)  # disabled
custom_preview_9 = CustomPreview(Geometry=c_script_4.Y, Material=create_material_8)  # disabled
custom_preview_10 = CustomPreview(Geometry=c_script_4.WetAreaBoxes, Material=create_material_10)  # disabled
custom_preview_11 = CustomPreview(Geometry=c_script_4.K, Material=create_material_11)  # disabled
custom_preview_12 = CustomPreview(Geometry=c_script_4.W, Material=create_material_12)  # disabled

# ----
create_material_13 = CreateMaterial(Diffuse=colour_swatch, Specular=RGB(255, 255, 255), Emission=RGB(0, 0, 0), Transparency=number_slider_68, Shine=0)  # disabled
create_material_14 = CreateMaterial(Diffuse=colour_swatch_2, Specular=RGB(255, 255, 255), Emission=RGB(0, 0, 0), Transparency=number_slider_69, Shine=0)  # disabled
create_material_15 = CreateMaterial(Diffuse=colour_swatch_9, Specular=RGB(255, 255, 255), Emission=RGB(0, 0, 0), Transparency=number_slider_72, Shine=0)  # disabled
create_material_16 = CreateMaterial(Diffuse=colour_swatch_10, Specular=RGB(255, 255, 255), Emission=RGB(0, 0, 0), Transparency=number_slider_73, Shine=0)  # disabled
custom_preview_13 = CustomPreview(Geometry=c_script_2.Furnitures, Material=create_material_13)  # disabled
custom_preview_14 = CustomPreview(Geometry=c_script_2.FurnituresMargins, Material=create_material_14)  # disabled
custom_preview_15 = CustomPreview(Geometry=c_script_4.Furnitures, Material=create_material_15)  # disabled
custom_preview_16 = CustomPreview(Geometry=c_script_4.FurnituresMargins, Material=create_material_16)  # disabled
list_length = ListLength(List=c_script_2.EntranceBoxes)  # disabled
list_length_2 = ListLength(List=c_script_2.CommonBoxes)  # disabled
list_length_3 = ListLength(List=c_script_2.W)  # disabled
list_length_4 = ListLength(List=c_script_2.WetAreaBoxes)  # disabled
list_length_5 = ListLength(List=c_script_2.Y)  # disabled
list_length_6 = ListLength(List=c_script_2.K)  # disabled
list_length_7 = ListLength(List=c_script_4.EntranceBoxes)  # disabled
list_length_8 = ListLength(List=c_script_4.CommonBoxes)  # disabled
list_length_9 = ListLength(List=c_script_4.W)  # disabled
list_length_10 = ListLength(List=c_script_4.WetAreaBoxes)  # disabled
list_length_11 = ListLength(List=c_script_4.Y)  # disabled
list_length_12 = ListLength(List=c_script_4.K)  # disabled
multiplication_14 = Multiplication(A=list_length_2, B=division_4)  # disabled
multiplication_15 = Multiplication(A=list_length, B=division_4)  # disabled
multiplication_16 = Multiplication(A=list_length_3, B=division_4)  # disabled
multiplication_17 = Multiplication(A=list_length_4, B=division_4)  # disabled
multiplication_18 = Multiplication(A=list_length_5, B=division_4)  # disabled
multiplication_19 = Multiplication(A=list_length_6, B=division_4)  # disabled
multiplication_20 = Multiplication(A=list_length_8, B=division_7)  # disabled
multiplication_21 = Multiplication(A=list_length_7, B=division_7)  # disabled
multiplication_22 = Multiplication(A=list_length_9, B=division_7)  # disabled
multiplication_23 = Multiplication(A=list_length_10, B=division_7)  # disabled
multiplication_24 = Multiplication(A=list_length_11, B=division_7)  # disabled
panel_45 = Panel("m2 ")  # disabled
panel_46 = Panel(multiplication_15)  # disabled
panel_47 = Panel(" Entrance = ")  # disabled
multiplication_25 = Multiplication(A=list_length_12, B=division_7)  # disabled
panel_48 = Panel(" Empty Space= ")  # disabled
panel_49 = Panel(multiplication_16)  # disabled
panel_50 = Panel("m2 ")  # disabled
panel_51 = Panel("m2 ")  # disabled
panel_52 = Panel(multiplication_14)  # disabled
panel_53 = Panel(" CommonArea = ")  # disabled
panel_54 = Panel("m2 ")  # disabled
panel_55 = Panel(multiplication_17)  # disabled
panel_56 = Panel("Wet Area = ")  # disabled
panel_57 = Panel(multiplication_18)  # disabled
panel_58 = Panel(" Common Area = ")  # disabled
panel_59 = Panel("m2 ")  # disabled
panel_60 = Panel(" Kitchen = ")  # disabled
panel_61 = Panel(" m2 ")  # disabled
panel_62 = Panel(multiplication_19)  # disabled
panel_63 = Panel("m2 ")  # disabled
panel_64 = Panel(multiplication_21)  # disabled
panel_65 = Panel(" Entrance = ")  # disabled
number_slider_76 = Slider(15, range=0..100)  # disabled
panel_66 = Panel(" Empty Space= ")  # disabled
panel_67 = Panel(multiplication_22)  # disabled
panel_68 = Panel("m2 ")  # disabled
panel_69 = Panel(multiplication_20)  # disabled
panel_70 = Panel("m2 ")  # disabled
panel_71 = Panel(" CommonArea = ")  # disabled
panel_72 = Panel("m2 ")  # disabled
panel_73 = Panel(multiplication_23)  # disabled
panel_74 = Panel(multiplication_24)  # disabled
panel_75 = Panel("Wet Area = ")  # disabled
panel_76 = Panel(" Common Area = ")  # disabled
panel_77 = Panel("m2 ")  # disabled
panel_78 = Panel(" Kitchen = ")  # disabled
panel_79 = Panel(" m2 ")  # disabled
panel_80 = Panel(multiplication_25)  # disabled
number_slider_77 = Slider(15, range=0..100)  # disabled
concatenate = Concatenate(Fragment_A=panel_48, Fragment_B=panel_49, Fragment_C=panel_51)  # disabled
concatenate_2 = Concatenate(Fragment_A=panel_47, Fragment_B=panel_46, Fragment_C=panel_45)  # disabled
panel_81 = Panel("0,-50")  # disabled
concatenate_3 = Concatenate(Fragment_A=panel_53, Fragment_B=panel_52, Fragment_C=panel_50)  # disabled
panel_82 = Panel("0,-80")  # disabled
panel_83 = Panel("0,-140")  # disabled
concatenate_4 = Concatenate(Fragment_A=panel_56, Fragment_B=panel_55, Fragment_C=panel_54)  # disabled
concatenate_5 = Concatenate(Fragment_A=panel_60, Fragment_B=panel_57, Fragment_C=panel_59)  # disabled
concatenate_6 = Concatenate(Fragment_A=panel_58, Fragment_B=panel_62, Fragment_C=panel_61)  # disabled
concatenate_7 = Concatenate(Fragment_A=panel_66, Fragment_B=panel_67, Fragment_C=panel_68)  # disabled
concatenate_8 = Concatenate(Fragment_A=panel_65, Fragment_B=panel_64, Fragment_C=panel_63)  # disabled
panel_84 = Panel("0,-50")  # disabled
concatenate_9 = Concatenate(Fragment_A=panel_71, Fragment_B=panel_69, Fragment_C=panel_70)  # disabled
panel_85 = Panel("0,-80")  # disabled
panel_86 = Panel(concatenate)  # disabled
panel_87 = Panel(concatenate_2)  # disabled
panel_88 = Panel("0,-140")  # disabled
concatenate_10 = Concatenate(Fragment_A=panel_75, Fragment_B=panel_73, Fragment_C=panel_72)  # disabled
concatenate_11 = Concatenate(Fragment_A=panel_78, Fragment_B=panel_74, Fragment_C=panel_77)  # disabled
panel_89 = Panel(concatenate_3)  # disabled
concatenate_12 = Concatenate(Fragment_A=panel_76, Fragment_B=panel_80, Fragment_C=panel_79)  # disabled
panel_90 = Panel(concatenate_4)  # disabled
panel_91 = Panel(concatenate_5)  # disabled
panel_92 = Panel(concatenate_6)  # disabled
panel_93 = Panel("240,-170")  # disabled
panel_94 = Panel("0,-110")  # disabled
panel_95 = Panel(concatenate_7)  # disabled
panel_96 = Panel(concatenate_8)  # disabled
panel_97 = Panel(concatenate_9)  # disabled
panel_98 = Panel(concatenate_10)  # disabled
panel_99 = Panel(concatenate_11)  # disabled
panel_100 = Panel("120,-200")  # disabled
panel_101 = Panel(concatenate_12)  # disabled
panel_102 = Panel("240,-170")  # disabled
panel_103 = Panel("0,-110")  # disabled
text_tag_3d = TextTag3D(Location=panel_81, Text=concatenate_2, Size=number_slider_76, Colour=colour_swatch_6, Justification=7)  # disabled
text_tag_3d_2 = TextTag3D(Location=panel_82, Text=concatenate_3, Size=number_slider_76, Colour=colour_swatch_7, Justification=7)  # disabled
text_tag_3d_3 = TextTag3D(Location=panel_83, Text=concatenate_5, Size=number_slider_76, Colour=colour_swatch_3, Justification=7)  # disabled
text_tag_3d_4 = TextTag3D(Location=panel_94, Text=concatenate_4, Size=number_slider_76, Colour=colour_swatch_8, Justification=7)  # disabled
text_tag_3d_5 = TextTag3D(Location=panel_83, Text=concatenate, Size=number_slider_76, Colour=colour_swatch_5, Justification=7)  # disabled
text_tag_3d_6 = TextTag3D(Location=panel_93, Text=concatenate_6, Size=number_slider_76, Colour=colour_swatch_4, Justification=7)  # disabled
text_tag_3d_7 = TextTag3D(Location=panel_84, Text=concatenate_8, Size=number_slider_77, Colour=colour_swatch_14, Justification=7)  # disabled
text_tag_3d_8 = TextTag3D(Location=panel_85, Text=concatenate_9, Size=number_slider_77, Colour=colour_swatch_15, Justification=7)  # disabled
text_tag_3d_9 = TextTag3D(Location=panel_88, Text=concatenate_11, Size=number_slider_77, Colour=colour_swatch_11, Justification=7)  # disabled
text_tag_3d_10 = TextTag3D(Location=panel_103, Text=concatenate_10, Size=number_slider_77, Colour=colour_swatch_16, Justification=7)  # disabled
text_tag_3d_11 = TextTag3D(Location=panel_88, Text=concatenate_7, Size=number_slider_77, Colour=colour_swatch_13, Justification=7)  # disabled
text_tag_3d_12 = TextTag3D(Location=panel_102, Text=concatenate_12, Size=number_slider_77, Colour=colour_swatch_12, Justification=7)  # disabled
mass_addition = MassAddition(Input=[multiplication_14, multiplication_15, multiplication_17, multiplication_18, multiplication_19, multiplication_16])  # -> flatten(Result), PartialResults; disabled
number_slider_78 = Slider(1, range=0..1)  # disabled
mass_addition_2 = MassAddition(Input=[multiplication_20, multiplication_21, multiplication_23, multiplication_24, multiplication_25, multiplication_22])  # -> flatten(Result), PartialResults; disabled
panel_105 = Panel(" Total Area =")  # disabled
number_slider_79 = Slider(1, range=0..1)  # disabled
panel_106 = Panel("m2 ")  # disabled
list_item_3 = ListItem(List=mass_addition.Result, Index=number_slider_78, Wrap=True)  # disabled
panel_107 = Panel(list_item_3)  # disabled
panel_108 = Panel(" Total Area =")  # disabled
panel_109 = Panel("m2 ")  # disabled
list_item_4 = ListItem(List=mass_addition_2.Result, Index=number_slider_79, Wrap=True)  # disabled
panel_110 = Panel(list_item_4)  # disabled
panel_111 = Panel("240,-100")  # disabled
concatenate_13 = Concatenate(Fragment_A=panel_105, Fragment_B=panel_107, Fragment_C=panel_106)  # disabled
panel_112 = Panel("240,-100")  # disabled
concatenate_14 = Concatenate(Fragment_A=panel_108, Fragment_B=panel_110, Fragment_C=panel_109)  # disabled
panel_113 = Panel(concatenate_13)  # disabled
text_tag_3d_13 = TextTag3D(Location=panel_111, Text=concatenate_13, Size=number_slider_76, Justification=7)  # disabled
panel_114 = Panel(concatenate_14)  # disabled
text_tag_3d_14 = TextTag3D(Location=panel_112, Text=concatenate_14, Size=number_slider_77, Justification=7)  # disabled
number_slider_80 = Slider(10, range=0..10)  # disabled
number_slider_81 = Slider(30, range=0..100)  # disabled
number_slider_82 = Slider(60, range=20..60)  # disabled
number_slider_83 = Slider(6, range=2..10)  # disabled
number_slider_84 = Slider(36, range=20..60)  # disabled
multiplication_26 = Multiplication(A=number_slider_81, B=number_slider_80)  # disabled
number_slider_85 = Slider(2, range=0..10)  # disabled
multiplication_27 = Multiplication(A=number_slider_82, B=number_slider_80)  # disabled
multiplication_28 = Multiplication(A=number_slider_83, B=number_slider_80)  # disabled
multiplication_29 = Multiplication(A=number_slider_84, B=number_slider_80)  # disabled
number_slider_86 = Slider(10000, range=0..10000)  # disabled
round_2 = Round()  # -> Nearest, Floor, Ceiling; disabled
panel_115 = Panel(multiplication_26)  # disabled
panel_116 = Panel(multiplication_29)  # disabled
panel_117 = Panel(multiplication_27)  # disabled
multiplication_30 = Multiplication(A=multiplication_28, B=multiplication_28)  # disabled
number_slider_87 = Slider(100, range=0..100)  # disabled
division_8 = Division(A=multiplication_27, B=multiplication_28)  # disabled
panel_118 = Panel(multiplication_28)  # disabled
division_9 = Division(A=multiplication_29, B=multiplication_28)  # disabled
number_slider_88 = Slider(150, range=0..1000)  # disabled
multiplication_31 = Multiplication(A=number_slider_86, B=number_slider_85)  # disabled
division_10 = Division(A=multiplication_30, B=multiplication_31)  # disabled
panel_119 = Panel(division_9)  # disabled
integer_7 = Integer(division_9)  # disabled
integer_8 = Integer(division_8)  # disabled
integer_9 = Integer(panel_115)  # disabled
box_38 = Box(closet)  # disabled
box_39 = Box(closet_margin)  # disabled
box_40 = Box(exterior_door)  # disabled
c_script_5 = CSharpScript(boxx=box_40)  # -> out, lenght; inputs boxx: Box; disabled; same code as c_script
panel_120 = Panel(c_script_5.lenght)  # disabled
deconstruct_box_30 = DeconstructBox(Box=box_40)  # -> Plane, X, Y, Z; disabled
panel_121 = Panel(deconstruct_box_30.Plane)  # disabled
panel_122 = Panel(deconstruct_box_30.Y)  # disabled
panel_123 = Panel(deconstruct_box_30.Z)  # disabled
panel_124 = Panel(deconstruct_box_30.X)  # disabled
box_41 = Box(changeover_zone)  # disabled
box_42 = Box(exterior_door_margin)  # disabled
box_43 = Box(change_over_zone_margin)  # disabled
box_44 = Box()  # disabled
box_45 = Box()  # disabled
box_46 = Box()  # disabled
box_47 = Box()  # disabled
box_48 = Box()  # disabled
box_49 = Box()  # disabled
box_50 = Box()  # disabled
box_51 = Box()  # disabled
box_52 = Box()  # disabled
box_53 = Box()  # disabled
box_54 = Box()  # disabled
number_slider_89 = Slider(8, range=0..10)  # disabled
c_script_6 = CSharpScript(
    Width=integer_8,
    Length=integer_7,
    Height=integer_9,
    LevelHeight=number_slider_88,
    cellSize=multiplication_28,
    ExteriorDoor=box_40,
    ExteriorDoorMargin=box_42,
    ChangeOverZone=box_41,
    ChangeOverZoneMargin=box_43,
    Closet=box_38,
    ClosetMargin=box_39,
    InteriorDoor=box_44,
    InteriorDoorMargin=box_45,
    Counter=box_46,
    CounterMargin=box_47,
    Table=box_48,
    TableMargin=box_49,
    SittingUnit=box_50,
    SittingUnitMargin=box_51,
    Bed=box_52,
    HealtCare=box_53,
    HealthCareMargin=box_54)  # -> out, A, EntranceBoxes, CommonBoxes, WetAreaBoxes, Y, K, W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; inputs Width: Int32, Length: Int32, Height: Int32, LevelHeight: Int32, cellSize: Int32, ExteriorDoor: Box, ExteriorDoorMargin: Box, ChangeOverZone: Box, ChangeOverZoneMargin: Box, Closet: Box, ClosetMargin: Box, InteriorDoor: Box, InteriorDoorMargin: Box, Counter: Box, CounterMargin: Box, Table: Box, TableMargin: Box, SittingUnit: Box, SittingUnitMargin: Box, Bed: Box, BedMargin: Box, HealtCare: Box, HealthCareMargin: Box; disabled
# ---------- c_script_6: C# ----------
    List<Box> entranceBoxes = new List<Box>();
    List<Box> commonBoxes = new List<Box>();
    List<Box> wetAreaBoxes = new List<Box>();

    /*List<Box> kitchenBoxes = new List<Box>();
      List<Box> commonAreaBoxes = new List<Box>();*/

    List<Box> WhiteBoxes = new List<Box>();

    /**  These sizes are Spreading Limits for the spaces   //total cells     **/

    double entranceSize = (6 * 100 * 100) / (cellSize * cellSize);
    double commonSize = (8 * 100 * 100) / (cellSize * cellSize);
    double wetAreaSize = (6 * 100 * 100 ) / (cellSize * cellSize);

    /*
    double kitchenSize = 7 * 100 * 100 / cellSize * cell  Size;
    double commonAreaSize = 10 * 100 * 100 / cellSize * cellSize;
    */

    Point3d pA = new Point3d(0, 0, 0);
    Point3d pB = new Point3d(10, 0, 0);
    Point3d pC = new Point3d(0, 10, 0);

    Plane p = new Plane(pA, pB, pC);

    int width = Width;
    int length = Length;
    int levelHeight = LevelHeight;
    int height = Height;
    int levelNumber = Height / LevelHeight;

    int[,,] areaArray = InitializeZeroMatrice(length, width, levelNumber);
    StartZones(areaArray);

    int[,,] emptyFullArray = InitializeZeroMatrice(length, width, levelNumber);

    for (int i = 0; i < width * length * 3; i++)
    {

      Spread(areaArray, ref entranceSize, entranceList, ref entranceCounter, entranceLimit, cellSize);
      Spread(areaArray, ref commonSize, commonList, ref commonCounter, commonLimit, cellSize);
      Spread(areaArray, ref wetAreaSize, wetAreaList, ref wetAreaCounter, wetAreaLimit, cellSize);

    }
/*
    noiseFilter(areaArray, 0, 6, 5);
    noiseFilter(areaArray, 1, 2, 2);
*/
    for (int k = 0;k < levelNumber;k++)
    {
      for (int i = 0;i < length;i++)
      {
        for (int j = 0;j < width;j++)
        {
          areaArray[i, j, k] = areaArray[i, j, 0];
        }
      }
    }

    for (int k = 0;k < levelNumber;k++)
    {
      for (int i = 0;i < length;i++)
      {
        for (int j = 0;j < width;j++)
        {
          emptyFullArray[i, j, k] = 0;
        }
      }
    }

    entranceList.Clear();
    commonList.Clear();
    wetAreaList.Clear();
    /*kitchenList.Clear();
    commonAreaList.Clear();*/

    for (int k = 0;k < levelNumber;k++)
    {
      for (int i = 0;i < length;i++)
      {
        for (int j = 0;j < width;j++)
        {
          if (areaArray[i, j, k] == 1)
          {
            Interval xInterval = new Interval(i * cellSize, (i + 1) * (cellSize ));
            Interval yInterval = new Interval(j * cellSize, (j + 1) * (cellSize ));
            Interval zInterval = new Interval(k * LevelHeight, k * LevelHeight + levelHeight);

            Box boxgh = new Box(p, xInterval, yInterval, zInterval);
            entranceBoxes.Add(boxgh);
            entranceList.AddRange(new int[2] { i, j });
          }
          if (areaArray[i, j, k] == 2)
          {
            Interval xInterval = new Interval(i * cellSize, (i + 1) * (cellSize ));
            Interval yInterval = new Interval(j * cellSize, (j + 1) * (cellSize ));
            Interval zInterval = new Interval(k * LevelHeight, k * LevelHeight + levelHeight);

            Box boxgh = new Box(p, xInterval, yInterval, zInterval);
            commonBoxes.Add(boxgh);
            commonList.AddRange(new int[2] { i, j });
          }
          if (areaArray[i, j, k] == 3)
          {
            Interval xInterval = new Interval(i * cellSize, (i + 1) * (cellSize ));
            Interval yInterval = new Interval(j * cellSize, (j + 1) * (cellSize ));
            Interval zInterval = new Interval(k * LevelHeight, k * LevelHeight + levelHeight);

            Box boxgh = new Box(p, xInterval, yInterval, zInterval);
            wetAreaBoxes.Add(boxgh);
            wetAreaList.AddRange(new int[2] { i, j });
          }

          /*if (areaArray[i, j, k] == 4)
          {
            Interval xInterval = new Interval(j * cellSize, (j + 1) * (cellSize ));
            Interval yInterval = new Interval(i * cellSize, (i + 1) * (cellSize ));
            Interval zInterval = new Interval(k * LevelHeight, k * LevelHeight + levelHeight);

            Box boxgh = new Box(p, xInterval, yInterval, zInterval);
            kitchenBoxes.Add(boxgh);
            kitchenList.AddRange(new int[2] { i, j });
          }
          if (areaArray[i, j, k] == 5)
          {
            Interval xInterval = new Interval(j * cellSize, (j + 1) * (cellSize ));
            Interval yInterval = new Interval(i * cellSize, (i + 1) * (cellSize ));
            Interval zInterval = new Interval(k * LevelHeight, k * LevelHeight + levelHeight);

            Box boxgh = new Box(p, xInterval, yInterval, zInterval);
            commonAreaBoxes.Add(boxgh);
            commonAreaList.AddRange(new int[2] { i, j });
          }*/
          if (areaArray[i, j, k] == 0)
          {

            Interval xInterval = new Interval(i * cellSize, (i + 1) * (cellSize ));
            Interval yInterval = new Interval(j * cellSize, (j + 1) * (cellSize ));
            Interval zInterval = new Interval(k * LevelHeight, k * LevelHeight + levelHeight);

            Box boxgh = new Box(p, xInterval, yInterval, zInterval);
            WhiteBoxes.Add(boxgh);
            //WhiteList.AddRange(i, j);
          }
        }
      }
    }

    ShowMatrix(areaArray);

    A = areaArray;
    EntranceBoxes = entranceBoxes;
    CommonBoxes = commonBoxes;
    WetAreaBoxes = wetAreaBoxes;
    W = WhiteBoxes;
# ---------- c_script_6: C# additional code ----------
  class Objects
  {
    public string Name;
    public int ZoneName;

    public Box Obj;
    public Box ObjMargin;

    public bool Front = false;
    public bool Right = false;
    public bool Back = false;
    public bool Left = false;
    public bool Top = false;
    public bool Bottom = false;

    public bool RotationBool = true;
    public int RotationOpt; // rotation options

    public bool MirrorBool = true;
    public int MirrorOpt; // mirror options

    public string Source; // Water, Electiricity
    public int FixedToWall; // Bed, Television //1,2,3 conditions
    public int CellSize;

    public Objects PreviousObject;

    public double ObjLength ;
    public double ObjWidth ;
    public double ObjHeight ;

    public double MrjLength;
    public double MrjWidth;
    public double MrjHeight;

    public double baseX, baseY, baseZ;
    public List<int> SpaceList = new List<int>();

    public double  XCell;
    public double  YCell;
    public double  ZCell;


    //deneme
    public Objects()
    {
            /*
            var Coordinates = new List<int>();
            Point3d pA = new Point3d(0, 0, 0);
            Point3d pB = new Point3d(10, 0, 0);
            Point3d pC = new Point3d(0, 10, 0);

            Plane p = new Plane(pA, pB, pC);*/
    }

    public Objects(string name, int zoneName, bool front, bool right, bool back, bool left, bool top, bool bottom, bool rotationalBool, int rotationOpt, bool mirrorBool, int mirrorOpt, string source, int fixedTowall, int cellSize, Box obj, Box objMargin, Objects previousObject, List<int> spaceList)
      : this()
    {
      this.Obj = obj;
      this.ObjMargin = objMargin;

      this.Name = name;
      this.ZoneName = zoneName;

      this.Front = front;
      this.Right = right;
      this.Back = back;
      this.Left = left;
      this.Bottom = bottom;
      this.Top = top;

      this.RotationBool = rotationalBool;
      this.RotationOpt = rotationOpt;

      this.MirrorBool = mirrorBool;
      this.MirrorOpt = mirrorOpt;

      this.Source = source;
      this.FixedToWall = fixedTowall;
      this.CellSize = cellSize;

      this.ObjWidth = obj.X.T1;
      this.ObjLength = obj.Y.T1;
      this.ObjHeight = obj.Z.T1;

      this.MrjWidth = objMargin.X.T1;
      this.MrjLength = objMargin.Y.T1;
      this.MrjHeight = objMargin.Z.T1;

      this.baseX = Obj.Plane.OriginX;
      this.baseY = Obj.Plane.OriginY;
      this.baseZ = Obj.Plane.OriginZ;

      this.PreviousObject = previousObject;
      this.SpaceList = spaceList;
    }

    public Objects(string name, int zoneName, bool front, bool right, bool back, bool left, bool top, bool bottom, bool rotationalBool, int rotationOpt, bool mirrorBool, int mirrorOpt, string source, int fixedTowall, int cellSize, Box obj, Box objMargin, List<int> spaceList)
      : this()
    {
      this.Obj = obj;
      this.ObjMargin = objMargin;

      this.Name = name;
      this.ZoneName = zoneName;

      this.Front = front;
      this.Right = right;
      this.Back = back;
      this.Left = left;
      this.Bottom = bottom;
      this.Top = top;

      this.RotationBool = rotationalBool;
      this.RotationOpt = rotationOpt;

      this.MirrorBool = mirrorBool;
      this.MirrorOpt = mirrorOpt;

      this.Source = source;
      this.FixedToWall = fixedTowall;
      this.CellSize = cellSize;

      this.ObjWidth = obj.X.T1;
      this.ObjLength = obj.Y.T1;
      this.ObjHeight = obj.Z.T1;

      this.MrjWidth = (this.ObjMargin.X.T1);
      this.MrjLength = (this.ObjMargin.Y.T1);
      this.MrjHeight = (this.ObjMargin.Z.T1);

      this.baseX = Obj.Plane.OriginX;
      this.baseY = Obj.Plane.OriginY;
      this.baseZ = Obj.Plane.OriginZ;

      this.SpaceList = spaceList;
    }

    public void assignDimensions()
    {
      this.ObjWidth = this.Obj.X.T1;
      this.ObjLength = this.Obj.Y.T1;
      this.ObjHeight = this.Obj.Z.T1;

      this.MrjWidth = this.ObjMargin.X.T1;
      this.MrjLength = this.ObjMargin.Y.T1;
      this.MrjHeight = this.ObjMargin.Z.T1;

    }

    public void printDimensions()
    {
      Rhino.RhinoApp.WriteLine("Obj Width " + this.ObjWidth.ToString());
      Rhino.RhinoApp.WriteLine("Obj Length " + this.ObjLength.ToString());
      Rhino.RhinoApp.WriteLine("Obj Height " + this.ObjHeight.ToString());

      Rhino.RhinoApp.WriteLine("Obj Width " + this.MrjWidth.ToString());
      Rhino.RhinoApp.WriteLine("Obj Length " + this.MrjLength.ToString());
      Rhino.RhinoApp.WriteLine("Obj Height " + this.MrjHeight.ToString());
    }



    public void placeRefObject(int [,,]emptyFullArray, int[,,]areaArray, out Box ObjBox, out Box marginBox)
    {
      this.XCell = Math.Ceiling((double) (this.MrjWidth / CellSize));
      this.YCell = Math.Ceiling((double) (this.MrjLength / CellSize));
      this.ZCell = Math.Ceiling((double) (this.MrjHeight / 150));

      bool emptyBool = true;
      bool sameZone = true;

      bool placeSuccessful = false;
      int trycount = 0;

      while (placeSuccessful == false)
      {
        var rand = new Random();
        var randomCellIndex = rand.Next(this.SpaceList.Count / 2);

        baseX = (this.SpaceList[2 * randomCellIndex]) * CellSize;
        baseY = (this.SpaceList[2 * randomCellIndex + 1]) * CellSize;
        baseZ = 0;
        baseZ = 0;

        //baseX = baseX * CellSize;
        //baseY = baseY * CellSize;

        if( (baseX + this.MrjWidth < 300) && (baseY + this.MrjLength < 600) && (baseZ + this.MrjHeight < 300) &&
          (baseX + this.MrjWidth > 0) && (baseY + this.MrjLength > 0) && (baseZ + this.MrjHeight > 0) )
        {
          for(int i = (int) (baseX / CellSize) ; i < (baseX / CellSize + (int) XCell); i++)
          {
            for(int j = (int) (baseY / CellSize); j < baseY / CellSize + (int) YCell; j++)
            {
              for(int k = (int) (baseZ / 150); k < baseZ / 150 + (int) ZCell; k++)
              {
                Rhino.RhinoApp.WriteLine("Entrance Reference Object :  " + "  i:  " + i + "  j:  " + j + "  k:  " + k);
                if (emptyFullArray[i, j, k] == 1)
                {
                  emptyBool = false;
                }
                if (areaArray[i, j, k] != this.ZoneName)
                {
                  sameZone = false;
                }
              }
            }
          }

          if (emptyBool && sameZone)
          {
            placeSuccessful = true;

            Rhino.RhinoApp.WriteLine("Reference Object conditions are successful ");
            for(int i = (int) (baseX / CellSize) ; i < (baseX / CellSize + (int) XCell); i++)
            {
              for(int j = (int) (baseY / CellSize); j < baseY / CellSize + (int) YCell; j++)
              {
                for(int k = (int) (baseZ / 150); k < baseZ / 150 + (int) ZCell; k++)
                {
                  emptyFullArray[i, j, k] = 1;
                }
              }
            }
          }
          else
          {
            Rhino.RhinoApp.WriteLine("Conditions are not satisfied ");
          }
        }

        trycount++;
        Rhino.RhinoApp.WriteLine("Try count is : " + trycount);
        if (trycount > 60 )
          Rhino.RhinoApp.WriteLine("Try count is over 60 placement is unsuccessful: ");
        placeSuccessful = true;
      }

      if( trycount < 60 && placeSuccessful )
      {
        Rhino.RhinoApp.WriteLine("baseX " + this.baseX);
        Rhino.RhinoApp.WriteLine("baseY " + this.baseY);
        Rhino.RhinoApp.WriteLine("baseZ " + this.baseZ);

        Point3d pointa = new Point3d(baseX, baseY, 0);
        Vector3d pointb = new Vector3d(0, 0, 1);

        Plane planebase = new Plane(pointa, pointb);

        Interval xInterval = new Interval(0, this.ObjWidth);
        Interval yInterval = new Interval(0, this.ObjLength);
        Interval zInterval = new Interval(0, this.ObjHeight);

        ObjBox = new Box(planebase, xInterval, yInterval, zInterval);

        xInterval = new Interval(0, this.MrjWidth);
        yInterval = new Interval(0, this.MrjLength);
        zInterval = new Interval(0, this.MrjHeight);

        marginBox = new Box(planebase, xInterval, yInterval, zInterval);

      }

      else
      {
        ObjBox = new Box();
        marginBox = new Box();
      }
    }

    public void placeRefObjectEntrance(int [,,]emptyFullArray, int[,,]areaArray, out Box ObjBox, out Box marginBox)
    {
      this.XCell = Math.Ceiling((double) (this.MrjWidth / CellSize));
      this.YCell = Math.Ceiling((double) (this.MrjLength / CellSize));
      this.ZCell = Math.Ceiling((double) (this.MrjHeight / 150));

      bool emptyBool = true;
      bool sameZone = true;


      bool placeSuccessful = false;
      int trycount = 0;

      while (placeSuccessful == false)
      {
        var rand = new Random();
        var randomCellIndex = rand.Next(this.SpaceList.Count / 2);

        baseX = (this.SpaceList[2 * randomCellIndex]) * CellSize;
        baseY = 0;
        baseZ = 0;

        //baseX = baseX * CellSize;
        //baseY = baseY * CellSize;

        if( (baseX + this.MrjWidth < 300) && (baseY + this.MrjLength < 600) && (baseZ + this.MrjHeight < 300) &&
          (baseX + this.MrjWidth > 0) && (baseY + this.MrjLength > 0) && (baseZ + this.MrjHeight > 0) )
        {
          for(int i = (int) (baseX / CellSize) ; i < (baseX / CellSize + (int) XCell); i++)
          {
            for(int j = (int) (baseY / CellSize); j < baseY / CellSize + (int) YCell; j++)
            {
              for(int k = (int) (baseZ / 150); k < baseZ / 150 + (int) ZCell; k++)
              {
                Rhino.RhinoApp.WriteLine("Entrance Reference Object :  " + "  i:  " + i + "  j:  " + j + "  k:  " + k);
                if (emptyFullArray[i, j, k] == 1)
                {
                  emptyBool = false;
                }
                if (areaArray[i, j, k] != this.ZoneName)
                {
                  sameZone = false;
                }
              }
            }
          }

          if (emptyBool && sameZone)
          {
            placeSuccessful = true;

            Rhino.RhinoApp.WriteLine("Reference Object conditions are successful ");
            for(int i = (int) (baseX / CellSize) ; i < (baseX / CellSize + (int) XCell); i++)
            {
              for(int j = (int) (baseY / CellSize); j < baseY / CellSize + (int) YCell; j++)
              {
                for(int k = (int) (baseZ / 150); k < baseZ / 150 + (int) ZCell; k++)
                {
                  emptyFullArray[i, j, k] = 1;
                }
              }
            }
          }
          else
          {
            Rhino.RhinoApp.WriteLine("Conditions are not satisfied ");
          }
        }

        trycount++;
        Rhino.RhinoApp.WriteLine("Try count is : " + trycount);
        if (trycount > 60 )
          Rhino.RhinoApp.WriteLine("Try count is over 60 placement is unsuccessful: ");
        placeSuccessful = true;
      }

      if( trycount < 60 && placeSuccessful )
      {
        Rhino.RhinoApp.WriteLine("baseX " + this.baseX);
        Rhino.RhinoApp.WriteLine("baseY " + this.baseY);
        Rhino.RhinoApp.WriteLine("baseZ " + this.baseZ);

        Point3d pointa = new Point3d(baseX, 0, 0);
        Vector3d pointb = new Vector3d(0, 0, 1);

        Plane planebase = new Plane(pointa, pointb);

        Interval xInterval = new Interval(0, this.ObjWidth);
        Interval yInterval = new Interval(0, this.ObjLength);
        Interval zInterval = new Interval(0, this.ObjHeight);

        ObjBox = new Box(planebase, xInterval, yInterval, zInterval);

        xInterval = new Interval(0, this.MrjWidth);
        yInterval = new Interval(0, this.MrjLength);
        zInterval = new Interval(0, this.MrjHeight);

        marginBox = new Box(planebase, xInterval, yInterval, zInterval);

      }


      else
      {
        ObjBox = new Box();
        marginBox = new Box();
      }

    }


    public void placeFront(int [,,]emptyFullArray, int[,,]areaArray, out Box ObjBox, out Box marginBox)
    {
      bool emptyBool = true;
      bool sameZone = true;

      this.XCell = Math.Ceiling((double) (this.MrjWidth / CellSize));
      this.YCell = Math.Ceiling((double) (this.MrjLength / CellSize));
      this.ZCell = Math.Ceiling((double) (this.MrjHeight / 150));

      this.baseX = PreviousObject.baseX;
      this.baseY = PreviousObject.baseY + CellSize * PreviousObject.YCell;
      this.baseZ = PreviousObject.baseZ;

      if( (baseX + this.MrjWidth < 300) && (baseY + this.MrjLength < 600) && (baseZ + this.MrjHeight < 300) &&
        (baseX + this.MrjWidth > 0) && (baseY + this.MrjLength > 0) && (baseZ + this.MrjHeight > 0) )
      {
        for(int i = (int) (baseX / CellSize) ; i < (baseX / CellSize + (int) XCell); i++)
        {
          for(int j = (int) (baseY / CellSize); j < baseY / CellSize + (int) YCell; j++)
          {
            for(int k = (int) (baseZ / 150); k < baseZ / 150 + (int) ZCell; k++)
            {
              Rhino.RhinoApp.WriteLine("i:  " + i + "  j:  " + j + "  k:  " + k);
              if (emptyFullArray[i, j, k] == 1)
              {
                emptyBool = false;
              }
              if (areaArray[i, j, k] != this.ZoneName)
              {
                sameZone = false;
              }
            }
          }
        }

        if (emptyBool && sameZone)
        {
          Rhino.RhinoApp.WriteLine("Conditions are successful ");
          for(int i = (int) (baseX / CellSize) ; i < (baseX / CellSize + (int) XCell); i++)
          {
            for(int j = (int) (baseY / CellSize); j < baseY / CellSize + (int) YCell; j++)
            {
              for(int k = (int) (baseZ / 150); k < baseZ / 150 + (int) ZCell; k++)
              {
                emptyFullArray[i, j, k] = 1;
              }
            }
          }
        }
        else
        {
          Rhino.RhinoApp.WriteLine("Place Front:  Conditions are not satisfied ");
        }
      }
      else
      {
        Rhino.RhinoApp.WriteLine("Place Front: Conditions are not satisfied ");
      }


      Point3d pointa = new Point3d(baseX, baseY, baseZ);
      Vector3d pointb = new Vector3d(0, 0, 1);

      Plane planebase = new Plane(pointa, pointb);

      Interval xInterval = new Interval(0, this.ObjWidth);
      Interval yInterval = new Interval(0, this.ObjLength);
      Interval zInterval = new Interval(0, this.ObjHeight);

      ObjBox = new Box(planebase, xInterval, yInterval, zInterval);

      xInterval = new Interval(0, this.MrjWidth);
      yInterval = new Interval(0, this.MrjLength);
      zInterval = new Interval(0, this.MrjHeight);

      marginBox = new Box(planebase, xInterval, yInterval, zInterval);
    }


    public void placeRight(int [,,]emptyFullArray, int[,,]areaArray, out Box ObjBox, out Box marginBox)
    {
      bool emptyBool = true;
      bool sameZone = true;

      this.XCell = Math.Ceiling((double) (this.MrjWidth / CellSize));
      this.YCell = Math.Ceiling((double) (this.MrjLength / CellSize));
      this.ZCell = Math.Ceiling((double) (this.MrjHeight / 150));

      this.baseX = PreviousObject.baseX + CellSize * PreviousObject.XCell;
      this.baseY = PreviousObject.baseY;
      this.baseZ = PreviousObject.baseZ;

      if( (baseX + this.ObjWidth < 300) && (baseY + this.ObjLength < 600) && (baseZ + this.ObjHeight < 300) &&
        (baseX + this.ObjWidth > 0) && (baseY + this.ObjLength > 0) && (baseZ + this.ObjHeight > 0) )
      {
        for(int i = (int) (baseX / CellSize) ; i < (baseX / CellSize + (int) XCell); i++)
        {
          for(int j = (int) (baseY / CellSize); j < baseY / CellSize + (int) YCell; j++)
          {
            for(int k = (int) (baseZ / 150); k < baseZ / 150 + (int) ZCell; k++)
            {
              if (emptyFullArray[i, j, k] == 1)
              {
                emptyBool = false;
              }
              if (areaArray[i, j, k] != this.ZoneName)
              {
                sameZone = false;
              }
            }
          }
        }

        if (emptyBool && sameZone)
        {
          Rhino.RhinoApp.WriteLine("Place Right: Conditions are successful ");
          for(int i = (int) (baseX / CellSize) ; i < (baseX / CellSize + (int) XCell); i++)
          {
            for(int j = (int) (baseY / CellSize); j < baseY / CellSize + (int) YCell; j++)
            {
              for(int k = (int) (baseZ / 150); k < baseZ / 150 + (int) ZCell; k++)
              {
                emptyFullArray[i, j, k] = 1;
              }
            }
          }
        }
        else
        {
          Rhino.RhinoApp.WriteLine("Place Right: Conditions are not satisfied ");
        }
      }
      else
      {
        Rhino.RhinoApp.WriteLine("Place Right: Conditions are not satisfied ");
      }

      Point3d pointa = new Point3d(baseX, baseY, baseZ);
      Vector3d pointb = new Vector3d(0, 0, 1);

      Plane planebase = new Plane(pointa, pointb);

      Interval xInterval = new Interval(0, this.ObjWidth);
      Interval yInterval = new Interval(0, this.ObjLength);
      Interval zInterval = new Interval(0, this.ObjHeight);

      ObjBox = new Box(planebase, xInterval, yInterval, zInterval);

      xInterval = new Interval(0, this.MrjWidth);
      yInterval = new Interval(0, this.MrjLength);
      zInterval = new Interval(0, this.MrjHeight);

      marginBox = new Box(planebase, xInterval, yInterval, zInterval);
    }

    public void placeBack(int [,,]emptyFullArray, int[,,]areaArray, out Box ObjBox, out Box marginBox)
    {
      bool emptyBool = true;
      bool sameZone = true;

      this.XCell = Math.Ceiling((double) (this.MrjWidth / CellSize));
      this.YCell = Math.Ceiling((double) (this.MrjLength / CellSize));
      this.ZCell = Math.Ceiling((double) (this.MrjHeight / 150));

      this.baseX = PreviousObject.baseX;
      this.baseY = PreviousObject.baseY - CellSize * this.YCell;
      this.baseZ = PreviousObject.baseZ;

      if( (baseX + this.ObjWidth < 300) && (baseY + this.ObjLength < 600) && (baseZ + this.ObjHeight < 300) &&
        (baseX + this.ObjWidth > 0) && (baseY + this.ObjLength > 0) && (baseZ + this.ObjHeight > 0) )
      {
        for(int i = (int) (baseX / CellSize) ; i < (baseX / CellSize + (int) XCell); i++)
        {
          for(int j = (int) (baseY / CellSize); j < baseY / CellSize + (int) YCell; j++)
          {
            for(int k = (int) (baseZ / 150); k < baseZ / 150 + (int) ZCell; k++)
            {
              if (emptyFullArray[i, j, k] == 1)
              {
                emptyBool = false;
              }
              if (areaArray[i, j, k] != this.ZoneName)
              {
                sameZone = false;
              }
            }
          }
        }

        if (emptyBool && sameZone)
        {
          Rhino.RhinoApp.WriteLine("Place Back: Conditions are successful ");
          for(int i = (int) (baseX / CellSize) ; i < (baseX / CellSize + (int) XCell); i++)
          {
            for(int j = (int) (baseY / CellSize); j < baseY / CellSize + (int) YCell; j++)
            {
              for(int k = (int) (baseZ / 150); k < baseZ / 150 + (int) ZCell; k++)
              {
                emptyFullArray[i, j, k] = 1;
              }
            }
          }
        }
        else
        {
          Rhino.RhinoApp.WriteLine("Place Back: Conditions are not satisfied ");
        }
      }
      else
      {
        Rhino.RhinoApp.WriteLine("Place Back:Conditions are not satisfied ");
      }

      Point3d pointa = new Point3d(baseX, baseY, baseZ);
      Vector3d pointb = new Vector3d(0, 0, 1);

      Plane planebase = new Plane(pointa, pointb);

      Interval xInterval = new Interval(0, this.ObjWidth);
      Interval yInterval = new Interval(0, this.ObjLength);
      Interval zInterval = new Interval(0, this.ObjHeight);

      ObjBox = new Box(planebase, xInterval, yInterval, zInterval);

      xInterval = new Interval(0, this.MrjWidth);
      yInterval = new Interval(0, this.MrjLength);
      zInterval = new Interval(0, this.MrjHeight);

      marginBox = new Box(planebase, xInterval, yInterval, zInterval);
    }

    public void placeLeft(int [,,]emptyFullArray, int[,,]areaArray, out Box ObjBox, out Box marginBox)
    {
      bool emptyBool = true;
      bool sameZone = true;

      this.XCell = Math.Ceiling((double) (this.MrjWidth / CellSize));
      this.YCell = Math.Ceiling((double) (this.MrjLength / CellSize));
      this.ZCell = Math.Ceiling((double) (this.MrjHeight / 150));

      this.baseX = PreviousObject.baseX - CellSize * this.XCell;
      this.baseY = PreviousObject.baseY;
      this.baseZ = PreviousObject.baseZ;

      if( (baseX + this.ObjWidth < 300) && (baseY + this.ObjLength < 600) && (baseZ + this.ObjHeight < 300) &&
        (baseX + this.ObjWidth > 0) && (baseY + this.ObjLength > 0) && (baseZ + this.ObjHeight > 0) )
      {
        for(int i = (int) (baseX / CellSize) ; i < (baseX / CellSize + (int) XCell); i++)
        {
          for(int j = (int) (baseY / CellSize); j < baseY / CellSize + (int) YCell; j++)
          {
            for(int k = (int) (baseZ / 150); k < baseZ / 150 + (int) ZCell; k++)
            {
              if (emptyFullArray[i, j, k] == 1)
              {
                emptyBool = false;
              }
              if (areaArray[i, j, k] != this.ZoneName)
              {
                sameZone = false;
              }
            }
          }
        }

        if (emptyBool && sameZone)
        {
          Rhino.RhinoApp.WriteLine("Place Left: Conditions are successful ");
          for(int i = (int) (baseX / CellSize) ; i < (baseX / CellSize + (int) XCell); i++)
          {
            for(int j = (int) (baseY / CellSize); j < baseY / CellSize + (int) YCell; j++)
            {
              for(int k = (int) (baseZ / 150); k < baseZ / 150 + (int) ZCell; k++)
              {
                emptyFullArray[i, j, k] = 1;
              }
            }
          }
        }
        else
        {
          Rhino.RhinoApp.WriteLine("Place Left: Conditions are not satisfied ");
        }
      }
      else
      {
        Rhino.RhinoApp.WriteLine("Place Left: Conditions are not satisfied ");
      }

      Point3d pointa = new Point3d(baseX, baseY, baseZ);
      Vector3d pointb = new Vector3d(0, 0, 1);

      Plane planebase = new Plane(pointa, pointb);

      Interval xInterval = new Interval(0, this.ObjWidth);
      Interval yInterval = new Interval(0, this.ObjLength);
      Interval zInterval = new Interval(0, this.ObjHeight);

      ObjBox = new Box(planebase, xInterval, yInterval, zInterval);

      xInterval = new Interval(0, this.MrjWidth);
      yInterval = new Interval(0, this.MrjLength);
      zInterval = new Interval(0, this.MrjHeight);

      marginBox = new Box(planebase, xInterval, yInterval, zInterval);
    }
    public void placeTop(int [,,]emptyFullArray, int[,,]areaArray, out Box ObjBox, out Box marginBox)
    {
      bool emptyBool = true;
      bool sameZone = true;

      this.XCell = Math.Ceiling((double) (this.MrjWidth / CellSize));
      this.YCell = Math.Ceiling((double) (this.MrjLength / CellSize));
      this.ZCell = Math.Ceiling((double) (this.MrjHeight / 150));

      this.baseX = PreviousObject.baseX;
      this.baseY = PreviousObject.baseY;
      this.baseZ = PreviousObject.baseZ + CellSize * PreviousObject.ZCell;

      if( (baseX + this.ObjWidth < 300) && (baseY + this.ObjLength < 600) && (baseZ + this.ObjHeight < 300) &&
        (baseX + this.ObjWidth > 0) && (baseY + this.ObjLength > 0) && (baseZ + this.ObjHeight > 0) )
      {
        for(int i = (int) (baseX / CellSize) ; i < (baseX / CellSize + (int) XCell); i++)
        {
          for(int j = (int) (baseY / CellSize); j < baseY / CellSize + (int) YCell; j++)
          {
            for(int k = (int) (baseZ / 150); k < baseZ / 150 + (int) ZCell; k++)
            {
              if (emptyFullArray[i, j, k] == 1)
              {
                emptyBool = false;
              }
              if (areaArray[i, j, k] != this.ZoneName)
              {
                sameZone = false;
              }
            }
          }
        }

        if (emptyBool && sameZone)
        {
          Rhino.RhinoApp.WriteLine("Conditions are successful ");
          for(int i = (int) (baseX / CellSize) ; i < (baseX / CellSize + (int) XCell); i++)
          {
            for(int j = (int) (baseY / CellSize); j < baseY / CellSize + (int) YCell; j++)
            {
              for(int k = (int) (baseZ / 150); k < baseZ / 150 + (int) ZCell; k++)
              {
                emptyFullArray[i, j, k] = 1;
              }
            }
          }
        }
        else
        {
          Rhino.RhinoApp.WriteLine("Conditions are not satisfied ");
        }
      }
      else
      {
        Rhino.RhinoApp.WriteLine("Conditions are not satisfied ");
      }

      Point3d pointa = new Point3d(baseX, baseY, baseZ);
      Vector3d pointb = new Vector3d(0, 0, 1);

      Plane planebase = new Plane(pointa, pointb);

      Interval xInterval = new Interval(0, this.ObjWidth);
      Interval yInterval = new Interval(0, this.ObjLength);
      Interval zInterval = new Interval(0, this.ObjHeight);

      ObjBox = new Box(planebase, xInterval, yInterval, zInterval);

      xInterval = new Interval(0, this.MrjWidth);
      yInterval = new Interval(0, this.MrjLength);
      zInterval = new Interval(0, this.MrjHeight);

      marginBox = new Box(planebase, xInterval, yInterval, zInterval);
    }

    public void placeBottom(int [,,]emptyFullArray, int[,,]areaArray, out Box ObjBox, out Box marginBox)
    {
      bool emptyBool = true;
      bool sameZone = true;

      this.XCell = Math.Ceiling((double) (this.MrjWidth / CellSize));
      this.YCell = Math.Ceiling((double) (this.MrjLength / CellSize));
      this.ZCell = Math.Ceiling((double) (this.MrjHeight / 150));

      this.baseX = PreviousObject.baseX;
      this.baseY = PreviousObject.baseY;
      this.baseZ = PreviousObject.baseZ - CellSize * this.ZCell;

      if( (baseX + this.ObjWidth < 300) && (baseY + this.ObjLength < 600) && (baseZ + this.ObjHeight < 300) &&
        (baseX + this.ObjWidth > 0) && (baseY + this.ObjLength > 0) && (baseZ + this.ObjHeight > 0) )
      {
        for(int i = (int) (baseX / CellSize) ; i < (baseX / CellSize + (int) XCell); i++)
        {
          for(int j = (int) (baseY / CellSize); j < baseY / CellSize + (int) YCell; j++)
          {
            for(int k = (int) (baseZ / 150); k < baseZ / 150 + (int) ZCell; k++)
            {
              if (emptyFullArray[i, j, k] == 1)
              {
                emptyBool = false;
              }
              if (areaArray[i, j, k] != this.ZoneName)
              {
                sameZone = false;
              }
            }
          }
        }

        if (emptyBool && sameZone)
        {
          Rhino.RhinoApp.WriteLine("Conditions are successful ");
          for(int i = (int) (baseX / CellSize) ; i < (baseX / CellSize + (int) XCell); i++)
          {
            for(int j = (int) (baseY / CellSize); j < baseY / CellSize + (int) YCell; j++)
            {
              for(int k = (int) (baseZ / 150); k < baseZ / 150 + (int) ZCell; k++)
              {
                emptyFullArray[i, j, k] = 1;
              }
            }
          }
        }
        else
        {
          Rhino.RhinoApp.WriteLine("Conditions are not satisfied ");
        }
      }
      else
      {
        Rhino.RhinoApp.WriteLine("Conditions are not satisfied ");
      }

      Point3d pointa = new Point3d(baseX, baseY, baseZ);
      Vector3d pointb = new Vector3d(0, 0, 1);

      Plane planebase = new Plane(pointa, pointb);

      Interval xInterval = new Interval(0, this.ObjWidth);
      Interval yInterval = new Interval(0, this.ObjLength);
      Interval zInterval = new Interval(0, this.ObjHeight);

      ObjBox = new Box(planebase, xInterval, yInterval, zInterval);

      xInterval = new Interval(0, this.MrjWidth);
      yInterval = new Interval(0, this.MrjLength);
      zInterval = new Interval(0, this.MrjHeight);

      marginBox = new Box(planebase, xInterval, yInterval, zInterval);
    }

    public void placeObject(int [,,]emptyFullArray, int[,,]areaArray, out Box ObjBox, out Box marginBox)
    {

      Point3d pointa = new Point3d(baseX, baseY, baseZ);
      Vector3d pointb = new Vector3d(0, 0, 1);

      Plane planebase = new Plane(pointa, pointb);

      Interval xInterval = new Interval(0, this.ObjWidth);
      Interval yInterval = new Interval(0, this.ObjLength);
      Interval zInterval = new Interval(0, this.ObjHeight);

      ObjBox = new Box(planebase, xInterval, yInterval, zInterval);

      xInterval = new Interval(0, this.MrjWidth);
      yInterval = new Interval(0, this.MrjLength);
      zInterval = new Interval(0, this.MrjHeight);

      marginBox = new Box(planebase, xInterval, yInterval, zInterval);

      List<int> growDirection = new List<int>();

      if(PreviousObject.Front == true)
        growDirection.Add(1); // Front Direction
      if(PreviousObject.Right == true)
        growDirection.Add(2); // Right Direction
      if(PreviousObject.Back == true)
        growDirection.Add(3); // Back Direction
      if(PreviousObject.Left == true)
        growDirection.Add(4); // Left Direction
      if(PreviousObject.Bottom == true)
        growDirection.Add(5); // Bottom Direction
      if(PreviousObject.Top == true)
        growDirection.Add(6); // Right Direction

      bool placeSuccess = false;
      int tryCounter = 0;

      if(growDirection.Count >= 1)
      {
        Random randm = new Random();

        while(placeSuccess == false )
        {
          int a = randm.Next(0, growDirection.Count);
          int randomMethod = growDirection[a];

          switch (a)
          ​{
            case 1:
              this.placeFront(emptyFullArray, areaArray, out  ObjBox, out marginBox);
              placeSuccess = true;
              break;
            case 2:
              this.placeRight(emptyFullArray, areaArray, out  ObjBox, out marginBox);
              placeSuccess = true;
              break;
            case 3:
              this.placeBack(emptyFullArray, areaArray, out  ObjBox, out marginBox);
              placeSuccess = true;
              break;
            case 4:
              this.placeLeft(emptyFullArray, areaArray, out  ObjBox, out marginBox);
              placeSuccess = true;
              break;
            case 5:
              this.placeBottom(emptyFullArray, areaArray, out  ObjBox, out marginBox);
              placeSuccess = true;
              break;
            case 6:
              this.placeTop(emptyFullArray, areaArray, out  ObjBox, out marginBox);
              placeSuccess = true;
              break;

            default:
              tryCounter++;
              break;
            // default statements
          }


        }
        growDirection.Clear();




      }


    }


    public void rotate()
    {

    }



    static void mirror()
    {

    }

    static void getClosestCell()
    {

    }

    static void createWall()
    {

    }

  }

  static void ShowMatrix(int[,,] Arr)
  {
    for (int i = 0; i < Arr.GetLength(0); i++)
    {
      for (int j = 0; j < Arr.GetLength(1); j++)
      {
        Rhino.RhinoApp.Write(Arr[i, j, 0] + " ");
      }
      Rhino.RhinoApp.WriteLine("Loop Runs" + i.ToString());
    }
    return;
  }

  static int[,,] InitializeZeroMatrice(int width, int length, int levelNumber)
  {
    var areaArray = new int[width, length, levelNumber];

    for (int k = 0; k < levelNumber; k++)
    {
      for (int i = 0; i < width; i++)
      {
        for (int j = 0; j < length; j++)
        {
          areaArray[i, j, k] = 0;
        }
      }
    }
    return areaArray;
  }

  /* The Color lists keep the colors in a seperate List in order to choose within them easily instead of searching where they are... */
  static List<int> entranceList = new List<int>();
  static List<int> commonList = new List<int>();
  static List<int> wetAreaList = new List<int>();
 /* static List<int> kitchenList = new List<int>();
  static List<int> commonAreaList = new List<int>();*/

  /**           these counters are used for starting the límitations counts.         **/

  static int entranceCounter = 1;
  static int commonCounter = 1;
  static int wetAreaCounter = 1;
  /*static int kitchenCounter = 1;
  static int commonAreaCounter = 1;*/
  /**           these limits are used for defining max distance that zone can spread.  **/

  static int entranceLimit = 2500;
  static int commonLimit = 400;
  static int wetAreaLimit = 300;
  /*static int kitchenLimit = 200;
  static int commonAreaLimit = 100;*/

  static void StartZones(int[,,] arr)
  {
    /**
     * Randomly Starts the color. Takes the Color lists as argumnts
     * (We can delete these argumnents and it can get them as local referance
     * in our case it gives us a chance to choose what to initilize)
     * **/

    Random rand = new Random();
    //----------------------
    /* GetLength(0) and GetLength(1) might be set as variable */
    //Array.GetLength(0) gives the column lenght in other words length of an array
    //Array.GetLength(1) gives the row lenght in other words width of an array
    var a = rand.Next(arr.GetLength(0) / 2, arr.GetLength(0) / 2);
    var b = rand.Next(0, 2);

    Rhino.RhinoApp.WriteLine("started");
    entranceList.AddRange(new int[2] { a, b }); //AddRange ==> Adds multiple elements to a List . We use mod%2 to call the index of the point back instead of stacking them as an another List(or Array) in our list.
    arr[a, b, 0] = 1;// entrance Starting Point
    //----------------------

    b = rand.Next(0, arr.GetLength(1));
    a = rand.Next(0, arr.GetLength(0));

    commonList.AddRange(new int[2] { a, b });
    arr[a, b, 0] = 2; // common Starting Point
    //----------------------
    a = rand.Next(0, arr.GetLength(0));
    b = rand.Next(0, arr.GetLength(1));

    wetAreaList.AddRange(new int[2] { a, b });
    arr[a, b, 0] = 3; // wetArea Starting Point
    //----------------------
    a = rand.Next(0, arr.GetLength(0));
    b = rand.Next(0, arr.GetLength(1));
/*
    kitchenList.AddRange(new int[2] { a, b });
    arr[a, b, 0] = 4; // kitchen Starting Point
    //----------------------
    a = rand.Next(0, arr.GetLength(0));
    b = rand.Next(0, arr.GetLength(1));

    commonAreaList.AddRange(new int[2] { a, b });
    arr[a, b, 0] = 5; // commonArea Starting Point
    //----------------------
  */
  }
        /* Calculates the distance between initial point in the color and the possible new point!
         *  (if the possible new point is too far from inital point eleminate it.) */
  static double distanceCalculate(List<int> spaceCoordList, int x2, int y2, int cellSize)
  {
    var distance = cellSize * Math.Sqrt((y2 - spaceCoordList[1]) * (y2 - spaceCoordList[1]) + (x2 - spaceCoordList[0]) * (x2 - spaceCoordList[0]));
    return distance;
  }

  static void Evaluate()
  {
    // according to relations give score to the created zones
    // get the centers of the zones and acoording to the distances and created sizes give
    //positive or negative points and if score is not acceptable re-run and create variatians.
  }


  static void noiseFilter (int [,,] arr, int type, int iterationNumber, int controlNumber)
  {
    if(type == 0)
    {
      for( int loop = 0 ; loop < iterationNumber ; loop++ )
      {
        List < int> surrounding = new List<int>();
        for(int i = 1 ; i < arr.GetLength(0) - 1 ;i++)
        {
          for(int j = 1 ; j < arr.GetLength(1) - 1 ;j++)
          {
            for(int x = -1 ; x < 2;x++)
            {
              for(int y = -1 ; y < 2;y++)
              {
                if(!(x == y && x == 0))
                {

                  surrounding.Add(arr[i + x, j + y, 0]);
                }
              }
            }
            for (int v = 0 ; v < 6 ;v++) // 6 is the number of the zones including  empty cells
            {
              int count = (from z in surrounding where z == v select z).Count();
              if ( count >= controlNumber )
              {
                arr[i, j, 0] = v;
              }
            }
            surrounding.Clear();
            surrounding.TrimExcess();
          }
        }
      }
    }

    if(type == 1)
    {
      for( int loop = 0 ; loop < iterationNumber ; loop++ )
      {
        List < int> surrounding = new List<int>();
        for(int i = 1 ; i < arr.GetLength(0) - 1 ;i++)
        {
          for(int j = 1 ; j < arr.GetLength(1) - 1 ;j++)
          {
            for(int x = -1 ; x < 2;x++)
            {
              for(int y = -1 ; y < 2;y++)
              {
                if(!(x == y && x == 0) && ( (x + y == 1 ) || (x + y == -1 )) )
                {
                  surrounding.Add(arr[i + x, j + y, 0]);
                }
              }
            }

            for (int v = 0 ; v < 6 ;v++) // 6 is the number of the zones including  empty cells
            {
              int count = (from z in surrounding where z == v select z).Count();
              if ( count >= 2 )
              {
                arr[i, j, 0] = v;
              }
            }
            surrounding.Clear();
            surrounding.TrimExcess();
          }
        }
      }
    }
  }

  static void Spread(int[,,] arr, ref double spaceSize, List<int> spaceCoordList, ref int counter, int spaceLimit, int cellSize)
  {
        /*ARGUMENTS
     * The main array which has rectangular form(will be 3d in short) ,
     * spaceSize = Maximum limit that can grow.  ,
     * spaceCoordList =  the cells of the zone which has been already defined. )
     */
    var rand = new Random();
    var directionList = new List<int>();
    int Xcoord;
    int Ycoord;
    bool draw = false;
    int trycount = 0;

    while (draw == false && counter <= spaceSize)
    {
      if (counter <= spaceSize ) //Can be deleted. The condition is added to the While Loop Conditions.
      {
        var randomCellIndex = rand.Next(spaceCoordList.Count / 2);

        Xcoord = spaceCoordList[2 * randomCellIndex];
        Ycoord = spaceCoordList[2 * randomCellIndex + 1];

        if (Xcoord < arr.GetLength(0) - 1 && Xcoord > 0 && Ycoord > 0 && Ycoord < arr.GetLength(1) - 1)
        {
          /* Check the conditions INSIDE borders */
          if (arr[Xcoord + 1, Ycoord, 0] == 0 && distanceCalculate(spaceCoordList, Xcoord + 1, Ycoord, cellSize) < spaceLimit ) // Check if possible new cell is still white or not!
            directionList.AddRange(new int[2] { (Xcoord + 1), Ycoord }); //Store possible spread directions in a list.

          if (arr[Xcoord - 1, Ycoord, 0] == 0 && distanceCalculate(spaceCoordList, Xcoord - 1, Ycoord, cellSize) < spaceLimit)
            directionList.AddRange(new int[2] { (Xcoord - 1), Ycoord }); //Store possible spread directions in a list.

          if (arr[Xcoord, Ycoord + 1, 0] == 0 && distanceCalculate(spaceCoordList, Xcoord, Ycoord + 1, cellSize) < spaceLimit)
            directionList.AddRange(new int[2] { (Xcoord), Ycoord + 1 }); //Store possible spread directions in a list.

          if (arr[Xcoord, Ycoord - 1, 0] == 0 && distanceCalculate(spaceCoordList, Xcoord, Ycoord - 1, cellSize) < spaceLimit)
            directionList.AddRange(new int[2] { (Xcoord), (Ycoord - 1) }); //Store possible spread directions in a list.

          if (directionList.Count > 0)
          {
            var randomIndex = rand.Next(directionList.Count / 2);
            int a = directionList[2 * randomIndex];
            int b = directionList[2 * randomIndex + 1];

            arr[a, b, 0] = arr[Xcoord, Ycoord, 0];

            spaceCoordList.AddRange(new int[2] { a, b });

            directionList.Clear();
            directionList.TrimExcess();
            draw = true;
            counter++;
          }
          else
          {
            trycount++;
            if (trycount >= spaceCoordList.Count)
            {
              draw = true;
              //Print("trycountNumber is ={0}", trycount);
            }
          }
        }

          /* EDGE CONDITIONS */
          //RIGHT
        else if (Xcoord == (arr.GetLength(0) - 1) && Ycoord != 0 && Ycoord != (arr.GetLength(1) - 1))
        {
          if (arr[Xcoord - 1, Ycoord, 0] == 0 && distanceCalculate(spaceCoordList, Xcoord - 1, Ycoord, cellSize) < spaceLimit )
            directionList.AddRange(new int[2] { (Xcoord - 1), (Ycoord) }); //Store possible spread directions in a list.
          if (arr[Xcoord, Ycoord + 1, 0] == 0 && distanceCalculate(spaceCoordList, Xcoord, Ycoord + 1, cellSize) < spaceLimit )
            directionList.AddRange(new int[2] { (Xcoord ), (Ycoord + 1) }); //Store possible spread directions in a list.
          if (arr[Xcoord, Ycoord - 1, 0] == 0 && distanceCalculate(spaceCoordList, Xcoord, Ycoord - 1, cellSize) < spaceLimit )
            directionList.AddRange(new int[2] { (Xcoord ), (Ycoord - 1) }); //Store possible spread directions in a list.

          if (directionList.Count > 0)
          {
            var randomIndex = rand.Next(directionList.Count / 2);
            int a = directionList[2 * randomIndex];
            int b = directionList[2 * randomIndex + 1];

            arr[a, b, 0] = arr[Xcoord, Ycoord, 0];

            spaceCoordList.AddRange(new int[2] { a, b });

            directionList.Clear();
            directionList.TrimExcess();
            draw = true;
            counter++;
          }
          else
          {
            trycount++;
            if (trycount >= spaceCoordList.Count)
            {
              draw = true;
              //Print("trycountNumber is ={0}", trycount);
            }
          }
        }

          //Left
        else if (Xcoord == 0 && Ycoord != 0 && Ycoord != (arr.GetLength(1) - 1))
        {

          if (arr[Xcoord + 1, Ycoord, 0] == 0 && distanceCalculate(spaceCoordList, Xcoord + 1, Ycoord, cellSize) < spaceLimit )
            directionList.AddRange(new int[2] { (Xcoord + 1), (Ycoord) }); //Store possible spread directions in a list.
          if (arr[Xcoord, Ycoord + 1, 0] == 0 && distanceCalculate(spaceCoordList, Xcoord, Ycoord + 1, cellSize) < spaceLimit )
            directionList.AddRange(new int[2] { (Xcoord ), (Ycoord + 1) }); //Store possible spread directions in a list.
          if (arr[Xcoord, Ycoord - 1, 0] == 0 && distanceCalculate(spaceCoordList, Xcoord, Ycoord - 1, cellSize) < spaceLimit )
            directionList.AddRange(new int[2] { (Xcoord ), (Ycoord - 1) }); //Store possible spread directions in a list.
          if (directionList.Count > 0)
          {
            var randomIndex = rand.Next(directionList.Count / 2);
            int a = directionList[2 * randomIndex];
            int b = directionList[2 * randomIndex + 1];

            arr[a, b, 0] = arr[Xcoord, Ycoord, 0];

            spaceCoordList.AddRange(new int[2] { a, b });

            directionList.Clear();
            directionList.TrimExcess();
            draw = true;
            counter++;
          }
          else
          {
            trycount++;
            if (trycount >= spaceCoordList.Count)
            {
              draw = true;
              //Print("trycountNumber is ={0}", trycount);
            }
          }

        }
          //TOP
        else if ((Ycoord == arr.GetLength(1) - 1) && Xcoord != 0 && Xcoord != (arr.GetLength(0) - 1))
        {

          if (arr[Xcoord, Ycoord - 1, 0] == 0 && distanceCalculate(spaceCoordList, Xcoord, Ycoord - 1, cellSize) < spaceLimit )
            directionList.AddRange(new int[2] { (Xcoord ), (Ycoord - 1) }); //Store possible spread directions in a list.
          if (arr[Xcoord + 1, Ycoord, 0] == 0 && distanceCalculate(spaceCoordList, Xcoord + 1, Ycoord, cellSize) < spaceLimit )
            directionList.AddRange(new int[2] { (Xcoord + 1 ), (Ycoord ) }); //Store possible spread directions in a list.
          if (arr[Xcoord - 1, Ycoord, 0] == 0 && distanceCalculate(spaceCoordList, Xcoord - 1, Ycoord, cellSize) < spaceLimit )
            directionList.AddRange(new int[2] { (Xcoord - 1), (Ycoord ) }); //Store possible spread directions in a list.
          if (directionList.Count > 0)
          {
            var randomIndex = rand.Next(directionList.Count / 2);
            int a = directionList[2 * randomIndex];
            int b = directionList[2 * randomIndex + 1];

            arr[a, b, 0] = arr[Xcoord, Ycoord, 0];

            spaceCoordList.AddRange(new int[2] { a, b });

            directionList.Clear();
            directionList.TrimExcess();
            draw = true;
            counter++;
          }
          else
          {
            trycount++;
            if (trycount >= spaceCoordList.Count)
            {
              draw = true;
              //Print("trycountNumber is ={0}", trycount);
            }
          }
        }
          //BOTTOM
        else if (Ycoord == 0 && Xcoord != 0 && Xcoord != (arr.GetLength(0) - 1))
        {
          if (arr[Xcoord, Ycoord + 1, 0] == 0 && distanceCalculate(spaceCoordList, Xcoord, Ycoord + 1, cellSize) < spaceLimit )
            directionList.AddRange(new int[2] { (Xcoord ), (Ycoord + 1) }); //Store possible spread directions in a list.
          if (arr[Xcoord + 1, Ycoord, 0] == 0 && distanceCalculate(spaceCoordList, Xcoord + 1, Ycoord, cellSize) < spaceLimit )
            directionList.AddRange(new int[2] { (Xcoord + 1 ), (Ycoord ) }); //Store possible spread directions in a list.
          if (arr[Xcoord - 1, Ycoord, 0] == 0 && distanceCalculate(spaceCoordList, Xcoord - 1, Ycoord, cellSize) < spaceLimit )
            directionList.AddRange(new int[2] { (Xcoord - 1), (Ycoord ) }); //Store possible spread directions in a list.
          if (directionList.Count > 0)
          {
            var randomIndex = rand.Next(directionList.Count / 2);
            int a = directionList[2 * randomIndex];
            int b = directionList[2 * randomIndex + 1];

            arr[a, b, 0] = arr[Xcoord, Ycoord, 0];

            spaceCoordList.AddRange(new int[2] { a, b });

            directionList.Clear();
            directionList.TrimExcess();
            draw = true;
            counter++;
          }
          else
          {
            trycount++;
            if (trycount >= spaceCoordList.Count)
            {
              draw = true;
              //Print("trycountNumber is ={0}", trycount);
            }
          }
        }

          //LEFT BOTTOM
        else if (Xcoord == 0 && Ycoord == 0)
        {
          if (arr[Xcoord, Ycoord + 1, 0] == 0 && distanceCalculate(spaceCoordList, Xcoord, Ycoord + 1, cellSize) < spaceLimit)
            directionList.Add(Xcoord); directionList.Add(Ycoord + 1);

          if (arr[Xcoord + 1, Ycoord, 0] == 0 && distanceCalculate(spaceCoordList, Xcoord + 1, Ycoord, cellSize) < spaceLimit)
            directionList.Add(Xcoord + 1); directionList.Add(Ycoord);

          if (directionList.Count > 0)
          {

            var randomIndex = rand.Next(directionList.Count / 2);

            int a = directionList[2 * randomIndex];
            int b = directionList[2 * randomIndex + 1];

            arr[a, b, 0] = arr[Xcoord, Ycoord, 0];

            spaceCoordList.AddRange(new int[2] { a, b });

            directionList.Clear();
            directionList.TrimExcess();
            draw = true;

            counter++;
            //Print(" Counter Number is : {0}", counter);
          }
          else
          {
            trycount++;
            if (trycount >= spaceCoordList.Count)
            {
              draw = true;
              //Print("trycountNumber is ={0}", trycount);
            }
          }
        }
          //LEFT  TOP
          /*
          else if (Xcoord == 0 && Ycoord == (arr.GetLength(1) - 1))
          {
          if (arr[Xcoord + 1, Ycoord] == 0)
          directionList.Add(Xcoord + 1); directionList.Add(Ycoord);

          if (arr[Xcoord, Ycoord - 1] == 0)
          directionList.Add(Xcoord); directionList.Add(Ycoord - 1);

          if (directionList.Count > 0)
          {
          var randomIndex = rand.Next(directionList.Count / 2);

          int a = directionList[2 * randomIndex];
          int b = directionList[2 * randomIndex + 1];

          Rhino.RhinoApp.WriteLine("Left Top "  +  a +  " "  +  b);
          arr[a, b] = arr[Xcoord, Ycoord];

          spaceCoordList.AddRange(new int[2] { a, b });

          directionList.Clear();
          directionList.TrimExcess();
          draw = true;

          counter++;
          //Print(" Counter Number is : {0}", counter);
          }
          else
          {
          trycount++;
          if (trycount >= spaceCoordList.Count)
          {
          draw = true;
          //Print("trycountNumber is ={0}", trycount);
          }
          }
          }
          */
          /*
          //RIGHT TOP
          else if (Xcoord == (arr.GetLength(0) - 1) && Ycoord == (arr.GetLength(1) - 1))
          {
          if (arr[Xcoord, Ycoord - 1] == 0)
          directionList.Add(Xcoord); directionList.Add(Ycoord - 1);

          if (arr[Xcoord - 1, Ycoord] == 0)
          directionList.Add(Xcoord - 1); directionList.Add(Ycoord);

          if (directionList.Count > 0)
          {
          var randomIndex = rand.Next(directionList.Count / 2);

          int a = directionList[2 * randomIndex];
          int b = directionList[2 * randomIndex + 1];
          Rhino.RhinoApp.WriteLine(" Right top "+ a + " " + b);
          arr[a, b] = arr[Xcoord, Ycoord];

          //spaceCoordList.AddRange(new int[2] { a, b });

          directionList.Clear();
          directionList.TrimExcess();
          draw = true;

          counter++;
          //Print(" Counter Number is : {0}", counter);
          }
          else
          {
          trycount++;
          if (trycount >= spaceCoordList.Count)
          {
          draw = true;
          //Print("trycountNumber is ={0}", trycount);
          }
          }
          }
          */
          //RIGHT BOTTOM
        else if (Xcoord == (arr.GetLength(0) - 1) && Ycoord == 0)
        {
          if (arr[Xcoord, Ycoord + 1, 0] == 0)
            directionList.Add(Xcoord); directionList.Add(Ycoord + 1);

          if (arr[Xcoord - 1, Ycoord, 0] == 0)
            directionList.Add(Xcoord - 1); directionList.Add(Ycoord);

          if (directionList.Count > 0)
          {
            var randomIndex = rand.Next(directionList.Count / 2);

            int a = directionList[2 * randomIndex];
            int b = directionList[2 * randomIndex + 1];

            arr[a, b, 0] = arr[Xcoord, Ycoord, 0];

            spaceCoordList.AddRange(new int[2] { a, b });

            directionList.Clear();
            directionList.TrimExcess();

            draw = true;
            counter++;
            //Print(" Counter Number is : {0}", counter);
          }
          else
          {
            trycount++;
            if (trycount >= spaceCoordList.Count)
            {
              draw = true;
              //Print("trycountNumber is ={0}", trycount);
            }
          }
        }
        /* EDGE CONDITIONS */
      }
    }

  }




    /* Instead of wrting methods seperately in main program, it is better to use class based
     informations to keep things organized, we are not yet transsferentrance methods here but we created the str.*/

    /*
    public class Zone
    {
        public string Name;
        public int SpaceLimit;
        public Int16 SpaceSize;
        public int Counter;
        public List<Int16> SpaceList;

        public void Describe()
        {
            Console.WriteLine("Hey this zone is{ 0} ", Name);
        }

        public Zone()
        {
           // SpaceList = new List<int>();
        }

        public Zone(string name, int spaceLimit,int spacesize,int counter, List<int> SpaceList)
        :this()
        {
        }
        static void InitializeZeroMatrice() { }
        static void startZones() { }
        public void SpreadZones() { }

    }
    */
# ---------- end c_script_6 ----------
box_55 = Box(c_script_6.Furnitures)  # disabled
deconstruct_box_31 = DeconstructBox(Box=box_55)  # -> Plane, X, Y, Z; disabled
panel_125 = Panel(deconstruct_box_31.Plane)  # disabled
panel_126 = Panel(deconstruct_box_31.Y)  # disabled
panel_127 = Panel(deconstruct_box_31.X)  # disabled
panel_128 = Panel(deconstruct_box_31.Z)  # disabled
boolean_toggle_3 = BooleanToggle(False)  # disabled
deconstruct_domain_54 = DeconstructDomain(Domain=panel_122)  # -> Start, End; disabled
deconstruct_domain_55 = DeconstructDomain(Domain=panel_124)  # -> Start, End; disabled
deconstruct_domain_56 = DeconstructDomain(Domain=panel_123)  # -> Start, End; disabled
deconstruct_domain_57 = DeconstructDomain(Domain=panel_126)  # -> Start, End; disabled
deconstruct_domain_58 = DeconstructDomain(Domain=panel_127)  # -> Start, End; disabled
box_56 = Box(c_script_6.Bxx)  # disabled
panel_129 = Panel(deconstruct_domain_55.End)  # disabled
panel_130 = Panel(deconstruct_domain_54.End)  # disabled
panel_131 = Panel(deconstruct_domain_56.End)  # disabled
panel_132 = Panel(box_56)  # disabled
panel_133 = Panel(deconstruct_domain_57.End)  # disabled
panel_134 = Panel(deconstruct_domain_58.End)  # disabled
list_item_5 = ListItem(List=c_script_6.Furnitures, Index=number_slider_89, Wrap=boolean_toggle_3)  # disabled
# Inıtıalıze
panel_135 = Panel(c_script_6.out)  # disabled
number_slider_90 = Slider(0, range=0..1)  # disabled
number_slider_91 = Slider(0.611, range=0..1)  # disabled
number_slider_92 = Slider(0.544, range=0..1)  # disabled
colour_swatch_17 = ColourSwatch(SwatchColor=RGB(0, 0, 0))  # disabled
colour_swatch_18 = ColourSwatch(SwatchColor=RGB(0, 0, 0))  # disabled
colour_swatch_19 = ColourSwatch(SwatchColor=RGB(255, 255, 0))  # disabled
colour_swatch_20 = ColourSwatch(SwatchColor=RGB(0, 0, 0))  # disabled
colour_swatch_21 = ColourSwatch(SwatchColor=RGB(255, 255, 255))  # disabled
colour_swatch_22 = ColourSwatch(SwatchColor=RGB(240, 240, 200))  # disabled
colour_swatch_23 = ColourSwatch(SwatchColor=RGB(240, 200, 200))  # disabled
colour_swatch_24 = ColourSwatch(SwatchColor=RGB(150, 200, 255))  # disabled

# ---- group: Visualize as 3D Boxes
number_slider_93 = Slider(0.428, range=0..1)  # disabled
create_material_17 = CreateMaterial(Diffuse=colour_swatch_22, Specular=RGB(255, 255, 255), Emission=RGB(0, 0, 0), Transparency=number_slider_93, Shine=0)  # disabled
create_material_18 = CreateMaterial(Diffuse=colour_swatch_19, Specular=RGB(255, 255, 255), Emission=RGB(0, 0, 0), Transparency=number_slider_93, Shine=0)  # disabled
create_material_19 = CreateMaterial(Diffuse=colour_swatch_23, Specular=RGB(255, 255, 255), Emission=RGB(0, 0, 0), Transparency=number_slider_93, Shine=0)  # disabled
create_material_20 = CreateMaterial(Diffuse=colour_swatch_24, Specular=RGB(255, 255, 255), Emission=RGB(0, 0, 0), Transparency=number_slider_93, Shine=0)  # disabled
create_material_21 = CreateMaterial(Diffuse=colour_swatch_20, Specular=RGB(255, 255, 255), Emission=RGB(0, 0, 0), Transparency=number_slider_93, Shine=0)  # disabled
create_material_22 = CreateMaterial(Diffuse=colour_swatch_21, Specular=RGB(255, 255, 255), Emission=RGB(0, 0, 0), Transparency=number_slider_92, Shine=0)  # disabled
custom_preview_17 = CustomPreview(Geometry=c_script_6.EntranceBoxes, Material=create_material_17)  # disabled
custom_preview_18 = CustomPreview(Geometry=c_script_6.CommonBoxes, Material=create_material_19)  # disabled
custom_preview_19 = CustomPreview(Geometry=c_script_6.WetAreaBoxes, Material=create_material_20)  # disabled
custom_preview_20 = CustomPreview(Geometry=c_script_6.K, Material=create_material_21)  # disabled
custom_preview_21 = CustomPreview(Geometry=c_script_6.W, Material=create_material_22)  # disabled
custom_preview_22 = CustomPreview(Geometry=c_script_6.Y, Material=create_material_18)  # disabled

# ----
create_material_23 = CreateMaterial(Diffuse=colour_swatch_17, Specular=RGB(255, 255, 255), Emission=RGB(0, 0, 0), Transparency=number_slider_90, Shine=0)  # disabled
create_material_24 = CreateMaterial(Diffuse=colour_swatch_18, Specular=RGB(255, 255, 255), Emission=RGB(0, 0, 0), Transparency=number_slider_91, Shine=0)  # disabled
custom_preview_23 = CustomPreview(Geometry=c_script_6.Furnitures, Material=create_material_23)  # disabled
custom_preview_24 = CustomPreview(Geometry=c_script_6.FurnituresMargins, Material=create_material_24)  # disabled
list_length_13 = ListLength(List=c_script_6.EntranceBoxes)  # disabled
list_length_14 = ListLength(List=c_script_6.CommonBoxes)  # disabled
list_length_15 = ListLength(List=c_script_6.W)  # disabled
list_length_16 = ListLength(List=c_script_6.WetAreaBoxes)  # disabled
list_length_17 = ListLength(List=c_script_6.Y)  # disabled
list_length_18 = ListLength(List=c_script_6.K)  # disabled
multiplication_32 = Multiplication(A=list_length_14, B=division_10)  # disabled
multiplication_33 = Multiplication(A=list_length_13, B=division_10)  # disabled
multiplication_34 = Multiplication(A=list_length_15, B=division_10)  # disabled
multiplication_35 = Multiplication(A=list_length_16, B=division_10)  # disabled
multiplication_36 = Multiplication(A=list_length_17, B=division_10)  # disabled
multiplication_37 = Multiplication(A=list_length_18, B=division_10)  # disabled
panel_136 = Panel("m2 ")  # disabled
panel_137 = Panel(multiplication_33)  # disabled
panel_138 = Panel(" Entrance = ")  # disabled
panel_139 = Panel(" Empty Space= ")  # disabled
panel_140 = Panel(multiplication_34)  # disabled
panel_141 = Panel("m2 ")  # disabled
panel_142 = Panel("m2 ")  # disabled
panel_143 = Panel(multiplication_32)  # disabled
panel_144 = Panel(" CommonArea = ")  # disabled
panel_145 = Panel("m2 ")  # disabled
panel_146 = Panel(multiplication_35)  # disabled
panel_147 = Panel("Wet Area = ")  # disabled
panel_148 = Panel(multiplication_36)  # disabled
panel_149 = Panel(" Common Area = ")  # disabled
panel_150 = Panel("m2 ")  # disabled
panel_151 = Panel(" Kitchen = ")  # disabled
panel_152 = Panel(" m2 ")  # disabled
panel_153 = Panel(multiplication_37)  # disabled
number_slider_94 = Slider(15, range=0..100)  # disabled
concatenate_15 = Concatenate(Fragment_A=panel_139, Fragment_B=panel_140, Fragment_C=panel_142)  # disabled
concatenate_16 = Concatenate(Fragment_A=panel_138, Fragment_B=panel_137, Fragment_C=panel_136)  # disabled
panel_154 = Panel("0,-50")  # disabled
concatenate_17 = Concatenate(Fragment_A=panel_144, Fragment_B=panel_143, Fragment_C=panel_141)  # disabled
panel_155 = Panel("0,-80")  # disabled
panel_156 = Panel("0,-140")  # disabled
concatenate_18 = Concatenate(Fragment_A=panel_147, Fragment_B=panel_146, Fragment_C=panel_145)  # disabled
concatenate_19 = Concatenate(Fragment_A=panel_151, Fragment_B=panel_148, Fragment_C=panel_150)  # disabled
concatenate_20 = Concatenate(Fragment_A=panel_149, Fragment_B=panel_153, Fragment_C=panel_152)  # disabled
panel_157 = Panel(concatenate_15)  # disabled
panel_158 = Panel(concatenate_16)  # disabled
panel_159 = Panel(concatenate_17)  # disabled
panel_160 = Panel(concatenate_18)  # disabled
panel_161 = Panel(concatenate_19)  # disabled
panel_162 = Panel(concatenate_20)  # disabled
panel_163 = Panel("240,-170")  # disabled
panel_164 = Panel("0,-110")  # disabled
text_tag_3d_15 = TextTag3D(Location=panel_154, Text=concatenate_16, Size=number_slider_94, Colour=colour_swatch_22, Justification=7)  # disabled
text_tag_3d_16 = TextTag3D(Location=panel_155, Text=concatenate_17, Size=number_slider_94, Colour=colour_swatch_23, Justification=7)  # disabled
text_tag_3d_17 = TextTag3D(Location=panel_156, Text=concatenate_19, Size=number_slider_94, Colour=colour_swatch_19, Justification=7)  # disabled
text_tag_3d_18 = TextTag3D(Location=panel_164, Text=concatenate_18, Size=number_slider_94, Colour=colour_swatch_24, Justification=7)  # disabled
text_tag_3d_19 = TextTag3D(Location=panel_156, Text=concatenate_15, Size=number_slider_94, Colour=colour_swatch_21, Justification=7)  # disabled
text_tag_3d_20 = TextTag3D(Location=panel_163, Text=concatenate_20, Size=number_slider_94, Colour=colour_swatch_20, Justification=7)  # disabled
mass_addition_3 = MassAddition(Input=[multiplication_32, multiplication_33, multiplication_35, multiplication_36, multiplication_37, multiplication_34])  # -> flatten(Result), PartialResults; disabled
number_slider_95 = Slider(1, range=0..1)  # disabled
panel_166 = Panel(" Total Area =")  # disabled
panel_167 = Panel("m2 ")  # disabled
list_item_6 = ListItem(List=mass_addition_3.Result, Index=number_slider_95, Wrap=True)  # disabled
panel_168 = Panel(list_item_6)  # disabled
panel_169 = Panel("240,-100")  # disabled
concatenate_21 = Concatenate(Fragment_A=panel_166, Fragment_B=panel_168, Fragment_C=panel_167)  # disabled
panel_170 = Panel(concatenate_21)  # disabled
text_tag_3d_21 = TextTag3D(Location=panel_169, Text=concatenate_21, Size=number_slider_94, Justification=7)  # disabled
number_slider_96 = Slider(10, range=0..10)
number_slider_97 = Slider(30, range=0..100)  # disabled
number_slider_98 = Slider(60, range=20..60)  # disabled
number_slider_99 = Slider(6, range=2..10)  # disabled
number_slider_100 = Slider(36, range=20..60)  # disabled
multiplication_38 = Multiplication(A=number_slider_97, B=number_slider_96)  # disabled
number_slider_101 = Slider(2, range=0..10)  # disabled
multiplication_39 = Multiplication(A=number_slider_98, B=number_slider_96)  # disabled
multiplication_40 = Multiplication(A=number_slider_99, B=number_slider_96)  # disabled
multiplication_41 = Multiplication(A=number_slider_100, B=number_slider_96)  # disabled
number_slider_102 = Slider(10000, range=0..10000)  # disabled
round_3 = Round()  # -> Nearest, Floor, Ceiling; disabled
panel_171 = Panel(multiplication_38)  # disabled
panel_172 = Panel(multiplication_41)  # disabled
panel_173 = Panel(multiplication_39)  # disabled
multiplication_42 = Multiplication(A=multiplication_40, B=multiplication_40)  # disabled
division_11 = Division(A=multiplication_39, B=multiplication_40)  # disabled
number_slider_103 = Slider(100, range=0..100)  # disabled
panel_174 = Panel(multiplication_40)  # disabled
division_12 = Division(A=multiplication_41, B=multiplication_40)  # disabled
number_slider_104 = Slider(150, range=0..1000)  # disabled
multiplication_43 = Multiplication(A=number_slider_102, B=number_slider_101)  # disabled
division_13 = Division(A=multiplication_42, B=multiplication_43)  # disabled
panel_175 = Panel(division_12)  # disabled
integer_10 = Integer(division_12)  # disabled
integer_11 = Integer(division_11)  # disabled
integer_12 = Integer(panel_171)  # disabled
box_57 = Box(closet)  # disabled
box_58 = Box(closet_margin)  # disabled
box_59 = Box(exterior_door)  # disabled
c_script_7 = CSharpScript(boxx=box_59)  # -> out, lenght; inputs boxx: Box; disabled; same code as c_script
panel_176 = Panel(c_script_7.lenght)  # disabled
deconstruct_box_32 = DeconstructBox(Box=box_59)  # -> Plane, X, Y, Z; disabled
panel_177 = Panel(deconstruct_box_32.Plane)  # disabled
panel_178 = Panel(deconstruct_box_32.Y)  # disabled
panel_179 = Panel(deconstruct_box_32.Z)  # disabled
panel_180 = Panel(deconstruct_box_32.X)  # disabled
box_60 = Box(changeover_zone)  # disabled
box_61 = Box(exterior_door_margin)  # disabled
box_62 = Box(change_over_zone_margin)  # disabled
box_63 = Box()  # disabled
box_64 = Box()  # disabled
box_65 = Box(counter_1_margin)  # disabled
box_66 = Box()  # disabled
box_67 = Box()  # disabled
box_68 = Box()  # disabled
box_69 = Box()  # disabled
box_70 = Box()  # disabled
box_71 = Box()  # disabled
box_72 = Box()  # disabled
box_73 = Box()  # disabled
number_slider_105 = Slider(8, range=0..10)  # disabled
c_script_8 = CSharpScript(
    Width=integer_11,
    Length=integer_10,
    Height=integer_12,
    LevelHeight=number_slider_104,
    cellSize=multiplication_40,
    ExteriorDoor=box_59,
    ExteriorDoorMargin=box_61,
    ChangeOverZone=box_60,
    ChangeOverZoneMargin=box_62,
    Closet=box_57,
    ClosetMargin=box_58,
    InteriorDoor=box_63,
    InteriorDoorMargin=box_64,
    Counter=box_65,
    CounterMargin=box_66,
    Table=box_67,
    TableMargin=box_68,
    SittingUnit=box_69,
    SittingUnitMargin=box_70,
    Bed=box_71,
    HealtCare=box_72,
    HealthCareMargin=box_73)  # -> out, A, EntranceBoxes, CommonBoxes, WetAreaBoxes, Y, K, W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; inputs Width: Int32, Length: Int32, Height: Int32, LevelHeight: Int32, cellSize: Int32, ExteriorDoor: Box, ExteriorDoorMargin: Box, ChangeOverZone: Box, ChangeOverZoneMargin: Box, Closet: Box, ClosetMargin: Box, InteriorDoor: Box, InteriorDoorMargin: Box, Counter: Box, CounterMargin: Box, Table: Box, TableMargin: Box, SittingUnit: Box, SittingUnitMargin: Box, Bed: Box, BedMargin: Box, HealtCare: Box, HealthCareMargin: Box; disabled
# ---------- c_script_8: C# ----------
 
    List<Box> entranceBoxes = new List<Box>();
    List<Box> commonBoxes = new List<Box>();
    List<Box> wetAreaBoxes = new List<Box>();

    /*List<Box> kitchenBoxes = new List<Box>();
      List<Box> commonAreaBoxes = new List<Box>();*/

    List<Box> WhiteBoxes = new List<Box>();

    /**  These sizes are Spreading Limits for the spaces   //total cells     **/

    double entranceSize = (7 * 100 * 100) / (cellSize * cellSize);
    double commonSize = (9 * 100 * 100) / (cellSize * cellSize);
    double wetAreaSize = (7 * 100 * 100 ) / (cellSize * cellSize);

    /*
    double kitchenSize = 7 * 100 * 100 / cellSize * cell  Size;
    double commonAreaSize = 10 * 100 * 100 / cellSize * cellSize;
    */

    Point3d pA = new Point3d(0, 0, 0);
    Point3d pB = new Point3d(10, 0, 0);
    Point3d pC = new Point3d(0, 10, 0);

    Plane p = new Plane(pA, pB, pC);

    int width = Width;
    int length = Length;
    int levelHeight = LevelHeight;
    int height = Height;
    int levelNumber = Height / LevelHeight;

    int[,,] areaArray = InitializeZeroMatrice(length, width, levelNumber);
    StartZones(areaArray);

    int[,,] emptyFullArray = InitializeZeroMatrice(length, width, levelNumber);

    for (int i = 0; i < width * length * 3; i++)
    {

      Spread(areaArray, ref entranceSize, entranceList, ref entranceCounter, entranceLimit, cellSize);
      Spread(areaArray, ref commonSize, commonList, ref commonCounter, commonLimit, cellSize);
      Spread(areaArray, ref wetAreaSize, wetAreaList, ref wetAreaCounter, wetAreaLimit, cellSize);

    }

    noiseFilter(areaArray, 0, 4, 5);
    noiseFilter(areaArray, 1, 2, 2);
 
    for (int k = 0;k < levelNumber;k++)
    {
      for (int i = 0;i < length;i++)
      {
        for (int j = 0;j < width;j++)
        {
          areaArray[i, j, k] = areaArray[i, j, 0];
        }
      }
    }

    for (int k = 0;k < levelNumber;k++)
    {
      for (int i = 0;i < length;i++)
      {
        for (int j = 0;j < width;j++)
        {
          emptyFullArray[i, j, k] = 0;
        }
      }
    }

    entranceList.Clear();
    commonList.Clear();
    wetAreaList.Clear();
    /*kitchenList.Clear();
    commonAreaList.Clear();*/

    for (int k = 0;k < levelNumber;k++)
    {
      for (int i = 0;i < length;i++)
      {
        for (int j = 0;j < width;j++)
        {
          if (areaArray[i, j, k] == 1)
          {
            Interval xInterval = new Interval(i * cellSize, (i + 1) * (cellSize ));
            Interval yInterval = new Interval(j * cellSize, (j + 1) * (cellSize ));
            Interval zInterval = new Interval(k * LevelHeight, k * LevelHeight + levelHeight);

            Box boxgh = new Box(p, xInterval, yInterval, zInterval);
            entranceBoxes.Add(boxgh);
            entranceList.AddRange(new int[2] { i, j });
          }
          if (areaArray[i, j, k] == 2)
          {
            Interval xInterval = new Interval(i * cellSize, (i + 1) * (cellSize ));
            Interval yInterval = new Interval(j * cellSize, (j + 1) * (cellSize ));
            Interval zInterval = new Interval(k * LevelHeight, k * LevelHeight + levelHeight);

            Box boxgh = new Box(p, xInterval, yInterval, zInterval);
            commonBoxes.Add(boxgh);
            commonList.AddRange(new int[2] { i, j });
          }
          if (areaArray[i, j, k] == 3)
          {
            Interval xInterval = new Interval(i * cellSize, (i + 1) * (cellSize ));
            Interval yInterval = new Interval(j * cellSize, (j + 1) * (cellSize ));
            Interval zInterval = new Interval(k * LevelHeight, k * LevelHeight + levelHeight);

            Box boxgh = new Box(p, xInterval, yInterval, zInterval);
            wetAreaBoxes.Add(boxgh);
            wetAreaList.AddRange(new int[2] { i, j });
          }

          /*if (areaArray[i, j, k] == 4)
          {
            Interval xInterval = new Interval(j * cellSize, (j + 1) * (cellSize ));
            Interval yInterval = new Interval(i * cellSize, (i + 1) * (cellSize ));
            Interval zInterval = new Interval(k * LevelHeight, k * LevelHeight + levelHeight);

            Box boxgh = new Box(p, xInterval, yInterval, zInterval);
            kitchenBoxes.Add(boxgh);
            kitchenList.AddRange(new int[2] { i, j });
          }
          if (areaArray[i, j, k] == 5)
          {
            Interval xInterval = new Interval(j * cellSize, (j + 1) * (cellSize ));
            Interval yInterval = new Interval(i * cellSize, (i + 1) * (cellSize ));
            Interval zInterval = new Interval(k * LevelHeight, k * LevelHeight + levelHeight);

            Box boxgh = new Box(p, xInterval, yInterval, zInterval);
            commonAreaBoxes.Add(boxgh);
            commonAreaList.AddRange(new int[2] { i, j });
          }*/
          if (areaArray[i, j, k] == 0)
          {

            Interval xInterval = new Interval(i * cellSize, (i + 1) * (cellSize ));
            Interval yInterval = new Interval(j * cellSize, (j + 1) * (cellSize ));
            Interval zInterval = new Interval(k * LevelHeight, k * LevelHeight + levelHeight);

            Box boxgh = new Box(p, xInterval, yInterval, zInterval);
            WhiteBoxes.Add(boxgh);
            //WhiteList.AddRange(i, j);
          }
        }
      }
    }

    ShowMatrix(areaArray);

    A = areaArray;
    EntranceBoxes = entranceBoxes;
    CommonBoxes = commonBoxes;
    WetAreaBoxes = wetAreaBoxes;
    W = WhiteBoxes;
# ---------- c_script_8: C# additional code ----------
  class Objects
  {
    public string Name;
    public int ZoneName;

    public Box Obj;
    public Box ObjMargin;

    public bool Front = false;
    public bool Right = false;
    public bool Back = false;
    public bool Left = false;
    public bool Top = false;
    public bool Bottom = false;

    public bool RotationBool = true;
    public int RotationOpt; // rotation options

    public bool MirrorBool = true;
    public int MirrorOpt; // mirror options

    public string Source; // Water, Electiricity
    public int FixedToWall; // Bed, Television //1,2,3 conditions
    public int CellSize;

    public Objects PreviousObject;

    public double ObjLength ;
    public double ObjWidth ;
    public double ObjHeight ;

    public double MrjLength;
    public double MrjWidth;
    public double MrjHeight;

    public double baseX, baseY, baseZ;
    public List<int> SpaceList = new List<int>();

    public double  XCell;
    public double  YCell;
    public double  ZCell;


    //deneme
    public Objects()
    {
            /*
            var Coordinates = new List<int>();
            Point3d pA = new Point3d(0, 0, 0);
            Point3d pB = new Point3d(10, 0, 0);
            Point3d pC = new Point3d(0, 10, 0);

            Plane p = new Plane(pA, pB, pC);*/
    }

    public Objects(string name, int zoneName, bool front, bool right, bool back, bool left, bool top, bool bottom, bool rotationalBool, int rotationOpt, bool mirrorBool, int mirrorOpt, string source, int fixedTowall, int cellSize, Box obj, Box objMargin, Objects previousObject, List<int> spaceList)
      : this()
    {
      this.Obj = obj;
      this.ObjMargin = objMargin;

      this.Name = name;
      this.ZoneName = zoneName;

      this.Front = front;
      this.Right = right;
      this.Back = back;
      this.Left = left;
      this.Bottom = bottom;
      this.Top = top;

      this.RotationBool = rotationalBool;
      this.RotationOpt = rotationOpt;

      this.MirrorBool = mirrorBool;
      this.MirrorOpt = mirrorOpt;

      this.Source = source;
      this.FixedToWall = fixedTowall;
      this.CellSize = cellSize;

      this.ObjWidth = obj.X.T1;
      this.ObjLength = obj.Y.T1;
      this.ObjHeight = obj.Z.T1;

      this.MrjWidth = objMargin.X.T1;
      this.MrjLength = objMargin.Y.T1;
      this.MrjHeight = objMargin.Z.T1;

      this.baseX = Obj.Plane.OriginX;
      this.baseY = Obj.Plane.OriginY;
      this.baseZ = Obj.Plane.OriginZ;

      this.PreviousObject = previousObject;
      this.SpaceList = spaceList;
    }

    public Objects(string name, int zoneName, bool front, bool right, bool back, bool left, bool top, bool bottom, bool rotationalBool, int rotationOpt, bool mirrorBool, int mirrorOpt, string source, int fixedTowall, int cellSize, Box obj, Box objMargin, List<int> spaceList)
      : this()
    {
      this.Obj = obj;
      this.ObjMargin = objMargin;

      this.Name = name;
      this.ZoneName = zoneName;

      this.Front = front;
      this.Right = right;
      this.Back = back;
      this.Left = left;
      this.Bottom = bottom;
      this.Top = top;

      this.RotationBool = rotationalBool;
      this.RotationOpt = rotationOpt;

      this.MirrorBool = mirrorBool;
      this.MirrorOpt = mirrorOpt;

      this.Source = source;
      this.FixedToWall = fixedTowall;
      this.CellSize = cellSize;

      this.ObjWidth = obj.X.T1;
      this.ObjLength = obj.Y.T1;
      this.ObjHeight = obj.Z.T1;

      this.MrjWidth = (this.ObjMargin.X.T1);
      this.MrjLength = (this.ObjMargin.Y.T1);
      this.MrjHeight = (this.ObjMargin.Z.T1);

      this.baseX = Obj.Plane.OriginX;
      this.baseY = Obj.Plane.OriginY;
      this.baseZ = Obj.Plane.OriginZ;

      this.SpaceList = spaceList;
    }

    public void assignDimensions()
    {
      this.ObjWidth = this.Obj.X.T1;
      this.ObjLength = this.Obj.Y.T1;
      this.ObjHeight = this.Obj.Z.T1;

      this.MrjWidth = this.ObjMargin.X.T1;
      this.MrjLength = this.ObjMargin.Y.T1;
      this.MrjHeight = this.ObjMargin.Z.T1;

    }

    public void printDimensions()
    {
      Rhino.RhinoApp.WriteLine("Obj Width " + this.ObjWidth.ToString());
      Rhino.RhinoApp.WriteLine("Obj Length " + this.ObjLength.ToString());
      Rhino.RhinoApp.WriteLine("Obj Height " + this.ObjHeight.ToString());

      Rhino.RhinoApp.WriteLine("Obj Width " + this.MrjWidth.ToString());
      Rhino.RhinoApp.WriteLine("Obj Length " + this.MrjLength.ToString());
      Rhino.RhinoApp.WriteLine("Obj Height " + this.MrjHeight.ToString());
    }



    public void placeRefObject(int [,,]emptyFullArray, int[,,]areaArray, out Box ObjBox, out Box marginBox)
    {
      this.XCell = Math.Ceiling((double) (this.MrjWidth / CellSize));
      this.YCell = Math.Ceiling((double) (this.MrjLength / CellSize));
      this.ZCell = Math.Ceiling((double) (this.MrjHeight / 150));

      bool emptyBool = true;
      bool sameZone = true;

      bool placeSuccessful = false;
      int trycount = 0;

      while (placeSuccessful == false)
      {
        var rand = new Random();
        var randomCellIndex = rand.Next(this.SpaceList.Count / 2);

        baseX = (this.SpaceList[2 * randomCellIndex]) * CellSize;
        baseY = (this.SpaceList[2 * randomCellIndex + 1]) * CellSize;
        baseZ = 0;
        baseZ = 0;

        //baseX = baseX * CellSize;
        //baseY = baseY * CellSize;

        if( (baseX + this.MrjWidth < 300) && (baseY + this.MrjLength < 600) && (baseZ + this.MrjHeight < 300) &&
          (baseX + this.MrjWidth > 0) && (baseY + this.MrjLength > 0) && (baseZ + this.MrjHeight > 0) )
        {
          for(int i = (int) (baseX / CellSize) ; i < (baseX / CellSize + (int) XCell); i++)
          {
            for(int j = (int) (baseY / CellSize); j < baseY / CellSize + (int) YCell; j++)
            {
              for(int k = (int) (baseZ / 150); k < baseZ / 150 + (int) ZCell; k++)
              {
                Rhino.RhinoApp.WriteLine("Entrance Reference Object :  " + "  i:  " + i + "  j:  " + j + "  k:  " + k);
                if (emptyFullArray[i, j, k] == 1)
                {
                  emptyBool = false;
                }
                if (areaArray[i, j, k] != this.ZoneName)
                {
                  sameZone = false;
                }
              }
            }
          }

          if (emptyBool && sameZone)
          {
            placeSuccessful = true;

            Rhino.RhinoApp.WriteLine("Reference Object conditions are successful ");
            for(int i = (int) (baseX / CellSize) ; i < (baseX / CellSize + (int) XCell); i++)
            {
              for(int j = (int) (baseY / CellSize); j < baseY / CellSize + (int) YCell; j++)
              {
                for(int k = (int) (baseZ / 150); k < baseZ / 150 + (int) ZCell; k++)
                {
                  emptyFullArray[i, j, k] = 1;
                }
              }
            }
          }
          else
          {
            Rhino.RhinoApp.WriteLine("Conditions are not satisfied ");
          }
        }

        trycount++;
        Rhino.RhinoApp.WriteLine("Try count is : " + trycount);
        if (trycount > 60 )
          Rhino.RhinoApp.WriteLine("Try count is over 60 placement is unsuccessful: ");
        placeSuccessful = true;
      }

      if( trycount < 60 && placeSuccessful )
      {
        Rhino.RhinoApp.WriteLine("baseX " + this.baseX);
        Rhino.RhinoApp.WriteLine("baseY " + this.baseY);
        Rhino.RhinoApp.WriteLine("baseZ " + this.baseZ);

        Point3d pointa = new Point3d(baseX, baseY, 0);
        Vector3d pointb = new Vector3d(0, 0, 1);

        Plane planebase = new Plane(pointa, pointb);

        Interval xInterval = new Interval(0, this.ObjWidth);
        Interval yInterval = new Interval(0, this.ObjLength);
        Interval zInterval = new Interval(0, this.ObjHeight);

        ObjBox = new Box(planebase, xInterval, yInterval, zInterval);

        xInterval = new Interval(0, this.MrjWidth);
        yInterval = new Interval(0, this.MrjLength);
        zInterval = new Interval(0, this.MrjHeight);

        marginBox = new Box(planebase, xInterval, yInterval, zInterval);

      }

      else
      {
        ObjBox = new Box();
        marginBox = new Box();
      }
    }

    public void placeRefObjectEntrance(int [,,]emptyFullArray, int[,,]areaArray, out Box ObjBox, out Box marginBox)
    {
      this.XCell = Math.Ceiling((double) (this.MrjWidth / CellSize));
      this.YCell = Math.Ceiling((double) (this.MrjLength / CellSize));
      this.ZCell = Math.Ceiling((double) (this.MrjHeight / 150));

      bool emptyBool = true;
      bool sameZone = true;


      bool placeSuccessful = false;
      int trycount = 0;

      while (placeSuccessful == false)
      {
        var rand = new Random();
        var randomCellIndex = rand.Next(this.SpaceList.Count / 2);

        baseX = (this.SpaceList[2 * randomCellIndex]) * CellSize;
        baseY = 0;
        baseZ = 0;

        //baseX = baseX * CellSize;
        //baseY = baseY * CellSize;

        if( (baseX + this.MrjWidth < 300) && (baseY + this.MrjLength < 600) && (baseZ + this.MrjHeight < 300) &&
          (baseX + this.MrjWidth > 0) && (baseY + this.MrjLength > 0) && (baseZ + this.MrjHeight > 0) )
        {
          for(int i = (int) (baseX / CellSize) ; i < (baseX / CellSize + (int) XCell); i++)
          {
            for(int j = (int) (baseY / CellSize); j < baseY / CellSize + (int) YCell; j++)
            {
              for(int k = (int) (baseZ / 150); k < baseZ / 150 + (int) ZCell; k++)
              {
                Rhino.RhinoApp.WriteLine("Entrance Reference Object :  " + "  i:  " + i + "  j:  " + j + "  k:  " + k);
                if (emptyFullArray[i, j, k] == 1)
                {
                  emptyBool = false;
                }
                if (areaArray[i, j, k] != this.ZoneName)
                {
                  sameZone = false;
                }
              }
            }
          }

          if (emptyBool && sameZone)
          {
            placeSuccessful = true;

            Rhino.RhinoApp.WriteLine("Reference Object conditions are successful ");
            for(int i = (int) (baseX / CellSize) ; i < (baseX / CellSize + (int) XCell); i++)
            {
              for(int j = (int) (baseY / CellSize); j < baseY / CellSize + (int) YCell; j++)
              {
                for(int k = (int) (baseZ / 150); k < baseZ / 150 + (int) ZCell; k++)
                {
                  emptyFullArray[i, j, k] = 1;
                }
              }
            }
          }
          else
          {
            Rhino.RhinoApp.WriteLine("Conditions are not satisfied ");
          }
        }

        trycount++;
        Rhino.RhinoApp.WriteLine("Try count is : " + trycount);
        if (trycount > 60 )
          Rhino.RhinoApp.WriteLine("Try count is over 60 placement is unsuccessful: ");
        placeSuccessful = true;
      }

      if( trycount < 60 && placeSuccessful )
      {
        Rhino.RhinoApp.WriteLine("baseX " + this.baseX);
        Rhino.RhinoApp.WriteLine("baseY " + this.baseY);
        Rhino.RhinoApp.WriteLine("baseZ " + this.baseZ);

        Point3d pointa = new Point3d(baseX, 0, 0);
        Vector3d pointb = new Vector3d(0, 0, 1);

        Plane planebase = new Plane(pointa, pointb);

        Interval xInterval = new Interval(0, this.ObjWidth);
        Interval yInterval = new Interval(0, this.ObjLength);
        Interval zInterval = new Interval(0, this.ObjHeight);

        ObjBox = new Box(planebase, xInterval, yInterval, zInterval);

        xInterval = new Interval(0, this.MrjWidth);
        yInterval = new Interval(0, this.MrjLength);
        zInterval = new Interval(0, this.MrjHeight);

        marginBox = new Box(planebase, xInterval, yInterval, zInterval);

      }


      else
      {
        ObjBox = new Box();
        marginBox = new Box();
      }

    }


    public void placeFront(int [,,]emptyFullArray, int[,,]areaArray, out Box ObjBox, out Box marginBox)
    {
      bool emptyBool = true;
      bool sameZone = true;

      this.XCell = Math.Ceiling((double) (this.MrjWidth / CellSize));
      this.YCell = Math.Ceiling((double) (this.MrjLength / CellSize));
      this.ZCell = Math.Ceiling((double) (this.MrjHeight / 150));

      this.baseX = PreviousObject.baseX;
      this.baseY = PreviousObject.baseY + CellSize * PreviousObject.YCell;
      this.baseZ = PreviousObject.baseZ;

      if( (baseX + this.MrjWidth < 300) && (baseY + this.MrjLength < 600) && (baseZ + this.MrjHeight < 300) &&
        (baseX + this.MrjWidth > 0) && (baseY + this.MrjLength > 0) && (baseZ + this.MrjHeight > 0) )
      {
        for(int i = (int) (baseX / CellSize) ; i < (baseX / CellSize + (int) XCell); i++)
        {
          for(int j = (int) (baseY / CellSize); j < baseY / CellSize + (int) YCell; j++)
          {
            for(int k = (int) (baseZ / 150); k < baseZ / 150 + (int) ZCell; k++)
            {
              Rhino.RhinoApp.WriteLine("i:  " + i + "  j:  " + j + "  k:  " + k);
              if (emptyFullArray[i, j, k] == 1)
              {
                emptyBool = false;
              }
              if (areaArray[i, j, k] != this.ZoneName)
              {
                sameZone = false;
              }
            }
          }
        }

        if (emptyBool && sameZone)
        {
          Rhino.RhinoApp.WriteLine("Conditions are successful ");
          for(int i = (int) (baseX / CellSize) ; i < (baseX / CellSize + (int) XCell); i++)
          {
            for(int j = (int) (baseY / CellSize); j < baseY / CellSize + (int) YCell; j++)
            {
              for(int k = (int) (baseZ / 150); k < baseZ / 150 + (int) ZCell; k++)
              {
                emptyFullArray[i, j, k] = 1;
              }
            }
          }
        }
        else
        {
          Rhino.RhinoApp.WriteLine("Place Front:  Conditions are not satisfied ");
        }
      }
      else
      {
        Rhino.RhinoApp.WriteLine("Place Front: Conditions are not satisfied ");
      }


      Point3d pointa = new Point3d(baseX, baseY, baseZ);
      Vector3d pointb = new Vector3d(0, 0, 1);

      Plane planebase = new Plane(pointa, pointb);

      Interval xInterval = new Interval(0, this.ObjWidth);
      Interval yInterval = new Interval(0, this.ObjLength);
      Interval zInterval = new Interval(0, this.ObjHeight);

      ObjBox = new Box(planebase, xInterval, yInterval, zInterval);

      xInterval = new Interval(0, this.MrjWidth);
      yInterval = new Interval(0, this.MrjLength);
      zInterval = new Interval(0, this.MrjHeight);

      marginBox = new Box(planebase, xInterval, yInterval, zInterval);
    }


    public void placeRight(int [,,]emptyFullArray, int[,,]areaArray, out Box ObjBox, out Box marginBox)
    {
      bool emptyBool = true;
      bool sameZone = true;

      this.XCell = Math.Ceiling((double) (this.MrjWidth / CellSize));
      this.YCell = Math.Ceiling((double) (this.MrjLength / CellSize));
      this.ZCell = Math.Ceiling((double) (this.MrjHeight / 150));

      this.baseX = PreviousObject.baseX + CellSize * PreviousObject.XCell;
      this.baseY = PreviousObject.baseY;
      this.baseZ = PreviousObject.baseZ;

      if( (baseX + this.ObjWidth < 300) && (baseY + this.ObjLength < 600) && (baseZ + this.ObjHeight < 300) &&
        (baseX + this.ObjWidth > 0) && (baseY + this.ObjLength > 0) && (baseZ + this.ObjHeight > 0) )
      {
        for(int i = (int) (baseX / CellSize) ; i < (baseX / CellSize + (int) XCell); i++)
        {
          for(int j = (int) (baseY / CellSize); j < baseY / CellSize + (int) YCell; j++)
          {
            for(int k = (int) (baseZ / 150); k < baseZ / 150 + (int) ZCell; k++)
            {
              if (emptyFullArray[i, j, k] == 1)
              {
                emptyBool = false;
              }
              if (areaArray[i, j, k] != this.ZoneName)
              {
                sameZone = false;
              }
            }
          }
        }

        if (emptyBool && sameZone)
        {
          Rhino.RhinoApp.WriteLine("Place Right: Conditions are successful ");
          for(int i = (int) (baseX / CellSize) ; i < (baseX / CellSize + (int) XCell); i++)
          {
            for(int j = (int) (baseY / CellSize); j < baseY / CellSize + (int) YCell; j++)
            {
              for(int k = (int) (baseZ / 150); k < baseZ / 150 + (int) ZCell; k++)
              {
                emptyFullArray[i, j, k] = 1;
              }
            }
          }
        }
        else
        {
          Rhino.RhinoApp.WriteLine("Place Right: Conditions are not satisfied ");
        }
      }
      else
      {
        Rhino.RhinoApp.WriteLine("Place Right: Conditions are not satisfied ");
      }

      Point3d pointa = new Point3d(baseX, baseY, baseZ);
      Vector3d pointb = new Vector3d(0, 0, 1);

      Plane planebase = new Plane(pointa, pointb);

      Interval xInterval = new Interval(0, this.ObjWidth);
      Interval yInterval = new Interval(0, this.ObjLength);
      Interval zInterval = new Interval(0, this.ObjHeight);

      ObjBox = new Box(planebase, xInterval, yInterval, zInterval);

      xInterval = new Interval(0, this.MrjWidth);
      yInterval = new Interval(0, this.MrjLength);
      zInterval = new Interval(0, this.MrjHeight);

      marginBox = new Box(planebase, xInterval, yInterval, zInterval);
    }

    public void placeBack(int [,,]emptyFullArray, int[,,]areaArray, out Box ObjBox, out Box marginBox)
    {
      bool emptyBool = true;
      bool sameZone = true;

      this.XCell = Math.Ceiling((double) (this.MrjWidth / CellSize));
      this.YCell = Math.Ceiling((double) (this.MrjLength / CellSize));
      this.ZCell = Math.Ceiling((double) (this.MrjHeight / 150));

      this.baseX = PreviousObject.baseX;
      this.baseY = PreviousObject.baseY - CellSize * this.YCell;
      this.baseZ = PreviousObject.baseZ;

      if( (baseX + this.ObjWidth < 300) && (baseY + this.ObjLength < 600) && (baseZ + this.ObjHeight < 300) &&
        (baseX + this.ObjWidth > 0) && (baseY + this.ObjLength > 0) && (baseZ + this.ObjHeight > 0) )
      {
        for(int i = (int) (baseX / CellSize) ; i < (baseX / CellSize + (int) XCell); i++)
        {
          for(int j = (int) (baseY / CellSize); j < baseY / CellSize + (int) YCell; j++)
          {
            for(int k = (int) (baseZ / 150); k < baseZ / 150 + (int) ZCell; k++)
            {
              if (emptyFullArray[i, j, k] == 1)
              {
                emptyBool = false;
              }
              if (areaArray[i, j, k] != this.ZoneName)
              {
                sameZone = false;
              }
            }
          }
        }

        if (emptyBool && sameZone)
        {
          Rhino.RhinoApp.WriteLine("Place Back: Conditions are successful ");
          for(int i = (int) (baseX / CellSize) ; i < (baseX / CellSize + (int) XCell); i++)
          {
            for(int j = (int) (baseY / CellSize); j < baseY / CellSize + (int) YCell; j++)
            {
              for(int k = (int) (baseZ / 150); k < baseZ / 150 + (int) ZCell; k++)
              {
                emptyFullArray[i, j, k] = 1;
              }
            }
          }
        }
        else
        {
          Rhino.RhinoApp.WriteLine("Place Back: Conditions are not satisfied ");
        }
      }
      else
      {
        Rhino.RhinoApp.WriteLine("Place Back:Conditions are not satisfied ");
      }

      Point3d pointa = new Point3d(baseX, baseY, baseZ);
      Vector3d pointb = new Vector3d(0, 0, 1);

      Plane planebase = new Plane(pointa, pointb);

      Interval xInterval = new Interval(0, this.ObjWidth);
      Interval yInterval = new Interval(0, this.ObjLength);
      Interval zInterval = new Interval(0, this.ObjHeight);

      ObjBox = new Box(planebase, xInterval, yInterval, zInterval);

      xInterval = new Interval(0, this.MrjWidth);
      yInterval = new Interval(0, this.MrjLength);
      zInterval = new Interval(0, this.MrjHeight);

      marginBox = new Box(planebase, xInterval, yInterval, zInterval);
    }

    public void placeLeft(int [,,]emptyFullArray, int[,,]areaArray, out Box ObjBox, out Box marginBox)
    {
      bool emptyBool = true;
      bool sameZone = true;

      this.XCell = Math.Ceiling((double) (this.MrjWidth / CellSize));
      this.YCell = Math.Ceiling((double) (this.MrjLength / CellSize));
      this.ZCell = Math.Ceiling((double) (this.MrjHeight / 150));

      this.baseX = PreviousObject.baseX - CellSize * this.XCell;
      this.baseY = PreviousObject.baseY;
      this.baseZ = PreviousObject.baseZ;

      if( (baseX + this.ObjWidth < 300) && (baseY + this.ObjLength < 600) && (baseZ + this.ObjHeight < 300) &&
        (baseX + this.ObjWidth > 0) && (baseY + this.ObjLength > 0) && (baseZ + this.ObjHeight > 0) )
      {
        for(int i = (int) (baseX / CellSize) ; i < (baseX / CellSize + (int) XCell); i++)
        {
          for(int j = (int) (baseY / CellSize); j < baseY / CellSize + (int) YCell; j++)
          {
            for(int k = (int) (baseZ / 150); k < baseZ / 150 + (int) ZCell; k++)
            {
              if (emptyFullArray[i, j, k] == 1)
              {
                emptyBool = false;
              }
              if (areaArray[i, j, k] != this.ZoneName)
              {
                sameZone = false;
              }
            }
          }
        }

        if (emptyBool && sameZone)
        {
          Rhino.RhinoApp.WriteLine("Place Left: Conditions are successful ");
          for(int i = (int) (baseX / CellSize) ; i < (baseX / CellSize + (int) XCell); i++)
          {
            for(int j = (int) (baseY / CellSize); j < baseY / CellSize + (int) YCell; j++)
            {
              for(int k = (int) (baseZ / 150); k < baseZ / 150 + (int) ZCell; k++)
              {
                emptyFullArray[i, j, k] = 1;
              }
            }
          }
        }
        else
        {
          Rhino.RhinoApp.WriteLine("Place Left: Conditions are not satisfied ");
        }
      }
      else
      {
        Rhino.RhinoApp.WriteLine("Place Left: Conditions are not satisfied ");
      }

      Point3d pointa = new Point3d(baseX, baseY, baseZ);
      Vector3d pointb = new Vector3d(0, 0, 1);

      Plane planebase = new Plane(pointa, pointb);

      Interval xInterval = new Interval(0, this.ObjWidth);
      Interval yInterval = new Interval(0, this.ObjLength);
      Interval zInterval = new Interval(0, this.ObjHeight);

      ObjBox = new Box(planebase, xInterval, yInterval, zInterval);

      xInterval = new Interval(0, this.MrjWidth);
      yInterval = new Interval(0, this.MrjLength);
      zInterval = new Interval(0, this.MrjHeight);

      marginBox = new Box(planebase, xInterval, yInterval, zInterval);
    }
    public void placeTop(int [,,]emptyFullArray, int[,,]areaArray, out Box ObjBox, out Box marginBox)
    {
      bool emptyBool = true;
      bool sameZone = true;

      this.XCell = Math.Ceiling((double) (this.MrjWidth / CellSize));
      this.YCell = Math.Ceiling((double) (this.MrjLength / CellSize));
      this.ZCell = Math.Ceiling((double) (this.MrjHeight / 150));

      this.baseX = PreviousObject.baseX;
      this.baseY = PreviousObject.baseY;
      this.baseZ = PreviousObject.baseZ + CellSize * PreviousObject.ZCell;

      if( (baseX + this.ObjWidth < 300) && (baseY + this.ObjLength < 600) && (baseZ + this.ObjHeight < 300) &&
        (baseX + this.ObjWidth > 0) && (baseY + this.ObjLength > 0) && (baseZ + this.ObjHeight > 0) )
      {
        for(int i = (int) (baseX / CellSize) ; i < (baseX / CellSize + (int) XCell); i++)
        {
          for(int j = (int) (baseY / CellSize); j < baseY / CellSize + (int) YCell; j++)
          {
            for(int k = (int) (baseZ / 150); k < baseZ / 150 + (int) ZCell; k++)
            {
              if (emptyFullArray[i, j, k] == 1)
              {
                emptyBool = false;
              }
              if (areaArray[i, j, k] != this.ZoneName)
              {
                sameZone = false;
              }
            }
          }
        }

        if (emptyBool && sameZone)
        {
          Rhino.RhinoApp.WriteLine("Conditions are successful ");
          for(int i = (int) (baseX / CellSize) ; i < (baseX / CellSize + (int) XCell); i++)
          {
            for(int j = (int) (baseY / CellSize); j < baseY / CellSize + (int) YCell; j++)
            {
              for(int k = (int) (baseZ / 150); k < baseZ / 150 + (int) ZCell; k++)
              {
                emptyFullArray[i, j, k] = 1;
              }
            }
          }
        }
        else
        {
          Rhino.RhinoApp.WriteLine("Conditions are not satisfied ");
        }
      }
      else
      {
        Rhino.RhinoApp.WriteLine("Conditions are not satisfied ");
      }

      Point3d pointa = new Point3d(baseX, baseY, baseZ);
      Vector3d pointb = new Vector3d(0, 0, 1);

      Plane planebase = new Plane(pointa, pointb);

      Interval xInterval = new Interval(0, this.ObjWidth);
      Interval yInterval = new Interval(0, this.ObjLength);
      Interval zInterval = new Interval(0, this.ObjHeight);

      ObjBox = new Box(planebase, xInterval, yInterval, zInterval);

      xInterval = new Interval(0, this.MrjWidth);
      yInterval = new Interval(0, this.MrjLength);
      zInterval = new Interval(0, this.MrjHeight);

      marginBox = new Box(planebase, xInterval, yInterval, zInterval);
    }

    public void placeBottom(int [,,]emptyFullArray, int[,,]areaArray, out Box ObjBox, out Box marginBox)
    {
      bool emptyBool = true;
      bool sameZone = true;

      this.XCell = Math.Ceiling((double) (this.MrjWidth / CellSize));
      this.YCell = Math.Ceiling((double) (this.MrjLength / CellSize));
      this.ZCell = Math.Ceiling((double) (this.MrjHeight / 150));

      this.baseX = PreviousObject.baseX;
      this.baseY = PreviousObject.baseY;
      this.baseZ = PreviousObject.baseZ - CellSize * this.ZCell;

      if( (baseX + this.ObjWidth < 300) && (baseY + this.ObjLength < 600) && (baseZ + this.ObjHeight < 300) &&
        (baseX + this.ObjWidth > 0) && (baseY + this.ObjLength > 0) && (baseZ + this.ObjHeight > 0) )
      {
        for(int i = (int) (baseX / CellSize) ; i < (baseX / CellSize + (int) XCell); i++)
        {
          for(int j = (int) (baseY / CellSize); j < baseY / CellSize + (int) YCell; j++)
          {
            for(int k = (int) (baseZ / 150); k < baseZ / 150 + (int) ZCell; k++)
            {
              if (emptyFullArray[i, j, k] == 1)
              {
                emptyBool = false;
              }
              if (areaArray[i, j, k] != this.ZoneName)
              {
                sameZone = false;
              }
            }
          }
        }

        if (emptyBool && sameZone)
        {
          Rhino.RhinoApp.WriteLine("Conditions are successful ");
          for(int i = (int) (baseX / CellSize) ; i < (baseX / CellSize + (int) XCell); i++)
          {
            for(int j = (int) (baseY / CellSize); j < baseY / CellSize + (int) YCell; j++)
            {
              for(int k = (int) (baseZ / 150); k < baseZ / 150 + (int) ZCell; k++)
              {
                emptyFullArray[i, j, k] = 1;
              }
            }
          }
        }
        else
        {
          Rhino.RhinoApp.WriteLine("Conditions are not satisfied ");
        }
      }
      else
      {
        Rhino.RhinoApp.WriteLine("Conditions are not satisfied ");
      }

      Point3d pointa = new Point3d(baseX, baseY, baseZ);
      Vector3d pointb = new Vector3d(0, 0, 1);

      Plane planebase = new Plane(pointa, pointb);

      Interval xInterval = new Interval(0, this.ObjWidth);
      Interval yInterval = new Interval(0, this.ObjLength);
      Interval zInterval = new Interval(0, this.ObjHeight);

      ObjBox = new Box(planebase, xInterval, yInterval, zInterval);

      xInterval = new Interval(0, this.MrjWidth);
      yInterval = new Interval(0, this.MrjLength);
      zInterval = new Interval(0, this.MrjHeight);

      marginBox = new Box(planebase, xInterval, yInterval, zInterval);
    }

    public void placeObject(int [,,]emptyFullArray, int[,,]areaArray, out Box ObjBox, out Box marginBox)
    {

      Point3d pointa = new Point3d(baseX, baseY, baseZ);
      Vector3d pointb = new Vector3d(0, 0, 1);

      Plane planebase = new Plane(pointa, pointb);

      Interval xInterval = new Interval(0, this.ObjWidth);
      Interval yInterval = new Interval(0, this.ObjLength);
      Interval zInterval = new Interval(0, this.ObjHeight);

      ObjBox = new Box(planebase, xInterval, yInterval, zInterval);

      xInterval = new Interval(0, this.MrjWidth);
      yInterval = new Interval(0, this.MrjLength);
      zInterval = new Interval(0, this.MrjHeight);

      marginBox = new Box(planebase, xInterval, yInterval, zInterval);

      List<int> growDirection = new List<int>();

      if(PreviousObject.Front == true)
        growDirection.Add(1); // Front Direction
      if(PreviousObject.Right == true)
        growDirection.Add(2); // Right Direction
      if(PreviousObject.Back == true)
        growDirection.Add(3); // Back Direction
      if(PreviousObject.Left == true)
        growDirection.Add(4); // Left Direction
      if(PreviousObject.Bottom == true)
        growDirection.Add(5); // Bottom Direction
      if(PreviousObject.Top == true)
        growDirection.Add(6); // Right Direction

      bool placeSuccess = false;
      int tryCounter = 0;

      if(growDirection.Count >= 1)
      {
        Random randm = new Random();

        while(placeSuccess == false )
        {
          int a = randm.Next(0, growDirection.Count);
          int randomMethod = growDirection[a];

          switch (a)
          ​{
            case 1:
              this.placeFront(emptyFullArray, areaArray, out  ObjBox, out marginBox);
              placeSuccess = true;
              break;
            case 2:
              this.placeRight(emptyFullArray, areaArray, out  ObjBox, out marginBox);
              placeSuccess = true;
              break;
            case 3:
              this.placeBack(emptyFullArray, areaArray, out  ObjBox, out marginBox);
              placeSuccess = true;
              break;
            case 4:
              this.placeLeft(emptyFullArray, areaArray, out  ObjBox, out marginBox);
              placeSuccess = true;
              break;
            case 5:
              this.placeBottom(emptyFullArray, areaArray, out  ObjBox, out marginBox);
              placeSuccess = true;
              break;
            case 6:
              this.placeTop(emptyFullArray, areaArray, out  ObjBox, out marginBox);
              placeSuccess = true;
              break;

            default:
              tryCounter++;
              break;
            // default statements
          }


        }
        growDirection.Clear();




      }


    }


    public void rotate()
    {

    }



    static void mirror()
    {

    }

    static void getClosestCell()
    {

    }

    static void createWall()
    {

    }

  }

  static void ShowMatrix(int[,,] Arr)
  {
    for (int i = 0; i < Arr.GetLength(0); i++)
    {
      for (int j = 0; j < Arr.GetLength(1); j++)
      {
        Rhino.RhinoApp.Write(Arr[i, j, 0] + " ");
      }
      Rhino.RhinoApp.WriteLine("Loop Runs" + i.ToString());
    }
    return;
  }

  static int[,,] InitializeZeroMatrice(int width, int length, int levelNumber)
  {
    var areaArray = new int[width, length, levelNumber];

    for (int k = 0; k < levelNumber; k++)
    {
      for (int i = 0; i < width; i++)
      {
        for (int j = 0; j < length; j++)
        {
          areaArray[i, j, k] = 0;
        }
      }
    }
    return areaArray;
  }

  /* The Color lists keep the colors in a seperate List in order to choose within them easily instead of searching where they are... */
  static List<int> entranceList = new List<int>();
  static List<int> commonList = new List<int>();
  static List<int> wetAreaList = new List<int>();
 /* static List<int> kitchenList = new List<int>();
  static List<int> commonAreaList = new List<int>();*/

  /**           these counters are used for starting the límitations counts.         **/

  static int entranceCounter = 1;
  static int commonCounter = 1;
  static int wetAreaCounter = 1;
  /*static int kitchenCounter = 1;
  static int commonAreaCounter = 1;*/
  /**           these limits are used for defining max distance that zone can spread.  **/

  static int entranceLimit = 250;
  static int commonLimit = 400;
  static int wetAreaLimit = 300;
  /*static int kitchenLimit = 200;
  static int commonAreaLimit = 100;*/

  static void StartZones(int[,,] arr)
  {
    /**
     * Randomly Starts the color. Takes the Color lists as argumnts
     * (We can delete these argumnents and it can get them as local referance
     * in our case it gives us a chance to choose what to initilize)
     * **/

    Random rand = new Random();
    //----------------------
    /* GetLength(0) and GetLength(1) might be set as variable */
    //Array.GetLength(0) gives the column lenght in other words length of an array
    //Array.GetLength(1) gives the row lenght in other words width of an array
    var a = rand.Next(arr.GetLength(0) / 2, arr.GetLength(0) / 2);
    var b = rand.Next(0, 2);

    Rhino.RhinoApp.WriteLine("started");
    entranceList.AddRange(new int[2] { a, b }); //AddRange ==> Adds multiple elements to a List . We use mod%2 to call the index of the point back instead of stacking them as an another List(or Array) in our list.
    arr[a, b, 0] = 1;// entrance Starting Point
    //----------------------

    b = rand.Next(0, arr.GetLength(1));
    a = rand.Next(0, arr.GetLength(0));

    commonList.AddRange(new int[2] { a, b });
    arr[a, b, 0] = 2; // common Starting Point
    //----------------------
    a = rand.Next(0, arr.GetLength(0));
    b = rand.Next(0, arr.GetLength(1));

    wetAreaList.AddRange(new int[2] { a, b });
    arr[a, b, 0] = 3; // wetArea Starting Point
    //----------------------
    a = rand.Next(0, arr.GetLength(0));
    b = rand.Next(0, arr.GetLength(1));
/*
    kitchenList.AddRange(new int[2] { a, b });
    arr[a, b, 0] = 4; // kitchen Starting Point
    //----------------------
    a = rand.Next(0, arr.GetLength(0));
    b = rand.Next(0, arr.GetLength(1));

    commonAreaList.AddRange(new int[2] { a, b });
    arr[a, b, 0] = 5; // commonArea Starting Point
    //----------------------
  */
  }
        /* Calculates the distance between initial point in the color and the possible new point!
         *  (if the possible new point is too far from inital point eleminate it.) */
  static double distanceCalculate(List<int> spaceCoordList, int x2, int y2, int cellSize)
  {
    var distance = cellSize * Math.Sqrt((y2 - spaceCoordList[1]) * (y2 - spaceCoordList[1]) + (x2 - spaceCoordList[0]) * (x2 - spaceCoordList[0]));
    return distance;
  }

  static void Evaluate()
  {
    // according to relations give score to the created zones
    // get the centers of the zones and acoording to the distances and created sizes give
    //positive or negative points and if score is not acceptable re-run and create variatians.
  }


  static void noiseFilter (int [,,] arr, int type, int iterationNumber, int controlNumber)
  {
    if(type == 0)
    {
      for( int loop = 0 ; loop < iterationNumber ; loop++ )
      {
        List < int> surrounding = new List<int>();
        for(int i = 1 ; i < arr.GetLength(0) - 1 ;i++)
        {
          for(int j = 1 ; j < arr.GetLength(1) - 1 ;j++)
          {
            for(int x = -1 ; x < 2;x++)
            {
              for(int y = -1 ; y < 2;y++)
              {
                if(!(x == y && x == 0))
                {

                  surrounding.Add(arr[i + x, j + y, 0]);
                }
              }
            }
            for (int v = 0 ; v < 6 ;v++) // 6 is the number of the zones including  empty cells
            {
              int count = (from z in surrounding where z == v select z).Count();
              if ( count >= controlNumber )
              {
                arr[i, j, 0] = v;
              }
            }
            surrounding.Clear();
            surrounding.TrimExcess();
          }
        }
      }
    }

    if(type == 1)
    {
      for( int loop = 0 ; loop < iterationNumber ; loop++ )
      {
        List < int> surrounding = new List<int>();
        for(int i = 1 ; i < arr.GetLength(0) - 1 ;i++)
        {
          for(int j = 1 ; j < arr.GetLength(1) - 1 ;j++)
          {
            for(int x = -1 ; x < 2;x++)
            {
              for(int y = -1 ; y < 2;y++)
              {
                if(!(x == y && x == 0) && ( (x + y == 1 ) || (x + y == -1 )) )
                {
                  surrounding.Add(arr[i + x, j + y, 0]);
                }
              }
            }

            for (int v = 0 ; v < 6 ;v++) // 6 is the number of the zones including  empty cells
            {
              int count = (from z in surrounding where z == v select z).Count();
              if ( count >= 2 )
              {
                arr[i, j, 0] = v;
              }
            }
            surrounding.Clear();
            surrounding.TrimExcess();
          }
        }
      }
    }
  }

  static void Spread(int[,,] arr, ref double spaceSize, List<int> spaceCoordList, ref int counter, int spaceLimit, int cellSize)
  {
        /*ARGUMENTS
     * The main array which has rectangular form(will be 3d in short) ,
     * spaceSize = Maximum limit that can grow.  ,
     * spaceCoordList =  the cells of the zone which has been already defined. )
     */
    var rand = new Random();
    var directionList = new List<int>();
    int Xcoord;
    int Ycoord;
    bool draw = false;
    int trycount = 0;

    while (draw == false && counter <= spaceSize)
    {
      if (counter <= spaceSize ) //Can be deleted. The condition is added to the While Loop Conditions.
      {
        var randomCellIndex = rand.Next(spaceCoordList.Count / 2);

        Xcoord = spaceCoordList[2 * randomCellIndex];
        Ycoord = spaceCoordList[2 * randomCellIndex + 1];

        if (Xcoord < arr.GetLength(0) - 1 && Xcoord > 0 && Ycoord > 0 && Ycoord < arr.GetLength(1) - 1)
        {
          /* Check the conditions INSIDE borders */
          if (arr[Xcoord + 1, Ycoord, 0] == 0 && distanceCalculate(spaceCoordList, Xcoord + 1, Ycoord, cellSize) < spaceLimit ) // Check if possible new cell is still white or not!
            directionList.AddRange(new int[2] { (Xcoord + 1), Ycoord }); //Store possible spread directions in a list.

          if (arr[Xcoord - 1, Ycoord, 0] == 0 && distanceCalculate(spaceCoordList, Xcoord - 1, Ycoord, cellSize) < spaceLimit)
            directionList.AddRange(new int[2] { (Xcoord - 1), Ycoord }); //Store possible spread directions in a list.

          if (arr[Xcoord, Ycoord + 1, 0] == 0 && distanceCalculate(spaceCoordList, Xcoord, Ycoord + 1, cellSize) < spaceLimit)
            directionList.AddRange(new int[2] { (Xcoord), Ycoord + 1 }); //Store possible spread directions in a list.

          if (arr[Xcoord, Ycoord - 1, 0] == 0 && distanceCalculate(spaceCoordList, Xcoord, Ycoord - 1, cellSize) < spaceLimit)
            directionList.AddRange(new int[2] { (Xcoord), (Ycoord - 1) }); //Store possible spread directions in a list.

          if (directionList.Count > 0)
          {
            var randomIndex = rand.Next(directionList.Count / 2);
            int a = directionList[2 * randomIndex];
            int b = directionList[2 * randomIndex + 1];

            arr[a, b, 0] = arr[Xcoord, Ycoord, 0];

            spaceCoordList.AddRange(new int[2] { a, b });

            directionList.Clear();
            directionList.TrimExcess();
            draw = true;
            counter++;
          }
          else
          {
            trycount++;
            if (trycount >= spaceCoordList.Count)
            {
              draw = true;
              //Print("trycountNumber is ={0}", trycount);
            }
          }
        }

          /* EDGE CONDITIONS */
          //RIGHT
        else if (Xcoord == (arr.GetLength(0) - 1) && Ycoord != 0 && Ycoord != (arr.GetLength(1) - 1))
        {
          if (arr[Xcoord - 1, Ycoord, 0] == 0 && distanceCalculate(spaceCoordList, Xcoord - 1, Ycoord, cellSize) < spaceLimit )
            directionList.AddRange(new int[2] { (Xcoord - 1), (Ycoord) }); //Store possible spread directions in a list.
          if (arr[Xcoord, Ycoord + 1, 0] == 0 && distanceCalculate(spaceCoordList, Xcoord, Ycoord + 1, cellSize) < spaceLimit )
            directionList.AddRange(new int[2] { (Xcoord ), (Ycoord + 1) }); //Store possible spread directions in a list.
          if (arr[Xcoord, Ycoord - 1, 0] == 0 && distanceCalculate(spaceCoordList, Xcoord, Ycoord - 1, cellSize) < spaceLimit )
            directionList.AddRange(new int[2] { (Xcoord ), (Ycoord - 1) }); //Store possible spread directions in a list.

          if (directionList.Count > 0)
          {
            var randomIndex = rand.Next(directionList.Count / 2);
            int a = directionList[2 * randomIndex];
            int b = directionList[2 * randomIndex + 1];

            arr[a, b, 0] = arr[Xcoord, Ycoord, 0];

            spaceCoordList.AddRange(new int[2] { a, b });

            directionList.Clear();
            directionList.TrimExcess();
            draw = true;
            counter++;
          }
          else
          {
            trycount++;
            if (trycount >= spaceCoordList.Count)
            {
              draw = true;
              //Print("trycountNumber is ={0}", trycount);
            }
          }
        }

          //Left
        else if (Xcoord == 0 && Ycoord != 0 && Ycoord != (arr.GetLength(1) - 1))
        {

          if (arr[Xcoord + 1, Ycoord, 0] == 0 && distanceCalculate(spaceCoordList, Xcoord + 1, Ycoord, cellSize) < spaceLimit )
            directionList.AddRange(new int[2] { (Xcoord + 1), (Ycoord) }); //Store possible spread directions in a list.
          if (arr[Xcoord, Ycoord + 1, 0] == 0 && distanceCalculate(spaceCoordList, Xcoord, Ycoord + 1, cellSize) < spaceLimit )
            directionList.AddRange(new int[2] { (Xcoord ), (Ycoord + 1) }); //Store possible spread directions in a list.
          if (arr[Xcoord, Ycoord - 1, 0] == 0 && distanceCalculate(spaceCoordList, Xcoord, Ycoord - 1, cellSize) < spaceLimit )
            directionList.AddRange(new int[2] { (Xcoord ), (Ycoord - 1) }); //Store possible spread directions in a list.
          if (directionList.Count > 0)
          {
            var randomIndex = rand.Next(directionList.Count / 2);
            int a = directionList[2 * randomIndex];
            int b = directionList[2 * randomIndex + 1];

            arr[a, b, 0] = arr[Xcoord, Ycoord, 0];

            spaceCoordList.AddRange(new int[2] { a, b });

            directionList.Clear();
            directionList.TrimExcess();
            draw = true;
            counter++;
          }
          else
          {
            trycount++;
            if (trycount >= spaceCoordList.Count)
            {
              draw = true;
              //Print("trycountNumber is ={0}", trycount);
            }
          }

        }
          //TOP
        else if ((Ycoord == arr.GetLength(1) - 1) && Xcoord != 0 && Xcoord != (arr.GetLength(0) - 1))
        {

          if (arr[Xcoord, Ycoord - 1, 0] == 0 && distanceCalculate(spaceCoordList, Xcoord, Ycoord - 1, cellSize) < spaceLimit )
            directionList.AddRange(new int[2] { (Xcoord ), (Ycoord - 1) }); //Store possible spread directions in a list.
          if (arr[Xcoord + 1, Ycoord, 0] == 0 && distanceCalculate(spaceCoordList, Xcoord + 1, Ycoord, cellSize) < spaceLimit )
            directionList.AddRange(new int[2] { (Xcoord + 1 ), (Ycoord ) }); //Store possible spread directions in a list.
          if (arr[Xcoord - 1, Ycoord, 0] == 0 && distanceCalculate(spaceCoordList, Xcoord - 1, Ycoord, cellSize) < spaceLimit )
            directionList.AddRange(new int[2] { (Xcoord - 1), (Ycoord ) }); //Store possible spread directions in a list.
          if (directionList.Count > 0)
          {
            var randomIndex = rand.Next(directionList.Count / 2);
            int a = directionList[2 * randomIndex];
            int b = directionList[2 * randomIndex + 1];

            arr[a, b, 0] = arr[Xcoord, Ycoord, 0];

            spaceCoordList.AddRange(new int[2] { a, b });

            directionList.Clear();
            directionList.TrimExcess();
            draw = true;
            counter++;
          }
          else
          {
            trycount++;
            if (trycount >= spaceCoordList.Count)
            {
              draw = true;
              //Print("trycountNumber is ={0}", trycount);
            }
          }
        }
          //BOTTOM
        else if (Ycoord == 0 && Xcoord != 0 && Xcoord != (arr.GetLength(0) - 1))
        {
          if (arr[Xcoord, Ycoord + 1, 0] == 0 && distanceCalculate(spaceCoordList, Xcoord, Ycoord + 1, cellSize) < spaceLimit )
            directionList.AddRange(new int[2] { (Xcoord ), (Ycoord + 1) }); //Store possible spread directions in a list.
          if (arr[Xcoord + 1, Ycoord, 0] == 0 && distanceCalculate(spaceCoordList, Xcoord + 1, Ycoord, cellSize) < spaceLimit )
            directionList.AddRange(new int[2] { (Xcoord + 1 ), (Ycoord ) }); //Store possible spread directions in a list.
          if (arr[Xcoord - 1, Ycoord, 0] == 0 && distanceCalculate(spaceCoordList, Xcoord - 1, Ycoord, cellSize) < spaceLimit )
            directionList.AddRange(new int[2] { (Xcoord - 1), (Ycoord ) }); //Store possible spread directions in a list.
          if (directionList.Count > 0)
          {
            var randomIndex = rand.Next(directionList.Count / 2);
            int a = directionList[2 * randomIndex];
            int b = directionList[2 * randomIndex + 1];

            arr[a, b, 0] = arr[Xcoord, Ycoord, 0];

            spaceCoordList.AddRange(new int[2] { a, b });

            directionList.Clear();
            directionList.TrimExcess();
            draw = true;
            counter++;
          }
          else
          {
            trycount++;
            if (trycount >= spaceCoordList.Count)
            {
              draw = true;
              //Print("trycountNumber is ={0}", trycount);
            }
          }
        }

          //LEFT BOTTOM
        else if (Xcoord == 0 && Ycoord == 0)
        {
          if (arr[Xcoord, Ycoord + 1, 0] == 0 && distanceCalculate(spaceCoordList, Xcoord, Ycoord + 1, cellSize) < spaceLimit)
            directionList.Add(Xcoord); directionList.Add(Ycoord + 1);

          if (arr[Xcoord + 1, Ycoord, 0] == 0 && distanceCalculate(spaceCoordList, Xcoord + 1, Ycoord, cellSize) < spaceLimit)
            directionList.Add(Xcoord + 1); directionList.Add(Ycoord);

          if (directionList.Count > 0)
          {

            var randomIndex = rand.Next(directionList.Count / 2);

            int a = directionList[2 * randomIndex];
            int b = directionList[2 * randomIndex + 1];

            arr[a, b, 0] = arr[Xcoord, Ycoord, 0];

            spaceCoordList.AddRange(new int[2] { a, b });

            directionList.Clear();
            directionList.TrimExcess();
            draw = true;

            counter++;
            //Print(" Counter Number is : {0}", counter);
          }
          else
          {
            trycount++;
            if (trycount >= spaceCoordList.Count)
            {
              draw = true;
              //Print("trycountNumber is ={0}", trycount);
            }
          }
        }
          //LEFT  TOP
          /*
          else if (Xcoord == 0 && Ycoord == (arr.GetLength(1) - 1))
          {
          if (arr[Xcoord + 1, Ycoord] == 0)
          directionList.Add(Xcoord + 1); directionList.Add(Ycoord);

          if (arr[Xcoord, Ycoord - 1] == 0)
          directionList.Add(Xcoord); directionList.Add(Ycoord - 1);

          if (directionList.Count > 0)
          {
          var randomIndex = rand.Next(directionList.Count / 2);

          int a = directionList[2 * randomIndex];
          int b = directionList[2 * randomIndex + 1];

          Rhino.RhinoApp.WriteLine("Left Top "  +  a +  " "  +  b);
          arr[a, b] = arr[Xcoord, Ycoord];

          spaceCoordList.AddRange(new int[2] { a, b });

          directionList.Clear();
          directionList.TrimExcess();
          draw = true;

          counter++;
          //Print(" Counter Number is : {0}", counter);
          }
          else
          {
          trycount++;
          if (trycount >= spaceCoordList.Count)
          {
          draw = true;
          //Print("trycountNumber is ={0}", trycount);
          }
          }
          }
          */
          /*
          //RIGHT TOP
          else if (Xcoord == (arr.GetLength(0) - 1) && Ycoord == (arr.GetLength(1) - 1))
          {
          if (arr[Xcoord, Ycoord - 1] == 0)
          directionList.Add(Xcoord); directionList.Add(Ycoord - 1);

          if (arr[Xcoord - 1, Ycoord] == 0)
          directionList.Add(Xcoord - 1); directionList.Add(Ycoord);

          if (directionList.Count > 0)
          {
          var randomIndex = rand.Next(directionList.Count / 2);

          int a = directionList[2 * randomIndex];
          int b = directionList[2 * randomIndex + 1];
          Rhino.RhinoApp.WriteLine(" Right top "+ a + " " + b);
          arr[a, b] = arr[Xcoord, Ycoord];

          //spaceCoordList.AddRange(new int[2] { a, b });

          directionList.Clear();
          directionList.TrimExcess();
          draw = true;

          counter++;
          //Print(" Counter Number is : {0}", counter);
          }
          else
          {
          trycount++;
          if (trycount >= spaceCoordList.Count)
          {
          draw = true;
          //Print("trycountNumber is ={0}", trycount);
          }
          }
          }
          */
          //RIGHT BOTTOM
        else if (Xcoord == (arr.GetLength(0) - 1) && Ycoord == 0)
        {
          if (arr[Xcoord, Ycoord + 1, 0] == 0)
            directionList.Add(Xcoord); directionList.Add(Ycoord + 1);

          if (arr[Xcoord - 1, Ycoord, 0] == 0)
            directionList.Add(Xcoord - 1); directionList.Add(Ycoord);

          if (directionList.Count > 0)
          {
            var randomIndex = rand.Next(directionList.Count / 2);

            int a = directionList[2 * randomIndex];
            int b = directionList[2 * randomIndex + 1];

            arr[a, b, 0] = arr[Xcoord, Ycoord, 0];

            spaceCoordList.AddRange(new int[2] { a, b });

            directionList.Clear();
            directionList.TrimExcess();

            draw = true;
            counter++;
            //Print(" Counter Number is : {0}", counter);
          }
          else
          {
            trycount++;
            if (trycount >= spaceCoordList.Count)
            {
              draw = true;
              //Print("trycountNumber is ={0}", trycount);
            }
          }
        }
        /* EDGE CONDITIONS */
      }
    }

  }




    /* Instead of wrting methods seperately in main program, it is better to use class based
     informations to keep things organized, we are not yet transsferentrance methods here but we created the str.*/

    /*
    public class Zone
    {
        public string Name;
        public int SpaceLimit;
        public Int16 SpaceSize;
        public int Counter;
        public List<Int16> SpaceList;

        public void Describe()
        {
            Console.WriteLine("Hey this zone is{ 0} ", Name);
        }

        public Zone()
        {
           // SpaceList = new List<int>();
        }

        public Zone(string name, int spaceLimit,int spacesize,int counter, List<int> SpaceList)
        :this()
        {
        }
        static void InitializeZeroMatrice() { }
        static void startZones() { }
        public void SpreadZones() { }

    }
    */
# ---------- end c_script_8 ----------
box_74 = Box(c_script_8.Furnitures)  # disabled
deconstruct_box_33 = DeconstructBox(Box=box_74)  # -> Plane, X, Y, Z; disabled
panel_181 = Panel(deconstruct_box_33.Plane)  # disabled
panel_182 = Panel(deconstruct_box_33.Y)  # disabled
panel_183 = Panel(deconstruct_box_33.X)  # disabled
panel_184 = Panel(deconstruct_box_33.Z)  # disabled
boolean_toggle_4 = BooleanToggle(False)  # disabled
deconstruct_domain_59 = DeconstructDomain(Domain=panel_178)  # -> Start, End; disabled
deconstruct_domain_60 = DeconstructDomain(Domain=panel_180)  # -> Start, End; disabled
deconstruct_domain_61 = DeconstructDomain(Domain=panel_179)  # -> Start, End; disabled
deconstruct_domain_62 = DeconstructDomain(Domain=panel_182)  # -> Start, End; disabled
deconstruct_domain_63 = DeconstructDomain(Domain=panel_183)  # -> Start, End; disabled
box_75 = Box(c_script_8.Bxx)  # disabled
panel_185 = Panel(deconstruct_domain_60.End)  # disabled
panel_186 = Panel(deconstruct_domain_59.End)  # disabled
panel_187 = Panel(deconstruct_domain_61.End)  # disabled
panel_188 = Panel(box_75)  # disabled
panel_189 = Panel(deconstruct_domain_62.End)  # disabled
panel_190 = Panel(deconstruct_domain_63.End)  # disabled
list_item_7 = ListItem(List=c_script_8.Furnitures, Index=number_slider_105, Wrap=boolean_toggle_4)  # disabled
# Spreading
panel_191 = Panel(c_script_8.out)  # disabled
number_slider_106 = Slider(0, range=0..1)  # disabled
number_slider_107 = Slider(0.611, range=0..1)  # disabled
number_slider_108 = Slider(0.544, range=0..1)  # disabled
colour_swatch_25 = ColourSwatch(SwatchColor=RGB(0, 0, 0))  # disabled
colour_swatch_26 = ColourSwatch(SwatchColor=RGB(0, 0, 0))  # disabled
colour_swatch_27 = ColourSwatch(SwatchColor=RGB(255, 255, 0))  # disabled
colour_swatch_28 = ColourSwatch(SwatchColor=RGB(0, 0, 0))  # disabled
colour_swatch_29 = ColourSwatch(SwatchColor=RGB(255, 255, 255))  # disabled
colour_swatch_30 = ColourSwatch(SwatchColor=RGB(240, 240, 200))  # disabled
colour_swatch_31 = ColourSwatch(SwatchColor=RGB(240, 200, 200))  # disabled
colour_swatch_32 = ColourSwatch(SwatchColor=RGB(150, 200, 255))  # disabled

# ---- group: Visualize as 3D Boxes
number_slider_109 = Slider(0.428, range=0..1)  # disabled
create_material_25 = CreateMaterial(Diffuse=colour_swatch_30, Specular=RGB(255, 255, 255), Emission=RGB(0, 0, 0), Transparency=number_slider_109, Shine=0)  # disabled
create_material_26 = CreateMaterial(Diffuse=colour_swatch_27, Specular=RGB(255, 255, 255), Emission=RGB(0, 0, 0), Transparency=number_slider_109, Shine=0)  # disabled
create_material_27 = CreateMaterial(Diffuse=colour_swatch_31, Specular=RGB(255, 255, 255), Emission=RGB(0, 0, 0), Transparency=number_slider_109, Shine=0)  # disabled
create_material_28 = CreateMaterial(Diffuse=colour_swatch_32, Specular=RGB(255, 255, 255), Emission=RGB(0, 0, 0), Transparency=number_slider_109, Shine=0)  # disabled
create_material_29 = CreateMaterial(Diffuse=colour_swatch_28, Specular=RGB(255, 255, 255), Emission=RGB(0, 0, 0), Transparency=number_slider_109, Shine=0)  # disabled
create_material_30 = CreateMaterial(Diffuse=colour_swatch_29, Specular=RGB(255, 255, 255), Emission=RGB(0, 0, 0), Transparency=number_slider_108, Shine=0)  # disabled
custom_preview_25 = CustomPreview(Geometry=c_script_8.EntranceBoxes, Material=create_material_25)  # disabled
custom_preview_26 = CustomPreview(Geometry=c_script_8.CommonBoxes, Material=create_material_27)  # disabled
custom_preview_27 = CustomPreview(Geometry=c_script_8.WetAreaBoxes, Material=create_material_28)  # disabled
custom_preview_28 = CustomPreview(Geometry=c_script_8.K, Material=create_material_29)  # disabled
custom_preview_29 = CustomPreview(Geometry=c_script_8.W, Material=create_material_30)  # disabled
custom_preview_30 = CustomPreview(Geometry=c_script_8.Y, Material=create_material_26)  # disabled

# ----
create_material_31 = CreateMaterial(Diffuse=colour_swatch_25, Specular=RGB(255, 255, 255), Emission=RGB(0, 0, 0), Transparency=number_slider_106, Shine=0)  # disabled
create_material_32 = CreateMaterial(Diffuse=colour_swatch_26, Specular=RGB(255, 255, 255), Emission=RGB(0, 0, 0), Transparency=number_slider_107, Shine=0)  # disabled
custom_preview_31 = CustomPreview(Geometry=c_script_8.Furnitures, Material=create_material_31)  # disabled
custom_preview_32 = CustomPreview(Geometry=c_script_8.FurnituresMargins, Material=create_material_32)  # disabled
list_length_19 = ListLength(List=c_script_8.EntranceBoxes)  # disabled
list_length_20 = ListLength(List=c_script_8.CommonBoxes)  # disabled
list_length_21 = ListLength(List=c_script_8.W)  # disabled
list_length_22 = ListLength(List=c_script_8.WetAreaBoxes)  # disabled
list_length_23 = ListLength(List=c_script_8.Y)  # disabled
list_length_24 = ListLength(List=c_script_8.K)  # disabled
multiplication_44 = Multiplication(A=list_length_20, B=division_13)  # disabled
multiplication_45 = Multiplication(A=list_length_19, B=division_13)  # disabled
multiplication_46 = Multiplication(A=list_length_21, B=division_13)  # disabled
multiplication_47 = Multiplication(A=list_length_22, B=division_13)  # disabled
multiplication_48 = Multiplication(A=list_length_23, B=division_13)  # disabled
multiplication_49 = Multiplication(A=list_length_24, B=division_13)  # disabled
panel_192 = Panel("m2 ")  # disabled
panel_193 = Panel(multiplication_45)  # disabled
panel_194 = Panel(" Entrance = ")  # disabled
panel_195 = Panel(" Empty Space= ")  # disabled
panel_196 = Panel(multiplication_46)  # disabled
panel_197 = Panel("m2 ")  # disabled
panel_198 = Panel("m2 ")  # disabled
panel_199 = Panel(multiplication_44)  # disabled
panel_200 = Panel(" CommonArea = ")  # disabled
panel_201 = Panel("m2 ")  # disabled
panel_202 = Panel(multiplication_47)  # disabled
panel_203 = Panel("Wet Area = ")  # disabled
panel_204 = Panel(multiplication_48)  # disabled
panel_205 = Panel(" Common Area = ")  # disabled
panel_206 = Panel("m2 ")  # disabled
panel_207 = Panel(" Kitchen = ")  # disabled
panel_208 = Panel(" m2 ")  # disabled
panel_209 = Panel(multiplication_49)  # disabled
number_slider_110 = Slider(15, range=0..100)  # disabled
concatenate_22 = Concatenate(Fragment_A=panel_195, Fragment_B=panel_196, Fragment_C=panel_198)  # disabled
concatenate_23 = Concatenate(Fragment_A=panel_194, Fragment_B=panel_193, Fragment_C=panel_192)  # disabled
panel_210 = Panel("0,-50")  # disabled
concatenate_24 = Concatenate(Fragment_A=panel_200, Fragment_B=panel_199, Fragment_C=panel_197)  # disabled
panel_211 = Panel("0,-80")  # disabled
panel_212 = Panel("0,-140")  # disabled
concatenate_25 = Concatenate(Fragment_A=panel_203, Fragment_B=panel_202, Fragment_C=panel_201)  # disabled
concatenate_26 = Concatenate(Fragment_A=panel_207, Fragment_B=panel_204, Fragment_C=panel_206)  # disabled
concatenate_27 = Concatenate(Fragment_A=panel_205, Fragment_B=panel_209, Fragment_C=panel_208)  # disabled
panel_213 = Panel(concatenate_22)  # disabled
panel_214 = Panel(concatenate_23)  # disabled
panel_215 = Panel(concatenate_24)  # disabled
panel_216 = Panel(concatenate_25)  # disabled
panel_217 = Panel(concatenate_26)  # disabled
panel_218 = Panel(concatenate_27)  # disabled
panel_219 = Panel("240,-170")  # disabled
panel_220 = Panel("0,-110")  # disabled
text_tag_3d_22 = TextTag3D(Location=panel_210, Text=concatenate_23, Size=number_slider_110, Colour=colour_swatch_30, Justification=7)  # disabled
text_tag_3d_23 = TextTag3D(Location=panel_211, Text=concatenate_24, Size=number_slider_110, Colour=colour_swatch_31, Justification=7)  # disabled
text_tag_3d_24 = TextTag3D(Location=panel_212, Text=concatenate_26, Size=number_slider_110, Colour=colour_swatch_27, Justification=7)  # disabled
text_tag_3d_25 = TextTag3D(Location=panel_220, Text=concatenate_25, Size=number_slider_110, Colour=colour_swatch_32, Justification=7)  # disabled
text_tag_3d_26 = TextTag3D(Location=panel_212, Text=concatenate_22, Size=number_slider_110, Colour=colour_swatch_29, Justification=7)  # disabled
text_tag_3d_27 = TextTag3D(Location=panel_219, Text=concatenate_27, Size=number_slider_110, Colour=colour_swatch_28, Justification=7)  # disabled
mass_addition_4 = MassAddition(Input=[multiplication_44, multiplication_45, multiplication_47, multiplication_48, multiplication_49, multiplication_46])  # -> flatten(Result), PartialResults; disabled
number_slider_111 = Slider(1, range=0..1)  # disabled
panel_222 = Panel(" Total Area =")  # disabled
panel_223 = Panel("m2 ")  # disabled
list_item_8 = ListItem(List=mass_addition_4.Result, Index=number_slider_111, Wrap=True)  # disabled
panel_224 = Panel(list_item_8)  # disabled
panel_225 = Panel("240,-100")  # disabled
concatenate_28 = Concatenate(Fragment_A=panel_222, Fragment_B=panel_224, Fragment_C=panel_223)  # disabled
panel_226 = Panel(concatenate_28)  # disabled
text_tag_3d_28 = TextTag3D(Location=panel_225, Text=concatenate_28, Size=number_slider_110, Justification=7)  # disabled

# ----
# left
# WET AREA
# right
# front
# front
# front
# front
# front
number_slider_112 = Slider(0, range=0..100)
vector_xyz_10 = VectorXYZ(XComponent=Slider(-100, range=-100..101), YComponent=0, ZComponent=0)  # -> Vector, Length
vector_xyz_11 = VectorXYZ(XComponent=number_slider_112, YComponent=0, ZComponent=0)  # -> Vector, Length
vector_xyz_12 = VectorXYZ(XComponent=Slider(0, range=0..100), YComponent=0, ZComponent=0)  # -> Vector, Length
vector_xyz_13 = VectorXYZ(XComponent=Slider(0, range=-1000..100), YComponent=0, ZComponent=0)  # -> Vector, Length
vector_xyz_14 = VectorXYZ(XComponent=Slider(-199, range=-1000..100), YComponent=0, ZComponent=0)  # -> Vector, Length
toılet = DomainBox(Base=vector_xyz_10.Vector, X=Slider(36, range=0..100), Y=Slider(54, range=0..100), Z=Slider(50, range=0..100))
dressing_cabin = DomainBox(Base=vector_xyz_13.Vector, X=Slider(80, range=0..100), Y=Slider(80, range=0..100), Z=Slider(200, range=0..300))
mirror_cupboard = DomainBox(Base=vector_xyz_11.Vector, X=Slider(60, range=0..100), Y=Slider(15, range=0..100), Z=Slider(60, range=0..300))
shower_cabin = DomainBox(Base=vector_xyz_12.Vector, X=Slider(80, range=0..100), Y=Slider(80, range=0..100), Z=Slider(210, range=0..300))
sink_cupboard = DomainBox(Base=vector_xyz_14.Vector, X=Slider(55, range=0..100), Y=Slider(40, range=0..100), Z=Slider(85, range=0..300))
deconstruct_box_34 = DeconstructBox(Box=toılet)  # -> Plane, X, Y, Z
deconstruct_box_35 = DeconstructBox(Box=mirror_cupboard)  # -> Plane, X, Y, Z
deconstruct_box_36 = DeconstructBox(Box=shower_cabin)  # -> Plane, X, Y, Z
deconstruct_box_37 = DeconstructBox(Box=sink_cupboard)  # -> Plane, X, Y, Z
deconstruct_box_38 = DeconstructBox(Box=dressing_cabin)  # -> Plane, X, Y, Z
deconstruct_domain_64 = DeconstructDomain(Domain=deconstruct_box_34.Y)  # -> Start, End
deconstruct_domain_65 = DeconstructDomain(Domain=deconstruct_box_34.Z)  # -> Start, End
deconstruct_domain_66 = DeconstructDomain(Domain=deconstruct_box_34.X)  # -> Start, End
deconstruct_domain_67 = DeconstructDomain(Domain=deconstruct_box_36.Y)  # -> Start, End
deconstruct_domain_68 = DeconstructDomain(Domain=deconstruct_box_35.Y)  # -> Start, End
deconstruct_domain_69 = DeconstructDomain(Domain=deconstruct_box_38.Y)  # -> Start, End
deconstruct_domain_70 = DeconstructDomain(Domain=deconstruct_box_37.Y)  # -> Start, End
addition_60 = Addition(A=deconstruct_domain_65.End, B=Slider(160, range=0..160))
addition_61 = Addition(A=deconstruct_domain_66.End, B=Slider(30, range=0..100))
addition_62 = Addition(A=deconstruct_domain_68.End, B=Slider(85, range=0..100))
addition_63 = Addition(A=deconstruct_domain_67.End, B=Slider(60, range=0..100))
addition_64 = Addition(A=deconstruct_domain_69.End, B=Slider(60, range=0..100))
addition_65 = Addition(A=deconstruct_domain_70.End, B=Slider(60, range=0..100))
construct_domain_20 = ConstructDomain(DomainStart=deconstruct_domain_65.Start, DomainEnd=addition_60)
construct_domain_21 = ConstructDomain(DomainStart=deconstruct_domain_68.Start, DomainEnd=addition_62)
construct_domain_22 = ConstructDomain(DomainStart=deconstruct_domain_67.Start, DomainEnd=addition_63)
construct_domain_23 = ConstructDomain(DomainStart=deconstruct_domain_69.Start, DomainEnd=addition_64)
construct_domain_24 = ConstructDomain(DomainStart=deconstruct_domain_70.Start, DomainEnd=addition_65)
domain_box_6 = DomainBox(Base=mirror_cupboard, X=deconstruct_box_35.X, Y=construct_domain_21, Z=deconstruct_box_35.Z)
domain_box_7 = DomainBox(Base=shower_cabin, X=deconstruct_box_36.X, Y=construct_domain_22, Z=deconstruct_box_36.Z)
domain_box_8 = DomainBox(Base=dressing_cabin, X=deconstruct_box_38.X, Y=construct_domain_23, Z=deconstruct_box_38.Z)
domain_box_9 = DomainBox(Base=sink_cupboard, X=deconstruct_box_37.X, Y=construct_domain_24, Z=deconstruct_box_37.Z)

addition_66 = Addition(A=deconstruct_domain_64.End, B=Slider(60, range=0..101))
addition_67 = Addition(A=deconstruct_domain_66.Start, B=Slider(-20, range=-20..100))

construct_domain_25 = ConstructDomain(DomainStart=addition_67, DomainEnd=addition_61)
construct_domain_26 = ConstructDomain(DomainStart=deconstruct_domain_64.Start, DomainEnd=addition_66)
domain_box_10 = DomainBox(Base=toılet, X=construct_domain_25, Y=construct_domain_26, Z=construct_domain_20)

box_76 = Box([sink_cupboard, domain_box_9])
box_77 = Box([sink_cupboard, domain_box_9])
box_78 = Box([box_76, box_77])
panel_227 = Panel(box_78)
