# Grasshopper definition CemGrasshopperC#73.gh (Grasshopper 1.0.7)

X = Slider(60, range=45..60)
Y = Slider(60, range=45..60)
Z = Slider(40, range=40..50)

# ----
# Sink
X_2 = Slider(30, range=26..40)  # disabled
# Stove
Y_2 = Slider(58, range=48..58)  # disabled
rectangle = Rectangle(Plane=PlaneXY(1500, 0, 0), XSize=X_2, YSize=Y_2, Radius=0)  # -> Rectangle, Length; disabled
Z_2 = Slider(15, range=15..22)  # disabled
stove = BoxRectangle(Rectangle=rectangle.Rectangle, Height=Z_2)  # disabled

# ----
# Lower Bed
number_slider = Slider(20, range=20..100)
# Counter 2
number_slider_2 = Slider(75, range=75..100)  # disabled

# ----
# Drawer
X_3 = Slider(60, range=60..100)  # disabled
Y_3 = Slider(60, range=50..65)  # disabled
Z_3 = Slider(18, range=18..25)  # disabled
rectangle_2 = Rectangle(Plane=PlaneXY(400, 0, 0), XSize=X_3, YSize=Y_3, Radius=0)  # -> Rectangle, Length; disabled
drawer = BoxRectangle(Rectangle=rectangle_2.Rectangle, Height=Z_3)  # disabled

# ----
# Counter 1
number_slider_3 = Slider(75, range=75..100)
# Table 1
number_slider_4 = Slider(100, range=75..100)
# Sitting Unit
number_slider_5 = Slider(75, range=75..100)

X_4 = Slider(60, range=55..70)  # disabled
# Fridge
Y_4 = Slider(60, range=50..65)  # disabled
rectangle_3 = Rectangle(Plane=PlaneXY(600, 0, 0), XSize=X_4, YSize=Y_4, Radius=0)  # -> Rectangle, Length; disabled
Z_4 = Slider(79, range=72..79)  # disabled
fridge = BoxRectangle(Rectangle=rectangle_3.Rectangle, Height=Z_4)  # disabled

X_5 = Slider(120, range=100..140)  # disabled
Y_5 = Slider(60, range=50..65)  # disabled
Z_5 = Slider(3, range=3..6)  # disabled

X_6 = Slider(60, range=38..60)  # disabled
Y_6 = Slider(44, range=38..50)  # disabled
rectangle_4 = Rectangle(Plane=PlaneXY(1300, 0, 0), XSize=X_6, YSize=Y_6, Radius=0)  # -> Rectangle, Length; disabled
Z_6 = Slider(22, range=13..22)  # disabled
table_2 = BoxRectangle(Rectangle=rectangle_4.Rectangle, Height=Z_6)  # disabled

Z_7 = Slider(3, range=3..6)
Y_7 = Slider(60, range=50..65)
X_7 = Slider(120, range=100..140)

X_8 = Slider(60, range=60..100)  # disabled
# Table 2
Y_8 = Slider(120, range=110..140)  # disabled
rectangle_5 = Rectangle(Plane=PlaneXY(1100, 0, 0), XSize=X_8, YSize=Y_8, Radius=0)  # -> Rectangle, Length; disabled
Z_8 = Slider(6, range=2..6)  # disabled
table_2_2 = BoxRectangle(Rectangle=rectangle_5.Rectangle, Height=Z_8)  # disabled

Z_9 = Slider(20, range=20..40)
X_9 = Slider(210, range=200..220)
Y_9 = Slider(120, range=90..120)

X_10 = Slider(120, range=110..140)
Z_10 = Slider(6, range=2..6)
Y_10 = Slider(60, range=60..100)

construct_point = ConstructPoint(XCoordinate=X_10, YCoordinate=Y_10, ZCoordinate=Z_10)
# Interior Door
vector_xyz = VectorXYZ(XComponent=Slider(0, range=0..1000), YComponent=0, ZComponent=0)  # -> Vector, Length
vector_xyz_2 = VectorXYZ(XComponent=0, YComponent=0, ZComponent=number_slider)  # -> Vector, Length
construct_point_2 = ConstructPoint(XCoordinate=X_7, YCoordinate=Y_7, ZCoordinate=Z_7)  # disabled
vector_xyz_3 = VectorXYZ(XComponent=Slider(0, range=0..1000), YComponent=0, ZComponent=0)  # -> Vector, Length
vector_xyz_4 = VectorXYZ(XComponent=0, YComponent=0, ZComponent=number_slider_2)  # -> Vector, Length; disabled
vector_xyz_5 = VectorXYZ(XComponent=Slider(0, range=0..1000), YComponent=0, ZComponent=0)  # -> Vector, Length
vector_xyz_6 = VectorXYZ(XComponent=Slider(0, range=0..2000), YComponent=0, ZComponent=0)  # -> Vector, Length
vector_xyz_7 = VectorXYZ(XComponent=0, YComponent=0, ZComponent=number_slider_3)  # -> Vector, Length
vector_xyz_8 = VectorXYZ(XComponent=0, YComponent=0, ZComponent=number_slider_5)  # -> Vector, Length
vector_xyz_9 = VectorXYZ(XComponent=0, YComponent=0, ZComponent=number_slider_4)  # -> Vector, Length
counter_1 = DomainBox(Base=vector_xyz_4.Vector, X=X_5, Y=Y_5, Z=Z_5)  # disabled
# Objects in Level 1
counter_1_2 = DomainBox(Base=vector_xyz_7.Vector, X=X_7, Y=Y_7, Z=Z_7)
table_1 = DomainBox(Base=vector_xyz_8.Vector, X=X, Y=Y, Z=Z)
table_1_2 = DomainBox(Base=vector_xyz_9.Vector, X=X_10, Y=Y_10, Z=Z_10)
lower_bed = DomainBox(Base=vector_xyz_2.Vector, X=X_9, Y=Y_9, Z=Z_9)
move = Move(Geometry=construct_point, Motion=vector_xyz_9.Vector)  # -> Geometry, Transform
move_2 = Move(Geometry=construct_point_2, Motion=vector_xyz_7.Vector)  # -> Geometry, Transform; disabled

deconstruct_box = DeconstructBox(Box=counter_1_2)  # -> Plane, X, Y, Z
deconstruct_domain = DeconstructDomain(Domain=deconstruct_box.Y)  # -> Start, End
deconstruct_domain_2 = DeconstructDomain(Domain=deconstruct_box.Z)  # -> Start, End
margin_front = Slider(60, range=60..80)
margin_top = Slider(90, range=70..90)
margin_bottom = Slider(-72, range=-72..-69)
addition = Addition(A=deconstruct_domain.End, B=margin_front)
addition_2 = Addition(A=margin_bottom, B=deconstruct_domain_2.Start)
addition_3 = Addition(A=deconstruct_domain_2.End, B=margin_top)
back_front_margin = ConstructDomain(DomainStart=deconstruct_domain.Start, DomainEnd=addition)
top_bottom_margin = ConstructDomain(DomainStart=addition_2, DomainEnd=addition_3)
counter_1_margin = DomainBox(Base=deconstruct_box.Plane, LEFTRIGHT=deconstruct_box.X, BACKFRONT=back_front_margin, TOPBOTTOM=top_bottom_margin)

interior_door = DomainBox(Base=vector_xyz.Vector, X=Slider(100, range=90..100), Y=Slider(5, range=5..15), Z=Slider(200, range=150..220))

deconstruct_box_2 = DeconstructBox(Box=drawer)  # -> Plane, X, Y, Z; disabled
margin_front_2 = Slider(60, range=60..80)  # disabled
margin_right = Slider(60, range=0..80)  # disabled
margin_left = Slider(-60, range=-80..0)  # disabled
deconstruct_domain_3 = DeconstructDomain(Domain=deconstruct_box_2.X)  # -> Start, End; disabled
deconstruct_domain_4 = DeconstructDomain(Domain=deconstruct_box_2.Y)  # -> Start, End; disabled
addition_4 = Addition(A=margin_left, B=deconstruct_domain_3.Start)  # disabled
addition_5 = Addition(A=deconstruct_domain_3.End, B=margin_right)  # disabled
addition_6 = Addition(A=deconstruct_domain_4.End, B=margin_front_2)  # disabled
left_right_margin = ConstructDomain(DomainStart=addition_4, DomainEnd=addition_5)  # disabled
back_front_margin_2 = ConstructDomain(DomainStart=deconstruct_domain_4.Start, DomainEnd=addition_6)  # disabled
drawer_margin = DomainBox(Base=deconstruct_box_2.Plane, LEFTRIGHT=left_right_margin, BACKFRONT=back_front_margin_2, TOPBOTTOM=deconstruct_box_2.Z)  # disabled

deconstruct_box_3 = DeconstructBox(Box=counter_1)  # -> Plane, X, Y, Z; disabled
deconstruct_domain_5 = DeconstructDomain(Domain=deconstruct_box_3.Z)  # -> Start, End; disabled
deconstruct_domain_6 = DeconstructDomain(Domain=deconstruct_box_3.Y)  # -> Start, End; disabled
margin_back = Slider(-60, range=-80..-60)  # disabled
margin_front_3 = Slider(60, range=60..80)  # disabled
margin_bottom_2 = Slider(-72, range=-72..-69)  # disabled
margin_top_2 = Slider(90, range=70..90)  # disabled
addition_7 = Addition(A=margin_back, B=deconstruct_domain_6.Start)  # disabled
addition_8 = Addition(A=margin_bottom_2, B=deconstruct_domain_5.Start)  # disabled
addition_9 = Addition(A=deconstruct_domain_5.End, B=margin_top_2)  # disabled
addition_10 = Addition(A=deconstruct_domain_6.End, B=margin_front_3)  # disabled
top_bottom_margin_2 = ConstructDomain(DomainStart=addition_8, DomainEnd=addition_9)  # disabled
back_front_margin_3 = ConstructDomain(DomainStart=addition_7, DomainEnd=addition_10)  # disabled
counter_2_margin = DomainBox(
    Base=deconstruct_box_3.Plane,
    LEFTRIGHT=deconstruct_box_3.X,
    BACKFRONT=back_front_margin_3,
    TOPBOTTOM=top_bottom_margin_2)  # disabled

deconstruct_box_4 = DeconstructBox(Box=fridge)  # -> Plane, X, Y, Z; disabled
deconstruct_domain_7 = DeconstructDomain(Domain=deconstruct_box_4.Y)  # -> Start, End; disabled
addition_11 = Addition(A=deconstruct_domain_7.End, B=X_4)  # disabled
back_front_margin_4 = ConstructDomain(DomainStart=deconstruct_domain_7.Start, DomainEnd=addition_11)  # disabled
fridge_margin = DomainBox(
    Base=deconstruct_box_4.Plane,
    LEFTRIGHT=deconstruct_box_4.X,
    BACKFRONT=back_front_margin_4,
    TOPBOTTOM=deconstruct_box_4.Z)  # disabled

deconstruct_box_5 = DeconstructBox(Box=lower_bed)  # -> Plane, X, Y, Z
margin_top_3 = Slider(90, range=70..90)
margin_bottom_3 = Slider(-40, range=-50..-40)
margin_front_4 = Slider(60, range=60..80)
deconstruct_domain_8 = DeconstructDomain(Domain=deconstruct_box_5.Z)  # -> Start, End
deconstruct_domain_9 = DeconstructDomain(Domain=deconstruct_box_5.Y)  # -> Start, End
addition_12 = Addition(A=margin_bottom_3, B=deconstruct_domain_8.Start)
addition_13 = Addition(A=deconstruct_domain_8.End, B=margin_top_3)
addition_14 = Addition(A=deconstruct_domain_9.End, B=margin_front_4)
back_front_margin_5 = ConstructDomain(DomainStart=deconstruct_domain_9.Start, DomainEnd=addition_14)
top_bottom_margin_3 = ConstructDomain(DomainStart=addition_12, DomainEnd=addition_13)
lower_bed_margin = DomainBox(
    Base=deconstruct_box_5.Plane,
    LEFTRIGHT=deconstruct_box_5.X,
    BACKFRONT=back_front_margin_5,
    TOPBOTTOM=top_bottom_margin_3)

deconstruct_box_6 = DeconstructBox(Box=table_1_2)  # -> Plane, X, Y, Z
margin_top_4 = Slider(135, range=130..135)
margin_right_2 = Slider(-60, range=-80..-50)
margin_top_5 = Slider(-78, range=-78..-66)
margin_left_2 = Slider(60, range=50..80)
deconstruct_domain_10 = DeconstructDomain(Domain=deconstruct_box_6.Z)  # -> Start, End
deconstruct_domain_11 = DeconstructDomain(Domain=deconstruct_box_6.X)  # -> Start, End
deconstruct_domain_12 = DeconstructDomain(Domain=deconstruct_box_6.Y)  # -> Start, End
margin_front_5 = Slider(60, range=50..80)
addition_15 = Addition(A=margin_right_2, B=deconstruct_domain_11.Start)
addition_16 = Addition(A=deconstruct_domain_10.End, B=margin_top_4)
addition_17 = Addition(A=deconstruct_domain_12.End, B=margin_front_5)
addition_18 = Addition(A=deconstruct_domain_11.End, B=margin_left_2)
addition_19 = Addition(A=margin_top_5, B=deconstruct_domain_10.Start)
back_front_margin_6 = ConstructDomain(DomainStart=deconstruct_domain_12.Start, DomainEnd=addition_17)
top_bottom_margin_4 = ConstructDomain(DomainStart=addition_19, DomainEnd=addition_16)
left_right_margin_2 = ConstructDomain(DomainStart=addition_15, DomainEnd=addition_18)
table_1_margin = DomainBox(
    Base=deconstruct_box_6.Plane,
    LEFTRIGHT=left_right_margin_2,
    BACKFRONT=back_front_margin_6,
    TOPBOTTOM=top_bottom_margin_4)

exterior_door = DomainBox(Base=vector_xyz_3.Vector, X=Slider(100, range=90..100), Y=Slider(10, range=5..15), Z=Slider(200, range=150..220))
closet = DomainBox(Base=vector_xyz_6.Vector, X=Slider(230, range=110..230), Y=Slider(60, range=55..65), Z=Slider(210, range=2..220))
changeover_zone = DomainBox(Base=vector_xyz_5.Vector, X=Slider(60, range=50..65), Y=Slider(40, range=35..45), Z=Slider(2, range=2..220))

deconstruct_box_7 = DeconstructBox(Box=table_2_2)  # -> Plane, X, Y, Z; disabled
margin_top_6 = Slider(135, range=130..135)  # disabled
margin_top_7 = Slider(-78, range=-78..-66)  # disabled
margin_right_3 = Slider(-60, range=-80..-50)  # disabled
margin_front_6 = Slider(60, range=50..80)  # disabled
margin_left_3 = Slider(60, range=50..80)  # disabled
deconstruct_domain_13 = DeconstructDomain(Domain=deconstruct_box_7.Z)  # -> Start, End; disabled
deconstruct_domain_14 = DeconstructDomain(Domain=deconstruct_box_7.X)  # -> Start, End; disabled
deconstruct_domain_15 = DeconstructDomain(Domain=deconstruct_box_7.Y)  # -> Start, End; disabled
addition_20 = Addition(A=margin_right_3, B=deconstruct_domain_14.Start)  # disabled
addition_21 = Addition(A=deconstruct_domain_13.End, B=margin_top_6)  # disabled
addition_22 = Addition(A=deconstruct_domain_15.End, B=margin_front_6)  # disabled
addition_23 = Addition(A=deconstruct_domain_14.End, B=margin_left_3)  # disabled
addition_24 = Addition(A=margin_top_7, B=deconstruct_domain_13.Start)  # disabled
back_front_margin_7 = ConstructDomain(DomainStart=deconstruct_domain_15.Start, DomainEnd=addition_22)  # disabled
top_bottom_margin_5 = ConstructDomain(DomainStart=addition_24, DomainEnd=addition_21)  # disabled
left_right_margin_3 = ConstructDomain(DomainStart=addition_20, DomainEnd=addition_23)  # disabled
table_2_margin = DomainBox(
    Base=deconstruct_box_7.Plane,
    LEFTRIGHT=left_right_margin_3,
    BACKFRONT=back_front_margin_7,
    TOPBOTTOM=top_bottom_margin_5)  # disabled

deconstruct_box_8 = DeconstructBox(Box=stove)  # -> Plane, X, Y, Z; disabled
margin_top_8 = Slider(90, range=70..90)  # disabled
deconstruct_domain_16 = DeconstructDomain(Domain=deconstruct_box_8.Z)  # -> Start, End; disabled
deconstruct_domain_17 = DeconstructDomain(Domain=deconstruct_box_8.Y)  # -> Start, End; disabled
margin_front_7 = Slider(60, range=60..80)  # disabled
addition_25 = Addition(A=deconstruct_domain_16.End, B=margin_top_8)  # disabled
addition_26 = Addition(A=deconstruct_domain_17.End, B=margin_front_7)  # disabled
back_front_margin_8 = ConstructDomain(DomainStart=deconstruct_domain_17.Start, DomainEnd=addition_26)  # disabled
top_bottom_margin_6 = ConstructDomain(DomainStart=deconstruct_domain_16.Start, DomainEnd=addition_25)  # disabled
stove_margin = DomainBox(
    Base=deconstruct_box_8.Plane,
    LEFTRIGHT=deconstruct_box_8.X,
    BACKFRONT=back_front_margin_8,
    TOPBOTTOM=top_bottom_margin_6)  # disabled

deconstruct_box_9 = DeconstructBox(Box=table_1)  # -> Plane, X, Y, Z
margin_right_4 = Slider(-60, range=-60..-45)
margin_left_4 = Slider(60, range=45..60)
margin_top_9 = Slider(160, range=150..160)
deconstruct_domain_18 = DeconstructDomain(Domain=deconstruct_box_9.X)  # -> Start, End
deconstruct_domain_19 = DeconstructDomain(Domain=deconstruct_box_9.Z)  # -> Start, End
deconstruct_domain_20 = DeconstructDomain(Domain=deconstruct_box_9.Y)  # -> Start, End
addition_27 = Addition(A=deconstruct_domain_19.End, B=margin_top_9)
addition_28 = Addition(A=deconstruct_domain_20.End, B="5")
addition_29 = Addition(A=margin_right_4, B=deconstruct_domain_18.Start)
addition_30 = Addition(A=deconstruct_domain_18.End, B=margin_left_4)
left_right_margin_4 = ConstructDomain(DomainStart=addition_29, DomainEnd=addition_30)
back_front_margin_9 = ConstructDomain(DomainStart=deconstruct_domain_20.Start, DomainEnd=addition_28)
top_bottom_margin_7 = ConstructDomain(DomainStart=deconstruct_domain_19.Start, DomainEnd=addition_27)
sitting_unit_margin = DomainBox(
    Base=deconstruct_box_9.Plane,
    LEFTRIGHT=left_right_margin_4,
    BACKFRONT=back_front_margin_9,
    TOPBOTTOM=top_bottom_margin_7)

deconstruct_box_10 = DeconstructBox(Box=table_2)  # -> Plane, X, Y, Z; disabled
margin_top_10 = Slider(90, range=70..90)  # disabled
margin_front_8 = Slider(60, range=60..80)  # disabled
deconstruct_domain_21 = DeconstructDomain(Domain=deconstruct_box_10.Z)  # -> Start, End; disabled
deconstruct_domain_22 = DeconstructDomain(Domain=deconstruct_box_10.Y)  # -> Start, End; disabled
addition_31 = Addition(A=deconstruct_domain_22.End, B=margin_front_8)  # disabled
addition_32 = Addition(A=deconstruct_domain_21.End, B=margin_top_10)  # disabled
back_front_margin_10 = ConstructDomain(DomainStart=deconstruct_domain_22.Start, DomainEnd=addition_31)  # disabled
top_bottom_margin_8 = ConstructDomain(DomainStart=deconstruct_domain_21.Start, DomainEnd=addition_32)  # disabled
table_2_margin_2 = DomainBox(
    Base=deconstruct_box_10.Plane,
    LEFTRIGHT=deconstruct_box_10.X,
    BACKFRONT=back_front_margin_10,
    TOPBOTTOM=top_bottom_margin_8)  # disabled

deconstruct_box_11 = DeconstructBox(Box=interior_door)  # -> Plane, X, Y, Z
deconstruct_box_12 = DeconstructBox(Box=exterior_door)  # -> Plane, X, Y, Z
deconstruct_box_13 = DeconstructBox(Box=changeover_zone)  # -> Plane, X, Y, Z
deconstruct_box_14 = DeconstructBox(Box=closet)  # -> Plane, X, Y, Z
panel = Panel(deconstruct_box_11.X)
deconstruct_domain_23 = DeconstructDomain(Domain=deconstruct_box_11.Y)  # -> Start, End
panel_2 = Panel(deconstruct_box_12.X)
deconstruct_domain_24 = DeconstructDomain(Domain=deconstruct_box_12.Y)  # -> Start, End
panel_3 = Panel(deconstruct_box_13.X)
deconstruct_domain_25 = DeconstructDomain(Domain=deconstruct_box_13.Y)  # -> Start, End
deconstruct_domain_26 = DeconstructDomain(Domain=deconstruct_box_13.Z)  # -> Start, End
panel_4 = Panel(deconstruct_box_14.X)
deconstruct_domain_27 = DeconstructDomain(Domain=deconstruct_box_14.Y)  # -> Start, End
addition_33 = Addition(A=deconstruct_domain_23.End, B=Slider(80, range=0..500))
addition_34 = Addition(A=deconstruct_domain_24.End, B=Slider(100, range=0..500))
addition_35 = Addition(A=deconstruct_domain_25.End, B=Slider(60, range=0..60))
addition_36 = Addition(A=deconstruct_domain_26.End, B=Slider(210, range=0..210))
addition_37 = Addition(A=deconstruct_domain_23.Start, B=Slider(-80, range=-80..500))
# Margin :  Front 80
construct_domain = ConstructDomain(DomainStart=addition_37, DomainEnd=addition_33)
addition_38 = Addition(A=deconstruct_domain_27.End, B=Slider(65, range=0..500))
# Margin :  Front 100
construct_domain_2 = ConstructDomain(DomainStart=deconstruct_domain_24.Start, DomainEnd=addition_34)
construct_domain_3 = ConstructDomain(DomainStart=deconstruct_domain_25.Start, DomainEnd=addition_35)
# Margin :  Front 60
# Margin :  Top 210
construct_domain_4 = ConstructDomain(DomainStart=deconstruct_domain_26.Start, DomainEnd=addition_36)
# Margin : 65
construct_domain_5 = ConstructDomain(DomainStart=deconstruct_domain_27.Start, DomainEnd=addition_38)
panel_5 = Panel(construct_domain)
interor_door_margin = DomainBox(Base=interior_door, X=deconstruct_box_11.X, Y=construct_domain, Z=deconstruct_box_11.Z)
panel_6 = Panel(construct_domain_2)
change_over_zone_margin = DomainBox(Base=changeover_zone, X=deconstruct_box_13.X, Y=construct_domain_3, Z=construct_domain_4)
exterior_door_margin = DomainBox(Base=exterior_door, X=deconstruct_box_12.X, Y=construct_domain_2, Z=deconstruct_box_12.Z)
panel_7 = Panel(construct_domain_5)
panel_8 = Panel(construct_domain_4)
closet_margin = DomainBox(Base=closet, X=deconstruct_box_14.X, Y=construct_domain_5, Z=deconstruct_box_14.Z)
panel_9 = Panel(construct_domain_3)

# ----
# Upper Bed
X_11 = Slider(60, range=33..60)  # disabled
# Microwave Oven
Y_11 = Slider(58, range=30..58)  # disabled
rectangle_6 = Rectangle(Plane=PlaneXY(1700, 0, 0), XSize=X_11, YSize=Y_11, Radius=0)  # -> Rectangle, Length; disabled
Z_11 = Slider(25, range=25..41)  # disabled
microwave_oven = BoxRectangle(Rectangle=rectangle_6.Rectangle, Height=Z_11)  # disabled

X_12 = Slider(60, range=30..60)  # disabled
# Cupboard
Y_12 = Slider(45, range=30..45)  # disabled
rectangle_7 = Rectangle(Plane=PlaneXY(1900, 0, 0), XSize=X_12, YSize=Y_12, Radius=0)  # -> Rectangle, Length; disabled
Z_12 = Slider(30, range=30..50)  # disabled
# Objects in Level  2
cupboard = BoxRectangle(Rectangle=rectangle_7.Rectangle, Height=Z_12)  # disabled

X_13 = Slider(210, range=200..220)  # disabled
Y_13 = Slider(120, range=90..120)  # disabled
rectangle_8 = Rectangle(Plane=PlaneXY(2700, 0, 0), XSize=X_13, YSize=Y_13, Radius=0)  # -> Rectangle, Length; disabled
Z_13 = Slider(20, range=20..40)  # disabled
upper_bed = BoxRectangle(Rectangle=rectangle_8.Rectangle, Height=Z_13)  # disabled

# ----
# First Aid
number_slider_6 = Slider(200, range=75..200)

Y_14 = Slider(3, range=3..8)  # disabled
X_14 = Slider(60, range=43..82)  # disabled
# Monitor
division = Division(A=9, B=16)  # disabled
rectangle_9 = Rectangle(Plane=PlaneXY(2300, 0, 0), XSize=X_14, YSize=Y_14, Radius=0)  # -> Rectangle, Length; disabled
multiplication = Multiplication(A=X_14, B=division)  # disabled
monitor = BoxRectangle(Rectangle=rectangle_9.Rectangle, Height=multiplication)  # disabled

X_15 = Slider(60, range=30..60)
Y_15 = Slider(20, range=13..20)
Z_14 = Slider(60, range=30..60)

create_material = CreateMaterial(
    Diffuse=ColourSwatch(SwatchColor=RGB(120, 116, 107)),
    Specular=RGB(255, 255, 255),
    Emission=RGB(0, 0, 0),
    Transparency=Slider(0.8, range=0..1),
    Shine=0)
# Entrance
create_material_2 = CreateMaterial(
    Diffuse=ColourSwatch(SwatchColor=RGB(120, 116, 107)),
    Specular=RGB(255, 255, 255),
    Emission=RGB(0, 0, 0),
    Transparency=Slider(0.33, range=0..1),
    Shine=0)
vector_xyz_10 = VectorXYZ(XComponent=0, YComponent=0, ZComponent=number_slider_6)  # -> Vector, Length
firstaid = DomainBox(Base=vector_xyz_10.Vector, X=X_15, Y=Y_15, Z=Z_14)
create_material_3 = CreateMaterial(
    Diffuse=ColourSwatch(SwatchColor=RGB(120, 116, 107)),
    Specular=RGB(255, 255, 255),
    Emission=RGB(0, 0, 0),
    Transparency=Slider(0.8, range=0..1),
    Shine=0)
# Wet Area
create_material_4 = CreateMaterial(
    Diffuse=ColourSwatch(SwatchColor=RGB(120, 116, 107)),
    Specular=RGB(255, 255, 255),
    Emission=RGB(0, 0, 0),
    Transparency=Slider(0.33, range=0..1),
    Shine=0)
box = Box([interior_door, exterior_door, changeover_zone, closet])
box_2 = Box([interor_door_margin, exterior_door_margin, change_over_zone_margin, closet_margin])
custom_preview = CustomPreview(Geometry=box, Material=create_material_2)  # disabled
custom_preview_2 = CustomPreview(Geometry=box_2, Material=create_material)  # disabled

deconstruct_box_15 = DeconstructBox(Box=upper_bed)  # -> Plane, X, Y, Z; disabled
deconstruct_domain_28 = DeconstructDomain(Domain=deconstruct_box_15.Y)  # -> Start, End; disabled
margin_front_9 = Slider(60, range=60..80)  # disabled
deconstruct_domain_29 = DeconstructDomain(Domain=deconstruct_box_15.Z)  # -> Start, End; disabled
margin_top_11 = Slider(90, range=70..90)  # disabled
addition_39 = Addition(A=deconstruct_domain_28.End, B=margin_front_9)  # disabled
addition_40 = Addition(A=deconstruct_domain_29.End, B=margin_top_11)  # disabled
back_front_margin_11 = ConstructDomain(DomainStart=deconstruct_domain_28.Start, DomainEnd=addition_39)  # disabled
top_bottom_margin_9 = ConstructDomain(DomainStart=deconstruct_domain_29.Start, DomainEnd=addition_40)  # disabled
upper_bed_margin = DomainBox(
    Base=deconstruct_box_15.Plane,
    LEFTRIGHT=deconstruct_box_15.X,
    BACKFRONT=back_front_margin_11,
    TOPBOTTOM=top_bottom_margin_9)  # disabled

deconstruct_box_16 = DeconstructBox(Box=microwave_oven)  # -> Plane, X, Y, Z; disabled
margin_front_10 = Slider(60, range=60..80)  # disabled
deconstruct_domain_30 = DeconstructDomain(Domain=deconstruct_box_16.Y)  # -> Start, End; disabled
addition_41 = Addition(A=deconstruct_domain_30.End, B=margin_front_10)  # disabled
back_front_margin_12 = ConstructDomain(DomainStart=deconstruct_domain_30.Start, DomainEnd=addition_41)  # disabled
microwave_oven_margin = DomainBox(Base=deconstruct_box_16.Plane, LEFTRIGHT=deconstruct_box_16.X, BACKFRONT=back_front_margin_12, TOPBOTTOM=Domain(0, 0.25))  # disabled

deconstruct_box_17 = DeconstructBox(Box=firstaid)  # -> Plane, X, Y, Z
deconstruct_domain_31 = DeconstructDomain(Domain=deconstruct_box_17.Y)  # -> Start, End
addition_42 = Addition(A=deconstruct_domain_31.End, B="30")
back_front_margin_13 = ConstructDomain(DomainStart=deconstruct_domain_31.Start, DomainEnd=addition_42)
first_aid_margin = DomainBox(
    Base=deconstruct_box_17.Plane,
    LEFTRIGHT=deconstruct_box_17.X,
    BACKFRONT=back_front_margin_13,
    TOPBOTTOM=deconstruct_box_17.Z)

deconstruct_box_18 = DeconstructBox(Box=monitor)  # -> Plane, X, Y, Z; disabled
margin_front_11 = Slider(150, range=50..150)  # disabled
deconstruct_domain_32 = DeconstructDomain(Domain=deconstruct_box_18.Y)  # -> Start, End; disabled
addition_43 = Addition(A=deconstruct_domain_32.End, B=margin_front_11)  # disabled
back_front_margin_14 = ConstructDomain(DomainStart=deconstruct_domain_32.Start, DomainEnd=addition_43)  # disabled
monitor_margin = DomainBox(
    Base=deconstruct_box_18.Plane,
    LEFTRIGHT=deconstruct_box_18.X,
    BACKFRONT=back_front_margin_14,
    TOPBOTTOM=deconstruct_box_18.Z)  # disabled

deconstruct_box_19 = DeconstructBox(Box=cupboard)  # -> Plane, X, Y, Z; disabled
margin_front_12 = Slider(60, range=60..80)  # disabled
deconstruct_domain_33 = DeconstructDomain(Domain=deconstruct_box_19.Y)  # -> Start, End; disabled
addition_44 = Addition(A=deconstruct_domain_33.End, B=margin_front_12)  # disabled
back_front_margin_15 = ConstructDomain(DomainStart=deconstruct_domain_33.Start, DomainEnd=addition_44)  # disabled
cupboard_margin = DomainBox(
    Base=deconstruct_box_19.Plane,
    LEFTRIGHT=deconstruct_box_19.X,
    BACKFRONT=back_front_margin_15,
    TOPBOTTOM=deconstruct_box_19.Z)  # disabled

create_material_5 = CreateMaterial(
    Diffuse=ColourSwatch(SwatchColor=RGB(120, 116, 107)),
    Specular=RGB(255, 255, 255),
    Emission=RGB(0, 0, 0),
    Transparency=Slider(0.8, range=0..1),
    Shine=0)
# Common Area
create_material_6 = CreateMaterial(
    Diffuse=ColourSwatch(SwatchColor=RGB(120, 116, 107)),
    Specular=RGB(255, 255, 255),
    Emission=RGB(0, 0, 0),
    Transparency=Slider(0.33, range=0..1),
    Shine=0)
box_3 = Box([counter_1_2, table_1_2, table_1, lower_bed])
box_4 = Box([counter_1_margin, table_1_margin, sitting_unit_margin, lower_bed_margin])
custom_preview_3 = CustomPreview(Geometry=box_3, Material=create_material_6)  # disabled
custom_preview_4 = CustomPreview(Geometry=box_4, Material=create_material_5)  # disabled
number_slider_7 = Slider(10, range=0..10)
number_slider_8 = Slider(10, range=0..10)  # disabled
number_slider_9 = Slider(30, range=0..100)  # disabled
number_slider_10 = Slider(60, range=20..60)  # disabled
number_slider_11 = Slider(6, range=2..10)  # disabled
number_slider_12 = Slider(36, range=20..60)  # disabled
multiplication_2 = Multiplication(A=Slider(30, range=0..100), B=number_slider_7)
multiplication_3 = Multiplication(A=Slider(60, range=20..60), B=number_slider_7)
multiplication_4 = Multiplication(A=Slider(6, range=2..10), B=number_slider_7)
multiplication_5 = Multiplication(A=Slider(36, range=20..60), B=number_slider_7)
multiplication_6 = Multiplication(A=number_slider_9, B=number_slider_8)  # disabled
panel_10 = Panel(multiplication_2)
panel_11 = Panel(multiplication_5)
number_slider_13 = Slider(2, range=0..10)  # disabled
panel_12 = Panel(multiplication_3)
multiplication_7 = Multiplication(A=multiplication_4, B=multiplication_4)
multiplication_8 = Multiplication(A=number_slider_10, B=number_slider_8)  # disabled
multiplication_9 = Multiplication(A=number_slider_11, B=number_slider_8)  # disabled
multiplication_10 = Multiplication(A=number_slider_12, B=number_slider_8)  # disabled
number_slider_14 = Slider(10000, range=0..10000)  # disabled
round = Round()  # -> Nearest, Floor, Ceiling; disabled
division_2 = Division(A=multiplication_3, B=multiplication_4)
panel_13 = Panel(multiplication_4)
division_3 = Division(A=multiplication_5, B=multiplication_4)
panel_14 = Panel(multiplication_6)  # disabled
panel_15 = Panel(multiplication_10)  # disabled
panel_16 = Panel(multiplication_8)  # disabled
multiplication_11 = Multiplication(A=multiplication_9, B=multiplication_9)  # disabled
multiplication_12 = Multiplication(A=Slider(10000, range=0..10000), B=Slider(2, range=0..10))
division_4 = Division(A=multiplication_7, B=multiplication_12)
panel_17 = Panel(division_3)
number_slider_15 = Slider(100, range=0..100)  # disabled
division_5 = Division(A=multiplication_8, B=multiplication_9)  # disabled
panel_18 = Panel(multiplication_9)  # disabled
division_6 = Division(A=multiplication_10, B=multiplication_9)  # disabled
number_slider_16 = Slider(150, range=0..1000)  # disabled
integer = Integer(division_3)
integer_2 = Integer(division_2)
integer_3 = Integer(panel_10)
box_5 = Box(closet_margin)
box_6 = Box(changeover_zone)
box_7 = Box(closet)
box_8 = Box(interior_door)
box_9 = Box(interor_door_margin)
box_10 = Box(exterior_door)
c_script = CSharpScript(boxx=box_10)  # -> out, lenght; inputs boxx: Box
# ---------- c_script: C# ----------
    lenght = boxx.X.T1;
        //lenght = 5;
# ---------- end c_script ----------
panel_19 = Panel(c_script.lenght)
box_11 = Box(exterior_door_margin)
box_12 = Box(counter_1_2)
box_13 = Box(counter_1_margin)
box_14 = Box(change_over_zone_margin)
box_15 = Box(table_1_2)
box_16 = Box(table_1_margin)
multiplication_13 = Multiplication(A=number_slider_14, B=number_slider_13)  # disabled
box_17 = Box(lower_bed_margin)
box_18 = Box(table_1)
box_19 = Box(firstaid)
box_20 = Box(first_aid_margin)
box_21 = Box(sitting_unit_margin)
box_22 = Box(lower_bed)
division_7 = Division(A=multiplication_11, B=multiplication_13)  # disabled
panel_20 = Panel(division_6)  # disabled
integer_4 = Integer(division_6)  # disabled
integer_5 = Integer(division_5)  # disabled
integer_6 = Integer(panel_14)  # disabled
box_23 = Box(closet_margin)  # disabled
box_24 = Box(closet)  # disabled
box_25 = Box(exterior_door)  # disabled
c_script_2 = CSharpScript(boxx=box_25)  # -> out, lenght; inputs boxx: Box; disabled; same code as c_script
panel_21 = Panel(c_script_2.lenght)  # disabled
deconstruct_box_20 = DeconstructBox(Box=box_25)  # -> Plane, X, Y, Z; disabled
panel_22 = Panel(deconstruct_box_20.Plane)  # disabled
panel_23 = Panel(deconstruct_box_20.Y)  # disabled
panel_24 = Panel(deconstruct_box_20.Z)  # disabled
panel_25 = Panel(deconstruct_box_20.X)  # disabled
box_26 = Box(changeover_zone)  # disabled
box_27 = Box(exterior_door_margin)  # disabled
box_28 = Box(change_over_zone_margin)  # disabled
box_29 = Box()  # disabled
box_30 = Box()  # disabled
box_31 = Box()  # disabled
box_32 = Box()  # disabled
box_33 = Box()  # disabled
box_34 = Box()  # disabled
box_35 = Box()  # disabled
box_36 = Box()  # disabled
box_37 = Box()  # disabled
box_38 = Box()  # disabled
number_slider_17 = Slider(8, range=0..10)  # disabled
c_script_3 = CSharpScript(
    Width=integer_5,
    Length=integer_4,
    Height=integer_6,
    LevelHeight=number_slider_16,
    cellSize=multiplication_9,
    ExteriorDoor=box_25,
    ExteriorDoorMargin=box_27,
    ChangeOverZone=box_26,
    ChangeOverZoneMargin=box_28,
    Closet=box_24,
    ClosetMargin=box_23,
    InteriorDoor=box_29,
    InteriorDoorMargin=box_30,
    Counter=box_31,
    CounterMargin=box_32,
    Table=box_33,
    TableMargin=box_34,
    SittingUnit=box_36,
    SittingUnitMargin=box_37,
    HealtCare=box_35,
    HealthCareMargin=box_38)  # -> out, A, EntranceBoxes, CommonBoxes, WetAreaBoxes, Y, K, W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; inputs Width: Int32, Length: Int32, Height: Int32, LevelHeight: Int32, cellSize: Int32, ExteriorDoor: Box, ExteriorDoorMargin: Box, ChangeOverZone: Box, ChangeOverZoneMargin: Box, Closet: Box, ClosetMargin: Box, InteriorDoor: Box, InteriorDoorMargin: Box, Counter: Box, CounterMargin: Box, Table: Box, TableMargin: Box, SittingUnit: Box, SittingUnitMargin: Box, Bed: Box, BedMargin: Box, HealtCare: Box, HealthCareMargin: Box; disabled
# ---------- c_script_3: C# usings ----------
using System.Linq;
# ---------- c_script_3: C# ----------
      
    List<Box> entranceBoxes = new List<Box>(); 
    List<Box> commonBoxes = new List<Box>();
    List<Box> wetAreaBoxes = new List<Box>();

    /*List<Box> kitchenBoxes = new List<Box>();
      List<Box> commonAreaBoxes = new List<Box>();*/

    List<Box> WhiteBoxes = new List<Box>();

    /**  These sizes are Spreading Limits for the spaces   //total cells     **/

    double entranceSize = (6 * 100 * 100) / (cellSize * cellSize);
    double commonSize = (8 * 100 * 100) / (cellSize * cellSize);
    double wetAreaSize = (6 * 100 * 100 ) / (cellSize * cellSize);

    /*
    double kitchenSize = 7 * 100 * 100 / cellSize * cell  Size;
    double commonAreaSize = 10 * 100 * 100 / cellSize * cellSize;
    */

    Point3d pA = new Point3d(0, 0, 0);
    Point3d pB = new Point3d(10, 0, 0);
    Point3d pC = new Point3d(0, 10, 0);

    Plane p = new Plane(pA, pB, pC);

    int width = Width;
    int length = Length;
    int levelHeight = LevelHeight;
    int height = Height;
    int levelNumber = Height / LevelHeight;

    int[,,] areaArray = InitializeZeroMatrice(length, width, levelNumber);
    //StartZones(areaArray);

    int[,,] emptyFullArray = InitializeZeroMatrice(length, width, levelNumber);

    for (int i = 0; i < width * length * 3; i++)
    {
/*
      Spread(areaArray, ref entranceSize, entranceList, ref entranceCounter, entranceLimit, cellSize);
      Spread(areaArray, ref commonSize, commonList, ref commonCounter, commonLimit, cellSize);
      Spread(areaArray, ref wetAreaSize, wetAreaList, ref wetAreaCounter, wetAreaLimit, cellSize);
*/
    }
/*
    noiseFilter(areaArray, 0, 6, 5);
    noiseFilter(areaArray, 1, 2, 2);
*/
    for (int k = 0;k < levelNumber;k++)
    {
      for (int i = 0;i < length;i++)
      {
        for (int j = 0;j < width;j++)
        {
          areaArray[i, j, k] = areaArray[i, j, 0];
        }
      }
    }

    for (int k = 0;k < levelNumber;k++)
    {
      for (int i = 0;i < length;i++)
      {
        for (int j = 0;j < width;j++)
        {
          emptyFullArray[i, j, k] = 0;
        }
      }
    }

    entranceList.Clear();
    commonList.Clear();
    wetAreaList.Clear();
    /*kitchenList.Clear();
    commonAreaList.Clear();*/

    for (int k = 0;k < levelNumber;k++)
    {
      for (int i = 0;i < length;i++)
      {
        for (int j = 0;j < width;j++)
        {
          if (areaArray[i, j, k] == 1)
          {
            Interval xInterval = new Interval(i * cellSize, (i + 1) * (cellSize ));
            Interval yInterval = new Interval(j * cellSize, (j + 1) * (cellSize ));
            Interval zInterval = new Interval(k * LevelHeight, k * LevelHeight + levelHeight);

            Box boxgh = new Box(p, xInterval, yInterval, zInterval);
            entranceBoxes.Add(boxgh);
            entranceList.AddRange(new int[2] { i, j });
          }
          if (areaArray[i, j, k] == 2)
          {
            Interval xInterval = new Interval(i * cellSize, (i + 1) * (cellSize ));
            Interval yInterval = new Interval(j * cellSize, (j + 1) * (cellSize ));
            Interval zInterval = new Interval(k * LevelHeight, k * LevelHeight + levelHeight);

            Box boxgh = new Box(p, xInterval, yInterval, zInterval);
            commonBoxes.Add(boxgh);
            commonList.AddRange(new int[2] { i, j });
          }
          if (areaArray[i, j, k] == 3)
          {
            Interval xInterval = new Interval(i * cellSize, (i + 1) * (cellSize ));
            Interval yInterval = new Interval(j * cellSize, (j + 1) * (cellSize ));
            Interval zInterval = new Interval(k * LevelHeight, k * LevelHeight + levelHeight);

            Box boxgh = new Box(p, xInterval, yInterval, zInterval);
            wetAreaBoxes.Add(boxgh);
            wetAreaList.AddRange(new int[2] { i, j });
          }

          /*if (areaArray[i, j, k] == 4)
          {
            Interval xInterval = new Interval(j * cellSize, (j + 1) * (cellSize ));
            Interval yInterval = new Interval(i * cellSize, (i + 1) * (cellSize ));
            Interval zInterval = new Interval(k * LevelHeight, k * LevelHeight + levelHeight);

            Box boxgh = new Box(p, xInterval, yInterval, zInterval);
            kitchenBoxes.Add(boxgh);
            kitchenList.AddRange(new int[2] { i, j });
          }
          if (areaArray[i, j, k] == 5)
          {
            Interval xInterval = new Interval(j * cellSize, (j + 1) * (cellSize ));
            Interval yInterval = new Interval(i * cellSize, (i + 1) * (cellSize ));
            Interval zInterval = new Interval(k * LevelHeight, k * LevelHeight + levelHeight);

            Box boxgh = new Box(p, xInterval, yInterval, zInterval);
            commonAreaBoxes.Add(boxgh);
            commonAreaList.AddRange(new int[2] { i, j });
          }*/
          if (areaArray[i, j, k] == 0)
          {

            Interval xInterval = new Interval(i * cellSize, (i + 1) * (cellSize ));
            Interval yInterval = new Interval(j * cellSize, (j + 1) * (cellSize ));
            Interval zInterval = new Interval(k * LevelHeight, k * LevelHeight + levelHeight);

            Box boxgh = new Box(p, xInterval, yInterval, zInterval);
            WhiteBoxes.Add(boxgh);
            //WhiteList.AddRange(i, j);
          }
        }
      }
    }
    
    ShowMatrix(areaArray);

    A = areaArray;
    EntranceBoxes = entranceBoxes;
    CommonBoxes = commonBoxes;
    WetAreaBoxes = wetAreaBoxes;
    W = WhiteBoxes;
# ---------- c_script_3: C# additional code ----------
  class Objects
  {
    public string Name;
    public int ZoneName;

    public Box Obj;
    public Box ObjMargin;

    public bool Front = false;
    public bool Right = false;
    public bool Back = false;
    public bool Left = false;
    public bool Top = false;
    public bool Bottom = false;

    public bool RotationBool = true;
    public int RotationOpt; // rotation options

    public bool MirrorBool = true;
    public int MirrorOpt; // mirror options

    public string Source; // Water, Electiricity
    public int FixedToWall; // Bed, Television //1,2,3 conditions
    public int CellSize;

    public Objects PreviousObject;

    public double ObjLength ;
    public double ObjWidth ;
    public double ObjHeight ;

    public double MrjLength;
    public double MrjWidth;
    public double MrjHeight;

    public double baseX, baseY, baseZ;
    public List<int> SpaceList = new List<int>();

    public double  XCell;
    public double  YCell;
    public double  ZCell;


    //deneme
    public Objects()
    {
            /*
            var Coordinates = new List<int>();
            Point3d pA = new Point3d(0, 0, 0);
            Point3d pB = new Point3d(10, 0, 0);
            Point3d pC = new Point3d(0, 10, 0);

            Plane p = new Plane(pA, pB, pC);*/
    }

    public Objects(string name, int zoneName, bool front, bool right, bool back, bool left, bool top, bool bottom, bool rotationalBool, int rotationOpt, bool mirrorBool, int mirrorOpt, string source, int fixedTowall, int cellSize, Box obj, Box objMargin, Objects previousObject, List<int> spaceList)
      : this()
    {
      this.Obj = obj;
      this.ObjMargin = objMargin;

      this.Name = name;
      this.ZoneName = zoneName;

      this.Front = front;
      this.Right = right;
      this.Back = back;
      this.Left = left;
      this.Bottom = bottom;
      this.Top = top;

      this.RotationBool = rotationalBool;
      this.RotationOpt = rotationOpt;

      this.MirrorBool = mirrorBool;
      this.MirrorOpt = mirrorOpt;

      this.Source = source;
      this.FixedToWall = fixedTowall;
      this.CellSize = cellSize;

      this.ObjWidth = obj.X.T1;
      this.ObjLength = obj.Y.T1;
      this.ObjHeight = obj.Z.T1;

      this.MrjWidth = objMargin.X.T1;
      this.MrjLength = objMargin.Y.T1;
      this.MrjHeight = objMargin.Z.T1;

      this.baseX = Obj.Plane.OriginX;
      this.baseY = Obj.Plane.OriginY;
      this.baseZ = Obj.Plane.OriginZ;

      this.PreviousObject = previousObject;
      this.SpaceList = spaceList;
    }

    public Objects(string name, int zoneName, bool front, bool right, bool back, bool left, bool top, bool bottom, bool rotationalBool, int rotationOpt, bool mirrorBool, int mirrorOpt, string source, int fixedTowall, int cellSize, Box obj, Box objMargin, List<int> spaceList)
      : this()
    {
      this.Obj = obj;
      this.ObjMargin = objMargin;

      this.Name = name;
      this.ZoneName = zoneName;

      this.Front = front;
      this.Right = right;
      this.Back = back;
      this.Left = left;
      this.Bottom = bottom;
      this.Top = top;

      this.RotationBool = rotationalBool;
      this.RotationOpt = rotationOpt;

      this.MirrorBool = mirrorBool;
      this.MirrorOpt = mirrorOpt;

      this.Source = source;
      this.FixedToWall = fixedTowall;
      this.CellSize = cellSize;

      this.ObjWidth = obj.X.T1;
      this.ObjLength = obj.Y.T1;
      this.ObjHeight = obj.Z.T1;

      this.MrjWidth = (this.ObjMargin.X.T1);
      this.MrjLength = (this.ObjMargin.Y.T1);
      this.MrjHeight = (this.ObjMargin.Z.T1);

      this.baseX = Obj.Plane.OriginX;
      this.baseY = Obj.Plane.OriginY;
      this.baseZ = Obj.Plane.OriginZ;

      this.SpaceList = spaceList;
    }

    public void assignDimensions()
    {
      this.ObjWidth = this.Obj.X.T1;
      this.ObjLength = this.Obj.Y.T1;
      this.ObjHeight = this.Obj.Z.T1;

      this.MrjWidth = this.ObjMargin.X.T1;
      this.MrjLength = this.ObjMargin.Y.T1;
      this.MrjHeight = this.ObjMargin.Z.T1;

    }

    public void printDimensions()
    {
      Rhino.RhinoApp.WriteLine("Obj Width " + this.ObjWidth.ToString());
      Rhino.RhinoApp.WriteLine("Obj Length " + this.ObjLength.ToString());
      Rhino.RhinoApp.WriteLine("Obj Height " + this.ObjHeight.ToString());

      Rhino.RhinoApp.WriteLine("Obj Width " + this.MrjWidth.ToString());
      Rhino.RhinoApp.WriteLine("Obj Length " + this.MrjLength.ToString());
      Rhino.RhinoApp.WriteLine("Obj Height " + this.MrjHeight.ToString());
    }



    public void placeRefObject(int [,,]emptyFullArray, int[,,]areaArray, out Box ObjBox, out Box marginBox)
    {
      this.XCell = Math.Ceiling((double) (this.MrjWidth / CellSize));
      this.YCell = Math.Ceiling((double) (this.MrjLength / CellSize));
      this.ZCell = Math.Ceiling((double) (this.MrjHeight / 150));

      bool emptyBool = true;
      bool sameZone = true;

      bool placeSuccessful = false;
      int trycount = 0;

      while (placeSuccessful == false)
      {
        var rand = new Random();
        var randomCellIndex = rand.Next(this.SpaceList.Count / 2);

        baseX = (this.SpaceList[2 * randomCellIndex]) * CellSize;
        baseY = (this.SpaceList[2 * randomCellIndex + 1]) * CellSize;
        baseZ = 0;
        baseZ = 0;

        //baseX = baseX * CellSize;
        //baseY = baseY * CellSize;

        if( (baseX + this.MrjWidth < 300) && (baseY + this.MrjLength < 600) && (baseZ + this.MrjHeight < 300) &&
          (baseX + this.MrjWidth > 0) && (baseY + this.MrjLength > 0) && (baseZ + this.MrjHeight > 0) )
        {
          for(int i = (int) (baseX / CellSize) ; i < (baseX / CellSize + (int) XCell); i++)
          {
            for(int j = (int) (baseY / CellSize); j < baseY / CellSize + (int) YCell; j++)
            {
              for(int k = (int) (baseZ / 150); k < baseZ / 150 + (int) ZCell; k++)
              {
                Rhino.RhinoApp.WriteLine("Entrance Reference Object :  " + "  i:  " + i + "  j:  " + j + "  k:  " + k);
                if (emptyFullArray[i, j, k] == 1)
                {
                  emptyBool = false;
                }
                if (areaArray[i, j, k] != this.ZoneName)
                {
                  sameZone = false;
                }
              }
            }
          }

          if (emptyBool && sameZone)
          {
            placeSuccessful = true;

            Rhino.RhinoApp.WriteLine("Reference Object conditions are successful ");
            for(int i = (int) (baseX / CellSize) ; i < (baseX / CellSize + (int) XCell); i++)
            {
              for(int j = (int) (baseY / CellSize); j < baseY / CellSize + (int) YCell; j++)
              {
                for(int k = (int) (baseZ / 150); k < baseZ / 150 + (int) ZCell; k++)
                {
                  emptyFullArray[i, j, k] = 1;
                }
              }
            }
          }
          else
          {
            Rhino.RhinoApp.WriteLine("Conditions are not satisfied ");
          }
        }

        trycount++;
        Rhino.RhinoApp.WriteLine("Try count is : " + trycount);
        if (trycount > 60 )
          Rhino.RhinoApp.WriteLine("Try count is over 60 placement is unsuccessful: ");
        placeSuccessful = true;
      }

      if( trycount < 60 && placeSuccessful )
      {
        Rhino.RhinoApp.WriteLine("baseX " + this.baseX);
        Rhino.RhinoApp.WriteLine("baseY " + this.baseY);
        Rhino.RhinoApp.WriteLine("baseZ " + this.baseZ);

        Point3d pointa = new Point3d(baseX, baseY, 0);
        Vector3d pointb = new Vector3d(0, 0, 1);

        Plane planebase = new Plane(pointa, pointb);

        Interval xInterval = new Interval(0, this.ObjWidth);
        Interval yInterval = new Interval(0, this.ObjLength);
        Interval zInterval = new Interval(0, this.ObjHeight);

        ObjBox = new Box(planebase, xInterval, yInterval, zInterval);

        xInterval = new Interval(0, this.MrjWidth);
        yInterval = new Interval(0, this.MrjLength);
        zInterval = new Interval(0, this.MrjHeight);

        marginBox = new Box(planebase, xInterval, yInterval, zInterval);

      }

      else
      {
        ObjBox = new Box();
        marginBox = new Box();
      }
    }

    public void placeRefObjectEntrance(int [,,]emptyFullArray, int[,,]areaArray, out Box ObjBox, out Box marginBox)
    {
      this.XCell = Math.Ceiling((double) (this.MrjWidth / CellSize));
      this.YCell = Math.Ceiling((double) (this.MrjLength / CellSize));
      this.ZCell = Math.Ceiling((double) (this.MrjHeight / 150));

      bool emptyBool = true;
      bool sameZone = true;


      bool placeSuccessful = false;
      int trycount = 0;

      while (placeSuccessful == false)
      {
        var rand = new Random();
        var randomCellIndex = rand.Next(this.SpaceList.Count / 2);

        baseX = (this.SpaceList[2 * randomCellIndex]) * CellSize;
        baseY = 0;
        baseZ = 0;

        //baseX = baseX * CellSize;
        //baseY = baseY * CellSize;

        if( (baseX + this.MrjWidth < 300) && (baseY + this.MrjLength < 600) && (baseZ + this.MrjHeight < 300) &&
          (baseX + this.MrjWidth > 0) && (baseY + this.MrjLength > 0) && (baseZ + this.MrjHeight > 0) )
        {
          for(int i = (int) (baseX / CellSize) ; i < (baseX / CellSize + (int) XCell); i++)
          {
            for(int j = (int) (baseY / CellSize); j < baseY / CellSize + (int) YCell; j++)
            {
              for(int k = (int) (baseZ / 150); k < baseZ / 150 + (int) ZCell; k++)
              {
                Rhino.RhinoApp.WriteLine("Entrance Reference Object :  " + "  i:  " + i + "  j:  " + j + "  k:  " + k);
                if (emptyFullArray[i, j, k] == 1)
                {
                  emptyBool = false;
                }
                if (areaArray[i, j, k] != this.ZoneName)
                {
                  sameZone = false;
                }
              }
            }
          }

          if (emptyBool && sameZone)
          {
            placeSuccessful = true;

            Rhino.RhinoApp.WriteLine("Reference Object conditions are successful ");
            for(int i = (int) (baseX / CellSize) ; i < (baseX / CellSize + (int) XCell); i++)
            {
              for(int j = (int) (baseY / CellSize); j < baseY / CellSize + (int) YCell; j++)
              {
                for(int k = (int) (baseZ / 150); k < baseZ / 150 + (int) ZCell; k++)
                {
                  emptyFullArray[i, j, k] = 1;
                }
              }
            }
          }
          else
          {
            Rhino.RhinoApp.WriteLine("Conditions are not satisfied ");
          }
        }

        trycount++;
        Rhino.RhinoApp.WriteLine("Try count is : " + trycount);
        if (trycount > 60 )
          Rhino.RhinoApp.WriteLine("Try count is over 60 placement is unsuccessful: ");
        placeSuccessful = true;
      }

      if( trycount < 60 && placeSuccessful )
      {
        Rhino.RhinoApp.WriteLine("baseX " + this.baseX);
        Rhino.RhinoApp.WriteLine("baseY " + this.baseY);
        Rhino.RhinoApp.WriteLine("baseZ " + this.baseZ);

        Point3d pointa = new Point3d(baseX, 0, 0);
        Vector3d pointb = new Vector3d(0, 0, 1);

        Plane planebase = new Plane(pointa, pointb);

        Interval xInterval = new Interval(0, this.ObjWidth);
        Interval yInterval = new Interval(0, this.ObjLength);
        Interval zInterval = new Interval(0, this.ObjHeight);

        ObjBox = new Box(planebase, xInterval, yInterval, zInterval);

        xInterval = new Interval(0, this.MrjWidth);
        yInterval = new Interval(0, this.MrjLength);
        zInterval = new Interval(0, this.MrjHeight);

        marginBox = new Box(planebase, xInterval, yInterval, zInterval);

      }


      else
      {
        ObjBox = new Box();
        marginBox = new Box();
      }

    }


    public void placeFront(int [,,]emptyFullArray, int[,,]areaArray, out Box ObjBox, out Box marginBox)
    {
      bool emptyBool = true;
      bool sameZone = true;

      this.XCell = Math.Ceiling((double) (this.MrjWidth / CellSize));
      this.YCell = Math.Ceiling((double) (this.MrjLength / CellSize));
      this.ZCell = Math.Ceiling((double) (this.MrjHeight / 150));

      this.baseX = PreviousObject.baseX;
      this.baseY = PreviousObject.baseY + CellSize * PreviousObject.YCell;
      this.baseZ = PreviousObject.baseZ;

      if( (baseX + this.MrjWidth < 300) && (baseY + this.MrjLength < 600) && (baseZ + this.MrjHeight < 300) &&
        (baseX + this.MrjWidth > 0) && (baseY + this.MrjLength > 0) && (baseZ + this.MrjHeight > 0) )
      {
        for(int i = (int) (baseX / CellSize) ; i < (baseX / CellSize + (int) XCell); i++)
        {
          for(int j = (int) (baseY / CellSize); j < baseY / CellSize + (int) YCell; j++)
          {
            for(int k = (int) (baseZ / 150); k < baseZ / 150 + (int) ZCell; k++)
            {
              Rhino.RhinoApp.WriteLine("i:  " + i + "  j:  " + j + "  k:  " + k);
              if (emptyFullArray[i, j, k] == 1)
              {
                emptyBool = false;
              }
              if (areaArray[i, j, k] != this.ZoneName)
              {
                sameZone = false;
              }
            }
          }
        }

        if (emptyBool && sameZone)
        {
          Rhino.RhinoApp.WriteLine("Conditions are successful ");
          for(int i = (int) (baseX / CellSize) ; i < (baseX / CellSize + (int) XCell); i++)
          {
            for(int j = (int) (baseY / CellSize); j < baseY / CellSize + (int) YCell; j++)
            {
              for(int k = (int) (baseZ / 150); k < baseZ / 150 + (int) ZCell; k++)
              {
                emptyFullArray[i, j, k] = 1;
              }
            }
          }
        }
        else
        {
          Rhino.RhinoApp.WriteLine("Place Front:  Conditions are not satisfied ");
        }
      }
      else
      {
        Rhino.RhinoApp.WriteLine("Place Front: Conditions are not satisfied ");
      }


      Point3d pointa = new Point3d(baseX, baseY, baseZ);
      Vector3d pointb = new Vector3d(0, 0, 1);

      Plane planebase = new Plane(pointa, pointb);

      Interval xInterval = new Interval(0, this.ObjWidth);
      Interval yInterval = new Interval(0, this.ObjLength);
      Interval zInterval = new Interval(0, this.ObjHeight);

      ObjBox = new Box(planebase, xInterval, yInterval, zInterval);

      xInterval = new Interval(0, this.MrjWidth);
      yInterval = new Interval(0, this.MrjLength);
      zInterval = new Interval(0, this.MrjHeight);

      marginBox = new Box(planebase, xInterval, yInterval, zInterval);
    }


    public void placeRight(int [,,]emptyFullArray, int[,,]areaArray, out Box ObjBox, out Box marginBox)
    {
      bool emptyBool = true;
      bool sameZone = true;

      this.XCell = Math.Ceiling((double) (this.MrjWidth / CellSize));
      this.YCell = Math.Ceiling((double) (this.MrjLength / CellSize));
      this.ZCell = Math.Ceiling((double) (this.MrjHeight / 150));

      this.baseX = PreviousObject.baseX + CellSize * PreviousObject.XCell;
      this.baseY = PreviousObject.baseY;
      this.baseZ = PreviousObject.baseZ;

      if( (baseX + this.ObjWidth < 300) && (baseY + this.ObjLength < 600) && (baseZ + this.ObjHeight < 300) &&
        (baseX + this.ObjWidth > 0) && (baseY + this.ObjLength > 0) && (baseZ + this.ObjHeight > 0) )
      {
        for(int i = (int) (baseX / CellSize) ; i < (baseX / CellSize + (int) XCell); i++)
        {
          for(int j = (int) (baseY / CellSize); j < baseY / CellSize + (int) YCell; j++)
          {
            for(int k = (int) (baseZ / 150); k < baseZ / 150 + (int) ZCell; k++)
            {
              if (emptyFullArray[i, j, k] == 1)
              {
                emptyBool = false;
              }
              if (areaArray[i, j, k] != this.ZoneName)
              {
                sameZone = false;
              }
            }
          }
        }

        if (emptyBool && sameZone)
        {
          Rhino.RhinoApp.WriteLine("Place Right: Conditions are successful ");
          for(int i = (int) (baseX / CellSize) ; i < (baseX / CellSize + (int) XCell); i++)
          {
            for(int j = (int) (baseY / CellSize); j < baseY / CellSize + (int) YCell; j++)
            {
              for(int k = (int) (baseZ / 150); k < baseZ / 150 + (int) ZCell; k++)
              {
                emptyFullArray[i, j, k] = 1;
              }
            }
          }
        }
        else
        {
          Rhino.RhinoApp.WriteLine("Place Right: Conditions are not satisfied ");
        }
      }
      else
      {
        Rhino.RhinoApp.WriteLine("Place Right: Conditions are not satisfied ");
      }

      Point3d pointa = new Point3d(baseX, baseY, baseZ);
      Vector3d pointb = new Vector3d(0, 0, 1);

      Plane planebase = new Plane(pointa, pointb);

      Interval xInterval = new Interval(0, this.ObjWidth);
      Interval yInterval = new Interval(0, this.ObjLength);
      Interval zInterval = new Interval(0, this.ObjHeight);

      ObjBox = new Box(planebase, xInterval, yInterval, zInterval);

      xInterval = new Interval(0, this.MrjWidth);
      yInterval = new Interval(0, this.MrjLength);
      zInterval = new Interval(0, this.MrjHeight);

      marginBox = new Box(planebase, xInterval, yInterval, zInterval);
    }

    public void placeBack(int [,,]emptyFullArray, int[,,]areaArray, out Box ObjBox, out Box marginBox)
    {
      bool emptyBool = true;
      bool sameZone = true;

      this.XCell = Math.Ceiling((double) (this.MrjWidth / CellSize));
      this.YCell = Math.Ceiling((double) (this.MrjLength / CellSize));
      this.ZCell = Math.Ceiling((double) (this.MrjHeight / 150));

      this.baseX = PreviousObject.baseX;
      this.baseY = PreviousObject.baseY - CellSize * this.YCell;
      this.baseZ = PreviousObject.baseZ;

      if( (baseX + this.ObjWidth < 300) && (baseY + this.ObjLength < 600) && (baseZ + this.ObjHeight < 300) &&
        (baseX + this.ObjWidth > 0) && (baseY + this.ObjLength > 0) && (baseZ + this.ObjHeight > 0) )
      {
        for(int i = (int) (baseX / CellSize) ; i < (baseX / CellSize + (int) XCell); i++)
        {
          for(int j = (int) (baseY / CellSize); j < baseY / CellSize + (int) YCell; j++)
          {
            for(int k = (int) (baseZ / 150); k < baseZ / 150 + (int) ZCell; k++)
            {
              if (emptyFullArray[i, j, k] == 1)
              {
                emptyBool = false;
              }
              if (areaArray[i, j, k] != this.ZoneName)
              {
                sameZone = false;
              }
            }
          }
        }

        if (emptyBool && sameZone)
        {
          Rhino.RhinoApp.WriteLine("Place Back: Conditions are successful ");
          for(int i = (int) (baseX / CellSize) ; i < (baseX / CellSize + (int) XCell); i++)
          {
            for(int j = (int) (baseY / CellSize); j < baseY / CellSize + (int) YCell; j++)
            {
              for(int k = (int) (baseZ / 150); k < baseZ / 150 + (int) ZCell; k++)
              {
                emptyFullArray[i, j, k] = 1;
              }
            }
          }
        }
        else
        {
          Rhino.RhinoApp.WriteLine("Place Back: Conditions are not satisfied ");
        }
      }
      else
      {
        Rhino.RhinoApp.WriteLine("Place Back:Conditions are not satisfied ");
      }

      Point3d pointa = new Point3d(baseX, baseY, baseZ);
      Vector3d pointb = new Vector3d(0, 0, 1);

      Plane planebase = new Plane(pointa, pointb);

      Interval xInterval = new Interval(0, this.ObjWidth);
      Interval yInterval = new Interval(0, this.ObjLength);
      Interval zInterval = new Interval(0, this.ObjHeight);

      ObjBox = new Box(planebase, xInterval, yInterval, zInterval);

      xInterval = new Interval(0, this.MrjWidth);
      yInterval = new Interval(0, this.MrjLength);
      zInterval = new Interval(0, this.MrjHeight);

      marginBox = new Box(planebase, xInterval, yInterval, zInterval);
    }

    public void placeLeft(int [,,]emptyFullArray, int[,,]areaArray, out Box ObjBox, out Box marginBox)
    {
      bool emptyBool = true;
      bool sameZone = true;

      this.XCell = Math.Ceiling((double) (this.MrjWidth / CellSize));
      this.YCell = Math.Ceiling((double) (this.MrjLength / CellSize));
      this.ZCell = Math.Ceiling((double) (this.MrjHeight / 150));

      this.baseX = PreviousObject.baseX - CellSize * this.XCell;
      this.baseY = PreviousObject.baseY;
      this.baseZ = PreviousObject.baseZ;

      if( (baseX + this.ObjWidth < 300) && (baseY + this.ObjLength < 600) && (baseZ + this.ObjHeight < 300) &&
        (baseX + this.ObjWidth > 0) && (baseY + this.ObjLength > 0) && (baseZ + this.ObjHeight > 0) )
      {
        for(int i = (int) (baseX / CellSize) ; i < (baseX / CellSize + (int) XCell); i++)
        {
          for(int j = (int) (baseY / CellSize); j < baseY / CellSize + (int) YCell; j++)
          {
            for(int k = (int) (baseZ / 150); k < baseZ / 150 + (int) ZCell; k++)
            {
              if (emptyFullArray[i, j, k] == 1)
              {
                emptyBool = false;
              }
              if (areaArray[i, j, k] != this.ZoneName)
              {
                sameZone = false;
              }
            }
          }
        }

        if (emptyBool && sameZone)
        {
          Rhino.RhinoApp.WriteLine("Place Left: Conditions are successful ");
          for(int i = (int) (baseX / CellSize) ; i < (baseX / CellSize + (int) XCell); i++)
          {
            for(int j = (int) (baseY / CellSize); j < baseY / CellSize + (int) YCell; j++)
            {
              for(int k = (int) (baseZ / 150); k < baseZ / 150 + (int) ZCell; k++)
              {
                emptyFullArray[i, j, k] = 1;
              }
            }
          }
        }
        else
        {
          Rhino.RhinoApp.WriteLine("Place Left: Conditions are not satisfied ");
        }
      }
      else
      {
        Rhino.RhinoApp.WriteLine("Place Left: Conditions are not satisfied ");
      }

      Point3d pointa = new Point3d(baseX, baseY, baseZ);
      Vector3d pointb = new Vector3d(0, 0, 1);

      Plane planebase = new Plane(pointa, pointb);

      Interval xInterval = new Interval(0, this.ObjWidth);
      Interval yInterval = new Interval(0, this.ObjLength);
      Interval zInterval = new Interval(0, this.ObjHeight);

      ObjBox = new Box(planebase, xInterval, yInterval, zInterval);

      xInterval = new Interval(0, this.MrjWidth);
      yInterval = new Interval(0, this.MrjLength);
      zInterval = new Interval(0, this.MrjHeight);

      marginBox = new Box(planebase, xInterval, yInterval, zInterval);
    }
    public void placeTop(int [,,]emptyFullArray, int[,,]areaArray, out Box ObjBox, out Box marginBox)
    {
      bool emptyBool = true;
      bool sameZone = true;

      this.XCell = Math.Ceiling((double) (this.MrjWidth / CellSize));
      this.YCell = Math.Ceiling((double) (this.MrjLength / CellSize));
      this.ZCell = Math.Ceiling((double) (this.MrjHeight / 150));

      this.baseX = PreviousObject.baseX;
      this.baseY = PreviousObject.baseY;
      this.baseZ = PreviousObject.baseZ + CellSize * PreviousObject.ZCell;

      if( (baseX + this.ObjWidth < 300) && (baseY + this.ObjLength < 600) && (baseZ + this.ObjHeight < 300) &&
        (baseX + this.ObjWidth > 0) && (baseY + this.ObjLength > 0) && (baseZ + this.ObjHeight > 0) )
      {
        for(int i = (int) (baseX / CellSize) ; i < (baseX / CellSize + (int) XCell); i++)
        {
          for(int j = (int) (baseY / CellSize); j < baseY / CellSize + (int) YCell; j++)
          {
            for(int k = (int) (baseZ / 150); k < baseZ / 150 + (int) ZCell; k++)
            {
              if (emptyFullArray[i, j, k] == 1)
              {
                emptyBool = false;
              }
              if (areaArray[i, j, k] != this.ZoneName)
              {
                sameZone = false;
              }
            }
          }
        }

        if (emptyBool && sameZone)
        {
          Rhino.RhinoApp.WriteLine("Conditions are successful ");
          for(int i = (int) (baseX / CellSize) ; i < (baseX / CellSize + (int) XCell); i++)
          {
            for(int j = (int) (baseY / CellSize); j < baseY / CellSize + (int) YCell; j++)
            {
              for(int k = (int) (baseZ / 150); k < baseZ / 150 + (int) ZCell; k++)
              {
                emptyFullArray[i, j, k] = 1;
              }
            }
          }
        }
        else
        {
          Rhino.RhinoApp.WriteLine("Conditions are not satisfied ");
        }
      }
      else
      {
        Rhino.RhinoApp.WriteLine("Conditions are not satisfied ");
      }

      Point3d pointa = new Point3d(baseX, baseY, baseZ);
      Vector3d pointb = new Vector3d(0, 0, 1);

      Plane planebase = new Plane(pointa, pointb);

      Interval xInterval = new Interval(0, this.ObjWidth);
      Interval yInterval = new Interval(0, this.ObjLength);
      Interval zInterval = new Interval(0, this.ObjHeight);

      ObjBox = new Box(planebase, xInterval, yInterval, zInterval);

      xInterval = new Interval(0, this.MrjWidth);
      yInterval = new Interval(0, this.MrjLength);
      zInterval = new Interval(0, this.MrjHeight);

      marginBox = new Box(planebase, xInterval, yInterval, zInterval);
    }

    public void placeBottom(int [,,]emptyFullArray, int[,,]areaArray, out Box ObjBox, out Box marginBox)
    {
      bool emptyBool = true;
      bool sameZone = true;

      this.XCell = Math.Ceiling((double) (this.MrjWidth / CellSize));
      this.YCell = Math.Ceiling((double) (this.MrjLength / CellSize));
      this.ZCell = Math.Ceiling((double) (this.MrjHeight / 150));

      this.baseX = PreviousObject.baseX;
      this.baseY = PreviousObject.baseY;
      this.baseZ = PreviousObject.baseZ - CellSize * this.ZCell;

      if( (baseX + this.ObjWidth < 300) && (baseY + this.ObjLength < 600) && (baseZ + this.ObjHeight < 300) &&
        (baseX + this.ObjWidth > 0) && (baseY + this.ObjLength > 0) && (baseZ + this.ObjHeight > 0) )
      {
        for(int i = (int) (baseX / CellSize) ; i < (baseX / CellSize + (int) XCell); i++)
        {
          for(int j = (int) (baseY / CellSize); j < baseY / CellSize + (int) YCell; j++)
          {
            for(int k = (int) (baseZ / 150); k < baseZ / 150 + (int) ZCell; k++)
            {
              if (emptyFullArray[i, j, k] == 1)
              {
                emptyBool = false;
              }
              if (areaArray[i, j, k] != this.ZoneName)
              {
                sameZone = false;
              }
            }
          }
        }

        if (emptyBool && sameZone)
        {
          Rhino.RhinoApp.WriteLine("Conditions are successful ");
          for(int i = (int) (baseX / CellSize) ; i < (baseX / CellSize + (int) XCell); i++)
          {
            for(int j = (int) (baseY / CellSize); j < baseY / CellSize + (int) YCell; j++)
            {
              for(int k = (int) (baseZ / 150); k < baseZ / 150 + (int) ZCell; k++)
              {
                emptyFullArray[i, j, k] = 1;
              }
            }
          }
        }
        else
        {
          Rhino.RhinoApp.WriteLine("Conditions are not satisfied ");
        }
      }
      else
      {
        Rhino.RhinoApp.WriteLine("Conditions are not satisfied ");
      }

      Point3d pointa = new Point3d(baseX, baseY, baseZ);
      Vector3d pointb = new Vector3d(0, 0, 1);

      Plane planebase = new Plane(pointa, pointb);

      Interval xInterval = new Interval(0, this.ObjWidth);
      Interval yInterval = new Interval(0, this.ObjLength);
      Interval zInterval = new Interval(0, this.ObjHeight);

      ObjBox = new Box(planebase, xInterval, yInterval, zInterval);

      xInterval = new Interval(0, this.MrjWidth);
      yInterval = new Interval(0, this.MrjLength);
      zInterval = new Interval(0, this.MrjHeight);

      marginBox = new Box(planebase, xInterval, yInterval, zInterval);
    }

    public void placeObject(int [,,]emptyFullArray, int[,,]areaArray, out Box ObjBox, out Box marginBox)
    {

      Point3d pointa = new Point3d(baseX, baseY, baseZ);
      Vector3d pointb = new Vector3d(0, 0, 1);

      Plane planebase = new Plane(pointa, pointb);

      Interval xInterval = new Interval(0, this.ObjWidth);
      Interval yInterval = new Interval(0, this.ObjLength);
      Interval zInterval = new Interval(0, this.ObjHeight);

      ObjBox = new Box(planebase, xInterval, yInterval, zInterval);

      xInterval = new Interval(0, this.MrjWidth);
      yInterval = new Interval(0, this.MrjLength);
      zInterval = new Interval(0, this.MrjHeight);

      marginBox = new Box(planebase, xInterval, yInterval, zInterval);

      List<int> growDirection = new List<int>();

      if(PreviousObject.Front == true)
        growDirection.Add(1); // Front Direction
      if(PreviousObject.Right == true)
        growDirection.Add(2); // Right Direction
      if(PreviousObject.Back == true)
        growDirection.Add(3); // Back Direction
      if(PreviousObject.Left == true)
        growDirection.Add(4); // Left Direction
      if(PreviousObject.Bottom == true)
        growDirection.Add(5); // Bottom Direction
      if(PreviousObject.Top == true)
        growDirection.Add(6); // Right Direction

      bool placeSuccess = false;
      int tryCounter = 0;

      if(growDirection.Count >= 1)
      {
        Random randm = new Random();

        while(placeSuccess == false )
        {
          int a = randm.Next(0, growDirection.Count);
          int randomMethod = growDirection[a];

          switch (a)
          ​{
            case 1:
              this.placeFront(emptyFullArray, areaArray, out  ObjBox, out marginBox);
              placeSuccess = true;
              break;
            case 2:
              this.placeRight(emptyFullArray, areaArray, out  ObjBox, out marginBox);
              placeSuccess = true;
              break;
            case 3:
              this.placeBack(emptyFullArray, areaArray, out  ObjBox, out marginBox);
              placeSuccess = true;
              break;
            case 4:
              this.placeLeft(emptyFullArray, areaArray, out  ObjBox, out marginBox);
              placeSuccess = true;
              break;
            case 5:
              this.placeBottom(emptyFullArray, areaArray, out  ObjBox, out marginBox);
              placeSuccess = true;
              break;
            case 6:
              this.placeTop(emptyFullArray, areaArray, out  ObjBox, out marginBox);
              placeSuccess = true;
              break;

            default:
              tryCounter++;
              break;
            // default statements
          }


        }
        growDirection.Clear();




      }


    }


    public void rotate()
    {

    }



    static void mirror()
    {

    }

    static void getClosestCell()
    {

    }

    static void createWall()
    {

    }

  }

  static void ShowMatrix(int[,,] Arr)
  {
    for (int i = 0; i < Arr.GetLength(0); i++)
    {
      for (int j = 0; j < Arr.GetLength(1); j++)
      {
        Rhino.RhinoApp.Write(Arr[i, j, 0] + " ");
      }
      Rhino.RhinoApp.WriteLine("Loop Runs" + i.ToString());
    }
    return;
  }

  static int[,,] InitializeZeroMatrice(int width, int length, int levelNumber)
  {
    var areaArray = new int[width, length, levelNumber];

    for (int k = 0; k < levelNumber; k++)
    {
      for (int i = 0; i < width; i++)
      {
        for (int j = 0; j < length; j++)
        {
          areaArray[i, j, k] = 0;
        }
      }
    }          
    return areaArray;
  }

  /* The Color lists keep the colors in a seperate List in order to choose within them easily instead of searching where they are... */
  static List<int> entranceList = new List<int>();
  static List<int> commonList = new List<int>();
  static List<int> wetAreaList = new List<int>();
 /* static List<int> kitchenList = new List<int>();
  static List<int> commonAreaList = new List<int>();*/

  /**           these counters are used for starting the límitations counts.         **/

  //static int entranceCounter = 1;
 // static int commonCounter = 1;
  //static int wetAreaCounter = 1;
  /*static int kitchenCounter = 1;
  static int commonAreaCounter = 1;*/
  /**           these limits are used for defining max distance that zone can spread.  **/

  //static int entranceLimit = 200;
 // static int commonLimit = 200;
  //static int wetAreaLimit = 200;
  /*static int kitchenLimit = 200;
  static int commonAreaLimit = 100;*/

  static void StartZones(int[,,] arr)
  {
    /**
     * Randomly Starts the color. Takes the Color lists as argumnts
     * (We can delete these argumnents and it can get them as local referance
     * in our case it gives us a chance to choose what to initilize)
     * **/

    Random rand = new Random();
    //----------------------
    /* GetLength(0) and GetLength(1) might be set as variable */
    //Array.GetLength(0) gives the column lenght in other words length of an array
    //Array.GetLength(1) gives the row lenght in other words width of an array
    var a = rand.Next(arr.GetLength(0) / 2, arr.GetLength(0) / 2);
    var b = rand.Next(0, 2);

    Rhino.RhinoApp.WriteLine("started");
    entranceList.AddRange(new int[2] { a, b }); //AddRange ==> Adds multiple elements to a List . We use mod%2 to call the index of the point back instead of stacking them as an another List(or Array) in our list.
    arr[a, b, 0] = 1;// entrance Starting Point
    //----------------------

    b = rand.Next(0, arr.GetLength(1));
    a = rand.Next(0, arr.GetLength(0));

    commonList.AddRange(new int[2] { a, b });
    arr[a, b, 0] = 2; // common Starting Point
    //----------------------
    a = rand.Next(0, arr.GetLength(0));
    b = rand.Next(0, arr.GetLength(1));

    wetAreaList.AddRange(new int[2] { a, b });
    arr[a, b, 0] = 3; // wetArea Starting Point
    //----------------------
    a = rand.Next(0, arr.GetLength(0));
    b = rand.Next(0, arr.GetLength(1));
/*
    kitchenList.AddRange(new int[2] { a, b });
    arr[a, b, 0] = 4; // kitchen Starting Point
    //----------------------
    a = rand.Next(0, arr.GetLength(0));
    b = rand.Next(0, arr.GetLength(1));

    commonAreaList.AddRange(new int[2] { a, b });
    arr[a, b, 0] = 5; // commonArea Starting Point
    //----------------------
  */
  }
        /* Calculates the distance between initial point in the color and the possible new point!
         *  (if the possible new point is too far from inital point eleminate it.) */
  static double distanceCalculate(List<int> spaceCoordList, int x2, int y2, int cellSize)
  {
    var distance = cellSize * Math.Sqrt((y2 - spaceCoordList[1]) * (y2 - spaceCoordList[1]) + (x2 - spaceCoordList[0]) * (x2 - spaceCoordList[0]));
    return distance;
  }

  static void Evaluate()
  {
    // according to relations give score to the created zones
    // get the centers of the zones and acoording to the distances and created sizes give
    //positive or negative points and if score is not acceptable re-run and create variatians.
  }


  static void noiseFilter (int [,,] arr, int type, int iterationNumber, int controlNumber)
  {
    if(type == 0)
    {
      for( int loop = 0 ; loop < iterationNumber ; loop++ )
      {
        List < int> surrounding = new List<int>();
        for(int i = 1 ; i < arr.GetLength(0) - 1 ;i++)
        {
          for(int j = 1 ; j < arr.GetLength(1) - 1 ;j++)
          {
            for(int x = -1 ; x < 2;x++)
            {
              for(int y = -1 ; y < 2;y++)
              {
                if(!(x == y && x == 0))
                {

                  surrounding.Add(arr[i + x, j + y, 0]);
                }
              }
            }
            for (int v = 0 ; v < 6 ;v++) // 6 is the number of the zones including  empty cells
            {
              int count = (from z in surrounding where z == v select z).Count();
              if ( count >= controlNumber )
              {
                arr[i, j, 0] = v;
              }
            }
            surrounding.Clear();
            surrounding.TrimExcess();
          }
        }
      }
    }

    if(type == 1)
    {
      for( int loop = 0 ; loop < iterationNumber ; loop++ )
      {
        List < int> surrounding = new List<int>();
        for(int i = 1 ; i < arr.GetLength(0) - 1 ;i++)
        {
          for(int j = 1 ; j < arr.GetLength(1) - 1 ;j++)
          {
            for(int x = -1 ; x < 2;x++)
            {
              for(int y = -1 ; y < 2;y++)
              {
                if(!(x == y && x == 0) && ( (x + y == 1 ) || (x + y == -1 )) )
                {
                  surrounding.Add(arr[i + x, j + y, 0]);
                }
              }
            }

            for (int v = 0 ; v < 6 ;v++) // 6 is the number of the zones including  empty cells
            {
              int count = (from z in surrounding where z == v select z).Count();
              if ( count >= 2 )
              {
                arr[i, j, 0] = v;
              }
            }
            surrounding.Clear();
            surrounding.TrimExcess();
          }
        }
      }
    }
  }

  static void Spread(int[,,] arr, ref double spaceSize, List<int> spaceCoordList, ref int counter, int spaceLimit, int cellSize)
  {
        /*ARGUMENTS
     * The main array which has rectangular form(will be 3d in short) ,
     * spaceSize = Maximum limit that can grow.  ,
     * spaceCoordList =  the cells of the zone which has been already defined. )
     */
    var rand = new Random();
    var directionList = new List<int>();
    int Xcoord;
    int Ycoord;
    bool draw = false;
    int trycount = 0;

    while (draw == false && counter <= spaceSize)
    {
      if (counter <= spaceSize ) //Can be deleted. The condition is added to the While Loop Conditions.
      {
        var randomCellIndex = rand.Next(spaceCoordList.Count / 2);

        Xcoord = spaceCoordList[2 * randomCellIndex];
        Ycoord = spaceCoordList[2 * randomCellIndex + 1];

        if (Xcoord < arr.GetLength(0) - 1 && Xcoord > 0 && Ycoord > 0 && Ycoord < arr.GetLength(1) - 1)
        {
          /* Check the conditions INSIDE borders */
          if (arr[Xcoord + 1, Ycoord, 0] == 0 && distanceCalculate(spaceCoordList, Xcoord + 1, Ycoord, cellSize) < spaceLimit ) // Check if possible new cell is still white or not!
            directionList.AddRange(new int[2] { (Xcoord + 1), Ycoord }); //Store possible spread directions in a list.

          if (arr[Xcoord - 1, Ycoord, 0] == 0 && distanceCalculate(spaceCoordList, Xcoord - 1, Ycoord, cellSize) < spaceLimit)
            directionList.AddRange(new int[2] { (Xcoord - 1), Ycoord }); //Store possible spread directions in a list.

          if (arr[Xcoord, Ycoord + 1, 0] == 0 && distanceCalculate(spaceCoordList, Xcoord, Ycoord + 1, cellSize) < spaceLimit)
            directionList.AddRange(new int[2] { (Xcoord), Ycoord + 1 }); //Store possible spread directions in a list.

          if (arr[Xcoord, Ycoord - 1, 0] == 0 && distanceCalculate(spaceCoordList, Xcoord, Ycoord - 1, cellSize) < spaceLimit)
            directionList.AddRange(new int[2] { (Xcoord), (Ycoord - 1) }); //Store possible spread directions in a list.

          if (directionList.Count > 0)
          {
            var randomIndex = rand.Next(directionList.Count / 2);
            int a = directionList[2 * randomIndex];
            int b = directionList[2 * randomIndex + 1];

            arr[a, b, 0] = arr[Xcoord, Ycoord, 0];

            spaceCoordList.AddRange(new int[2] { a, b });

            directionList.Clear();
            directionList.TrimExcess();
            draw = true;
            counter++;
          }
          else
          {
            trycount++;
            if (trycount >= spaceCoordList.Count)
            {
              draw = true;
              //Print("trycountNumber is ={0}", trycount);
            }
          }
        }

          /* EDGE CONDITIONS */
          //RIGHT
        else if (Xcoord == (arr.GetLength(0) - 1) && Ycoord != 0 && Ycoord != (arr.GetLength(1) - 1))
        {
          if (arr[Xcoord - 1, Ycoord, 0] == 0 && distanceCalculate(spaceCoordList, Xcoord - 1, Ycoord, cellSize) < spaceLimit )
            directionList.AddRange(new int[2] { (Xcoord - 1), (Ycoord) }); //Store possible spread directions in a list.
          if (arr[Xcoord, Ycoord + 1, 0] == 0 && distanceCalculate(spaceCoordList, Xcoord, Ycoord + 1, cellSize) < spaceLimit )
            directionList.AddRange(new int[2] { (Xcoord ), (Ycoord + 1) }); //Store possible spread directions in a list.
          if (arr[Xcoord, Ycoord - 1, 0] == 0 && distanceCalculate(spaceCoordList, Xcoord, Ycoord - 1, cellSize) < spaceLimit )
            directionList.AddRange(new int[2] { (Xcoord ), (Ycoord - 1) }); //Store possible spread directions in a list.

          if (directionList.Count > 0)
          {
            var randomIndex = rand.Next(directionList.Count / 2);
            int a = directionList[2 * randomIndex];
            int b = directionList[2 * randomIndex + 1];

            arr[a, b, 0] = arr[Xcoord, Ycoord, 0];

            spaceCoordList.AddRange(new int[2] { a, b });

            directionList.Clear();
            directionList.TrimExcess();
            draw = true;
            counter++;
          }
          else
          {
            trycount++;
            if (trycount >= spaceCoordList.Count)
            {
              draw = true;
              //Print("trycountNumber is ={0}", trycount);
            }
          }
        }

          //Left
        else if (Xcoord == 0 && Ycoord != 0 && Ycoord != (arr.GetLength(1) - 1))
        {

          if (arr[Xcoord + 1, Ycoord, 0] == 0 && distanceCalculate(spaceCoordList, Xcoord + 1, Ycoord, cellSize) < spaceLimit )
            directionList.AddRange(new int[2] { (Xcoord + 1), (Ycoord) }); //Store possible spread directions in a list.
          if (arr[Xcoord, Ycoord + 1, 0] == 0 && distanceCalculate(spaceCoordList, Xcoord, Ycoord + 1, cellSize) < spaceLimit )
            directionList.AddRange(new int[2] { (Xcoord ), (Ycoord + 1) }); //Store possible spread directions in a list.
          if (arr[Xcoord, Ycoord - 1, 0] == 0 && distanceCalculate(spaceCoordList, Xcoord, Ycoord - 1, cellSize) < spaceLimit )
            directionList.AddRange(new int[2] { (Xcoord ), (Ycoord - 1) }); //Store possible spread directions in a list.
          if (directionList.Count > 0)
          {
            var randomIndex = rand.Next(directionList.Count / 2);
            int a = directionList[2 * randomIndex];
            int b = directionList[2 * randomIndex + 1];

            arr[a, b, 0] = arr[Xcoord, Ycoord, 0];

            spaceCoordList.AddRange(new int[2] { a, b });

            directionList.Clear();
            directionList.TrimExcess();
            draw = true;
            counter++;
          }
          else
          {
            trycount++;
            if (trycount >= spaceCoordList.Count)
            {
              draw = true;
              //Print("trycountNumber is ={0}", trycount);
            }
          }

        }
          //TOP
        else if ((Ycoord == arr.GetLength(1) - 1) && Xcoord != 0 && Xcoord != (arr.GetLength(0) - 1))
        {

          if (arr[Xcoord, Ycoord - 1, 0] == 0 && distanceCalculate(spaceCoordList, Xcoord, Ycoord - 1, cellSize) < spaceLimit )
            directionList.AddRange(new int[2] { (Xcoord ), (Ycoord - 1) }); //Store possible spread directions in a list.
          if (arr[Xcoord + 1, Ycoord, 0] == 0 && distanceCalculate(spaceCoordList, Xcoord + 1, Ycoord, cellSize) < spaceLimit )
            directionList.AddRange(new int[2] { (Xcoord + 1 ), (Ycoord ) }); //Store possible spread directions in a list.
          if (arr[Xcoord - 1, Ycoord, 0] == 0 && distanceCalculate(spaceCoordList, Xcoord - 1, Ycoord, cellSize) < spaceLimit )
            directionList.AddRange(new int[2] { (Xcoord - 1), (Ycoord ) }); //Store possible spread directions in a list.
          if (directionList.Count > 0)
          {
            var randomIndex = rand.Next(directionList.Count / 2);
            int a = directionList[2 * randomIndex];
            int b = directionList[2 * randomIndex + 1];

            arr[a, b, 0] = arr[Xcoord, Ycoord, 0];

            spaceCoordList.AddRange(new int[2] { a, b });

            directionList.Clear();
            directionList.TrimExcess();
            draw = true;
            counter++;
          }
          else
          {
            trycount++;
            if (trycount >= spaceCoordList.Count)
            {
              draw = true;
              //Print("trycountNumber is ={0}", trycount);
            }
          }
        }
          //BOTTOM
        else if (Ycoord == 0 && Xcoord != 0 && Xcoord != (arr.GetLength(0) - 1))
        {
          if (arr[Xcoord, Ycoord + 1, 0] == 0 && distanceCalculate(spaceCoordList, Xcoord, Ycoord + 1, cellSize) < spaceLimit )
            directionList.AddRange(new int[2] { (Xcoord ), (Ycoord + 1) }); //Store possible spread directions in a list.
          if (arr[Xcoord + 1, Ycoord, 0] == 0 && distanceCalculate(spaceCoordList, Xcoord + 1, Ycoord, cellSize) < spaceLimit )
            directionList.AddRange(new int[2] { (Xcoord + 1 ), (Ycoord ) }); //Store possible spread directions in a list.
          if (arr[Xcoord - 1, Ycoord, 0] == 0 && distanceCalculate(spaceCoordList, Xcoord - 1, Ycoord, cellSize) < spaceLimit )
            directionList.AddRange(new int[2] { (Xcoord - 1), (Ycoord ) }); //Store possible spread directions in a list.
          if (directionList.Count > 0)
          {
            var randomIndex = rand.Next(directionList.Count / 2);
            int a = directionList[2 * randomIndex];
            int b = directionList[2 * randomIndex + 1];

            arr[a, b, 0] = arr[Xcoord, Ycoord, 0];

            spaceCoordList.AddRange(new int[2] { a, b });

            directionList.Clear();
            directionList.TrimExcess();
            draw = true;
            counter++;
          }
          else
          {
            trycount++;
            if (trycount >= spaceCoordList.Count)
            {
              draw = true;
              //Print("trycountNumber is ={0}", trycount);
            }
          }
        }

          //LEFT BOTTOM
        else if (Xcoord == 0 && Ycoord == 0)
        {
          if (arr[Xcoord, Ycoord + 1, 0] == 0 && distanceCalculate(spaceCoordList, Xcoord, Ycoord + 1, cellSize) < spaceLimit)
            directionList.Add(Xcoord); directionList.Add(Ycoord + 1);

          if (arr[Xcoord + 1, Ycoord, 0] == 0 && distanceCalculate(spaceCoordList, Xcoord + 1, Ycoord, cellSize) < spaceLimit)
            directionList.Add(Xcoord + 1); directionList.Add(Ycoord);

          if (directionList.Count > 0)
          {

            var randomIndex = rand.Next(directionList.Count / 2);

            int a = directionList[2 * randomIndex];
            int b = directionList[2 * randomIndex + 1];

            arr[a, b, 0] = arr[Xcoord, Ycoord, 0];

            spaceCoordList.AddRange(new int[2] { a, b });

            directionList.Clear();
            directionList.TrimExcess();
            draw = true;

            counter++;
            //Print(" Counter Number is : {0}", counter);
          }
          else
          {
            trycount++;
            if (trycount >= spaceCoordList.Count)
            {
              draw = true;
              //Print("trycountNumber is ={0}", trycount);
            }
          }
        }
          //LEFT  TOP
          /*
          else if (Xcoord == 0 && Ycoord == (arr.GetLength(1) - 1))
          {
          if (arr[Xcoord + 1, Ycoord] == 0)
          directionList.Add(Xcoord + 1); directionList.Add(Ycoord);

          if (arr[Xcoord, Ycoord - 1] == 0)
          directionList.Add(Xcoord); directionList.Add(Ycoord - 1);

          if (directionList.Count > 0)
          {
          var randomIndex = rand.Next(directionList.Count / 2);

          int a = directionList[2 * randomIndex];
          int b = directionList[2 * randomIndex + 1];

          Rhino.RhinoApp.WriteLine("Left Top "  +  a +  " "  +  b);
          arr[a, b] = arr[Xcoord, Ycoord];

          spaceCoordList.AddRange(new int[2] { a, b });

          directionList.Clear();
          directionList.TrimExcess();
          draw = true;

          counter++;
          //Print(" Counter Number is : {0}", counter);
          }
          else
          {
          trycount++;
          if (trycount >= spaceCoordList.Count)
          {
          draw = true;
          //Print("trycountNumber is ={0}", trycount);
          }
          }
          }
          */
          /*
          //RIGHT TOP
          else if (Xcoord == (arr.GetLength(0) - 1) && Ycoord == (arr.GetLength(1) - 1))
          {
          if (arr[Xcoord, Ycoord - 1] == 0)
          directionList.Add(Xcoord); directionList.Add(Ycoord - 1);

          if (arr[Xcoord - 1, Ycoord] == 0)
          directionList.Add(Xcoord - 1); directionList.Add(Ycoord);

          if (directionList.Count > 0)
          {
          var randomIndex = rand.Next(directionList.Count / 2);

          int a = directionList[2 * randomIndex];
          int b = directionList[2 * randomIndex + 1];
          Rhino.RhinoApp.WriteLine(" Right top "+ a + " " + b);
          arr[a, b] = arr[Xcoord, Ycoord];

          //spaceCoordList.AddRange(new int[2] { a, b });

          directionList.Clear();
          directionList.TrimExcess();
          draw = true;

          counter++;
          //Print(" Counter Number is : {0}", counter);
          }
          else
          {
          trycount++;
          if (trycount >= spaceCoordList.Count)
          {
          draw = true;
          //Print("trycountNumber is ={0}", trycount);
          }
          }
          }
          */
          //RIGHT BOTTOM
        else if (Xcoord == (arr.GetLength(0) - 1) && Ycoord == 0)
        {
          if (arr[Xcoord, Ycoord + 1, 0] == 0)
            directionList.Add(Xcoord); directionList.Add(Ycoord + 1);

          if (arr[Xcoord - 1, Ycoord, 0] == 0)
            directionList.Add(Xcoord - 1); directionList.Add(Ycoord);

          if (directionList.Count > 0)
          {
            var randomIndex = rand.Next(directionList.Count / 2);

            int a = directionList[2 * randomIndex];
            int b = directionList[2 * randomIndex + 1];

            arr[a, b, 0] = arr[Xcoord, Ycoord, 0];

            spaceCoordList.AddRange(new int[2] { a, b });

            directionList.Clear();
            directionList.TrimExcess();

            draw = true;
            counter++;
            //Print(" Counter Number is : {0}", counter);
          }
          else
          {
            trycount++;
            if (trycount >= spaceCoordList.Count)
            {
              draw = true;
              //Print("trycountNumber is ={0}", trycount);
            }
          }
        }
        /* EDGE CONDITIONS */
      }
    }

  }




    /* Instead of wrting methods seperately in main program, it is better to use class based
     informations to keep things organized, we are not yet transsferentrance methods here but we created the str.*/

    /*
    public class Zone
    {
        public string Name;
        public int SpaceLimit;
        public Int16 SpaceSize;
        public int Counter;
        public List<Int16> SpaceList;

        public void Describe()
        {
            Console.WriteLine("Hey this zone is{ 0} ", Name);
        }

        public Zone()
        {
           // SpaceList = new List<int>();
        }

        public Zone(string name, int spaceLimit,int spacesize,int counter, List<int> SpaceList)
        :this()
        {
        }
        static void InitializeZeroMatrice() { }
        static void startZones() { }
        public void SpreadZones() { }

    }
    */
# ---------- end c_script_3 ----------
box_39 = Box(c_script_3.Furnitures)  # disabled
deconstruct_box_21 = DeconstructBox(Box=box_39)  # -> Plane, X, Y, Z; disabled
panel_26 = Panel(deconstruct_box_21.Plane)  # disabled
panel_27 = Panel(deconstruct_box_21.Y)  # disabled
panel_28 = Panel(deconstruct_box_21.X)  # disabled
panel_29 = Panel(deconstruct_box_21.Z)  # disabled
boolean_toggle = BooleanToggle(False)  # disabled
deconstruct_domain_34 = DeconstructDomain(Domain=panel_23)  # -> Start, End; disabled
deconstruct_domain_35 = DeconstructDomain(Domain=panel_25)  # -> Start, End; disabled
deconstruct_domain_36 = DeconstructDomain(Domain=panel_24)  # -> Start, End; disabled
deconstruct_domain_37 = DeconstructDomain(Domain=panel_27)  # -> Start, End; disabled
deconstruct_domain_38 = DeconstructDomain(Domain=panel_28)  # -> Start, End; disabled
deconstruct_domain_39 = DeconstructDomain(Domain=panel_29)  # -> Start, End; disabled
box_40 = Box(c_script_3.Bxx)  # disabled
panel_30 = Panel(deconstruct_domain_35.End)  # disabled
panel_31 = Panel(deconstruct_domain_34.End)  # disabled
panel_32 = Panel(deconstruct_domain_36.End)  # disabled
panel_33 = Panel(box_40)  # disabled
panel_34 = Panel(deconstruct_domain_37.End)  # disabled
panel_35 = Panel(deconstruct_domain_38.End)  # disabled
# White Cells
panel_36 = Panel(deconstruct_domain_39.End)  # disabled
list_item = ListItem(List=c_script_3.Furnitures, Index=number_slider_17, Wrap=boolean_toggle)  # disabled
# White Cells
panel_37 = Panel(c_script_3.out)  # disabled
colour_swatch = ColourSwatch(SwatchColor=RGB(255, 255, 0))
colour_swatch_2 = ColourSwatch(SwatchColor=RGB(0, 0, 0))
colour_swatch_3 = ColourSwatch(SwatchColor=RGB(255, 255, 255))
colour_swatch_4 = ColourSwatch(SwatchColor=RGB(240, 240, 200))
colour_swatch_5 = ColourSwatch(SwatchColor=RGB(240, 200, 200))
colour_swatch_6 = ColourSwatch(SwatchColor=RGB(150, 200, 255))
number_slider_18 = Slider(0, range=0..1)  # disabled
number_slider_19 = Slider(0.611, range=0..1)  # disabled
number_slider_20 = Slider(0.544, range=0..1)  # disabled
colour_swatch_7 = ColourSwatch(SwatchColor=RGB(0, 0, 0))  # disabled
colour_swatch_8 = ColourSwatch(SwatchColor=RGB(0, 0, 0))  # disabled
colour_swatch_9 = ColourSwatch(SwatchColor=RGB(255, 255, 0))  # disabled
colour_swatch_10 = ColourSwatch(SwatchColor=RGB(0, 0, 0))  # disabled
colour_swatch_11 = ColourSwatch(SwatchColor=RGB(255, 255, 255))  # disabled
colour_swatch_12 = ColourSwatch(SwatchColor=RGB(240, 240, 200))  # disabled
colour_swatch_13 = ColourSwatch(SwatchColor=RGB(240, 200, 200))  # disabled
colour_swatch_14 = ColourSwatch(SwatchColor=RGB(150, 200, 255))  # disabled

# ---- group: Visualize as 3D Boxes
number_slider_21 = Slider(0.801, range=0..1)  # disabled
create_material_7 = CreateMaterial(Diffuse=colour_swatch_12, Specular=RGB(255, 255, 255), Emission=RGB(0, 0, 0), Transparency=number_slider_21, Shine=0)  # disabled
create_material_8 = CreateMaterial(Diffuse=colour_swatch_9, Specular=RGB(255, 255, 255), Emission=RGB(0, 0, 0), Transparency=number_slider_21, Shine=0)  # disabled
create_material_9 = CreateMaterial(Diffuse=colour_swatch_13, Specular=RGB(255, 255, 255), Emission=RGB(0, 0, 0), Transparency=number_slider_21, Shine=0)  # disabled
create_material_10 = CreateMaterial(Diffuse=colour_swatch_14, Specular=RGB(255, 255, 255), Emission=RGB(0, 0, 0), Transparency=number_slider_21, Shine=0)  # disabled
create_material_11 = CreateMaterial(Diffuse=colour_swatch_10, Specular=RGB(255, 255, 255), Emission=RGB(0, 0, 0), Transparency=number_slider_21, Shine=0)  # disabled
create_material_12 = CreateMaterial(Diffuse=colour_swatch_11, Specular=RGB(255, 255, 255), Emission=RGB(0, 0, 0), Transparency=number_slider_20, Shine=0)  # disabled
custom_preview_5 = CustomPreview(Geometry=c_script_3.EntranceBoxes, Material=create_material_7)  # disabled
custom_preview_6 = CustomPreview(Geometry=c_script_3.CommonBoxes, Material=create_material_9)  # disabled
custom_preview_7 = CustomPreview(Geometry=c_script_3.Y, Material=create_material_8)  # disabled
custom_preview_8 = CustomPreview(Geometry=c_script_3.WetAreaBoxes, Material=create_material_10)  # disabled
custom_preview_9 = CustomPreview(Geometry=c_script_3.K, Material=create_material_11)  # disabled
custom_preview_10 = CustomPreview(Geometry=c_script_3.W, Material=create_material_12)  # disabled

# ----
create_material_13 = CreateMaterial(
    Diffuse=ColourSwatch(SwatchColor=RGB(0, 0, 0)),
    Specular=RGB(255, 255, 255),
    Emission=RGB(0, 0, 0),
    Transparency=Slider(0, range=0..1),
    Shine=0)
create_material_14 = CreateMaterial(
    Diffuse=ColourSwatch(SwatchColor=RGB(120, 116, 107)),
    Specular=RGB(255, 255, 255),
    Emission=RGB(0, 0, 0),
    Transparency=Slider(0.8, range=0..1),
    Shine=0)
create_material_15 = CreateMaterial(Diffuse=colour_swatch_7, Specular=RGB(255, 255, 255), Emission=RGB(0, 0, 0), Transparency=number_slider_18, Shine=0)  # disabled
create_material_16 = CreateMaterial(Diffuse=colour_swatch_8, Specular=RGB(255, 255, 255), Emission=RGB(0, 0, 0), Transparency=number_slider_19, Shine=0)  # disabled
custom_preview_11 = CustomPreview(Geometry=c_script_3.Furnitures, Material=create_material_15)  # disabled
custom_preview_12 = CustomPreview(Geometry=c_script_3.FurnituresMargins, Material=create_material_16)  # disabled
list_length = ListLength(List=c_script_3.EntranceBoxes)  # disabled
list_length_2 = ListLength(List=c_script_3.CommonBoxes)  # disabled
list_length_3 = ListLength(List=c_script_3.W)  # disabled
list_length_4 = ListLength(List=c_script_3.WetAreaBoxes)  # disabled
list_length_5 = ListLength(List=c_script_3.Y)  # disabled
list_length_6 = ListLength(List=c_script_3.K)  # disabled
multiplication_14 = Multiplication(A=list_length_2, B=division_7)  # disabled
multiplication_15 = Multiplication(A=list_length, B=division_7)  # disabled
multiplication_16 = Multiplication(A=list_length_3, B=division_7)  # disabled
multiplication_17 = Multiplication(A=list_length_4, B=division_7)  # disabled
multiplication_18 = Multiplication(A=list_length_5, B=division_7)  # disabled
multiplication_19 = Multiplication(A=list_length_6, B=division_7)  # disabled
panel_38 = Panel("m2 ")  # disabled
panel_39 = Panel(multiplication_15)  # disabled
panel_40 = Panel(" Entrance = ")  # disabled
number_slider_22 = Slider(15, range=0..100)
panel_41 = Panel(" Empty Space= ")  # disabled
panel_42 = Panel(multiplication_16)  # disabled
panel_43 = Panel("m2 ")  # disabled
panel_44 = Panel(multiplication_14)  # disabled
panel_45 = Panel("m2 ")  # disabled
panel_46 = Panel(" CommonArea = ")  # disabled
panel_47 = Panel("m2 ")  # disabled
panel_48 = Panel(multiplication_17)  # disabled
panel_49 = Panel(multiplication_18)  # disabled
panel_50 = Panel("Wet Area = ")  # disabled
panel_51 = Panel(" Common Area = ")  # disabled
panel_52 = Panel("m2 ")  # disabled
panel_53 = Panel(" Kitchen = ")  # disabled
panel_54 = Panel(" m2 ")  # disabled
panel_55 = Panel(multiplication_19)  # disabled
number_slider_23 = Slider(15, range=0..100)  # disabled
concatenate = Concatenate(Fragment_A=panel_41, Fragment_B=panel_42, Fragment_C=panel_43)  # disabled
concatenate_2 = Concatenate(Fragment_A=panel_40, Fragment_B=panel_39, Fragment_C=panel_38)  # disabled
panel_56 = Panel("0,-50")  # disabled
concatenate_3 = Concatenate(Fragment_A=panel_46, Fragment_B=panel_44, Fragment_C=panel_45)  # disabled
panel_57 = Panel("0,-80")  # disabled
panel_58 = Panel("0,-140")  # disabled
concatenate_4 = Concatenate(Fragment_A=panel_50, Fragment_B=panel_48, Fragment_C=panel_47)  # disabled
concatenate_5 = Concatenate(Fragment_A=panel_53, Fragment_B=panel_49, Fragment_C=panel_52)  # disabled
concatenate_6 = Concatenate(Fragment_A=panel_51, Fragment_B=panel_55, Fragment_C=panel_54)  # disabled
panel_59 = Panel(concatenate)  # disabled
panel_60 = Panel(concatenate_2)  # disabled
panel_61 = Panel(concatenate_3)  # disabled
panel_62 = Panel(concatenate_4)  # disabled
panel_63 = Panel(concatenate_5)  # disabled
panel_64 = Panel("120,-200")
panel_65 = Panel(concatenate_6)  # disabled
panel_66 = Panel("240,-170")  # disabled
panel_67 = Panel("0,-110")  # disabled
panel_68 = Panel("120,-200")  # disabled
text_tag_3d = TextTag3D(Location=panel_56, Text=concatenate_2, Size=number_slider_23, Colour=colour_swatch_12, Justification=7)  # disabled
text_tag_3d_2 = TextTag3D(Location=panel_57, Text=concatenate_3, Size=number_slider_23, Colour=colour_swatch_13, Justification=7)  # disabled
text_tag_3d_3 = TextTag3D(Location=panel_58, Text=concatenate_5, Size=number_slider_23, Colour=colour_swatch_9, Justification=7)  # disabled
text_tag_3d_4 = TextTag3D(Location=panel_67, Text=concatenate_4, Size=number_slider_23, Colour=colour_swatch_14, Justification=7)  # disabled
text_tag_3d_5 = TextTag3D(Location=panel_58, Text=concatenate, Size=number_slider_23, Colour=colour_swatch_11, Justification=7)  # disabled
text_tag_3d_6 = TextTag3D(Location=panel_66, Text=concatenate_6, Size=number_slider_23, Colour=colour_swatch_10, Justification=7)  # disabled
mass_addition = MassAddition(Input=[multiplication_14, multiplication_15, multiplication_17, multiplication_18, multiplication_19, multiplication_16])  # -> flatten(Result), PartialResults; disabled
number_slider_24 = Slider(1, range=0..1)  # disabled
panel_69 = Panel(" Total Area =")  # disabled
panel_70 = Panel("m2 ")  # disabled
list_item_2 = ListItem(List=mass_addition.Result, Index=number_slider_24, Wrap=True)  # disabled
panel_71 = Panel(list_item_2)  # disabled
panel_72 = Panel("240,-100")  # disabled
concatenate_7 = Concatenate(Fragment_A=panel_69, Fragment_B=panel_71, Fragment_C=panel_70)  # disabled
panel_73 = Panel(concatenate_7)  # disabled
text_tag_3d_7 = TextTag3D(Location=panel_72, Text=concatenate_7, Size=number_slider_23, Justification=7)  # disabled
number_slider_25 = Slider(10, range=0..10)  # disabled
number_slider_26 = Slider(30, range=0..100)  # disabled
number_slider_27 = Slider(60, range=20..60)  # disabled
number_slider_28 = Slider(6, range=2..10)  # disabled
number_slider_29 = Slider(36, range=20..60)  # disabled
multiplication_20 = Multiplication(A=number_slider_26, B=number_slider_25)  # disabled
number_slider_30 = Slider(2, range=0..10)  # disabled
multiplication_21 = Multiplication(A=number_slider_27, B=number_slider_25)  # disabled
multiplication_22 = Multiplication(A=number_slider_28, B=number_slider_25)  # disabled
multiplication_23 = Multiplication(A=number_slider_29, B=number_slider_25)  # disabled
number_slider_31 = Slider(10000, range=0..10000)  # disabled
round_2 = Round()  # -> Nearest, Floor, Ceiling; disabled
panel_74 = Panel(multiplication_20)  # disabled
panel_75 = Panel(multiplication_23)  # disabled
panel_76 = Panel(multiplication_21)  # disabled
multiplication_24 = Multiplication(A=multiplication_22, B=multiplication_22)  # disabled
number_slider_32 = Slider(100, range=0..100)  # disabled
division_8 = Division(A=multiplication_21, B=multiplication_22)  # disabled
panel_77 = Panel(multiplication_22)  # disabled
division_9 = Division(A=multiplication_23, B=multiplication_22)  # disabled
number_slider_33 = Slider(150, range=0..1000)  # disabled
multiplication_25 = Multiplication(A=number_slider_31, B=number_slider_30)  # disabled
division_10 = Division(A=multiplication_24, B=multiplication_25)  # disabled
panel_78 = Panel(division_9)  # disabled
integer_7 = Integer(division_9)  # disabled
integer_8 = Integer(division_8)  # disabled
integer_9 = Integer(panel_74)  # disabled
box_41 = Box(closet)  # disabled
box_42 = Box(closet_margin)  # disabled
box_43 = Box(exterior_door)  # disabled
c_script_4 = CSharpScript(boxx=box_43)  # -> out, lenght; inputs boxx: Box; disabled; same code as c_script
panel_79 = Panel(c_script_4.lenght)  # disabled
deconstruct_box_22 = DeconstructBox(Box=box_43)  # -> Plane, X, Y, Z; disabled
panel_80 = Panel(deconstruct_box_22.Plane)  # disabled
panel_81 = Panel(deconstruct_box_22.Y)  # disabled
panel_82 = Panel(deconstruct_box_22.Z)  # disabled
panel_83 = Panel(deconstruct_box_22.X)  # disabled
box_44 = Box(changeover_zone)  # disabled
box_45 = Box(exterior_door_margin)  # disabled
box_46 = Box(change_over_zone_margin)  # disabled
box_47 = Box()  # disabled
box_48 = Box()  # disabled
box_49 = Box()  # disabled
box_50 = Box()  # disabled
box_51 = Box()  # disabled
box_52 = Box()  # disabled
box_53 = Box()  # disabled
box_54 = Box()  # disabled
box_55 = Box()  # disabled
box_56 = Box()  # disabled
box_57 = Box()  # disabled
number_slider_34 = Slider(8, range=0..10)  # disabled
c_script_5 = CSharpScript(
    Width=integer_8,
    Length=integer_7,
    Height=integer_9,
    LevelHeight=number_slider_33,
    cellSize=multiplication_22,
    ExteriorDoor=box_43,
    ExteriorDoorMargin=box_45,
    ChangeOverZone=box_44,
    ChangeOverZoneMargin=box_46,
    Closet=box_41,
    ClosetMargin=box_42,
    InteriorDoor=box_47,
    InteriorDoorMargin=box_48,
    Counter=box_49,
    CounterMargin=box_50,
    Table=box_51,
    TableMargin=box_52,
    SittingUnit=box_53,
    SittingUnitMargin=box_54,
    Bed=box_55,
    HealtCare=box_56,
    HealthCareMargin=box_57)  # -> out, A, EntranceBoxes, CommonBoxes, WetAreaBoxes, Y, K, W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; inputs Width: Int32, Length: Int32, Height: Int32, LevelHeight: Int32, cellSize: Int32, ExteriorDoor: Box, ExteriorDoorMargin: Box, ChangeOverZone: Box, ChangeOverZoneMargin: Box, Closet: Box, ClosetMargin: Box, InteriorDoor: Box, InteriorDoorMargin: Box, Counter: Box, CounterMargin: Box, Table: Box, TableMargin: Box, SittingUnit: Box, SittingUnitMargin: Box, Bed: Box, BedMargin: Box, HealtCare: Box, HealthCareMargin: Box; disabled
# ---------- c_script_5: C# ----------
    List<Box> entranceBoxes = new List<Box>();
    List<Box> commonBoxes = new List<Box>();
    List<Box> wetAreaBoxes = new List<Box>();

    /*List<Box> kitchenBoxes = new List<Box>();
      List<Box> commonAreaBoxes = new List<Box>();*/

    List<Box> WhiteBoxes = new List<Box>();

    /**  These sizes are Spreading Limits for the spaces   //total cells     **/

    double entranceSize = (6 * 100 * 100) / (cellSize * cellSize);
    double commonSize = (8 * 100 * 100) / (cellSize * cellSize);
    double wetAreaSize = (6 * 100 * 100 ) / (cellSize * cellSize);

    /*
    double kitchenSize = 7 * 100 * 100 / cellSize * cell  Size;
    double commonAreaSize = 10 * 100 * 100 / cellSize * cellSize;
    */

    Point3d pA = new Point3d(0, 0, 0);
    Point3d pB = new Point3d(10, 0, 0);
    Point3d pC = new Point3d(0, 10, 0);

    Plane p = new Plane(pA, pB, pC);

    int width = Width;
    int length = Length;
    int levelHeight = LevelHeight;
    int height = Height;
    int levelNumber = Height / LevelHeight;

    int[,,] areaArray = InitializeZeroMatrice(length, width, levelNumber);
    StartZones(areaArray);

    int[,,] emptyFullArray = InitializeZeroMatrice(length, width, levelNumber);

    for (int i = 0; i < width * length * 3; i++)
    {

      Spread(areaArray, ref entranceSize, entranceList, ref entranceCounter, entranceLimit, cellSize);
      Spread(areaArray, ref commonSize, commonList, ref commonCounter, commonLimit, cellSize);
      Spread(areaArray, ref wetAreaSize, wetAreaList, ref wetAreaCounter, wetAreaLimit, cellSize);

    }
/*
    noiseFilter(areaArray, 0, 6, 5);
    noiseFilter(areaArray, 1, 2, 2);
*/
    for (int k = 0;k < levelNumber;k++)
    {
      for (int i = 0;i < length;i++)
      {
        for (int j = 0;j < width;j++)
        {
          areaArray[i, j, k] = areaArray[i, j, 0];
        }
      }
    }

    for (int k = 0;k < levelNumber;k++)
    {
      for (int i = 0;i < length;i++)
      {
        for (int j = 0;j < width;j++)
        {
          emptyFullArray[i, j, k] = 0;
        }
      }
    }

    entranceList.Clear();
    commonList.Clear();
    wetAreaList.Clear();
    /*kitchenList.Clear();
    commonAreaList.Clear();*/

    for (int k = 0;k < levelNumber;k++)
    {
      for (int i = 0;i < length;i++)
      {
        for (int j = 0;j < width;j++)
        {
          if (areaArray[i, j, k] == 1)
          {
            Interval xInterval = new Interval(i * cellSize, (i + 1) * (cellSize ));
            Interval yInterval = new Interval(j * cellSize, (j + 1) * (cellSize ));
            Interval zInterval = new Interval(k * LevelHeight, k * LevelHeight + levelHeight);

            Box boxgh = new Box(p, xInterval, yInterval, zInterval);
            entranceBoxes.Add(boxgh);
            entranceList.AddRange(new int[2] { i, j });
          }
          if (areaArray[i, j, k] == 2)
          {
            Interval xInterval = new Interval(i * cellSize, (i + 1) * (cellSize ));
            Interval yInterval = new Interval(j * cellSize, (j + 1) * (cellSize ));
            Interval zInterval = new Interval(k * LevelHeight, k * LevelHeight + levelHeight);

            Box boxgh = new Box(p, xInterval, yInterval, zInterval);
            commonBoxes.Add(boxgh);
            commonList.AddRange(new int[2] { i, j });
          }
          if (areaArray[i, j, k] == 3)
          {
            Interval xInterval = new Interval(i * cellSize, (i + 1) * (cellSize ));
            Interval yInterval = new Interval(j * cellSize, (j + 1) * (cellSize ));
            Interval zInterval = new Interval(k * LevelHeight, k * LevelHeight + levelHeight);

            Box boxgh = new Box(p, xInterval, yInterval, zInterval);
            wetAreaBoxes.Add(boxgh);
            wetAreaList.AddRange(new int[2] { i, j });
          }

          /*if (areaArray[i, j, k] == 4)
          {
            Interval xInterval = new Interval(j * cellSize, (j + 1) * (cellSize ));
            Interval yInterval = new Interval(i * cellSize, (i + 1) * (cellSize ));
            Interval zInterval = new Interval(k * LevelHeight, k * LevelHeight + levelHeight);

            Box boxgh = new Box(p, xInterval, yInterval, zInterval);
            kitchenBoxes.Add(boxgh);
            kitchenList.AddRange(new int[2] { i, j });
          }
          if (areaArray[i, j, k] == 5)
          {
            Interval xInterval = new Interval(j * cellSize, (j + 1) * (cellSize ));
            Interval yInterval = new Interval(i * cellSize, (i + 1) * (cellSize ));
            Interval zInterval = new Interval(k * LevelHeight, k * LevelHeight + levelHeight);

            Box boxgh = new Box(p, xInterval, yInterval, zInterval);
            commonAreaBoxes.Add(boxgh);
            commonAreaList.AddRange(new int[2] { i, j });
          }*/
          if (areaArray[i, j, k] == 0)
          {

            Interval xInterval = new Interval(i * cellSize, (i + 1) * (cellSize ));
            Interval yInterval = new Interval(j * cellSize, (j + 1) * (cellSize ));
            Interval zInterval = new Interval(k * LevelHeight, k * LevelHeight + levelHeight);

            Box boxgh = new Box(p, xInterval, yInterval, zInterval);
            WhiteBoxes.Add(boxgh);
            //WhiteList.AddRange(i, j);
          }
        }
      }
    }

    ShowMatrix(areaArray);

    A = areaArray;
    EntranceBoxes = entranceBoxes;
    CommonBoxes = commonBoxes;
    WetAreaBoxes = wetAreaBoxes;
    W = WhiteBoxes;
# ---------- c_script_5: C# additional code ----------
  class Objects
  {
    public string Name;
    public int ZoneName;

    public Box Obj;
    public Box ObjMargin;

    public bool Front = false;
    public bool Right = false;
    public bool Back = false;
    public bool Left = false;
    public bool Top = false;
    public bool Bottom = false;

    public bool RotationBool = true;
    public int RotationOpt; // rotation options

    public bool MirrorBool = true;
    public int MirrorOpt; // mirror options

    public string Source; // Water, Electiricity
    public int FixedToWall; // Bed, Television //1,2,3 conditions
    public int CellSize;

    public Objects PreviousObject;

    public double ObjLength ;
    public double ObjWidth ;
    public double ObjHeight ;

    public double MrjLength;
    public double MrjWidth;
    public double MrjHeight;

    public double baseX, baseY, baseZ;
    public List<int> SpaceList = new List<int>();

    public double  XCell;
    public double  YCell;
    public double  ZCell;


    //deneme
    public Objects()
    {
            /*
            var Coordinates = new List<int>();
            Point3d pA = new Point3d(0, 0, 0);
            Point3d pB = new Point3d(10, 0, 0);
            Point3d pC = new Point3d(0, 10, 0);

            Plane p = new Plane(pA, pB, pC);*/
    }

    public Objects(string name, int zoneName, bool front, bool right, bool back, bool left, bool top, bool bottom, bool rotationalBool, int rotationOpt, bool mirrorBool, int mirrorOpt, string source, int fixedTowall, int cellSize, Box obj, Box objMargin, Objects previousObject, List<int> spaceList)
      : this()
    {
      this.Obj = obj;
      this.ObjMargin = objMargin;

      this.Name = name;
      this.ZoneName = zoneName;

      this.Front = front;
      this.Right = right;
      this.Back = back;
      this.Left = left;
      this.Bottom = bottom;
      this.Top = top;

      this.RotationBool = rotationalBool;
      this.RotationOpt = rotationOpt;

      this.MirrorBool = mirrorBool;
      this.MirrorOpt = mirrorOpt;

      this.Source = source;
      this.FixedToWall = fixedTowall;
      this.CellSize = cellSize;

      this.ObjWidth = obj.X.T1;
      this.ObjLength = obj.Y.T1;
      this.ObjHeight = obj.Z.T1;

      this.MrjWidth = objMargin.X.T1;
      this.MrjLength = objMargin.Y.T1;
      this.MrjHeight = objMargin.Z.T1;

      this.baseX = Obj.Plane.OriginX;
      this.baseY = Obj.Plane.OriginY;
      this.baseZ = Obj.Plane.OriginZ;

      this.PreviousObject = previousObject;
      this.SpaceList = spaceList;
    }

    public Objects(string name, int zoneName, bool front, bool right, bool back, bool left, bool top, bool bottom, bool rotationalBool, int rotationOpt, bool mirrorBool, int mirrorOpt, string source, int fixedTowall, int cellSize, Box obj, Box objMargin, List<int> spaceList)
      : this()
    {
      this.Obj = obj;
      this.ObjMargin = objMargin;

      this.Name = name;
      this.ZoneName = zoneName;

      this.Front = front;
      this.Right = right;
      this.Back = back;
      this.Left = left;
      this.Bottom = bottom;
      this.Top = top;

      this.RotationBool = rotationalBool;
      this.RotationOpt = rotationOpt;

      this.MirrorBool = mirrorBool;
      this.MirrorOpt = mirrorOpt;

      this.Source = source;
      this.FixedToWall = fixedTowall;
      this.CellSize = cellSize;

      this.ObjWidth = obj.X.T1;
      this.ObjLength = obj.Y.T1;
      this.ObjHeight = obj.Z.T1;

      this.MrjWidth = (this.ObjMargin.X.T1);
      this.MrjLength = (this.ObjMargin.Y.T1);
      this.MrjHeight = (this.ObjMargin.Z.T1);

      this.baseX = Obj.Plane.OriginX;
      this.baseY = Obj.Plane.OriginY;
      this.baseZ = Obj.Plane.OriginZ;

      this.SpaceList = spaceList;
    }

    public void assignDimensions()
    {
      this.ObjWidth = this.Obj.X.T1;
      this.ObjLength = this.Obj.Y.T1;
      this.ObjHeight = this.Obj.Z.T1;

      this.MrjWidth = this.ObjMargin.X.T1;
      this.MrjLength = this.ObjMargin.Y.T1;
      this.MrjHeight = this.ObjMargin.Z.T1;

    }

    public void printDimensions()
    {
      Rhino.RhinoApp.WriteLine("Obj Width " + this.ObjWidth.ToString());
      Rhino.RhinoApp.WriteLine("Obj Length " + this.ObjLength.ToString());
      Rhino.RhinoApp.WriteLine("Obj Height " + this.ObjHeight.ToString());

      Rhino.RhinoApp.WriteLine("Obj Width " + this.MrjWidth.ToString());
      Rhino.RhinoApp.WriteLine("Obj Length " + this.MrjLength.ToString());
      Rhino.RhinoApp.WriteLine("Obj Height " + this.MrjHeight.ToString());
    }



    public void placeRefObject(int [,,]emptyFullArray, int[,,]areaArray, out Box ObjBox, out Box marginBox)
    {
      this.XCell = Math.Ceiling((double) (this.MrjWidth / CellSize));
      this.YCell = Math.Ceiling((double) (this.MrjLength / CellSize));
      this.ZCell = Math.Ceiling((double) (this.MrjHeight / 150));

      bool emptyBool = true;
      bool sameZone = true;

      bool placeSuccessful = false;
      int trycount = 0;

      while (placeSuccessful == false)
      {
        var rand = new Random();
        var randomCellIndex = rand.Next(this.SpaceList.Count / 2);

        baseX = (this.SpaceList[2 * randomCellIndex]) * CellSize;
        baseY = (this.SpaceList[2 * randomCellIndex + 1]) * CellSize;
        baseZ = 0;
        baseZ = 0;

        //baseX = baseX * CellSize;
        //baseY = baseY * CellSize;

        if( (baseX + this.MrjWidth < 300) && (baseY + this.MrjLength < 600) && (baseZ + this.MrjHeight < 300) &&
          (baseX + this.MrjWidth > 0) && (baseY + this.MrjLength > 0) && (baseZ + this.MrjHeight > 0) )
        {
          for(int i = (int) (baseX / CellSize) ; i < (baseX / CellSize + (int) XCell); i++)
          {
            for(int j = (int) (baseY / CellSize); j < baseY / CellSize + (int) YCell; j++)
            {
              for(int k = (int) (baseZ / 150); k < baseZ / 150 + (int) ZCell; k++)
              {
                Rhino.RhinoApp.WriteLine("Entrance Reference Object :  " + "  i:  " + i + "  j:  " + j + "  k:  " + k);
                if (emptyFullArray[i, j, k] == 1)
                {
                  emptyBool = false;
                }
                if (areaArray[i, j, k] != this.ZoneName)
                {
                  sameZone = false;
                }
              }
            }
          }

          if (emptyBool && sameZone)
          {
            placeSuccessful = true;

            Rhino.RhinoApp.WriteLine("Reference Object conditions are successful ");
            for(int i = (int) (baseX / CellSize) ; i < (baseX / CellSize + (int) XCell); i++)
            {
              for(int j = (int) (baseY / CellSize); j < baseY / CellSize + (int) YCell; j++)
              {
                for(int k = (int) (baseZ / 150); k < baseZ / 150 + (int) ZCell; k++)
                {
                  emptyFullArray[i, j, k] = 1;
                }
              }
            }
          }
          else
          {
            Rhino.RhinoApp.WriteLine("Conditions are not satisfied ");
          }
        }

        trycount++;
        Rhino.RhinoApp.WriteLine("Try count is : " + trycount);
        if (trycount > 60 )
          Rhino.RhinoApp.WriteLine("Try count is over 60 placement is unsuccessful: ");
        placeSuccessful = true;
      }

      if( trycount < 60 && placeSuccessful )
      {
        Rhino.RhinoApp.WriteLine("baseX " + this.baseX);
        Rhino.RhinoApp.WriteLine("baseY " + this.baseY);
        Rhino.RhinoApp.WriteLine("baseZ " + this.baseZ);

        Point3d pointa = new Point3d(baseX, baseY, 0);
        Vector3d pointb = new Vector3d(0, 0, 1);

        Plane planebase = new Plane(pointa, pointb);

        Interval xInterval = new Interval(0, this.ObjWidth);
        Interval yInterval = new Interval(0, this.ObjLength);
        Interval zInterval = new Interval(0, this.ObjHeight);

        ObjBox = new Box(planebase, xInterval, yInterval, zInterval);

        xInterval = new Interval(0, this.MrjWidth);
        yInterval = new Interval(0, this.MrjLength);
        zInterval = new Interval(0, this.MrjHeight);

        marginBox = new Box(planebase, xInterval, yInterval, zInterval);

      }

      else
      {
        ObjBox = new Box();
        marginBox = new Box();
      }
    }

    public void placeRefObjectEntrance(int [,,]emptyFullArray, int[,,]areaArray, out Box ObjBox, out Box marginBox)
    {
      this.XCell = Math.Ceiling((double) (this.MrjWidth / CellSize));
      this.YCell = Math.Ceiling((double) (this.MrjLength / CellSize));
      this.ZCell = Math.Ceiling((double) (this.MrjHeight / 150));

      bool emptyBool = true;
      bool sameZone = true;


      bool placeSuccessful = false;
      int trycount = 0;

      while (placeSuccessful == false)
      {
        var rand = new Random();
        var randomCellIndex = rand.Next(this.SpaceList.Count / 2);

        baseX = (this.SpaceList[2 * randomCellIndex]) * CellSize;
        baseY = 0;
        baseZ = 0;

        //baseX = baseX * CellSize;
        //baseY = baseY * CellSize;

        if( (baseX + this.MrjWidth < 300) && (baseY + this.MrjLength < 600) && (baseZ + this.MrjHeight < 300) &&
          (baseX + this.MrjWidth > 0) && (baseY + this.MrjLength > 0) && (baseZ + this.MrjHeight > 0) )
        {
          for(int i = (int) (baseX / CellSize) ; i < (baseX / CellSize + (int) XCell); i++)
          {
            for(int j = (int) (baseY / CellSize); j < baseY / CellSize + (int) YCell; j++)
            {
              for(int k = (int) (baseZ / 150); k < baseZ / 150 + (int) ZCell; k++)
              {
                Rhino.RhinoApp.WriteLine("Entrance Reference Object :  " + "  i:  " + i + "  j:  " + j + "  k:  " + k);
                if (emptyFullArray[i, j, k] == 1)
                {
                  emptyBool = false;
                }
                if (areaArray[i, j, k] != this.ZoneName)
                {
                  sameZone = false;
                }
              }
            }
          }

          if (emptyBool && sameZone)
          {
            placeSuccessful = true;

            Rhino.RhinoApp.WriteLine("Reference Object conditions are successful ");
            for(int i = (int) (baseX / CellSize) ; i < (baseX / CellSize + (int) XCell); i++)
            {
              for(int j = (int) (baseY / CellSize); j < baseY / CellSize + (int) YCell; j++)
              {
                for(int k = (int) (baseZ / 150); k < baseZ / 150 + (int) ZCell; k++)
                {
                  emptyFullArray[i, j, k] = 1;
                }
              }
            }
          }
          else
          {
            Rhino.RhinoApp.WriteLine("Conditions are not satisfied ");
          }
        }

        trycount++;
        Rhino.RhinoApp.WriteLine("Try count is : " + trycount);
        if (trycount > 60 )
          Rhino.RhinoApp.WriteLine("Try count is over 60 placement is unsuccessful: ");
        placeSuccessful = true;
      }

      if( trycount < 60 && placeSuccessful )
      {
        Rhino.RhinoApp.WriteLine("baseX " + this.baseX);
        Rhino.RhinoApp.WriteLine("baseY " + this.baseY);
        Rhino.RhinoApp.WriteLine("baseZ " + this.baseZ);

        Point3d pointa = new Point3d(baseX, 0, 0);
        Vector3d pointb = new Vector3d(0, 0, 1);

        Plane planebase = new Plane(pointa, pointb);

        Interval xInterval = new Interval(0, this.ObjWidth);
        Interval yInterval = new Interval(0, this.ObjLength);
        Interval zInterval = new Interval(0, this.ObjHeight);

        ObjBox = new Box(planebase, xInterval, yInterval, zInterval);

        xInterval = new Interval(0, this.MrjWidth);
        yInterval = new Interval(0, this.MrjLength);
        zInterval = new Interval(0, this.MrjHeight);

        marginBox = new Box(planebase, xInterval, yInterval, zInterval);

      }


      else
      {
        ObjBox = new Box();
        marginBox = new Box();
      }

    }


    public void placeFront(int [,,]emptyFullArray, int[,,]areaArray, out Box ObjBox, out Box marginBox)
    {
      bool emptyBool = true;
      bool sameZone = true;

      this.XCell = Math.Ceiling((double) (this.MrjWidth / CellSize));
      this.YCell = Math.Ceiling((double) (this.MrjLength / CellSize));
      this.ZCell = Math.Ceiling((double) (this.MrjHeight / 150));

      this.baseX = PreviousObject.baseX;
      this.baseY = PreviousObject.baseY + CellSize * PreviousObject.YCell;
      this.baseZ = PreviousObject.baseZ;

      if( (baseX + this.MrjWidth < 300) && (baseY + this.MrjLength < 600) && (baseZ + this.MrjHeight < 300) &&
        (baseX + this.MrjWidth > 0) && (baseY + this.MrjLength > 0) && (baseZ + this.MrjHeight > 0) )
      {
        for(int i = (int) (baseX / CellSize) ; i < (baseX / CellSize + (int) XCell); i++)
        {
          for(int j = (int) (baseY / CellSize); j < baseY / CellSize + (int) YCell; j++)
          {
            for(int k = (int) (baseZ / 150); k < baseZ / 150 + (int) ZCell; k++)
            {
              Rhino.RhinoApp.WriteLine("i:  " + i + "  j:  " + j + "  k:  " + k);
              if (emptyFullArray[i, j, k] == 1)
              {
                emptyBool = false;
              }
              if (areaArray[i, j, k] != this.ZoneName)
              {
                sameZone = false;
              }
            }
          }
        }

        if (emptyBool && sameZone)
        {
          Rhino.RhinoApp.WriteLine("Conditions are successful ");
          for(int i = (int) (baseX / CellSize) ; i < (baseX / CellSize + (int) XCell); i++)
          {
            for(int j = (int) (baseY / CellSize); j < baseY / CellSize + (int) YCell; j++)
            {
              for(int k = (int) (baseZ / 150); k < baseZ / 150 + (int) ZCell; k++)
              {
                emptyFullArray[i, j, k] = 1;
              }
            }
          }
        }
        else
        {
          Rhino.RhinoApp.WriteLine("Place Front:  Conditions are not satisfied ");
        }
      }
      else
      {
        Rhino.RhinoApp.WriteLine("Place Front: Conditions are not satisfied ");
      }


      Point3d pointa = new Point3d(baseX, baseY, baseZ);
      Vector3d pointb = new Vector3d(0, 0, 1);

      Plane planebase = new Plane(pointa, pointb);

      Interval xInterval = new Interval(0, this.ObjWidth);
      Interval yInterval = new Interval(0, this.ObjLength);
      Interval zInterval = new Interval(0, this.ObjHeight);

      ObjBox = new Box(planebase, xInterval, yInterval, zInterval);

      xInterval = new Interval(0, this.MrjWidth);
      yInterval = new Interval(0, this.MrjLength);
      zInterval = new Interval(0, this.MrjHeight);

      marginBox = new Box(planebase, xInterval, yInterval, zInterval);
    }


    public void placeRight(int [,,]emptyFullArray, int[,,]areaArray, out Box ObjBox, out Box marginBox)
    {
      bool emptyBool = true;
      bool sameZone = true;

      this.XCell = Math.Ceiling((double) (this.MrjWidth / CellSize));
      this.YCell = Math.Ceiling((double) (this.MrjLength / CellSize));
      this.ZCell = Math.Ceiling((double) (this.MrjHeight / 150));

      this.baseX = PreviousObject.baseX + CellSize * PreviousObject.XCell;
      this.baseY = PreviousObject.baseY;
      this.baseZ = PreviousObject.baseZ;

      if( (baseX + this.ObjWidth < 300) && (baseY + this.ObjLength < 600) && (baseZ + this.ObjHeight < 300) &&
        (baseX + this.ObjWidth > 0) && (baseY + this.ObjLength > 0) && (baseZ + this.ObjHeight > 0) )
      {
        for(int i = (int) (baseX / CellSize) ; i < (baseX / CellSize + (int) XCell); i++)
        {
          for(int j = (int) (baseY / CellSize); j < baseY / CellSize + (int) YCell; j++)
          {
            for(int k = (int) (baseZ / 150); k < baseZ / 150 + (int) ZCell; k++)
            {
              if (emptyFullArray[i, j, k] == 1)
              {
                emptyBool = false;
              }
              if (areaArray[i, j, k] != this.ZoneName)
              {
                sameZone = false;
              }
            }
          }
        }

        if (emptyBool && sameZone)
        {
          Rhino.RhinoApp.WriteLine("Place Right: Conditions are successful ");
          for(int i = (int) (baseX / CellSize) ; i < (baseX / CellSize + (int) XCell); i++)
          {
            for(int j = (int) (baseY / CellSize); j < baseY / CellSize + (int) YCell; j++)
            {
              for(int k = (int) (baseZ / 150); k < baseZ / 150 + (int) ZCell; k++)
              {
                emptyFullArray[i, j, k] = 1;
              }
            }
          }
        }
        else
        {
          Rhino.RhinoApp.WriteLine("Place Right: Conditions are not satisfied ");
        }
      }
      else
      {
        Rhino.RhinoApp.WriteLine("Place Right: Conditions are not satisfied ");
      }

      Point3d pointa = new Point3d(baseX, baseY, baseZ);
      Vector3d pointb = new Vector3d(0, 0, 1);

      Plane planebase = new Plane(pointa, pointb);

      Interval xInterval = new Interval(0, this.ObjWidth);
      Interval yInterval = new Interval(0, this.ObjLength);
      Interval zInterval = new Interval(0, this.ObjHeight);

      ObjBox = new Box(planebase, xInterval, yInterval, zInterval);

      xInterval = new Interval(0, this.MrjWidth);
      yInterval = new Interval(0, this.MrjLength);
      zInterval = new Interval(0, this.MrjHeight);

      marginBox = new Box(planebase, xInterval, yInterval, zInterval);
    }

    public void placeBack(int [,,]emptyFullArray, int[,,]areaArray, out Box ObjBox, out Box marginBox)
    {
      bool emptyBool = true;
      bool sameZone = true;

      this.XCell = Math.Ceiling((double) (this.MrjWidth / CellSize));
      this.YCell = Math.Ceiling((double) (this.MrjLength / CellSize));
      this.ZCell = Math.Ceiling((double) (this.MrjHeight / 150));

      this.baseX = PreviousObject.baseX;
      this.baseY = PreviousObject.baseY - CellSize * this.YCell;
      this.baseZ = PreviousObject.baseZ;

      if( (baseX + this.ObjWidth < 300) && (baseY + this.ObjLength < 600) && (baseZ + this.ObjHeight < 300) &&
        (baseX + this.ObjWidth > 0) && (baseY + this.ObjLength > 0) && (baseZ + this.ObjHeight > 0) )
      {
        for(int i = (int) (baseX / CellSize) ; i < (baseX / CellSize + (int) XCell); i++)
        {
          for(int j = (int) (baseY / CellSize); j < baseY / CellSize + (int) YCell; j++)
          {
            for(int k = (int) (baseZ / 150); k < baseZ / 150 + (int) ZCell; k++)
            {
              if (emptyFullArray[i, j, k] == 1)
              {
                emptyBool = false;
              }
              if (areaArray[i, j, k] != this.ZoneName)
              {
                sameZone = false;
              }
            }
          }
        }

        if (emptyBool && sameZone)
        {
          Rhino.RhinoApp.WriteLine("Place Back: Conditions are successful ");
          for(int i = (int) (baseX / CellSize) ; i < (baseX / CellSize + (int) XCell); i++)
          {
            for(int j = (int) (baseY / CellSize); j < baseY / CellSize + (int) YCell; j++)
            {
              for(int k = (int) (baseZ / 150); k < baseZ / 150 + (int) ZCell; k++)
              {
                emptyFullArray[i, j, k] = 1;
              }
            }
          }
        }
        else
        {
          Rhino.RhinoApp.WriteLine("Place Back: Conditions are not satisfied ");
        }
      }
      else
      {
        Rhino.RhinoApp.WriteLine("Place Back:Conditions are not satisfied ");
      }

      Point3d pointa = new Point3d(baseX, baseY, baseZ);
      Vector3d pointb = new Vector3d(0, 0, 1);

      Plane planebase = new Plane(pointa, pointb);

      Interval xInterval = new Interval(0, this.ObjWidth);
      Interval yInterval = new Interval(0, this.ObjLength);
      Interval zInterval = new Interval(0, this.ObjHeight);

      ObjBox = new Box(planebase, xInterval, yInterval, zInterval);

      xInterval = new Interval(0, this.MrjWidth);
      yInterval = new Interval(0, this.MrjLength);
      zInterval = new Interval(0, this.MrjHeight);

      marginBox = new Box(planebase, xInterval, yInterval, zInterval);
    }

    public void placeLeft(int [,,]emptyFullArray, int[,,]areaArray, out Box ObjBox, out Box marginBox)
    {
      bool emptyBool = true;
      bool sameZone = true;

      this.XCell = Math.Ceiling((double) (this.MrjWidth / CellSize));
      this.YCell = Math.Ceiling((double) (this.MrjLength / CellSize));
      this.ZCell = Math.Ceiling((double) (this.MrjHeight / 150));

      this.baseX = PreviousObject.baseX - CellSize * this.XCell;
      this.baseY = PreviousObject.baseY;
      this.baseZ = PreviousObject.baseZ;

      if( (baseX + this.ObjWidth < 300) && (baseY + this.ObjLength < 600) && (baseZ + this.ObjHeight < 300) &&
        (baseX + this.ObjWidth > 0) && (baseY + this.ObjLength > 0) && (baseZ + this.ObjHeight > 0) )
      {
        for(int i = (int) (baseX / CellSize) ; i < (baseX / CellSize + (int) XCell); i++)
        {
          for(int j = (int) (baseY / CellSize); j < baseY / CellSize + (int) YCell; j++)
          {
            for(int k = (int) (baseZ / 150); k < baseZ / 150 + (int) ZCell; k++)
            {
              if (emptyFullArray[i, j, k] == 1)
              {
                emptyBool = false;
              }
              if (areaArray[i, j, k] != this.ZoneName)
              {
                sameZone = false;
              }
            }
          }
        }

        if (emptyBool && sameZone)
        {
          Rhino.RhinoApp.WriteLine("Place Left: Conditions are successful ");
          for(int i = (int) (baseX / CellSize) ; i < (baseX / CellSize + (int) XCell); i++)
          {
            for(int j = (int) (baseY / CellSize); j < baseY / CellSize + (int) YCell; j++)
            {
              for(int k = (int) (baseZ / 150); k < baseZ / 150 + (int) ZCell; k++)
              {
                emptyFullArray[i, j, k] = 1;
              }
            }
          }
        }
        else
        {
          Rhino.RhinoApp.WriteLine("Place Left: Conditions are not satisfied ");
        }
      }
      else
      {
        Rhino.RhinoApp.WriteLine("Place Left: Conditions are not satisfied ");
      }

      Point3d pointa = new Point3d(baseX, baseY, baseZ);
      Vector3d pointb = new Vector3d(0, 0, 1);

      Plane planebase = new Plane(pointa, pointb);

      Interval xInterval = new Interval(0, this.ObjWidth);
      Interval yInterval = new Interval(0, this.ObjLength);
      Interval zInterval = new Interval(0, this.ObjHeight);

      ObjBox = new Box(planebase, xInterval, yInterval, zInterval);

      xInterval = new Interval(0, this.MrjWidth);
      yInterval = new Interval(0, this.MrjLength);
      zInterval = new Interval(0, this.MrjHeight);

      marginBox = new Box(planebase, xInterval, yInterval, zInterval);
    }
    public void placeTop(int [,,]emptyFullArray, int[,,]areaArray, out Box ObjBox, out Box marginBox)
    {
      bool emptyBool = true;
      bool sameZone = true;

      this.XCell = Math.Ceiling((double) (this.MrjWidth / CellSize));
      this.YCell = Math.Ceiling((double) (this.MrjLength / CellSize));
      this.ZCell = Math.Ceiling((double) (this.MrjHeight / 150));

      this.baseX = PreviousObject.baseX;
      this.baseY = PreviousObject.baseY;
      this.baseZ = PreviousObject.baseZ + CellSize * PreviousObject.ZCell;

      if( (baseX + this.ObjWidth < 300) && (baseY + this.ObjLength < 600) && (baseZ + this.ObjHeight < 300) &&
        (baseX + this.ObjWidth > 0) && (baseY + this.ObjLength > 0) && (baseZ + this.ObjHeight > 0) )
      {
        for(int i = (int) (baseX / CellSize) ; i < (baseX / CellSize + (int) XCell); i++)
        {
          for(int j = (int) (baseY / CellSize); j < baseY / CellSize + (int) YCell; j++)
          {
            for(int k = (int) (baseZ / 150); k < baseZ / 150 + (int) ZCell; k++)
            {
              if (emptyFullArray[i, j, k] == 1)
              {
                emptyBool = false;
              }
              if (areaArray[i, j, k] != this.ZoneName)
              {
                sameZone = false;
              }
            }
          }
        }

        if (emptyBool && sameZone)
        {
          Rhino.RhinoApp.WriteLine("Conditions are successful ");
          for(int i = (int) (baseX / CellSize) ; i < (baseX / CellSize + (int) XCell); i++)
          {
            for(int j = (int) (baseY / CellSize); j < baseY / CellSize + (int) YCell; j++)
            {
              for(int k = (int) (baseZ / 150); k < baseZ / 150 + (int) ZCell; k++)
              {
                emptyFullArray[i, j, k] = 1;
              }
            }
          }
        }
        else
        {
          Rhino.RhinoApp.WriteLine("Conditions are not satisfied ");
        }
      }
      else
      {
        Rhino.RhinoApp.WriteLine("Conditions are not satisfied ");
      }

      Point3d pointa = new Point3d(baseX, baseY, baseZ);
      Vector3d pointb = new Vector3d(0, 0, 1);

      Plane planebase = new Plane(pointa, pointb);

      Interval xInterval = new Interval(0, this.ObjWidth);
      Interval yInterval = new Interval(0, this.ObjLength);
      Interval zInterval = new Interval(0, this.ObjHeight);

      ObjBox = new Box(planebase, xInterval, yInterval, zInterval);

      xInterval = new Interval(0, this.MrjWidth);
      yInterval = new Interval(0, this.MrjLength);
      zInterval = new Interval(0, this.MrjHeight);

      marginBox = new Box(planebase, xInterval, yInterval, zInterval);
    }

    public void placeBottom(int [,,]emptyFullArray, int[,,]areaArray, out Box ObjBox, out Box marginBox)
    {
      bool emptyBool = true;
      bool sameZone = true;

      this.XCell = Math.Ceiling((double) (this.MrjWidth / CellSize));
      this.YCell = Math.Ceiling((double) (this.MrjLength / CellSize));
      this.ZCell = Math.Ceiling((double) (this.MrjHeight / 150));

      this.baseX = PreviousObject.baseX;
      this.baseY = PreviousObject.baseY;
      this.baseZ = PreviousObject.baseZ - CellSize * this.ZCell;

      if( (baseX + this.ObjWidth < 300) && (baseY + this.ObjLength < 600) && (baseZ + this.ObjHeight < 300) &&
        (baseX + this.ObjWidth > 0) && (baseY + this.ObjLength > 0) && (baseZ + this.ObjHeight > 0) )
      {
        for(int i = (int) (baseX / CellSize) ; i < (baseX / CellSize + (int) XCell); i++)
        {
          for(int j = (int) (baseY / CellSize); j < baseY / CellSize + (int) YCell; j++)
          {
            for(int k = (int) (baseZ / 150); k < baseZ / 150 + (int) ZCell; k++)
            {
              if (emptyFullArray[i, j, k] == 1)
              {
                emptyBool = false;
              }
              if (areaArray[i, j, k] != this.ZoneName)
              {
                sameZone = false;
              }
            }
          }
        }

        if (emptyBool && sameZone)
        {
          Rhino.RhinoApp.WriteLine("Conditions are successful ");
          for(int i = (int) (baseX / CellSize) ; i < (baseX / CellSize + (int) XCell); i++)
          {
            for(int j = (int) (baseY / CellSize); j < baseY / CellSize + (int) YCell; j++)
            {
              for(int k = (int) (baseZ / 150); k < baseZ / 150 + (int) ZCell; k++)
              {
                emptyFullArray[i, j, k] = 1;
              }
            }
          }
        }
        else
        {
          Rhino.RhinoApp.WriteLine("Conditions are not satisfied ");
        }
      }
      else
      {
        Rhino.RhinoApp.WriteLine("Conditions are not satisfied ");
      }

      Point3d pointa = new Point3d(baseX, baseY, baseZ);
      Vector3d pointb = new Vector3d(0, 0, 1);

      Plane planebase = new Plane(pointa, pointb);

      Interval xInterval = new Interval(0, this.ObjWidth);
      Interval yInterval = new Interval(0, this.ObjLength);
      Interval zInterval = new Interval(0, this.ObjHeight);

      ObjBox = new Box(planebase, xInterval, yInterval, zInterval);

      xInterval = new Interval(0, this.MrjWidth);
      yInterval = new Interval(0, this.MrjLength);
      zInterval = new Interval(0, this.MrjHeight);

      marginBox = new Box(planebase, xInterval, yInterval, zInterval);
    }

    public void placeObject(int [,,]emptyFullArray, int[,,]areaArray, out Box ObjBox, out Box marginBox)
    {

      Point3d pointa = new Point3d(baseX, baseY, baseZ);
      Vector3d pointb = new Vector3d(0, 0, 1);

      Plane planebase = new Plane(pointa, pointb);

      Interval xInterval = new Interval(0, this.ObjWidth);
      Interval yInterval = new Interval(0, this.ObjLength);
      Interval zInterval = new Interval(0, this.ObjHeight);

      ObjBox = new Box(planebase, xInterval, yInterval, zInterval);

      xInterval = new Interval(0, this.MrjWidth);
      yInterval = new Interval(0, this.MrjLength);
      zInterval = new Interval(0, this.MrjHeight);

      marginBox = new Box(planebase, xInterval, yInterval, zInterval);

      List<int> growDirection = new List<int>();

      if(PreviousObject.Front == true)
        growDirection.Add(1); // Front Direction
      if(PreviousObject.Right == true)
        growDirection.Add(2); // Right Direction
      if(PreviousObject.Back == true)
        growDirection.Add(3); // Back Direction
      if(PreviousObject.Left == true)
        growDirection.Add(4); // Left Direction
      if(PreviousObject.Bottom == true)
        growDirection.Add(5); // Bottom Direction
      if(PreviousObject.Top == true)
        growDirection.Add(6); // Right Direction

      bool placeSuccess = false;
      int tryCounter = 0;

      if(growDirection.Count >= 1)
      {
        Random randm = new Random();

        while(placeSuccess == false )
        {
          int a = randm.Next(0, growDirection.Count);
          int randomMethod = growDirection[a];

          switch (a)
          ​{
            case 1:
              this.placeFront(emptyFullArray, areaArray, out  ObjBox, out marginBox);
              placeSuccess = true;
              break;
            case 2:
              this.placeRight(emptyFullArray, areaArray, out  ObjBox, out marginBox);
              placeSuccess = true;
              break;
            case 3:
              this.placeBack(emptyFullArray, areaArray, out  ObjBox, out marginBox);
              placeSuccess = true;
              break;
            case 4:
              this.placeLeft(emptyFullArray, areaArray, out  ObjBox, out marginBox);
              placeSuccess = true;
              break;
            case 5:
              this.placeBottom(emptyFullArray, areaArray, out  ObjBox, out marginBox);
              placeSuccess = true;
              break;
            case 6:
              this.placeTop(emptyFullArray, areaArray, out  ObjBox, out marginBox);
              placeSuccess = true;
              break;

            default:
              tryCounter++;
              break;
            // default statements
          }


        }
        growDirection.Clear();




      }


    }


    public void rotate()
    {

    }



    static void mirror()
    {

    }

    static void getClosestCell()
    {

    }

    static void createWall()
    {

    }

  }

  static void ShowMatrix(int[,,] Arr)
  {
    for (int i = 0; i < Arr.GetLength(0); i++)
    {
      for (int j = 0; j < Arr.GetLength(1); j++)
      {
        Rhino.RhinoApp.Write(Arr[i, j, 0] + " ");
      }
      Rhino.RhinoApp.WriteLine("Loop Runs" + i.ToString());
    }
    return;
  }

  static int[,,] InitializeZeroMatrice(int width, int length, int levelNumber)
  {
    var areaArray = new int[width, length, levelNumber];

    for (int k = 0; k < levelNumber; k++)
    {
      for (int i = 0; i < width; i++)
      {
        for (int j = 0; j < length; j++)
        {
          areaArray[i, j, k] = 0;
        }
      }
    }
    return areaArray;
  }

  /* The Color lists keep the colors in a seperate List in order to choose within them easily instead of searching where they are... */
  static List<int> entranceList = new List<int>();
  static List<int> commonList = new List<int>();
  static List<int> wetAreaList = new List<int>();
 /* static List<int> kitchenList = new List<int>();
  static List<int> commonAreaList = new List<int>();*/

  /**           these counters are used for starting the límitations counts.         **/

  static int entranceCounter = 1;
  static int commonCounter = 1;
  static int wetAreaCounter = 1;
  /*static int kitchenCounter = 1;
  static int commonAreaCounter = 1;*/
  /**           these limits are used for defining max distance that zone can spread.  **/

  static int entranceLimit = 2500;
  static int commonLimit = 400;
  static int wetAreaLimit = 300;
  /*static int kitchenLimit = 200;
  static int commonAreaLimit = 100;*/

  static void StartZones(int[,,] arr)
  {
    /**
     * Randomly Starts the color. Takes the Color lists as argumnts
     * (We can delete these argumnents and it can get them as local referance
     * in our case it gives us a chance to choose what to initilize)
     * **/

    Random rand = new Random();
    //----------------------
    /* GetLength(0) and GetLength(1) might be set as variable */
    //Array.GetLength(0) gives the column lenght in other words length of an array
    //Array.GetLength(1) gives the row lenght in other words width of an array
    var a = rand.Next(arr.GetLength(0) / 2, arr.GetLength(0) / 2);
    var b = rand.Next(0, 2);

    Rhino.RhinoApp.WriteLine("started");
    entranceList.AddRange(new int[2] { a, b }); //AddRange ==> Adds multiple elements to a List . We use mod%2 to call the index of the point back instead of stacking them as an another List(or Array) in our list.
    arr[a, b, 0] = 1;// entrance Starting Point
    //----------------------

    b = rand.Next(0, arr.GetLength(1));
    a = rand.Next(0, arr.GetLength(0));

    commonList.AddRange(new int[2] { a, b });
    arr[a, b, 0] = 2; // common Starting Point
    //----------------------
    a = rand.Next(0, arr.GetLength(0));
    b = rand.Next(0, arr.GetLength(1));

    wetAreaList.AddRange(new int[2] { a, b });
    arr[a, b, 0] = 3; // wetArea Starting Point
    //----------------------
    a = rand.Next(0, arr.GetLength(0));
    b = rand.Next(0, arr.GetLength(1));
/*
    kitchenList.AddRange(new int[2] { a, b });
    arr[a, b, 0] = 4; // kitchen Starting Point
    //----------------------
    a = rand.Next(0, arr.GetLength(0));
    b = rand.Next(0, arr.GetLength(1));

    commonAreaList.AddRange(new int[2] { a, b });
    arr[a, b, 0] = 5; // commonArea Starting Point
    //----------------------
  */
  }
        /* Calculates the distance between initial point in the color and the possible new point!
         *  (if the possible new point is too far from inital point eleminate it.) */
  static double distanceCalculate(List<int> spaceCoordList, int x2, int y2, int cellSize)
  {
    var distance = cellSize * Math.Sqrt((y2 - spaceCoordList[1]) * (y2 - spaceCoordList[1]) + (x2 - spaceCoordList[0]) * (x2 - spaceCoordList[0]));
    return distance;
  }

  static void Evaluate()
  {
    // according to relations give score to the created zones
    // get the centers of the zones and acoording to the distances and created sizes give
    //positive or negative points and if score is not acceptable re-run and create variatians.
  }


  static void noiseFilter (int [,,] arr, int type, int iterationNumber, int controlNumber)
  {
    if(type == 0)
    {
      for( int loop = 0 ; loop < iterationNumber ; loop++ )
      {
        List < int> surrounding = new List<int>();
        for(int i = 1 ; i < arr.GetLength(0) - 1 ;i++)
        {
          for(int j = 1 ; j < arr.GetLength(1) - 1 ;j++)
          {
            for(int x = -1 ; x < 2;x++)
            {
              for(int y = -1 ; y < 2;y++)
              {
                if(!(x == y && x == 0))
                {

                  surrounding.Add(arr[i + x, j + y, 0]);
                }
              }
            }
            for (int v = 0 ; v < 6 ;v++) // 6 is the number of the zones including  empty cells
            {
              int count = (from z in surrounding where z == v select z).Count();
              if ( count >= controlNumber )
              {
                arr[i, j, 0] = v;
              }
            }
            surrounding.Clear();
            surrounding.TrimExcess();
          }
        }
      }
    }

    if(type == 1)
    {
      for( int loop = 0 ; loop < iterationNumber ; loop++ )
      {
        List < int> surrounding = new List<int>();
        for(int i = 1 ; i < arr.GetLength(0) - 1 ;i++)
        {
          for(int j = 1 ; j < arr.GetLength(1) - 1 ;j++)
          {
            for(int x = -1 ; x < 2;x++)
            {
              for(int y = -1 ; y < 2;y++)
              {
                if(!(x == y && x == 0) && ( (x + y == 1 ) || (x + y == -1 )) )
                {
                  surrounding.Add(arr[i + x, j + y, 0]);
                }
              }
            }

            for (int v = 0 ; v < 6 ;v++) // 6 is the number of the zones including  empty cells
            {
              int count = (from z in surrounding where z == v select z).Count();
              if ( count >= 2 )
              {
                arr[i, j, 0] = v;
              }
            }
            surrounding.Clear();
            surrounding.TrimExcess();
          }
        }
      }
    }
  }

  static void Spread(int[,,] arr, ref double spaceSize, List<int> spaceCoordList, ref int counter, int spaceLimit, int cellSize)
  {
        /*ARGUMENTS
     * The main array which has rectangular form(will be 3d in short) ,
     * spaceSize = Maximum limit that can grow.  ,
     * spaceCoordList =  the cells of the zone which has been already defined. )
     */
    var rand = new Random();
    var directionList = new List<int>();
    int Xcoord;
    int Ycoord;
    bool draw = false;
    int trycount = 0;

    while (draw == false && counter <= spaceSize)
    {
      if (counter <= spaceSize ) //Can be deleted. The condition is added to the While Loop Conditions.
      {
        var randomCellIndex = rand.Next(spaceCoordList.Count / 2);

        Xcoord = spaceCoordList[2 * randomCellIndex];
        Ycoord = spaceCoordList[2 * randomCellIndex + 1];

        if (Xcoord < arr.GetLength(0) - 1 && Xcoord > 0 && Ycoord > 0 && Ycoord < arr.GetLength(1) - 1)
        {
          /* Check the conditions INSIDE borders */
          if (arr[Xcoord + 1, Ycoord, 0] == 0 && distanceCalculate(spaceCoordList, Xcoord + 1, Ycoord, cellSize) < spaceLimit ) // Check if possible new cell is still white or not!
            directionList.AddRange(new int[2] { (Xcoord + 1), Ycoord }); //Store possible spread directions in a list.

          if (arr[Xcoord - 1, Ycoord, 0] == 0 && distanceCalculate(spaceCoordList, Xcoord - 1, Ycoord, cellSize) < spaceLimit)
            directionList.AddRange(new int[2] { (Xcoord - 1), Ycoord }); //Store possible spread directions in a list.

          if (arr[Xcoord, Ycoord + 1, 0] == 0 && distanceCalculate(spaceCoordList, Xcoord, Ycoord + 1, cellSize) < spaceLimit)
            directionList.AddRange(new int[2] { (Xcoord), Ycoord + 1 }); //Store possible spread directions in a list.

          if (arr[Xcoord, Ycoord - 1, 0] == 0 && distanceCalculate(spaceCoordList, Xcoord, Ycoord - 1, cellSize) < spaceLimit)
            directionList.AddRange(new int[2] { (Xcoord), (Ycoord - 1) }); //Store possible spread directions in a list.

          if (directionList.Count > 0)
          {
            var randomIndex = rand.Next(directionList.Count / 2);
            int a = directionList[2 * randomIndex];
            int b = directionList[2 * randomIndex + 1];

            arr[a, b, 0] = arr[Xcoord, Ycoord, 0];

            spaceCoordList.AddRange(new int[2] { a, b });

            directionList.Clear();
            directionList.TrimExcess();
            draw = true;
            counter++;
          }
          else
          {
            trycount++;
            if (trycount >= spaceCoordList.Count)
            {
              draw = true;
              //Print("trycountNumber is ={0}", trycount);
            }
          }
        }

          /* EDGE CONDITIONS */
          //RIGHT
        else if (Xcoord == (arr.GetLength(0) - 1) && Ycoord != 0 && Ycoord != (arr.GetLength(1) - 1))
        {
          if (arr[Xcoord - 1, Ycoord, 0] == 0 && distanceCalculate(spaceCoordList, Xcoord - 1, Ycoord, cellSize) < spaceLimit )
            directionList.AddRange(new int[2] { (Xcoord - 1), (Ycoord) }); //Store possible spread directions in a list.
          if (arr[Xcoord, Ycoord + 1, 0] == 0 && distanceCalculate(spaceCoordList, Xcoord, Ycoord + 1, cellSize) < spaceLimit )
            directionList.AddRange(new int[2] { (Xcoord ), (Ycoord + 1) }); //Store possible spread directions in a list.
          if (arr[Xcoord, Ycoord - 1, 0] == 0 && distanceCalculate(spaceCoordList, Xcoord, Ycoord - 1, cellSize) < spaceLimit )
            directionList.AddRange(new int[2] { (Xcoord ), (Ycoord - 1) }); //Store possible spread directions in a list.

          if (directionList.Count > 0)
          {
            var randomIndex = rand.Next(directionList.Count / 2);
            int a = directionList[2 * randomIndex];
            int b = directionList[2 * randomIndex + 1];

            arr[a, b, 0] = arr[Xcoord, Ycoord, 0];

            spaceCoordList.AddRange(new int[2] { a, b });

            directionList.Clear();
            directionList.TrimExcess();
            draw = true;
            counter++;
          }
          else
          {
            trycount++;
            if (trycount >= spaceCoordList.Count)
            {
              draw = true;
              //Print("trycountNumber is ={0}", trycount);
            }
          }
        }

          //Left
        else if (Xcoord == 0 && Ycoord != 0 && Ycoord != (arr.GetLength(1) - 1))
        {

          if (arr[Xcoord + 1, Ycoord, 0] == 0 && distanceCalculate(spaceCoordList, Xcoord + 1, Ycoord, cellSize) < spaceLimit )
            directionList.AddRange(new int[2] { (Xcoord + 1), (Ycoord) }); //Store possible spread directions in a list.
          if (arr[Xcoord, Ycoord + 1, 0] == 0 && distanceCalculate(spaceCoordList, Xcoord, Ycoord + 1, cellSize) < spaceLimit )
            directionList.AddRange(new int[2] { (Xcoord ), (Ycoord + 1) }); //Store possible spread directions in a list.
          if (arr[Xcoord, Ycoord - 1, 0] == 0 && distanceCalculate(spaceCoordList, Xcoord, Ycoord - 1, cellSize) < spaceLimit )
            directionList.AddRange(new int[2] { (Xcoord ), (Ycoord - 1) }); //Store possible spread directions in a list.
          if (directionList.Count > 0)
          {
            var randomIndex = rand.Next(directionList.Count / 2);
            int a = directionList[2 * randomIndex];
            int b = directionList[2 * randomIndex + 1];

            arr[a, b, 0] = arr[Xcoord, Ycoord, 0];

            spaceCoordList.AddRange(new int[2] { a, b });

            directionList.Clear();
            directionList.TrimExcess();
            draw = true;
            counter++;
          }
          else
          {
            trycount++;
            if (trycount >= spaceCoordList.Count)
            {
              draw = true;
              //Print("trycountNumber is ={0}", trycount);
            }
          }

        }
          //TOP
        else if ((Ycoord == arr.GetLength(1) - 1) && Xcoord != 0 && Xcoord != (arr.GetLength(0) - 1))
        {

          if (arr[Xcoord, Ycoord - 1, 0] == 0 && distanceCalculate(spaceCoordList, Xcoord, Ycoord - 1, cellSize) < spaceLimit )
            directionList.AddRange(new int[2] { (Xcoord ), (Ycoord - 1) }); //Store possible spread directions in a list.
          if (arr[Xcoord + 1, Ycoord, 0] == 0 && distanceCalculate(spaceCoordList, Xcoord + 1, Ycoord, cellSize) < spaceLimit )
            directionList.AddRange(new int[2] { (Xcoord + 1 ), (Ycoord ) }); //Store possible spread directions in a list.
          if (arr[Xcoord - 1, Ycoord, 0] == 0 && distanceCalculate(spaceCoordList, Xcoord - 1, Ycoord, cellSize) < spaceLimit )
            directionList.AddRange(new int[2] { (Xcoord - 1), (Ycoord ) }); //Store possible spread directions in a list.
          if (directionList.Count > 0)
          {
            var randomIndex = rand.Next(directionList.Count / 2);
            int a = directionList[2 * randomIndex];
            int b = directionList[2 * randomIndex + 1];

            arr[a, b, 0] = arr[Xcoord, Ycoord, 0];

            spaceCoordList.AddRange(new int[2] { a, b });

            directionList.Clear();
            directionList.TrimExcess();
            draw = true;
            counter++;
          }
          else
          {
            trycount++;
            if (trycount >= spaceCoordList.Count)
            {
              draw = true;
              //Print("trycountNumber is ={0}", trycount);
            }
          }
        }
          //BOTTOM
        else if (Ycoord == 0 && Xcoord != 0 && Xcoord != (arr.GetLength(0) - 1))
        {
          if (arr[Xcoord, Ycoord + 1, 0] == 0 && distanceCalculate(spaceCoordList, Xcoord, Ycoord + 1, cellSize) < spaceLimit )
            directionList.AddRange(new int[2] { (Xcoord ), (Ycoord + 1) }); //Store possible spread directions in a list.
          if (arr[Xcoord + 1, Ycoord, 0] == 0 && distanceCalculate(spaceCoordList, Xcoord + 1, Ycoord, cellSize) < spaceLimit )
            directionList.AddRange(new int[2] { (Xcoord + 1 ), (Ycoord ) }); //Store possible spread directions in a list.
          if (arr[Xcoord - 1, Ycoord, 0] == 0 && distanceCalculate(spaceCoordList, Xcoord - 1, Ycoord, cellSize) < spaceLimit )
            directionList.AddRange(new int[2] { (Xcoord - 1), (Ycoord ) }); //Store possible spread directions in a list.
          if (directionList.Count > 0)
          {
            var randomIndex = rand.Next(directionList.Count / 2);
            int a = directionList[2 * randomIndex];
            int b = directionList[2 * randomIndex + 1];

            arr[a, b, 0] = arr[Xcoord, Ycoord, 0];

            spaceCoordList.AddRange(new int[2] { a, b });

            directionList.Clear();
            directionList.TrimExcess();
            draw = true;
            counter++;
          }
          else
          {
            trycount++;
            if (trycount >= spaceCoordList.Count)
            {
              draw = true;
              //Print("trycountNumber is ={0}", trycount);
            }
          }
        }

          //LEFT BOTTOM
        else if (Xcoord == 0 && Ycoord == 0)
        {
          if (arr[Xcoord, Ycoord + 1, 0] == 0 && distanceCalculate(spaceCoordList, Xcoord, Ycoord + 1, cellSize) < spaceLimit)
            directionList.Add(Xcoord); directionList.Add(Ycoord + 1);

          if (arr[Xcoord + 1, Ycoord, 0] == 0 && distanceCalculate(spaceCoordList, Xcoord + 1, Ycoord, cellSize) < spaceLimit)
            directionList.Add(Xcoord + 1); directionList.Add(Ycoord);

          if (directionList.Count > 0)
          {

            var randomIndex = rand.Next(directionList.Count / 2);

            int a = directionList[2 * randomIndex];
            int b = directionList[2 * randomIndex + 1];

            arr[a, b, 0] = arr[Xcoord, Ycoord, 0];

            spaceCoordList.AddRange(new int[2] { a, b });

            directionList.Clear();
            directionList.TrimExcess();
            draw = true;

            counter++;
            //Print(" Counter Number is : {0}", counter);
          }
          else
          {
            trycount++;
            if (trycount >= spaceCoordList.Count)
            {
              draw = true;
              //Print("trycountNumber is ={0}", trycount);
            }
          }
        }
          //LEFT  TOP
          /*
          else if (Xcoord == 0 && Ycoord == (arr.GetLength(1) - 1))
          {
          if (arr[Xcoord + 1, Ycoord] == 0)
          directionList.Add(Xcoord + 1); directionList.Add(Ycoord);

          if (arr[Xcoord, Ycoord - 1] == 0)
          directionList.Add(Xcoord); directionList.Add(Ycoord - 1);

          if (directionList.Count > 0)
          {
          var randomIndex = rand.Next(directionList.Count / 2);

          int a = directionList[2 * randomIndex];
          int b = directionList[2 * randomIndex + 1];

          Rhino.RhinoApp.WriteLine("Left Top "  +  a +  " "  +  b);
          arr[a, b] = arr[Xcoord, Ycoord];

          spaceCoordList.AddRange(new int[2] { a, b });

          directionList.Clear();
          directionList.TrimExcess();
          draw = true;

          counter++;
          //Print(" Counter Number is : {0}", counter);
          }
          else
          {
          trycount++;
          if (trycount >= spaceCoordList.Count)
          {
          draw = true;
          //Print("trycountNumber is ={0}", trycount);
          }
          }
          }
          */
          /*
          //RIGHT TOP
          else if (Xcoord == (arr.GetLength(0) - 1) && Ycoord == (arr.GetLength(1) - 1))
          {
          if (arr[Xcoord, Ycoord - 1] == 0)
          directionList.Add(Xcoord); directionList.Add(Ycoord - 1);

          if (arr[Xcoord - 1, Ycoord] == 0)
          directionList.Add(Xcoord - 1); directionList.Add(Ycoord);

          if (directionList.Count > 0)
          {
          var randomIndex = rand.Next(directionList.Count / 2);

          int a = directionList[2 * randomIndex];
          int b = directionList[2 * randomIndex + 1];
          Rhino.RhinoApp.WriteLine(" Right top "+ a + " " + b);
          arr[a, b] = arr[Xcoord, Ycoord];

          //spaceCoordList.AddRange(new int[2] { a, b });

          directionList.Clear();
          directionList.TrimExcess();
          draw = true;

          counter++;
          //Print(" Counter Number is : {0}", counter);
          }
          else
          {
          trycount++;
          if (trycount >= spaceCoordList.Count)
          {
          draw = true;
          //Print("trycountNumber is ={0}", trycount);
          }
          }
          }
          */
          //RIGHT BOTTOM
        else if (Xcoord == (arr.GetLength(0) - 1) && Ycoord == 0)
        {
          if (arr[Xcoord, Ycoord + 1, 0] == 0)
            directionList.Add(Xcoord); directionList.Add(Ycoord + 1);

          if (arr[Xcoord - 1, Ycoord, 0] == 0)
            directionList.Add(Xcoord - 1); directionList.Add(Ycoord);

          if (directionList.Count > 0)
          {
            var randomIndex = rand.Next(directionList.Count / 2);

            int a = directionList[2 * randomIndex];
            int b = directionList[2 * randomIndex + 1];

            arr[a, b, 0] = arr[Xcoord, Ycoord, 0];

            spaceCoordList.AddRange(new int[2] { a, b });

            directionList.Clear();
            directionList.TrimExcess();

            draw = true;
            counter++;
            //Print(" Counter Number is : {0}", counter);
          }
          else
          {
            trycount++;
            if (trycount >= spaceCoordList.Count)
            {
              draw = true;
              //Print("trycountNumber is ={0}", trycount);
            }
          }
        }
        /* EDGE CONDITIONS */
      }
    }

  }




    /* Instead of wrting methods seperately in main program, it is better to use class based
     informations to keep things organized, we are not yet transsferentrance methods here but we created the str.*/

    /*
    public class Zone
    {
        public string Name;
        public int SpaceLimit;
        public Int16 SpaceSize;
        public int Counter;
        public List<Int16> SpaceList;

        public void Describe()
        {
            Console.WriteLine("Hey this zone is{ 0} ", Name);
        }

        public Zone()
        {
           // SpaceList = new List<int>();
        }

        public Zone(string name, int spaceLimit,int spacesize,int counter, List<int> SpaceList)
        :this()
        {
        }
        static void InitializeZeroMatrice() { }
        static void startZones() { }
        public void SpreadZones() { }

    }
    */
# ---------- end c_script_5 ----------
box_58 = Box(c_script_5.Furnitures)  # disabled
deconstruct_box_23 = DeconstructBox(Box=box_58)  # -> Plane, X, Y, Z; disabled
panel_84 = Panel(deconstruct_box_23.Plane)  # disabled
panel_85 = Panel(deconstruct_box_23.Y)  # disabled
panel_86 = Panel(deconstruct_box_23.X)  # disabled
panel_87 = Panel(deconstruct_box_23.Z)  # disabled
boolean_toggle_2 = BooleanToggle(False)  # disabled
deconstruct_domain_40 = DeconstructDomain(Domain=panel_81)  # -> Start, End; disabled
deconstruct_domain_41 = DeconstructDomain(Domain=panel_83)  # -> Start, End; disabled
deconstruct_domain_42 = DeconstructDomain(Domain=panel_82)  # -> Start, End; disabled
deconstruct_domain_43 = DeconstructDomain(Domain=panel_85)  # -> Start, End; disabled
deconstruct_domain_44 = DeconstructDomain(Domain=panel_86)  # -> Start, End; disabled
box_59 = Box(c_script_5.Bxx)  # disabled
panel_88 = Panel(deconstruct_domain_41.End)  # disabled
panel_89 = Panel(deconstruct_domain_40.End)  # disabled
panel_90 = Panel(deconstruct_domain_42.End)  # disabled
panel_91 = Panel(box_59)  # disabled
panel_92 = Panel(deconstruct_domain_43.End)  # disabled
panel_93 = Panel(deconstruct_domain_44.End)  # disabled
list_item_3 = ListItem(List=c_script_5.Furnitures, Index=number_slider_34, Wrap=boolean_toggle_2)  # disabled
# Inıtıalıze
panel_94 = Panel(c_script_5.out)  # disabled
number_slider_35 = Slider(0, range=0..1)  # disabled
number_slider_36 = Slider(0.611, range=0..1)  # disabled
number_slider_37 = Slider(0.544, range=0..1)  # disabled
colour_swatch_15 = ColourSwatch(SwatchColor=RGB(0, 0, 0))  # disabled
colour_swatch_16 = ColourSwatch(SwatchColor=RGB(0, 0, 0))  # disabled
colour_swatch_17 = ColourSwatch(SwatchColor=RGB(255, 255, 0))  # disabled
colour_swatch_18 = ColourSwatch(SwatchColor=RGB(0, 0, 0))  # disabled
colour_swatch_19 = ColourSwatch(SwatchColor=RGB(255, 255, 255))  # disabled
colour_swatch_20 = ColourSwatch(SwatchColor=RGB(240, 240, 200))  # disabled
colour_swatch_21 = ColourSwatch(SwatchColor=RGB(240, 200, 200))  # disabled
colour_swatch_22 = ColourSwatch(SwatchColor=RGB(150, 200, 255))  # disabled

# ---- group: Visualize as 3D Boxes
number_slider_38 = Slider(0.428, range=0..1)  # disabled
create_material_17 = CreateMaterial(Diffuse=colour_swatch_20, Specular=RGB(255, 255, 255), Emission=RGB(0, 0, 0), Transparency=number_slider_38, Shine=0)  # disabled
create_material_18 = CreateMaterial(Diffuse=colour_swatch_17, Specular=RGB(255, 255, 255), Emission=RGB(0, 0, 0), Transparency=number_slider_38, Shine=0)  # disabled
create_material_19 = CreateMaterial(Diffuse=colour_swatch_21, Specular=RGB(255, 255, 255), Emission=RGB(0, 0, 0), Transparency=number_slider_38, Shine=0)  # disabled
create_material_20 = CreateMaterial(Diffuse=colour_swatch_22, Specular=RGB(255, 255, 255), Emission=RGB(0, 0, 0), Transparency=number_slider_38, Shine=0)  # disabled
create_material_21 = CreateMaterial(Diffuse=colour_swatch_18, Specular=RGB(255, 255, 255), Emission=RGB(0, 0, 0), Transparency=number_slider_38, Shine=0)  # disabled
create_material_22 = CreateMaterial(Diffuse=colour_swatch_19, Specular=RGB(255, 255, 255), Emission=RGB(0, 0, 0), Transparency=number_slider_37, Shine=0)  # disabled
custom_preview_13 = CustomPreview(Geometry=c_script_5.EntranceBoxes, Material=create_material_17)  # disabled
custom_preview_14 = CustomPreview(Geometry=c_script_5.CommonBoxes, Material=create_material_19)  # disabled
custom_preview_15 = CustomPreview(Geometry=c_script_5.WetAreaBoxes, Material=create_material_20)  # disabled
custom_preview_16 = CustomPreview(Geometry=c_script_5.K, Material=create_material_21)  # disabled
custom_preview_17 = CustomPreview(Geometry=c_script_5.W, Material=create_material_22)  # disabled
custom_preview_18 = CustomPreview(Geometry=c_script_5.Y, Material=create_material_18)  # disabled

# ----
create_material_23 = CreateMaterial(Diffuse=colour_swatch_15, Specular=RGB(255, 255, 255), Emission=RGB(0, 0, 0), Transparency=number_slider_35, Shine=0)  # disabled
create_material_24 = CreateMaterial(Diffuse=colour_swatch_16, Specular=RGB(255, 255, 255), Emission=RGB(0, 0, 0), Transparency=number_slider_36, Shine=0)  # disabled
custom_preview_19 = CustomPreview(Geometry=c_script_5.Furnitures, Material=create_material_23)  # disabled
custom_preview_20 = CustomPreview(Geometry=c_script_5.FurnituresMargins, Material=create_material_24)  # disabled
list_length_7 = ListLength(List=c_script_5.EntranceBoxes)  # disabled
list_length_8 = ListLength(List=c_script_5.CommonBoxes)  # disabled
list_length_9 = ListLength(List=c_script_5.W)  # disabled
list_length_10 = ListLength(List=c_script_5.WetAreaBoxes)  # disabled
list_length_11 = ListLength(List=c_script_5.Y)  # disabled
list_length_12 = ListLength(List=c_script_5.K)  # disabled
multiplication_26 = Multiplication(A=list_length_8, B=division_10)  # disabled
multiplication_27 = Multiplication(A=list_length_7, B=division_10)  # disabled
multiplication_28 = Multiplication(A=list_length_9, B=division_10)  # disabled
multiplication_29 = Multiplication(A=list_length_10, B=division_10)  # disabled
multiplication_30 = Multiplication(A=list_length_11, B=division_10)  # disabled
multiplication_31 = Multiplication(A=list_length_12, B=division_10)  # disabled
panel_95 = Panel("m2 ")  # disabled
panel_96 = Panel(multiplication_27)  # disabled
panel_97 = Panel(" Entrance = ")  # disabled
panel_98 = Panel(" Empty Space= ")  # disabled
panel_99 = Panel(multiplication_28)  # disabled
panel_100 = Panel("m2 ")  # disabled
panel_101 = Panel("m2 ")  # disabled
panel_102 = Panel(multiplication_26)  # disabled
panel_103 = Panel(" CommonArea = ")  # disabled
panel_104 = Panel("m2 ")  # disabled
panel_105 = Panel(multiplication_29)  # disabled
panel_106 = Panel("Wet Area = ")  # disabled
panel_107 = Panel(multiplication_30)  # disabled
panel_108 = Panel(" Common Area = ")  # disabled
panel_109 = Panel("m2 ")  # disabled
panel_110 = Panel(" Kitchen = ")  # disabled
panel_111 = Panel(" m2 ")  # disabled
panel_112 = Panel(multiplication_31)  # disabled
number_slider_39 = Slider(15, range=0..100)  # disabled
concatenate_8 = Concatenate(Fragment_A=panel_98, Fragment_B=panel_99, Fragment_C=panel_101)  # disabled
concatenate_9 = Concatenate(Fragment_A=panel_97, Fragment_B=panel_96, Fragment_C=panel_95)  # disabled
panel_113 = Panel("0,-50")  # disabled
concatenate_10 = Concatenate(Fragment_A=panel_103, Fragment_B=panel_102, Fragment_C=panel_100)  # disabled
panel_114 = Panel("0,-80")  # disabled
panel_115 = Panel("0,-140")  # disabled
concatenate_11 = Concatenate(Fragment_A=panel_106, Fragment_B=panel_105, Fragment_C=panel_104)  # disabled
concatenate_12 = Concatenate(Fragment_A=panel_110, Fragment_B=panel_107, Fragment_C=panel_109)  # disabled
concatenate_13 = Concatenate(Fragment_A=panel_108, Fragment_B=panel_112, Fragment_C=panel_111)  # disabled
panel_116 = Panel(concatenate_8)  # disabled
panel_117 = Panel(concatenate_9)  # disabled
panel_118 = Panel(concatenate_10)  # disabled
panel_119 = Panel(concatenate_11)  # disabled
panel_120 = Panel(concatenate_12)  # disabled
panel_121 = Panel(concatenate_13)  # disabled
panel_122 = Panel("240,-170")  # disabled
panel_123 = Panel("0,-110")  # disabled
text_tag_3d_8 = TextTag3D(Location=panel_113, Text=concatenate_9, Size=number_slider_39, Colour=colour_swatch_20, Justification=7)  # disabled
text_tag_3d_9 = TextTag3D(Location=panel_114, Text=concatenate_10, Size=number_slider_39, Colour=colour_swatch_21, Justification=7)  # disabled
text_tag_3d_10 = TextTag3D(Location=panel_115, Text=concatenate_12, Size=number_slider_39, Colour=colour_swatch_17, Justification=7)  # disabled
text_tag_3d_11 = TextTag3D(Location=panel_123, Text=concatenate_11, Size=number_slider_39, Colour=colour_swatch_22, Justification=7)  # disabled
text_tag_3d_12 = TextTag3D(Location=panel_115, Text=concatenate_8, Size=number_slider_39, Colour=colour_swatch_19, Justification=7)  # disabled
text_tag_3d_13 = TextTag3D(Location=panel_122, Text=concatenate_13, Size=number_slider_39, Colour=colour_swatch_18, Justification=7)  # disabled
mass_addition_2 = MassAddition(Input=[multiplication_26, multiplication_27, multiplication_29, multiplication_30, multiplication_31, multiplication_28])  # -> flatten(Result), PartialResults; disabled
number_slider_40 = Slider(1, range=0..1)  # disabled
panel_125 = Panel(" Total Area =")  # disabled
panel_126 = Panel("m2 ")  # disabled
list_item_4 = ListItem(List=mass_addition_2.Result, Index=number_slider_40, Wrap=True)  # disabled
panel_127 = Panel(list_item_4)  # disabled
panel_128 = Panel("240,-100")  # disabled
concatenate_14 = Concatenate(Fragment_A=panel_125, Fragment_B=panel_127, Fragment_C=panel_126)  # disabled
panel_129 = Panel(concatenate_14)  # disabled
text_tag_3d_14 = TextTag3D(Location=panel_128, Text=concatenate_14, Size=number_slider_39, Justification=7)  # disabled
number_slider_41 = Slider(10, range=0..10)  # disabled
number_slider_42 = Slider(30, range=0..100)  # disabled
number_slider_43 = Slider(60, range=20..60)  # disabled
number_slider_44 = Slider(6, range=2..10)  # disabled
number_slider_45 = Slider(36, range=20..60)  # disabled
multiplication_32 = Multiplication(A=number_slider_42, B=number_slider_41)  # disabled
number_slider_46 = Slider(2, range=0..10)  # disabled
multiplication_33 = Multiplication(A=number_slider_43, B=number_slider_41)  # disabled
multiplication_34 = Multiplication(A=number_slider_44, B=number_slider_41)  # disabled
multiplication_35 = Multiplication(A=number_slider_45, B=number_slider_41)  # disabled
number_slider_47 = Slider(10000, range=0..10000)  # disabled
round_3 = Round()  # -> Nearest, Floor, Ceiling; disabled
panel_130 = Panel(multiplication_32)  # disabled
panel_131 = Panel(multiplication_35)  # disabled
panel_132 = Panel(multiplication_33)  # disabled
multiplication_36 = Multiplication(A=multiplication_34, B=multiplication_34)  # disabled
division_11 = Division(A=multiplication_33, B=multiplication_34)  # disabled
number_slider_48 = Slider(100, range=0..100)  # disabled
panel_133 = Panel(multiplication_34)  # disabled
division_12 = Division(A=multiplication_35, B=multiplication_34)  # disabled
number_slider_49 = Slider(150, range=0..1000)  # disabled
multiplication_37 = Multiplication(A=number_slider_47, B=number_slider_46)  # disabled
division_13 = Division(A=multiplication_36, B=multiplication_37)  # disabled
panel_134 = Panel(division_12)  # disabled
integer_10 = Integer(division_12)  # disabled
integer_11 = Integer(division_11)  # disabled
integer_12 = Integer(panel_130)  # disabled
box_60 = Box(closet)  # disabled
box_61 = Box(closet_margin)  # disabled
box_62 = Box(exterior_door)  # disabled
c_script_6 = CSharpScript(boxx=box_62)  # -> out, lenght; inputs boxx: Box; disabled; same code as c_script
panel_135 = Panel(c_script_6.lenght)  # disabled
deconstruct_box_24 = DeconstructBox(Box=box_62)  # -> Plane, X, Y, Z; disabled
panel_136 = Panel(deconstruct_box_24.Plane)  # disabled
panel_137 = Panel(deconstruct_box_24.Y)  # disabled
panel_138 = Panel(deconstruct_box_24.Z)  # disabled
panel_139 = Panel(deconstruct_box_24.X)  # disabled
box_63 = Box(changeover_zone)  # disabled
box_64 = Box(exterior_door_margin)  # disabled
box_65 = Box(change_over_zone_margin)  # disabled
box_66 = Box()  # disabled
box_67 = Box()  # disabled
box_68 = Box(counter_1_margin)  # disabled
box_69 = Box()  # disabled
box_70 = Box()  # disabled
box_71 = Box()  # disabled
box_72 = Box()  # disabled
box_73 = Box()  # disabled
box_74 = Box()  # disabled
box_75 = Box()  # disabled
box_76 = Box()  # disabled
number_slider_50 = Slider(8, range=0..10)  # disabled
c_script_7 = CSharpScript(
    Width=integer_11,
    Length=integer_10,
    Height=integer_12,
    LevelHeight=number_slider_49,
    cellSize=multiplication_34,
    ExteriorDoor=box_62,
    ExteriorDoorMargin=box_64,
    ChangeOverZone=box_63,
    ChangeOverZoneMargin=box_65,
    Closet=box_60,
    ClosetMargin=box_61,
    InteriorDoor=box_66,
    InteriorDoorMargin=box_67,
    Counter=box_68,
    CounterMargin=box_69,
    Table=box_70,
    TableMargin=box_71,
    SittingUnit=box_72,
    SittingUnitMargin=box_73,
    Bed=box_74,
    HealtCare=box_75,
    HealthCareMargin=box_76)  # -> out, A, EntranceBoxes, CommonBoxes, WetAreaBoxes, Y, K, W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; inputs Width: Int32, Length: Int32, Height: Int32, LevelHeight: Int32, cellSize: Int32, ExteriorDoor: Box, ExteriorDoorMargin: Box, ChangeOverZone: Box, ChangeOverZoneMargin: Box, Closet: Box, ClosetMargin: Box, InteriorDoor: Box, InteriorDoorMargin: Box, Counter: Box, CounterMargin: Box, Table: Box, TableMargin: Box, SittingUnit: Box, SittingUnitMargin: Box, Bed: Box, BedMargin: Box, HealtCare: Box, HealthCareMargin: Box; disabled
# ---------- c_script_7: C# ----------
 
    List<Box> entranceBoxes = new List<Box>();
    List<Box> commonBoxes = new List<Box>();
    List<Box> wetAreaBoxes = new List<Box>();

    /*List<Box> kitchenBoxes = new List<Box>();
      List<Box> commonAreaBoxes = new List<Box>();*/

    List<Box> WhiteBoxes = new List<Box>();

    /**  These sizes are Spreading Limits for the spaces   //total cells     **/

    double entranceSize = (7 * 100 * 100) / (cellSize * cellSize);
    double commonSize = (9 * 100 * 100) / (cellSize * cellSize);
    double wetAreaSize = (7 * 100 * 100 ) / (cellSize * cellSize);

    /*
    double kitchenSize = 7 * 100 * 100 / cellSize * cell  Size;
    double commonAreaSize = 10 * 100 * 100 / cellSize * cellSize;
    */

    Point3d pA = new Point3d(0, 0, 0);
    Point3d pB = new Point3d(10, 0, 0);
    Point3d pC = new Point3d(0, 10, 0);

    Plane p = new Plane(pA, pB, pC);

    int width = Width;
    int length = Length;
    int levelHeight = LevelHeight;
    int height = Height;
    int levelNumber = Height / LevelHeight;

    int[,,] areaArray = InitializeZeroMatrice(length, width, levelNumber);
    StartZones(areaArray);

    int[,,] emptyFullArray = InitializeZeroMatrice(length, width, levelNumber);

    for (int i = 0; i < width * length * 3; i++)
    {

      Spread(areaArray, ref entranceSize, entranceList, ref entranceCounter, entranceLimit, cellSize);
      Spread(areaArray, ref commonSize, commonList, ref commonCounter, commonLimit, cellSize);
      Spread(areaArray, ref wetAreaSize, wetAreaList, ref wetAreaCounter, wetAreaLimit, cellSize);

    }

    noiseFilter(areaArray, 0, 4, 5);
    noiseFilter(areaArray, 1, 2, 2);
 
    for (int k = 0;k < levelNumber;k++)
    {
      for (int i = 0;i < length;i++)
      {
        for (int j = 0;j < width;j++)
        {
          areaArray[i, j, k] = areaArray[i, j, 0];
        }
      }
    }

    for (int k = 0;k < levelNumber;k++)
    {
      for (int i = 0;i < length;i++)
      {
        for (int j = 0;j < width;j++)
        {
          emptyFullArray[i, j, k] = 0;
        }
      }
    }

    entranceList.Clear();
    commonList.Clear();
    wetAreaList.Clear();
    /*kitchenList.Clear();
    commonAreaList.Clear();*/

    for (int k = 0;k < levelNumber;k++)
    {
      for (int i = 0;i < length;i++)
      {
        for (int j = 0;j < width;j++)
        {
          if (areaArray[i, j, k] == 1)
          {
            Interval xInterval = new Interval(i * cellSize, (i + 1) * (cellSize ));
            Interval yInterval = new Interval(j * cellSize, (j + 1) * (cellSize ));
            Interval zInterval = new Interval(k * LevelHeight, k * LevelHeight + levelHeight);

            Box boxgh = new Box(p, xInterval, yInterval, zInterval);
            entranceBoxes.Add(boxgh);
            entranceList.AddRange(new int[2] { i, j });
          }
          if (areaArray[i, j, k] == 2)
          {
            Interval xInterval = new Interval(i * cellSize, (i + 1) * (cellSize ));
            Interval yInterval = new Interval(j * cellSize, (j + 1) * (cellSize ));
            Interval zInterval = new Interval(k * LevelHeight, k * LevelHeight + levelHeight);

            Box boxgh = new Box(p, xInterval, yInterval, zInterval);
            commonBoxes.Add(boxgh);
            commonList.AddRange(new int[2] { i, j });
          }
          if (areaArray[i, j, k] == 3)
          {
            Interval xInterval = new Interval(i * cellSize, (i + 1) * (cellSize ));
            Interval yInterval = new Interval(j * cellSize, (j + 1) * (cellSize ));
            Interval zInterval = new Interval(k * LevelHeight, k * LevelHeight + levelHeight);

            Box boxgh = new Box(p, xInterval, yInterval, zInterval);
            wetAreaBoxes.Add(boxgh);
            wetAreaList.AddRange(new int[2] { i, j });
          }

          /*if (areaArray[i, j, k] == 4)
          {
            Interval xInterval = new Interval(j * cellSize, (j + 1) * (cellSize ));
            Interval yInterval = new Interval(i * cellSize, (i + 1) * (cellSize ));
            Interval zInterval = new Interval(k * LevelHeight, k * LevelHeight + levelHeight);

            Box boxgh = new Box(p, xInterval, yInterval, zInterval);
            kitchenBoxes.Add(boxgh);
            kitchenList.AddRange(new int[2] { i, j });
          }
          if (areaArray[i, j, k] == 5)
          {
            Interval xInterval = new Interval(j * cellSize, (j + 1) * (cellSize ));
            Interval yInterval = new Interval(i * cellSize, (i + 1) * (cellSize ));
            Interval zInterval = new Interval(k * LevelHeight, k * LevelHeight + levelHeight);

            Box boxgh = new Box(p, xInterval, yInterval, zInterval);
            commonAreaBoxes.Add(boxgh);
            commonAreaList.AddRange(new int[2] { i, j });
          }*/
          if (areaArray[i, j, k] == 0)
          {

            Interval xInterval = new Interval(i * cellSize, (i + 1) * (cellSize ));
            Interval yInterval = new Interval(j * cellSize, (j + 1) * (cellSize ));
            Interval zInterval = new Interval(k * LevelHeight, k * LevelHeight + levelHeight);

            Box boxgh = new Box(p, xInterval, yInterval, zInterval);
            WhiteBoxes.Add(boxgh);
            //WhiteList.AddRange(i, j);
          }
        }
      }
    }

    ShowMatrix(areaArray);

    A = areaArray;
    EntranceBoxes = entranceBoxes;
    CommonBoxes = commonBoxes;
    WetAreaBoxes = wetAreaBoxes;
    W = WhiteBoxes;
# ---------- c_script_7: C# additional code ----------
  class Objects
  {
    public string Name;
    public int ZoneName;

    public Box Obj;
    public Box ObjMargin;

    public bool Front = false;
    public bool Right = false;
    public bool Back = false;
    public bool Left = false;
    public bool Top = false;
    public bool Bottom = false;

    public bool RotationBool = true;
    public int RotationOpt; // rotation options

    public bool MirrorBool = true;
    public int MirrorOpt; // mirror options

    public string Source; // Water, Electiricity
    public int FixedToWall; // Bed, Television //1,2,3 conditions
    public int CellSize;

    public Objects PreviousObject;

    public double ObjLength ;
    public double ObjWidth ;
    public double ObjHeight ;

    public double MrjLength;
    public double MrjWidth;
    public double MrjHeight;

    public double baseX, baseY, baseZ;
    public List<int> SpaceList = new List<int>();

    public double  XCell;
    public double  YCell;
    public double  ZCell;


    //deneme
    public Objects()
    {
            /*
            var Coordinates = new List<int>();
            Point3d pA = new Point3d(0, 0, 0);
            Point3d pB = new Point3d(10, 0, 0);
            Point3d pC = new Point3d(0, 10, 0);

            Plane p = new Plane(pA, pB, pC);*/
    }

    public Objects(string name, int zoneName, bool front, bool right, bool back, bool left, bool top, bool bottom, bool rotationalBool, int rotationOpt, bool mirrorBool, int mirrorOpt, string source, int fixedTowall, int cellSize, Box obj, Box objMargin, Objects previousObject, List<int> spaceList)
      : this()
    {
      this.Obj = obj;
      this.ObjMargin = objMargin;

      this.Name = name;
      this.ZoneName = zoneName;

      this.Front = front;
      this.Right = right;
      this.Back = back;
      this.Left = left;
      this.Bottom = bottom;
      this.Top = top;

      this.RotationBool = rotationalBool;
      this.RotationOpt = rotationOpt;

      this.MirrorBool = mirrorBool;
      this.MirrorOpt = mirrorOpt;

      this.Source = source;
      this.FixedToWall = fixedTowall;
      this.CellSize = cellSize;

      this.ObjWidth = obj.X.T1;
      this.ObjLength = obj.Y.T1;
      this.ObjHeight = obj.Z.T1;

      this.MrjWidth = objMargin.X.T1;
      this.MrjLength = objMargin.Y.T1;
      this.MrjHeight = objMargin.Z.T1;

      this.baseX = Obj.Plane.OriginX;
      this.baseY = Obj.Plane.OriginY;
      this.baseZ = Obj.Plane.OriginZ;

      this.PreviousObject = previousObject;
      this.SpaceList = spaceList;
    }

    public Objects(string name, int zoneName, bool front, bool right, bool back, bool left, bool top, bool bottom, bool rotationalBool, int rotationOpt, bool mirrorBool, int mirrorOpt, string source, int fixedTowall, int cellSize, Box obj, Box objMargin, List<int> spaceList)
      : this()
    {
      this.Obj = obj;
      this.ObjMargin = objMargin;

      this.Name = name;
      this.ZoneName = zoneName;

      this.Front = front;
      this.Right = right;
      this.Back = back;
      this.Left = left;
      this.Bottom = bottom;
      this.Top = top;

      this.RotationBool = rotationalBool;
      this.RotationOpt = rotationOpt;

      this.MirrorBool = mirrorBool;
      this.MirrorOpt = mirrorOpt;

      this.Source = source;
      this.FixedToWall = fixedTowall;
      this.CellSize = cellSize;

      this.ObjWidth = obj.X.T1;
      this.ObjLength = obj.Y.T1;
      this.ObjHeight = obj.Z.T1;

      this.MrjWidth = (this.ObjMargin.X.T1);
      this.MrjLength = (this.ObjMargin.Y.T1);
      this.MrjHeight = (this.ObjMargin.Z.T1);

      this.baseX = Obj.Plane.OriginX;
      this.baseY = Obj.Plane.OriginY;
      this.baseZ = Obj.Plane.OriginZ;

      this.SpaceList = spaceList;
    }

    public void assignDimensions()
    {
      this.ObjWidth = this.Obj.X.T1;
      this.ObjLength = this.Obj.Y.T1;
      this.ObjHeight = this.Obj.Z.T1;

      this.MrjWidth = this.ObjMargin.X.T1;
      this.MrjLength = this.ObjMargin.Y.T1;
      this.MrjHeight = this.ObjMargin.Z.T1;

    }

    public void printDimensions()
    {
      Rhino.RhinoApp.WriteLine("Obj Width " + this.ObjWidth.ToString());
      Rhino.RhinoApp.WriteLine("Obj Length " + this.ObjLength.ToString());
      Rhino.RhinoApp.WriteLine("Obj Height " + this.ObjHeight.ToString());

      Rhino.RhinoApp.WriteLine("Obj Width " + this.MrjWidth.ToString());
      Rhino.RhinoApp.WriteLine("Obj Length " + this.MrjLength.ToString());
      Rhino.RhinoApp.WriteLine("Obj Height " + this.MrjHeight.ToString());
    }



    public void placeRefObject(int [,,]emptyFullArray, int[,,]areaArray, out Box ObjBox, out Box marginBox)
    {
      this.XCell = Math.Ceiling((double) (this.MrjWidth / CellSize));
      this.YCell = Math.Ceiling((double) (this.MrjLength / CellSize));
      this.ZCell = Math.Ceiling((double) (this.MrjHeight / 150));

      bool emptyBool = true;
      bool sameZone = true;

      bool placeSuccessful = false;
      int trycount = 0;

      while (placeSuccessful == false)
      {
        var rand = new Random();
        var randomCellIndex = rand.Next(this.SpaceList.Count / 2);

        baseX = (this.SpaceList[2 * randomCellIndex]) * CellSize;
        baseY = (this.SpaceList[2 * randomCellIndex + 1]) * CellSize;
        baseZ = 0;
        baseZ = 0;

        //baseX = baseX * CellSize;
        //baseY = baseY * CellSize;

        if( (baseX + this.MrjWidth < 300) && (baseY + this.MrjLength < 600) && (baseZ + this.MrjHeight < 300) &&
          (baseX + this.MrjWidth > 0) && (baseY + this.MrjLength > 0) && (baseZ + this.MrjHeight > 0) )
        {
          for(int i = (int) (baseX / CellSize) ; i < (baseX / CellSize + (int) XCell); i++)
          {
            for(int j = (int) (baseY / CellSize); j < baseY / CellSize + (int) YCell; j++)
            {
              for(int k = (int) (baseZ / 150); k < baseZ / 150 + (int) ZCell; k++)
              {
                Rhino.RhinoApp.WriteLine("Entrance Reference Object :  " + "  i:  " + i + "  j:  " + j + "  k:  " + k);
                if (emptyFullArray[i, j, k] == 1)
                {
                  emptyBool = false;
                }
                if (areaArray[i, j, k] != this.ZoneName)
                {
                  sameZone = false;
                }
              }
            }
          }

          if (emptyBool && sameZone)
          {
            placeSuccessful = true;

            Rhino.RhinoApp.WriteLine("Reference Object conditions are successful ");
            for(int i = (int) (baseX / CellSize) ; i < (baseX / CellSize + (int) XCell); i++)
            {
              for(int j = (int) (baseY / CellSize); j < baseY / CellSize + (int) YCell; j++)
              {
                for(int k = (int) (baseZ / 150); k < baseZ / 150 + (int) ZCell; k++)
                {
                  emptyFullArray[i, j, k] = 1;
                }
              }
            }
          }
          else
          {
            Rhino.RhinoApp.WriteLine("Conditions are not satisfied ");
          }
        }

        trycount++;
        Rhino.RhinoApp.WriteLine("Try count is : " + trycount);
        if (trycount > 60 )
          Rhino.RhinoApp.WriteLine("Try count is over 60 placement is unsuccessful: ");
        placeSuccessful = true;
      }

      if( trycount < 60 && placeSuccessful )
      {
        Rhino.RhinoApp.WriteLine("baseX " + this.baseX);
        Rhino.RhinoApp.WriteLine("baseY " + this.baseY);
        Rhino.RhinoApp.WriteLine("baseZ " + this.baseZ);

        Point3d pointa = new Point3d(baseX, baseY, 0);
        Vector3d pointb = new Vector3d(0, 0, 1);

        Plane planebase = new Plane(pointa, pointb);

        Interval xInterval = new Interval(0, this.ObjWidth);
        Interval yInterval = new Interval(0, this.ObjLength);
        Interval zInterval = new Interval(0, this.ObjHeight);

        ObjBox = new Box(planebase, xInterval, yInterval, zInterval);

        xInterval = new Interval(0, this.MrjWidth);
        yInterval = new Interval(0, this.MrjLength);
        zInterval = new Interval(0, this.MrjHeight);

        marginBox = new Box(planebase, xInterval, yInterval, zInterval);

      }

      else
      {
        ObjBox = new Box();
        marginBox = new Box();
      }
    }

    public void placeRefObjectEntrance(int [,,]emptyFullArray, int[,,]areaArray, out Box ObjBox, out Box marginBox)
    {
      this.XCell = Math.Ceiling((double) (this.MrjWidth / CellSize));
      this.YCell = Math.Ceiling((double) (this.MrjLength / CellSize));
      this.ZCell = Math.Ceiling((double) (this.MrjHeight / 150));

      bool emptyBool = true;
      bool sameZone = true;


      bool placeSuccessful = false;
      int trycount = 0;

      while (placeSuccessful == false)
      {
        var rand = new Random();
        var randomCellIndex = rand.Next(this.SpaceList.Count / 2);

        baseX = (this.SpaceList[2 * randomCellIndex]) * CellSize;
        baseY = 0;
        baseZ = 0;

        //baseX = baseX * CellSize;
        //baseY = baseY * CellSize;

        if( (baseX + this.MrjWidth < 300) && (baseY + this.MrjLength < 600) && (baseZ + this.MrjHeight < 300) &&
          (baseX + this.MrjWidth > 0) && (baseY + this.MrjLength > 0) && (baseZ + this.MrjHeight > 0) )
        {
          for(int i = (int) (baseX / CellSize) ; i < (baseX / CellSize + (int) XCell); i++)
          {
            for(int j = (int) (baseY / CellSize); j < baseY / CellSize + (int) YCell; j++)
            {
              for(int k = (int) (baseZ / 150); k < baseZ / 150 + (int) ZCell; k++)
              {
                Rhino.RhinoApp.WriteLine("Entrance Reference Object :  " + "  i:  " + i + "  j:  " + j + "  k:  " + k);
                if (emptyFullArray[i, j, k] == 1)
                {
                  emptyBool = false;
                }
                if (areaArray[i, j, k] != this.ZoneName)
                {
                  sameZone = false;
                }
              }
            }
          }

          if (emptyBool && sameZone)
          {
            placeSuccessful = true;

            Rhino.RhinoApp.WriteLine("Reference Object conditions are successful ");
            for(int i = (int) (baseX / CellSize) ; i < (baseX / CellSize + (int) XCell); i++)
            {
              for(int j = (int) (baseY / CellSize); j < baseY / CellSize + (int) YCell; j++)
              {
                for(int k = (int) (baseZ / 150); k < baseZ / 150 + (int) ZCell; k++)
                {
                  emptyFullArray[i, j, k] = 1;
                }
              }
            }
          }
          else
          {
            Rhino.RhinoApp.WriteLine("Conditions are not satisfied ");
          }
        }

        trycount++;
        Rhino.RhinoApp.WriteLine("Try count is : " + trycount);
        if (trycount > 60 )
          Rhino.RhinoApp.WriteLine("Try count is over 60 placement is unsuccessful: ");
        placeSuccessful = true;
      }

      if( trycount < 60 && placeSuccessful )
      {
        Rhino.RhinoApp.WriteLine("baseX " + this.baseX);
        Rhino.RhinoApp.WriteLine("baseY " + this.baseY);
        Rhino.RhinoApp.WriteLine("baseZ " + this.baseZ);

        Point3d pointa = new Point3d(baseX, 0, 0);
        Vector3d pointb = new Vector3d(0, 0, 1);

        Plane planebase = new Plane(pointa, pointb);

        Interval xInterval = new Interval(0, this.ObjWidth);
        Interval yInterval = new Interval(0, this.ObjLength);
        Interval zInterval = new Interval(0, this.ObjHeight);

        ObjBox = new Box(planebase, xInterval, yInterval, zInterval);

        xInterval = new Interval(0, this.MrjWidth);
        yInterval = new Interval(0, this.MrjLength);
        zInterval = new Interval(0, this.MrjHeight);

        marginBox = new Box(planebase, xInterval, yInterval, zInterval);

      }


      else
      {
        ObjBox = new Box();
        marginBox = new Box();
      }

    }


    public void placeFront(int [,,]emptyFullArray, int[,,]areaArray, out Box ObjBox, out Box marginBox)
    {
      bool emptyBool = true;
      bool sameZone = true;

      this.XCell = Math.Ceiling((double) (this.MrjWidth / CellSize));
      this.YCell = Math.Ceiling((double) (this.MrjLength / CellSize));
      this.ZCell = Math.Ceiling((double) (this.MrjHeight / 150));

      this.baseX = PreviousObject.baseX;
      this.baseY = PreviousObject.baseY + CellSize * PreviousObject.YCell;
      this.baseZ = PreviousObject.baseZ;

      if( (baseX + this.MrjWidth < 300) && (baseY + this.MrjLength < 600) && (baseZ + this.MrjHeight < 300) &&
        (baseX + this.MrjWidth > 0) && (baseY + this.MrjLength > 0) && (baseZ + this.MrjHeight > 0) )
      {
        for(int i = (int) (baseX / CellSize) ; i < (baseX / CellSize + (int) XCell); i++)
        {
          for(int j = (int) (baseY / CellSize); j < baseY / CellSize + (int) YCell; j++)
          {
            for(int k = (int) (baseZ / 150); k < baseZ / 150 + (int) ZCell; k++)
            {
              Rhino.RhinoApp.WriteLine("i:  " + i + "  j:  " + j + "  k:  " + k);
              if (emptyFullArray[i, j, k] == 1)
              {
                emptyBool = false;
              }
              if (areaArray[i, j, k] != this.ZoneName)
              {
                sameZone = false;
              }
            }
          }
        }

        if (emptyBool && sameZone)
        {
          Rhino.RhinoApp.WriteLine("Conditions are successful ");
          for(int i = (int) (baseX / CellSize) ; i < (baseX / CellSize + (int) XCell); i++)
          {
            for(int j = (int) (baseY / CellSize); j < baseY / CellSize + (int) YCell; j++)
            {
              for(int k = (int) (baseZ / 150); k < baseZ / 150 + (int) ZCell; k++)
              {
                emptyFullArray[i, j, k] = 1;
              }
            }
          }
        }
        else
        {
          Rhino.RhinoApp.WriteLine("Place Front:  Conditions are not satisfied ");
        }
      }
      else
      {
        Rhino.RhinoApp.WriteLine("Place Front: Conditions are not satisfied ");
      }


      Point3d pointa = new Point3d(baseX, baseY, baseZ);
      Vector3d pointb = new Vector3d(0, 0, 1);

      Plane planebase = new Plane(pointa, pointb);

      Interval xInterval = new Interval(0, this.ObjWidth);
      Interval yInterval = new Interval(0, this.ObjLength);
      Interval zInterval = new Interval(0, this.ObjHeight);

      ObjBox = new Box(planebase, xInterval, yInterval, zInterval);

      xInterval = new Interval(0, this.MrjWidth);
      yInterval = new Interval(0, this.MrjLength);
      zInterval = new Interval(0, this.MrjHeight);

      marginBox = new Box(planebase, xInterval, yInterval, zInterval);
    }


    public void placeRight(int [,,]emptyFullArray, int[,,]areaArray, out Box ObjBox, out Box marginBox)
    {
      bool emptyBool = true;
      bool sameZone = true;

      this.XCell = Math.Ceiling((double) (this.MrjWidth / CellSize));
      this.YCell = Math.Ceiling((double) (this.MrjLength / CellSize));
      this.ZCell = Math.Ceiling((double) (this.MrjHeight / 150));

      this.baseX = PreviousObject.baseX + CellSize * PreviousObject.XCell;
      this.baseY = PreviousObject.baseY;
      this.baseZ = PreviousObject.baseZ;

      if( (baseX + this.ObjWidth < 300) && (baseY + this.ObjLength < 600) && (baseZ + this.ObjHeight < 300) &&
        (baseX + this.ObjWidth > 0) && (baseY + this.ObjLength > 0) && (baseZ + this.ObjHeight > 0) )
      {
        for(int i = (int) (baseX / CellSize) ; i < (baseX / CellSize + (int) XCell); i++)
        {
          for(int j = (int) (baseY / CellSize); j < baseY / CellSize + (int) YCell; j++)
          {
            for(int k = (int) (baseZ / 150); k < baseZ / 150 + (int) ZCell; k++)
            {
              if (emptyFullArray[i, j, k] == 1)
              {
                emptyBool = false;
              }
              if (areaArray[i, j, k] != this.ZoneName)
              {
                sameZone = false;
              }
            }
          }
        }

        if (emptyBool && sameZone)
        {
          Rhino.RhinoApp.WriteLine("Place Right: Conditions are successful ");
          for(int i = (int) (baseX / CellSize) ; i < (baseX / CellSize + (int) XCell); i++)
          {
            for(int j = (int) (baseY / CellSize); j < baseY / CellSize + (int) YCell; j++)
            {
              for(int k = (int) (baseZ / 150); k < baseZ / 150 + (int) ZCell; k++)
              {
                emptyFullArray[i, j, k] = 1;
              }
            }
          }
        }
        else
        {
          Rhino.RhinoApp.WriteLine("Place Right: Conditions are not satisfied ");
        }
      }
      else
      {
        Rhino.RhinoApp.WriteLine("Place Right: Conditions are not satisfied ");
      }

      Point3d pointa = new Point3d(baseX, baseY, baseZ);
      Vector3d pointb = new Vector3d(0, 0, 1);

      Plane planebase = new Plane(pointa, pointb);

      Interval xInterval = new Interval(0, this.ObjWidth);
      Interval yInterval = new Interval(0, this.ObjLength);
      Interval zInterval = new Interval(0, this.ObjHeight);

      ObjBox = new Box(planebase, xInterval, yInterval, zInterval);

      xInterval = new Interval(0, this.MrjWidth);
      yInterval = new Interval(0, this.MrjLength);
      zInterval = new Interval(0, this.MrjHeight);

      marginBox = new Box(planebase, xInterval, yInterval, zInterval);
    }

    public void placeBack(int [,,]emptyFullArray, int[,,]areaArray, out Box ObjBox, out Box marginBox)
    {
      bool emptyBool = true;
      bool sameZone = true;

      this.XCell = Math.Ceiling((double) (this.MrjWidth / CellSize));
      this.YCell = Math.Ceiling((double) (this.MrjLength / CellSize));
      this.ZCell = Math.Ceiling((double) (this.MrjHeight / 150));

      this.baseX = PreviousObject.baseX;
      this.baseY = PreviousObject.baseY - CellSize * this.YCell;
      this.baseZ = PreviousObject.baseZ;

      if( (baseX + this.ObjWidth < 300) && (baseY + this.ObjLength < 600) && (baseZ + this.ObjHeight < 300) &&
        (baseX + this.ObjWidth > 0) && (baseY + this.ObjLength > 0) && (baseZ + this.ObjHeight > 0) )
      {
        for(int i = (int) (baseX / CellSize) ; i < (baseX / CellSize + (int) XCell); i++)
        {
          for(int j = (int) (baseY / CellSize); j < baseY / CellSize + (int) YCell; j++)
          {
            for(int k = (int) (baseZ / 150); k < baseZ / 150 + (int) ZCell; k++)
            {
              if (emptyFullArray[i, j, k] == 1)
              {
                emptyBool = false;
              }
              if (areaArray[i, j, k] != this.ZoneName)
              {
                sameZone = false;
              }
            }
          }
        }

        if (emptyBool && sameZone)
        {
          Rhino.RhinoApp.WriteLine("Place Back: Conditions are successful ");
          for(int i = (int) (baseX / CellSize) ; i < (baseX / CellSize + (int) XCell); i++)
          {
            for(int j = (int) (baseY / CellSize); j < baseY / CellSize + (int) YCell; j++)
            {
              for(int k = (int) (baseZ / 150); k < baseZ / 150 + (int) ZCell; k++)
              {
                emptyFullArray[i, j, k] = 1;
              }
            }
          }
        }
        else
        {
          Rhino.RhinoApp.WriteLine("Place Back: Conditions are not satisfied ");
        }
      }
      else
      {
        Rhino.RhinoApp.WriteLine("Place Back:Conditions are not satisfied ");
      }

      Point3d pointa = new Point3d(baseX, baseY, baseZ);
      Vector3d pointb = new Vector3d(0, 0, 1);

      Plane planebase = new Plane(pointa, pointb);

      Interval xInterval = new Interval(0, this.ObjWidth);
      Interval yInterval = new Interval(0, this.ObjLength);
      Interval zInterval = new Interval(0, this.ObjHeight);

      ObjBox = new Box(planebase, xInterval, yInterval, zInterval);

      xInterval = new Interval(0, this.MrjWidth);
      yInterval = new Interval(0, this.MrjLength);
      zInterval = new Interval(0, this.MrjHeight);

      marginBox = new Box(planebase, xInterval, yInterval, zInterval);
    }

    public void placeLeft(int [,,]emptyFullArray, int[,,]areaArray, out Box ObjBox, out Box marginBox)
    {
      bool emptyBool = true;
      bool sameZone = true;

      this.XCell = Math.Ceiling((double) (this.MrjWidth / CellSize));
      this.YCell = Math.Ceiling((double) (this.MrjLength / CellSize));
      this.ZCell = Math.Ceiling((double) (this.MrjHeight / 150));

      this.baseX = PreviousObject.baseX - CellSize * this.XCell;
      this.baseY = PreviousObject.baseY;
      this.baseZ = PreviousObject.baseZ;

      if( (baseX + this.ObjWidth < 300) && (baseY + this.ObjLength < 600) && (baseZ + this.ObjHeight < 300) &&
        (baseX + this.ObjWidth > 0) && (baseY + this.ObjLength > 0) && (baseZ + this.ObjHeight > 0) )
      {
        for(int i = (int) (baseX / CellSize) ; i < (baseX / CellSize + (int) XCell); i++)
        {
          for(int j = (int) (baseY / CellSize); j < baseY / CellSize + (int) YCell; j++)
          {
            for(int k = (int) (baseZ / 150); k < baseZ / 150 + (int) ZCell; k++)
            {
              if (emptyFullArray[i, j, k] == 1)
              {
                emptyBool = false;
              }
              if (areaArray[i, j, k] != this.ZoneName)
              {
                sameZone = false;
              }
            }
          }
        }

        if (emptyBool && sameZone)
        {
          Rhino.RhinoApp.WriteLine("Place Left: Conditions are successful ");
          for(int i = (int) (baseX / CellSize) ; i < (baseX / CellSize + (int) XCell); i++)
          {
            for(int j = (int) (baseY / CellSize); j < baseY / CellSize + (int) YCell; j++)
            {
              for(int k = (int) (baseZ / 150); k < baseZ / 150 + (int) ZCell; k++)
              {
                emptyFullArray[i, j, k] = 1;
              }
            }
          }
        }
        else
        {
          Rhino.RhinoApp.WriteLine("Place Left: Conditions are not satisfied ");
        }
      }
      else
      {
        Rhino.RhinoApp.WriteLine("Place Left: Conditions are not satisfied ");
      }

      Point3d pointa = new Point3d(baseX, baseY, baseZ);
      Vector3d pointb = new Vector3d(0, 0, 1);

      Plane planebase = new Plane(pointa, pointb);

      Interval xInterval = new Interval(0, this.ObjWidth);
      Interval yInterval = new Interval(0, this.ObjLength);
      Interval zInterval = new Interval(0, this.ObjHeight);

      ObjBox = new Box(planebase, xInterval, yInterval, zInterval);

      xInterval = new Interval(0, this.MrjWidth);
      yInterval = new Interval(0, this.MrjLength);
      zInterval = new Interval(0, this.MrjHeight);

      marginBox = new Box(planebase, xInterval, yInterval, zInterval);
    }
    public void placeTop(int [,,]emptyFullArray, int[,,]areaArray, out Box ObjBox, out Box marginBox)
    {
      bool emptyBool = true;
      bool sameZone = true;

      this.XCell = Math.Ceiling((double) (this.MrjWidth / CellSize));
      this.YCell = Math.Ceiling((double) (this.MrjLength / CellSize));
      this.ZCell = Math.Ceiling((double) (this.MrjHeight / 150));

      this.baseX = PreviousObject.baseX;
      this.baseY = PreviousObject.baseY;
      this.baseZ = PreviousObject.baseZ + CellSize * PreviousObject.ZCell;

      if( (baseX + this.ObjWidth < 300) && (baseY + this.ObjLength < 600) && (baseZ + this.ObjHeight < 300) &&
        (baseX + this.ObjWidth > 0) && (baseY + this.ObjLength > 0) && (baseZ + this.ObjHeight > 0) )
      {
        for(int i = (int) (baseX / CellSize) ; i < (baseX / CellSize + (int) XCell); i++)
        {
          for(int j = (int) (baseY / CellSize); j < baseY / CellSize + (int) YCell; j++)
          {
            for(int k = (int) (baseZ / 150); k < baseZ / 150 + (int) ZCell; k++)
            {
              if (emptyFullArray[i, j, k] == 1)
              {
                emptyBool = false;
              }
              if (areaArray[i, j, k] != this.ZoneName)
              {
                sameZone = false;
              }
            }
          }
        }

        if (emptyBool && sameZone)
        {
          Rhino.RhinoApp.WriteLine("Conditions are successful ");
          for(int i = (int) (baseX / CellSize) ; i < (baseX / CellSize + (int) XCell); i++)
          {
            for(int j = (int) (baseY / CellSize); j < baseY / CellSize + (int) YCell; j++)
            {
              for(int k = (int) (baseZ / 150); k < baseZ / 150 + (int) ZCell; k++)
              {
                emptyFullArray[i, j, k] = 1;
              }
            }
          }
        }
        else
        {
          Rhino.RhinoApp.WriteLine("Conditions are not satisfied ");
        }
      }
      else
      {
        Rhino.RhinoApp.WriteLine("Conditions are not satisfied ");
      }

      Point3d pointa = new Point3d(baseX, baseY, baseZ);
      Vector3d pointb = new Vector3d(0, 0, 1);

      Plane planebase = new Plane(pointa, pointb);

      Interval xInterval = new Interval(0, this.ObjWidth);
      Interval yInterval = new Interval(0, this.ObjLength);
      Interval zInterval = new Interval(0, this.ObjHeight);

      ObjBox = new Box(planebase, xInterval, yInterval, zInterval);

      xInterval = new Interval(0, this.MrjWidth);
      yInterval = new Interval(0, this.MrjLength);
      zInterval = new Interval(0, this.MrjHeight);

      marginBox = new Box(planebase, xInterval, yInterval, zInterval);
    }

    public void placeBottom(int [,,]emptyFullArray, int[,,]areaArray, out Box ObjBox, out Box marginBox)
    {
      bool emptyBool = true;
      bool sameZone = true;

      this.XCell = Math.Ceiling((double) (this.MrjWidth / CellSize));
      this.YCell = Math.Ceiling((double) (this.MrjLength / CellSize));
      this.ZCell = Math.Ceiling((double) (this.MrjHeight / 150));

      this.baseX = PreviousObject.baseX;
      this.baseY = PreviousObject.baseY;
      this.baseZ = PreviousObject.baseZ - CellSize * this.ZCell;

      if( (baseX + this.ObjWidth < 300) && (baseY + this.ObjLength < 600) && (baseZ + this.ObjHeight < 300) &&
        (baseX + this.ObjWidth > 0) && (baseY + this.ObjLength > 0) && (baseZ + this.ObjHeight > 0) )
      {
        for(int i = (int) (baseX / CellSize) ; i < (baseX / CellSize + (int) XCell); i++)
        {
          for(int j = (int) (baseY / CellSize); j < baseY / CellSize + (int) YCell; j++)
          {
            for(int k = (int) (baseZ / 150); k < baseZ / 150 + (int) ZCell; k++)
            {
              if (emptyFullArray[i, j, k] == 1)
              {
                emptyBool = false;
              }
              if (areaArray[i, j, k] != this.ZoneName)
              {
                sameZone = false;
              }
            }
          }
        }

        if (emptyBool && sameZone)
        {
          Rhino.RhinoApp.WriteLine("Conditions are successful ");
          for(int i = (int) (baseX / CellSize) ; i < (baseX / CellSize + (int) XCell); i++)
          {
            for(int j = (int) (baseY / CellSize); j < baseY / CellSize + (int) YCell; j++)
            {
              for(int k = (int) (baseZ / 150); k < baseZ / 150 + (int) ZCell; k++)
              {
                emptyFullArray[i, j, k] = 1;
              }
            }
          }
        }
        else
        {
          Rhino.RhinoApp.WriteLine("Conditions are not satisfied ");
        }
      }
      else
      {
        Rhino.RhinoApp.WriteLine("Conditions are not satisfied ");
      }

      Point3d pointa = new Point3d(baseX, baseY, baseZ);
      Vector3d pointb = new Vector3d(0, 0, 1);

      Plane planebase = new Plane(pointa, pointb);

      Interval xInterval = new Interval(0, this.ObjWidth);
      Interval yInterval = new Interval(0, this.ObjLength);
      Interval zInterval = new Interval(0, this.ObjHeight);

      ObjBox = new Box(planebase, xInterval, yInterval, zInterval);

      xInterval = new Interval(0, this.MrjWidth);
      yInterval = new Interval(0, this.MrjLength);
      zInterval = new Interval(0, this.MrjHeight);

      marginBox = new Box(planebase, xInterval, yInterval, zInterval);
    }

    public void placeObject(int [,,]emptyFullArray, int[,,]areaArray, out Box ObjBox, out Box marginBox)
    {

      Point3d pointa = new Point3d(baseX, baseY, baseZ);
      Vector3d pointb = new Vector3d(0, 0, 1);

      Plane planebase = new Plane(pointa, pointb);

      Interval xInterval = new Interval(0, this.ObjWidth);
      Interval yInterval = new Interval(0, this.ObjLength);
      Interval zInterval = new Interval(0, this.ObjHeight);

      ObjBox = new Box(planebase, xInterval, yInterval, zInterval);

      xInterval = new Interval(0, this.MrjWidth);
      yInterval = new Interval(0, this.MrjLength);
      zInterval = new Interval(0, this.MrjHeight);

      marginBox = new Box(planebase, xInterval, yInterval, zInterval);

      List<int> growDirection = new List<int>();

      if(PreviousObject.Front == true)
        growDirection.Add(1); // Front Direction
      if(PreviousObject.Right == true)
        growDirection.Add(2); // Right Direction
      if(PreviousObject.Back == true)
        growDirection.Add(3); // Back Direction
      if(PreviousObject.Left == true)
        growDirection.Add(4); // Left Direction
      if(PreviousObject.Bottom == true)
        growDirection.Add(5); // Bottom Direction
      if(PreviousObject.Top == true)
        growDirection.Add(6); // Right Direction

      bool placeSuccess = false;
      int tryCounter = 0;

      if(growDirection.Count >= 1)
      {
        Random randm = new Random();

        while(placeSuccess == false )
        {
          int a = randm.Next(0, growDirection.Count);
          int randomMethod = growDirection[a];

          switch (a)
          ​{
            case 1:
              this.placeFront(emptyFullArray, areaArray, out  ObjBox, out marginBox);
              placeSuccess = true;
              break;
            case 2:
              this.placeRight(emptyFullArray, areaArray, out  ObjBox, out marginBox);
              placeSuccess = true;
              break;
            case 3:
              this.placeBack(emptyFullArray, areaArray, out  ObjBox, out marginBox);
              placeSuccess = true;
              break;
            case 4:
              this.placeLeft(emptyFullArray, areaArray, out  ObjBox, out marginBox);
              placeSuccess = true;
              break;
            case 5:
              this.placeBottom(emptyFullArray, areaArray, out  ObjBox, out marginBox);
              placeSuccess = true;
              break;
            case 6:
              this.placeTop(emptyFullArray, areaArray, out  ObjBox, out marginBox);
              placeSuccess = true;
              break;

            default:
              tryCounter++;
              break;
            // default statements
          }


        }
        growDirection.Clear();




      }


    }


    public void rotate()
    {

    }



    static void mirror()
    {

    }

    static void getClosestCell()
    {

    }

    static void createWall()
    {

    }

  }

  static void ShowMatrix(int[,,] Arr)
  {
    for (int i = 0; i < Arr.GetLength(0); i++)
    {
      for (int j = 0; j < Arr.GetLength(1); j++)
      {
        Rhino.RhinoApp.Write(Arr[i, j, 0] + " ");
      }
      Rhino.RhinoApp.WriteLine("Loop Runs" + i.ToString());
    }
    return;
  }

  static int[,,] InitializeZeroMatrice(int width, int length, int levelNumber)
  {
    var areaArray = new int[width, length, levelNumber];

    for (int k = 0; k < levelNumber; k++)
    {
      for (int i = 0; i < width; i++)
      {
        for (int j = 0; j < length; j++)
        {
          areaArray[i, j, k] = 0;
        }
      }
    }
    return areaArray;
  }

  /* The Color lists keep the colors in a seperate List in order to choose within them easily instead of searching where they are... */
  static List<int> entranceList = new List<int>();
  static List<int> commonList = new List<int>();
  static List<int> wetAreaList = new List<int>();
 /* static List<int> kitchenList = new List<int>();
  static List<int> commonAreaList = new List<int>();*/

  /**           these counters are used for starting the límitations counts.         **/

  static int entranceCounter = 1;
  static int commonCounter = 1;
  static int wetAreaCounter = 1;
  /*static int kitchenCounter = 1;
  static int commonAreaCounter = 1;*/
  /**           these limits are used for defining max distance that zone can spread.  **/

  static int entranceLimit = 250;
  static int commonLimit = 400;
  static int wetAreaLimit = 300;
  /*static int kitchenLimit = 200;
  static int commonAreaLimit = 100;*/

  static void StartZones(int[,,] arr)
  {
    /**
     * Randomly Starts the color. Takes the Color lists as argumnts
     * (We can delete these argumnents and it can get them as local referance
     * in our case it gives us a chance to choose what to initilize)
     * **/

    Random rand = new Random();
    //----------------------
    /* GetLength(0) and GetLength(1) might be set as variable */
    //Array.GetLength(0) gives the column lenght in other words length of an array
    //Array.GetLength(1) gives the row lenght in other words width of an array
    var a = rand.Next(arr.GetLength(0) / 2, arr.GetLength(0) / 2);
    var b = rand.Next(0, 2);

    Rhino.RhinoApp.WriteLine("started");
    entranceList.AddRange(new int[2] { a, b }); //AddRange ==> Adds multiple elements to a List . We use mod%2 to call the index of the point back instead of stacking them as an another List(or Array) in our list.
    arr[a, b, 0] = 1;// entrance Starting Point
    //----------------------

    b = rand.Next(0, arr.GetLength(1));
    a = rand.Next(0, arr.GetLength(0));

    commonList.AddRange(new int[2] { a, b });
    arr[a, b, 0] = 2; // common Starting Point
    //----------------------
    a = rand.Next(0, arr.GetLength(0));
    b = rand.Next(0, arr.GetLength(1));

    wetAreaList.AddRange(new int[2] { a, b });
    arr[a, b, 0] = 3; // wetArea Starting Point
    //----------------------
    a = rand.Next(0, arr.GetLength(0));
    b = rand.Next(0, arr.GetLength(1));
/*
    kitchenList.AddRange(new int[2] { a, b });
    arr[a, b, 0] = 4; // kitchen Starting Point
    //----------------------
    a = rand.Next(0, arr.GetLength(0));
    b = rand.Next(0, arr.GetLength(1));

    commonAreaList.AddRange(new int[2] { a, b });
    arr[a, b, 0] = 5; // commonArea Starting Point
    //----------------------
  */
  }
        /* Calculates the distance between initial point in the color and the possible new point!
         *  (if the possible new point is too far from inital point eleminate it.) */
  static double distanceCalculate(List<int> spaceCoordList, int x2, int y2, int cellSize)
  {
    var distance = cellSize * Math.Sqrt((y2 - spaceCoordList[1]) * (y2 - spaceCoordList[1]) + (x2 - spaceCoordList[0]) * (x2 - spaceCoordList[0]));
    return distance;
  }

  static void Evaluate()
  {
    // according to relations give score to the created zones
    // get the centers of the zones and acoording to the distances and created sizes give
    //positive or negative points and if score is not acceptable re-run and create variatians.
  }


  static void noiseFilter (int [,,] arr, int type, int iterationNumber, int controlNumber)
  {
    if(type == 0)
    {
      for( int loop = 0 ; loop < iterationNumber ; loop++ )
      {
        List < int> surrounding = new List<int>();
        for(int i = 1 ; i < arr.GetLength(0) - 1 ;i++)
        {
          for(int j = 1 ; j < arr.GetLength(1) - 1 ;j++)
          {
            for(int x = -1 ; x < 2;x++)
            {
              for(int y = -1 ; y < 2;y++)
              {
                if(!(x == y && x == 0))
                {

                  surrounding.Add(arr[i + x, j + y, 0]);
                }
              }
            }
            for (int v = 0 ; v < 6 ;v++) // 6 is the number of the zones including  empty cells
            {
              int count = (from z in surrounding where z == v select z).Count();
              if ( count >= controlNumber )
              {
                arr[i, j, 0] = v;
              }
            }
            surrounding.Clear();
            surrounding.TrimExcess();
          }
        }
      }
    }

    if(type == 1)
    {
      for( int loop = 0 ; loop < iterationNumber ; loop++ )
      {
        List < int> surrounding = new List<int>();
        for(int i = 1 ; i < arr.GetLength(0) - 1 ;i++)
        {
          for(int j = 1 ; j < arr.GetLength(1) - 1 ;j++)
          {
            for(int x = -1 ; x < 2;x++)
            {
              for(int y = -1 ; y < 2;y++)
              {
                if(!(x == y && x == 0) && ( (x + y == 1 ) || (x + y == -1 )) )
                {
                  surrounding.Add(arr[i + x, j + y, 0]);
                }
              }
            }

            for (int v = 0 ; v < 6 ;v++) // 6 is the number of the zones including  empty cells
            {
              int count = (from z in surrounding where z == v select z).Count();
              if ( count >= 2 )
              {
                arr[i, j, 0] = v;
              }
            }
            surrounding.Clear();
            surrounding.TrimExcess();
          }
        }
      }
    }
  }

  static void Spread(int[,,] arr, ref double spaceSize, List<int> spaceCoordList, ref int counter, int spaceLimit, int cellSize)
  {
        /*ARGUMENTS
     * The main array which has rectangular form(will be 3d in short) ,
     * spaceSize = Maximum limit that can grow.  ,
     * spaceCoordList =  the cells of the zone which has been already defined. )
     */
    var rand = new Random();
    var directionList = new List<int>();
    int Xcoord;
    int Ycoord;
    bool draw = false;
    int trycount = 0;

    while (draw == false && counter <= spaceSize)
    {
      if (counter <= spaceSize ) //Can be deleted. The condition is added to the While Loop Conditions.
      {
        var randomCellIndex = rand.Next(spaceCoordList.Count / 2);

        Xcoord = spaceCoordList[2 * randomCellIndex];
        Ycoord = spaceCoordList[2 * randomCellIndex + 1];

        if (Xcoord < arr.GetLength(0) - 1 && Xcoord > 0 && Ycoord > 0 && Ycoord < arr.GetLength(1) - 1)
        {
          /* Check the conditions INSIDE borders */
          if (arr[Xcoord + 1, Ycoord, 0] == 0 && distanceCalculate(spaceCoordList, Xcoord + 1, Ycoord, cellSize) < spaceLimit ) // Check if possible new cell is still white or not!
            directionList.AddRange(new int[2] { (Xcoord + 1), Ycoord }); //Store possible spread directions in a list.

          if (arr[Xcoord - 1, Ycoord, 0] == 0 && distanceCalculate(spaceCoordList, Xcoord - 1, Ycoord, cellSize) < spaceLimit)
            directionList.AddRange(new int[2] { (Xcoord - 1), Ycoord }); //Store possible spread directions in a list.

          if (arr[Xcoord, Ycoord + 1, 0] == 0 && distanceCalculate(spaceCoordList, Xcoord, Ycoord + 1, cellSize) < spaceLimit)
            directionList.AddRange(new int[2] { (Xcoord), Ycoord + 1 }); //Store possible spread directions in a list.

          if (arr[Xcoord, Ycoord - 1, 0] == 0 && distanceCalculate(spaceCoordList, Xcoord, Ycoord - 1, cellSize) < spaceLimit)
            directionList.AddRange(new int[2] { (Xcoord), (Ycoord - 1) }); //Store possible spread directions in a list.

          if (directionList.Count > 0)
          {
            var randomIndex = rand.Next(directionList.Count / 2);
            int a = directionList[2 * randomIndex];
            int b = directionList[2 * randomIndex + 1];

            arr[a, b, 0] = arr[Xcoord, Ycoord, 0];

            spaceCoordList.AddRange(new int[2] { a, b });

            directionList.Clear();
            directionList.TrimExcess();
            draw = true;
            counter++;
          }
          else
          {
            trycount++;
            if (trycount >= spaceCoordList.Count)
            {
              draw = true;
              //Print("trycountNumber is ={0}", trycount);
            }
          }
        }

          /* EDGE CONDITIONS */
          //RIGHT
        else if (Xcoord == (arr.GetLength(0) - 1) && Ycoord != 0 && Ycoord != (arr.GetLength(1) - 1))
        {
          if (arr[Xcoord - 1, Ycoord, 0] == 0 && distanceCalculate(spaceCoordList, Xcoord - 1, Ycoord, cellSize) < spaceLimit )
            directionList.AddRange(new int[2] { (Xcoord - 1), (Ycoord) }); //Store possible spread directions in a list.
          if (arr[Xcoord, Ycoord + 1, 0] == 0 && distanceCalculate(spaceCoordList, Xcoord, Ycoord + 1, cellSize) < spaceLimit )
            directionList.AddRange(new int[2] { (Xcoord ), (Ycoord + 1) }); //Store possible spread directions in a list.
          if (arr[Xcoord, Ycoord - 1, 0] == 0 && distanceCalculate(spaceCoordList, Xcoord, Ycoord - 1, cellSize) < spaceLimit )
            directionList.AddRange(new int[2] { (Xcoord ), (Ycoord - 1) }); //Store possible spread directions in a list.

          if (directionList.Count > 0)
          {
            var randomIndex = rand.Next(directionList.Count / 2);
            int a = directionList[2 * randomIndex];
            int b = directionList[2 * randomIndex + 1];

            arr[a, b, 0] = arr[Xcoord, Ycoord, 0];

            spaceCoordList.AddRange(new int[2] { a, b });

            directionList.Clear();
            directionList.TrimExcess();
            draw = true;
            counter++;
          }
          else
          {
            trycount++;
            if (trycount >= spaceCoordList.Count)
            {
              draw = true;
              //Print("trycountNumber is ={0}", trycount);
            }
          }
        }

          //Left
        else if (Xcoord == 0 && Ycoord != 0 && Ycoord != (arr.GetLength(1) - 1))
        {

          if (arr[Xcoord + 1, Ycoord, 0] == 0 && distanceCalculate(spaceCoordList, Xcoord + 1, Ycoord, cellSize) < spaceLimit )
            directionList.AddRange(new int[2] { (Xcoord + 1), (Ycoord) }); //Store possible spread directions in a list.
          if (arr[Xcoord, Ycoord + 1, 0] == 0 && distanceCalculate(spaceCoordList, Xcoord, Ycoord + 1, cellSize) < spaceLimit )
            directionList.AddRange(new int[2] { (Xcoord ), (Ycoord + 1) }); //Store possible spread directions in a list.
          if (arr[Xcoord, Ycoord - 1, 0] == 0 && distanceCalculate(spaceCoordList, Xcoord, Ycoord - 1, cellSize) < spaceLimit )
            directionList.AddRange(new int[2] { (Xcoord ), (Ycoord - 1) }); //Store possible spread directions in a list.
          if (directionList.Count > 0)
          {
            var randomIndex = rand.Next(directionList.Count / 2);
            int a = directionList[2 * randomIndex];
            int b = directionList[2 * randomIndex + 1];

            arr[a, b, 0] = arr[Xcoord, Ycoord, 0];

            spaceCoordList.AddRange(new int[2] { a, b });

            directionList.Clear();
            directionList.TrimExcess();
            draw = true;
            counter++;
          }
          else
          {
            trycount++;
            if (trycount >= spaceCoordList.Count)
            {
              draw = true;
              //Print("trycountNumber is ={0}", trycount);
            }
          }

        }
          //TOP
        else if ((Ycoord == arr.GetLength(1) - 1) && Xcoord != 0 && Xcoord != (arr.GetLength(0) - 1))
        {

          if (arr[Xcoord, Ycoord - 1, 0] == 0 && distanceCalculate(spaceCoordList, Xcoord, Ycoord - 1, cellSize) < spaceLimit )
            directionList.AddRange(new int[2] { (Xcoord ), (Ycoord - 1) }); //Store possible spread directions in a list.
          if (arr[Xcoord + 1, Ycoord, 0] == 0 && distanceCalculate(spaceCoordList, Xcoord + 1, Ycoord, cellSize) < spaceLimit )
            directionList.AddRange(new int[2] { (Xcoord + 1 ), (Ycoord ) }); //Store possible spread directions in a list.
          if (arr[Xcoord - 1, Ycoord, 0] == 0 && distanceCalculate(spaceCoordList, Xcoord - 1, Ycoord, cellSize) < spaceLimit )
            directionList.AddRange(new int[2] { (Xcoord - 1), (Ycoord ) }); //Store possible spread directions in a list.
          if (directionList.Count > 0)
          {
            var randomIndex = rand.Next(directionList.Count / 2);
            int a = directionList[2 * randomIndex];
            int b = directionList[2 * randomIndex + 1];

            arr[a, b, 0] = arr[Xcoord, Ycoord, 0];

            spaceCoordList.AddRange(new int[2] { a, b });

            directionList.Clear();
            directionList.TrimExcess();
            draw = true;
            counter++;
          }
          else
          {
            trycount++;
            if (trycount >= spaceCoordList.Count)
            {
              draw = true;
              //Print("trycountNumber is ={0}", trycount);
            }
          }
        }
          //BOTTOM
        else if (Ycoord == 0 && Xcoord != 0 && Xcoord != (arr.GetLength(0) - 1))
        {
          if (arr[Xcoord, Ycoord + 1, 0] == 0 && distanceCalculate(spaceCoordList, Xcoord, Ycoord + 1, cellSize) < spaceLimit )
            directionList.AddRange(new int[2] { (Xcoord ), (Ycoord + 1) }); //Store possible spread directions in a list.
          if (arr[Xcoord + 1, Ycoord, 0] == 0 && distanceCalculate(spaceCoordList, Xcoord + 1, Ycoord, cellSize) < spaceLimit )
            directionList.AddRange(new int[2] { (Xcoord + 1 ), (Ycoord ) }); //Store possible spread directions in a list.
          if (arr[Xcoord - 1, Ycoord, 0] == 0 && distanceCalculate(spaceCoordList, Xcoord - 1, Ycoord, cellSize) < spaceLimit )
            directionList.AddRange(new int[2] { (Xcoord - 1), (Ycoord ) }); //Store possible spread directions in a list.
          if (directionList.Count > 0)
          {
            var randomIndex = rand.Next(directionList.Count / 2);
            int a = directionList[2 * randomIndex];
            int b = directionList[2 * randomIndex + 1];

            arr[a, b, 0] = arr[Xcoord, Ycoord, 0];

            spaceCoordList.AddRange(new int[2] { a, b });

            directionList.Clear();
            directionList.TrimExcess();
            draw = true;
            counter++;
          }
          else
          {
            trycount++;
            if (trycount >= spaceCoordList.Count)
            {
              draw = true;
              //Print("trycountNumber is ={0}", trycount);
            }
          }
        }

          //LEFT BOTTOM
        else if (Xcoord == 0 && Ycoord == 0)
        {
          if (arr[Xcoord, Ycoord + 1, 0] == 0 && distanceCalculate(spaceCoordList, Xcoord, Ycoord + 1, cellSize) < spaceLimit)
            directionList.Add(Xcoord); directionList.Add(Ycoord + 1);

          if (arr[Xcoord + 1, Ycoord, 0] == 0 && distanceCalculate(spaceCoordList, Xcoord + 1, Ycoord, cellSize) < spaceLimit)
            directionList.Add(Xcoord + 1); directionList.Add(Ycoord);

          if (directionList.Count > 0)
          {

            var randomIndex = rand.Next(directionList.Count / 2);

            int a = directionList[2 * randomIndex];
            int b = directionList[2 * randomIndex + 1];

            arr[a, b, 0] = arr[Xcoord, Ycoord, 0];

            spaceCoordList.AddRange(new int[2] { a, b });

            directionList.Clear();
            directionList.TrimExcess();
            draw = true;

            counter++;
            //Print(" Counter Number is : {0}", counter);
          }
          else
          {
            trycount++;
            if (trycount >= spaceCoordList.Count)
            {
              draw = true;
              //Print("trycountNumber is ={0}", trycount);
            }
          }
        }
          //LEFT  TOP
          /*
          else if (Xcoord == 0 && Ycoord == (arr.GetLength(1) - 1))
          {
          if (arr[Xcoord + 1, Ycoord] == 0)
          directionList.Add(Xcoord + 1); directionList.Add(Ycoord);

          if (arr[Xcoord, Ycoord - 1] == 0)
          directionList.Add(Xcoord); directionList.Add(Ycoord - 1);

          if (directionList.Count > 0)
          {
          var randomIndex = rand.Next(directionList.Count / 2);

          int a = directionList[2 * randomIndex];
          int b = directionList[2 * randomIndex + 1];

          Rhino.RhinoApp.WriteLine("Left Top "  +  a +  " "  +  b);
          arr[a, b] = arr[Xcoord, Ycoord];

          spaceCoordList.AddRange(new int[2] { a, b });

          directionList.Clear();
          directionList.TrimExcess();
          draw = true;

          counter++;
          //Print(" Counter Number is : {0}", counter);
          }
          else
          {
          trycount++;
          if (trycount >= spaceCoordList.Count)
          {
          draw = true;
          //Print("trycountNumber is ={0}", trycount);
          }
          }
          }
          */
          /*
          //RIGHT TOP
          else if (Xcoord == (arr.GetLength(0) - 1) && Ycoord == (arr.GetLength(1) - 1))
          {
          if (arr[Xcoord, Ycoord - 1] == 0)
          directionList.Add(Xcoord); directionList.Add(Ycoord - 1);

          if (arr[Xcoord - 1, Ycoord] == 0)
          directionList.Add(Xcoord - 1); directionList.Add(Ycoord);

          if (directionList.Count > 0)
          {
          var randomIndex = rand.Next(directionList.Count / 2);

          int a = directionList[2 * randomIndex];
          int b = directionList[2 * randomIndex + 1];
          Rhino.RhinoApp.WriteLine(" Right top "+ a + " " + b);
          arr[a, b] = arr[Xcoord, Ycoord];

          //spaceCoordList.AddRange(new int[2] { a, b });

          directionList.Clear();
          directionList.TrimExcess();
          draw = true;

          counter++;
          //Print(" Counter Number is : {0}", counter);
          }
          else
          {
          trycount++;
          if (trycount >= spaceCoordList.Count)
          {
          draw = true;
          //Print("trycountNumber is ={0}", trycount);
          }
          }
          }
          */
          //RIGHT BOTTOM
        else if (Xcoord == (arr.GetLength(0) - 1) && Ycoord == 0)
        {
          if (arr[Xcoord, Ycoord + 1, 0] == 0)
            directionList.Add(Xcoord); directionList.Add(Ycoord + 1);

          if (arr[Xcoord - 1, Ycoord, 0] == 0)
            directionList.Add(Xcoord - 1); directionList.Add(Ycoord);

          if (directionList.Count > 0)
          {
            var randomIndex = rand.Next(directionList.Count / 2);

            int a = directionList[2 * randomIndex];
            int b = directionList[2 * randomIndex + 1];

            arr[a, b, 0] = arr[Xcoord, Ycoord, 0];

            spaceCoordList.AddRange(new int[2] { a, b });

            directionList.Clear();
            directionList.TrimExcess();

            draw = true;
            counter++;
            //Print(" Counter Number is : {0}", counter);
          }
          else
          {
            trycount++;
            if (trycount >= spaceCoordList.Count)
            {
              draw = true;
              //Print("trycountNumber is ={0}", trycount);
            }
          }
        }
        /* EDGE CONDITIONS */
      }
    }

  }




    /* Instead of wrting methods seperately in main program, it is better to use class based
     informations to keep things organized, we are not yet transsferentrance methods here but we created the str.*/

    /*
    public class Zone
    {
        public string Name;
        public int SpaceLimit;
        public Int16 SpaceSize;
        public int Counter;
        public List<Int16> SpaceList;

        public void Describe()
        {
            Console.WriteLine("Hey this zone is{ 0} ", Name);
        }

        public Zone()
        {
           // SpaceList = new List<int>();
        }

        public Zone(string name, int spaceLimit,int spacesize,int counter, List<int> SpaceList)
        :this()
        {
        }
        static void InitializeZeroMatrice() { }
        static void startZones() { }
        public void SpreadZones() { }

    }
    */
# ---------- end c_script_7 ----------
box_77 = Box(c_script_7.Furnitures)  # disabled
deconstruct_box_25 = DeconstructBox(Box=box_77)  # -> Plane, X, Y, Z; disabled
panel_140 = Panel(deconstruct_box_25.Plane)  # disabled
panel_141 = Panel(deconstruct_box_25.Y)  # disabled
panel_142 = Panel(deconstruct_box_25.X)  # disabled
panel_143 = Panel(deconstruct_box_25.Z)  # disabled
boolean_toggle_3 = BooleanToggle(False)  # disabled
deconstruct_domain_45 = DeconstructDomain(Domain=panel_137)  # -> Start, End; disabled
deconstruct_domain_46 = DeconstructDomain(Domain=panel_139)  # -> Start, End; disabled
deconstruct_domain_47 = DeconstructDomain(Domain=panel_138)  # -> Start, End; disabled
deconstruct_domain_48 = DeconstructDomain(Domain=panel_141)  # -> Start, End; disabled
deconstruct_domain_49 = DeconstructDomain(Domain=panel_142)  # -> Start, End; disabled
box_78 = Box(c_script_7.Bxx)  # disabled
panel_144 = Panel(deconstruct_domain_46.End)  # disabled
panel_145 = Panel(deconstruct_domain_45.End)  # disabled
panel_146 = Panel(deconstruct_domain_47.End)  # disabled
panel_147 = Panel(box_78)  # disabled
panel_148 = Panel(deconstruct_domain_48.End)  # disabled
panel_149 = Panel(deconstruct_domain_49.End)  # disabled
list_item_5 = ListItem(List=c_script_7.Furnitures, Index=number_slider_50, Wrap=boolean_toggle_3)  # disabled
# Spreading
panel_150 = Panel(c_script_7.out)  # disabled
number_slider_51 = Slider(0, range=0..1)  # disabled
number_slider_52 = Slider(0.611, range=0..1)  # disabled
number_slider_53 = Slider(0.544, range=0..1)  # disabled
colour_swatch_23 = ColourSwatch(SwatchColor=RGB(0, 0, 0))  # disabled
colour_swatch_24 = ColourSwatch(SwatchColor=RGB(0, 0, 0))  # disabled
colour_swatch_25 = ColourSwatch(SwatchColor=RGB(255, 255, 0))  # disabled
colour_swatch_26 = ColourSwatch(SwatchColor=RGB(0, 0, 0))  # disabled
colour_swatch_27 = ColourSwatch(SwatchColor=RGB(255, 255, 255))  # disabled
colour_swatch_28 = ColourSwatch(SwatchColor=RGB(240, 240, 200))  # disabled
colour_swatch_29 = ColourSwatch(SwatchColor=RGB(240, 200, 200))  # disabled
colour_swatch_30 = ColourSwatch(SwatchColor=RGB(150, 200, 255))  # disabled

# ---- group: Visualize as 3D Boxes
number_slider_54 = Slider(0.428, range=0..1)  # disabled
create_material_25 = CreateMaterial(Diffuse=colour_swatch_28, Specular=RGB(255, 255, 255), Emission=RGB(0, 0, 0), Transparency=number_slider_54, Shine=0)  # disabled
create_material_26 = CreateMaterial(Diffuse=colour_swatch_25, Specular=RGB(255, 255, 255), Emission=RGB(0, 0, 0), Transparency=number_slider_54, Shine=0)  # disabled
create_material_27 = CreateMaterial(Diffuse=colour_swatch_29, Specular=RGB(255, 255, 255), Emission=RGB(0, 0, 0), Transparency=number_slider_54, Shine=0)  # disabled
create_material_28 = CreateMaterial(Diffuse=colour_swatch_30, Specular=RGB(255, 255, 255), Emission=RGB(0, 0, 0), Transparency=number_slider_54, Shine=0)  # disabled
create_material_29 = CreateMaterial(Diffuse=colour_swatch_26, Specular=RGB(255, 255, 255), Emission=RGB(0, 0, 0), Transparency=number_slider_54, Shine=0)  # disabled
create_material_30 = CreateMaterial(Diffuse=colour_swatch_27, Specular=RGB(255, 255, 255), Emission=RGB(0, 0, 0), Transparency=number_slider_53, Shine=0)  # disabled
custom_preview_21 = CustomPreview(Geometry=c_script_7.EntranceBoxes, Material=create_material_25)  # disabled
custom_preview_22 = CustomPreview(Geometry=c_script_7.CommonBoxes, Material=create_material_27)  # disabled
custom_preview_23 = CustomPreview(Geometry=c_script_7.WetAreaBoxes, Material=create_material_28)  # disabled
custom_preview_24 = CustomPreview(Geometry=c_script_7.K, Material=create_material_29)  # disabled
custom_preview_25 = CustomPreview(Geometry=c_script_7.W, Material=create_material_30)  # disabled
custom_preview_26 = CustomPreview(Geometry=c_script_7.Y, Material=create_material_26)  # disabled

# ----
create_material_31 = CreateMaterial(Diffuse=colour_swatch_23, Specular=RGB(255, 255, 255), Emission=RGB(0, 0, 0), Transparency=number_slider_51, Shine=0)  # disabled
create_material_32 = CreateMaterial(Diffuse=colour_swatch_24, Specular=RGB(255, 255, 255), Emission=RGB(0, 0, 0), Transparency=number_slider_52, Shine=0)  # disabled
custom_preview_27 = CustomPreview(Geometry=c_script_7.Furnitures, Material=create_material_31)  # disabled
custom_preview_28 = CustomPreview(Geometry=c_script_7.FurnituresMargins, Material=create_material_32)  # disabled
list_length_13 = ListLength(List=c_script_7.EntranceBoxes)  # disabled
list_length_14 = ListLength(List=c_script_7.CommonBoxes)  # disabled
list_length_15 = ListLength(List=c_script_7.W)  # disabled
list_length_16 = ListLength(List=c_script_7.WetAreaBoxes)  # disabled
list_length_17 = ListLength(List=c_script_7.Y)  # disabled
list_length_18 = ListLength(List=c_script_7.K)  # disabled
multiplication_38 = Multiplication(A=list_length_14, B=division_13)  # disabled
multiplication_39 = Multiplication(A=list_length_13, B=division_13)  # disabled
multiplication_40 = Multiplication(A=list_length_15, B=division_13)  # disabled
multiplication_41 = Multiplication(A=list_length_16, B=division_13)  # disabled
multiplication_42 = Multiplication(A=list_length_17, B=division_13)  # disabled
multiplication_43 = Multiplication(A=list_length_18, B=division_13)  # disabled
panel_151 = Panel("m2 ")  # disabled
panel_152 = Panel(multiplication_39)  # disabled
panel_153 = Panel(" Entrance = ")  # disabled
panel_154 = Panel(" Empty Space= ")  # disabled
panel_155 = Panel(multiplication_40)  # disabled
panel_156 = Panel("m2 ")  # disabled
panel_157 = Panel("m2 ")  # disabled
panel_158 = Panel(multiplication_38)  # disabled
panel_159 = Panel(" CommonArea = ")  # disabled
panel_160 = Panel("m2 ")  # disabled
panel_161 = Panel(multiplication_41)  # disabled
panel_162 = Panel("Wet Area = ")  # disabled
panel_163 = Panel(multiplication_42)  # disabled
panel_164 = Panel(" Common Area = ")  # disabled
panel_165 = Panel("m2 ")  # disabled
panel_166 = Panel(" Kitchen = ")  # disabled
panel_167 = Panel(" m2 ")  # disabled
panel_168 = Panel(multiplication_43)  # disabled
number_slider_55 = Slider(15, range=0..100)  # disabled
concatenate_15 = Concatenate(Fragment_A=panel_154, Fragment_B=panel_155, Fragment_C=panel_157)  # disabled
concatenate_16 = Concatenate(Fragment_A=panel_153, Fragment_B=panel_152, Fragment_C=panel_151)  # disabled
panel_169 = Panel("0,-50")  # disabled
concatenate_17 = Concatenate(Fragment_A=panel_159, Fragment_B=panel_158, Fragment_C=panel_156)  # disabled
panel_170 = Panel("0,-80")  # disabled
panel_171 = Panel("0,-140")  # disabled
concatenate_18 = Concatenate(Fragment_A=panel_162, Fragment_B=panel_161, Fragment_C=panel_160)  # disabled
concatenate_19 = Concatenate(Fragment_A=panel_166, Fragment_B=panel_163, Fragment_C=panel_165)  # disabled
concatenate_20 = Concatenate(Fragment_A=panel_164, Fragment_B=panel_168, Fragment_C=panel_167)  # disabled
panel_172 = Panel(concatenate_15)  # disabled
panel_173 = Panel(concatenate_16)  # disabled
panel_174 = Panel(concatenate_17)  # disabled
panel_175 = Panel(concatenate_18)  # disabled
panel_176 = Panel(concatenate_19)  # disabled
panel_177 = Panel(concatenate_20)  # disabled
panel_178 = Panel("240,-170")  # disabled
panel_179 = Panel("0,-110")  # disabled
text_tag_3d_15 = TextTag3D(Location=panel_169, Text=concatenate_16, Size=number_slider_55, Colour=colour_swatch_28, Justification=7)  # disabled
text_tag_3d_16 = TextTag3D(Location=panel_170, Text=concatenate_17, Size=number_slider_55, Colour=colour_swatch_29, Justification=7)  # disabled
text_tag_3d_17 = TextTag3D(Location=panel_171, Text=concatenate_19, Size=number_slider_55, Colour=colour_swatch_25, Justification=7)  # disabled
text_tag_3d_18 = TextTag3D(Location=panel_179, Text=concatenate_18, Size=number_slider_55, Colour=colour_swatch_30, Justification=7)  # disabled
text_tag_3d_19 = TextTag3D(Location=panel_171, Text=concatenate_15, Size=number_slider_55, Colour=colour_swatch_27, Justification=7)  # disabled
text_tag_3d_20 = TextTag3D(Location=panel_178, Text=concatenate_20, Size=number_slider_55, Colour=colour_swatch_26, Justification=7)  # disabled
mass_addition_3 = MassAddition(Input=[multiplication_38, multiplication_39, multiplication_41, multiplication_42, multiplication_43, multiplication_40])  # -> flatten(Result), PartialResults; disabled
number_slider_56 = Slider(1, range=0..1)  # disabled
panel_181 = Panel(" Total Area =")  # disabled
panel_182 = Panel("m2 ")  # disabled
list_item_6 = ListItem(List=mass_addition_3.Result, Index=number_slider_56, Wrap=True)  # disabled
panel_183 = Panel(list_item_6)  # disabled
panel_184 = Panel("240,-100")  # disabled
concatenate_21 = Concatenate(Fragment_A=panel_181, Fragment_B=panel_183, Fragment_C=panel_182)  # disabled
panel_185 = Panel(concatenate_21)  # disabled
text_tag_3d_21 = TextTag3D(Location=panel_184, Text=concatenate_21, Size=number_slider_55, Justification=7)  # disabled

# ----
# left
# WET AREA
# right
# front
# front
# front
# front
# front
number_slider_57 = Slider(100, range=0..100)
vector_xyz_11 = VectorXYZ(XComponent=Slider(0, range=-100..101), YComponent=0, ZComponent=0)  # -> Vector, Length
vector_xyz_12 = VectorXYZ(XComponent=0, YComponent=0, ZComponent=number_slider_57)  # -> Vector, Length
vector_xyz_13 = VectorXYZ(XComponent=Slider(0, range=0..100), YComponent=0, ZComponent=0)  # -> Vector, Length
vector_xyz_14 = VectorXYZ(XComponent=Slider(0, range=-1000..100), YComponent=0, ZComponent=0)  # -> Vector, Length
vector_xyz_15 = VectorXYZ(XComponent=0, YComponent=0, ZComponent=Slider(85, range=0..200))  # -> Vector, Length
toılet = DomainBox(Base=vector_xyz_11.Vector, X=Slider(36, range=0..100), Y=Slider(54, range=0..100), Z=Slider(50, range=0..100))
dressing_cabin = DomainBox(Base=vector_xyz_14.Vector, X=Slider(80, range=0..100), Y=Slider(80, range=0..100), Z=Slider(200, range=0..300))
mirror_cupboard = DomainBox(Base=vector_xyz_12.Vector, X=Slider(60, range=0..100), Y=Slider(15, range=0..100), Z=Slider(60, range=0..300))
shower_cabin = DomainBox(Base=vector_xyz_13.Vector, X=Slider(80, range=0..100), Y=Slider(80, range=0..100), Z=Slider(210, range=0..300))
sink_cupboard = DomainBox(Base=vector_xyz_15.Vector, X=Slider(55, range=0..100), Y=Slider(40, range=0..100), Z=Slider(37, range=0..300))
deconstruct_box_26 = DeconstructBox(Box=toılet)  # -> Plane, X, Y, Z
deconstruct_box_27 = DeconstructBox(Box=mirror_cupboard)  # -> Plane, X, Y, Z
deconstruct_box_28 = DeconstructBox(Box=shower_cabin)  # -> Plane, X, Y, Z
deconstruct_box_29 = DeconstructBox(Box=sink_cupboard)  # -> Plane, X, Y, Z
deconstruct_box_30 = DeconstructBox(Box=dressing_cabin)  # -> Plane, X, Y, Z
deconstruct_domain_50 = DeconstructDomain(Domain=deconstruct_box_26.Y)  # -> Start, End
deconstruct_domain_51 = DeconstructDomain(Domain=deconstruct_box_26.Z)  # -> Start, End
deconstruct_domain_52 = DeconstructDomain(Domain=deconstruct_box_26.X)  # -> Start, End
deconstruct_domain_53 = DeconstructDomain(Domain=deconstruct_box_28.Y)  # -> Start, End
deconstruct_domain_54 = DeconstructDomain(Domain=deconstruct_box_27.Y)  # -> Start, End
deconstruct_domain_55 = DeconstructDomain(Domain=deconstruct_box_30.Y)  # -> Start, End
deconstruct_domain_56 = DeconstructDomain(Domain=deconstruct_box_29.Y)  # -> Start, End
addition_45 = Addition(A=deconstruct_domain_51.End, B=Slider(160, range=0..160))
addition_46 = Addition(A=deconstruct_domain_52.End, B=Slider(30, range=0..100))
addition_47 = Addition(A=deconstruct_domain_54.End, B=Slider(85, range=0..100))
addition_48 = Addition(A=deconstruct_domain_53.End, B=Slider(60, range=0..100))
addition_49 = Addition(A=deconstruct_domain_55.End, B=Slider(60, range=0..100))
addition_50 = Addition(A=deconstruct_domain_56.End, B=Slider(60, range=0..100))
construct_domain_6 = ConstructDomain(DomainStart=deconstruct_domain_51.Start, DomainEnd=addition_45)
construct_domain_7 = ConstructDomain(DomainStart=deconstruct_domain_54.Start, DomainEnd=addition_47)
construct_domain_8 = ConstructDomain(DomainStart=deconstruct_domain_53.Start, DomainEnd=addition_48)
construct_domain_9 = ConstructDomain(DomainStart=deconstruct_domain_55.Start, DomainEnd=addition_49)
construct_domain_10 = ConstructDomain(DomainStart=deconstruct_domain_56.Start, DomainEnd=addition_50)
domain_box = DomainBox(Base=mirror_cupboard, X=deconstruct_box_27.X, Y=construct_domain_7, Z=deconstruct_box_27.Z)
shower_cabin_2 = DomainBox(Base=shower_cabin, X=deconstruct_box_28.X, Y=construct_domain_8, Z=deconstruct_box_28.Z)
shower_cabin_margin = DomainBox(Base=dressing_cabin, X=deconstruct_box_30.X, Y=construct_domain_9, Z=deconstruct_box_30.Z)

deconstruct_domain_57 = DeconstructDomain(Domain=deconstruct_box_29.Z)  # -> Start, End
addition_51 = Addition(A=deconstruct_domain_50.End, B=Slider(60, range=0..101))
addition_52 = Addition(A=deconstruct_domain_52.Start, B=Slider(-20, range=-20..100))
addition_53 = Addition(A=deconstruct_domain_57.End, B=Slider(100, range=0..160))
construct_domain_11 = ConstructDomain(DomainStart=deconstruct_domain_57.Start, DomainEnd=addition_53)

construct_domain_12 = ConstructDomain(DomainStart=addition_52, DomainEnd=addition_46)
construct_domain_13 = ConstructDomain(DomainStart=deconstruct_domain_50.Start, DomainEnd=addition_51)
toilet_margin = DomainBox(Base=toılet, X=construct_domain_12, Y=construct_domain_13, Z=construct_domain_6)
sink_margin = DomainBox(Base=sink_cupboard, X=deconstruct_box_29.X, Y=construct_domain_10, Z=construct_domain_11)

custom_preview_29 = CustomPreview(Geometry=[toilet_margin, sink_margin, shower_cabin_2, shower_cabin_margin], Material=create_material_3)  # disabled
custom_preview_30 = CustomPreview(Geometry=[toılet, sink_cupboard, shower_cabin, dressing_cabin], Material=create_material_4)  # disabled
box_79 = Box(shower_cabin)
box_80 = Box(toilet_margin)
box_81 = Box(sink_cupboard)
box_82 = Box(sink_margin)
box_83 = Box(shower_cabin_2)
box_84 = Box(toılet)
c_script_8 = CSharpScript(
    Width=integer_2,
    Length=integer,
    Height=integer_3,
    LevelHeight=Slider(150, range=0..1000),
    cellSize=multiplication_4,
    ExteriorDoor=box_10,
    ExteriorDoorMargin=box_11,
    ChangeOverZone=box_6,
    ChangeOverZoneMargin=box_14,
    Closet=box_7,
    ClosetMargin=box_5,
    InteriorDoor=box_8,
    InteriorDoorMargin=box_9,
    Counter=box_12,
    CounterMargin=box_13,
    Table=box_15,
    TableMargin=box_16,
    SittingUnit=box_18,
    SittingUnitMargin=box_21,
    Bed=box_22,
    HealtCare=box_19,
    HealthCareMargin=box_20,
    Toilet=box_84,
    ToiletMargin=box_80,
    Sink=box_81,
    SinkMargin=box_82,
    SowerCabin=box_79,
    ShowerCabinMargin=box_83)  # -> out, A, EntranceBoxes, CommonBoxes, WetAreaBoxes, Y, K, W, Furnitures, FurnituresMargins; inputs Width: Int32, Length: Int32, Height: Int32, LevelHeight: Int32, cellSize: Int32, ExteriorDoor: Box, ExteriorDoorMargin: Box, ChangeOverZone: Box, ChangeOverZoneMargin: Box, Closet: Box, ClosetMargin: Box, InteriorDoor: Box, InteriorDoorMargin: Box, Counter: Box, CounterMargin: Box, Table: Box, TableMargin: Box, SittingUnit: Box, SittingUnitMargin: Box, Bed: Box, BedMargin: Box, HealtCare: Box, HealthCareMargin: Box, Toilet: Box, ToiletMargin: Box, Sink: Box, SinkMargin: Box, SowerCabin: Box; disabled
# ---------- c_script_8: C# ----------
    List<Box> entranceBoxes = new List<Box>();
    List<Box> commonBoxes = new List<Box>();
    List<Box> wetAreaBoxes = new List<Box>();

    /*List<Box> kitchenBoxes = new List<Box>();
      List<Box> commonAreaBoxes = new List<Box>();*/

    List<Box> WhiteBoxes = new List<Box>();

    /**  These sizes are Spreading Limits for the spaces   //total cells     **/
 
    double entranceSize = (7 * 100 * 100) / (cellSize * cellSize);
    double commonSize = (9 * 100 * 100) / (cellSize * cellSize);
    double wetAreaSize = (7 * 100 * 100 ) / (cellSize * cellSize);

    /*
    double kitchenSize = 7 * 100 * 100 / cellSize * cell  Size;
    double commonAreaSize = 10 * 100 * 100 / cellSize * cellSize;
    */

    Point3d pA = new Point3d(0, 0, 0);
    Point3d pB = new Point3d(10, 0, 0);
    Point3d pC = new Point3d(0, 10, 0);

    Plane p = new Plane(pA, pB, pC);

    int width = Width;
    int length = Length;
    int levelHeight = LevelHeight;
    int height = Height;
    int levelNumber = Height / LevelHeight;

    int[,,] areaArray = InitializeZeroMatrice(length, width, levelNumber);
    StartZones(areaArray);

    int[,,] emptyFullArray = InitializeZeroMatrice(length, width, levelNumber);

    for (int i = 0; i < width * length * 3; i++)
    {
      //Rhino.RhinoApp.WriteLine("\n Loop Runs" + i.ToString());

      Spread(areaArray, ref entranceSize, entranceList, ref entranceCounter, entranceLimit, cellSize);
      /*Rhino.RhinoApp.WriteLine("Entrance size" + entranceSize.ToString());
      Rhino.RhinoApp.WriteLine("Entrance counter" + entranceCounter.ToString());
      Rhino.RhinoApp.WriteLine("\n ");*/


      Spread(areaArray, ref commonSize, commonList, ref commonCounter, commonLimit, cellSize);
      /*Rhino.RhinoApp.WriteLine("Common size" + commonSize.ToString());
      Rhino.RhinoApp.WriteLine("Common counter" + commonCounter.ToString());*/

      Spread(areaArray, ref wetAreaSize, wetAreaList, ref wetAreaCounter, wetAreaLimit, cellSize);

      /*Spread(areaArray, ref kitchenSize, kitchenList, ref kitchenCounter, kitchenLimit, cellSize);
      Spread(areaArray, ref commonAreaSize, commonAreaList, ref commonAreaCounter, commonAreaLimit, cellSize);*/
    }

    noiseFilter(areaArray, 0, 3, 5);
    noiseFilter(areaArray, 1, 2, 2);

    for (int k = 0;k < levelNumber;k++)
    {
      for (int i = 0;i < length;i++)
      {
        for (int j = 0;j < width;j++)
        {
          areaArray[i, j, k] = areaArray[i, j, 0];
        }
      }
    }

    for (int k = 0;k < levelNumber;k++)
    {
      for (int i = 0;i < length;i++)
      {
        for (int j = 0;j < width;j++)
        {
          emptyFullArray[i, j, k] = 0;
        }
      }
    }

    entranceList.Clear();
    commonList.Clear();
    wetAreaList.Clear();
    /*kitchenList.Clear();
    commonAreaList.Clear();*/

    for (int k = 0;k < levelNumber;k++)
    {
      for (int i = 0;i < length;i++)
      {
        for (int j = 0;j < width;j++)
        {
          if (areaArray[i, j, k] == 1)
          {
            Interval xInterval = new Interval(i * cellSize, (i + 1) * (cellSize ));
            Interval yInterval = new Interval(j * cellSize, (j + 1) * (cellSize ));
            Interval zInterval = new Interval(k * LevelHeight, k * LevelHeight + levelHeight);

            Box boxgh = new Box(p, xInterval, yInterval, zInterval);
            entranceBoxes.Add(boxgh);
            entranceList.AddRange(new int[2] { i, j });
          }
          if (areaArray[i, j, k] == 2)
          {
            Interval xInterval = new Interval(i * cellSize, (i + 1) * (cellSize ));
            Interval yInterval = new Interval(j * cellSize, (j + 1) * (cellSize ));
            Interval zInterval = new Interval(k * LevelHeight, k * LevelHeight + levelHeight);

            Box boxgh = new Box(p, xInterval, yInterval, zInterval);
            commonBoxes.Add(boxgh);
            commonList.AddRange(new int[2] { i, j });
          }
          if (areaArray[i, j, k] == 3)
          {
            Interval xInterval = new Interval(i * cellSize, (i + 1) * (cellSize ));
            Interval yInterval = new Interval(j * cellSize, (j + 1) * (cellSize ));
            Interval zInterval = new Interval(k * LevelHeight, k * LevelHeight + levelHeight);

            Box boxgh = new Box(p, xInterval, yInterval, zInterval);
            wetAreaBoxes.Add(boxgh);
            wetAreaList.AddRange(new int[2] { i, j });
          }

          /*if (areaArray[i, j, k] == 4)
          {
            Interval xInterval = new Interval(j * cellSize, (j + 1) * (cellSize ));
            Interval yInterval = new Interval(i * cellSize, (i + 1) * (cellSize ));
            Interval zInterval = new Interval(k * LevelHeight, k * LevelHeight + levelHeight);

            Box boxgh = new Box(p, xInterval, yInterval, zInterval);
            kitchenBoxes.Add(boxgh);
            kitchenList.AddRange(new int[2] { i, j });
          }
          if (areaArray[i, j, k] == 5)
          {
            Interval xInterval = new Interval(j * cellSize, (j + 1) * (cellSize ));
            Interval yInterval = new Interval(i * cellSize, (i + 1) * (cellSize ));
            Interval zInterval = new Interval(k * LevelHeight, k * LevelHeight + levelHeight);

            Box boxgh = new Box(p, xInterval, yInterval, zInterval);
            commonAreaBoxes.Add(boxgh);
            commonAreaList.AddRange(new int[2] { i, j });
          }*/
          if (areaArray[i, j, k] == 0)
          {

            Interval xInterval = new Interval(i * cellSize, (i + 1) * (cellSize ));
            Interval yInterval = new Interval(j * cellSize, (j + 1) * (cellSize ));
            Interval zInterval = new Interval(k * LevelHeight, k * LevelHeight + levelHeight);

            Box boxgh = new Box(p, xInterval, yInterval, zInterval);
            WhiteBoxes.Add(boxgh);
            //WhiteList.AddRange(i, j);
          }
        }
      }
    }
    List<Box> ObjectsList = new List<Box>();
    List<Box> MarginsList = new List<Box>();


    /* FURNITURE LAYOUT ==> ENTRANCE STARTED */


    Point3d pointa = new Point3d(0, 0, 0);
    Vector3d vectorb = new Vector3d(0, 0, 1);

    Plane planebase = new Plane(pointa, vectorb);

    Interval xInter = new Interval(0, 10);
    Interval yInter = new Interval(0, 10);
    Interval zInter = new Interval(0, 10);


    Box ObjBox = new Box(planebase, xInter, yInter, zInter);
    Box marginBox = new Box(planebase, xInter, yInter, zInter);


    /* ENTRANCE REFERENCE */
    var exteriorDoorO = new Objects
      {
        Name = "Exterior Door",
        ZoneName = 1,

        Obj = ExteriorDoor,
        ObjMargin = ExteriorDoorMargin,

        Front = true,
        Right = true,
        Back = false,
        Left = true,
        Top = false,
        Bottom = false,

        RotationBool = false,
        RotationOpt = 2,

        MirrorBool = false,
        MirrorOpt = 2,

        Source = "NULL",
        FixedToWall = 1,

        CellSize = 60,
        SpaceList = entranceList,

        //PreviousObject = changeOverZoneO

        };
    exteriorDoorO.assignDimensions();
    exteriorDoorO.placeRefObjectEntrance(emptyFullArray, areaArray, out ObjBox, out marginBox);

    ObjectsList.Add(ObjBox);
    MarginsList.Add(marginBox);



    /* ENTRANCE 2ND OBJECT */

    var changeOverZoneO = new Objects
      {
        Name = "changeOverZone",
        ZoneName = 1,

        Obj = ChangeOverZone,
        ObjMargin = ChangeOverZoneMargin,

        Front = true,
        Right = true,
        Back = false,
        Left = true,
        Top = false,
        Bottom = false,

        RotationBool = false,
        RotationOpt = 2,

        MirrorBool = false,
        MirrorOpt = 2,

        Source = "NULL",
        FixedToWall = 1,
        CellSize = 60,

        PreviousObject = exteriorDoorO,
        SpaceList = entranceList,

        };

    changeOverZoneO.assignDimensions();

    changeOverZoneO.placeFront(emptyFullArray, areaArray, out ObjBox, out marginBox);
    //changeOverZoneO.printDimensions();
    ObjectsList.Add(ObjBox);
    MarginsList.Add(marginBox);


    /* ENTRANCE 3RD OBJECT */
    var closetO = new Objects
      {
        Name = "closet",
        ZoneName = 1,

        Obj = Closet,
        ObjMargin = ClosetMargin,

        Front = true,
        Right = true,
        Back = false,
        Left = false,
        Top = false,
        Bottom = false,

        RotationBool = false,
        RotationOpt = 2,

        MirrorBool = false,
        MirrorOpt = 2,

        Source = "NULL",
        FixedToWall = 1,
        CellSize = 60,

        PreviousObject = changeOverZoneO,
        SpaceList = entranceList,

        };

    closetO.assignDimensions();

    closetO.placeFront(emptyFullArray, areaArray, out ObjBox, out marginBox);
    //changeOverZoneO.printDimensions();
    ObjectsList.Add(ObjBox);
    MarginsList.Add(marginBox);


    /* ENTRANCE 4TH OBJECT */
    var interiorDoorO = new Objects
      {
        Name = "Interior Door",
        ZoneName = 1,

        Obj = InteriorDoor,
        ObjMargin = InteriorDoorMargin,

        Front = false,
        Right = false,
        Back = false,
        Left = false,
        Top = false,
        Bottom = false,

        RotationBool = false,
        RotationOpt = 2,

        MirrorBool = false,
        MirrorOpt = 2,

        Source = "NULL",
        FixedToWall = 1,
        CellSize = 60,

        PreviousObject = closetO,
        SpaceList = entranceList,

        };

    interiorDoorO.assignDimensions();

    interiorDoorO.placeFront(emptyFullArray, areaArray, out ObjBox, out marginBox);

    ObjectsList.Add(ObjBox);
    MarginsList.Add(marginBox);

    /* FURNITURE LAYOUT ==> ENTRANCE ENDED */


    /* FURNITURE LAYOUT ==> COMMON STARTED */

    var counterO = new Objects
      {
        Name = "Counter",
        ZoneName = 2,

        Obj = Counter,
        ObjMargin = CounterMargin,

        Front = true,
        Right = true,
        Back = false,
        Left = false,
        Top = false,
        Bottom = false,

        RotationBool = false,
        RotationOpt = 2,

        MirrorBool = false,
        MirrorOpt = 2,

        Source = "NULL",
        FixedToWall = 1,

        CellSize = 60,
        SpaceList = commonList,


        };
    counterO.assignDimensions();
    counterO.placeRefObject(emptyFullArray, areaArray, out ObjBox, out marginBox);
    ObjectsList.Add(ObjBox);
    MarginsList.Add(marginBox);


    /* COMMONAREA 2ND OBJECT */

    var tableO = new Objects
      {
        Name = "Table",
        ZoneName = 2,

        Obj = Table,
        ObjMargin = TableMargin,

        Front = true,
        Right = true,
        Back = false,
        Left = false,
        Top = false,
        Bottom = false,

        RotationBool = false,
        RotationOpt = 2,

        MirrorBool = false,
        MirrorOpt = 2,

        Source = "NULL",
        FixedToWall = 1,
        CellSize = 60,

        PreviousObject = counterO,
        SpaceList = commonList,

        };

    tableO.assignDimensions();

/*
    Point3d pointa = new Point3d(0, 0, 0);
    Vector3d vectorb = new Vector3d(0, 0, 1);

    Plane planebase = new Plane(pointa, vectorb);

    Interval xInter = new Interval(0, 10);
    Interval yInter = new Interval(0, 10);
    Interval zInter = new Interval(0, 10);


    Box ObjBox = new Box(planebase, xInter, yInter, zInter);
    Box marginBox = new Box(planebase, xInter, yInter, zInter);
*/

    tableO.placeFront(emptyFullArray, areaArray, out ObjBox, out marginBox);
    //changeOverZoneO.printDimensions();
    ObjectsList.Add(ObjBox);
    MarginsList.Add(marginBox);


    /* COMMON 3RD OBJECT */
    var sittingUnitO = new Objects
      {
        Name = "Sitting Unit",
        ZoneName = 2,

        Obj = SittingUnit,
        ObjMargin = SittingUnitMargin,

        Front = true,
        Right = true,
        Back = false,
        Left = false,
        Top = false,
        Bottom = false,

        RotationBool = false,
        RotationOpt = 2,

        MirrorBool = false,
        MirrorOpt = 2,

        Source = "NULL",
        FixedToWall = 1,
        CellSize = 60,

        PreviousObject = tableO,
        SpaceList = commonList,

        };

    sittingUnitO.assignDimensions();

    sittingUnitO.placeFront(emptyFullArray, areaArray, out ObjBox, out marginBox);
    //changeOverZoneO.printDimensions();
    ObjectsList.Add(ObjBox);
    MarginsList.Add(marginBox);


    /* COMMON 4TH OBJECT */


    var bedO = new Objects
      {
        Name = "Bed",
        ZoneName = 2,

        Obj = Bed,
        ObjMargin = BedMargin,

        Front = true,
        Right = true,
        Back = false,
        Left = false,
        Top = false,
        Bottom = false,

        RotationBool = false,
        RotationOpt = 2,

        MirrorBool = false,
        MirrorOpt = 2,

        Source = "NULL",
        FixedToWall = 1,
        CellSize = 60,

        PreviousObject = sittingUnitO,
        SpaceList = commonList,

        };

    bedO.assignDimensions();

    bedO.placeFront(emptyFullArray, areaArray, out ObjBox, out marginBox);

    ObjectsList.Add(ObjBox);
    MarginsList.Add(marginBox);

    /* FURNITURE LAYOUT ==> COMMON END */

    ShowMatrix(areaArray);

    //Bxx = boxx;
    A = areaArray;
    EntranceBoxes = entranceBoxes;
    CommonBoxes = commonBoxes;
    WetAreaBoxes = wetAreaBoxes;
    /*Y = kitchenBoxes;
    K = commonAreaBoxes;*/
    W = WhiteBoxes;
    Furnitures = ObjectsList;
    FurnituresMargins = MarginsList;
# ---------- c_script_8: C# additional code ----------
  class Objects
  {
    public string Name;
    public int ZoneName;

    public Box Obj;
    public Box ObjMargin;

    public bool Front = false;
    public bool Right = false;
    public bool Back = false;
    public bool Left = false;
    public bool Top = false;
    public bool Bottom = false;

    public bool RotationBool = true;
    public int RotationOpt; // rotation options

    public bool MirrorBool = true;
    public int MirrorOpt; // mirror options

    public string Source; // Water, Electiricity
    public int FixedToWall; // Bed, Television //1,2,3 conditions
    public int CellSize;

    public Objects PreviousObject;

    public double ObjLength ;
    public double ObjWidth ;
    public double ObjHeight ;

    public double MrjLength;
    public double MrjWidth;
    public double MrjHeight;

    public double baseX, baseY, baseZ;
    public List<int> SpaceList = new List<int>();

    public double  XCell;
    public double  YCell;
    public double  ZCell;


    //deneme
    public Objects()
    {
            /*
            var Coordinates = new List<int>();
            Point3d pA = new Point3d(0, 0, 0);
            Point3d pB = new Point3d(10, 0, 0);
            Point3d pC = new Point3d(0, 10, 0);

            Plane p = new Plane(pA, pB, pC);*/
    }

    public Objects(string name, int zoneName, bool front, bool right, bool back, bool left, bool top, bool bottom, bool rotationalBool, int rotationOpt, bool mirrorBool, int mirrorOpt, string source, int fixedTowall, int cellSize, Box obj, Box objMargin, Objects previousObject, List<int> spaceList)
      : this()
    {
      this.Obj = obj;
      this.ObjMargin = objMargin;

      this.Name = name;
      this.ZoneName = zoneName;

      this.Front = front;
      this.Right = right;
      this.Back = back;
      this.Left = left;
      this.Bottom = bottom;
      this.Top = top;

      this.RotationBool = rotationalBool;
      this.RotationOpt = rotationOpt;

      this.MirrorBool = mirrorBool;
      this.MirrorOpt = mirrorOpt;

      this.Source = source;
      this.FixedToWall = fixedTowall;
      this.CellSize = cellSize;

      this.ObjWidth = obj.X.T1;
      this.ObjLength = obj.Y.T1;
      this.ObjHeight = obj.Z.T1;

      this.MrjWidth = objMargin.X.T1;
      this.MrjLength = objMargin.Y.T1;
      this.MrjHeight = objMargin.Z.T1;

      this.baseX = Obj.Plane.OriginX;
      this.baseY = Obj.Plane.OriginY;
      this.baseZ = Obj.Plane.OriginZ;

      this.PreviousObject = previousObject;
      this.SpaceList = spaceList;
    }

    public Objects(string name, int zoneName, bool front, bool right, bool back, bool left, bool top, bool bottom, bool rotationalBool, int rotationOpt, bool mirrorBool, int mirrorOpt, string source, int fixedTowall, int cellSize, Box obj, Box objMargin, List<int> spaceList)
      : this()
    {
      this.Obj = obj;
      this.ObjMargin = objMargin;

      this.Name = name;
      this.ZoneName = zoneName;

      this.Front = front;
      this.Right = right;
      this.Back = back;
      this.Left = left;
      this.Bottom = bottom;
      this.Top = top;

      this.RotationBool = rotationalBool;
      this.RotationOpt = rotationOpt;

      this.MirrorBool = mirrorBool;
      this.MirrorOpt = mirrorOpt;

      this.Source = source;
      this.FixedToWall = fixedTowall;
      this.CellSize = cellSize;

      this.ObjWidth = obj.X.T1;
      this.ObjLength = obj.Y.T1;
      this.ObjHeight = obj.Z.T1;

      this.MrjWidth = (this.ObjMargin.X.T1);
      this.MrjLength = (this.ObjMargin.Y.T1);
      this.MrjHeight = (this.ObjMargin.Z.T1);

      this.baseX = Obj.Plane.OriginX;
      this.baseY = Obj.Plane.OriginY;
      this.baseZ = Obj.Plane.OriginZ;

      this.SpaceList = spaceList;
    }

    public void assignDimensions()
    {
      this.ObjWidth = this.Obj.X.T1;
      this.ObjLength = this.Obj.Y.T1;
      this.ObjHeight = this.Obj.Z.T1;

      this.MrjWidth = this.ObjMargin.X.T1;
      this.MrjLength = this.ObjMargin.Y.T1;
      this.MrjHeight = this.ObjMargin.Z.T1;

    }

    public void printDimensions()
    {
      Rhino.RhinoApp.WriteLine("Obj Width " + this.ObjWidth.ToString());
      Rhino.RhinoApp.WriteLine("Obj Length " + this.ObjLength.ToString());
      Rhino.RhinoApp.WriteLine("Obj Height " + this.ObjHeight.ToString());

      Rhino.RhinoApp.WriteLine("Obj Width " + this.MrjWidth.ToString());
      Rhino.RhinoApp.WriteLine("Obj Length " + this.MrjLength.ToString());
      Rhino.RhinoApp.WriteLine("Obj Height " + this.MrjHeight.ToString());
    }



    public void placeRefObject(int [,,]emptyFullArray, int[,,]areaArray, out Box ObjBox, out Box marginBox)
    {
      this.XCell = Math.Ceiling((double) (this.MrjWidth / CellSize));
      this.YCell = Math.Ceiling((double) (this.MrjLength / CellSize));
      this.ZCell = Math.Ceiling((double) (this.MrjHeight / 150));

      bool emptyBool = true;
      bool sameZone = true;

      bool placeSuccessful = false;
      int trycount = 0;

      while (placeSuccessful == false)
      {
        var rand = new Random();
        var randomCellIndex = rand.Next(this.SpaceList.Count / 2);

        baseX = (this.SpaceList[2 * randomCellIndex]) * CellSize;
        baseY = (this.SpaceList[2 * randomCellIndex + 1]) * CellSize;
        baseZ = 0;
        baseZ = 0;

        //baseX = baseX * CellSize;
        //baseY = baseY * CellSize;

        if( (baseX + this.MrjWidth < 300) && (baseY + this.MrjLength < 600) && (baseZ + this.MrjHeight < 300) &&
          (baseX + this.MrjWidth > 0) && (baseY + this.MrjLength > 0) && (baseZ + this.MrjHeight > 0) )
        {
          for(int i = (int) (baseX / CellSize) ; i < (baseX / CellSize + (int) XCell); i++)
          {
            for(int j = (int) (baseY / CellSize); j < baseY / CellSize + (int) YCell; j++)
            {
              for(int k = (int) (baseZ / 150); k < baseZ / 150 + (int) ZCell; k++)
              {
                Rhino.RhinoApp.WriteLine("Entrance Reference Object :  " + "  i:  " + i + "  j:  " + j + "  k:  " + k);
                if (emptyFullArray[i, j, k] == 1)
                {
                  emptyBool = false;
                }
                if (areaArray[i, j, k] != this.ZoneName)
                {
                  sameZone = false;
                }
              }
            }
          }

          if (emptyBool && sameZone)
          {
            placeSuccessful = true;

            Rhino.RhinoApp.WriteLine("Reference Object conditions are successful ");
            for(int i = (int) (baseX / CellSize) ; i < (baseX / CellSize + (int) XCell); i++)
            {
              for(int j = (int) (baseY / CellSize); j < baseY / CellSize + (int) YCell; j++)
              {
                for(int k = (int) (baseZ / 150); k < baseZ / 150 + (int) ZCell; k++)
                {
                  emptyFullArray[i, j, k] = 1;
                }
              }
            }
          }
          else
          {
            Rhino.RhinoApp.WriteLine("Conditions are not satisfied ");
          }
        }

        trycount++;
        Rhino.RhinoApp.WriteLine("Try count is : " + trycount);
        if (trycount > 60 )
          Rhino.RhinoApp.WriteLine("Try count is over 60 placement is unsuccessful: ");
        placeSuccessful = true;
      }

      if( trycount < 60 && placeSuccessful )
      {
        Rhino.RhinoApp.WriteLine("baseX " + this.baseX);
        Rhino.RhinoApp.WriteLine("baseY " + this.baseY);
        Rhino.RhinoApp.WriteLine("baseZ " + this.baseZ);

        Point3d pointa = new Point3d(baseX, baseY, 0);
        Vector3d pointb = new Vector3d(0, 0, 1);

        Plane planebase = new Plane(pointa, pointb);

        Interval xInterval = new Interval(0, this.ObjWidth);
        Interval yInterval = new Interval(0, this.ObjLength);
        Interval zInterval = new Interval(0, this.ObjHeight);

        ObjBox = new Box(planebase, xInterval, yInterval, zInterval);

        xInterval = new Interval(0, this.MrjWidth);
        yInterval = new Interval(0, this.MrjLength);
        zInterval = new Interval(0, this.MrjHeight);

        marginBox = new Box(planebase, xInterval, yInterval, zInterval);

      }

      else
      {
        ObjBox = new Box();
        marginBox = new Box();
      }
    }

    public void placeRefObjectEntrance(int [,,]emptyFullArray, int[,,]areaArray, out Box ObjBox, out Box marginBox)
    {
      this.XCell = Math.Ceiling((double) (this.MrjWidth / CellSize));
      this.YCell = Math.Ceiling((double) (this.MrjLength / CellSize));
      this.ZCell = Math.Ceiling((double) (this.MrjHeight / 150));

      bool emptyBool = true;
      bool sameZone = true;


      bool placeSuccessful = false;
      int trycount = 0;

      while (placeSuccessful == false)
      {
        var rand = new Random();
        var randomCellIndex = rand.Next(this.SpaceList.Count / 2);

        baseX = (this.SpaceList[2 * randomCellIndex]) * CellSize;
        baseY = 0;
        baseZ = 0;

        //baseX = baseX * CellSize;
        //baseY = baseY * CellSize;

        if( (baseX + this.MrjWidth < 300) && (baseY + this.MrjLength < 600) && (baseZ + this.MrjHeight < 300) &&
          (baseX + this.MrjWidth > 0) && (baseY + this.MrjLength > 0) && (baseZ + this.MrjHeight > 0) )
        {
          for(int i = (int) (baseX / CellSize) ; i < (baseX / CellSize + (int) XCell); i++)
          {
            for(int j = (int) (baseY / CellSize); j < baseY / CellSize + (int) YCell; j++)
            {
              for(int k = (int) (baseZ / 150); k < baseZ / 150 + (int) ZCell; k++)
              {
                Rhino.RhinoApp.WriteLine("Entrance Reference Object :  " + "  i:  " + i + "  j:  " + j + "  k:  " + k);
                if (emptyFullArray[i, j, k] == 1)
                {
                  emptyBool = false;
                }
                if (areaArray[i, j, k] != this.ZoneName)
                {
                  sameZone = false;
                }
              }
            }
          }

          if (emptyBool && sameZone)
          {
            placeSuccessful = true;

            Rhino.RhinoApp.WriteLine("Reference Object conditions are successful ");
            for(int i = (int) (baseX / CellSize) ; i < (baseX / CellSize + (int) XCell); i++)
            {
              for(int j = (int) (baseY / CellSize); j < baseY / CellSize + (int) YCell; j++)
              {
                for(int k = (int) (baseZ / 150); k < baseZ / 150 + (int) ZCell; k++)
                {
                  emptyFullArray[i, j, k] = 1;
                }
              }
            }
          }
          else
          {
            Rhino.RhinoApp.WriteLine("Conditions are not satisfied ");
          }
        }

        trycount++;
        Rhino.RhinoApp.WriteLine("Try count is : " + trycount);
        if (trycount > 60 )
          Rhino.RhinoApp.WriteLine("Try count is over 60 placement is unsuccessful: ");
        placeSuccessful = true;
      }

      if( trycount < 60 && placeSuccessful )
      {
        Rhino.RhinoApp.WriteLine("baseX " + this.baseX);
        Rhino.RhinoApp.WriteLine("baseY " + this.baseY);
        Rhino.RhinoApp.WriteLine("baseZ " + this.baseZ);

        Point3d pointa = new Point3d(baseX, 0, 0);
        Vector3d pointb = new Vector3d(0, 0, 1);

        Plane planebase = new Plane(pointa, pointb);

        Interval xInterval = new Interval(0, this.ObjWidth);
        Interval yInterval = new Interval(0, this.ObjLength);
        Interval zInterval = new Interval(0, this.ObjHeight);

        ObjBox = new Box(planebase, xInterval, yInterval, zInterval);

        xInterval = new Interval(0, this.MrjWidth);
        yInterval = new Interval(0, this.MrjLength);
        zInterval = new Interval(0, this.MrjHeight);

        marginBox = new Box(planebase, xInterval, yInterval, zInterval);

      }


      else
      {
        ObjBox = new Box();
        marginBox = new Box();
      }

    }


    public void placeFront(int [,,]emptyFullArray, int[,,]areaArray, out Box ObjBox, out Box marginBox)
    {
      bool emptyBool = true;
      bool sameZone = true;

      this.XCell = Math.Ceiling((double) (this.MrjWidth / CellSize));
      this.YCell = Math.Ceiling((double) (this.MrjLength / CellSize));
      this.ZCell = Math.Ceiling((double) (this.MrjHeight / 150));

      this.baseX = PreviousObject.baseX;
      this.baseY = PreviousObject.baseY + CellSize * PreviousObject.YCell;
      this.baseZ = PreviousObject.baseZ;

      if( (baseX + this.MrjWidth < 300) && (baseY + this.MrjLength < 600) && (baseZ + this.MrjHeight < 300) &&
        (baseX + this.MrjWidth > 0) && (baseY + this.MrjLength > 0) && (baseZ + this.MrjHeight > 0) )
      {
        for(int i = (int) (baseX / CellSize) ; i < (baseX / CellSize + (int) XCell); i++)
        {
          for(int j = (int) (baseY / CellSize); j < baseY / CellSize + (int) YCell; j++)
          {
            for(int k = (int) (baseZ / 150); k < baseZ / 150 + (int) ZCell; k++)
            {
              Rhino.RhinoApp.WriteLine("i:  " + i + "  j:  " + j + "  k:  " + k);
              if (emptyFullArray[i, j, k] == 1)
              {
                emptyBool = false;
              }
              if (areaArray[i, j, k] != this.ZoneName)
              {
                sameZone = false;
              }
            }
          }
        }

        if (emptyBool && sameZone)
        {
          Rhino.RhinoApp.WriteLine("Conditions are successful ");
          for(int i = (int) (baseX / CellSize) ; i < (baseX / CellSize + (int) XCell); i++)
          {
            for(int j = (int) (baseY / CellSize); j < baseY / CellSize + (int) YCell; j++)
            {
              for(int k = (int) (baseZ / 150); k < baseZ / 150 + (int) ZCell; k++)
              {
                emptyFullArray[i, j, k] = 1;
              }
            }
          }
        }
        else
        {
          Rhino.RhinoApp.WriteLine("Place Front:  Conditions are not satisfied ");
        }
      }
      else
      {
        Rhino.RhinoApp.WriteLine("Place Front: Conditions are not satisfied ");
      }


      Point3d pointa = new Point3d(baseX, baseY, baseZ);
      Vector3d pointb = new Vector3d(0, 0, 1);

      Plane planebase = new Plane(pointa, pointb);

      Interval xInterval = new Interval(0, this.ObjWidth);
      Interval yInterval = new Interval(0, this.ObjLength);
      Interval zInterval = new Interval(0, this.ObjHeight);

      ObjBox = new Box(planebase, xInterval, yInterval, zInterval);

      xInterval = new Interval(0, this.MrjWidth);
      yInterval = new Interval(0, this.MrjLength);
      zInterval = new Interval(0, this.MrjHeight);

      marginBox = new Box(planebase, xInterval, yInterval, zInterval);
    }


    public void placeRight(int [,,]emptyFullArray, int[,,]areaArray, out Box ObjBox, out Box marginBox)
    {
      bool emptyBool = true;
      bool sameZone = true;

      this.XCell = Math.Ceiling((double) (this.MrjWidth / CellSize));
      this.YCell = Math.Ceiling((double) (this.MrjLength / CellSize));
      this.ZCell = Math.Ceiling((double) (this.MrjHeight / 150));

      this.baseX = PreviousObject.baseX + CellSize * PreviousObject.XCell;
      this.baseY = PreviousObject.baseY;
      this.baseZ = PreviousObject.baseZ;

      if( (baseX + this.ObjWidth < 300) && (baseY + this.ObjLength < 600) && (baseZ + this.ObjHeight < 300) &&
        (baseX + this.ObjWidth > 0) && (baseY + this.ObjLength > 0) && (baseZ + this.ObjHeight > 0) )
      {
        for(int i = (int) (baseX / CellSize) ; i < (baseX / CellSize + (int) XCell); i++)
        {
          for(int j = (int) (baseY / CellSize); j < baseY / CellSize + (int) YCell; j++)
          {
            for(int k = (int) (baseZ / 150); k < baseZ / 150 + (int) ZCell; k++)
            {
              if (emptyFullArray[i, j, k] == 1)
              {
                emptyBool = false;
              }
              if (areaArray[i, j, k] != this.ZoneName)
              {
                sameZone = false;
              }
            }
          }
        }

        if (emptyBool && sameZone)
        {
          Rhino.RhinoApp.WriteLine("Place Right: Conditions are successful ");
          for(int i = (int) (baseX / CellSize) ; i < (baseX / CellSize + (int) XCell); i++)
          {
            for(int j = (int) (baseY / CellSize); j < baseY / CellSize + (int) YCell; j++)
            {
              for(int k = (int) (baseZ / 150); k < baseZ / 150 + (int) ZCell; k++)
              {
                emptyFullArray[i, j, k] = 1;
              }
            }
          }
        }
        else
        {
          Rhino.RhinoApp.WriteLine("Place Right: Conditions are not satisfied ");
        }
      }
      else
      {
        Rhino.RhinoApp.WriteLine("Place Right: Conditions are not satisfied ");
      }

      Point3d pointa = new Point3d(baseX, baseY, baseZ);
      Vector3d pointb = new Vector3d(0, 0, 1);

      Plane planebase = new Plane(pointa, pointb);

      Interval xInterval = new Interval(0, this.ObjWidth);
      Interval yInterval = new Interval(0, this.ObjLength);
      Interval zInterval = new Interval(0, this.ObjHeight);

      ObjBox = new Box(planebase, xInterval, yInterval, zInterval);

      xInterval = new Interval(0, this.MrjWidth);
      yInterval = new Interval(0, this.MrjLength);
      zInterval = new Interval(0, this.MrjHeight);

      marginBox = new Box(planebase, xInterval, yInterval, zInterval);
    }

    public void placeBack(int [,,]emptyFullArray, int[,,]areaArray, out Box ObjBox, out Box marginBox)
    {
      bool emptyBool = true;
      bool sameZone = true;

      this.XCell = Math.Ceiling((double) (this.MrjWidth / CellSize));
      this.YCell = Math.Ceiling((double) (this.MrjLength / CellSize));
      this.ZCell = Math.Ceiling((double) (this.MrjHeight / 150));

      this.baseX = PreviousObject.baseX;
      this.baseY = PreviousObject.baseY - CellSize * this.YCell;
      this.baseZ = PreviousObject.baseZ;

      if( (baseX + this.ObjWidth < 300) && (baseY + this.ObjLength < 600) && (baseZ + this.ObjHeight < 300) &&
        (baseX + this.ObjWidth > 0) && (baseY + this.ObjLength > 0) && (baseZ + this.ObjHeight > 0) )
      {
        for(int i = (int) (baseX / CellSize) ; i < (baseX / CellSize + (int) XCell); i++)
        {
          for(int j = (int) (baseY / CellSize); j < baseY / CellSize + (int) YCell; j++)
          {
            for(int k = (int) (baseZ / 150); k < baseZ / 150 + (int) ZCell; k++)
            {
              if (emptyFullArray[i, j, k] == 1)
              {
                emptyBool = false;
              }
              if (areaArray[i, j, k] != this.ZoneName)
              {
                sameZone = false;
              }
            }
          }
        }

        if (emptyBool && sameZone)
        {
          Rhino.RhinoApp.WriteLine("Place Back: Conditions are successful ");
          for(int i = (int) (baseX / CellSize) ; i < (baseX / CellSize + (int) XCell); i++)
          {
            for(int j = (int) (baseY / CellSize); j < baseY / CellSize + (int) YCell; j++)
            {
              for(int k = (int) (baseZ / 150); k < baseZ / 150 + (int) ZCell; k++)
              {
                emptyFullArray[i, j, k] = 1;
              }
            }
          }
        }
        else
        {
          Rhino.RhinoApp.WriteLine("Place Back: Conditions are not satisfied ");
        }
      }
      else
      {
        Rhino.RhinoApp.WriteLine("Place Back:Conditions are not satisfied ");
      }

      Point3d pointa = new Point3d(baseX, baseY, baseZ);
      Vector3d pointb = new Vector3d(0, 0, 1);

      Plane planebase = new Plane(pointa, pointb);

      Interval xInterval = new Interval(0, this.ObjWidth);
      Interval yInterval = new Interval(0, this.ObjLength);
      Interval zInterval = new Interval(0, this.ObjHeight);

      ObjBox = new Box(planebase, xInterval, yInterval, zInterval);

      xInterval = new Interval(0, this.MrjWidth);
      yInterval = new Interval(0, this.MrjLength);
      zInterval = new Interval(0, this.MrjHeight);

      marginBox = new Box(planebase, xInterval, yInterval, zInterval);
    }

    public void placeLeft(int [,,]emptyFullArray, int[,,]areaArray, out Box ObjBox, out Box marginBox)
    {
      bool emptyBool = true;
      bool sameZone = true;

      this.XCell = Math.Ceiling((double) (this.MrjWidth / CellSize));
      this.YCell = Math.Ceiling((double) (this.MrjLength / CellSize));
      this.ZCell = Math.Ceiling((double) (this.MrjHeight / 150));

      this.baseX = PreviousObject.baseX - CellSize * this.XCell;
      this.baseY = PreviousObject.baseY;
      this.baseZ = PreviousObject.baseZ;

      if( (baseX + this.ObjWidth < 300) && (baseY + this.ObjLength < 600) && (baseZ + this.ObjHeight < 300) &&
        (baseX + this.ObjWidth > 0) && (baseY + this.ObjLength > 0) && (baseZ + this.ObjHeight > 0) )
      {
        for(int i = (int) (baseX / CellSize) ; i < (baseX / CellSize + (int) XCell); i++)
        {
          for(int j = (int) (baseY / CellSize); j < baseY / CellSize + (int) YCell; j++)
          {
            for(int k = (int) (baseZ / 150); k < baseZ / 150 + (int) ZCell; k++)
            {
              if (emptyFullArray[i, j, k] == 1)
              {
                emptyBool = false;
              }
              if (areaArray[i, j, k] != this.ZoneName)
              {
                sameZone = false;
              }
            }
          }
        }

        if (emptyBool && sameZone)
        {
          Rhino.RhinoApp.WriteLine("Place Left: Conditions are successful ");
          for(int i = (int) (baseX / CellSize) ; i < (baseX / CellSize + (int) XCell); i++)
          {
            for(int j = (int) (baseY / CellSize); j < baseY / CellSize + (int) YCell; j++)
            {
              for(int k = (int) (baseZ / 150); k < baseZ / 150 + (int) ZCell; k++)
              {
                emptyFullArray[i, j, k] = 1;
              }
            }
          }
        }
        else
        {
          Rhino.RhinoApp.WriteLine("Place Left: Conditions are not satisfied ");
        }
      }
      else
      {
        Rhino.RhinoApp.WriteLine("Place Left: Conditions are not satisfied ");
      }

      Point3d pointa = new Point3d(baseX, baseY, baseZ);
      Vector3d pointb = new Vector3d(0, 0, 1);

      Plane planebase = new Plane(pointa, pointb);

      Interval xInterval = new Interval(0, this.ObjWidth);
      Interval yInterval = new Interval(0, this.ObjLength);
      Interval zInterval = new Interval(0, this.ObjHeight);

      ObjBox = new Box(planebase, xInterval, yInterval, zInterval);

      xInterval = new Interval(0, this.MrjWidth);
      yInterval = new Interval(0, this.MrjLength);
      zInterval = new Interval(0, this.MrjHeight);

      marginBox = new Box(planebase, xInterval, yInterval, zInterval);
    }
    public void placeTop(int [,,]emptyFullArray, int[,,]areaArray, out Box ObjBox, out Box marginBox)
    {
      bool emptyBool = true;
      bool sameZone = true;

      this.XCell = Math.Ceiling((double) (this.MrjWidth / CellSize));
      this.YCell = Math.Ceiling((double) (this.MrjLength / CellSize));
      this.ZCell = Math.Ceiling((double) (this.MrjHeight / 150));

      this.baseX = PreviousObject.baseX;
      this.baseY = PreviousObject.baseY;
      this.baseZ = PreviousObject.baseZ + CellSize * PreviousObject.ZCell;

      if( (baseX + this.ObjWidth < 300) && (baseY + this.ObjLength < 600) && (baseZ + this.ObjHeight < 300) &&
        (baseX + this.ObjWidth > 0) && (baseY + this.ObjLength > 0) && (baseZ + this.ObjHeight > 0) )
      {
        for(int i = (int) (baseX / CellSize) ; i < (baseX / CellSize + (int) XCell); i++)
        {
          for(int j = (int) (baseY / CellSize); j < baseY / CellSize + (int) YCell; j++)
          {
            for(int k = (int) (baseZ / 150); k < baseZ / 150 + (int) ZCell; k++)
            {
              if (emptyFullArray[i, j, k] == 1)
              {
                emptyBool = false;
              }
              if (areaArray[i, j, k] != this.ZoneName)
              {
                sameZone = false;
              }
            }
          }
        }

        if (emptyBool && sameZone)
        {
          Rhino.RhinoApp.WriteLine("Conditions are successful ");
          for(int i = (int) (baseX / CellSize) ; i < (baseX / CellSize + (int) XCell); i++)
          {
            for(int j = (int) (baseY / CellSize); j < baseY / CellSize + (int) YCell; j++)
            {
              for(int k = (int) (baseZ / 150); k < baseZ / 150 + (int) ZCell; k++)
              {
                emptyFullArray[i, j, k] = 1;
              }
            }
          }
        }
        else
        {
          Rhino.RhinoApp.WriteLine("Conditions are not satisfied ");
        }
      }
      else
      {
        Rhino.RhinoApp.WriteLine("Conditions are not satisfied ");
      }

      Point3d pointa = new Point3d(baseX, baseY, baseZ);
      Vector3d pointb = new Vector3d(0, 0, 1);

      Plane planebase = new Plane(pointa, pointb);

      Interval xInterval = new Interval(0, this.ObjWidth);
      Interval yInterval = new Interval(0, this.ObjLength);
      Interval zInterval = new Interval(0, this.ObjHeight);

      ObjBox = new Box(planebase, xInterval, yInterval, zInterval);

      xInterval = new Interval(0, this.MrjWidth);
      yInterval = new Interval(0, this.MrjLength);
      zInterval = new Interval(0, this.MrjHeight);

      marginBox = new Box(planebase, xInterval, yInterval, zInterval);
    }

    public void placeBottom(int [,,]emptyFullArray, int[,,]areaArray, out Box ObjBox, out Box marginBox)
    {
      bool emptyBool = true;
      bool sameZone = true;

      this.XCell = Math.Ceiling((double) (this.MrjWidth / CellSize));
      this.YCell = Math.Ceiling((double) (this.MrjLength / CellSize));
      this.ZCell = Math.Ceiling((double) (this.MrjHeight / 150));

      this.baseX = PreviousObject.baseX;
      this.baseY = PreviousObject.baseY;
      this.baseZ = PreviousObject.baseZ - CellSize * this.ZCell;

      if( (baseX + this.ObjWidth < 300) && (baseY + this.ObjLength < 600) && (baseZ + this.ObjHeight < 300) &&
        (baseX + this.ObjWidth > 0) && (baseY + this.ObjLength > 0) && (baseZ + this.ObjHeight > 0) )
      {
        for(int i = (int) (baseX / CellSize) ; i < (baseX / CellSize + (int) XCell); i++)
        {
          for(int j = (int) (baseY / CellSize); j < baseY / CellSize + (int) YCell; j++)
          {
            for(int k = (int) (baseZ / 150); k < baseZ / 150 + (int) ZCell; k++)
            {
              if (emptyFullArray[i, j, k] == 1)
              {
                emptyBool = false;
              }
              if (areaArray[i, j, k] != this.ZoneName)
              {
                sameZone = false;
              }
            }
          }
        }

        if (emptyBool && sameZone)
        {
          Rhino.RhinoApp.WriteLine("Conditions are successful ");
          for(int i = (int) (baseX / CellSize) ; i < (baseX / CellSize + (int) XCell); i++)
          {
            for(int j = (int) (baseY / CellSize); j < baseY / CellSize + (int) YCell; j++)
            {
              for(int k = (int) (baseZ / 150); k < baseZ / 150 + (int) ZCell; k++)
              {
                emptyFullArray[i, j, k] = 1;
              }
            }
          }
        }
        else
        {
          Rhino.RhinoApp.WriteLine("Conditions are not satisfied ");
        }
      }
      else
      {
        Rhino.RhinoApp.WriteLine("Conditions are not satisfied ");
      }

      Point3d pointa = new Point3d(baseX, baseY, baseZ);
      Vector3d pointb = new Vector3d(0, 0, 1);

      Plane planebase = new Plane(pointa, pointb);

      Interval xInterval = new Interval(0, this.ObjWidth);
      Interval yInterval = new Interval(0, this.ObjLength);
      Interval zInterval = new Interval(0, this.ObjHeight);

      ObjBox = new Box(planebase, xInterval, yInterval, zInterval);

      xInterval = new Interval(0, this.MrjWidth);
      yInterval = new Interval(0, this.MrjLength);
      zInterval = new Interval(0, this.MrjHeight);

      marginBox = new Box(planebase, xInterval, yInterval, zInterval);
    }

    public void placeObject(int [,,]emptyFullArray, int[,,]areaArray, out Box ObjBox, out Box marginBox)
    {

      Point3d pointa = new Point3d(baseX, baseY, baseZ);
      Vector3d pointb = new Vector3d(0, 0, 1);

      Plane planebase = new Plane(pointa, pointb);

      Interval xInterval = new Interval(0, this.ObjWidth);
      Interval yInterval = new Interval(0, this.ObjLength);
      Interval zInterval = new Interval(0, this.ObjHeight);

      ObjBox = new Box(planebase, xInterval, yInterval, zInterval);

      xInterval = new Interval(0, this.MrjWidth);
      yInterval = new Interval(0, this.MrjLength);
      zInterval = new Interval(0, this.MrjHeight);

      marginBox = new Box(planebase, xInterval, yInterval, zInterval);

      List<int> growDirection = new List<int>();

      if(PreviousObject.Front == true)
        growDirection.Add(1); // Front Direction
      if(PreviousObject.Right == true)
        growDirection.Add(2); // Right Direction
      if(PreviousObject.Back == true)
        growDirection.Add(3); // Back Direction
      if(PreviousObject.Left == true)
        growDirection.Add(4); // Left Direction
      if(PreviousObject.Bottom == true)
        growDirection.Add(5); // Bottom Direction
      if(PreviousObject.Top == true)
        growDirection.Add(6); // Right Direction

      bool placeSuccess = false;
      int tryCounter = 0;

      if(growDirection.Count >= 1)
      {
        Random randm = new Random();

        while(placeSuccess == false )
        {
          int a = randm.Next(0, growDirection.Count);
          int randomMethod = growDirection[a];

          switch (a)
          ​{
            case 1:
              this.placeFront(emptyFullArray, areaArray, out  ObjBox, out marginBox);
              placeSuccess = true;
              break;
            case 2:
              this.placeRight(emptyFullArray, areaArray, out  ObjBox, out marginBox);
              placeSuccess = true;
              break;
            case 3:
              this.placeBack(emptyFullArray, areaArray, out  ObjBox, out marginBox);
              placeSuccess = true;
              break;
            case 4:
              this.placeLeft(emptyFullArray, areaArray, out  ObjBox, out marginBox);
              placeSuccess = true;
              break;
            case 5:
              this.placeBottom(emptyFullArray, areaArray, out  ObjBox, out marginBox);
              placeSuccess = true;
              break;
            case 6:
              this.placeTop(emptyFullArray, areaArray, out  ObjBox, out marginBox);
              placeSuccess = true;
              break;

            default:
              tryCounter++;
              break;
            // default statements
          }


        }
        growDirection.Clear();




      }


    }


    public void rotate()
    {

    }



    static void mirror()
    {

    }

    static void getClosestCell()
    {

    }

    static void createWall()
    {

    }

  }

  static void ShowMatrix(int[,,] Arr)
  {
    for (int i = 0; i < Arr.GetLength(0); i++)
    {
      for (int j = 0; j < Arr.GetLength(1); j++)
      {
        Rhino.RhinoApp.Write(Arr[i, j, 0] + " ");
      }
      Rhino.RhinoApp.WriteLine("Loop Runs" + i.ToString());
    }
    return;
  }

  static int[,,] InitializeZeroMatrice(int width, int length, int levelNumber)
  {
    var areaArray = new int[width, length, levelNumber];

    for (int k = 0; k < levelNumber; k++)
    {
      for (int i = 0; i < width; i++)
      {
        for (int j = 0; j < length; j++)
        {
          areaArray[i, j, k] = 0;
        }
      }
    }
    return areaArray;
  }

  /* The Color lists keep the colors in a seperate List in order to choose within them easily instead of searching where they are... */
  static List<int> entranceList = new List<int>();
  static List<int> commonList = new List<int>();
  static List<int> wetAreaList = new List<int>();
 /* static List<int> kitchenList = new List<int>();
  static List<int> commonAreaList = new List<int>();*/

  /**           these counters are used for starting the límitations counts.         **/

  static int entranceCounter = 1;
  static int commonCounter = 1;
  static int wetAreaCounter = 1;
  /*static int kitchenCounter = 1;
  static int commonAreaCounter = 1;*/
  /**           these limits are used for defining max distance that zone can spread.  **/

  static int entranceLimit = 250;
  static int commonLimit = 400;
  static int wetAreaLimit = 300;
  /*static int kitchenLimit = 200;
  static int commonAreaLimit = 100;*/

  static void StartZones(int[,,] arr)
  {
    /**
     * Randomly Starts the color. Takes the Color lists as argumnts
     * (We can delete these argumnents and it can get them as local referance
     * in our case it gives us a chance to choose what to initilize)
     * **/

    Random rand = new Random();
    //----------------------
    /* GetLength(0) and GetLength(1) might be set as variable */
    //Array.GetLength(0) gives the column lenght in other words length of an array
    //Array.GetLength(1) gives the row lenght in other words width of an array
    var a = rand.Next(arr.GetLength(0) / 2, arr.GetLength(0) / 2);
    var b = rand.Next(0, 2);

    Rhino.RhinoApp.WriteLine("started");
    entranceList.AddRange(new int[2] { a, b }); //AddRange ==> Adds multiple elements to a List . We use mod%2 to call the index of the point back instead of stacking them as an another List(or Array) in our list.
    arr[a, b, 0] = 1;// entrance Starting Point
    //----------------------

    b = rand.Next(0, arr.GetLength(1));
    a = rand.Next(0, arr.GetLength(0));

    commonList.AddRange(new int[2] { a, b });
    arr[a, b, 0] = 2; // common Starting Point
    //----------------------
    a = rand.Next(0, arr.GetLength(0));
    b = rand.Next(0, arr.GetLength(1));

    wetAreaList.AddRange(new int[2] { a, b });
    arr[a, b, 0] = 3; // wetArea Starting Point
    //----------------------
    a = rand.Next(0, arr.GetLength(0));
    b = rand.Next(0, arr.GetLength(1));
/*
    kitchenList.AddRange(new int[2] { a, b });
    arr[a, b, 0] = 4; // kitchen Starting Point
    //----------------------
    a = rand.Next(0, arr.GetLength(0));
    b = rand.Next(0, arr.GetLength(1));

    commonAreaList.AddRange(new int[2] { a, b });
    arr[a, b, 0] = 5; // commonArea Starting Point
    //----------------------
  */
  }
        /* Calculates the distance between initial point in the color and the possible new point!
         *  (if the possible new point is too far from inital point eleminate it.) */
  static double distanceCalculate(List<int> spaceCoordList, int x2, int y2, int cellSize)
  {
    var distance = cellSize * Math.Sqrt((y2 - spaceCoordList[1]) * (y2 - spaceCoordList[1]) + (x2 - spaceCoordList[0]) * (x2 - spaceCoordList[0]));
    return distance;
  }

  static void Evaluate()
  {
    // according to relations give score to the created zones
    // get the centers of the zones and acoording to the distances and created sizes give
    //positive or negative points and if score is not acceptable re-run and create variatians.
  }


  static void noiseFilter (int [,,] arr, int type, int iterationNumber, int controlNumber)
  {
    if(type == 0)
    {
      for( int loop = 0 ; loop < iterationNumber ; loop++ )
      {
        List < int> surrounding = new List<int>();
        for(int i = 1 ; i < arr.GetLength(0) - 1 ;i++)
        {
          for(int j = 1 ; j < arr.GetLength(1) - 1 ;j++)
          {
            for(int x = -1 ; x < 2;x++)
            {
              for(int y = -1 ; y < 2;y++)
              {
                if(!(x == y && x == 0))
                {

                  surrounding.Add(arr[i + x, j + y, 0]);
                }
              }
            }
            for (int v = 0 ; v < 6 ;v++) // 6 is the number of the zones including  empty cells
            {
              int count = (from z in surrounding where z == v select z).Count();
              if ( count >= controlNumber )
              {
                arr[i, j, 0] = v;
              }
            }
            surrounding.Clear();
            surrounding.TrimExcess();
          }
        }
      }
    }

    if(type == 1)
    {
      for( int loop = 0 ; loop < iterationNumber ; loop++ )
      {
        List < int> surrounding = new List<int>();
        for(int i = 1 ; i < arr.GetLength(0) - 1 ;i++)
        {
          for(int j = 1 ; j < arr.GetLength(1) - 1 ;j++)
          {
            for(int x = -1 ; x < 2;x++)
            {
              for(int y = -1 ; y < 2;y++)
              {
                if(!(x == y && x == 0) && ( (x + y == 1 ) || (x + y == -1 )) )
                {
                  surrounding.Add(arr[i + x, j + y, 0]);
                }
              }
            }

            for (int v = 0 ; v < 6 ;v++) // 6 is the number of the zones including  empty cells
            {
              int count = (from z in surrounding where z == v select z).Count();
              if ( count >= 2 )
              {
                arr[i, j, 0] = v;
              }
            }
            surrounding.Clear();
            surrounding.TrimExcess();
          }
        }
      }
    }
  }

  static void Spread(int[,,] arr, ref double spaceSize, List<int> spaceCoordList, ref int counter, int spaceLimit, int cellSize)
  {
        /*ARGUMENTS
     * The main array which has rectangular form(will be 3d in short) ,
     * spaceSize = Maximum limit that can grow.  ,
     * spaceCoordList =  the cells of the zone which has been already defined. )
     */
    var rand = new Random();
    var directionList = new List<int>();
    int Xcoord;
    int Ycoord;
    bool draw = false;
    int trycount = 0;

    while (draw == false && counter <= spaceSize)
    {
      if (counter <= spaceSize ) //Can be deleted. The condition is added to the While Loop Conditions.
      {
        var randomCellIndex = rand.Next(spaceCoordList.Count / 2);

        Xcoord = spaceCoordList[2 * randomCellIndex];
        Ycoord = spaceCoordList[2 * randomCellIndex + 1];

        if (Xcoord < arr.GetLength(0) - 1 && Xcoord > 0 && Ycoord > 0 && Ycoord < arr.GetLength(1) - 1)
        {
          /* Check the conditions INSIDE borders */
          if (arr[Xcoord + 1, Ycoord, 0] == 0 && distanceCalculate(spaceCoordList, Xcoord + 1, Ycoord, cellSize) < spaceLimit ) // Check if possible new cell is still white or not!
            directionList.AddRange(new int[2] { (Xcoord + 1), Ycoord }); //Store possible spread directions in a list.

          if (arr[Xcoord - 1, Ycoord, 0] == 0 && distanceCalculate(spaceCoordList, Xcoord - 1, Ycoord, cellSize) < spaceLimit)
            directionList.AddRange(new int[2] { (Xcoord - 1), Ycoord }); //Store possible spread directions in a list.

          if (arr[Xcoord, Ycoord + 1, 0] == 0 && distanceCalculate(spaceCoordList, Xcoord, Ycoord + 1, cellSize) < spaceLimit)
            directionList.AddRange(new int[2] { (Xcoord), Ycoord + 1 }); //Store possible spread directions in a list.

          if (arr[Xcoord, Ycoord - 1, 0] == 0 && distanceCalculate(spaceCoordList, Xcoord, Ycoord - 1, cellSize) < spaceLimit)
            directionList.AddRange(new int[2] { (Xcoord), (Ycoord - 1) }); //Store possible spread directions in a list.

          if (directionList.Count > 0)
          {
            var randomIndex = rand.Next(directionList.Count / 2);
            int a = directionList[2 * randomIndex];
            int b = directionList[2 * randomIndex + 1];

            arr[a, b, 0] = arr[Xcoord, Ycoord, 0];

            spaceCoordList.AddRange(new int[2] { a, b });

            directionList.Clear();
            directionList.TrimExcess();
            draw = true;
            counter++;
          }
          else
          {
            trycount++;
            if (trycount >= spaceCoordList.Count)
            {
              draw = true;
              //Print("trycountNumber is ={0}", trycount);
            }
          }
        }

          /* EDGE CONDITIONS */
          //RIGHT
        else if (Xcoord == (arr.GetLength(0) - 1) && Ycoord != 0 && Ycoord != (arr.GetLength(1) - 1))
        {
          if (arr[Xcoord - 1, Ycoord, 0] == 0 && distanceCalculate(spaceCoordList, Xcoord - 1, Ycoord, cellSize) < spaceLimit )
            directionList.AddRange(new int[2] { (Xcoord - 1), (Ycoord) }); //Store possible spread directions in a list.
          if (arr[Xcoord, Ycoord + 1, 0] == 0 && distanceCalculate(spaceCoordList, Xcoord, Ycoord + 1, cellSize) < spaceLimit )
            directionList.AddRange(new int[2] { (Xcoord ), (Ycoord + 1) }); //Store possible spread directions in a list.
          if (arr[Xcoord, Ycoord - 1, 0] == 0 && distanceCalculate(spaceCoordList, Xcoord, Ycoord - 1, cellSize) < spaceLimit )
            directionList.AddRange(new int[2] { (Xcoord ), (Ycoord - 1) }); //Store possible spread directions in a list.

          if (directionList.Count > 0)
          {
            var randomIndex = rand.Next(directionList.Count / 2);
            int a = directionList[2 * randomIndex];
            int b = directionList[2 * randomIndex + 1];

            arr[a, b, 0] = arr[Xcoord, Ycoord, 0];

            spaceCoordList.AddRange(new int[2] { a, b });

            directionList.Clear();
            directionList.TrimExcess();
            draw = true;
            counter++;
          }
          else
          {
            trycount++;
            if (trycount >= spaceCoordList.Count)
            {
              draw = true;
              //Print("trycountNumber is ={0}", trycount);
            }
          }
        }

          //Left
        else if (Xcoord == 0 && Ycoord != 0 && Ycoord != (arr.GetLength(1) - 1))
        {

          if (arr[Xcoord + 1, Ycoord, 0] == 0 && distanceCalculate(spaceCoordList, Xcoord + 1, Ycoord, cellSize) < spaceLimit )
            directionList.AddRange(new int[2] { (Xcoord + 1), (Ycoord) }); //Store possible spread directions in a list.
          if (arr[Xcoord, Ycoord + 1, 0] == 0 && distanceCalculate(spaceCoordList, Xcoord, Ycoord + 1, cellSize) < spaceLimit )
            directionList.AddRange(new int[2] { (Xcoord ), (Ycoord + 1) }); //Store possible spread directions in a list.
          if (arr[Xcoord, Ycoord - 1, 0] == 0 && distanceCalculate(spaceCoordList, Xcoord, Ycoord - 1, cellSize) < spaceLimit )
            directionList.AddRange(new int[2] { (Xcoord ), (Ycoord - 1) }); //Store possible spread directions in a list.
          if (directionList.Count > 0)
          {
            var randomIndex = rand.Next(directionList.Count / 2);
            int a = directionList[2 * randomIndex];
            int b = directionList[2 * randomIndex + 1];

            arr[a, b, 0] = arr[Xcoord, Ycoord, 0];

            spaceCoordList.AddRange(new int[2] { a, b });

            directionList.Clear();
            directionList.TrimExcess();
            draw = true;
            counter++;
          }
          else
          {
            trycount++;
            if (trycount >= spaceCoordList.Count)
            {
              draw = true;
              //Print("trycountNumber is ={0}", trycount);
            }
          }

        }
          //TOP
        else if ((Ycoord == arr.GetLength(1) - 1) && Xcoord != 0 && Xcoord != (arr.GetLength(0) - 1))
        {

          if (arr[Xcoord, Ycoord - 1, 0] == 0 && distanceCalculate(spaceCoordList, Xcoord, Ycoord - 1, cellSize) < spaceLimit )
            directionList.AddRange(new int[2] { (Xcoord ), (Ycoord - 1) }); //Store possible spread directions in a list.
          if (arr[Xcoord + 1, Ycoord, 0] == 0 && distanceCalculate(spaceCoordList, Xcoord + 1, Ycoord, cellSize) < spaceLimit )
            directionList.AddRange(new int[2] { (Xcoord + 1 ), (Ycoord ) }); //Store possible spread directions in a list.
          if (arr[Xcoord - 1, Ycoord, 0] == 0 && distanceCalculate(spaceCoordList, Xcoord - 1, Ycoord, cellSize) < spaceLimit )
            directionList.AddRange(new int[2] { (Xcoord - 1), (Ycoord ) }); //Store possible spread directions in a list.
          if (directionList.Count > 0)
          {
            var randomIndex = rand.Next(directionList.Count / 2);
            int a = directionList[2 * randomIndex];
            int b = directionList[2 * randomIndex + 1];

            arr[a, b, 0] = arr[Xcoord, Ycoord, 0];

            spaceCoordList.AddRange(new int[2] { a, b });

            directionList.Clear();
            directionList.TrimExcess();
            draw = true;
            counter++;
          }
          else
          {
            trycount++;
            if (trycount >= spaceCoordList.Count)
            {
              draw = true;
              //Print("trycountNumber is ={0}", trycount);
            }
          }
        }
          //BOTTOM
        else if (Ycoord == 0 && Xcoord != 0 && Xcoord != (arr.GetLength(0) - 1))
        {
          if (arr[Xcoord, Ycoord + 1, 0] == 0 && distanceCalculate(spaceCoordList, Xcoord, Ycoord + 1, cellSize) < spaceLimit )
            directionList.AddRange(new int[2] { (Xcoord ), (Ycoord + 1) }); //Store possible spread directions in a list.
          if (arr[Xcoord + 1, Ycoord, 0] == 0 && distanceCalculate(spaceCoordList, Xcoord + 1, Ycoord, cellSize) < spaceLimit )
            directionList.AddRange(new int[2] { (Xcoord + 1 ), (Ycoord ) }); //Store possible spread directions in a list.
          if (arr[Xcoord - 1, Ycoord, 0] == 0 && distanceCalculate(spaceCoordList, Xcoord - 1, Ycoord, cellSize) < spaceLimit )
            directionList.AddRange(new int[2] { (Xcoord - 1), (Ycoord ) }); //Store possible spread directions in a list.
          if (directionList.Count > 0)
          {
            var randomIndex = rand.Next(directionList.Count / 2);
            int a = directionList[2 * randomIndex];
            int b = directionList[2 * randomIndex + 1];

            arr[a, b, 0] = arr[Xcoord, Ycoord, 0];

            spaceCoordList.AddRange(new int[2] { a, b });

            directionList.Clear();
            directionList.TrimExcess();
            draw = true;
            counter++;
          }
          else
          {
            trycount++;
            if (trycount >= spaceCoordList.Count)
            {
              draw = true;
              //Print("trycountNumber is ={0}", trycount);
            }
          }
        }

          //LEFT BOTTOM
        else if (Xcoord == 0 && Ycoord == 0)
        {
          if (arr[Xcoord, Ycoord + 1, 0] == 0 && distanceCalculate(spaceCoordList, Xcoord, Ycoord + 1, cellSize) < spaceLimit)
            directionList.Add(Xcoord); directionList.Add(Ycoord + 1);

          if (arr[Xcoord + 1, Ycoord, 0] == 0 && distanceCalculate(spaceCoordList, Xcoord + 1, Ycoord, cellSize) < spaceLimit)
            directionList.Add(Xcoord + 1); directionList.Add(Ycoord);

          if (directionList.Count > 0)
          {

            var randomIndex = rand.Next(directionList.Count / 2);

            int a = directionList[2 * randomIndex];
            int b = directionList[2 * randomIndex + 1];

            arr[a, b, 0] = arr[Xcoord, Ycoord, 0];

            spaceCoordList.AddRange(new int[2] { a, b });

            directionList.Clear();
            directionList.TrimExcess();
            draw = true;

            counter++;
            //Print(" Counter Number is : {0}", counter);
          }
          else
          {
            trycount++;
            if (trycount >= spaceCoordList.Count)
            {
              draw = true;
              //Print("trycountNumber is ={0}", trycount);
            }
          }
        }
          //LEFT  TOP
          /*
          else if (Xcoord == 0 && Ycoord == (arr.GetLength(1) - 1))
          {
          if (arr[Xcoord + 1, Ycoord] == 0)
          directionList.Add(Xcoord + 1); directionList.Add(Ycoord);

          if (arr[Xcoord, Ycoord - 1] == 0)
          directionList.Add(Xcoord); directionList.Add(Ycoord - 1);

          if (directionList.Count > 0)
          {
          var randomIndex = rand.Next(directionList.Count / 2);

          int a = directionList[2 * randomIndex];
          int b = directionList[2 * randomIndex + 1];

          Rhino.RhinoApp.WriteLine("Left Top "  +  a +  " "  +  b);
          arr[a, b] = arr[Xcoord, Ycoord];

          spaceCoordList.AddRange(new int[2] { a, b });

          directionList.Clear();
          directionList.TrimExcess();
          draw = true;

          counter++;
          //Print(" Counter Number is : {0}", counter);
          }
          else
          {
          trycount++;
          if (trycount >= spaceCoordList.Count)
          {
          draw = true;
          //Print("trycountNumber is ={0}", trycount);
          }
          }
          }
          */
          /*
          //RIGHT TOP
          else if (Xcoord == (arr.GetLength(0) - 1) && Ycoord == (arr.GetLength(1) - 1))
          {
          if (arr[Xcoord, Ycoord - 1] == 0)
          directionList.Add(Xcoord); directionList.Add(Ycoord - 1);

          if (arr[Xcoord - 1, Ycoord] == 0)
          directionList.Add(Xcoord - 1); directionList.Add(Ycoord);

          if (directionList.Count > 0)
          {
          var randomIndex = rand.Next(directionList.Count / 2);

          int a = directionList[2 * randomIndex];
          int b = directionList[2 * randomIndex + 1];
          Rhino.RhinoApp.WriteLine(" Right top "+ a + " " + b);
          arr[a, b] = arr[Xcoord, Ycoord];

          //spaceCoordList.AddRange(new int[2] { a, b });

          directionList.Clear();
          directionList.TrimExcess();
          draw = true;

          counter++;
          //Print(" Counter Number is : {0}", counter);
          }
          else
          {
          trycount++;
          if (trycount >= spaceCoordList.Count)
          {
          draw = true;
          //Print("trycountNumber is ={0}", trycount);
          }
          }
          }
          */
          //RIGHT BOTTOM
        else if (Xcoord == (arr.GetLength(0) - 1) && Ycoord == 0)
        {
          if (arr[Xcoord, Ycoord + 1, 0] == 0)
            directionList.Add(Xcoord); directionList.Add(Ycoord + 1);

          if (arr[Xcoord - 1, Ycoord, 0] == 0)
            directionList.Add(Xcoord - 1); directionList.Add(Ycoord);

          if (directionList.Count > 0)
          {
            var randomIndex = rand.Next(directionList.Count / 2);

            int a = directionList[2 * randomIndex];
            int b = directionList[2 * randomIndex + 1];

            arr[a, b, 0] = arr[Xcoord, Ycoord, 0];

            spaceCoordList.AddRange(new int[2] { a, b });

            directionList.Clear();
            directionList.TrimExcess();

            draw = true;
            counter++;
            //Print(" Counter Number is : {0}", counter);
          }
          else
          {
            trycount++;
            if (trycount >= spaceCoordList.Count)
            {
              draw = true;
              //Print("trycountNumber is ={0}", trycount);
            }
          }
        }
        /* EDGE CONDITIONS */
      }
    }

  }




    /* Instead of wrting methods seperately in main program, it is better to use class based
     informations to keep things organized, we are not yet transsferentrance methods here but we created the str.*/

    /*
    public class Zone
    {
        public string Name;
        public int SpaceLimit;
        public Int16 SpaceSize;
        public int Counter;
        public List<Int16> SpaceList;

        public void Describe()
        {
            Console.WriteLine("Hey this zone is{ 0} ", Name);
        }

        public Zone()
        {
           // SpaceList = new List<int>();
        }

        public Zone(string name, int spaceLimit,int spacesize,int counter, List<int> SpaceList)
        :this()
        {
        }
        static void InitializeZeroMatrice() { }
        static void startZones() { }
        public void SpreadZones() { }

    }
    */
# ---------- end c_script_8 ----------
panel_186 = Panel(c_script_8.out)

# ---- group: Visualize as 3D Boxes
number_slider_58 = Slider(0.742, range=0..1)
create_material_33 = CreateMaterial(Diffuse=colour_swatch_4, Specular=RGB(255, 255, 255), Emission=RGB(0, 0, 0), Transparency=number_slider_58, Shine=0)
create_material_34 = CreateMaterial(Diffuse=colour_swatch, Specular=RGB(255, 255, 255), Emission=RGB(0, 0, 0), Transparency=number_slider_58, Shine=0)
create_material_35 = CreateMaterial(Diffuse=colour_swatch_5, Specular=RGB(255, 255, 255), Emission=RGB(0, 0, 0), Transparency=number_slider_58, Shine=0)
create_material_36 = CreateMaterial(Diffuse=colour_swatch_6, Specular=RGB(255, 255, 255), Emission=RGB(0, 0, 0), Transparency=number_slider_58, Shine=0)
create_material_37 = CreateMaterial(Diffuse=colour_swatch_2, Specular=RGB(255, 255, 255), Emission=RGB(0, 0, 0), Transparency=number_slider_58, Shine=0)
create_material_38 = CreateMaterial(
    Diffuse=colour_swatch_3,
    Specular=RGB(255, 255, 255),
    Emission=RGB(0, 0, 0),
    Transparency=Slider(0.624, range=0..1),
    Shine=0)
custom_preview_31 = CustomPreview(Geometry=c_script_8.EntranceBoxes, Material=create_material_33)
custom_preview_32 = CustomPreview(Geometry=c_script_8.CommonBoxes, Material=create_material_35)
custom_preview_33 = CustomPreview(Geometry=c_script_8.Y, Material=create_material_34)
custom_preview_34 = CustomPreview(Geometry=c_script_8.WetAreaBoxes, Material=create_material_36)
custom_preview_35 = CustomPreview(Geometry=c_script_8.K, Material=create_material_37)
custom_preview_36 = CustomPreview(Geometry=c_script_8.W, Material=create_material_38)

# ----
custom_preview_37 = CustomPreview(Geometry=c_script_8.Furnitures, Material=create_material_13)  # disabled
custom_preview_38 = CustomPreview(Geometry=c_script_8.FurnituresMargins, Material=create_material_14)  # disabled
list_length_19 = ListLength(List=c_script_8.EntranceBoxes)
list_length_20 = ListLength(List=c_script_8.CommonBoxes)
list_length_21 = ListLength(List=c_script_8.W)
list_length_22 = ListLength(List=c_script_8.WetAreaBoxes)
list_length_23 = ListLength(List=c_script_8.Y)
list_length_24 = ListLength(List=c_script_8.K)
multiplication_44 = Multiplication(A=list_length_20, B=division_4)
multiplication_45 = Multiplication(A=list_length_19, B=division_4)
multiplication_46 = Multiplication(A=list_length_21, B=division_4)
multiplication_47 = Multiplication(A=list_length_22, B=division_4)
multiplication_48 = Multiplication(A=list_length_23, B=division_4)
multiplication_49 = Multiplication(A=list_length_24, B=division_4)
panel_187 = Panel(multiplication_45)
panel_188 = Panel(multiplication_46)
panel_189 = Panel(multiplication_44)
panel_190 = Panel(multiplication_47)
panel_191 = Panel(multiplication_48)
panel_192 = Panel(multiplication_49)
concatenate_22 = Concatenate(Fragment_A=" Empty Space= ", Fragment_B=panel_188, Fragment_C="m2 ")
concatenate_23 = Concatenate(Fragment_A=" Entrance = ", Fragment_B=panel_187, Fragment_C="m2 ")
concatenate_24 = Concatenate(Fragment_A=" CommonArea = ", Fragment_B=panel_189, Fragment_C="m2 ")
concatenate_25 = Concatenate(Fragment_A="Wet Area = ", Fragment_B=panel_190, Fragment_C="m2 ")
concatenate_26 = Concatenate(Fragment_A=" Kitchen = ", Fragment_B=panel_191, Fragment_C="m2 ")
concatenate_27 = Concatenate(Fragment_A=" Common Area = ", Fragment_B=panel_192, Fragment_C=" m2 ")
panel_193 = Panel(concatenate_22)
panel_194 = Panel(concatenate_23)
panel_195 = Panel(concatenate_24)
panel_196 = Panel(concatenate_25)
panel_197 = Panel(concatenate_26)
panel_198 = Panel(concatenate_27)
text_tag_3d_22 = TextTag3D(Location="0,-50", Text=concatenate_23, Size=number_slider_22, Colour=colour_swatch_4, Justification=7)
text_tag_3d_23 = TextTag3D(Location="0,-80", Text=concatenate_24, Size=number_slider_22, Colour=colour_swatch_5, Justification=7)
text_tag_3d_24 = TextTag3D(Location="0,-140", Text=concatenate_26, Size=number_slider_22, Colour=colour_swatch, Justification=7)
text_tag_3d_25 = TextTag3D(Location="0,-110", Text=concatenate_25, Size=number_slider_22, Colour=colour_swatch_6, Justification=7)
text_tag_3d_26 = TextTag3D(Location="0,-140", Text=concatenate_22, Size=number_slider_22, Colour=colour_swatch_3, Justification=7)
text_tag_3d_27 = TextTag3D(Location="240,-170", Text=concatenate_27, Size=number_slider_22, Colour=colour_swatch_2, Justification=7)
mass_addition_4 = MassAddition(Input=[multiplication_44, multiplication_45, multiplication_47, multiplication_48, multiplication_49, multiplication_46])  # -> flatten(Result), PartialResults
list_item_7 = ListItem(List=mass_addition_4.Result, Index=Slider(1, range=0..1), Wrap=True)
panel_199 = Panel(list_item_7)
concatenate_28 = Concatenate(Fragment_A=" Total Area =", Fragment_B=panel_199, Fragment_C="m2 ")
panel_200 = Panel(concatenate_28)
text_tag_3d_28 = TextTag3D(Location="240,-100", Text=concatenate_28, Size=number_slider_22, Justification=7)
